% Simulink data dictionary Objsel_Data.sldd

ACC_Infout = Simulink.Bus()
  ACC_TargetID: uint8
  ACC_Mode: uint8

AEB_NoFunctionIn = Simulink.Parameter(0, StorageClass="ExportedGlobal", DataType="single")

AEB_ObjData = Simulink.Bus()
  AEB_Obj_ID: uint8
  AEB_Obj_Type: uint8
  AEB_Obj_Stat: uint8
  AEB_Obj_Behavior: uint8
  AEB_FusType: uint8
  AEB_ObjLaneAssign: uint8
  AEB_Obj_XPosn_m: single
  AEB_Obj_YPosn_m: single
  AEB_Obj_XPos_Quality: single
  AEB_Obj_YPos_Quality: single
  AEB_Obj_XSpd_mps: single
  AEB_Obj_YSpd_mps: single
  AEB_Obj_XSpd_Quality: single
  AEB_Obj_YSpd_Quality: single
  AEB_Obj_XAbsSpd_mps: single
  AEB_Obj_YAbsSpd_mps: single
  AEB_Obj_Length_m: single
  AEB_Obj_Width_m: single
  AEB_Obj_Height_m: single
  AEB_Obj_XAccl_mps2: single
  AEB_Obj_YAccl_mps2: single
  AEB_Obj_XAbsAccl_mps2: single
  AEB_Obj_YAbsAccl_mps2: single
  AEB_Obj_Conf: uint8
  AEB_Obj_TTC_s: single
  AEB_Obj_Ag_rads: single
  AEB_Obj_HeadAg_rads: single

AEB_SoftVerion = Simulink.Parameter(1.0020240221, StorageClass="ExportedGlobal", DataType="single")

AccelPdlOvRid_ADT = Simulink.AliasType(BaseType="boolean")  % 油门踏板override状态
  % 0: Inactive
  % 1: Active
  % Unit:

AccelPdlPos_ADT = Simulink.AliasType(BaseType="uint8")  % 油门踏板开度
  % 0~FFh
  % Unit: per

AccelPdlPosvalid_ADT = Simulink.AliasType(BaseType="boolean")  % valid flag for the signal AccelPedal Status
  % 0x0: INVALID
  % 0x1: VALID
  % Unit:

AccelPdlSts_ADT = Simulink.AliasType(BaseType="boolean")  % 油门踏板状态
  % 0x0: OFF
  % 0x1: ON
  % Unit:

ActualGearValid_ADT = Simulink.AliasType(BaseType="boolean")  % 实际档位有效信号
  % 0x0: INVALID
  % 0x1: VALID
  % Unit:

ActualGear_ADT = Simulink.AliasType(BaseType="uint8")  % 变速箱实际档位
  % 0x0: unknow/default
  % 0x1: P
  % 0x2: R
  % 0x3: N
  % 0x4: D
  % 0x5: Gear 1
  % 0x6: Gear 2
  % 0x7: Gear 3
  % 0x8: Gear 4
  % 0x9: Gear 5
  % 0x10: Gear 6
  % 0x15: Invalid
  % Unit:

BrakePedalSts_ADT = Simulink.AliasType(BaseType="uint8")  % Brake pedal status
  % 0x0:
  % NOT_PRESSED_INIT_DEFAULT
  % 0x1: PRESSED
  % 0x2: RESERVED
  % 0x3: ERROR
  % Unit:

BreakCtlSts_ADT = Simulink.AliasType(BaseType="uint8")  % 刹车控制状态
  % 0x0 : 禁止控制
  % 0x1 : 可以控制
  % 0x2 : ACC控制
  % 0x3 : AEB控制
  % Unit:

CenterOfGravityFullLoad_ADT = Simulink.AliasType(BaseType="uint16", HeaderFile="Rte_Type.h")  % 质心高度（满载）
  % Unit: mm

CenterOfGravityNoLoad_ADT = Simulink.AliasType(BaseType="uint16", HeaderFile="Rte_Type.h")  % 质心高度（空载）
  % Unit: mm

ChangeLaneLeverSts_ADT = Simulink.AliasType(BaseType="uint8")  % 拨杆状态
  % 0x0: OFF
  % 0x1: Change lane to left
  % 0x2: Change lane to Right
  % 0x3: Reserve
  % Unit:

Chassis_Struct = Simulink.Bus(DataScope="Imported", HeaderFile="common_struct.h")
  timeStamp: int64_t
  indicatedSpd_kph: single
  vehicleSpd: single
  vehicleSpdValid: bool_t
  wheelSpdFL: single
  wheelSpdFLValid: bool_t
  wheelSpdFR: single
  wheelSpdFRValid: bool_t
  wheelSpdRL: single
  wheelSpdRLValid: bool_t
  wheelSpdRR: single
  wheelSpdRRValid: bool_t
  wheelDirectionFL: bool_t
  wheelDirectionFLValid: bool_t
  wheelDirectionFR: bool_t
  wheelDirectionFRValid: bool_t
  wheelDirectionRL: bool_t
  wheelDirectionRLValid: bool_t
  wheelDirectionRR: bool_t
  wheelDirectionRRValid: bool_t
  vehicleStandstill: uint8_t
  vehicleStandstillValid: bool_t
  vehicleMovingDir: uint8_t
  vehLongAccValid: bool_t
  vehLongAcc: single
  vehLatAccValid: bool_t
  vehLatAcc: single
  vehYawRateValid: bool_t
  vehYawRate: single
  IBSValid: uint8_t
  ABSActive: uint8_t
  HACActive: uint8_t
  EBDActive: uint8_t
  AVHActive: uint8_t
  AVHValid: bool_t
  TCSStatus: uint8_t
  TCSMode: uint8_t
  TCSEnable: uint8_t
  TCSActive: uint8_t
  VSEStatus: uint8_t
  VSEMode: uint8_t
  HDCStatus: uint8_t
  brakePedalSts: uint8_t
  brakePedalPos: single
  brakePedalValid: bool_t
  masterCylindPress: single
  masterCylindPressValid: bool_t
  EPTBrkStatus: uint8_t
  EPTBrkValid: bool_t
  EPBStatus: uint8_t
  accelPdlPos: single
  accelPdlPosValid: bool_t
  accelPdlOvRid: bool_t
  actualGear: uint8_t
  shiftLeverPos: uint8_t
  PTReady: uint8_t
  motorSpd_rpm: single
  motorMaxDec: single
  motorMaxDecValid: bool_t
  motorRecTorq: single
  motorTorqMode: uint8_t
  vehicleTorque: single
  steerAngle_deg: single
  steerAngleValid: bool_t
  steerAngleSpd_deg: single
  driverSteerTorq: single
  driverSteerTorqValid: bool_t
  driverOverride: uint8_t
  EPSSteerCurrentFbk: single
  EPSSteerCurrentFbkValid: bool_t
  EPSLKAResponFbk: uint8_t
  EPSDriveMode: uint8_t
  EPSAngleCtrlSts: uint8_t
  EPSTorqCtrlSts: uint8_t
  EPSStatus: uint8_t
  EPSFault: uint16_t

DoorSts_ADT = Simulink.AliasType(BaseType="uint8")  % 四门两盖、加油口、充电口状态
  % bit0: Driver door state
  % bit1: Passenger door state
  % bit2: rear left door state
  % bit3: rear right door state
  % bit4:tail gate state
  % bit5:Engine Hood state
  % Bit6：加油口
  % Bit7：充电口
  % 1=open,0=close
  % Unit:

DriveMode_ADT = Simulink.AliasType(BaseType="uint8")  % Indicates the driving mode of the vehicle
  % 0x0: ECO
  % 0x1: COMFORT
  % 0x2: SPORT
  % 0x3: Offroad
  % 0x4~0x7: Reserved
  % Unit:

DriveReady_ADT = Simulink.AliasType(BaseType="uint8")  % Powertrain ready.
  % 0x0: Not_Ready
  % 0x1: Ready_Local
  % 0x2: Ready_Romote
  % 0x3: Fault
  % Unit:

DrvAccelAction_ADT = Simulink.AliasType(BaseType="uint16")  % 驾驶员加速动作
  % 0：Default;
  % 1:  no Acceleration;
  % 2:  Acceleration;
  % 3：Unknow;
  % Unit:

DrvBrakeAction_ADT = Simulink.AliasType(BaseType="uint16")  % 驾驶员制动动作
  % 0：Default;
  % 1:  no Brake;
  % 2:  Brake;
  % 3：Unknow;
  % Unit:

DrvDistractionSts_ADT = Simulink.AliasType(BaseType="uint8")  % 驾驶员分心检测
  % 0：Default;
  % 1:  not Distraction;
  % 2:  Distraction;
  % 3：Unknow;
  % Unit:

DrvFatigueSts_ADT = Simulink.AliasType(BaseType="uint8")  % 驾驶员疲劳状态
  % 0：Default;
  % 1:  not Fatigue;
  % 2:  Fatigue;
  % 3：Unknow;
  % Unit:

DrvHandsOff_ADT = Simulink.AliasType(BaseType="uint8")  % 驾驶员脱手检测
  % 0：Default;
  % 1: HandsOff;
  % 2: HandsOn;
  % 3: Unknow
  % Unit:

DrvPresentSts_ADT = Simulink.AliasType(BaseType="uint8")  % 驾驶员是否存在
  % 0：Default;
  % 1:  not Present;
  % 2:  Present;
  % 3：Unknow;
  % Unit:

DrvRapidAccelAction_ADT = Simulink.AliasType(BaseType="uint16")  % 驾驶员急加速动作
  % 0：Default;
  % 1:  no Rapid Aeecleration;
  % 2:  Rapid Acceleration;
  % 3：Unknow;
  % Unit:

DrvStatus_ADT = Simulink.AliasType(BaseType="uint8")  % 驾驶员状态信息，备用信号，暂时不定义内容
  % Unit:

DrvSteerAglAction_ADT = Simulink.AliasType(BaseType="uint16")  % 驾驶员大转角动作
  % 0：Default;
  % 1:  no big Steering Angle;
  % 2:  big Steering Angle;
  % 3：Unknow;
  % Unit:

DrvSteerOveride_ADT = Simulink.AliasType(BaseType="uint16")  % 驾驶员转向优先
  % 0：Default;
  % 1:  no Steering Overide;
  % 2:  Steering Overdie;
  % 3：Unknow;
  % Unit:

DrvSteerSpdAction_ADT = Simulink.AliasType(BaseType="uint16")  % 驾驶员快速转向动作
  % 0：Default;
  % 1:  not Steering Speed;
  % 2:  Steering Speed;
  % 3：Unknow;
  % Unit:

DrvTurnLeftAction_ADT = Simulink.AliasType(BaseType="uint16")  % 驾驶员左转动作
  % 0：Default;
  % 1:  no left Turn;
  % 2: Turn left;
  % 3：Unknow;
  % Unit:

DrvTurnRightAction_ADT = Simulink.AliasType(BaseType="uint16")  % 驾驶员右转动作
  % 0：Default;
  % 1:  no right Turn;
  % 2:  Turn right;
  % 3：Unknow;
  % Unit:

EPSCalibratedSts_ADT = Simulink.AliasType(BaseType="boolean")  % EPS_SAS， EPS 转角标定状态
  % 0x0:
  % NOT_CALIBRATED
  % 0x1: CALIBRATED
  % Unit:

EPSSasFailure_ADT = Simulink.AliasType(BaseType="boolean")  % EPS_SAS， EPS 转角是否失效
  % 0x0: NORMAL
  % 0x1: FAULT
  % Unit:

EPSSasSteerAngSpdValid_ADT = Simulink.AliasType(BaseType="boolean")  % EPS_SAS， EPS 转角速度有效性。
  % 0x0: INVALID
  % 0x1: VALID
  % Unit:

EPSSasSteerAngValid_ADT = Simulink.AliasType(BaseType="boolean")  % EPS_SAS， EPS 转角有效性
  % 0x0: INVALID
  % 0x1: VALID
  % Unit:

EdgeData_Struct = Simulink.Bus(DataScope="Imported", HeaderFile="common_struct.h")
  edgeId: uint32_t
  edgePosition: uint8_t
  edgeStart: single
  edgeEnd: single
  edgeEndOutRange: bool_t
  edgeStartOutRange: bool_t
  edgeSegNum: uint8_t
  edgeSegs: Bus: EdgeSeg_Struct[3]

EdgeSeg_Struct = Simulink.Bus(DataScope="Imported", HeaderFile="common_struct.h")
  edgeSegId: uint32_t
  edgeSegValid: bool_t
  sensorType: uint16_t
  edgeType: uint8_t
  edgeSegStart: single
  edgeSegEnd: single
  lineC0: single
  lineC0Std: single
  lineC1: single
  lineC1Std: single
  lineC2: single
  lineC2Std: single
  lineC3: single
  lineC3Std: single
  edgeHeight: single

EgoLatAccelEstSts_ADT = Simulink.AliasType(BaseType="uint8")  % 自车横向加速度状态
  % 0x0:Unknow;
  % 0x1:bad;
  % 0x2:normal;
  % 0x3:middle;
  % 0x4:good;
  % 0x5:best
  % Unit:

EgoLatAccelEst_ADT = Simulink.AliasType(BaseType="single")  % 自车横向加速度
  % Unit: mps2

EgoLatAccel_ADT = Simulink.AliasType(BaseType="single")  % 自车横向加速度
  % Unit: mps2

EgoLongiAccelEstSts_ADT = Simulink.AliasType(BaseType="uint8")  % 自车纵向加速度状态
  % 0x0:Unknow;
  % 0x1:bad;
  % 0x2:normal;
  % 0x3:middle;
  % 0x4:good;
  % 0x5:best
  % Unit:

EgoLongiAccelEst_ADT = Simulink.AliasType(BaseType="single")  % 自车纵向加速度
  % Unit: mps2

EgoLongiAccel_ADT = Simulink.AliasType(BaseType="single")  % 自车纵向加速度
  % Unit: mps2

EgoSituation_ADT = Simulink.AliasType(BaseType="uint16")  % Ego Situation Detection results
  % Unit:

EgoTrajCurvature_ADT = Simulink.AliasType(BaseType="single")  % 本车轨迹曲率
  % Unit:

Extension_input_Bus = Simulink.Bus()
  SAS_SteeringWheelAngle: single
  SAS_SteeringWheelSpeedSign: uint8
  SAS_SteeringWheelSpeed: single
  YawRate: single
  AEB_Intervention_ESP: uint8
  ABS_VehicleSpeed: single
  ABS_DrivingDirection: uint8
  ABS_MasterCylinderPressure: single
  AX1: single
  AY1: single

FrontOverhang_ADT = Simulink.AliasType(BaseType="uint16", HeaderFile="Rte_Type.h")  % 前悬长
  % Unit: mm

FrontTireEdgeWidth_ADT = Simulink.AliasType(BaseType="uint16", HeaderFile="Rte_Type.h")  % 前轮外沿宽度
  % Unit: mm

FrontWheelTread_ADT = Simulink.AliasType(BaseType="uint16", HeaderFile="Rte_Type.h")  % 前轮距
  % Unit: mm

IPBInputRodStrokeSts_ADT = Simulink.AliasType(BaseType="boolean")  % Indicate inputRod stroke status'
  % 0x0: Invalid_default
  % 0x1: valid_init
  % Unit:

IPBInputRodStroke_ADT = Simulink.AliasType(BaseType="single")  % Indicate inputRod stroke
  % Indicate inputRod stroke
  % Unit: mm

IPBSysSts_ADT = Simulink.AliasType(BaseType="uint8")  % Pedal feeling state
  % 0x0: BBF_FullSys/Init/Default
  % 0x1: BBF_DegradedPedalFeel
  % 0x2: BBF_CircuitSperation
  % 0x3: BBF_C1/2BoostOnly
  % 0x4: HydBack w/ act / HydBack w/o act
  % 0x5~0x7: reserved
  % Unit:

InnerWheelAngleRangeFullLoad_ADT = Simulink.AliasType(BaseType="single", HeaderFile="Rte_Type.h")  % 内轮最大转角（满载）
  % Unit: deg

InnerWheelAngleRangeNoLoad_ADT = Simulink.AliasType(BaseType="single", HeaderFile="Rte_Type.h")  % 内轮最大转角（空载）
  % Unit: deg

LaneAttrSeg_Struct = Simulink.Bus(DataScope="Imported", HeaderFile="common_struct.h")
  laneSegStart: single
  laneSegEnd: single
  laneAttrSegValid: bool_t
  laneSegType: uint8_t
  laneSegSource: uint8_t
  maxLaneSpeed: single
  minLaneSpeed: single
  recLaneSpeed: single
  laneSegTransitType: uint8_t

LaneData_Struct = Simulink.Bus(DataScope="Imported", HeaderFile="common_struct.h")
  laneId: uint8
  laneDirection: uint8_t
  lanePosition: uint8_t
  laneStart: single
  laneEnd: single
  laneStartOutRange: bool_t
  laneEndOutRange: bool_t
  laneTTLC: single
  laneTurn: uint8_t
  laneLeftLineNum: uint8_t
  laneLeftLineIDs: uint32_t[2]
  laneRightLineNum: uint8_t
  laneRightLineIDs: uint32_t[2]
  laneSegNum: uint8_t
  laneSegs: Bus: LaneSeg_Struct[3]
  laneAttrSegNum: uint8_t
  laneAttrSegs: Bus: LaneAttrSeg_Struct[3]

LaneSeg_Struct = Simulink.Bus(DataScope="Imported", HeaderFile="common_struct.h")
  laneSegId: uint64_t
  laneSegValid: bool_t
  laneSegWidth: single
  laneSegStart: single
  laneSegEnd: single
  laneSegIdx: uint8_t
  centerLineType: uint8_t
  sensorType: uint16_t
  laneC0: single
  laneC0Std: single
  laneC1: single
  laneC1Std: single
  laneC2: single
  laneC2Std: single
  laneC3: single
  laneC3Std: single

LatAValSts_ADT = Simulink.AliasType(BaseType="uint8")  % Lateral acceleration value status
  % 0x0: Invalid
  % 0x1: Valid
  % 0x2: Reserved
  % 0x3: Initializing
  % Unit:

LgtAValSts_ADT = Simulink.AliasType(BaseType="uint8")  % Longitudinal acceleration value status
  % 0x0: Invalid
  % 0x1: Valid
  % 0x2: Reserved
  % 0x3: Initializing
  % Unit:

LineAttrSeg_Struct = Simulink.Bus(DataScope="Imported", HeaderFile="common_struct.h")
  lineSegAttrValid: bool_t
  lineSegStart: single
  lineSegEnd: single
  lineSegType: uint8_t
  lineSegColor: uint8_t

LineData_Struct = Simulink.Bus(DataScope="Imported", HeaderFile="common_struct.h")
  lineId: uint32_t
  linePosition: uint8_t
  lineStart: single
  lineEnd: single
  lineStartOutRange: bool_t
  lineEndOutRange: bool_t
  lineSegNum: uint8_t
  lineSegs: Bus: LineSeg_Struct[3]
  lineAttrSegNum: uint8_t
  lineAttrSegs: Bus: LineAttrSeg_Struct[3]

LineSeg_Struct = Simulink.Bus(DataScope="Imported", HeaderFile="common_struct.h")
  lineSegId: uint32_t
  lineSegValid: bool_t
  sensorType: uint16_t
  lineSegWidth: single
  lineSegStart: single
  lineSegEnd: single
  lineC0: single
  lineC0Std: single
  lineC1: single
  lineC1Std: single
  lineC2: single
  lineC2Std: single
  lineC3: single
  lineC3Std: single

Mass_Veh_ADT = Simulink.AliasType(BaseType="single", HeaderFile="Rte_Type.h")  % 整车质量
  % Unit: Kg

MasterCylinderPresSts_ADT = Simulink.AliasType(BaseType="boolean")  % Indicate plunger pressure status
  % 0x0: Invalid_default
  % 0x1: valid_init
  % Unit:

MasterCylinderPres_ADT = Simulink.AliasType(BaseType="single")  % 主动制动压力
  % Unit: bar

Meas_Boudingbox_Calculate = Simulink.Signal(StorageClass="ExportedGlobal", DataType="boolean", Dimensions=[32 1])
Meas_ID_Long = Simulink.Signal(StorageClass="ExportedGlobal", DataType="uint8")
Meas_Index_Left_Obj = Simulink.Signal(StorageClass="ExportedGlobal", DataType="double")
Meas_Index_Right_Obj = Simulink.Signal(StorageClass="ExportedGlobal", DataType="double")
Meas_LongTTI = Simulink.Signal(StorageClass="ExportedGlobal", DataType="single", Dimensions=[32 1])
Meas_ObjAx = Simulink.Signal(StorageClass="ExportedGlobal", DataType="single", Dimensions=[32 1])
Meas_ObjAxabs = Simulink.Signal(StorageClass="ExportedGlobal", DataType="single", Dimensions=[32 1])
Meas_ObjAy = Simulink.Signal(StorageClass="ExportedGlobal", DataType="single", Dimensions=[32 1])
Meas_ObjAyabs = Simulink.Signal(StorageClass="ExportedGlobal", DataType="single", Dimensions=[32 1])
Meas_ObjCoef = Simulink.Signal(StorageClass="ExportedGlobal", DataType="uint8", Dimensions=[32 1])
Meas_ObjConfidence = Simulink.Signal(StorageClass="ExportedGlobal", DataType="uint8", Dimensions=[32 1])
Meas_ObjDx = Simulink.Signal(StorageClass="ExportedGlobal", DataType="single", Dimensions=[32 1])
Meas_ObjDxStd = Simulink.Signal(DataType="single", Dimensions=[32 1])
Meas_ObjDy = Simulink.Signal(StorageClass="ExportedGlobal", DataType="single", Dimensions=[32 1])
Meas_ObjDyStd = Simulink.Signal(StorageClass="ExportedGlobal", DataType="single", Dimensions=[32 1])
Meas_ObjHeadAngle = Simulink.Signal(StorageClass="ExportedGlobal", DataType="single", Dimensions=[32 1])
Meas_ObjID = Simulink.Signal(StorageClass="ExportedGlobal", DataType="uint8", Dimensions=[32 1])
Meas_ObjLength = Simulink.Signal(StorageClass="ExportedGlobal", DataType="single", Dimensions=[32 1])
Meas_ObjOrientation = Simulink.Signal(StorageClass="ExportedGlobal", DataType="uint8", Dimensions=[32 1])
Meas_ObjSortNum_Long = Simulink.Signal(StorageClass="ExportedGlobal", DataType="uint8")
Meas_ObjState = Simulink.Signal(StorageClass="ExportedGlobal", DataType="uint8", Dimensions=[32 1])
Meas_ObjType = Simulink.Signal(StorageClass="ExportedGlobal", DataType="uint8", Dimensions=[32 1])
Meas_ObjVx = Simulink.Signal(StorageClass="ExportedGlobal", DataType="single", Dimensions=[32 1])
Meas_ObjVxStd = Simulink.Signal(StorageClass="ExportedGlobal", DataType="single", Dimensions=[32 1])
Meas_ObjVxabs = Simulink.Signal(StorageClass="ExportedGlobal", DataType="single", Dimensions=[32 1])
Meas_ObjVy = Simulink.Signal(StorageClass="ExportedGlobal", DataType="single", Dimensions=[32 1])
Meas_ObjVyStd = Simulink.Signal(DataType="single", Dimensions=[32 1])
Meas_ObjVyabs = Simulink.Signal(StorageClass="ExportedGlobal", DataType="single", Dimensions=[32 1])
Meas_ObjWidth = Simulink.Signal(StorageClass="ExportedGlobal", DataType="single", Dimensions=[32 1])
Meas_TTCLong = Simulink.Signal(StorageClass="ExportedGlobal", DataType="single")
Meas_Utility = Simulink.Signal(StorageClass="ExportedGlobal", DataType="boolean", Dimensions=[32 1])
Meas_WeightCoef_1 = Simulink.Signal(StorageClass="ExportedGlobal", DataType="uint8", Dimensions=[32 1])
Meas_WeightCoef_2 = Simulink.Signal(StorageClass="ExportedGlobal", DataType="uint8", Dimensions=[32 1])
OFF = Simulink.Parameter(0, StorageClass="ExportedGlobal", DataType="boolean")
ON = Simulink.Parameter(1, StorageClass="ExportedGlobal", DataType="boolean")

ObjLong_Bus = Simulink.Bus()
  ID_Long: uint8
  ObjSortNum_Long: uint8
  TTCLong: single

ObjTraj_Struct = Simulink.Bus(DataScope="Imported", HeaderFile="common_struct.h")
  objID: uint16_t
  objValid: bool_t
  predTimeStamp: int64_t
  predPeriod: single
  predProb: single
  isInteractive: bool_t
  predPiority: single
  trajectoryPoints: Bus: TrajectoryPoint_Struct[30]

ObjectELK_Struct = Simulink.Bus(DataScope="Imported", HeaderFile="common_struct.h")
  timeStamp: int64_t
  objNum: uint8_t
  objELKLeft: Bus: Object_Struct
  objELKRight: Bus: Object_Struct

Object_Struct = Simulink.Bus(DataScope="Imported", HeaderFile="common_struct.h")
  objTimeStamp: int64_t
  objID: uint16_t
  objValid: bool_t
  objExitProb: single
  objIsobsProb: single
  objLifeCycle: single
  fusionType: int64_t
  objType: uint8_t
  objTypeProb: single
  dxCenter: single
  dxCenterStd: single
  dyCenter: single
  dyCenterStd: single
  dxRef: single
  dyRef: single
  refPosition: uint8_t
  dxRefSurface: single
  dyRefSurface: single
  surfacePos: uint8_t
  vxRel: single
  vyRel: single
  axRel: single
  ayRel: single
  vxRelStd: single
  vyRelStd: single
  axRelStd: single
  ayRelStd: single
  vxAbs: single
  vyAbs: single
  axAbs: single
  ayAbs: single
  vxAbsStd: single
  vyAbsStd: single
  axAbsStd: single
  ayAbsStd: single
  yawAngle: single
  yawAngleStd: single
  azimuthAngle: single
  azimuthAngleStd: single
  yawRate: single
  yawRateStd: single
  objLength: single
  objWidth: single
  objHeight: single
  objLengthStd: single
  objWidthStd: single
  objHeightStd: single
  movingStatus: uint8_t
  movingDirection: uint8_t
  lightStatus: uint16_t
  doorStatus: uint16_t
  trailerStatus: bool_t
  laneAssign: uint8_t
  laneAssociateConf: single
  laneLeftPortion: single
  laneRightPortion: single
  laneLeftConf: single
  laneRightConf: single
  objIntention: uint8_t
  objIntentionProb: single
  objTTC: single
  objLatDist2LaneCenter: single
  objLatDist2EgoCenter: single
  objPosition: uint8_t

ObjectsTraj_Struct = Simulink.Bus(DataScope="Imported", HeaderFile="common_struct.h")
  timeStamp: int64_t
  objTrajNum: uint8_t
  objTrajData: Bus: ObjTraj_Struct[32]

Objects_Struct = Simulink.Bus(DataScope="Imported", HeaderFile="common_struct.h")
  timeStamp: int64_t
  objNum: uint8_t
  objData: Bus: Object_Struct[32]

Objrebuild_Bus = Simulink.Bus()
  vxRel: single[32]
  vyRel: single[32]
  vxRelStd: single[32]
  vyRelStd: single[32]
  axRel: single[32]
  ayRel: single[32]
  axRelStd: single[32]
  ayRelStd: single[32]
  azimuthAngle: single[32]
  azimuthAngleStd: single[32]
  objLatDist2LaneCenter: single[32]
  objLatDist2EgoCenter: single[32]
  objPosition: uint8[32]

OuterWheelAngleRangeFullLoad_ADT = Simulink.AliasType(BaseType="single", HeaderFile="Rte_Type.h")  % 外轮最大转角（满载）
  % Unit: per

OuterWheelAngleRangeNoLoad_ADT = Simulink.AliasType(BaseType="single", HeaderFile="Rte_Type.h")  % 外轮最大转角（空载）
  % Unit: deg

P_DM_AcclPedalRelsAdjLv = Simulink.Parameter(4, StorageClass="ExportedGlobal", DataType="single")
P_DM_AcclPedalRelsAdjOnOff = Simulink.Parameter(1, StorageClass="ExportedGlobal", DataType="boolean")
P_DM_AcclPedalRelsAdjTi = Simulink.Parameter(-0.61, StorageClass="ExportedGlobal", DataType="single")
P_DM_DriveStatusCitySpeed = Simulink.Parameter(14, StorageClass="ExportedGlobal", DataType="single")
P_DM_DriveStatusLongAcclJude = Simulink.Parameter(-0.5, StorageClass="ExportedGlobal", DataType="single")
P_DM_DriveStatusObjSpeed = Simulink.Parameter(2.5, StorageClass="ExportedGlobal", DataType="single")
P_DM_DrvAccActvAdjLv = Simulink.Parameter(4, StorageClass="ExportedGlobal", DataType="single")
P_DM_DrvAccActvAdjOnOff = Simulink.Parameter(1, StorageClass="ExportedGlobal", DataType="boolean")
P_DM_DrvAccActvAdjTi = Simulink.Parameter(-0.58, StorageClass="ExportedGlobal", DataType="single")
P_DM_DrvAccBrkReactAdjLv = Simulink.Parameter(4, StorageClass="ExportedGlobal", DataType="single")
P_DM_DrvAccBrkReactionTiAdjTimeCount = Simulink.Parameter(0.1, StorageClass="ExportedGlobal", DataType="single")
P_DM_DrvAccBrkReactionTiAdjUpTime = Simulink.Parameter(1, StorageClass="ExportedGlobal", DataType="single")
P_DM_DrvAccBrkReationTiAdjLookUpX = Simulink.Parameter([-3 -2 -1 0], StorageClass="ExportedGlobal", DataType="single")
P_DM_DrvAccBrkReationTiAdjLookUpY = Simulink.Parameter([-0.38 -0.38 -0.48 -0.48], StorageClass="ExportedGlobal", DataType="single")
P_DM_DrvAccBrklReactionTimeOnOff = Simulink.Parameter(1, StorageClass="ExportedGlobal", DataType="boolean")
P_DM_DrvAcclPedlPosnRatAdjLv = Simulink.Parameter(4, StorageClass="ExportedGlobal", DataType="single")
P_DM_DrvAcclPedlPosnRatAdjOnOff = Simulink.Parameter(1, StorageClass="ExportedGlobal", DataType="boolean")
P_DM_DrvAcclPedlPosnRatAdjTi = Simulink.Parameter(-0.76, StorageClass="ExportedGlobal", DataType="single")
P_DM_DrvAcclReactAdjLv = Simulink.Parameter(4, StorageClass="ExportedGlobal", DataType="single")
P_DM_DrvAcclReactionTiAdjUpTime = Simulink.Parameter(1, StorageClass="ExportedGlobal")
P_DM_DrvAcclReationTiAdjLookUpX = Simulink.Parameter([0 0.5 2 3], StorageClass="ExportedGlobal", DataType="single")
P_DM_DrvAcclReationTiAdjLookUpY = Simulink.Parameter([0 0 -0.48 -0.48], StorageClass="ExportedGlobal", DataType="single")
P_DM_DrvBrakingOffTi = Simulink.Parameter(10, StorageClass="ExportedGlobal", DataType="single")
P_DM_DrvBrakingOnOff = Simulink.Parameter(1, StorageClass="ExportedGlobal", DataType="boolean")
P_DM_DrvCrvtCalcWeightFactor = Simulink.Parameter([0 1], StorageClass="ExportedGlobal", DataType="single")
P_DM_DrvDeclToTarAdjLv = Simulink.Parameter(4, StorageClass="ExportedGlobal", DataType="single")
P_DM_DrvDeclToTarAdjTi = Simulink.Parameter(-0.98, StorageClass="ExportedGlobal", DataType="single")
P_DM_DrvDeclToTarDelayTi = Simulink.Parameter(1, StorageClass="ExportedGlobal", DataType="single")
P_DM_DrvDeclToTarObjAcclLimt = Simulink.Parameter(-3.5, StorageClass="ExportedGlobal", DataType="single")
P_DM_DrvDeclToTarObjOnOff = Simulink.Parameter(1, StorageClass="ExportedGlobal", DataType="boolean")
P_DM_DrvDrvAcclReactionTimeOnOff = Simulink.Parameter(1, StorageClass="ExportedGlobal", DataType="boolean")
P_DM_DrvDrvInCityAdj = Simulink.Parameter(1, StorageClass="ExportedGlobal", DataType="boolean")
P_DM_DrvDrvInCityAdjLv = Simulink.Parameter(4, StorageClass="ExportedGlobal", DataType="single")
P_DM_DrvDrvInCityAdjTi = Simulink.Parameter(-0.7, StorageClass="ExportedGlobal", DataType="single")
P_DM_DrvHighSteerAgAdjLv = Simulink.Parameter(4, StorageClass="ExportedGlobal", DataType="single")
P_DM_DrvHighSteerAgAdjOnOff = Simulink.Parameter(1, StorageClass="ExportedGlobal", DataType="boolean")
P_DM_DrvHighSteerAgAdjTi = Simulink.Parameter(-0.58, StorageClass="ExportedGlobal", DataType="single")
P_DM_DrvOvrdTakeTarAcclLimit = Simulink.Parameter(-3.5, StorageClass="ExportedGlobal", DataType="single")
P_DM_DrvOvrdTakeTarAdjLv = Simulink.Parameter(4, StorageClass="ExportedGlobal", DataType="single")
P_DM_DrvOvrdTakeTarAdjTi = Simulink.Parameter(-0.68, StorageClass="ExportedGlobal", DataType="single")
P_DM_DrvOvrdTakeTarOnOff = Simulink.Parameter(1, StorageClass="ExportedGlobal", DataType="boolean")
P_DM_DrvSatusAcclPadelRatio = Simulink.Parameter(30, StorageClass="ExportedGlobal", DataType="single")
P_DM_DrvStatusAcclInDrvAcclJudge = Simulink.Parameter(5, StorageClass="ExportedGlobal", DataType="single")
P_DM_DrvStatusAcclPedlPosnJudge = Simulink.Parameter(5, StorageClass="ExportedGlobal", DataType="single")
P_DM_DrvStatusAcclPedlRelsDelayTi = Simulink.Parameter(1.5, StorageClass="ExportedGlobal", DataType="single")
P_DM_DrvStatusDrvDeclToObj = Simulink.Parameter(-3.5, StorageClass="ExportedGlobal", DataType="single")
P_DM_DrvStatusLongAcclInAccActv = Simulink.Parameter(-1, StorageClass="ExportedGlobal", DataType="single")
P_DM_DrvStatusSteerAngleJudge = Simulink.Parameter(1.75, StorageClass="ExportedGlobal", DataType="single")
P_DM_DrvStatusSteerAngleRateJudge = Simulink.Parameter(1.5, StorageClass="ExportedGlobal", DataType="single")
P_DM_DrvVLgtForCrvtTable = Simulink.Parameter([5 7], StorageClass="ExportedGlobal", DataType="single")
P_DM_FrequencyInAEB = Simulink.Parameter(50, StorageClass="ExportedGlobal", DataType="single")
P_DM_LoPosValInDrvrStEstimr = Simulink.Parameter(1.0e-5, StorageClass="ExportedGlobal", DataType="single")
P_DM_PahSegNrInDrvrStEstimr = Simulink.Parameter(4, StorageClass="ExportedGlobal", DataType="uint8")
P_DM_PahSegTiStepAryInDrvrStEstimr = Simulink.Parameter([1 2 3 4], StorageClass="ExportedGlobal", DataType="uint8")
P_DM_VehSelfMinSpdInDrvrStEstimr = Simulink.Parameter(0.2, StorageClass="ExportedGlobal", DataType="single")
P_TA_AccTarCfmDlyEnadInTaSlection = Simulink.Parameter(1, StorageClass="ExportedGlobal", DataType="boolean")
P_TA_AccTarCfmDlyInTaSlection = Simulink.Parameter(0.7, StorageClass="ExportedGlobal", DataType="single")
P_TA_CallFrequencyInTaSlection = Simulink.Parameter(20, StorageClass="ExportedGlobal", DataType="single")
P_TA_DynWeightFactor = Simulink.Parameter([0 1], StorageClass="ExportedGlobal", DataType="single")
P_TA_DynWeightLongSpd = Simulink.Parameter([8 10], StorageClass="ExportedGlobal", DataType="single")
P_TA_MotionDataLowPassFilter = Simulink.Parameter(1, StorageClass="ExportedGlobal")
P_TA_ObjAccCalculateCalebration = Simulink.Parameter(1, StorageClass="ExportedGlobal", DataType="boolean")
P_TA_ObjAddAttrCalValue = Simulink.Parameter(1, StorageClass="ExportedGlobal", DataType="boolean")
P_TA_ObjAxLowPassFactor = Simulink.Parameter(0.05, StorageClass="ExportedGlobal", DataType="single")
P_TA_ObjAyLowPassFactor = Simulink.Parameter(0.05, StorageClass="ExportedGlobal", DataType="single")
P_TA_ObjBehaviorLatStationPara = Simulink.Parameter(0.25, StorageClass="ExportedGlobal", DataType="single")
P_TA_ObjBehaviorLongStationPara = Simulink.Parameter(0.25, StorageClass="ExportedGlobal", DataType="single")
P_TA_ObjBehaviorOnComingPara = Simulink.Parameter(-1, StorageClass="ExportedGlobal", DataType="single")
P_TA_ObjBicycleLengthPara = Simulink.Parameter(1.7, StorageClass="ExportedGlobal", DataType="single")
P_TA_ObjBicycleWidthPara = Simulink.Parameter(0.5, StorageClass="ExportedGlobal", DataType="single")
P_TA_ObjBusLengthPara = Simulink.Parameter(12, StorageClass="ExportedGlobal", DataType="single")
P_TA_ObjBusWidthPara = Simulink.Parameter(2.5, StorageClass="ExportedGlobal", DataType="single")
P_TA_ObjCarLengthPara = Simulink.Parameter(5, StorageClass="ExportedGlobal", DataType="single")
P_TA_ObjCarWidthPara = Simulink.Parameter(1.9, StorageClass="ExportedGlobal", DataType="single")
P_TA_ObjDistancebyVxandDxFactor = Simulink.Parameter(0.5, StorageClass="ExportedGlobal", DataType="single")
P_TA_ObjDistancebyVyandDyFactor = Simulink.Parameter(0.5, StorageClass="ExportedGlobal", DataType="single")
P_TA_ObjDxLowPassFactor = Simulink.Parameter(0.05, StorageClass="ExportedGlobal", DataType="single")
P_TA_ObjDxRateVarianceThredValue = Simulink.Parameter(1, StorageClass="ExportedGlobal", DataType="single")
P_TA_ObjDxSTDThredValue = Simulink.Parameter(1, StorageClass="ExportedGlobal", DataType="single")
P_TA_ObjDyLowPassFactor = Simulink.Parameter(0.05, StorageClass="ExportedGlobal", DataType="single")
P_TA_ObjDyRateVarianceThredValue = Simulink.Parameter(1, StorageClass="ExportedGlobal", DataType="single")
P_TA_ObjDySTDThredValue = Simulink.Parameter(1, StorageClass="ExportedGlobal", DataType="single")
P_TA_ObjHeadAngleDiffThred = Simulink.Parameter(0.2, StorageClass="ExportedGlobal", DataType="single")
P_TA_ObjHeadAngleLowPassFactor = Simulink.Parameter(0.05, StorageClass="ExportedGlobal", DataType="single")
P_TA_ObjHeadAngleSTDThredValue = Simulink.Parameter(1, StorageClass="ExportedGlobal", DataType="single")
P_TA_ObjLongthValidFactor = Simulink.Parameter(0.5, StorageClass="ExportedGlobal", DataType="single")
P_TA_ObjMotorBicycleLengthPara = Simulink.Parameter(2, StorageClass="ExportedGlobal", DataType="single")
P_TA_ObjMotorBicycleWidthPara = Simulink.Parameter(0.5, StorageClass="ExportedGlobal", DataType="single")
P_TA_ObjMotorVehSpdThd = Simulink.Parameter(5.56, StorageClass="ExportedGlobal", DataType="single")
P_TA_ObjPedestrainLengthPara = Simulink.Parameter(0.5, StorageClass="ExportedGlobal", DataType="single")
P_TA_ObjPedestrainSpdThd = Simulink.Parameter(2.22, StorageClass="ExportedGlobal", DataType="single")
P_TA_ObjPedestrainWidthPara = Simulink.Parameter(0.5, StorageClass="ExportedGlobal", DataType="single")
P_TA_ObjSpeedxbyVxandDxFactor = Simulink.Parameter(0.5, StorageClass="ExportedGlobal", DataType="single")
P_TA_ObjSpeedybyVyandDyFactor = Simulink.Parameter(0.5, StorageClass="ExportedGlobal", DataType="single")
P_TA_ObjTruckLengthPara = Simulink.Parameter(12, StorageClass="ExportedGlobal", DataType="single")
P_TA_ObjTruckWidthPara = Simulink.Parameter(2.5, StorageClass="ExportedGlobal", DataType="single")
P_TA_ObjVxLowPassFactor = Simulink.Parameter(0.05, StorageClass="ExportedGlobal", DataType="single")
P_TA_ObjVxSTDThredValue = Simulink.Parameter(1, StorageClass="ExportedGlobal", DataType="single")
P_TA_ObjVxVarianceThredValue = Simulink.Parameter(1, StorageClass="ExportedGlobal", DataType="single")
P_TA_ObjVyLowPassFactor = Simulink.Parameter(0.05, StorageClass="ExportedGlobal", DataType="single")
P_TA_ObjVySTDThredValue = Simulink.Parameter(1, StorageClass="ExportedGlobal", DataType="single")
P_TA_ObjVyVarianceThredValue = Simulink.Parameter(1, StorageClass="ExportedGlobal", DataType="single")
P_TA_ObjWidthValidFactor = Simulink.Parameter(0.3, StorageClass="ExportedGlobal", DataType="single")
P_TA_ObjdxRangetheMax = Simulink.Parameter(120, StorageClass="ExportedGlobal", DataType="single")
P_TA_ObjdxRangetheMin = Simulink.Parameter(0, StorageClass="ExportedGlobal", DataType="single")
P_TA_ObjdyRangetheMax = Simulink.Parameter(20, StorageClass="ExportedGlobal", DataType="single")
P_TA_ObjdyRangetheMin = Simulink.Parameter(-20, StorageClass="ExportedGlobal", DataType="single")
P_TA_PinionAgRateFilConInAsyEvlrCritEve = Simulink.Parameter(0.2, StorageClass="ExportedGlobal", DataType="single")
P_TA_PrmForLaneWidthThred = Simulink.Parameter(3.75, StorageClass="ExportedGlobal", DataType="single")
P_TA_PrmForLatObjLatSpdThred = Simulink.Parameter(0.25, StorageClass="ExportedGlobal", DataType="single")
P_TA_PrmForLatObjNumber = Simulink.Parameter(10, StorageClass="ExportedGlobal", DataType="uint8")
P_TA_PrmForMotorSpdThred = Simulink.Parameter(6.94, StorageClass="ExportedGlobal", DataType="single")
P_TA_PrmForObjDisThrd = Simulink.Parameter(0.2, StorageClass="ExportedGlobal", DataType="single")
P_TA_PrmForObjSelectDxThred = Simulink.Parameter(5, StorageClass="ExportedGlobal", DataType="single")
P_TA_PrmForObjSelectDyOffset = Simulink.Parameter(0.25, StorageClass="ExportedGlobal", DataType="single")
P_TA_PrmForObjSpdStationary = Simulink.Parameter(0.25, StorageClass="ExportedGlobal", DataType="single")
P_TA_PrmForOverlapCalSelect = Simulink.Parameter(0, StorageClass="ExportedGlobal", DataType="uint8")
P_TA_PrmForOverlapLongThrd = Simulink.Parameter(5, StorageClass="ExportedGlobal", DataType="single")
P_TA_PrmForSteerRatio = Simulink.Parameter(16.18, StorageClass="ExportedGlobal", DataType="single")
P_TA_PrmForTTCalDistanceOffset = Simulink.Parameter(5, StorageClass="ExportedGlobal", DataType="single")
P_TA_PrmForVehBicycleMdlAxleDistFrnt = Simulink.Parameter(1.331, StorageClass="ExportedGlobal", DataType="single")
P_TA_PrmForVehBicycleMdlAxleDistRe = Simulink.Parameter(1.419, StorageClass="ExportedGlobal", DataType="single")
P_TA_PrmForVehBicycleMdlCornrgStfnFrnt = Simulink.Parameter(99471, StorageClass="ExportedGlobal", DataType="single")
P_TA_PrmForVehBicycleMdlCornrgStfnRe = Simulink.Parameter(99471, StorageClass="ExportedGlobal", DataType="single")
P_TA_PrmForVehLongth = Simulink.Parameter(4.49, StorageClass="ExportedGlobal", DataType="single")
P_TA_PrmForVehRearAxleDisttoFrnt = Simulink.Parameter(3.606, StorageClass="ExportedGlobal", DataType="single")
P_TA_PrmForVehRearAxleDisttoRear = Simulink.Parameter(0.884, StorageClass="ExportedGlobal", DataType="single")
P_TA_PrmForVehSpdStationary = Simulink.Parameter(0.25, StorageClass="ExportedGlobal", DataType="single")
P_TA_PrmForVehSteerWhlAgRat = Simulink.Parameter(16.18, StorageClass="ExportedGlobal", DataType="single")
P_TA_PrmForVehWhlBase = Simulink.Parameter(2.75, StorageClass="ExportedGlobal", DataType="single")
P_TA_PrmForVehWholeWeight = Simulink.Parameter(1890, StorageClass="ExportedGlobal", DataType="single")
P_TA_PrmForVehWidth = Simulink.Parameter(1.874, StorageClass="ExportedGlobal", DataType="single")
P_TA_SftyArUpprLimForTi = Simulink.Parameter(3, StorageClass="ExportedGlobal", DataType="single")
P_TA_SpdThdInAsyEvlrCritEve = Simulink.Parameter(0.25, StorageClass="ExportedGlobal", DataType="single")
P_TA_TTILowerLimitNegative = Simulink.Parameter(-100, StorageClass="ExportedGlobal", DataType="single")
P_TA_TTIUpperLimiPositive = Simulink.Parameter(100, StorageClass="ExportedGlobal", DataType="single")
P_TA_TTIValidNumber = Simulink.Parameter(10, StorageClass="ExportedGlobal", DataType="single")
P_TA_TiLowrLimInAsyEvlrCritEve = Simulink.Parameter(-100, StorageClass="ExportedGlobal", DataType="single")
P_TA_TiUpprLimInAsyEvlrCritEve = Simulink.Parameter(100, StorageClass="ExportedGlobal", DataType="single")
P_TA_TimegapThred = Simulink.Parameter(3, StorageClass="ExportedGlobal", DataType="single")

PahEstimn = Simulink.Bus()
  CtrlAryLat: single[4]
  CtrlAryLgt: single[4]
  TiAry: single[2]

ProtocolVersion_ADT = Simulink.AliasType(BaseType="uint8")  % Protocol Version
  % Unit:

RainIntensity_ADT = Simulink.AliasType(BaseType="uint8")  % 雨量
  % 0x0:Rain_Undefined
  % 0x1:Rain_Level1
  % 0x2:Rain_Level2
  % 0x3:Rain_Level3
  % 0x4:Rain_Level4
  % 0x5:Rain_Level5
  % 0x6:Rain_Reserved
  % Unit:

RearAxleSlipAngle_ADT = Simulink.AliasType(BaseType="single")  % 后轴侧偏角
  % Unit: deg

RearOverhang_ADT = Simulink.AliasType(BaseType="uint16", HeaderFile="Rte_Type.h")  % 后悬长
  % Unit: mm

RearTireEdgeWidth_ADT = Simulink.AliasType(BaseType="uint16", HeaderFile="Rte_Type.h")  % 后轮外沿宽度
  % Unit: mm

RearWheelTread_ADT = Simulink.AliasType(BaseType="uint16", HeaderFile="Rte_Type.h")  % 后轮距
  % Unit: mm

RoadNum_ADT = Simulink.AliasType(BaseType="uint8")  % road数量
  % Unit:

RoadSlopeAngle_ADT = Simulink.AliasType(BaseType="single")  % 道路坡度
  % Unit: deg

Road_struct = Simulink.Bus(DataScope="Imported", HeaderFile="common_struct.h")
  timeStamp: int64_t
  roadStatus: uint8_t
  roadType: uint8_t
  laneNum: uint8_t
  laneData: Bus: LaneData_Struct[3]
  lineNum: uint8_t
  lineData: Bus: LineData_Struct[4]
  edgeNum: uint8_t
  edgeData: Bus: EdgeData_Struct[2]

ShiftLeverPos_ADT = Simulink.AliasType(BaseType="uint8")  % 变速箱手柄档位状态
  % 0x0: unknown/default
  % 0x1: P
  % 0x2: R
  % 0x3: N
  % 0x4: D
  % 0x5: S
  % 0x6: M
  % 0x7: E
  % 0x15: Invalid
  % Unit:

SpeedCtlSts_ADT = Simulink.AliasType(BaseType="uint8")  % 速度控制状态
  % 0x0 : 禁止控制
  % 0x1 : 可以控制
  % 0x2 : 控制中
  % Unit:

SteerAngleCorrSts_ADT = Simulink.AliasType(BaseType="uint8")  % 修正后方向盘角度的状态
  % 0x0:Unknow;
  % 0x1:bad;
  % 0x2:normal;
  % 0x3:middle;
  % 0x4:good;
  % 0x5:best
  % Unit:

SteerAngleCorr_ADT = Simulink.AliasType(BaseType="single")  % 修正后方向盘转角
  % Unit: deg

SteerAngleSpd_ADT = Simulink.AliasType(BaseType="single")  % 方向盘转角速度
  % Unit: degps

SteerAngle_ADT = Simulink.AliasType(BaseType="single")  % 方向盘转角
  % Unit: deg

SteerCtlSts_ADT = Simulink.AliasType(BaseType="uint8")  % 转向控制状态
  % 0x0 : 禁止控制
  % 0x1 : 可以控制
  % 0x2 : 控制中
  % Unit:

SteeringRange_ADT = Simulink.AliasType(BaseType="single", HeaderFile="Rte_Type.h")  % 方向盘转角范围（最大）
  % Unit: deg

SteeringRatio_ADT = Simulink.AliasType(BaseType="single", HeaderFile="Rte_Type.h")  % 方向盘转向比
  % Unit: n/a

TA_ObjInfo = Simulink.Bus()
  TA_ObjID: uint8[32]
  TA_ObjType: uint8[32]
  TA_ObjState: uint8[32]
  TA_ObjOrientation: uint8[32]
  TA_ObjfusType: uint8[32]
  TA_ObjLaneAssign: uint8[32]
  TA_ObjDx: single[32]
  TA_ObjDy: single[32]
  TA_ObjDxStd: single[32]
  TA_ObjDyStd: single[32]
  TA_ObjVx: single[32]
  TA_ObjVy: single[32]
  TA_ObjVxStd: single[32]
  TA_ObjVyStd: single[32]
  TA_ObjVxAbs: single[32]
  TA_ObjVyAbs: single[32]
  TA_ObjLength: single[32]
  TA_ObjWidth: single[32]
  TA_ObjHight: single[32]
  TA_ObjAx: single[32]
  TA_ObjAy: single[32]
  TA_ObjAxAbs: single[32]
  TA_ObjAyAbs: single[32]
  TA_ObjConfidence: uint8[32]
  TA_ObjCenterAngle: single[32]
  TA_ObjHeadAngle: single[32]
  TA_ObjHeadAngleStd: single[32]

TA_ObjProInfo = Simulink.Bus()
  Cam_ObsCutInFlg_u8: uint8[32]
  Cam_ObsCutInSpd_s: single[32]
  Cam_ObsCutInSpdValid_b: boolean[32]
  Cam_ObsProNotOnRoad_b: boolean[32]
  Cam_ObsProCoverdByOthers_b: boolean[32]
  Cam_ObsProObserveJump_b: boolean[32]
  Cam_ObsProObserveSide_b: boolean[32]
  Cam_ObsProBtTapLevel1_b: boolean[32]
  Cam_ObsProBtTapLevel2_b: boolean[32]
  Cam_ObsProBtTapLevel3_b: boolean[32]
  Cam_laneAssociateConf: single[32]
  Cam_laneLeftPortion: single[32]
  Cam_laneRightPortion: single[32]
  Cam_laneLeftConf: single[32]
  Cam_laneRightConf: single[32]
  Cam_objIntention: uint8_t[32]
  Cam_objIntentionProb: single[32]
  Cam_ObsID_u8: uint8[32]
  Cam_ObsValid_u8: uint8[32]
  Cam_ObsAge_u16: uint16[32]
  Cam_ObsConfidence_u8: uint8[32]
  Cam_ObsMotionCategory_u8: uint8[32]
  Cam_ObsMotionStatus_u8: uint8[32]
  Cam_ObsMeasureStatus_u8: uint8[32]
  Cam_ObsClass_u8: uint8[32]
  Cam_ObsVhSubType_u8: uint8[32]
  Cam_ObsPedSubType_u8: uint8[32]
  Cam_ObsPedPos_u8: uint8[32]
  Cam_ObsPedOrientation_u8: uint8[32]
  Cam_ObsLaneAssign_u8: uint8[32]
  Cam_ObsLength_s: single[32]
  Cam_ObsWidth_s: single[32]
  Cam_ObsHeight_s: single[32]
  Cam_ObsCIPV_b: boolean[32]
  Cam_ObsMCP_b: boolean[32]
  Cam_ObsBlinker_u8: uint8[32]
  Cam_ObsBrkLgt_b: boolean[32]
  Cam_ObsCenterAngle_s: single[32]
  Cam_ObsPosType_u8: uint8[32]
  Cam_ObsPosX_s: single[32]
  Cam_ObsPosY_s: single[32]
  Cam_ObsVelX_s: single[32]
  Cam_ObsVelY_s: single[32]
  Cam_ObsAccX_s: single[32]
  Cam_ObsPosXSTD_s: single[32]
  Cam_ObsPosYSTD_s: single[32]
  Cam_ObsVelXSTD_s: single[32]
  Cam_ObsVelYSTD_s: single[32]
  Cam_ObsAccY_s: single[32]
  Cam_ObsAngle_s: single[32]
  Cam_ObsAngleSTD_s: single[32]
  Cam_ObsVelXAbs_s: single[32]
  Cam_ObsVelYAbs_s: single[32]
  Cam_ObsCornerPntX_s: single[32]
  Cam_ObsCutInDis_s: single[32]
  Cam_ObsCornerPntY_s: single[32]
  Cam_fusiontype: int64_t[32]
  Cam_lightStatus: uint16_t[32]
  Cam_laneAssign: uint8_t[32]

TA_ObjSumInfo = Simulink.Bus()
  TA_ObjProtoInfo: Bus: TA_ObjProtoInfo
  TA_ObjInfo: Bus: TA_ObjInfo

TiltSlop_ADT = Simulink.AliasType(BaseType="single")  % 横向坡度
  % Unit: deg

TimeStamp_ADT = Simulink.AliasType(BaseType="uint32")  % 时间戳
  % Unit: ms

TireRadius_ADT = Simulink.AliasType(BaseType="uint16", HeaderFile="Rte_Type.h")  % 轮胎半径
  % Unit: mm

TireWidth_ADT = Simulink.AliasType(BaseType="uint16", HeaderFile="Rte_Type.h")  % 轮胎宽度
  % Unit: mm

TrajectoryPoint_Struct = Simulink.Bus(DataScope="Imported", HeaderFile="common_struct.h")
  longDist: single
  latDist: single
  yaw: single
  vx: single
  vy: single
  yawRate: single
  ax: single
  ay: single
  predTime: single
  predProb: single

TurnIndicator_ADT = Simulink.AliasType(BaseType="uint8")  % 转向拨杆状态
  % 0x0 : default
  % 0x1 : Left
  % 0x2 : Right
  % Unit:

VehicleLength_ADT = Simulink.AliasType(BaseType="uint16", HeaderFile="Rte_Type.h")  % 车长
  % Unit: mm

VehicleSpeedCorrSts_ADT = Simulink.AliasType(BaseType="uint8")  % 修正后车速状态
  % 0x0:Unknow;
  % 0x1:bad;
  % 0x2:normal;
  % 0x3:middle;
  % 0x4:good;
  % 0x5:best
  % Unit:

VehicleSpeedCorr_ADT = Simulink.AliasType(BaseType="single")  % 修正后车速
  % Unit: mps

VehicleStandstillValid_ADT = Simulink.AliasType(BaseType="boolean")  % Vehicle Standstill state valid signal.
  % 0x0: INVALID
  % 0x1: VALID
  % Unit:

VehicleStandstill_ADT = Simulink.AliasType(BaseType="uint8")  % Indicating whether the vehicle is standstill or not; Cannot be set until standstill is surely reached.
  % 0x0: NOT_STANDSTILL
  % 0x1: STANDSTILL
  % 0x2: RESERVED
  % Unit:

VehicleWidth_ADT = Simulink.AliasType(BaseType="uint16", HeaderFile="Rte_Type.h")  % 车宽
  % Unit: mm

VehicleWindWardArea_ADT = Simulink.AliasType(BaseType="single", HeaderFile="Rte_Type.h")  % 迎风面积
  % Unit: m2

WheelBase_ADT = Simulink.AliasType(BaseType="uint16", HeaderFile="Rte_Type.h")  % 轴距
  % Unit: mm

YRSCalibratedSts_ADT = Simulink.AliasType(BaseType="uint8")  % 横摆角速度状态
  % 0x0: Not Calibrated
  % 0x1: Calibrated
  % 0x2: Reserved
  % 0x3: Signal not avaliable
  % Unit:

YawRateCorrSts_ADT = Simulink.AliasType(BaseType="uint8")  % 修正后横摆角速度状态
  % 0x0:Unknow;
  % 0x1:bad;
  % 0x2:normal;
  % 0x3:middle;
  % 0x4:good;
  % 0x5:best
  % Unit:

YawRateCorr_ADT = Simulink.AliasType(BaseType="single")  % 修正后自车横摆角速率
  % Unit: degps

YawRateValSts_ADT = Simulink.AliasType(BaseType="uint8")  % Yaw rate value staus
  % 0x0: Invalid
  % 0x1: Valid
  % 0x2: Reserved
  % 0x3: Initializing
  % Unit:

YawRate_ADT = Simulink.AliasType(BaseType="single")  % 自车横摆角速率
  % Unit: degps

bool_t = Simulink.AliasType(BaseType="int8", DataScope="Imported", HeaderFile="common_struct.h")

dRefLaneWidth_ADT = Simulink.AliasType(BaseType="single")  % planning reference lane width
  % Unit: m

egopredictiontrajectory_struct = Simulink.Bus()
  a0_x: single  % ego prediction trajectory longitudinal coefficient of degree 0
    % Unit:
  a1_x: single  % ego prediction trajectory longitudinal coefficient of degree 1
    % Unit:
  a2_x: single  % ego prediction trajectory longitudinal coefficient of degree 2
    % Unit:
  a3_x: single  % ego prediction trajectory longitudinal coefficient of degree 3
    % Unit:
  txStart: single  % ego prediction trajectory longitudinal start time
    % Unit: s
  txEnd: single  % ego prediction trajectory longitudinal end time
    % Unit: s
  a0_y: single  % ego prediction trajectory lateral coefficient of degree 0
    % Unit:
  a1_y: single  % ego prediction trajectory lateral coefficient of degree 1
    % Unit:
  a2_y: single  % ego prediction trajectory lateral coefficient of degree 2
    % Unit:
  a3_y: single  % ego prediction trajectory lateral coefficient of degree 3
    % Unit:
  tyStart: single  % ego prediction trajectory lateral start time
    % Unit: s
  tyEnd: single  % ego prediction trajectory lateral end time
    % Unit: s
  Quality: uint8  % quality of trajectory
    % Unit:
  TimeStamp: uint32  % time stamp for current prediction trajectory
    % Unit: ms

egopredresult_struct = Simulink.Bus()
  coefEgTrajA0: single  % ego prediction path curve's coefficient of degree 0
    % Unit: m
  coefEgoTrajA1: single  % ego prediction path curve's coefficient of degree 1
    % Unit: rad
  coefEgTrajA2: single  % ego prediction path curve's coefficient of degree 2
    % Unit: 1pm
  coefEgoTrajA3: single  % ego prediction path curve's coefficient of degree 3
    % Unit: 1pm2
  DxUpperLimit: single  % end dx of predicted trajectory
    % Unit: m
  QualityTraj: uint8  % quality of trajectory
    % Unit:
  EgoTrajTimeStamp: uint32  % time stamp for current prediction path
    % Unit: ms

histobjtraj_struct = Simulink.Bus(HeaderFile="Rte_Type.h")  % 目标历史轨迹
  % Unit:
  CoefTrajA0: single  % polynomial coefficient of degree 0 of trajectory
    % Unit: m
  CoefTrajA1: single  % polynomial coefficient of degree 1 of trajectory
    % Unit:
  CoefTrajA2: single  % polynomial coefficient of degree 2 of trajectory
    % Unit:
  CoefTrajA3: single  % polynomial coefficient of degree 3 of trajectory
    % Unit: 1pm2
  StartDxHistTraj: single  % start dx of historical trajectory
    % Unit: m
  EndDxHistTraj: single  % end dx of historical trajectory
    % Unit: m
  QualityTraj: uint8  % quality of trajectory
    % Unit:

int16_t = Simulink.AliasType(BaseType="int16", DataScope="Imported", HeaderFile="common_struct.h")
int32_t = Simulink.AliasType(BaseType="int32", DataScope="Imported", HeaderFile="common_struct.h")
int64_t = Simulink.AliasType(BaseType="int32", DataScope="Imported", HeaderFile="common_struct.h")
int8_t = Simulink.AliasType(BaseType="int8", DataScope="Imported", HeaderFile="common_struct.h")

lanedatas_struct = Simulink.Bus()  % 车道结构体定义
  % Unit:
  LaneType: uint8  % 车道类型
    % 0x00:UNKNOWN
    % 0x01:CITY_DRIVING(机动车道)
    % 0x02:EMERGENCY（应急车道）
    % Unit:
  LaneDirection: uint8  % 车道方向
    % 0：前向车道；
    % 1：反向车道；
    % 2：双向车道
    % 3：reserve;
    % Unit:
  LaneTurn: uint8  % 车道转向
    % 0x00:NO_TURN(直行车道)
    % 0x01:LEFT_TURN(左转车道)
    % 0x02:RIGHT_TURN(右转车道)
    % 0x03:U_TURN(掉头车道)
    % Unit:
  SlopeA0: single  % 坡度关于x三次方程0次项系数
    % Unit:
  SlopeA1: single  % 坡度关于x三次方程1次项系数
    % Unit:
  SlopeA2: single  % 坡度关于x三次方程2次项系数
    % Unit:
  SlopeA3: single  % 坡度关于x三次方程3次项系数
    % Unit:
  SlopeStartX: single  % 坡度关于x三次方程自变量x的范围起点
    % Unit: m
  SlopeEndX: single  % 坡度关于x三次方程自变量x的范围终点
    % Unit: m
  LaneTTLC: single  % Time to line crossing
    % Unit: s
  LaneWidth: single  % 车道宽度
    % Unit: m
  LaneLeftLineID: uint8  % 左线ID
    % Unit:
  LaneRightLineID: uint8  % 右线ID
    % Unit:
  LaneId: uint16  % Lane Id，透传高精地图
    % Unit:
  MaxLaneSpeed: single  % 车道最大限速
    % Unit:
  MinLaneSpeed: single  % 车道最小限速
    % Unit:

linedatas_struct = Simulink.Bus()  % 道路标识线结构体定义
  % Unit:
  LineID: uint16  % 线ID
    % Unit:
  LineType: uint8  % 线类型
    % 0：无属性；
    % 1：单虚线；
    % 2：单实线；
    % 3：双实线；
    % 4：内虚外实；
    % 5：内实外虚；
    % 6：双虚线；
    % 7:连续锥桶;
    % 8:护栏/临时护栏;
    % 9:水槽;
    % 10:路沿;
    % 11:水泥墙;
    % 12:绿化带;
    % 13:道路与草地边界;
    % 14:水马;
    % 15:内线外路沿；
    % 16~23:reserve;
    % Unit:
  LineColor: uint8  % 线颜色
    % 0：无属性；
    % 1：黄色；
    % 2：白色；
    % 3：蓝色；
    % 4：桔色；
    % 5~15:reserve;
    % Unit:
  LineQuality: uint8  % 线质量
    % 0: Bad
    % 1: Middle
    % 2: Good
    % 3: Best
    % Unit:
  LineA0: single  % 曲线参数0
    % Unit: m
  LineA1: single  % 曲线参数1
    % Unit:
  LineA2: single  % 曲线参数2
    % Unit: 1pm
  LineA3: single  % 曲线参数3
    % Unit: 1pm2
  LineStart: single  % 线有效范围起点
    % Unit: m
  LineEnd: single  % 线有效范围终点
    % Unit: m
  LineWidth: uint16  % 线宽
    % Unit: mm
  Position: uint8  % line position in lanes
    % 0: UnDefinedLine
    % 1: LeftLaneLeftLine
    % 2: LeftLaneRightLine
    % 3: RightLine
    % 4: RightNeighborLine
    % Unit:

objtraj_struct = Simulink.Bus(HeaderFile="Rte_Type.h")  % 目标预测轨迹
  % Unit:
  CoefTrajA0: single  % polynomial coefficient of degree 0 of trajectory
    % Unit: m
  CoefTrajA1: single  % polynomial coefficient of degree 1 of trajectory
    % Unit:
  CoefTrajA2: single  % polynomial coefficient of degree 2 of trajectory
    % Unit: 1pm
  CoefTrajA3: single  % polynomial coefficient of degree 3 of trajectory
    % Unit: 1pm2
  DxUpperLimit: single  % end dx of predicted trajectory
    % Unit: m
  QualityTraj: uint8  % quality of trajectory
    % Unit:
  CoefA0Xtraj: single  % polynomial coefficient of degree 0 of trajectory x=f(t)
    % Unit: m
  CoefA1Xtraj: single  % polynomial coefficient of degree 1 of trajectory x=f(t)
    % Unit: mps
  CoefA2Xtraj: single  % polynomial coefficient of degree 2 of trajectory x=f(t)
    % Unit: mps2
  CoefA3Xtraj: single  % polynomial coefficient of degree 3 of trajectory x=f(t)
    % Unit: mps3
  TstartXtraj: single  % start t of trajectory X
    % Unit: s
  TendXtraj: single  % end of of trajectory X
    % Unit: s
  QualityXtraj: uint8  % quality of trajectory X
    % Unit:
  CoefA0Ytraj: single  % polynomial coefficient of degree 0 of trajectory y=f(t)
    % Unit: m
  CoefA1Ytraj: single  % polynomial coefficient of degree 1 of trajectory y=f(t)
    % Unit: mps
  CoefA2Ytraj: single  % polynomial coefficient of degree 2 of trajectory y=f(t)
    % Unit: mps2
  CoefA3Ytraj: single  % polynomial coefficient of degree 3 of trajectory y=f(t)
    % Unit: mps3
  TstartYtraj: single  % start t of trajectory Y
    % Unit: s
  TendYtraj: single  % end t of trajectory Y
    % Unit: s
  QualityYtraj: uint8  % quality of trajectory Y
    % Unit:

obstaclesectectaeb_struct = Simulink.Bus(HeaderFile="Rte_Type.h")  % all obstacle selected for AEB
  % Unit:
  AebVehicleObjInfo: Bus: predobject_struct  % vehicle object information selected for AEB
    % Unit:
  AebVru1ObjInfo: Bus: predobject_struct  % VRU 1  object information selected for AEB
    % Unit:
  AebVru2ObjInfo: Bus: predobject_struct  % VRU 2  object information selected for AEB
    % Unit:

obstacleselectbsd_struct = Simulink.Bus()  % all obstacle selected for BSD
  % Unit:
  BsdLeftObjInfo: Bus: predobject_struct  % left object information selected for BSD
    % Unit:
  BsdRightObjInfo: Bus: predobject_struct  % right object information selected for BSD
    % Unit:

obstacleselectdow_struct = Simulink.Bus()  % all obstacle selected for DOW
  % Unit:
  DowLeftObjInfo: Bus: predobject_struct  % left object information selected for DOW
    % Unit:
  DowRightObjInfo: Bus: predobject_struct  % right object information selected for DOW
    % Unit:

obstacleselectelk_struct = Simulink.Bus()  % all obstacle selected for ELK
  % Unit:
  ElkVehicleLeftObjInfo: Bus: predobject_struct  % left object information selected for ELK
    % Unit:
  ElkVehicleRightObjInfo: Bus: predobject_struct  % right object information selected for ELK
    % Unit:

obstacleselectfcta_struct = Simulink.Bus()  % all obstacle selected for FCTA
  % Unit:
  FctaLeftObjInfo: Bus: predobject_struct  % left object information selected for FCTA
    % Unit:
  FctaRightObjInfo: Bus: predobject_struct  % right object information selected for FCTA
    % Unit:

obstacleselectfvsr_struct = Simulink.Bus()  % all obstacle selected for FVSR
  % Unit:
  FvsrVehicleObjInfo: Bus: predobject_struct  % vehicle object information selected for FVSR
    % Unit:

obstacleselectja_strcut = Simulink.Bus()  % all obstacle selected for JA
  % Unit:
  JaVehicleObjInfo: Bus: predobject_struct  % vehicle object information selected for JA
    % Unit:
  JaVru1ObjInfo: Bus: predobject_struct  % VRU 1  object information selected for JA
    % Unit:
  JaVru2ObjInfo: Bus: predobject_struct  % VRU 2  object information selected for JA
    % Unit:
  JaVru3ObjInfo: Bus: predobject_struct  % VRU 3  object information selected for JA
    % Unit:

obstacleselectlca_struct = Simulink.Bus()  % all obstacle selected for LCA
  % Unit:
  LcaLeftObjInfo: Bus: predobject_struct  % left object information selected for LCA
    % Unit:
  LcaRightObjInfo: Bus: predobject_struct  % right object information selected for LCA
    % Unit:

obstacleselectmeb_struct = Simulink.Bus()  % all obstacle selected for MEB
  % Unit:
  MebFront1ObjInfo: Bus: predobject_struct  % left object information selected for MEB
    % Unit:
  MebFront2ObjInfo: Bus: predobject_struct  % left object information selected for MEB
    % Unit:
  MebFront3ObjInfo: Bus: predobject_struct  % left object information selected for MEB
    % Unit:
  MebFront4ObjInfo: Bus: predobject_struct  % left object information selected for MEB
    % Unit:
  MebBehand1ObjInfo: Bus: predobject_struct  % left object information selected for MEB
    % Unit:
  MebBehand2ObjInfo: Bus: predobject_struct  % left object information selected for MEB
    % Unit:
  MebBehand3ObjInfo: Bus: predobject_struct  % left object information selected for MEB
    % Unit:
  MebBehand4ObjInfo: Bus: predobject_struct  % left object information selected for MEB
    % Unit:

obstacleselectrcta_struct = Simulink.Bus()  % all obstacle selected for RCTA
  % Unit:
  RctaLeftObjInfo: Bus: predobject_struct  % left object information selected for RCTA
    % Unit:
  RctaRightObjInfo: Bus: predobject_struct  % right object information selected for RCTA
    % Unit:

obstacleselectrcw_struct = Simulink.Bus()  % all obstacle selected for RCW
  % Unit:
  RcwObjInfo: Bus: predobject_struct  % left object information selected for RCW
    % Unit:

pepsPowerMode_ADT = Simulink.AliasType(BaseType="uint8")  % 0x0: DEFAULT_POWERMODE
  % 0x1: OFF_POWERMODE
  % 0x2: Local ON_POWERMODE
  % 0x3: Remote ON_POWERMODE
  % 0x4: RESERVE_POWERMODE1
  % 0x5: RESERVE_POWERMODE2
  % 0x6: RESERVE_POWERMODE3
  % 0x7: INVALID_POWERMODE
  % Unit:

predobject_struct = Simulink.Bus(HeaderFile="Rte_Type.h")
  TimeStamp: uint32  % timestamp
    % Unit: ms
  IdObj: uint32  % ID of object
    % Unit:
  LongDisObj: single  % longitudinal distance of object
    % Unit: m
  LatDisObj: single  % lateral distance of object
    % Unit: m
  LongVelObj: single  % longitudinal relative velocity of object
    % Unit: mps
  LatVelObj: single  % lateral relative velocity of object
    % Unit: mps
  LongAccelObj: single  % longitudinal cceleration of object
    % Unit: mps2
  LatAccelObj: single  % lateral acceleration of object
    % Unit: mps2
  VarDxObj: single  % variance of longitudinal distance of object
    % Unit: m2
  VarDyObj: single  % variance of lateral distance of object
    % Unit: m2
  VarVxObj: single  % variance of longitudinal relative velocity of object
    % Unit: mps
  VarVyObj: single  % variance of lateral relative velocity of object
    % Unit: mps
  VarAxObj: single  % variance of longitudinal cceleration of object
    % Unit: mps
  VarAyObj: single  % variance of lateral acceleration of object
    % Unit: mps2
  VxAbsObj: single  % absolute vx of object
    % Unit: mps
  VyAbsObj: single  % absolute vy of object
    % Unit: mps
  AxAbsObj: single  % absolute ax of object
    % Unit: mps2
  AyAbsObj: single  % absolute ay of object
    % Unit: mps2
  PsiDtObj: single  % yaw-rate of object
    % Unit: rad/s
  RotAcceleration: single  % rotation acceleration of obeject
    % Unit: mps2
  Valid: uint8  % valid status of object
    % Unit:
  MotionStatus: uint8  % motion status of obejct
    % MSTYPE_NOTDEFINED = 0,
    % MSTYPE_STANDING      1,
    % MSTYPE_PARKED         2,
    % MSTYPE_MOVABLESTOPED   3,
    % MSTYPE_MOVABLEUNKNOWN  4,
    % MSTYPE_MOVABLEMOVING   5,
    % MSTYPE_ONCOMINGSTOPED  6,
    % MSTYPE_ONCOMINGUNKNOWN 7,
    % MSTYPE_ONCOMINGMOVING  8,
    % MSTYPE_CROSSINGSTOPED  9,
    % MSTYPE_CROSSINGMOVINGLEFT  10,
    % MSTYPE_CROSSINGMOVINGRIGHT 11,
    % Unit:
  TypeObj: uint8  % type of object
    % OBJECTTYPE_UNKNOWN = 0,
    % OBJECTTYPE_PEDESTRIAN 1,
    % OBJECTTYPE_RIDER      2,
    % OBJECTTYPE_CAR        3,
    % OBJECTTYPE_TRUCK      4,
    % OBJECTTYPE_BUS        5,
    % OBJECTTYPE_TRICYCLE   6,
    % OBJECTTYPE_ANIMAL     7,
    % OBJECTTYPE_TREE       8,
    % OBJECTTYPE_POLE       9,
    % OBJECTTYPE_CONE       10,
    % OBJECTTYPE_TURNSTILE  11,
    % OBJECTTYPE_NOPARKING_SIGN 12,
    % OBJECTTYPE_WARNINGPOST 13,
    % OBJECTTYPE_PARKINGLOCK_OPEN 14,
    % OBJECTTYPE_PARKINGLOCK_CLOSE 15,
    % OBJECTTYPE_LIMITEDBAR 16,
    % OBJECTTYPE_BICYCLE    17,
    % OBJECTTYPE_TRASH_CAN  18,
    % OBJECTTYPE_GATE_BODY  19,
    % OBJECTTYPE_GATE_POLE  20,
    % OBJECTTYPE_PILLAR     21,
    % OBJECTTYPE_STONE_PIER 22,
    % OBJECTTYPE_OTHER      23
    % Unit:
  FusionTypeObj: uint8  % fusion type of object
    % 0 : Unknown
    % 1 : camera
    % 2 : radar
    % 3 : camera &amp; radar
    % 4 : ultrasonic
    % 5 : camera &amp; ultrasonic
    % 6 : ultrasonic &amp; radar
    % 7 : camera &amp; radar &amp; ultrasonic
    % Unit:
  TtcObj: single  % TTC of object
    % Unit: s
  Heading: single  % heading angle of object
    % Unit: rad
  HeadingStd: single  % standard deviation of object heading
    % Unit: rad
  WidthObj: single  % width of object
    % Unit: m
  WidthObjStd: single  % standard deviation of object width
    % Unit: m
  LengthObj: single  % length of object
    % Unit: m
  LengthObjStd: single  % standard deviation of object length
    % Unit: m
  HeightObj: single  % height of object
    % Unit: m
  HeightObjStd: single  % standard deviation of object height
    % Unit: m
  ConfidenceObj: uint8  % confidence of object
    % Unit: per
  AgeObj: uint32  % age of object
    % Unit:
  LaneAssignment: uint8  % lane assignment of object
    % 0 : Unknown
    % 1 : In Host Lane
    % 2：Left to Host Lane
    % 3：Right to Host Lane
    % 4：In Left Lane
    % 5：Left to Left Lane
    % 6：In Right Lane
    % 7：Right to Right Lane
    % 8 : Cut In
    % 9 : Cut Out
    % Unit:
  TurnIndicator: uint8  % turn indicator status
    % 0: NOT_AVAILABLE
    % 1: NO_TURN_INDICATOR
    % 2: LEFT_TURN_INDICATOR_ACTIVE
    % 3: RIGHT_TURN_INDICATOR_ACTIVE
    % 4: DOUBLE_TURN_INDICATOR_ACTIVE
    % Unit:
  BrakeIndicator: uint8  % brake indicator status
    % 0: NOT_AVAILABLE
    % 1: ON
    % 2: OFF
    % Unit:
  PredIntentionObj: uint8  % predicted behavior intention of object
    % 0: Unknown
    % 1: Keep lane
    % 2: Lane change Left
    % 3: Lane change Right
    % 4: Reserved1
    % 5: Reserved2
    % Unit:
  DatumSide: uint8  % 目标基准面
    % 仅适用于车辆类目标
    % 0 : Unknown
    % 1 : Front
    % 2 : Rear
    % 3 : Side
    % Unit:
  OrientationObj: single  % orientation of object
    % Unit: rad
  IsMovingObj: uint8  % Is object moving
    % UNKNOWN = 0,
    % MOVING = 1,
    % STANDSTILL = 2,
    % Unit:
  IsCrossingObj: uint8  % Is object crossing
    % UNKNOWN = 0,
    % TRAVERSE = 1,
    % NOTRAVERSE = 2,
    % Unit:
  IsOnComingObj: uint8  % Is On Coming Object Crossing
    % UNKNOWN = 0,
    % OnComing = 1,
    % NotOnComing = 2,
    % Unit:
  LanePositionObj: uint8  % Lane Position of object
    % LEFT_LANE = 0u,
    % EGO_LANE,
    % RIGHT_LANE,
    % UNKNOWN_LANE = (0xFF)
    % Unit:
  LaneProbabilityObj: single[5]  % Lane Probability of object
    % Unit:
  PredObjTraj: Bus: objtraj_struct[3]  % 目标预测轨迹
    % Unit:
  HistObjTraj: Bus: histobjtraj_struct[3]  % 目标历史轨迹
    % Unit:

remoteMode_ADT = Simulink.AliasType(BaseType="uint8")  % 0x0: INVALID
  % 0x1: NORMAL
  % 0x2: REMOTE
  % 0x3: Reserved
  % Unit:

roaddata_struct = Simulink.Bus()
  RoadType: uint8  % 道路类型，主干道or匝道
    % Unit:
  RoadId: uint16  % 道路ID，透传HDMap的LinkID，0表示没有HDMap数据
    % Unit:
  BoundaryNum: uint8  % 边界线数量
    % Unit:
  LineNum: uint8  % 标识线数量
    % Unit:
  LaneNum: uint8  % 道路个数
    % Unit:
  BoundaryData: Bus: linedatas_struct[4]  % 道路边界线结构体定义
    % Road[0].Boundary[0]:Left boundary
    % Road[0].Boundary[1]:Right boundary
    % Unit:
  RdLineData: Bus: linedatas_struct[8]  % 道路标识线结构体定义
    % Road[0].Line[0]: Left_Line
    % Road[0].Line[1]: Right_Line
    % Road[0].Line[2]: LeftLeft_Line
    % Road[0].Line[3]: RightRight_Line
    % Unit:
  RdLaneData: Bus: lanedatas_struct[8]  % 车道架构体定义
    % Road[0].Lane[0]: Ego_Lane
    % Road[0].Lane[1]: Left_Lane
    % Road[0].Lane[2]: Right_Lane
    % Unit:

scenedatas_struct = Simulink.Bus()
  Scene_Type: uint32  % 场景类型
    % 0:unknown
    % 1:隧道
    % 2:收费站
    % 3:分流点
    % 4:合流点
    % 5:上匝道
    % 6:下匝道
    % Unit:
  LatDistacne: int16  % 场景距自车的横向距离
    % Unit: mm
  LongDistacne: int32  % 场景距自车的纵向距离
    % Unit: mm
  Scene_Value: int16  % 特地场景值
    % 如分叉点的角度等
    % Unit:

tTimeStamp_ADT = Simulink.AliasType(BaseType="uint32")  % time stamp
  % Unit: ms

uint16_t = Simulink.AliasType(BaseType="uint16", DataScope="Imported", HeaderFile="common_struct.h")
uint32_t = Simulink.AliasType(BaseType="uint32", DataScope="Imported", HeaderFile="common_struct.h")
uint64_t = Simulink.AliasType(BaseType="uint32", DataScope="Imported", HeaderFile="common_struct.h")
uint8_t = Simulink.AliasType(BaseType="uint8", DataScope="Imported", HeaderFile="common_struct.h")
ObjSelect_CalAEBInvalidObjID = Simulink.Parameter(0, DataType="uint8")  % 模块的标定量定义
ObjSelect_CalAEBPedAccelReduceFactor = Simulink.Parameter(0.3, DataType="single")  % 模块的标定量定义
ObjSelect_CalAEBPedLength = Simulink.Parameter(0.25, DataType="single")  % 模块的标定量定义
ObjSelect_CalAEBPedWidth = Simulink.Parameter(0.25, DataType="single")  % 模块的标定量定义
ObjSelect_CalAEBPredCollisionProbThres = Simulink.Parameter(0.7, DataType="single")  % 模块的标定量定义
ObjSelect_CalAEBPredInterval = Simulink.Parameter(0.1, DataType="single")  % 模块的标定量定义
ObjSelect_CalAEBPredSteps = Simulink.Parameter(20, DataType="uint16")  % 模块的标定量定义
ObjSelect_CalAEBRoadWidthDefaultMO = Simulink.Parameter(3, DataType="single")  % 模块的标定量定义
ObjSelect_CalAEBRoadWidthDefaultSO = Simulink.Parameter(1.8, DataType="single")  % 模块的标定量定义
ObjSelect_CalAEBVehDxMin4ApproachingObj = Simulink.Parameter(10, DataType="single")  % 模块的标定量定义
ObjSelect_CalAEBVehDxMin4LeavingObj = Simulink.Parameter(10, DataType="single")  % 模块的标定量定义
ObjSelect_CalAEBVehLaneProbMin = Simulink.Parameter(0.4, DataType="single")  % 模块的标定量定义
ObjSelect_CalAEBVehLength = Simulink.Parameter(5, DataType="single")  % 模块的标定量定义
ObjSelect_CalAEBVehTHWMax4LeavingObj = Simulink.Parameter(2, DataType="single")  % 模块的标定量定义
ObjSelect_CalAEBVehTTCMax4ApproachingObj = Simulink.Parameter(4, DataType="single")  % 模块的标定量定义
ObjSelect_CalAEBVehVrAbsStandstill = Simulink.Parameter(0.6, DataType="single")  % 模块的标定量定义
ObjSelect_CalAEBVehVxAbsLowerLimit = Simulink.Parameter(-0.6, DataType="single")  % 模块的标定量定义
ObjSelect_CalAEBVehVyAbsStandstill = Simulink.Parameter(0.6, DataType="single")  % 模块的标定量定义
ObjSelect_CalAEBVehWidth = Simulink.Parameter(2, DataType="single")  % 模块的标定量定义
ObjSelect_CalAEB_CrossSpdDirThres = Simulink.Parameter(0.785, DataType="single")  % 模块的标定量定义
ObjSelect_CalAEB_NUM_OBJ_HIST_POINTS = Simulink.Parameter(11, DataType="uint32")  % 模块的标定量定义
ObjSelect_CalELKInvalidObjID = Simulink.Parameter(0, DataType="uint8")  % 模块的标定量定义
ObjSelect_CalFVSREgoSpdStandstill = Simulink.Parameter(0.01, DataType="single")  % 模块的标定量定义
ObjSelect_CalFVSREgoSpeedLowerLimit = Simulink.Parameter(-0.6, DataType="single")  % 模块的标定量定义
ObjSelect_CalFVSREgoSpeedUpperLimit = Simulink.Parameter(2.5, DataType="single")  % 模块的标定量定义
ObjSelect_CalFVSRInvalidObjID = Simulink.Parameter(0, DataType="uint8")  % 模块的标定量定义
ObjSelect_CalFVSRObjLatDisLimit = Simulink.Parameter(2, DataType="single")  % 模块的标定量定义
ObjSelect_CalFVSRVehVrAbsStandstill = Simulink.Parameter(0.6, DataType="single")  % 模块的标定量定义
ObjSelect_CalFVSRVehVxAbsLowerLimit = Simulink.Parameter(-0.6, DataType="single")  % 模块的标定量定义
ObjSelect_CalFVSR_CrossSpdDirThres = Simulink.Parameter(0.785, DataType="single")  % 模块的标定量定义
ObjSelect_CalJAInvalidObjID = Simulink.Parameter(0, DataType="uint8")  % 模块的标定量定义
ObjSelect_CalJAVehTTCMax = Simulink.Parameter(2.5, DataType="single")  % 模块的标定量定义
ObjSelect_CalRCWInvalidObjID = Simulink.Parameter(0, DataType="uint8")  % 模块的标定量定义
ObjSelect_CalRCWVxRelLowerLimit = Simulink.Parameter(10, DataType="single")  % 模块的标定量定义
ObjSelect_CalRCW_CrossSpdDirThres = Simulink.Parameter(0.785, DataType="single")  % 模块的标定量定义
ObjSelect_CalRcwObjConfidenceThr = Simulink.Parameter(80, DataType="uint8")  % 模块的标定量定义
ObjSelect_CalRcwRearBlindLength_m = Simulink.Parameter(-1, DataType="single")  % 模块的标定量定义
ObjSelect_CalRcwWarnLongiDis_m = Simulink.Parameter(-70, DataType="single")  % 模块的标定量定义
ObjSelect_EPSILON = Simulink.Parameter(0.001, DataType="single")  % 模块的标定量定义
ObjSelect_f_VelYWindowSize = Simulink.Parameter(1.5, DataType="single")  % 模块的标定量定义
ObjSelect_f_YoffWindowSize = Simulink.Parameter(9, DataType="single")  % 模块的标定量定义

SL_Bus_Demo_3D_Dynamics_cs_base_msgs_Header = Simulink.Bus()  % MsgType=base_msgs/Header
  TimestampNs: double  % Int64Type=int64
  Counter: uint8
  FrameId: Bus: SL_Bus_Demo_3D_Dynamics_cs_base_msgs_PositionType  % MsgType=base_msgs/PositionType

SL_Bus_Demo_3D_Dynamics_cs_base_msgs_PositionType = Simulink.Bus()  % MsgType=base_msgs/PositionType
  Value: uint8

SL_Bus_Demo_3D_Dynamics_cs_vehicle_msgs_ACCReq = Simulink.Bus()  % MsgType=vehicle_msgs/ACCReq
  AccTjaSwReqEnum: uint16
  AccSpdAutoSetSwReqEnum: uint16
  AccSpdLmtOfst: uint16
  IlcSwReqEnum: uint16
  IsRstrFctryDfltsReq: boolean
  AccSpdVcCmdSwReqEnum: uint16

SL_Bus_Demo_3D_Dynamics_cs_vehicle_msgs_ACCSwitch = Simulink.Bus()  % MsgType=vehicle_msgs/ACCSwitch
  AccSwitchBitEnum: uint8
  IsAccSetSwActv: boolean
  IsAccSpdIncSwActv: boolean
  IsAccSpdDecSwActv: boolean
  IsAccDstDecSwActv: boolean
  IsAccDstIncSwActv: boolean
  AccSwDataIntgtyEnum: uint16
  AccSwtCnt: uint16
  IsAccSwtChecksumVld: boolean
  SpdSetRollerDirEnum: uint8
  SpdSetRollerSpd: single
  FolDistanceIncrsEnum: uint8
  IsFolDistanceIncrsVld: boolean
  FolDistanceDecrsEnum: uint8
  IsFolDistanceDecrsVld: boolean
  DrvReqShiftEnum: uint8
  SpdSetRollerOkbuttonEnum: uint8
  SpdSetRollerOkbuttonStuckSenum: uint8
  FolDistanceIncrsStuckEnum: uint8
  FolDistanceDecrsStuckEnum: uint8
  CruisingSpdIncreaseReqEnum: uint8
  CruisingSpdIncreaseStuckEnum: uint8
  CruisingSpdDecreaseReqKph: uint8
  CruisingSpdEcreaseStuckEnm: uint8
  CruisingModeActReqEnum: uint8
  CruisingModeActStuckEnum: uint8
  ResumeReqEnum: uint8

SL_Bus_Demo_3D_Dynamics_cs_vehicle_msgs_ACCVoice = Simulink.Bus()  % MsgType=vehicle_msgs/ACCVoice
  AccDstAdjustVcCmdEnum: uint16
  AccVcCmdReqStsEnum: uint16
  AccSpdVcCmdEnum: uint16
  AccDstVcCmdEnum: uint16
  AccSpdVcCmd: uint16

SL_Bus_Demo_3D_Dynamics_cs_vehicle_msgs_DoorStatus = Simulink.Bus()  % MsgType=vehicle_msgs/DoorStatus
  DriverDoorStsEnum: uint16
  IsDriverDoorStsVld: boolean
  FrontNondriverDoorStsEnum: uint16
  IsFrontNondriverDoorStsVld: boolean
  RlDoorStsEnum: uint16
  IsRlDoorStsVld: boolean
  RrDoorStsEnum: uint16
  IsRrDoorStsVld: boolean
  LoadspaceHoodStsEnum: uint16
  IsLoadspaceHoodStsVld: boolean
  BonnetStsEnum: uint16
  IsBonnetStsVld: boolean

SL_Bus_Demo_3D_Dynamics_cs_vehicle_msgs_DriverRequest = Simulink.Bus()  % MsgType=vehicle_msgs/DriverRequest
  AccSwicth: Bus: SL_Bus_Demo_3D_Dynamics_cs_vehicle_msgs_ACCSwitch  % MsgType=vehicle_msgs/ACCSwitch
  AccReq: Bus: SL_Bus_Demo_3D_Dynamics_cs_vehicle_msgs_ACCReq  % MsgType=vehicle_msgs/ACCReq
  AccVoiceCmd: Bus: SL_Bus_Demo_3D_Dynamics_cs_vehicle_msgs_ACCVoice  % MsgType=vehicle_msgs/ACCVoice
  IcaSwicth: Bus: SL_Bus_Demo_3D_Dynamics_cs_vehicle_msgs_ICASwitch  % MsgType=vehicle_msgs/ICASwitch
  IcaReq: Bus: SL_Bus_Demo_3D_Dynamics_cs_vehicle_msgs_ICAReq  % MsgType=vehicle_msgs/ICAReq
  IcaVoiceCmd: Bus: SL_Bus_Demo_3D_Dynamics_cs_vehicle_msgs_ICAVoice  % MsgType=vehicle_msgs/ICAVoice
  NcaSwicth: Bus: SL_Bus_Demo_3D_Dynamics_cs_vehicle_msgs_NCASwitch  % MsgType=vehicle_msgs/NCASwitch
  NcaReq: Bus: SL_Bus_Demo_3D_Dynamics_cs_vehicle_msgs_NCAReq  % MsgType=vehicle_msgs/NCAReq
  NcaVoiceCmd: Bus: SL_Bus_Demo_3D_Dynamics_cs_vehicle_msgs_NCAVoice  % MsgType=vehicle_msgs/NCAVoice
  PrkSwicth: Bus: SL_Bus_Demo_3D_Dynamics_cs_vehicle_msgs_ParkingSwitch  % MsgType=vehicle_msgs/ParkingSwitch
  PrkReq: Bus: SL_Bus_Demo_3D_Dynamics_cs_vehicle_msgs_ParkingReq  % MsgType=vehicle_msgs/ParkingReq
  PrkVoiceCmd: Bus: SL_Bus_Demo_3D_Dynamics_cs_vehicle_msgs_ParkingVoice  % MsgType=vehicle_msgs/ParkingVoice
  OtherSwitch: Bus: SL_Bus_Demo_3D_Dynamics_cs_vehicle_msgs_OtherSwitch  % MsgType=vehicle_msgs/OtherSwitch

SL_Bus_Demo_3D_Dynamics_cs_vehicle_msgs_HodStatus = Simulink.Bus()  % MsgType=vehicle_msgs/HodStatus
  HodSysStsEnum: uint16
  HodDetnStsEnum: uint16

SL_Bus_Demo_3D_Dynamics_cs_vehicle_msgs_ICAReq = Simulink.Bus()  % MsgType=vehicle_msgs/ICAReq
  IcaTjaSwReqEnum: uint16
  IcaLaneChangeSetReqEnum: uint16
  LcrSwReqEnum: uint16
  IcaSpdAutoSetSwReqEnum: uint16
  IcaSpdLmtOfst: uint16
  IcaSpdVcCmdSwReqEnum: uint16

SL_Bus_Demo_3D_Dynamics_cs_vehicle_msgs_ICASwitch = Simulink.Bus()  % MsgType=vehicle_msgs/ICASwitch
  IsIcaActvSwActv: boolean
  IsIcaSetSwActv: boolean
  IsIcaSpdIncSwActv: boolean
  IsIcaSpdDecSwActv: boolean
  IsIcaDstDecSwActv: boolean
  IsIcaDstIncSwActv: boolean
  IcaSwDataIntgtyEnum: uint16
  IcaSwtCnt: uint16
  IsIcaSwtChecksumVld: boolean

SL_Bus_Demo_3D_Dynamics_cs_vehicle_msgs_ICAVoice = Simulink.Bus()  % MsgType=vehicle_msgs/ICAVoice
  IcaDstAdjustVcCmdEnum: uint16
  IcaVcCmdReqStsEnum: uint16
  IcaSpdVcCmdEnum: uint16
  IcaDstVcCmdEnum: uint16
  IcaSpdVcCmd: uint16
  AutoLaneChangeVcCmdEnum: uint16

SL_Bus_Demo_3D_Dynamics_cs_vehicle_msgs_LightStatus = Simulink.Bus()  % MsgType=vehicle_msgs/LightStatus
  DircnIndLampSwStsEnum: uint16
  IsLeftDircnIndLampOn: boolean
  IsRightDircnIndLampOn: boolean
  IsDippedBeamLightOn: boolean
  IsFrtFogLightOn: boolean
  IsRrFogLightOn: boolean
  IsMainBeamLightOn: boolean
  SideBrakeLightStsEnum: uint8
  CentreHightBrakeLightStsEnum: uint8

SL_Bus_Demo_3D_Dynamics_cs_vehicle_msgs_MirrorStatus = Simulink.Bus()  % MsgType=vehicle_msgs/MirrorStatus
  LeftMirrorStsEnum: uint8
  RightMirrorStsEnum: uint8

SL_Bus_Demo_3D_Dynamics_cs_vehicle_msgs_NCAReq = Simulink.Bus()  % MsgType=vehicle_msgs/NCAReq
  NcaTjaSwReqEnum: uint16
  NcaSpdAutoSetSwReqEnum: uint16
  NcaSpdLmtOfst: uint16
  IsRstrFctryDfltsReq: boolean
  NcaSpdVcCmdSwReqEnum: uint16

SL_Bus_Demo_3D_Dynamics_cs_vehicle_msgs_NCASwitch = Simulink.Bus()  % MsgType=vehicle_msgs/NCASwitch
  NcaSwReqEnum: uint16
  IsNcaActvSwActv: boolean
  IsNcaSetSwActv: boolean
  IsNcaSpdIncSwActv: boolean
  IsNcaSpdDecSwActv: boolean
  IsNcaDstDecSwActv: boolean
  IsNcaDstIncSwActv: boolean
  NcaSwDataIntgtyEnum: uint16
  NcaSwtCnt: uint16
  IsCaSwtChecksumVld: boolean

SL_Bus_Demo_3D_Dynamics_cs_vehicle_msgs_NCAVoice = Simulink.Bus()  % MsgType=vehicle_msgs/NCAVoice
  NcaDstAdjustVcCmdEnum: uint16
  NcaVcCmdReqStsEnum: uint16
  NcaSpdVcCmdEnum: uint16
  NcaDstVcCmdEnum: uint16
  NcaSpdVcCmd: uint16

SL_Bus_Demo_3D_Dynamics_cs_vehicle_msgs_OtherSwitch = Simulink.Bus()  % MsgType=vehicle_msgs/OtherSwitch
  AebSwReqEnum: uint16
  FcwSnstvtLvlReqEnum: uint16
  FcwSwReqEnum: uint16
  LdwAdoWarningReqEnum: uint16
  LdwLkaSwReqEnum: uint16
  LdwLkaHptWarningReqEnum: uint16
  LdwSnstvtLvlReqEnum: uint16
  TrfcLghtFnSwReqEnum: uint16
  AebDspCmdEnum: uint16
  SebMsgReqEnum: uint16
  FcwDspCmdEnum: uint16
  FcwSnstvtLvlEnum: uint16
  FcwSysFltStsEnum: uint16
  FcwWrnngStsEnum: uint16

SL_Bus_Demo_3D_Dynamics_cs_vehicle_msgs_ParkingReq = Simulink.Bus()  % MsgType=vehicle_msgs/ParkingReq
  ParkingAvpApaSwReqEnum: uint16
  IsRstrFctryDfltsReq: boolean
  AccSpdVcCmdSwReqEnum: uint16

SL_Bus_Demo_3D_Dynamics_cs_vehicle_msgs_ParkingSwitch = Simulink.Bus()  % MsgType=vehicle_msgs/ParkingSwitch
  IsParkingSwActv: boolean
  IsVpaSwActv: boolean
  IsVpaNewMapSwActv: boolean
  IsParkinSelectedSlotActv: boolean
  IsParkoutDirectionSwActv: boolean
  IsParkinSwActv: boolean
  IsParkoutSwActv: boolean
  ParkingSwtCnt: uint16
  IsParkingSwtChecksumVld: boolean

SL_Bus_Demo_3D_Dynamics_cs_vehicle_msgs_ParkingVoice = Simulink.Bus()  % MsgType=vehicle_msgs/ParkingVoice
  ParkingSuspendVcCmdEnum: uint16
  AvpCruiseToApaSearchReqEnum: uint16

SL_Bus_Demo_3D_Dynamics_cs_vehicle_msgs_SdmStatus = Simulink.Bus()  % MsgType=vehicle_msgs/SdmStatus
  DrvrStbltStsEnum: uint8
  IsDrvrStbltAttdVld: boolean
  IsAirbagDplyd: boolean
  IsAirbagSysFlt: boolean

SL_Bus_Demo_3D_Dynamics_cs_vehicle_msgs_VehicleBody = Simulink.Bus()  % MsgType=vehicle_msgs/VehicleBody
  DoorSts: Bus: SL_Bus_Demo_3D_Dynamics_cs_vehicle_msgs_DoorStatus  % MsgType=vehicle_msgs/DoorStatus
  LightSts: Bus: SL_Bus_Demo_3D_Dynamics_cs_vehicle_msgs_LightStatus  % MsgType=vehicle_msgs/LightStatus
  MirrorSts: Bus: SL_Bus_Demo_3D_Dynamics_cs_vehicle_msgs_MirrorStatus  % MsgType=vehicle_msgs/MirrorStatus
  SdmSts: Bus: SL_Bus_Demo_3D_Dynamics_cs_vehicle_msgs_SdmStatus  % MsgType=vehicle_msgs/SdmStatus
  HodSts: Bus: SL_Bus_Demo_3D_Dynamics_cs_vehicle_msgs_HodStatus  % MsgType=vehicle_msgs/HodStatus
  FrtWiperSwStsEnum: uint16
  IsSeatOccpd: boolean[10]
  IsSeatbeltFastened: boolean[10]

SL_Bus_Demo_3D_Dynamics_cs_vehicle_msgs_VehicleState = Simulink.Bus()  % MsgType=vehicle_msgs/VehicleState
  VehDrvModeEnum: uint16
  VehPwrModeEnum: uint16
  IsVehPwrModeVld: boolean
  IsSysBpmEnbd: boolean
  SysBpmEnum: uint16

SL_Bus_Demo_3D_Dynamics_cs_vehicle_msgs_VehicleStatus = Simulink.Bus()  % MsgType=vehicle_msgs/VehicleStatus
  StdHeader: Bus: SL_Bus_Demo_3D_Dynamics_cs_base_msgs_Header  % MsgType=base_msgs/Header
  Vehbody: Bus: SL_Bus_Demo_3D_Dynamics_cs_vehicle_msgs_VehicleBody  % MsgType=vehicle_msgs/VehicleBody
  VehState: Bus: SL_Bus_Demo_3D_Dynamics_cs_vehicle_msgs_VehicleState  % MsgType=vehicle_msgs/VehicleState
  Drvin: Bus: SL_Bus_Demo_3D_Dynamics_cs_vehicle_msgs_DriverRequest  % MsgType=vehicle_msgs/DriverRequest

SL_Bus_Demo_3D_Dynamics_cs_vehicle_msgs_AccelerationPedal = Simulink.Bus()  % MsgType=vehicle_msgs/AccelerationPedal
  IsAcclOvrd: boolean
  EptAcclPos: single
  IsEptAcclPosVld: boolean

SL_Bus_Demo_3D_Dynamics_cs_vehicle_msgs_BrakePedal = Simulink.Bus()  % MsgType=vehicle_msgs/BrakePedal
  BrkpdlAppdEnum: uint16
  BrkpdlAppdPos: single
  BrkpdlAppdVld: boolean
  BrkpdlAppdPrsValid: boolean
  BrkpdlAppdPrsKpa: single
  EptBrkpdlAppdEnum: uint16
  EptBrkpdlAppdVld: boolean

SL_Bus_Demo_3D_Dynamics_cs_vehicle_msgs_BrakeSystem = Simulink.Bus()  % MsgType=vehicle_msgs/BrakeSystem
  Brkpdl: Bus: SL_Bus_Demo_3D_Dynamics_cs_vehicle_msgs_BrakePedal  % MsgType=vehicle_msgs/BrakePedal
  Prkbrk: Bus: SL_Bus_Demo_3D_Dynamics_cs_vehicle_msgs_ParkingBrake  % MsgType=vehicle_msgs/ParkingBrake
  BrkDiscTempStsEnum: uint16

SL_Bus_Demo_3D_Dynamics_cs_vehicle_msgs_Gear = Simulink.Bus()  % MsgType=vehicle_msgs/Gear
  IsActvGearVld: boolean
  ActvGearEnum: uint16
  ApaIntervenGearStsEnum: uint8

SL_Bus_Demo_3D_Dynamics_cs_vehicle_msgs_Motor = Simulink.Bus()  % MsgType=vehicle_msgs/Motor
  MotorRotSpdRpm: int32
  MotorMaxRecpDecelMS2: single
  MotorMaxRecpDecelStsEnum: uint8
  MotorRecpTorqStsEnum: uint8
  MotorRecpTorqNm: single

SL_Bus_Demo_3D_Dynamics_cs_vehicle_msgs_MovingStatus = Simulink.Bus()  % MsgType=vehicle_msgs/MovingStatus
  VehststStsEnum: uint16
  IsVehststStsVld: boolean
  VehMovgDirEnum: uint16

SL_Bus_Demo_3D_Dynamics_cs_vehicle_msgs_ParkingBrake = Simulink.Bus()  % MsgType=vehicle_msgs/ParkingBrake
  EpbstsEnum: uint16
  EpbAvailApaStsEnum: uint16
  EpbAvailRpaStsEnum: uint16

SL_Bus_Demo_3D_Dynamics_cs_vehicle_msgs_PowerTrain = Simulink.Bus()  % MsgType=vehicle_msgs/PowerTrain
  Gear: Bus: SL_Bus_Demo_3D_Dynamics_cs_vehicle_msgs_Gear  % MsgType=vehicle_msgs/Gear
  Acclpdl: Bus: SL_Bus_Demo_3D_Dynamics_cs_vehicle_msgs_AccelerationPedal  % MsgType=vehicle_msgs/AccelerationPedal
  TorqSts: Bus: SL_Bus_Demo_3D_Dynamics_cs_vehicle_msgs_TorqueStatus  % MsgType=vehicle_msgs/TorqueStatus
  Motor: Bus: SL_Bus_Demo_3D_Dynamics_cs_vehicle_msgs_Motor  % MsgType=vehicle_msgs/Motor

SL_Bus_Demo_3D_Dynamics_cs_vehicle_msgs_SteeringSystem = Simulink.Bus()  % MsgType=vehicle_msgs/SteeringSystem
  PnnagsaeDeg: single
  IsPnnagsaeDegVld: boolean
  PnnagsaeGrd: uint16
  DrvrStrgDlvrdToqNm: single
  IsDrvrStrgDlvrdToqVld: boolean
  AdasStrgDlvrdToqNm: single
  IsAdasStrgDlvrdToqVld: boolean
  LkaHptcRespEnum: uint16
  EpsCurModeEnum: uint16
  EpsAgRespStsEnum: uint16
  EpsAgRespStsInhEnum: uint16
  OverridedetnEnum: uint16
  EpsstsEnum: uint16

SL_Bus_Demo_3D_Dynamics_cs_vehicle_msgs_TorqueStatus = Simulink.Bus()  % MsgType=vehicle_msgs/TorqueStatus
  IsEptRdy: boolean
  EptTtlTorqNm: single
  IsEptTtlTorqVld: boolean
  EptMaxTorqNm: single
  IsEptMaxTorqVld: boolean

SL_Bus_Demo_3D_Dynamics_cs_vehicle_msgs_VehicleAcceleration = Simulink.Bus()  % MsgType=vehicle_msgs/VehicleAcceleration
  IsLongAcclVld: boolean
  LongAcclMS2: single
  IsLatAcclVld: boolean
  LatAcclMS2: single
  VehdynYawrateDegS: single
  IsVehdynYawrateVld: boolean

SL_Bus_Demo_3D_Dynamics_cs_vehicle_msgs_VehicleChassis = Simulink.Bus()  % MsgType=vehicle_msgs/VehicleChassis
  StdHeader: Bus: SL_Bus_Demo_3D_Dynamics_cs_base_msgs_Header  % MsgType=base_msgs/Header
  Vehdyn: Bus: SL_Bus_Demo_3D_Dynamics_cs_vehicle_msgs_VehicleDynamic  % MsgType=vehicle_msgs/VehicleDynamic
  Vehsttc: Bus: SL_Bus_Demo_3D_Dynamics_cs_vehicle_msgs_VehicleStatic  % MsgType=vehicle_msgs/VehicleStatic
  Brksys: Bus: SL_Bus_Demo_3D_Dynamics_cs_vehicle_msgs_BrakeSystem  % MsgType=vehicle_msgs/BrakeSystem
  Pt: Bus: SL_Bus_Demo_3D_Dynamics_cs_vehicle_msgs_PowerTrain  % MsgType=vehicle_msgs/PowerTrain
  Strsys: Bus: SL_Bus_Demo_3D_Dynamics_cs_vehicle_msgs_SteeringSystem  % MsgType=vehicle_msgs/SteeringSystem
  Whl: Bus: SL_Bus_Demo_3D_Dynamics_cs_vehicle_msgs_Wheel  % MsgType=vehicle_msgs/Wheel

SL_Bus_Demo_3D_Dynamics_cs_vehicle_msgs_VehicleDynamic = Simulink.Bus()  % MsgType=vehicle_msgs/VehicleDynamic
  Vehspd: Bus: SL_Bus_Demo_3D_Dynamics_cs_vehicle_msgs_VehicleSpeed  % MsgType=vehicle_msgs/VehicleSpeed
  Movgsts: Bus: SL_Bus_Demo_3D_Dynamics_cs_vehicle_msgs_MovingStatus  % MsgType=vehicle_msgs/MovingStatus
  Vehaccl: Bus: SL_Bus_Demo_3D_Dynamics_cs_vehicle_msgs_VehicleAcceleration  % MsgType=vehicle_msgs/VehicleAcceleration

SL_Bus_Demo_3D_Dynamics_cs_vehicle_msgs_VehicleSpeed = Simulink.Bus()  % MsgType=vehicle_msgs/VehicleSpeed
  IsVehspdVld: boolean
  VehspdMS: single
  VehspdKph: single
  DspVehSpdKph: single

SL_Bus_Demo_3D_Dynamics_cs_vehicle_msgs_VehicleStatic = Simulink.Bus()  % MsgType=vehicle_msgs/VehicleStatic
  IsIbsVld: boolean
  IsAntilockBrksysActv: boolean
  IsBrksysHillStAstStsActv: boolean
  IsEbdActv: boolean
  IsAvhActv: boolean
  IsAvhActvVld: boolean
  TractionCtrlSysActvEnum: uint8
  TractionCtrlSysModeEnum: uint16
  IsTractionCtrlSysEnbd: boolean
  IsTractionCtrlSysActv: boolean
  VseSysStsEnum: uint8
  VseSysModeEnum: uint16
  HdcSysStsEnum: uint16

SL_Bus_Demo_3D_Dynamics_cs_vehicle_msgs_Wheel = Simulink.Bus()  % MsgType=vehicle_msgs/Wheel
  Whlspdsts: Bus: SL_Bus_Demo_3D_Dynamics_cs_vehicle_msgs_WheelSpeed  % MsgType=vehicle_msgs/WheelSpeed
  Whlspdmovgdir: Bus: SL_Bus_Demo_3D_Dynamics_cs_vehicle_msgs_WheelMovingDir  % MsgType=vehicle_msgs/WheelMovingDir
  Whlplscnt: Bus: SL_Bus_Demo_3D_Dynamics_cs_vehicle_msgs_WheelPulseCnt  % MsgType=vehicle_msgs/WheelPulseCnt
  WhlBrkPrsStsEnum: uint16

SL_Bus_Demo_3D_Dynamics_cs_vehicle_msgs_WheelMovingDir = Simulink.Bus()  % MsgType=vehicle_msgs/WheelMovingDir
  IsFlWhlmvgdirVld: boolean
  FlWhlmvgdirEnum: uint16
  IsFrWhlmvgdirVld: boolean
  FrWhlmvgdirEnum: uint16
  IsRlWhlmvgdirVld: boolean
  RlWhlmvgdirEnum: uint16
  IsRrWhlmvgdirVld: boolean
  RrWhlmvgdirEnum: uint16

SL_Bus_Demo_3D_Dynamics_cs_vehicle_msgs_WheelPulseCnt = Simulink.Bus()  % MsgType=vehicle_msgs/WheelPulseCnt
  IsFlWhlplscntVld: boolean
  FlWhlplsCnt: uint16
  IsFrWhlplscntVld: boolean
  FrWhlplsCnt: uint16
  IsRlWhlplscntVld: boolean
  RlWhlplsCnt: uint16
  IsRrWhlplscntVld: boolean
  RrWhlplsCnt: uint16

SL_Bus_Demo_3D_Dynamics_cs_vehicle_msgs_WheelSpeed = Simulink.Bus()  % MsgType=vehicle_msgs/WheelSpeed
  IsFlWhlspdVld: boolean
  FlWhlspdKph: single
  IsFrWhlspdVld: boolean
  FrWhlspdKph: single
  IsRlWhlspdVld: boolean
  RlWhlspdKph: single
  IsRrWhlspdVld: boolean
  RrWhlspdKph: single

SL_Bus_Demo_3D_Dynamics_cs_p_msgs_IMU = Simulink.Bus()  % MsgType=p_msgs/IMU
  StdHeader: Bus: SL_Bus_Demo_3D_Dynamics_cs_base_msgs_Header  % MsgType=base_msgs/Header
  AccelXMS2: single
  AccelYMS2: single
  AccelZMS2: single
  GyroXDegS: single
  GyroYDegS: single
  GyroZDegS: single
  IsImuValid: boolean
  IsImuStatus: boolean
  ImuFeqHz: uint8
  AccBiasXMS2: single
  AccBiasYMS2: single
  AccBiasZMS2: single
  GyroBiasXDegS: single
  GyroBiasYDegS: single
  GyroBiasZDegS: single
  IsBiasValid: boolean
  ImuSynctimeUs: double  % Int64Type=uint64
  ImuTowMs: uint32
  ImuWeek: uint16
  ImuSyncstatusEnum: uint8
  ImuTemperature: double

SL_Bus_Demo_3D_Dynamics_cs_base_msgs_DelayStatisticsInfo = Simulink.Bus()  % MsgType=base_msgs/DelayStatisticsInfo
  TopicNameEnum: uint8
  PreNodePubTimestampNs: double  % Int64Type=int64
  ThisNodeSubTimestampNs: double  % Int64Type=int64
  NetworkTimegapNs: double  % Int64Type=int64

SL_Bus_Demo_3D_Dynamics_cs_base_msgs_DiagnosticTool = Simulink.Bus()  % MsgType=base_msgs/DiagnosticTool
  ProcStartTimestampNs: double  % Int64Type=int64
  PublishTimestampNs: double  % Int64Type=int64
  ProcessTimegapNs: double  % Int64Type=int64
  DelayStatisticsList: Bus: SL_Bus_Demo_3D_Dynamics_cs_base_msgs_DelayStatisticsInfo[10]  % MsgType=base_msgs/DelayStatisticsInfo

SL_Bus_Demo_3D_Dynamics_cs_base_msgs_ObjectClassification = Simulink.Bus()  % MsgType=base_msgs/ObjectClassification
  Value: uint8

SL_Bus_Demo_3D_Dynamics_cs_base_msgs_Point3f = Simulink.Bus()  % MsgType=base_msgs/Point3f
  XM: single
  YM: single
  ZM: single

SL_Bus_Demo_3D_Dynamics_cs_base_msgs_Vector3f = Simulink.Bus()  % MsgType=base_msgs/Vector3f
  X: single
  Y: single
  Z: single

SL_Bus_Demo_3D_Dynamics_cs_fusion_msgs_FusionObject = Simulink.Bus()  % MsgType=fusion_msgs/FusionObject
  Id: uint16
  IsValid: boolean
  ExistProbability: single
  ObstacleProbability: single
  LifeTimeS: single
  UpdateTimestampNs: double  % Int64Type=int64
  TrackingTypeEnum: uint8
  ContributingModuleBit: double  % Int64Type=int64
  ClassificationEnum: Bus: SL_Bus_Demo_3D_Dynamics_cs_base_msgs_ObjectClassification  % MsgType=base_msgs/ObjectClassification
  ClassificationProbability: single
  PosCenterM: Bus: SL_Bus_Demo_3D_Dynamics_cs_base_msgs_Point3f  % MsgType=base_msgs/Point3f
  PosRefM: Bus: SL_Bus_Demo_3D_Dynamics_cs_base_msgs_Point3f  % MsgType=base_msgs/Point3f
  RefEnum: uint8
  VelAbsMS: Bus: SL_Bus_Demo_3D_Dynamics_cs_base_msgs_Vector3f  % MsgType=base_msgs/Vector3f
  AccAbsMS2: Bus: SL_Bus_Demo_3D_Dynamics_cs_base_msgs_Vector3f  % MsgType=base_msgs/Vector3f
  YawRad: single
  YawRateRadS: single
  SizeM: Bus: SL_Bus_Demo_3D_Dynamics_cs_base_msgs_Vector3f  % MsgType=base_msgs/Vector3f
  MotionTypeEnum: uint8
  MotionDirectionEnum: uint8
  IsLightOnList: boolean[16]
  IsDoorOpenList: boolean[16]
  IsTrailer: boolean
  PolygonPointList: Bus: SL_Bus_Demo_3D_Dynamics_cs_base_msgs_Point3f[16]  % MsgType=base_msgs/Point3f:IsVarLen=1:VarLenCategory=data:VarLenElem=PolygonPointList_SL_Info:TruncateAction=warn
  PolygonPointList_SL_Info: Bus: SL_Bus_ROSVariableLengthArrayInfo  % IsVarLen=1:VarLenCategory=length:VarLenElem=PolygonPointList
  NumberOfPolygonPoint: uint8
  AssociatedLaneNum: uint8
  OlaAttributesList: Bus: SL_Bus_Demo_3D_Dynamics_cs_fusion_msgs_FusionOlaAttr[3]  % MsgType=fusion_msgs/FusionOlaAttr
  PosStd: Bus: SL_Bus_Demo_3D_Dynamics_cs_base_msgs_Vector3f  % MsgType=base_msgs/Vector3f
  VelAbsStd: Bus: SL_Bus_Demo_3D_Dynamics_cs_base_msgs_Vector3f  % MsgType=base_msgs/Vector3f
  AccAbsStd: Bus: SL_Bus_Demo_3D_Dynamics_cs_base_msgs_Vector3f  % MsgType=base_msgs/Vector3f
  YawRadStd: single
  AssociatedSlotId: double  % Int64Type=int64
  DebugBitList: double[128]  % IsVarLen=1:VarLenCategory=data:VarLenElem=DebugBitList_SL_Info:Int64Type=int64:TruncateAction=warn
  DebugBitList_SL_Info: Bus: SL_Bus_ROSVariableLengthArrayInfo  % IsVarLen=1:VarLenCategory=length:VarLenElem=DebugBitList
  IntentionNum: uint8
  IntentionList: Bus: SL_Bus_Demo_3D_Dynamics_cs_fusion_msgs_Intention[3]  % MsgType=fusion_msgs/Intention
  PredictedTrajectoryList: Bus: SL_Bus_Demo_3D_Dynamics_cs_fusion_msgs_PredictedTrajectory[16]  % MsgType=fusion_msgs/PredictedTrajectory:IsVarLen=1:VarLenCategory=data:VarLenElem=PredictedTrajectoryList_SL_Info:TruncateAction=warn
  PredictedTrajectoryList_SL_Info: Bus: SL_Bus_ROSVariableLengthArrayInfo  % IsVarLen=1:VarLenCategory=length:VarLenElem=PredictedTrajectoryList

SL_Bus_Demo_3D_Dynamics_cs_fusion_msgs_FusionObjects = Simulink.Bus()  % MsgType=fusion_msgs/FusionObjects
  StdHeader: Bus: SL_Bus_Demo_3D_Dynamics_cs_base_msgs_Header  % MsgType=base_msgs/Header
  DiagTool: Bus: SL_Bus_Demo_3D_Dynamics_cs_base_msgs_DiagnosticTool  % MsgType=base_msgs/DiagnosticTool
  NumberOfObjects: uint16
  Objects: Bus: SL_Bus_Demo_3D_Dynamics_cs_fusion_msgs_FusionObject[16]  % MsgType=fusion_msgs/FusionObject:IsVarLen=1:VarLenCategory=data:VarLenElem=Objects_SL_Info:TruncateAction=warn
  Objects_SL_Info: Bus: SL_Bus_ROSVariableLengthArrayInfo  % IsVarLen=1:VarLenCategory=length:VarLenElem=Objects

SL_Bus_Demo_3D_Dynamics_cs_fusion_msgs_FusionOlaAttr = Simulink.Bus()  % MsgType=fusion_msgs/FusionOlaAttr
  AssociatedLaneId: int32
  AssociatedLaneLeftPortion: single
  AssociatedLaneRightPortion: single
  AssociatedLaneLeftConfidence: single
  AssociatedLaneRightConfidence: single

SL_Bus_Demo_3D_Dynamics_cs_fusion_msgs_Intention = Simulink.Bus()  % MsgType=fusion_msgs/Intention
  IntentionTypeEnum: uint8
  IntentionProbability: single
  TimeToInteractNs: double  % Int64Type=int64

SL_Bus_Demo_3D_Dynamics_cs_fusion_msgs_PredictedTrajectory = Simulink.Bus()  % MsgType=fusion_msgs/PredictedTrajectory
  BeginTimestampNs: double  % Int64Type=int64
  PredictedPeriod: single
  Probability: single
  InteractiveTag: uint8
  Priority: uint8
  PredictedPoints: Bus: SL_Bus_Demo_3D_Dynamics_cs_PredictedTrajectoryPoint_h7q1bm[16]  % MsgType=fusion_msgs/PredictedTrajectoryPoint:IsVarLen=1:VarLenCategory=data:VarLenElem=PredictedPoints_SL_Info:TruncateAction=warn
  PredictedPoints_SL_Info: Bus: SL_Bus_ROSVariableLengthArrayInfo  % IsVarLen=1:VarLenCategory=length:VarLenElem=PredictedPoints

SL_Bus_Demo_3D_Dynamics_cs_PredictedTrajectoryPoint_h7q1bm = Simulink.Bus()  % MsgType=fusion_msgs/PredictedTrajectoryPoint
  Position: Bus: SL_Bus_Demo_3D_Dynamics_cs_base_msgs_Point3f  % MsgType=base_msgs/Point3f
  Yaw: single
  Linear: Bus: SL_Bus_Demo_3D_Dynamics_cs_base_msgs_Vector3f  % MsgType=base_msgs/Vector3f
  YawRate: single
  Acceleration: Bus: SL_Bus_Demo_3D_Dynamics_cs_base_msgs_Vector3f  % MsgType=base_msgs/Vector3f
  RelativeTime: single
  Probability: single

SL_Bus_ROSVariableLengthArrayInfo = Simulink.Bus()
  CurrentLength: uint32
  ReceivedLength: uint32

objLat_Bus = Simulink.Bus()
  ID_Lat: uint8[10]
  ObjSortNum_Lat: uint8[10]
  TTC_Lat: single[10]