% Simulink data dictionary ADAS.sldd
% references PubIfStateAEB_RTE.sldd
% references PvtParsAEB.sldd
% references PubIfBsw_StbMProxy.sldd
% references PubIfVCanV71_HEV_DHT_NEW_V400.sldd
% references PvtIfAEB.sldd

UINT64 = Simulink.AliasType(BaseType="uint64")
Param = Simulink.Parameter([], StorageClass="ExportedGlobal")

longObjCalcInfoDefaultParams = mpt.Parameter(struct(
  LongObjRawInfo=struct(
    FusionType=0,
    ObjectID=uint8(0),
    ObjectType=ObjectTypeCopy.UnknownType,
    ObjectTypeCameraConfirmed=0,
    ObjectLength=0,
    ObjectWidth=0,
    ObjectHight=0,
    ObjectAzimuthAngle=0,
    ObjectYawAngle=0,
    ObjectMovingState=AEB_ObjectMovingState.UnknownState,
    ObjectMovingOrientation=AEB_ObjectMovingOrientation.UnknownDir,
    dxFisrtDetection=0,
    dyFisrtDetection=0,
    dx=256,
    dy=0,
    dz=0,
    vx=0,
    vy=0,
    ax=0,
    ay=0,
    dxVariance=0,
    dyVariance=0,
    vxVariance=0,
    vyVariance=0,
    axVariance=0,
    ayVariance=0,
    ObjectLengthVar=0,
    ObjectWidthVar=0,
    ObjectYawAngleVar=0,
    ObjectTypeProb=0,
    ObjectMovingStateProb=0,
    ObjectMovingOrientationProb=0,
    ObjectExistProb=0,
    ObjectIsObstacleProb=0,
    ObjectRCS=0,
    ObjectMeasurementStatus=0,
    ObjectLifeCycle=0,
    dyObject2Center=0,
    dyEgo2Center=0,
    ObjUpdate=0,
    FR_ObjectID=0,
    FR_ObjectType=ObjectTypeCopy.UnknownType,
    FR_ObjectMovingState=AEB_ObjectMovingState.UnknownState,
    FR_ObjectMovingOrientation=AEB_ObjectMovingOrientation.UnknownDir,
    FR_Dx=0,
    FR_Dy=0,
    FR_Vx=0,
    FR_Vy=0,
    FC_ObjectID=0,
    FC_ObjectType=ObjectTypeCopy.UnknownType,
    FC_ObjectMovingState=AEB_ObjectMovingState.UnknownState,
    FC_ObjectMovingOrientation=AEB_ObjectMovingOrientation.UnknownDir,
    FC_Dx=0,
    FC_Dy=0,
    FC_Vx=0,
    FC_Vy=0),
  longObjAbsInfo=struct(dxFrontBumper=256, vxAbsObj=0, axAbsObj=0, ObjFusQuality=0),
  LongCollisionAssess=struct(
    longCollisionSeverity=CollisionSeverity.None,
    TTC=256,
    accelAvoidLowLvlBrk=0,
    lowLvlBrkFlg4Warning=0,
    lowLvlBrkFlg4Brake=0,
    accelAvoidHighLvlBrk4Warning=0,
    highLvlBrkFlg4Warning=0,
    accelAvoidHighLvlBrk4Brake=0,
    highLvlBrkFlg4Brake=0,
    accelLatAvoidLeft=0,
    accelLatAvoidRight=0,
    latAvoidFlg4Warning=0,
    latAvoidFlg4Brake=0),
  probEscape=0,
  overlapRatio=0), StorageClass="ExportedGlobal", DataType="Bus: BusLongObjCalcInfo")

latPedObjCalcInfoDefaultParams = mpt.Parameter(struct(
  latPedObjRawInfo=struct(
    FusionType=0,
    ObjectID=uint8(0),
    ObjectType=ObjectTypeCopy.UnknownType,
    ObjectTypeCameraConfirmed=0,
    ObjectLength=0,
    ObjectWidth=0,
    ObjectHight=0,
    ObjectAzimuthAngle=0,
    ObjectYawAngle=0,
    ObjectMovingState=AEB_ObjectMovingState.UnknownState,
    ObjectMovingOrientation=AEB_ObjectMovingOrientation.UnknownDir,
    dxFisrtDetection=0,
    dyFisrtDetection=0,
    dx=256,
    dy=0,
    dz=0,
    vx=0,
    vy=0,
    ax=0,
    ay=0,
    dxVariance=0,
    dyVariance=0,
    vxVariance=0,
    vyVariance=0,
    axVariance=0,
    ayVariance=0,
    ObjectLengthVar=0,
    ObjectWidthVar=0,
    ObjectYawAngleVar=0,
    ObjectTypeProb=0,
    ObjectMovingStateProb=0,
    ObjectMovingOrientationProb=0,
    ObjectExistProb=0,
    ObjectIsObstacleProb=0,
    ObjectRCS=0,
    ObjectMeasurementStatus=0,
    ObjectLifeCycle=0,
    ObjUpdate=0,
    FR_ObjectID=0,
    FR_ObjectType=ObjectTypeCopy.UnknownType,
    FR_ObjectMovingState=AEB_ObjectMovingState.UnknownState,
    FR_ObjectMovingOrientation=AEB_ObjectMovingOrientation.UnknownDir,
    FR_Dx=0,
    FR_Dy=0,
    FR_Vx=0,
    FR_Vy=0,
    FC_ObjectID=0,
    FC_ObjectType=ObjectTypeCopy.UnknownType,
    FC_ObjectMovingState=AEB_ObjectMovingState.UnknownState,
    FC_ObjectMovingOrientation=AEB_ObjectMovingOrientation.UnknownDir,
    FC_Dx=0,
    FC_Dy=0,
    FC_Vx=0,
    FC_Vy=0),
  latPedObjAbsInfo=struct(dxFrontBumper=256, vxAbsObj=0, axAbsObj=0, vyCorr=0, ObjFusQuality=0),
  CollisionRiskProb=0,
  pedCollisionRiskProb_TTC=0,
  PreCollisionFlg=0,
  pedPreCollisionFlg_TTC=0), StorageClass="ExportedGlobal", DataType="Bus: BusLatPedObjCalcInfo")

latCycObjCalcInfoDefaultParams = mpt.Parameter(struct(
  latCycObjRawInfo=struct(
    FusionType=0,
    ObjectID=uint8(0),
    ObjectType=ObjectTypeCopy.UnknownType,
    ObjectTypeCameraConfirmed=0,
    ObjectLength=0,
    ObjectWidth=0,
    ObjectHight=0,
    ObjectAzimuthAngle=0,
    ObjectYawAngle=0,
    ObjectMovingState=AEB_ObjectMovingState.UnknownState,
    ObjectMovingOrientation=AEB_ObjectMovingOrientation.UnknownDir,
    dxFisrtDetection=0,
    dyFisrtDetection=0,
    dx=256,
    dy=0,
    dz=0,
    vx=0,
    vy=0,
    ax=0,
    ay=0,
    dxVariance=0,
    dyVariance=0,
    vxVariance=0,
    vyVariance=0,
    axVariance=0,
    ayVariance=0,
    ObjectLengthVar=0,
    ObjectWidthVar=0,
    ObjectYawAngleVar=0,
    ObjectTypeProb=0,
    ObjectMovingStateProb=0,
    ObjectMovingOrientationProb=0,
    ObjectExistProb=0,
    ObjectIsObstacleProb=0,
    ObjectRCS=0,
    ObjectMeasurementStatus=0,
    ObjectLifeCycle=0,
    ObjUpdate=0,
    FR_ObjectID=uint8(0),
    FR_ObjectType=ObjectTypeCopy.UnknownType,
    FR_ObjectMovingState=AEB_ObjectMovingState.UnknownState,
    FR_ObjectMovingOrientation=AEB_ObjectMovingOrientation.UnknownDir,
    FR_Dx=0,
    FR_Dy=0,
    FR_Vx=0,
    FR_Vy=0,
    FC_ObjectID=uint8(0),
    FC_ObjectType=ObjectTypeCopy.UnknownType,
    FC_ObjectMovingState=AEB_ObjectMovingState.UnknownState,
    FC_ObjectMovingOrientation=AEB_ObjectMovingOrientation.UnknownDir,
    FC_Dx=0,
    FC_Dy=0,
    FC_Vx=0,
    FC_Vy=0),
  latCycObjAbsInfo=struct(dxFrontBumper=256, vxAbsObj=0, axAbsObj=0, vyCorr=0, ObjFusQuality=0),
  CollisionRiskProb=0,
  cycCollisionRiskProb_TTC=0,
  PreCollisionFlg=0,
  cycPreCollisionFlg_TTC=0), StorageClass="ExportedGlobal", DataType="Bus: BusLatCycObjCalcInfo")

JAPedObjCalcInfoDefaultParams = mpt.Parameter(struct(
  AEBJAPedObj=struct(
    FusionType=0,
    ObjectID=uint8(0),
    ObjectType=ObjectTypeCopy.UnknownType,
    ObjectTypeCameraConfirmed=0,
    ObjectLength=0,
    ObjectWidth=0,
    ObjectHight=0,
    ObjectAzimuthAngle=0,
    ObjectYawAngle=0,
    ObjectMovingState=AEB_ObjectMovingState.UnknownState,
    ObjectMovingOrientation=AEB_ObjectMovingOrientation.UnknownDir,
    dxFisrtDetection=0,
    dyFisrtDetection=0,
    dx=256,
    dy=0,
    dz=0,
    vx=0,
    vy=0,
    ax=0,
    ay=0,
    dxVariance=0,
    dyVariance=0,
    vxVariance=0,
    vyVariance=0,
    axVariance=0,
    ayVariance=0,
    ObjectLengthVar=0,
    ObjectWidthVar=0,
    ObjectYawAngleVar=0,
    ObjectTypeProb=0,
    ObjectMovingStateProb=0,
    ObjectMovingOrientationProb=0,
    ObjectExistProb=0,
    ObjectIsObstacleProb=0,
    ObjectRCS=0,
    ObjectMeasurementStatus=0,
    ObjectLifeCycle=0,
    ObjUpdate=0,
    FR_ObjectID=0,
    FR_ObjectType=ObjectTypeCopy.UnknownType,
    FR_ObjectMovingState=AEB_ObjectMovingState.UnknownState,
    FR_ObjectMovingOrientation=AEB_ObjectMovingOrientation.UnknownDir,
    FR_Dx=0,
    FR_Dy=0,
    FR_Vx=0,
    FR_Vy=0,
    FC_ObjectID=0,
    FC_ObjectType=ObjectTypeCopy.UnknownType,
    FC_ObjectMovingState=AEB_ObjectMovingState.UnknownState,
    FC_ObjectMovingOrientation=AEB_ObjectMovingOrientation.UnknownDir,
    FC_Dx=0,
    FC_Dy=0,
    FC_Vx=0,
    FC_Vy=0),
  AEBJAPedObjAbsInfo=struct(dxFrontBumper=256, vxAbsObj=0, axAbsObj=0, vyRelCorr=0, ObjFusQuality=0, ObjectYawAngleCorr=0),
  AEBJAPedObjColliInfo=struct(tPredictTime=256, ObjColliFlg=0)), StorageClass="ExportedGlobal", DataType="Bus: BusAEBJAPedObjCalcInfo")

JAVehObjCalcInfoDefaultParams = mpt.Parameter(struct(
  AEBJAVehObj=struct(
    FusionType=0,
    ObjectID=uint8(0),
    ObjectType=ObjectTypeCopy.UnknownType,
    ObjectTypeCameraConfirmed=0,
    ObjectLength=0,
    ObjectWidth=0,
    ObjectHight=0,
    ObjectAzimuthAngle=0,
    ObjectYawAngle=0,
    ObjectMovingState=AEB_ObjectMovingState.UnknownState,
    ObjectMovingOrientation=AEB_ObjectMovingOrientation.UnknownDir,
    dxFisrtDetection=0,
    dyFisrtDetection=0,
    dx=256,
    dy=0,
    dz=0,
    vx=0,
    vy=0,
    ax=0,
    ay=0,
    dxVariance=0,
    dyVariance=0,
    vxVariance=0,
    vyVariance=0,
    axVariance=0,
    ayVariance=0,
    ObjectLengthVar=0,
    ObjectWidthVar=0,
    ObjectYawAngleVar=0,
    ObjectTypeProb=0,
    ObjectMovingStateProb=0,
    ObjectMovingOrientationProb=0,
    ObjectExistProb=0,
    ObjectIsObstacleProb=0,
    ObjectRCS=0,
    ObjectMeasurementStatus=0,
    ObjectLifeCycle=0,
    ObjUpdate=0,
    FR_ObjectID=0,
    FR_ObjectType=ObjectTypeCopy.UnknownType,
    FR_ObjectMovingState=AEB_ObjectMovingState.UnknownState,
    FR_ObjectMovingOrientation=AEB_ObjectMovingOrientation.UnknownDir,
    FR_Dx=0,
    FR_Dy=0,
    FR_Vx=0,
    FR_Vy=0,
    FC_ObjectID=0,
    FC_ObjectType=ObjectTypeCopy.UnknownType,
    FC_ObjectMovingState=AEB_ObjectMovingState.UnknownState,
    FC_ObjectMovingOrientation=AEB_ObjectMovingOrientation.UnknownDir,
    FC_Dx=0,
    FC_Dy=0,
    FC_Vx=0,
    FC_Vy=0),
  AEBJAVehObjAbsInfo=struct(dxFrontBumper=256, vxAbsObj=0, axAbsObj=0, vyRelCorr=0, ObjFusQuality=0),
  AEBJAVehObjColliInfo=struct(tPredictTime=256, ObjColliFlg=0)), StorageClass="ExportedGlobal", DataType="Bus: BusAEBJAVehObjCalcInfo")

JACycObjCalcInfoDefaultParams = mpt.Parameter(struct(
  JaCycObj=struct(
    FusionType=0,
    ObjectID=uint8(0),
    ObjectType=ObjectTypeCopy.UnknownType,
    ObjectTypeCameraConfirmed=0,
    ObjectLength=0,
    ObjectWidth=0,
    ObjectHight=0,
    ObjectAzimuthAngle=0,
    ObjectYawAngle=0,
    ObjectMovingState=AEB_ObjectMovingState.UnknownState,
    ObjectMovingOrientation=AEB_ObjectMovingOrientation.UnknownDir,
    dxFisrtDetection=0,
    dyFisrtDetection=0,
    dx=256,
    dy=0,
    dz=0,
    vx=0,
    vy=0,
    ax=0,
    ay=0,
    dxVariance=0,
    dyVariance=0,
    vxVariance=0,
    vyVariance=0,
    axVariance=0,
    ayVariance=0,
    ObjectLengthVar=0,
    ObjectWidthVar=0,
    ObjectYawAngleVar=0,
    ObjectTypeProb=0,
    ObjectMovingStateProb=0,
    ObjectMovingOrientationProb=0,
    ObjectExistProb=0,
    ObjectIsObstacleProb=0,
    ObjectRCS=0,
    ObjectMeasurementStatus=0,
    ObjectLifeCycle=0,
    ObjUpdate=0,
    FR_ObjectID=0,
    FR_ObjectType=ObjectTypeCopy.UnknownType,
    FR_ObjectMovingState=AEB_ObjectMovingState.UnknownState,
    FR_ObjectMovingOrientation=AEB_ObjectMovingOrientation.UnknownDir,
    FR_Dx=0,
    FR_Dy=0,
    FR_Vx=0,
    FR_Vy=0,
    FC_ObjectID=0,
    FC_ObjectType=ObjectTypeCopy.UnknownType,
    FC_ObjectMovingState=AEB_ObjectMovingState.UnknownState,
    FC_ObjectMovingOrientation=AEB_ObjectMovingOrientation.UnknownDir,
    FC_Dx=0,
    FC_Dy=0,
    FC_Vx=0,
    FC_Vy=0),
  JaCycObjAbsInfo=struct(dxFrontBumper=256, vxAbsObj=0, axAbsObj=0, vyRelCorr=0, ObjFusQuality=0, ObjectYawAngleCorr=0),
  JaCycObjColliInfo=struct(tPredictTime=256, ObjColliFlg=0)), StorageClass="ExportedGlobal", DataType="Bus: BusAEBJaCycObjCalcInfo")

P_Global_CURB_kg = Simulink.Parameter(1727, StorageClass="ExportedGlobal", DataType="single", Unit="kg")  % 车辆特征车速（过渡转向和转向不足的临界车速，ESP提供）
P_Global_CharSpd_ms = Simulink.Parameter(22, StorageClass="ExportedGlobal", DataType="single", Unit="m/s")  % 整备质量
P_Global_DxvFrontBumper_m = Simulink.Parameter(3.777, StorageClass="ExportedGlobal", DataType="single", Unit="m")  % 后轴到前杠前边缘的X向位置
P_Global_DxvRearBumper_m = Simulink.Parameter(-1.002, StorageClass="ExportedGlobal", DataType="single", Unit="m")  % 后轴中心到后杠后边缘中心的X向位置
P_Global_EHRV3CALIBRA_DIS_DX = Simulink.Parameter(0, StorageClass="ExportedGlobal", DataType="single", Unit="m")  % 地图盒子坐标轴到后轴中心点的X向位置
P_Global_EHRV3CALIBRA_DIS_DY = Simulink.Parameter(0, StorageClass="ExportedGlobal", DataType="single", Unit="m")  % 地图盒子坐标轴到后轴中心点的Y向位置
P_Global_EQ2LeftWheel_m = Simulink.Parameter(0.901, StorageClass="ExportedGlobal", DataType="single", Unit="m")  % 摄像头光心到左轮的Y向距离
P_Global_EQ2RearAxisX_m = Simulink.Parameter(1.884, StorageClass="ExportedGlobal", DataType="single", Unit="m")  % 后轴中心点到摄像头光心的X向位置
P_Global_EQ2RearAxisY_m = Simulink.Parameter(-0.093, StorageClass="ExportedGlobal", DataType="single", Unit="m")  % 摄像头光心到后轴中心点的Y向位置
P_Global_EQ2RightWheel_m = Simulink.Parameter(0.732, StorageClass="ExportedGlobal", DataType="single", Unit="m")  % 摄像头光心到右轮的Y向距离
P_Global_Empty_mass_kg = Simulink.Parameter(1727, StorageClass="ExportedGlobal", DataType="single", Unit="kg")  % 空载
P_Global_FrontAxleToCenter_m = Simulink.Parameter(1.2065, StorageClass="ExportedGlobal", DataType="single", Unit="m")  % 前轴距到车辆质心距离
P_Global_GVW_kg = Simulink.Parameter(2102, StorageClass="ExportedGlobal", DataType="single", Unit="kg")  % 满载
P_Global_Height_m = Simulink.Parameter(1.679, StorageClass="ExportedGlobal", DataType="single", Unit="m")  % 地面到车顶高度Z向位置
P_Global_IEnviroment_Bottom_Crop = Simulink.Parameter(-94, StorageClass="ExportedGlobal", DataType="int16", Unit="pixel")  % 底部剪切范围（默认-90）
P_Global_IEnviroment_Top_Crop = Simulink.Parameter(135, StorageClass="ExportedGlobal", DataType="uint16", Unit="pixel")  % 顶部剪切范围（默认120）
P_Global_IEnvironment_CamToFrontAxle = Simulink.Parameter(0.842, StorageClass="ExportedGlobal", DataType="single", Unit="m")  % 摄像头光心到前轴中心点的X向距离
P_Global_IEnvironment_RefPX_Front_Bumper = Simulink.Parameter(1.93, StorageClass="ExportedGlobal", DataType="single", Unit="m")  % 摄像头到前保险杠的X向距离偏移量
P_Global_IEnvironment_WheelWidth = Simulink.Parameter(0.235, StorageClass="ExportedGlobal", DataType="single", Unit="m")  % 车轮宽度
P_Global_RadarToRearAxleCenterX_m = Simulink.Parameter(3.733, StorageClass="ExportedGlobal", DataType="single", Unit="m")  % 前雷达安装位置到后轴中心点的X向位置
P_Global_RadarToRearAxleCenterY_m = Simulink.Parameter(0, StorageClass="ExportedGlobal", DataType="single", Unit="m")  % 前雷达安装位置到后轴中心点的Y向位置
P_Global_RearAxleToCenter_m = Simulink.Parameter(1.592, StorageClass="ExportedGlobal", DataType="single", Unit="m")  % 后轴到车辆质心的X向位置
P_Global_SideSlipAnglefactor = Simulink.Parameter(0.002, StorageClass="ExportedGlobal", DataType="single")  % 侧滑角系数
P_Global_SteeringAngleRatio = Simulink.Parameter(16.39, StorageClass="ExportedGlobal", DataType="single")  % 方向盘与前轮转角传动比
P_Global_TAC_Bottom = Simulink.Parameter(-94, StorageClass="ExportedGlobal", DataType="int8", Unit="pixel")  % 底部剪切值（默认值-90）
P_Global_TAC_Camera_Height = Simulink.Parameter(1.508, StorageClass="ExportedGlobal", DataType="single", Unit="m")  % 摄像头距地面的高度Hc
P_Global_TAC_Targets_Num = Simulink.Parameter(2, StorageClass="ExportedGlobal", DataType="uint8", Unit="个")  % 目标数量
P_Global_TireRadius_m = Simulink.Parameter(0.36, StorageClass="ExportedGlobal", DataType="single", Unit="m")  % 轮胎半径
P_Global_VehiclePowerType = Simulink.Parameter(0, StorageClass="ExportedGlobal", DataType="uint8")  % 动力形式，0-V71混动；1-V61混动
P_Global_VehicleWidthMax_m = Simulink.Parameter(2.126, StorageClass="ExportedGlobal", DataType="single", Unit="m")  % 最大车宽
P_Global_VehicleWidthMin_m = Simulink.Parameter(1.89, StorageClass="ExportedGlobal", DataType="single", Unit="m")  % 最小车宽
P_Global_Vehicle_Length_m = Simulink.Parameter(4.78, StorageClass="ExportedGlobal", DataType="single", Unit="m")  % 车长
P_Global_Weight_N = Simulink.Parameter(16925, StorageClass="ExportedGlobal", DataType="single", Unit="N")  % 车重
P_Global_WheelBase_m = Simulink.Parameter(2.8, StorageClass="ExportedGlobal", DataType="single", Unit="m")  % 轴距
P_Global_WheelTrack_m = Simulink.Parameter(1.63, StorageClass="ExportedGlobal", DataType="single", Unit="m")  % 轮距
collisionSeverityLowFlg = AUTOSAR4.Signal(SwCalibrationAccess="ReadOnly", StorageClass="ExportedGlobal")
collisionSeverityMediumFlg = AUTOSAR4.Signal(SwCalibrationAccess="ReadOnly", StorageClass="ExportedGlobal")
collisionSeverityHighFlg = AUTOSAR4.Signal(SwCalibrationAccess="ReadOnly", StorageClass="ExportedGlobal")
FCW_AEB_VehFctSts = AUTOSAR4.Signal(SwCalibrationAccess="ReadOnly", StorageClass="ExportedGlobal")
FCW_AEB_PedFctSts = AUTOSAR4.Signal(SwCalibrationAccess="ReadOnly", StorageClass="ExportedGlobal")
FCW_AEB_JAFctSts = AUTOSAR4.Signal(SwCalibrationAccess="ReadOnly", StorageClass="ExportedGlobal")
AEB_VehResp = AUTOSAR4.Signal(SwCalibrationAccess="ReadOnly", StorageClass="ExportedGlobal")
AEB_PedResp = AUTOSAR4.Signal(SwCalibrationAccess="ReadOnly", StorageClass="ExportedGlobal")
AEB_JAResp = AUTOSAR4.Signal(SwCalibrationAccess="ReadOnly", StorageClass="ExportedGlobal")
vehAssociatedSysStsSuppFlg = AUTOSAR4.Signal(SwCalibrationAccess="ReadOnly", StorageClass="ExportedGlobal")
vehUnstableSts = AUTOSAR4.Signal(SwCalibrationAccess="ReadOnly", StorageClass="ExportedGlobal")
FCWSnvty_Check = AUTOSAR4.Signal(SwCalibrationAccess="ReadOnly", StorageClass="ExportedGlobal")
TCUOperatingStateSuppFlg0 = AUTOSAR4.Signal(SwCalibrationAccess="ReadOnly", StorageClass="ExportedGlobal")
ESPOperatingStateSuppFlg0 = AUTOSAR4.Signal(SwCalibrationAccess="ReadOnly", StorageClass="ExportedGlobal")
DrvModOperatingStateSuppFlg0 = AUTOSAR4.Signal(SwCalibrationAccess="ReadOnly", StorageClass="ExportedGlobal")
bodyCtrlSuppFlg0 = AUTOSAR4.Signal(SwCalibrationAccess="ReadOnly", StorageClass="ExportedGlobal")
EngStateSuppFlg0 = AUTOSAR4.Signal(SwCalibrationAccess="ReadOnly", StorageClass="ExportedGlobal")
TrailerStsSuppFlg0 = AUTOSAR4.Signal(SwCalibrationAccess="ReadOnly", StorageClass="ExportedGlobal")
longObjInfo = AUTOSAR4.Signal(SwCalibrationAccess="ReadOnly", StorageClass="ExportedGlobal")