% Simulink data dictionary PubIfBswStbM.sldd

P_Dem_UdsStatusByteType = Simulink.Parameter(0, DataType="Dem_UdsStatusByteType")
P_Dem_DTCFormatType = Simulink.Parameter(0, DataType="Dem_DTCFormatType")
P_Dem_DebouncingStateType = Simulink.Parameter(0, DataType="Dem_DebouncingStateType")
P_Dem_MaxDataValueType = Simulink.Parameter([0 0 0 0], DataType="Dem_MaxDataValueType")
P_Dem_EventIdType = Simulink.Parameter(0, DataType="Dem_EventIdType")
P_Std_ReturnType = Simulink.Parameter(0, DataType="uint8")
P_StbM_TimeStampExtendedType = Simulink.Parameter(struct(timeBaseStatus=uint8(0), nanoseconds=uint32(0), seconds=fi(0, 0, 64, 0)), DataType="Bus: StbM_TimeStampExtendedType")
P_StbM_UserDataType = Simulink.Parameter(struct(userDataLength=uint8(0), userByte0=uint8(0), userByte1=uint8(0), userByte2=uint8(0)), DataType="Bus: StbM_UserDataType")
Dem_UdsStatusByteType = Simulink.AliasType(BaseType="uint8")
Dem_DTCFormatType = Simulink.AliasType(BaseType="uint8")
StbM_TimeBaseStatusType = Simulink.AliasType(BaseType="uint8")
Dem_EventIdType = Simulink.AliasType(BaseType="uint16")
Dem_MaxDataValueType = Simulink.AliasType(BaseType="uint8")
Dem_DebouncingStateType = Simulink.AliasType(BaseType="uint8")

StbM_TimeStampType = Simulink.Bus()
  timeBaseStatus: StbM_TimeBaseStatusType
  nanoseconds: uint32
  seconds: uint32
  secondsHi: uint16

StbM_UserDataType = Simulink.Bus()
  userDataLength: uint8
  userByte0: uint8
  userByte1: uint8
  userByte2: uint8