% Simulink data dictionary PubIfBsw_StbMProxy.sldd
% references ADAS.sldd

UInt64 = Simulink.AliasType(BaseType="uint64")
P_StbM_Proxy_TimeStampExtendedType = Simulink.Parameter(struct(timeBaseStatus=uint8(0), nanoseconds=uint32(0), seconds=fi(0, 0, 64, 0)), StorageClass="ExportedGlobal", DataType="Bus: StbM_Proxy_TimeStampExtendedType")