% Simulink data dictionary PubIfChassisAHBC_RTE.sldd

AHBC_ADB_BUS = Simulink.Bus()
  CameraSts: uint8
  AmbLight: boolean
  RoadIllumDetd: boolean
  Trafficstyle: uint8
  Spots1Valid: boolean
  Spots1Typ: uint8
  Spots1HozlPosnRiAng: single
  Spots1HozlPosnLeAng: single
  Spots1Distance: uint16
  Spots1HozLeAngSpd: single
  Spot1VertAng: single
  Spots1TrackingInfo: boolean
  Spots1VehObjClassn: uint8
  Spots2Valid: boolean
  Spots2Typ: uint8
  Spots2HozlPosnRiAng: single
  Spots2HozlPosnLeAng: single
  Spots2Distance: uint16
  Spots2HozLeAngSpd: single
  Spot2VertAng: single
  Spots2TrackingInfo: boolean
  Spots2VehObjClassn: uint8
  Spots3Valid: boolean
  Spots3Typ: uint8
  Spots3HozlPosnRiAng: single
  Spots3HozlPosnLeAng: single
  Spots3Distance: uint16
  Spots3HozLeAngSpd: single
  Spot3VertAng: single
  Spots3TrackingInfo: boolean
  Spots3VehObjClassn: uint8
  Spots4Valid: boolean
  Spots4Typ: uint8
  Spots4HozlPosnRiAng: single
  Spots4HozlPosnLeAng: single
  Spots4Distance: uint16
  Spots4HozLeAngSpd: single
  Spot4VertAng: single
  Spots4TrackingInfo: boolean
  Spots4VehObjClassn: uint8
  Spots5Valid: boolean
  Spots5Typ: uint8
  Spots5HozlPosnRiAng: single
  Spots5HozlPosnLeAng: single
  Spots5Distance: uint16
  Spots5HozLeAngSpd: single
  Spot5VertAng: single
  Spots5TrackingInfo: boolean
  Spots5VehObjClassn: uint8
  Spots6Valid: boolean
  Spots6Typ: uint8
  Spots6HozlPosnRiAng: single
  Spots6HozlPosnLeAng: single
  Spots6Distance: uint16
  Spots6HozLeAngSpd: single
  Spot6VertAng: single
  Spots6TrackingInfo: boolean
  Spots6VehObjClassn: uint8
  Spots7Valid: boolean
  Spots7Typ: uint8
  Spots7HozlPosnRiAng: single
  Spots7HozlPosnLeAng: single
  Spots7Distance: uint16
  Spots7HozLeAngSpd: single
  Spot7VertAng: single
  Spots7TrackingInfo: boolean
  Spots7VehObjClassn: uint8
  Spots8Valid: boolean
  Spots8Typ: uint8
  Spots8HozlPosnRiAng: single
  Spots8HozlPosnLeAng: single
  Spots8Distance: uint16
  Spots8HozLeAngSpd: single
  Spot8VertAng: single
  Spots8TrackingInfo: boolean
  Spots8VehObjClassn: uint8

AHBC_HMA_BUS = Simulink.Bus()
  HMA_Sts: uint8
  HMA_HibeamReq: uint8

AHBC_VCAN_ESP_BUS = Simulink.Bus()
  VehSpd: single
  FLWheelDriveDirection: uint8
  FRWheelDriveDirection: uint8
  RLWheelDriveDirection: uint8
  RRWheelDriveDirection: uint8
  ABSActv: boolean
  VDCActv: boolean
  BTCActv: boolean
  PTCActv: boolean
  MSRActv: boolean

AHBC_VCAN_GW_BUS = Simulink.Bus()
  CURRENT_GEAR: uint8
  FrntWiprSwtSts: uint8
  WiprReq_F_PBOX: uint8
  FFogLmpSts_F_Pbox: boolean
  LTurnLmpSwtSts: boolean
  RTurnLmpSwtSts: boolean
  VehYawRate: single
  VehLatAccel: single
  RFogLmpSts_R_Pbox: boolean