% Simulink data dictionary PubIfCommonEHRV2_RTE.sldd

EHRV2_TRAFFIC_INFO_VAL = struct(
  i_spd_lmt_front_info=uint8(0),
  i_end_of_spd_lmt_front_info=uint8(0),
  i_end_of_spd_lmt_front_dis=uint16(0),
  i_traffic_sign_type=uint8(0),
  i_traffic_sign_dis=uint16(0))

EHRV2_TRAFFIC_INFO_PAR = AUTOSAR4.Parameter(struct(
  i_spd_lmt_front_info=uint8(0),
  i_end_of_spd_lmt_front_info=uint8(0),
  i_end_of_spd_lmt_front_dis=uint16(0),
  i_traffic_sign_type=uint8(0),
  i_traffic_sign_dis=uint16(0)), SwCalibrationAccess="ReadWrite", StorageClass="Global", DataType="Bus:EHRV2_TRAFFIC_INFO_BUS")

EHRV2_ROAD_ROI_VAL = struct(
  i_toll_booth_front_info=uint8(0),
  i_toll_booth_dis=uint16(0),
  i_enter_bridge_info=uint8(0),
  i_bridge_dis=uint16(0),
  i_enter_tunnel_info=uint8(0),
  i_tunnel_dis=uint16(0),
  i_enter_service_info=uint8(0),
  i_service_dis=uint16(0))

EHRV2_ROAD_ROI_PAR = AUTOSAR4.Parameter(struct(
  i_toll_booth_front_info=uint8(0),
  i_toll_booth_dis=uint16(0),
  i_enter_bridge_info=uint8(0),
  i_bridge_dis=uint16(0),
  i_enter_tunnel_info=uint8(0),
  i_tunnel_dis=uint16(0),
  i_enter_service_info=uint8(0),
  i_service_dis=uint16(0)), SwCalibrationAccess="ReadWrite", StorageClass="Global", DataType="Bus:EHRV2_ROAD_ROI_BUS")

EHRV2_META_INFO_VAL = struct(i_spd_lmt_unit=uint8(0), i_drv_side=uint8(0))
EHRV2_META_INFO_PAR = AUTOSAR4.Parameter(struct(i_spd_lmt_unit=uint8(0), i_drv_side=uint8(0)), SwCalibrationAccess="ReadWrite", StorageClass="Global", DataType="Bus:EHRV2_META_INFO_BUS")
EHRV2_HDR_VAL = struct(MapDataValid=uint8(0), ErrorCode=uint32(0))
EHRV2_HDR_PAR = AUTOSAR4.Parameter(struct(MapDataValid=uint8(0), ErrorCode=uint32(0)), SwCalibrationAccess="ReadWrite", StorageClass="Global", DataType="Bus:EHRV2_HDR_BUS")
EHRV2_HutHandshake_PAR = Simulink.Parameter(0, StorageClass="ExportedGlobal", DataType="uint8")
P_EHRV2_OC_SWT = Simulink.Parameter(0, StorageClass="SimulinkGlobal", DataType="uint8")

EHRV2_ROAD_INFO_PAR = AUTOSAR4.Parameter(struct(
  i_func_road_class=uint8(0),
  i_form_of_way=uint8(0),
  i_spd_lmt_type=uint8(0),
  i_spd_lmt=uint8(0),
  i_lane_num_cur_drv=uint8(0),
  i_lane_num_cur_opp=uint8(0),
  i_electronic_eye_distance=uint16(0),
  i_electronic_eye_speed_limit=uint8(0),
  i_road_curvature=single(-1),
  i_road_curvature_far=single(-1),
  i_road_curvature_far_distance=uint16(0),
  i_road_slope=single(-60),
  i_road_slope_far=single(-60),
  i_road_curvature_value_matrix=single(repmat(-1, 1, 10)),
  i_road_curvature_distance_matrix=single(repmat(0, 1, 10)),
  i_road_curvature_matrix_size=uint8(0),
  i_road_slope_value_matrix=single(repmat(-60, 1, 10)),
  i_road_slope_distance_matrix=single(repmat(0, 1, 10)),
  i_road_slope_matrix_size=uint8(0),
  i_multi_way_intersection_distance=uint16(0)), SwCalibrationAccess="ReadWrite", StorageClass="Global", DataType="Bus:EHRV2_ROAD_INFO_BUS")

EHRV2_ROAD_INFO_VAL = struct(
  i_func_road_class=uint8(0),
  i_form_of_way=uint8(0),
  i_spd_lmt_type=uint8(0),
  i_spd_lmt=uint8(0),
  i_lane_num_cur_drv=uint8(0),
  i_lane_num_cur_opp=uint8(0),
  i_electronic_eye_distance=uint16(0),
  i_electronic_eye_speed_limit=uint8(0),
  i_road_curvature=single(-1),
  i_road_curvature_far=single(-1),
  i_road_curvature_far_distance=uint16(0),
  i_road_slope=single(-60),
  i_road_slope_far=single(-60),
  i_road_curvature_value_matrix=single(repmat(-1, 1, 10)),
  i_road_curvature_distance_matrix=single(repmat(0, 1, 10)),
  i_road_curvature_matrix_size=uint8(0),
  i_road_slope_value_matrix=single(repmat(-60, 1, 10)),
  i_road_slope_distance_matrix=single(repmat(0, 1, 10)),
  i_road_slope_matrix_size=uint8(0),
  i_multi_way_intersection_distance=uint16(0))

EHRV2_DYNAMIC_INFO_PAR = AUTOSAR4.Parameter(struct(
  i_traffic_jam_info=uint8(0),
  i_traffic_jam_dis=uint16(0),
  i_traffic_event_info=uint8(0),
  i_traffic_event_dis=uint16(0),
  i_weather_info=uint8(0),
  i_temperature=int8(-63),
  i_traffic_jam_distance_hold=uint16(0),
  i_repair_road_point_distance=uint16(0),
  i_ctrl_point_distance=uint16(0),
  i_build_up_area=uint8(0),
  i_cmplx_insct_distance=uint16(0),
  i_country_code=uint16(0)), SwCalibrationAccess="ReadWrite", StorageClass="Global", DataType="Bus:EHRV2_DYNAMIC_INFO_BUS")

EHRV2_DYNAMIC_INFO_VAL = struct(
  i_traffic_jam_info=uint8(0),
  i_traffic_jam_dis=uint16(0),
  i_traffic_event_info=uint8(0),
  i_traffic_event_dis=uint16(0),
  i_weather_info=uint8(0),
  i_temperature=int8(-63),
  i_traffic_jam_distance_hold=uint16(0),
  i_repair_road_point_distance=uint16(0),
  i_ctrl_point_distance=uint16(0),
  i_build_up_area=uint8(0),
  i_cmplx_insct_distance=uint16(0),
  i_country_code=uint16(0))

EHRV2_NAV_STUB_PAR = AUTOSAR4.Parameter(struct(i_stub_type=uint8(0), i_stub_dis=uint16(0), i_stub_direc=uint8(0), i_stub_ramp_type=uint8(0)), SwCalibrationAccess="ReadWrite", StorageClass="Global", DataType="Bus:EHRV2_NAV_STUB_BUS")
EHRV2_NAV_STUB_VAL = struct(i_stub_type=uint8(0), i_stub_dis=uint16(0), i_stub_direc=uint8(0), i_stub_ramp_type=uint8(0))
i_suggest_lanes_PAR = Simulink.Parameter(0, StorageClass="ExportedGlobal", DataType="uint8")
DistanceOfSuggestPoint_PAR = Simulink.Parameter(0, StorageClass="ExportedGlobal", DataType="uint16")
i_on_nav_path_PAR = Simulink.Parameter(0, DataType="uint8")
IM_EHRV2_VCAN_ESP = AUTOSAR4.Signal(SwCalibrationAccess="ReadOnly", StorageClass="Global", MemorySection="VAR")
IM_EHRV2_VCAN_HUT = AUTOSAR4.Signal(SwCalibrationAccess="ReadOnly", StorageClass="Global", MemorySection="VAR")
IM_EcuMod = AUTOSAR4.Signal(SwCalibrationAccess="ReadOnly", StorageClass="Global", MemorySection="VAR")
OC_EHRV2_HDR = AUTOSAR4.Signal(SwCalibrationAccess="ReadOnly", StorageClass="Global", MemorySection="VAR")
OC_EHRV2_HutHandshake = AUTOSAR4.Signal(SwCalibrationAccess="ReadOnly", StorageClass="Global", MemorySection="VAR")
OC_EHRV2_ROAD_ROI = AUTOSAR4.Signal(SwCalibrationAccess="ReadOnly", StorageClass="Global", MemorySection="VAR")
OC_EHRV2_ROAD_INFO = AUTOSAR4.Signal(SwCalibrationAccess="ReadOnly", StorageClass="Global", MemorySection="VAR")
OC_EHRV2_NAV_INFO = AUTOSAR4.Signal(SwCalibrationAccess="ReadOnly", StorageClass="Global", MemorySection="VAR")
OC_EHRV2_DYNAMIC_INFO = AUTOSAR4.Signal(SwCalibrationAccess="ReadOnly", StorageClass="Global", MemorySection="VAR")
OC_EHRV2_TRAFFIC_INFO = AUTOSAR4.Signal(SwCalibrationAccess="ReadOnly", StorageClass="Global", MemorySection="VAR")
OC_EHRV2_META_INFO = AUTOSAR4.Signal(SwCalibrationAccess="ReadOnly", StorageClass="Global", MemorySection="VAR")

EHRV2_DYNAMIC_INFO_BUS = Simulink.Bus()
  i_traffic_jam_info: uint8  % 前方是否出现交通拥堵
  i_traffic_jam_dis: uint16  % 距交通拥堵距离
  i_traffic_event_info: uint8  % 前方是否有交通事故
  i_traffic_event_dis: uint16  % 距交通事故距离
  i_weather_info: uint8  % 前方天气
  i_temperature: int8  % 当前车辆位置、当前时刻的温度信息
  i_traffic_jam_distance_hold: uint16  % 前方拥堵路段持续距离
  i_repair_road_point_distance: uint16  % 距前方修路点距离
  i_ctrl_point_distance: uint16  % 距前方控制点距离
  i_build_up_area: uint8  % 当前行驶路段是否位于城市/郊区信息
  i_cmplx_insct_distance: uint16  % 距前方复杂路口距离
  i_country_code: uint16  % 国家代码

EHRV2_HDR_BUS = Simulink.Bus()
  MapDataValid: uint8  % 地图数据是否有效
  ErrorCode: uint32

EHRV2_META_INFO_BUS = Simulink.Bus()
  i_spd_lmt_unit: uint8
  i_drv_side: uint8

EHRV2_NAV_INFO_BUS = Simulink.Bus()
  i_suggest_lanes: uint8
  DistanceOfSuggestPoint: uint16
  st_split_stub: Bus: EHRV2_NAV_STUB_BUS[5]
  st_merge_stub: Bus: EHRV2_NAV_STUB_BUS[5]
  i_on_nav_path: uint8  % 是否行驶在导航路径上

EHRV2_NAV_STUB_BUS = Simulink.Bus()
  i_stub_type: uint8  % 路口类型
  i_stub_dis: uint16  % 距离路口距离
  i_stub_direc: uint8  % 方向
  i_stub_ramp_type: uint8  % 表现前方行驶意图

EHRV2_ROAD_INFO_BUS = Simulink.Bus()
  i_func_road_class: uint8  % 当前道路的道路等级
  i_form_of_way: uint8  % 行驶在主干道上
  i_spd_lmt_type: uint8  % 当前道路限速类型
  i_spd_lmt: uint8  % 当前道路限速值
  i_lane_num_cur_drv: uint8  % 驾驶方向的车道数量（不包含紧急车道）
  i_lane_num_cur_opp: uint8
  i_electronic_eye_distance: uint16  % 前方与电子眼距离
  i_electronic_eye_speed_limit: uint8  % 前方电子眼限速信息
  i_road_curvature: single  % 当前车辆位置处曲率(左正右负)
  i_road_curvature_far: single  % 当前车辆位置前方Xm内最大曲率(左正右负)
  i_road_curvature_far_distance: uint16  % 当前车辆位置与前方Xm内最大曲率点相对距离
  i_road_slope: single  % 当前车辆位置处坡度（上坡正下坡负）
  i_road_slope_far: single  % 当前车辆位置前方Xm处坡度（上坡正下坡负）
  i_road_curvature_value_matrix: single[10]  % 当前车辆位置前方300m内所有曲率点的曲率值（左正右负）
  i_road_curvature_distance_matrix: single[10]  % 当前车辆位置前方300m内所有曲率点与自车距离值（与曲率点一一对应）
  i_road_curvature_matrix_size: uint8  % 当前车辆位置前方300m内所有曲率点个数（0表示EHR数据库中无前方曲率数据）
  i_road_slope_value_matrix: single[10]  % 当前车辆位置前方300m内所有坡度点的坡度值（上坡正下坡负）
  i_road_slope_distance_matrix: single[10]  % 当前车辆位置前方300m内所有坡度点与自车距离值（与坡度点一一对应）
  i_road_slope_matrix_size: uint8  % 当前车辆位置前方300m内所有坡度点个数（0表示EHR数据库中无前方坡度数据）
  i_multi_way_intersection_distance: uint16  % 距前方多叉路口距离

EHRV2_ROAD_ROI_BUS = Simulink.Bus()
  i_toll_booth_front_info: uint8  % 前方是否有收费站
  i_toll_booth_dis: uint16  % 本车距收费站距离
  i_enter_bridge_info: uint8  % 车辆是否在桥梁
  i_bridge_dis: uint16  % 距桥梁距离
  i_enter_tunnel_info: uint8  % 车辆是否在隧道
  i_tunnel_dis: uint16  % 距隧道距离
  i_enter_service_info: uint8  % 车辆是否在服务区
  i_service_dis: uint16  % 距服务区距离

EHRV2_TRAFFIC_INFO_BUS = Simulink.Bus()
  i_spd_lmt_front_info: uint8
  i_end_of_spd_lmt_front_info: uint8
  i_end_of_spd_lmt_front_dis: uint16
  i_traffic_sign_type: uint8
  i_traffic_sign_dis: uint16

EHRV2_VCAN_META_BUS = Simulink.Bus()
  ADAS_Meta_CountryCode: uint16  % 国家代码
  ADAS_Meta_MapProvider: uint8  % 地图供应商
  ADAS_Meta_MsgTyp: uint8  % 标识该消息位meta data message
  ADAS_Meta_HwVer: uint16  % 生成器的硬件和/或 软件版本
  ADAS_Meta_ProtVer_MinorSub: uint8  % 次要协议子版本
  ADAS_Meta_ProtVer_Major: uint8  % 主要协议版本
  ADAS_Meta_CycCnt: uint8  % 这个message type的循环计数器
  ADAS_Meta_RegionCode: uint16  % 区域代码
  ADAS_Meta_DrvSide: boolean  % 驾驶方向
  ADAS_Meta_MapVerYear: uint8  % 地图版本年
  ADAS_Meta_MapVerQtr: uint8  % 地图版本季度
  ADAS_Meta_ProtVer_Minor: uint8  % 次要协议版本
  ADAS_Meta_SpdUnits: boolean  % 限速单位

EHRV2_VCAN_POSN_BUS = Simulink.Bus()
  ADAS_Posn_Offset: uint16  % 车辆距路径起点位置
  ADAS_Posn_MsgTye: uint8  % 标识该消息为Position Message
  ADAS_Posn_Pathldx: uint8  % 当前Path索引号
  ADAS_Posn_CycCnt: uint8  % Position Message的循环计数器
  ADAS_Posn_Age: uint16  % 从消息被发出，到车辆位置已被positioning子系统算出时，两者之间的时间差：
  ADAS_Posn_PosProbb: single  % 这个值由ADASIS v2 Horizon生成器的Positioning模块算出，不同的Av2HPs将使用不同的算法来计算这个值 取值0代表未知unknown；取值31代表N/A
  ADAS_Posn_Idx: uint8  % 如果Av2HP支持Positioning备选，则为Position候选的索引号。
  ADAS_Posn_Spd: single  % 车辆沿Path行驶的预计速度
  ADAS_Posn_CurLane: uint8  % 当前车道
  ADAS_Posn_PosConfdc: uint8  % Position置信度
  ADAS_Posn_Rehead: single  % 相对于path的车头朝向

EHRV2_VCAN_PROFLONG_BUS = Simulink.Bus()
  ADAS_ProfLong_Offset: uint16  % 起点位置到第一个profile spot的位移距离
  ADAS_ProfLong_MsgTyp: uint8  % 标识该消息标识profile long message
  ADAS_ProfLong_PathIdx: uint8  % 这个profile所在path的索引值
  ADAS_ProfLong_CycCnt: uint8  % 这个message type和profile type的循环计数器
  ADAS_ProfLong_Update: boolean  % profile long 更新
  ADAS_ProfLong_Retr: boolean  % 如果为true，这个消息在之前已经被发送过一次.
  ADAS_ProfLong_CtrlPoint: boolean  % 控制点
  ADAS_ProfLong_ProfTyp: uint8  % profile long类型
  ADAS_ProfLong_Value: uint32  % profile long 值

EHRV2_VCAN_PROFSHORT_BUS = Simulink.Bus()
  ADAS_ProfShort_Offset: uint16  % 起点位置到第一个profile spot的位移距离
  ADAS_ProfShort_MsgTyp: uint8  % 标识该消息是Profile Short Message
  ADAS_ProfShort_PathIdx: uint8  % 这个profile所在path的索引值
  ADAS_ProfShort_CycCnt: uint8  % 这个message type和profile type的循环计数器
  ADAS_ProfShort_Update: boolean  % Profile short消息更新
  ADAS_ProfShort_Retr: boolean  % 如果为true，这个消息在之前已经被发送过一次
  ADAS_ProfShort_CtrlPoint: boolean  % 控制点
  ADAS_ProfShort_ProfTyp: uint8  % profile short 类别
  ADAS_ProfShort_Dist1: uint16  % 从第一个profile spot到第二个的距离
  ADAS_ProfShort_AccurClass: uint8  % 准确度
  ADAS_ProfShort_Value0: uint16  % 在offset的profile值
  ADAS_ProfShort_Value1: uint16  % 在offset+distance1 处的profile值

EHRV2_VCAN_SEG_BUS = Simulink.Bus()
  ADAS_Seg_Offset: uint16  % 当前segment起点到该Path起点的距离
  ADAS_Seg_MsgTyp: uint8  % 标识该消息为segment Message
  ADAS_Seg_PathIdx: uint8  % 这个segment所属于的path的索引值
  ADAS_Seg_CycCnt: uint8  % SEGMENT Message的循环计数器
  ADAS_Seg_Update: boolean  % Segment更新
  ADAS_Seg_Retr: boolean  % 如果为true，这个消息在之前已经被发送过一次
  ADAS_Seg_BuildUpArea: uint8  % segment 所在位置是城市/郊区信息
  ADAS_Seg_Brdg: uint8  % segment桥信息
  ADAS_Seg_Tunnel: uint8  % segment隧道信息
  ADAS_Seg_FuncRoadClass: uint8  % segment FRC信息（对应道路类型，主路）
  ADAS_Seg_RelProbb: single  % 相比在同一条path的上一个segment，这段segment的相对概率
  ADAS_Seg_FormOfWay: uint8  % segment道路设施信息（对应匝道信息，主路及需要进入）
  ADAS_Seg_CmplxInsct: uint8  % segment复杂路口信息
  ADAS_Seg_PartOfCalcRoute: uint8  % segment是否是规划路径信息
  ADAS_Seg_EffSpdLmtTyp: uint8  % segment有效限速类型信息
  ADAS_Seg_EffSpdLmt: uint8  % segment限速信息
  ADAS_Seg_NumOfLaneDrvDir: uint8  % segment行车方向车道数信息
  ADAS_Seg_NumOfLaneOppDir: uint8  % segment行车反反向车道数信息
  ADAS_Seg_DivideRoad: uint8  % segment隔离带信息

EHRV2_VCAN_STUB_BUS = Simulink.Bus()
  ADAS_Stub_Offset: uint16  % stub起点与path起点的距离
  ADAS_Stub_MsgTyp: uint8  % 标识该消息为Stub Message
  ADAS_Stub_PathIdx: uint8  % 父path的索引值，0代表在Horizon中从这个STUB开始了第一条path
  ADAS_Stub_CycCnt: uint8  % STUB Message 的循环计数器
  ADAS_Stub_Update: boolean  % Stub Segment更新
  ADAS_Stub_Retr: boolean  % 如果为true，这个消息在之前已经被发送过一次
  ADAS_Stub_StubPathIdx: uint8  % stub path索引
  ADAS_Stub_FuncRoadClass: uint8  % stub FRC信息（对应道路类型）
  ADAS_Stub_RelProbb: single  % 在路口的新path的相对概率
  ADAS_Stub_FormOfWay: uint8  % stub 道路设施信息（对应匝道信息，支路）
  ADAS_Stub_CmplxInsct: uint8  % stub复杂路口信息
  ADAS_Stub_PartOfCalcRoute: uint8  % stub是否在规划路径上的信息
  ADAS_Stub_TurnAngl: single  % stub转向角度信息
  ADAS_Stub_NumOfLaneDrvDir: uint8  % stub当前行车方向车道数信息
  ADAS_Stub_NumOfLaneOppDir: uint8  % stub当前行车反方向车道数信息
  ADAS_Stub_RtOfWay: uint8  % stub路权信息
  ADAS_Stub_LastStub: boolean  % stub消息是给定父path和offset的最后一个