% Simulink data dictionary PubIfControlLATC_RTE.sldd

LATC_VCAN_CSA_BUS = Simulink.Bus()
  SteerWheelAng: single
  SteerWheelAngSign: boolean
  SteerWheelSpd: single
  SteerWheelSpdSign: boolean

LATC_VCAN_EPS_BUS = Simulink.Bus()
  EPS_SteerMod: uint8
  EPS_DrvInpTrqVal_HighReslolution: single
  EPS_LKATorqOvrlDlvd: single  % eps执行扭矩
  EPS_LKATorqOvrlDlvdVld: boolean