% Simulink data dictionary PubIfDiagnosticDFIM_RTE.sldd

DFIM_AEB_STS_BUS = Simulink.Bus()
  AEB_Error: uint8
  AEB_Ped_Error: uint8
  AEB_JA_Error: uint8

DFIM_AHBC_STS_BUS = Simulink.Bus()
  HMA_error: uint8
  ADB_error: uint8

DFIM_VSM_STS_BUS = Simulink.Bus()
  TJA_ICA_Error: uint8
  ACC_Error: uint8
  HWA_Error: uint8
  LKA_LCK_Error: uint8
  LDW_Error: uint8
  ELK_Error: uint8
  ESS_Error: uint8
  TSR_Error: uint8
  ALC_Error: uint8
  NOA_Error: uint8
  ID_Error: uint8

P_DFIM_TJA_ICA_Error = AUTOSAR4.Parameter(0, SwCalibrationAccess="ReadWrite", DataType="uint8")
P_DFIM_ACC_Error = AUTOSAR4.Parameter(0, SwCalibrationAccess="ReadWrite", DataType="uint8")
P_DFIM_LKA_LCK_Error = AUTOSAR4.Parameter(0, SwCalibrationAccess="ReadWrite", DataType="uint8")
P_DFIM_LDW_Error = AUTOSAR4.Parameter(0, SwCalibrationAccess="ReadWrite", DataType="uint8")
P_DFIM_ELK_Error = AUTOSAR4.Parameter(0, SwCalibrationAccess="ReadWrite", DataType="uint8")
P_DFIM_ESS_Error = AUTOSAR4.Parameter(0, SwCalibrationAccess="ReadWrite", DataType="uint8")
P_DFIM_TSR_Error = AUTOSAR4.Parameter(0, SwCalibrationAccess="ReadWrite", DataType="uint8")
P_DFIM_ALC_Error = AUTOSAR4.Parameter(0, SwCalibrationAccess="ReadWrite", DataType="uint8")
P_DFIM_ID_Error = AUTOSAR4.Parameter(0, SwCalibrationAccess="ReadWrite", DataType="uint8")
P_DFIM_AEB_Error = AUTOSAR4.Parameter(0, SwCalibrationAccess="ReadWrite", DataType="uint8")
P_DFIM_AEB_Ped_Error = AUTOSAR4.Parameter(0, SwCalibrationAccess="ReadWrite", DataType="uint8")
P_DFIM_AEB_JA_Error = AUTOSAR4.Parameter(0, SwCalibrationAccess="ReadWrite", DataType="uint8")
P_DFIM_HMA_Error = AUTOSAR4.Parameter(0, SwCalibrationAccess="ReadWrite", DataType="uint8")
P_DFIM_ADB_error = AUTOSAR4.Parameter(0, SwCalibrationAccess="ReadWrite", DataType="uint8")
P_DFIM_HWA_Error = AUTOSAR4.Parameter(0, SwCalibrationAccess="ReadWrite", DataType="uint8")
P_DFIM_NOA_Error = AUTOSAR4.Parameter(0, SwCalibrationAccess="ReadWrite", DataType="uint8")