% Simulink data dictionary PubIfFusionRFM_RTE.sldd

RFM_TSR_VAL = struct(
  FUSSts=uint8(0),
  RFframe_count=uint32(0),
  CtryType=uint8(0),
  RoadType=uint8(0),
  SPL_TypeCurRoad=uint8(0),
  SPL_ValueCurRoad=uint8(0),
  VehToTrafEyeDist=uint16(0),
  SPL_Unit=uint8(0),
  SPL_End=uint8(0),
  SPL_noSupp_Value=uint8(0),
  SPL_whSupp_Value=uint8(0),
  SPL_Sup1_SignName=uint8(0),
  SPL_Sup1_Confidence=single(0),
  SPL_Sup2_SignName=uint8(0),
  SPL_Sup2_Confidence=single(0),
  SPL_noSupp_LongDistance=uint8(0),
  SPL_whSupp_LongDistance=uint8(0),
  SPL_LeftLaneValue=uint8(0),
  SPL_RightLaneValue=uint8(0),
  TSR_ID=uint8(0),
  TS_SignName=uint8(0),
  TS_Confidence=single(0),
  TS_LongDistance=uint8(0),
  VehInLeftmostLane=uint8(0),
  VehInRightmostLane=uint8(0),
  SPL_LaneChanged=uint8(0),
  TSR_Sign_Long_Distance=uint32(0),
  TSR_Sign_Lateral_Distance=single(-32))

RFM_TSR_PAR = AUTOSAR4.Parameter(struct(
  FUSSts=uint8(0),
  RFframe_count=uint32(0),
  CtryType=uint8(0),
  RoadType=uint8(0),
  SPL_TypeCurRoad=uint8(0),
  SPL_ValueCurRoad=uint8(0),
  VehToTrafEyeDist=uint16(0),
  SPL_Unit=uint8(0),
  SPL_End=uint8(0),
  SPL_noSupp_Value=uint8(0),
  SPL_whSupp_Value=uint8(0),
  SPL_Sup1_SignName=uint8(0),
  SPL_Sup1_Confidence=single(0),
  SPL_Sup2_SignName=uint8(0),
  SPL_Sup2_Confidence=single(0),
  SPL_noSupp_LongDistance=uint8(0),
  SPL_whSupp_LongDistance=uint8(0),
  SPL_LeftLaneValue=uint8(0),
  SPL_RightLaneValue=uint8(0),
  TSR_ID=uint8(0),
  TS_SignName=uint8(0),
  TS_Confidence=single(0),
  TS_LongDistance=uint8(0),
  VehInLeftmostLane=uint8(0),
  VehInRightmostLane=uint8(0),
  SPL_LaneChanged=uint8(0),
  TSR_Sign_Long_Distance=uint32(0),
  TSR_Sign_Lateral_Distance=single(-32)), SwCalibrationAccess="ReadWrite", StorageClass="Global", DataType="Bus:RFM_TSR_BUS")

RFM_REC_LANES_VAL = struct(i_rec_lanes_num=uint8(0), i_rec_lanes=uint8(repmat(0, 1, 8)))
RFM_REC_LANES_PAR = AUTOSAR4.Parameter(struct(i_rec_lanes_num=uint8(0), i_rec_lanes=uint8(repmat(0, 1, 8))), SwCalibrationAccess="ReadWrite", StorageClass="Global", DataType="Bus:RFM_REC_LANES_BUS")

RFM_LINE_VAL = struct(
  bIsLineExist=uint8(0),
  dC0V=single(-30),
  dC1V=single(-2),
  dC2V=single(-0.125),
  dC3V=single(-0.004),
  dLaneWidth=single(0),
  eLineType=uint8(0),
  dDisStart=single(0),
  dDisFront=single(0),
  dQuality=single(0),
  eColour=uint8(0),
  eFuType=uint8(0),
  nTrackAge=uint8(0))

RFM_LINE_PAR = AUTOSAR4.Parameter(struct(
  bIsLineExist=uint8(0),
  dC0V=single(-30),
  dC1V=single(-2),
  dC2V=single(-0.125),
  dC3V=single(-0.004),
  dLaneWidth=single(0),
  eLineType=uint8(0),
  dDisStart=single(0),
  dDisFront=single(0),
  dQuality=single(0),
  eColour=uint8(0),
  eFuType=uint8(0),
  nTrackAge=uint8(0)), SwCalibrationAccess="ReadWrite", StorageClass="Global", DataType="Bus:RFM_LINE_BUS")

RFM_LANE_VAL = struct(
  b_is_avalible=uint8(0),
  en_lane_type=uint8(0),
  i_speed_max=uint8(0),
  f_spd_change_dis=single(0),
  i_change_spd_max=uint8(0),
  f_width=single(0),
  b_vanish_valid=uint8(0),
  f_vanish_pt_dis=single(0))

RFM_LANE_PAR = AUTOSAR4.Parameter(struct(
  b_is_avalible=uint8(0),
  en_lane_type=uint8(0),
  i_speed_max=uint8(0),
  f_spd_change_dis=single(0),
  i_change_spd_max=uint8(0),
  f_width=single(0),
  b_vanish_valid=uint8(0),
  f_vanish_pt_dis=single(0)), SwCalibrationAccess="ReadWrite", StorageClass="Global", DataType="Bus:RFM_LANE_BUS")

RFM_INTERSEC_ALERT_VAL = struct(b_is_available=uint8(0), f_distance=single(0), en_direction=uint8(0), en_type=uint8(0))
RFM_INTERSEC_ALERT_PAR = AUTOSAR4.Parameter(struct(b_is_available=uint8(0), f_distance=single(0), en_direction=uint8(0), en_type=uint8(0)), SwCalibrationAccess="ReadWrite", StorageClass="Global", DataType="Bus:RFM_INTERSEC_ALERT_BUS")
RFM_BRANCH_VAL = struct(b_available=uint8(0), f_turning_angle=single(0), en_RoadClass=uint8(0))
RFM_BRANCH_PAR = AUTOSAR4.Parameter(struct(b_available=uint8(0), f_turning_angle=single(0), en_RoadClass=uint8(0)), SwCalibrationAccess="ReadWrite", StorageClass="Global", DataType="Bus:RFM_BRANCH_BUS")
RFM_UpdateCnt_PAR = Simulink.Parameter(0, DataType="uint32")

RFM_ROAD_VAL = struct(
  nLaneID=uint8(0),
  nLaneNum=uint8(0),
  dCurrentLaneWidth=single(0),
  dLeftLaneWidth=single(0),
  dRightLaneWidth=single(0),
  bCurrentLaneFree=uint8(0),
  fCurrentLaneFreeDis=single(0),
  bLeftLaneFree=uint8(0),
  fLeftLaneFreeDis=single(0),
  bRightLaneFree=uint8(0),
  fRighLaneFreeDis=single(0),
  b_toll=uint8(0),
  f_toll_distance=single(0),
  b_tunnel=uint8(0),
  f_tunnel_distance=single(0),
  b_bridge=uint8(0),
  f_bridge_distance=single(0),
  b_traffic_jam=uint8(0),
  f_distance_to_jam=single(0),
  b_traffic_accident=uint8(0),
  f_distance_to_accident=single(0),
  en_weather=uint8(0),
  i_mapvalid=uint8(0),
  i_on_nav_path=uint8(0))

RFM_ROAD_PAR = AUTOSAR4.Parameter(struct(
  nLaneID=uint8(0),
  nLaneNum=uint8(0),
  dCurrentLaneWidth=single(0),
  dLeftLaneWidth=single(0),
  dRightLaneWidth=single(0),
  bCurrentLaneFree=uint8(0),
  fCurrentLaneFreeDis=single(0),
  bLeftLaneFree=uint8(0),
  fLeftLaneFreeDis=single(0),
  bRightLaneFree=uint8(0),
  fRighLaneFreeDis=single(0),
  b_toll=uint8(0),
  f_toll_distance=single(0),
  b_tunnel=uint8(0),
  f_tunnel_distance=single(0),
  b_bridge=uint8(0),
  f_bridge_distance=single(0),
  b_traffic_jam=uint8(0),
  f_distance_to_jam=single(0),
  b_traffic_accident=uint8(0),
  f_distance_to_accident=single(0),
  en_weather=uint8(0),
  i_mapvalid=uint8(0),
  i_on_nav_path=uint8(0)), SwCalibrationAccess="ReadWrite", StorageClass="Global", DataType="Bus:RFM_ROAD_BUS")

RFM_BRANCH_BUS = Simulink.Bus()
  b_available: uint8  % 距离路口一定距离（暂定200m）时给出true
  f_turning_angle: single  % 道路分支相比主路的夹角，（暂不确定能否给出）
  en_RoadClass: uint8

RFM_INTERSEC_ALERT_BUS = Simulink.Bus()
  b_is_available: uint8  % 是否可用：
    % 0：否
    % 1：是
    % 前方1000m有路口时给出true
  f_distance: single  % 到最近路口距离
  en_direction: uint8  % 前方最近路口主车通行方向（合流默认为左）：
    % Unknown：0X0
    % 驶出：0x1
    % 驶入：0x2
    % 前方2000m内驶出，当前路口直行：0x3
    % （行驶方向
    % 0x01：右侧，0x02左侧，0x00无效）
    % （方向信息待确认，保持与EHRV2一致）
  en_type: uint8  % 路口类型：合流分流：
    % 0: STUB_MERGE
    % 1:  STUB_SPLIT,

RFM_LANE_BUS = Simulink.Bus()
  b_is_avalible: uint8  % 车道是否可用
    % 0：不可用
    % 1：可用
    % （与b_free相同，后续或删除）
  en_lane_type: uint8  % 车道类型（目前只有0、1、2、3、5）：
    % 0：Unknown
    % 1：Normal
    % 2：Exit
    % 3：Entry :
    % 4： Auxiliary
    % 5： Emergency
    % 6：RestrictedForbidden
    % 7： RestrictedUsable
    % 8：HOV
    % 9：Express
    % 10：Reversible
    % 11：Slow
    % 12： DrivableShoulder
    % 13：TurnOrSuicide
  i_speed_max: uint8  % 当前限速(KMPH)
  f_spd_change_dis: single  % 前方限速变化距离
  i_change_spd_max: uint8  % 限速变化后的值
  f_width: single  % 车道宽度
  b_vanish_valid: uint8  % 是否为消失车道
    % 0：不是
    % 1：是
  f_vanish_pt_dis: single  % 到消失点的距离

RFM_LINE_BUS = Simulink.Bus()
  bIsLineExist: uint8  % 表示车道线有无，2为有，1为无
  dC0V: single  % 车辆坐标系下，车道线参数C0
  dC1V: single  % 车辆坐标系下，车道线参数C1
  dC2V: single  % 车辆坐标系下，车道线参数C2
  dC3V: single  % 车辆坐标系下，车道线参数C3
  dLaneWidth: single  % 车道线宽度
  eLineType: uint8  % 车道线线型 （普通、实线、虚线、路牙...）
  dDisStart: single  % 车道线前方，起点长度
  dDisFront: single  % 车道线前方，有效长度
  dQuality: single  % 车道线质量信息
  eColour: uint8  % 车道线颜色
  eFuType: uint8  % 车道线融合状态（无、摄像头、地图、摄像头融合地图、预留）
  nTrackAge: uint8  % 车道线预测周期数（未预测时为0）

RFM_REC_LANES_BUS = Simulink.Bus()
  i_rec_lanes_num: uint8  % 推荐行驶车道处车道总数
  i_rec_lanes: uint8[8]  % 推荐行驶车道数组（最多8个元素）

RFM_ROAD_BUS = Simulink.Bus()
  nLaneID: uint8  % 自动驾驶车辆所在车道ID（从左往右）
  nLaneNum: uint8  % 当前总车道数
  dCurrentLaneWidth: single  % 本车道宽度
  dLeftLaneWidth: single  % 左侧相邻，车道宽度
  dRightLaneWidth: single  % 右侧相邻，车道宽度
  bCurrentLaneFree: uint8  % 当前车道是否可行驶（freespace 可用）
  fCurrentLaneFreeDis: single  % 当前可行驶距离
  bLeftLaneFree: uint8  % 左侧车道是否可行驶（freespace 可用）
  fLeftLaneFreeDis: single  % 左侧可行驶距离
  bRightLaneFree: uint8  % 右侧车道是否可行驶（freespace 可用）
  fRighLaneFreeDis: single  % 右侧可行驶距离
  b_toll: uint8  % 前方是否有收费站：
    % Unknown：0x0
    % Yes：0x1
    % No：0x2
  f_toll_distance: single  % 到收费站距离
  b_tunnel: uint8  % 车辆是否在隧道：
    % Unknown：0x0
    % Yes：0x1
    % No：0x2
  f_tunnel_distance: single  % 到隧道的距离
  b_bridge: uint8  % 车辆是否在桥梁上：
    % Unknown：0x0
    % Yes：0x1
    % No：0x2
  f_bridge_distance: single  % 到桥梁的距离
  b_traffic_jam: uint8  % 前方是否有交通拥堵：
    % Unknown：0x0
    % Yes：0x1
    % No：0x2
  f_distance_to_jam: single  % 到交通拥堵点的距离
  b_traffic_accident: uint8  % 前方是否发生交通事故：
    % Unknown：0x0
    % Yes：0x1
    % No：0x2
  f_distance_to_accident: single  % 到交通事故发生点的距离
  en_weather: uint8  % 天气情况
  i_mapvalid: uint8
  i_on_nav_path: uint8

RFM_TSR_BUS = Simulink.Bus()
  FUSSts: uint8  % 融合状态（故障，融合，仅视觉，仅导航）
  RFframe_count: uint32  % 程序运行帧数
  CtryType: uint8  % 指示车辆当前行驶位置的国家/地区类型（HUT）
  RoadType: uint8  % 指示导航检测到的车辆当前行驶位置的行驶类型(HUT)
  SPL_TypeCurRoad: uint8  % 限速类型
  SPL_ValueCurRoad: uint8  % 限速值
  VehToTrafEyeDist: uint16  % 到电子眼限速的距离
  SPL_Unit: uint8  % 指示当前限速单位
  SPL_End: uint8  % 结束限速标志
  SPL_noSupp_Value: uint8  % 指示当前车道的限速值，或者无法区分车道的无补充标志的限速值。
  SPL_whSupp_Value: uint8  % 条件限速标志的值
  SPL_Sup1_SignName: uint8  % 条件限速的第一个补充标识类型
  SPL_Sup1_Confidence: single  % 条件限速的第一个补充标识的可信度
  SPL_Sup2_SignName: uint8  % 条件限速的第二个补充标识类型
  SPL_Sup2_Confidence: single  % 条件限速的第二个补充标识的可信度
  SPL_noSupp_LongDistance: uint8  % 暂不使用
  SPL_whSupp_LongDistance: uint8  % 暂不使用
  SPL_LeftLaneValue: uint8  % 指示左侧车道限速值
  SPL_RightLaneValue: uint8  % 指示右侧车道限速值
  TSR_ID: uint8  % 暂不使用
  TS_SignName: uint8  % 识别到的与本车相关的交通标志类型
  TS_Confidence: single  % 检测到的交通标志的可信度
  TS_LongDistance: uint8  % 暂不使用
  VehInLeftmostLane: uint8  % 指示是否在最左侧车道
  VehInRightmostLane: uint8  % 指示是否在最右侧车道
  SPL_LaneChanged: uint8  % 指示是否发生变道以及变道向哪个方向
  TSR_Sign_Long_Distance: uint32  % 限速交通标志距摄像头纵向距离
  TSR_Sign_Lateral_Distance: single  % 限速交通标志距摄像头横向距离

RFM_LINE_COLOR_E = enum(DefaultValue="NONE", AddClassNameToEnumNames=true)
  NONE = 0  % 车道线颜色
  YELLOW = 1  % 车道线颜色
  WHITE = 2  % 车道线颜色
  BLUE = 3  % 车道线颜色
  ORANGE = 4  % 车道线颜色

RFM_LINE_TYPE_E = enum(DefaultValue="UNDECIDED", AddClassNameToEnumNames=true)
  UNDECIDED = 0  % 车道线线型 （普通、实线、虚线、路牙...）
  SOLID = 1  % 车道线线型 （普通、实线、虚线、路牙...）
  DASHED = 2  % 车道线线型 （普通、实线、虚线、路牙...）
  DOUBLE_SOLID_DASHED = 3  % 车道线线型 （普通、实线、虚线、路牙...）
  DOUBLE_DASHED_SOLID = 4  % 车道线线型 （普通、实线、虚线、路牙...）
  DOUBLE_SOLID_SOLID = 5  % 车道线线型 （普通、实线、虚线、路牙...）
  DOUBLE_DASHED_DASHED = 6  % 车道线线型 （普通、实线、虚线、路牙...）
  BOTTS = 7  % 车道线线型 （普通、实线、虚线、路牙...）
  DECELERATION = 8  % 车道线线型 （普通、实线、虚线、路牙...）
  HOV_LANE = 9  % 车道线线型 （普通、实线、虚线、路牙...）
  ROAD_EDGE = 10  % 车道线线型 （普通、实线、虚线、路牙...）
  ELEVATED_STRUCTURE = 11  % 车道线线型 （普通、实线、虚线、路牙...）
  LCURB = 12  % 车道线线型 （普通、实线、虚线、路牙...）
  CONES_POLES = 13  % 车道线线型 （普通、实线、虚线、路牙...）
  PARKED_CARS = 14  % 车道线线型 （普通、实线、虚线、路牙...）

RFM_LANECHANGE_DIR_E = enum(DefaultValue="INVALID", AddClassNameToEnumNames=true)
  INVALID = 0  % 指示是否发生变道以及变道向哪个方向
  LEFT = 1  % 指示是否发生变道以及变道向哪个方向
  RIGHT = 2  % 指示是否发生变道以及变道向哪个方向

RFM_NAV_SPLUNIT_E = enum(DefaultValue="KMH", AddClassNameToEnumNames=true)
  KMH = 0  % 指示当前限速单位
  MPH = 1  % 指示当前限速单位
  UNKNOWN = 2  % 指示当前限速单位
  RESERVED = 3  % 指示当前限速单位

RFM_NAV_SPLTYPE_E = enum(DefaultValue="UNKNOWN", AddClassNameToEnumNames=true)
  UNKNOWN = 0  % 限速类型
  TRAFFIC_SIGN = 1  % 限速类型
  ELECTRONIC_EYE = 2  % 限速类型
  ROAD_DEFAULT = 3  % 限速类型

RFM_TSR_FUSIONSTS_E = enum(DefaultValue="UNKNOWN", AddClassNameToEnumNames=true)
  UNKNOWN = 0  % 融合状态（故障，融合，仅视觉，仅导航）
  FUSION = 1  % 融合状态（故障，融合，仅视觉，仅导航）
  VISION = 2  % 融合状态（故障，融合，仅视觉，仅导航）
  HUT = 3  % 融合状态（故障，融合，仅视觉，仅导航）
  FAILURE = 4  % 融合状态（故障，融合，仅视觉，仅导航）

RFM_NAV_ROADTYPE_E = enum(DefaultValue="UNKNOWN", AddClassNameToEnumNames=true)
  UNKNOWN = 0  % 指示导航检测到的车辆当前行驶位置的行驶类型(HUT)
  EXPRESSWAY = 1  % 指示导航检测到的车辆当前行驶位置的行驶类型(HUT)
  CITY_EXPRESSWAY = 2  % 指示导航检测到的车辆当前行驶位置的行驶类型(HUT)
  NATIONAL_ROAD = 3  % 指示导航检测到的车辆当前行驶位置的行驶类型(HUT)
  PROVINCIAL_ROAD = 4  % 指示导航检测到的车辆当前行驶位置的行驶类型(HUT)
  COUNTRY_ROAD = 5  % 指示导航检测到的车辆当前行驶位置的行驶类型(HUT)
  CITY_OR_VILLAGE_ROAD = 6  % 指示导航检测到的车辆当前行驶位置的行驶类型(HUT)
  RAMP = 7  % 指示导航检测到的车辆当前行驶位置的行驶类型(HUT)
  TUNNEL = 8  % 指示导航检测到的车辆当前行驶位置的行驶类型(HUT)
  SIDE_ROAD = 9  % 指示导航检测到的车辆当前行驶位置的行驶类型(HUT)
  CHANNEL = 10  % 指示导航检测到的车辆当前行驶位置的行驶类型(HUT)
  RESERVED = 11  % 指示导航检测到的车辆当前行驶位置的行驶类型(HUT)