% Simulink data dictionary PubIfSensorCR_ROut.sldd

VCAN_CR_MSG_BUS = Simulink.Bus()
  CR_BliSts: boolean  % CR_FD1|1|0|0|1|boolean
  CR_BrkgReq: boolean  % CR_FD1|1|0|0|1|boolean
  CR_BrkgReqVal: single  % CR_FD1|0.000488|-16|-16|16|single
  CR_ErrSts: boolean  % CR_FD1|1|0|0|1|boolean
  CR_FCTA_Resp: boolean  % CR_FD1|1|0|0|1|boolean
  CR_FCTB_Resp: boolean  % CR_FD1|1|0|0|1|boolean
  CR_ObjDistXStd_Le: single  % CR_FD1|0.375|0|0|11.625|single
  CR_ObjDistXStd_Ri: single  % CR_FD1|0.375|0|0|11.625|single
  CR_ObjDistX_Le: single  % CR_FD1|0.1|-10|-10|92.3|single
  CR_ObjDistX_Ri: single  % CR_FD1|0.1|-10|-10|92.3|single
  CR_ObjDistYStd_Le: single  % CR_FD1|0.375|0|0|11.625|single
  CR_ObjDistYStd_Ri: single  % CR_FD1|0.375|0|0|11.625|single
  CR_ObjDistY_Le: single  % CR_FD1|0.1|-12.8|-12.8|12.7|single
  CR_ObjDistY_Ri: single  % CR_FD1|0.1|-12.8|-12.8|12.7|single
  CR_ObjID_Le: uint8  % CR_FD1|1|0|0|63|uint8
  CR_ObjID_Ri: uint8  % CR_FD1|1|0|0|63|uint8
  CR_ObjMotionType_Le: uint8  % CR_FD1|1|0|0|7|uint8
  CR_ObjMotionType_Ri: uint8  % CR_FD1|1|0|0|7|uint8
  CR_ObjRAccelXStd_Le: single  % CR_FD1|0.375|0|0|11.625|single
  CR_ObjRAccelXStd_Ri: single  % CR_FD1|0.375|0|0|11.625|single
  CR_ObjRAccelYStd_Le: single  % CR_FD1|0.375|0|0|11.625|single
  CR_ObjRAccelYStd_Ri: single  % CR_FD1|0.375|0|0|11.625|single
  CR_ObjRelAccelX_Le: single  % CR_FD1|0.03125|-16|-16|15.9688|single
  CR_ObjRelAccelX_Ri: single  % CR_FD1|0.03125|-16|-16|15.9688|single
  CR_ObjRelAccelY_Le: single  % CR_FD1|0.03125|-16|-16|15.9688|single
  CR_ObjRelAccelY_Ri: single  % CR_FD1|0.03125|-16|-16|15.9688|single
  CR_ObjRelVelXStd_Le: single  % CR_FD1|0.375|0|0|11.625|single
  CR_ObjRelVelXStd_Ri: single  % CR_FD1|0.375|0|0|11.625|single
  CR_ObjRelVelX_Le: single  % CR_FD1|0.1|-60|-60|42.3|single
  CR_ObjRelVelX_Ri: single  % CR_FD1|0.1|-60|-60|42.3|single
  CR_ObjRelVelYStd_Le: single  % CR_FD1|0.375|0|0|11.625|single
  CR_ObjRelVelYStd_Ri: single  % CR_FD1|0.375|0|0|11.625|single
  CR_ObjRelVelY_Le: single  % CR_FD1|0.1|-6.4|-6.4|6.3|single
  CR_ObjRelVelY_Ri: single  % CR_FD1|0.1|-6.4|-6.4|6.3|single
  CR_ObjSts_Le: uint8  % CR_FD1|1|0|0|3|uint8
  CR_ObjSts_Ri: uint8  % CR_FD1|1|0|0|3|uint8
  FCTA_B_FuncSts: uint8  % CR_FD1|1|0|0|3|uint8
  FCTA_B_TTC: single  % CR_FD1|0.1|0|0|6.3|single
  FCTA_Warn: boolean  % CR_FD1|1|0|0|1|boolean
  FCTBTrig: boolean  % CR_FD1|1|0|0|1|boolean
  FCTB_ABA_Level: uint8  % CR_FD1|1|0|0|3|uint8
  FCTB_ABA_Req: boolean  % CR_FD1|1|0|0|1|boolean
  FCTB_ABP_Req: boolean  % CR_FD1|1|0|0|1|boolean