% Simulink data dictionary PubIfSensorEQ4_V4_20_5_RTE.sldd
% references ADAS.sldd

EQ4_IGENERAL_HDR_VAL = struct(
  IGeneral_Zero_Byte=uint8(0),
  IGeneral_Protocol_Version=uint8(0),
  IGeneral_Optional_Signals=uint8(0),
  IGeneral_Buffer_1_V=uint8(0),
  IGeneral_Buffer_1=uint8(0),
  IGeneral_Roll_Angle_Base_V=uint8(0),
  IGeneral_Roll_Angle_Base=single(0),
  IGeneral_CLB_DYN_AF_Pitch_V=uint8(0),
  IGeneral_CLB_DYN_AF_Pitch=int16(0),
  IGeneral_CLB_DYN_AF_Yaw_V=uint8(0),
  IGeneral_CLB_DYN_AF_Yaw=int16(0),
  IGeneral_CLB_DYN_AF_Roll_V=uint8(0),
  IGeneral_CLB_DYN_AF_Roll=single(0),
  IGeneral_Region_Code=uint8(0),
  IGeneral_Driving_Side=uint8(0),
  IGeneral_HIL_Mode=uint8(0),
  IGeneral_Cam_Height_Full=single(0),
  Reserved_1=uint8(0),
  IGeneral_Pitch_Base=int16(0),
  IGeneral_Yaw_Base=int16(0),
  IGeneral_Camera_Height_Base=single(0),
  Reserved_2=uint8(0))

EQ4_IENV_HDR_VAL = struct(
  IEnvironment_Zero_Byte=uint8(0),
  IEnvironment_Protocol_Version=uint8(0),
  IEnvironment_Optional_Signals=uint8(0),
  IEnvironment_GPSToCam_dx_V=uint8(0),
  IEnvironment_GPSToCam_dx=single(0),
  IEnvironment_Buffer1_V=uint8(0),
  IEnvironment_Buffer1=uint8(0),
  IEnvironment_GPSToCam_dy_V=uint8(0),
  IEnvironment_GPSToCam_dy=single(0),
  IEnvironment_GPSToCam_dz_V=uint8(0),
  IEnvironment_GPSToCam_dz=single(0),
  IEnvironment_WheelWidth=single(0),
  Reserved_1=uint8(0),
  IEnvironment_WheelRadius=single(0),
  IEnvironment_LeftWheel=single(0),
  Reserved_2=uint8(0),
  IEnvironment_RightWheel=single(0),
  IEnvironment_RefPX_Front_Bumper=single(0),
  IEnvironment_CamToFrontAxle=single(0),
  IEnvironment_CamToRearAxle=single(0),
  IEnvironment_MinHorizon=int16(0),
  IEnvironment_MaxHorizon=int16(0),
  IEnvironment_MinYaw=int8(0),
  IEnvironment_MaxYaw=uint8(0),
  IEnvironment_MaxRoll=single(0),
  IEnvironment_Top_Crop=uint8(0),
  IEnvironment_Bottom_Crop=int16(0),
  Reserved_3=uint8(0))

EQ4_IDV_HDR_VAL = struct(IDV_Zero_byte=uint8(0), IDV_Protocol_Version=uint8(0), IDV_Optional_Signals=uint8(0))

EQ4_IDEBUG_HDR_VAL = struct(
  IDebug_Zero_Byte=uint8(0),
  IDebug_Protocol_Version=uint8(0),
  IDebug_Optional_Signals=uint8(0),
  IDebug_Construction_Area=uint8(0),
  IDebug_Free_Space=uint8(0),
  IDebug_Hazards=uint8(0),
  IDebug_INTP=uint8(0),
  IDebug_Land_Marks=uint8(0),
  IDebug_Lane_marks=uint8(0),
  IDebug_Light_Scene=uint8(0),
  IDebug_Objects=uint8(0),
  IDebug_Semantic_Crossing=uint8(0),
  IDebug_Semantic_Lines=uint8(0),
  IDebug_Semantic_Marks=uint8(0),
  IDebug_TFL_Structure=uint8(0),
  IDebug_TFL_Spots=uint8(0),
  IDebug_Traffic_Signs=uint8(0),
  IDebug_DSTraffic_Signs=uint8(0),
  IDebug_Semantic_Junction=uint8(0),
  Reserved_1=uint8(0))

EQ4_ICAM_HDR_VAL = struct(
  INIT_Cam_Zero_Byte=uint8(0),
  INIT_Cam_Protocol_Version=uint8(0),
  INIT_Cam_Optional_Signals=uint8(0),
  INIT_Cam_Buffer_1_V=uint8(0),
  INIT_Cam_Buffer_1=uint8(0),
  INIT_Cam_Sensor_ID_P1_V=uint8(0),
  INIT_Cam_Sensor_ID_P1=uint64(0),
  INIT_Cam_Buffer_2_V=uint8(0),
  INIT_Cam_Buffer_2=uint8(0),
  INIT_Cam_Sensor_ID_P2_V=uint8(0),
  INIT_Cam_Sensor_ID_P2=uint64(0),
  INIT_Cam_Buffer_3_V=uint8(0),
  INIT_Cam_Buffer_3=uint8(0),
  INIT_Cam_Sensor_ID_P3_V=uint8(0),
  INIT_Cam_Sensor_ID_P3=uint64(0),
  INIT_Cam_Buffer_4_V=uint8(0),
  INIT_Cam_Buffer_4=uint8(0),
  INIT_Cam_Sensor_ID_P4_V=uint8(0),
  INIT_Cam_Sensor_ID_P4=uint64(0),
  INIT_Cam_Buffer_5_V=uint8(0),
  INIT_Cam_Buffer_5=uint8(0),
  INIT_Cam_Sensor_ID_P5_V=uint8(0),
  INIT_Cam_Sensor_ID_P5=uint64(0),
  INIT_Cam_Buffer_6_V=uint8(0),
  INIT_Cam_Buffer_6=uint8(0),
  INIT_Cam_Sensor_ID_P6_V=uint8(0),
  INIT_Cam_Sensor_ID_P6=uint64(0),
  INIT_Cam_Buffer_7_V=uint8(0),
  INIT_Cam_Buffer_7=uint8(0),
  INIT_Cam_Sensor_ID_P7_V=uint8(0),
  INIT_Cam_Sensor_ID_P7=uint64(0),
  INIT_Cam_Buffer_8_V=uint8(0),
  INIT_Cam_Buffer_8=uint8(0),
  INIT_Cam_Sensor_ID_P8_V=uint8(0),
  INIT_Cam_Sensor_ID_P8=uint64(0),
  INIT_Cam_Buffer_9_V=uint8(0),
  INIT_Cam_Buffer_9=uint8(0),
  INIT_Cam_EPROM_CRC_V=uint8(0),
  INIT_Cam_EPROM_CRC=uint32(0),
  INIT_Cam_Type=uint8(0),
  INIT_Cam_distortionModelType=uint8(0),
  Reserved_1=uint8(0),
  INIT_Cam_CODX=0,
  INIT_Cam_CODY=0,
  INIT_Cam_distorParams0=0,
  INIT_Cam_distorParams1=0,
  INIT_Cam_distorParams2=0,
  INIT_Cam_distorParams3=0,
  INIT_Cam_distorParams4=0,
  INIT_Cam_distorParams5=0,
  INIT_Cam_distorParams6=0,
  INIT_Cam_distorParams7=0,
  INIT_Cam_distorParams8=0,
  INIT_Cam_distorParams9=0,
  INIT_Cam_distorParams10=0,
  INIT_Cam_distorParams11=0,
  INIT_Cam_distorParams12=0,
  INIT_Cam_distorParams13=0,
  INIT_Cam_distorParams14=0,
  INIT_Cam_distorParams15=0,
  INIT_Cam_FocalLengthX=0,
  INIT_Cam_FocalLengthY=0,
  INIT_Cam_Skew=0,
  INIT_Cam_PrincipalPointX=0,
  INIT_Cam_PrincipalPointY=0)

EQ4_IC2C_HDR_VAL = struct(
  IC2C_Zero_Byte=uint8(0),
  IC2C_Protocol_Version=uint8(0),
  IC2C_Optional_Signals=uint8(0),
  IC2C_Sensor_ID=uint32(0),
  IC2C_Cam_Type=uint8(0),
  Reserved_1=uint8(0),
  IC2C_Tx=single(0),
  IC2C_Ty=single(0),
  IC2C_Tz=single(0),
  IC2C_R11=single(0),
  IC2C_R12=single(0),
  IC2C_R13=single(0),
  IC2C_R21=single(0),
  IC2C_R22=single(0),
  IC2C_R23=single(0),
  IC2C_R31=single(0),
  IC2C_R32=single(0),
  IC2C_R33=single(0))

EQ4_IC2C_HDR_PAR = AUTOSAR4.Parameter(struct(
  IC2C_Zero_Byte=uint8(0),
  IC2C_Protocol_Version=uint8(0),
  IC2C_Optional_Signals=uint8(0),
  IC2C_Sensor_ID=uint32(0),
  IC2C_Cam_Type=uint8(0),
  Reserved_1=uint8(0),
  IC2C_Tx=single(0),
  IC2C_Ty=single(0),
  IC2C_Tz=single(0),
  IC2C_R11=single(0),
  IC2C_R12=single(0),
  IC2C_R13=single(0),
  IC2C_R21=single(0),
  IC2C_R22=single(0),
  IC2C_R23=single(0),
  IC2C_R31=single(0),
  IC2C_R32=single(0),
  IC2C_R33=single(0)), SwCalibrationAccess="ReadWrite", DataType="Bus: EQ4_IC2C_HDR_BUS")

EQ4_ICAM_HDR_PAR = AUTOSAR4.Parameter(struct(
  INIT_Cam_Zero_Byte=uint8(0),
  INIT_Cam_Protocol_Version=uint8(0),
  INIT_Cam_Optional_Signals=uint8(0),
  INIT_Cam_Buffer_1_V=uint8(0),
  INIT_Cam_Buffer_1=uint8(0),
  INIT_Cam_Sensor_ID_P1_V=uint8(0),
  INIT_Cam_Sensor_ID_P1=uint64(0),
  INIT_Cam_Buffer_2_V=uint8(0),
  INIT_Cam_Buffer_2=uint8(0),
  INIT_Cam_Sensor_ID_P2_V=uint8(0),
  INIT_Cam_Sensor_ID_P2=uint64(0),
  INIT_Cam_Buffer_3_V=uint8(0),
  INIT_Cam_Buffer_3=uint8(0),
  INIT_Cam_Sensor_ID_P3_V=uint8(0),
  INIT_Cam_Sensor_ID_P3=uint64(0),
  INIT_Cam_Buffer_4_V=uint8(0),
  INIT_Cam_Buffer_4=uint8(0),
  INIT_Cam_Sensor_ID_P4_V=uint8(0),
  INIT_Cam_Sensor_ID_P4=uint64(0),
  INIT_Cam_Buffer_5_V=uint8(0),
  INIT_Cam_Buffer_5=uint8(0),
  INIT_Cam_Sensor_ID_P5_V=uint8(0),
  INIT_Cam_Sensor_ID_P5=uint64(0),
  INIT_Cam_Buffer_6_V=uint8(0),
  INIT_Cam_Buffer_6=uint8(0),
  INIT_Cam_Sensor_ID_P6_V=uint8(0),
  INIT_Cam_Sensor_ID_P6=uint64(0),
  INIT_Cam_Buffer_7_V=uint8(0),
  INIT_Cam_Buffer_7=uint8(0),
  INIT_Cam_Sensor_ID_P7_V=uint8(0),
  INIT_Cam_Sensor_ID_P7=uint64(0),
  INIT_Cam_Buffer_8_V=uint8(0),
  INIT_Cam_Buffer_8=uint8(0),
  INIT_Cam_Sensor_ID_P8_V=uint8(0),
  INIT_Cam_Sensor_ID_P8=uint64(0),
  INIT_Cam_Buffer_9_V=uint8(0),
  INIT_Cam_Buffer_9=uint8(0),
  INIT_Cam_EPROM_CRC_V=uint8(0),
  INIT_Cam_EPROM_CRC=uint32(0),
  INIT_Cam_Type=uint8(0),
  INIT_Cam_distortionModelType=uint8(0),
  Reserved_1=uint8(0),
  INIT_Cam_CODX=0,
  INIT_Cam_CODY=0,
  INIT_Cam_distorParams0=0,
  INIT_Cam_distorParams1=0,
  INIT_Cam_distorParams2=0,
  INIT_Cam_distorParams3=0,
  INIT_Cam_distorParams4=0,
  INIT_Cam_distorParams5=0,
  INIT_Cam_distorParams6=0,
  INIT_Cam_distorParams7=0,
  INIT_Cam_distorParams8=0,
  INIT_Cam_distorParams9=0,
  INIT_Cam_distorParams10=0,
  INIT_Cam_distorParams11=0,
  INIT_Cam_distorParams12=0,
  INIT_Cam_distorParams13=0,
  INIT_Cam_distorParams14=0,
  INIT_Cam_distorParams15=0,
  INIT_Cam_FocalLengthX=0,
  INIT_Cam_FocalLengthY=0,
  INIT_Cam_Skew=0,
  INIT_Cam_PrincipalPointX=0,
  INIT_Cam_PrincipalPointY=0), SwCalibrationAccess="ReadWrite", DataType="Bus:EQ4_ICAM_HDR_BUS")

EQ4_IDEBUG_HDR_PAR = AUTOSAR4.Parameter(struct(
  IDebug_Zero_Byte=uint8(0),
  IDebug_Protocol_Version=uint8(0),
  IDebug_Optional_Signals=uint8(0),
  IDebug_Construction_Area=uint8(0),
  IDebug_Free_Space=uint8(0),
  IDebug_Hazards=uint8(0),
  IDebug_INTP=uint8(0),
  IDebug_Land_Marks=uint8(0),
  IDebug_Lane_marks=uint8(0),
  IDebug_Light_Scene=uint8(0),
  IDebug_Objects=uint8(0),
  IDebug_Semantic_Crossing=uint8(0),
  IDebug_Semantic_Lines=uint8(0),
  IDebug_Semantic_Marks=uint8(0),
  IDebug_TFL_Structure=uint8(0),
  IDebug_TFL_Spots=uint8(0),
  IDebug_Traffic_Signs=uint8(0),
  IDebug_DSTraffic_Signs=uint8(0),
  IDebug_Semantic_Junction=uint8(0),
  Reserved_1=uint8(0)), SwCalibrationAccess="ReadWrite", DataType="Bus:EQ4_IDEBUG_HDR_BUS")

EQ4_IDV_HDR_PAR = AUTOSAR4.Parameter(struct(IDV_Zero_byte=uint8(0), IDV_Protocol_Version=uint8(0), IDV_Optional_Signals=uint8(0)), SwCalibrationAccess="ReadWrite", DataType="Bus:EQ4_IDV_HDR_BUS")

EQ4_IENV_HDR_PAR = AUTOSAR4.Parameter(struct(
  IEnvironment_Zero_Byte=uint8(0),
  IEnvironment_Protocol_Version=2,
  IEnvironment_Optional_Signals=uint8(0),
  IEnvironment_GPSToCam_dx_V=uint8(0),
  IEnvironment_GPSToCam_dx=single(0),
  IEnvironment_Buffer1_V=uint8(0),
  IEnvironment_Buffer1=uint8(0),
  IEnvironment_GPSToCam_dy_V=uint8(0),
  IEnvironment_GPSToCam_dy=single(0),
  IEnvironment_GPSToCam_dz_V=uint8(0),
  IEnvironment_GPSToCam_dz=single(0),
  IEnvironment_WheelWidth=0.266,
  Reserved_1=uint8(0),
  IEnvironment_WheelRadius=0.387,
  IEnvironment_LeftWheel=1.061,
  Reserved_2=uint8(0),
  IEnvironment_RightWheel=0.87,
  IEnvironment_RefPX_Front_Bumper=1.933,
  IEnvironment_CamToFrontAxle=1.004,
  IEnvironment_CamToRearAxle=1.922,
  IEnvironment_MinHorizon=-39,
  IEnvironment_MaxHorizon=39,
  IEnvironment_MinYaw=-46,
  IEnvironment_MaxYaw=46,
  IEnvironment_MaxRoll=0.05,
  IEnvironment_Top_Crop=120,
  IEnvironment_Bottom_Crop=-120,
  Reserved_3=uint8(0)), SwCalibrationAccess="ReadWrite", DataType="Bus:EQ4_IENV_HDR_BUS")

EQ4_IGENERAL_HDR_PAR = AUTOSAR4.Parameter(struct(
  IGeneral_Zero_Byte=uint8(0),
  IGeneral_Protocol_Version=uint8(0),
  IGeneral_Optional_Signals=uint8(0),
  IGeneral_Buffer_1_V=uint8(0),
  IGeneral_Buffer_1=uint8(0),
  IGeneral_Roll_Angle_Base_V=uint8(0),
  IGeneral_Roll_Angle_Base=single(0),
  IGeneral_CLB_DYN_AF_Pitch_V=uint8(0),
  IGeneral_CLB_DYN_AF_Pitch=int16(0),
  IGeneral_CLB_DYN_AF_Yaw_V=uint8(0),
  IGeneral_CLB_DYN_AF_Yaw=int16(0),
  IGeneral_CLB_DYN_AF_Roll_V=uint8(0),
  IGeneral_CLB_DYN_AF_Roll=single(0),
  IGeneral_Region_Code=uint8(0),
  IGeneral_Driving_Side=uint8(0),
  IGeneral_HIL_Mode=uint8(0),
  IGeneral_Cam_Height_Full=single(0),
  Reserved_1=uint8(0),
  IGeneral_Pitch_Base=int16(0),
  IGeneral_Yaw_Base=int16(0),
  IGeneral_Camera_Height_Base=single(0),
  Reserved_2=uint8(0)), SwCalibrationAccess="ReadWrite", DataType="Bus:EQ4_IGENERAL_HDR_BUS")

EQ4_IIPB_EXT_HDR_PAR = AUTOSAR4.Parameter(struct(
  IIPB_EXT_Zero_byte=uint8(0),
  IIPB_EXT_Protocol_Version=uint8(0),
  IIPB_EXT_Optional_Signals=uint8(0),
  Reserved_1=uint8(0),
  TTB_baseReactionTimeFar=single(0),
  TTB_baseReactionTimeMedium=single(0),
  TTB_baseReactionTimeNear=single(0),
  TTB_Dist_Fact_Tgt_Str_Brk_0=single(0),
  TTB_Dist_Fact_Tgt_Str_Brk_1=single(0),
  TTB_Dist_Fact_Tgt_Str_Brk_2=single(0),
  TTB_Dist_Fact_Tgt_Str_Brk_3=single(0),
  TTB_Dist_Fact_kneepoints_0=uint8(0),
  TTB_Dist_Fact_kneepoints_1=uint8(0),
  TTB_Dist_Fact_kneepoints_2=uint8(0),
  TTB_Dist_Fact_kneepoints_3=uint8(0),
  TTB_EgoSp_Fact_Stationary_0=single(0),
  TTB_EgoSp_Fact_Stationary_1=single(0),
  TTB_EgoSp_Fact_Stationary_2=single(0),
  TTB_EgoSp_Fact_Stationary_3=single(0),
  TTB_EgoSp_Fact_Stationary_4=single(0),
  TTB_EgoSp_Fact_Stationary_5=single(0),
  TTB_EgoSp_Fact_Moving_0=single(0),
  TTB_EgoSp_Fact_Moving_1=single(0),
  TTB_EgoSp_Fact_Moving_2=single(0),
  TTB_EgoSp_Fact_Moving_3=single(0),
  TTB_EgoSp_Fact_Moving_4=single(0),
  TTB_EgoSp_Fact_Moving_5=single(0),
  TTB_EgoSp_Fact_Follow_Brk_0=single(0),
  TTB_EgoSp_Fact_Follow_Brk_1=single(0),
  TTB_EgoSp_Fact_Follow_Brk_2=single(0),
  TTB_EgoSp_Fact_Follow_Brk_3=single(0),
  TTB_EgoSp_Fact_Follow_Brk_4=single(0),
  TTB_EgoSp_Fact_Follow_Brk_5=single(0),
  TTB_EgoSp_Fact_Kneepoints_0=single(0),
  TTB_EgoSp_Fact_Kneepoints_1=single(0),
  TTB_EgoSp_Fact_Kneepoints_2=single(0),
  TTB_EgoSp_Fact_Kneepoints_3=single(0),
  TTB_EgoSp_Fact_Kneepoints_4=single(0),
  TTB_EgoSp_Fact_Kneepoints_5=single(0),
  TTB_Att_Factor_Stationary_0=single(0),
  TTB_Att_Factor_Stationary_1=single(0),
  TTB_Att_Factor_Stationary_2=single(0),
  TTB_Att_Factor_Stationary_3=single(0),
  TTB_Att_Factor_Moving_0=single(0),
  TTB_Att_Factor_Moving_1=single(0),
  TTB_Att_Factor_Moving_2=single(0),
  TTB_Att_Factor_Moving_3=single(0),
  TTB_Att_Factr_Follw_Brake_0=single(0),
  TTB_Att_Factr_Follw_Brake_1=single(0),
  TTB_Att_Factr_Follw_Brake_2=single(0),
  TTB_Att_Factr_Follw_Brake_3=single(0),
  TTB_Att_Factor_Kneepoints_0=single(0),
  TTB_Att_Factor_Kneepoints_1=single(0),
  TTB_Att_Factor_Kneepoints_2=single(0),
  TTB_Att_Factor_Kneepoints_3=single(0),
  TTS_baseReactionTimeFar=single(0),
  TTS_baseReactionTimeMedium=single(0),
  TTS_baseReactionTimeNear=single(0),
  TTS_Attention_Factor_0=single(0),
  TTS_Attention_Factor_1=single(0),
  TTS_Attention_Factor_2=single(0),
  TTS_Attention_Factor_3=single(0),
  TTS_Att_Fact_Kneepoints_0=single(0),
  TTS_Att_Fact_Kneepoints_1=single(0),
  TTS_Att_Fact_Kneepoints_2=single(0),
  TTS_Att_Fact_Kneepoints_3=single(0),
  AEB_ayAvoid_EgoSpeed_0=uint8(0),
  AEB_ayAvoid_EgoSpeed_1=uint8(0),
  AEB_ayAvoid_EgoSpeed_2=uint8(0),
  AEB_ayAvoid_EgoSpeed_3=uint8(0),
  AEB_ayAvoid_LatAcc_0=single(0),
  AEB_ayAvoid_LatAcc_1=single(0),
  AEB_ayAvoid_LatAcc_2=single(0),
  AEB_ayAvoid_LatAcc_3=single(0),
  FCW_ayAvoid_EgoSpeed_0=single(0),
  FCW_ayAvoid_EgoSpeed_1=single(0),
  FCW_ayAvoid_EgoSpeed_2=single(0),
  FCW_ayAvoid_EgoSpeed_3=single(0),
  FCW_ayAvoid_LatAcc_0=single(0),
  FCW_ayAvoid_LatAcc_1=single(0),
  FCW_ayAvoid_LatAcc_2=single(0),
  FCW_ayAvoid_LatAcc_3=single(0),
  AEB_decel_reduction_0=single(0),
  AEB_decel_reduction_1=single(0),
  AEB_decel_reduction_2=single(0),
  AEB_deceleration_0=single(0),
  AEB_deceleration_1=single(0),
  AEB_deceleration_2=single(0),
  FCW_decel_reduction_0=single(0),
  FCW_decel_reduction_1=single(0),
  FCW_decel_reduction_2=single(0),
  FCW_deceleration_0=single(0),
  FCW_deceleration_1=single(0),
  FCW_deceleration_2=single(0),
  Dr_Brking_Offset_Factor=single(0),
  Reserved_2=uint8(0),
  Overlap_Offset_Factor=single(0),
  Brake1_Max_Deceleration_0=single(0),
  Brake1_Max_Deceleration_1=single(0),
  Brake1_Max_Deceleration_2=single(0),
  Brake1_Max_Deceleration_3=single(0),
  Brk_Max_Decel_Kneepts_0=uint8(0),
  Brk_Max_Decel_Kneepts_1=uint8(0),
  Brk_Max_Decel_Kneepts_2=uint8(0),
  Brk_Max_Decel_Kneepts_3=uint8(0),
  Brake1_Duration=single(0),
  Brake1_Max_Gradient_0=uint8(0),
  Brake1_Max_Gradient_1=uint8(0),
  Brake1_Max_Gradient_2=uint8(0),
  Brk_Max_Gradient_Kneepts_0=uint8(0),
  Brk_Max_Gradient_Kneepts_1=uint8(0),
  Brk_Max_Gradient_Kneepts_2=uint8(0),
  Brake2_Max_Gradient_0=uint8(0),
  Brake2_Max_Gradient_1=uint8(0),
  Brake2_Max_Gradient_2=uint8(0),
  Brake2_Max_Deceleration_0=single(0),
  Brake2_Max_Deceleration_1=single(0),
  Brake2_Max_Deceleration_2=single(0),
  Brake2_Max_Deceleration_3=single(0),
  Brake2_Min_Deceleration=single(0),
  Brake3_Max_Gradient_0=uint8(0),
  Brake3_Max_Gradient_1=uint8(0),
  Brake3_Max_Gradient_2=uint8(0),
  Brake3_Max_Deceleration_0=single(0),
  Brake3_Max_Deceleration_1=single(0),
  Brake3_Max_Deceleration_2=single(0),
  Brake3_Max_Deceleration_3=single(0),
  Brake3_Avoid_Decel_Thresh=single(0),
  Brake3_TTC_Thr=single(0),
  Brake3_On_Off=uint8(0),
  Brk1_to_Brk3_Min_T_Elapse=single(0),
  Brake3_Max_Headway=single(0),
  AEB_maxSteeringAngle=single(0),
  FCW_maxSteeringAngle=single(0),
  k_FCA_LatencyCompensation=single(0),
  Reserved_3=uint8(0)), SwCalibrationAccess="ReadWrite", DataType="Bus:EQ4_IIPB_EXT_HDR_BUS")

EQ4_IIPB_EXT_HDR_VAL = Simulink.Parameter(struct(
  IIPB_EXT_Zero_byte=uint8(0),
  IIPB_EXT_Protocol_Version=uint8(0),
  IIPB_EXT_Optional_Signals=uint8(0),
  Reserved_1=uint8(0),
  TTB_baseReactionTimeFar=single(0),
  TTB_baseReactionTimeMedium=single(0),
  TTB_baseReactionTimeNear=single(0),
  TTB_Dist_Fact_Tgt_Str_Brk_0=single(0),
  TTB_Dist_Fact_Tgt_Str_Brk_1=single(0),
  TTB_Dist_Fact_Tgt_Str_Brk_2=single(0),
  TTB_Dist_Fact_Tgt_Str_Brk_3=single(0),
  TTB_Dist_Fact_kneepoints_0=uint8(0),
  TTB_Dist_Fact_kneepoints_1=uint8(0),
  TTB_Dist_Fact_kneepoints_2=uint8(0),
  TTB_Dist_Fact_kneepoints_3=uint8(0),
  TTB_EgoSp_Fact_Stationary_0=single(0),
  TTB_EgoSp_Fact_Stationary_1=single(0),
  TTB_EgoSp_Fact_Stationary_2=single(0),
  TTB_EgoSp_Fact_Stationary_3=single(0),
  TTB_EgoSp_Fact_Stationary_4=single(0),
  TTB_EgoSp_Fact_Stationary_5=single(0),
  TTB_EgoSp_Fact_Moving_0=single(0),
  TTB_EgoSp_Fact_Moving_1=single(0),
  TTB_EgoSp_Fact_Moving_2=single(0),
  TTB_EgoSp_Fact_Moving_3=single(0),
  TTB_EgoSp_Fact_Moving_4=single(0),
  TTB_EgoSp_Fact_Moving_5=single(0),
  TTB_EgoSp_Fact_Follow_Brk_0=single(0),
  TTB_EgoSp_Fact_Follow_Brk_1=single(0),
  TTB_EgoSp_Fact_Follow_Brk_2=single(0),
  TTB_EgoSp_Fact_Follow_Brk_3=single(0),
  TTB_EgoSp_Fact_Follow_Brk_4=single(0),
  TTB_EgoSp_Fact_Follow_Brk_5=single(0),
  TTB_EgoSp_Fact_Kneepoints_0=single(0),
  TTB_EgoSp_Fact_Kneepoints_1=single(0),
  TTB_EgoSp_Fact_Kneepoints_2=single(0),
  TTB_EgoSp_Fact_Kneepoints_3=single(0),
  TTB_EgoSp_Fact_Kneepoints_4=single(0),
  TTB_EgoSp_Fact_Kneepoints_5=single(0),
  TTB_Att_Factor_Stationary_0=single(0),
  TTB_Att_Factor_Stationary_1=single(0),
  TTB_Att_Factor_Stationary_2=single(0),
  TTB_Att_Factor_Stationary_3=single(0),
  TTB_Att_Factor_Moving_0=single(0),
  TTB_Att_Factor_Moving_1=single(0),
  TTB_Att_Factor_Moving_2=single(0),
  TTB_Att_Factor_Moving_3=single(0),
  TTB_Att_Factr_Follw_Brake_0=single(0),
  TTB_Att_Factr_Follw_Brake_1=single(0),
  TTB_Att_Factr_Follw_Brake_2=single(0),
  TTB_Att_Factr_Follw_Brake_3=single(0),
  TTB_Att_Factor_Kneepoints_0=single(0),
  TTB_Att_Factor_Kneepoints_1=single(0),
  TTB_Att_Factor_Kneepoints_2=single(0),
  TTB_Att_Factor_Kneepoints_3=single(0),
  TTS_baseReactionTimeFar=single(0),
  TTS_baseReactionTimeMedium=single(0),
  TTS_baseReactionTimeNear=single(0),
  TTS_Attention_Factor_0=single(0),
  TTS_Attention_Factor_1=single(0),
  TTS_Attention_Factor_2=single(0),
  TTS_Attention_Factor_3=single(0),
  TTS_Att_Fact_Kneepoints_0=single(0),
  TTS_Att_Fact_Kneepoints_1=single(0),
  TTS_Att_Fact_Kneepoints_2=single(0),
  TTS_Att_Fact_Kneepoints_3=single(0),
  AEB_ayAvoid_EgoSpeed_0=uint8(0),
  AEB_ayAvoid_EgoSpeed_1=uint8(0),
  AEB_ayAvoid_EgoSpeed_2=uint8(0),
  AEB_ayAvoid_EgoSpeed_3=uint8(0),
  AEB_ayAvoid_LatAcc_0=single(0),
  AEB_ayAvoid_LatAcc_1=single(0),
  AEB_ayAvoid_LatAcc_2=single(0),
  AEB_ayAvoid_LatAcc_3=single(0),
  FCW_ayAvoid_EgoSpeed_0=single(0),
  FCW_ayAvoid_EgoSpeed_1=single(0),
  FCW_ayAvoid_EgoSpeed_2=single(0),
  FCW_ayAvoid_EgoSpeed_3=single(0),
  FCW_ayAvoid_LatAcc_0=single(0),
  FCW_ayAvoid_LatAcc_1=single(0),
  FCW_ayAvoid_LatAcc_2=single(0),
  FCW_ayAvoid_LatAcc_3=single(0),
  AEB_decel_reduction_0=single(0),
  AEB_decel_reduction_1=single(0),
  AEB_decel_reduction_2=single(0),
  AEB_deceleration_0=single(0),
  AEB_deceleration_1=single(0),
  AEB_deceleration_2=single(0),
  FCW_decel_reduction_0=single(0),
  FCW_decel_reduction_1=single(0),
  FCW_decel_reduction_2=single(0),
  FCW_deceleration_0=single(0),
  FCW_deceleration_1=single(0),
  FCW_deceleration_2=single(0),
  Dr_Brking_Offset_Factor=single(0),
  Reserved_2=uint8(0),
  Overlap_Offset_Factor=single(0),
  Brake1_Max_Deceleration_0=single(0),
  Brake1_Max_Deceleration_1=single(0),
  Brake1_Max_Deceleration_2=single(0),
  Brake1_Max_Deceleration_3=single(0),
  Brk_Max_Decel_Kneepts_0=uint8(0),
  Brk_Max_Decel_Kneepts_1=uint8(0),
  Brk_Max_Decel_Kneepts_2=uint8(0),
  Brk_Max_Decel_Kneepts_3=uint8(0),
  Brake1_Duration=single(0),
  Brake1_Max_Gradient_0=uint8(0),
  Brake1_Max_Gradient_1=uint8(0),
  Brake1_Max_Gradient_2=uint8(0),
  Brk_Max_Gradient_Kneepts_0=uint8(0),
  Brk_Max_Gradient_Kneepts_1=uint8(0),
  Brk_Max_Gradient_Kneepts_2=uint8(0),
  Brake2_Max_Gradient_0=uint8(0),
  Brake2_Max_Gradient_1=uint8(0),
  Brake2_Max_Gradient_2=uint8(0),
  Brake2_Max_Deceleration_0=single(0),
  Brake2_Max_Deceleration_1=single(0),
  Brake2_Max_Deceleration_2=single(0),
  Brake2_Max_Deceleration_3=single(0),
  Brake2_Min_Deceleration=single(0),
  Brake3_Max_Gradient_0=uint8(0),
  Brake3_Max_Gradient_1=uint8(0),
  Brake3_Max_Gradient_2=uint8(0),
  Brake3_Max_Deceleration_0=single(0),
  Brake3_Max_Deceleration_1=single(0),
  Brake3_Max_Deceleration_2=single(0),
  Brake3_Max_Deceleration_3=single(0),
  Brake3_Avoid_Decel_Thresh=single(0),
  Brake3_TTC_Thr=single(0),
  Brake3_On_Off=uint8(0),
  Brk1_to_Brk3_Min_T_Elapse=single(0),
  Brake3_Max_Headway=single(0),
  AEB_maxSteeringAngle=single(0),
  FCW_maxSteeringAngle=single(0),
  k_FCA_LatencyCompensation=single(0),
  Reserved_3=uint8(0)))

EQ4_IIPB_HDR_PAR = AUTOSAR4.Parameter(struct(
  IIPB_Zero_byte=uint8(0),
  IIPB_Protocol_Version=uint8(0),
  IIPB_Optional_Signals=uint8(0),
  AdhereToGapSensitivity_V=uint8(0),
  AdhereToGapSensitivity=uint8(0),
  AEB_BrakeToStillMode_V=uint8(0),
  AEB_BrakeToStillMode=uint8(0),
  IIPB_Buffer_1_V=uint8(0),
  IIPB_Buffer_1=uint8(0),
  AEB_Deceleration_0_V=uint8(0),
  AEB_Deceleration_0=single(0),
  AEB_Deceleration_1_V=uint8(0),
  AEB_Deceleration_1=single(0),
  AEB_Deceleration_2_V=uint8(0),
  AEB_Deceleration_2=single(0),
  AEB_Deceleration_Reduction_0_V=uint8(0),
  AEB_Deceleration_Reduction_0=single(0),
  AEB_Deceleration_Reduction_1_V=uint8(0),
  AEB_Deceleration_Reduction_1=single(0),
  AEB_Deceleration_Reduction_2_V=uint8(0),
  AEB_Deceleration_Reduction_2=single(0),
  IIPB_Buffer_2_V=uint8(0),
  IIPB_Buffer_2=uint8(0),
  AEB_MaxRelV_V=uint8(0),
  AEB_MaxRelV=single(0),
  AEB_MaxSpeed_V=uint8(0),
  AEB_MaxSpeed=single(0),
  IIPB_Buffer_3_V=uint8(0),
  IIPB_Buffer_3=uint8(0),
  AEB_MaxSpeedReduction_V=uint8(0),
  AEB_MaxSpeedReduction=single(0),
  AEB_MaxYawRate_V=uint8(0),
  AEB_MaxYawRate=uint16(0),
  IIPB_Buffer_4_V=uint8(0),
  IIPB_Buffer_4=uint8(0),
  AEB_Min_time_after_AEB_for_AEB_V=uint8(0),
  AEB_Min_time_after_AEB_for_AEB=single(0),
  AEB_MinRelV_V=uint8(0),
  AEB_MinRelV=single(0),
  IIPB_Buffer_5_V=uint8(0),
  IIPB_Buffer_5=uint8(0),
  AEB_MinSpeed_V=uint8(0),
  AEB_MinSpeed=single(0),
  AEB_StandStillFollowTimeHyst_V=uint8(0),
  AEB_StandStillFollowTimeHyst=single(0),
  IIPB_Buffer_6_V=uint8(0),
  IIPB_Buffer_6=uint8(0),
  AEB_StandStillMaxSpeed_V=uint8(0),
  AEB_StandStillMaxSpeed=single(0),
  AEB_StandStillStillTimeHyst_V=uint8(0),
  AEB_StandStillStillTimeHyst=single(0),
  Far_FCA_HW_VAL_0_V=uint8(0),
  Far_FCA_HW_VAL_0=single(0),
  IIPB_Buffer_7_V=uint8(0),
  IIPB_Buffer_7=uint8(0),
  Far_FCA_HW_VAL_1_V=uint8(0),
  Far_FCA_HW_VAL_1=single(0),
  Far_FCA_HW_VAL_2_V=uint8(0),
  Far_FCA_HW_VAL_2=single(0),
  Far_FCA_HW_VAL_3_V=uint8(0),
  Far_FCA_HW_VAL_3=single(0),
  IIPB_Buffer_8_V=uint8(0),
  IIPB_Buffer_8=uint8(0),
  Far_FCA_HW_VAL_4_V=uint8(0),
  Far_FCA_HW_VAL_4=single(0),
  Far_FCA_HW_VAL_5_V=uint8(0),
  Far_FCA_HW_VAL_5=single(0),
  FAR_TTC_TABLE_0_V=uint8(0),
  FAR_TTC_TABLE_0=single(0),
  IIPB_Buffer_9_V=uint8(0),
  IIPB_Buffer_9=uint8(0),
  FAR_TTC_TABLE_1_V=uint8(0),
  FAR_TTC_TABLE_1=single(0),
  FAR_TTC_TABLE_2_V=uint8(0),
  FAR_TTC_TABLE_2=single(0),
  FAR_TTC_TABLE_3_V=uint8(0),
  FAR_TTC_TABLE_3=single(0),
  FAR_TTC_TABLE_4_V=uint8(0),
  FAR_TTC_TABLE_4=single(0),
  FAR_TTC_TABLE_5_V=uint8(0),
  FAR_TTC_TABLE_5=single(0),
  IIPB_Buffer_10_V=uint8(0),
  IIPB_Buffer_10=uint8(0),
  FAR_TTC_TABLE_6_V=uint8(0),
  FAR_TTC_TABLE_6=single(0),
  FAR_TTC_TABLE_7_V=uint8(0),
  FAR_TTC_TABLE_7=single(0),
  IIPB_Buffer_11_V=uint8(0),
  IIPB_Buffer_11=uint8(0),
  FCA_HW_Kneepoints_0_V=uint8(0),
  FCA_HW_Kneepoints_0=single(0),
  FCA_HW_Kneepoints_1_V=uint8(0),
  FCA_HW_Kneepoints_1=single(0),
  FCA_HW_Kneepoints_2_V=uint8(0),
  FCA_HW_Kneepoints_2=single(0),
  FCA_HW_Kneepoints_3_V=uint8(0),
  FCA_HW_Kneepoints_3=single(0),
  FCA_HW_Kneepoints_4_V=uint8(0),
  FCA_HW_Kneepoints_4=single(0),
  FCA_HW_Kneepoints_5_V=uint8(0),
  FCA_HW_Kneepoints_5=single(0),
  FCA_HW_Stop_Fact_V=uint8(0),
  FCA_HW_Stop_Fact=single(0),
  FCA_Ignition_default_state_V=uint8(0),
  FCA_Ignition_default_state=uint8(0),
  FCW_BaseSpeeds_0_V=uint8(0),
  FCW_BaseSpeeds_0=single(0),
  IIPB_Buffer_12_V=uint8(0),
  IIPB_Buffer_12=uint8(0),
  FCW_BaseSpeeds_1_V=uint8(0),
  FCW_BaseSpeeds_1=single(0),
  FCW_BaseSpeeds_2_V=uint8(0),
  FCW_BaseSpeeds_2=single(0),
  FCW_BaseSpeeds_3_V=uint8(0),
  FCW_BaseSpeeds_3=single(0),
  FCW_BaseSpeeds_4_V=uint8(0),
  FCW_BaseSpeeds_4=single(0),
  FCW_BaseSpeeds_5_V=uint8(0),
  FCW_BaseSpeeds_5=single(0),
  FCW_BaseSpeeds_6_V=uint8(0),
  FCW_BaseSpeeds_6=single(0),
  FCW_BaseSpeeds_7_V=uint8(0),
  FCW_BaseSpeeds_7=single(0),
  FCW_Deceleration_0_V=uint8(0),
  FCW_Deceleration_0=single(0),
  IIPB_Buffer_13_V=uint8(0),
  IIPB_Buffer_13=uint8(0),
  FCW_Deceleration_1_V=uint8(0),
  FCW_Deceleration_1=single(0),
  FCW_Deceleration_2_V=uint8(0),
  FCW_Deceleration_2=single(0),
  FCW_Deceleration_reduction_0_V=uint8(0),
  FCW_Deceleration_reduction_0=single(0),
  FCW_Deceleration_reduction_1_V=uint8(0),
  FCW_Deceleration_reduction_1=single(0),
  FCW_Deceleration_reduction_2_V=uint8(0),
  FCW_Deceleration_reduction_2=single(0),
  FCW_MaxDistance_V=uint8(0),
  FCW_MaxDistance=single(0),
  FCW_MaxThresh_V=uint8(0),
  FCW_MaxThresh=single(0),
  K_FCAAccelHaloTime_V=uint8(0),
  K_FCAAccelHaloTime=single(0),
  K_FCAAccelLevel_V=uint8(0),
  K_FCAAccelLevel=uint16(0),
  K_FCABrakeApplyDur_V=uint8(0),
  K_FCABrakeApplyDur=single(0),
  K_FCABrakeApplyHaloTime_V=uint8(0),
  K_FCABrakeApplyHaloTime=single(0),
  K_FCALIATime_V=uint8(0),
  K_FCALIATime=single(0),
  IIPB_Buffer_14_V=uint8(0),
  IIPB_Buffer_14=uint8(0),
  K_FCAR_t_ClutchHaloTime_V=uint8(0),
  K_FCAR_t_ClutchHaloTime=single(0),
  K_MaxFCAEnableSpeed_V=uint8(0),
  K_MaxFCAEnableSpeed=uint8(0),
  K_MaxFCAEnableSpeedHysteresis_V=uint8(0),
  K_MaxFCAEnableSpeedHysteresis=uint8(0),
  IIPB_Buffer_15_V=uint8(0),
  IIPB_Buffer_15=uint8(0),
  K_MinFCAEnableSpeed_V=uint8(0),
  K_MinFCAEnableSpeed=uint8(0),
  K_MinFCAEnableSpeedHysteresis_V=uint8(0),
  K_MinFCAEnableSpeedHysteresis=uint8(0),
  Medium_FCA_HW_VAL_0_V=uint8(0),
  Medium_FCA_HW_VAL_0=single(0),
  Medium_FCA_HW_VAL_1_V=uint8(0),
  Medium_FCA_HW_VAL_1=single(0),
  Medium_FCA_HW_VAL_2_V=uint8(0),
  Medium_FCA_HW_VAL_2=single(0),
  Medium_FCA_HW_VAL_3_V=uint8(0),
  Medium_FCA_HW_VAL_3=single(0),
  Medium_FCA_HW_VAL_4_V=uint8(0),
  Medium_FCA_HW_VAL_4=single(0),
  IIPB_Buffer_16_V=uint8(0),
  IIPB_Buffer_16=uint8(0),
  Medium_FCA_HW_VAL_5_V=uint8(0),
  Medium_FCA_HW_VAL_5=single(0),
  MEDIUM_TTC_TABLE_0_V=uint8(0),
  MEDIUM_TTC_TABLE_0=single(0),
  MEDIUM_TTC_TABLE_1_V=uint8(0),
  MEDIUM_TTC_TABLE_1=single(0),
  MEDIUM_TTC_TABLE_2_V=uint8(0),
  MEDIUM_TTC_TABLE_2=single(0),
  MEDIUM_TTC_TABLE_3_V=uint8(0),
  MEDIUM_TTC_TABLE_3=single(0),
  MEDIUM_TTC_TABLE_4_V=uint8(0),
  MEDIUM_TTC_TABLE_4=single(0),
  MEDIUM_TTC_TABLE_5_V=uint8(0),
  MEDIUM_TTC_TABLE_5=single(0),
  MEDIUM_TTC_TABLE_6_V=uint8(0),
  MEDIUM_TTC_TABLE_6=single(0),
  IIPB_Buffer_17_V=uint8(0),
  IIPB_Buffer_17=uint8(0),
  MEDIUM_TTC_TABLE_7_V=uint8(0),
  MEDIUM_TTC_TABLE_7=single(0),
  Near_FCA_HW_VAL_0_V=uint8(0),
  Near_FCA_HW_VAL_0=single(0),
  Near_FCA_HW_VAL_1_V=uint8(0),
  Near_FCA_HW_VAL_1=single(0),
  IIPB_Buffer_18_V=uint8(0),
  IIPB_Buffer_18=uint8(0),
  Near_FCA_HW_VAL_2_V=uint8(0),
  Near_FCA_HW_VAL_2=single(0),
  Near_FCA_HW_VAL_3_V=uint8(0),
  Near_FCA_HW_VAL_3=single(0),
  Near_FCA_HW_VAL_4_V=uint8(0),
  Near_FCA_HW_VAL_4=single(0),
  IIPB_Buffer_19_V=uint8(0),
  IIPB_Buffer_19=uint8(0),
  Near_FCA_HW_VAL_5_V=uint8(0),
  Near_FCA_HW_VAL_5=single(0),
  NEAR_TTC_TABLE_0_V=uint8(0),
  NEAR_TTC_TABLE_0=single(0),
  NEAR_TTC_TABLE_1_V=uint8(0),
  NEAR_TTC_TABLE_1=single(0),
  NEAR_TTC_TABLE_2_V=uint8(0),
  NEAR_TTC_TABLE_2=single(0),
  NEAR_TTC_TABLE_3_V=uint8(0),
  NEAR_TTC_TABLE_3=single(0),
  NEAR_TTC_TABLE_4_V=uint8(0),
  NEAR_TTC_TABLE_4=single(0),
  NEAR_TTC_TABLE_5_V=uint8(0),
  NEAR_TTC_TABLE_5=single(0),
  NEAR_TTC_TABLE_6_V=uint8(0),
  NEAR_TTC_TABLE_6=single(0),
  IIPB_Buffer_20_V=uint8(0),
  IIPB_Buffer_20=uint8(0),
  NEAR_TTC_TABLE_7_V=uint8(0),
  NEAR_TTC_TABLE_7=single(0),
  STEERING_VALUES_TABLE_0_V=uint8(0),
  STEERING_VALUES_TABLE_0=uint16(0),
  STEERING_VALUES_TABLE_1_V=uint8(0),
  STEERING_VALUES_TABLE_1=uint16(0),
  STEERING_VALUES_TABLE_2_V=uint8(0),
  STEERING_VALUES_TABLE_2=uint16(0),
  vEgo_vs_vRel_threshAdditive_0_V=uint8(0),
  vEgo_vs_vRel_threshAdditive_0=single(0),
  vEgo_vs_vRel_threshAdditive_1_V=uint8(0),
  vEgo_vs_vRel_threshAdditive_1=single(0),
  vEgo_vs_vRel_threshAdditive_2_V=uint8(0),
  vEgo_vs_vRel_threshAdditive_2=single(0),
  vEgo_vs_vRel_threshAdditive_3_V=uint8(0),
  vEgo_vs_vRel_threshAdditive_3=single(0),
  vEgo_vs_vRel_threshAdditive_4_V=uint8(0),
  vEgo_vs_vRel_threshAdditive_4=single(0),
  IIPB_Buffer_21_V=uint8(0),
  IIPB_Buffer_21=uint8(0),
  vEgo_vs_vRel_threshAdditive_5_V=uint8(0),
  vEgo_vs_vRel_threshAdditive_5=single(0),
  vEgo_vs_vRel_threshAdditive_6_V=uint8(0),
  vEgo_vs_vRel_threshAdditive_6=single(0),
  vEgo_vs_vRel_threshAdditive_7_V=uint8(0),
  vEgo_vs_vRel_threshAdditive_7=single(0),
  IIPB_Buffer_22_V=uint8(0),
  IIPB_Buffer_22=uint8(0),
  vEgo_vs_vRel_threshAdditive_8_V=uint8(0),
  vEgo_vs_vRel_threshAdditive_8=single(0),
  vEgo_vs_vRel_threshAdditive_9_V=uint8(0),
  vEgo_vs_vRel_threshAdditive_9=single(0),
  vEgo_vs_vRel_threshAdditive_10_V=uint8(0),
  vEgo_vs_vRel_threshAdditive_10=single(0),
  IIPB_Buffer_23_V=uint8(0),
  IIPB_Buffer_23=uint8(0),
  vEgo_vs_vRel_threshAdditive_11_V=uint8(0),
  vEgo_vs_vRel_threshAdditive_11=single(0),
  vEgo_vs_vRel_threshAdditive_12_V=uint8(0),
  vEgo_vs_vRel_threshAdditive_12=single(0),
  vEgo_vs_vRel_threshAdditive_13_V=uint8(0),
  vEgo_vs_vRel_threshAdditive_13=single(0),
  IIPB_Buffer_24_V=uint8(0),
  IIPB_Buffer_24=uint8(0),
  vEgo_vs_vRel_threshAdditive_14_V=uint8(0),
  vEgo_vs_vRel_threshAdditive_14=single(0),
  vEgo_vs_vRel_threshAdditive_15_V=uint8(0),
  vEgo_vs_vRel_threshAdditive_15=single(0),
  vEgo_vs_vRel_threshAdditive_16_V=uint8(0),
  vEgo_vs_vRel_threshAdditive_16=single(0),
  IIPB_Buffer_25_V=uint8(0),
  IIPB_Buffer_25=uint8(0),
  vEgo_vs_vRel_threshAdditive_17_V=uint8(0),
  vEgo_vs_vRel_threshAdditive_17=single(0),
  vEgo_vs_vRel_threshAdditive_18_V=uint8(0),
  vEgo_vs_vRel_threshAdditive_18=single(0),
  vEgo_vs_vRel_threshAdditive_19_V=uint8(0),
  vEgo_vs_vRel_threshAdditive_19=single(0),
  IIPB_Buffer_26_V=uint8(0),
  IIPB_Buffer_26=uint8(0),
  vEgo_vs_vRel_threshAdditive_20_V=uint8(0),
  vEgo_vs_vRel_threshAdditive_20=single(0),
  vEgo_vs_vRel_threshAdditive_21_V=uint8(0),
  vEgo_vs_vRel_threshAdditive_21=single(0),
  vEgo_vs_vRel_threshAdditive_22_V=uint8(0),
  vEgo_vs_vRel_threshAdditive_22=single(0),
  IIPB_Buffer_27_V=uint8(0),
  IIPB_Buffer_27=uint8(0),
  vEgo_vs_vRel_threshAdditive_23_V=uint8(0),
  vEgo_vs_vRel_threshAdditive_23=single(0),
  vEgo_vs_vRel_threshAdditive_24_V=uint8(0),
  vEgo_vs_vRel_threshAdditive_24=single(0),
  vEgo_vs_vRel_vEgoKneePts_0_V=uint8(0),
  vEgo_vs_vRel_vEgoKneePts_0=single(0),
  vEgo_vs_vRel_vEgoKneePts_1_V=uint8(0),
  vEgo_vs_vRel_vEgoKneePts_1=single(0),
  vEgo_vs_vRel_vEgoKneePts_2_V=uint8(0),
  vEgo_vs_vRel_vEgoKneePts_2=single(0),
  IIPB_Buffer_28_V=uint8(0),
  IIPB_Buffer_28=uint8(0),
  vEgo_vs_vRel_vEgoKneePts_3_V=uint8(0),
  vEgo_vs_vRel_vEgoKneePts_3=single(0),
  vEgo_vs_vRel_vEgoKneePts_4_V=uint8(0),
  vEgo_vs_vRel_vEgoKneePts_4=single(0),
  IIPB_Buffer_29_V=uint8(0),
  IIPB_Buffer_29=uint8(0),
  vEgo_vs_vRel_vRelKneePts_0_V=uint8(0),
  vEgo_vs_vRel_vRelKneePts_0=single(0),
  vEgo_vs_vRel_vRelKneePts_1_V=uint8(0),
  vEgo_vs_vRel_vRelKneePts_1=single(0),
  IIPB_Buffer_30_V=uint8(0),
  IIPB_Buffer_30=uint8(0),
  vEgo_vs_vRel_vRelKneePts_2_V=uint8(0),
  vEgo_vs_vRel_vRelKneePts_2=single(0),
  vEgo_vs_vRel_vRelKneePts_3_V=uint8(0),
  vEgo_vs_vRel_vRelKneePts_3=single(0),
  IIPB_Buffer_31_V=uint8(0),
  IIPB_Buffer_31=uint8(0),
  vEgo_vs_vRel_vRelKneePts_4_V=uint8(0),
  vEgo_vs_vRel_vRelKneePts_4=single(0),
  vRel_vs_Olap_OlapKnePts_0_V=uint8(0),
  vRel_vs_Olap_OlapKnePts_0=single(0),
  vRel_vs_Olap_OlapKnePts_1_V=uint8(0),
  vRel_vs_Olap_OlapKnePts_1=single(0),
  vRel_vs_Olap_OlapKnePts_2_V=uint8(0),
  vRel_vs_Olap_OlapKnePts_2=single(0),
  vRel_vs_Olap_OlapKnePts_3_V=uint8(0),
  vRel_vs_Olap_OlapKnePts_3=single(0),
  vRel_vs_Olap_OlapKnePts_4_V=uint8(0),
  vRel_vs_Olap_OlapKnePts_4=single(0),
  IIPB_Buffer_32_V=uint8(0),
  IIPB_Buffer_32=uint8(0),
  vRel_vs_Olap_ReductionVals_0_V=uint8(0),
  vRel_vs_Olap_ReductionVals_0=single(0),
  vRel_vs_Olap_ReductionVals_1_V=uint8(0),
  vRel_vs_Olap_ReductionVals_1=single(0),
  vRel_vs_Olap_ReductionVals_2_V=uint8(0),
  vRel_vs_Olap_ReductionVals_2=single(0),
  IIPB_Buffer_33_V=uint8(0),
  IIPB_Buffer_33=uint8(0),
  vRel_vs_Olap_ReductionVals_3_V=uint8(0),
  vRel_vs_Olap_ReductionVals_3=single(0),
  vRel_vs_Olap_ReductionVals_4_V=uint8(0),
  vRel_vs_Olap_ReductionVals_4=single(0),
  vRel_vs_Olap_ReductionVals_5_V=uint8(0),
  vRel_vs_Olap_ReductionVals_5=single(0),
  IIPB_Buffer_34_V=uint8(0),
  IIPB_Buffer_34=uint8(0),
  vRel_vs_Olap_ReductionVals_6_V=uint8(0),
  vRel_vs_Olap_ReductionVals_6=single(0),
  vRel_vs_Olap_ReductionVals_7_V=uint8(0),
  vRel_vs_Olap_ReductionVals_7=single(0),
  vRel_vs_Olap_ReductionVals_8_V=uint8(0),
  vRel_vs_Olap_ReductionVals_8=single(0),
  IIPB_Buffer_35_V=uint8(0),
  IIPB_Buffer_35=uint8(0),
  vRel_vs_Olap_ReductionVals_9_V=uint8(0),
  vRel_vs_Olap_ReductionVals_9=single(0),
  vRel_vs_Olap_ReductionVals_10_V=uint8(0),
  vRel_vs_Olap_ReductionVals_10=single(0),
  vRel_vs_Olap_ReductionVals_11_V=uint8(0),
  vRel_vs_Olap_ReductionVals_11=single(0),
  IIPB_Buffer_36_V=uint8(0),
  IIPB_Buffer_36=uint8(0),
  vRel_vs_Olap_ReductionVals_12_V=uint8(0),
  vRel_vs_Olap_ReductionVals_12=single(0),
  vRel_vs_Olap_ReductionVals_13_V=uint8(0),
  vRel_vs_Olap_ReductionVals_13=single(0),
  vRel_vs_Olap_ReductionVals_14_V=uint8(0),
  vRel_vs_Olap_ReductionVals_14=single(0),
  IIPB_Buffer_37_V=uint8(0),
  IIPB_Buffer_37=uint8(0),
  vRel_vs_Olap_ReductionVals_15_V=uint8(0),
  vRel_vs_Olap_ReductionVals_15=single(0),
  vRel_vs_Olap_ReductionVals_16_V=uint8(0),
  vRel_vs_Olap_ReductionVals_16=single(0),
  vRel_vs_Olap_ReductionVals_17_V=uint8(0),
  vRel_vs_Olap_ReductionVals_17=single(0),
  IIPB_Buffer_38_V=uint8(0),
  IIPB_Buffer_38=uint8(0),
  vRel_vs_Olap_ReductionVals_18_V=uint8(0),
  vRel_vs_Olap_ReductionVals_18=single(0),
  vRel_vs_Olap_ReductionVals_19_V=uint8(0),
  vRel_vs_Olap_ReductionVals_19=single(0),
  vRel_vs_Olap_ReductionVals_20_V=uint8(0),
  vRel_vs_Olap_ReductionVals_20=single(0),
  IIPB_Buffer_39_V=uint8(0),
  IIPB_Buffer_39=uint8(0),
  vRel_vs_Olap_ReductionVals_21_V=uint8(0),
  vRel_vs_Olap_ReductionVals_21=single(0),
  vRel_vs_Olap_ReductionVals_22_V=uint8(0),
  vRel_vs_Olap_ReductionVals_22=single(0),
  vRel_vs_Olap_ReductionVals_23_V=uint8(0),
  vRel_vs_Olap_ReductionVals_23=single(0),
  IIPB_Buffer_40_V=uint8(0),
  IIPB_Buffer_40=uint8(0),
  vRel_vs_Olap_ReductionVals_24_V=uint8(0),
  vRel_vs_Olap_ReductionVals_24=single(0),
  vRel_vs_Olap_vRelKneePts_0_V=uint8(0),
  vRel_vs_Olap_vRelKneePts_0=single(0),
  IIPB_Buffer_41_V=uint8(0),
  IIPB_Buffer_41=uint8(0),
  vRel_vs_Olap_vRelKneePts_1_V=uint8(0),
  vRel_vs_Olap_vRelKneePts_1=single(0),
  vRel_vs_Olap_vRelKneePts_2_V=uint8(0),
  vRel_vs_Olap_vRelKneePts_2=single(0),
  IIPB_Buffer_42_V=uint8(0),
  IIPB_Buffer_42=uint8(0),
  vRel_vs_Olap_vRelKneePts_3_V=uint8(0),
  vRel_vs_Olap_vRelKneePts_3=single(0),
  vRel_vs_Olap_vRelKneePts_4_V=uint8(0),
  vRel_vs_Olap_vRelKneePts_4=single(0),
  Reserved_1=uint8(0)), SwCalibrationAccess="ReadWrite", DataType="Bus:EQ4_IIPB_HDR_BUS")

EQ4_IIPB_HDR_VAL = Simulink.Parameter(struct(
  IIPB_Zero_byte=uint8(0),
  IIPB_Protocol_Version=uint8(0),
  IIPB_Optional_Signals=uint8(0),
  AdhereToGapSensitivity_V=uint8(0),
  AdhereToGapSensitivity=uint8(0),
  AEB_BrakeToStillMode_V=uint8(0),
  AEB_BrakeToStillMode=uint8(0),
  IIPB_Buffer_1_V=uint8(0),
  IIPB_Buffer_1=uint8(0),
  AEB_Deceleration_0_V=uint8(0),
  AEB_Deceleration_0=single(0),
  AEB_Deceleration_1_V=uint8(0),
  AEB_Deceleration_1=single(0),
  AEB_Deceleration_2_V=uint8(0),
  AEB_Deceleration_2=single(0),
  AEB_Deceleration_Reduction_0_V=uint8(0),
  AEB_Deceleration_Reduction_0=single(0),
  AEB_Deceleration_Reduction_1_V=uint8(0),
  AEB_Deceleration_Reduction_1=single(0),
  AEB_Deceleration_Reduction_2_V=uint8(0),
  AEB_Deceleration_Reduction_2=single(0),
  IIPB_Buffer_2_V=uint8(0),
  IIPB_Buffer_2=uint8(0),
  AEB_MaxRelV_V=uint8(0),
  AEB_MaxRelV=single(0),
  AEB_MaxSpeed_V=uint8(0),
  AEB_MaxSpeed=single(0),
  IIPB_Buffer_3_V=uint8(0),
  IIPB_Buffer_3=uint8(0),
  AEB_MaxSpeedReduction_V=uint8(0),
  AEB_MaxSpeedReduction=single(0),
  AEB_MaxYawRate_V=uint8(0),
  AEB_MaxYawRate=uint16(0),
  IIPB_Buffer_4_V=uint8(0),
  IIPB_Buffer_4=uint8(0),
  AEB_Min_time_after_AEB_for_AEB_V=uint8(0),
  AEB_Min_time_after_AEB_for_AEB=single(0),
  AEB_MinRelV_V=uint8(0),
  AEB_MinRelV=single(0),
  IIPB_Buffer_5_V=uint8(0),
  IIPB_Buffer_5=uint8(0),
  AEB_MinSpeed_V=uint8(0),
  AEB_MinSpeed=single(0),
  AEB_StandStillFollowTimeHyst_V=uint8(0),
  AEB_StandStillFollowTimeHyst=single(0),
  IIPB_Buffer_6_V=uint8(0),
  IIPB_Buffer_6=uint8(0),
  AEB_StandStillMaxSpeed_V=uint8(0),
  AEB_StandStillMaxSpeed=single(0),
  AEB_StandStillStillTimeHyst_V=uint8(0),
  AEB_StandStillStillTimeHyst=single(0),
  Far_FCA_HW_VAL_0_V=uint8(0),
  Far_FCA_HW_VAL_0=single(0),
  IIPB_Buffer_7_V=uint8(0),
  IIPB_Buffer_7=uint8(0),
  Far_FCA_HW_VAL_1_V=uint8(0),
  Far_FCA_HW_VAL_1=single(0),
  Far_FCA_HW_VAL_2_V=uint8(0),
  Far_FCA_HW_VAL_2=single(0),
  Far_FCA_HW_VAL_3_V=uint8(0),
  Far_FCA_HW_VAL_3=single(0),
  IIPB_Buffer_8_V=uint8(0),
  IIPB_Buffer_8=uint8(0),
  Far_FCA_HW_VAL_4_V=uint8(0),
  Far_FCA_HW_VAL_4=single(0),
  Far_FCA_HW_VAL_5_V=uint8(0),
  Far_FCA_HW_VAL_5=single(0),
  FAR_TTC_TABLE_0_V=uint8(0),
  FAR_TTC_TABLE_0=single(0),
  IIPB_Buffer_9_V=uint8(0),
  IIPB_Buffer_9=uint8(0),
  FAR_TTC_TABLE_1_V=uint8(0),
  FAR_TTC_TABLE_1=single(0),
  FAR_TTC_TABLE_2_V=uint8(0),
  FAR_TTC_TABLE_2=single(0),
  FAR_TTC_TABLE_3_V=uint8(0),
  FAR_TTC_TABLE_3=single(0),
  FAR_TTC_TABLE_4_V=uint8(0),
  FAR_TTC_TABLE_4=single(0),
  FAR_TTC_TABLE_5_V=uint8(0),
  FAR_TTC_TABLE_5=single(0),
  IIPB_Buffer_10_V=uint8(0),
  IIPB_Buffer_10=uint8(0),
  FAR_TTC_TABLE_6_V=uint8(0),
  FAR_TTC_TABLE_6=single(0),
  FAR_TTC_TABLE_7_V=uint8(0),
  FAR_TTC_TABLE_7=single(0),
  IIPB_Buffer_11_V=uint8(0),
  IIPB_Buffer_11=uint8(0),
  FCA_HW_Kneepoints_0_V=uint8(0),
  FCA_HW_Kneepoints_0=single(0),
  FCA_HW_Kneepoints_1_V=uint8(0),
  FCA_HW_Kneepoints_1=single(0),
  FCA_HW_Kneepoints_2_V=uint8(0),
  FCA_HW_Kneepoints_2=single(0),
  FCA_HW_Kneepoints_3_V=uint8(0),
  FCA_HW_Kneepoints_3=single(0),
  FCA_HW_Kneepoints_4_V=uint8(0),
  FCA_HW_Kneepoints_4=single(0),
  FCA_HW_Kneepoints_5_V=uint8(0),
  FCA_HW_Kneepoints_5=single(0),
  FCA_HW_Stop_Fact_V=uint8(0),
  FCA_HW_Stop_Fact=single(0),
  FCA_Ignition_default_state_V=uint8(0),
  FCA_Ignition_default_state=uint8(0),
  FCW_BaseSpeeds_0_V=uint8(0),
  FCW_BaseSpeeds_0=single(0),
  IIPB_Buffer_12_V=uint8(0),
  IIPB_Buffer_12=uint8(0),
  FCW_BaseSpeeds_1_V=uint8(0),
  FCW_BaseSpeeds_1=single(0),
  FCW_BaseSpeeds_2_V=uint8(0),
  FCW_BaseSpeeds_2=single(0),
  FCW_BaseSpeeds_3_V=uint8(0),
  FCW_BaseSpeeds_3=single(0),
  FCW_BaseSpeeds_4_V=uint8(0),
  FCW_BaseSpeeds_4=single(0),
  FCW_BaseSpeeds_5_V=uint8(0),
  FCW_BaseSpeeds_5=single(0),
  FCW_BaseSpeeds_6_V=uint8(0),
  FCW_BaseSpeeds_6=single(0),
  FCW_BaseSpeeds_7_V=uint8(0),
  FCW_BaseSpeeds_7=single(0),
  FCW_Deceleration_0_V=uint8(0),
  FCW_Deceleration_0=single(0),
  IIPB_Buffer_13_V=uint8(0),
  IIPB_Buffer_13=uint8(0),
  FCW_Deceleration_1_V=uint8(0),
  FCW_Deceleration_1=single(0),
  FCW_Deceleration_2_V=uint8(0),
  FCW_Deceleration_2=single(0),
  FCW_Deceleration_reduction_0_V=uint8(0),
  FCW_Deceleration_reduction_0=single(0),
  FCW_Deceleration_reduction_1_V=uint8(0),
  FCW_Deceleration_reduction_1=single(0),
  FCW_Deceleration_reduction_2_V=uint8(0),
  FCW_Deceleration_reduction_2=single(0),
  FCW_MaxDistance_V=uint8(0),
  FCW_MaxDistance=single(0),
  FCW_MaxThresh_V=uint8(0),
  FCW_MaxThresh=single(0),
  K_FCAAccelHaloTime_V=uint8(0),
  K_FCAAccelHaloTime=single(0),
  K_FCAAccelLevel_V=uint8(0),
  K_FCAAccelLevel=uint16(0),
  K_FCABrakeApplyDur_V=uint8(0),
  K_FCABrakeApplyDur=single(0),
  K_FCABrakeApplyHaloTime_V=uint8(0),
  K_FCABrakeApplyHaloTime=single(0),
  K_FCALIATime_V=uint8(0),
  K_FCALIATime=single(0),
  IIPB_Buffer_14_V=uint8(0),
  IIPB_Buffer_14=uint8(0),
  K_FCAR_t_ClutchHaloTime_V=uint8(0),
  K_FCAR_t_ClutchHaloTime=single(0),
  K_MaxFCAEnableSpeed_V=uint8(0),
  K_MaxFCAEnableSpeed=uint8(0),
  K_MaxFCAEnableSpeedHysteresis_V=uint8(0),
  K_MaxFCAEnableSpeedHysteresis=uint8(0),
  IIPB_Buffer_15_V=uint8(0),
  IIPB_Buffer_15=uint8(0),
  K_MinFCAEnableSpeed_V=uint8(0),
  K_MinFCAEnableSpeed=uint8(0),
  K_MinFCAEnableSpeedHysteresis_V=uint8(0),
  K_MinFCAEnableSpeedHysteresis=uint8(0),
  Medium_FCA_HW_VAL_0_V=uint8(0),
  Medium_FCA_HW_VAL_0=single(0),
  Medium_FCA_HW_VAL_1_V=uint8(0),
  Medium_FCA_HW_VAL_1=single(0),
  Medium_FCA_HW_VAL_2_V=uint8(0),
  Medium_FCA_HW_VAL_2=single(0),
  Medium_FCA_HW_VAL_3_V=uint8(0),
  Medium_FCA_HW_VAL_3=single(0),
  Medium_FCA_HW_VAL_4_V=uint8(0),
  Medium_FCA_HW_VAL_4=single(0),
  IIPB_Buffer_16_V=uint8(0),
  IIPB_Buffer_16=uint8(0),
  Medium_FCA_HW_VAL_5_V=uint8(0),
  Medium_FCA_HW_VAL_5=single(0),
  MEDIUM_TTC_TABLE_0_V=uint8(0),
  MEDIUM_TTC_TABLE_0=single(0),
  MEDIUM_TTC_TABLE_1_V=uint8(0),
  MEDIUM_TTC_TABLE_1=single(0),
  MEDIUM_TTC_TABLE_2_V=uint8(0),
  MEDIUM_TTC_TABLE_2=single(0),
  MEDIUM_TTC_TABLE_3_V=uint8(0),
  MEDIUM_TTC_TABLE_3=single(0),
  MEDIUM_TTC_TABLE_4_V=uint8(0),
  MEDIUM_TTC_TABLE_4=single(0),
  MEDIUM_TTC_TABLE_5_V=uint8(0),
  MEDIUM_TTC_TABLE_5=single(0),
  MEDIUM_TTC_TABLE_6_V=uint8(0),
  MEDIUM_TTC_TABLE_6=single(0),
  IIPB_Buffer_17_V=uint8(0),
  IIPB_Buffer_17=uint8(0),
  MEDIUM_TTC_TABLE_7_V=uint8(0),
  MEDIUM_TTC_TABLE_7=single(0),
  Near_FCA_HW_VAL_0_V=uint8(0),
  Near_FCA_HW_VAL_0=single(0),
  Near_FCA_HW_VAL_1_V=uint8(0),
  Near_FCA_HW_VAL_1=single(0),
  IIPB_Buffer_18_V=uint8(0),
  IIPB_Buffer_18=uint8(0),
  Near_FCA_HW_VAL_2_V=uint8(0),
  Near_FCA_HW_VAL_2=single(0),
  Near_FCA_HW_VAL_3_V=uint8(0),
  Near_FCA_HW_VAL_3=single(0),
  Near_FCA_HW_VAL_4_V=uint8(0),
  Near_FCA_HW_VAL_4=single(0),
  IIPB_Buffer_19_V=uint8(0),
  IIPB_Buffer_19=uint8(0),
  Near_FCA_HW_VAL_5_V=uint8(0),
  Near_FCA_HW_VAL_5=single(0),
  NEAR_TTC_TABLE_0_V=uint8(0),
  NEAR_TTC_TABLE_0=single(0),
  NEAR_TTC_TABLE_1_V=uint8(0),
  NEAR_TTC_TABLE_1=single(0),
  NEAR_TTC_TABLE_2_V=uint8(0),
  NEAR_TTC_TABLE_2=single(0),
  NEAR_TTC_TABLE_3_V=uint8(0),
  NEAR_TTC_TABLE_3=single(0),
  NEAR_TTC_TABLE_4_V=uint8(0),
  NEAR_TTC_TABLE_4=single(0),
  NEAR_TTC_TABLE_5_V=uint8(0),
  NEAR_TTC_TABLE_5=single(0),
  NEAR_TTC_TABLE_6_V=uint8(0),
  NEAR_TTC_TABLE_6=single(0),
  IIPB_Buffer_20_V=uint8(0),
  IIPB_Buffer_20=uint8(0),
  NEAR_TTC_TABLE_7_V=uint8(0),
  NEAR_TTC_TABLE_7=single(0),
  STEERING_VALUES_TABLE_0_V=uint8(0),
  STEERING_VALUES_TABLE_0=uint16(0),
  STEERING_VALUES_TABLE_1_V=uint8(0),
  STEERING_VALUES_TABLE_1=uint16(0),
  STEERING_VALUES_TABLE_2_V=uint8(0),
  STEERING_VALUES_TABLE_2=uint16(0),
  vEgo_vs_vRel_threshAdditive_0_V=uint8(0),
  vEgo_vs_vRel_threshAdditive_0=single(0),
  vEgo_vs_vRel_threshAdditive_1_V=uint8(0),
  vEgo_vs_vRel_threshAdditive_1=single(0),
  vEgo_vs_vRel_threshAdditive_2_V=uint8(0),
  vEgo_vs_vRel_threshAdditive_2=single(0),
  vEgo_vs_vRel_threshAdditive_3_V=uint8(0),
  vEgo_vs_vRel_threshAdditive_3=single(0),
  vEgo_vs_vRel_threshAdditive_4_V=uint8(0),
  vEgo_vs_vRel_threshAdditive_4=single(0),
  IIPB_Buffer_21_V=uint8(0),
  IIPB_Buffer_21=uint8(0),
  vEgo_vs_vRel_threshAdditive_5_V=uint8(0),
  vEgo_vs_vRel_threshAdditive_5=single(0),
  vEgo_vs_vRel_threshAdditive_6_V=uint8(0),
  vEgo_vs_vRel_threshAdditive_6=single(0),
  vEgo_vs_vRel_threshAdditive_7_V=uint8(0),
  vEgo_vs_vRel_threshAdditive_7=single(0),
  IIPB_Buffer_22_V=uint8(0),
  IIPB_Buffer_22=uint8(0),
  vEgo_vs_vRel_threshAdditive_8_V=uint8(0),
  vEgo_vs_vRel_threshAdditive_8=single(0),
  vEgo_vs_vRel_threshAdditive_9_V=uint8(0),
  vEgo_vs_vRel_threshAdditive_9=single(0),
  vEgo_vs_vRel_threshAdditive_10_V=uint8(0),
  vEgo_vs_vRel_threshAdditive_10=single(0),
  IIPB_Buffer_23_V=uint8(0),
  IIPB_Buffer_23=uint8(0),
  vEgo_vs_vRel_threshAdditive_11_V=uint8(0),
  vEgo_vs_vRel_threshAdditive_11=single(0),
  vEgo_vs_vRel_threshAdditive_12_V=uint8(0),
  vEgo_vs_vRel_threshAdditive_12=single(0),
  vEgo_vs_vRel_threshAdditive_13_V=uint8(0),
  vEgo_vs_vRel_threshAdditive_13=single(0),
  IIPB_Buffer_24_V=uint8(0),
  IIPB_Buffer_24=uint8(0),
  vEgo_vs_vRel_threshAdditive_14_V=uint8(0),
  vEgo_vs_vRel_threshAdditive_14=single(0),
  vEgo_vs_vRel_threshAdditive_15_V=uint8(0),
  vEgo_vs_vRel_threshAdditive_15=single(0),
  vEgo_vs_vRel_threshAdditive_16_V=uint8(0),
  vEgo_vs_vRel_threshAdditive_16=single(0),
  IIPB_Buffer_25_V=uint8(0),
  IIPB_Buffer_25=uint8(0),
  vEgo_vs_vRel_threshAdditive_17_V=uint8(0),
  vEgo_vs_vRel_threshAdditive_17=single(0),
  vEgo_vs_vRel_threshAdditive_18_V=uint8(0),
  vEgo_vs_vRel_threshAdditive_18=single(0),
  vEgo_vs_vRel_threshAdditive_19_V=uint8(0),
  vEgo_vs_vRel_threshAdditive_19=single(0),
  IIPB_Buffer_26_V=uint8(0),
  IIPB_Buffer_26=uint8(0),
  vEgo_vs_vRel_threshAdditive_20_V=uint8(0),
  vEgo_vs_vRel_threshAdditive_20=single(0),
  vEgo_vs_vRel_threshAdditive_21_V=uint8(0),
  vEgo_vs_vRel_threshAdditive_21=single(0),
  vEgo_vs_vRel_threshAdditive_22_V=uint8(0),
  vEgo_vs_vRel_threshAdditive_22=single(0),
  IIPB_Buffer_27_V=uint8(0),
  IIPB_Buffer_27=uint8(0),
  vEgo_vs_vRel_threshAdditive_23_V=uint8(0),
  vEgo_vs_vRel_threshAdditive_23=single(0),
  vEgo_vs_vRel_threshAdditive_24_V=uint8(0),
  vEgo_vs_vRel_threshAdditive_24=single(0),
  vEgo_vs_vRel_vEgoKneePts_0_V=uint8(0),
  vEgo_vs_vRel_vEgoKneePts_0=single(0),
  vEgo_vs_vRel_vEgoKneePts_1_V=uint8(0),
  vEgo_vs_vRel_vEgoKneePts_1=single(0),
  vEgo_vs_vRel_vEgoKneePts_2_V=uint8(0),
  vEgo_vs_vRel_vEgoKneePts_2=single(0),
  IIPB_Buffer_28_V=uint8(0),
  IIPB_Buffer_28=uint8(0),
  vEgo_vs_vRel_vEgoKneePts_3_V=uint8(0),
  vEgo_vs_vRel_vEgoKneePts_3=single(0),
  vEgo_vs_vRel_vEgoKneePts_4_V=uint8(0),
  vEgo_vs_vRel_vEgoKneePts_4=single(0),
  IIPB_Buffer_29_V=uint8(0),
  IIPB_Buffer_29=uint8(0),
  vEgo_vs_vRel_vRelKneePts_0_V=uint8(0),
  vEgo_vs_vRel_vRelKneePts_0=single(0),
  vEgo_vs_vRel_vRelKneePts_1_V=uint8(0),
  vEgo_vs_vRel_vRelKneePts_1=single(0),
  IIPB_Buffer_30_V=uint8(0),
  IIPB_Buffer_30=uint8(0),
  vEgo_vs_vRel_vRelKneePts_2_V=uint8(0),
  vEgo_vs_vRel_vRelKneePts_2=single(0),
  vEgo_vs_vRel_vRelKneePts_3_V=uint8(0),
  vEgo_vs_vRel_vRelKneePts_3=single(0),
  IIPB_Buffer_31_V=uint8(0),
  IIPB_Buffer_31=uint8(0),
  vEgo_vs_vRel_vRelKneePts_4_V=uint8(0),
  vEgo_vs_vRel_vRelKneePts_4=single(0),
  vRel_vs_Olap_OlapKnePts_0_V=uint8(0),
  vRel_vs_Olap_OlapKnePts_0=single(0),
  vRel_vs_Olap_OlapKnePts_1_V=uint8(0),
  vRel_vs_Olap_OlapKnePts_1=single(0),
  vRel_vs_Olap_OlapKnePts_2_V=uint8(0),
  vRel_vs_Olap_OlapKnePts_2=single(0),
  vRel_vs_Olap_OlapKnePts_3_V=uint8(0),
  vRel_vs_Olap_OlapKnePts_3=single(0),
  vRel_vs_Olap_OlapKnePts_4_V=uint8(0),
  vRel_vs_Olap_OlapKnePts_4=single(0),
  IIPB_Buffer_32_V=uint8(0),
  IIPB_Buffer_32=uint8(0),
  vRel_vs_Olap_ReductionVals_0_V=uint8(0),
  vRel_vs_Olap_ReductionVals_0=single(0),
  vRel_vs_Olap_ReductionVals_1_V=uint8(0),
  vRel_vs_Olap_ReductionVals_1=single(0),
  vRel_vs_Olap_ReductionVals_2_V=uint8(0),
  vRel_vs_Olap_ReductionVals_2=single(0),
  IIPB_Buffer_33_V=uint8(0),
  IIPB_Buffer_33=uint8(0),
  vRel_vs_Olap_ReductionVals_3_V=uint8(0),
  vRel_vs_Olap_ReductionVals_3=single(0),
  vRel_vs_Olap_ReductionVals_4_V=uint8(0),
  vRel_vs_Olap_ReductionVals_4=single(0),
  vRel_vs_Olap_ReductionVals_5_V=uint8(0),
  vRel_vs_Olap_ReductionVals_5=single(0),
  IIPB_Buffer_34_V=uint8(0),
  IIPB_Buffer_34=uint8(0),
  vRel_vs_Olap_ReductionVals_6_V=uint8(0),
  vRel_vs_Olap_ReductionVals_6=single(0),
  vRel_vs_Olap_ReductionVals_7_V=uint8(0),
  vRel_vs_Olap_ReductionVals_7=single(0),
  vRel_vs_Olap_ReductionVals_8_V=uint8(0),
  vRel_vs_Olap_ReductionVals_8=single(0),
  IIPB_Buffer_35_V=uint8(0),
  IIPB_Buffer_35=uint8(0),
  vRel_vs_Olap_ReductionVals_9_V=uint8(0),
  vRel_vs_Olap_ReductionVals_9=single(0),
  vRel_vs_Olap_ReductionVals_10_V=uint8(0),
  vRel_vs_Olap_ReductionVals_10=single(0),
  vRel_vs_Olap_ReductionVals_11_V=uint8(0),
  vRel_vs_Olap_ReductionVals_11=single(0),
  IIPB_Buffer_36_V=uint8(0),
  IIPB_Buffer_36=uint8(0),
  vRel_vs_Olap_ReductionVals_12_V=uint8(0),
  vRel_vs_Olap_ReductionVals_12=single(0),
  vRel_vs_Olap_ReductionVals_13_V=uint8(0),
  vRel_vs_Olap_ReductionVals_13=single(0),
  vRel_vs_Olap_ReductionVals_14_V=uint8(0),
  vRel_vs_Olap_ReductionVals_14=single(0),
  IIPB_Buffer_37_V=uint8(0),
  IIPB_Buffer_37=uint8(0),
  vRel_vs_Olap_ReductionVals_15_V=uint8(0),
  vRel_vs_Olap_ReductionVals_15=single(0),
  vRel_vs_Olap_ReductionVals_16_V=uint8(0),
  vRel_vs_Olap_ReductionVals_16=single(0),
  vRel_vs_Olap_ReductionVals_17_V=uint8(0),
  vRel_vs_Olap_ReductionVals_17=single(0),
  IIPB_Buffer_38_V=uint8(0),
  IIPB_Buffer_38=uint8(0),
  vRel_vs_Olap_ReductionVals_18_V=uint8(0),
  vRel_vs_Olap_ReductionVals_18=single(0),
  vRel_vs_Olap_ReductionVals_19_V=uint8(0),
  vRel_vs_Olap_ReductionVals_19=single(0),
  vRel_vs_Olap_ReductionVals_20_V=uint8(0),
  vRel_vs_Olap_ReductionVals_20=single(0),
  IIPB_Buffer_39_V=uint8(0),
  IIPB_Buffer_39=uint8(0),
  vRel_vs_Olap_ReductionVals_21_V=uint8(0),
  vRel_vs_Olap_ReductionVals_21=single(0),
  vRel_vs_Olap_ReductionVals_22_V=uint8(0),
  vRel_vs_Olap_ReductionVals_22=single(0),
  vRel_vs_Olap_ReductionVals_23_V=uint8(0),
  vRel_vs_Olap_ReductionVals_23=single(0),
  IIPB_Buffer_40_V=uint8(0),
  IIPB_Buffer_40=uint8(0),
  vRel_vs_Olap_ReductionVals_24_V=uint8(0),
  vRel_vs_Olap_ReductionVals_24=single(0),
  vRel_vs_Olap_vRelKneePts_0_V=uint8(0),
  vRel_vs_Olap_vRelKneePts_0=single(0),
  IIPB_Buffer_41_V=uint8(0),
  IIPB_Buffer_41=uint8(0),
  vRel_vs_Olap_vRelKneePts_1_V=uint8(0),
  vRel_vs_Olap_vRelKneePts_1=single(0),
  vRel_vs_Olap_vRelKneePts_2_V=uint8(0),
  vRel_vs_Olap_vRelKneePts_2=single(0),
  IIPB_Buffer_42_V=uint8(0),
  IIPB_Buffer_42=uint8(0),
  vRel_vs_Olap_vRelKneePts_3_V=uint8(0),
  vRel_vs_Olap_vRelKneePts_3=single(0),
  vRel_vs_Olap_vRelKneePts_4_V=uint8(0),
  vRel_vs_Olap_vRelKneePts_4=single(0),
  Reserved_1=uint8(0)))

EQ4_ILDW_HDR_PAR = AUTOSAR4.Parameter(struct(
  ILDW_Zero_byte=uint8(0),
  ILDW_Protocol_Version=uint8(0),
  ILDW_Optional_Signals=uint8(0),
  ILDW_Header_Buffer=uint8(0),
  LDW_Set_Enable_0=uint8(0),
  LDW_Set_Enable_1=uint8(0),
  LDW_Set_Enable_2=uint8(0),
  LDW_Set_Enable_3=uint8(0),
  min_lane_width_0=single(0),
  min_lane_width_1=single(0),
  min_lane_width_2=single(0),
  Reserved_1=uint8(0),
  min_lane_width_3=single(0),
  ind_min_wrn_disable_0=uint8(0),
  ind_min_wrn_disable_1=uint8(0),
  ind_min_wrn_disable_2=uint8(0),
  ind_min_wrn_disable_3=uint8(0),
  min_lane_width_hysteresis_0=single(0),
  min_lane_width_hysteresis_1=single(0),
  Reserved_2=uint8(0),
  min_lane_width_hysteresis_2=single(0),
  min_lane_width_hysteresis_3=single(0),
  narrow_lane_width_0=single(0),
  Reserved_3=uint8(0),
  narrow_lane_width_1=single(0),
  narrow_lane_width_2=single(0),
  narrow_lane_width_3=single(0),
  Reserved_4=uint8(0),
  tlc_0=single(0),
  tlc_1=single(0),
  tlc_2=single(0),
  tlc_3=single(0),
  warning_line_tlc_0=single(0),
  warning_line_tlc_1=single(0),
  warning_line_tlc_2=single(0),
  warning_line_tlc_3=single(0),
  position_warning_dist_thresh_0=single(0),
  position_warning_dist_thresh_1=single(0),
  position_warning_dist_thresh_2=single(0),
  position_warning_dist_thresh_3=single(0),
  outer_dist_to_terminate_war_0=single(0),
  outer_dist_to_terminate_war_1=single(0),
  outer_dist_to_terminate_war_2=single(0),
  outer_dist_to_terminate_war_3=single(0),
  inner_reset_offset_0=single(0),
  inner_reset_offset_1=single(0),
  inner_reset_offset_2=single(0),
  Reserved_5=uint8(0),
  inner_reset_offset_3=single(0),
  corridor_outer_boundary_0=single(0),
  corridor_outer_boundary_1=single(0),
  Reserved_6=uint8(0),
  corridor_outer_boundary_2=single(0),
  corridor_outer_boundary_3=single(0),
  inner_curve_tlc_reduced_0=single(0),
  Reserved_7=uint8(0),
  inner_curve_tlc_reduced_1=single(0),
  inner_curve_tlc_reduced_2=single(0),
  inner_curve_tlc_reduced_3=single(0),
  Reserved_8=uint8(0),
  inner_curve_tlc_shift_thresh_0=single(0),
  inner_curve_tlc_shift_thresh_1=single(0),
  Reserved_9=uint8(0),
  inner_curve_tlc_shift_thresh_2=single(0),
  inner_curve_tlc_shift_thresh_3=single(0),
  Reserved_10=uint8(0)), SwCalibrationAccess="ReadWrite", DataType="Bus:EQ4_ILDW_HDR_BUS")

EQ4_ILDW_HDR_VAL = Simulink.Parameter(struct(
  ILDW_Zero_byte=uint8(0),
  ILDW_Protocol_Version=uint8(0),
  ILDW_Optional_Signals=uint8(0),
  ILDW_Header_Buffer=uint8(0),
  LDW_Set_Enable_0=uint8(0),
  LDW_Set_Enable_1=uint8(0),
  LDW_Set_Enable_2=uint8(0),
  LDW_Set_Enable_3=uint8(0),
  min_lane_width_0=single(0),
  min_lane_width_1=single(0),
  min_lane_width_2=single(0),
  Reserved_1=uint8(0),
  min_lane_width_3=single(0),
  ind_min_wrn_disable_0=uint8(0),
  ind_min_wrn_disable_1=uint8(0),
  ind_min_wrn_disable_2=uint8(0),
  ind_min_wrn_disable_3=uint8(0),
  min_lane_width_hysteresis_0=single(0),
  min_lane_width_hysteresis_1=single(0),
  Reserved_2=uint8(0),
  min_lane_width_hysteresis_2=single(0),
  min_lane_width_hysteresis_3=single(0),
  narrow_lane_width_0=single(0),
  Reserved_3=uint8(0),
  narrow_lane_width_1=single(0),
  narrow_lane_width_2=single(0),
  narrow_lane_width_3=single(0),
  Reserved_4=uint8(0),
  tlc_0=single(0),
  tlc_1=single(0),
  tlc_2=single(0),
  tlc_3=single(0),
  warning_line_tlc_0=single(0),
  warning_line_tlc_1=single(0),
  warning_line_tlc_2=single(0),
  warning_line_tlc_3=single(0),
  position_warning_dist_thresh_0=single(0),
  position_warning_dist_thresh_1=single(0),
  position_warning_dist_thresh_2=single(0),
  position_warning_dist_thresh_3=single(0),
  outer_dist_to_terminate_war_0=single(0),
  outer_dist_to_terminate_war_1=single(0),
  outer_dist_to_terminate_war_2=single(0),
  outer_dist_to_terminate_war_3=single(0),
  inner_reset_offset_0=single(0),
  inner_reset_offset_1=single(0),
  inner_reset_offset_2=single(0),
  Reserved_5=uint8(0),
  inner_reset_offset_3=single(0),
  corridor_outer_boundary_0=single(0),
  corridor_outer_boundary_1=single(0),
  Reserved_6=uint8(0),
  corridor_outer_boundary_2=single(0),
  corridor_outer_boundary_3=single(0),
  inner_curve_tlc_reduced_0=single(0),
  Reserved_7=uint8(0),
  inner_curve_tlc_reduced_1=single(0),
  inner_curve_tlc_reduced_2=single(0),
  inner_curve_tlc_reduced_3=single(0),
  Reserved_8=uint8(0),
  inner_curve_tlc_shift_thresh_0=single(0),
  inner_curve_tlc_shift_thresh_1=single(0),
  Reserved_9=uint8(0),
  inner_curve_tlc_shift_thresh_2=single(0),
  inner_curve_tlc_shift_thresh_3=single(0),
  Reserved_10=uint8(0)))

EQ4_ILS_HDR_PAR = AUTOSAR4.Parameter(struct(
  ILS_Zero_byte=uint8(0),
  ILS_Protocol_Version=uint8(0),
  ILS_Optional_Signals=uint8(0),
  ILS_Buffer_1_V=uint8(0),
  ILS_Buffer_1=uint8(0),
  C_IN_CURVE_RADIUS_ENTER_THRESH_V=uint8(0),
  C_IN_CURVE_RADIUS_ENTER_THRESH=uint16(0),
  C_IN_CURVE_RADIUS_EXIT_THRESH_V=uint8(0),
  C_IN_CURVE_RADIUS_EXIT_THRESH=uint16(0),
  ILS_Buffer_2_V=uint8(0),
  ILS_Buffer_2=uint8(0),
  C_VERY_SHARP_CUR_RADIUS_ENTER_V=uint8(0),
  C_VERY_SHARP_CUR_RADIUS_ENTER=uint16(0),
  C_VERY_SHARP_CUR_RADIUS_EXIT_V=uint8(0),
  C_VERY_SHARP_CUR_RADIUS_EXIT=uint16(0),
  C_LOW_BEAM_ON_JUNCTION_V=uint8(0),
  C_LOW_BEAM_ON_JUNCTION=uint8(0),
  ILS_Buffer_3_V=uint8(0),
  ILS_Buffer_3=uint8(0),
  C_OC_CURVE_TIME_DELAY_V=uint8(0),
  C_OC_CURVE_TIME_DELAY=uint16(0),
  C_OC_MAX_DELAY_CURVE_UP_AHEAD_V=uint8(0),
  C_OC_MAX_DELAY_CURVE_UP_AHEAD=uint16(0),
  ILS_Buffer_4_V=uint8(0),
  ILS_Buffer_4=uint8(0),
  C_OC_MID_DISAP_TIME_DELAY_V=uint8(0),
  C_OC_MID_DISAP_TIME_DELAY=uint16(0),
  C_OC_MID_DISAP_TIME_DELAY_HW_V=uint8(0),
  C_OC_MID_DISAP_TIME_DELAY_HW=uint16(0),
  ILS_Buffer_5_V=uint8(0),
  ILS_Buffer_5=uint8(0),
  C_OC_NORMAL_TIME_DELAY_V=uint8(0),
  C_OC_NORMAL_TIME_DELAY=uint16(0),
  C_OC_NORMAL_TIME_DELAY_HW_V=uint8(0),
  C_OC_NORMAL_TIME_DELAY_HW=uint16(0),
  ILS_Buffer_6_V=uint8(0),
  ILS_Buffer_6=uint8(0),
  C_OC_STRONG_SUSP_TIME_DELAY_V=uint8(0),
  C_OC_STRONG_SUSP_TIME_DELAY=uint16(0),
  C_OC_SUSPECT_TIME_DELAY_V=uint8(0),
  C_OC_SUSPECT_TIME_DELAY=uint16(0),
  C_TL_ENABLE_O_Take_CALC_V=uint8(0),
  C_TL_ENABLE_O_Take_CALC=uint8(0),
  ILS_Buffer_7_V=uint8(0),
  ILS_Buffer_7=uint8(0),
  C_TL_LAST_SEEN_SUSPECT_DELAY_V=uint8(0),
  C_TL_LAST_SEEN_SUSPECT_DELAY=uint16(0),
  C_TL_MAX_DELAY_CURVE_UP_AHEAD_V=uint8(0),
  C_TL_MAX_DELAY_CURVE_UP_AHEAD=uint16(0),
  ILS_Buffer_8_V=uint8(0),
  ILS_Buffer_8=uint8(0),
  C_TL_MID_DISAP_TIME_DELAY_V=uint8(0),
  C_TL_MID_DISAP_TIME_DELAY=uint16(0),
  C_TL_MID_DISAP_TIME_DELAY_HW_V=uint8(0),
  C_TL_MID_DISAP_TIME_DELAY_HW=uint16(0),
  ILS_Buffer_9_V=uint8(0),
  ILS_Buffer_9=uint8(0),
  C_TL_NORMAL_TIME_DELAY_V=uint8(0),
  C_TL_NORMAL_TIME_DELAY=uint16(0),
  C_TL_NORMAL_TIME_DELAY_HW_V=uint8(0),
  C_TL_NORMAL_TIME_DELAY_HW=uint16(0),
  ILS_Buffer_10_V=uint8(0),
  ILS_Buffer_10=uint8(0),
  C_TL_OC_STRONG_SUSP_TIME_DELAY_V=uint8(0),
  C_TL_OC_STRONG_SUSP_TIME_DELAY=uint16(0),
  C_TL_OC_SUSPECT_TIME_DELAY_V=uint8(0),
  C_TL_OC_SUSPECT_TIME_DELAY=uint16(0),
  ILS_Buffer_11_V=uint8(0),
  ILS_Buffer_11=uint8(0),
  C_TL_O_TAKE_H_BEAM_SIDE_ANGLE_V=uint8(0),
  C_TL_O_TAKE_H_BEAM_SIDE_ANGLE=single(0),
  C_TL_O_Take_MAX_TIME_DELAY_V=uint8(0),
  C_TL_O_Take_MAX_TIME_DELAY=uint16(0),
  ILS_Buffer_12_V=uint8(0),
  ILS_Buffer_12=uint8(0),
  C_TL_O_Take_TRUCK_LENGTH_V=uint8(0),
  C_TL_O_Take_TRUCK_LENGTH=single(0),
  C_TL_O_Take_VEHICLE_LENGTH_V=uint8(0),
  C_TL_O_Take_VEHICLE_LENGTH=single(0),
  SPEED_SWITCHING_HIGH_BEAMS_OFF_V=uint8(0),
  SPEED_SWITCHING_HIGH_BEAMS_OFF=uint8(0),
  ILS_Buffer_13_V=uint8(0),
  ILS_Buffer_13=uint8(0),
  SPEED_SWITCHING_HIGH_BEAMS_ON_V=uint8(0),
  SPEED_SWITCHING_HIGH_BEAMS_ON=uint8(0),
  LN_US_ECE_BEHAVIOR_V=uint8(0),
  LN_US_ECE_BEHAVIOR=uint8(0),
  FAR_TAIL_KIL_DIST_COUPLE_V=uint8(0),
  FAR_TAIL_KIL_DIST_COUPLE=uint16(0),
  ILS_Buffer_14_V=uint8(0),
  ILS_Buffer_14=uint8(0),
  FAR_TAIL_KIL_DIST_COUPLE_CHI_V=uint8(0),
  FAR_TAIL_KIL_DIST_COUPLE_CHI=uint16(0),
  FAR_TAIL_KIL_DIST_ONE_V=uint8(0),
  FAR_TAIL_KIL_DIST_ONE=uint16(0),
  ILS_Buffer_15_V=uint8(0),
  ILS_Buffer_15=uint8(0),
  FAR_TAIL_KIL_DIST_ONE_CHINA_V=uint8(0),
  FAR_TAIL_KIL_DIST_ONE_CHINA=uint16(0),
  MAX_ONCOMING_DIST_COUPLE_V=uint8(0),
  MAX_ONCOMING_DIST_COUPLE=uint16(0),
  ILS_Buffer_16_V=uint8(0),
  ILS_Buffer_16=uint8(0),
  MAX_ONCOMING_DIST_COUPLE_CHINA_V=uint8(0),
  MAX_ONCOMING_DIST_COUPLE_CHINA=uint16(0),
  MAX_OC_DIST_COUPLE_IN_LB_V=uint8(0),
  MAX_OC_DIST_COUPLE_IN_LB=uint16(0),
  ILS_Buffer_17_V=uint8(0),
  ILS_Buffer_17=uint8(0),
  MAX_OC_DIST_COUPLE_IN_LB_CHINA_V=uint8(0),
  MAX_OC_DIST_COUPLE_IN_LB_CHINA=uint16(0),
  MAX_OC_DIST_ONE_V=uint8(0),
  MAX_OC_DIST_ONE=uint16(0),
  ILS_Buffer_18_V=uint8(0),
  ILS_Buffer_18=uint8(0),
  MAX_ONCOMING_DIST_ONE_CHINA_V=uint8(0),
  MAX_ONCOMING_DIST_ONE_CHINA=uint16(0),
  MAX_ONCOMING_DIST_ONE_IN_LB_V=uint8(0),
  MAX_ONCOMING_DIST_ONE_IN_LB=uint16(0),
  ILS_Buffer_19_V=uint8(0),
  ILS_Buffer_19=uint8(0),
  MAX_OC_DIST_ONE_IN_LB_CHINA_V=uint8(0),
  MAX_OC_DIST_ONE_IN_LB_CHINA=uint16(0),
  MAX_TAIL_DIST_COUPLE_V=uint8(0),
  MAX_TAIL_DIST_COUPLE=uint16(0),
  ILS_Buffer_20_V=uint8(0),
  ILS_Buffer_20=uint8(0),
  MAX_TAIL_DIST_COUPLE_CHINA_V=uint8(0),
  MAX_TAIL_DIST_COUPLE_CHINA=uint16(0),
  MAX_TAIL_DIST_COUPLE_IN_LB_V=uint8(0),
  MAX_TAIL_DIST_COUPLE_IN_LB=uint16(0),
  ILS_Buffer_21_V=uint8(0),
  ILS_Buffer_21=uint8(0),
  MAX_TAIL_DIST_COUP_IN_LB_CHINA_V=uint8(0),
  MAX_TAIL_DIST_COUPLE_IN_LB_CHINA=uint16(0),
  MAX_TAIL_DIST_ONE_V=uint8(0),
  MAX_TAIL_DIST_ONE=uint16(0),
  ILS_Buffer_22_V=uint8(0),
  ILS_Buffer_22=uint8(0),
  MAX_TAIL_DIST_ONE_CHINA_V=uint8(0),
  MAX_TAIL_DIST_ONE_CHINA=uint16(0),
  MAX_TAIL_DIST_ONE_IN_LB_V=uint8(0),
  MAX_TAIL_DIST_ONE_IN_LB=uint16(0),
  ILS_Buffer_23_V=uint8(0),
  ILS_Buffer_23=uint8(0),
  MAX_TAIL_DIST_ONE_IN_LB_CHINA_V=uint8(0),
  MAX_TAIL_DIST_ONE_IN_LB_CHINA=uint16(0),
  OBJECTS_CLUSTERING_METHOD_V=uint8(0),
  OBJECTS_CLUSTERING_METHOD=uint8(0),
  MAX_NUM_STRONG_REFLECTORS_V=uint8(0),
  MAX_NUM_STRONG_REFLECTORS=uint8(0),
  MAX_NUM_VEHICLE_OBJECTS_V=uint8(0),
  MAX_NUM_VEHICLE_OBJECTS=uint8(0),
  Reduce_Sense_Force_Activation_V=uint8(0),
  Reduce_Sense_Force_Activation=uint8(0),
  ILS_Buffer_24_V=uint8(0),
  ILS_Buffer_24=uint8(0),
  Reduce_Sense_Grace_Frames_V=uint8(0),
  Reduce_Sense_Grace_Frames=uint8(0),
  Reduce_Sense_HighToLow_V=uint8(0),
  Reduce_Sense_HighToLow=single(0),
  Reduce_Sense_HighToLow_H5R_V=uint8(0),
  Reduce_Sense_HighToLow_H5R=single(0),
  ILS_Buffer_25_V=uint8(0),
  ILS_Buffer_25=uint8(0),
  Reduce_Sense_LowToHigh_V=uint8(0),
  Reduce_Sense_LowToHigh=single(0),
  ONCOMING_SENSITIVITY_V=uint8(0),
  ONCOMING_SENSITIVITY=single(0),
  TAILLIGHT_SENSITIVITY_V=uint8(0),
  TAILLIGHT_SENSITIVITY=single(0),
  OC_REDUCED_SENSITIVITY_V=uint8(0),
  OC_REDUCED_SENSITIVITY=single(0),
  VE_OBJ_APPROVAL_DIST_FULL_FOV_V=uint8(0),
  VE_OBJ_APPROVAL_DIST_FULL_FOV=uint16(0),
  VE_OBJ_APPROVAL_FOV_V=uint8(0),
  VE_OBJ_APPROVAL_FOV=single(0),
  MIN_TTLI_V=uint8(0),
  MIN_TTLI=single(0),
  BS_DUSK_DELAY_V=uint8(0),
  BS_DUSK_DELAY=uint32(0),
  BS_ENTER_THRESH_V=uint8(0),
  BS_ENTER_THRESH=single(0),
  BS_EXIT_THRESH_V=uint8(0),
  BS_EXIT_THRESH=single(0),
  BS_OB_ENTER_THRESH_V=uint8(0),
  BS_OB_ENTER_THRESH=single(0),
  ILS_Buffer_26_V=uint8(0),
  ILS_Buffer_26=uint8(0),
  BS_OB_EXIT_THRESH_V=uint8(0),
  BS_OB_EXIT_THRESH=single(0),
  CONTROL_LOW_BEAM_ON_BLINK_TFL_V=uint8(0),
  CONTROL_LOW_BEAM_ON_BLINK_TFL=uint8(0),
  CONTROL_OC_CURVY_ROAD_DELAY_V=uint8(0),
  CONTROL_OC_CURVY_ROAD_DELAY=uint16(0),
  ILS_Buffer_27_V=uint8(0),
  ILS_Buffer_27=uint8(0),
  CONTROL_TL_CURVY_ROAD_DELAY_V=uint8(0),
  CONTROL_TL_CURVY_ROAD_DELAY=uint16(0),
  COUPLE_H_LIGHTS_DIST_PRIVATE_V=uint8(0),
  COUPLE_H_LIGHTS_DIST_PRIVATE=single(0),
  COUPLE_H_LIGHTS_DIST_TRUCK_V=uint8(0),
  COUPLE_H_LIGHTS_DIST_TRUCK=single(0),
  COUPLE_T_LIGHTS_DIST_PRIVATE_V=uint8(0),
  COUPLE_T_LIGHTS_DIST_PRIVATE=single(0),
  COUPLE_T_LIGHTS_DIST_TRUCK_V=uint8(0),
  COUPLE_T_LIGHTS_DIST_TRUCK=single(0),
  DARK_SCENE_ONCOMING_SENS_V=uint8(0),
  DARK_SCENE_ONCOMING_SENS=single(0),
  ILS_Buffer_28_V=uint8(0),
  ILS_Buffer_28=uint8(0),
  DARK_SCENE_TAILLIGHT_SENS_V=uint8(0),
  DARK_SCENE_TAILLIGHT_SENS=single(0),
  DELAY_HLB_FULL_TO_INACTIVE_V=uint8(0),
  DELAY_HLB_FULL_TO_INACTIVE=uint16(0),
  ILS_Buffer_29_V=uint8(0),
  ILS_Buffer_29=uint8(0),
  DELAY_HLB_INACTIVE_TO_FULL_V=uint8(0),
  DELAY_HLB_INACTIVE_TO_FULL=uint32(0),
  HEADLIGHTS_HEIGHT_V=uint8(0),
  HEADLIGHTS_HEIGHT=single(0),
  MAX_NUM_MODELIF_STREET_LIGHTS_V=uint8(0),
  MAX_NUM_MODELIF_STREET_LIGHTS=uint8(0),
  NO_HLB_V=uint8(0),
  NO_HLB=uint8(0),
  NO_HLB_MODEL_V=uint8(0),
  NO_HLB_MODEL=uint8(0),
  REFLECTOR_MIN_BRIGHTNESS_V=uint8(0),
  REFLECTOR_MIN_BRIGHTNESS=single(0),
  REFLECTOR_MIN_SIZE_V=uint8(0),
  REFLECTOR_MIN_SIZE=uint16(0),
  ILS_Buffer_30_V=uint8(0),
  ILS_Buffer_30=uint8(0),
  REFLECTOR_ROI_X_V=uint8(0),
  REFLECTOR_ROI_X=single(0),
  REFLECTOR_ROI_Y_V=uint8(0),
  REFLECTOR_ROI_Y=single(0),
  ILS_Buffer_31_V=uint8(0),
  ILS_Buffer_31=uint8(0),
  SL_MAX_GRACE_DIST_HIGH_SPEED_V=uint8(0),
  SL_MAX_GRACE_DIST_HIGH_SPEED=uint8(0),
  SL_MAX_GRACE_DIST_LOW_SPEED_V=uint8(0),
  SL_MAX_GRACE_DIST_LOW_SPEED=uint8(0),
  SL_MAX_GRACE_DIST_VILL_SPEED_V=uint8(0),
  SL_MAX_GRACE_DIST_VILL_SPEED=uint8(0),
  ILS_Buffer_32_V=uint8(0),
  ILS_Buffer_32=uint8(0),
  TAILLIGHTS_HEIGHT_V=uint8(0),
  TAILLIGHTS_HEIGHT=single(0),
  ACTIVE_STATIONARY_TESTING_V=uint8(0),
  ACTIVE_STATIONARY_TESTING=uint8(0),
  OVERTAKING_SIDELONG_OBJECTS_V=uint8(0),
  OVERTAKING_SIDELONG_OBJECTS=uint8(0),
  USE_CITY_ENTRANCE_V=uint8(0),
  USE_CITY_ENTRANCE=uint8(0),
  LN_ONLY_SL_SPEED_EXIT_V=uint8(0),
  LN_ONLY_SL_SPEED_EXIT=uint8(0),
  LN_ONLY_SL_SPEED_ENTER_V=uint8(0),
  LN_ONLY_SL_SPEED_ENTER=uint8(0),
  USE_DUSK_ACTIVATION_V=uint8(0),
  USE_DUSK_ACTIVATION=uint8(0),
  POSITION_PREDICTION_V=uint8(0),
  POSITION_PREDICTION=uint16(0),
  LIGHTCONE_DETECTION_MODE_V=uint8(0),
  LIGHTCONE_DETECTION_MODE=uint8(0),
  DETECTION_SENSITIVITY_V=uint8(0),
  DETECTION_SENSITIVITY=int8(0),
  LSI_Buffer_C12=uint8(0),
  LSI_Buffer_C13=single(0),
  LSI_Buffer_C14=uint8(0),
  ILS_Buffer_33_V=uint8(0),
  ILS_Buffer_33=uint8(0),
  LSI_Buffer_C15=single(0),
  USE_SINGLE_OBJECT_CLUSTERING_V=uint8(0),
  USE_SINGLE_OBJECT_CLUSTERING=uint8(0),
  Reserved_1=uint8(0)), SwCalibrationAccess="ReadWrite", DataType="Bus:EQ4_ILS_HDR_BUS")

EQ4_ILS_HDR_VAL = Simulink.Parameter(struct(
  ILS_Zero_byte=uint8(0),
  ILS_Protocol_Version=uint8(0),
  ILS_Optional_Signals=uint8(0),
  ILS_Buffer_1_V=uint8(0),
  ILS_Buffer_1=uint8(0),
  C_IN_CURVE_RADIUS_ENTER_THRESH_V=uint8(0),
  C_IN_CURVE_RADIUS_ENTER_THRESH=uint16(0),
  C_IN_CURVE_RADIUS_EXIT_THRESH_V=uint8(0),
  C_IN_CURVE_RADIUS_EXIT_THRESH=uint16(0),
  ILS_Buffer_2_V=uint8(0),
  ILS_Buffer_2=uint8(0),
  C_VERY_SHARP_CUR_RADIUS_ENTER_V=uint8(0),
  C_VERY_SHARP_CUR_RADIUS_ENTER=uint16(0),
  C_VERY_SHARP_CUR_RADIUS_EXIT_V=uint8(0),
  C_VERY_SHARP_CUR_RADIUS_EXIT=uint16(0),
  C_LOW_BEAM_ON_JUNCTION_V=uint8(0),
  C_LOW_BEAM_ON_JUNCTION=uint8(0),
  ILS_Buffer_3_V=uint8(0),
  ILS_Buffer_3=uint8(0),
  C_OC_CURVE_TIME_DELAY_V=uint8(0),
  C_OC_CURVE_TIME_DELAY=uint16(0),
  C_OC_MAX_DELAY_CURVE_UP_AHEAD_V=uint8(0),
  C_OC_MAX_DELAY_CURVE_UP_AHEAD=uint16(0),
  ILS_Buffer_4_V=uint8(0),
  ILS_Buffer_4=uint8(0),
  C_OC_MID_DISAP_TIME_DELAY_V=uint8(0),
  C_OC_MID_DISAP_TIME_DELAY=uint16(0),
  C_OC_MID_DISAP_TIME_DELAY_HW_V=uint8(0),
  C_OC_MID_DISAP_TIME_DELAY_HW=uint16(0),
  ILS_Buffer_5_V=uint8(0),
  ILS_Buffer_5=uint8(0),
  C_OC_NORMAL_TIME_DELAY_V=uint8(0),
  C_OC_NORMAL_TIME_DELAY=uint16(0),
  C_OC_NORMAL_TIME_DELAY_HW_V=uint8(0),
  C_OC_NORMAL_TIME_DELAY_HW=uint16(0),
  ILS_Buffer_6_V=uint8(0),
  ILS_Buffer_6=uint8(0),
  C_OC_STRONG_SUSP_TIME_DELAY_V=uint8(0),
  C_OC_STRONG_SUSP_TIME_DELAY=uint16(0),
  C_OC_SUSPECT_TIME_DELAY_V=uint8(0),
  C_OC_SUSPECT_TIME_DELAY=uint16(0),
  C_TL_ENABLE_O_Take_CALC_V=uint8(0),
  C_TL_ENABLE_O_Take_CALC=uint8(0),
  ILS_Buffer_7_V=uint8(0),
  ILS_Buffer_7=uint8(0),
  C_TL_LAST_SEEN_SUSPECT_DELAY_V=uint8(0),
  C_TL_LAST_SEEN_SUSPECT_DELAY=uint16(0),
  C_TL_MAX_DELAY_CURVE_UP_AHEAD_V=uint8(0),
  C_TL_MAX_DELAY_CURVE_UP_AHEAD=uint16(0),
  ILS_Buffer_8_V=uint8(0),
  ILS_Buffer_8=uint8(0),
  C_TL_MID_DISAP_TIME_DELAY_V=uint8(0),
  C_TL_MID_DISAP_TIME_DELAY=uint16(0),
  C_TL_MID_DISAP_TIME_DELAY_HW_V=uint8(0),
  C_TL_MID_DISAP_TIME_DELAY_HW=uint16(0),
  ILS_Buffer_9_V=uint8(0),
  ILS_Buffer_9=uint8(0),
  C_TL_NORMAL_TIME_DELAY_V=uint8(0),
  C_TL_NORMAL_TIME_DELAY=uint16(0),
  C_TL_NORMAL_TIME_DELAY_HW_V=uint8(0),
  C_TL_NORMAL_TIME_DELAY_HW=uint16(0),
  ILS_Buffer_10_V=uint8(0),
  ILS_Buffer_10=uint8(0),
  C_TL_OC_STRONG_SUSP_TIME_DELAY_V=uint8(0),
  C_TL_OC_STRONG_SUSP_TIME_DELAY=uint16(0),
  C_TL_OC_SUSPECT_TIME_DELAY_V=uint8(0),
  C_TL_OC_SUSPECT_TIME_DELAY=uint16(0),
  ILS_Buffer_11_V=uint8(0),
  ILS_Buffer_11=uint8(0),
  C_TL_O_TAKE_H_BEAM_SIDE_ANGLE_V=uint8(0),
  C_TL_O_TAKE_H_BEAM_SIDE_ANGLE=single(0),
  C_TL_O_Take_MAX_TIME_DELAY_V=uint8(0),
  C_TL_O_Take_MAX_TIME_DELAY=uint16(0),
  ILS_Buffer_12_V=uint8(0),
  ILS_Buffer_12=uint8(0),
  C_TL_O_Take_TRUCK_LENGTH_V=uint8(0),
  C_TL_O_Take_TRUCK_LENGTH=single(0),
  C_TL_O_Take_VEHICLE_LENGTH_V=uint8(0),
  C_TL_O_Take_VEHICLE_LENGTH=single(0),
  SPEED_SWITCHING_HIGH_BEAMS_OFF_V=uint8(0),
  SPEED_SWITCHING_HIGH_BEAMS_OFF=uint8(0),
  ILS_Buffer_13_V=uint8(0),
  ILS_Buffer_13=uint8(0),
  SPEED_SWITCHING_HIGH_BEAMS_ON_V=uint8(0),
  SPEED_SWITCHING_HIGH_BEAMS_ON=uint8(0),
  LN_US_ECE_BEHAVIOR_V=uint8(0),
  LN_US_ECE_BEHAVIOR=uint8(0),
  FAR_TAIL_KIL_DIST_COUPLE_V=uint8(0),
  FAR_TAIL_KIL_DIST_COUPLE=uint16(0),
  ILS_Buffer_14_V=uint8(0),
  ILS_Buffer_14=uint8(0),
  FAR_TAIL_KIL_DIST_COUPLE_CHI_V=uint8(0),
  FAR_TAIL_KIL_DIST_COUPLE_CHI=uint16(0),
  FAR_TAIL_KIL_DIST_ONE_V=uint8(0),
  FAR_TAIL_KIL_DIST_ONE=uint16(0),
  ILS_Buffer_15_V=uint8(0),
  ILS_Buffer_15=uint8(0),
  FAR_TAIL_KIL_DIST_ONE_CHINA_V=uint8(0),
  FAR_TAIL_KIL_DIST_ONE_CHINA=uint16(0),
  MAX_ONCOMING_DIST_COUPLE_V=uint8(0),
  MAX_ONCOMING_DIST_COUPLE=uint16(0),
  ILS_Buffer_16_V=uint8(0),
  ILS_Buffer_16=uint8(0),
  MAX_ONCOMING_DIST_COUPLE_CHINA_V=uint8(0),
  MAX_ONCOMING_DIST_COUPLE_CHINA=uint16(0),
  MAX_OC_DIST_COUPLE_IN_LB_V=uint8(0),
  MAX_OC_DIST_COUPLE_IN_LB=uint16(0),
  ILS_Buffer_17_V=uint8(0),
  ILS_Buffer_17=uint8(0),
  MAX_OC_DIST_COUPLE_IN_LB_CHINA_V=uint8(0),
  MAX_OC_DIST_COUPLE_IN_LB_CHINA=uint16(0),
  MAX_OC_DIST_ONE_V=uint8(0),
  MAX_OC_DIST_ONE=uint16(0),
  ILS_Buffer_18_V=uint8(0),
  ILS_Buffer_18=uint8(0),
  MAX_ONCOMING_DIST_ONE_CHINA_V=uint8(0),
  MAX_ONCOMING_DIST_ONE_CHINA=uint16(0),
  MAX_ONCOMING_DIST_ONE_IN_LB_V=uint8(0),
  MAX_ONCOMING_DIST_ONE_IN_LB=uint16(0),
  ILS_Buffer_19_V=uint8(0),
  ILS_Buffer_19=uint8(0),
  MAX_OC_DIST_ONE_IN_LB_CHINA_V=uint8(0),
  MAX_OC_DIST_ONE_IN_LB_CHINA=uint16(0),
  MAX_TAIL_DIST_COUPLE_V=uint8(0),
  MAX_TAIL_DIST_COUPLE=uint16(0),
  ILS_Buffer_20_V=uint8(0),
  ILS_Buffer_20=uint8(0),
  MAX_TAIL_DIST_COUPLE_CHINA_V=uint8(0),
  MAX_TAIL_DIST_COUPLE_CHINA=uint16(0),
  MAX_TAIL_DIST_COUPLE_IN_LB_V=uint8(0),
  MAX_TAIL_DIST_COUPLE_IN_LB=uint16(0),
  ILS_Buffer_21_V=uint8(0),
  ILS_Buffer_21=uint8(0),
  MAX_TAIL_DIST_COUP_IN_LB_CHINA_V=uint8(0),
  MAX_TAIL_DIST_COUPLE_IN_LB_CHINA=uint16(0),
  MAX_TAIL_DIST_ONE_V=uint8(0),
  MAX_TAIL_DIST_ONE=uint16(0),
  ILS_Buffer_22_V=uint8(0),
  ILS_Buffer_22=uint8(0),
  MAX_TAIL_DIST_ONE_CHINA_V=uint8(0),
  MAX_TAIL_DIST_ONE_CHINA=uint16(0),
  MAX_TAIL_DIST_ONE_IN_LB_V=uint8(0),
  MAX_TAIL_DIST_ONE_IN_LB=uint16(0),
  ILS_Buffer_23_V=uint8(0),
  ILS_Buffer_23=uint8(0),
  MAX_TAIL_DIST_ONE_IN_LB_CHINA_V=uint8(0),
  MAX_TAIL_DIST_ONE_IN_LB_CHINA=uint16(0),
  OBJECTS_CLUSTERING_METHOD_V=uint8(0),
  OBJECTS_CLUSTERING_METHOD=uint8(0),
  MAX_NUM_STRONG_REFLECTORS_V=uint8(0),
  MAX_NUM_STRONG_REFLECTORS=uint8(0),
  MAX_NUM_VEHICLE_OBJECTS_V=uint8(0),
  MAX_NUM_VEHICLE_OBJECTS=uint8(0),
  Reduce_Sense_Force_Activation_V=uint8(0),
  Reduce_Sense_Force_Activation=uint8(0),
  ILS_Buffer_24_V=uint8(0),
  ILS_Buffer_24=uint8(0),
  Reduce_Sense_Grace_Frames_V=uint8(0),
  Reduce_Sense_Grace_Frames=uint8(0),
  Reduce_Sense_HighToLow_V=uint8(0),
  Reduce_Sense_HighToLow=single(0),
  Reduce_Sense_HighToLow_H5R_V=uint8(0),
  Reduce_Sense_HighToLow_H5R=single(0),
  ILS_Buffer_25_V=uint8(0),
  ILS_Buffer_25=uint8(0),
  Reduce_Sense_LowToHigh_V=uint8(0),
  Reduce_Sense_LowToHigh=single(0),
  ONCOMING_SENSITIVITY_V=uint8(0),
  ONCOMING_SENSITIVITY=single(0),
  TAILLIGHT_SENSITIVITY_V=uint8(0),
  TAILLIGHT_SENSITIVITY=single(0),
  OC_REDUCED_SENSITIVITY_V=uint8(0),
  OC_REDUCED_SENSITIVITY=single(0),
  VE_OBJ_APPROVAL_DIST_FULL_FOV_V=uint8(0),
  VE_OBJ_APPROVAL_DIST_FULL_FOV=uint16(0),
  VE_OBJ_APPROVAL_FOV_V=uint8(0),
  VE_OBJ_APPROVAL_FOV=single(0),
  MIN_TTLI_V=uint8(0),
  MIN_TTLI=single(0),
  BS_DUSK_DELAY_V=uint8(0),
  BS_DUSK_DELAY=uint32(0),
  BS_ENTER_THRESH_V=uint8(0),
  BS_ENTER_THRESH=single(0),
  BS_EXIT_THRESH_V=uint8(0),
  BS_EXIT_THRESH=single(0),
  BS_OB_ENTER_THRESH_V=uint8(0),
  BS_OB_ENTER_THRESH=single(0),
  ILS_Buffer_26_V=uint8(0),
  ILS_Buffer_26=uint8(0),
  BS_OB_EXIT_THRESH_V=uint8(0),
  BS_OB_EXIT_THRESH=single(0),
  CONTROL_LOW_BEAM_ON_BLINK_TFL_V=uint8(0),
  CONTROL_LOW_BEAM_ON_BLINK_TFL=uint8(0),
  CONTROL_OC_CURVY_ROAD_DELAY_V=uint8(0),
  CONTROL_OC_CURVY_ROAD_DELAY=uint16(0),
  ILS_Buffer_27_V=uint8(0),
  ILS_Buffer_27=uint8(0),
  CONTROL_TL_CURVY_ROAD_DELAY_V=uint8(0),
  CONTROL_TL_CURVY_ROAD_DELAY=uint16(0),
  COUPLE_H_LIGHTS_DIST_PRIVATE_V=uint8(0),
  COUPLE_H_LIGHTS_DIST_PRIVATE=single(0),
  COUPLE_H_LIGHTS_DIST_TRUCK_V=uint8(0),
  COUPLE_H_LIGHTS_DIST_TRUCK=single(0),
  COUPLE_T_LIGHTS_DIST_PRIVATE_V=uint8(0),
  COUPLE_T_LIGHTS_DIST_PRIVATE=single(0),
  COUPLE_T_LIGHTS_DIST_TRUCK_V=uint8(0),
  COUPLE_T_LIGHTS_DIST_TRUCK=single(0),
  DARK_SCENE_ONCOMING_SENS_V=uint8(0),
  DARK_SCENE_ONCOMING_SENS=single(0),
  ILS_Buffer_28_V=uint8(0),
  ILS_Buffer_28=uint8(0),
  DARK_SCENE_TAILLIGHT_SENS_V=uint8(0),
  DARK_SCENE_TAILLIGHT_SENS=single(0),
  DELAY_HLB_FULL_TO_INACTIVE_V=uint8(0),
  DELAY_HLB_FULL_TO_INACTIVE=uint16(0),
  ILS_Buffer_29_V=uint8(0),
  ILS_Buffer_29=uint8(0),
  DELAY_HLB_INACTIVE_TO_FULL_V=uint8(0),
  DELAY_HLB_INACTIVE_TO_FULL=uint32(0),
  HEADLIGHTS_HEIGHT_V=uint8(0),
  HEADLIGHTS_HEIGHT=single(0),
  MAX_NUM_MODELIF_STREET_LIGHTS_V=uint8(0),
  MAX_NUM_MODELIF_STREET_LIGHTS=uint8(0),
  NO_HLB_V=uint8(0),
  NO_HLB=uint8(0),
  NO_HLB_MODEL_V=uint8(0),
  NO_HLB_MODEL=uint8(0),
  REFLECTOR_MIN_BRIGHTNESS_V=uint8(0),
  REFLECTOR_MIN_BRIGHTNESS=single(0),
  REFLECTOR_MIN_SIZE_V=uint8(0),
  REFLECTOR_MIN_SIZE=uint16(0),
  ILS_Buffer_30_V=uint8(0),
  ILS_Buffer_30=uint8(0),
  REFLECTOR_ROI_X_V=uint8(0),
  REFLECTOR_ROI_X=single(0),
  REFLECTOR_ROI_Y_V=uint8(0),
  REFLECTOR_ROI_Y=single(0),
  ILS_Buffer_31_V=uint8(0),
  ILS_Buffer_31=uint8(0),
  SL_MAX_GRACE_DIST_HIGH_SPEED_V=uint8(0),
  SL_MAX_GRACE_DIST_HIGH_SPEED=uint8(0),
  SL_MAX_GRACE_DIST_LOW_SPEED_V=uint8(0),
  SL_MAX_GRACE_DIST_LOW_SPEED=uint8(0),
  SL_MAX_GRACE_DIST_VILL_SPEED_V=uint8(0),
  SL_MAX_GRACE_DIST_VILL_SPEED=uint8(0),
  ILS_Buffer_32_V=uint8(0),
  ILS_Buffer_32=uint8(0),
  TAILLIGHTS_HEIGHT_V=uint8(0),
  TAILLIGHTS_HEIGHT=single(0),
  ACTIVE_STATIONARY_TESTING_V=uint8(0),
  ACTIVE_STATIONARY_TESTING=uint8(0),
  OVERTAKING_SIDELONG_OBJECTS_V=uint8(0),
  OVERTAKING_SIDELONG_OBJECTS=uint8(0),
  USE_CITY_ENTRANCE_V=uint8(0),
  USE_CITY_ENTRANCE=uint8(0),
  LN_ONLY_SL_SPEED_EXIT_V=uint8(0),
  LN_ONLY_SL_SPEED_EXIT=uint8(0),
  LN_ONLY_SL_SPEED_ENTER_V=uint8(0),
  LN_ONLY_SL_SPEED_ENTER=uint8(0),
  USE_DUSK_ACTIVATION_V=uint8(0),
  USE_DUSK_ACTIVATION=uint8(0),
  POSITION_PREDICTION_V=uint8(0),
  POSITION_PREDICTION=uint16(0),
  LIGHTCONE_DETECTION_MODE_V=uint8(0),
  LIGHTCONE_DETECTION_MODE=uint8(0),
  DETECTION_SENSITIVITY_V=uint8(0),
  DETECTION_SENSITIVITY=int8(0),
  LSI_Buffer_C12=uint8(0),
  LSI_Buffer_C13=single(0),
  LSI_Buffer_C14=uint8(0),
  ILS_Buffer_33_V=uint8(0),
  ILS_Buffer_33=uint8(0),
  LSI_Buffer_C15=single(0),
  USE_SINGLE_OBJECT_CLUSTERING_V=uint8(0),
  USE_SINGLE_OBJECT_CLUSTERING=uint8(0),
  Reserved_1=uint8(0)))

EQ4_IMTFV_HDR_PAR = AUTOSAR4.Parameter(struct(
  IMTFV_Zero_byte=uint8(0),
  IMTFV_Protocol_Version=uint8(0),
  IMTFV_Optional_Signals=uint8(0),
  IMTFV_Camera_Identity=int8(0),
  IMTFV_Fixed_Exposure=uint16(0),
  IMTFV_Mode=uint8(0),
  Reserved_1=uint8(0)), SwCalibrationAccess="ReadWrite", DataType="Bus:EQ4_IMTFV_HDR_BUS")

EQ4_IMTFV_HDR_VAL = Simulink.Parameter(struct(
  IMTFV_Zero_byte=uint8(0),
  IMTFV_Protocol_Version=uint8(0),
  IMTFV_Optional_Signals=uint8(0),
  IMTFV_Camera_Identity=int8(0),
  IMTFV_Fixed_Exposure=uint16(0),
  IMTFV_Mode=uint8(0),
  Reserved_1=uint8(0)))

EQ4_IPCW_HDR_PAR = AUTOSAR4.Parameter(struct(
  IPCW_Zero_byte=uint8(0),
  IPCW_Protocol_Version=uint8(0),
  IPCW_Optional_Signals=uint8(0),
  PCA_Ignition_default_state_V=uint8(0),
  PCA_Ignition_default_state=uint8(0),
  PCW_Buffer_1_V=uint8(0),
  PCW_Buffer_1=uint8(0),
  PCW_FCV_MediumTTCAddition_V=uint8(0),
  PCW_FCV_MediumTTCAddition=single(0),
  PCW_LX_TTC_kneePoints_warn_0_V=uint8(0),
  PCW_LX_TTC_kneePoints_warn_0=single(0),
  PCW_LX_TTC_kneePoints_warn_1_V=uint8(0),
  PCW_LX_TTC_kneePoints_warn_1=single(0),
  PCW_Buffer_2_V=uint8(0),
  PCW_Buffer_2=uint8(0),
  PCW_LX_TTC_kneePoints_warn_2_V=uint8(0),
  PCW_LX_TTC_kneePoints_warn_2=single(0),
  PCW_LX_TTC_kneePoints_warn_3_V=uint8(0),
  PCW_LX_TTC_kneePoints_warn_3=single(0),
  PCW_LX_TTC_kneePoints_warn_4_V=uint8(0),
  PCW_LX_TTC_kneePoints_warn_4=single(0),
  PCW_Buffer_3_V=uint8(0),
  PCW_Buffer_3=uint8(0),
  PCW_LX_TTC_kneePoints_warn_5_V=uint8(0),
  PCW_LX_TTC_kneePoints_warn_5=single(0),
  PCW_LX_TTC_kneePoints_night_0_V=uint8(0),
  PCW_LX_TTC_kneePoints_night_0=single(0),
  PCW_LX_TTC_kneePoints_night_1_V=uint8(0),
  PCW_LX_TTC_kneePoints_night_1=single(0),
  PCW_Buffer_4_V=uint8(0),
  PCW_Buffer_4=uint8(0),
  PCW_LX_TTC_kneePoints_night_2_V=uint8(0),
  PCW_LX_TTC_kneePoints_night_2=single(0),
  PCW_LX_TTC_kneePoints_night_3_V=uint8(0),
  PCW_LX_TTC_kneePoints_night_3=single(0),
  PCW_LX_TTC_kneePoints_night_4_V=uint8(0),
  PCW_LX_TTC_kneePoints_night_4=single(0),
  PCW_Buffer_5_V=uint8(0),
  PCW_Buffer_5=uint8(0),
  PCW_LX_TTC_kneePoints_night_5_V=uint8(0),
  PCW_LX_TTC_kneePoints_night_5=single(0),
  PCW_LX_TTC_kPoints_bicycle_0_V=uint8(0),
  PCW_LX_TTC_kPoints_bicycle_0=single(0),
  PCW_LX_TTC_kPoints_bicycle_1_V=uint8(0),
  PCW_LX_TTC_kPoints_bicycle_1=single(0),
  PCW_Buffer_6_V=uint8(0),
  PCW_Buffer_6=uint8(0),
  PCW_LX_TTC_kPoints_bicycle_2_V=uint8(0),
  PCW_LX_TTC_kPoints_bicycle_2=single(0),
  PCW_LX_TTC_kPoints_bicycle_3_V=uint8(0),
  PCW_LX_TTC_kPoints_bicycle_3=single(0),
  PCW_LX_TTC_kPoints_bicycle_4_V=uint8(0),
  PCW_LX_TTC_kPoints_bicycle_4=single(0),
  PCW_Buffer_7_V=uint8(0),
  PCW_Buffer_7=uint8(0),
  PCW_LX_TTC_kPoints_bicycle_5_V=uint8(0),
  PCW_LX_TTC_kPoints_bicycle_5=single(0),
  PCW_LX_TTC_kPoints_bicy_N_0_V=uint8(0),
  PCW_LX_TTC_kPoints_bicy_N_0=single(0),
  PCW_LX_TTC_kPoints_bicy_N_1_V=uint8(0),
  PCW_LX_TTC_kPoints_bicy_N_1=single(0),
  PCW_Buffer_8_V=uint8(0),
  PCW_Buffer_8=uint8(0),
  PCW_LX_TTC_kPoints_bicy_N_2_V=uint8(0),
  PCW_LX_TTC_kPoints_bicy_N_2=single(0),
  PCW_LX_TTC_kPoints_bicy_N_3_V=uint8(0),
  PCW_LX_TTC_kPoints_bicy_N_3=single(0),
  PCW_LX_TTC_kPoints_bicy_N_4_V=uint8(0),
  PCW_LX_TTC_kPoints_bicy_N_4=single(0),
  PCW_Buffer_9_V=uint8(0),
  PCW_Buffer_9=uint8(0),
  PCW_LX_TTC_kPoints_bicy_N_5_V=uint8(0),
  PCW_LX_TTC_kPoints_bicy_N_5=single(0),
  PCW_LX_speed_kneePoints_0_V=uint8(0),
  PCW_LX_speed_kneePoints_0=single(0),
  PCW_Buffer_10_V=uint8(0),
  PCW_Buffer_10=uint8(0),
  PCW_LX_speed_kneePoints_1_V=uint8(0),
  PCW_LX_speed_kneePoints_1=single(0),
  PCW_LX_speed_kneePoints_2_V=uint8(0),
  PCW_LX_speed_kneePoints_2=single(0),
  PCW_Buffer_11_V=uint8(0),
  PCW_Buffer_11=uint8(0),
  PCW_LX_speed_kneePoints_3_V=uint8(0),
  PCW_LX_speed_kneePoints_3=single(0),
  PCW_LX_speed_kneePoints_4_V=uint8(0),
  PCW_LX_speed_kneePoints_4=single(0),
  PCW_Buffer_12_V=uint8(0),
  PCW_Buffer_12=uint8(0),
  PCW_LX_speed_kneePoints_5_V=uint8(0),
  PCW_LX_speed_kneePoints_5=single(0),
  PCW_LX_speed_kPoint_bicycles_0_V=uint8(0),
  PCW_LX_speed_kPoint_bicycles_0=single(0),
  PCW_Buffer_13_V=uint8(0),
  PCW_Buffer_13=uint8(0),
  PCW_LX_speed_kPoint_bicycles_1_V=uint8(0),
  PCW_LX_speed_kPoint_bicycles_1=single(0),
  PCW_LX_speed_kPoint_bicycles_2_V=uint8(0),
  PCW_LX_speed_kPoint_bicycles_2=single(0),
  PCW_Buffer_14_V=uint8(0),
  PCW_Buffer_14=uint8(0),
  PCW_LX_speed_kPoint_bicycles_3_V=uint8(0),
  PCW_LX_speed_kPoint_bicycles_3=single(0),
  PCW_LX_speed_kPoint_bicycles_4_V=uint8(0),
  PCW_LX_speed_kPoint_bicycles_4=single(0),
  PCW_Buffer_15_V=uint8(0),
  PCW_Buffer_15=uint8(0),
  PCW_LX_speed_kPoint_bicycles_5_V=uint8(0),
  PCW_LX_speed_kPoint_bicycles_5=single(0),
  PCW_LX_speedParams_0_V=uint8(0),
  PCW_LX_speedParams_0=single(0),
  PCW_Buffer_16_V=uint8(0),
  PCW_Buffer_16=uint8(0),
  PCW_LX_speedParams_1_V=uint8(0),
  PCW_LX_speedParams_1=single(0),
  PCW_LX_speedParams_2_V=uint8(0),
  PCW_LX_speedParams_2=single(0),
  PCW_Buffer_17_V=uint8(0),
  PCW_Buffer_17=uint8(0),
  PCW_LX_speedParams_3_V=uint8(0),
  PCW_LX_speedParams_3=single(0),
  PCW_LX_currSide_0_V=uint8(0),
  PCW_LX_currSide_0=single(0),
  PCW_Buffer_18_V=uint8(0),
  PCW_Buffer_18=uint8(0),
  PCW_LX_currSide_1_V=uint8(0),
  PCW_LX_currSide_1=single(0),
  PCW_LX_currSide_2_V=uint8(0),
  PCW_LX_currSide_2=single(0),
  PCW_LX_currSide_3_V=uint8(0),
  PCW_LX_currSide_3=single(0),
  PCW_LX_crossingExpand_0_V=uint8(0),
  PCW_LX_crossingExpand_0=single(0),
  PCW_LX_crossingExpand_1_V=uint8(0),
  PCW_LX_crossingExpand_1=single(0),
  PCW_Buffer_19_V=uint8(0),
  PCW_Buffer_19=uint8(0),
  PCW_LX_crossingExpand_2_V=uint8(0),
  PCW_LX_crossingExpand_2=single(0),
  PCW_LX_crossingExpand_3_V=uint8(0),
  PCW_LX_crossingExpand_3=single(0),
  PCW_LX_crossingBicycleExp_0_V=uint8(0),
  PCW_LX_crossingBicycleExp_0=single(0),
  PCW_LX_crossingBicycleExp_1_V=uint8(0),
  PCW_LX_crossingBicycleExp_1=single(0),
  PCW_LX_crossingBicycleExp_2_V=uint8(0),
  PCW_LX_crossingBicycleExp_2=single(0),
  PCW_Buffer_20_V=uint8(0),
  PCW_Buffer_20=uint8(0),
  PCW_LX_crossingBicycleExp_3_V=uint8(0),
  PCW_LX_crossingBicycleExp_3=single(0),
  PCW_LX_predSide_0_V=uint8(0),
  PCW_LX_predSide_0=single(0),
  PCW_LX_predSide_1_V=uint8(0),
  PCW_LX_predSide_1=single(0),
  PCW_LX_predSide_2_V=uint8(0),
  PCW_LX_predSide_2=single(0),
  PCW_LX_predSide_3_V=uint8(0),
  PCW_LX_predSide_3=single(0),
  PCW_Buffer_21_V=uint8(0),
  PCW_Buffer_21=uint8(0),
  PCW_LX_bicycleSide_0_V=uint8(0),
  PCW_LX_bicycleSide_0=single(0),
  PCW_LX_bicycleSide_1_V=uint8(0),
  PCW_LX_bicycleSide_1=single(0),
  PCW_LX_bicycleSide_2_V=uint8(0),
  PCW_LX_bicycleSide_2=single(0),
  PCW_LX_bicycleSide_3_V=uint8(0),
  PCW_LX_bicycleSide_3=single(0),
  PCW_LX_MinPauseAfterWarn_V=uint8(0),
  PCW_LX_MinPauseAfterWarn=single(0),
  PCW_Buffer_22_V=uint8(0),
  PCW_Buffer_22=uint8(0),
  PCW_LX_MinSpeedForWarn_V=uint8(0),
  PCW_LX_MinSpeedForWarn=single(0),
  PCW_LX_MaxSpeedForWarn_V=uint8(0),
  PCW_LX_MaxSpeedForWarn=single(0),
  PCW_Buffer_23_V=uint8(0),
  PCW_Buffer_23=uint8(0),
  PCW_LX_brakingTTCReduction_V=uint8(0),
  PCW_LX_brakingTTCReduction=single(0),
  PCW_LX_maxYawRadPerSec_warn_V=uint8(0),
  PCW_LX_maxYawRadPerSec_warn=single(0),
  PCW_LX_maxWheelAngle_V=uint8(0),
  PCW_LX_maxWheelAngle=single(0),
  PCW_Buffer_24_V=uint8(0),
  PCW_Buffer_24=uint8(0),
  PCW_LX_TTC_kPoints_warn_far_0_V=uint8(0),
  PCW_LX_TTC_kPoints_warn_far_0=single(0),
  PCW_LX_TTC_kPoints_warn_far_1_V=uint8(0),
  PCW_LX_TTC_kPoints_warn_far_1=single(0),
  PCW_LX_TTC_kPoints_warn_far_2_V=uint8(0),
  PCW_LX_TTC_kPoints_warn_far_2=single(0),
  PCW_Buffer_25_V=uint8(0),
  PCW_Buffer_25=uint8(0),
  PCW_LX_TTC_kPoints_warn_far_3_V=uint8(0),
  PCW_LX_TTC_kPoints_warn_far_3=single(0),
  PCW_LX_TTC_kPoints_warn_far_4_V=uint8(0),
  PCW_LX_TTC_kPoints_warn_far_4=single(0),
  PCW_LX_TTC_kPoints_warn_far_5_V=uint8(0),
  PCW_LX_TTC_kPoints_warn_far_5=single(0),
  PCW_Buffer_26_V=uint8(0),
  PCW_Buffer_26=uint8(0),
  PCW_LX_TTC_kPoints_warn_n_0_V=uint8(0),
  PCW_LX_TTC_kPoints_warn_n_0=single(0),
  PCW_LX_TTC_kPoints_warn_n_1_V=uint8(0),
  PCW_LX_TTC_kPoints_warn_n_1=single(0),
  PCW_LX_TTC_kPoints_warn_n_2_V=uint8(0),
  PCW_LX_TTC_kPoints_warn_n_2=single(0),
  PCW_Buffer_27_V=uint8(0),
  PCW_Buffer_27=uint8(0),
  PCW_LX_TTC_kPoints_warn_n_3_V=uint8(0),
  PCW_LX_TTC_kPoints_warn_n_3=single(0),
  PCW_LX_TTC_kPoints_warn_n_4_V=uint8(0),
  PCW_LX_TTC_kPoints_warn_n_4=single(0),
  PCW_LX_TTC_kPoints_warn_n_5_V=uint8(0),
  PCW_LX_TTC_kPoints_warn_n_5=single(0),
  PCW_Buffer_28_V=uint8(0),
  PCW_Buffer_28=uint8(0),
  PCW_LX_TTC_kPoints_bi_F_0_V=uint8(0),
  PCW_LX_TTC_kPoints_bi_F_0=single(0),
  PCW_LX_TTC_kPoints_bi_F_1_V=uint8(0),
  PCW_LX_TTC_kPoints_bi_F_1=single(0),
  PCW_LX_TTC_kPoints_bi_F_2_V=uint8(0),
  PCW_LX_TTC_kPoints_bi_F_2=single(0),
  PCW_Buffer_29_V=uint8(0),
  PCW_Buffer_29=uint8(0),
  PCW_LX_TTC_kPoints_bi_F_3_V=uint8(0),
  PCW_LX_TTC_kPoints_bi_F_3=single(0),
  PCW_LX_TTC_kPoints_bi_F_4_V=uint8(0),
  PCW_LX_TTC_kPoints_bi_F_4=single(0),
  PCW_LX_TTC_kPoints_bi_F_5_V=uint8(0),
  PCW_LX_TTC_kPoints_bi_F_5=single(0),
  PCW_Buffer_30_V=uint8(0),
  PCW_Buffer_30=uint8(0),
  PCW_LX_TTC_kPoints_bi_N_0_V=uint8(0),
  PCW_LX_TTC_kPoints_bi_N_0=single(0),
  PCW_LX_TTC_kPoints_bi_N_1_V=uint8(0),
  PCW_LX_TTC_kPoints_bi_N_1=single(0),
  PCW_LX_TTC_kPoints_bi_N_2_V=uint8(0),
  PCW_LX_TTC_kPoints_bi_N_2=single(0),
  PCW_Buffer_31_V=uint8(0),
  PCW_Buffer_31=uint8(0),
  PCW_LX_TTC_kPoints_bi_N_3_V=uint8(0),
  PCW_LX_TTC_kPoints_bi_N_3=single(0),
  PCW_LX_TTC_kPoints_bi_N_4_V=uint8(0),
  PCW_LX_TTC_kPoints_bi_N_4=single(0),
  PCW_LX_TTC_kPoints_bi_N_5_V=uint8(0),
  PCW_LX_TTC_kPoints_bi_N_5=single(0),
  PCW_LX_DeactivateInNight_V=uint8(0),
  PCW_LX_DeactivateInNight=uint8(0),
  PCW_LX_adhereToGapSensitivity_V=uint8(0),
  PCW_LX_adhereToGapSensitivity=uint8(0),
  PCW_LX_warnOnBicycles_V=uint8(0),
  PCW_LX_warnOnBicycles=uint8(0),
  PCW_LX_SuppressByBrake_V=uint8(0),
  PCW_LX_SuppressByBrake=uint8(0),
  Reserved_1=uint8(0)), SwCalibrationAccess="ReadWrite", DataType="Bus:EQ4_IPCW_HDR_BUS")

EQ4_IPCW_HDR_VAL = Simulink.Parameter(struct(
  IPCW_Zero_byte=uint8(0),
  IPCW_Protocol_Version=uint8(0),
  IPCW_Optional_Signals=uint8(0),
  PCA_Ignition_default_state_V=uint8(0),
  PCA_Ignition_default_state=uint8(0),
  PCW_Buffer_1_V=uint8(0),
  PCW_Buffer_1=uint8(0),
  PCW_FCV_MediumTTCAddition_V=uint8(0),
  PCW_FCV_MediumTTCAddition=single(0),
  PCW_LX_TTC_kneePoints_warn_0_V=uint8(0),
  PCW_LX_TTC_kneePoints_warn_0=single(0),
  PCW_LX_TTC_kneePoints_warn_1_V=uint8(0),
  PCW_LX_TTC_kneePoints_warn_1=single(0),
  PCW_Buffer_2_V=uint8(0),
  PCW_Buffer_2=uint8(0),
  PCW_LX_TTC_kneePoints_warn_2_V=uint8(0),
  PCW_LX_TTC_kneePoints_warn_2=single(0),
  PCW_LX_TTC_kneePoints_warn_3_V=uint8(0),
  PCW_LX_TTC_kneePoints_warn_3=single(0),
  PCW_LX_TTC_kneePoints_warn_4_V=uint8(0),
  PCW_LX_TTC_kneePoints_warn_4=single(0),
  PCW_Buffer_3_V=uint8(0),
  PCW_Buffer_3=uint8(0),
  PCW_LX_TTC_kneePoints_warn_5_V=uint8(0),
  PCW_LX_TTC_kneePoints_warn_5=single(0),
  PCW_LX_TTC_kneePoints_night_0_V=uint8(0),
  PCW_LX_TTC_kneePoints_night_0=single(0),
  PCW_LX_TTC_kneePoints_night_1_V=uint8(0),
  PCW_LX_TTC_kneePoints_night_1=single(0),
  PCW_Buffer_4_V=uint8(0),
  PCW_Buffer_4=uint8(0),
  PCW_LX_TTC_kneePoints_night_2_V=uint8(0),
  PCW_LX_TTC_kneePoints_night_2=single(0),
  PCW_LX_TTC_kneePoints_night_3_V=uint8(0),
  PCW_LX_TTC_kneePoints_night_3=single(0),
  PCW_LX_TTC_kneePoints_night_4_V=uint8(0),
  PCW_LX_TTC_kneePoints_night_4=single(0),
  PCW_Buffer_5_V=uint8(0),
  PCW_Buffer_5=uint8(0),
  PCW_LX_TTC_kneePoints_night_5_V=uint8(0),
  PCW_LX_TTC_kneePoints_night_5=single(0),
  PCW_LX_TTC_kPoints_bicycle_0_V=uint8(0),
  PCW_LX_TTC_kPoints_bicycle_0=single(0),
  PCW_LX_TTC_kPoints_bicycle_1_V=uint8(0),
  PCW_LX_TTC_kPoints_bicycle_1=single(0),
  PCW_Buffer_6_V=uint8(0),
  PCW_Buffer_6=uint8(0),
  PCW_LX_TTC_kPoints_bicycle_2_V=uint8(0),
  PCW_LX_TTC_kPoints_bicycle_2=single(0),
  PCW_LX_TTC_kPoints_bicycle_3_V=uint8(0),
  PCW_LX_TTC_kPoints_bicycle_3=single(0),
  PCW_LX_TTC_kPoints_bicycle_4_V=uint8(0),
  PCW_LX_TTC_kPoints_bicycle_4=single(0),
  PCW_Buffer_7_V=uint8(0),
  PCW_Buffer_7=uint8(0),
  PCW_LX_TTC_kPoints_bicycle_5_V=uint8(0),
  PCW_LX_TTC_kPoints_bicycle_5=single(0),
  PCW_LX_TTC_kPoints_bicy_N_0_V=uint8(0),
  PCW_LX_TTC_kPoints_bicy_N_0=single(0),
  PCW_LX_TTC_kPoints_bicy_N_1_V=uint8(0),
  PCW_LX_TTC_kPoints_bicy_N_1=single(0),
  PCW_Buffer_8_V=uint8(0),
  PCW_Buffer_8=uint8(0),
  PCW_LX_TTC_kPoints_bicy_N_2_V=uint8(0),
  PCW_LX_TTC_kPoints_bicy_N_2=single(0),
  PCW_LX_TTC_kPoints_bicy_N_3_V=uint8(0),
  PCW_LX_TTC_kPoints_bicy_N_3=single(0),
  PCW_LX_TTC_kPoints_bicy_N_4_V=uint8(0),
  PCW_LX_TTC_kPoints_bicy_N_4=single(0),
  PCW_Buffer_9_V=uint8(0),
  PCW_Buffer_9=uint8(0),
  PCW_LX_TTC_kPoints_bicy_N_5_V=uint8(0),
  PCW_LX_TTC_kPoints_bicy_N_5=single(0),
  PCW_LX_speed_kneePoints_0_V=uint8(0),
  PCW_LX_speed_kneePoints_0=single(0),
  PCW_Buffer_10_V=uint8(0),
  PCW_Buffer_10=uint8(0),
  PCW_LX_speed_kneePoints_1_V=uint8(0),
  PCW_LX_speed_kneePoints_1=single(0),
  PCW_LX_speed_kneePoints_2_V=uint8(0),
  PCW_LX_speed_kneePoints_2=single(0),
  PCW_Buffer_11_V=uint8(0),
  PCW_Buffer_11=uint8(0),
  PCW_LX_speed_kneePoints_3_V=uint8(0),
  PCW_LX_speed_kneePoints_3=single(0),
  PCW_LX_speed_kneePoints_4_V=uint8(0),
  PCW_LX_speed_kneePoints_4=single(0),
  PCW_Buffer_12_V=uint8(0),
  PCW_Buffer_12=uint8(0),
  PCW_LX_speed_kneePoints_5_V=uint8(0),
  PCW_LX_speed_kneePoints_5=single(0),
  PCW_LX_speed_kPoint_bicycles_0_V=uint8(0),
  PCW_LX_speed_kPoint_bicycles_0=single(0),
  PCW_Buffer_13_V=uint8(0),
  PCW_Buffer_13=uint8(0),
  PCW_LX_speed_kPoint_bicycles_1_V=uint8(0),
  PCW_LX_speed_kPoint_bicycles_1=single(0),
  PCW_LX_speed_kPoint_bicycles_2_V=uint8(0),
  PCW_LX_speed_kPoint_bicycles_2=single(0),
  PCW_Buffer_14_V=uint8(0),
  PCW_Buffer_14=uint8(0),
  PCW_LX_speed_kPoint_bicycles_3_V=uint8(0),
  PCW_LX_speed_kPoint_bicycles_3=single(0),
  PCW_LX_speed_kPoint_bicycles_4_V=uint8(0),
  PCW_LX_speed_kPoint_bicycles_4=single(0),
  PCW_Buffer_15_V=uint8(0),
  PCW_Buffer_15=uint8(0),
  PCW_LX_speed_kPoint_bicycles_5_V=uint8(0),
  PCW_LX_speed_kPoint_bicycles_5=single(0),
  PCW_LX_speedParams_0_V=uint8(0),
  PCW_LX_speedParams_0=single(0),
  PCW_Buffer_16_V=uint8(0),
  PCW_Buffer_16=uint8(0),
  PCW_LX_speedParams_1_V=uint8(0),
  PCW_LX_speedParams_1=single(0),
  PCW_LX_speedParams_2_V=uint8(0),
  PCW_LX_speedParams_2=single(0),
  PCW_Buffer_17_V=uint8(0),
  PCW_Buffer_17=uint8(0),
  PCW_LX_speedParams_3_V=uint8(0),
  PCW_LX_speedParams_3=single(0),
  PCW_LX_currSide_0_V=uint8(0),
  PCW_LX_currSide_0=single(0),
  PCW_Buffer_18_V=uint8(0),
  PCW_Buffer_18=uint8(0),
  PCW_LX_currSide_1_V=uint8(0),
  PCW_LX_currSide_1=single(0),
  PCW_LX_currSide_2_V=uint8(0),
  PCW_LX_currSide_2=single(0),
  PCW_LX_currSide_3_V=uint8(0),
  PCW_LX_currSide_3=single(0),
  PCW_LX_crossingExpand_0_V=uint8(0),
  PCW_LX_crossingExpand_0=single(0),
  PCW_LX_crossingExpand_1_V=uint8(0),
  PCW_LX_crossingExpand_1=single(0),
  PCW_Buffer_19_V=uint8(0),
  PCW_Buffer_19=uint8(0),
  PCW_LX_crossingExpand_2_V=uint8(0),
  PCW_LX_crossingExpand_2=single(0),
  PCW_LX_crossingExpand_3_V=uint8(0),
  PCW_LX_crossingExpand_3=single(0),
  PCW_LX_crossingBicycleExp_0_V=uint8(0),
  PCW_LX_crossingBicycleExp_0=single(0),
  PCW_LX_crossingBicycleExp_1_V=uint8(0),
  PCW_LX_crossingBicycleExp_1=single(0),
  PCW_LX_crossingBicycleExp_2_V=uint8(0),
  PCW_LX_crossingBicycleExp_2=single(0),
  PCW_Buffer_20_V=uint8(0),
  PCW_Buffer_20=uint8(0),
  PCW_LX_crossingBicycleExp_3_V=uint8(0),
  PCW_LX_crossingBicycleExp_3=single(0),
  PCW_LX_predSide_0_V=uint8(0),
  PCW_LX_predSide_0=single(0),
  PCW_LX_predSide_1_V=uint8(0),
  PCW_LX_predSide_1=single(0),
  PCW_LX_predSide_2_V=uint8(0),
  PCW_LX_predSide_2=single(0),
  PCW_LX_predSide_3_V=uint8(0),
  PCW_LX_predSide_3=single(0),
  PCW_Buffer_21_V=uint8(0),
  PCW_Buffer_21=uint8(0),
  PCW_LX_bicycleSide_0_V=uint8(0),
  PCW_LX_bicycleSide_0=single(0),
  PCW_LX_bicycleSide_1_V=uint8(0),
  PCW_LX_bicycleSide_1=single(0),
  PCW_LX_bicycleSide_2_V=uint8(0),
  PCW_LX_bicycleSide_2=single(0),
  PCW_LX_bicycleSide_3_V=uint8(0),
  PCW_LX_bicycleSide_3=single(0),
  PCW_LX_MinPauseAfterWarn_V=uint8(0),
  PCW_LX_MinPauseAfterWarn=single(0),
  PCW_Buffer_22_V=uint8(0),
  PCW_Buffer_22=uint8(0),
  PCW_LX_MinSpeedForWarn_V=uint8(0),
  PCW_LX_MinSpeedForWarn=single(0),
  PCW_LX_MaxSpeedForWarn_V=uint8(0),
  PCW_LX_MaxSpeedForWarn=single(0),
  PCW_Buffer_23_V=uint8(0),
  PCW_Buffer_23=uint8(0),
  PCW_LX_brakingTTCReduction_V=uint8(0),
  PCW_LX_brakingTTCReduction=single(0),
  PCW_LX_maxYawRadPerSec_warn_V=uint8(0),
  PCW_LX_maxYawRadPerSec_warn=single(0),
  PCW_LX_maxWheelAngle_V=uint8(0),
  PCW_LX_maxWheelAngle=single(0),
  PCW_Buffer_24_V=uint8(0),
  PCW_Buffer_24=uint8(0),
  PCW_LX_TTC_kPoints_warn_far_0_V=uint8(0),
  PCW_LX_TTC_kPoints_warn_far_0=single(0),
  PCW_LX_TTC_kPoints_warn_far_1_V=uint8(0),
  PCW_LX_TTC_kPoints_warn_far_1=single(0),
  PCW_LX_TTC_kPoints_warn_far_2_V=uint8(0),
  PCW_LX_TTC_kPoints_warn_far_2=single(0),
  PCW_Buffer_25_V=uint8(0),
  PCW_Buffer_25=uint8(0),
  PCW_LX_TTC_kPoints_warn_far_3_V=uint8(0),
  PCW_LX_TTC_kPoints_warn_far_3=single(0),
  PCW_LX_TTC_kPoints_warn_far_4_V=uint8(0),
  PCW_LX_TTC_kPoints_warn_far_4=single(0),
  PCW_LX_TTC_kPoints_warn_far_5_V=uint8(0),
  PCW_LX_TTC_kPoints_warn_far_5=single(0),
  PCW_Buffer_26_V=uint8(0),
  PCW_Buffer_26=uint8(0),
  PCW_LX_TTC_kPoints_warn_n_0_V=uint8(0),
  PCW_LX_TTC_kPoints_warn_n_0=single(0),
  PCW_LX_TTC_kPoints_warn_n_1_V=uint8(0),
  PCW_LX_TTC_kPoints_warn_n_1=single(0),
  PCW_LX_TTC_kPoints_warn_n_2_V=uint8(0),
  PCW_LX_TTC_kPoints_warn_n_2=single(0),
  PCW_Buffer_27_V=uint8(0),
  PCW_Buffer_27=uint8(0),
  PCW_LX_TTC_kPoints_warn_n_3_V=uint8(0),
  PCW_LX_TTC_kPoints_warn_n_3=single(0),
  PCW_LX_TTC_kPoints_warn_n_4_V=uint8(0),
  PCW_LX_TTC_kPoints_warn_n_4=single(0),
  PCW_LX_TTC_kPoints_warn_n_5_V=uint8(0),
  PCW_LX_TTC_kPoints_warn_n_5=single(0),
  PCW_Buffer_28_V=uint8(0),
  PCW_Buffer_28=uint8(0),
  PCW_LX_TTC_kPoints_bi_F_0_V=uint8(0),
  PCW_LX_TTC_kPoints_bi_F_0=single(0),
  PCW_LX_TTC_kPoints_bi_F_1_V=uint8(0),
  PCW_LX_TTC_kPoints_bi_F_1=single(0),
  PCW_LX_TTC_kPoints_bi_F_2_V=uint8(0),
  PCW_LX_TTC_kPoints_bi_F_2=single(0),
  PCW_Buffer_29_V=uint8(0),
  PCW_Buffer_29=uint8(0),
  PCW_LX_TTC_kPoints_bi_F_3_V=uint8(0),
  PCW_LX_TTC_kPoints_bi_F_3=single(0),
  PCW_LX_TTC_kPoints_bi_F_4_V=uint8(0),
  PCW_LX_TTC_kPoints_bi_F_4=single(0),
  PCW_LX_TTC_kPoints_bi_F_5_V=uint8(0),
  PCW_LX_TTC_kPoints_bi_F_5=single(0),
  PCW_Buffer_30_V=uint8(0),
  PCW_Buffer_30=uint8(0),
  PCW_LX_TTC_kPoints_bi_N_0_V=uint8(0),
  PCW_LX_TTC_kPoints_bi_N_0=single(0),
  PCW_LX_TTC_kPoints_bi_N_1_V=uint8(0),
  PCW_LX_TTC_kPoints_bi_N_1=single(0),
  PCW_LX_TTC_kPoints_bi_N_2_V=uint8(0),
  PCW_LX_TTC_kPoints_bi_N_2=single(0),
  PCW_Buffer_31_V=uint8(0),
  PCW_Buffer_31=uint8(0),
  PCW_LX_TTC_kPoints_bi_N_3_V=uint8(0),
  PCW_LX_TTC_kPoints_bi_N_3=single(0),
  PCW_LX_TTC_kPoints_bi_N_4_V=uint8(0),
  PCW_LX_TTC_kPoints_bi_N_4=single(0),
  PCW_LX_TTC_kPoints_bi_N_5_V=uint8(0),
  PCW_LX_TTC_kPoints_bi_N_5=single(0),
  PCW_LX_DeactivateInNight_V=uint8(0),
  PCW_LX_DeactivateInNight=uint8(0),
  PCW_LX_adhereToGapSensitivity_V=uint8(0),
  PCW_LX_adhereToGapSensitivity=uint8(0),
  PCW_LX_warnOnBicycles_V=uint8(0),
  PCW_LX_warnOnBicycles=uint8(0),
  PCW_LX_SuppressByBrake_V=uint8(0),
  PCW_LX_SuppressByBrake=uint8(0),
  Reserved_1=uint8(0)))

EQ4_ISPC_HDR_PAR = AUTOSAR4.Parameter(struct(
  ISPC_Zero_byte=uint8(0),
  ISPC_Protocol_Version=uint8(0),
  ISPC_Optional_Signals=uint8(0),
  ISPC_Slow_Mode=uint8(0),
  Reserved_1=uint8(0)), SwCalibrationAccess="ReadWrite", DataType="Bus:EQ4_ISPC_HDR_BUS")

EQ4_ISPC_HDR_VAL = Simulink.Parameter(struct(
  ISPC_Zero_byte=uint8(0),
  ISPC_Protocol_Version=uint8(0),
  ISPC_Optional_Signals=uint8(0),
  ISPC_Slow_Mode=uint8(0),
  Reserved_1=uint8(0)))

EQ4_ISPTAC_HDR_PAR = AUTOSAR4.Parameter(struct(ISPTAC_Zero_byte=uint8(0), ISPTAC_Protocol_Version=uint8(0), ISPTAC_Optional_Signals=uint8(0)), SwCalibrationAccess="ReadWrite", DataType="Bus:EQ4_ISPTAC_HDR_BUS")
EQ4_ISPTAC_HDR_VAL = Simulink.Parameter(struct(ISPTAC_Zero_byte=uint8(0), ISPTAC_Protocol_Version=uint8(0), ISPTAC_Optional_Signals=uint8(0)))

EQ4_ITAC_HDR_PAR = AUTOSAR4.Parameter(struct(
  TAC_Zero_byte=uint8(0),
  TAC_Protocol_Version=uint8(0),
  TAC_Optional_Signals=uint8(0),
  TAC_Mode=uint8(0),
  TAC_BottomLeftSquare_0=uint8(0),
  TAC_BottomLeftSquare_1=uint8(0),
  TAC_BottomLeftSquare_2=uint8(0),
  TAC_TargetInfo_Lat_Distance_0=single(0),
  Reserved_1=uint8(0),
  TAC_TargetInfo_Lat_Distance_1=single(0),
  TAC_TargetInfo_Lat_Distance_2=single(0),
  TAC_TargetInfo_Height_0=single(0),
  TAC_TargetInfo_Height_1=single(0),
  TAC_TargetInfo_Height_2=single(0),
  TAC_Camera_Height=single(0),
  TAC_Camera_Z=single(0),
  TAC_Max_Horizon=int8(0),
  TAC_Min_Horizon=int8(0),
  TAC_Max_Yaw=uint8(0),
  TAC_Min_Yaw=int8(0),
  TAC_Max_RollAngle=single(0),
  Reserved_2=uint8(0),
  TAC_SquareSideSize=single(0),
  TAC_Bottom=int8(0),
  TAC_Targets_Num=uint8(0),
  Reserved_3=uint8(0)), SwCalibrationAccess="ReadWrite", DataType="Bus:EQ4_ITAC_HDR_BUS")

EQ4_ITAC_HDR_VAL = Simulink.Parameter(struct(
  TAC_Zero_byte=uint8(0),
  TAC_Protocol_Version=uint8(0),
  TAC_Optional_Signals=uint8(0),
  TAC_Mode=uint8(0),
  TAC_BottomLeftSquare_0=uint8(0),
  TAC_BottomLeftSquare_1=uint8(0),
  TAC_BottomLeftSquare_2=uint8(0),
  TAC_TargetInfo_Lat_Distance_0=single(0),
  Reserved_1=uint8(0),
  TAC_TargetInfo_Lat_Distance_1=single(0),
  TAC_TargetInfo_Lat_Distance_2=single(0),
  TAC_TargetInfo_Height_0=single(0),
  TAC_TargetInfo_Height_1=single(0),
  TAC_TargetInfo_Height_2=single(0),
  TAC_Camera_Height=single(0),
  TAC_Camera_Z=single(0),
  TAC_Max_Horizon=int8(0),
  TAC_Min_Horizon=int8(0),
  TAC_Max_Yaw=uint8(0),
  TAC_Min_Yaw=int8(0),
  TAC_Max_RollAngle=single(0),
  Reserved_2=uint8(0),
  TAC_SquareSideSize=single(0),
  TAC_Bottom=int8(0),
  TAC_Targets_Num=uint8(0),
  Reserved_3=uint8(0)))

EQ4_IVISION_HDR_PAR = AUTOSAR4.Parameter(struct(IVISION_Zero_Byte=uint8(0), IVISION_Protocol_Version=uint8(0), IVISION_Optional_Signals=uint8(0)), SwCalibrationAccess="ReadWrite", DataType="Bus:EQ4_IVISION_HDR_BUS")
EQ4_IVISION_HDR_VAL = Simulink.Parameter(struct(IVISION_Zero_Byte=uint8(0), IVISION_Protocol_Version=uint8(0), IVISION_Optional_Signals=uint8(0)))

EQ4_CIN_BUS = Simulink.Bus()
  EQ4_CIN_HDR: Bus: EQ4_CIN_HDR_BUS

EQ4_IC2C_BUS = Simulink.Bus()
  EQ4_IC2C_HDR: Bus: EQ4_IC2C_HDR_BUS

EQ4_IC2C_HDR_BUS = Simulink.Bus()
  IC2C_Zero_Byte: uint8
  IC2C_Protocol_Version: uint8  % Protocol Version
  IC2C_Optional_Signals: uint8
  IC2C_Sensor_ID: uint32  % Camera sensorID
  IC2C_Cam_Type: uint8  % Represent the type of the camera
  Reserved_1: uint8
  IC2C_Tx: single  % Translation vector X
  IC2C_Ty: single  % Translation vector Y
  IC2C_Tz: single  % Translation vector Z
  IC2C_R11: single  % Rotation Matrix R11
  IC2C_R12: single  % Rotation Matrix R12
  IC2C_R13: single  % Rotation Matrix R13
  IC2C_R21: single  % Rotation Matrix R21
  IC2C_R22: single  % Rotation Matrix R22
  IC2C_R23: single  % Rotation Matrix R23
  IC2C_R31: single  % Rotation Matrix R31
  IC2C_R32: single  % Rotation Matrix R32
  IC2C_R33: single  % Rotation Matrix R33

EQ4_ICAM_BUS = Simulink.Bus()
  EQ4_ICAM_HDR: Bus: EQ4_ICAM_HDR_BUS

EQ4_ICAM_HDR_BUS = Simulink.Bus()
  INIT_Cam_Zero_Byte: uint8
  INIT_Cam_Protocol_Version: uint8  % Protocol Version
  INIT_Cam_Optional_Signals: uint8
  INIT_Cam_Buffer_1_V: uint8
  INIT_Cam_Buffer_1: uint8
  INIT_Cam_Sensor_ID_P1_V: uint8  % Validate using  INIT_Cam_Sensor_ID value_1  in init process
  INIT_Cam_Sensor_ID_P1: uint64  % Remote Camera Sensor ID. ID size is 64 byte. Each part include 8 bytes of the full ID.
  INIT_Cam_Buffer_2_V: uint8
  INIT_Cam_Buffer_2: uint8
  INIT_Cam_Sensor_ID_P2_V: uint8  % Validate using  INIT_Cam_Sensor_ID value_2  in init process
  INIT_Cam_Sensor_ID_P2: uint64  % Remote Camera Sensor ID. ID size is 64 byte. Each part include 8 bytes of the full ID.
  INIT_Cam_Buffer_3_V: uint8
  INIT_Cam_Buffer_3: uint8
  INIT_Cam_Sensor_ID_P3_V: uint8  % Validate using  INIT_Cam_Sensor_ID value_3  in init process
  INIT_Cam_Sensor_ID_P3: uint64  % Remote Camera Sensor ID. ID size is 64 byte. Each part include 8 bytes of the full ID.
  INIT_Cam_Buffer_4_V: uint8
  INIT_Cam_Buffer_4: uint8
  INIT_Cam_Sensor_ID_P4_V: uint8  % Validate using  INIT_Cam_Sensor_ID value_4  in init process
  INIT_Cam_Sensor_ID_P4: uint64  % Remote Camera Sensor ID. ID size is 64 byte. Each part include 8 bytes of the full ID.
  INIT_Cam_Buffer_5_V: uint8
  INIT_Cam_Buffer_5: uint8
  INIT_Cam_Sensor_ID_P5_V: uint8  % Validate using  INIT_Cam_Sensor_ID value_5  in init process
  INIT_Cam_Sensor_ID_P5: uint64  % Remote Camera Sensor ID. ID size is 64 byte. Each part include 8 bytes of the full ID.
  INIT_Cam_Buffer_6_V: uint8
  INIT_Cam_Buffer_6: uint8
  INIT_Cam_Sensor_ID_P6_V: uint8  % Validate using  INIT_Cam_Sensor_ID value_6  in init process
  INIT_Cam_Sensor_ID_P6: uint64  % Remote Camera Sensor ID. ID size is 64 byte. Each part include 8 bytes of the full ID.
  INIT_Cam_Buffer_7_V: uint8
  INIT_Cam_Buffer_7: uint8
  INIT_Cam_Sensor_ID_P7_V: uint8  % Validate using  INIT_Cam_Sensor_ID value_7  in init process
  INIT_Cam_Sensor_ID_P7: uint64  % Remote Camera Sensor ID. ID size is 64 byte. Each part include 8 bytes of the full ID.
  INIT_Cam_Buffer_8_V: uint8
  INIT_Cam_Buffer_8: uint8
  INIT_Cam_Sensor_ID_P8_V: uint8  % Validate using  INIT_Cam_Sensor_ID value_8  in init process
  INIT_Cam_Sensor_ID_P8: uint64  % Remote Camera Sensor ID. ID size is 64 byte. Each part include 8 bytes of the full ID.
  INIT_Cam_Buffer_9_V: uint8
  INIT_Cam_Buffer_9: uint8
  INIT_Cam_EPROM_CRC_V: uint8  % Validate using  Validate using INIT_Cam_EPROM_CRC value  in init process value  in init process
  INIT_Cam_EPROM_CRC: uint32  % CRC on the EPROM Data
  INIT_Cam_Type: uint8  % Represent the type of the camera
  INIT_Cam_distortionModelType: uint8  % The distortion model type number for the main lens
  Reserved_1: uint8
  INIT_Cam_CODX: double  % Distortion parameter 0 - the x location of the centre of distortion in the main lens image
  INIT_Cam_CODY: double  % Distortion parameter 1 - the y location of the centre of distortion in the main lens image
  INIT_Cam_distorParams0: double  % Distortion parameter 3 - Extra Distortion parameters for the main lens image
  INIT_Cam_distorParams1: double  % Distortion parameter 4 - Extra Distortion parameters for the main lens image
  INIT_Cam_distorParams2: double  % Distortion parameter 5 - Extra Distortion parameters for the main lens image
  INIT_Cam_distorParams3: double  % Distortion parameter 6 - Extra Distortion parameters for the main lens image
  INIT_Cam_distorParams4: double  % Distortion parameter 7 - Extra Distortion parameters for the main lens image
  INIT_Cam_distorParams5: double  % Distortion parameter 8 - Extra Distortion parameters for the main lens image
  INIT_Cam_distorParams6: double  % Distortion parameter 9 - Extra Distortion parameters for the main lens image
  INIT_Cam_distorParams7: double  % Distortion parameter 10 - Extra Distortion parameters for the main lens image
  INIT_Cam_distorParams8: double  % Distortion parameter 11 - Extra Distortion parameters for the main lens image
  INIT_Cam_distorParams9: double  % Distortion parameter 12 - Extra Distortion parameters for the main lens image
  INIT_Cam_distorParams10: double  % Distortion parameter 13 - Extra Distortion parameters for the main lens image
  INIT_Cam_distorParams11: double  % Distortion parameter 14 - Extra Distortion parameters for the main lens image
  INIT_Cam_distorParams12: double  % Distortion parameter 15 - Extra Distortion parameters for the main lens image
  INIT_Cam_distorParams13: double  % Distortion parameter 16 - Extra Distortion parameters for the main lens image
  INIT_Cam_distorParams14: double  % Distortion parameter 17 - Extra Distortion parameters for the main lens image
  INIT_Cam_distorParams15: double  % Distortion parameter 18 - Extra Distortion parameters for the main lens image
  INIT_Cam_FocalLengthX: double  % Focal length of the main lens in the x direction
  INIT_Cam_FocalLengthY: double  % Focal length of the main lens in the x direction
  INIT_Cam_Skew: double  % The main lens bore sight point error in the x direction
  INIT_Cam_PrincipalPointX: double  % The main lens bore sight point error in the x direction
  INIT_Cam_PrincipalPointY: double  % The main lens bore sight point error in the y direction

EQ4_IDEBUG_BUS = Simulink.Bus()
  EQ4_IDEBUG_HDR: Bus: EQ4_IDEBUG_HDR_BUS

EQ4_IDEBUG_HDR_BUS = Simulink.Bus()
  IDebug_Zero_Byte: uint8
  IDebug_Protocol_Version: uint8  % Version number of the initialization message
  IDebug_Optional_Signals: uint8
  IDebug_Construction_Area: uint8  % True is to enable Construction Aread elements debug
  IDebug_Free_Space: uint8  % True is to enable free spce element debug (not yet supported)
  IDebug_Hazards: uint8  % True is to enable Hazards elements debug
  IDebug_INTP: uint8  % True is to enable INTP element debug (ID Only Px not yet supported)
  IDebug_Land_Marks: uint8  % True is to enable Land Markselements debug
  IDebug_Lane_marks: uint8  % True is to enableHost and Adjacent Lane marks elements debug (ID Only Px not yet supported)
  IDebug_Light_Scene: uint8  % True is to enable VCL RFL and STL elements debug (not yet supported)
  IDebug_Objects: uint8  % True is to enable Objects elements debug
  IDebug_Semantic_Crossing: uint8  % True is to enable semantic Crossing elements debug
  IDebug_Semantic_Lines: uint8  % True is to enable semantic Lines elements debug
  IDebug_Semantic_Marks: uint8  % True is to enable semantic Marks elements debug
  IDebug_TFL_Structure: uint8  % True is to enable TFL Structure Elements debug
  IDebug_TFL_Spots: uint8  % True is to enable TFL Spots Element debug
  IDebug_Traffic_Signs: uint8  % True is to enableTraffic Signs elements debug
  IDebug_DSTraffic_Signs: uint8  % True is to enableDSTraffic Signs elements debug
  IDebug_Semantic_Junction: uint8  % True is to enableSemantic_Junction elements debug
  Reserved_1: uint8

EQ4_IDV_BUS = Simulink.Bus()
  EQ4_IDV_HDR: Bus: EQ4_IDV_HDR_BUS

EQ4_IDV_HDR_BUS = Simulink.Bus()
  IDV_Zero_byte: uint8
  IDV_Protocol_Version: uint8
  IDV_Optional_Signals: uint8  % All signals are requierd

EQ4_IENV_BUS = Simulink.Bus()
  EQ4_IENV_HDR: Bus: EQ4_IENV_HDR_BUS

EQ4_IENV_HDR_BUS = Simulink.Bus()
  IEnvironment_Zero_Byte: uint8
  IEnvironment_Protocol_Version: uint8
  IEnvironment_Optional_Signals: uint8
  IEnvironment_GPSToCam_dx_V: uint8  % Validate using IEnvironment_GPSToCam_dx value  in init process
  IEnvironment_GPSToCam_dx: single  % GPS location relative to camera in the dx axis - x axis points to right of the vehicle
  IEnvironment_Buffer1_V: uint8
  IEnvironment_Buffer1: uint8
  IEnvironment_GPSToCam_dy_V: uint8  % Validate using IEnvironment_GPSToCam_dy value  in init process
  IEnvironment_GPSToCam_dy: single  % GPS location relative to camera in the dy axis - y axis points up
  IEnvironment_GPSToCam_dz_V: uint8  % Validate using IEnvironment_GPSToCam_dz value  in init process
  IEnvironment_GPSToCam_dz: single  % GPS location relative to camera in the dz axis - z axis points to front of the vehicle
  IEnvironment_WheelWidth: single  % the width of the wheel that is used to work out the center of the driving tube for the road surface profile functions.  Mark for transfer to coding
  Reserved_1: uint8
  IEnvironment_WheelRadius: single  % height of the center of the axles from the ground
  IEnvironment_LeftWheel: single  % Distance from main camera to left wheel. Use this in conjunction with rightWheel to populate the distance to center of vehicle
  Reserved_2: uint8
  IEnvironment_RightWheel: single  % Distance from main camera to right wheel. Use this in conjunction with leftWheel to populate the distance to center of vehicle
  IEnvironment_RefPX_Front_Bumper: single  % Set to the distance offset from camera to front bumper.
  IEnvironment_CamToFrontAxle: single  % the longitudinal distance from the camera to the datum of reference for the road surface profile functions and LDW..  Mark for transfer to coding
  IEnvironment_CamToRearAxle: single  % longitudinal distance from the camera to the rear axle
  IEnvironment_MinHorizon: int16  % Minimum horizon value  in Level -2 (full resolution 1280,960)
  IEnvironment_MaxHorizon: int16  % Maximum horizon value in Level -2 (full resolution 1280,960)
  IEnvironment_MinYaw: int8  % Minimum YAW value in Level -2 (full resultion 1280,960)
  IEnvironment_MaxYaw: uint8  % Maximum YAW value in Level -2 (full resolution 1280,960)
  IEnvironment_MaxRoll: single  % Maximum Roll value in Radians
  IEnvironment_Top_Crop: uint8  % Number of pixels to crop from top of Image. 0,0 as center of image. Pixels in level 0 (320,240)
  IEnvironment_Bottom_Crop: int16  % Number of pixels to crop from bottom of Image. 0,0 as center of image. Pixels in level 0 (320,240)
  Reserved_3: uint8

EQ4_IGENERAL_BUS = Simulink.Bus()
  EQ4_IGENERAL_HDR: Bus: EQ4_IGENERAL_HDR_BUS

EQ4_IGENERAL_HDR_BUS = Simulink.Bus()
  IGeneral_Zero_Byte: uint8
  IGeneral_Protocol_Version: uint8  % Version number of the initialization message
  IGeneral_Optional_Signals: uint8
  IGeneral_Buffer_1_V: uint8
  IGeneral_Buffer_1: uint8
  IGeneral_Roll_Angle_Base_V: uint8  % Validate using Roll_Angle_Base value  in init process
  IGeneral_Roll_Angle_Base: single  % The angle the camera is rotated about the vehicle longitudinal axis.  A positive value indicates camera roll to the right when viewed from inside the vehicle.
  IGeneral_CLB_DYN_AF_Pitch_V: uint8  % Validate using CLB_DYN_AF_Pitch value  in init process
  IGeneral_CLB_DYN_AF_Pitch: int16  % Measured in Level -2 relative to center of image.
    % Min Horizon <= Horizon and
    % (Horizon + autoFix_Horizon)  <= Max Horizon
    % Mapped to horizonFull in camera.conf
  IGeneral_CLB_DYN_AF_Yaw_V: uint8  % Validate using _CLB_DYN_AF_Yaw value  in init process
  IGeneral_CLB_DYN_AF_Yaw: int16  % Measured in Level -2 relative to center of image.
    % Min Yaw <= Yaw and
    % (yaw + autfix_yaw) <= Max Yaw
    % Mapped to yawFull in camera.conf
  IGeneral_CLB_DYN_AF_Roll_V: uint8  % Validate using CLB_DYN_AF_Roll value  in init process
  IGeneral_CLB_DYN_AF_Roll: single  % The angle the camera is rotated about the vehicle longitudinal axis.  A positive value indicates camera roll to the right when viewed from inside the vehicle.
  IGeneral_Region_Code: uint8  % Enable usage of specific customization for different countries.
    % Should be changed only after ME approval.
  IGeneral_Driving_Side: uint8  % Indicates if we are in left hand drive or right hand drive road. The default is right side. New values are sent in the Common protocol, and should be used here.
  IGeneral_HIL_Mode: uint8  % set the system to work in HIL (hardware in the loop) mode (image instead of camera video.)
  IGeneral_Cam_Height_Full: single  % Height of main camera above ground.
  Reserved_1: uint8
  IGeneral_Pitch_Base: int16  % Measured in Level -2 relative to center of image.
    % Min Horizon <= Horizon and
    % (Horizon + autoFix_Horizon)  <= Max Horizon
    % Mapped to horizonFull in camera.conf
  IGeneral_Yaw_Base: int16  % Measured in Level -2 relative to center of image.
    % Min Yaw <= Yaw and
    % (yaw + autfix_yaw) <= Max Yaw
    % Mapped to yawFull in camera.conf
  IGeneral_Camera_Height_Base: single  % Add a new baseline camera height signal to the General Init message to allow the customer to send the CAD value of the camera height. This will be used in the future for validating the calibrated camera height for safety purposes.
  Reserved_2: uint8

EQ4_IIPB_BUS = Simulink.Bus()
  EQ4_IIPB_HDR: Bus: EQ4_IIPB_HDR_BUS

EQ4_IIPB_EXT_BUS = Simulink.Bus()
  EQ4_IIPB_EXT_HDR: Bus: EQ4_IIPB_EXT_HDR_BUS

EQ4_IIPB_EXT_HDR_BUS = Simulink.Bus()
  IIPB_EXT_Zero_byte: uint8
  IIPB_EXT_Protocol_Version: uint8
  IIPB_EXT_Optional_Signals: uint8  % Number of optional signals (has validator bit)
  Reserved_1: uint8
  TTB_baseReactionTimeFar: single  % Early base reaction time threshold for issuing the alert (the time required for the driver to start braking before the latest braking point is reached).
  TTB_baseReactionTimeMedium: single  % Medium base reaction time threshold for issuing the alert (the time required for the driver to start braking before the latest braking point is reached).
  TTB_baseReactionTimeNear: single  % Late base reaction time threshold for issuing the alert (the time required for the driver to start braking before the latest braking point is reached).
  TTB_Dist_Fact_Tgt_Str_Brk_0: single  % Scale factor for the TTB base reaction time dependent on target distance when the target is braking with a deceleration >~6 m/s2
  TTB_Dist_Fact_Tgt_Str_Brk_1: single  % Scale factor for the TTB base reaction time dependent on target distance when the target is braking with a deceleration >~6 m/s2
  TTB_Dist_Fact_Tgt_Str_Brk_2: single  % Scale factor for the TTB base reaction time dependent on target distance when the target is braking with a deceleration >~6 m/s2
  TTB_Dist_Fact_Tgt_Str_Brk_3: single  % Scale factor for the TTB base reaction time dependent on target distance when the target is braking with a deceleration >~6 m/s2
  TTB_Dist_Fact_kneepoints_0: uint8  % Distance knee points for TTB_Distance_Factor
  TTB_Dist_Fact_kneepoints_1: uint8  % Distance knee points for TTB_Distance_Factor
  TTB_Dist_Fact_kneepoints_2: uint8  % Distance knee points for TTB_Distance_Factor
  TTB_Dist_Fact_kneepoints_3: uint8  % Distance knee points for TTB_Distance_Factor
  TTB_EgoSp_Fact_Stationary_0: single  % Scale factor for the TTB base reaction time for stationary objects based on the speed of the host vehicle.
  TTB_EgoSp_Fact_Stationary_1: single  % Scale factor for the TTB base reaction time for stationary objects based on the speed of the host vehicle.
  TTB_EgoSp_Fact_Stationary_2: single  % Scale factor for the TTB base reaction time for stationary objects based on the speed of the host vehicle.
  TTB_EgoSp_Fact_Stationary_3: single  % Scale factor for the TTB base reaction time for stationary objects based on the speed of the host vehicle.
  TTB_EgoSp_Fact_Stationary_4: single  % Scale factor for the TTB base reaction time for stationary objects based on the speed of the host vehicle.
  TTB_EgoSp_Fact_Stationary_5: single  % Scale factor for the TTB base reaction time for stationary objects based on the speed of the host vehicle.
  TTB_EgoSp_Fact_Moving_0: single  % Scale factor for the TTB base reaction time for moving and stopped objects based on the speed of the host vehicle.
  TTB_EgoSp_Fact_Moving_1: single  % Scale factor for the TTB base reaction time for moving and stopped objects based on the speed of the host vehicle.
  TTB_EgoSp_Fact_Moving_2: single  % Scale factor for the TTB base reaction time for moving and stopped objects based on the speed of the host vehicle.
  TTB_EgoSp_Fact_Moving_3: single  % Scale factor for the TTB base reaction time for moving and stopped objects based on the speed of the host vehicle.
  TTB_EgoSp_Fact_Moving_4: single  % Scale factor for the TTB base reaction time for moving and stopped objects based on the speed of the host vehicle.
  TTB_EgoSp_Fact_Moving_5: single  % Scale factor for the TTB base reaction time for moving and stopped objects based on the speed of the host vehicle.
  TTB_EgoSp_Fact_Follow_Brk_0: single  % Scale factor for the TTB base reaction time for decelerating objects (> ~1.5 m/s2) based on the speed of the host vehicle.
  TTB_EgoSp_Fact_Follow_Brk_1: single  % Scale factor for the TTB base reaction time for decelerating objects (> ~1.5 m/s2) based on the speed of the host vehicle.
  TTB_EgoSp_Fact_Follow_Brk_2: single  % Scale factor for the TTB base reaction time for decelerating objects (> ~1.5 m/s2) based on the speed of the host vehicle.
  TTB_EgoSp_Fact_Follow_Brk_3: single  % Scale factor for the TTB base reaction time for decelerating objects (> ~1.5 m/s2) based on the speed of the host vehicle.
  TTB_EgoSp_Fact_Follow_Brk_4: single  % Scale factor for the TTB base reaction time for decelerating objects (> ~1.5 m/s2) based on the speed of the host vehicle.
  TTB_EgoSp_Fact_Follow_Brk_5: single  % Scale factor for the TTB base reaction time for decelerating objects (> ~1.5 m/s2) based on the speed of the host vehicle.
  TTB_EgoSp_Fact_Kneepoints_0: single  % Speed knee points for TTB_Ego_Speed_Factor
    % NOTE: array elements must be in increasing order
  TTB_EgoSp_Fact_Kneepoints_1: single  % Speed knee points for TTB_Ego_Speed_Factor
    % NOTE: array elements must be in increasing order
  TTB_EgoSp_Fact_Kneepoints_2: single  % Speed knee points for TTB_Ego_Speed_Factor
    % NOTE: array elements must be in increasing order
  TTB_EgoSp_Fact_Kneepoints_3: single  % Speed knee points for TTB_Ego_Speed_Factor
    % NOTE: array elements must be in increasing order
  TTB_EgoSp_Fact_Kneepoints_4: single  % Speed knee points for TTB_Ego_Speed_Factor
    % NOTE: array elements must be in increasing order
  TTB_EgoSp_Fact_Kneepoints_5: single  % Speed knee points for TTB_Ego_Speed_Factor
    % NOTE: array elements must be in increasing order
  TTB_Att_Factor_Stationary_0: single  % Scale factor for the TTB base reaction time for stationary objects based on the computed driver attention communicated in HR_IN_CAR_SIGNALS.DriverAwareness
  TTB_Att_Factor_Stationary_1: single  % Scale factor for the TTB base reaction time for stationary objects based on the computed driver attention communicated in HR_IN_CAR_SIGNALS.DriverAwareness
  TTB_Att_Factor_Stationary_2: single  % Scale factor for the TTB base reaction time for stationary objects based on the computed driver attention communicated in HR_IN_CAR_SIGNALS.DriverAwareness
  TTB_Att_Factor_Stationary_3: single  % Scale factor for the TTB base reaction time for stationary objects based on the computed driver attention communicated in HR_IN_CAR_SIGNALS.DriverAwareness
  TTB_Att_Factor_Moving_0: single  % Scale factor for the TTB base reaction time for moving and stopped objects based on the computed driver attention communicated in HR_IN_CAR_SIGNALS.DriverAwareness
  TTB_Att_Factor_Moving_1: single  % Scale factor for the TTB base reaction time for moving and stopped objects based on the computed driver attention communicated in HR_IN_CAR_SIGNALS.DriverAwareness
  TTB_Att_Factor_Moving_2: single  % Scale factor for the TTB base reaction time for moving and stopped objects based on the computed driver attention communicated in HR_IN_CAR_SIGNALS.DriverAwareness
  TTB_Att_Factor_Moving_3: single  % Scale factor for the TTB base reaction time for moving and stopped objects based on the computed driver attention communicated in HR_IN_CAR_SIGNALS.DriverAwareness
  TTB_Att_Factr_Follw_Brake_0: single  % Scale factor for the TTB base reaction time for decelerating objects (> ~1.5 m/s2) based on the computed driver attention communicated in HR_IN_CAR_SIGNALS.DriverAwareness
  TTB_Att_Factr_Follw_Brake_1: single  % Scale factor for the TTB base reaction time for decelerating objects (> ~1.5 m/s2) based on the computed driver attention communicated in HR_IN_CAR_SIGNALS.DriverAwareness
  TTB_Att_Factr_Follw_Brake_2: single  % Scale factor for the TTB base reaction time for decelerating objects (> ~1.5 m/s2) based on the computed driver attention communicated in HR_IN_CAR_SIGNALS.DriverAwareness
  TTB_Att_Factr_Follw_Brake_3: single  % Scale factor for the TTB base reaction time for decelerating objects (> ~1.5 m/s2) based on the computed driver attention communicated in HR_IN_CAR_SIGNALS.DriverAwareness
  TTB_Att_Factor_Kneepoints_0: single  % Driver attention knee points for TTB_Attention_Factor
    % NOTE: array elements must be in increasing order
  TTB_Att_Factor_Kneepoints_1: single  % Driver attention knee points for TTB_Attention_Factor
    % NOTE: array elements must be in increasing order
  TTB_Att_Factor_Kneepoints_2: single  % Driver attention knee points for TTB_Attention_Factor
    % NOTE: array elements must be in increasing order
  TTB_Att_Factor_Kneepoints_3: single  % Driver attention knee points for TTB_Attention_Factor
    % NOTE: array elements must be in increasing order
  TTS_baseReactionTimeFar: single  % Early base reaction time threshold for issuing the alert based on TTS (the time available for the driver to avoid the accident with steering before the latest steering point is reached).
  TTS_baseReactionTimeMedium: single  % Medium base reaction time threshold for issuing the alert based on TTS (the time available for the driver to avoid the accident with steering before the latest steering point is reached).
  TTS_baseReactionTimeNear: single  % Late base reaction time threshold for issuing the alert based on TTS (the time available for the driver to avoid the accident with steering before the latest steering point is reached).
  TTS_Attention_Factor_0: single  % Scale factor for the TTS base reaction time based on the computed driver attention communicated in HR_IN_CAR_SIGNALS.DriverAwareness.
  TTS_Attention_Factor_1: single  % Scale factor for the TTS base reaction time based on the computed driver attention communicated in HR_IN_CAR_SIGNALS.DriverAwareness.
  TTS_Attention_Factor_2: single  % Scale factor for the TTS base reaction time based on the computed driver attention communicated in HR_IN_CAR_SIGNALS.DriverAwareness.
  TTS_Attention_Factor_3: single  % Scale factor for the TTS base reaction time based on the computed driver attention communicated in HR_IN_CAR_SIGNALS.DriverAwareness.
  TTS_Att_Fact_Kneepoints_0: single  % Driver attention knee points for TTS_Attention_Factor
    % NOTE: array elements must be in increasing order
  TTS_Att_Fact_Kneepoints_1: single  % Driver attention knee points for TTS_Attention_Factor
    % NOTE: array elements must be in increasing order
  TTS_Att_Fact_Kneepoints_2: single  % Driver attention knee points for TTS_Attention_Factor
    % NOTE: array elements must be in increasing order
  TTS_Att_Fact_Kneepoints_3: single  % Driver attention knee points for TTS_Attention_Factor
    % NOTE: array elements must be in increasing order
  AEB_ayAvoid_EgoSpeed_0: uint8  % Knee points for AEB_ayAvoid_LatAcc based on host vehicle speed
  AEB_ayAvoid_EgoSpeed_1: uint8  % Knee points for AEB_ayAvoid_LatAcc based on host vehicle speed
  AEB_ayAvoid_EgoSpeed_2: uint8  % Knee points for AEB_ayAvoid_LatAcc based on host vehicle speed
  AEB_ayAvoid_EgoSpeed_3: uint8  % Knee points for AEB_ayAvoid_LatAcc based on host vehicle speed
  AEB_ayAvoid_LatAcc_0: single  % Lateral acceleration mission profile at different speeds for TTS computation
  AEB_ayAvoid_LatAcc_1: single  % Lateral acceleration mission profile at different speeds for TTS computation
  AEB_ayAvoid_LatAcc_2: single  % Lateral acceleration mission profile at different speeds for TTS computation
  AEB_ayAvoid_LatAcc_3: single  % Lateral acceleration mission profile at different speeds for TTS computation
  FCW_ayAvoid_EgoSpeed_0: single  % Knee points for FCW_ayAvoid_LatAcc based on host vehicle speed
  FCW_ayAvoid_EgoSpeed_1: single  % Knee points for FCW_ayAvoid_LatAcc based on host vehicle speed
  FCW_ayAvoid_EgoSpeed_2: single  % Knee points for FCW_ayAvoid_LatAcc based on host vehicle speed
  FCW_ayAvoid_EgoSpeed_3: single  % Knee points for FCW_ayAvoid_LatAcc based on host vehicle speed
  FCW_ayAvoid_LatAcc_0: single  % Lateral acceleration mission profile at different speeds for TTS computation
  FCW_ayAvoid_LatAcc_1: single  % Lateral acceleration mission profile at different speeds for TTS computation
  FCW_ayAvoid_LatAcc_2: single  % Lateral acceleration mission profile at different speeds for TTS computation
  FCW_ayAvoid_LatAcc_3: single  % Lateral acceleration mission profile at different speeds for TTS computation
  AEB_decel_reduction_0: single  % TTC reduction values based on the deceleration of the host vehicle whilst the brake pedal is pressed - for AEB Alerts
    % NOTE: array elements must be in decreasing order
  AEB_decel_reduction_1: single  % TTC reduction values based on the deceleration of the host vehicle whilst the brake pedal is pressed - for AEB Alerts
    % NOTE: array elements must be in decreasing order
  AEB_decel_reduction_2: single  % TTC reduction values based on the deceleration of the host vehicle whilst the brake pedal is pressed - for AEB Alerts
    % NOTE: array elements must be in decreasing order
  AEB_deceleration_0: single  % Deceleration rates knee points for AEB_deceleration_reduction_setX
    % NOTE: array elements must be in increasing order
  AEB_deceleration_1: single  % Deceleration rates knee points for AEB_deceleration_reduction_setX
    % NOTE: array elements must be in increasing order
  AEB_deceleration_2: single  % Deceleration rates knee points for AEB_deceleration_reduction_setX
    % NOTE: array elements must be in increasing order
  FCW_decel_reduction_0: single  % TTC reduction values based on the deceleration of the host vehicle whilst the brake pedal is pressed - for FCW Alerts
    % NOTE: array elements must be in decreasing order
  FCW_decel_reduction_1: single  % TTC reduction values based on the deceleration of the host vehicle whilst the brake pedal is pressed - for FCW Alerts
    % NOTE: array elements must be in decreasing order
  FCW_decel_reduction_2: single  % TTC reduction values based on the deceleration of the host vehicle whilst the brake pedal is pressed - for FCW Alerts
    % NOTE: array elements must be in decreasing order
  FCW_deceleration_0: single  % Deceleration rates knee points for FCW_deceleration_reduction_setX
    % NOTE: array elements must be in increasing order
  FCW_deceleration_1: single  % Deceleration rates knee points for FCW_deceleration_reduction_setX
    % NOTE: array elements must be in increasing order
  FCW_deceleration_2: single  % Deceleration rates knee points for FCW_deceleration_reduction_setX
    % NOTE: array elements must be in increasing order
  Dr_Brking_Offset_Factor: single  % Scale factor for the driver braking offset TTC reduction values
  Reserved_2: uint8
  Overlap_Offset_Factor: single  % Scale factor for the overlap TTC reduction values
  Brake1_Max_Deceleration_0: single  % Deceleration requested during the Brake 1 stage dependent on host vehicle speed.
  Brake1_Max_Deceleration_1: single  % Deceleration requested during the Brake 1 stage dependent on host vehicle speed.
  Brake1_Max_Deceleration_2: single  % Deceleration requested during the Brake 1 stage dependent on host vehicle speed.
  Brake1_Max_Deceleration_3: single  % Deceleration requested during the Brake 1 stage dependent on host vehicle speed.
  Brk_Max_Decel_Kneepts_0: uint8  % Speed knee points for Brake1_Decel , Brake2_Max_Deceleration and Brake3_Decel_setX
    % NOTE: array elements must be in increasing order
  Brk_Max_Decel_Kneepts_1: uint8  % Speed knee points for Brake1_Decel , Brake2_Max_Deceleration and Brake3_Decel_setX
    % NOTE: array elements must be in increasing order
  Brk_Max_Decel_Kneepts_2: uint8  % Speed knee points for Brake1_Decel , Brake2_Max_Deceleration and Brake3_Decel_setX
    % NOTE: array elements must be in increasing order
  Brk_Max_Decel_Kneepts_3: uint8  % Speed knee points for Brake1_Decel , Brake2_Max_Deceleration and Brake3_Decel_setX
    % NOTE: array elements must be in increasing order
  Brake1_Duration: single  % Maximum duration that the Brake 1 stag should be applied for.
  Brake1_Max_Gradient_0: uint8  % Maximum allowable gradient change in the Brake 1 stage
  Brake1_Max_Gradient_1: uint8  % Maximum allowable gradient change in the Brake 1 stage
  Brake1_Max_Gradient_2: uint8  % Maximum allowable gradient change in the Brake 1 stage
  Brk_Max_Gradient_Kneepts_0: uint8  % Speed knee points for Brake1, Brake2 and Brake3 Max_Gradient tables
    % NOTE: array elements must be in increasing order
  Brk_Max_Gradient_Kneepts_1: uint8  % Speed knee points for Brake1, Brake2 and Brake3 Max_Gradient tables
    % NOTE: array elements must be in increasing order
  Brk_Max_Gradient_Kneepts_2: uint8  % Speed knee points for Brake1, Brake2 and Brake3 Max_Gradient tables
    % NOTE: array elements must be in increasing order
  Brake2_Max_Gradient_0: uint8  % Maximum allowable gradient change in the Brake 2 stage
  Brake2_Max_Gradient_1: uint8  % Maximum allowable gradient change in the Brake 2 stage
  Brake2_Max_Gradient_2: uint8  % Maximum allowable gradient change in the Brake 2 stage
  Brake2_Max_Deceleration_0: single  % Maximum allowable deceleration during the Brake 2 stage
  Brake2_Max_Deceleration_1: single  % Maximum allowable deceleration during the Brake 2 stage
  Brake2_Max_Deceleration_2: single  % Maximum allowable deceleration during the Brake 2 stage
  Brake2_Max_Deceleration_3: single  % Maximum allowable deceleration during the Brake 2 stage
  Brake2_Min_Deceleration: single  % Minimum allowable deceleration during the brake 2 stage
  Brake3_Max_Gradient_0: uint8  % Maximum allowable gradient change in the Brake 3 stage
  Brake3_Max_Gradient_1: uint8  % Maximum allowable gradient change in the Brake 3 stage
  Brake3_Max_Gradient_2: uint8  % Maximum allowable gradient change in the Brake 3 stage
  Brake3_Max_Deceleration_0: single  % Deceleration requested during the Brake 3 stage dependent on host vehicle speed.
  Brake3_Max_Deceleration_1: single  % Deceleration requested during the Brake 3 stage dependent on host vehicle speed.
  Brake3_Max_Deceleration_2: single  % Deceleration requested during the Brake 3 stage dependent on host vehicle speed.
  Brake3_Max_Deceleration_3: single  % Deceleration requested during the Brake 3 stage dependent on host vehicle speed.
  Brake3_Avoid_Decel_Thresh: single  % Avoidance decel threshold required to engage Brake3
  Brake3_TTC_Thr: single  % Maximum TTC to the object for Brake 3 to be engaged
  Brake3_On_Off: uint8  % If set to 0, the Brake 3 part of the profile is disabled.  If set to 1, it is enabled.
  Brk1_to_Brk3_Min_T_Elapse: single  % The minimum time that the Brake 1 stage should be applied before the system is allowed to transition to the Brake 3 stage.
  Brake3_Max_Headway: single  % Maximum headway to the object required to engage Brake 3
  AEB_maxSteeringAngle: single  % Maximum allowable front axle angle for AEB to be active
  FCW_maxSteeringAngle: single  % Maximum allowable front axle angle for FCW to be active
  k_FCA_LatencyCompensation: single  % latency compensation for vehicle warning and braking requests
  Reserved_3: uint8

EQ4_IIPB_HDR_BUS = Simulink.Bus()
  IIPB_Zero_byte: uint8
  IIPB_Protocol_Version: uint8
  IIPB_Optional_Signals: uint8  % Number of optional signals (has validator bit)
  AdhereToGapSensitivity_V: uint8  % This validity flag, if set to TRUE, indicates that we should map the information sent to us in the AdhereToGapSensitivity signal to the FFS
  AdhereToGapSensitivity: uint8  % Decide if gap sensitivity is used for specific set
  AEB_BrakeToStillMode_V: uint8  % This validity flag, if set to TRUE, indicates that we should map the information sent to us in the AEB_BrakeToStillMode signal to the FFS
  AEB_BrakeToStillMode: uint8  % defining stand still mode
  IIPB_Buffer_1_V: uint8
  IIPB_Buffer_1: uint8
  AEB_Deceleration_0_V: uint8  % This validity flag, if set to TRUE, indicates that we should map the information sent to us in the AEB_Deceleration_0 signal to the FFS
  AEB_Deceleration_0: single  % Ego Deceleration-dependent TTC threshold reductions. Defines deceleration thresholds to be used in accordance with  AEB_deceleration_reduction. Based on the signals egobrake and longitudinal Acceleration.
  AEB_Deceleration_1_V: uint8  % This validity flag, if set to TRUE, indicates that we should map the information sent to us in the AEB_Deceleration_1 signal to the FFS
  AEB_Deceleration_1: single  % Ego Deceleration-dependent TTC threshold reductions. Defines deceleration thresholds to be used in accordance with  AEB_deceleration_reduction. Based on the signals egobrake and longitudinal Acceleration.
  AEB_Deceleration_2_V: uint8  % This validity flag, if set to TRUE, indicates that we should map the information sent to us in the AEB_Deceleration_2 signal to the FFS
  AEB_Deceleration_2: single  % Ego Deceleration-dependent TTC threshold reductions. Defines deceleration thresholds to be used in accordance with  AEB_deceleration_reduction. Based on the signals egobrake and longitudinal Acceleration.
  AEB_Deceleration_Reduction_0_V: uint8  % This validity flag, if set to TRUE, indicates that we should map the information sent to us in the AEB_Deceleration_Reduction_0 signal to the FFS
  AEB_Deceleration_Reduction_0: single  % Threshold reduction values. The TTC Threshold will be reduced by the corresponding parameter value in accordance with the Deceleration Thresholds set in AEB_deceleration
  AEB_Deceleration_Reduction_1_V: uint8  % This validity flag, if set to TRUE, indicates that we should map the information sent to us in the AEB_Deceleration_Reduction_1 signal to the FFS
  AEB_Deceleration_Reduction_1: single  % Threshold reduction values. The TTC Threshold will be reduced by the corresponding parameter value in accordance with the Deceleration Thresholds set in AEB_deceleration
  AEB_Deceleration_Reduction_2_V: uint8  % This validity flag, if set to TRUE, indicates that we should map the information sent to us in the AEB_Deceleration_Reduction_2 signal to the FFS
  AEB_Deceleration_Reduction_2: single  % Threshold reduction values. The TTC Threshold will be reduced by the corresponding parameter value in accordance with the Deceleration Thresholds set in AEB_deceleration
  IIPB_Buffer_2_V: uint8
  IIPB_Buffer_2: uint8
  AEB_MaxRelV_V: uint8  % This validity flag, if set to TRUE, indicates that we should map the information sent to us in the AEB_MaxRelV signal to the FFS
  AEB_MaxRelV: single  % Maximum relative speed  for AEB alerts. New alert will not be issued above this speed
  AEB_MaxSpeed_V: uint8  % This validity flag, if set to TRUE, indicates that we should map the information sent to us in the AEB_MaxSpeed signal to the FFS
  AEB_MaxSpeed: single  % Maximum ego Speed for AEB alert.  New alert will not be issued above this speed.
  IIPB_Buffer_3_V: uint8
  IIPB_Buffer_3: uint8
  AEB_MaxSpeedReduction_V: uint8  % This validity flag, if set to TRUE, indicates that we should map the information sent to us in the AEB_MaxSpeedReduction signal to the FFS
  AEB_MaxSpeedReduction: single  % Max speed reduction to abort an AEB warning (starting from AEB warning activation). 0 == no limitation. When the speed reduction due to this alert is reached, the alert will be suppressed.
  AEB_MaxYawRate_V: uint8  % This validity flag, if set to TRUE, indicates that we should map the information sent to us in the AEB_MaxYawRate signal to the FFS
  AEB_MaxYawRate: uint16  % Max Yaw Rate Suppression Threshold. Based on the signal from ego vehicle
  IIPB_Buffer_4_V: uint8
  IIPB_Buffer_4: uint8
  AEB_Min_time_after_AEB_for_AEB_V: uint8  % This validity flag, if set to TRUE, indicates that we should map the information sent to us in the AEB_Min_time_after_AEB_for_AEB signal to the FFS
  AEB_Min_time_after_AEB_for_AEB: single  % Minimum Suppression time between  AEB Warnings for a specific set
  AEB_MinRelV_V: uint8  % This validity flag, if set to TRUE, indicates that we should map the information sent to us in the AEB_MinRelV signal to the FFS
  AEB_MinRelV: single  % Minimum relative speed  for AEB alerts. New alert will not be issued below this speed.
  IIPB_Buffer_5_V: uint8
  IIPB_Buffer_5: uint8
  AEB_MinSpeed_V: uint8  % This validity flag, if set to TRUE, indicates that we should map the information sent to us in the AEB_MinSpeed signal to the FFS
  AEB_MinSpeed: single  % Maximum ego Speed for AEB alert.  New alert will not be issued below this speed.
  AEB_StandStillFollowTimeHyst_V: uint8  % This validity flag, if set to TRUE, indicates that we should map the information sent to us in the AEB_StandStillFollowTimeHyst signal to the FFS
  AEB_StandStillFollowTimeHyst: single  % If the Stand Still Mode is set to 2, then for target vehicles which do not move, continue the alert. If target vehicle starts to move, continue the event for additional AEB_standStillFollowTimeHyst.
  IIPB_Buffer_6_V: uint8
  IIPB_Buffer_6: uint8
  AEB_StandStillMaxSpeed_V: uint8  % This validity flag, if set to TRUE, indicates that we should map the information sent to us in the AEB_StandStillMaxSpeed signal to the FFS
  AEB_StandStillMaxSpeed: single  % Max ego speed for activating standstill management
  AEB_StandStillStillTimeHyst_V: uint8  % This validity flag, if set to TRUE, indicates that we should map the information sent to us in the AEB_StandStillStillTimeHyst signal to the FFS
  AEB_StandStillStillTimeHyst: single  % If the Stand Still Mode is set to 1, then regardless of target vehicle behavior, alert will be continued for this time
  Far_FCA_HW_VAL_0_V: uint8  % This validity flag, if set to TRUE, indicates that we should map the information sent to us in the Far_FCA_HW_VAL_0 signal to the FFS
  Far_FCA_HW_VAL_0: single  % HW values kneepoints in Far mode
  IIPB_Buffer_7_V: uint8
  IIPB_Buffer_7: uint8
  Far_FCA_HW_VAL_1_V: uint8  % This validity flag, if set to TRUE, indicates that we should map the information sent to us in the Far_FCA_HW_VAL_1 signal to the FFS
  Far_FCA_HW_VAL_1: single  % HW values kneepoints in Far mode
  Far_FCA_HW_VAL_2_V: uint8  % This validity flag, if set to TRUE, indicates that we should map the information sent to us in the Far_FCA_HW_VAL_2 signal to the FFS
  Far_FCA_HW_VAL_2: single  % HW values kneepoints in Far mode
  Far_FCA_HW_VAL_3_V: uint8  % This validity flag, if set to TRUE, indicates that we should map the information sent to us in the Far_FCA_HW_VAL_3 signal to the FFS
  Far_FCA_HW_VAL_3: single  % HW values kneepoints in Far mode
  IIPB_Buffer_8_V: uint8
  IIPB_Buffer_8: uint8
  Far_FCA_HW_VAL_4_V: uint8  % This validity flag, if set to TRUE, indicates that we should map the information sent to us in the Far_FCA_HW_VAL_4 signal to the FFS
  Far_FCA_HW_VAL_4: single  % HW values kneepoints in Far mode
  Far_FCA_HW_VAL_5_V: uint8  % This validity flag, if set to TRUE, indicates that we should map the information sent to us in the Far_FCA_HW_VAL_5 signal to the FFS
  Far_FCA_HW_VAL_5: single  % HW values kneepoints in Far mode
  FAR_TTC_TABLE_0_V: uint8  % This validity flag, if set to TRUE, indicates that we should map the information sent to us in the FAR_TTC_TABLE_0 signal to the FFS
  FAR_TTC_TABLE_0: single  % TTC threshold array kneepoints for sensitivity level FAR
  IIPB_Buffer_9_V: uint8
  IIPB_Buffer_9: uint8
  FAR_TTC_TABLE_1_V: uint8  % This validity flag, if set to TRUE, indicates that we should map the information sent to us in the FAR_TTC_TABLE_1 signal to the FFS
  FAR_TTC_TABLE_1: single  % TTC threshold array kneepoints for sensitivity level FAR
  FAR_TTC_TABLE_2_V: uint8  % This validity flag, if set to TRUE, indicates that we should map the information sent to us in the FAR_TTC_TABLE_2 signal to the FFS
  FAR_TTC_TABLE_2: single  % TTC threshold array kneepoints for sensitivity level FAR
  FAR_TTC_TABLE_3_V: uint8  % This validity flag, if set to TRUE, indicates that we should map the information sent to us in the FAR_TTC_TABLE_3 signal to the FFS
  FAR_TTC_TABLE_3: single  % TTC threshold array kneepoints for sensitivity level FAR
  FAR_TTC_TABLE_4_V: uint8  % This validity flag, if set to TRUE, indicates that we should map the information sent to us in the FAR_TTC_TABLE_4 signal to the FFS
  FAR_TTC_TABLE_4: single  % TTC threshold array kneepoints for sensitivity level FAR
  FAR_TTC_TABLE_5_V: uint8  % This validity flag, if set to TRUE, indicates that we should map the information sent to us in the FAR_TTC_TABLE_5 signal to the FFS
  FAR_TTC_TABLE_5: single  % TTC threshold array kneepoints for sensitivity level FAR
  IIPB_Buffer_10_V: uint8
  IIPB_Buffer_10: uint8
  FAR_TTC_TABLE_6_V: uint8  % This validity flag, if set to TRUE, indicates that we should map the information sent to us in the FAR_TTC_TABLE_6 signal to the FFS
  FAR_TTC_TABLE_6: single  % TTC threshold array kneepoints for sensitivity level FAR
  FAR_TTC_TABLE_7_V: uint8  % This validity flag, if set to TRUE, indicates that we should map the information sent to us in the FAR_TTC_TABLE_7 signal to the FFS
  FAR_TTC_TABLE_7: single  % TTC threshold array kneepoints for sensitivity level FAR
  IIPB_Buffer_11_V: uint8
  IIPB_Buffer_11: uint8
  FCA_HW_Kneepoints_0_V: uint8  % This validity flag, if set to TRUE, indicates that we should map the information sent to us in the FCA_HW_Kneepoints_0 signal to the FFS
  FCA_HW_Kneepoints_0: single  % Ego speed kneepoints for HW
  FCA_HW_Kneepoints_1_V: uint8  % This validity flag, if set to TRUE, indicates that we should map the information sent to us in the FCA_HW_Kneepoints_1 signal to the FFS
  FCA_HW_Kneepoints_1: single  % Ego speed kneepoints for HW
  FCA_HW_Kneepoints_2_V: uint8  % This validity flag, if set to TRUE, indicates that we should map the information sent to us in the FCA_HW_Kneepoints_2 signal to the FFS
  FCA_HW_Kneepoints_2: single  % Ego speed kneepoints for HW
  FCA_HW_Kneepoints_3_V: uint8  % This validity flag, if set to TRUE, indicates that we should map the information sent to us in the FCA_HW_Kneepoints_3 signal to the FFS
  FCA_HW_Kneepoints_3: single  % Ego speed kneepoints for HW
  FCA_HW_Kneepoints_4_V: uint8  % This validity flag, if set to TRUE, indicates that we should map the information sent to us in the FCA_HW_Kneepoints_4 signal to the FFS
  FCA_HW_Kneepoints_4: single  % Ego speed kneepoints for HW
  FCA_HW_Kneepoints_5_V: uint8  % This validity flag, if set to TRUE, indicates that we should map the information sent to us in the FCA_HW_Kneepoints_5 signal to the FFS
  FCA_HW_Kneepoints_5: single  % Ego speed kneepoints for HW
  FCA_HW_Stop_Fact_V: uint8  % This validity flag, if set to TRUE, indicates that we should map the information sent to us in the FCA_HW_Stop_Fact signal to the FFS
  FCA_HW_Stop_Fact: single  % Hysteresis for stopping HW alert. Used as factor to the HW val
  FCA_Ignition_default_state_V: uint8  % This validity flag, if set to TRUE, indicates that we should map the information sent to us in the FCA_Ignition_default_state signal to the FFS
  FCA_Ignition_default_state: uint8  % Defines the ignition state. 0=Disabled, 1=Near, 2=Medium, 3=Far. Ignition state correlates to ego speed based TTC threshold tables
  FCW_BaseSpeeds_0_V: uint8  % This validity flag, if set to TRUE, indicates that we should map the information sent to us in the FCW_BaseSpeeds_0 signal to the FFS
  FCW_BaseSpeeds_0: single  % Speed kneepoint array to define TTC threshold values in the X axis
  IIPB_Buffer_12_V: uint8
  IIPB_Buffer_12: uint8
  FCW_BaseSpeeds_1_V: uint8  % This validity flag, if set to TRUE, indicates that we should map the information sent to us in the FCW_BaseSpeeds_1 signal to the FFS
  FCW_BaseSpeeds_1: single  % Speed kneepoint array to define TTC threshold values in the X axis
  FCW_BaseSpeeds_2_V: uint8  % This validity flag, if set to TRUE, indicates that we should map the information sent to us in the FCW_BaseSpeeds_2 signal to the FFS
  FCW_BaseSpeeds_2: single  % Speed kneepoint array to define TTC threshold values in the X axis
  FCW_BaseSpeeds_3_V: uint8  % This validity flag, if set to TRUE, indicates that we should map the information sent to us in the FCW_BaseSpeeds_3 signal to the FFS
  FCW_BaseSpeeds_3: single  % Speed kneepoint array to define TTC threshold values in the X axis
  FCW_BaseSpeeds_4_V: uint8  % This validity flag, if set to TRUE, indicates that we should map the information sent to us in the FCW_BaseSpeeds_4 signal to the FFS
  FCW_BaseSpeeds_4: single  % Speed kneepoint array to define TTC threshold values in the X axis
  FCW_BaseSpeeds_5_V: uint8  % This validity flag, if set to TRUE, indicates that we should map the information sent to us in the FCW_BaseSpeeds_5 signal to the FFS
  FCW_BaseSpeeds_5: single  % Speed kneepoint array to define TTC threshold values in the X axis
  FCW_BaseSpeeds_6_V: uint8  % This validity flag, if set to TRUE, indicates that we should map the information sent to us in the FCW_BaseSpeeds_6 signal to the FFS
  FCW_BaseSpeeds_6: single  % Speed kneepoint array to define TTC threshold values in the X axis
  FCW_BaseSpeeds_7_V: uint8  % This validity flag, if set to TRUE, indicates that we should map the information sent to us in the FCW_BaseSpeeds_7 signal to the FFS
  FCW_BaseSpeeds_7: single  % Speed kneepoint array to define TTC threshold values in the X axis
  FCW_Deceleration_0_V: uint8  % This validity flag, if set to TRUE, indicates that we should map the information sent to us in the FCW_Deceleration_0 signal to the FFS
  FCW_Deceleration_0: single  % Deceleration reduction values to be used in case of ego braking for the TTC threshold
  IIPB_Buffer_13_V: uint8
  IIPB_Buffer_13: uint8
  FCW_Deceleration_1_V: uint8  % This validity flag, if set to TRUE, indicates that we should map the information sent to us in the FCW_Deceleration_1 signal to the FFS
  FCW_Deceleration_1: single  % Deceleration reduction values to be used in case of ego braking for the TTC threshold
  FCW_Deceleration_2_V: uint8  % This validity flag, if set to TRUE, indicates that we should map the information sent to us in the FCW_Deceleration_2 signal to the FFS
  FCW_Deceleration_2: single  % Deceleration reduction values to be used in case of ego braking for the TTC threshold
  FCW_Deceleration_reduction_0_V: uint8  % This validity flag, if set to TRUE, indicates that we should map the information sent to us in the FCW_Deceleration_reduction_0 signal to the FFS
  FCW_Deceleration_reduction_0: single  % TTC thresholds reduction values
  FCW_Deceleration_reduction_1_V: uint8  % This validity flag, if set to TRUE, indicates that we should map the information sent to us in the FCW_Deceleration_reduction_1 signal to the FFS
  FCW_Deceleration_reduction_1: single  % TTC thresholds reduction values
  FCW_Deceleration_reduction_2_V: uint8  % This validity flag, if set to TRUE, indicates that we should map the information sent to us in the FCW_Deceleration_reduction_2 signal to the FFS
  FCW_Deceleration_reduction_2: single  % TTC thresholds reduction values
  FCW_MaxDistance_V: uint8  % This validity flag, if set to TRUE, indicates that we should map the information sent to us in the FCW_MaxDistance signal to the FFS
  FCW_MaxDistance: single  % Max distance to target for alert. 0 = no limitation
  FCW_MaxThresh_V: uint8  % This validity flag, if set to TRUE, indicates that we should map the information sent to us in the FCW_MaxThresh signal to the FFS
  FCW_MaxThresh: single  % Max FCW TTC threshold
  K_FCAAccelHaloTime_V: uint8  % This validity flag, if set to TRUE, indicates that we should map the information sent to us in the K_FCAAccelHaloTime signal to the FFS
  K_FCAAccelHaloTime: single  % Acceleration Suppression will be triggered for FCAAccelHaloTime if the ego vehicle Accelerator Pedal crosses the FCAAccelLevel threshold.
  K_FCAAccelLevel_V: uint8  % This validity flag, if set to TRUE, indicates that we should map the information sent to us in the K_FCAAccelLevel signal to the FFS
  K_FCAAccelLevel: uint16  % Acceleration Pedal Threshold required for Acceleration Suppression 10 th of percent/s
  K_FCABrakeApplyDur_V: uint8  % This validity flag, if set to TRUE, indicates that we should map the information sent to us in the K_FCABrakeApplyDur signal to the FFS
  K_FCABrakeApplyDur: single  % Minimum time for braking to be considered as “real ego braking”. Used for suppressions of non AEB alerts
  K_FCABrakeApplyHaloTime_V: uint8  % This validity flag, if set to TRUE, indicates that we should map the information sent to us in the K_FCABrakeApplyHaloTime signal to the FFS
  K_FCABrakeApplyHaloTime: single  % Grace period (FCW suppression) after “real ego braking” is achieved. Meaning the alert will continue to be disabled after this time period
  K_FCALIATime_V: uint8  % This validity flag, if set to TRUE, indicates that we should map the information sent to us in the K_FCALIATime signal to the FFS
  K_FCALIATime: single  % Suppression time after FCA alert is given (grace period between alerts).
  IIPB_Buffer_14_V: uint8
  IIPB_Buffer_14: uint8
  K_FCAR_t_ClutchHaloTime_V: uint8  % This validity flag, if set to TRUE, indicates that we should map the information sent to us in the K_FCAR_t_ClutchHaloTime signal to the FFS
  K_FCAR_t_ClutchHaloTime: single  % FCW Suppression grace period after clutch is pressed.
  K_MaxFCAEnableSpeed_V: uint8  % This validity flag, if set to TRUE, indicates that we should map the information sent to us in the K_MaxFCAEnableSpeed signal to the FFS
  K_MaxFCAEnableSpeed: uint8  % Max speed for non AEB alerts. 0 = no limit
  K_MaxFCAEnableSpeedHysteresis_V: uint8  % This validity flag, if set to TRUE, indicates that we should map the information sent to us in the K_MaxFCAEnableSpeedHysteresis signal to the FFS
  K_MaxFCAEnableSpeedHysteresis: uint8  % Hysteresis of FCW function. If ego speed was above minimum ego speed, function will be available until K_MaxFCAEnableSpeed + K_MaxFCAEnableSpeedHysteresis
  IIPB_Buffer_15_V: uint8
  IIPB_Buffer_15: uint8
  K_MinFCAEnableSpeed_V: uint8  % This validity flag, if set to TRUE, indicates that we should map the information sent to us in the K_MinFCAEnableSpeed signal to the FFS
  K_MinFCAEnableSpeed: uint8  % Minimum speed for None AEB alert
  K_MinFCAEnableSpeedHysteresis_V: uint8  % This validity flag, if set to TRUE, indicates that we should map the information sent to us in the K_MinFCAEnableSpeedHysteresis signal to the FFS
  K_MinFCAEnableSpeedHysteresis: uint8  % Hysteresis of FCW function. If ego speed was above minimum ego speed, function will be available until K_MinFCAEnableSpeed - K_MinFCAEnableSpeedHysteresis
  Medium_FCA_HW_VAL_0_V: uint8  % This validity flag, if set to TRUE, indicates that we should map the information sent to us in the Medium_FCA_HW_VAL_0 signal to the FFS
  Medium_FCA_HW_VAL_0: single  % HW values kneepoints in Medium mode
  Medium_FCA_HW_VAL_1_V: uint8  % This validity flag, if set to TRUE, indicates that we should map the information sent to us in the Medium_FCA_HW_VAL_1 signal to the FFS
  Medium_FCA_HW_VAL_1: single  % HW values kneepoints in Medium mode
  Medium_FCA_HW_VAL_2_V: uint8  % This validity flag, if set to TRUE, indicates that we should map the information sent to us in the Medium_FCA_HW_VAL_2 signal to the FFS
  Medium_FCA_HW_VAL_2: single  % HW values kneepoints in Medium mode
  Medium_FCA_HW_VAL_3_V: uint8  % This validity flag, if set to TRUE, indicates that we should map the information sent to us in the Medium_FCA_HW_VAL_3 signal to the FFS
  Medium_FCA_HW_VAL_3: single  % HW values kneepoints in Medium mode
  Medium_FCA_HW_VAL_4_V: uint8  % This validity flag, if set to TRUE, indicates that we should map the information sent to us in the Medium_FCA_HW_VAL_4 signal to the FFS
  Medium_FCA_HW_VAL_4: single  % HW values kneepoints in Medium mode
  IIPB_Buffer_16_V: uint8
  IIPB_Buffer_16: uint8
  Medium_FCA_HW_VAL_5_V: uint8  % This validity flag, if set to TRUE, indicates that we should map the information sent to us in the Medium_FCA_HW_VAL_5 signal to the FFS
  Medium_FCA_HW_VAL_5: single  % HW values kneepoints in Medium mode
  MEDIUM_TTC_TABLE_0_V: uint8  % This validity flag, if set to TRUE, indicates that we should map the information sent to us in the MEDIUM_TTC_TABLE_0 signal to the FFS
  MEDIUM_TTC_TABLE_0: single  % TTC threshold array kneepoints for sensitivity level Medium
  MEDIUM_TTC_TABLE_1_V: uint8  % This validity flag, if set to TRUE, indicates that we should map the information sent to us in the MEDIUM_TTC_TABLE_1 signal to the FFS
  MEDIUM_TTC_TABLE_1: single  % TTC threshold array kneepoints for sensitivity level Medium
  MEDIUM_TTC_TABLE_2_V: uint8  % This validity flag, if set to TRUE, indicates that we should map the information sent to us in the MEDIUM_TTC_TABLE_2 signal to the FFS
  MEDIUM_TTC_TABLE_2: single  % TTC threshold array kneepoints for sensitivity level Medium
  MEDIUM_TTC_TABLE_3_V: uint8  % This validity flag, if set to TRUE, indicates that we should map the information sent to us in the MEDIUM_TTC_TABLE_3 signal to the FFS
  MEDIUM_TTC_TABLE_3: single  % TTC threshold array kneepoints for sensitivity level Medium
  MEDIUM_TTC_TABLE_4_V: uint8  % This validity flag, if set to TRUE, indicates that we should map the information sent to us in the MEDIUM_TTC_TABLE_4 signal to the FFS
  MEDIUM_TTC_TABLE_4: single  % TTC threshold array kneepoints for sensitivity level Medium
  MEDIUM_TTC_TABLE_5_V: uint8  % This validity flag, if set to TRUE, indicates that we should map the information sent to us in the MEDIUM_TTC_TABLE_5 signal to the FFS
  MEDIUM_TTC_TABLE_5: single  % TTC threshold array kneepoints for sensitivity level Medium
  MEDIUM_TTC_TABLE_6_V: uint8  % This validity flag, if set to TRUE, indicates that we should map the information sent to us in the MEDIUM_TTC_TABLE_6 signal to the FFS
  MEDIUM_TTC_TABLE_6: single  % TTC threshold array kneepoints for sensitivity level Medium
  IIPB_Buffer_17_V: uint8
  IIPB_Buffer_17: uint8
  MEDIUM_TTC_TABLE_7_V: uint8  % This validity flag, if set to TRUE, indicates that we should map the information sent to us in the MEDIUM_TTC_TABLE_7 signal to the FFS
  MEDIUM_TTC_TABLE_7: single  % TTC threshold array kneepoints for sensitivity level Medium
  Near_FCA_HW_VAL_0_V: uint8  % This validity flag, if set to TRUE, indicates that we should map the information sent to us in the Near_FCA_HW_VAL_0 signal to the FFS
  Near_FCA_HW_VAL_0: single  % HW values kneepoints in Near mode
  Near_FCA_HW_VAL_1_V: uint8  % This validity flag, if set to TRUE, indicates that we should map the information sent to us in the Near_FCA_HW_VAL_1 signal to the FFS
  Near_FCA_HW_VAL_1: single  % HW values kneepoints in Near mode
  IIPB_Buffer_18_V: uint8
  IIPB_Buffer_18: uint8
  Near_FCA_HW_VAL_2_V: uint8  % This validity flag, if set to TRUE, indicates that we should map the information sent to us in the Near_FCA_HW_VAL_2 signal to the FFS
  Near_FCA_HW_VAL_2: single  % HW values kneepoints in Near mode
  Near_FCA_HW_VAL_3_V: uint8  % This validity flag, if set to TRUE, indicates that we should map the information sent to us in the Near_FCA_HW_VAL_3 signal to the FFS
  Near_FCA_HW_VAL_3: single  % HW values kneepoints in Near mode
  Near_FCA_HW_VAL_4_V: uint8  % This validity flag, if set to TRUE, indicates that we should map the information sent to us in the Near_FCA_HW_VAL_4 signal to the FFS
  Near_FCA_HW_VAL_4: single  % HW values kneepoints in Near mode
  IIPB_Buffer_19_V: uint8
  IIPB_Buffer_19: uint8
  Near_FCA_HW_VAL_5_V: uint8  % This validity flag, if set to TRUE, indicates that we should map the information sent to us in the Near_FCA_HW_VAL_5 signal to the FFS
  Near_FCA_HW_VAL_5: single  % HW values kneepoints in Near mode
  NEAR_TTC_TABLE_0_V: uint8  % This validity flag, if set to TRUE, indicates that we should map the information sent to us in the NEAR_TTC_TABLE_0 signal to the FFS
  NEAR_TTC_TABLE_0: single  % TTC threshold array kneepoints for sensitivity level NEAR
  NEAR_TTC_TABLE_1_V: uint8  % This validity flag, if set to TRUE, indicates that we should map the information sent to us in the NEAR_TTC_TABLE_1 signal to the FFS
  NEAR_TTC_TABLE_1: single  % TTC threshold array kneepoints for sensitivity level NEAR
  NEAR_TTC_TABLE_2_V: uint8  % This validity flag, if set to TRUE, indicates that we should map the information sent to us in the NEAR_TTC_TABLE_2 signal to the FFS
  NEAR_TTC_TABLE_2: single  % TTC threshold array kneepoints for sensitivity level NEAR
  NEAR_TTC_TABLE_3_V: uint8  % This validity flag, if set to TRUE, indicates that we should map the information sent to us in the NEAR_TTC_TABLE_3 signal to the FFS
  NEAR_TTC_TABLE_3: single  % TTC threshold array kneepoints for sensitivity level NEAR
  NEAR_TTC_TABLE_4_V: uint8  % This validity flag, if set to TRUE, indicates that we should map the information sent to us in the NEAR_TTC_TABLE_4 signal to the FFS
  NEAR_TTC_TABLE_4: single  % TTC threshold array kneepoints for sensitivity level NEAR
  NEAR_TTC_TABLE_5_V: uint8  % This validity flag, if set to TRUE, indicates that we should map the information sent to us in the NEAR_TTC_TABLE_5 signal to the FFS
  NEAR_TTC_TABLE_5: single  % TTC threshold array kneepoints for sensitivity level NEAR
  NEAR_TTC_TABLE_6_V: uint8  % This validity flag, if set to TRUE, indicates that we should map the information sent to us in the NEAR_TTC_TABLE_6 signal to the FFS
  NEAR_TTC_TABLE_6: single  % TTC threshold array kneepoints for sensitivity level NEAR
  IIPB_Buffer_20_V: uint8
  IIPB_Buffer_20: uint8
  NEAR_TTC_TABLE_7_V: uint8  % This validity flag, if set to TRUE, indicates that we should map the information sent to us in the NEAR_TTC_TABLE_7 signal to the FFS
  NEAR_TTC_TABLE_7: single  % TTC threshold array kneepoints for sensitivity level NEAR
  STEERING_VALUES_TABLE_0_V: uint8  % This validity flag, if set to TRUE, indicates that we should map the information sent to us in the STEERING_VALUES_TABLE_0 signal to the FFS
  STEERING_VALUES_TABLE_0: uint16  % Defines kneepoints for steering values to be used for TTC threshold reduction
  STEERING_VALUES_TABLE_1_V: uint8  % This validity flag, if set to TRUE, indicates that we should map the information sent to us in the STEERING_VALUES_TABLE_1 signal to the FFS
  STEERING_VALUES_TABLE_1: uint16  % Defines kneepoints for steering values to be used for TTC threshold reduction
  STEERING_VALUES_TABLE_2_V: uint8  % This validity flag, if set to TRUE, indicates that we should map the information sent to us in the STEERING_VALUES_TABLE_2 signal to the FFS
  STEERING_VALUES_TABLE_2: uint16  % Defines kneepoints for steering values to be used for TTC threshold reduction
  vEgo_vs_vRel_threshAdditive_0_V: uint8  % This validity flag, if set to TRUE, indicates that we should map the information sent to us in the vEgo_vs_vRel_threshAdditives_0 signal to the FFS
  vEgo_vs_vRel_threshAdditive_0: single  % TTC thresholds table correlates to ego/rel speed kneepoints
  vEgo_vs_vRel_threshAdditive_1_V: uint8  % This validity flag, if set to TRUE, indicates that we should map the information sent to us in the vEgo_vs_vRel_threshAdditives_1 signal to the FFS
  vEgo_vs_vRel_threshAdditive_1: single  % TTC thresholds table correlates to ego/rel speed kneepoints
  vEgo_vs_vRel_threshAdditive_2_V: uint8  % This validity flag, if set to TRUE, indicates that we should map the information sent to us in the vEgo_vs_vRel_threshAdditives_2 signal to the FFS
  vEgo_vs_vRel_threshAdditive_2: single  % TTC thresholds table correlates to ego/rel speed kneepoints
  vEgo_vs_vRel_threshAdditive_3_V: uint8  % This validity flag, if set to TRUE, indicates that we should map the information sent to us in the vEgo_vs_vRel_threshAdditives_3 signal to the FFS
  vEgo_vs_vRel_threshAdditive_3: single  % TTC thresholds table correlates to ego/rel speed kneepoints
  vEgo_vs_vRel_threshAdditive_4_V: uint8  % This validity flag, if set to TRUE, indicates that we should map the information sent to us in the vEgo_vs_vRel_threshAdditives_4 signal to the FFS
  vEgo_vs_vRel_threshAdditive_4: single  % TTC thresholds table correlates to ego/rel speed kneepoints
  IIPB_Buffer_21_V: uint8
  IIPB_Buffer_21: uint8
  vEgo_vs_vRel_threshAdditive_5_V: uint8  % This validity flag, if set to TRUE, indicates that we should map the information sent to us in the vEgo_vs_vRel_threshAdditives_5 signal to the FFS
  vEgo_vs_vRel_threshAdditive_5: single  % TTC thresholds table correlates to ego/rel speed kneepoints
  vEgo_vs_vRel_threshAdditive_6_V: uint8  % This validity flag, if set to TRUE, indicates that we should map the information sent to us in the vEgo_vs_vRel_threshAdditives_6 signal to the FFS
  vEgo_vs_vRel_threshAdditive_6: single  % TTC thresholds table correlates to ego/rel speed kneepoints
  vEgo_vs_vRel_threshAdditive_7_V: uint8  % This validity flag, if set to TRUE, indicates that we should map the information sent to us in the vEgo_vs_vRel_threshAdditives_7 signal to the FFS
  vEgo_vs_vRel_threshAdditive_7: single  % TTC thresholds table correlates to ego/rel speed kneepoints
  IIPB_Buffer_22_V: uint8
  IIPB_Buffer_22: uint8
  vEgo_vs_vRel_threshAdditive_8_V: uint8  % This validity flag, if set to TRUE, indicates that we should map the information sent to us in the vEgo_vs_vRel_threshAdditives_8 signal to the FFS
  vEgo_vs_vRel_threshAdditive_8: single  % TTC thresholds table correlates to ego/rel speed kneepoints
  vEgo_vs_vRel_threshAdditive_9_V: uint8  % This validity flag, if set to TRUE, indicates that we should map the information sent to us in the vEgo_vs_vRel_threshAdditives_9 signal to the FFS
  vEgo_vs_vRel_threshAdditive_9: single  % TTC thresholds table correlates to ego/rel speed kneepoints
  vEgo_vs_vRel_threshAdditive_10_V: uint8  % This validity flag, if set to TRUE, indicates that we should map the information sent to us in the vEgo_vs_vRel_threshAdditives_10 signal to the FFS
  vEgo_vs_vRel_threshAdditive_10: single  % TTC thresholds table correlates to ego/rel speed kneepoints
  IIPB_Buffer_23_V: uint8
  IIPB_Buffer_23: uint8
  vEgo_vs_vRel_threshAdditive_11_V: uint8  % This validity flag, if set to TRUE, indicates that we should map the information sent to us in the vEgo_vs_vRel_threshAdditives_11 signal to the FFS
  vEgo_vs_vRel_threshAdditive_11: single  % TTC thresholds table correlates to ego/rel speed kneepoints
  vEgo_vs_vRel_threshAdditive_12_V: uint8  % This validity flag, if set to TRUE, indicates that we should map the information sent to us in the vEgo_vs_vRel_threshAdditives_12 signal to the FFS
  vEgo_vs_vRel_threshAdditive_12: single  % TTC thresholds table correlates to ego/rel speed kneepoints
  vEgo_vs_vRel_threshAdditive_13_V: uint8  % This validity flag, if set to TRUE, indicates that we should map the information sent to us in the vEgo_vs_vRel_threshAdditives_13 signal to the FFS
  vEgo_vs_vRel_threshAdditive_13: single  % TTC thresholds table correlates to ego/rel speed kneepoints
  IIPB_Buffer_24_V: uint8
  IIPB_Buffer_24: uint8
  vEgo_vs_vRel_threshAdditive_14_V: uint8  % This validity flag, if set to TRUE, indicates that we should map the information sent to us in the vEgo_vs_vRel_threshAdditives_14 signal to the FFS
  vEgo_vs_vRel_threshAdditive_14: single  % TTC thresholds table correlates to ego/rel speed kneepoints
  vEgo_vs_vRel_threshAdditive_15_V: uint8  % This validity flag, if set to TRUE, indicates that we should map the information sent to us in the vEgo_vs_vRel_threshAdditives_15 signal to the FFS
  vEgo_vs_vRel_threshAdditive_15: single  % TTC thresholds table correlates to ego/rel speed kneepoints
  vEgo_vs_vRel_threshAdditive_16_V: uint8  % This validity flag, if set to TRUE, indicates that we should map the information sent to us in the vEgo_vs_vRel_threshAdditives_16 signal to the FFS
  vEgo_vs_vRel_threshAdditive_16: single  % TTC thresholds table correlates to ego/rel speed kneepoints
  IIPB_Buffer_25_V: uint8
  IIPB_Buffer_25: uint8
  vEgo_vs_vRel_threshAdditive_17_V: uint8  % This validity flag, if set to TRUE, indicates that we should map the information sent to us in the vEgo_vs_vRel_threshAdditives_17 signal to the FFS
  vEgo_vs_vRel_threshAdditive_17: single  % TTC thresholds table correlates to ego/rel speed kneepoints
  vEgo_vs_vRel_threshAdditive_18_V: uint8  % This validity flag, if set to TRUE, indicates that we should map the information sent to us in the vEgo_vs_vRel_threshAdditives_18 signal to the FFS
  vEgo_vs_vRel_threshAdditive_18: single  % TTC thresholds table correlates to ego/rel speed kneepoints
  vEgo_vs_vRel_threshAdditive_19_V: uint8  % This validity flag, if set to TRUE, indicates that we should map the information sent to us in the vEgo_vs_vRel_threshAdditives_19 signal to the FFS
  vEgo_vs_vRel_threshAdditive_19: single  % TTC thresholds table correlates to ego/rel speed kneepoints
  IIPB_Buffer_26_V: uint8
  IIPB_Buffer_26: uint8
  vEgo_vs_vRel_threshAdditive_20_V: uint8  % This validity flag, if set to TRUE, indicates that we should map the information sent to us in the vEgo_vs_vRel_threshAdditives_20 signal to the FFS
  vEgo_vs_vRel_threshAdditive_20: single  % TTC thresholds table correlates to ego/rel speed kneepoints
  vEgo_vs_vRel_threshAdditive_21_V: uint8  % This validity flag, if set to TRUE, indicates that we should map the information sent to us in the vEgo_vs_vRel_threshAdditives_21 signal to the FFS
  vEgo_vs_vRel_threshAdditive_21: single  % TTC thresholds table correlates to ego/rel speed kneepoints
  vEgo_vs_vRel_threshAdditive_22_V: uint8  % This validity flag, if set to TRUE, indicates that we should map the information sent to us in the vEgo_vs_vRel_threshAdditives_22 signal to the FFS
  vEgo_vs_vRel_threshAdditive_22: single  % TTC thresholds table correlates to ego/rel speed kneepoints
  IIPB_Buffer_27_V: uint8
  IIPB_Buffer_27: uint8
  vEgo_vs_vRel_threshAdditive_23_V: uint8  % This validity flag, if set to TRUE, indicates that we should map the information sent to us in the vEgo_vs_vRel_threshAdditives_23 signal to the FFS
  vEgo_vs_vRel_threshAdditive_23: single  % TTC thresholds table correlates to ego/rel speed kneepoints
  vEgo_vs_vRel_threshAdditive_24_V: uint8  % This validity flag, if set to TRUE, indicates that we should map the information sent to us in the vEgo_vs_vRel_threshAdditives_24 signal to the FFS
  vEgo_vs_vRel_threshAdditive_24: single  % TTC thresholds table correlates to ego/rel speed kneepoints
  vEgo_vs_vRel_vEgoKneePts_0_V: uint8  % This validity flag, if set to TRUE, indicates that we should map the information sent to us in the vEgo_vs_vRel_vEgoKneePts_0 signal to the FFS
  vEgo_vs_vRel_vEgoKneePts_0: single  % ego speed kneepoints for ego/rel table
  vEgo_vs_vRel_vEgoKneePts_1_V: uint8  % This validity flag, if set to TRUE, indicates that we should map the information sent to us in the vEgo_vs_vRel_vEgoKneePts_1 signal to the FFS
  vEgo_vs_vRel_vEgoKneePts_1: single  % ego speed kneepoints for ego/rel table
  vEgo_vs_vRel_vEgoKneePts_2_V: uint8  % This validity flag, if set to TRUE, indicates that we should map the information sent to us in the vEgo_vs_vRel_vEgoKneePts_2 signal to the FFS
  vEgo_vs_vRel_vEgoKneePts_2: single  % ego speed kneepoints for ego/rel table
  IIPB_Buffer_28_V: uint8
  IIPB_Buffer_28: uint8
  vEgo_vs_vRel_vEgoKneePts_3_V: uint8  % This validity flag, if set to TRUE, indicates that we should map the information sent to us in the vEgo_vs_vRel_vEgoKneePts_3 signal to the FFS
  vEgo_vs_vRel_vEgoKneePts_3: single  % ego speed kneepoints for ego/rel table
  vEgo_vs_vRel_vEgoKneePts_4_V: uint8  % This validity flag, if set to TRUE, indicates that we should map the information sent to us in the vEgo_vs_vRel_vEgoKneePts_4 signal to the FFS
  vEgo_vs_vRel_vEgoKneePts_4: single  % ego speed kneepoints for ego/rel table
  IIPB_Buffer_29_V: uint8
  IIPB_Buffer_29: uint8
  vEgo_vs_vRel_vRelKneePts_0_V: uint8  % This validity flag, if set to TRUE, indicates that we should map the information sent to us in the vEgo_vs_vRel_vRelKneePts_0 signal to the FFS
  vEgo_vs_vRel_vRelKneePts_0: single  % relative speed kneepoint for ego/rel table
  vEgo_vs_vRel_vRelKneePts_1_V: uint8  % This validity flag, if set to TRUE, indicates that we should map the information sent to us in the vEgo_vs_vRel_vRelKneePts_1 signal to the FFS
  vEgo_vs_vRel_vRelKneePts_1: single  % relative speed kneepoint for ego/rel table
  IIPB_Buffer_30_V: uint8
  IIPB_Buffer_30: uint8
  vEgo_vs_vRel_vRelKneePts_2_V: uint8  % This validity flag, if set to TRUE, indicates that we should map the information sent to us in the vEgo_vs_vRel_vRelKneePts_2 signal to the FFS
  vEgo_vs_vRel_vRelKneePts_2: single  % relative speed kneepoint for ego/rel table
  vEgo_vs_vRel_vRelKneePts_3_V: uint8  % This validity flag, if set to TRUE, indicates that we should map the information sent to us in the vEgo_vs_vRel_vRelKneePts_3 signal to the FFS
  vEgo_vs_vRel_vRelKneePts_3: single  % relative speed kneepoint for ego/rel table
  IIPB_Buffer_31_V: uint8
  IIPB_Buffer_31: uint8
  vEgo_vs_vRel_vRelKneePts_4_V: uint8  % This validity flag, if set to TRUE, indicates that we should map the information sent to us in the vEgo_vs_vRel_vRelKneePts_4 signal to the FFS
  vEgo_vs_vRel_vRelKneePts_4: single  % relative speed kneepoint for ego/rel table
  vRel_vs_Olap_OlapKnePts_0_V: uint8  % This validity flag, if set to TRUE, indicates that we should map the information sent to us in the vRel_vs_Overlap_OverlapKneePts_0 signal to the FFS
  vRel_vs_Olap_OlapKnePts_0: single  % Overlap kneepoints for TTC threshold reduction according to overlap between ego and targets
  vRel_vs_Olap_OlapKnePts_1_V: uint8  % This validity flag, if set to TRUE, indicates that we should map the information sent to us in the vRel_vs_Overlap_OverlapKneePts_1 signal to the FFS
  vRel_vs_Olap_OlapKnePts_1: single  % Overlap kneepoints for TTC threshold reduction according to overlap between ego and targets
  vRel_vs_Olap_OlapKnePts_2_V: uint8  % This validity flag, if set to TRUE, indicates that we should map the information sent to us in the vRel_vs_Overlap_OverlapKneePts_2 signal to the FFS
  vRel_vs_Olap_OlapKnePts_2: single  % Overlap kneepoints for TTC threshold reduction according to overlap between ego and targets
  vRel_vs_Olap_OlapKnePts_3_V: uint8  % This validity flag, if set to TRUE, indicates that we should map the information sent to us in the vRel_vs_Overlap_OverlapKneePts_3 signal to the FFS
  vRel_vs_Olap_OlapKnePts_3: single  % Overlap kneepoints for TTC threshold reduction according to overlap between ego and targets
  vRel_vs_Olap_OlapKnePts_4_V: uint8  % This validity flag, if set to TRUE, indicates that we should map the information sent to us in the vRel_vs_Overlap_OverlapKneePts_4 signal to the FFS
  vRel_vs_Olap_OlapKnePts_4: single  % Overlap kneepoints for TTC threshold reduction according to overlap between ego and targets
  IIPB_Buffer_32_V: uint8
  IIPB_Buffer_32: uint8
  vRel_vs_Olap_ReductionVals_0_V: uint8  % This validity flag, if set to TRUE, indicates that we should map the information sent to us in the vRel_vs_Overlap_ReductionVals_0 signal to the FFS
  vRel_vs_Olap_ReductionVals_0: single  % TTC threshold reduction values by overlap/relative speed table
  vRel_vs_Olap_ReductionVals_1_V: uint8  % This validity flag, if set to TRUE, indicates that we should map the information sent to us in the vRel_vs_Overlap_ReductionVals_1 signal to the FFS
  vRel_vs_Olap_ReductionVals_1: single  % TTC threshold reduction values by overlap/relative speed table
  vRel_vs_Olap_ReductionVals_2_V: uint8  % This validity flag, if set to TRUE, indicates that we should map the information sent to us in the vRel_vs_Overlap_ReductionVals_2 signal to the FFS
  vRel_vs_Olap_ReductionVals_2: single  % TTC threshold reduction values by overlap/relative speed table
  IIPB_Buffer_33_V: uint8
  IIPB_Buffer_33: uint8
  vRel_vs_Olap_ReductionVals_3_V: uint8  % This validity flag, if set to TRUE, indicates that we should map the information sent to us in the vRel_vs_Overlap_ReductionVals_3 signal to the FFS
  vRel_vs_Olap_ReductionVals_3: single  % TTC threshold reduction values by overlap/relative speed table
  vRel_vs_Olap_ReductionVals_4_V: uint8  % This validity flag, if set to TRUE, indicates that we should map the information sent to us in the vRel_vs_Overlap_ReductionVals_4 signal to the FFS
  vRel_vs_Olap_ReductionVals_4: single  % TTC threshold reduction values by overlap/relative speed table
  vRel_vs_Olap_ReductionVals_5_V: uint8  % This validity flag, if set to TRUE, indicates that we should map the information sent to us in the vRel_vs_Overlap_ReductionVals_5 signal to the FFS
  vRel_vs_Olap_ReductionVals_5: single  % TTC threshold reduction values by overlap/relative speed table
  IIPB_Buffer_34_V: uint8
  IIPB_Buffer_34: uint8
  vRel_vs_Olap_ReductionVals_6_V: uint8  % This validity flag, if set to TRUE, indicates that we should map the information sent to us in the vRel_vs_Overlap_ReductionVals_6 signal to the FFS
  vRel_vs_Olap_ReductionVals_6: single  % TTC threshold reduction values by overlap/relative speed table
  vRel_vs_Olap_ReductionVals_7_V: uint8  % This validity flag, if set to TRUE, indicates that we should map the information sent to us in the vRel_vs_Overlap_ReductionVals_7 signal to the FFS
  vRel_vs_Olap_ReductionVals_7: single  % TTC threshold reduction values by overlap/relative speed table
  vRel_vs_Olap_ReductionVals_8_V: uint8  % This validity flag, if set to TRUE, indicates that we should map the information sent to us in the vRel_vs_Overlap_ReductionVals_8 signal to the FFS
  vRel_vs_Olap_ReductionVals_8: single  % TTC threshold reduction values by overlap/relative speed table
  IIPB_Buffer_35_V: uint8
  IIPB_Buffer_35: uint8
  vRel_vs_Olap_ReductionVals_9_V: uint8  % This validity flag, if set to TRUE, indicates that we should map the information sent to us in the vRel_vs_Overlap_ReductionVals_9 signal to the FFS
  vRel_vs_Olap_ReductionVals_9: single  % TTC threshold reduction values by overlap/relative speed table
  vRel_vs_Olap_ReductionVals_10_V: uint8  % This validity flag, if set to TRUE, indicates that we should map the information sent to us in the vRel_vs_Overlap_ReductionVals_10 signal to the FFS
  vRel_vs_Olap_ReductionVals_10: single  % TTC threshold reduction values by overlap/relative speed table
  vRel_vs_Olap_ReductionVals_11_V: uint8  % This validity flag, if set to TRUE, indicates that we should map the information sent to us in the vRel_vs_Overlap_ReductionVals_11 signal to the FFS
  vRel_vs_Olap_ReductionVals_11: single  % TTC threshold reduction values by overlap/relative speed table
  IIPB_Buffer_36_V: uint8
  IIPB_Buffer_36: uint8
  vRel_vs_Olap_ReductionVals_12_V: uint8  % This validity flag, if set to TRUE, indicates that we should map the information sent to us in the vRel_vs_Overlap_ReductionVals_12 signal to the FFS
  vRel_vs_Olap_ReductionVals_12: single  % TTC threshold reduction values by overlap/relative speed table
  vRel_vs_Olap_ReductionVals_13_V: uint8  % This validity flag, if set to TRUE, indicates that we should map the information sent to us in the vRel_vs_Overlap_ReductionVals_13 signal to the FFS
  vRel_vs_Olap_ReductionVals_13: single  % TTC threshold reduction values by overlap/relative speed table
  vRel_vs_Olap_ReductionVals_14_V: uint8  % This validity flag, if set to TRUE, indicates that we should map the information sent to us in the vRel_vs_Overlap_ReductionVals_14 signal to the FFS
  vRel_vs_Olap_ReductionVals_14: single  % TTC threshold reduction values by overlap/relative speed table
  IIPB_Buffer_37_V: uint8
  IIPB_Buffer_37: uint8
  vRel_vs_Olap_ReductionVals_15_V: uint8  % This validity flag, if set to TRUE, indicates that we should map the information sent to us in the vRel_vs_Overlap_ReductionVals_15 signal to the FFS
  vRel_vs_Olap_ReductionVals_15: single  % TTC threshold reduction values by overlap/relative speed table
  vRel_vs_Olap_ReductionVals_16_V: uint8  % This validity flag, if set to TRUE, indicates that we should map the information sent to us in the vRel_vs_Overlap_ReductionVals_16 signal to the FFS
  vRel_vs_Olap_ReductionVals_16: single  % TTC threshold reduction values by overlap/relative speed table
  vRel_vs_Olap_ReductionVals_17_V: uint8  % This validity flag, if set to TRUE, indicates that we should map the information sent to us in the vRel_vs_Overlap_ReductionVals_17 signal to the FFS
  vRel_vs_Olap_ReductionVals_17: single  % TTC threshold reduction values by overlap/relative speed table
  IIPB_Buffer_38_V: uint8
  IIPB_Buffer_38: uint8
  vRel_vs_Olap_ReductionVals_18_V: uint8  % This validity flag, if set to TRUE, indicates that we should map the information sent to us in the vRel_vs_Overlap_ReductionVals_18 signal to the FFS
  vRel_vs_Olap_ReductionVals_18: single  % TTC threshold reduction values by overlap/relative speed table
  vRel_vs_Olap_ReductionVals_19_V: uint8  % This validity flag, if set to TRUE, indicates that we should map the information sent to us in the vRel_vs_Overlap_ReductionVals_19 signal to the FFS
  vRel_vs_Olap_ReductionVals_19: single  % TTC threshold reduction values by overlap/relative speed table
  vRel_vs_Olap_ReductionVals_20_V: uint8  % This validity flag, if set to TRUE, indicates that we should map the information sent to us in the vRel_vs_Overlap_ReductionVals_20 signal to the FFS
  vRel_vs_Olap_ReductionVals_20: single  % TTC threshold reduction values by overlap/relative speed table
  IIPB_Buffer_39_V: uint8
  IIPB_Buffer_39: uint8
  vRel_vs_Olap_ReductionVals_21_V: uint8  % This validity flag, if set to TRUE, indicates that we should map the information sent to us in the vRel_vs_Overlap_ReductionVals_21 signal to the FFS
  vRel_vs_Olap_ReductionVals_21: single  % TTC threshold reduction values by overlap/relative speed table
  vRel_vs_Olap_ReductionVals_22_V: uint8  % This validity flag, if set to TRUE, indicates that we should map the information sent to us in the vRel_vs_Overlap_ReductionVals_22 signal to the FFS
  vRel_vs_Olap_ReductionVals_22: single  % TTC threshold reduction values by overlap/relative speed table
  vRel_vs_Olap_ReductionVals_23_V: uint8  % This validity flag, if set to TRUE, indicates that we should map the information sent to us in the vRel_vs_Overlap_ReductionVals_23 signal to the FFS
  vRel_vs_Olap_ReductionVals_23: single  % TTC threshold reduction values by overlap/relative speed table
  IIPB_Buffer_40_V: uint8
  IIPB_Buffer_40: uint8
  vRel_vs_Olap_ReductionVals_24_V: uint8  % This validity flag, if set to TRUE, indicates that we should map the information sent to us in the vRel_vs_Overlap_ReductionVals_24 signal to the FFS
  vRel_vs_Olap_ReductionVals_24: single  % TTC threshold reduction values by overlap/relative speed table
  vRel_vs_Olap_vRelKneePts_0_V: uint8  % This validity flag, if set to TRUE, indicates that we should map the information sent to us in the vRel_vs_Overlap_vRelKneePts_0 signal to the FFS
  vRel_vs_Olap_vRelKneePts_0: single  % Relative speed kneepoints for TTC threshold reduction according to overlap between ego and target
  IIPB_Buffer_41_V: uint8
  IIPB_Buffer_41: uint8
  vRel_vs_Olap_vRelKneePts_1_V: uint8  % This validity flag, if set to TRUE, indicates that we should map the information sent to us in the vRel_vs_Overlap_vRelKneePts_1 signal to the FFS
  vRel_vs_Olap_vRelKneePts_1: single  % Relative speed kneepoints for TTC threshold reduction according to overlap between ego and target
  vRel_vs_Olap_vRelKneePts_2_V: uint8  % This validity flag, if set to TRUE, indicates that we should map the information sent to us in the vRel_vs_Overlap_vRelKneePts_2 signal to the FFS
  vRel_vs_Olap_vRelKneePts_2: single  % Relative speed kneepoints for TTC threshold reduction according to overlap between ego and target
  IIPB_Buffer_42_V: uint8
  IIPB_Buffer_42: uint8
  vRel_vs_Olap_vRelKneePts_3_V: uint8  % This validity flag, if set to TRUE, indicates that we should map the information sent to us in the vRel_vs_Overlap_vRelKneePts_3 signal to the FFS
  vRel_vs_Olap_vRelKneePts_3: single  % Relative speed kneepoints for TTC threshold reduction according to overlap between ego and target
  vRel_vs_Olap_vRelKneePts_4_V: uint8  % This validity flag, if set to TRUE, indicates that we should map the information sent to us in the vRel_vs_Overlap_vRelKneePts_4 signal to the FFS
  vRel_vs_Olap_vRelKneePts_4: single  % Relative speed kneepoints for TTC threshold reduction according to overlap between ego and target
  Reserved_1: uint8

EQ4_ILDW_BUS = Simulink.Bus()
  EQ4_ILDW_HDR: Bus: EQ4_ILDW_HDR_BUS

EQ4_ILDW_HDR_BUS = Simulink.Bus()
  ILDW_Zero_byte: uint8
  ILDW_Protocol_Version: uint8  % Denotes protocol version
  ILDW_Optional_Signals: uint8  % All signals are requierd
  ILDW_Header_Buffer: uint8
  LDW_Set_Enable_0: uint8  % Enabler flag for warning for First set
  LDW_Set_Enable_1: uint8  % Enabler flag for warning for Second set
  LDW_Set_Enable_2: uint8  % Enabler flag for warning for Third set
  LDW_Set_Enable_3: uint8  % Enabler flag for warning for Fourth set
  min_lane_width_0: single  % The minimal possible lane width. If the detected lane is narrower, warning availability will be dropped.
  min_lane_width_1: single  % The minimal possible lane width. If the detected lane is narrower, warning availability will be dropped.
  min_lane_width_2: single  % The minimal possible lane width. If the detected lane is narrower, warning availability will be dropped.
  Reserved_1: uint8
  min_lane_width_3: single  % The minimal possible lane width. If the detected lane is narrower, warning availability will be dropped.
  ind_min_wrn_disable_0: uint8  % When set to true, an ongoing warning is suppressed immediately when the driver is indicating without waiting for the min warning time to pass. For Set 1
  ind_min_wrn_disable_1: uint8  % When set to true, an ongoing warning is suppressed immediately when the driver is indicating without waiting for the min warning time to pass. For Set 2
  ind_min_wrn_disable_2: uint8  % When set to true, an ongoing warning is suppressed immediately when the driver is indicating without waiting for the min warning time to pass. For Set 3
  ind_min_wrn_disable_3: uint8  % When set to true, an ongoing warning is suppressed immediately when the driver is indicating without waiting for the min warning time to pass. For Set 4
  min_lane_width_hysteresis_0: single  % This signal prevents noisy min_lane_width suppression, or hysteresis on the minimum possible lane width. If the detected lane width minus the hysteresis is detected, warning availability is dropped. Warning availability only returns when the lane width plus the hysteresis is detected. For Set 1
  min_lane_width_hysteresis_1: single  % This signal prevents noisy min_lane_width suppression, or hysteresis on the minimum possible lane width. If the detected lane width minus the hysteresis is detected, warning availability is dropped. Warning availability only returns when the lane width plus the hysteresis is detected. For Set 2
  Reserved_2: uint8
  min_lane_width_hysteresis_2: single  % This signal prevents noisy min_lane_width suppression, or hysteresis on the minimum possible lane width. If the detected lane width minus the hysteresis is detected, warning availability is dropped. Warning availability only returns when the lane width plus the hysteresis is detected. For Set 3
  min_lane_width_hysteresis_3: single  % This signal prevents noisy min_lane_width suppression, or hysteresis on the minimum possible lane width. If the detected lane width minus the hysteresis is detected, warning availability is dropped. Warning availability only returns when the lane width plus the hysteresis is detected. For Set 4
  narrow_lane_width_0: single  % Defines a narrow road threshold. Below this threshold extra offsets are applied to the warning lines to avoid irrelevant warnings.
    % The extra offset is equal to half the difference between the current lane width and the narrow lane width. For example, if the lane width is 2.3m, a shift of -0.1m is added to each line.
    % This parameter needs to conform to the min_lane_width <= narrow_lane_width rule. For Set 1
  Reserved_3: uint8
  narrow_lane_width_1: single  % Defines a narrow road threshold. Below this threshold extra offsets are applied to the warning lines to avoid irrelevant warnings.
    % The extra offset is equal to half the difference between the current lane width and the narrow lane width. For example, if the lane width is 2.3m, a shift of -0.1m is added to each line.
    % This parameter needs to conform to the min_lane_width <= narrow_lane_width rule. For Set 2
  narrow_lane_width_2: single  % Defines a narrow road threshold. Below this threshold extra offsets are applied to the warning lines to avoid irrelevant warnings.
    % The extra offset is equal to half the difference between the current lane width and the narrow lane width. For example, if the lane width is 2.3m, a shift of -0.1m is added to each line.
    % This parameter needs to conform to the min_lane_width <= narrow_lane_width rule. For Set 3
  narrow_lane_width_3: single  % Defines a narrow road threshold. Below this threshold extra offsets are applied to the warning lines to avoid irrelevant warnings.
    % The extra offset is equal to half the difference between the current lane width and the narrow lane width. For example, if the lane width is 2.3m, a shift of -0.1m is added to each line.
    % This parameter needs to conform to the min_lane_width <= narrow_lane_width rule. For Set 4
  Reserved_4: uint8
  tlc_0: single  % Defines the time threshold for triggering a TLC warning. If the vehicle is about to cross the virtual warning line in less than "TLC" seconds, the LDW module issues a TLC warning. For Set 1
  tlc_1: single  % Defines the time threshold for triggering a TLC warning. If the vehicle is about to cross the virtual warning line in less than "TLC" seconds, the LDW module issues a TLC warning. For Set 2
  tlc_2: single  % Defines the time threshold for triggering a TLC warning. If the vehicle is about to cross the virtual warning line in less than "TLC" seconds, the LDW module issues a TLC warning. For Set 3
  tlc_3: single  % Defines the time threshold for triggering a TLC warning. If the vehicle is about to cross the virtual warning line in less than "TLC" seconds, the LDW module issues a TLC warning. For Set 4
  warning_line_tlc_0: single  % The shift of the virtual TLC warning line from the detected lane mark. For Set 1
  warning_line_tlc_1: single  % The shift of the virtual TLC warning line from the detected lane mark. For Set 2
  warning_line_tlc_2: single  % The shift of the virtual TLC warning line from the detected lane mark. For Set 3
  warning_line_tlc_3: single  % The shift of the virtual TLC warning line from the detected lane mark. For Set 4
  position_warning_dist_thresh_0: single  % The shift of the position warning line from the detected lane. For Set 1
  position_warning_dist_thresh_1: single  % The shift of the position warning line from the detected lane. For Set 2
  position_warning_dist_thresh_2: single  % The shift of the position warning line from the detected lane. For Set 3
  position_warning_dist_thresh_3: single  % The shift of the position warning line from the detected lane. For Set 4
  outer_dist_to_terminate_war_0: single  % After the host vehicle crosses this distance from the detected lane mark, the warning is terminated. (This is called the termination line.). For Set 1
  outer_dist_to_terminate_war_1: single  % After the host vehicle crosses this distance from the detected lane mark, the warning is terminated. (This is called the termination line.). For Set 2
  outer_dist_to_terminate_war_2: single  % After the host vehicle crosses this distance from the detected lane mark, the warning is terminated. (This is called the termination line.). For Set 3
  outer_dist_to_terminate_war_3: single  % After the host vehicle crosses this distance from the detected lane mark, the warning is terminated. (This is called the termination line.). For Set 4
  inner_reset_offset_0: single  % The distance in which the crossing wheel moves back from the approached lane, to enable a new warning when no crossing occurred. For Set 1
  inner_reset_offset_1: single  % The distance in which the crossing wheel moves back from the approached lane, to enable a new warning when no crossing occurred. For Set 2
  inner_reset_offset_2: single  % The distance in which the crossing wheel moves back from the approached lane, to enable a new warning when no crossing occurred. For Set 3
  Reserved_5: uint8
  inner_reset_offset_3: single  % The distance in which the crossing wheel moves back from the approached lane, to enable a new warning when no crossing occurred. For Set 4
  corridor_outer_boundary_0: single  % A warning is issued if this distance to the detected lane mark has not yet been crossed.  (This is only relevant if availability is lost and regained during the lane crossing. Must be negative. This negative value indicates a distance to the outer side of the detected lane mark.). For Set 1
  corridor_outer_boundary_1: single  % A warning is issued if this distance to the detected lane mark has not yet been crossed.  (This is only relevant if availability is lost and regained during the lane crossing. Must be negative. This negative value indicates a distance to the outer side of the detected lane mark.). For Set 2
  Reserved_6: uint8
  corridor_outer_boundary_2: single  % A warning is issued if this distance to the detected lane mark has not yet been crossed.  (This is only relevant if availability is lost and regained during the lane crossing. Must be negative. This negative value indicates a distance to the outer side of the detected lane mark.). For Set 3
  corridor_outer_boundary_3: single  % A warning is issued if this distance to the detected lane mark has not yet been crossed.  (This is only relevant if availability is lost and regained during the lane crossing. Must be negative. This negative value indicates a distance to the outer side of the detected lane mark.). For Set 4
  inner_curve_tlc_reduced_0: single  % Defines the maximal extra shift of the virtual TLC warning line in curves. For Set 1
  Reserved_7: uint8
  inner_curve_tlc_reduced_1: single  % Defines the maximal extra shift of the virtual TLC warning line in curves. For Set 2
  inner_curve_tlc_reduced_2: single  % Defines the maximal extra shift of the virtual TLC warning line in curves. For Set 3
  inner_curve_tlc_reduced_3: single  % Defines the maximal extra shift of the virtual TLC warning line in curves. For Set 4
  Reserved_8: uint8
  inner_curve_tlc_shift_thresh_0: single  % Defines a threshold on curvatures. A greater curvature is considered as a strong curvature for TLC warnings. For Set 1
  inner_curve_tlc_shift_thresh_1: single  % Defines a threshold on curvatures. A greater curvature is considered as a strong curvature for TLC warnings. For Set 2
  Reserved_9: uint8
  inner_curve_tlc_shift_thresh_2: single  % Defines a threshold on curvatures. A greater curvature is considered as a strong curvature for TLC warnings. For Set 3
  inner_curve_tlc_shift_thresh_3: single  % Defines a threshold on curvatures. A greater curvature is considered as a strong curvature for TLC warnings. For Set 4
  Reserved_10: uint8

EQ4_ILS_BUS = Simulink.Bus()
  EQ4_ILS_HDR: Bus: EQ4_ILS_HDR_BUS

EQ4_ILS_HDR_BUS = Simulink.Bus()
  ILS_Zero_byte: uint8
  ILS_Protocol_Version: uint8
  ILS_Optional_Signals: uint8  % number of optional signals.
  ILS_Buffer_1_V: uint8
  ILS_Buffer_1: uint8
  C_IN_CURVE_RADIUS_ENTER_THRESH_V: uint8  % This validity flag, if set to TRUE, tells us to map the information sent to us in the C_IN_CURVE_RADIUS_ENTER_THRESH signal to the FFS
  C_IN_CURVE_RADIUS_ENTER_THRESH: uint16  % When entering a road whose curve radius is (calculated/estimated to be) less than this, we enter curve road mode, which affects grace times
  C_IN_CURVE_RADIUS_EXIT_THRESH_V: uint8  % This validity flag, if set to TRUE, tells us to map the information sent to us in the C_IN_CURVE_RADIUS_EXIT_THRESH signal to the FFS
  C_IN_CURVE_RADIUS_EXIT_THRESH: uint16  % If we are in curve road mode and we estimate the current road curve radius to be more than this, we exit the state
  ILS_Buffer_2_V: uint8
  ILS_Buffer_2: uint8
  C_VERY_SHARP_CUR_RADIUS_ENTER_V: uint8  % This validity flag, if set to TRUE, tells us to map the information sent to us in the C_VERY_SHARP_CUR_RADIUS_ENTER signal to the FFS
  C_VERY_SHARP_CUR_RADIUS_ENTER: uint16  % When entering a road whose curve radius is (calculated/estimated to be) less than this, we enter very sharp curve mode, which affects grace times
  C_VERY_SHARP_CUR_RADIUS_EXIT_V: uint8  % This validity flag, if set to TRUE, tells us to map the information sent to us in the C_VERY_SHARP_CUR_RADIUS_EXIT signal to the FFS
  C_VERY_SHARP_CUR_RADIUS_EXIT: uint16  % If we are in very sharp curve mode and we estimate the current road curve radius to be more than this, we exit the state
  C_LOW_BEAM_ON_JUNCTION_V: uint8  % This validity flag, if set to TRUE, tells us to map the information sent to us in the C_LOW_BEAM_ON_JUNCTION signal to the FFS
  C_LOW_BEAM_ON_JUNCTION: uint8  % Set the junction decision reason on/off
  ILS_Buffer_3_V: uint8
  ILS_Buffer_3: uint8
  C_OC_CURVE_TIME_DELAY_V: uint8  % This validity flag, if set to TRUE, tells us to map the information sent to us in the C_OC_CURVE_TIME_DELAY signal to the FFS
  C_OC_CURVE_TIME_DELAY: uint16  % If we are in a curve road state and an OC leaves the image, this is the grace time to be set
  C_OC_MAX_DELAY_CURVE_UP_AHEAD_V: uint8  % This validity flag, if set to TRUE, tells us to map the information sent to us in the C_OC_MAX_DELAY_CURVE_UP_AHEAD signal to the FFS
  C_OC_MAX_DELAY_CURVE_UP_AHEAD: uint16  % Delay after oncoming while there is a curve on the road
  ILS_Buffer_4_V: uint8
  ILS_Buffer_4: uint8
  C_OC_MID_DISAP_TIME_DELAY_V: uint8  % This validity flag, if set to TRUE, tells us to map the information sent to us in the C_OC_MIDDLE_DISAP_TIME_DELAY signal to the FFS
  C_OC_MID_DISAP_TIME_DELAY: uint16  % Delay after disappearing oncoming
  C_OC_MID_DISAP_TIME_DELAY_HW_V: uint8  % This validity flag, if set to TRUE, tells us to map the information sent to us in the C_OC_MIDDLE_DISAP_TIME_DELAY_HW signal to the FFS
  C_OC_MID_DISAP_TIME_DELAY_HW: uint16  % Delay after disappearing oncoming on highway
  ILS_Buffer_5_V: uint8
  ILS_Buffer_5: uint8
  C_OC_NORMAL_TIME_DELAY_V: uint8  % This validity flag, if set to TRUE, tells us to map the information sent to us in the C_OC_NORMAL_TIME_DELAY signal to the FFS
  C_OC_NORMAL_TIME_DELAY: uint16  % Delay after oncoming
  C_OC_NORMAL_TIME_DELAY_HW_V: uint8  % This validity flag, if set to TRUE, tells us to map the information sent to us in the C_OC_NORMAL_TIME_DELAY_HW signal to the FFS
  C_OC_NORMAL_TIME_DELAY_HW: uint16  % Delay after oncoming on highway
  ILS_Buffer_6_V: uint8
  ILS_Buffer_6: uint8
  C_OC_STRONG_SUSP_TIME_DELAY_V: uint8  % This validity flag, if set to TRUE, tells us to map the information sent to us in the C_OC_STRONG_SUSP_TIME_DELAY signal to the FFS
  C_OC_STRONG_SUSP_TIME_DELAY: uint16  % Delay after oncoming while there is an oncoming suspect in the image
  C_OC_SUSPECT_TIME_DELAY_V: uint8  % This validity flag, if set to TRUE, tells us to map the information sent to us in the C_OC_SUSPECT_TIME_DELAY signal to the FFS
  C_OC_SUSPECT_TIME_DELAY: uint16  % Delay after oncoming while there is an oncoming suspect in the image
  C_TL_ENABLE_O_Take_CALC_V: uint8  % This validity flag, if set to TRUE, tells us to map the information sent to us in the C_TL_ENABLE_OVERTAKE_CALC signal to the FFS
  C_TL_ENABLE_O_Take_CALC: uint8  % Enable dynamic calculation of time to overtake to determine taillight grace
  ILS_Buffer_7_V: uint8
  ILS_Buffer_7: uint8
  C_TL_LAST_SEEN_SUSPECT_DELAY_V: uint8  % This validity flag, if set to TRUE, tells us to map the information sent to us in the C_TL_LAST_SEEN_SUSPECT_DELAY signal to the FFS
  C_TL_LAST_SEEN_SUSPECT_DELAY: uint16  % Delay after taillight while there is a suspect in the image
  C_TL_MAX_DELAY_CURVE_UP_AHEAD_V: uint8  % This validity flag, if set to TRUE, tells us to map the information sent to us in the C_TL_MAX_DELAY_CURVE_UP_AHEAD signal to the FFS
  C_TL_MAX_DELAY_CURVE_UP_AHEAD: uint16  % Delay after taillight while there is a curve on the road
  ILS_Buffer_8_V: uint8
  ILS_Buffer_8: uint8
  C_TL_MID_DISAP_TIME_DELAY_V: uint8  % This validity flag, if set to TRUE, tells us to map the information sent to us in the C_TL_MIDDLE_DISAP_TIME_DELAY signal to the FFS
  C_TL_MID_DISAP_TIME_DELAY: uint16  % Delay after disappearing taillight
  C_TL_MID_DISAP_TIME_DELAY_HW_V: uint8  % This validity flag, if set to TRUE, tells us to map the information sent to us in the C_TL_MIDDLE_DISAP_TIME_DELAY_HW signal to the FFS
  C_TL_MID_DISAP_TIME_DELAY_HW: uint16  % Delay after disappearing taillight on highway
  ILS_Buffer_9_V: uint8
  ILS_Buffer_9: uint8
  C_TL_NORMAL_TIME_DELAY_V: uint8  % This validity flag, if set to TRUE, tells us to map the information sent to us in the C_TL_NORMAL_TIME_DELAY signal to the FFS
  C_TL_NORMAL_TIME_DELAY: uint16  % Delay after taillight
  C_TL_NORMAL_TIME_DELAY_HW_V: uint8  % This validity flag, if set to TRUE, tells us to map the information sent to us in the C_TL_NORMAL_TIME_DELAY_HW signal to the FFS
  C_TL_NORMAL_TIME_DELAY_HW: uint16  % Delay after taillight on highway
  ILS_Buffer_10_V: uint8
  ILS_Buffer_10: uint8
  C_TL_OC_STRONG_SUSP_TIME_DELAY_V: uint8  % This validity flag, if set to TRUE, tells us to map the information sent to us in the C_TL_OC_STRONG_SUSP_TIME_DELAY signal to the FFS
  C_TL_OC_STRONG_SUSP_TIME_DELAY: uint16  % Last object recognized is TL, but there is also an OC STRONG suspect in the scene, this is the grace to be set
  C_TL_OC_SUSPECT_TIME_DELAY_V: uint8  % This validity flag, if set to TRUE, tells us to map the information sent to us in the C_TL_OC_SUSPECT_TIME_DELAY signal to the FFS
  C_TL_OC_SUSPECT_TIME_DELAY: uint16  % Last object recognized is TL, but there is also an OC suspect in the scene, this is the grace to be set
  ILS_Buffer_11_V: uint8
  ILS_Buffer_11: uint8
  C_TL_O_TAKE_H_BEAM_SIDE_ANGLE_V: uint8  % This validity flag, if set to TRUE, tells us to map the information sent to us in the C_TL_OVERTAKE_H_BEAM_SIDE_ANGLE signal to the FFS
  C_TL_O_TAKE_H_BEAM_SIDE_ANGLE: single  % Angle between host vehicle and target vehicle's front hood at which it is safe to switch back to high beam.
  C_TL_O_Take_MAX_TIME_DELAY_V: uint8  % This validity flag, if set to TRUE, tells us to map the information sent to us in the C_TL_OVERTAKE_MAX_TIME_DELAY signal to the FFS
  C_TL_O_Take_MAX_TIME_DELAY: uint16  % Upper bound for overtake calculation grace
  ILS_Buffer_12_V: uint8
  ILS_Buffer_12: uint8
  C_TL_O_Take_TRUCK_LENGTH_V: uint8  % This validity flag, if set to TRUE, tells us to map the information sent to us in the C_TL_OVERTAKE_TRUCK_LENGTH signal to the FFS
  C_TL_O_Take_TRUCK_LENGTH: single  % Length in meters of a typical target (overtaken) truck. This value is used if vehicle is marked as truck by VD or if its estimated width is larger than a regular vehicle.
  C_TL_O_Take_VEHICLE_LENGTH_V: uint8  % This validity flag, if set to TRUE, tells us to map the information sent to us in the C_TL_OVERTAKE_VEHICLE_LENGTH signal to the FFS
  C_TL_O_Take_VEHICLE_LENGTH: single  % Length in meters of a typical target (overtaken) vehicle
  SPEED_SWITCHING_HIGH_BEAMS_OFF_V: uint8  % This validity flag, if set to TRUE, tells us to map the information sent to us in the SPEED_SWITCHING_HIGH_BEAMS_OFF signal to the FFS
  SPEED_SWITCHING_HIGH_BEAMS_OFF: uint8  % Lower threshold for disabling two-step control
  ILS_Buffer_13_V: uint8
  ILS_Buffer_13: uint8
  SPEED_SWITCHING_HIGH_BEAMS_ON_V: uint8  % This validity flag, if set to TRUE, tells us to map the information sent to us in the SPEED_SWITCHING_HIGH_BEAMS_ON signal to the FFS
  SPEED_SWITCHING_HIGH_BEAMS_ON: uint8  % High threshold for enabling two-step control
  LN_US_ECE_BEHAVIOR_V: uint8  % This validity flag, if set to TRUE, tells us to map the information sent to us in the LN_US_ECE_BEHAVIOR signal to the FFS
  LN_US_ECE_BEHAVIOR: uint8  % 0 - set litNight behavior according to country code, 1 - force US behavior, 2 - force ECE behavior
  FAR_TAIL_KIL_DIST_COUPLE_V: uint8  % This validity flag, if set to TRUE, tells us to map the information sent to us in the FAR_TAIL_KIL_DIST_COUPLE signal to the FFS
  FAR_TAIL_KIL_DIST_COUPLE: uint16  % above this distance the system will remove taillight couple approval
  ILS_Buffer_14_V: uint8
  ILS_Buffer_14: uint8
  FAR_TAIL_KIL_DIST_COUPLE_CHI_V: uint8  % This validity flag, if set to TRUE, tells us to map the information sent to us in the FAR_TAIL_KIL_DIST_COUPLE_CHI signal to the FFS
  FAR_TAIL_KIL_DIST_COUPLE_CHI: uint16  % above this distance the system will remove taillight couple approval
  FAR_TAIL_KIL_DIST_ONE_V: uint8  % This validity flag, if set to TRUE, tells us to map the information sent to us in the FAR_TAIL_KIL_DIST_ONE signal to the FFS
  FAR_TAIL_KIL_DIST_ONE: uint16  % above this distance the system will remove single taillight approval
  ILS_Buffer_15_V: uint8
  ILS_Buffer_15: uint8
  FAR_TAIL_KIL_DIST_ONE_CHINA_V: uint8  % This validity flag, if set to TRUE, tells us to map the information sent to us in the FAR_TAIL_KIL_DIST_ONE_CHINA signal to the FFS
  FAR_TAIL_KIL_DIST_ONE_CHINA: uint16  % above this distance the system will remove single taillight approval. If region code is CHINA_RC this value will override the regular correlating parameter
  MAX_ONCOMING_DIST_COUPLE_V: uint8  % This validity flag, if set to TRUE, tells us to map the information sent to us in the MAX_ONCOMING_DIST_COUPLE signal to the FFS
  MAX_ONCOMING_DIST_COUPLE: uint16  % the maximum distance of couple oncomings which should be approved
  ILS_Buffer_16_V: uint8
  ILS_Buffer_16: uint8
  MAX_ONCOMING_DIST_COUPLE_CHINA_V: uint8  % This validity flag, if set to TRUE, tells us to map the information sent to us in the MAX_ONCOMING_DIST_COUPLE_CHINA signal to the FFS
  MAX_ONCOMING_DIST_COUPLE_CHINA: uint16  % the maximum distance of (couple) oncomings which should be approved/reported. If region code is CHINA_RC this value will override the regular correlating parameter
  MAX_OC_DIST_COUPLE_IN_LB_V: uint8  % This validity flag, if set to TRUE, tells us to map the information sent to us in the MAX_OC_DIST_COUPLE_IN_LB signal to the FFS
  MAX_OC_DIST_COUPLE_IN_LB: uint16  % the maximum distance of (couple) oncomings which should be approved/reported while in low beam
  ILS_Buffer_17_V: uint8
  ILS_Buffer_17: uint8
  MAX_OC_DIST_COUPLE_IN_LB_CHINA_V: uint8  % This validity flag, if set to TRUE, tells us to map the information sent to us in the MAX_OC_DIST_COUPLE_IN_LB_CHINA signal to the FFS
  MAX_OC_DIST_COUPLE_IN_LB_CHINA: uint16  % the maximum distance of (couple) oncomings which should be approved/reported while in low beam. If region code is CHINA_RC this value will override the regular correlating parameter
  MAX_OC_DIST_ONE_V: uint8  % This validity flag, if set to TRUE, tells us to map the information sent to us in the MAX_OC_DIST_ONE signal to the FFS
  MAX_OC_DIST_ONE: uint16  % the maximum distance of one oncomings which should be approved
  ILS_Buffer_18_V: uint8
  ILS_Buffer_18: uint8
  MAX_ONCOMING_DIST_ONE_CHINA_V: uint8  % This validity flag, if set to TRUE, tells us to map the information sent to us in the MAX_ONCOMING_DIST_ONE_CHINA signal to the FFS
  MAX_ONCOMING_DIST_ONE_CHINA: uint16  % the maximum distance of (one light source) oncomings which should be approved/reported. If region code is CHINA_RC this value will override the regular correlating parameter
  MAX_ONCOMING_DIST_ONE_IN_LB_V: uint8  % This validity flag, if set to TRUE, tells us to map the information sent to us in the MAX_ONCOMING_DIST_ONE_IN_LB signal to the FFS
  MAX_ONCOMING_DIST_ONE_IN_LB: uint16  % the maximum distance of (one light source) oncomings which should be approved/reported while in low beam
  ILS_Buffer_19_V: uint8
  ILS_Buffer_19: uint8
  MAX_OC_DIST_ONE_IN_LB_CHINA_V: uint8  % This validity flag, if set to TRUE, tells us to map the information sent to us in the MAX_OC_DIST_ONE_IN_LB_CHINA signal to the FFS
  MAX_OC_DIST_ONE_IN_LB_CHINA: uint16  % the maximum distance of (one light source) oncomings which should be approved/reported while in low beam. If region code is CHINA_RC this value will override the regular correlating parameter
  MAX_TAIL_DIST_COUPLE_V: uint8  % This validity flag, if set to TRUE, tells us to map the information sent to us in the MAX_TAIL_DIST_COUPLE signal to the FFS
  MAX_TAIL_DIST_COUPLE: uint16  % the maximum distance of couple tailights which should be approved
  ILS_Buffer_20_V: uint8
  ILS_Buffer_20: uint8
  MAX_TAIL_DIST_COUPLE_CHINA_V: uint8  % This validity flag, if set to TRUE, tells us to map the information sent to us in the MAX_TAIL_DIST_COUPLE_CHINA signal to the FFS
  MAX_TAIL_DIST_COUPLE_CHINA: uint16  % the maximum distance of (couple) tailights which should be approved/reported. If region code is CHINA_RC this value will override the regular correlating parameter
  MAX_TAIL_DIST_COUPLE_IN_LB_V: uint8  % This validity flag, if set to TRUE, tells us to map the information sent to us in the MAX_TAIL_DIST_COUPLE_IN_LB signal to the FFS
  MAX_TAIL_DIST_COUPLE_IN_LB: uint16  % the maximum distance of (couple) tailights which should be approved/reported while in low beam
  ILS_Buffer_21_V: uint8
  ILS_Buffer_21: uint8
  MAX_TAIL_DIST_COUP_IN_LB_CHINA_V: uint8  % This validity flag, if set to TRUE, tells us to map the information sent to us in the MAX_TAIL_DIST_COUPLE_IN_LB_CHINA signal to the FFS
  MAX_TAIL_DIST_COUPLE_IN_LB_CHINA: uint16  % the maximum distance of (couple) tailights which should be approved/reported while in low beam. If region code is CHINA_RC this value will override the regular correlating parameter
  MAX_TAIL_DIST_ONE_V: uint8  % This validity flag, if set to TRUE, tells us to map the information sent to us in the MAX_TAIL_DIST_ONE signal to the FFS
  MAX_TAIL_DIST_ONE: uint16  % the maximum distance of one tailights which should be approved
  ILS_Buffer_22_V: uint8
  ILS_Buffer_22: uint8
  MAX_TAIL_DIST_ONE_CHINA_V: uint8  % This validity flag, if set to TRUE, tells us to map the information sent to us in the MAX_TAIL_DIST_ONE_CHINA signal to the FFS
  MAX_TAIL_DIST_ONE_CHINA: uint16  % the maximum distance of (one light source) tailights which should be approved/reported. If region code is CHINA_RC this value will override the regular correlating parameter
  MAX_TAIL_DIST_ONE_IN_LB_V: uint8  % This validity flag, if set to TRUE, tells us to map the information sent to us in the MAX_TAIL_DIST_ONE_IN_LB signal to the FFS
  MAX_TAIL_DIST_ONE_IN_LB: uint16  % the maximum distance of (one light source) tailights which should be approved/reported while in low beam
  ILS_Buffer_23_V: uint8
  ILS_Buffer_23: uint8
  MAX_TAIL_DIST_ONE_IN_LB_CHINA_V: uint8  % This validity flag, if set to TRUE, tells us to map the information sent to us in the MAX_TAIL_DIST_ONE_IN_LB_CHINA signal to the FFS
  MAX_TAIL_DIST_ONE_IN_LB_CHINA: uint16  % the maximum distance of (one light source) tailights which should be approved/reported while in low beam. If region code is CHINA_RC this value will override the regular correlating parameter
  OBJECTS_CLUSTERING_METHOD_V: uint8  % This validity flag, if set to TRUE, tells us to map the information sent to us in the OBJECTS_CLUSTERING_METHOD signal to the FFS
  OBJECTS_CLUSTERING_METHOD: uint8  % clustering method of objects (only vehicle spots) within modelIF
  MAX_NUM_STRONG_REFLECTORS_V: uint8  % This validity flag, if set to TRUE, tells us to map the information sent to us in the MAX_NUM_STRONG_REFLECTORS signal to the FFS
  MAX_NUM_STRONG_REFLECTORS: uint8
  MAX_NUM_VEHICLE_OBJECTS_V: uint8  % This validity flag, if set to TRUE, tells us to map the information sent to us in the MAX_NUM_VEHICLE_OBJECTS signal to the FFS
  MAX_NUM_VEHICLE_OBJECTS: uint8  % if more vehicle than this number exists - clustering will run
  Reduce_Sense_Force_Activation_V: uint8  % This validity flag, if set to TRUE, tells us to map the information sent to us in the Reduce_Sense_Force_Activation signal to the FFS
  Reduce_Sense_Force_Activation: uint8  % reduced Sensitivity force option. (0-2) default is 2 -- no force, 0 -- force off, 1 force on.
  ILS_Buffer_24_V: uint8
  ILS_Buffer_24: uint8
  Reduce_Sense_Grace_Frames_V: uint8  % This validity flag, if set to TRUE, tells us to map the information sent to us in the Reduce_Sense_Grace_Frames signal to the FFS
  Reduce_Sense_Grace_Frames: uint8  % Number of frames after there is a tracked spot and before leaving reduced sensitivity scene.
  Reduce_Sense_HighToLow_V: uint8  % This validity flag, if set to TRUE, tells us to map the information sent to us in the Reduce_Sense_HighToLow signal to the FFS
  Reduce_Sense_HighToLow: single  % Threshold (in Candela) to switch from high to low beam in dark scenes.
  Reduce_Sense_HighToLow_H5R_V: uint8  % This validity flag, if set to TRUE, tells us to map the information sent to us in the Reduce_Sense_HighToLow_H5R signal to the FFS
  Reduce_Sense_HighToLow_H5R: single  % Threshold (in Candela) to switch from high to low beam when light source is located as in reduced sensitivity scene H5R.
  ILS_Buffer_25_V: uint8
  ILS_Buffer_25: uint8
  Reduce_Sense_LowToHigh_V: uint8  % This validity flag, if set to TRUE, tells us to map the information sent to us in the Reduce_Sense_LowToHigh signal to the FFS
  Reduce_Sense_LowToHigh: single  % Threshold (in Candela) to switch from low to high beam.
  ONCOMING_SENSITIVITY_V: uint8  % This validity flag, if set to TRUE, tells us to map the information sent to us in the ONCOMING_SENSITIVITY signal to the FFS
  ONCOMING_SENSITIVITY: single  % Sensitivity parameter for oncoming spot
  TAILLIGHT_SENSITIVITY_V: uint8  % This validity flag, if set to TRUE, tells us to map the information sent to us in the TAILLIGHT_SENSITIVITY signal to the FFS
  TAILLIGHT_SENSITIVITY: single  % Sensitivity parameter for taillight spot
  OC_REDUCED_SENSITIVITY_V: uint8  % This validity flag, if set to TRUE, tells us to map the information sent to us in the OC_REDUCED_SENSITIVITY signal to the FFS
  OC_REDUCED_SENSITIVITY: single  % reduced sensitivity factor for reducing oncoming FP (typically in US). The higher the value the quicker the required threshold will rise, making it effectively harder to approve spots on the side
  VE_OBJ_APPROVAL_DIST_FULL_FOV_V: uint8  % This validity flag, if set to TRUE, tells us to map the information sent to us in the VE_OBJ_APPROVAL_DIST_FULL_FOV signal to the FFS
  VE_OBJ_APPROVAL_DIST_FULL_FOV: uint16  % Before approving a vehicle object, if the object distance is below this value, it will be approved regardless it's x position.
  VE_OBJ_APPROVAL_FOV_V: uint8  % This validity flag, if set to TRUE, tells us to map the information sent to us in the VE_OBJ_APPROVAL_FOV signal to the FFS
  VE_OBJ_APPROVAL_FOV: single  % Before approving a vehicle object, if the object x position is above this value, the object will not be approved unless it's distance is below VEHICLE_OBJECTS_APPROVAL_DISTANCE_FULL_FOV
  MIN_TTLI_V: uint8  % This validity flag, if set to TRUE, tells us to map the information sent to us in the MIN_TTLI signal to the FFS
  MIN_TTLI: single  % (min time to leave image), if a spot will leave the image in time smaller than this value, it will not be approved [s]
  BS_DUSK_DELAY_V: uint8  % This validity flag, if set to TRUE, tells us to map the information sent to us in the BS_DUSK_DELAY signal to the FFS
  BS_DUSK_DELAY: uint32  % Timer to prevent entering HLB_FULL after seeing bright sky (~dusk with trees) (in ms - max delay is 10 minutes)
  BS_ENTER_THRESH_V: uint8  % This validity flag, if set to TRUE, tells us to map the information sent to us in the BS_ENTER_THRESH signal to the FFS
  BS_ENTER_THRESH: single  % Entrance threshold for bright scene decision (AML)
  BS_EXIT_THRESH_V: uint8  % This validity flag, if set to TRUE, tells us to map the information sent to us in the BS_EXIT_THRESH signal to the FFS
  BS_EXIT_THRESH: single  % Exit threshold for bright scene decision (AML)
  BS_OB_ENTER_THRESH_V: uint8  % This validity flag, if set to TRUE, tells us to map the information sent to us in the BS_OB_ENTER_THRESH  signal to the FFS
  BS_OB_ENTER_THRESH: single  % Determines enter threshold of Obviously Bright signal (implemented as signal)
  ILS_Buffer_26_V: uint8
  ILS_Buffer_26: uint8
  BS_OB_EXIT_THRESH_V: uint8  % This validity flag, if set to TRUE, tells us to map the information sent to us in the BS_OB_EXIT_THRESH  signal to the FFS
  BS_OB_EXIT_THRESH: single  % Determines exit threshold of Obviously Bright signal (implemented as signal)
  CONTROL_LOW_BEAM_ON_BLINK_TFL_V: uint8  % This validity flag, if set to TRUE, tells us to map the information sent to us in the CONTROL_LOW_BEAM_ON_BLINK_TFL  signal to the FFS
  CONTROL_LOW_BEAM_ON_BLINK_TFL: uint8  % Activate low beam decision due to blinking TFL
  CONTROL_OC_CURVY_ROAD_DELAY_V: uint8  % This validity flag, if set to TRUE, tells us to map the information sent to us in the CONTROL_OC_CURVY_ROAD_DELAY  signal to the FFS
  CONTROL_OC_CURVY_ROAD_DELAY: uint16  % If we are in a curvy road (multi-frame calculation based on curvatures) state and an OC leaves the image, this is the grace time to be set
  ILS_Buffer_27_V: uint8
  ILS_Buffer_27: uint8
  CONTROL_TL_CURVY_ROAD_DELAY_V: uint8  % This validity flag, if set to TRUE, tells us to map the information sent to us in the CONTROL_TL_CURVY_ROAD_DELAY  signal to the FFS
  CONTROL_TL_CURVY_ROAD_DELAY: uint16  % If we are in a curvy road (multi-frame calculation based on curvatures) state and an OC leaves the image, this is the grace time to be set
  COUPLE_H_LIGHTS_DIST_PRIVATE_V: uint8  % This validity flag, if set to TRUE, tells us to map the information sent to us in the COUPLE_H_LIGHTS_DIST_PRIVATE  signal to the FFS
  COUPLE_H_LIGHTS_DIST_PRIVATE: single  % DIST between right and left headlamps in a private vehicle
  COUPLE_H_LIGHTS_DIST_TRUCK_V: uint8  % This validity flag, if set to TRUE, tells us to map the information sent to us in the COUPLE_H_LIGHTS_DIST_TRUCK  signal to the FFS
  COUPLE_H_LIGHTS_DIST_TRUCK: single  % DIST between right and left headlamps in a truck
  COUPLE_T_LIGHTS_DIST_PRIVATE_V: uint8  % This validity flag, if set to TRUE, tells us to map the information sent to us in the COUPLE_T_LIGHTS_DIST_PRIVATE  signal to the FFS
  COUPLE_T_LIGHTS_DIST_PRIVATE: single  % DIST between right and left taillight in a private vehicle
  COUPLE_T_LIGHTS_DIST_TRUCK_V: uint8  % This validity flag, if set to TRUE, tells us to map the information sent to us in the COUPLE_T_LIGHTS_DIST_TRUCK  signal to the FFS
  COUPLE_T_LIGHTS_DIST_TRUCK: single  % DIST between right and left taillight in a truck
  DARK_SCENE_ONCOMING_SENS_V: uint8  % This validity flag, if set to TRUE, tells us to map the information sent to us in the DARK_SCENE_ONCOMING_SENS  signal to the FFS
  DARK_SCENE_ONCOMING_SENS: single  % SENS parameter for oncoming spots in dark scene
  ILS_Buffer_28_V: uint8
  ILS_Buffer_28: uint8
  DARK_SCENE_TAILLIGHT_SENS_V: uint8  % This validity flag, if set to TRUE, tells us to map the information sent to us in the DARK_SCENE_TAILLIGHT_SENS  signal to the FFS
  DARK_SCENE_TAILLIGHT_SENS: single  % SENS parameter for taillight spots in dark scene
  DELAY_HLB_FULL_TO_INACTIVE_V: uint8  % This validity flag, if set to TRUE, tells us to map the information sent to us in the DELAY_HLB_FULL_TO_INACTIVE  signal to the FFS
  DELAY_HLB_FULL_TO_INACTIVE: uint16  % Time delay (ms) before exiting HLB_FULL tech running mode
  ILS_Buffer_29_V: uint8
  ILS_Buffer_29: uint8
  DELAY_HLB_INACTIVE_TO_FULL_V: uint8  % This validity flag, if set to TRUE, tells us to map the information sent to us in the DELAY_HLB_INACTIVE_TO_FULL  signal to the FFS
  DELAY_HLB_INACTIVE_TO_FULL: uint32  % Time delay (ms) before switching from HLB_INACTIVE to FULL
  HEADLIGHTS_HEIGHT_V: uint8  % This validity flag, if set to TRUE, tells us to map the information sent to us in the HEADLIGHTS_HEIGHT  signal to the FFS
  HEADLIGHTS_HEIGHT: single  % Height of headlights from ground
  MAX_NUM_MODELIF_STREET_LIGHTS_V: uint8  % This validity flag, if set to TRUE, tells us to map the information sent to us in the MAX_NUM_MODELIF_STREET_LIGHTS  signal to the FFS
  MAX_NUM_MODELIF_STREET_LIGHTS: uint8  % Maximum number of streetlights to report
  NO_HLB_V: uint8  % This validity flag, if set to TRUE, tells us to map the information sent to us in the NO_HLB  signal to the FFS
  NO_HLB: uint8  % Turns off hlb functionality completely (both modelIF and tech)
  NO_HLB_MODEL_V: uint8  % This validity flag, if set to TRUE, tells us to map the information sent to us in the NO_HLB_MODEL  signal to the FFS
  NO_HLB_MODEL: uint8  % Disable hlb modelIF; tech will still be running (implemented as signal)
  REFLECTOR_MIN_BRIGHTNESS_V: uint8  % This validity flag, if set to TRUE, tells us to map the information sent to us in the REFLECTOR_MIN_BRIGHTNESS  signal to the FFS
  REFLECTOR_MIN_BRIGHTNESS: single  % Below this threshold, strong reflectors will not be reported
  REFLECTOR_MIN_SIZE_V: uint8  % This validity flag, if set to TRUE, tells us to map the information sent to us in the REFLECTOR_MIN_SIZE  signal to the FFS
  REFLECTOR_MIN_SIZE: uint16  % Below this threshold in pixels, strong reflectors will not be reported
  ILS_Buffer_30_V: uint8
  ILS_Buffer_30: uint8
  REFLECTOR_ROI_X_V: uint8  % This validity flag, if set to TRUE, tells us to map the information sent to us in the REFLECTOR_ROI_X  signal to the FFS
  REFLECTOR_ROI_X: single  % ROI for strong reflectors (to right and left)
  REFLECTOR_ROI_Y_V: uint8  % This validity flag, if set to TRUE, tells us to map the information sent to us in the REFLECTOR_ROI_Y  signal to the FFS
  REFLECTOR_ROI_Y: single  % ROI for strong reflectors (to bottom and top)
  ILS_Buffer_31_V: uint8
  ILS_Buffer_31: uint8
  SL_MAX_GRACE_DIST_HIGH_SPEED_V: uint8  % This validity flag, if set to TRUE, tells us to map the information sent to us in the SL_MAX_GRACE_DIST_HIGH_SPEED  signal to the FFS
  SL_MAX_GRACE_DIST_HIGH_SPEED: uint8  % When exiting Street Light mode, if we are in High Speed mode (egoSpeed above SL_LOW_SPEED), this is the maximum grace (egoDIST) we will use
  SL_MAX_GRACE_DIST_LOW_SPEED_V: uint8  % This validity flag, if set to TRUE, tells us to map the information sent to us in the SL_MAX_GRACE_DIST_LOW_SPEED  signal to the FFS
  SL_MAX_GRACE_DIST_LOW_SPEED: uint8  % When exiting Street Light mode, if we are in Low Speed mode (egoSpeed above SL_VILLAGE_SPEED+not high), this is the maximum grace (egoDIST) we will use
  SL_MAX_GRACE_DIST_VILL_SPEED_V: uint8  % This validity flag, if set to TRUE, tells us to map the information sent to us in the SL_MAX_GRACE_DIST_VILL_SPEED  signal to the FFS
  SL_MAX_GRACE_DIST_VILL_SPEED: uint8  % When exiting Street Light mode, if we are in VILL Speed mode (egoSpeed below SL_VILL_SPEED), this is the maximum grace (egoDIST) we will use
  ILS_Buffer_32_V: uint8
  ILS_Buffer_32: uint8
  TAILLIGHTS_HEIGHT_V: uint8  % This validity flag, if set to TRUE, tells us to map the information sent to us in the TAILLIGHTS_HEIGHT  signal to the FFS
  TAILLIGHTS_HEIGHT: single  % Height of taillights from ground
  ACTIVE_STATIONARY_TESTING_V: uint8  % This validity flag, if set to TRUE, tells us to map the information sent to us in the ACTIVE_STATIONARY_TESTING  signal to the FFS
  ACTIVE_STATIONARY_TESTING: uint8  % Activate HLB_FULL even when vehicle is stationary (used for testing)
  OVERTAKING_SIDELONG_OBJECTS_V: uint8  % This validity flag, if set to TRUE, tells us to map the information sent to us in the OVERTAKING_SIDELONG_OBJECTS signal to the FFS
  OVERTAKING_SIDELONG_OBJECTS: uint8  % If TRUE, allows detection of crossing (1) and overtaking (2) vehicles using fusion with Vehicle Detection tech. Approved vehicles receive the code vehicleSubType (LSV_Sub_Type) 1 or 2 (correlating to 1 and 2 above).
  USE_CITY_ENTRANCE_V: uint8  % This validity flag, if set to TRUE, tells us to map the information sent to us in the USE_CITY_ENTRANCE signal to the FFS
  USE_CITY_ENTRANCE: uint8  % If TRUE, allows fusion between TSR's city entrance signs and the street light detection to trigger an earlier lit-night signal.
  LN_ONLY_SL_SPEED_EXIT_V: uint8  % This validity flag, if set to TRUE, tells us to map the information sent to us in theLN_ONLY_SL_SPEED_EXIT signal to the FFS
  LN_ONLY_SL_SPEED_EXIT: uint8  % Hysteresis for the parameter LN_ONLY_SL_SPEED_ENTER. LN_ONLY_SL_SPEED_ENTER must be higher than LN_ONLY_SL_SPEED_EXIT
  LN_ONLY_SL_SPEED_ENTER_V: uint8  % This validity flag, if set to TRUE, tells us to map the information sent to us in the LN_ONLY_SL_SPEED_ENTER signal to the FFS
  LN_ONLY_SL_SPEED_ENTER: uint8  % Above this speed (kph), turning on litNight can be a result of slScene decision + AML decision. LN_ONLY_SL_SPEED_ENTER must be higher than LN_ONLY_SL_SPEED_EXIT
  USE_DUSK_ACTIVATION_V: uint8  % This validity flag, if set to TRUE, tells us to map the information sent to us in the USE_DUSK_ACTIVATION signal to the FFS
  USE_DUSK_ACTIVATION: uint8  % If TRUE will activate dusk activation development before ML5
  POSITION_PREDICTION_V: uint8  % This validity flag, if set to TRUE, tells us to map the information sent to us in the POSITION_PREDICTION signal to the FFS
  POSITION_PREDICTION: uint16  % Time to predict object’s position in millisecond
  LIGHTCONE_DETECTION_MODE_V: uint8  % This validity flag, if set to TRUE, tells us to map the information sent to us in the LIGHTCONE_DETECTION_MODE signal to the FFS
  LIGHTCONE_DETECTION_MODE: uint8  % Activate lightcone scene detection
  DETECTION_SENSITIVITY_V: uint8  % This validity flag, if set to TRUE, tells us to map the information sent to us in the DETECTION_SENSITIVITY signal to the FFS
  DETECTION_SENSITIVITY: int8  % Tuning of the whole detection system
  LSI_Buffer_C12: uint8
  LSI_Buffer_C13: single
  LSI_Buffer_C14: uint8
  ILS_Buffer_33_V: uint8
  ILS_Buffer_33: uint8
  LSI_Buffer_C15: single
  USE_SINGLE_OBJECT_CLUSTERING_V: uint8  % This validity flag, if set to TRUE, tells us to map the information sent to us in the USE_SINGLE_OBJECT_CLUSTERING signal to the FFS
  USE_SINGLE_OBJECT_CLUSTERING: uint8  % Activation parameter for single object clustering development
  Reserved_1: uint8

EQ4_IMTFV_BUS = Simulink.Bus()
  EQ4_IMTFV_HDR: Bus: EQ4_IMTFV_HDR_BUS

EQ4_IMTFV_HDR_BUS = Simulink.Bus()
  IMTFV_Zero_byte: uint8
  IMTFV_Protocol_Version: uint8
  IMTFV_Optional_Signals: uint8  % All signals are requierd
  IMTFV_Camera_Identity: int8  % Which camera is being initialised for MTF Verification
  IMTFV_Fixed_Exposure: uint16  % Represents a request for a fixed exposure at that many line times.
  IMTFV_Mode: uint8  % Select which quad configuration and number of targets  that the EyeQ should search for during system initialisation
  Reserved_1: uint8

EQ4_IPCW_BUS = Simulink.Bus()
  EQ4_IPCW_HDR: Bus: EQ4_IPCW_HDR_BUS

EQ4_IPCW_HDR_BUS = Simulink.Bus()
  IPCW_Zero_byte: uint8
  IPCW_Protocol_Version: uint8
  IPCW_Optional_Signals: uint8  % Number of optional signals (has validator bit)
  PCA_Ignition_default_state_V: uint8  % This validity flag, if set to TRUE, tells us to map the information sent to us in the PCA_Ignition_default_state signal to the FFS
  PCA_Ignition_default_state: uint8  % Initial level of gap sensitivity
  PCW_Buffer_1_V: uint8
  PCW_Buffer_1: uint8
  PCW_FCV_MediumTTCAddition_V: uint8  % This validity flag, if set to TRUE, tells us to map the information sent to us in the PCW_FCV_MediumTTCAddition signal to the FFS
  PCW_FCV_MediumTTCAddition: single  % Addition of TTC values to the TTC threshold to activate medium level
  PCW_LX_TTC_kneePoints_warn_0_V: uint8  % This validity flag, if set to TRUE, tells us to map the information sent to us in the PCW_LX_TTC_kneePoints_warn_0 signal to the FFS
  PCW_LX_TTC_kneePoints_warn_0: single  % TTC threshold kneepoints for pedestrian targets by day
  PCW_LX_TTC_kneePoints_warn_1_V: uint8  % This validity flag, if set to TRUE, tells us to map the information sent to us in the PCW_LX_TTC_kneePoints_warn_1 signal to the FFS
  PCW_LX_TTC_kneePoints_warn_1: single  % TTC threshold kneepoints for pedestrian targets by day
  PCW_Buffer_2_V: uint8
  PCW_Buffer_2: uint8
  PCW_LX_TTC_kneePoints_warn_2_V: uint8  % This validity flag, if set to TRUE, tells us to map the information sent to us in the PCW_LX_TTC_kneePoints_warn_2 signal to the FFS
  PCW_LX_TTC_kneePoints_warn_2: single  % TTC threshold kneepoints for pedestrian targets by day
  PCW_LX_TTC_kneePoints_warn_3_V: uint8  % This validity flag, if set to TRUE, tells us to map the information sent to us in the PCW_LX_TTC_kneePoints_warn_3 signal to the FFS
  PCW_LX_TTC_kneePoints_warn_3: single  % TTC threshold kneepoints for pedestrian targets by day
  PCW_LX_TTC_kneePoints_warn_4_V: uint8  % This validity flag, if set to TRUE, tells us to map the information sent to us in the PCW_LX_TTC_kneePoints_warn_4 signal to the FFS
  PCW_LX_TTC_kneePoints_warn_4: single  % TTC threshold kneepoints for pedestrian targets by day
  PCW_Buffer_3_V: uint8
  PCW_Buffer_3: uint8
  PCW_LX_TTC_kneePoints_warn_5_V: uint8  % This validity flag, if set to TRUE, tells us to map the information sent to us in the PCW_LX_TTC_kneePoints_warn_5 signal to the FFS
  PCW_LX_TTC_kneePoints_warn_5: single  % TTC threshold kneepoints for pedestrian targets by day
  PCW_LX_TTC_kneePoints_night_0_V: uint8  % This validity flag, if set to TRUE, tells us to map the information sent to us in the PCW_LX_TTC_kneePoints_night_0 signal to the FFS
  PCW_LX_TTC_kneePoints_night_0: single  % TTC threshold kneepoints for pedestrian targets by day
  PCW_LX_TTC_kneePoints_night_1_V: uint8  % This validity flag, if set to TRUE, tells us to map the information sent to us in the PCW_LX_TTC_kneePoints_night_1 signal to the FFS
  PCW_LX_TTC_kneePoints_night_1: single  % TTC threshold kneepoints for pedestrian targets at night
  PCW_Buffer_4_V: uint8
  PCW_Buffer_4: uint8
  PCW_LX_TTC_kneePoints_night_2_V: uint8  % This validity flag, if set to TRUE, tells us to map the information sent to us in the PCW_LX_TTC_kneePoints_night_2 signal to the FFS
  PCW_LX_TTC_kneePoints_night_2: single  % TTC threshold kneepoints for pedestrian targets at night
  PCW_LX_TTC_kneePoints_night_3_V: uint8  % This validity flag, if set to TRUE, tells us to map the information sent to us in the PCW_LX_TTC_kneePoints_night_3 signal to the FFS
  PCW_LX_TTC_kneePoints_night_3: single  % TTC threshold kneepoints for pedestrian targets at night
  PCW_LX_TTC_kneePoints_night_4_V: uint8  % This validity flag, if set to TRUE, tells us to map the information sent to us in the PCW_LX_TTC_kneePoints_night_4 signal to the FFS
  PCW_LX_TTC_kneePoints_night_4: single  % TTC threshold kneepoints for pedestrian targets at night
  PCW_Buffer_5_V: uint8
  PCW_Buffer_5: uint8
  PCW_LX_TTC_kneePoints_night_5_V: uint8  % This validity flag, if set to TRUE, tells us to map the information sent to us in the PCW_LX_TTC_kneePoints_night_5 signal to the FFS
  PCW_LX_TTC_kneePoints_night_5: single  % TTC threshold kneepoints for pedestrian targets at night
  PCW_LX_TTC_kPoints_bicycle_0_V: uint8  % This validity flag, if set to TRUE, tells us to map the information sent to us in the PCW_LX_TTC_kPoints_bicycle_0 signal to the FFS
  PCW_LX_TTC_kPoints_bicycle_0: single  % TTC threshold kneepoints for cyclist targets by day
  PCW_LX_TTC_kPoints_bicycle_1_V: uint8  % This validity flag, if set to TRUE, tells us to map the information sent to us in the PCW_LX_TTC_kPoints_bicycle_1 signal to the FFS
  PCW_LX_TTC_kPoints_bicycle_1: single  % TTC threshold kneepoints for cyclist targets by day
  PCW_Buffer_6_V: uint8
  PCW_Buffer_6: uint8
  PCW_LX_TTC_kPoints_bicycle_2_V: uint8  % This validity flag, if set to TRUE, tells us to map the information sent to us in the PCW_LX_TTC_kPoints_bicycle_2 signal to the FFS
  PCW_LX_TTC_kPoints_bicycle_2: single  % TTC threshold kneepoints for cyclist targets by day
  PCW_LX_TTC_kPoints_bicycle_3_V: uint8  % This validity flag, if set to TRUE, tells us to map the information sent to us in the PCW_LX_TTC_kPoints_bicycle_3 signal to the FFS
  PCW_LX_TTC_kPoints_bicycle_3: single  % TTC threshold kneepoints for cyclist targets by day
  PCW_LX_TTC_kPoints_bicycle_4_V: uint8  % This validity flag, if set to TRUE, tells us to map the information sent to us in the PCW_LX_TTC_kPoints_bicycle_4 signal to the FFS
  PCW_LX_TTC_kPoints_bicycle_4: single  % TTC threshold kneepoints for cyclist targets by day
  PCW_Buffer_7_V: uint8
  PCW_Buffer_7: uint8
  PCW_LX_TTC_kPoints_bicycle_5_V: uint8  % This validity flag, if set to TRUE, tells us to map the information sent to us in the PCW_LX_TTC_kPoints_bicycle_5 signal to the FFS
  PCW_LX_TTC_kPoints_bicycle_5: single  % TTC threshold kneepoints for cyclist targets by day
  PCW_LX_TTC_kPoints_bicy_N_0_V: uint8  % This validity flag, if set to TRUE, tells us to map the information sent to us in the PCW_LX_TTC_kPoints_bicy_N_0 signal to the FFS
  PCW_LX_TTC_kPoints_bicy_N_0: single  % TTC threshold kneepoints for cyclist targets at night
  PCW_LX_TTC_kPoints_bicy_N_1_V: uint8  % This validity flag, if set to TRUE, tells us to map the information sent to us in the PCW_LX_TTC_kPoints_bicy_N_1 signal to the FFS
  PCW_LX_TTC_kPoints_bicy_N_1: single  % TTC threshold kneepoints for cyclist targets at night
  PCW_Buffer_8_V: uint8
  PCW_Buffer_8: uint8
  PCW_LX_TTC_kPoints_bicy_N_2_V: uint8  % This validity flag, if set to TRUE, tells us to map the information sent to us in the PCW_LX_TTC_kPoints_bicy_N_2 signal to the FFS
  PCW_LX_TTC_kPoints_bicy_N_2: single  % TTC threshold kneepoints for cyclist targets at night
  PCW_LX_TTC_kPoints_bicy_N_3_V: uint8  % This validity flag, if set to TRUE, tells us to map the information sent to us in the PCW_LX_TTC_kPoints_bicy_N_3 signal to the FFS
  PCW_LX_TTC_kPoints_bicy_N_3: single  % TTC threshold kneepoints for cyclist targets at night
  PCW_LX_TTC_kPoints_bicy_N_4_V: uint8  % This validity flag, if set to TRUE, tells us to map the information sent to us in the PCW_LX_TTC_kPoints_bicy_N_4 signal to the FFS
  PCW_LX_TTC_kPoints_bicy_N_4: single  % TTC threshold kneepoints for cyclist targets at night
  PCW_Buffer_9_V: uint8
  PCW_Buffer_9: uint8
  PCW_LX_TTC_kPoints_bicy_N_5_V: uint8  % This validity flag, if set to TRUE, tells us to map the information sent to us in the PCW_LX_TTC_kPoints_bicy_N_5 signal to the FFS
  PCW_LX_TTC_kPoints_bicy_N_5: single  % TTC threshold kneepoints for cyclist targets at night
  PCW_LX_speed_kneePoints_0_V: uint8  % This validity flag, if set to TRUE, tells us to map the information sent to us in the PCW_LX_speed_kneePoints_0 signal to the FFS
  PCW_LX_speed_kneePoints_0: single  % Speed kneepoints for pedestrian targets
  PCW_Buffer_10_V: uint8
  PCW_Buffer_10: uint8
  PCW_LX_speed_kneePoints_1_V: uint8  % This validity flag, if set to TRUE, tells us to map the information sent to us in the PCW_LX_speed_kneePoints_1 signal to the FFS
  PCW_LX_speed_kneePoints_1: single  % Speed kneepoints for pedestrian targets
  PCW_LX_speed_kneePoints_2_V: uint8  % This validity flag, if set to TRUE, tells us to map the information sent to us in the PCW_LX_speed_kneePoints_2 signal to the FFS
  PCW_LX_speed_kneePoints_2: single  % Speed kneepoints for pedestrian targets
  PCW_Buffer_11_V: uint8
  PCW_Buffer_11: uint8
  PCW_LX_speed_kneePoints_3_V: uint8  % This validity flag, if set to TRUE, tells us to map the information sent to us in the PCW_LX_speed_kneePoints_3 signal to the FFS
  PCW_LX_speed_kneePoints_3: single  % Speed kneepoints for pedestrian targets
  PCW_LX_speed_kneePoints_4_V: uint8  % This validity flag, if set to TRUE, tells us to map the information sent to us in the PCW_LX_speed_kneePoints_4 signal to the FFS
  PCW_LX_speed_kneePoints_4: single  % Speed kneepoints for pedestrian targets
  PCW_Buffer_12_V: uint8
  PCW_Buffer_12: uint8
  PCW_LX_speed_kneePoints_5_V: uint8  % This validity flag, if set to TRUE, tells us to map the information sent to us in the PCW_LX_speed_kneePoints_5 signal to the FFS
  PCW_LX_speed_kneePoints_5: single  % Speed kneepoints for pedestrian targets
  PCW_LX_speed_kPoint_bicycles_0_V: uint8  % This validity flag, if set to TRUE, tells us to map the information sent to us in the PCW_LX_speed_kPoint_bicycles_0 signal to the FFS
  PCW_LX_speed_kPoint_bicycles_0: single  % Speed kneepoints for pedestrian targets
  PCW_Buffer_13_V: uint8
  PCW_Buffer_13: uint8
  PCW_LX_speed_kPoint_bicycles_1_V: uint8  % This validity flag, if set to TRUE, tells us to map the information sent to us in the PCW_LX_speed_kPoint_bicycles_1 signal to the FFS
  PCW_LX_speed_kPoint_bicycles_1: single  % Speed kneepoints for pedestrian targets
  PCW_LX_speed_kPoint_bicycles_2_V: uint8  % This validity flag, if set to TRUE, tells us to map the information sent to us in the PCW_LX_speed_kPoint_bicycles_2 signal to the FFS
  PCW_LX_speed_kPoint_bicycles_2: single  % Speed kneepoints for pedestrian targets
  PCW_Buffer_14_V: uint8
  PCW_Buffer_14: uint8
  PCW_LX_speed_kPoint_bicycles_3_V: uint8  % This validity flag, if set to TRUE, tells us to map the information sent to us in the PCW_LX_speed_kPoint_bicycles_3 signal to the FFS
  PCW_LX_speed_kPoint_bicycles_3: single  % Speed kneepoints for pedestrian targets
  PCW_LX_speed_kPoint_bicycles_4_V: uint8  % This validity flag, if set to TRUE, tells us to map the information sent to us in the PCW_LX_speed_kPoint_bicycles_4 signal to the FFS
  PCW_LX_speed_kPoint_bicycles_4: single  % Speed kneepoints for pedestrian targets
  PCW_Buffer_15_V: uint8
  PCW_Buffer_15: uint8
  PCW_LX_speed_kPoint_bicycles_5_V: uint8  % This validity flag, if set to TRUE, tells us to map the information sent to us in the PCW_LX_speed_kPoint_bicycles_5 signal to the FFS
  PCW_LX_speed_kPoint_bicycles_5: single  % Speed kneepoints for pedestrian targets
  PCW_LX_speedParams_0_V: uint8  % This validity flag, if set to TRUE, tells us to map the information sent to us in the PCW_LX_speedParams_0 signal to the FFS
  PCW_LX_speedParams_0: single  % Lateral corridor speed kneepoints
  PCW_Buffer_16_V: uint8
  PCW_Buffer_16: uint8
  PCW_LX_speedParams_1_V: uint8  % This validity flag, if set to TRUE, tells us to map the information sent to us in the PCW_LX_speedParams_1 signal to the FFS
  PCW_LX_speedParams_1: single  % Lateral corridor speed kneepoints
  PCW_LX_speedParams_2_V: uint8  % This validity flag, if set to TRUE, tells us to map the information sent to us in the PCW_LX_speedParams_2 signal to the FFS
  PCW_LX_speedParams_2: single  % Lateral corridor speed kneepoints
  PCW_Buffer_17_V: uint8
  PCW_Buffer_17: uint8
  PCW_LX_speedParams_3_V: uint8  % This validity flag, if set to TRUE, tells us to map the information sent to us in the PCW_LX_speedParams_3 signal to the FFS
  PCW_LX_speedParams_3: single  % Lateral corridor speed kneepoints
  PCW_LX_currSide_0_V: uint8  % This validity flag, if set to TRUE, tells us to map the information sent to us in the PCW_LX_currSide_0 signal to the FFS
  PCW_LX_currSide_0: single  % Lateral corridor kneepoints. Pedestrian must be inside this lateral corridor for an alert to be issued.
  PCW_Buffer_18_V: uint8
  PCW_Buffer_18: uint8
  PCW_LX_currSide_1_V: uint8  % This validity flag, if set to TRUE, tells us to map the information sent to us in the PCW_LX_currSide_1 signal to the FFS
  PCW_LX_currSide_1: single  % Lateral corridor kneepoints. Pedestrian must be inside this lateral corridor for an alert to be issued.
  PCW_LX_currSide_2_V: uint8  % This validity flag, if set to TRUE, tells us to map the information sent to us in the PCW_LX_currSide_2 signal to the FFS
  PCW_LX_currSide_2: single  % Lateral corridor kneepoints. Pedestrian must be inside this lateral corridor for an alert to be issued.
  PCW_LX_currSide_3_V: uint8  % This validity flag, if set to TRUE, tells us to map the information sent to us in the PCW_LX_currSide_3 signal to the FFS
  PCW_LX_currSide_3: single  % Lateral corridor kneepoints. Pedestrian must be inside this lateral corridor for an alert to be issued.
  PCW_LX_crossingExpand_0_V: uint8  % This validity flag, if set to TRUE, tells us to map the information sent to us in the PCW_LX_crossingExpand_0 signal to the FFS
  PCW_LX_crossingExpand_0: single  % For rapid target movement, currSide is expanded by kneepoints value for pedestrian targets
  PCW_LX_crossingExpand_1_V: uint8  % This validity flag, if set to TRUE, tells us to map the information sent to us in the PCW_LX_crossingExpand_1 signal to the FFS
  PCW_LX_crossingExpand_1: single  % For rapid target movement, currSide is expanded by kneepoints value for pedestrian targets
  PCW_Buffer_19_V: uint8
  PCW_Buffer_19: uint8
  PCW_LX_crossingExpand_2_V: uint8  % This validity flag, if set to TRUE, tells us to map the information sent to us in the PCW_LX_crossingExpand_2 signal to the FFS
  PCW_LX_crossingExpand_2: single  % For rapid target movement, currSide is expanded by kneepoints value for pedestrian targets
  PCW_LX_crossingExpand_3_V: uint8  % This validity flag, if set to TRUE, tells us to map the information sent to us in the PCW_LX_crossingExpand_3 signal to the FFS
  PCW_LX_crossingExpand_3: single  % For rapid target movement, currSide is expanded by kneepoints value for pedestrian targets
  PCW_LX_crossingBicycleExp_0_V: uint8  % This validity flag, if set to TRUE, tells us to map the information sent to us in the PCW_LX_crossingBicycleExp_0 signal to the FFS
  PCW_LX_crossingBicycleExp_0: single  % For rapid target movement, bicycleSide is expanded by the kneepoints value for cyclist targets
  PCW_LX_crossingBicycleExp_1_V: uint8  % This validity flag, if set to TRUE, tells us to map the information sent to us in the PCW_LX_crossingBicycleExp_1 signal to the FFS
  PCW_LX_crossingBicycleExp_1: single  % For rapid target movement, bicycleSide is expanded by the kneepoints value for cyclist targets
  PCW_LX_crossingBicycleExp_2_V: uint8  % This validity flag, if set to TRUE, tells us to map the information sent to us in the PCW_LX_crossingBicycleExp_2 signal to the FFS
  PCW_LX_crossingBicycleExp_2: single  % For rapid target movement, bicycleSide is expanded by the kneepoints value for cyclist targets
  PCW_Buffer_20_V: uint8
  PCW_Buffer_20: uint8
  PCW_LX_crossingBicycleExp_3_V: uint8  % This validity flag, if set to TRUE, tells us to map the information sent to us in the PCW_LX_crossingBicycleExp_3 signal to the FFS
  PCW_LX_crossingBicycleExp_3: single  % For rapid target movement, bicycleSide is expanded by the kneepoints value for cyclist targets
  PCW_LX_predSide_0_V: uint8  % This validity flag, if set to TRUE, tells us to map the information sent to us in the PCW_LX_predSide_0 signal to the FFS
  PCW_LX_predSide_0: single  % Pedestrian target should be within this lateral corridor at the predicted ttc = 0
  PCW_LX_predSide_1_V: uint8  % This validity flag, if set to TRUE, tells us to map the information sent to us in the PCW_LX_predSide_1 signal to the FFS
  PCW_LX_predSide_1: single  % Pedestrian target should be within this lateral corridor at the predicted ttc = 0
  PCW_LX_predSide_2_V: uint8  % This validity flag, if set to TRUE, tells us to map the information sent to us in the PCW_LX_predSide_2 signal to the FFS
  PCW_LX_predSide_2: single  % Pedestrian target should be within this lateral corridor at the predicted ttc = 0
  PCW_LX_predSide_3_V: uint8  % This validity flag, if set to TRUE, tells us to map the information sent to us in the PCW_LX_predSide_3 signal to the FFS
  PCW_LX_predSide_3: single  % Pedestrian target should be within this lateral corridor at the predicted ttc = 0
  PCW_Buffer_21_V: uint8
  PCW_Buffer_21: uint8
  PCW_LX_bicycleSide_0_V: uint8  % This validity flag, if set to TRUE, tells us to map the information sent to us in the PCW_LX_bicycleSide_0 signal to the FFS
  PCW_LX_bicycleSide_0: single  % Defines together Current side and lateral side for cyclist targets
  PCW_LX_bicycleSide_1_V: uint8  % This validity flag, if set to TRUE, tells us to map the information sent to us in the PCW_LX_bicycleSide_1 signal to the FFS
  PCW_LX_bicycleSide_1: single  % Defines together Current side and lateral side for cyclist targets
  PCW_LX_bicycleSide_2_V: uint8  % This validity flag, if set to TRUE, tells us to map the information sent to us in the PCW_LX_bicycleSide_2 signal to the FFS
  PCW_LX_bicycleSide_2: single  % Defines together Current side and lateral side for cyclist targets
  PCW_LX_bicycleSide_3_V: uint8  % This validity flag, if set to TRUE, tells us to map the information sent to us in the PCW_LX_bicycleSide_3 signal to the FFS
  PCW_LX_bicycleSide_3: single  % Defines together Current side and lateral side for cyclist targets
  PCW_LX_MinPauseAfterWarn_V: uint8  % This validity flag, if set to TRUE, tells us to map the information sent to us in the PCW_LX_MinPauseAfterWarn signal to the FFS
  PCW_LX_MinPauseAfterWarn: single  % Do we suppress alert for ego brake
  PCW_Buffer_22_V: uint8
  PCW_Buffer_22: uint8
  PCW_LX_MinSpeedForWarn_V: uint8  % This validity flag, if set to TRUE, tells us to map the information sent to us in the PCW_LX_MinSpeedForWarn signal to the FFS
  PCW_LX_MinSpeedForWarn: single  % Minimum pause time after alert was issued (grace period)
  PCW_LX_MaxSpeedForWarn_V: uint8  % This validity flag, if set to TRUE, tells us to map the information sent to us in the PCW_LX_MaxSpeedForWarn signal to the FFS
  PCW_LX_MaxSpeedForWarn: single  % Minimum ego speed for an alert to be issued
  PCW_Buffer_23_V: uint8
  PCW_Buffer_23: uint8
  PCW_LX_brakingTTCReduction_V: uint8  % This validity flag, if set to TRUE, tells us to map the information sent to us in the PCW_LX_brakingTTCReduction signal to the FFS
  PCW_LX_brakingTTCReduction: single  % Maximum ego speed for an alert to be issued
  PCW_LX_maxYawRadPerSec_warn_V: uint8  % This validity flag, if set to TRUE, tells us to map the information sent to us in the PCW_LX_maxYawRadPerSec_warn signal to the FFS
  PCW_LX_maxYawRadPerSec_warn: single  % If ego is braking, TTC threshold is reduced by this value. (rad/sec)
  PCW_LX_maxWheelAngle_V: uint8  % This validity flag, if set to TRUE, tells us to map the information sent to us in the PCW_LX_maxWheelAngle signal to the FFS
  PCW_LX_maxWheelAngle: single  % Maximum ego yaw rate in order for an alert to be issued
  PCW_Buffer_24_V: uint8
  PCW_Buffer_24: uint8
  PCW_LX_TTC_kPoints_warn_far_0_V: uint8  % This validity flag, if set to TRUE, tells us to map the information sent to us in the PCW_LX_TTC_kPoints_warn_far_0 signal to the FFS
  PCW_LX_TTC_kPoints_warn_far_0: single  % Defines TTC threshold kneepoints for Far gap sensitivity (Ped targets)
  PCW_LX_TTC_kPoints_warn_far_1_V: uint8  % This validity flag, if set to TRUE, tells us to map the information sent to us in the PCW_LX_TTC_kPoints_warn_far_1 signal to the FFS
  PCW_LX_TTC_kPoints_warn_far_1: single  % Defines TTC threshold kneepoints for Far gap sensitivity (Ped targets)
  PCW_LX_TTC_kPoints_warn_far_2_V: uint8  % This validity flag, if set to TRUE, tells us to map the information sent to us in the PCW_LX_TTC_kPoints_warn_far_2 signal to the FFS
  PCW_LX_TTC_kPoints_warn_far_2: single  % Defines TTC threshold kneepoints for Far gap sensitivity (Ped targets)
  PCW_Buffer_25_V: uint8
  PCW_Buffer_25: uint8
  PCW_LX_TTC_kPoints_warn_far_3_V: uint8  % This validity flag, if set to TRUE, tells us to map the information sent to us in the PCW_LX_TTC_kPoints_warn_far_3 signal to the FFS
  PCW_LX_TTC_kPoints_warn_far_3: single  % Defines TTC threshold kneepoints for Far gap sensitivity (Ped targets)
  PCW_LX_TTC_kPoints_warn_far_4_V: uint8  % This validity flag, if set to TRUE, tells us to map the information sent to us in the PCW_LX_TTC_kPoints_warn_far_4 signal to the FFS
  PCW_LX_TTC_kPoints_warn_far_4: single  % Defines TTC threshold kneepoints for Far gap sensitivity (Ped targets)
  PCW_LX_TTC_kPoints_warn_far_5_V: uint8  % This validity flag, if set to TRUE, tells us to map the information sent to us in the PCW_LX_TTC_kPoints_warn_far_5 signal to the FFS
  PCW_LX_TTC_kPoints_warn_far_5: single  % Defines TTC threshold kneepoints for Far gap sensitivity (Ped targets)
  PCW_Buffer_26_V: uint8
  PCW_Buffer_26: uint8
  PCW_LX_TTC_kPoints_warn_n_0_V: uint8  % This validity flag, if set to TRUE, tells us to map the information sent to us in the PCW_LX_TTC_kPoints_warn_n_0 signal to the FFS
  PCW_LX_TTC_kPoints_warn_n_0: single  % Defines TTC threshold kneepoints for Near gap sensitivity (Ped targets)
  PCW_LX_TTC_kPoints_warn_n_1_V: uint8  % This validity flag, if set to TRUE, tells us to map the information sent to us in the PCW_LX_TTC_kPoints_warn_n_1 signal to the FFS
  PCW_LX_TTC_kPoints_warn_n_1: single  % Defines TTC threshold kneepoints for Near gap sensitivity (Ped targets)
  PCW_LX_TTC_kPoints_warn_n_2_V: uint8  % This validity flag, if set to TRUE, tells us to map the information sent to us in the PCW_LX_TTC_kPoints_warn_n_2 signal to the FFS
  PCW_LX_TTC_kPoints_warn_n_2: single  % Defines TTC threshold kneepoints for Near gap sensitivity (Ped targets)
  PCW_Buffer_27_V: uint8
  PCW_Buffer_27: uint8
  PCW_LX_TTC_kPoints_warn_n_3_V: uint8  % This validity flag, if set to TRUE, tells us to map the information sent to us in the PCW_LX_TTC_kPoints_warn_n_3 signal to the FFS
  PCW_LX_TTC_kPoints_warn_n_3: single  % Defines TTC threshold kneepoints for Near gap sensitivity (Ped targets)
  PCW_LX_TTC_kPoints_warn_n_4_V: uint8  % This validity flag, if set to TRUE, tells us to map the information sent to us in the PCW_LX_TTC_kPoints_warn_n_4 signal to the FFS
  PCW_LX_TTC_kPoints_warn_n_4: single  % Defines TTC threshold kneepoints for Near gap sensitivity (Ped targets)
  PCW_LX_TTC_kPoints_warn_n_5_V: uint8  % This validity flag, if set to TRUE, tells us to map the information sent to us in the PCW_LX_TTC_kPoints_warn_n_5 signal to the FFS
  PCW_LX_TTC_kPoints_warn_n_5: single  % Defines TTC threshold kneepoints for Near gap sensitivity (Ped targets)
  PCW_Buffer_28_V: uint8
  PCW_Buffer_28: uint8
  PCW_LX_TTC_kPoints_bi_F_0_V: uint8  % This validity flag, if set to TRUE, tells us to map the information sent to us in the PCW_LX_TTC_kPoints_bi_F_0 signal to the FFS
  PCW_LX_TTC_kPoints_bi_F_0: single  % Defines TTC threshold kneepoints for Far gap sensitivity (Cyclist targets)
  PCW_LX_TTC_kPoints_bi_F_1_V: uint8  % This validity flag, if set to TRUE, tells us to map the information sent to us in the PCW_LX_TTC_kPoints_bi_F_1 signal to the FFS
  PCW_LX_TTC_kPoints_bi_F_1: single  % Defines TTC threshold kneepoints for Far gap sensitivity (Cyclist targets)
  PCW_LX_TTC_kPoints_bi_F_2_V: uint8  % This validity flag, if set to TRUE, tells us to map the information sent to us in the PCW_LX_TTC_kPoints_bi_F_2 signal to the FFS
  PCW_LX_TTC_kPoints_bi_F_2: single  % Defines TTC threshold kneepoints for Far gap sensitivity (Cyclist targets)
  PCW_Buffer_29_V: uint8
  PCW_Buffer_29: uint8
  PCW_LX_TTC_kPoints_bi_F_3_V: uint8  % This validity flag, if set to TRUE, tells us to map the information sent to us in the PCW_LX_TTC_kPoints_bi_F_3 signal to the FFS
  PCW_LX_TTC_kPoints_bi_F_3: single  % Defines TTC threshold kneepoints for Far gap sensitivity (Cyclist targets)
  PCW_LX_TTC_kPoints_bi_F_4_V: uint8  % This validity flag, if set to TRUE, tells us to map the information sent to us in the PCW_LX_TTC_kPoints_bi_F_4 signal to the FFS
  PCW_LX_TTC_kPoints_bi_F_4: single  % Defines TTC threshold kneepoints for Far gap sensitivity (Cyclist targets)
  PCW_LX_TTC_kPoints_bi_F_5_V: uint8  % This validity flag, if set to TRUE, tells us to map the information sent to us in the PCW_LX_TTC_kPoints_bi_F_5 signal to the FFS
  PCW_LX_TTC_kPoints_bi_F_5: single  % Defines TTC threshold kneepoints for Far gap sensitivity (Cyclist targets)
  PCW_Buffer_30_V: uint8
  PCW_Buffer_30: uint8
  PCW_LX_TTC_kPoints_bi_N_0_V: uint8  % This validity flag, if set to TRUE, tells us to map the information sent to us in the PCW_LX_TTC_kPoints_bi_N_0 signal to the FFS
  PCW_LX_TTC_kPoints_bi_N_0: single  % Defines TTC threshold kneepoints for Near gap sensitivity (Cyclist targets)
  PCW_LX_TTC_kPoints_bi_N_1_V: uint8  % This validity flag, if set to TRUE, tells us to map the information sent to us in the PCW_LX_TTC_kPoints_bi_N_1 signal to the FFS
  PCW_LX_TTC_kPoints_bi_N_1: single  % Defines TTC threshold kneepoints for Near gap sensitivity (Cyclist targets)
  PCW_LX_TTC_kPoints_bi_N_2_V: uint8  % This validity flag, if set to TRUE, tells us to map the information sent to us in the PCW_LX_TTC_kPoints_bi_N_2 signal to the FFS
  PCW_LX_TTC_kPoints_bi_N_2: single  % Defines TTC threshold kneepoints for Near gap sensitivity (Cyclist targets)
  PCW_Buffer_31_V: uint8
  PCW_Buffer_31: uint8
  PCW_LX_TTC_kPoints_bi_N_3_V: uint8  % This validity flag, if set to TRUE, tells us to map the information sent to us in the PCW_LX_TTC_kPoints_bi_N_3 signal to the FFS
  PCW_LX_TTC_kPoints_bi_N_3: single  % Defines TTC threshold kneepoints for Near gap sensitivity (Cyclist targets)
  PCW_LX_TTC_kPoints_bi_N_4_V: uint8  % This validity flag, if set to TRUE, tells us to map the information sent to us in the PCW_LX_TTC_kPoints_bi_N_4 signal to the FFS
  PCW_LX_TTC_kPoints_bi_N_4: single  % Defines TTC threshold kneepoints for Near gap sensitivity (Cyclist targets)
  PCW_LX_TTC_kPoints_bi_N_5_V: uint8  % This validity flag, if set to TRUE, tells us to map the information sent to us in the PCW_LX_TTC_kPoints_bi_N_5 signal to the FFS
  PCW_LX_TTC_kPoints_bi_N_5: single  % Defines TTC threshold kneepoints for Near gap sensitivity (Cyclist targets)
  PCW_LX_DeactivateInNight_V: uint8  % This validity flag, if set to TRUE, tells us to map the information sent to us in the PCW_LX_DeactivateInNight signal to the FFS
  PCW_LX_DeactivateInNight: uint8  % Defines whether a configuration set is active on targets at night. 1 == no alerts will be issued at night
  PCW_LX_adhereToGapSensitivity_V: uint8  % This validity flag, if set to TRUE, tells us to map the information sent to us in the PCW_LX_adhereToGapSensitivity signal to the FFS
  PCW_LX_adhereToGapSensitivity: uint8  % Defines whether configuration set has gap sensitivity (only non-AEB sets)
  PCW_LX_warnOnBicycles_V: uint8  % This validity flag, if set to TRUE, tells us to map the information sent to us in the PCW_LX_warnOnBicycles signal to the FFS
  PCW_LX_warnOnBicycles: uint8  % Defines whether alert is issued on cyclist targets
  PCW_LX_SuppressByBrake_V: uint8  % This validity flag, if set to TRUE, tells us to map the information sent to us in the PCW_LX_SuppressByBrake signal to the FFS
  PCW_LX_SuppressByBrake: uint8  % Do we suppress alert for ego brake
  Reserved_1: uint8

EQ4_ISPC_BUS = Simulink.Bus()
  EQ4_ISPC_HDR: Bus: EQ4_ISPC_HDR_BUS

EQ4_ISPC_HDR_BUS = Simulink.Bus()
  ISPC_Zero_byte: uint8
  ISPC_Protocol_Version: uint8  % Version number of the initialization message
  ISPC_Optional_Signals: uint8  % All signals are requierd
  ISPC_Slow_Mode: uint8  % Boolean selecting the type of SPC - regular (FALSE), or slow (TRUE).
    % Slow SPC is used for limited space production facilities, and allows short range calibration.
  Reserved_1: uint8

EQ4_ISPTAC_BUS = Simulink.Bus()
  EQ4_ISPTAC_HDR: Bus: EQ4_ISPTAC_HDR_BUS

EQ4_ISPTAC_HDR_BUS = Simulink.Bus()
  ISPTAC_Zero_byte: uint8
  ISPTAC_Protocol_Version: uint8
  ISPTAC_Optional_Signals: uint8  % All signals are requierd

EQ4_ITAC_BUS = Simulink.Bus()
  EQ4_ITAC_HDR: Bus: EQ4_ITAC_HDR_BUS

EQ4_ITAC_HDR_BUS = Simulink.Bus()
  TAC_Zero_byte: uint8
  TAC_Protocol_Version: uint8
  TAC_Optional_Signals: uint8  % All signals are requierd
  TAC_Mode: uint8  % Defines target type. ME_TAC refers to the TAC targets setup; other values are project-specific implementations
  TAC_BottomLeftSquare_0: uint8  % Color of bottom-left square of the leftmost target
  TAC_BottomLeftSquare_1: uint8  % Color of bottom-left square of the second from the left target
  TAC_BottomLeftSquare_2: uint8  % Color of bottom-left square of the center target (if exist).  if white=0, black=1
  TAC_TargetInfo_Lat_Distance_0: single  % Distance between the leftmost target center and the center of the car
  Reserved_1: uint8
  TAC_TargetInfo_Lat_Distance_1: single  % Distance between the second from the left target center and the center of the car
  TAC_TargetInfo_Lat_Distance_2: single  % Distance between the center target and the center of the car (usually the this should be 0 for the center target since this target is placed in front of the center of the vehicle)
  TAC_TargetInfo_Height_0: single  % Height of the center of the leftmost target
  TAC_TargetInfo_Height_1: single  % Height of the center of the second from the left target
  TAC_TargetInfo_Height_2: single  % Height of the center of the center target
  TAC_Camera_Height: single  % Camera height from ground. Must be the same reference plane as the targets height
  TAC_Camera_Z: single  % Distance from camera to targets
  TAC_Max_Horizon: int8  % Maximum allowed horizon value in Level 0 (reduced resolution 320,240)
  TAC_Min_Horizon: int8  % Minimum allowed horizon value in Level 0 (reduced resolution 320,240)
  TAC_Max_Yaw: uint8  % Maximum allowed YAW value in in Level 0 (reduced resolution 320,240)
  TAC_Min_Yaw: int8  % Minimum allowed YAW value in in Level 0 (reduced resolution 320,240)
  TAC_Max_RollAngle: single  % Maximum allowed absolute roll output
  Reserved_2: uint8
  TAC_SquareSideSize: single  % Size of a single square, not the whole target. For a round target, this is the radius
  TAC_Bottom: int8  % Search window bottom definition. The value represents Level-0 pixels from the image center.
  TAC_Targets_Num: uint8  % Number of TAC targets
  Reserved_3: uint8

EQ4_IVISION_BUS = Simulink.Bus()
  EQ4_IVISION_HDR: Bus: EQ4_IVISION_HDR_BUS

EQ4_IVISION_HDR_BUS = Simulink.Bus()
  IVISION_Zero_Byte: uint8
  IVISION_Protocol_Version: uint8
  IVISION_Optional_Signals: uint8

EQ4_APPINFO_BUS = Simulink.Bus()
  APP_SyncTs: UINT64
  APP_SyncTsValid: uint8
  APP_E2EStatus: uint8

EQ4_APP_BUS = Simulink.Bus()
  EQ4_APPINFO: Bus: EQ4_APPINFO_BUS
  EQ4_APP_HDR: Bus: EQ4_APP_HDR_BUS

EQ4_APP_HDR_BUS = Simulink.Bus()
  APP_Zero_Byte: uint8
  Application_Message_Version: uint8
  APP_Main_State: uint8  % Application main state.
  APP_Sub_State: uint8  % Application sub-state.
  APP_EyeQ_Process_Index: uint32  % TAPI frame ID. Used for syncronization with algorithmic output.
  APP_EyeQ_Timestamp: uint32  % Time since init of the camera
  APP_EyeQ_Current_Timestamp: uint32  % Time since init of the EyeQ
  APP_Diagnostics_part_1: uint16  % Application Diagnostics (first short)
  APP_Diagnostics_part_2: uint16  % Application Diagnostics (second short)
  APP_Fatal_Error: uint8  % None rcoverable EyeQ error. Algorithmic processing is halted and only application message is sent. Recovery possible only after a reset.
    % Note - value zero means that there is no error.
  App_RSRV_1: uint8
  APP_Minor_Error: uint16  % BPP Minor error.
    % A non fatal error reported from one of EyeQ components. In this case, EyeQ main processing loop continues running as usual.
    % NOTE: For now mapped only to EDR errors.
  APP_EyeQTemperature1: int16  % The temperature of the EyeQ (first sensor)
  APP_EyeQTemperature2: int16  % The temperature of the EyeQ (second sensor)
  APP_Temperature_DDR: int8  % DDR Temperture range enumeration.
    % More information on BPP-base-communication-protocol.doc
  App_RSRV_2: uint8
  App_RSRV_3: uint16
  App_RSRV_4: uint8
  APP_spiErrors: uint8  % This byte represents the SPI communication layer status.
    % A nonzero value of any bit in the SPI status indicates an SPI issue. Note that once set, the bits will not be cleared in the next frames:
    % bit-0: SPI_CRC_BIT - CRC error occurred.
    % bit-1: SPI_CRC_CONTINUOUS_BIT - 3 consecutive CRC errors occurred.
    % bit-2: SPI_SEQ_BIT - sequence error occurred.
    % bit-3: SPI_SEQ_CONTINUOUS_BIT - 3 consecutive sequence errors occurred.
    % Bits 4-7: Reserved.
  APP_Valid_second_cam_temp_info: uint8  % The supported camera's second temperature . Each supported Camera will have it's bit on.
    % 0=Not Valid, 1- Valid. Not implemented yet.
  APP_Valid_cameras_information: uint8  % The supported cameras . Each supported Camera will have it's bit on.
    % 0=Not Valid, 1- Valid
  APP_Camera1_temperature_1: int16  % Camera1 temperature. Note that 127 is the maximal reported value, even if the actual temperature is higher.
  APP_Camera2_temperature_1: int16  % As described for camera1
  APP_Camera3_temperature_1: int16  % As described for camera1
  APP_Camera1_temperature_2: int16  % Camera1 temperature second sensor. Note that 127 is the maximal reported value, even if the actual temperature is higher.
  APP_Camera2_temperature_2: int16  % As described for camera1
  APP_Camera3_temperature_2: int16  % As described for camera1
  App_RSRV_5: int16
  App_RSRV_6: int16
  APP_Camera1_VideoErrorRange: uint8  % This byte represents video errors frames range:
    % bits-0-3: The number of consecutive video frames with errors
    % bits-4-7: The 4 LSB bits of the image frame counter of the first erroneous frame.
  APP_Camera2_VideoErrorRange: uint8  % As described for camera1
  APP_Camera3_VideoErrorRange: uint8  % As described for camera1
  App_RSRV_7: uint8
  App_RSRV_8: uint8
  App_RSRV_9: uint8
  App_RSRV_10: uint8
  App_RSRV_11: uint8
  APP_Camera1_VideoErrorFlags_pt1: uint32  % Internal camera error flag
  APP_Camera2_VideoErrorFlags_pt1: uint32  % Internal camera error flag
  APP_Camera3_VideoErrorFlags_pt1: uint32  % Internal camera error flag
  APP_Brain_drops_counter: uint32  % The total number of brain drops
  APP_appMode: uint32  % The app mode that configured in the FFS
  APP_Application_ver: uint32
  App_RSRV_12: uint32
  App_RSRV_13: uint32
  APP_Camera1_VideoErrorFlags_pt2: uint32  % Internal camera error flag
  APP_Camera2_VideoErrorFlags_pt2: uint32  % Internal camera error flag
  APP_Camera3_VideoErrorFlags_pt2: uint32  % Internal camera error flag
  APP_SPI_Bus_Load_Tx: uint32  % The number of bytes transmitted by EyeQ over SPI since the last application message
  APP_SPI_Bus_Load_Rx: uint32  % The number of bytes received by EyeQ over SPI since the last application message
  APP_SPI_Retransmit_Tx: uint32  % The number of bytes retransmitted by EyeQ over SPI since the last application message
  App_RSRV_14: uint32
  App_CRC32: uint32  % The range of the CRC is whole the message not include the App_CRC32 it self.

EQ4_BOOT_BUS = Simulink.Bus()
  EQ4_APPINFO: Bus: EQ4_APPINFO_BUS
  EQ4_BOOT_HDR: Bus: EQ4_BOOT_HDR_BUS

EQ4_BOOT_HDR_BUS = Simulink.Bus()
  BOOT_Zero_byte: uint8
  BootMsg_Protocol_Version: uint8  % What version of this protocol we are up to
  Reserved_1: uint8
  BOOT_Test_results: uint16  % It is a bit map where each bit represents single test result: 0 = OK, 1 = Failure.
  BOOT_Board_project_code: uint8
  BOOT_Board_revision: uint8  % based on GPIO
  BOOT_Ver: uint32  % 4 bytes fields:
    % byte 0=reserved;
    % byte 1=third number of version;
    % byte 2=second number of version;
    % byte 3 (LSB)=first number of version;
    % Example: Boot version 8.102.6 will be represented as the following byte sequence:  byte#8 = 0x00, byte#9 = 0x101, byte#10 =  0x66, byte#11 = 0x08
  BOOT_Application_ver: uint32  % Application (mest) version number - not implemented
  BOOT_EyeQ_Type: uint32
  BOOT_EyeQ_ID: uint32
  BOOT_DDR_manufacturer_code: uint8  % LPDDR4 Manufacturer ID according to JEDEC standard No. 209.
    % For example: 0x08 = Winbond; 0xFF = Micron
  BOOT_DDR_Size: uint32
  BOOT_Flash_Man_Code: uint8  % LPDDR4 Manufacturer ID according to JEDEC standard No. 209.
    % For example: 0x08 = Winbond; 0xFF = Micron
  BOOT_Flash_Size: uint32
  BOOT_CPU_Temperature: int16  % CPU temperature in degs
  BOOT_VMP_Temperature: int16  % VMP  temperature in degs
  BOOT_LPDDR4_Temperature_Status: uint8  % 0=temperature is 85C  default refresh.
    % 1=SDRAM low temperature operating limit exceeded.
    % 2=SDRAM high temperature operating limit exceeded.
    % 3=temperature is much greater than 85C  0.25x refresh, with derating.
    % 4=temperature is much less than 85C  default refresh.
    % 5=temperature is less than 85C  default refresh.
    % 6=temperature is greater than 85C  0.5x refresh.
    % 7=temperature is greater than 85C  0.25x refresh, no derating.
  Reserved_2: uint8
  BOOT_Flash2_Man_Code: uint8  % Each flash memory device has a manufacturer ID (which is assigned by JEDEC).
  BOOT_Flash_2_Size: uint32
  Boot_Stage: uint8
  BOOT_Failure_info_0: uint32  % This is currently a BLOB, that will most likely be refined later (later Istep) into signals
  BOOT_Failure_info_1: uint32  % This is currently a BLOB, that will most likely be refined later (later Core Protocol Release) into signals
  BOOT_Failure_info_2: uint32  % This is currently a BLOB, that will most likely be refined later (later Core Protocol Release) into signals
  BOOT_Failure_info_3: uint32  % This is currently a BLOB, that will most likely be refined later (later Core Protocol Release) into signals
  BOOT_Failure_info_4: uint32  % This is currently a BLOB, that will most likely be refined later (later Core Protocol Release) into signals
  BOOT_Failure_info_5: uint32  % This is currently a BLOB, that will most likely be refined later (later Core Protocol Release) into signals
  BOOT_Failure_info_6: uint32  % This is currently a BLOB, that will most likely be refined later (later Core Protocol Release) into signals
  BOOT_Failure_info_7: uint32  % This is currently a BLOB, that will most likely be refined later (later Core Protocol Release) into signals

EQ4_CIN_HDR_BUS = Simulink.Bus()
  CIN_Zero_Byte: uint8
  Reserved_1: uint8
  CIN_CRC: uint32  % CRC on all signals
  CIN_Protocol_Version: uint8  % Version
  CIN_Vehicle_Code: uint8  % Used for data collection purposes
  CIN_Sync_Frame_Index: uint8  % A cyclic counter to verify that all sent messages have been received. Send consecutive values every time the input message is sent
  Reserved_2: uint8
  CIN_Vehicle_Speed: single  % Actual vehicle speed. In case the vehicle driving direction is backwards then use CIN_Reverse_Indicator signals to indicate the reverse direction.
  CIN_Vehicle_Speed_Valid: uint8  % Establishes validity of speed
  CIN_Vehicle_Yaw: single  % Positive on right turn
  CIN_Vehicle_Yaw_Valid: uint8  % Establishes validity of Yaw
  Reserved_3: uint8
  CIN_Lat_Accel: single  % Positive on right acceleration
  CIN_Lat_Accel_Valid: uint8  % Establishes validity of Acceleration
  CIN_Wiper_Status_Valid: uint8  % establishes validity of wiper signal
  CIN_Wiper_Status: uint8  % How fast wiper is moving (speed not fully implemented - at the moment, 0 is off and everything else is read as on)
    % 0=OFF
    % 1=ON (LOW)
    % 2=ON (MEDIUM)
    % 3=ON (HIGH)
    % 4=ON (SINGLE WIPE)
  CIN_Reverse_Indicator: uint8  % Indicates gear is set to reverse mode or the vehicle is moving in the reverse direction
  CIN_Reverse_Indicator_Valid: uint8  % Establishes validity of reverse indicator
  Reserved_4: uint8
  CIN_Steering_Wheel_Angle: single  % Angle of the steering wheel. Angle to the right is positive
  CIN_Steering_Wheel_Angle_Valid: uint8  % Establishes validity of steering wheel angle
  CIN_Turn_Switch_Status: uint8  % Status of left right indicator
  CIN_High_Beam_Active: uint8  % Indicates the status of the High Beam lights - True means high lights are on. Any other case will be False
  CIN_Fog_Light_Active: uint8  % Are fog lights active
  CIN_Accel_Pedal_Value: single  % Provides the graduated value of the accelerator pedal
  CIN_Accel_Pedal_Valid: uint8  % Establishes validity of the Accelerator Pedal signal
  Reserved_5: uint8
  CIN_Accel_Rate: single  % Longitudinal Acceleration / Deceleration Rate. Preferably hill compensated
  CIN_Accel_Rate_Valid: uint8  % Establishes the validity of the rate provided for acceleration/deceleration
  CIN_Ambient_Light_Level: uint16  % Used to communicate the level of ambient light using external sensors
  CIN_Ambient_Light_Level_Valid: uint8  % Is the AmbientLightLevel signal valid or not
  Reserved_6: uint8
  CIN_Brake_Pedal_Position: single  % Communicates the position of the brake pedal
  CIN_Brake_Pedal_Pressed: uint8  % Indicates whether the pedal is pressed (enum)
  CIN_Brake_Pedal_Pressed_Valid: uint8  % Establishes the validity of the brake pedal signal
  CIN_Vehicle_Display_Speed: single  % Display vehicle speed from cluster. In case the vehicle driving direction is backwards then use CIN_Reverse_Indicator signals to indicate the reverse
  CIN_Vehicle_Display_Speed_Valid: uint8  % Establishes validity of display speed
  Reserved_7: uint8
  CIN_Effective_Steer_Axle_Angle: single  % Indicates the effective steering angle of the car wheels direction, considering front wheels and rear axle steering.
    % When turning to the right, this signal should be positive. If set to 0xFFFF signal is classified as invalid and any functionality that cannot operate without such a signal will be disabled.
  Reserved_8: uint8
  CIN_MCU_Sync_Timestamp: UINT64  % MCU local clock timestamp at the moment clock sync occurred.
  CIN_MCU_Sync_Timestamp_Valid: uint8  % Establishes that the MCU is communicating to the EyeQ a timestamp related to a toggled GPIO pin
  CIN_Susp_Height_Delta: single  % The change of the camera height due to changes in the height of the vehicle's suspension.
  CIN_Susp_Height_Delta_Valid: uint8  % A flag indicating when the suspension height signal is valid for use by the EyeQ.
  CIN_Susp_Height_Change_Active: uint8  % A flag indicating that a change to the height of the suspension is in progress.
  CIN_VSpeed_HiPrecision: single  % Hi precision speed signal odometry speed
  CIN_VSpeed_HiPrecision_Valid: uint8  % Establishes validity of Hi Precision speed
  CIN_gpsCountryCode_Capital: uint8  % non capital can be used for USA states only. If not set using capital
  CIN_gpsCountryCode_FirstChar: uint8  % Country Code
  CIN_gpsCountryCode_SecondChar: uint8  % Country Code
  CIN_AEB_Brake_Activated: uint8  % Indicates whether AEB brake is executed by vehicle
  CIN_AEB_BrakeValid: uint8  % Establishes the validity of the AEB brake signal
  GSensor_Tire_Preassure_Psi_FL_V: uint8  % Actual Tire Pressure in PSI.
  GSensor_Tire_Preassure_Psi_FR_V: uint8  % Actual Tire Pressure in PSI.
  GSensor_Tire_Preassure_Psi_RL_V: uint8  % Actual Tire Pressure in PSI.
  GSensor_Tire_Preassure_Psi_RR_V: uint8  % Actual Tire Pressure in PSI.
  GSensor_Tire_Preassure_Psi_FL: uint8  % Actual Tire Pressure in PSI.
  GSensor_Tire_Preassure_Psi_FR: uint8  % Actual Tire Pressure in PSI.
  Reserved_9: uint8
  GSensor_Tire_Preassure_Psi_RL: uint8  % Actual Tire Pressure in PSI.
  GSensor_Tire_Preassure_Psi_RR: uint8  % Actual Tire Pressure in PSI.
  GSensor_Acc_Pitch_V: uint8  % Validators
  GSensor_Acc_Pitch: single  % IMU measurement of the acceleration in the height direction
  GSensor_Gyro_PitchRate_V: uint8  % Validators
  Reserved_10: uint8
  GSensor_Gyro_PitchRate: single  % Vehicle pitch rate. Indicates the change derivative of pitch in time.
  GSensor_Gyro_RollRate_V: uint8  % Validators
  Reserved_11: uint8
  GSensor_Gyro_RollRate: single  % Vehicle roll rate. Indicates the change derivative of roll in time.
  GSensor_WheelSpeed_FL_V: uint8  % Validators
  GSensor_WheelSpeed_FR_V: uint8  % Validators
  GSensor_WheelSpeed_RL_V: uint8  % Validators
  GSensor_WheelSpeed_RR_V: uint8  % Validators
  Reserved_12: uint8
  GSensor_WheelSpeed_FL: single  % Wheel speed in rad/s.
    % Note:
    % 0xFFFD=INIT
    % 0xFFFE=UNDER_VOLTAGE
    % 0xFFFF=ERROR
  GSensor_WheelSpeed_FR: single  % Wheel speed in rad/s.
    % Note:
    % 0xFFFD=INIT
    % 0xFFFE=UNDER_VOLTAGE
    % 0xFFFF=ERROR
  GSensor_WheelSpeed_RL: single  % Wheel speed in rad/s.
    % Note:
    % 0xFFFD=INIT
    % 0xFFFE=UNDER_VOLTAGE
    % 0xFFFF=ERROR
  GSensor_WheelSpeed_RR: single  % Wheel speed in rad/s.
    % Note:
    % 0xFFFD=INIT
    % 0xFFFE=UNDER_VOLTAGE
    % 0xFFFF=ERROR
  GSensor_Wheel_Direction_FL_V: uint8  % Wheel tick number of front left wheel validator
  GSensor_Wheel_Direction_FR_V: uint8  % Wheel tick number of front right wheel validator
  GSensor_Wheel_Direction_RL_V: uint8  % Wheel tick number of rear left wheel validator
  GSensor_Wheel_Direction_RR_V: uint8  % Wheel tick number of rear right wheel validator
  GSensor_Wheel_Direction_FL: uint8  % Drive direction of front left wheel.
  GSensor_Wheel_Direction_FR: uint8  % Drive direction of front right wheel.
  GSensor_Wheel_Direction_RL: uint8  % Drive direction of rear left wheel.
  GSensor_Wheel_Direction_RR: uint8  % Drive direction of rear right wheel.
  GSensor_WheelTicks_FL_V_deprecated: uint8  % Do not use - lept for backwards compatability only
  GSensor_WheelTicks_FR_V_deprecated: uint8  % Do not use - lept for backwards compatability only
  GSensor_WheelTicks_RL_V_deprecated: uint8  % Do not use - lept for backwards compatability only
  GSensor_WheelTicks_RR_V_deprecated: uint8  % Do not use - lept for backwards compatability only
  GSensor_WheelTicks_FL_deprecated: uint8  % Do not use - lept for backwards compatability only
  GSensor_WheelTicks_FR_deprecated: uint8  % Do not use - lept for backwards compatability only
  GSensor_WheelTicks_RL_deprecated: uint8  % Do not use - lept for backwards compatability only
  GSensor_WheelTicks_RR_deprecated: uint8  % Do not use - lept for backwards compatability only
  fcaGapSensitivityValid: uint8  % If the FCA Gap sensitivity is valid
  fcaGapSensitivity: uint8  % 3 level setting used to tailor the non braking component of forward collision for vehicles.
  pcwGapSensitivityValid: uint8  % If the PCW gap sensitivity is valid
  pcwGapSensitivity: uint8  % 3 level setting used to tailor the non braking component of forward collision for pedestrians.
  Driver_Awareness_Valid: uint8  % Is the Driver Awareness signal valid or not
  Driver_Awareness: single  % Driver awareness - 0 represents lack of awareness while values closer to 1 show higher awareness
  External_Temp_Valid: uint8  % is External temperature value is valid to be used
  Reserved_13: uint8
  External_Temp: single  % external temperature in degrees Celsius
  ACTIVE_STATIONARY_TESTING_Valid: uint8  % is ACTIVE_STATIONARY_TESTING value is valid to be used
  ACTIVE_STATIONARY_TESTING: uint8  % If was set to true in Init, will enable to chnage the value in every frame frame without forcing an init cycle
  Reduce_Sense_Force_Activation_Valid: uint8  % is Reduce_Sense_Force_Activation value is valid to be used
  Reduce_Sense_Force_Activation: uint8  % If TRUE will activate ACTIVE_STATIONARY state and give the ability to change it in each frame without forcing an init cycle'
  CIN_StandStill_V: uint8  % Establishes validity of CIN_StandStill
  CIN_StandStill: uint8  % Indication of the vehicle being completely stationary
  CIN_FrontWheelsAngle_V: uint8  % Establishes validity of CIN_FrontWheelsAngle
  CIN_FrontWheelsAngle: single  % Indicates the effective angle of the front wheels relative to the body direction. Right side is positive.
  CIN_Susp_Pitch_Delta_V: uint8  % Establishes validity of CIN_Susp_Pitch_Delta
  CIN_Susp_Pitch_Delta: single  % Delta to the pitch angle caused by active suspension. Up is positive.
  CIN_Susp_Roll_Delta_V: uint8  % Establishes validity of CIN_Susp_Roll_Delta
  CIN_Susp_Roll_Delta: single  % Delta to the roll angle caused by active suspension. Right is positive
  CIN_Susp_FR_V: uint8  % Establishes validity of CIN_Susp_FR
  CIN_Susp_FR: int16  % Delta height to the suspension of the front right wheel
  CIN_Susp_FL_V: uint8  % Establishes validity of CIN_Susp_FL
  Reserved_14: uint8
  CIN_Susp_FL: int16  % Delta height to the suspension of the front left wheel
  CIN_Susp_RR_V: uint8  % Establishes validity of CIN_Susp_RR
  CIN_Susp_RR: int16  % Delta height to the suspension of the rear right wheel
  CIN_Susp_RL_V: uint8  % Establishes validity of CIN_Susp_RL
  CIN_Susp_RL: int16  % Delta height to the suspension of the rear left wheel
  GSensor_WheelTicks_FL: uint16  % Wheel tick number of front left wheel. 0XFF=ERROR
  GSensor_WheelTicks_FR: uint16  % Wheel tick number of front right wheel. 0XFF=ERROR
  GSensor_WheelTicks_RL: uint16  % Wheel tick number of rear left wheel. 0XFF=ERROR
  Reserved_15: uint8
  GSensor_WheelTicks_RR: uint16  % Wheel tick number of rear right wheel. 0XFF=ERROR
  GSensor_WheelTicks_FL_V: uint8  % Validator for GSensor_WheelTicks_FL
  GSensor_WheelTicks_FR_V: uint8  % Validator for GSensor_WheelTicks_FR
  GSensor_WheelTicks_RL_V: uint8  % Validator for GSensor_WheelTicks_RL
  GSensor_WheelTicks_RR_V: uint8  % Validator for GSensor_WheelTicks_RR
  Reserved_16: uint8
  GSensor_WheelTicks_timestamp_FL: uint32  % The timestamp in microseconds of the moment the last tick was sampled
  GSensor_WheelTicks_timestamp_FR: uint32  % The timestamp in microseconds of the moment the last tick was sampled
  GSensor_WheelTicks_timestamp_RL: uint32  % The timestamp in microseconds of the moment the last tick was sampled
  GSensor_WheelTicks_timestamp_RR: uint32  % The timestamp in microseconds of the moment the last tick was sampled
  GSensor_WheelTicks_timestamp_FL_V: uint8  % Validator for GSensor_WheelTicks_timestamp_FL_V
  GSensor_WheelTicks_timestamp_FR_V: uint8  % Validator for GSensor_WheelTicks_timestamp_FR_V
  GSensor_WheelTicks_timestamp_RL_V: uint8  % Validator for GSensor_WheelTicks_timestamp_RL_V
  GSensor_WheelTicks_timestamp_RR_V: uint8  % Validator for GSensor_WheelTicks_timestamp_RR_V
  CIN_Acc_Is_On: uint8  % Indicates whether the Acc is on
  CIN_Acc_Is_On_Valid: uint8  % Establishes the validity of the Acc is on signal
  CIN_Acc_HW_Status_Available: uint8  % Indicates whether the Acc status is available for the driver
  CIN_Acc_HW_Status_Available_Valid: uint8  % Establishes the validity of the Acc status is available signal
  CIN_Acc_Braking: uint8  % Indicates whether the Acc is braking the vehicle
  CIN_Acc_Braking_Valid: uint8  % Establishes the validity of the Acc is braking signal
  Reserved_17: uint8

EQ4_CLB_DYN_BUS = Simulink.Bus()
  EQ4_APPINFO: Bus: EQ4_APPINFO_BUS
  EQ4_CLB_DYN_HDR: Bus: EQ4_CLB_DYN_HDR_BUS

EQ4_CLB_DYN_HDR_BUS = Simulink.Bus()
  CLB_DYN_Zero_byte: uint8  % in case set to FF message is not available.
  Reserved_1: uint8
  CLB_DYN_Header_CRC: uint32  % Calculated over all header signals including CLB_DYN_Header_Buffer
  CLB_DYN_Protocol_Version: uint8  % Denotes the protocol version
  CLB_DYN_Sync_ID: uint8  % Sync ID for sync between messages
  CLB_DYN_Run_Mode: uint8  % Calibration run mode
  CLB_DYN_Cam_Height_Status: uint8  % SPC/AutoFix camera height convergence status (main camera only)
  CLB_DYN_Yaw_Status: uint8  % SPC/AutoFix yaw convergence status (main camera only)
  CLB_DYN_Pitch_Status: uint8  % SPC/AutoFix pitch convergence status (main camera only)
  CLB_DYN_Roll_Status: uint8  % SPC/AutoFix roll convergence status (main camera only)
  CLB_DYN_Cam_Height_Error: uint8  % SPC/AutoFix camera height convergence error cause (main camera only)
  CLB_DYN_Yaw_Error: uint8  % SPC/AutoFix yaw convergence error cause (main camera only)
  Reserved_2: uint8
  CLB_DYN_Pitch_Error: uint8  % SPC/AutoFix pitch convergence error cause (main camera only)
  CLB_DYN_Roll_Error: uint8  % SPC/AutoFix roll convergence error cause (main camera only)
  CLB_DYN_Pause_Reason: uint8  % SPC/AUTOFIX reason for not using the current frame for the dynamic calibration convergence.
  CLB_DYN_Cam_Height_Confidence: uint8  % SPC/AutoFix confidence of the camera height convergence results
  CLB_DYN_Yaw_Confidence: uint8  % SPC/AutoFix confidence of the yaw convergence results
  CLB_DYN_Pitch_Confidence: uint8  % SPC/AutoFix confidence of the pitch convergence results
  Reserved_3: uint8
  CLB_DYN_Roll_Confidence: uint8  % SPC/AutoFix confidence of the roll convergence results
  CLB_DYN_Cam_Height_Progress: uint8  % SPC/AutoFix camera height convergence progress
  CLB_DYN_Yaw_Progress: uint8  % SPC/AutoFix yaw convergence progress
  CLB_DYN_Pitch_Progress: uint8  % SPC/AutoFix pitch convergence progress
  Reserved_4: uint8
  CLB_DYN_Roll_Progress: uint8  % SPC/AutoFix roll convergence progress
  CLB_DYN_Total_Cam_Height_Time: uint16  % Total elapsed time from the previous AutoFix camera height convergence or SPC start
  Reserved_5: uint8
  CLB_DYN_Total_Cam_Height_Dist: uint16  % Total elapsed distance from the previous AutoFix camera height convergence or SPC start
  CLB_DYN_Total_Yaw_Time: uint16  % Total elapsed time from the previous AutoFix yaw convergence or SPC start
  Reserved_6: uint8
  CLB_DYN_Total_Yaw_Dist: uint16  % Total elapsed distance from the previous AutoFix yaw convergence or SPC start
  CLB_DYN_Total_Pitch_Time: uint16  % Total elapsed time from the previous AutoFix pitch convergence or SPC start
  Reserved_7: uint8
  CLB_DYN_Total_Pitch_Dist: uint16  % Total elapsed distance from the previous AutoFix pitch convergence or SPC start
  CLB_DYN_Total_Roll_Time: uint16  % Total elapsed time from the previous AutoFix roll convergence or SPC start
  Reserved_8: uint8
  CLB_DYN_Total_Roll_Dist: uint16  % Total elapsed distance from the previous AutoFix roll convergence or SPC start
  CLB_DYN_Header_Buffer: uint8
  CLB_DYN_CRC: uint32  % Calculated over each object signals, until (not including) CLB_DYN_Buffer
  CLB_DYN_Yaw_Deg: single  % Online cam2world calibrated delta Yaw from the calibration baseline (TAC/SPC) in degrees.
  CLB_DYN_Pitch_Deg: single  % Online cam2world calibrated delta Pitch from the calibration baseline (TAC/SPC) in degrees.
  CLB_DYN_Yaw_Px: int16  % Full yaw (pixels in level -2)
  CLB_DYN_Pitch_Px: int16  % Full pitch (pixels in level -2)
  CLB_DYN_Roll: single  % Full roll  (in radians)
  CLB_DYN_Cam_Height: single  % full camera_Height
  CLB_DYN_Buffer: uint8

EQ4_CLB_STATIC_BUS = Simulink.Bus()
  EQ4_APPINFO: Bus: EQ4_APPINFO_BUS
  EQ4_CLB_STATIC_HDR: Bus: EQ4_CLB_STATIC_HDR_BUS

EQ4_CLB_STATIC_HDR_BUS = Simulink.Bus()
  CLB_Stat_Zero_byte: uint8  % in case set to FF message is not available.
  Reserved_1: uint8
  CLB_Stat_CRC: uint32  % Calculated over all header signals
  CLB_Stat_Protocol_Version: uint8  % Denotes the protocol version
  CLB_Sync_ID: uint8  % sync to other messages and common data
  CLB_Stat_Run_Mode: uint8  % Calibration run mode
  CLB_Stat_Progress: uint8  % Calibration Static status currently in steps for SPTAC only; for the other TAC applications, the only available steps are INIT and READY
  CLB_Stat_Error: uint8  % Refer to CTAC , SPTAC, and TAC documentation for error values
  CLB_Stat_Header_Buffer: uint8
  CLB_Stat_PH_Yaw: single  % Pinhole yaw deviation from the chassis CS
  CLB_Stat_PH_Pitch: single  % Pinhole pitch deviation from the chassis CS
  CLB_Stat_DIST_Yaw: int16  % Distorted image yaw deviation from the chassis CS. Range depends on the camera resolution. Only for front/rear-looking cameras.
  CLB_Stat_DIST_Pitch: int16  % Distorted image pitch deviation from the chassis CS. Range depends on camera resolution. Only for front/rear-looking cameras.
  Reserved_2: uint8
  CLB_Stat_Roll: single  % Roll deviation from the chassis CS
  CLB_Stat_CAM_Height: single  % Camera height above road surface
  CLB_Recorder_Status: uint8  % The flag indicating flash write status should be integrated into TAC2 output protocol, in order to avoid flash write interruptions by the Tier1's MCU.
  CLB_Stat_Buffer: uint8

EQ4_COM_BUS = Simulink.Bus()
  EQ4_APPINFO: Bus: EQ4_APPINFO_BUS
  EQ4_COM_HDR: Bus: EQ4_COM_HDR_BUS

EQ4_COM_HDR_BUS = Simulink.Bus()
  COM_Zero_byte: uint8  % in case set to FF message is not available.
  Reserved_1: uint8
  COM_CRC: uint32  % Calculated over all signals
  COM_Protocol_Version: uint8  % What version of this protocol we are up to
  COM_Sync_Frame_ID: uint8  % synchronizes between the messages in the same frame
  Reserved_2: uint8
  COM_Frame_MCU_TS_Start: UINT64  % Timestamp of exposure start expressed in MCU time system
  COM_Last_MCU_Sync_TS: UINT64  % Feedback of last clock sync timestamp that was sent to EyeQ from MCU
  COM_Last_Clock_Sync_Skew: int32  % Skew between actual clock sync time that was sent to EyeQ and what EyeQ was expecting. If internal error exceeds signal limits, signal is clamped to its maximum.
  COM_Last_Clock_Sync_Error: uint8  % If Skew is larger than defined in configuration as error or data corruption was found this bit will be turned on to True
  Reserved_3: uint8
  COM_EyeQ_Frame_ID: uint32  % Index of the frame by frame processed number. Only images processed by algo are assigned a number hence the output will be sequential.
  COM_Cam_Frame_ID: uint32  % Actual grab index from camera. Not every image is processed by algo however. This may not be sequential as some are dropped. This is what the logger sees on the headers
  COM_DayTime_Indicator: uint8  % Check Enum Values
  COM_HIL_Mode_Status: uint8
  COM_Exposure_Type: uint8  % Which exposure this is
  COM_Region_Code_V: uint8  % Validator set to false in case the signal is not available.
  COM_Region_Code: uint8  % Region code requierd for sgin accuracy,
  COM_Driving_Side_V: uint8  % Validator set to false in case the signal is not available.
  COM_Driving_Side: uint8  % Indicates driving side.
  COM_Is_HighSpeed_Road_V: uint8  % Validator set to false in case the signal is not available.
  COM_Is_HighSpeed_Road: uint8  % TSR Responsibility: If detected, highway semantics and high driving speed signal will be set to true
  COM_Is_In_Tunnel: uint8  % Indicates whether the vehicle is currently in a tunnel.
    % The signal logic includes the tunnel_confidence with other internal parameters for tunnel detection.
  COM_Tunnel_Conf: single  % Confidence of tunnel detection
  Reserved_4: uint8

EQ4_FCF_VD_BUS = Simulink.Bus()
  EQ4_APPINFO: Bus: EQ4_APPINFO_BUS
  EQ4_FCF_VD_HDR: Bus: EQ4_FCF_VD_HDR_BUS

EQ4_FCF_VD_HDR_BUS = Simulink.Bus()
  FCF_VD_Zero_byte: uint8  % in case set to FF message is not available.
  FCF_VD_Protocol_Version: uint8  % Denotes the protocol version
  FCF_VD_SyncID: uint8  % Synchronizes between messages in same frame
  Reserved_1: uint8
  FCF_Header_CRC: uint32  % CRC over all the below header signals
  FCF_VD_AEB_Supp_FCV: uint16  % AEB suppression reason
  FCF_VD_Alert_FCV: uint16  % Fusion suggestion. Based on configurable specific sets G, H for this purpose.
  FCF_VD_ID_FCV: uint8  % ID of vehicle on which activation was issued
  FCF_VD_HeadWay_Alert: uint8  % HeadWay Alert
  FCF_VD_HeadWay_Distance: single  % Headway distance in meters. Not Implemented
  FCF_VD_Req_Decel_Raw: single  % Requierd break deceleration
  FCF_VD_Brake_Stage: uint8  % Current braking stage in the braking cascade.
  Reserved_2: uint8
  FCF_VD_HW_Supp_Reason: uint16  % For suppression head way reasons please refer to documentations of the Frontal Collision Functionalities.
  FCF_VD_Brake_Decel_Req: single  % General brake deceleration request
  FCF_Header_Buffer: uint8
  FCF_VD_CRC_A: uint32  % CRC over FCF_VD_ID_X and the following signal (16 bit total) only
  FCF_VD_Alert_A: uint16  % Alert for this set
  FCF_VD_ID_A: uint8  % ID of vehicle on which activation was issued
  FCF_VD_Brake_Decel_Req_A: single  % Brake deceleration request
  FCF_VD_AEB_Supp_A: uint16  % AEB suppression reason
  FCF_VD_Safety_Suppressed_A: uint8  % The bit indicates allert suppresion as for safety event
  Reserved_3: uint8
  FCF_VD_FCW_Supp_A: uint32  % FCW suppression reason
  FCF_VD_Set_Type_A: uint8  % The type of the raised alert
  FCF_VD_TTC_Thresh_A: single  % TTC used threshold
  FCF_VD_TTC_A: single  % Estimated TTC for debug usage only
  FCF_VD_Buffer_A: uint8
  FCF_VD_CRC_B: uint32  % CRC over FCF_VD_ID_X and the following signal (16 bit total) only
  FCF_VD_Alert_B: uint16  % Alert for this set
  FCF_VD_ID_B: uint8  % ID of vehicle on which activation was issued
  FCF_VD_Brake_Decel_Req_B: single  % Brake deceleration request
  FCF_VD_AEB_Supp_B: uint16  % AEB suppression reason:
  FCF_VD_Safety_Suppressed_B: uint8  % The bit indicates allert suppresion as for safety event
  Reserved_4: uint8
  FCF_VD_FCW_Supp_B: uint32  % FCW suppression reason
  FCF_VD_Set_Type_B: uint8  % The type of the raised alert
  FCF_VD_TTC_Thresh_B: single  % TTC used threshold
  FCF_VD_TTC_B: single  % Estimated TTC for debug usage only
  FCF_VD_Buffer_B: uint8
  FCF_VD_CRC_C: uint32  % CRC over FCF_VD_ID_X and the following signal (16 bit total) only
  FCF_VD_Alert_C: uint16  % Alert for this set
  FCF_VD_ID_C: uint8  % ID of vehicle on which activation was issued
  FCF_VD_Brake_Decel_Req_C: single  % Brake deceleration request
  FCF_VD_AEB_Supp_C: uint16  % AEB suppression reason:
  FCF_VD_Safety_Suppressed_C: uint8  % The bit indicates allert suppresion as for safety event
  Reserved_5: uint8
  FCF_VD_FCW_Supp_C: uint32  % FCW suppression reason
  FCF_VD_Set_Type_C: uint8  % The type of the raised alert
  FCF_VD_TTC_Thresh_C: single  % TTC used threshold
  FCF_VD_TTC_C: single  % Estimated TTC for debug usage only
  FCF_VD_Buffer_C: uint8
  FCF_VD_CRC_D: uint32  % CRC over FCF_VD_ID_X and the following signal (16 bit total) only
  FCF_VD_Alert_D: uint16  % Alert for this set
  FCF_VD_ID_D: uint8  % ID of vehicle on which activation was issued
  FCF_VD_Brake_Decel_Req_D: single  % Brake deceleration request
  FCF_VD_AEB_Supp_D: uint16  % AEB suppression reason:
  FCF_VD_Safety_Suppressed_D: uint8  % The bit indicates allert suppresion as for safety event
  Reserved_6: uint8
  FCF_VD_FCW_Supp_D: uint32  % FCW suppression reason
  FCF_VD_Set_Type_D: uint8  % The type of the raised alert
  FCF_VD_TTC_Thresh_D: single  % TTC used threshold
  FCF_VD_TTC_D: single  % Estimated TTC for debug usage only
  FCF_VD_Buffer_D: uint8
  FCF_VD_CRC_E: uint32  % CRC over FCF_VD_ID_X and the following signal (16 bit total) only
  FCF_VD_Alert_E: uint16  % Alert for this set
  FCF_VD_ID_E: uint8  % ID of vehicle on which activation was issued
  FCF_VD_Brake_Decel_Req_E: single  % Brake deceleration request
  FCF_VD_AEB_Supp_E: uint16  % AEB suppression reason:
  FCF_VD_Safety_Suppressed_E: uint8  % The bit indicates allert suppresion as for safety event
  Reserved_7: uint8
  FCF_VD_FCW_Supp_E: uint32  % FCW suppression reason
  FCF_VD_Set_Type_E: uint8  % The type of the raised alert
  FCF_VD_TTC_Thresh_E: single  % TTC used threshold
  FCF_VD_TTC_E: single  % Estimated TTC for debug usage only
  FCF_VD_Buffer_E: uint8
  FCF_VD_CRC_F: uint32  % CRC over FCF_VD_ID_X and the following signal (16 bit total) only
  FCF_VD_Alert_F: uint16  % Alert for this set
  FCF_VD_ID_F: uint8  % ID of vehicle on which activation was issued
  FCF_VD_Brake_Decel_Req_F: single  % Brake deceleration request
  FCF_VD_AEB_Supp_F: uint16  % AEB suppression reason:
  FCF_VD_Safety_Suppressed_F: uint8  % The bit indicates allert suppresion as for safety event
  Reserved_8: uint8
  FCF_VD_FCW_Supp_F: uint32  % FCW suppression reason
  FCF_VD_Set_Type_F: uint8  % The type of the raised alert
  FCF_VD_TTC_Thresh_F: single  % TTC used threshold
  FCF_VD_TTC_F: single  % Estimated TTC for debug usage only
  FCF_VD_Buffer_F: uint8
  FCF_VD_CRC_G: uint32  % CRC over FCF_VD_ID_X and the following signal (16 bit total) only
  FCF_VD_Alert_G: uint16  % Alert for this set
  FCF_VD_ID_G: uint8  % ID of vehicle on which activation was issued
  FCF_VD_Brake_Decel_Req_G: single  % Brake deceleration request
  FCF_VD_AEB_Supp_G: uint16  % AEB suppression reason:
  FCF_VD_Safety_Suppressed_G: uint8  % The bit indicates allert suppresion as for safety event
  Reserved_9: uint8
  FCF_VD_FCW_Supp_G: uint32  % FCW suppression reason
  FCF_VD_Set_Type_G: uint8  % The type of the raised alert
  FCF_VD_TTC_Thresh_G: single  % TTC used threshold
  FCF_VD_TTC_G: single  % Estimated TTC for debug usage only
  FCF_VD_Buffer_G: uint8
  FCF_VD_CRC_H: uint32  % CRC over FCF_VD_ID_X and the following signal (16 bit total) only
  FCF_VD_Alert_H: uint16  % Alert for this set
  FCF_VD_ID_H: uint8  % ID of vehicle on which activation was issued
  FCF_VD_Brake_Decel_Req_H: single  % Brake deceleration request
  FCF_VD_AEB_Supp_H: uint16  % AEB suppression reason:
  FCF_VD_Safety_Suppressed_H: uint8  % The bit indicates allert suppresion as for safety event
  Reserved_10: uint8
  FCF_VD_FCW_Supp_H: uint32  % FCW suppression reason
  FCF_VD_Set_Type_H: uint8  % The type of the raised alert
  FCF_VD_TTC_Thresh_H: single  % TTC used threshold
  FCF_VD_TTC_H: single  % Estimated TTC for debug usage only
  FCF_VD_Buffer_H: uint8

EQ4_FCF_VRU_BUS = Simulink.Bus()
  EQ4_APPINFO: Bus: EQ4_APPINFO_BUS
  EQ4_FCF_VRU_HDR: Bus: EQ4_FCF_VRU_HDR_BUS

EQ4_FCF_VRU_HDR_BUS = Simulink.Bus()
  FCF_VRU_Zero_byte: uint8  % in case set to FF message is not available.
  FCF_VRU_Protocol_Version: uint8  % Denotes the protocol version
  FCF_VRU_Sync_ID: uint8  % Sync ID to be used to sync between signals in the system
  FCF_VRU_Brake_Decel_Req: single  % General brake deceleration request
  FCF_VRU_Header_Buffer: uint8
  FCF_VRU_CRC_L1: uint32  % CRC over FCF_VRU_PED_ID_LX and previous Signal (16 bit total)
  FCF_VRU_Alert_L1: uint16  % Alert for this set
  FCF_VRU_Brake_Decel_Req_L1: single  % Breaking deceleration request
  FCF_VRU_PED_ID_L1: uint8  % ID for MCP
  FCF_VRU_Suppress_L1: uint8  % Alert suppress bitmap.
    % bits description :
    % 1=MAX_SPEED
    % 2=MIN_SPEED
    % 3=BRAKE
    % 4=MAX_YAW RATE
    % 5=REAR_GEAR
    % 6=STEERING_ANGLE
  FCF_VRU_Safety_Suppressed_L1: uint8  % Bit represents suppresion as for safety event
  FCF_VRU_Set_Type_L1: uint8  % The type of the raised alert
  FCF_VRU_Curr_In_Path_L1: uint8  % Is target inside current path?
  FCF_VRU_Pred_In_Path_L1: uint8  % Is target predicted to be in current path?
  FCF_VRU_TTC_L1: single  % General estimation for debug only of the TTC measured at alert event
  FCF_VRU_TTC_Thresh_L1: single  % TTC threshold for target
  FCF_VRU_Buffer_L1: uint8
  FCF_VRU_CRC_L2: uint32  % CRC over FCF_VRU_PED_ID_LX and previous Signal (16 bit total)
  FCF_VRU_Alert_L2: uint16  % Alert for this set
  FCF_VRU_Brake_Decel_Req_L2: single  % Breaking deceleration request
  FCF_VRU_PED_ID_L2: uint8  % ID for MCP
  FCF_VRU_Suppress_L2: uint8  % Alert suppress bitmam.
    % bits description :
    % 1=MAX_SPEED
    % 2=MIN_SPEED
    % 3=BRAKE
    % 4=MAX_YAW RATE
    % 5=REAR_GEAR
    % 6=STEERING_ANGLE
  FCF_VRU_Safety_Suppressed_L2: uint8  % Bit represents suppresion as for safety event
  FCF_VRU_Set_Type_L2: uint8  % The type of the raised alert
  FCF_VRU_Curr_In_Path_L2: uint8  % Is target inside current path?
  FCF_VRU_Pred_In_Path_L2: uint8  % Is target predicted to be in current path?
  FCF_VRU_TTC_L2: single  % General estimation for debug only of the TTC measured at alert event
  FCF_VRU_TTC_Thresh_L2: single  % TTC threshold for target
  FCF_VRU_Buffer_L2: uint8
  FCF_VRU_CRC_L3: uint32  % CRC over FCF_VRU_PED_ID_LX and previous Signal (16 bit total)
  FCF_VRU_Alert_L3: uint16  % Alert for this set
  FCF_VRU_Brake_Decel_Req_L3: single  % Breaking deceleration request
  FCF_VRU_PED_ID_L3: uint8  % ID for MCP
  FCF_VRU_Suppress_L3: uint8  % Alert suppress bitmam.
    % bits description :
    % 1=MAX_SPEED
    % 2=MIN_SPEED
    % 3=BRAKE
    % 4=MAX_YAW RATE
    % 5=REAR_GEAR
    % 6=STEERING_ANGLE
  FCF_VRU_Safety_Suppressed_L3: uint8  % Bit represents suppresion as for safety event
  FCF_VRU_Set_Type_L3: uint8  % The type of the raised alert
  FCF_VRU_Curr_In_Path_L3: uint8  % Is target inside current path?
  FCF_VRU_Pred_In_Path_L3: uint8  % Is target predicted to be in current path?
  FCF_VRU_TTC_L3: single  % General estimation for debug only of the TTC measured at alert event
  FCF_VRU_TTC_Thresh_L3: single  % TTC threshold for target
  FCF_VRU_Buffer_L3: uint8
  FCF_VRU_CRC_L4: uint32  % CRC over FCF_VRU_PED_ID_LX and previous Signal (16 bit total)
  FCF_VRU_Alert_L4: uint16  % Alert for this set
  FCF_VRU_Brake_Decel_Req_L4: single  % Breaking deceleration request
  FCF_VRU_PED_ID_L4: uint8  % ID for MCP
  FCF_VRU_Suppress_L4: uint8  % Alert suppress bitmam.
    % bits description :
    % 1=MAX_SPEED
    % 2=MIN_SPEED
    % 3=BRAKE
    % 4=MAX_YAW RATE
    % 5=REAR_GEAR
    % 6=STEERING_ANGLE
  FCF_VRU_Safety_Suppressed_L4: uint8  % Bit represents suppresion as for safety event
  FCF_VRU_Set_Type_L4: uint8  % The type of the raised alert
  FCF_VRU_Curr_In_Path_L4: uint8  % Is target inside current path?
  FCF_VRU_Pred_In_Path_L4: uint8  % Is target predicted to be in current path?
  FCF_VRU_TTC_L4: single  % General estimation for debug only of the TTC measured at alert event
  FCF_VRU_TTC_Thresh_L4: single  % TTC threshold for target
  FCF_VRU_Buffer_L4: uint8
  FCF_VRU_CRC_L5: uint32  % CRC over FCF_VRU_PED_ID_LX and previous Signal (16 bit total)
  FCF_VRU_Alert_L5: uint16  % Alert for this set
  FCF_VRU_Brake_Decel_Req_L5: single  % Breaking deceleration request
  FCF_VRU_PED_ID_L5: uint8  % ID for MCP
  FCF_VRU_Suppress_L5: uint8  % Alert suppress bitmam.
    % bits description :
    % 1=MAX_SPEED
    % 2=MIN_SPEED
    % 3=BRAKE
    % 4=MAX_YAW RATE
    % 5=REAR_GEAR
    % 6=STEERING_ANGLE
  FCF_VRU_Safety_Suppressed_L5: uint8  % Bit represents suppresion as for safety event
  FCF_VRU_Set_Type_L5: uint8  % The type of the raised alert
  FCF_VRU_Curr_In_Path_L5: uint8  % Is target inside current path?
  FCF_VRU_Pred_In_Path_L5: uint8  % Is target predicted to be in current path?
  FCF_VRU_TTC_L5: single  % General estimation for debug only of the TTC measured at alert event
  FCF_VRU_TTC_Thresh_L5: single  % TTC threshold for target
  FCF_VRU_Buffer_L5: uint8
  FCF_VRU_CRC_L6: uint32  % CRC over FCF_VRU_PED_ID_LX and previous Signal (16 bit total)
  FCF_VRU_Alert_L6: uint16  % Alert for this set
  FCF_VRU_Brake_Decel_Req_L6: single  % Breaking deceleration request
  FCF_VRU_PED_ID_L6: uint8  % ID for MCP
  FCF_VRU_Suppress_L6: uint8  % Alert suppress bitmam.
    % bits description :
    % 1=MAX_SPEED
    % 2=MIN_SPEED
    % 3=BRAKE
    % 4=MAX_YAW RATE
    % 5=REAR_GEAR
    % 6=STEERING_ANGLE
  FCF_VRU_Safety_Suppressed_L6: uint8  % Bit represents suppresion as for safety event
  FCF_VRU_Set_Type_L6: uint8  % The type of the raised alert
  FCF_VRU_Curr_In_Path_L6: uint8  % Is target inside current path?
  FCF_VRU_Pred_In_Path_L6: uint8  % Is target predicted to be in current path?
  FCF_VRU_TTC_L6: single  % General estimation for debug only of the TTC measured at alert event
  FCF_VRU_TTC_Thresh_L6: single  % TTC threshold for target
  FCF_VRU_Buffer_L6: uint8
  FCF_VRU_CRC_L7: uint32  % CRC over FCF_VRU_PED_ID_LX and previous Signal (16 bit total)
  FCF_VRU_Alert_L7: uint16  % Alert for this set
  FCF_VRU_Brake_Decel_Req_L7: single  % Breaking deceleration request
  FCF_VRU_PED_ID_L7: uint8  % ID for MCP
  FCF_VRU_Suppress_L7: uint8  % Alert suppress bitmam.
    % bits description :
    % 1=MAX_SPEED
    % 2=MIN_SPEED
    % 3=BRAKE
    % 4=MAX_YAW RATE
    % 5=REAR_GEAR
    % 6=STEERING_ANGLE
  FCF_VRU_Safety_Suppressed_L7: uint8  % Bit represents suppresion as for safety event
  FCF_VRU_Set_Type_L7: uint8  % The type of the raised alert
  FCF_VRU_Curr_In_Path_L7: uint8  % Is target inside current path?
  FCF_VRU_Pred_In_Path_L7: uint8  % Is target predicted to be in current path?
  FCF_VRU_TTC_L7: single  % General estimation for debug only of the TTC measured at alert event
  FCF_VRU_TTC_Thresh_L7: single  % TTC threshold for target
  FCF_VRU_Buffer_L7: uint8
  FCF_VRU_CRC_L8: uint32  % CRC over FCF_VRU_PED_ID_LX and previous Signal (16 bit total)
  FCF_VRU_Alert_L8: uint16  % Alert for this set
  FCF_VRU_Brake_Decel_Req_L8: single  % Breaking deceleration request
  FCF_VRU_PED_ID_L8: uint8  % ID for MCP
  FCF_VRU_Suppress_L8: uint8  % Alert suppress bitmam.
    % bits description :
    % 1=MAX_SPEED
    % 2=MIN_SPEED
    % 3=BRAKE
    % 4=MAX_YAW RATE
    % 5=REAR_GEAR
    % 6=STEERING_ANGLE
  FCF_VRU_Safety_Suppressed_L8: uint8  % Bit represents suppresion as for safety event
  FCF_VRU_Set_Type_L8: uint8  % The type of the raised alert
  FCF_VRU_Curr_In_Path_L8: uint8  % Is target inside current path?
  FCF_VRU_Pred_In_Path_L8: uint8  % Is target predicted to be in current path?
  FCF_VRU_TTC_L8: single  % General estimation for debug only of the TTC measured at alert event
  FCF_VRU_TTC_Thresh_L8: single  % TTC threshold for target
  FCF_VRU_Buffer_L8: uint8

EQ4_FSPX_BUS = Simulink.Bus()
  EQ4_APPINFO: Bus: EQ4_APPINFO_BUS
  EQ4_FSPX_HDR: Bus: EQ4_FSPX_HDR_BUS
  EQ4_FSPX_ELEM: Bus: EQ4_FSPX_ELEM_BUS[72]

EQ4_FSPX_ELEM_BUS = Simulink.Bus()
  FSPX_Is_Valid: uint8
  FSPX_Existence_Prob_B0: single  % Probability of presence of obstacle
  FSPX_Mobility_Status_B0: uint8  % Enumeration of mobility status
  FSPX_Classification_Conf_B0: single  % Confidence level of classification
  FSPX_Classification_Type_B0: uint8  % Enumeration of classification type
  FSPX_Lane_Assginment_B0: uint8  % the lane on which the obstacle is detected
  Reserved_1: uint8
  FSPX_Obstacle_ID_B0: uint8  % the obs id which the border relate to (if available)
  FSPX_Elevation_Angle_B0: single  % The angle between the horizon and the obsticle contact point on the road
  FSPX_Range_STD_B0: single  % Polar distance STD in meters
  Reserved_2: uint8
  FSPX_Height_B0: single  % Obstacle height in meters
  FSPX_Height_STD_B0: single  % Obstacle height STD in meters
  FSPX_Azimuth_Angle_B0: single  % The angle between the longitudinal axis and the obstacle point. Left growing positive and right growing negative
  FSPX_Azimuth_Angle_STD_B0: single  % Angle std
  FSPX_Range_B0: single  % Polar distance to obstacle in meters
  Reserved_3: uint8

EQ4_FSPX_HDR_BUS = Simulink.Bus()
  FSPX_Zero_byte: uint8  % in case set to FF message is not available.
  FSPX_Protocol_Version: uint8  % Denotes the protocol version
  FSPX_Sync_ID: uint8  % Sync ID to be used to sync between signals in the system
  FSPX_Header_Buffer: uint8

EQ4_FS_BUS = Simulink.Bus()
  EQ4_APPINFO: Bus: EQ4_APPINFO_BUS
  EQ4_FS_HDR: Bus: EQ4_FS_HDR_BUS
  EQ4_FS_ELEM: Bus: EQ4_FS_ELEM_BUS[15]

EQ4_FS_ELEM_BUS = Simulink.Bus()
  FS_CRC: uint32  % Calculated over each object signal
  FS_Camera_ID: uint8  % The relevant camera.
  FS_Free_Sight: uint8  % False until free sight is approved
  FS_Splashes: uint8  % The lower edges of vehicles cannot be detected due to water spray, a.k.a. splashes.
  FS_Sun_Ray: uint8  % Strong glare due to micro scratches on windshield.
  FS_Low_Sun: uint8  % Sun glare which disrupts the image. The sun appears over the FOE.
  FS_Blur_Image: uint8  % Issued when visibility on the image is lowered such that detection of objects inside the Danger Zone (in-path and next lanes up-to some level) cannot be fully performed
  FS_Partial_Blockage: uint8  % Low visibility due to partially covered lens.
  FS_Full_Blockage: uint8  % No visibility due to fully covered lens. Takes 50 frames with no edges. Recovery is very quick (max 50 frames). Will be on when standing at night with no headlights.
  FS_Frozen_Windshield_Lens: uint8  % Significant failsafe indicating windshield is frozen. This will impact on all technologies.
  FS_Out_Of_Focus: uint8  % Vision detected that the focus calibration is not correct.
  FS_C2C_Out_Of_Calib: uint8  % Vision detected that  reported  camera to main  camera  calibration, can't be corrected (Auto Fix).

EQ4_FS_HDR_BUS = Simulink.Bus()
  FSP_Zero_byte: uint8  % in case set to FF message is not available.
  Reserved_1: uint8
  FS_Header_CRC: uint32  % Calculated over all header values
  FS_Protocol_Version: uint8  % Version number of failsafe message
  FS_Sync_ID: uint8  % The ID of the Sync message, used to synchronize between signals in the system. Every new frame promotes the sync ID by one.
  FS_Cameras_Number: uint8  % Number of FS available cameras
  FS_TSR_Out_OF_Calib: uint8  % Specific TSR Out-of-Calib Signal
  FS_Out_Of_Calib: uint8  % Vision detected that the calibration camera to world exceede level 0 40 px tollerance  from the baseline calibration (Auto Fix).
  Reserved_2: uint8
  FS_Impacted_Technologies: uint16  % Impacted technologies from detected fail safes according to the fail-safe ME schema
  FS_Buffer_C1: uint16
  FS_Rain: uint8  % Detection of precipitation.
  FS_Fog: uint8  % Detection of fog.
  FS_Calibration_Misalignment: uint8  % Road Model misalignment
  FS_C2W_OOR: uint8  % The Out Of Range (OOR) FS signal will indicate that the current Cam2World extrinsic calibration found exceeded the allowed system tolerance defined by the OEM using the min/max Yaw/Horizon and MaxRoll ranges definitions
  Reserved_3: uint8

EQ4_HLB_BUS = Simulink.Bus()
  EQ4_APPINFO: Bus: EQ4_APPINFO_BUS
  EQ4_HLB_HDR: Bus: EQ4_HLB_HDR_BUS

EQ4_HLB_HDR_BUS = Simulink.Bus()
  HLB_Zero_byte: uint8  % in case set to FF message is not available.
  HLB_Protocol_Version: uint8  % Denotes the protocol version
  HLB_Sync_ID: uint8  % Sync ID to be used to sync between signals in the system
  HLB_Running_Mode: uint8  % INVALID_TYPE = -1
    % HLB_OFF  - during the day,  all hrSpots modules shouldn't run
    % HLB_INACTIVE - only brightScene module is running
    % HLB_FULL - all hrSpots is running
  HLB_Inactive_Reason: uint8  % Reason for entering Inactive State
  HLB_Decision: uint8
  HZD_Buffer_C1: uint8
  HLB_Reason: uint32
  HLB_Brightness_Score: single  % MF score of brightness calculated in HLB technology

EQ4_LAP_ELEM_BUS = Simulink.Bus()
  LAP_INTP_ID: uint8  % ID of the interest point , which is unique ID kept as long as the INTP is tracked.
  LAP_INTP_Distance_Age: uint8  % The distance age represents the duration in meters of the INTP from the first frame it was detected. The distance age in the first detected frame has the maximum value and the last frame that the INTP was detected has the minimum value of distance age.
  LAP_INTP_Confidence: single  % The Confidence of the INTP.
  LAP_INTP_Is_Valid: uint8  % The INTP information should not be used if this signal is not valid.
  LAP_INTP_Type: uint8  % Semantic information describing if the interest point is of split or merge type.
  LAP_INTP_Is_Start: uint8  % Indicates whether the INTP is the start or end point of a transition.
  Reserved_4: uint8
  LAP_INTP_Lat_Distance: single  % The lateral distance from the camera to the interest point.
  LAP_INTP_Long_Distance: single  % The longitudinal distance from the camera to the interest point.
  Reserved_5: uint8
  LAP_INTP_SRD: uint8  % Semantic description of the interest point.
  LAP_INTP_Role: uint8  % Role of interest point
  Reserved_6: uint8

EQ4_LAP_HDR_BUS = Simulink.Bus()
  LAP_Zero_byte: uint8  % in case set to FF message is not available.
  LAP_Protocol_Version: uint8  % Denotes the protocol version
  LAP_Sync_ID: uint8  % The ID of the Sync message, used to synchronize between signals in the system. Every new frame promotes the sync ID by one.
  LAP_Is_Construction_Area: uint8  % Indicates whether this is a construction area scene.
  LAP_Snow_On_Road: uint8  % Indication of snow on the road ahead of the host vehicle
  LAP_INTP_Available: uint8  % Indicates if Interest Points (INTP) information is available.
    % INTP are split and merge points
  LAP_INTP_Count: uint8  % The number of detected interest points.
  LAP_Exit_Merge_Available: uint8  % Indicates if merge exit signal information is available.
  LAP_Is_Highway_Merge_Left: uint8  % Indication of highway merge left to the host.
  LAP_Is_Highway_Merge_Right: uint8  % Indication of highway merge right to the host.
  LAP_Is_Highway_Exit_Left: uint8  % Indication of highway exit left to the host.
  LAP_Is_Highway_Exit_Right: uint8  % Indication of highway exit right to the host.
  LAP_Vertical_Surface_Available: uint8  % Vertical surface is used by the customers to visualize  lane boundaries on the image. This signal indicates if the vertical surface information is available.
  LAP_Vertical_Surface_VR_End: single  % The vertical surface polynomial should be used up to VR end.
  Reserved_1: uint8
  LAP_Vertical_Surface_C0: single  % Ci is coefficient corresponding to variable with power of 'i'.
  LAP_Vertical_Surface_C1: single  % Ci is coefficient corresponding to variable with power of 'i'.
  LAP_Vertical_Surface_C2: single  % Ci is coefficient corresponding to variable with power of 'i'.
  LAP_Vertical_Surface_C3: single  % Ci is coefficient corresponding to variable with power of 'i'.
  LAP_Path_Pred_CRC: uint32  % CRC over the Path_Pred signals.
  LAP_Path_Pred_Available: uint8  % Indicates if path prediction technology is allowed by configuration
  LAP_Path_Pred_First_Valid: uint8  % The path prediction (PP) model can be represented by two consecutive segments; first segment and second segment. This representation is rare and needed only in certain scenarios where a single model cannot represent the drivable path accurately. Whenever host is multi-segments, the PP is also multi-segments.
  LAP_Path_Pred_Second_Valid: uint8  % The path prediction (PP) model can be represented by two consecutive segments; first segment and second segment. This representation is rare and needed only in certain scenarios where a single model cannot represent the drivable path accurately. Whenever host is multi-segments, the PP is also multi-segments. In those cases, this signal is turned on. If the PP model is represented by a single model, this signal is turned off.
  LAP_Path_Pred_Half_Width: single  % The half of the host lane width
  LAP_Path_Pred_Conf: single  % The path prediction confidence is set by the fusion algorithm and is highly reliable and correlated with lateral error
  LAP_Is_Triggered_SDM_Model: uint8  % This flag is turned on when the SDM is triggered on path prediction model.
  Reserved_2: uint8
  LAP_Path_Pred_First_VR_End: single  % The view range end of the Path Prediction first polynomial. The Path Prediction output is valid at the first visible point of the road, above the ego vehicle's car hood.
  LAP_Path_Pred_second_VR_End: single  % The view range end of the Path Prediction second segment
  Reserved_3: uint8
  LAP_Path_Pred_First_C0: single  % Ci is coefficient corresponding to variable with power of 'i' in the first segment polynomial.
  LAP_Path_Pred_First_C1: single  % Ci is coefficient corresponding to variable with power of 'i' in the first segment polynomial.
  LAP_Path_Pred_First_C2: single  % Ci is coefficient corresponding to variable with power of 'i' in the first segment polynomial.
  LAP_Path_Pred_First_C3: single  % Ci is coefficient corresponding to variable with power of 'i' in the first segment polynomial.
  LAP_Path_Pred_Second_C0: single  % Ci is coefficient corresponding to variable with power of 'i' in the second segment polynomial.
  LAP_Path_Pred_Second_C1: single  % Ci is coefficient corresponding to variable with power of 'i' in the second segment polynomial.
  LAP_Path_Pred_Second_C2: single  % Ci is coefficient corresponding to variable with power of 'i' in the second segment polynomial.
  LAP_Path_Pred_Second_C3: single  % Ci is coefficient corresponding to variable with power of 'i' in the second segment polynomial.

EQ4_LA_BUS = Simulink.Bus()
  EQ4_APPINFO: Bus: EQ4_APPINFO_BUS
  EQ4_LA_HDR: Bus: EQ4_LA_HDR_BUS
  EQ4_LA_ELEM: Bus: EQ4_LA_ELEM_BUS[4]

EQ4_LA_ELEM_BUS = Simulink.Bus()
  LA_Lane_Track_ID: uint8  % ID of the lane mark model. Each lane mark has its own unique ID which is kept as long as the lane mark is tracked.
  LA_Age: uint8  % The age represents the duration of the lane mark from the first frame it was detected.
  LA_Confidence: single  % The confidence indicates the probability that the lane mark actually exists.
  LA_Color: uint8  % The color classification of the lane mark;  can be white, yellow or blue
  LA_Color_Conf: single  % The confidence of the lane mark color classification
  LA_Prediction_Reason: uint8  % Prediction_Reason [i] will be set to true if the lane mark was predicted for reason i
    % more than one index of the array might be set to true, since several predictions can be activated simultaneously(first segment only)
  LA_Availability_State: uint8  % The lane mark can be detected, predicted or unavailable. The lane mark is considered predicted only if no segment is detected from the image.
  LA_View_Range_Start: single  % The lane mark polynomial should be used only between VR start to VR end.
    % VR start represents the first point detected or predicted, the smaller between the two.
  Reserved_2: uint8
  LA_View_Range_End: single  % The lane mark polynomial should be used only between VR start to VR end.
    % VR end represents the last point detected or predicted, the larger between the two.
  LA_Measured_VR_End: single  % Measured view range indicates the furthest detected point.
    % Measured view range is always smaller or equal to VR end.
  Reserved_3: uint8
  LA_Lanemark_Type: uint8  % The type classification of the lane mark.
    % The double lane mark (DLM) type have sub-type; see LA_DLM_Type
    % HOV and decceleration types are not supported for the next lanes.
  LA_DLM_Type: uint8  % Double lane mark type is defined first by the inner lane mark (close to the vehicle) and than the outer lane mark.
  LA_Lanemark_Type_Conf: single  % The confidence of the lane mark type classification
  LA_Line_Side: uint8  % The role of the lane mark relative to the host vehicle.
    % Commonly the host left boundary is also the right boundary of the next left lane (and the host right boundary is also the left boundary of the next right lane)
    % In safety zone (hatched area) there are two lane marks that defines the next lane.
    % For next lane to the right of the host lane: the RIGHT_LEFT_LANEMARK is the closer line to the host lane and the RIGHT_RIGHT_LANEMARK is the further.
    % When no safety zone, one of the lane mark is defined by the host line and the second is by the following:
    % RIGHT_RIGHT_LANEMARK represents the next lane mark to the right of the host, LEFT_LEFT_LANEMARK represents the next lane mark to the left of the host.
  LA_Marker_Width: single  % The lane mark width is defined as the distance between the inner most edge of the inner most lane mark (with respect to vehicles driving in that lane) and the outer most edge of the outer most lane mark. The definition is also valid for multiple lane marks. The width outputted is the lane mark's average width over the lane boundary detected range.
  Reserved_4: uint8
  LA_Marker_Width_STD: single  % Standard deviation of the lane mark width
  Reserved_5: uint8
  LA_Line_C3: single  % Ci is coefficient corresponding to variable with power of 'i'
  LA_Line_C2: single  % Ci is coefficient corresponding to variable with power of 'i'
  LA_Line_C1: single  % Ci is coefficient corresponding to variable with power of 'i'
  LA_Line_C0: single  % Ci is coefficient corresponding to variable with power of 'i'
  LA_Detection_Source: uint8  % Indication of the detection source for surround setups
  Reserved_6: uint8

EQ4_LA_HDR_BUS = Simulink.Bus()
  LA_Zero_byte: uint8  % in case set to FF message is not available.
  LA_Protocol_Version: uint8  % Denotes protocol version
  LA_Sync_ID: uint8  % Sync ID to be used to sync between signals in system
  LA_Adjacent_Count: uint8  % Maximum number of lines supported by this protocol
  Reserved_1: uint8

EQ4_LDW_BUS = Simulink.Bus()
  EQ4_APPINFO: Bus: EQ4_APPINFO_BUS
  EQ4_LDW_HDR: Bus: EQ4_LDW_HDR_BUS

EQ4_LDW_ELEM_BUS = Simulink.Bus()
  LDW_Suppression_Reason: uint16  % Warning Suppression reasons
  LDW_Time_To_Warning_Left: single  % Time to cross the closest warning line, position, or TLC.
  LDW_Time_To_Warning_Right: single  % Time to cross the closest warning line, position, or TLC.
  LDW_Warning_Status_Left: uint8  % SUPPRESSED: LDW module is unavailable due to suppression
    % DISABLED: LDW Module is not available
    % ENABLED: Module is ready to assist
    % ACTIVE: Alarm warning is triggered
  LDW_Warning_Status_Right: uint8  % SUPPRESSED: LDW module is unavailable due to suppression
    % DISABLED: LDW Module is not available
    % ENABLED: Module is ready to assist
    % ACTIVE:  Alarm warning is triggered
  Reserved_3: uint8

EQ4_LDW_HDR_BUS = Simulink.Bus()
  LDW_Zero_byte: uint8  % in case set to FF message is not available.
  LDW_Protocol_Version: uint8  % Denotes protocol version
  LDW_Sync_ID: uint8  % Sync ID to be used to sync between signals in system
  LDW_Line_Valid_Left: uint8  % True if left lane can be used for warning
  LDW_Line_Valid_Right: uint8  % True if right lane can be used for warning
  Reserved_1: uint8
  LDW_Time_To_Host_Left: single  % time to host right lanemark  crossing
  LDW_Time_To_Host_Right: single  % time to host right lanemark  crossing
  Reserved_2: uint8

EQ4_LH_BUS = Simulink.Bus()
  EQ4_APPINFO: Bus: EQ4_APPINFO_BUS
  EQ4_LH_HDR: Bus: EQ4_LH_HDR_BUS
  EQ4_LH_ELEM: Bus: EQ4_LH_ELEM_BUS[2]

EQ4_LH_ELEM_BUS = Simulink.Bus()
  LH_CRC: uint32  % Calculated over all host lane mark information. Starting from  LH_Is_Triggered_SDM_Type until (including) LH_Buffer_C3
  LH_Is_Triggered_SDM_Type: uint8  % This flag is turned on when the SDM is triggered on lane mark type.
  LH_Is_Triggered_SDM_Model: uint8  % This flag is turned on when the SDM is triggered on lane mark model.
  LH_Track_ID: uint8  % ID of the lane mark model. Each lane mark had its own unique ID which is kept as long as the lane mark is tracked.
  LH_Age: uint8  % The age represents the duration of the lane mark from the first frame it was detected.
  LH_Confidence: single  % The confidence indicates the probability that the lane mark actually exists.
  Reserved_3: uint8
  LH_Prediction_Reason: uint8  % Prediction_Reason [i] will be set to true if the lane mark was predicted for reason i
    % more than one index of the array might be set to true, since several predictions can be actived simultaneously. (This is valid for the first segment only)
  LH_Availability_State: uint8  % The lane mark can be detected, predicted or unavailable. The lane mark is considered predicted only if no segment is detected from the image.
  LH_Color: uint8  % The color classification of the lane mark;  can be white, yellow or blue
  LH_Color_Confidence: single  % The confidence of the lane mark color classification
  LH_Lanemark_Type: uint8
  LH_DLM_Type: uint8  % Double lane mark type is defined first by the inner lane mark (close to the vehicle) and than the outer lane mark.
  LH_DECEL_Type: uint8  % The decceleration area type is defined by the type of the center lane mark.
  Reserved_4: uint8
  LH_Lanemark_Type_Conf: single  % The confidence of the lane mark type classification
  LH_Side: uint8  % The side of the host lane mark ; host left ot host right
  LH_Crossing: uint8  % The crossing signal is an indication of whether the host vehicle performed lane crossing
  LH_Marker_Width: single  % The lane mark width is defined as the distance between the inner most edge of the inner most lane mark (with respect to vehicles driving in that lane) and the outer most edge of the outer most lane mark. The definition is also valid for multiple lane marks. The width outputted is the lane mark's average width over the lane boundary detected range.
  LH_Marker_Width_STD: single  % Standard deviation of the lane mark width
  Reserved_5: uint8
  LH_Dash_Average_Length: single  % Average length of each section of dashed line when lane mark is classified as dashed. This is a multi-frame signal. (first segment only)
  LH_Dash_Average_Gap: single  % Average gap between of sections of dashed line when lane mark is classified as dashed.  This is a multi-frame signal. (first segment only)
  LH_Is_Multi_Clothoid: uint8  % The lane mark model can be represented by two consecutive segments; first segment and second segment. This representation is rare and needed only in certain scenarios where a single model cannot represent the lane mark accuratly. In those cases, this signal is turned on. Lane mark attributes, like color, type, LM width etc are relevant to the first segment only.
  Reserved_6: uint8
  LH_Line_First_C0: single  % Ci is coefficient corresponding to variable with power of 'i'.
    % In multi-clothoid modeling, this represent the C0 of the first segment coefficient.
    % For single model, the C0 coefficient is used to represent the entire model.
  LH_Line_First_C1: single  % Ci is coefficient corresponding to variable with power of 'i'.
    % In multi-clothoid modeling, this represent the C1 of the first segment coefficient.
    % For single model, the C0 coefficient is used to represent the entire model.
  LH_Line_First_C2: single  % Ci is coefficient corresponding to variable with power of 'i'.
    % In multi-clothoid modeling, this represent the C2 of the first segment coefficient.
    % For single model, the C0 coefficient is used to represent the entire model.
  LH_Line_First_C3: single  % Ci is coefficient corresponding to variable with power of 'i'.
    % In multi-clothoid modeling, this represent the C3 of the first segment coefficient.
    % For single model, the C0 coefficient is used to represent the entire model.
  LH_First_VR_Start: single  % The lane mark polynomial should be used only between VR start to VR end.
    % VR start represents the first point detected or predicted, the smaller between the two.
    % In case of multi-chlotoid representation, this is the start VR of the first segment, otherwise (single model) this is the VR start of the model.
  LH_First_VR_End: single  % The lane mark polynomial should be used only between VR start to VR end.
    % VR end represents the last point detected or predicted, the larger between the two.
    % In case of multi-chlotoid representation, this is the VR end of the first segment, otherwise (single model) this is the VR end of the model.
  Reserved_7: uint8
  LH_First_Measured_VR_End: single  % Measured view range indicates the furthest detected point.
    % Measured view range is always smaller or equal to VR end.
    % Relevant only when model representation is by a single model.
    % (not relevant for multi-chlotoid modeling)
  LH_Second_Measured_VR_End: single  % Measured view range indicates the furthest detected point.
    % Measured view range is always smaller or equal to VR end.
    % (not relevant for multi-chlotoid modeling)
  Reserved_8: uint8
  LH_Line_Second_C0: single  % Ci is coefficient corresponding to variable with power of 'i'.
    % In multi-clothoid modeling, this represent the C0 of the second segment coefficient.
    % For single modeling, those coefficients are not relevant.
  LH_Line_Second_C1: single  % Ci is coefficient corresponding to variable with power of 'i'.
    % In multi-clothoid modeling, this represent the C1 of the second segment coefficient.
    % For single modeling, those coefficients are not relevant.
  LH_Line_Second_C2: single  % Ci is coefficient corresponding to variable with power of 'i'.
    % In multi-clothoid modeling, this represent the C2 of the second segment coefficient.
    % For single modeling, those coefficients are not relevant.
  LH_Line_Second_C3: single  % Ci is coefficient corresponding to variable with power of 'i'.
    % In multi-clothoid modeling, this represent the C3 of the second segment coefficient.
    % For single modeling, those coefficients are not relevant.
  LH_Second_VR_Start: single  % The lane mark polynomial should be used only between VR start to VR end.
    % VR start represents the first point detected or predicted, the smaller between the two.
    % In case of multi-chlotoid representation, this is the start VR of the second segment (not relevant for a single modeling)
  LH_Second_VR_End: single  % The lane mark polynomial should be used only between VR start to VR end.
    % VR end represents the last point detected or predicted, the larger between the two.
    % In case of multi-chlotoid representation, this is the VR end of the second segment. (not relevant for a single modeling)
  LH_Detection_Source: uint8  % Indication of the detection source for surround setups

EQ4_LH_HDR_BUS = Simulink.Bus()
  LH_Zero_byte: uint8  % in case set to FF message is not available.
  LH_Protocol_Version: uint8  % Denotes protocol version
  LH_Sync_ID: uint8  % Sync ID to be used to sync between signals in system
  LH_Lanes_Count: uint8  % Maximum number of lines supported by this protocol
  Reserved_1: uint8
  LH_Estimated_Width: single  % The host lane width is defined as the distance between the reference right edge and the reference left edge.
    % The lane width is estimated over a few dozen of meters.
  Reserved_2: uint8

EQ4_LRE_BUS = Simulink.Bus()
  EQ4_APPINFO: Bus: EQ4_APPINFO_BUS
  EQ4_LRE_HDR: Bus: EQ4_LRE_HDR_BUS
  EQ4_LRE_ELEM: Bus: EQ4_LRE_ELEM_BUS[2]

EQ4_LRE_ELEM_BUS = Simulink.Bus()
  LRE_Element_CRC: uint32  % CRC calculated over all element signals. Starting from LRE_ID until (including) the last signal in the element
  LRE_ID: uint8  % ID of the lane boundary model. Each lane boundary has its own unique ID which is kept as long as the lane boundary is tracked.
  LRE_Age: uint8  % The age represents the duration of the lane boundary from the first frame it was detected.
  LRE_Confidence: single  % The Confidence of the road edge. Normally values of the confidence is 0 to 1. When confidence is -1 it means that the confidence is not applicable. As oppose to low value of confidence, it does not implicate on the quality of the road edge model.
  LRE_Type: uint8  % The road edge type classification.
    % ELEVATED_STRUCTURE = Barrier, stone wall, guard rail
    % PARKING_CARS type is currently on evaluation stage.
  Reserved_2: uint8
  LRE_Prediction_Reason: uint8  % Prediction_Reason [i] will be set to true if the lane mark was predicted for reason i
    % more than one index of the array might be set to true, since several predictions can be activated simultaneously(first segment only)
  LRE_Availability_State: uint8  % The lane boundary can be detected, predicted or unavailable. The lane boundary is considered predicted only if no segment is detected from the image.
  LRE_Height: single  % Road edge Height is only specify for structural borders
  LRE_Height_STD: single  % Road edge Height STD is only specify for structural borders
  Reserved_3: uint8
  LRE_View_Range_Start: single  % The lane boundary polynomial should be used only between VR start to VR end.
    % VR start represents the first point detected or predicted, the smaller between the two.
  LRE_View_Range_End: single  % The lane boundary polynomial should be used only between VR start to VR end.
    % VR end represents the last point detected or predicted, the larger between the two.
  Reserved_4: uint8
  LRE_Measured_VR_End: single  % Measured view range indicates the furthest detected point.
    % Measured view range is always smaller or equal to VR end.
  LRE_Side: uint8  % Indicates whether the road edge is at the left or right side of the host vehicle
  LRE_Is_Triggered_SDM_Model: uint8  % This flag is turned on when the SDM is triggered on lane mark model.
  Reserved_5: uint8
  LRE_Line_C3: single  % Ci is coefficient corresponding to variable with power of 'i' in the road edge polynomial.
  LRE_Line_C2: single  % Ci is coefficient corresponding to variable with power of 'i' in the road edge polynomial.
  LRE_Line_C1: single  % Ci is coefficient corresponding to variable with power of 'i' in the road edge polynomial.
  LRE_Line_C0: single  % Ci is coefficient corresponding to variable with power of 'i' in the road edge polynomial.
  LRE_Detection_Source: uint8  % Indication of the detection source for surround setups
  LRE_Element_Buffer: uint8

EQ4_LRE_HDR_BUS = Simulink.Bus()
  LRE_Zero_byte: uint8  % in case set to FF message is not available.
  Reserved_1: uint8
  LRE_Header_CRC: uint32  % CRC calculated over all header signals. Starting from LRE_Protocol_Version until the last signal in the header
  LRE_Protocol_Version: uint8  % Denotes the protocol version
  LRE_Sync_ID: uint8  % The ID of the Sync message, used to synchronize between signals in the system. Every new frame promotes the sync ID by one.
  LRE_Count: uint8  % Number of lines reported
  LRE_Header_Buffer: uint8

EQ4_LSR_BUS = Simulink.Bus()
  EQ4_APPINFO: Bus: EQ4_APPINFO_BUS
  EQ4_LSR_HDR: Bus: EQ4_LSR_HDR_BUS
  EQ4_LSR_ELEM: Bus: EQ4_LSR_ELEM_BUS[2]

EQ4_LSR_ELEM_BUS = Simulink.Bus()
  LSR_ID: uint8  % Light object ID. Range is 1-255, while 0 indicates that the field in unfilled.
  LSR_Brightness: single  % The brightness of the reflector. Note different range from other brightness values.
  LSR_Max_Brightness: single  % Note different range from other brightness values.
  LSR_Distance: uint16  % Distance to reflector attention center in meters.
  Reserved_1: uint8
  LSR_Top_Angle: single  % Angle to top of the reflector rectangle.
  LSR_Right_Angle: single  % Angle to right of the reflector rectangle.
  Reserved_2: uint8
  LSR_Bottom_Angle: single  % Angle to bottom of light rectangle
  LSR_Left_Angle: single  % Angle to left of the reflector rectangle.
  Reserved_3: uint8
  LSR_Atten_Cent_Angle_H: single  % Degree to most bright pixel of light object
  LSR_Is_Cluster: uint8  % True in case of a cluster of reflective signs.
  LSR_Atten_Cent_Angle_Lat: single  % Angle to the most bright pixel of the light object.
  LSR_Buffer: uint8

EQ4_LSR_HDR_BUS = Simulink.Bus()
  LSR_Zero_byte: uint8  % in case set to FF message is not available.
  LSR_Protocol_Version: uint8
  LSR_Sync_ID: uint8  % The ID of the Sync message, used to synchronize between signals in the system. Every new frame promotes the sync ID by one.
  LSR_Running_Mode: uint8  % Indicated the Light scene mode:
    % LS_OFF - during the day,  all hrSpots modules are turned-off.
    % LS_INACTIVE - only brightScene module is running.
    % LS_FULL - all hrSpots modules are running.
  LSR_Inactive_Reason: uint8  % Reason for entering InActive State
  LSR_Strong_Reflectors_Count: uint8  % Number of light objects related to highly reflective signs in the scene.

EQ4_LSV_BUS = Simulink.Bus()
  EQ4_APPINFO: Bus: EQ4_APPINFO_BUS
  EQ4_LSV_HDR: Bus: EQ4_LSV_HDR_BUS
  EQ4_LSV_ELEM: Bus: EQ4_LSV_ELEM_BUS[6]

EQ4_LSV_ELEM_BUS = Simulink.Bus()
  LSV_ID: uint8  % Light object ID. Range is 1-255, while 0 indicates that the field in unfilled.
  LSV_Type: uint8  % Describes the vehicle light type.
    % In case of a cluster it represents the type of the closest vehicle in the cluster.
    % Clearance = Truck cabin top lights.
  LSV_Sub_Type: uint8  % Vehicle sub type.
  LSV_CL_Sub_Type: uint8  % ENUM describes cluster sub type. If not cluster = 0
  LSV_Consecutive_Detection: int8  % The number of consecutive frames in which the light object was detected.
  Reserved_1: uint8
  LSV_Width_STD: single  % Width STD
  LSV_Confidence: single  % DNN Confidence value
  LSV_Is_New: uint8  % Indicates whether the object was not first detected at the current frame.
  LSV_VD_ID: uint8  % Vehicle ID in VD if available.
  Reserved_2: uint8
  LSV_Brightness: uint32  % Brightness of object in case of couple is the mean of the two lights in the couple (Power9 units)
  LSV_Distance: uint16
  Reserved_3: uint8
  LSV_Distance_STD: uint8
  LSV_CL_Distance_Right: uint16  % Distance to  light cluster right object of attention center in meter units
  LSV_CL_Distance_Left: uint16  % Distance to light cluster left object of attention center in meter units
  Reserved_4: uint8
  LSV_Top_Angle: single  % Angle to top of light rectangle
  LSV_Bottom_Angle: single  % Angle to bottom of light rectangle
  Reserved_5: uint8
  LSV_Right_Angle: single  % Angle to right of light rectangle
  LSV_Left_Angle: single  % Angle to left of light rectangle
  Reserved_6: uint8
  LSV_Angular_Velocity_Right: single  % Angular velocity based on angle to right of light rectangle (can be couple)
  LSV_Angular_Velocity_Left: single  % Angular velocity based on angle to left of light rectangle (can be couple)
  Reserved_7: uint8
  LSV_Atten_Cent_Angle_H: single  % Degree to most bright pixel of light object
  LSV_Atten_Cent_Angle_Lat: single  % Degree to most bright pixel of light object
  Reserved_8: uint8
  LSV_Facade_Top_Angle: single  % Angles to the front or back of the detected vehicles top
  LSV_Facade_Right_Angle: single  % Right - angles to vehicle's right front/back  border according to VD's object. if there is no fusion will output the right angle by light detection object (will be the same as LSV_Right_Angle)
  Reserved_9: uint8
  LSV_Facade_Left_Angle: single  % Left - angles to vehicle's left front/back  border according to VD's object. if there is no fusion will output the left angle by light detection object (will be the same as LSV_Left_Angle)
  Reserved_10: uint8

EQ4_LSV_HDR_BUS = Simulink.Bus()
  LSV_Zero_byte: uint8  % in case set to FF message is not available.
  LSV_Protocol_Version: uint8
  LSV_Sync_ID: uint8  % The ID of the Sync message, used to synchronize between signals in the system. Every new frame promotes the sync ID by one.
  LSV_Running_Mode: uint8  % Light Scene mode.
    % LS_OFF - hrSpots modules do not run at daytime.
    % LS_INACTIVE - only brightScene module runs.
    % LS_FULL - all hrSpots modules are running.
  LSV_Inactive_Reason: uint8  % Reason for entering InActive State
  LSV_HLB_Decision: uint8
  LSV_HLB_Buffer_C0: uint8
  LSV_HLB_Reason: uint32
  LSV_Vehicles_Count: uint8  % Number of light objects related to vehicles in the scene.
  LSV_Brightness_Score: single  % MF score of brightness calculated in HLB technology

EQ4_OBJ_BUS = Simulink.Bus()
  EQ4_APPINFO: Bus: EQ4_APPINFO_BUS
  EQ4_OBJ_HDR: Bus: EQ4_OBJ_HDR_BUS
  EQ4_OBJ_ELEM: Bus: EQ4_OBJ_ELEM_BUS[20]

EQ4_OBJ_ELEM_BUS = Simulink.Bus()
  OBJ_CRC: uint32  % Calculated over each object signal
  OBJ_ID: uint8  % The detected object ID. Range is 1-255, while 0 indicates that the field in unfilled.
  OBJ_Existence_Probability: single  % The existence probability of the vehicle
  OBJ_Fusion_Source: uint16  % sources ids used for fusion
  OBJ_Triggered_SDM: uint8  % Indicates whether the object has trigered the SDM (Safety Diagnostic Manager) alert.
  OBJ_Motion_Category: uint8  % Relevant for VD only. Full description of values can be found at the ACC guide.
  OBJ_Moving_IN_Probability: single  % The probability the object is eventually move into ego lane. (In case that the OBJ_Motion_Category signal is set to  MOVING_IN
  OBJ_Object_Age: uint16  % The number of frames in which the object was recognized.
  OBJ_Measuring_Status: uint8  % Measurment status. Old vs New marks if this is the first frame in which the object is reported. Predicted vs Measured marks if the report is raw or has been predicted forward in time using the measured dynamics and ego motion.
  OBJ_Object_Class: uint8  % Indicates the object type. Uncertain is outputted in case the probability that a vehicle is a truck is very similar to the probability that it is a car.
  Reserved_4: uint8
  OBJ_Class_Probability: single  % The probability of this type classification.
  OBJ_Car_Probability: single  % The probability the object is a car
  OBJ_Truck_Probability: single  % The probability the object is a Truck
  OBJ_Bike_Probability: single  % The probability the object is a Bike
  OBJ_Camera_Source: uint8  % The camera in which this object was detected (best choice).
  OBJ_Motion_Status: uint8  % MOVING - the object is moving
    % STATIONARY - the object was never seen moving
    % STOPPED -  the object was moving and has stopped
    % MOVING_SLOWLY - the object is moving very slowly
  OBJ_Motion_Orientation: uint8  % The direction of the targets heading compared to the host.
  OBJ_Has_Cut_Lane: uint8  % Indicates whether the object cut the host's (right or left) lane. In case there are no lanes, indicates whether the objects is at most 1 meters away from the host.
  OBJ_Has_Cut_Path: uint8  % Indicates whether the object is in the host's path.
  OBJ_Brake_Light: uint8  % Indication for brake lights
  OBJ_Turn_Indicator_Right: uint8  % Indication for blinking right light.
  OBJ_Turn_Indicator_Left: uint8  % Indication for blinking left light
  OBJ_Light_Indicator_Validity: uint8  % Validator for light indicators
  OBJ_Right_Out_Of_Image: uint8  % Indicates whether the measurment are predicted out of the right side of the image bounderies.
  OBJ_Left_Out_Of_Image: uint8  % Indicates whether if measurment are predicted out of  the left side of the image bounderies
  OBJ_Right_Out_Of_Image_V: uint8  % validator
  OBJ_Left_Out_Of_Image_V: uint8  % validator
  OBJ_Top_Out_Of_Image: uint8  % Indicates whether if measurment are predicted out of  the top of the image bounderies
  OBJ_Bottom_Out_Of_Image: uint8  % Indicates whether if measurment are predicted out of  the bottom of the image bounderies
  OBJ_Top_Out_Of_Image_V: uint8  % validator
  OBJ_Bottom_Out_Of_Image_V: uint8  % validator
  OBJ_Lane_Assignment: uint8  % The object's lane relative to the host lane.
  OBJ_Lane_Assignment_V: uint8  % Validator for lane assignment
  OBJ_Age_Seconds: uint8  % Time in seconds in which the object was recognized.
  OBJ_Age_Seconds_V: uint8  % Validator for object age
  OBJ_Width: single  % The width of the target vehicle in the world (not to be mistaken with the width of the visible part of the vehicle).
  OBJ_Width_V: uint8  % Validator for object width
  OBJ_Width_STD: single  % Standard deviation for object width
  OBJ_Width_STD_V: uint8  % Validator for the standard deviation of object width
  OBJ_Length: single  % The length of the vehicle in the world. For crossing bicycles it gives the viewed length of the bicycle.
  OBJ_Length_V: uint8  % Validator for object length.
  OBJ_Length_STD: single  % Standard deviation for object length.
  OBJ_Length_STD_V: uint8  % Validator for the standard deviation of object length.
  OBJ_Radar_ID: uint8  % Radar Object ID of the Fused Object, Only relvant when OBJ_Fusion_Source is not Camera only
  OBJ_Height: single  % The height of the object in the world.
  OBJ_Height_V: uint8  % Validator for object height.
  Reserved_5: uint8
  OBJ_Height_STD: single  % Standard deviation for object height.
  OBJ_Height_STD_V: uint8  % Validator for the standard deviation of object height.
  OBJ_Abs_Long_Velocity: single  % Absolute longitudinal velocity.
  OBJ_Abs_Long_Velocity_V: uint8  % Validator for absolute longitudinal velocity.
  Reserved_6: uint8
  OBJ_Abs_Long_Velocity_STD: single  % Standard deviation of absolute longitudinal velocity.
  OBJ_Abs_Long_Vel_STD_V: uint8  % Validator for the standard deviation of the absolute longitudinal velocity.
  OBJ_Abs_Lat_Velocity: single  % The lateral ground speed of the object.
  OBJ_Abs_Lat_Velocity_V: uint8  % Validator for the lateral ground speed of the object.
  Reserved_7: uint8
  OBJ_Abs_Lat_Velocity_STD: single  % STD of the lateral ground speed of the object.
  OBJ_Abs_Lat_Vel_STD_V: uint8  % Validator for the STD of the lateral ground speed of the object.
  OBJ_Abs_Long_Acc: single  % The longitudinal ground acceleration of the object.
  OBJ_Abs_Long_Acc_V: uint8  % Validator for the longitudinal ground acceleration of the object.
  Reserved_8: uint8
  OBJ_Abs_Long_Acc_STD: single  % STD of the longitudinal ground acceleration of the object.
  OBJ_Abs_Long_Acc_STD_V: uint8  % Validator for the STD of the longitudinal ground acceleration of the object.
  OBJ_Abs_Lat_Acc: single  % The lateral ground acceleration of the object.
  OBJ_Abs_Lat_Acc_V: uint8  % Validator for the lateral ground acceleration of the object.
  OBJ_Abs_Lat_Acc_STD: single  % STD of the lateral ground acceleration of the object.
  OBJ_Abs_Lat_Acc_STD_V: uint8  % Validator for the STD of the lateral ground acceleration of the object.
  OBJ_Abs_Acceleration: single  % The absolute ground acceleration in the target's heading direction.
  OBJ_Abs_Acceleration_V: uint8  % Validator for the absolute ground acceleration.
  OBJ_Abs_Acc_STD: single  % STD of the absolute ground acceleration.
  OBJ_Abs_Acc_STD_V: uint8  % Validator for the STD of the absolute ground acceleration.
  OBJ_Inv_TTC: single  % Inverse TTC (time to collision).
  OBJ_Inv_TTC_V: uint8  % Validator for Inverse TTC.
  OBJ_Inv_TTC_STD: single  % STD for inverse TTC .
  OBJ_Inv_TTC_STD_V: uint8  % Validator for the STD for inverse TTC .
  OBJ_Relative_Long_Acc: single  % The relative lateral ground acceleration of the object.
  OBJ_Relative_Long_Acc_V: uint8  % Validator for the relative lateral ground acceleration of the object.
  Reserved_9: uint8
  OBJ_Relative_Long_Acc_STD: single  % STD of the relative lateral ground acceleration of the object.
  OBJ_Rel_Long_Acc_STD_V: uint8  % Validator for the STD of the relative lateral ground acceleration.
  OBJ_Relative_Long_Velocity: single  % The relative longtitudinal speed between the target and ego vehicle.
  OBJ_Relative_Long_Velocity_V: uint8  % Validator for the relative longtitudinal speed.
  Reserved_10: uint8
  OBJ_Relative_Long_Vel_STD: single  % STD of the relative longtitudinal speed.
  OBJ_Rel_Long_Vel_STD_V: uint8  % Validator for the STD of the relative longtitudinal speed.
  OBJ_Relative_Lat_Velocity: single  % The relative lateral speed between the target and ego vehicle.
  OBJ_Relative_Lat_Velocity_V: uint8  % Validator for the relative lateral speed.
  Reserved_11: uint8
  OBJ_Relative_Lat_Velocity_STD: single  % STD of the relative lateral speed.
  OBJ_Rel_Lat_Vel_STD_V: uint8  % Validator for the STD of the relative lateral speed.
  OBJ_Long_Distance: single  % The longtitudinal distance from the object to middle of the rear bumper (middle of the RL and RR corners) of the target.
  OBJ_Long_Distance_V: uint8  % Validator of the longtitudinal distance field
  Reserved_12: uint8
  OBJ_Long_Distance_STD: single  % STD of the  longtitudinal distance.
  OBJ_Long_Distance_STD_V: uint8  % Validator for the STD of the  longtitudinal distance.
  OBJ_Lat_Distance: single  % Lateral distance to the middle of the RL and RR corners.
  OBJ_Lat_Distance_V: uint8  % Validator for the lateral distance of the object.
  Reserved_13: uint8
  OBJ_Lat_Distance_STD: single  % STD of the lateral distance of the object.
  OBJ_Lat_Distance_STD_V: uint8  % Validator for the STD of the lateral distance of the object.
  OBJ_Absolute_Speed: single  % The absolute ground speed in the targets' heading direction.
  OBJ_Absolute_Speed_V: uint8  % Validator for the absolute ground speed.
  Reserved_14: uint8
  OBJ_Absolute_Speed_STD: single  % STD of the absolute ground speed.
  OBJ_Absolute_Speed_STD_V: uint8  % Validator for the STD of the absolute ground speed.
  OBJ_Heading: single  % The angle beetweenthe host longitudinal axis and target's heading (clockwise, e.g. PI/2 is a target crossing from left to right).
  OBJ_Heading_V: uint8  % Validator for the object heading.
  Reserved_15: uint8
  OBJ_Heading_STD: single  % STD of the object heading.
  OBJ_Heading_STD_V: uint8  % Validator for the STD of the object heading.
  OBJ_Angle_Rate_STD: single  % Standard deviation of the angular speed. (radians)
  OBJ_Angle_Rate_STD_V: uint8  % Validator for the STD of the angular speed.
  OBJ_Angle_Rate: single  % The momentary angular speed of the object. (radians)
  OBJ_Angle_Rate_V: uint8  % Validator for the angular speed.
  OBJ_Angle_Right: single  % The angle between the host longitudinal axis and the right side of the front / rear of the target (the visible one). The positive side is to the host's right.
  OBJ_Angle_Right_V: uint8  % Validator for angleRight
  Reserved_16: uint8
  OBJ_Angle_Right_STD: single  % Standard deviation of angleRight
  OBJ_Angle_Right_STD_V: uint8  % Validator for the standard deviation of angleRight.
  OBJ_Angle_Left: single  % The angle between the host longitudinal axis and the left side of the front / rear of the target (the visible one). The positive side is to the host's right.
  OBJ_Angle_Left_V: uint8  % Validator for angleLeft.
  Reserved_17: uint8
  OBJ_Angle_Left_STD: single  % Standard deviation of angleLeft.
  OBJ_Angle_Left_STD_V: uint8  % Validator for the standard deviation of angleLeft.
  OBJ_Angle_Side: single  % The angle between the host longitudinal axis and the far visible edge - the visible edge of the front / rear of the target that is not visible. Currently supported for vehicles only.
  OBJ_Angle_Side_V: uint8  % Validator for angleSide.
  Reserved_18: uint8
  OBJ_Angle_Side_STD: single  % Standard deviation of angleSide.
  OBJ_Angle_Side_STD_V: uint8  % Validator for the STD of angleSide.
  OBJ_Angle_Mid_V: uint8  % Validator for angleMid.
  OBJ_Angle_Mid: single  % The angle between the host longitudinal axis and the middle of the front / rear of the target (the visible one). The positive side is to the host's right.
  Reserved_19: uint8
  OBJ_Angle_Mid_STD: single  % Standard deviation of angleMid.
  OBJ_Angle_Mid_STD_V: uint8  % Validator for the STD of angleMid.
  OBJ_Angle_Bottom_V: uint8  % Validator for OBJAngle_Bottom.
  OBJ_Angle_Bottom: single  % The angle between the longitudinal axis and the Bottom of the front / rear of the target (the visible one). The positive side is to the host's bottom
  Reserved_20: uint8
  OBJ_Angle_Bottom_STD: single  % STD for OBJAngle_Bottom.
  OBJ_Angle_Bottom_STD_V: uint8  % Validator for OBJAngle_Bottom_STD.
  OBJ_Visibility_Side_V: uint8  % Currently Supported for VD only
  OBJ_Visibility_Side: uint8  % From what car  side is the object visible
  OBJ_Is_In_Drivable_Area: uint8  % Indicates whether the target is in a driveable area.
  OBJ_Is_In_Drivable_Area_V: uint8  % Validator for OBJ_Is_In_Drivable_Area.
  OBJ_Is_VeryClose_V: uint8  % Validator for OBJ_Is_VeryClose.
  OBJ_Is_VeryClose: uint8  % Indicates whether the target is very close to the host such that it is hard to measure its distance. Currently relevant for peds only
  OBJ_Occlusion_RL: uint8  % Was Rear left of the 3D detection of theobject occluded
  OBJ_Occlusion_RR: uint8  % Was Rear Right of the 3D detection of theobject occluded
  OBJ_Occlusion_FR: uint8  % Was front Right of the 3D detection of theobject occluded
  OBJ_Occlusion_FL: uint8  % Was Front left of the 3D detection of theobject occluded
  Reserved_21: uint8
  OBJ_OverlapAngleEgoLaneR: single  % Object to line assignment. Angle-based overlap of an object with the own lane from the right.
  OBJ_OverlapAngleEgoLaneL: single  % Object to line assignment. Angle-based overlap of an object with the own lane from the left
  OBJ_Is_EMERGENCY_VCL: uint8  % Is Object an Emergency Vehicle
  OBJ_EMERGENCY_LIGHT_COLOR: uint8  % Emergency Color
  OBJ_EMERGENCY_V: uint8  % Are OBJ_Is_EMERGENCY_VCL and OBJ_EMERGENCY_LIGHT_COLOR Valid
  Reserved_22: uint8
  OBJ_Buffer_C10: single
  OBJ_Buffer_C11: uint8
  OBJ_Buffer_C12: single
  OBJ_Buffer_C13: uint8
  OBJ_Buffer_C14: single
  OBJ_Buffer_C15: single
  OBJ_Buffer_C18: uint8
  OBJ_Buffer_C19: uint8
  Reserved_23: uint8

EQ4_OBJ_HDR_BUS = Simulink.Bus()
  OBJ_Zero_byte: uint8  % in case set to FF message is not available.
  Reserved_1: uint8
  OBJ_Header_CRC: uint32  % CRC calculated over all header values.
  OBJ_Protocol_Version: uint8  % Denotes the protocol version
  OBJ_Sync_ID: uint8  % The ID of the Sync message, used to synchronize between signals in the system. Every new frame promotes the sync ID by one.
  OBJ_VRU_Count: uint8  % The number of recognized Vulnerable Road Users (pedestrians, bicycles) in the scene.
  OBJ_VD_Count: uint8  % The number of recognized vehicles in the scene.
  OBJ_General_OBJ_Count: uint8  % The number of recognized General Objects in the scene.
  Reserved_2: uint8
  OBJ_Animal_Count: uint8  % The number of recognized animals in the scene.
  OBJ_VD_NIV_Left: uint8  % The ID of the closet VD object to the left of the host.
  OBJ_VD_NIV_Right: uint8  % The ID of the closet VD object to the right of the host.
  OBJ_VD_CIPV_ID: uint8  % The Current In Path Vehicle (CIPV) object ID.
  OBJ_VD_CIPV_Lost: uint8  % Reports a CIPV loss that cannot be explained to initiate a take over request.
  OBJ_VD_Allow_Acc: uint8  % This signal is intended to suppress acceleration in stop and go ACC scenarios when we suspect something is in our way.
  OBJ_Is_Blocked_Left: uint8  % Indicates whether the left side is blocked for lane change.
  OBJ_Is_Blocked_Right: uint8  % Indicates whether the right side is blocked for lane change.
  OBJ_Buffer_C16: uint8
  OBJ_Buffer_C17: uint8
  Reserved_3: uint8

EQ4_SD_BUS = Simulink.Bus()
  EQ4_APPINFO: Bus: EQ4_APPINFO_BUS
  EQ4_SD_HDR: Bus: EQ4_SD_HDR_BUS
  EQ4_SD_ELEM: Bus: EQ4_SD_ELEM_BUS[64]

EQ4_SD_ELEM_BUS = Simulink.Bus()
  SD_Bit: uint8  % See description in Safety_Description TAB.

EQ4_SD_HDR_BUS = Simulink.Bus()
  SD_Zero_byte: uint8  % in case set to FF message is not available.
  Reserved_1: uint8
  SD_CRC: uint32
  SD_Protocol_Version: uint8
  SD_Sync_ID: uint8
  SD_Challenge_Response1: uint8  % SCFM - Challenge/Response error (response[s] do not match expected value) [GENERICTSC-651]
  SD_Challenge_Response2: uint8  % SCFM - Challenge/Response error (response[s] do not match expected value) [GENERICTSC-651]
  SD_Challenge_Response3: uint8  % SCFM - Challenge/Response error (response[s] do not match expected value) [GENERICTSC-651]
  SD_Challenge_Response4: uint8  % SCFM - Challenge/Response error (response[s] do not match expected value) [GENERICTSC-651]
  SD_Challenge_Identifier: uint8  % SCFM - Challenge/Response error (response[s] do not match expected value) [GENERICTSC-651]
  Reserved_2: uint8

EQ4_TFL_SPOTS_BUS = Simulink.Bus()
  EQ4_APPINFO: Bus: EQ4_APPINFO_BUS
  EQ4_TFL_SPOTS_HDR: Bus: EQ4_TFL_SPOTS_HDR_BUS
  EQ4_TFL_SPOTS_ELEM: Bus: EQ4_TFL_SPOTS_ELEM_BUS[20]

EQ4_TFL_SPOTS_ELEM_BUS = Simulink.Bus()
  TFL_Spot_Spot_ID: uint8  % Unique id for of light
  TFL_Spot_Structure_ID: uint8  % Unique id for life of light - indicates which lightbox the spot is identified with
  TFL_Spot_Color: uint8  % Color of traffic light
  TFL_Spot_Red_Probability: single  % Red probability
  Reserved_2: uint8
  TFL_Spot_Orange_Probability: single  % Orange probability
  TFL_Spot_Green_Probability: single  % Green probability
  TFL_Spot_Mode: uint8  % The mode of the TFL spot
  TFL_Spot_Shape: uint8  % The Shape of the TFL Spot
  TFL_Spot_Shape_Probability: single  % Shape Probability
  Reserved_3: uint8
  TFL_Spot_Relevancy: single
  TFL_Spot_matched_Relevancy: uint8  % The Matched relevancy is an ENUM derived from the consistency level between the spot shape and arrows from Road Marking
  TFL_Spot_Blinking_Confidence: single  % TFL_Spot_Blinking_Confidence
  TFL_Spot_Image_Status: uint8  % TFL Spot measurement status
  Reserved_4: uint8

EQ4_TFL_SPOTS_HDR_BUS = Simulink.Bus()
  TFL_Spot_Zero_byte: uint8  % in case set to FF message is not available.
  TFL_Spot_Protocol_Version: uint8  % Denotes the protocol version
  TFL_Spot_Sync_ID: uint8  % Sync ID to be used to sync between signals in the system
  TFL_Spot_Number_Of_Objects: uint8  % Number of TFL spots objects
  Reserved_1: uint8

EQ4_TFL_STRUCT_BUS = Simulink.Bus()
  EQ4_APPINFO: Bus: EQ4_APPINFO_BUS
  EQ4_TFL_STRUCT_HDR: Bus: EQ4_TFL_STRUCT_HDR_BUS
  EQ4_TFL_STRUCT_ELEM: Bus: EQ4_TFL_STRUCT_ELEM_BUS[5]

EQ4_TFL_STRUCT_ELEM_BUS = Simulink.Bus()
  TFL_Struct_ID: uint8  % Unique id for life of light
  TFL_Struct_Age: uint8  % age in frames
  TFL_Struct_State: uint8  % State of the Traffic Light based on analysis of the TL Spots and Structure.
  TFL_Struct_State_Age: uint8  % State Age in frames
  TFL_Struct_State_Confidence: uint8  % state confidence
  TFL_Struct_Relevancy_Score: single  % Relevncy score of this structure.
  TFL_Struct_Detection_Camera: uint8
  TFL_Struct_Type: uint16  % The type of the TFL structure
  Reserved_2: uint8
  TFL_Struct_Type_Conf: single  % structure type confidence
  TFL_Struct_Lat_Distance: single  % Lateral distance - Right is positive
  TFL_Struct_Lat_Distance_STD: single  % Lateral distance - Right is positive - STD
  Reserved_3: uint8
  TFL_Struct_Rel_Height: single  % Height from Camera
  TFL_Struct_Rel_Height_STD: single  % Height from Camera - STD
  TFL_Struct_Long_Distance: single  % Longitudinal distance
  Reserved_4: uint8
  TFL_Struct_Long_Distance_STD: single  % Longitudinal distance - STD
  TFL_Struct_Dist_Max_Fov: single  % The distance to where the TFL structure will reach the max field of view available
  Reserved_5: uint8
  TFL_Struct_Existence_Prob: single  % The existence probability of this TFL structure
  TFL_Struct_Image_Status: uint8  % This describe whether the TFL structure is actually Visible (measured) or Occluded (predicted).
  TFL_Struct_State_Conf_Reason: uint8  % The reason based on which the state confidence is scored
  TFL_Struct_Width: single  % TFL Struct Width
  TFL_Struct_Width_STD: single  % TFL Struct Width STD
  Reserved_6: uint8
  TFL_Struct_Height: single  % TFL Struc Height
  TFL_Struct_Height_STD: single  % TFL Struct Height STD
  TFL_Struct_Poisition_Relevancy: single  % The structure position relevancy is a score drived from the geometrical properties of the structure with regards to the path prediction of the ego vehicle
  TFL_Struct_Day_Night_System: uint8  % This signal reports which system Day/Night is responsible for the TFL structure detection
  Reserved_7: uint8

EQ4_TFL_STRUCT_HDR_BUS = Simulink.Bus()
  TFL_Struct_Zero_byte: uint8  % in case set to FF message is not available.
  TFL_Struct_Protocol_Version: uint8  % Denotes the protocol version
  TFL_Struct_Sync_ID: uint8  % Sync ID to be used to sync between signals in the system
  TFL_Struct_Count: uint8  % Number of TFL stuctures
  TFL_Struct_Time_Of_Day: uint8  % TFL Time of Day System
  Reserved_1: uint8

EQ4_TSR_BUS = Simulink.Bus()
  EQ4_APPINFO: Bus: EQ4_APPINFO_BUS
  EQ4_TSR_HDR: Bus: EQ4_TSR_HDR_BUS
  EQ4_TSR_ELEM: Bus: EQ4_TSR_ELEM_BUS[10]

EQ4_TSR_ELEM_BUS = Simulink.Bus()
  TSR_ID: uint8  % sign ID
  TSR_Camera_Source: uint8  % The camera which the object was found at
  TSR_Sign_Name: uint16  % Sign descriptive name (TSR Signs ENUM)
  TSR_Relevancy: uint8  % Each sign is considered relevant unless non relevant reason is identified. The ENUM represent those reason of reject sign from being relevant by providing the reason.
  Reserved_2: uint8
  TSR_Filter_Type: uint8  % The filter type represent a decision of the AI that this is not a considerable sign. (on truck or road number etc.)
  TSR_Sup1_SignName: uint8  % First Supplementary Sign descriptive name (TSR Signs ENUM)
  TSR_Sup1_Confidence: single
  TSR_Sup1_Position: uint8  % Supplementary sign relative  position
  TSR_Sup2_SignName: uint8  % Second Supplementary Sign descriptive name (TSR Signs ENUM)
  Reserved_3: uint8
  TSR_Sup2_Confidence: single
  TSR_Sup2_Position: uint8  % Supplementary sign relative  position
  TSR_Confidence: single  % Approved  signs currently don't have Confidence, it is set to 1.
  TSR_Sign_Shape: uint8  % Sign Shape (ENUM)
  TSR_Sign_Structure: uint8  % Indicate if the Sign structure is Standard or Electronic.
  Reserved_4: uint8
  TSR_Tracking_Age: uint16  % For now supported for under tracking objects only from multi-frame approval time. Number of frames.
  TSR_Sign_Long_Distance: single  % Longitudinal distance to sign (on the ground ) in meters
  Reserved_5: uint8
  TSR_Sign_Long_Distance_STD: single  % Longitudinal distance to sign (on the ground ) in meters STD Kalman
  TSR_Sign_Lateral_Distance: single  % Lateral distance to sign (on the ground) in meters
  Reserved_6: uint8
  TSR_Sign_Lat_Distance_STD: single  % Lateral distance to sign (on the ground) in meters STD Kalman
  TSR_Sign_Height: single  % Sign height in meters from camera / refernce point
  Reserved_7: uint8
  TSR_Sign_Panel_Height_STD: single  % STD
  TSR_Sign_Height_STD: single  % Sign height in meters STD Kalman
  Reserved_8: uint8
  TSR_Sign_Panel_Width: single  % Sign Panel width  in meters
  TSR_Sign_Panel_Height: single  % Sign Panel height in meters
  TSR_Sign_Panel_Width_STD: single  % Sign Panel width  in meters STD
  Reserved_9: uint8
  TSR_Measurement_Status: uint8  % Visibility Measurement  status
  TSR_AngleZ: single  % The sign horizontal rotation relative to the longitudinal axis of the ego car (0 when the sign is perpendicular). No polarity indication.
  TSR_Relevancy_Confidence: single  % Provide Relevancy Confidence TSR
  Reserved_10: uint8

EQ4_TSR_HDR_BUS = Simulink.Bus()
  TSR_Zero_byte: uint8  % in case set to FF message is not available.
  TSR_Protocol_Version: uint8  % Denotes the protocol version
  TSR_Sync_ID: uint8  % Sync ID to be used to sync between signals in system
  TSR_Approved_Sign_Count: uint8  % Number of approved signed in the scene
  TSR_Filtered_Sign_Count: uint8  % Number of filtered and Irelevant signs that were seen in the scene (TSR_Filter_Type not 0 or TSR_Relevancy not 0)
  TSR_UnderTracking_Sign_Count: uint8  % Number of signs that are still being tracked in the scene
  Reserved_1: uint8

EQ4_LAP_BUS = Simulink.Bus()
  EQ4_APPINFO: Bus: EQ4_APPINFO_BUS
  EQ4_LAP_HDR: Bus: EQ4_LAP_HDR_BUS
  EQ4_LAP_ELEM: Bus: EQ4_LAP_ELEM_BUS[8]