% Simulink data dictionary PubIfVCanV71_HEV_DHT_NEW_V400.sldd

ADCAN_DIAG_UPDATE_BUS = Simulink.Bus()
  ADCAN_BSW_RSDS_FD1_IsUpdated: boolean
  ADCAN_BSW_RSDS_FD2_IsUpdated: boolean
  ADCAN_BSW_ECM_FD1_IsUpdated: boolean
  ADCAN_BSW_ECM_FD2_IsUpdated: boolean
  ADCAN_BSW_ECM_FD3_IsUpdated: boolean
  ADCAN_BSW_ECM1_IsUpdated: boolean
  ADCAN_BSW_HCU_FD1_IsUpdated: boolean
  ADCAN_BSW_DCT_FD1_IsUpdated: boolean
  ADCAN_BSW_DCT_FD4_IsUpdated: boolean
  ADCAN_BSW_DCT5_IsUpdated: boolean
  ADCAN_BSW_ESP_FD2_IsUpdated: boolean
  ADCAN_BSW_ESP_FD3_IsUpdated: boolean
  ADCAN_BSW_EPS_FD1_IsUpdated: boolean
  ADCAN_BSW_BCM1_IsUpdated: boolean
  ADCAN_BSW_BCM3_IsUpdated: boolean
  ADCAN_BSW_BCM8_IsUpdated: boolean
  ADCAN_BSW_AC2_IsUpdated: boolean
  ADCAN_BSW_F_PBox1_IsUpdated: boolean
  ADCAN_BSW_R_PBox_IsUpdated: boolean
  ADCAN_BSW_CSA1_IsUpdated: boolean
  ADCAN_BSW_CSA2_IsUpdated: boolean
  ADCAN_BSW_ABM1_IsUpdated: boolean
  ADCAN_BSW_ABM2_IsUpdated: boolean
  ADCAN_BSW_HAP_FD1_IsUpdated: boolean
  ADCAN_BSW_IP2_IsUpdated: boolean
  ADCAN_BSW_HUT_FD1_IsUpdated: boolean
  ADCAN_BSW_HUT19_IsUpdated: boolean
  ADCAN_BSW_T_Box_FD3_IsUpdated: boolean
  ADCAN_BSW_HC1_IsUpdated: boolean
  ADCAN_BSW_DMS_FD1_IsUpdated: boolean

VCAN_ABM_MSG_BUS = Simulink.Bus()
  PassSBR: boolean  % ABM1|1|0|0|1|boolean
  DrvSBR: boolean  % ABM1|1|0|0|1|boolean
  VehLgtAccel: single  % ABM2|0.00098|-21.592|-21.592|21.592|single
  VehLatAccel: single  % ABM2|0.00098|-21.592|-21.592|21.592|single
  VehYawRate: single  % ABM2|0.00024|-2.093|-2.093|2.093|single
  VehDynYawRateVld: boolean  % ABM2|1|0|0|1|boolean
  VehLatAccelVld: boolean  % ABM2|1|0|0|1|boolean
  VehLgtAccelVld: boolean  % ABM2|1|0|0|1|boolean

VCAN_BCM_MSG_BUS = Simulink.Bus()
  WindshldWiprActvSts: boolean  % BCM1|1|0|0|1|boolean
  RRDoorSts: boolean  % BCM1|1|0|0|1|boolean
  PassengerDoorSts: boolean  % BCM1|1|0|0|1|boolean
  LRDoorSts: boolean  % BCM1|1|0|0|1|boolean
  DrvDoorSts: boolean  % BCM1|1|0|0|1|boolean
  HazardLmpSwtSts: boolean  % BCM3|1|0|0|1|boolean
  PASWorkCmd: boolean  % BCM8|1|0|0|1|boolean
  WiprReq_F_PBOX: uint8  % BCM8|1|0|0|7|uint8
  KL30BRelaySts: boolean  % BCM8|1|0|0|1|boolean
  FFogLmpSts_F_Pbox: boolean  % F_PBox1|1|0|0|1|boolean
  LowBeamSts_F_Pbox: boolean  % F_PBox1|1|0|0|1|boolean
  HiBeamSts_F_Pbox: boolean  % F_PBox1|1|0|0|1|boolean
  HoodSts_F_Pbox: boolean  % F_PBox1|1|0|0|1|boolean
  RTurnLmpSts_R_Pbox: boolean  % R_PBox1|1|0|0|1|boolean
  LTurnLmpSts_R_Pbox: boolean  % R_PBox1|1|0|0|1|boolean

VCAN_CSA_MSG_BUS = Simulink.Bus()
  FrntWiprSwtSts: uint8  % CSA1|1|0|0|7|uint8
  FrntWshrSwtSts: uint8  % CSA1|1|0|0|3|uint8
  LTurnLmpSwtSts: boolean  % CSA1|1|0|0|1|boolean
  RTurnLmpSwtSts: boolean  % CSA1|1|0|0|1|boolean
  FrntFogLmpSwtSts: boolean  % CSA1|1|0|0|1|boolean
  LowBeamSwtSts: boolean  % CSA1|1|0|0|1|boolean
  HiBeamSwtSts: boolean  % CSA1|1|0|0|1|boolean
  AutoLmpSwtSts: boolean  % CSA1|1|0|0|1|boolean
  SteerWheelAngSign: boolean  % CSA2|1|0|0|1|boolean
  SteerWheelAng: single  % CSA2|0.1|0|0|780|single
  SteerWheelSpdSign: boolean  % CSA2|1|0|0|1|boolean
  SteerWheelSpd: single  % CSA2|0.1|0|0|1016|single
  ACC_TimeGap_DecSetSwt: boolean  % CSA2|1|0|0|1|boolean
  ACC_TimeGap_IncSetSwt: boolean  % CSA2|1|0|0|1|boolean
  CC_ACC_CANCEL_OFFSwt: boolean  % CSA2|1|0|0|1|boolean
  CC_ACC_CRUISE_OFFSwt: boolean  % CSA2|1|0|0|1|boolean
  CC_ACCSwtErr: boolean  % CSA2|1|0|0|1|boolean
  CC_ACC_DecSetSpd_SetSwt: boolean  % CSA2|1|0|0|1|boolean
  CC_ACC_IncSetSpd_ResuSwt: boolean  % CSA2|1|0|0|1|boolean
  SAS_Sts: uint8  % CSA2|1|0|0|3|uint8
  HWA_OK_OFFSwt: boolean  % CSA2|1|0|0|1|boolean

VCAN_DCT_MSG_BUS = Simulink.Bus()
  TargetGearValid: boolean  % DCT5|1|0|0|1|boolean
  SHIFT_IN_PROGRESS: boolean  % DCT5|1|0|0|1|boolean
  CurrentGearValid: boolean  % DCT5|1|0|0|1|boolean
  TARGET_GEAR: uint8  % DCT5|1|0|0|15|uint8
  ShiftInPrgValid: boolean  % DCT5|1|0|0|1|boolean
  TGS_LEVER: uint8  % DCT5|1|0|0|15|uint8
  CURRENT_GEAR: uint8  % DCT5|1|0|0|15|uint8
  RatAct: single  % DCT_FD1|0.1|0|0|25.5|single
  DrvFaiMsg: uint8  % DCT_FD4|1|0|0|15|uint8

VCAN_ECM_MSG_BUS = Simulink.Bus()
  NetEngTrq: single  % ECM_FD1|0.0030518|-100|-100|99.9967|single
  DrvEngTrqReq: single  % ECM_FD1|0.0030518|-100|-100|99.9997|single
  DrvEngTrqReqVld: boolean  % ECM_FD1|1|0|0|1|boolean
  HCU_Start_StopSts: uint8  % ECM_FD1|1|0|0|9|uint8
  HCU_PowertrainSts_P0: uint8  % ECM_FD1|1|0|0|15|uint8
  EngTrqMinAct: single  % ECM_FD1|0.0030518|-100|-100|99.9997|single
  EngTrqMaxActSpd: single  % ECM_FD1|0.0030518|-100|-100|99.9997|single
  TrqLoss: single  % ECM_FD1|0.0030518|-100|-100|99.9997|single
  TrqLossVldty: boolean  % ECM_FD1|1|0|0|1|boolean
  BrkPedalSts: uint8  % ECM_FD1|1|0|0|3|uint8
  Start_StopSts: uint8  % ECM_FD1|1|0|0|7|uint8
  EngSpd: single  % ECM_FD1|0.125|0|0|8191.875|single
  EngSpdVldty: uint8  % ECM_FD1|1|0|0|2|uint8
  AccPedalOverride: boolean  % ECM_FD2|1|0|0|1|boolean
  AccelPedlPosnDiagc: single  % ECM_FD2|0.3937|0|0|100.3935|single
  ECMACCInterface: boolean  % ECM_FD2|1|0|0|1|boolean
  ECMRespACC: boolean  % ECM_FD2|1|0|0|1|boolean
  EngFail: uint8  % ECM_FD2|1|0|0|7|uint8
  AccelPedalPosn: single  % ECM_FD2|0.3937|0|0|100.3935|single
  AccelPedalPosnVldty: uint8  % ECM_FD2|1|0|0|2|uint8
  EngState: uint8  % ECM_FD2|1|0|0|3|uint8
  EngState_PHEV: uint8  % ECM_FD2|1|0|0|7|uint8
  MaxEngTrqNorm: uint16  % ECM_FD3|5|0|0|560|uint16
  EngLimpHomeSts: boolean  % ECM_FD3|1|0|0|1|boolean

VCAN_EPS_MSG_BUS = Simulink.Bus()
  EPS_DSTCtrlSts: uint8
  EPS_FailSts: uint8
  EPS_TrqSnsrSts: boolean
  EPS_SteerMod: uint8
  EPS_LKAAngDlvdSts: uint8
  EPS_DrvInpTrqVal_HighReslolution: single  % EPS_FD1|0.015625|-31.9844|-31.9844|32|single
  EPS_LKATorqOvrlDlvd: single  % EPS_FD1|0.01|-15|-15|15|single
  EPS_LKATrqOvlDlvdSts: uint8
  EPS_DrvInpTrqVal_HighResVld: boolean
  EPS_LKATorqOvrlDlvdVld: boolean
  EPS_SteerWheelAngSign: boolean
  EPS_SteerWheelAng: single
  EPS_SteerWheelSpdSign: boolean
  EPS_SteerWheelSpd: single
  EPS_AvailStsforHAD: uint8
  EPS_SteerWheelAngVld: boolean
  EPS_HADerror_Reason: uint8
  EPS_HADHndShkRespSt: uint8
  EPS_AngCmdOverRange: boolean

VCAN_ESP_MSG_BUS = Simulink.Bus()
  EB_ABPActv: boolean  % EBOOSTER_FD1|1|0|0|1|boolean
  EB_ABPAvailable: boolean  % EBOOSTER_FD1|1|0|0|1|boolean
  EB_AEBAvailable: boolean  % EBOOSTER_FD1|1|0|0|1|boolean
  EB_AEBBAActv: boolean  % EBOOSTER_FD1|1|0|0|1|boolean
  EB_AEBIBActv: boolean  % EBOOSTER_FD1|1|0|0|1|boolean
  EB_VehStandstill: uint8  % EBOOSTER_FD1|1|0|0|3|uint8
  EB_AWBActv: boolean  % EBOOSTER_FD1|1|0|0|1|boolean
  EB_AWBAvailable: boolean  % EBOOSTER_FD1|1|0|0|1|boolean
  EB_CDDAvailable: boolean  % EBOOSTER_FD1|1|0|0|1|boolean
  EB_CDDActv: boolean  % EBOOSTER_FD1|1|0|0|1|boolean
  IsDrvReqFxBrakeDom: boolean  % ESP14|1|0|0|1|boolean
  DrvReqFxBrkDomAvail: uint8  % ESP14|1|0|0|3|uint8
  IsDrvPressBrkPedal: boolean  % ESP14|1|0|0|1|boolean
  DrvPressBrkPedalAvl: uint8  % ESP14|1|0|0|3|uint8
  L12mainVMCavailiable: boolean  % ESP_FD2|1|0|0|1|boolean
  L12VLCADactive: boolean  % ESP_FD2|1|0|0|1|boolean
  ESP_DiagActv: boolean  % ESP_FD2|1|0|0|1|boolean
  BrkDskOvrheatd: boolean  % ESP_FD2|1|0|0|1|boolean
  NoBrkForce: boolean  % ESP_FD2|1|0|0|1|boolean
  VehStandstill: uint8  % ESP_FD2|1|0|0|3|uint8
  AEBIBActv: boolean  % ESP_FD2|1|0|0|1|boolean
  AEBBAActv: boolean  % ESP_FD2|1|0|0|1|boolean
  AEBAvailable: boolean  % ESP_FD2|1|0|0|1|boolean
  ABPAvailable: boolean  % ESP_FD2|1|0|0|1|boolean
  ABPActv: boolean  % ESP_FD2|1|0|0|1|boolean
  ABAavailable: boolean  % ESP_FD2|1|0|0|1|boolean
  ABAactv: boolean  % ESP_FD2|1|0|0|1|boolean
  HDCCtrl: uint8  % ESP_FD2|1|0|0|2|uint8
  CDDActv: boolean  % ESP_FD2|1|0|0|1|boolean
  CDDAvailable: boolean  % ESP_FD2|1|0|0|1|boolean
  AWBAvailable: boolean  % ESP_FD2|1|0|0|1|boolean
  AWBActv: boolean  % ESP_FD2|1|0|0|1|boolean
  AVHSts: uint8  % ESP_FD2|1|0|0|2|uint8
  CDPActv: boolean  % ESP_FD2|1|0|0|1|boolean
  DrivingModDis: uint8  % ESP_FD2|1|0|0|31|uint8
  PTCActv_RA: boolean  % ESP_FD2|1|0|0|1|boolean
  BTCActv_RA: boolean  % ESP_FD2|1|0|0|1|boolean
  ESPFuncOffSts: boolean  % ESP_FD2|1|0|0|1|boolean
  ESPBrkLmpCtrl: boolean  % ESP_FD2|1|0|0|1|boolean
  ESPFailSts: boolean  % ESP_FD2|1|0|0|1|boolean
  ESP_MasterCylBrkPressVld: boolean  % ESP_FD2|1|0|0|1|boolean
  VDCActv: boolean  % ESP_FD2|1|0|0|1|boolean
  MSRActv: boolean  % ESP_FD2|1|0|0|1|boolean
  PTCActv: boolean  % ESP_FD2|1|0|0|1|boolean
  BTCActv: boolean  % ESP_FD2|1|0|0|1|boolean
  ESP_MasterCylBrkPress: single  % ESP_FD2|0.03125|-42.5|-42.5|425|single
  MSRActv_RA: boolean  % ESP_FD2|1|0|0|1|boolean
  VehSpdVld: boolean  % ESP_FD2|1|0|0|1|boolean
  EBDFailSts: boolean  % ESP_FD2|1|0|0|1|boolean
  ABSFailSts: boolean  % ESP_FD2|1|0|0|1|boolean
  VehSpd: single  % ESP_FD2|0.05625|0|0|299.9812|single
  ABSActv: boolean  % ESP_FD2|1|0|0|1|boolean
  FLWheelSpdVld: boolean  % ESP_FD3|1|0|0|1|boolean
  FLWheelDriveDirection: uint8  % ESP_FD3|1|0|0|3|uint8
  FLWheelSpd: single  % ESP_FD3|0.05625|0|0|299.9812|single
  FRWheelSpdVld: boolean  % ESP_FD3|1|0|0|1|boolean
  FRWheelDriveDirection: uint8  % ESP_FD3|1|0|0|3|uint8
  FRWheelSpd_ESP_FD3: single  % ESP_FD3|0.05625|0|0|299.9812|single
  WssFLEdgesSum: uint8  % ESP_FD3|1|0|0|255|uint8
  WssFREdgesSum: uint8  % ESP_FD3|1|0|0|255|uint8
  WssFREdgesSumVld: boolean  % ESP_FD3|1|0|0|1|boolean
  WssFLEdgesSumVld: boolean  % ESP_FD3|1|0|0|1|boolean
  EPB_SwtPosnVld: boolean  % ESP_FD3|1|0|0|1|boolean
  EPBErrSts: uint8  % ESP_FD3|1|0|0|3|uint8
  EPBSts: uint8  % ESP_FD3|1|0|0|3|uint8
  EPB_SwtPosn: uint8  % ESP_FD3|1|0|0|3|uint8
  ESP_DSTSts: uint8  % ESP_FD3|1|0|0|7|uint8
  RLWheelSpdVld: boolean  % ESP_FD3|1|0|0|1|boolean
  RLWheelDriveDirection: uint8  % ESP_FD3|1|0|0|3|uint8
  RLWheelSpd: single  % ESP_FD3|0.05625|0|0|299.9812|single
  RRWheelSpdVld: boolean  % ESP_FD3|1|0|0|1|boolean
  RRWheelDriveDirection: uint8  % ESP_FD3|1|0|0|3|uint8
  RRWheelSpd: single  % ESP_FD3|0.05625|0|0|299.9812|single
  WssRREdgesSum: uint8  % ESP_FD3|1|0|0|255|uint8
  WssRLEdgesSum: uint8  % ESP_FD3|1|0|0|255|uint8
  WssRREdgesSumVld: boolean  % ESP_FD3|1|0|0|1|boolean
  WssRLEdgesSumVld: boolean  % ESP_FD3|1|0|0|1|boolean
  LSMGearRequest: uint8  % ESP_FD3|1|0|0|2|uint8
  VLC_ESP_State: uint8  % ESP_FD3|1|0|0|3|uint8
  VLC_ESP_FuelCutOffPrevention: boolean  % ESP_FD3|1|0|0|1|boolean
  L3mainVMCavailiable: uint8  % ESP_FD3|1|0|0|3|uint8
  L3VLCADactive: boolean  % ESP_FD3|1|0|0|1|boolean
  ParkPawlRequest: boolean  % ESP_FD3|1|0|0|1|boolean
  VLC_IntTartAccel: single  % ESP_FD3|0.0125|-16|-16|16|single

VCAN_HCM_MSG_BUS = Simulink.Bus()
  LHiBeamSts: boolean
  LLowBeamSts: boolean
  RHiBeamSts: boolean
  RLowBeamSts: boolean

VCAN_HCU_MSG_BUS = Simulink.Bus()
  HCU_AccelPedalPosn_Diag: single  % HCU_FD1|0.3937|0|0|100.395|single
  HCU_BrkPedalStsValid: boolean  % HCU_FD1|1|0|0|1|boolean
  HCU_AccelPedalPosn_DiagValid: boolean  % HCU_FD1|1|0|0|1|boolean
  HCU_BrkPedalSts: uint8  % HCU_FD1|1|0|0|3|uint8
  ActWheelTrqDmd: int16  % HCU_FD1|5|-6000|-6000|14475|int16
  MaxPsblWheelTrq: int16  % HCU_FD1|20|-6000|-6000|14460|int16
  TotWheelTrq: int16  % HCU_FD1|5|-6000|-6000|14475|int16
  HCU_ACCInterface: boolean  % HCU_FD1|1|0|0|1|boolean
  TotWheelTrqVld: boolean  % HCU_FD1|1|0|0|1|boolean
  MinPsblWheelTrq: int16  % HCU_FD1|20|-6000|-6000|14460|int16
  HCU_PowertrainSts: uint8  % HCU_FD1|1|0|0|31|uint8
  ACU_ShiftInProgress: uint8  % HCU_FD1|1|0|0|3|uint8
  HCU_PTDrvMod: uint8  % HCU_FD3|1|0|0|7|uint8
  HCU_DrvMod: uint8  % HCU_FD3|1|0|0|15|uint8
  DrvTrqReqOvld: uint8  % HCU_FD3|1|0|0|3|uint8
  HCU_FltLvl: uint8  % HCU_FD3|1|0|0|2|uint8
  HCU_GearSts: uint8  % HCU_FD3|1|0|0|15|uint8

VCAN_HUT_MSG_BUS = Simulink.Bus()
  ADAS_Meta_MapProvider: uint8  % HUT19|1|0|0|7|uint8
  ADAS_Meta_MsgTyp: uint8  % HUT19|1|0|0|7|uint8
  ADAS_Meta_CountryCode: uint16  % HUT19|1|0|0|1023|uint16
  ADAS_Meta_ProtVer_MinorSub: uint8  % HUT19|1|0|0|7|uint8
  ADAS_Meta_ProtVer_Major: uint8  % HUT19|1|0|0|3|uint8
  ADAS_Meta_CycCnt: uint8  % HUT19|1|0|0|3|uint8
  ADAS_Meta_HwVer: uint16  % HUT19|1|0|0|511|uint16
  ADAS_Meta_DrvSide: boolean  % HUT19|1|0|0|1|boolean
  ADAS_Meta_RegionCode: uint16  % HUT19|1|0|0|32767|uint16
  ADAS_Meta_MapVerYear: uint8  % HUT19|1|0|0|63|uint8
  ADAS_Meta_MapVerQtr: uint8  % HUT19|1|0|0|3|uint8
  ADAS_Meta_ProtVer_Minor: uint8  % HUT19|1|0|0|15|uint8
  ADAS_Meta_SpdUnits: boolean  % HUT19|1|0|0|1|boolean
  ADAS_ProfLong_MsgTyp: uint8  % HUT20|1|0|0|7|uint8
  ADAS_ProfLong_Offset: uint16  % HUT20|1|0|0|8190|uint16
  ADAS_ProfLong_PathIdx: uint8  % HUT20|1|0|0|63|uint8
  ADAS_ProfLong_CycCnt: uint8  % HUT20|1|0|0|3|uint8
  ADAS_ProfLong_Update: boolean  % HUT20|1|0|0|1|boolean
  ADAS_ProfLong_Retr: boolean  % HUT20|1|0|0|1|boolean
  ADAS_ProfLong_CtrlPoint: boolean  % HUT20|1|0|0|1|boolean
  ADAS_ProfLong_ProfTyp: uint8  % HUT20|1|0|0|31|uint8
  ADAS_ProfLong_Value: uint32  % HUT20|1|0|0|4294967295|uint32
  ADAS_ProfShort_MsgTyp: uint8  % HUT21|1|0|0|7|uint8
  ADAS_ProfShort_Offset: uint16  % HUT21|1|0|0|8190|uint16
  ADAS_ProfShort_PathIdx: uint8  % HUT21|1|0|0|63|uint8
  ADAS_ProfShort_CycCnt: uint8  % HUT21|1|0|0|3|uint8
  ADAS_ProfShort_Update: boolean  % HUT21|1|0|0|1|boolean
  ADAS_ProfShort_Retr: boolean  % HUT21|1|0|0|1|boolean
  ADAS_ProfShort_CtrlPoint: boolean  % HUT21|1|0|0|1|boolean
  ADAS_ProfShort_ProfTyp: uint8  % HUT21|1|0|0|31|uint8
  ADAS_ProfShort_AccurClass: uint8  % HUT21|1|0|0|3|uint8
  ADAS_ProfShort_Dist1: uint16  % HUT21|1|0|0|1022|uint16
  ADAS_ProfShort_Value0: uint16  % HUT21|1|0|0|1022|uint16
  ADAS_ProfShort_Value1: uint16  % HUT21|1|0|0|1022|uint16
  ADAS_Seg_MsgTyp: uint8  % HUT22|1|0|0|7|uint8
  ADAS_Seg_Offset: uint16  % HUT22|1|0|0|8190|uint16
  ADAS_Seg_PathIdx: uint8  % HUT22|1|0|0|63|uint8
  ADAS_Seg_CycCnt: uint8  % HUT22|1|0|0|3|uint8
  ADAS_Seg_Update: boolean  % HUT22|1|0|0|1|boolean
  ADAS_Seg_Retr: boolean  % HUT22|1|0|0|1|boolean
  ADAS_Seg_BuildUpArea: uint8  % HUT22|1|0|0|3|uint8
  ADAS_Seg_Brdg: uint8  % HUT22|1|0|0|3|uint8
  ADAS_Seg_Tunnel: uint8  % HUT22|1|0|0|3|uint8
  ADAS_Seg_FuncRoadClass: uint8  % HUT22|1|0|0|7|uint8
  ADAS_Seg_RelProbb: single  % HUT22|3.3333|0|0|100|single
  ADAS_Seg_FormOfWay: uint8  % HUT22|1|0|0|15|uint8
  ADAS_Seg_CmplxInsct: uint8  % HUT22|1|0|0|3|uint8
  ADAS_Seg_PartOfCalcRoute: uint8  % HUT22|1|0|0|3|uint8
  ADAS_Seg_EffSpdLmtTyp: uint8  % HUT22|1|0|0|7|uint8
  ADAS_Seg_EffSpdLmt: uint8  % HUT22|1|0|0|31|uint8
  ADAS_Seg_NumOfLaneDrvDir: uint8  % HUT22|1|0|0|7|uint8
  ADAS_Seg_NumOfLaneOppDir: uint8  % HUT22|1|0|0|3|uint8
  ADAS_Seg_DivideRoad: uint8  % HUT22|1|0|0|3|uint8
  ADAS_Stub_MsgTyp: uint8  % HUT23|1|0|0|7|uint8
  ADAS_Stub_Offset: uint16  % HUT23|1|0|0|8190|uint16
  ADAS_Stub_PathIdx: uint8  % HUT23|1|0|0|63|uint8
  ADAS_Stub_CycCnt: uint8  % HUT23|1|0|0|3|uint8
  ADAS_Stub_Update: boolean  % HUT23|1|0|0|1|boolean
  ADAS_Stub_Retr: boolean  % HUT23|1|0|0|1|boolean
  ADAS_Stub_StubPathIdx: uint8  % HUT23|1|0|0|63|uint8
  ADAS_Stub_FuncRoadClass: uint8  % HUT23|1|0|0|7|uint8
  ADAS_Stub_RelProbb: single  % HUT23|3.3333|0|0|100|single
  ADAS_Stub_FormOfWay: uint8  % HUT23|1|0|0|15|uint8
  ADAS_Stub_CmplxInsct: uint8  % HUT23|1|0|0|3|uint8
  ADAS_Stub_PartOfCalcRoute: uint8  % HUT23|1|0|0|3|uint8
  ADAS_Stub_TurnAngl: single  % HUT23|1.4173|0|0|358.583|single
  ADAS_Stub_NumOfLaneDrvDir: uint8  % HUT23|1|0|0|7|uint8
  ADAS_Stub_NumOfLaneOppDir: uint8  % HUT23|1|0|0|3|uint8
  ADAS_Stub_RtOfWay: uint8  % HUT23|1|0|0|3|uint8
  ADAS_Stub_LastStub: boolean  % HUT23|1|0|0|1|boolean
  Time_Hour: uint8  % HUT34|1|0|0|31|uint8
  TimeMod: boolean  % HUT34|1|0|0|1|boolean
  TimeIndcn: boolean  % HUT34|1|0|0|1|boolean
  Time_Minutes: uint8  % HUT34|1|0|0|63|uint8
  Time_Second: uint8  % HUT34|1|0|0|63|uint8
  Time_Year_Right: uint8  % HUT34|1|0|0|15|uint8
  Time_Year_Left: uint8  % HUT34|1|0|0|15|uint8
  Time_Month: uint8  % HUT34|1|0|0|15|uint8
  Time_Day: uint8  % HUT34|1|0|0|31|uint8
  IFC_SnvtySet: uint8  % HUT_FD1|1|0|0|3|uint8
  FCW_SnvtySet: uint8  % HUT_FD1|1|0|0|3|uint8
  LDWSwtReq: boolean  % HUT_FD1|1|0|0|1|boolean
  ESS_VehSwtReq: boolean  % HUT_FD1|1|0|0|1|boolean
  ESS_PedSwtReq: boolean  % HUT_FD1|1|0|0|1|boolean
  ELKSwtReq: boolean  % HUT_FD1|1|0|0|1|boolean
  LCKSwtReq: boolean  % HUT_FD1|1|0|0|1|boolean
  LKASwtReq: boolean  % HUT_FD1|1|0|0|1|boolean
  AEB_VehSwtReq: boolean  % HUT_FD1|1|0|0|1|boolean
  LSSWarnFormSwtReq: uint8  % HUT_FD1|1|0|0|3|uint8
  TSRWarnSwtReq: boolean  % HUT_FD1|1|0|0|1|boolean
  TSRSwtReq: boolean  % HUT_FD1|1|0|0|1|boolean
  AEB_PedSwtReq: boolean  % HUT_FD1|1|0|0|1|boolean
  LSSSwtReq: boolean  % HUT_FD1|1|0|0|1|boolean
  IntelligentEvaSwtReq: boolean  % HUT_FD1|1|0|0|1|boolean
  TSR_SnvtySet: int8  % HUT_FD1|1|-15|-15|15|int8
  ISLSwtReq: boolean  % HUT_FD1|1|0|0|1|boolean
  ICA_HandsOffSwtReq: boolean  % HUT_FD1|1|0|0|1|boolean
  NavVehToTrafEyeDist: uint16  % HUT_FD1|1|0|0|1023|uint16
  NavSpdLimUnit_HUT: uint8  % HUT_FD1|1|0|0|3|uint8
  NavSpdLimValue: uint8  % HUT_FD1|1|0|0|63|uint8
  HWA_SwtReq: boolean  % HUT_FD1|1|0|0|1|boolean
  NavSpdLimSignSts: uint8  % HUT_FD1|1|0|0|7|uint8
  NavCtryType: uint16  % HUT_FD1|1|0|0|1023|uint16
  NavTSRTrafSign: uint8  % HUT_FD1|1|0|0|255|uint8
  ALC_SwtReq: boolean  % HUT_FD1|1|0|0|1|boolean
  AESSwtReq: boolean  % HUT_FD1|1|0|0|1|boolean
  AEB_JASwtReq: boolean  % HUT_FD1|1|0|0|1|boolean
  FCTABrkSwtReq: boolean  % HUT_FD1|1|0|0|1|boolean
  FCTASwtReq: boolean  % HUT_FD1|1|0|0|1|boolean
  HWA_SnvtySet: uint8  % HUT_FD1|1|0|0|3|uint8
  NavSpdLimType: uint8  % HUT_FD1|1|0|0|3|uint8
  NavRoadType: uint8  % HUT_FD1|1|0|0|15|uint8
  ADAS_Posn_MsgTye: uint8  % HUT_FD1|1|0|0|7|uint8
  ADAS_Posn_Offset: uint16  % HUT_FD1|1|0|0|8190|uint16
  ADAS_Posn_Pathldx: uint8  % HUT_FD1|1|0|0|63|uint8
  ADAS_Posn_CycCnt: uint8  % HUT_FD1|1|0|0|3|uint8
  ADAS_Posn_PosProbb: single  % HUT_FD1|3.33|0|0|100|single
  ADAS_Posn_Idx: uint8  % HUT_FD1|1|0|0|3|uint8
  ADAS_Posn_Age: uint16  % HUT_FD1|5|0|0|2545|uint16
  ADAS_Posn_CurLane: uint8  % HUT_FD1|1|0|0|7|uint8
  ADAS_Posn_PosConfdc: uint8  % HUT_FD1|1|0|0|7|uint8
  ADAS_Posn_Spd: single  % HUT_FD1|0.2|-12.8|-12.8|89.2|single
  ADAS_Posn_Rehead: single  % HUT_FD1|1.4173|0|0|358.583|single
  NOH_Act_Req: boolean  % HUT_FD3|1|0|0|1|boolean
  NOH_Swt_Req: boolean  % HUT_FD3|1|0|0|1|boolean

VCAN_IBOOSTER_MSG_BUS = Simulink.Bus()
  IsDrvReqFxBrakeDom_IB3: boolean  % IBooster3|1|0|0|1|boolean
  DrvReqFxBrkDomAvail_IB3: uint8  % IBooster3|1|0|0|3|uint8
  IB_BrkPedalAppldVld: uint8  % IBooster_FD2|1|0|0|3|uint8
  IB_BrkPedalAppld: boolean  % IBooster_FD2|1|0|0|1|boolean
  VehStandstill_IB_FD2: uint8  % IBooster_FD2|1|0|0|3|uint8
  FLWheelSpdVld_IB_FD2: boolean  % IBooster_FD2|1|0|0|1|boolean
  FLWheelDriveDirection_IB_FD2: uint8  % IBooster_FD2|1|0|0|3|uint8
  FLWheelSpd_IB_FD2: single  % IBooster_FD2|0.05625|0|0|299.9812|single
  FRWheelSpdVld_IB_FD2: boolean  % IBooster_FD2|1|0|0|1|boolean
  FRWheelDriveDirection_IB_FD2: uint8  % IBooster_FD2|1|0|0|3|uint8
  FRWheelSpd_IB_FD2: single  % IBooster_FD2|0.05625|0|0|299.9812|single
  WssFLEdgesSum_IB_FD2: uint8  % IBooster_FD2|1|0|0|255|uint8
  WssFREdgesSum_IB_FD2: uint8  % IBooster_FD2|1|0|0|255|uint8
  WssFREdgesSumVld_IB_FD2: boolean  % IBooster_FD2|1|0|0|1|boolean
  WssFLEdgesSumVld_IB_FD2: boolean  % IBooster_FD2|1|0|0|1|boolean
  VehSpdVld_IB_FD2: boolean  % IBooster_FD2|1|0|0|1|boolean
  VehSpd_IB_FD2: single  % IBooster_FD2|0.05625|0|0|299.9812|single
  L3mainVMCavailiable_IB_FD2: uint8  % IBooster_FD2|1|0|0|3|uint8
  L3VLCADactive_IB_FD2: boolean  % IBooster_FD2|1|0|0|1|boolean
  VLC_IntTartAccel_IB_FD2: single  % IBooster_FD2|0.0125|-16|-16|16|single
  RLWheelSpdVld_IB_FD2: boolean  % IBooster_FD2|1|0|0|1|boolean
  RLWheelDriveDirection_IB_FD2: uint8  % IBooster_FD2|1|0|0|3|uint8
  RLWheelSpd_IB_FD2: single  % IBooster_FD2|0.05625|0|0|299.9812|single
  RRWheelSpdVld_IB_FD2: boolean  % IBooster_FD2|1|0|0|1|boolean
  RRWheelDriveDirection_IB_FD2: uint8  % IBooster_FD2|1|0|0|3|uint8
  RRWheelSpd_IB_FD2: single  % IBooster_FD2|0.05625|0|0|299.9812|single
  WssRREdgesSum_IB_FD2: uint8  % IBooster_FD2|1|0|0|255|uint8
  WssRLEdgesSum_IB_FD2: uint8  % IBooster_FD2|1|0|0|255|uint8
  WssRREdgesSumVld_IB_FD2: boolean  % IBooster_FD2|1|0|0|1|boolean
  WssRLEdgesSumVld_IB_FD2: boolean  % IBooster_FD2|1|0|0|1|boolean

VCAN_TRAILER_MSG_BUS = Simulink.Bus()
  TrailerSts: boolean  % Trailer1|1|0|0|1|boolean