% Simulink data dictionary PvtIfAEB.sldd

BusAEBJAPedObjAbsInfoCopy = Simulink.Bus()
  dxFrontBumper: single
  vxAbsObj: single
  axAbsObj: single
  vyRelCorr: single
  ObjFusQuality: boolean

BusAEBModStsFuncImpArb = Simulink.Bus()
  warningFuncImpArb: Bus: BusWarningFuncImpArb
  brkReadyFuncImpArb: Bus: BusBrkReadyFuncImpArb
  brkFuncImpArb: Bus: BusBrkFuncImpArb

BusBrkFuncImpArb = Simulink.Bus()
  AEBpartFuncImpArb: Enum: ModSts
  cycAEBpartFuncImpArb: Enum: ModSts
  AEBfullFuncImpArb: Enum: ModSts
  JA_AEBfullFuncImpArb: Enum: ModSts
  cycAEBfullFuncImpArb: Enum: ModSts
  pedAEBfullFuncImpArb: Enum: ModSts
  EBAFuncImpArb: Enum: ModSts
  FCTBFuncImpArb: Enum: ModSts
  JA_PTW_AEBFuncImpArb: Enum: ModSts
  JA_cycAEBFuncImpArb: Enum: ModSts
  JA_pedAEBFuncImpArb: Enum: ModSts

BusBrkReadyFuncImpArb = Simulink.Bus()
  prefillFuncImpArb: Enum: ModSts
  ABAFuncImpArb: Enum: ModSts
  pedPrefillFuncImpArb: Enum: ModSts
  pedABAFuncImpArb: Enum: ModSts
  cycPrefillFuncImpArb: Enum: ModSts
  JA_vehPrefillFuncImpArb: Enum: ModSts
  JA_PTW_PrefillFuncImpArb: Enum: ModSts
  JA_cycPrefillFuncImpArb: Enum: ModSts
  JA_pedPrefillFuncImpArb: Enum: ModSts
  FCTB_PrefillFuncImpArb: Enum: ModSts
  FCTB_ABAFuncImpArb: Enum: ModSts

BusDiagManageInfo = Simulink.Bus()
  FCW_AEB_ErrorState: boolean
  AEB_PEDP_ErrorState: boolean
  AEB_JA_ErrorState: boolean

BusLatFuncActiveStateTime = Simulink.Bus()
  pedPrefillWorkTime: double
  pedPreWarningWorkTime: double
  pedABAWorkTime: double
  pedAEBfullWorkTime: double
  cycPrefillWorkTime: double
  cycAEBpartWorkTime: double
  cycAEBfullWorkTime: double

BusSubjInfo = Simulink.Bus()
  subjVel: single
  subjLongAccel: single
  subjLatAccel: single
  subjCurvTraj: single
  subjYawRate: single

BusVehCanInfo = Simulink.Bus()
  DriverSBR: boolean
  PassSBR: boolean
  LongitudeAcc: single
  LongitudeAccValid: boolean
  FLWheelDriveDirection: uint8
  FLWheelSpdValid: boolean
  FLWheelSpd: single
  FRWheelDriveDirection: uint8
  FRWheelSpdValid: boolean
  FRWheelSpd: single
  RLWheelDriveDirection: uint8
  RLWheelSpdValid: boolean
  RLWheelSpd: single
  RRWheelDriveDirection: uint8
  RRWheelSpdValid: boolean
  RRWheelSpd: single
  BTCActive: boolean
  PTCActive: boolean
  VDCActive: boolean
  ESP_MasterCylindBrakePressValid: boolean
  ESP_MasterCylindBrakePress: single
  VehicleStandstill: uint8
  ABAactive: boolean
  ABAavailable: boolean
  ABPActive: boolean
  ABPAvailable: boolean
  AEBAvailable: boolean
  AEBBAActive: boolean
  AEBIBActive: boolean
  AWBactive: boolean
  AWBavailable: boolean
  AVHStsActv: boolean
  DrivingModeDis: uint8
  EspFuncOffSts: boolean
  DriverDoorSts: boolean
  PassengerDoorSts: boolean
  LeftTurnSWSts: boolean
  RightTurnSWSts: boolean
  SteerWheelAngle: single
  SteerWheelAngle_Deg: single
  SteerWheelAngleSign: boolean
  SteerWheelSpd: single
  SteerWheelSpd_DegS: single
  SteerWheelSpdSign: boolean
  CurrentGearValid: boolean
  CURRENT_GEAR: uint8
  BrakePedalStatus_G: uint8
  EngState: uint8
  HCU_Start_StopSts: uint8
  AccrPedlPosnDiagc: single
  AEB_PedSwtReq: boolean
  AEB_VehSwtReq: boolean
  AEB_JASwtReq: boolean
  FCW_SnvtySet: uint8
  FCTB_ABA_Level: uint8
  FCTB_ABA_Req: Enum: ModSts
  FCTB_ABP_Req: Enum: ModSts
  FCTB_BrkgReq: Enum: ModSts
  FCTB_BrkgReqVal: single
  HCU_PowertrainSts: uint8
  HCU_GearSts: uint8
  IB_BrkPedalAppld: boolean
  TrailerSts: boolean

BusVehConfigInfo = Simulink.Bus()
  VehicleConfigFCW: boolean
  VehicleConfigAEB: boolean
  VehicleConfigAEBPed: boolean
  VehicleConfigAEBCyc: boolean
  VehConfigAEBJA: boolean
  VehConfigIbooster: boolean

BusWarningFuncImpArb = Simulink.Bus()
  latentWarningFuncImpArb: Enum: ModSts
  preWarningFuncImpArb: Enum: ModSts
  acuteWarningFuncImpArb: Enum: ModSts
  pedPreWarningFuncImpArb: Enum: ModSts

ObjectTypeCopy = enum(DefaultValue="INVALIDE", AddClassNameToEnumNames=true)
  INVALIDE = 0
  UnknownType = 1
  CAR = 2
  TRUCK = 3
  MOTORBIKE = 4
  BICYCLE = 5
  PEDESTRIAN = 6
  GENERAL_OBJECT = 7
  ANIMAL = 8

ObjectType = enum(DefaultValue="INVALIDE", AddClassNameToEnumNames=true)
  INVALIDE = 0
  UnknownType = 1
  CAR = 2
  TRUCK = 3
  MOTORBIKE = 4
  BICYCLE = 5
  PEDESTRIAN = 6
  GENERAL_OBJECT = 7
  ANIMAL = 8

AEB_ObjectMovingState = enum(DefaultValue="UnknownState", AddClassNameToEnumNames=true)
  UnknownState = 0
  Still = 1
  Moving = 2
  Stopped = 3

AEB_ObjectMovingOrientation = enum(DefaultValue="UnknownDir", AddClassNameToEnumNames=true)
  UnknownDir = 0
  SameDir = 1
  InvDir = 2
  Crossing = 3

ACCModSts = enum(DefaultValue="OFFMode", AddClassNameToEnumNames=true)
  OFFMode = 0
  RejectMode = 1
  StandbyMode = 2
  ActiveControlMode = 3
  BrakeOnlyMode = 4
  OverrideMode = 5
  StandstillMode = 6
  FailureMode = 7

ModSts = enum(DefaultValue="OFFState", AddClassNameToEnumNames=true)
  OFFState = 0
  StandbyState = 1
  ActiveState = 2
  StandstillActiveState = 3
  FaultState = 4

BusAEBJaCycObjAbsInfo = Simulink.Bus()
  dxFrontBumper: single
  vxAbsObj: single
  axAbsObj: single
  vyRelCorr: single
  ObjFusQuality: boolean
  ObjectYawAngleCorr: single

BusAEBFuncSwtSts = Simulink.Bus()
  AEB_VehResp: boolean
  AEB_PedResp: boolean
  AEB_JAResp: boolean
  FCWSnvty: Enum: FCWSnvty

BusAEBJACycTgtCalcInfo = Simulink.Bus()
  JACycTgtObjInfo: Bus: BusAEBJaCycObjCalcInfo
  JACycCollisonAssessInfo: Bus: BusAEBJaCycCollisonAssessInfo

BusAEBJAPedCollisonAssessInfo = Simulink.Bus()
  TgtYawAngle: single
  distRadical2Collsion: single
  distBraking: single
  TTB: single

BusAEBJAPedObjAbsInfo = Simulink.Bus()
  dxFrontBumper: single
  vxAbsObj: single
  axAbsObj: single
  vyRelCorr: single
  ObjFusQuality: boolean
  ObjectYawAngleCorr: single

BusAEBJAPedObjCalcInfo = Simulink.Bus()
  AEBJAPedObj: Bus: BusAEBJAObjBus
  AEBJAPedObjAbsInfo: Bus: BusAEBJAPedObjAbsInfo
  AEBJAPedObjColliInfo: Bus: BusAEBJAPedObjColliInfo

BusAEBJAPedObjColliInfo = Simulink.Bus()
  tPredictTime: single
  ObjColliFlg: boolean

BusAEBJAPedTgtCalcInfo = Simulink.Bus()
  JAPedTgtObjInfo: Bus: BusAEBJAPedObjCalcInfo
  JAPedCollisonAssessInfo: Bus: BusAEBJAPedCollisonAssessInfo

BusAEBJAVehCollisonAssessInfo = Simulink.Bus()
  initialLatDist: single
  restLatDist2Collsion: single
  TTB: single

BusAEBJAVehObjAbsInfo = Simulink.Bus()
  dxFrontBumper: single
  vxAbsObj: single
  axAbsObj: single
  vyRelCorr: single
  ObjFusQuality: boolean

BusAEBJAVehObjCalcInfo = Simulink.Bus()
  AEBJAVehObj: Bus: BusAEBJAObjBus
  AEBJAVehObjAbsInfo: Bus: BusAEBJAVehObjAbsInfo
  AEBJAVehObjColliInfo: Bus: BusAEBJAVehObjColliInfo

BusAEBJAVehObjColliInfo = Simulink.Bus()
  tPredictTime: single
  ObjColliFlg: boolean

BusAEBJAVehTgtCalcInfo = Simulink.Bus()
  JAVehTgtObjInfo: Bus: BusAEBJAVehObjCalcInfo
  JAVehCollisonAssessInfo: Bus: BusAEBJAVehCollisonAssessInfo

BusAEBJaCycCollisonAssessInfo = Simulink.Bus()
  TgtYawAngle: single
  distRadical2Collsion: single
  distBraking: single
  TTB: single

BusAEBJaCycObjCalcInfo = Simulink.Bus()
  JaCycObj: Bus: BusAEBJAObjBus
  JaCycObjAbsInfo: Bus: BusAEBJaCycObjAbsInfo
  JaCycObjColliInfo: Bus: BusAEBJaCycObjColliInfo

BusAEBJaCycObjColliInfo = Simulink.Bus()
  tPredictTime: single
  ObjColliFlg: boolean

BusAEBModRawSts = Simulink.Bus()
  vehRawModSts: Bus: BusVehRawModSts
  latAEBRawModSts: Bus: BusLatAEBRawModSts
  JA_AEBRawModSts: Bus: BusJA_AEBRawModSts

BusAEBModStsArb = Simulink.Bus()
  vehAEBModStsArb: Bus: BusVehAEBModStsArb
  latAEBModStsArb: Bus: BusLatAEBModStsArb
  JA_AEBModStsArb: Bus: BusJA_AEBModStsArb

BusAEBSFuncOutput = Simulink.Bus()
  AEBTrigger: boolean
  axTgtReqValue: single
  ABPTrigger: boolean
  ABATrigger: boolean
  ABALvl: uint8
  latentWarningTrigger: boolean
  preWarningTrigger: boolean
  acuteWarningTrigger: boolean
  acuteWarningLvl: uint8

CollisionSeverity = enum(DefaultValue="None", AddClassNameToEnumNames=true)
  None = 0
  Low = 1
  Medium = 2
  High = 3

BusLatCycCollisionAssessInfo = Simulink.Bus()
  latCollisionSeverity: Enum: CollisionSeverity
  distBraking4PartBrake: single
  distBraking4FullBrake: single
  distSecure: single

BusLatPedCollisionAssessInfo = Simulink.Bus()
  latCollisionSeverity: Enum: CollisionSeverity
  distBraking: single
  distSecure: single

BusLongCollisionAssess = Simulink.Bus()
  longCollisionSeverity: Enum: CollisionSeverity
  TTC: single
  accelAvoidLowLvlBrk: single
  lowLvlBrkFlg4Warning: boolean
  lowLvlBrkFlg4Brake: boolean
  accelAvoidHighLvlBrk4Warning: single
  highLvlBrkFlg4Warning: boolean
  accelAvoidHighLvlBrk4Brake: single
  highLvlBrkFlg4Brake: boolean
  accelLatAvoidLeft: single
  accelLatAvoidRight: single
  latAvoidFlg4Warning: boolean
  latAvoidFlg4Brake: boolean

FCWSnvty = enum(DefaultValue="HMISettingEarly", AddClassNameToEnumNames=true)
  HMISettingMiddle = 0
  HMISettingEarly = 1
  HMISettingLate = 2

BusLatAEBModStsArb = Simulink.Bus()
  pedPreWarningModStsArb: Enum: ModSts
  pedPrefillModStsArb: Enum: ModSts
  cycPrefillModStsArb: Enum: ModSts
  pedABAModStsArb: Enum: ModSts
  cycAEBpartModStsArb: Enum: ModSts
  cycAEBfullModStsArb: Enum: ModSts
  pedAEBfullModStsArb: Enum: ModSts

BusLatAEBRawModSts = Simulink.Bus()
  pedPrefillRawModSts: Enum: ModSts
  pedPreWarningRawModSts: Enum: ModSts
  pedABARawModSts: Enum: ModSts
  pedAEBfullRawModSts: Enum: ModSts
  cycPrefillRawModSts: Enum: ModSts
  cycAEBpartRawModSts: Enum: ModSts
  cycAEBfullRawModSts: Enum: ModSts

BusLatCycObjAbsInfo = Simulink.Bus()
  dxFrontBumper: single
  vxAbsObj: single
  axAbsObj: single
  vyCorr: single
  ObjFusQuality: boolean

BusLatCycObjCalcInfo = Simulink.Bus()
  latCycObjRawInfo: Bus: BusAEBLatObj
  latCycObjAbsInfo: Bus: BusLatCycObjAbsInfo
  CollisionRiskProb: single
  cycCollisionRiskProb_TTC: single
  PreCollisionFlg: boolean
  cycPreCollisionFlg_TTC: single

BusLatCycTgtCalcInfo = Simulink.Bus()
  latCycObjCalcInfo: Bus: BusLatCycObjCalcInfo
  latCycCollisionAssessInfo: Bus: BusLatCycCollisionAssessInfo

BusLatPedObjAbsInfo = Simulink.Bus()
  dxFrontBumper: single
  vxAbsObj: single
  axAbsObj: single
  vyCorr: single
  ObjFusQuality: boolean

BusLatPedObjCalcInfo = Simulink.Bus()
  latPedObjRawInfo: Bus: BusAEBLatObj
  latPedObjAbsInfo: Bus: BusLatPedObjAbsInfo
  CollisionRiskProb: single
  pedCollisionRiskProb_TTC: single
  PreCollisionFlg: boolean
  pedPreCollisionFlg_TTC: single

BusLatPedTgtCalcInfo = Simulink.Bus()
  latPedObjCalcInfo: Bus: BusLatPedObjCalcInfo
  latPedCollsionAssesInfo: Bus: BusLatPedCollisionAssessInfo

BusBrkFuncImpAborCond = Simulink.Bus()
  FCTBFuncImpAborCond: boolean
  vehAEBpartFuncImpAborCond: boolean
  cycAEBpartFuncImpAborCond: boolean
  JA_vehAEBfullFuncImpAborCond: boolean
  vehAEBfullFuncImpAborCond: boolean
  cycAEBfullFuncImpAborCond: boolean
  pedAEBfullFuncImpAborCond: boolean
  vehEBAFuncImpAborCond: boolean
  JA_pedAEBfullFuncImpAborCond: boolean
  JA_cycAEBfullFuncImpAborCond: boolean
  JA_PTW_AEBfullFuncImpAborCond: boolean

BusBrkFuncImpSuppAborCond = Simulink.Bus()
  brkFuncImpAborCond: Bus: BusBrkFuncImpAborCond
  brkFuncImpSuppCond: Bus: BusBrkFuncImpSuppCond

BusBrkFuncImpSuppCond = Simulink.Bus()
  FCTBFuncImpSuppCond: boolean
  vehAEBpartFuncImpSuppCond: boolean
  cycAEBpartFuncImpSuppCond: boolean
  JA_vehAEBfullFuncImpSuppCond: boolean
  vehAEBfullFuncImpSuppCond: boolean
  cycAEBfullFuncImpSuppCond: boolean
  pedAEBfullFuncImpSuppCond: boolean
  vehEBAFuncImpSuppCond: boolean
  JA_pedAEBfullFuncImpSuppCond: boolean
  JA_cycAEBfullFuncImpSuppCond: boolean
  JA_PTW_AEBfullFuncImpSuppCond: boolean

BusBrkReadyFuncImpAborCond = Simulink.Bus()
  cycPrefillFuncImpAborCond: boolean
  pedPrefillFuncImpAborCond: boolean
  vehPrefillFuncImpAborCond: boolean
  vehABAFuncImpAborCond: boolean
  pedABAFuncImpAborCond: boolean
  JA_vehPrefillFuncImpAborCond: boolean
  JA_pedPrefillFuncImpAborCond: boolean
  JA_cycPrefillFuncImpAborCond: boolean
  JA_PTW_PrefillFuncImpAborCond: boolean
  FCTB_PrefillFuncImpAborCond: boolean
  FCTB_ABAFuncImpAborCond: boolean

BusBrkReadyFuncImpSuppAborCond = Simulink.Bus()
  brkReadyFuncImpAborCond: Bus: BusBrkReadyFuncImpAborCond
  brkReadyFuncImpSuppCond: Bus: BusBrkReadyFuncImpSuppCond

BusBrkReadyFuncImpSuppCond = Simulink.Bus()
  cycPrefillFuncImpSuppCond: boolean
  pedPrefillFuncImpSuppCond: boolean
  vehPrefillFuncImpSuppCond: boolean
  vehABAFuncImpSuppCond: boolean
  pedABAFuncImpSuppCond: boolean
  JA_vehPrefillFuncImpSuppCond: boolean
  JA_pedPrefillFuncImpSuppCond: boolean
  JA_cycPrefillFuncImpSuppCond: boolean
  JA_PTW_PrefillFuncImpSuppCond: boolean
  FCTB_PrefillFuncImpSuppCond: boolean
  FCTB_ABAFuncImpSuppCond: boolean

BusCycFuncSuppAborCond = Simulink.Bus()
  cycPrefillSuppCond: boolean
  cycPrefillAborCond: boolean
  cycAEBpartSuppCond: boolean
  cycAEBpartAborCondNoStandstill: boolean
  cycAEBpartAborCondStandstill: boolean
  cycAEBfullSuppCond: boolean
  cycAEBfullAborCondNoStandstill: boolean
  cycAEBfullAborCondStandstill: boolean

BusFIM_BrakeInfo4Control = Simulink.Bus()
  accelMin: single
  accelMax: single
  GradientFuncDecMax: single

BusFIM_BrkTriggerInfo = Simulink.Bus()
  FuncActvationTime: single
  AebFullFuncStatus: Enum: ModSts
  AebActiveFirstCycle: boolean
  FuncActvationTimeAtStart: single
  subjVelAtStart: single
  dxSecureAtStart: single
  vxPredictedAtStart: single

BusFIM_ObjPredicted = Simulink.Bus()
  dxFrontBumperPredicted: single
  vxAbsObjPredicted: single
  vxPredicted: single

BusFuncBlockTime = Simulink.Bus()
  blockTimeBrakeReady: single
  blockTimeWarning: single
  blockTimeBrake: single

BusFuncCondCalcInfo = Simulink.Bus()
  VehFuncSuppAborCond: Bus: BusVehFuncSuppAborCond
  PedFuncSuppAborCond: Bus: BusPedFuncSuppAborCond
  CycFuncSuppAborCond: Bus: BusCycFuncSuppAborCond
  JAPedFuncSuppAborCond: Bus: BusJAPedFuncSuppAborCond
  JAVehFuncSuppAborCond: Bus: BusJAVehFuncSuppAborCond
  JACycFuncSuppAborCond: Bus: BusJACycFuncSuppAborCond

BusFuncImpSuppAborCond = Simulink.Bus()
  warningFuncImpSuppAborCond: Bus: BusWarningFuncImpSuppAborCond
  brkReadyFuncImpSuppAborCond: Bus: BusBrkReadyFuncImpSuppAborCond
  brkFuncImpSuppAborCond: Bus: BusBrkFuncImpSuppAborCond

BusFuncManeuAborCond = Simulink.Bus()
  vehBrkManeuAborCond: boolean
  latBrkManeuAborCond: boolean
  JABrkManeuAborCond: boolean
  ABPFuncManeuAborCond: boolean
  ABAFuncManeuAborCond: boolean
  acuteWarningFuncManeuAborCond: boolean

BusJACycFuncSuppAborCond = Simulink.Bus()
  JACycPrefillSuppCond: boolean
  JACycPrefillAborCond: boolean
  JACycAEBfullSuppCond: boolean
  JACycAEBfullAborCondNoStandstill: boolean
  JACycAEBfullAborCondStandstill: boolean

BusJAPedFuncSuppAborCond = Simulink.Bus()
  JAPedPrefillSuppCond: boolean
  JAPedPrefillAborCond: boolean
  JAPedAEBfullSuppCond: boolean
  JAPedAEBfullAborCondNoStandstill: boolean
  JAPedAEBfullAborCondStandstill: boolean

BusJAVehFuncSuppAborCond = Simulink.Bus()
  JAVehPrefillSuppCond: boolean
  JAVehPrefillAborCond: boolean
  JAVehAEBfullSuppCond: boolean
  JAVehAEBfullAborCondNoStandstill: boolean
  JAVehAEBfullAborCondStandstill: boolean

BusJA_AEBModStsArb = Simulink.Bus()
  JA_vehAEBModStsArb: Enum: ModSts
  JA_PTW_AEBModStsArb: Enum: ModSts
  JA_cycAEBModStsArb: Enum: ModSts
  JA_pedAEBModStsArb: Enum: ModSts
  JA_vehPrefillModStsArb: Enum: ModSts
  JA_PTW_PrefillModStsArb: Enum: ModSts
  JA_cycPrefillModStsArb: Enum: ModSts
  JA_pedPrefillModStsArb: Enum: ModSts

BusJA_AEBRawModSts = Simulink.Bus()
  JA_vehPrefillRawModSts: Enum: ModSts
  JA_vehAEBRawModSts: Enum: ModSts
  JA_pedPrefillRawModSts: Enum: ModSts
  JA_pedAEBRawModSts: Enum: ModSts
  JA_cycPrefillRawModSts: Enum: ModSts
  JA_cycAEBRawModSts: Enum: ModSts
  JA_PTW_PrefillRawModSts: Enum: ModSts
  JA_PTW_AEBRawModSts: Enum: ModSts

BusLongObjAbsInfo = Simulink.Bus()
  dxFrontBumper: single
  vxAbsObj: single
  axAbsObj: single
  ObjFusQuality: boolean

BusPedFuncSuppAborCond = Simulink.Bus()
  pedPrefillSuppCond: boolean
  pedPrefillAborCond: boolean
  pedPreWarningSuppCond: boolean
  pedPreWarningAborCond: boolean
  pedABASuppCond: boolean
  pedABAAborCond: boolean
  pedAEBfullSuppCond: boolean
  pedAEBfullAborCondNoStandstill: boolean
  pedAEBfullAborCondStandstill: boolean

BusVSCCycFuncSuppAborCond = Simulink.Bus()
  VSCcycPrefillSuppCond: boolean
  VSCcycPrefillAborCond: boolean
  VSCcycAEBpartSuppCond: boolean
  VSCcycAEBpartAborCond: boolean
  VSCcycAEBfullSuppCond: boolean
  VSCcycAEBfullAborCond: boolean

BusVSCPedFuncSuppAborCond = Simulink.Bus()
  VSCPedPrefillSuppCond: boolean
  VSCPedPrefillAborCond: boolean
  VSCPedABASuppCond: boolean
  VSCPedABAAborCond: boolean
  VSCPedPreWarningSuppCond: boolean
  VSCPedPreWarningAborCond: boolean
  VSCPedAEBfullSuppCond: boolean
  VSCPedAEBfullAborCond: boolean

BusVSCVehSuppAborCond = Simulink.Bus()
  VSCvehPreWarningSuppCond: boolean
  VSCvehPreWarningAborCond: boolean
  VSCvehAcuteWarningSuppCond: boolean
  VSCvehAcuteWarningAborCond: boolean
  VSCvehLatentWarningSuppCond: boolean
  VSCvehLatentWarningAborCond: boolean
  VSCvehPrefillSuppCond: boolean
  VSCvehPrefillAborCond: boolean
  VSCvehABASuppCond: boolean
  VSCvehABAAborCond: boolean
  VSCvehAEBpartSuppCond: boolean
  VSCvehAEBpartAborCond: boolean
  VSCvehAEBfullSuppCond: boolean
  VSCvehAEBfullAborCond: boolean
  VSCvehEBASuppCond: boolean
  VSCvehEBAAborCond: boolean

BusVSC_FCW_AEB_FctSts = Simulink.Bus()
  FCW_AEB_VehFctSts: uint8
  FCW_AEB_PedFctSts: uint8
  FCW_AEB_JAFctSts: uint8

BusVSC_JAFuncSuppAborCond = Simulink.Bus()
  VSC_JAVehPrefillSuppCond: boolean
  VSC_JAVehPrefillAborCond: boolean
  VSC_JAVehAEBfullSuppCond: boolean
  VSC_JAVehAEBfullAborCond: boolean
  VSC_JAPedPrefillSuppCond: boolean
  VSC_JAPedPrefillAborCond: boolean
  VSC_JAPedAEBfullSuppCond: boolean
  VSC_JAPedVehAEBfullAborCond: boolean
  VSC_JACycPrefillSuppCond: boolean
  VSC_JACycPrefillAborCond: boolean
  VSC_JACycAEBfullSuppCond: boolean
  VSC_JACycAEBfullAborCond: boolean

BusVehAEBModStsArb = Simulink.Bus()
  latentWarningModStsArb: Enum: ModSts
  preWarningModStsArb: Enum: ModSts
  acuteWarningModStsArb: Enum: ModSts
  prefillModStsArb: Enum: ModSts
  ABAModStsArb: Enum: ModSts
  AEBpartModStsArb: Enum: ModSts
  AEBfullModStsArb: Enum: ModSts
  EBAModStsArb: Enum: ModSts

BusVehFuncSuppAborCond = Simulink.Bus()
  vehPreWarningSuppCond: boolean
  vehPreWarningAborCond: boolean
  vehAcuteWarningSuppCond: boolean
  vehAcuteWarningAborCond: boolean
  vehLatentWarningSuppCond: boolean
  vehLatentWarningAborCond: boolean
  vehPrefillSuppCond: boolean
  vehPrefillAborCond: boolean
  vehABASuppCond: boolean
  vehABAAborCond: boolean
  vehAEBpartSuppCond: boolean
  vehAEBpartAborCondNoStandstill: boolean
  vehAEBpartAborCondStandstill: boolean
  vehAEBfullSuppCond: boolean
  vehAEBfullAborCondNoStandstill: boolean
  vehAEBfullAborCondStandstill: boolean
  vehEBASuppCond: boolean
  vehEBAAborCondNoStandstill: boolean
  vehEBAAborCondStandstill: boolean

BusVehRawModSts = Simulink.Bus()
  vehPrefillRawModSts: Enum: ModSts
  vehPreWarningRawModSts: Enum: ModSts
  vehAcuteWarningRawModSts: Enum: ModSts
  vehAEBpartRawModSts: Enum: ModSts
  vehAEBfullRawModSts: Enum: ModSts
  vehEBARawModSts: Enum: ModSts
  vehABARawModSts: Enum: ModSts
  vehLatentWarningRawModSts: Enum: ModSts

BusVehStateCalcInfo = Simulink.Bus()
  VSCVehSuppAborCond: Bus: BusVSCVehSuppAborCond
  VSCPedFuncSuppAborCond: Bus: BusVSCPedFuncSuppAborCond
  VSCCycFuncSuppAborCond: Bus: BusVSCCycFuncSuppAborCond
  VSC_JAFuncSuppAborCond: Bus: BusVSC_JAFuncSuppAborCond
  VSC_FCW_AEB_FctSts: Bus: BusVSC_FCW_AEB_FctSts
  VSC_AEBFuncSwtSts: Bus: BusAEBFuncSwtSts
  VSCVehStandStill: boolean

BusWarningFuncImpAborCond = Simulink.Bus()
  vehLatentWarningFuncImpAborCond: boolean
  pedPreWarningFuncImpAborCond: boolean
  vehPreWarningFuncImpAborCond: boolean
  vehAcuteWarningFuncimpAborCond: boolean

BusWarningFuncImpSuppAborCond = Simulink.Bus()
  warningFuncImpAborCond: Bus: BusWarningFuncImpAborCond
  warningFuncImpSuppCond: Bus: BusWarningFuncImpSuppCond

BusWarningFuncImpSuppCond = Simulink.Bus()
  vehLatentWarningFuncImpSuppCond: boolean
  pedPreWarningFuncImpSuppCond: boolean
  vehPreWarningFuncImpSuppCond: boolean
  vehAcuteWarningFuncimpSuppCond: boolean

FusionType11 = enum(DefaultValue="INVALID", AddClassNameToEnumNames=true)
  INVALID = 0
  FCamera = 1
  FRader = 2
  FRadCamFusion = 3
  LFRadar = 4
  RFRadar = 5
  RLRader = 6
  RRRader = 7
  FRadCamLRadFusion = 8
  FRadCamRRadFusion = 9
  FRadCamRRadLRadFusion = 10
  FRadLRadFusion = 11
  FRadRRadFusion = 12
  FRadLRadRRadFusion = 13
  LRadRRadFusion = 14
  OtherFusion = 15

BusLongObjCalcInfo = Simulink.Bus()
  LongObjRawInfo: Bus: BusAEBLongObj
  longObjAbsInfo: Bus: BusLongObjAbsInfo
  LongCollisionAssess: Bus: BusLongCollisionAssess
  probEscape: single
  overlapRatio: single

CNPEBSAccelNegInf = mpt.Parameter(-80, StorageClass="ExportedGlobal", DataType="single", Unit="m/s^2")
CNPEBSAccelNull = mpt.Parameter(0, StorageClass="ExportedGlobal", DataType="single")
CNSTOPMAX = mpt.Parameter(256, StorageClass="ExportedGlobal", DataType="single")
CNTTCMAX = mpt.Parameter(256, StorageClass="ExportedGlobal", DataType="single")
CNTTCNULL = mpt.Parameter(0, StorageClass="ExportedGlobal", DataType="single")
CNaccelAvoidMax = mpt.Parameter(0, StorageClass="ExportedGlobal", DataType="single", Unit="m/s^2")
CNaccelAvoidMin = mpt.Parameter(-30, StorageClass="ExportedGlobal", DataType="single", Unit="m/s^2")
CNcomfortStrLeftAccelMax = mpt.Parameter(10, StorageClass="ExportedGlobal", DataType="single")
CNcomfortStrLeftAccelMin = mpt.Parameter(0, StorageClass="ExportedGlobal", DataType="single")
CNcomfortStrRightAccelMax = mpt.Parameter(0, StorageClass="ExportedGlobal", DataType="single")
CNcomfortStrRightAccelMin = mpt.Parameter(-10, StorageClass="ExportedGlobal", DataType="single")
CNreactionTimetimesincelastACCMAX = Simulink.Parameter(10, StorageClass="ExportedGlobal", DataType="single", Unit="s")  % The parameter describes the maximun value of time after ACC deactivate
PcomfortStrLatDistMinSO = mpt.Parameter(3, StorageClass="ExportedGlobal", DataType="single", Min=0, Max=10)
PcomfortStrRminSO = mpt.Parameter(5, StorageClass="ExportedGlobal", DataType="single", Min=0, Max=10, Unit="m")
CNDrvDoorOpen = mpt.Parameter(1, StorageClass="ExportedGlobal", DataType="boolean")
CNDrvModeEco = mpt.Parameter(2, StorageClass="ExportedGlobal", DataType="uint8")
CNDrvModeNorm = mpt.Parameter(0, StorageClass="ExportedGlobal", DataType="uint8")
CNDrvModeSport = mpt.Parameter(1, StorageClass="ExportedGlobal", DataType="uint8")
CNDrvSBRreminder = mpt.Parameter(1, StorageClass="ExportedGlobal", DataType="boolean")
CNEngOff = mpt.Parameter(0, StorageClass="ExportedGlobal", DataType="boolean")
CNPassDoorOpen = mpt.Parameter(1, StorageClass="ExportedGlobal", DataType="boolean")
CNPassSBRreminder = mpt.Parameter(1, StorageClass="ExportedGlobal", DataType="boolean")
CNSwtOFF = mpt.Parameter(0, StorageClass="ExportedGlobal", DataType="boolean")
CNSwtON = mpt.Parameter(1, StorageClass="ExportedGlobal", DataType="boolean")
CNVehConfigAEBCycNone = mpt.Parameter(0, StorageClass="ExportedGlobal", DataType="boolean")
CNVehConfigAEBNone = mpt.Parameter(0, StorageClass="ExportedGlobal", DataType="boolean")
CNVehConfigAEBPedNone = mpt.Parameter(0, StorageClass="ExportedGlobal", DataType="boolean")
CNVehConfigFCWNone = mpt.Parameter(0, StorageClass="ExportedGlobal", DataType="boolean")
CNVehConfigJANone = mpt.Parameter(0, StorageClass="ExportedGlobal", DataType="boolean")
CN_BTCActive = mpt.Parameter(1, StorageClass="ExportedGlobal", DataType="boolean")
CN_PTCActive = mpt.Parameter(1, StorageClass="ExportedGlobal", DataType="boolean")
CN_VDCActive = mpt.Parameter(1, StorageClass="ExportedGlobal", DataType="boolean")
CN_VSC_AEB_JA_Error = mpt.Parameter(1, StorageClass="ExportedGlobal", DataType="boolean")
CN_VSC_EspOff = mpt.Parameter(1, StorageClass="ExportedGlobal", DataType="boolean")
CN_VSC_FCW_AEB_Error = mpt.Parameter(1, StorageClass="ExportedGlobal", DataType="uint8")
CN_VSC_FCW_AEB_NoDispay = mpt.Parameter(0, StorageClass="ExportedGlobal", DataType="uint8")
CN_VSC_VehStandstill = mpt.Parameter(1, StorageClass="ExportedGlobal", DataType="uint8")
CN_VSC_AEB_PEDP_Error = mpt.Parameter(1, StorageClass="ExportedGlobal", DataType="boolean")
CNNull = mpt.Parameter(0, StorageClass="ExportedGlobal", DataType="single")
FALSE = mpt.Parameter(0, StorageClass="ExportedGlobal", DataType="boolean")
OFF = mpt.Parameter(0, StorageClass="ExportedGlobal")
ON = mpt.Parameter(1, StorageClass="ExportedGlobal", DataType="boolean")
TRUE = mpt.Parameter(1, StorageClass="ExportedGlobal", DataType="boolean")
Ts = Simulink.Parameter(0.02, StorageClass="ExportedGlobal", DataType="single")  % the sample time
dxFrontBumperToRearAxis = mpt.Parameter(3.93, StorageClass="ExportedGlobal", DataType="single")
dxRearBumperToRearAxis = mpt.Parameter(0.859, StorageClass="ExportedGlobal", DataType="single")
CNobjInvalidID = mpt.Parameter(0, StorageClass="ExportedGlobal", DataType="uint8")
CNsubjWidth = mpt.Parameter(1.8, StorageClass="ExportedGlobal", DataType="single")
subjWidth = mpt.Parameter(1.8, StorageClass="ExportedGlobal", DataType="single", Unit="m")
CNbrakePedalPress = mpt.Parameter(1, StorageClass="ExportedGlobal", DataType="boolean", Min=0, Max=1)
PAEBJAVehPrefilltReactionTime = Simulink.Parameter(0.3, StorageClass="ExportedGlobal", Min=0, Max=1)
tBrakeConfig = Simulink.Parameter(0, StorageClass="ExportedGlobal", DataType="boolean")
NO_ALERT = mpt.Parameter(39270, StorageClass="ExportedGlobal", DataType="uint16")
ALERT = mpt.Parameter(43605, StorageClass="ExportedGlobal", DataType="uint16")
CN_VSC_FCW_AEB_PerfmDgdtn = mpt.Parameter(3, StorageClass="ExportedGlobal", DataType="uint8")
CN_VSC_FCW_AEB_TempUnAvlbl = mpt.Parameter(2, StorageClass="ExportedGlobal", DataType="uint8")
P_AEB_LatPedObjAbs_SensorDeltDxThresXCopy = mpt.Parameter([2.78; 5.56; 8.3; 11.1; 13.8; 16.67], StorageClass="ExportedGlobal")
P_AEB_LatPedObjAbs_SensorDeltDxThresYCopy = mpt.Parameter(repmat(8, 6, 1), StorageClass="ExportedGlobal")

BusAEBLongObj = Simulink.Bus()
  FusionType: uint8
  ObjectID: uint16
  ObjectType: Enum: ObjectTypeCopy
  ObjectTypeCameraConfirmed: boolean
  ObjectLength: single
  ObjectWidth: single
  ObjectHight: single
  ObjectAzimuthAngle: single
  ObjectYawAngle: single
  ObjectMovingState: Enum: AEB_ObjectMovingState
  ObjectMovingOrientation: Enum: AEB_ObjectMovingOrientation
  dxFisrtDetection: single
  dyFisrtDetection: single
  dx: single
  dy: single
  dz: single
  vx: single
  vy: single
  ax: single
  ay: single
  dxVariance: single
  dyVariance: single
  vxVariance: single
  vyVariance: single
  axVariance: single
  ayVariance: single
  ObjectLengthVar: single
  ObjectWidthVar: single
  ObjectYawAngleVar: single
  ObjectTypeProb: single
  ObjectMovingStateProb: single
  ObjectMovingOrientationProb: single
  ObjectExistProb: single
  ObjectIsObstacleProb: single
  ObjectRCS: single
  ObjectMeasurementStatus: single
  ObjectLifeCycle: single
  dyObject2Center: single
  dyEgo2Center: single
  ObjUpdate: boolean
  FR_ObjectID: uint16
  FR_ObjectType: Enum: ObjectTypeCopy
  FR_ObjectMovingState: Enum: AEB_ObjectMovingState
  FR_ObjectMovingOrientation: Enum: AEB_ObjectMovingOrientation
  FR_Dx: single
  FR_Dy: single
  FR_Vx: single
  FR_Vy: single
  FC_ObjectID: uint16
  FC_ObjectType: Enum: ObjectTypeCopy
  FC_ObjectMovingState: Enum: AEB_ObjectMovingState
  FC_ObjectMovingOrientation: Enum: AEB_ObjectMovingOrientation
  FC_Dx: single
  FC_Dy: single
  FC_Vx: single
  FC_Vy: single

BusAEBJAObjBus = Simulink.Bus()
  FusionType: uint8
  ObjectID: uint16
  ObjectType: Enum: ObjectTypeCopy
  ObjectTypeCameraConfirmed: boolean
  ObjectLength: single
  ObjectWidth: single
  ObjectHight: single
  ObjectAzimuthAngle: single
  ObjectYawAngle: single
  ObjectMovingState: Enum: AEB_ObjectMovingState
  ObjectMovingOrientation: Enum: AEB_ObjectMovingOrientation
  dxFisrtDetection: single
  dyFisrtDetection: single
  dx: single
  dy: single
  dz: single
  vx: single
  vy: single
  ax: single
  ay: single
  dxVariance: single
  dyVariance: single
  vxVariance: single
  vyVariance: single
  axVariance: single
  ayVariance: single
  ObjectLengthVar: single
  ObjectWidthVar: single
  ObjectYawAngleVar: single
  ObjectTypeProb: single
  ObjectMovingStateProb: single
  ObjectMovingOrientationProb: single
  ObjectExistProb: single
  ObjectIsObstacleProb: single
  ObjectRCS: single
  ObjectMeasurementStatus: single
  ObjectLifeCycle: single
  ObjUpdate: boolean
  FR_ObjectID: uint16
  FR_ObjectType: Enum: ObjectTypeCopy
  FR_ObjectMovingState: Enum: AEB_ObjectMovingState
  FR_ObjectMovingOrientation: Enum: AEB_ObjectMovingOrientation
  FR_Dx: single
  FR_Dy: single
  FR_Vx: single
  FR_Vy: single
  FC_ObjectID: uint16
  FC_ObjectType: Enum: ObjectTypeCopy
  FC_ObjectMovingState: Enum: AEB_ObjectMovingState
  FC_ObjectMovingOrientation: Enum: AEB_ObjectMovingOrientation
  FC_Dx: single
  FC_Dy: single
  FC_Vx: single
  FC_Vy: single

BusAEBLatObj = Simulink.Bus()
  FusionType: uint8
  ObjectID: uint16
  ObjectType: Enum: ObjectTypeCopy
  ObjectTypeCameraConfirmed: boolean
  ObjectLength: single
  ObjectWidth: single
  ObjectHight: single
  ObjectAzimuthAngle: single
  ObjectYawAngle: single
  ObjectMovingState: Enum: AEB_ObjectMovingState
  ObjectMovingOrientation: Enum: AEB_ObjectMovingOrientation
  dxFisrtDetection: single
  dyFisrtDetection: single
  dx: single
  dy: single
  dz: single
  vx: single
  vy: single
  ax: single
  ay: single
  dxVariance: single
  dyVariance: single
  vxVariance: single
  vyVariance: single
  axVariance: single
  ayVariance: single
  ObjectLengthVar: single
  ObjectWidthVar: single
  ObjectYawAngleVar: single
  ObjectTypeProb: single
  ObjectMovingStateProb: single
  ObjectMovingOrientationProb: single
  ObjectExistProb: single
  ObjectIsObstacleProb: single
  ObjectRCS: single
  ObjectMeasurementStatus: single
  ObjectLifeCycle: single
  ObjUpdate: boolean
  FR_ObjectID: uint16
  FR_ObjectType: Enum: ObjectTypeCopy
  FR_ObjectMovingState: Enum: AEB_ObjectMovingState
  FR_ObjectMovingOrientation: Enum: AEB_ObjectMovingOrientation
  FR_Dx: single
  FR_Dy: single
  FR_Vx: single
  FR_Vy: single
  FC_ObjectID: uint16
  FC_ObjectType: Enum: ObjectTypeCopy
  FC_ObjectMovingState: Enum: AEB_ObjectMovingState
  FC_ObjectMovingOrientation: Enum: AEB_ObjectMovingOrientation
  FC_Dx: single
  FC_Dy: single
  FC_Vx: single
  FC_Vy: single

CN_CurrentGearR = mpt.Parameter(3, StorageClass="ExportedGlobal", DataType="uint8")
CN_CurrentGearR_DHT = mpt.Parameter(3, StorageClass="ExportedGlobal", DataType="uint8")
CNDrvModeOther = mpt.Parameter(0, StorageClass="ExportedGlobal", DataType="uint8")