% Simulink data dictionary PvtIfAHBC.sldd

UserDefined_LSR_ELEM_BUS = Simulink.Bus()
  LSR_ID_Out: uint8, Min=0, Max=255  % Light object ID. Range is 1-255, while 0 indicates that the field in unfilled.
  LSR_Distance_Out: uint16, Min=0, Max=1000
  LSR_Right_Angle_Out: single, Min=-40, Max=40  % Angle to right of light rectangle
  LSR_Left_Angle_Out: single, Min=-40, Max=40  % Angle to left of light rectangle
  LSR_Top_Angle_Out: single, Min=-10, Max=10  % Angle to top of light rectangle

UserDefined_LSV_ELEM_BUS = Simulink.Bus()
  LSV_ID_Out: uint8, Min=0, Max=255  % Light object ID. Range is 1-255, while 0 indicates that the field in unfilled.
  LSV_Is_New_Out: uint8, Min=0, Max=1  % Indicates whether the object was not first detected at the current frame. Due to a bug in the implementation.
  LSV_Confidence_Out: single, Min=0, Max=1  % DNN Confidence value
  LSV_Consecutive_Detection_Out: int8, Min=-5, Max=100  % The number of consecutive frames in which the light object was approved.
  LSV_Type_Out: uint8, Min=0, Max=6  % Describes the vehicle light type.
    % In case of a cluster it represents the type of the closest vehicle in the cluster.
    % Clearance = Truck cabin top lights.
  LSV_Sub_Type_Out: uint8, Min=0, Max=63  % Vehicle sub type.
  LSV_CL_Sub_Type_Out: uint8, Min=0, Max=6  % ENUM describes cluster sub type. If not cluster = 0
  LSV_Distance_Out: uint16, Min=0, Max=1000
  LSV_Right_Angle_Out: single, Min=-40, Max=40  % Angle to right of light rectangle
  LSV_Left_Angle_Out: single, Min=-40, Max=40  % Angle to left of light rectangle
  LSV_Top_Angle_Out: single, Min=-10, Max=10  % Angle to top of light rectangle
  LSV_Angular_Velocity_Right_Out: single, Min=-128, Max=127.875  % Angular velocity based on angle to right of light rectangle (can be couple)
  LSV_Angular_Velocity_Left_Out: single, Min=-128, Max=127.875  % Angular velocity based on angle to left of light rectangle (can be couple)