% Simulink data dictionary PvtIfLATC.sldd

LCS_Debug_BUS = Simulink.Bus()
  LCS_PID_torqP: single
  LCS_PID_torqD: single
  ErrDt: single
  LCS_ControlAngleError: single
  LCS_TarSteerAngle_deg: single
  LCS_TarSteerAngleEnd: single
  LCS_CurSteerAngle_deg: single

ESS_TarTorq = Simulink.Signal()
ESS_TarAngle = Simulink.Signal()