% Simulink data dictionary PvtIfLM_1_InPort.sldd

LM_CSA_BUS = Simulink.Bus()
  SteerWheelAngSign: boolean
  SteerWheelAng: single
  SteerWheelSpd: single
  SAS_Sts: uint8
  LTurnLmpSwtSts: boolean
  RTurnLmpSwtSts: boolean

LM_EHRV2_BUS = Simulink.Bus()
  EHRV2_ROAD_ATTR_INFO: single
  EHRV2_CTRL_INFO: single

LM_ESP_BUS = Simulink.Bus()
  FLWheelSpd: single
  FRWheelSpd: single
  RLWheelSpd: single
  RRWheelSpd: single
  FLWheelDriveDirection: uint8
  FRWheelDriveDirection: uint8
  RLWheelDriveDirection: uint8
  RRWheelDriveDirection: uint8
  VehStandstill: uint8

LM_LSM_HWA_BUS = Simulink.Bus()
  HWALineValid: boolean
  HWALineC1: single
  HWALineC2: single
  HWALineC3: single
  HWARange: single

LM_OFM_BUS = Simulink.Bus()
  Object_Fus_Type: uint8[80]  % 目标是否是融合,传感器类型，FC代表摄像头；FR代表前雷达；CL代表左角雷达；CR代表右角雷达；BL代表左盲点雷达；BR代表右盲点雷达；
  Object_ID: uint8[80], Min=1, Max=80  % 融合追踪处理后，目标的ID
  Object_Type: uint8[80]  % 目标的类型（行人、小汽车、卡车...）
  Object_Length: single[80], Min=1.2, Max=21, Unit="m"  % 目标的长度
  Object_Width: single[80], Min=0.04, Max=2.98, Unit="m"  % 目标的宽度
  Object_Hight: single[80], Min=0.01, Max=2.95, Unit="m"  % 目标的高度
  Object_HeadingAngle: single[80], Min=-180, Max=180, Unit="deg"  % 车体系下, 目标航向角
  Object_YawAngle: single[80], Min=-180, Max=180, Unit="deg"  % 车体系下, 目标的方位角
  Object_MovingState: uint8[80]  % 目标的运动状态(静止、运动...)
  Object_Orientation: uint8[80]  % 目标的运动方向(同向、对向、横穿...)
  Object_DX: single[80], Min=-80, Max=200, Unit="m"  % 车体坐标系下，自车和目标纵向相对距离
  Object_DY: single[80], Min=-100, Max=100, Unit="m"  % 车体坐标系下，自车和目标横向相对距离
  Object_VX: single[80], Min=-120, Max=130, Unit="m/s"  % 目标的  纵向的  速度
  Object_VY: single[80], Min=-50, Max=50, Unit="m/s"  % 目标的  横向的  速度
  Object_Std_AX: single[80], Min=0, Max=7.3  % 目标的  纵向的  加速度的方差
  Object_Std_AY: single[80], Min=0, Max=7.3  % 目标的  横向的  加速度的方差
  Object_Std_DX: single[80], Min=0, Max=250  % 目标的  纵向的  距离的方差
  Object_Std_DY: single[80], Min=0, Max=100  % 目标的  横向的  距离的方差
  Object_Std_VX: single[80], Min=0, Max=130  % 目标的  纵向的  速度的方差
  Object_Std_VY: single[80], Min=0, Max=50  % 目标的  横向的  速度的方差
  Object_AX: single[80], Min=-10.3, Max=7.3, Unit="m/s^2"  % 目标的  纵向的  加速度
  Object_AY: single[80], Min=-10.3, Max=7.3, Unit="m/s^2"  % 目标的  横向的  加速度
  Object_Std_Length: single[80], Min=0, Max=10  % 目标长度的方差
  Object_Std_Width: single[80], Min=0, Max=2  % 目标宽度的方差
  Object_Std_HeadingAngle: single[80], Min=0, Max=3.14  % 目标的航向角的方差
  Object_Type_Prob: single[80], Min=0, Max=1  % 目标对应类型的概率值
  Object_ExistProb: single[80], Min=0, Max=1  % 目标存在的概率值
  Object_ObstacleProb: single[80], Min=0, Max=1  % 目标成为障碍物的概率值
  Object_Age: uint16[80], Min=0, Max=65535  % 目标存在生命周期
  Object_State: uint8[80]  % 前摄像头传感目标ID
  FR_ObjectID: uint8[80], Min=0, Max=255  % 前摄像头传感目标类型
  FR_ObjectType: uint8[80], Min=0, Max=15  % 前摄像头传感目标运动状态
  FR_ObjectMovingState: uint8[80], Min=0, Max=7  % 前摄像头传感目标运动朝向
  FR_ObjectMovingOrientation: uint8[80], Min=0, Max=7  % 前摄像头传感目标纵向距离
  FR_Dx: single[80], Min=0, Max=254.9375, Unit="m"  % 前摄像头传感目标横向距离
  FR_Dy: single[80], Min=-128, Max=127.875, Unit="m"  % 前摄像头传感目标纵向速度
  FR_Vx: single[80], Min=-128, Max=126.9976, Unit="m/s"  % 前摄像头传感目标横向速度
  FR_Vy: single[80], Min=-128, Max=126.9976, Unit="m/s"  % 前雷达传感目标ID
  FC_ObjectID: uint8[80], Min=0, Max=255  % 前雷达传感目标类型
  FC_ObjectType: uint8[80], Min=0, Max=8  % 前雷达传感目标运动状态
  FC_ObjectMovingState: uint8[80], Min=0, Max=5  % 前雷达传感目标运动朝向
  FC_ObjectMovingOrientation: uint8[80], Min=0, Max=13  % 前雷达传感目标纵向距离
  FC_Dx: single[80], Min=-200, Max=250, Unit="m"  % 前雷达传感目标横向距离
  FC_Dy: single[80], Min=-100, Max=100, Unit="m"  % 前雷达传感目标纵向速度
  FC_Vx: single[80], Min=-120, Max=130, Unit="m/s"  % 前雷达传感目标横向速度
  FC_Vy: single[80], Min=-50, Max=50, Unit="m/s"

LM_RFM_LINE = Simulink.Bus()
  RFM_LINE_L1: Bus:LM_RFM_LINE_BUS
  RFM_LINE_R1: Bus:LM_RFM_LINE_BUS
  RFM_LINE_L2: Bus:LM_RFM_LINE_BUS
  RFM_LINE_R2: Bus:LM_RFM_LINE_BUS

LM_RFM_LINE_BUS = Simulink.Bus()
  bIsLineExist: uint8  % 表示车道线有无，2为有，1为无
  dC0V: single, Min=-30, Max=30  % 车辆坐标系下，车道线参数C0
  dC1V: single, Min=-2, Max=2  % 车辆坐标系下，车道线参数C1
  dC2V: single, Min=-0.125, Max=0.125  % 车辆坐标系下，车道线参数C2
  dC3V: single, Min=-0.004, Max=0.004  % 车辆坐标系下，车道线参数C3
  dLaneWidth: single, Min=0, Max=0.7  % 车道线宽度
  eLineType: uint8  % 车道线线型 （普通、实线、虚线、路牙...）
  dDisStart: single, Min=0, Max=200  % 车道线前方，起点长度
  dDisFront: single, Min=0, Max=200  % 车道线前方，有效长度
  dQuality: single  % 车道线质量信息
  eColour: uint8  % 车道线颜色
  eFuType: uint8, Min=0, Max=4  % 车道线融合状态（无、摄像头、地图、摄像头融合地图、预留）
  nTrackAge: uint8, Min=0, Max=255  % 车道线预测周期数（未预测时为0）

LM_RFM_LineInfo_BUS = Simulink.Bus()
  RFM_LINE: Bus: LM_RFM_LINE
  RFM_LINE_L3: Bus: LM_RFM_LINE_BUS
  RFM_LINE_R3: Bus: LM_RFM_LINE_BUS
  RFM_LINE_CL: Bus: LM_RFM_LINE_BUS
  RFM_LINE_LB: Bus: LM_RFM_LINE_BUS
  RFM_LINE_RB: Bus: LM_RFM_LINE_BUS

LM_TOS_ACCP0_BUS = Simulink.Bus()
  IDP0: uint8
  DxP0: single
  DyP0: single
  VxRelP0: single
  VyRelP0: single

LM_VIE_BUS = Simulink.Bus()
  axvRefMs2: single
  vxvRefMs: single
  axvRoadSlopeMs2: single
  axRefMs2: single
  axRefDt: single
  psiDtOpt: single
  ayvRefMs2: single
  alpSideSlipAngle: single
  kapTraj: single
  SteerAngleOffset_deg: single

LM_VSM_HMI_BUS = Simulink.Bus()
  HWASts: uint8
  HWAActive: boolean