% Simulink data dictionary PvtIfLM_2_PP.sldd

LM_PP_ComEVOffset_BUS = Simulink.Bus()
  LM_ComEVOffsetX: single
  LM_ComEVOffsetY: single
  LM_ComEVOffsetAng: single

LM_PP_EQ4_Bus = Simulink.Bus()
  EQ4_LA_ELEM_0: Bus: LM_PP_EQ4_LA_ELEM_Bus
  EQ4_LA_ELEM_1: Bus: LM_PP_EQ4_LA_ELEM_Bus
  EQ4_LA_ELEM_2: Bus: LM_PP_EQ4_LA_ELEM_Bus
  EQ4_LA_ELEM_3: Bus: LM_PP_EQ4_LA_ELEM_Bus
  LM_PP_LA_HDR: Bus: LM_PP_LA_HDR_Bus
  LM_PP_EQ4_LH_ELEM_0: Bus: LM_PP_EQ4_LH_ELEM_Bus
  LM_PP_EQ4_LH_ELEM_1: Bus: LM_PP_EQ4_LH_ELEM_Bus
  LM_PP_LH_HDR: Bus: LM_PP_LH_HDR_Bus
  EQ4_LRE_ELEM0: Bus: LM_PP_EQ4_LRE_ELEM_Bus
  EQ4_LRE_ELEM1: Bus: LM_PP_EQ4_LRE_ELEM_Bus
  LRE_HDR: Bus: LM_PP_LRE_HDR_Bus

LM_PP_EQ4_LA_ELEM_Bus = Simulink.Bus()
  LA_Line_C0: single
  LA_Line_C1: single
  LA_Line_C2: single
  LA_Line_C3: single
  LA_View_Range_End: single
  LA_View_Range_Start: single
  LA_Availability_State: uint8
  LA_Lanemark_Type: uint8
  LA_DLM_Type: uint8
  LA_Line_Side: uint8
  LA_Marker_Width: single
  LA_Confidence: single

LM_PP_EQ4_LH_ELEM_Bus = Simulink.Bus()
  LH_Line_First_C0: single
  LH_Line_First_C1: single
  LH_Line_First_C2: single
  LH_Line_First_C3: single
  LH_First_VR_End: single
  LH_First_VR_Start: single
  LH_Availability_State: uint8
  LH_Lanemark_Type: uint8
  LH_DLM_Type: uint8
  LH_Side: uint8
  LH_Marker_Width: single
  LH_Crossing: uint8
  LH_Confidence: single

LM_PP_EQ4_LRE_ELEM_Bus = Simulink.Bus()
  LRE_Line_C0: single
  LRE_Line_C1: single
  LRE_Line_C2: single
  LRE_Line_C3: single
  LRE_View_Range_End: single
  LRE_View_Range_Start: single
  LRE_Availability_State: uint8
  LRE_Side: uint8
  LRE_Confidence: single

LM_PP_LA_HDR_Bus = Simulink.Bus()
  LA_Adjacent_Count: uint8
  LA_Protocol_Version: uint8
  LA_Sync_ID: uint8
  LA_Zero_byte: uint8

LM_PP_LH_HDR_Bus = Simulink.Bus()
  LH_Estimated_Width: single
  LH_Lanes_Count: uint8
  LH_Protocol_Version: uint8
  LH_Sync_ID: uint8
  LH_Zero_byte: uint8

LM_PP_LRE_HDR_Bus = Simulink.Bus()
  LRE_Count: uint8
  LRE_CRC: uint32
  LRE_Header_Buffer: uint8
  LRE_Protocol_Version: uint8
  LRE_Sync_ID: uint8
  LRE_Zero_byte: uint8

LM_PP_PathDis_BUS = Simulink.Bus()
  LM_FntPath1Dis: single
  LM_FntPath2Dis: single
  LM_FntPath3Dis: single
  LM_FntPath4Dis: single
  LM_FntPath5Dis: single
  LM_RearPath1Dis: single
  LM_RearPath2Dis: single
  LM_RearPath3Dis: single

LM_PP_RFM_LINE = Simulink.Bus()
  RFM_LINE_L1: Bus:LM_PP_RFM_LINE_BUS
  RFM_LINE_R1: Bus:LM_PP_RFM_LINE_BUS
  RFM_LINE_L2: Bus:LM_PP_RFM_LINE_BUS
  RFM_LINE_R2: Bus:LM_PP_RFM_LINE_BUS

LM_PP_RFM_LINE_BUS = Simulink.Bus()
  bIsLineExist: uint8  % 表示车道线有无，2为有，1为无
  dC0V: single, Min=-30, Max=30  % 车辆坐标系下，车道线参数C0
  dC1V: single, Min=-2, Max=2  % 车辆坐标系下，车道线参数C1
  dC2V: single, Min=-0.125, Max=0.125  % 车辆坐标系下，车道线参数C2
  dC3V: single, Min=-0.004, Max=0.004  % 车辆坐标系下，车道线参数C3
  dLaneWidth: single, Min=0, Max=0.7  % 车道线宽度
  eLineType: uint8  % 车道线线型 （普通、实线、虚线、路牙...）
  dDisStart: single, Min=0, Max=200  % 车道线前方，起点长度
  dDisFront: single, Min=0, Max=200  % 车道线前方，有效长度
  dQuality: single  % 车道线质量信息
  eColour: uint8  % 车道线颜色
  eFuType: uint8, Min=0, Max=4  % 车道线融合状态（无、摄像头、地图、摄像头融合地图、预留）
  nTrackAge: uint8, Min=0, Max=255  % 车道线预测周期数（未预测时为0）

LM_PP_RFM_LineInfo = Simulink.Bus()
  RFM_LINE: Bus: LM_PP_RFM_LINE
  LM_LINE_L1: Bus: LM_PP_RFM_LINE_BUS
  LM_LINE_R1: Bus: LM_PP_RFM_LINE_BUS
  LM_LINE_L2: Bus: LM_PP_RFM_LINE_BUS
  LM_LINE_R2: Bus: LM_PP_RFM_LINE_BUS
  LM_LINE_L3: Bus: LM_PP_RFM_LINE_BUS
  LM_LINE_R3: Bus: LM_PP_RFM_LINE_BUS
  LM_LINE_CL: Bus: LM_PP_RFM_LINE_BUS
  LM_LINE_LB: Bus: LM_PP_RFM_LINE_BUS
  LM_LINE_RB: Bus: LM_PP_RFM_LINE_BUS

LM_PP_SigConfirm_BUS = Simulink.Bus()
  LM_PP_ComAllLineLost_flg: boolean
  LM_PP_ComLineLostNum: uint8
  LM_PP_ComREValid: boolean
  LM_PP_ComRENum: uint8
  LM_PP_DrivInWLType: uint8
  LM_PP_PathDis_Bus: Bus: LM_PP_PathDis_BUS
  LM_PP_ComEVOffset: Bus: LM_PP_ComEVOffset_BUS
  LM_PP_RFM_LineInfo: Bus: LM_PP_RFM_LineInfo