% Simulink data dictionary PvtIfLM_3_DIR.sldd

C_LM_ComSteer2LeFlg = Simulink.Parameter(0, DataType="uint8")
C_LM_ComSteer2RigFlg = Simulink.Parameter(1, DataType="uint8")
C_LM_CombLineIsExist = Simulink.Parameter(2, DataType="uint8")

LM_DIR_BUS = Simulink.Bus()
  LM_DIRTurnLeftValid: boolean
  LM_DIRTurnRightValid: boolean
  LM_DIRLC2LeValid: boolean
  LM_DIRLC2RigValid: boolean