% Simulink data dictionary PvtIfLM_4_VSL.sldd

LM_VSL_BUS = Simulink.Bus()
  LM_VSLFntPath1P: single[4]
  LM_VSLFntPath1Quality: single
  LM_VSLFntPath2P: single[4]
  LM_VSLFntPath2Quality: single
  LM_VSLFntPath3P: single[4]
  LM_VSLFntPath3Quality: single
  LM_VSLBaseDis: single
  LM_VSLLLC0: single
  LM_VSLLRC0: single
  LM_VSLRLC0: single
  LM_VSLRRC0: single
  LM_VSLLineDiffnum: single
  LM_VSLDiffValid: boolean[4]
  LM_VSLBLIndex: uint8
  LM_VSLRearPath1P: single[4]
  LM_VSLRearPath1Qulity: single
  LM_VSLRearPath2P: single[4]
  LM_VSLRearPath2Qulity: single
  LM_VSLRearPath3P: single[4]
  LM_VSLRearPath3Qulity: single