% Simulink data dictionary PvtIfLM_5_EML.sldd

LM_EML_BUS = Simulink.Bus()
  LM_EMLFntPath1P: single[1 4]
  LM_EMLFntPath1Quality: single
  LM_EMLFntPath2P: single[1 4]
  LM_EMLFntPath2Quality: single
  LM_EMLFntPath3P: single[1 4]
  LM_EMLFntPath3Quality: single
  LM_EMLLLC0: single
  LM_EMLLRC0: single
  LM_EMLRLC0: single
  LM_EMLRRC0: single
  LM_EMLRearPath1P: single[1 4]
  LM_EMLRearPath1Qulity: single
  LM_EMLRearPath2P: single[1 4]
  LM_EMLRearPath2Qulity: single
  LM_EMLRearPath3P: single[1 4]
  LM_EMLRearPath3Qulity: single

LM_EML_C0 = Simulink.Bus()
  LM_EML_LLC0: single
  LM_EML_LRC0: single
  LM_EML_RLC0: single
  LM_EML_RRC0: single