% Simulink data dictionary PvtIfLM_7_OTL.sldd

LM_OTLFitPar_Bus = Simulink.Bus()
  LM_OTLFntPath1Qulity: single
  LM_OTLFntPath2Qulity: single
  LM_OTLFntPath3Qulity: single
  LM_OTLFntPath1P: single[1 4]
  LM_OTLFntPath2P: single[1 4]
  LM_OTLFntPath3P: single[1 4]

LM_OTL_BLInfoCalc_Out_Bus = Simulink.Bus()
  LM_OTL_Range_s: single
  LM_OTLFitPar: Bus:LM_OTLFitPar_Bus

LM_OTL_Bus = Simulink.Bus()
  LM_OTL_BLInfoCalc_Out: Bus:LM_OTL_BLInfoCalc_Out_Bus
  LM_OTL_TrajParFit_Out: Bus:LM_OTL_TrajParFit_Out_Bus
  LM_OTL_MObjSelectCalc_Out: Bus:LM_OTL_MObjSelectCalc_Out_Bus

LM_OTL_MObjSelectCalc_Out_Bus = Simulink.Bus()
  MObjNum: uint8
  MObjIndex: uint8
  MObjC2: single
  C2Max: single
  C2Min: single
  EMLC2pm: single

LM_OTL_TrajParFit_Out_Bus = Simulink.Bus()
  LM_OTL_TrajFitPar: single[20 2]
  LM_OTL_HstTrajFitErr: single[20]
  LM_OTL_fitxval: single[20 60]
  LM_OTL_fityval: single[20 60]
  LM_OTL_TrajStartPntDx: single[20]
  LM_OTL_TrajEndPntDx: single[20]
  LM_OTL_TrajValidRange: single[20]
  LM_OTL_TrajDyOffset: single[20]
  LM_OTL_Dyvar: single[20]
  LM_OTL_fornum: uint8[20]
  LM_OTL_errsum: single[20]
  LM_OTL_trajstartdy: single[20]
  LM_OTL_trajenddy: single[20]
  LM_OTL_detdyfromstart2end: single[20]
  LM_OTL_TrajQua_vect: single[20]