% Simulink data dictionary PvtIfLM_8_Fusion.sldd

LM_FusBLInfo_Bus = Simulink.Bus()
  LM_FusBLFntPath1Info: Bus:LM_FusBLPathInfoBus
  LM_FusBLFntPath2Info: Bus:LM_FusBLPathInfoBus
  LM_FusBLFntPath3Info: Bus:LM_FusBLPathInfoBus
  LM_FusBLRearPath1Info: Bus:LM_FusBLPathInfoBus
  LM_FusBLRearPath2Info: Bus:LM_FusBLPathInfoBus
  LM_FusBLRearPath3Info: Bus:LM_FusBLPathInfoBus

LM_FusfCamValid_BUS = Simulink.Bus()
  LM_FusFntPath1fCamValid: uint8
  LM_FusFntPath2fCamValid: uint8
  LM_FusFntPath3fCamValid: uint8

LM_Fusion_FusRatio_BUS = Simulink.Bus()
  LM_VSL_01_Fus_Ratio: single
  LM_VSL_02_Fus_Ratio: single
  LM_VSL_03_Fus_Ratio: single
  LM_EML_01_Fus_Ratio: single
  LM_EML_02_Fus_Ratio: single
  LM_EML_03_Fus_Ratio: single
  LM_OTL_01_Fus_Ratio: single
  LM_OTL_02_Fus_Ratio: single
  LM_OTL_03_Fus_Ratio: single
  LM_MAL_01_Fus_Ratio: single
  LM_MAL_02_Fus_Ratio: single
  LM_MAL_03_Fus_Ratio: single
  LM_REL_01_Fus_Ratio: single
  LM_REL_02_Fus_Ratio: single
  LM_REL_03_Fus_Ratio: single

LM_FusBLInfoBefFilt_Bus = Simulink.Bus()
  LM_FusBLBefFiltFntPath1Info: Bus: LM_FusBLPathInfoBus
  LM_FusBLBefFiltFntPath2Info: Bus: LM_FusBLPathInfoBus
  LM_FusBLBefFiltFntPath3Info: Bus: LM_FusBLPathInfoBus
  LM_FusBLBefFiltRearPath1Info: Bus: LM_FusBLPathInfoBus
  LM_FusBLBefFiltRearPath2Info: Bus: LM_FusBLPathInfoBus
  LM_FusBLBefFiltRearPath3Info: Bus: LM_FusBLPathInfoBus

LM_FusBLInfoFilt_Bus = Simulink.Bus()
  LM_FusBLFPath1Info: Bus: LM_FusBLPathInfoBus
  LM_FusBLFPath2Info: Bus: LM_FusBLPathInfoBus
  LM_FusBLFPath3Info: Bus: LM_FusBLPathInfoBus
  LM_FusBLRPath1Info: Bus: LM_FusBLPathInfoBus
  LM_FusBLRPath2Info: Bus: LM_FusBLPathInfoBus
  LM_FusBLRPath3Info: Bus: LM_FusBLPathInfoBus

LM_FusBLPathInfoBus = Simulink.Bus()
  LM_FusBLPathC0: single
  LM_FusBLPathC1: single
  LM_FusBLPathC2: single
  LM_FusBLPathC3: single
  LM_FusBLPathQuality: single

LM_FusC0InfoBus = Simulink.Bus()
  LM_LLC0: single
  LM_LRC0: single
  LM_RLC0: single
  LM_RRC0: single

LM_FusFntPathKInfoBus = Simulink.Bus()
  LM_FusFntPath1EMLK: single
  LM_FusFntPath1VSLK: single
  LM_FusFntPath1OTLK: single
  LM_FusFntPath1RELK: single
  LM_FusFntPath1MALK: single
  LM_FusFntPath2EMLK: single
  LM_FusFntPath2VSLK: single
  LM_FusFntPath2OTLK: single
  LM_FusFntPath2RELK: single
  LM_FusFntPath2MALK: single
  LM_FusFntPath3EMLK: single
  LM_FusFntPath3VSLK: single
  LM_FusFntPath3OTLK: single
  LM_FusFntPath3RELK: single
  LM_FusFntPath3MALK: single

LM_FusRatioInfoBus = Simulink.Bus()
  LM_FusFntPathK: Bus: LM_FusFntPathKInfoBus
  LM_FusRearPathK: Bus: LM_FusRearPathKInfoBus

LM_FusRearPathKInfoBus = Simulink.Bus()
  LM_FusRearPath1VSLK: single
  LM_FusRearPath2VSLK: single
  LM_FusRearPath3VSLK: single
  LM_FusFntPath1EMLK: single
  LM_FusFntPath2EMLK: single
  LM_FusFntPath3EMLK: single