% Simulink data dictionary PvtIfPLAN.sldd

C_LongCtrl_0_Single = Simulink.Parameter(0, DataType="single")
C_LongCtrl_0_Uint8 = Simulink.Parameter(0, DataType="uint8")
C_LongCtrl_1_Single = Simulink.Parameter(1, DataType="single")
C_LongCtrl_1_Uint8 = Simulink.Parameter(1, DataType="uint8")
C_LongCtrl_2_Uint8 = Simulink.Parameter(1, DataType="uint8")
C_LongCtrl_3_Uint8 = Simulink.Parameter(1, DataType="uint8")
C_LongCtrl_4_Uint8 = Simulink.Parameter(1, DataType="uint8")
C_LongCtrl_100_Single = Simulink.Parameter(100, DataType="single")
C_LongCtrl_distThreDecToStop = Simulink.Parameter(20, DataType="single", Unit="m")
C_LongCtrl_Mph2Kph = Simulink.Parameter(1.609, DataType="single")
C_LongCtrl_Ms2Kph = Simulink.Parameter(3.6, DataType="single")
C_LongCtrl_velSubjThreDecToStop = Simulink.Parameter(3, DataType="single", Unit="m/s")
C_LongCtrl_velTargetThreDecleToStop = Simulink.Parameter(1, DataType="single", Unit="m/s")
PLAN_ALC_tMinCC = Simulink.Parameter(100)  % 请求换道最少要求巡航保持时间，实际执行时间为标定量*模型调用周期
PLAN_ALC_tMinPreLC = Simulink.Parameter(100)  % 请求换道最小要求提前等待时间（点亮转向灯但不执行换道），实际执行时间为标定量*模型调用周期

PLAN_DPC_ALC_BUS = Simulink.Bus()
  PLAN_DPC_HWA_DangerPlaus_L: single  % 左侧DOC
  PLAN_DPC_HWA_DangerPlaus_R: single  % 右侧DPC
  PLAN_DPC_HWA_OncomingFlag_Le: boolean  % 左侧线是否有对向行驶目标
  PLAN_DPC_HWA_OncomingFlag_Ri: boolean  % 右侧是否有对向行驶的目标
  PLAN_DPC_HWA_NearestObjValid_L: boolean  % 左侧最近目标有效性
  PLAN_DPC_HWA_NearestObjValid_R: boolean  % 右侧最近目标有效性
  PLAN_DPC_HWA_NearestObjDx_L: single  % 左侧最近目标距离
  PLAN_DPC_HWA_NearestObjDx_R: single  % 右侧最近目标距离
  PLAN_DPC_HWA_NearestObjSpeed_L: single  % 速度
  PLAN_DPC_HWA_NearestObjSpeed_R: single  % 速度
  PLAN_DPC_HWA_RearObjValid: boolean  % 本车道后方目标有效性
  PLAN_DPC_HWA_RearObjDx: single  % 本车道后方目标距离
  PLAN_DPC_HWA_RearObjSpeed: single  % 本车道后方目标速度

AP_SoftwareVersion = Simulink.Signal()