% Simulink data dictionary PvtIfTOS_10_dop.sldd

C_TOS_dop_IsntTOS_ACCP0Target = Simulink.Parameter(0, DataType="uint8")
C_TOS_dop_IsntTOS_ACCP1Target = Simulink.Parameter(0, DataType="uint8")
C_TOS_dop_NumberOfEffectiveTargets = Simulink.Parameter(80, DataType="uint8")
C_TOS_dop_OFMObjIDInvilad_Val = Simulink.Parameter(0, DataType="uint8")
C_TOS_dop_OFM_ObjValid_Flag = Simulink.Parameter(1, DataType="uint8")
C_TOS_dop_ObjNotREElementType = Simulink.Parameter(0, DataType="uint8")
C_TOS_dop_P0_Trajectory_TrackRecord_Num = Simulink.Parameter(135, DataType="single")
C_TOS_dop_TargetFront_Flag = Simulink.Parameter(1, DataType="boolean")
C_TOS_dop_ObjFusType_FC_FR_Confirm_b = Simulink.Parameter(1, DataType="boolean")
C_TOS_dop_ObjFusType_FR_Confirm_b = Simulink.Parameter(1, DataType="boolean")
C_TOS_dop_ObjFusType_FC_Confirm_b = Simulink.Parameter(1, DataType="boolean")

TOS_A2L_dop_P0_Confirm_ObserVale_bus = Simulink.Bus()
  TOS_P0_SteerWheelAngConfirm_ObserVale: boolean
  TOS_P0_FusionType_ObserVale: boolean
  TOS_P0_TrgMovDir_ObserVale: boolean
  TOS_P0_TargetDxConfirm_ObserVale: boolean
  TOS_P0_ObjType_ObserVale: boolean
  TOS_P0_ObstacleProb_ObserVale: boolean
  TOS_P0_DyConfirm_ObserVale: boolean
  TOS_P0_TrgMovDirFlag_1_ObserVale: boolean
  TOS_P0_TrgMovDirFlag_2_ObserVale: boolean
  TOS_P0_TrgMovDirFlag_3_ObserVale: boolean
  TOS_P0_TrgMovDirFlag_4_ObserVale: boolean
  TOS_P0_TrgMovDirFlag_5_ObserVale: boolean
  TOS_P0_TrgMovDirFlag_6_ObserVale: boolean
  TOS_P0_DyConfirm_1_ObserVale: uint8
  TOS_P0_DyConfirm_2_ObserVale: boolean
  TOS_P0_DyConfirm_3_ObserVale: boolean
  TOS_P0_DyConfirm_4_OverlapRatio_ObserVale: boolean
  TOS_P0_DyConfirm_5_OverlapConfirm_ObserVale: boolean
  TOS_P0_DyConfirm_ALL_6_ObserVale: boolean
  TOS_P0_DyConfirm_Parking_7_ObserVale: boolean
  TOS_P0_dy_ObjSelect_8_ObserVale: boolean

TOS_A2L_dop_P1_Confirm_ObserVale_bus = Simulink.Bus()
  TOS_P1_FusionType_ObserVale: boolean
  TOS_P1_TrgMovDir_ObserVale: boolean
  TOS_P1_TargetDxConfirm_ObserVale: boolean
  TOS_P1_ObjType_ObserVale: boolean
  TOS_P1_ObstacleProb_ObserVale: boolean
  TOS_P1_DyConfirm_ObserVale: boolean
  TOS_P1_TrgMovDirFlag_1_ObserVale: boolean
  TOS_P1_TrgMovDirFlag_2_ObserVale: boolean
  TOS_P1_TrgMovDirFlag_3_ObserVale: boolean
  TOS_P1_TrgMovDirFlag_4_ObserVale: boolean
  TOS_P1_TrgMovDirFlag_5_ObserVale: boolean
  TOS_P1_TrgMovDirFlag_6_ObserVale: boolean
  TOS_P1_DyConfirm_1_ObserVale: boolean
  TOS_P1_DyConfirm_2_ObserVale: boolean
  TOS_P1_DyConfirm_3_ObserVale: boolean
  TOS_P1_DyConfirm_4_OverlapRatio_ObserVale: boolean
  TOS_P1_DyConfirm_5_OverlapConfirm_ObserVale: boolean
  TOS_P1_DyConfirm_ALL_6_ObserVale: boolean

TOS_dop_P0_Confirm_ObserVale_bus = Simulink.Bus()
  TOS_P0_SteerWheelAngConfirm_ObserVale: boolean
  TOS_P0_FusionType_ObserVale: boolean
  TOS_P0_TrgMovDir_ObserVale: boolean
  TOS_P0_TargetDxConfirm_ObserVale: boolean
  TOS_P0_ObjType_ObserVale: boolean
  TOS_P0_ObstacleProb_ObserVale: boolean
  TOS_P0_DyConfirm_ObserVale: boolean
  TOS_P0_TrgMovDirFlag_1_ObserVale: boolean
  TOS_P0_TrgMovDirFlag_2_ObserVale: boolean
  TOS_P0_TrgMovDirFlag_3_ObserVale: boolean
  TOS_P0_TrgMovDirFlag_4_ObserVale: boolean
  TOS_P0_TrgMovDirFlag_5_ObserVale: boolean
  TOS_P0_TrgMovDirFlag_6_ObserVale: boolean
  TOS_P0_DyConfirm_1_ObserVale: uint8
  TOS_P0_DyConfirm_2_ObserVale: boolean
  TOS_P0_DyConfirm_3_ObserVale: boolean
  TOS_P0_DyConfirm_4_OverlapRatio_ObserVale: boolean
  TOS_P0_DyConfirm_5_OverlapConfirm_ObserVale: boolean
  TOS_P0_DyConfirm_ALL_6_ObserVale: boolean
  TOS_P0_DyConfirm_Parking_7_ObserVale: boolean
  TOS_P0_dy_ObjSelect_8_ObserVale: boolean

TOS_dop_P0_P1_Pre_ObserVale_bus = Simulink.Bus()
  TOS_dop_P0_P1_Pre_Condition_1: boolean
  TOS_dop_P0_P1_Pre_FusionType: boolean
  TOS_dop_P0_P1_Pre_FRSplitTarget: boolean
  TOS_dop_P0_P1_Pre_BoundaryFilt: boolean
  TOS_dop_P0_P1_Pre_ObjType: boolean
  TOS_dop_P0_P1_Pre_RoadEdge: boolean
  TOS_dop_P0_P1_FusType_TruckFRSplit_Patch: boolean
  TOS_dop_P0_P1_Pre_Condition_2: boolean
  TOS_dop_P0_P1_dy_CutIn_Flag: boolean
  TOS_dop_P0_P1_DyConfirm: boolean
  TOS_dop_P0_P1_Parking_DyConfirm: boolean
  TOS_dop_P0_P1_Parking_Line_fCamValid: boolean
  TOS_dop_P0_P1_DyWidening_Flag: boolean
  TOS_dop_P0_P1_SL_3: boolean
  TOS_dop_P0_P1_Overlap: boolean
  TOS_dop_P0_P1_SameLane: boolean
  TOS_dop_P0_P1_dy_CutIn: boolean

TOS_dop_P0_bus = Simulink.Bus()
  IDP0: uint8, Min=0, Max=255  % 目标P0的ID
  dxP0: single, Min=0, Max=210  % 自车和P0目标纵向相对距离
  vxRelP0: single, Min=-110, Max=55  % 自车和P0目标的纵向的相对速度
  ACCTgtObjVy: single  % Lateral relative speed of the ACCTarget objective with the ego vehicle
  axAbsGroundP0: single, Min=-21.592, Max=21.592  % P0目标对地的绝对加速度
  rangeP0: single, Min=0, Max=210  % 自车最前端和P0目标距离
  targetExistP0: boolean, Min=0, Max=1  % P0目标是否存在
  fu_typeP0: uint8  % 目标是否是融合,传感器类型
  ObjMovingStateP0: uint8  % 目标的运动状态(静止、运动...)
  Object_Orientation: uint8  % 目标的运动方向(同向、对向、横穿...)
  ObjTypeP0: uint8  % 目标的类型（行人、小汽车、卡车...）
  ObjDYP0: single  % 车体坐标系下，自车和目标横向相对距离
  ACCTgtObjObstcl: single  % ACCTarget objective are the possibility of obstacles
  ACCTgtObjAy: single  % Lateral ACCeleration of ACCTarget objective with ego vehicle；
  ACCTgtObjCntAlive: single  % Indicate the duration of the ACCTarget objective's existence；
  ACCTgtObjExist: single  % The possibility of ACCTarget objecttive existence
  P0HeadingAngle: single  % 车体系下, 目标航向角
  P0CutInflg: boolean, Min=0, Max=1  % P0目标是否为cutin

TOS_dop_P1_Confirm_ObserVale_bus = Simulink.Bus()
  TOS_P1_FusionType_ObserVale: boolean
  TOS_P1_TrgMovDir_ObserVale: boolean
  TOS_P1_TargetDxConfirm_ObserVale: boolean
  TOS_P1_ObjType_ObserVale: boolean
  TOS_P1_ObstacleProb_ObserVale: boolean
  TOS_P1_DyConfirm_ObserVale: boolean
  TOS_P1_TrgMovDirFlag_1_ObserVale: boolean
  TOS_P1_TrgMovDirFlag_2_ObserVale: boolean
  TOS_P1_TrgMovDirFlag_3_ObserVale: boolean
  TOS_P1_TrgMovDirFlag_4_ObserVale: boolean
  TOS_P1_TrgMovDirFlag_5_ObserVale: boolean
  TOS_P1_TrgMovDirFlag_6_ObserVale: boolean
  TOS_P1_DyConfirm_1_ObserVale: boolean
  TOS_P1_DyConfirm_2_ObserVale: boolean
  TOS_P1_DyConfirm_3_ObserVale: boolean
  TOS_P1_DyConfirm_4_OverlapRatio_ObserVale: boolean
  TOS_P1_DyConfirm_5_OverlapConfirm_ObserVale: boolean
  TOS_P1_DyConfirm_ALL_6_ObserVale: boolean

TOS_dop_P1_bus = Simulink.Bus()
  IDP1: uint8, Min=0, Max=255  % 目标P1的ID
  dxP1: single, Min=0, Max=210  % 自车和P1目标纵向相对距离
  vxRelP1: single, Min=-110, Max=55  % 自车和P1目标的纵向的相对速度
  axAbsGroundP1: single, Min=-21.592, Max=21.592  % 目标P1对地的绝对加速度
  rangeP1: single, Min=0, Max=210  % 自车最前端和目标P1距离
  targetExistP1: boolean  % P1目标是否存在
  fu_typeP1: uint8  % 目标是否是融合,传感器类型
  ObjMovingStateP1: uint8  % 目标的运动状态(静止、运动...)
  ObjTypeP1: uint8  % 目标的类型（行人、小汽车、卡车...）
  ObjDYP1: single  % 车体坐标系下，自车和目标横向相对距离
  P1HeadingAngle: single  % 车体系下, 目标航向角

TOS_A2L_dop_P0P1_Pre_BUS = Simulink.Bus()
  TOS_dop_P0_P1_Pre_FusionType: boolean
  TOS_dop_P0_P1_Pre_FRSplitTarget: boolean
  TOS_dop_P0_P1_Pre_BoundaryFilt: boolean
  TOS_dop_P0_P1_Pre_ObjType: boolean
  TOS_dop_P0_P1_Pre_RoadEdge: boolean
  TOS_dop_P0_P1_dy_CutIn_Flag: boolean
  TOS_dop_P0_P1_DyConfirm: boolean
  TOS_dop_P0_P1_Parking_DyConfirm: boolean