% Simulink data dictionary PvtIfTOS_11_OutPort.sldd

C_TOS_OutPort_ACCP0_Target = Simulink.Parameter(0, DataType="uint8")
C_TOS_OutPort_ACCP1_Target = Simulink.Parameter(0, DataType="uint8")
C_TOS_OutPort_ACCP2_Target = Simulink.Parameter(0, DataType="uint8")
C_TOS_OutPort_ACCP3_Target = Simulink.Parameter(0, DataType="uint8")
C_TOS_OutPort_ACCP4_Target = Simulink.Parameter(0, DataType="uint8")
C_TOS_OutPort_ACCP5_Target = Simulink.Parameter(0, DataType="uint8")
C_TOS_OutPort_AEBJA_TargetSize_Val = Simulink.Parameter(32, DataType="uint8")
C_TOS_OutPort_AEBJunct_Target = Simulink.Parameter(0, DataType="uint8")
C_TOS_OutPort_AEBLat_Target = Simulink.Parameter(0, DataType="uint8")
C_TOS_OutPort_AEBLat_TargetSize_Val = Simulink.Parameter(10, DataType="uint8")
C_TOS_OutPort_AEBLong_Target = Simulink.Parameter(0, DataType="uint8")
C_TOS_OutPort_ELK_Target = Simulink.Parameter(0, DataType="uint8")
C_TOS_OutPort_LCKie_Target = Simulink.Parameter(0, DataType="uint8")
C_TOS_OutPort_LC_Target = Simulink.Parameter(0, DataType="uint8")
C_TOS_OutPort_NumberOfEffective_Targets = Simulink.Parameter(80, DataType="uint8")
C_TOS_OutPort_OFMObjIDInvilad_Val = Simulink.Parameter(0, DataType="uint8")

TOS_ACCP0_BUS_FB = Simulink.Bus()
  IDP0: uint8, Min=0, Max=255  % 目标P0的ID
  dxP0: single, Min=0, Max=210  % 自车和P0目标纵向相对距离
  vxRelP0: single, Min=-110, Max=55  % 自车和P0目标的纵向的相对速度
  ACCTgtObjVy: single  % Lateral relative speed of the ACCTarget objective with the ego vehicle
  axAbsGroundP0: single, Min=-21.592, Max=21.592  % P0目标对地的绝对加速度
  rangeP0: single, Min=0, Max=210  % 自车最前端和P0目标距离
  targetExistP0: boolean, Min=0, Max=1  % P0目标是否存在
  fu_typeP0: uint8  % 目标是否是融合,传感器类型
  ObjMovingStateP0: uint8  % 目标的运动状态(静止、运动...)
  Object_Orientation: uint8  % 目标的运动方向(同向、对向、横穿...)
  ObjTypeP0: uint8  % 目标的类型（行人、小汽车、卡车...）
  ObjDYP0: single  % 车体坐标系下，自车和目标横向相对距离
  ACCTgtObjObstcl: single  % ACCTarget objective are the possibility of obstacles
  ACCTgtObjAy: single  % Lateral ACCeleration of ACCTarget objective with ego vehicle；
  ACCTgtObjCntAlive: single  % Indicate the duration of the ACCTarget objective's existence；
  ACCTgtObjExist: single  % The possibility of ACCTarget objecttive existence
  P0HeadingAngle: single  % 车体系下, 目标航向角
  P0CutInflg: boolean, Min=0, Max=1  % P0目标是否为cutin

TOS_ACCP1_BUS_FB = Simulink.Bus()
  IDP1: uint8, Min=0, Max=255  % 目标P1的ID
  dxP1: single, Min=0, Max=210  % 自车和P1目标纵向相对距离
  vxRelP1: single, Min=-110, Max=55  % 自车和P1目标的纵向的相对速度
  axAbsGroundP1: single, Min=-21.592, Max=21.592  % 目标P1对地的绝对加速度
  rangeP1: single, Min=0, Max=210  % 自车最前端和目标P1距离
  targetExistP1: boolean  % P1目标是否存在
  fu_typeP1: uint8  % 目标是否是融合,传感器类型
  ObjMovingStateP1: uint8  % 目标的运动状态(静止、运动...)
  ObjTypeP1: uint8  % 目标的类型（行人、小汽车、卡车...）
  ObjDYP1: single  % 车体坐标系下，自车和目标横向相对距离
  P1HeadingAngle: single  % 车体系下, 目标航向角

TOS_ACCP2_BUS_FB = Simulink.Bus()
  IDP2: uint8, Min=0, Max=255  % 目标P2的ID
  dxP2: single, Min=0, Max=210  % 自车和P2目标纵向相对距离
  vxRelP2: single, Min=-110, Max=55  % 自车和P2目标的纵向的相对速度
  axAbsGroundP2: single, Min=-21.592, Max=21.592  % P2目标对地的绝对加速度
  rangeP2: single, Min=0, Max=210  % 自车最前端和P2目标距离
  targetExistP2: boolean  % P2目标是否存在
  fu_typeP2: uint8  % 目标是否是融合,传感器类型
  ObjMovingStateP2: uint8  % 目标的运动状态(静止、运动...)
  ObjTypeP2: uint8  % 目标的类型（行人、小汽车、卡车...）
  ObjDYP2: single  % 车体坐标系下，自车和目标横向相对距离
  P2CutinProb: single  % P2切入本车道的概率
  P2HeadingAngle: single  % 车体系下, 目标航向角

TOS_ACCP3_BUS_FB = Simulink.Bus()
  IDP3: uint8, Min=0, Max=255  % 目标P3的ID
  dxP3: single, Min=0, Max=210  % 自车和P3目标纵向相对距离
  vxRelP3: single, Min=-110, Max=55  % 自车和P3目标的纵向的相对速度
  axAbsGroundP3: single, Min=-21.592, Max=21.592  % P3目标对地的绝对加速度
  rangeP3: single, Min=0, Max=210  % 自车最前端和P3目标距离
  targetExistP3: boolean  % P3目标是否存在
  fu_typeP3: uint8  % 目标是否是融合,传感器类型
  ObjMovingStateP3: uint8  % 目标的运动状态(静止、运动...)
  ObjTypeP3: uint8  % 目标的类型（行人、小汽车、卡车...）
  ObjDYP3: single  % 车体坐标系下，自车和目标横向相对距离
  P3CutinProb: single  % P3切入本车道的概率
  P3HeadingAngle: single  % 车体系下, 目标航向角

TOS_ACCP4_BUS_FB = Simulink.Bus()
  dyP4: single  % P4车体坐标系下的横向距离
  dxP4: single  % P4车体坐标系下的纵向距离
  ObjTypeP4: uint8  % P4目标类别
  targetExistP4: boolean  % P4是否存在

TOS_ACCP5_BUS_FB = Simulink.Bus()
  dyP5: single  % P5车体坐标系下的横向距离
  dxP5: single  % P5车体坐标系下的纵向距离
  ObjTypeP5: uint8  % P5目标类别
  targetExistP5: boolean  % P5是否存在

TOS_ACC_Index_bus = Simulink.Bus()
  TOS_ACCP0_Index: uint8
  TOS_ACCP1_Index: uint8
  TOS_ACCP2_Index: uint8
  TOS_ACCP3_Index: uint8
  TOS_ACCP4_Index: uint8
  TOS_ACCP5_Index: uint8

TOS_AEB_Index_bus = Simulink.Bus()
  TOS_AEB_Long_Index: uint8
  TOS_AEB_Lat_Index: uint8[10]
  TOS_AEB_JA_Index: uint8[32]

TOS_AEB_JAOBJ_BUS_FB = Simulink.Bus()
  FusionType: uint8  % 目标是否是融合,传感器类型
  ObjectID: uint8  % 融合追踪处理后，目标的ID
  ObjectType: uint8  % 目标的类型（行人、小汽车、卡车...）
  ObjectTypeCameraConfirmed: boolean  % 目标类型经过摄像头确认标志位
  ObjectLength: single  % 目标的长度
  ObjectWidth: single  % 目标的宽度
  ObjectHight: single  % 目标的高度
  ObjectAzimuthAngle: single  % 车体系下, 目标方位角
  ObjectYawAngle: single  % 车体系下, 目标的航向角
  ObjectMovingState: uint8  % 目标的运动状态(静止、运动...)
  ObjectMovingOrientation: uint8  % 目标的运动方向(同向、对向、横穿...)
  dxFisrtDetection: single  % 首次探测到目标时自车和目标纵向相对距离
  dyFisrtDetection: single  % 首次探测到目标时自车和目标横向相对距离
  dx: single  % 车体坐标系下，自车和目标纵向相对距离
  dy: single  % 车体坐标系下，自车和目标横向相对距离
  dz: single  % 自车和目标垂向相对距离
  vx: single  % 自车和目标的纵向的相对速度
  vy: single  % 自车和目标的横向的相对速度
  ax: single  % 车和目标的  纵向的  相对加速度的方差
  ay: single  % 车和目标的  横向的  相对加速度的方差
  dxVariance: single  % 自车和目标  纵向  相对距离的方差
  dyVariance: single  % 自车和目标  横向  相对距离的方差
  vxVariance: single  % 车和目标的  纵向的  相对速度的方差
  vyVariance: single  % 车和目标的  横向的  相对速度的方差
  axVariance: single  % 自车和目标的纵向的相对加速度
  ayVariance: single  % 自车和目标的横向的相对加速度
  ObjectLengthVar: single  % 目标长度的方差
  ObjectWidthVar: single  % 目标宽度的方差
  ObjectYawAngleVar: single  % 目标的航向角的方差
  ObjectTypeProb: single  % 目标对应类型的概率值
  ObjectMovingStateProb: single  % 目标的运动状态对应的概率值
  ObjectMovingOrientationProb: single  % 目标的运动方向对应的概率值
  ObjectExistProb: single  % 目标存在的概率值
  ObjectIsObstacleProb: single  % 目标成为障碍物的概率值
  ObjectRCS: single  % 目标的反射能量
  ObjectMeasurementStatus: single  % 目标的测量状态
  ObjectLifeCycle: uint16  % 目标存在生命周期
  ObjUpdate: boolean, Min=0, Max=1  % 融合目标在本周期内是否更新（新添加AEB需求  2020/9/15）
  FR_ObjectID: uint8, Min=0, Max=255  % 前摄像头传感目标类型
  FR_ObjectType: uint8, Min=0, Max=15  % 前摄像头传感目标运动状态
  FR_ObjectMovingState: uint8, Min=0, Max=7  % 前摄像头传感目标运动朝向
  FR_ObjectMovingOrientation: uint8, Min=0, Max=7  % 前摄像头传感目标纵向距离
  FR_Dx: single, Min=0, Max=254.9375, Unit="m"  % 前摄像头传感目标横向距离
  FR_Dy: single, Min=-128, Max=127.875, Unit="m"  % 前摄像头传感目标纵向速度
  FR_Vx: single, Min=-128, Max=126.9976, Unit="m/s"  % 前摄像头传感目标横向速度
  FR_Vy: single, Min=-128, Max=126.9976, Unit="m/s"  % 前雷达传感目标ID
  FC_ObjectID: uint8, Min=0, Max=255  % 前雷达传感目标类型
  FC_ObjectType: uint8, Min=0, Max=8  % 前雷达传感目标运动状态
  FC_ObjectMovingState: uint8, Min=0, Max=5  % 前雷达传感目标运动朝向
  FC_ObjectMovingOrientation: uint8, Min=0, Max=13  % 前雷达传感目标纵向距离
  FC_Dx: single, Min=-200, Max=250, Unit="m"  % 前雷达传感目标横向距离
  FC_Dy: single, Min=-100, Max=100, Unit="m"  % 前雷达传感目标纵向速度
  FC_Vx: single, Min=-120, Max=130, Unit="m/s"  % 前雷达传感目标横向速度
  FC_Vy: single, Min=-50, Max=50, Unit="m/s"

TOS_AEB_LATOBJ_BUS_FB = Simulink.Bus()
  FusionType: uint8  % 目标是否是融合,传感器类型
  ObjectID: uint8  % 融合追踪处理后，目标的ID
  ObjectType: uint8  % 目标的类型（行人、小汽车、卡车...）
  ObjectTypeCameraConfirmed: boolean  % 目标类型经过摄像头确认标志位
  ObjectLength: single  % 目标的长度
  ObjectWidth: single  % 目标的宽度
  ObjectHight: single  % 目标的高度
  ObjectAzimuthAngle: single  % 车体系下, 目标方位角
  ObjectYawAngle: single  % 车体系下, 目标的航向角
  ObjectMovingState: uint8  % 目标的运动状态(静止、运动...)
  ObjectMovingOrientation: uint8  % 目标的运动方向(同向、对向、横穿...)
  dxFisrtDetection: single  % 首次探测到目标时自车和目标纵向相对距离
  dyFisrtDetection: single  % 首次探测到目标时自车和目标横向相对距离
  dx: single  % 车体坐标系下，自车和目标纵向相对距离
  dy: single  % 车体坐标系下，自车和目标横向相对距离
  dz: single  % 自车和目标垂向相对距离
  vx: single  % 自车和目标的纵向的相对速度
  vy: single  % 自车和目标的横向的相对速度
  ax: single  % 车和目标的  纵向的  相对加速度的方差
  ay: single  % 车和目标的  横向的  相对加速度的方差
  dxVariance: single  % 自车和目标  纵向  相对距离的方差
  dyVariance: single  % 自车和目标  横向  相对距离的方差
  vxVariance: single  % 车和目标的  纵向的  相对速度的方差
  vyVariance: single  % 车和目标的  横向的  相对速度的方差
  axVariance: single  % 自车和目标的纵向的相对加速度
  ayVariance: single  % 自车和目标的横向的相对加速度
  ObjectLengthVar: single  % 目标长度的方差
  ObjectWidthVar: single  % 目标宽度的方差
  ObjectYawAngleVar: single  % 目标的航向角的方差
  ObjectTypeProb: single  % 目标对应类型的概率值
  ObjectMovingStateProb: single  % 目标的运动状态对应的概率值
  ObjectMovingOrientationProb: single  % 目标的运动方向对应的概率值
  ObjectExistProb: single  % 目标存在的概率值
  ObjectIsObstacleProb: single  % 目标成为障碍物的概率值
  ObjectRCS: single  % 目标的反射能量
  ObjectMeasurementStatus: single  % 目标的测量状态
  ObjectLifeCycle: uint16  % 目标存在生命周期
  ObjUpdate: boolean, Min=0, Max=1  % 融合目标在本周期内是否更新（新添加AEB需求  2020/9/15）
  FR_ObjectID: uint8, Min=0, Max=255  % 前摄像头传感目标类型
  FR_ObjectType: uint8, Min=0, Max=15  % 前摄像头传感目标运动状态
  FR_ObjectMovingState: uint8, Min=0, Max=7  % 前摄像头传感目标运动朝向
  FR_ObjectMovingOrientation: uint8, Min=0, Max=7  % 前摄像头传感目标纵向距离
  FR_Dx: single, Min=0, Max=254.9375, Unit="m"  % 前摄像头传感目标横向距离
  FR_Dy: single, Min=-128, Max=127.875, Unit="m"  % 前摄像头传感目标纵向速度
  FR_Vx: single, Min=-128, Max=126.9976, Unit="m/s"  % 前摄像头传感目标横向速度
  FR_Vy: single, Min=-128, Max=126.9976, Unit="m/s"  % 前雷达传感目标ID
  FC_ObjectID: uint8, Min=0, Max=255  % 前雷达传感目标类型
  FC_ObjectType: uint8, Min=0, Max=8  % 前雷达传感目标运动状态
  FC_ObjectMovingState: uint8, Min=0, Max=5  % 前雷达传感目标运动朝向
  FC_ObjectMovingOrientation: uint8, Min=0, Max=13  % 前雷达传感目标纵向距离
  FC_Dx: single, Min=-200, Max=250, Unit="m"  % 前雷达传感目标横向距离
  FC_Dy: single, Min=-100, Max=100, Unit="m"  % 前雷达传感目标纵向速度
  FC_Vx: single, Min=-120, Max=130, Unit="m/s"  % 前雷达传感目标横向速度
  FC_Vy: single, Min=-50, Max=50, Unit="m/s"

TOS_AEB_LONOBJ_BUS_FB = Simulink.Bus()
  FusionType: uint8  % 目标是否是融合,传感器类型
  ObjectID: uint8  % 融合追踪处理后，目标的ID
  ObjectType: uint8  % 目标的类型（行人、小汽车、卡车...）
  ObjectTypeCameraConfirmed: boolean  % 目标类型经过摄像头确认标志位
  ObjectLength: single  % 目标的长度
  ObjectWidth: single  % 目标的宽度
  ObjectHight: single  % 目标的高度
  ObjectAzimuthAngle: single  % 车体系下, 目标方位角
  ObjectYawAngle: single  % 车体系下, 目标的航向角
  ObjectMovingState: uint8  % 目标的运动状态(静止、运动...)
  ObjectMovingOrientation: uint8  % 目标的运动方向(同向、对向、横穿...)
  dxFisrtDetection: single  % 首次探测到目标时自车和目标纵向相对距离
  dyFisrtDetection: single  % 首次探测到目标时自车和目标横向相对距离
  dx: single  % 车体坐标系下，自车和目标纵向相对距离
  dy: single  % 车体坐标系下，自车和目标横向相对距离
  dz: single  % 自车和目标垂向相对距离
  vx: single  % 自车和目标的纵向的相对速度
  vy: single  % 自车和目标的横向的相对速度
  ax: single  % 车和目标的  纵向的  相对加速度的方差
  ay: single  % 车和目标的  横向的  相对加速度的方差
  dxVariance: single  % 自车和目标  纵向  相对距离的方差
  dyVariance: single  % 自车和目标  横向  相对距离的方差
  vxVariance: single  % 车和目标的  纵向的  相对速度的方差
  vyVariance: single  % 车和目标的  横向的  相对速度的方差
  axVariance: single  % 自车和目标的纵向的相对加速度
  ayVariance: single  % 自车和目标的横向的相对加速度
  ObjectLengthVar: single  % 目标长度的方差
  ObjectWidthVar: single  % 目标宽度的方差
  ObjectYawAngleVar: single  % 目标的航向角的方差
  ObjectTypeProb: single  % 目标对应类型的概率值
  ObjectMovingStateProb: single  % 目标的运动状态对应的概率值
  ObjectMovingOrientationProb: single  % 目标的运动方向对应的概率值
  ObjectExistProb: single  % 目标存在的概率值
  ObjectIsObstacleProb: single  % 目标成为障碍物的概率值
  ObjectRCS: single  % 目标的反射能量
  ObjectMeasurementStatus: single  % 目标的测量状态
  ObjectLifeCycle: uint16  % 目标存在生命周期
  dyObject2Center: single  % 目标中心线距中间车道中心线距离
  dyEgo2Center: single  % 自车中心线距中间车道中心线距离
  ObjUpdate: boolean, Min=0, Max=1  % 融合目标在本周期内是否更新（新添加AEB需求  2020/9/15）
  FR_ObjectID: uint8, Min=0, Max=255  % 前摄像头传感目标类型
  FR_ObjectType: uint8, Min=0, Max=15  % 前摄像头传感目标运动状态
  FR_ObjectMovingState: uint8, Min=0, Max=7  % 前摄像头传感目标运动朝向
  FR_ObjectMovingOrientation: uint8, Min=0, Max=7  % 前摄像头传感目标纵向距离
  FR_Dx: single, Min=0, Max=254.9375, Unit="m"  % 前摄像头传感目标横向距离
  FR_Dy: single, Min=-128, Max=127.875, Unit="m"  % 前摄像头传感目标纵向速度
  FR_Vx: single, Min=-128, Max=126.9976, Unit="m/s"  % 前摄像头传感目标横向速度
  FR_Vy: single, Min=-128, Max=126.9976, Unit="m/s"  % 前雷达传感目标ID
  FC_ObjectID: uint8, Min=0, Max=255  % 前雷达传感目标类型
  FC_ObjectType: uint8, Min=0, Max=8  % 前雷达传感目标运动状态
  FC_ObjectMovingState: uint8, Min=0, Max=5  % 前雷达传感目标运动朝向
  FC_ObjectMovingOrientation: uint8, Min=0, Max=13  % 前雷达传感目标纵向距离
  FC_Dx: single, Min=-200, Max=250, Unit="m"  % 前雷达传感目标横向距离
  FC_Dy: single, Min=-100, Max=100, Unit="m"  % 前雷达传感目标纵向速度
  FC_Vx: single, Min=-120, Max=130, Unit="m/s"  % 前雷达传感目标横向速度
  FC_Vy: single, Min=-50, Max=50, Unit="m/s"

TOS_ELK_BUS_FB = Simulink.Bus()
  Object_Fus_Type: uint8[8]  % 目标是否是融合,传感器类型
  Object_ID: uint8[8]  % 融合追踪处理后，目标的ID
  Object_Type: uint8[8]  % 目标的类型（行人、小汽车、卡车...）
  Object_Length: single[8]  % 目标的长度
  Object_Width: single[8]  % 目标的宽度
  Object_Hight: single[8]  % 目标的高度
  Object_HeadingAngle: single[8]  % 车体系下, 目标航向角
  Object_YawAngle: single[8]  % 车体系下, 目标的方位角
  Object_MovingState: uint8[8]  % 目标的运动状态(静止、运动...)
  Object_Orientation: uint8[8]  % 目标的运动方向(同向、对向、横穿...)
  Object_DX: single[8]  % 车体坐标系下，自车和目标纵向相对距离
  Object_DY: single[8]  % 车体坐标系下，自车和目标横向相对距离
  Object_VX: single[8]  % 目标的  纵向的  速度
  Object_VY: single[8]  % 目标的  横向的  速度
  Object_Std_AX: single[8]  % 目标的  纵向的  加速度的方差
  Object_Std_AY: single[8]  % 目标的  横向的  加速度的方差
  Object_Std_DX: single[8]  % 目标的  纵向的  距离的方差
  Object_Std_DY: single[8]  % 目标的  横向的  距离的方差
  Object_Std_VX: single[8]  % 目标的  纵向的  速度的方差
  Object_Std_VY: single[8]  % 目标的  横向的  速度的方差
  Object_AX: single[8]  % 目标的  纵向的  加速度
  Object_AY: single[8]  % 目标的  横向的  加速度
  Object_Std_Length: single[8]  % 目标长度的方差
  Object_Std_Width: single[8]  % 目标宽度的方差
  Object_Std_HeadingAngle: single[8]  % 目标的航向角的方差
  Object_Type_Prob: single[8]  % 目标对应类型的概率值
  Object_ExistProb: single[8]  % 目标存在的概率值
  Object_ObstacleProb: single[8]  % 目标成为障碍物的概率值
  Object_Age: single[8]  % 目标存在生命周期
  CurrentLane_Prob: single[8]  % 目标在本车道概率值（添加20200910）
  LeftLane_Prob: single[8]  % 目标在本左道概率值（添加20200910）
  RightLane_Prob: single[8]  % 目标在本右道概率值（添加20200910）
  ObjectIn_Lane: uint8[8]  % 目标所在车道标志位

TOS_HWA_Index_bus = Simulink.Bus()
  TOS_ELK_Index: uint8[11]
  TOS_LCKie_Index: uint8[11]
  TOS_LC_Index: uint8[11]
  TOS_ObjIn_Lane_b: uint8[11]

TOS_LCKIE_BUS_FB = Simulink.Bus()
  Object_Fus_Type: uint8[9]  % 目标是否是融合,传感器类型
  Object_ID: uint8[9]  % 融合追踪处理后，目标的ID
  Object_Type: uint8[9]  % 目标的类型（行人、小汽车、卡车...）
  Object_Length: single[9]  % 目标的长度
  Object_Width: single[9]  % 目标的宽度
  Object_Hight: single[9]  % 目标的高度
  Object_HeadingAngle: single[9]  % 车体系下, 目标航向角
  Object_YawAngle: single[9]  % 车体系下, 目标的方位角
  Object_MovingState: uint8[9]  % 目标的运动状态(静止、运动...)
  Object_Orientation: uint8[9]  % 目标的运动方向(同向、对向、横穿...)
  Object_DX: single[9]  % 车体坐标系下，自车和目标纵向相对距离
  Object_DY: single[9]  % 车体坐标系下，自车和目标横向相对距离
  Object_VX: single[9]  % 目标的  纵向的  速度
  Object_VY: single[9]  % 目标的  横向的  速度
  Object_Std_AX: single[9]  % 目标的  纵向的  加速度的方差
  Object_Std_AY: single[9]  % 目标的  横向的  加速度的方差
  Object_Std_DX: single[9]  % 目标的  纵向的  距离的方差
  Object_Std_DY: single[9]  % 目标的  横向的  距离的方差
  Object_Std_VX: single[9]  % 目标的  纵向的  速度的方差
  Object_Std_VY: single[9]  % 目标的  横向的  速度的方差
  Object_AX: single[9]  % 目标的  纵向的  加速度
  Object_AY: single[9]  % 目标的  横向的  加速度
  Object_Std_Length: single[9]  % 目标长度的方差
  Object_Std_Width: single[9]  % 目标宽度的方差
  Object_Std_HeadingAngle: single[9]  % 目标的航向角的方差
  Object_Type_Prob: single[9]  % 目标对应类型的概率值
  Object_ExistProb: single[9]  % 目标存在的概率值
  Object_ObstacleProb: single[9]  % 目标成为障碍物的概率值
  Object_Age: single[9]  % 目标存在生命周期
  cutIn: uint8[9]  % 目标是否有切入本车道趋势，标志位
  CurrentLane_Prob: single[9]  % 目标在本车道概率值（添加20200910）
  LeftLane_Prob: single[9]  % 目标在本左道概率值（添加20200910）
  RightLane_Prob: single[9]  % 目标在本右道概率值（添加20200910）
  ObjectIn_Lane: uint8[9]  % 目标所在车道标志位

TOS_LC_BUS_FB = Simulink.Bus()
  Object_Fus_Type: uint8[11]  % 目标是否是融合,传感器类型
  Object_ID: uint8[11]  % 融合追踪处理后，目标的ID
  Object_Type: uint8[11]  % 目标的类型（行人、小汽车、卡车...）
  Object_Length: single[11]  % 目标的长度
  Object_Width: single[11]  % 目标的宽度
  Object_Hight: single[11]  % 目标的高度
  Object_HeadingAngle: single[11]  % 车体系下, 目标航向角
  Object_YawAngle: single[11]  % 车体系下, 目标的方位角
  Object_MovingState: uint8[11]  % 目标的运动状态(静止、运动...)
  Object_Orientation: uint8[11]  % 目标的运动方向(同向、对向、横穿...)
  Object_DX: single[11]  % 车体坐标系下，自车和目标纵向相对距离
  Object_DY: single[11]  % 车体坐标系下，自车和目标横向相对距离
  Object_VX: single[11]  % 目标的  纵向的  速度
  Object_VY: single[11]  % 目标的  横向的  速度
  Object_Std_AX: single[11]  % 目标的  纵向的  加速度的方差
  Object_Std_AY: single[11]  % 目标的  横向的  加速度的方差
  Object_Std_DX: single[11]  % 目标的  纵向的  距离的方差
  Object_Std_DY: single[11]  % 目标的  横向的  距离的方差
  Object_Std_VX: single[11]  % 目标的  纵向的  速度的方差
  Object_Std_VY: single[11]  % 目标的  横向的  速度的方差
  Object_AX: single[11]  % 目标的  纵向的  加速度
  Object_AY: single[11]  % 目标的  横向的  加速度
  Object_Std_Length: single[11]  % 目标长度的方差
  Object_Std_Width: single[11]  % 目标宽度的方差
  Object_Std_HeadingAngle: single[11]  % 目标的航向角的方差
  Object_Type_Prob: single[11]  % 目标对应类型的概率值
  Object_ExistProb: single[11]  % 目标存在的概率值
  Object_ObstacleProb: single[11]  % 目标成为障碍物的概率值
  Object_Age: single[11]  % 目标存在生命周期
  CurrentLane_Prob: single[11]  % 目标在本车道概率值（添加20200910）
  LeftLane_Prob: single[11]  % 目标在本左道概率值（添加20200910）
  RightLane_Prob: single[11]  % 目标在本右道概率值（添加20200910）
  ObjectIn_Lane: uint8[11]  % 目标所在车道标志位

TOS_OutPut_FB_BUS = Simulink.Bus()
  TOS_ACCP0: Bus: TOS_ACCP0_BUS_FB
  TOS_ACCP1: Bus: TOS_ACCP1_BUS_FB
  TOS_ACCP2: Bus: TOS_ACCP2_BUS_FB
  TOS_ACCP3: Bus: TOS_ACCP3_BUS_FB
  TOS_ACCP4: Bus: TOS_ACCP4_BUS_FB
  TOS_ACCP5: Bus: TOS_ACCP5_BUS_FB
  TOS_ELK: Bus: TOS_ELK_BUS_FB
  TOS_LCKIE: Bus: TOS_LCKIE_BUS_FB
  TOS_LC: Bus: TOS_LC_BUS_FB
  TOS_AEB_LONOBJ: Bus: TOS_AEB_LONOBJ_BUS_FB
  TOS_AEB_LATOBJ: Bus: TOS_AEB_LATOBJ_BUS_FB[10]
  TOS_AEB_JAOBJ: Bus: TOS_AEB_JAOBJ_BUS_FB[32]
  TOS_UpdateCnt: uint32
  TOS_P0_TARGET_LINE: Bus: TOS_P0_TARGET_LINE_BUS_FB

TOS_P0_TARGET_LINE_BUS_FB = Simulink.Bus()
  OTL_Valid: boolean
  OTL_C3: single
  OTL_C2: single
  OTL_C1: single
  OTL_C0: single
  OTL_Range: single
  OTL_Cnt: uint8

TOS_A2L_AEB_Junc_bus = Simulink.Bus()
  FusionType: uint8  % 目标是否是融合,传感器类型
  ObjectID: uint8  % 融合追踪处理后，目标的ID
  ObjectType: uint8  % 目标的类型（行人、小汽车、卡车...）
  ObjectYawAngle: single  % 车体系下, 目标的航向角
  ObjectMovingState: uint8  % 目标的运动状态(静止、运动...)
  ObjectMovingOrientation: uint8  % 目标的运动方向(同向、对向、横穿...)
  dx: single  % 车体坐标系下，自车和目标纵向相对距离
  dy: single  % 车体坐标系下，自车和目标横向相对距离
  vx: single  % 自车和目标的纵向的相对速度
  vy: single  % 自车和目标的横向的相对速度
  ax: single  % 车和目标的  纵向的  相对加速度的方差
  FR_ObjectID: uint8  % 前摄像头传感目标类型
  FC_ObjectID: uint8  % 前雷达传感目标类型

TOS_A2L_AEB_Lat_bus = Simulink.Bus()
  FusionType: uint8  % 目标是否是融合,传感器类型
  ObjectID: uint8  % 融合追踪处理后，目标的ID
  ObjectType: uint8  % 目标的类型（行人、小汽车、卡车...）
  ObjectYawAngle: single  % 车体系下, 目标的航向角
  ObjectMovingState: uint8  % 目标的运动状态(静止、运动...)
  ObjectMovingOrientation: uint8  % 目标的运动方向(同向、对向、横穿...)
  dx: single  % 车体坐标系下，自车和目标纵向相对距离
  dy: single  % 车体坐标系下，自车和目标横向相对距离
  vx: single  % 自车和目标的纵向的相对速度
  vy: single  % 自车和目标的横向的相对速度
  ax: single  % 车和目标的  纵向的  相对加速度的方差
  FR_ObjectID: uint8  % 前摄像头传感目标类型
  FR_ObjectType: uint8  % 前摄像头传感目标运动状态
  FR_ObjectMovingState: uint8  % 前摄像头传感目标运动朝向
  FR_ObjectMovingOrientation: uint8  % 前摄像头传感目标纵向距离
  FR_Dx: single  % 前摄像头传感目标横向距离
  FR_Dy: single  % 前摄像头传感目标纵向速度
  FR_Vx: single  % 前摄像头传感目标横向速度
  FR_Vy: single  % 前雷达传感目标ID
  FC_ObjectID: uint8  % 前雷达传感目标类型
  FC_ObjectType: uint8  % 前雷达传感目标运动状态
  FC_ObjectMovingState: uint8  % 前雷达传感目标运动朝向
  FC_ObjectMovingOrientation: uint8  % 前雷达传感目标纵向距离
  FC_Dx: single  % 前雷达传感目标横向距离
  FC_Dy: single  % 前雷达传感目标纵向速度
  FC_Vx: single  % 前雷达传感目标横向速度
  FC_Vy: single

TOS_A2L_AEB_Long_bus = Simulink.Bus()
  FusionType: uint8  % 目标是否是融合,传感器类型
  ObjectID: uint8  % 融合追踪处理后，目标的ID
  ObjectType: uint8  % 目标的类型（行人、小汽车、卡车...）
  ObjectYawAngle: single  % 车体系下, 目标的航向角
  ObjectMovingState: uint8  % 目标的运动状态(静止、运动...)
  ObjectMovingOrientation: uint8  % 目标的运动方向(同向、对向、横穿...)
  dx: single  % 车体坐标系下，自车和目标纵向相对距离
  dy: single  % 车体坐标系下，自车和目标横向相对距离
  vx: single  % 自车和目标的纵向的相对速度
  vy: single  % 自车和目标的横向的相对速度
  ax: single  % 车和目标的  纵向的  相对加速度的方差
  dxVariance: single
  ObjectTypeProb: single
  FR_ObjectID: uint8  % 前摄像头传感目标类型
  FR_ObjectType: uint8  % 前摄像头传感目标运动状态
  FR_ObjectMovingState: uint8  % 前摄像头传感目标运动朝向
  FR_ObjectMovingOrientation: uint8  % 前摄像头传感目标纵向距离
  FR_Dx: single  % 前摄像头传感目标横向距离
  FR_Dy: single  % 前摄像头传感目标纵向速度
  FR_Vx: single  % 前摄像头传感目标横向速度
  FR_Vy: single  % 前雷达传感目标ID
  FC_ObjectID: uint8  % 前雷达传感目标类型
  FC_ObjectType: uint8  % 前雷达传感目标运动状态
  FC_ObjectMovingState: uint8  % 前雷达传感目标运动朝向
  FC_ObjectMovingOrientation: uint8  % 前雷达传感目标纵向距离
  FC_Dx: single  % 前雷达传感目标横向距离
  FC_Dy: single  % 前雷达传感目标纵向速度
  FC_Vx: single  % 前雷达传感目标横向速度
  FC_Vy: single

TOS_A2L_ELK_bus = Simulink.Bus()
  Object_Fus_Type: uint8  % 目标是否是融合,传感器类型
  Object_ID: uint8  % 融合追踪处理后，目标的ID
  Object_Type: uint8  % 目标的类型（行人、小汽车、卡车...）
  Object_Width: single  % 目标的宽度
  Object_MovingState: uint8  % 目标的运动状态(静止、运动...)
  Object_DX: single  % 车体坐标系下，自车和目标纵向相对距离
  Object_DY: single  % 车体坐标系下，自车和目标横向相对距离
  Object_VX: single  % 目标的  纵向的  速度
  Object_VY: single  % 目标的  横向的  速度
  Object_Std_Width: single  % 目标的航向角的方差
  Object_Age: single  % 目标存在生命周期

TOS_A2L_LCKie_bus = Simulink.Bus()
  Object_Fus_Type: uint8  % 目标是否是融合,传感器类型
  Object_ID: uint8  % 融合追踪处理后，目标的ID
  Object_Type: uint8  % 目标的类型（行人、小汽车、卡车...）
  Object_Width: single  % 目标的宽度
  Object_MovingState: uint8  % 目标的运动状态(静止、运动...)
  Object_DX: single  % 车体坐标系下，自车和目标纵向相对距离
  Object_DY: single  % 车体坐标系下，自车和目标横向相对距离
  Object_VX: single  % 目标的  纵向的  速度
  Object_VY: single  % 目标的  横向的  速度
  Object_Std_Width: single  % 目标的航向角的方差
  Object_Age: single  % 目标存在生命周期

TOS_A2L_LC_bus = Simulink.Bus()
  Object_Fus_Type: uint8  % 目标是否是融合,传感器类型
  Object_ID: uint8  % 融合追踪处理后，目标的ID
  Object_Type: uint8  % 目标的类型（行人、小汽车、卡车...）
  Object_Width: single  % 目标的宽度
  Object_MovingState: uint8  % 目标的运动状态(静止、运动...)
  Object_DX: single  % 车体坐标系下，自车和目标纵向相对距离
  Object_DY: single  % 车体坐标系下，自车和目标横向相对距离
  Object_VX: single  % 目标的  纵向的  速度
  Object_VY: single  % 目标的  横向的  速度
  Object_Std_Width: single  % 目标的航向角的方差
  Object_Age: single  % 目标存在生命周期