% Simulink data dictionary PvtIfTOS_1_Port.sldd

TOS_EHRV2_SignalVerification_bus = Simulink.Bus()
  TOS_EHRV2_HDR: uint8
  TOS_EHRV2_ROAD_ROI: Bus: TOS_EHRV2_ROAD_ROI_BUS
  TOS_EHRV2_ROAD_INFO: Bus: TOS_EHRV2_ROAD_INFO_BUS
  TOS_EHRV2_NAV_INFO: Bus: TOS_EHRV2_NAV_INFO_BUS
  TOS_EHRV2_DYNAMIC_INFO: Bus: TOS_EHRV2_DYNAMIC_INFO_BUS

TOS_EHRV3_SignalVerification_bus = Simulink.Bus()
  TOS_EHRV3_HDR: Bus: TOS_EHRV3_HDR_BUS
  TOS_EHRV3_Intersec_Info: Bus: TOS_EHRV3_Intersec_BUS

TOS_LM_EML_FusRatio_bus = Simulink.Bus()
  LM_EML_01_Fus_Ratio: single
  LM_EML_02_Fus_Ratio: single
  LM_EML_03_Fus_Ratio: single

TOS_LM_FusRatio_SignalVerification_bus = Simulink.Bus()
  TOS_LM_VSL_Fus_Ratio: Bus: TOS_LM_VSL_FusRatio_bus
  TOS_LM_EML_Fus_Ratio: Bus: TOS_LM_EML_FusRatio_bus
  TOS_LM_OTL_Fus_Ratio: Bus: TOS_LM_OTL_FusRatio_bus
  TOS_LM_MAL_Fus_Ratio: Bus: TOS_LM_MAL_FusRatio_bus
  TOS_LM_REL_Fus_Ratio: Bus: TOS_LM_REL_FusRatio_bus

TOS_LM_MAL_FusRatio_bus = Simulink.Bus()
  LM_MAL_01_Fus_Ratio: single
  LM_MAL_02_Fus_Ratio: single
  LM_MAL_03_Fus_Ratio: single

TOS_LM_OTL_FusRatio_bus = Simulink.Bus()
  LM_OTL_01_Fus_Ratio: single
  LM_OTL_02_Fus_Ratio: single
  LM_OTL_03_Fus_Ratio: single

TOS_LM_REL_FusRatio_bus = Simulink.Bus()
  LM_REL_01_Fus_Ratio: single
  LM_REL_02_Fus_Ratio: single
  LM_REL_03_Fus_Ratio: single

TOS_LM_SignalVerification_bus = Simulink.Bus()
  TOS_LM_LL_Bus: Bus: TOS_LM_LL_Line_bus
  TOS_LM_LR_Bus: Bus: TOS_LM_LR_Line_bus
  TOS_LM_RL_Bus: Bus: TOS_LM_RL_Line_bus
  TOS_LM_RR_Bus: Bus: TOS_LM_RR_Line_bus
  TOS_PP_LM_SpecialRoadType: uint8
  TOS_PP_LM_RoadNumChg: uint8
  TOS_PP_LM_DrivInWLflg: uint8

TOS_LM_VSL_FusRatio_bus = Simulink.Bus()
  LM_VSL_01_Fus_Ratio: single
  LM_VSL_02_Fus_Ratio: single
  LM_VSL_03_Fus_Ratio: single

TOS_OFM_SignalVerification_bus = Simulink.Bus()
  Object_Fus_Type: uint8[80]  % 目标是否是融合,传感器类型，FC代表摄像头；FR代表前雷达；CL代表左角雷达；CR代表右角雷达；BL代表左盲点雷达；BR代表右盲点雷达；
  Object_ID: uint8[80], Min=1, Max=80  % 融合追踪处理后，目标的ID
  Object_Type: uint8[80]  % 目标的类型（行人、小汽车、卡车...）
  Object_Length: single[80], Min=1.2, Max=21, Unit="m"  % 目标的长度
  Object_Width: single[80], Min=0.04, Max=2.98, Unit="m"  % 目标的宽度
  Object_Hight: single[80], Min=0.01, Max=2.95, Unit="m"  % 目标的高度
  Object_HeadingAngle: single[80], Min=-180, Max=180, Unit="deg"  % 车体系下, 目标航向角
  Object_YawAngle: single[80], Min=-180, Max=180, Unit="deg"  % 车体系下, 目标的方位角
  Object_MovingState: uint8[80]  % 目标的运动状态(静止、运动...)
  Object_Orientation: uint8[80]  % 目标的运动方向(同向、对向、横穿...)
  Object_DX: single[80], Min=-80, Max=200, Unit="m"  % 车体坐标系下，自车和目标纵向相对距离
  Object_DY: single[80], Min=-100, Max=100, Unit="m"  % 车体坐标系下，自车和目标横向相对距离
  Object_VX: single[80], Min=-120, Max=130, Unit="m/s"  % 目标的  纵向的  速度
  Object_VY: single[80], Min=-50, Max=50, Unit="m/s"  % 目标的  横向的  速度
  Object_Std_AX: single[80], Min=0, Max=7.3  % 目标的  纵向的  加速度的方差
  Object_Std_AY: single[80], Min=0, Max=7.3  % 目标的  横向的  加速度的方差
  Object_Std_DX: single[80], Min=0, Max=250  % 目标的  纵向的  距离的方差
  Object_Std_DY: single[80], Min=0, Max=100  % 目标的  横向的  距离的方差
  Object_Std_VX: single[80], Min=0, Max=130  % 目标的  纵向的  速度的方差
  Object_Std_VY: single[80], Min=0, Max=50  % 目标的  横向的  速度的方差
  Object_AX: single[80], Min=-10.3, Max=7.3, Unit="m/s^2"  % 目标的  纵向的  加速度
  Object_AY: single[80], Min=-10.3, Max=7.3, Unit="m/s^2"  % 目标的  横向的  加速度
  Object_Std_Length: single[80], Min=0, Max=10  % 目标长度的方差
  Object_Std_Width: single[80], Min=0, Max=2  % 目标宽度的方差
  Object_Std_HeadingAngle: single[80], Min=0, Max=3.14  % 目标的航向角的方差
  Object_Type_Prob: single[80], Min=0, Max=1  % 目标对应类型的概率值
  Object_ExistProb: single[80], Min=0, Max=1  % 目标存在的概率值
  Object_ObstacleProb: single[80], Min=0, Max=1  % 目标成为障碍物的概率值
  Object_Age: uint16[80], Min=0, Max=65535  % 目标存在生命周期
  Object_State: uint8[80]  % 前摄像头传感目标ID
  FR_ObjectID: uint8[80], Min=0, Max=255  % 前摄像头传感目标类型
  FR_ObjectType: uint8[80], Min=0, Max=15  % 前摄像头传感目标运动状态
  FR_ObjectMovingState: uint8[80], Min=0, Max=7  % 前摄像头传感目标运动朝向
  FR_ObjectMovingOrientation: uint8[80], Min=0, Max=7  % 前摄像头传感目标纵向距离
  FR_Dx: single[80], Min=0, Max=254.9375, Unit="m"  % 前摄像头传感目标横向距离
  FR_Dy: single[80], Min=-128, Max=127.875, Unit="m"  % 前摄像头传感目标纵向速度
  FR_Vx: single[80], Min=-128, Max=126.9976, Unit="m/s"  % 前摄像头传感目标横向速度
  FR_Vy: single[80], Min=-128, Max=126.9976, Unit="m/s"  % 前雷达传感目标ID
  FC_ObjectID: uint8[80], Min=0, Max=255  % 前雷达传感目标类型
  FC_ObjectType: uint8[80], Min=0, Max=8  % 前雷达传感目标运动状态
  FC_ObjectMovingState: uint8[80], Min=0, Max=5  % 前雷达传感目标运动朝向
  FC_ObjectMovingOrientation: uint8[80], Min=0, Max=13  % 前雷达传感目标纵向距离
  FC_Dx: single[80], Min=-200, Max=250, Unit="m"  % 前雷达传感目标横向距离
  FC_Dy: single[80], Min=-100, Max=100, Unit="m"  % 前雷达传感目标纵向速度
  FC_Vx: single[80], Min=-120, Max=130, Unit="m/s"  % 前雷达传感目标横向速度
  FC_Vy: single[80], Min=-50, Max=50, Unit="m/s"

TOS_VCAN_SignalVerification_bus = Simulink.Bus()
  SteerWheelAngSign: boolean
  SteerWheelAng: single
  SteerWheelSpd: single

TOS_VIE_SignalVerification_bus = Simulink.Bus()
  vxvRefMs: single
  psiDtOpt: single
  kapTraj: single
  axvRefMs2: single

TOS_VSM_SignalVerification_bus = Simulink.Bus()
  TOS_VSM_LAT_CTRL: Bus: TOS_VSM_LAT_CTRL_BUS
  TOS_VSM_HMI: Bus: TOS_VSM_HMI_BUS

TOS_EHRV2_DYNAMIC_INFO_BUS = Simulink.Bus()
  TOS_EHRV2_TrafficJamFlag: uint8
  TOS_EHRV2_TrafficJamDis: uint16
  TOS_EHRV2_TrafficEventFlag: uint8
  TOS_EHRV2_TrafficEventDis: uint16
  TOS_EHRV2_TrafficJamHoldDis: uint16
  TOS_EHRV2_RepairRoadDis: uint16
  TOS_EHRV2_CtrlPointDis: uint16
  TOS_EHRV2_CityAreaFlag: uint8
  TOS_EHRV2_CmplxInsctDis: uint16
  TOS_EHRV2_Countrycode: uint16

TOS_EHRV2_NAV_INFO_BUS = Simulink.Bus()
  TOS_EHRV2_Stub_Type: uint8
  TOS_EHRV2_Stub_Dis: uint16
  TOS_EHRV2_Stub_Dir: uint8
  TOS_EHRV2_Stub_DrivType: uint8
  TOS_EHRV2_Merge_Type: uint8
  TOS_EHRV2_Merge_Dis: uint16
  TOS_EHRV2_Merge_Dir: uint8
  TOS_EHRV2_Merge_DrivType: uint8
  TOS_EHRV2_OnNavPath: uint8

TOS_EHRV2_ROAD_INFO_BUS = Simulink.Bus()
  TOS_EHRV2_RoadClass: uint8
  TOS_EHRV2_DrivMainWay: uint8
  TOS_EHRV2_DrivLaneNum: uint8
  TOS_EHRV2_RoadSlope: single
  TOS_EHRV2_RoadSlopeDis: single
  TOS_EHRV2_IntersectionDis: uint16

TOS_EHRV2_ROAD_ROI_BUS = Simulink.Bus()
  TOS_EHRV2_BoothFlag: uint8
  TOS_EHRV2_BoothDis: uint16
  TOS_EHRV2_BridgeFlag: uint8
  TOS_EHRV2_BridgeDis: uint16
  TOS_EHRV2_TunnelFlag: uint8
  TOS_EHRV2_Tunnel_Dis: uint16
  TOS_EHRV2_ServiceFlag: uint8
  TOS_EHRV2_ServiceDis: uint16

TOS_EHRV3_HDR_BUS = Simulink.Bus()
  TOS_EHRV3_Valid: uint8

TOS_EHRV3_Intersec_BUS = Simulink.Bus()
  TOS_EHRV3_IntersecType: uint8
  TOS_EHRV3_IntersecDis: single
  TOS_EHRV3_IntersecValid: uint8

TOS_LM_LL_Line_bus = Simulink.Bus()
  LM_LL_Line01: Bus: TOS_LM_Line_bus
  LM_LL_Line02: Bus: TOS_LM_Line_bus
  LM_LL_Line03: Bus: TOS_LM_Line_bus
  LM_LL_Line04: Bus: TOS_LM_Line_bus
  LM_LL_Line05: Bus: TOS_LM_Line_bus
  LM_LL_Line06: Bus: TOS_LM_Line_bus
  LM_LL_Line07: Bus: TOS_LM_Line_bus
  LM_LL_Line08: Bus: TOS_LM_Line_bus

TOS_LM_LR_Line_bus = Simulink.Bus()
  LM_LR_Line01: Bus: TOS_LM_Line_bus
  LM_LR_Line02: Bus: TOS_LM_Line_bus
  LM_LR_Line03: Bus: TOS_LM_Line_bus
  LM_LR_Line04: Bus: TOS_LM_Line_bus
  LM_LR_Line05: Bus: TOS_LM_Line_bus
  LM_LR_Line06: Bus: TOS_LM_Line_bus
  LM_LR_Line07: Bus: TOS_LM_Line_bus
  LM_LR_Line08: Bus: TOS_LM_Line_bus

TOS_LM_Line_bus = Simulink.Bus()
  pC0: single
  pC1: single
  pC2: single
  pC3: single
  dDisStart: single
  dDisEnd: single
  dQuality: single
  fCamValid: uint8

TOS_LM_RL_Line_bus = Simulink.Bus()
  LM_RL_Line01: Bus: TOS_LM_Line_bus
  LM_RL_Line02: Bus: TOS_LM_Line_bus
  LM_RL_Line03: Bus: TOS_LM_Line_bus
  LM_RL_Line04: Bus: TOS_LM_Line_bus
  LM_RL_Line05: Bus: TOS_LM_Line_bus
  LM_RL_Line06: Bus: TOS_LM_Line_bus
  LM_RL_Line07: Bus: TOS_LM_Line_bus
  LM_RL_Line08: Bus: TOS_LM_Line_bus

TOS_LM_RR_Line_bus = Simulink.Bus()
  LM_RR_Line01: Bus: TOS_LM_Line_bus
  LM_RR_Line02: Bus: TOS_LM_Line_bus
  LM_RR_Line03: Bus: TOS_LM_Line_bus
  LM_RR_Line04: Bus: TOS_LM_Line_bus
  LM_RR_Line05: Bus: TOS_LM_Line_bus
  LM_RR_Line06: Bus: TOS_LM_Line_bus
  LM_RR_Line07: Bus: TOS_LM_Line_bus
  LM_RR_Line08: Bus: TOS_LM_Line_bus

TOS_RFM_Entry_CenterLine_bus = Simulink.Bus()
  TOS_RFM_Entry_CenterLine_Valid: uint8
  TOS_RFM_Entry_CenterLine_C0: single
  TOS_RFM_Entry_CenterLine_C1: single
  TOS_RFM_Entry_CenterLine_C2: single
  TOS_RFM_Entry_CenterLine_C3: single
  TOS_RFM_Entry_CenterLine_LineType: uint8
  TOS_RFM_Entry_CenterLine_StartPointDis: single
  TOS_RFM_Entry_CenterLine_Length: single
  TOS_RFM_Entry_CenterLine_Quality: single
  TOS_RFM_Entry_CenterLine_FusType: uint8
  TOS_RFM_Entry_CenterLine_Age: uint8

TOS_RFM_Entry_Exit_CenterLine_bus = Simulink.Bus()
  TOS_RFM_Entry_CenterLine: Bus: TOS_RFM_Entry_CenterLine_bus
  TOS_RFM_Exit_CenterLine: Bus: TOS_RFM_Exit_CenterLine_bus

TOS_RFM_Exit_CenterLine_bus = Simulink.Bus()
  TOS_RFM_Exit_CenterLine_Valid: uint8
  TOS_RFM_Exit_CenterLine_C0: single
  TOS_RFM_Exit_CenterLine_C1: single
  TOS_RFM_Exit_CenterLine_C2: single
  TOS_RFM_Exit_CenterLine_C3: single
  TOS_RFM_Exit_CenterLine_LineType: uint8
  TOS_RFM_Exit_CenterLine_StartPointDis: single
  TOS_RFM_Exit_CenterLine_Length: single
  TOS_RFM_Exit_CenterLine_Quality: single
  TOS_RFM_Exit_CenterLine_FusType: uint8
  TOS_RFM_Exit_CenterLine_Age: uint8

TOS_VSM_HMI_BUS = Simulink.Bus()
  TOS_VSM_TJASts: uint8
  TOS_VSM_HWASts: uint8
  TOS_VSM_HWAActive: boolean
  TOS_VSM_LCKSts: uint8
  TOS_VSM_LDWSts: uint8
  TOS_VSM_LKASts: uint8
  TOS_VSM_ELKSts: uint8
  TOS_VSM_HandsOffDetd: boolean
  TOS_VSM_ESSSts: uint8
  TOS_VSM_AESSts: uint8
  TOS_VSM_LCKIESts: uint8
  TOS_VSM_NOH_Sts: uint8
  TOS_VSM_HWA_LaneChange: uint8
  TOS_TJA_FollowSts: uint8

TOS_VSM_LAT_CTRL_BUS = Simulink.Bus()
  TOS_VSM_TarLineValid: boolean
  TOS_VSM_TarLineC3: single
  TOS_VSM_TarLineC2: single
  TOS_VSM_TarLineC1: single
  TOS_VSM_TarLineC0: single