% Simulink data dictionary PvtIfTOS_2_PP.sldd

C_TOS_PP_ObjFusType_FR_Confirm_b = Simulink.Parameter(1, DataType="boolean")
C_TOS_PP_ObjFusType_FC_FR_Confirm_b = Simulink.Parameter(1, DataType="boolean")
C_TOS_PP_ObjFusType_FC_Confirm_b = Simulink.Parameter(1, DataType="boolean")
C_TOS_PP_OFM_ObjID_Invilad = Simulink.Parameter(0, DataType="uint8")
C_TOS_PP_OFM_ObjAge_Invilad_Val = Simulink.Parameter(0, DataType="uint16")
C_TOS_PP_OFM_ObjFusTypeInvilad_Val = Simulink.Parameter(0, DataType="uint8")
C_TOS_PP_OFM_ObjOrientationInvilad_Val = Simulink.Parameter(0, DataType="uint8")
C_TOS_PP_OFM_ObjTypeInvilad_Val = Simulink.Parameter(0, DataType="uint8")
C_TOS_PP_OFM_ObjMovStateInvilad_Val = Simulink.Parameter(0, DataType="uint8")
C_TOS_PP_OFMObjIDInvilad_Val = Simulink.Parameter(0, DataType="uint8")
C_TOS_RE_ThretaDefault_Val = Simulink.Parameter(181, DataType="single")
C_TOS_RE_ObjectNumDefault_Val = Simulink.Parameter(80, DataType="single")
C_TOS_RE_ObjectNum_Val = Simulink.Parameter(80, DataType="uint8")
C_TOS_RE_InvalidTargetChainDir_Val = Simulink.Parameter(0, DataType="uint8")
C_TOS_RE_InvalidFlag_bool = Simulink.Parameter(0, DataType="boolean")
C_TOS_RE_D2R = Simulink.Parameter(57.29578, DataType="single")
C_TOS_RE_D_180_Val = Simulink.Parameter(180, DataType="single")
C_TOS_RE_80Uint8Default_Val = Simulink.Parameter(repmat(0, 80, 1), DataType="uint8")
C_TOS_RE_80Single255Default_Val = Simulink.Parameter(repmat(255, 80, 1), DataType="single")
C_TOS_RE_80Single181Default_Val = Simulink.Parameter(repmat(181, 80, 1), DataType="single")
C_TOS_RE_80BoolDefault_Val = Simulink.Parameter(repmat(0, 80, 1), DataType="boolean")
C_TOS_PP_DefaultValueObjectToCenterLine_dy = Simulink.Parameter(0, DataType="single")
C_TOS_axAbsGround_Parameter = Simulink.Parameter(0, DataType="single")
C_TOS_StillObjSortInvalidIndex_Val = Simulink.Parameter(0, DataType="uint8")
C_TOS_PP_OFM_ObjValid_Flag = Simulink.Parameter(1, DataType="uint8")

TOS_PP_A2L_OFM_OBJ_bus = Simulink.Bus()
  Object_Fus_Type: uint8  % 目标是否是融合,传感器类型，FC代表摄像头；FR代表前雷达；CL代表左角雷达；CR代表右角雷达；BL代表左盲点雷达；BR代表右盲点雷达；
  Object_ID: uint8, Min=1, Max=80  % 融合追踪处理后，目标的ID
  Object_Type: uint8  % 目标的类型（行人、小汽车、卡车...）
  Object_Length: single, Min=1.2, Max=21, Unit="m"  % 目标的长度
  Object_Width: single, Min=0.04, Max=2.98, Unit="m"  % 目标的宽度
  Object_Hight: single, Min=0.01, Max=2.95, Unit="m"  % 目标的高度
  Object_HeadingAngle: single, Min=-180, Max=180, Unit="deg"  % 车体系下, 目标航向角
  Object_YawAngle: single, Min=-180, Max=180, Unit="deg"  % 车体系下, 目标的方位角
  Object_MovingState: uint8  % 目标的运动状态(静止、运动...)
  Object_Orientation: uint8  % 目标的运动方向(同向、对向、横穿...)
  Object_DX: single, Min=-80, Max=200, Unit="m"  % 车体坐标系下，自车和目标纵向相对距离
  Object_DY: single, Min=-100, Max=100, Unit="m"  % 车体坐标系下，自车和目标横向相对距离
  Object_VX: single, Min=-120, Max=130, Unit="m/s"  % 目标的  纵向的  速度
  Object_VY: single, Min=-50, Max=50, Unit="m/s"  % 目标的  横向的  速度
  Object_Std_AX: single, Min=0, Max=7.3  % 目标的  纵向的  加速度的方差
  Object_Std_AY: single, Min=0, Max=7.3  % 目标的  横向的  加速度的方差
  Object_Std_DX: single, Min=0, Max=250  % 目标的  纵向的  距离的方差
  Object_Std_DY: single, Min=0, Max=100  % 目标的  横向的  距离的方差
  Object_Std_VX: single, Min=0, Max=130  % 目标的  纵向的  速度的方差
  Object_Std_VY: single, Min=0, Max=50  % 目标的  横向的  速度的方差
  Object_AX: single, Min=-10.3, Max=7.3, Unit="m/s^2"  % 目标的  纵向的  加速度
  Object_AY: single, Min=-10.3, Max=7.3, Unit="m/s^2"  % 目标的  横向的  加速度
  Object_Std_Length: single, Min=0, Max=10  % 目标长度的方差
  Object_Std_Width: single, Min=0, Max=2  % 目标宽度的方差
  Object_Std_HeadingAngle: single, Min=0, Max=3.14  % 目标的航向角的方差
  Object_Type_Prob: single, Min=0, Max=1  % 目标对应类型的概率值
  Object_ExistProb: single, Min=0, Max=1  % 目标存在的概率值
  Object_ObstacleProb: single, Min=0, Max=1  % 目标成为障碍物的概率值
  Object_Age: uint16, Min=0, Max=65535  % 目标存在生命周期
  Object_State: uint8  % 前摄像头传感目标ID
  FR_ObjectID: uint8, Min=0, Max=255  % 前摄像头传感目标类型
  FR_ObjectType: uint8, Min=0, Max=15  % 前摄像头传感目标运动状态
  FR_ObjectMovingState: uint8, Min=0, Max=7  % 前摄像头传感目标运动朝向
  FR_ObjectMovingOrientation: uint8, Min=0, Max=7  % 前摄像头传感目标纵向距离
  FR_Dx: single, Min=0, Max=254.9375, Unit="m"  % 前摄像头传感目标横向距离
  FR_Dy: single, Min=-128, Max=127.875, Unit="m"  % 前摄像头传感目标纵向速度
  FR_Vx: single, Min=-128, Max=126.9976, Unit="m/s"  % 前摄像头传感目标横向速度
  FR_Vy: single, Min=-128, Max=126.9976, Unit="m/s"  % 前雷达传感目标ID
  FC_ObjectID: uint8, Min=0, Max=255  % 前雷达传感目标类型
  FC_ObjectType: uint8, Min=0, Max=8  % 前雷达传感目标运动状态
  FC_ObjectMovingState: uint8, Min=0, Max=5  % 前雷达传感目标运动朝向
  FC_ObjectMovingOrientation: uint8, Min=0, Max=13  % 前雷达传感目标纵向距离
  FC_Dx: single, Min=-200, Max=250, Unit="m"  % 前雷达传感目标横向距离
  FC_Dy: single, Min=-100, Max=100, Unit="m"  % 前雷达传感目标纵向速度
  FC_Vx: single, Min=-120, Max=130, Unit="m/s"  % 前雷达传感目标横向速度
  FC_Vy: single, Min=-50, Max=50, Unit="m/s"

TOS_PP_CenterLineCalculat_bus = Simulink.Bus()
  TOS_PP_LaneWidth: Bus: TOS_PP_LaneWidth_bus
  TOS_PP_SameLane_CenterLine: Bus: TOS_PP_SameLane_CenterLine_bus
  TOS_PP_LeftLane_CenterLine: Bus: TOS_PP_LeftLane_CenterLine_bus
  TOS_PP_RightLane_CenterLine: Bus: TOS_PP_RightLane_CenterLine_bus

TOS_PP_LM_FusRatio_bus = Simulink.Bus()
  TOS_PP_LM_FusRatio_Flag: uint8
  TOS_PP_LM_VSL_FusRatio: single
  TOS_PP_LM_EML_FusRatio: single
  TOS_PP_LM_OTL_FusRatio: single

TOS_PP_LM_Line_bus = Simulink.Bus()
  PC3: single
  PC2: single
  PC1: single
  PC0: single
  dDisStart: single
  dDisEnd: single

TOS_PP_LM_No_fCamVaild_bus = Simulink.Bus()
  TOS_PP_LM_No_fCam_Flag: uint8
  TOS_PP_LM_No_fCam_pC2: single
  TOS_PP_LM_No_fCam: uint8

TOS_PP_LM_VaildConfirm_bus = Simulink.Bus()
  TOS_PP_LM_LeftLane_Vaild: boolean
  TOS_PP_LM_RightLane_Vaild: boolean
  TOS_PP_LM_Length_Vaild: boolean[80]

TOS_PP_LMfCamVaild_bus = Simulink.Bus()
  TOS_PP_LM_fCam_Flag: uint8
  TOS_PP_LM_fCam_pC2: single
  TOS_PP_LM_fCam: uint8

TOS_PP_LaneWidth_bus = Simulink.Bus()
  TOS_PP_LeftLaneWidth: single
  TOS_PP_SameLaneWidth: single
  TOS_PP_RightLaneWidth: single

TOS_PP_LeftLane_CenterLine_bus = Simulink.Bus()
  CenterLine01: Bus: TOS_PP_LM_Line_bus
  CenterLine02: Bus: TOS_PP_LM_Line_bus
  CenterLine03: Bus: TOS_PP_LM_Line_bus
  CenterLine04: Bus: TOS_PP_LM_Line_bus
  CenterLine05: Bus: TOS_PP_LM_Line_bus
  CenterLine06: Bus: TOS_PP_LM_Line_bus

TOS_PP_NOH_OFM_Attribute_bus = Simulink.Bus()
  TOS_PP_OFM_ObjValid_Flag: uint8[80]
  Object_ID: uint8[80]
  Object_Type: uint8[80]
  Object_Width: single[80]
  Object_YawAngle: single[80]
  Object_MovingState: uint8[80]
  Object_Orientation: uint8[80]
  Object_DX: single[80]
  Object_DY: single[80]
  Object_VX: single[80]
  Object_VY: single[80]
  Object_AX: single[80]
  Object_AY: single[80]
  Object_Age: uint16[80]

TOS_PP_NOH_RFM_Attribute_bus = Simulink.Bus()
  TOS_PP_NOH_RFM_Standby_Sig1: boolean
  TOS_PP_NOH_RFM_Standby_Sig2: boolean

TOS_PP_NOH_SigConfirm_bus = Simulink.Bus()
  TOS_PP_NOH_OFM_Attribute: Bus: TOS_PP_NOH_OFM_Attribute_bus
  TOS_PP_NOH_RFM_Attribute: Bus: TOS_PP_NOH_RFM_Attribute_bus

TOS_PP_OFM_Attribute_bus = Simulink.Bus()
  TOS_PP_Object_VY_Filt: single[80]
  TOS_PP_Object_DY_Filt: single[80]
  TOS_PP_Object_Length_Filt: single[80]
  TOS_PP_Object_Width_Filt: single[80]
  TOS_PP_Object_YawAngle_Filt: single[80]

TOS_PP_OFM_SignalVerification_bus = Simulink.Bus()
  TOS_PP_OFM_ObjValid_Flag: uint8[80]
  Object_Num: uint8
  Object_Fus_Type: uint8[80]  % 目标是否是融合,传感器类型，FC代表摄像头；FR代表前雷达；CL代表左角雷达；CR代表右角雷达；BL代表左盲点雷达；BR代表右盲点雷达；
  Object_ID: uint8[80], Min=1, Max=80  % 融合追踪处理后，目标的ID
  Object_Type: uint8[80]  % 目标的类型（行人、小汽车、卡车...）
  Object_Length: single[80], Min=1.2, Max=21, Unit="m"  % 目标的长度
  Object_Width: single[80], Min=0.04, Max=2.98, Unit="m"  % 目标的宽度
  Object_Hight: single[80], Min=0.01, Max=2.95, Unit="m"  % 目标的高度
  Object_HeadingAngle: single[80], Min=-180, Max=180, Unit="deg"  % 车体系下, 目标航向角
  Object_YawAngle: single[80], Min=-180, Max=180, Unit="deg"  % 车体系下, 目标的方位角
  Object_MovingState: uint8[80]  % 目标的运动状态(静止、运动...)
  Object_Orientation: uint8[80]  % 目标的运动方向(同向、对向、横穿...)
  Object_DX: single[80], Min=-80, Max=200, Unit="m"  % 车体坐标系下，自车和目标纵向相对距离
  Object_DY: single[80], Min=-100, Max=100, Unit="m"  % 车体坐标系下，自车和目标横向相对距离
  Object_VX: single[80], Min=-120, Max=130, Unit="m/s"  % 目标的  纵向的  速度
  Object_VY: single[80], Min=-50, Max=50, Unit="m/s"  % 目标的  横向的  速度
  Object_Std_AX: single[80], Min=0, Max=7.3  % 目标的  纵向的  加速度的方差
  Object_Std_AY: single[80], Min=0, Max=7.3  % 目标的  横向的  加速度的方差
  Object_Std_DX: single[80], Min=0, Max=250  % 目标的  纵向的  距离的方差
  Object_Std_DY: single[80], Min=0, Max=100  % 目标的  横向的  距离的方差
  Object_Std_VX: single[80], Min=0, Max=130  % 目标的  纵向的  速度的方差
  Object_Std_VY: single[80], Min=0, Max=50  % 目标的  横向的  速度的方差
  Object_AX: single[80], Min=-10.3, Max=7.3, Unit="m/s^2"  % 目标的  纵向的  加速度
  Object_AY: single[80], Min=-10.3, Max=7.3, Unit="m/s^2"  % 目标的  横向的  加速度
  Object_Std_Length: single[80], Min=0, Max=10  % 目标长度的方差
  Object_Std_Width: single[80], Min=0, Max=2  % 目标宽度的方差
  Object_Std_HeadingAngle: single[80], Min=0, Max=3.14  % 目标的航向角的方差
  Object_Type_Prob: single[80], Min=0, Max=1  % 目标对应类型的概率值
  Object_ExistProb: single[80], Min=0, Max=1  % 目标存在的概率值
  Object_ObstacleProb: single[80], Min=0, Max=1  % 目标成为障碍物的概率值
  Object_Age: uint16[80], Min=0, Max=65535  % 目标存在生命周期
  Object_State: uint8[80]  % 前摄像头传感目标ID
  FR_ObjectID: uint8[80], Min=0, Max=255  % 前摄像头传感目标类型
  FR_ObjectType: uint8[80], Min=0, Max=15  % 前摄像头传感目标运动状态
  FR_ObjectMovingState: uint8[80], Min=0, Max=7  % 前摄像头传感目标运动朝向
  FR_ObjectMovingOrientation: uint8[80], Min=0, Max=7  % 前摄像头传感目标纵向距离
  FR_Dx: single[80], Min=0, Max=254.9375, Unit="m"  % 前摄像头传感目标横向距离
  FR_Dy: single[80], Min=-128, Max=127.875, Unit="m"  % 前摄像头传感目标纵向速度
  FR_Vx: single[80], Min=-128, Max=126.9976, Unit="m/s"  % 前摄像头传感目标横向速度
  FR_Vy: single[80], Min=-128, Max=126.9976, Unit="m/s"  % 前雷达传感目标ID
  FC_ObjectID: uint8[80], Min=0, Max=255  % 前雷达传感目标类型
  FC_ObjectType: uint8[80], Min=0, Max=8  % 前雷达传感目标运动状态
  FC_ObjectMovingState: uint8[80], Min=0, Max=5  % 前雷达传感目标运动朝向
  FC_ObjectMovingOrientation: uint8[80], Min=0, Max=13  % 前雷达传感目标纵向距离
  FC_Dx: single[80], Min=-200, Max=250, Unit="m"  % 前雷达传感目标横向距离
  FC_Dy: single[80], Min=-100, Max=100, Unit="m"  % 前雷达传感目标纵向速度
  FC_Vx: single[80], Min=-120, Max=130, Unit="m/s"  % 前雷达传感目标横向速度
  FC_Vy: single[80], Min=-50, Max=50, Unit="m/s"

TOS_PP_ObjFirst_dxdyDetect_bus = Simulink.Bus()
  TOS_PP_ObjFirstDetect_dx: single[80]
  TOS_PP_ObjFirstDetect_dy: single[80]

TOS_PP_ObjToCenterLine_bus = Simulink.Bus()
  TOS_PP_ObjectToCenterLine_Vyc: single[80]
  TOS_PP_ObjectToCenterLine_dy: single[80]
  TOS_PP_EgoVehCenterLine_dy: single

TOS_PP_RightLane_CenterLine_bus = Simulink.Bus()
  CenterLine01: Bus: TOS_PP_LM_Line_bus
  CenterLine02: Bus: TOS_PP_LM_Line_bus
  CenterLine03: Bus: TOS_PP_LM_Line_bus
  CenterLine04: Bus: TOS_PP_LM_Line_bus
  CenterLine05: Bus: TOS_PP_LM_Line_bus
  CenterLine06: Bus: TOS_PP_LM_Line_bus

TOS_PP_SameLane_CenterLine_bus = Simulink.Bus()
  CenterLine01: Bus: TOS_PP_LM_Line_bus
  CenterLine02: Bus: TOS_PP_LM_Line_bus
  CenterLine03: Bus: TOS_PP_LM_Line_bus
  CenterLine04: Bus: TOS_PP_LM_Line_bus
  CenterLine05: Bus: TOS_PP_LM_Line_bus
  CenterLine06: Bus: TOS_PP_LM_Line_bus

TOS_PP_SigProcessing_bus = Simulink.Bus()
  TOS_PP_MovingState: uint8
  TOS_PP_AEB_MovingState: uint8
  TOS_PP_ObjMovingDir: uint8
  TOS_PP_axAbsGround: single
  TOS_PP_CamareConfirm: boolean
  TOS_PP_Obj2EgoCarFrontbump: single
  TOS_PP_ObjFusType_FC_FR_Confirm: boolean
  TOS_PP_ObjFusType_FR_Confirm: boolean
  TOS_PP_ObjFusType_FC_Confirm: boolean
  TOS_PP_ObjFusType_CL_other_Confirm: boolean
  TOS_PP_ObjFusType_CR_other_Confirm: boolean