% Simulink data dictionary PvtIfTOS_3_PIL.sldd

C_TOS_PIL_CameraConfirmedFlag = Simulink.Parameter(1, DataType="boolean")
C_TOS_PIL_CurrentLaneCoreMinWidth_Val = Simulink.Parameter(0, DataType="single")
C_TOS_PIL_CutInProb_Val_Zero = Simulink.Parameter(0, DataType="single")  % 目标不满足cut in条件时，cutin概率值置为0
C_TOS_PIL_CutOutProb_Val_Zero = Simulink.Parameter(0, DataType="single")  % 目标切出可能性为 0
C_TOS_PIL_DefaultValueObjectToCenterLine_dy = Simulink.Parameter(0, DataType="single")  % 目标dx范围dx>150m 或 dx<-80m时，默认目标到车道中心线距离 dis=dy-3.5
C_TOS_PIL_DefaultValueObjectToLeftCenterLine_dy = Simulink.Parameter(3.5, DataType="single")  % 目标到左侧车道中心线距离。默认3.5m
C_TOS_PIL_DefaultValueObjectToRightCenterLine_dy = Simulink.Parameter(-3.5, DataType="single")
C_TOS_PIL_EgoCarWidth_Val = Simulink.Parameter(1.88, DataType="single")  % 自车宽度
C_TOS_PIL_HalfWidthVehicle_Con = Simulink.Parameter(0.5, DataType="single")  % 车辆宽度一半；参数 0.5
C_TOS_PIL_LM_LeftLane_Vaild = Simulink.Parameter(1, DataType="boolean")
C_TOS_PIL_LM_Length_Vaild = Simulink.Parameter(1, DataType="boolean")
C_TOS_PIL_LM_RightLane_Vaild = Simulink.Parameter(1, DataType="boolean")
C_TOS_PIL_LaneLineCourseErrorFront = Simulink.Parameter(0.00014, DataType="single")
C_TOS_PIL_LaneLineCourseErrorRear = Simulink.Parameter(0.00014, DataType="single")  % 自车后方道路曲率偏差 0.00014
C_TOS_PIL_LatDisCons_Val_zero = Simulink.Parameter(0, DataType="single")  % 计算PIL考虑车辆宽度后，dyc ± objwdth 约束值 0
C_TOS_PIL_MotorbikeDefaultWidth_m = Simulink.Parameter(0.8, DataType="single")  % cut in 摩托车宽度 1m
C_TOS_PIL_OFM_ObjID_Invilad = Simulink.Parameter(0, DataType="uint8")
C_TOS_PIL_OFM_ObjValid_Flag = Simulink.Parameter(0, DataType="uint8")
C_TOS_PIL_ObjInCurrentLane_Val = Simulink.Parameter(1, DataType="single")  % 目标位于本车道核心区域内
C_TOS_PIL_ObjNotInCurrentLane_ProMax_Val = Simulink.Parameter(1, DataType="single")
C_TOS_PIL_ObjNotInCurrentLane_ProMin_Val = Simulink.Parameter(0, DataType="single")
C_TOS_PIL_ObjNotInCurrentLane_Val = Simulink.Parameter(0, DataType="single")
C_TOS_PIL_ObjPredictDis_dy_ConstantVal_Zeros = Simulink.Parameter(0, DataType="single")  % 根据ObjectToCenterLine_dy 、 目标预测距离判断；车辆过中心线预测距离置0
C_TOS_PIL_ObjToCenterLine_ConstantVal_Zeros = Simulink.Parameter(0, DataType="single")  % 目标到中心线之间距离；判断目标在左侧OR右侧 ；常量0
C_TOS_PIL_Obj_Age_Val = Simulink.Parameter(1, DataType="uint16")
C_TOS_PIL_ObjectDefaultWidth_m = Simulink.Parameter(0.5, DataType="single")  % 行人、自行车、摩托车；未知类型目标 默认宽度0.5
C_TOS_PIL_OFM_ObjProbCalculation_ObjValid_Flag = Simulink.Parameter(1, DataType="uint8")
C_TOS_PIL_OFM_ObjValid_Val = Simulink.Parameter(1, DataType="uint8")

TOS_A2L_PIL_ObjCutIn_ObserVal_bus = Simulink.Bus()
  TOS_PIL_ObjectCutIn_Flag: boolean
  TOS_P0_P1_ObjCutIn_dy_1: boolean
  TOS_PIL_ObjCutIn_vy_2: boolean
  TOS_Pil_ObjCutIn_vy_Reset_3: boolean
  TOS_PIL_ObjCutIn_Age_K1_4: single
  TOS_PIL_ObjCutIn_State_5: uint8
  TOS_PIL_ObjCutIn_LM_fCamAge_6: uint32

TOS_PIL_Lane_BasicWidth_ObserVale_bus = Simulink.Bus()
  TOS_PIL_SameLane_BasicWidth_ObserVale: single
  TOS_PIL_LeftLane_BasicWidth_ObserVale: single
  TOS_PIL_RightLane_BasicWidth_ObserVale: single

TOS_PIL_LeftLane_Boundary_bus = Simulink.Bus()
  TOS_PIL_LeftLane_CoreArea: single
  TOS_PIL_LeftLane_EdgeLeft: single
  TOS_PIL_LeftLane_EdgeRight: single

TOS_PIL_ObjCutIn_bus = Simulink.Bus()
  TOS_PIL_ObjectCutIn_Flag: boolean[80]
  TOS_PIL_ObjectCutInPro_Filt: single[80]

TOS_PIL_ObjCutOut_bus = Simulink.Bus()
  TOS_PIL_ObjectCutOut_Flag: boolean[80]
  TOS_PIL_ObjectCutOutPro_Filt: single[80]

TOS_PIL_ObjInLane_Confirm_bus = Simulink.Bus()
  TOS_PIL_ObjSameLane_Flag: boolean
  TOS_PIL_ObjLeftLane_Flag: boolean
  TOS_PIL_ObjRightLane_Flag: boolean

TOS_PIL_ObjLanePro_Filt_bus = Simulink.Bus()
  TOS_PIL_ObjLaneProb_All_Filt: single[80]
  TOS_PIL_SameLanePro_Filt: single[80]
  TOS_PIL_LeftLaneProb_Filt: single[80]
  TOS_PIL_RightLaneProb_Filt: single[80]

TOS_PIL_ObjLaneProb_bus = Simulink.Bus()
  TOS_PIL_ObjLaneProb_All: single
  TOS_PIL_SameLaneProb: single
  TOS_PIL_LeftLaneProb: single
  TOS_PIL_RightLaneProb: single

TOS_PIL_RightLane_Boundary_bus = Simulink.Bus()
  TOS_PIL_RightLane_CoreArea: single
  TOS_PIL_RightLane_EdgeLeft: single
  TOS_PIL_RightLane_EdgeRight: single

TOS_PIL_SameLane_Boundary_bus = Simulink.Bus()
  TOS_PIL_SameLane_CoreArea: single
  TOS_PIL_SameLane_EdgeLeft: single
  TOS_PIL_SameLane_EdgeRight: single

TOS_PIL_EgoVehPro_bus = Simulink.Bus()
  TOS_PIL_EgoVeh_LeftLaneProb_Filt: single
  TOS_PIL_EgoVeh_SameLaneProb_Filt: single
  TOS_PIL_EgoVeh_RightLaneProb_Filt: single