% Simulink data dictionary PvtIfTOS_4_TLJ.sldd

C_TOS_TLJ_OFM_ObjValid_Flag = Simulink.Parameter(1, DataType="uint8")
C_TOS_TLJ_ObjLaneProb_al_Val = Simulink.Parameter(0.2, DataType="single")  % 目标在三个车道内总的概率值
C_TOS_TLJ_ObjectCutInFlag_b = Simulink.Parameter(1, DataType="boolean")  % TLJ 目标切入判断
C_TOS_TLJ_ObjectCutOutFlag_b = Simulink.Parameter(1, DataType="boolean")  % TLJ 目标切出判断

TOS_TLJ_LaneProb_ObserVale_bus = Simulink.Bus()
  TOS_TLJ_LeftLane_Prob_ObserVale: single
  TOS_TLJ_SameLane_Prob_ObserVale: single
  TOS_TLJ_RightLane_Prob_ObserVale: single
  TOS_TLJ_ObjInLaneCondition_Flag_ObserVale: uint8

TOS_TLJ_TargetConfirm_bus = Simulink.Bus()
  TOS_TLJ_LeftLane_flag: boolean
  TOS_TLJ_SameLane_flag: boolean
  TOS_TLJ_RightLane_flag: boolean