% Simulink data dictionary PvtIfTOS_5_CA.sldd

NOH_HWACurrentLaneTarget_bus = Simulink.Bus()
  NOH_FDx1stNearTarget: uint8
  NOH_FDx2edNearTarget: uint8
  NOH_RDx1stNearTarget: uint8
  NOH_RDx2edNearTarget: uint8

NOH_HWALeftLaneTarget_bus = Simulink.Bus()
  NOH_FDx1stNearTarget: uint8
  NOH_FDx2edNearTarget: uint8
  NOH_RDx1stNearTarget: uint8
  NOH_RDx2edNearTarget: uint8

NOH_HWARightLaneTarget_bus = Simulink.Bus()
  NOH_FDx1stNearTarget: uint8
  NOH_FDx2edNearTarget: uint8
  NOH_RDx1stNearTarget: uint8
  NOH_RDx2edNearTarget: uint8

TOS_NOH_Target_Index_bus = Simulink.Bus()
  TOS_NOH_LeftLaneTarget: Bus: NOH_HWALeftLaneTarget_bus
  TOS_NOH_CurrentLaneTarget: Bus: NOH_HWACurrentLaneTarget_bus
  TOS_NOH_RightLaneTarget: Bus: NOH_HWARightLaneTarget_bus