% Simulink data dictionary PvtIfTOS_6_DC.sldd

C_TOS_DC_OFMObjIDInvilad_Val = Simulink.Parameter(0, DataType="uint8")

TOS_PP_SigProcess_DimensionConvert_bus = Simulink.Bus()
  TOS_PP_MovingState: uint8[80]
  TOS_PP_AEB_MovingState: uint8[80]
  TOS_PP_ObjMovingDir: uint8[80]
  TOS_PP_axAbsGround: single[80]
  TOS_PP_CamareConfirm: boolean[80]
  TOS_PP_Obj2EgoCarFrontbump: single[80]
  TOS_PP_ObjFusType_FC_FR_Confirm: boolean[80]
  TOS_PP_ObjFusType_FR_Confirm: boolean[80]
  TOS_PP_ObjFusType_FC_Confirm: boolean[80]
  TOS_PP_ObjFusType_CL_other_Confirm: boolean[80]
  TOS_PP_ObjFusType_CR_other_Confirm: boolean[80]

TOS_TLJ_TargetConfirm_DimensionConvert_bus = Simulink.Bus()
  TOS_TLJ_LeftLane_flag: boolean[80]
  TOS_TLJ_SameLane_flag: boolean[80]
  TOS_TLJ_RightLane_flag: boolean[80]