% Simulink data dictionary PvtIfTOS_7_ACC.sldd

C_TOS_ACC_NumberOfEffectiveTargets = Simulink.Parameter(80, DataType="uint8")
C_TOS_ACC_OFMObjIDInvilad_Val = Simulink.Parameter(0, DataType="uint8")
C_TOS_ACC_OFM_ObjValid_Flag = Simulink.Parameter(1, DataType="uint8")
C_TOS_ACC_ObjFusType_FC_Confirm_b = Simulink.Parameter(1, DataType="boolean")
C_TOS_ACC_ObjFusType_FC_FR_Confirm_b = Simulink.Parameter(1, DataType="boolean")
C_TOS_ACC_ObjFusType_FR_Confirm_b = Simulink.Parameter(1, DataType="boolean")
C_TOS_ACC_ObjNotREElementType = Simulink.Parameter(0, DataType="uint8")
C_TOS_ACC_ObjToCenterLine_ConstantVal_Zeros = Simulink.Parameter(0, DataType="single")
C_TOS_ACC_TargetFront_Flag = Simulink.Parameter(1, DataType="boolean")
C_TOS_ACC_P1_HMI_DisplayPatch_ObjID = Simulink.Parameter(0, DataType="uint8")
C_TOS_ACC_P4_HMI_DisplayPatch_ObjID = Simulink.Parameter(0, DataType="uint8")
C_TOS_ACC_P5_HMI_DisplayPatch_ObjID = Simulink.Parameter(0, DataType="uint8")

TOS_ACC_P0_Confirm_ObserVale_bus = Simulink.Bus()
  TOS_P0_SteerWheelAngConfirm_ObserVale: boolean
  TOS_P0_FusionType_ObserVale: boolean
  TOS_P0_TrgMovDir_ObserVale: boolean
  TOS_P0_TargetDxConfirm_ObserVale: boolean
  TOS_P0_ObjType_ObserVale: boolean
  TOS_P0_ObstacleProb_ObserVale: boolean
  TOS_P0_DyConfirm_ObserVale: boolean
  TOS_P0_TrgMovDirFlag_1_ObserVale: boolean
  TOS_P0_TrgMovDirFlag_2_ObserVale: boolean
  TOS_P0_TrgMovDirFlag_3_ObserVale: boolean
  TOS_P0_TrgMovDirFlag_4_ObserVale: boolean
  TOS_P0_TrgMovDirFlag_5_ObserVale: boolean
  TOS_P0_TrgMovDirFlag_6_ObserVale: boolean
  TOS_P0_DyConfirm_1_ObserVale: uint8
  TOS_P0_DyConfirm_2_ObserVale: boolean
  TOS_P0_DyConfirm_3_ObserVale: boolean
  TOS_P0_DyConfirm_4_OverlapRatio_ObserVale: boolean
  TOS_P0_DyConfirm_5_OverlapConfirm_ObserVale: boolean
  TOS_P0_DyConfirm_ALL_6_ObserVale: boolean
  TOS_P0_DyConfirm_Parking_7_ObserVale: boolean
  TOS_P0_dy_ObjSelect_8_ObserVale: boolean
  TOS_ACC_P0_P1_CutIn_Flag_9_ObserVale: boolean
  TOS_ACC_P0_P1_Pre_SmallOvelap_10_ObserVale: boolean
  TOS_ACC_DyConfirm_NoLine_Curve_11_ObserVale: boolean
  TOS_ACC_P0_TrackingTime: uint32

TOS_ACC_P0_P1_Pre_ObserVale_bus = Simulink.Bus()
  TOS_ACC_P0_P1_Pre_Condition_1: boolean
  TOS_ACC_P0P1_Pre_FRSplit_Target_1: boolean
  TOS_ACC_P0_P1_Pre_FusionType: boolean
  TOS_ACC_P0_P1_Pre_FRSplitTarget_2: boolean
  TOS_ACC_P0_P1_Pre_BoundaryFilt: boolean
  TOS_ACC_P0_P1_Pre_ObjType: boolean
  TOS_ACC_P0_P1_Pre_RoadEdge: boolean
  TOS_ACC_P0P1_Pre_FRSplit_Track_FusObjID_1_1: uint8
  TOS_ACC_P0P1_Pre_FRSplit_State: uint8
  TOS_ACC_P0_P1_FusType_TruckFRSplit_Patch: boolean
  TOS_ACC_P0_P1_Pre_Condition_2: boolean
  TOS_ACC_P0_P1_CutIn_Flag: boolean
  TOS_ACC_P0_P1_dy_CutIn_Flag: boolean
  TOS_ACC_P0_P1_DyConfirm: boolean
  TOS_ACC_StraightLine_dyConfirm_Flag: boolean
  TOS_ACC_P0_P1_Parking_DyConfirm: boolean
  TOS_ACC_SmallOvelap_ObjSelect: boolean
  TOS_ACC_P0_P1_Parking_Line_fCamValid: boolean
  TOS_P0_P1_ObjCutIn_C1: boolean
  TOS_P0_P1_ObjCutIn_C2: boolean
  TOS_P0_P1_ObjCutIn_C3: boolean
  TOS_P0_P1_ObjCutIn_dy_C1_1: boolean
  TOS_P0_P1_ObjCutIn_Flag_C1_2: boolean
  TOS_P0_P1_ObjCutIn_dx_C1_3: boolean
  TOS_P0_P1_ObjCutIn_vx_C1_4: boolean
  TOS_P0_P1_ObjCutIn_dy_State_C1_5: uint8
  TOS_P0_P1_ObjCutIn_dy_C3_1: single
  TOS_P0_P1_ObjCutIn_LaneWidth_C3_2: single
  TOS_P0_P1_ObjCutIn_Curve_C3_3: boolean
  TOS_ACC_SmallOvelap_ObjSelect_C1: boolean
  TOS_ACC_SmallOvelap_ObjSelect_C2: boolean
  TOS_ACC_SmallOvelap_ObjSelect_C3: boolean
  TOS_ACC_SmallOvelap_ObjSelect_dy_C4: boolean
  TOS_ACC_SmallOvelap_ObjSelect_C3_0: single
  TOS_ACC_SmallOvelap_ObjSelect_C3_1: single
  TOS_ACC_SmallOvelap_ObjSelect_C3_2: uint8
  TOS_ACC_SmallOvelap_Curvr_LM_Valid_C3_3: boolean
  TOS_ACC_Curve_LM_fCamAge_C3_4: boolean
  TOS_ACC_SmallOvelap_Curvr_dyc_C3_5: boolean
  TOS_ACC_SmallOvelap_Straight_LM_Valid_C3_6: boolean
  TOS_ACC_Straight_LM_fCamAge_C3_7: boolean
  TOS_ACC_SmallOvelap_Straight_dyc_C3_8: boolean
  TOS_ACC_SmallOvelap_Truck_YawAngle_DiseError_C3_9: single
  TOS_ACC_SmallOvelap_ObjSelect_dy_State_C4_1: uint8
  TOS_ACC_P0_P1_SL_3: boolean
  TOS_ACC_P0_P1_Overlap: boolean
  TOS_ACC_P0_P1_SameLane: boolean
  TOS_ACC_P0_P1_CutIn: boolean
  TOS_ACC_P0_P1_dy_CutIn: boolean

TOS_ACC_P1_Confirm_ObserVale_bus = Simulink.Bus()
  TOS_P1_FusionType_ObserVale: boolean
  TOS_P1_TrgMovDir_ObserVale: boolean
  TOS_P1_TargetDxConfirm_ObserVale: boolean
  TOS_P1_ObjType_ObserVale: boolean
  TOS_P1_ObstacleProb_ObserVale: boolean
  TOS_P1_DyConfirm_ObserVale: boolean
  TOS_P1_TrgMovDirFlag_1_ObserVale: boolean
  TOS_P1_TrgMovDirFlag_2_ObserVale: boolean
  TOS_P1_TrgMovDirFlag_3_ObserVale: boolean
  TOS_P1_TrgMovDirFlag_4_ObserVale: boolean
  TOS_P1_TrgMovDirFlag_5_ObserVale: boolean
  TOS_P1_TrgMovDirFlag_6_ObserVale: boolean
  TOS_P1_DyConfirm_1_ObserVale: boolean
  TOS_P1_DyConfirm_2_ObserVale: boolean
  TOS_P1_DyConfirm_3_ObserVale: boolean
  TOS_P1_DyConfirm_4_OverlapRatio_ObserVale: boolean
  TOS_P1_DyConfirm_5_OverlapConfirm_ObserVale: boolean
  TOS_P1_DyConfirm_ALL_6_ObserVale: boolean

TOS_ACC_P2_Confirm_ObserVale_bus = Simulink.Bus()
  TOS_P2_FusionType_ObserVale: boolean
  TOS_P2_TrgMovDir_ObserVale: boolean
  TOS_P2_TargetDxConfirm_ObserVale: boolean
  TOS_P2_ObjType_ObserVale: boolean
  TOS_P2_ObstacleProb_ObserVale: boolean
  TOS_P2_TrgMovDirFlag_1_ObserVale: boolean
  TOS_P2_TrgMovDirFlag_2_ObserVale: boolean
  TOS_P2_TrgMovDirFlag_3_ObserVale: boolean
  TOS_P2_TrgMovDirFlag_4_ObserVale: boolean
  TOS_P2_TrgMovDirFlag_5_ObserVale: boolean
  TOS_P2_TrgMovDirFlag_6_ObserVale: boolean

TOS_ACC_P2_P4_Pre_ObserVale_bus = Simulink.Bus()
  TOS_ACC_P2_P4_Pre_FusType: boolean
  TOS_ACC_P2_P4_Pre_BoundaryFilt: boolean
  TOS_ACC_P2_P4_Pre_ObjType: boolean
  TOS_ACC_P2_P4_Pre_DyConfirm: boolean

TOS_ACC_P3_Confirm_ObserVale_bus = Simulink.Bus()
  TOS_P3_FusionType_ObserVale: boolean
  TOS_P3_TrgMovDir_ObserVale: boolean
  TOS_P3_TargetDxConfirm_ObserVale: boolean
  TOS_P3_ObjType_ObserVale: boolean
  TOS_P3_ObstacleProb_ObserVale: boolean
  TOS_P3_TrgMovDirFlag_1_ObserVale: boolean
  TOS_P3_TrgMovDirFlag_2_ObserVale: boolean
  TOS_P3_TrgMovDirFlag_3_ObserVale: boolean
  TOS_P3_TrgMovDirFlag_4_ObserVale: boolean
  TOS_P3_TrgMovDirFlag_5_ObserVale: boolean
  TOS_P3_TrgMovDirFlag_6_ObserVale: boolean

TOS_ACC_P4_Confirm_ObserVale_bus = Simulink.Bus()
  TOS_P4_FusionType_ObserVale: boolean
  TOS_P4_TrgMovDir_ObserVale: boolean
  TOS_P4_TargetDxConfirm_ObserVale: boolean
  TOS_P4_ObjType_ObserVale: boolean
  TOS_P4_ObstacleProb_ObserVale: boolean
  TOS_P4_TrgMovDirFlag_1_ObserVale: boolean
  TOS_P4_TrgMovDirFlag_2_ObserVale: boolean
  TOS_P4_TrgMovDirFlag_3_ObserVale: boolean
  TOS_P4_TrgMovDirFlag_4_ObserVale: boolean
  TOS_P4_TrgMovDirFlag_5_ObserVale: boolean
  TOS_P4_TrgMovDirFlag_6_ObserVale: boolean

TOS_ACC_P5_Confirm_ObserVale_bus = Simulink.Bus()
  TOS_P3_FusionType_ObserVale: boolean
  TOS_P3_TrgMovDir_ObserVale: boolean
  TOS_P3_TargetDxConfirm_ObserVale: boolean
  TOS_P3_ObjType_ObserVale: boolean
  TOS_P3_ObstacleProb_ObserVale: boolean
  TOS_P3_TrgMovDirFlag_1_ObserVale: boolean
  TOS_P3_TrgMovDirFlag_2_ObserVale: boolean
  TOS_P3_TrgMovDirFlag_3_ObserVale: boolean
  TOS_P3_TrgMovDirFlag_4_ObserVale: boolean
  TOS_P3_TrgMovDirFlag_5_ObserVale: boolean
  TOS_P3_TrgMovDirFlag_6_ObserVale: boolean

TOS_ACC_RightLane_Pre_ObserVale_bus = Simulink.Bus()
  TOS_ACC_P3_P5_Pre_FusType: boolean
  TOS_ACC_P3_P5_Pre_BoundaryFilt: boolean
  TOS_ACC_P3_P5_Pre_ObjType: boolean
  TOS_ACC_P3_P5_Pre_DyConfirm: boolean

TOS_A2L_ACC_P0P1_Pre_BUS = Simulink.Bus()
  TOS_ACC_P0_P1_Pre_FusionType: boolean
  TOS_ACC_P0_P1_Pre_FRSplitTarget: boolean
  TOS_ACC_P0_P1_Pre_BoundaryFilt: boolean
  TOS_ACC_P0_P1_Pre_ObjType: boolean
  TOS_ACC_P0_P1_Pre_RoadEdge: boolean
  TOS_ACC_P0_P1_CutIn_Flag: boolean
  TOS_ACC_P0_P1_dy_CutIn_Flag: boolean
  TOS_ACC_P0_P1_DyConfirm: boolean
  TOS_ACC_P0_P1_Parking_DyConfirm: boolean

TOS_A2L_ACC_P0_Confirm_ObserVale_bus = Simulink.Bus()
  TOS_P0_SteerWheelAngConfirm_ObserVale: boolean
  TOS_P0_FusionType_ObserVale: boolean
  TOS_P0_TrgMovDir_ObserVale: boolean
  TOS_P0_TargetDxConfirm_ObserVale: boolean
  TOS_P0_ObjType_ObserVale: boolean
  TOS_P0_ObstacleProb_ObserVale: boolean
  TOS_P0_DyConfirm_ObserVale: boolean
  TOS_P0_TrgMovDirFlag_1_ObserVale: boolean
  TOS_P0_TrgMovDirFlag_2_ObserVale: boolean
  TOS_P0_TrgMovDirFlag_3_ObserVale: boolean
  TOS_P0_TrgMovDirFlag_4_ObserVale: boolean
  TOS_P0_TrgMovDirFlag_5_ObserVale: boolean
  TOS_P0_TrgMovDirFlag_6_ObserVale: boolean
  TOS_P0_DyConfirm_1_ObserVale: uint8
  TOS_P0_DyConfirm_2_ObserVale: boolean
  TOS_P0_DyConfirm_3_ObserVale: boolean
  TOS_P0_DyConfirm_4_OverlapRatio_ObserVale: boolean
  TOS_P0_DyConfirm_5_OverlapConfirm_ObserVale: boolean
  TOS_P0_DyConfirm_ALL_6_ObserVale: boolean
  TOS_P0_DyConfirm_Parking_7_ObserVale: boolean
  TOS_P0_dy_ObjSelect_8_ObserVale: boolean

TOS_A2L_ACC_P1_Confirm_ObserVale_bus = Simulink.Bus()
  TOS_P1_FusionType_ObserVale: boolean
  TOS_P1_TrgMovDir_ObserVale: boolean
  TOS_P1_TargetDxConfirm_ObserVale: boolean
  TOS_P1_ObjType_ObserVale: boolean
  TOS_P1_ObstacleProb_ObserVale: boolean
  TOS_P1_DyConfirm_ObserVale: boolean
  TOS_P1_TrgMovDirFlag_1_ObserVale: boolean
  TOS_P1_TrgMovDirFlag_2_ObserVale: boolean
  TOS_P1_TrgMovDirFlag_3_ObserVale: boolean
  TOS_P1_TrgMovDirFlag_4_ObserVale: boolean
  TOS_P1_TrgMovDirFlag_5_ObserVale: boolean
  TOS_P1_TrgMovDirFlag_6_ObserVale: boolean
  TOS_P1_DyConfirm_1_ObserVale: boolean
  TOS_P1_DyConfirm_2_ObserVale: boolean
  TOS_P1_DyConfirm_3_ObserVale: boolean
  TOS_P1_DyConfirm_4_OverlapRatio_ObserVale: boolean
  TOS_P1_DyConfirm_5_OverlapConfirm_ObserVale: boolean
  TOS_P1_DyConfirm_ALL_6_ObserVale: boolean