% Simulink data dictionary PvtIfTOS_8_HWA.sldd

C_TOS_HWA_CurrentLaneFlag = Simulink.Parameter(1, DataType="boolean")
C_TOS_HWA_LeftLaneFlag = Simulink.Parameter(1, DataType="boolean")
C_TOS_HWA_MovState_Vaild = Simulink.Parameter(1, DataType="boolean")
C_TOS_HWA_MovingDir_Vaild = Simulink.Parameter(1, DataType="boolean")
C_TOS_HWA_NumberOfEffectiveTargets = Simulink.Parameter(80, DataType="uint8")
C_TOS_HWA_OFMObjIDInvilad_Val = Simulink.Parameter(0, DataType="uint8")
C_TOS_HWA_OFM_ObjValid_Flag = Simulink.Parameter(1, DataType="uint8")
C_TOS_HWA_ObjFusType_FC_Confirm_b = Simulink.Parameter(1, DataType="boolean")
C_TOS_HWA_ObjFusType_FC_FR_Confirm_b = Simulink.Parameter(1, DataType="boolean")
C_TOS_HWA_ObjFusType_FR_Confirm_b = Simulink.Parameter(1, DataType="boolean")
C_TOS_HWA_ObjInCurrentLaneValid = Simulink.Parameter(1, DataType="uint8")  % 目标在本车道
C_TOS_HWA_ObjInLeftLaneValid = Simulink.Parameter(2, DataType="uint8")  % 目标在左车道
C_TOS_HWA_ObjInRightLaneValid = Simulink.Parameter(3, DataType="uint8")  % 目标在右车道
C_TOS_HWA_ObjNotREElementType = Simulink.Parameter(0, DataType="uint8")
C_TOS_HWA_RightLaneFlag = Simulink.Parameter(1, DataType="boolean")
C_TOS_HWA_TargetFront_Flag = Simulink.Parameter(1, DataType="boolean")

TOS_A2L_HWA_Same_F2_Confirm_ObserVale_bus = Simulink.Bus()
  TOS_HWA_Same_F2_FusionType_ObserVale: boolean
  TOS_HWA_Same_F2_TrgMovDir_ObserVale: boolean
  TOS_HWA_Same_F2_DxConfirm_ObserVale: boolean
  TOS_HWA_Same_F2_ObjType_ObserVale: boolean
  TOS_HWA_Same_F2_ObstacleProb_ObserVale: boolean
  TOS_HWA_Same_F2_DyConfirm_ObserVale: boolean
  TOS_HWA_Same_F2_MovDir_1_ObserVale: boolean
  TOS_HWA_Same_F2_MovDir_2_ObserVale: boolean
  TOS_HWA_Same_F2_MovDir_3_ObserVale: boolean
  TOS_HWA_Same_F2_MovDir_4_ObserVale: boolean
  TOS_HWA_Same_F2_MovDir_5_ObserVale: boolean
  TOS_HWA_Same_F2_MovDir_6_ObserVale: boolean
  TOS_HWA_Same_F2_DyConfirm_1_ObserVale: boolean
  TOS_HWA_Same_F2_DyConfirm_2_ObserVale: boolean
  TOS_HWA_Same_F2_DyConfirm_3_ObserVale: boolean
  TOS_HWA_Same_F2_DyConfirm_4_ObserVale: boolean
  TOS_HWA_Same_F2_DyConfirm_5_ObserVale: boolean
  TOS_HWA_Same_F2_DyConfirm_ALL_6_ObserVale: boolean

TOS_HWA_LeftLane_Confirm_ObserVale_bus = Simulink.Bus()
  TOS_HWA_Left_F_FusType_ObserVale: boolean
  TOS_HWA_Left_F_InLaneFlag_ObserVale: boolean
  TOS_HWA_Left_F_MovDir_ObserVale: boolean
  TOS_HWA_Left_R_MovState_ObserVale: boolean
  TOS_HWA_Left_R_FusionType_ObserVale: boolean
  TOS_HWA_Left_R_InLaneFlag_ObserVale: boolean
  TOS_HWA_Left_R_MovingDir_ObserVale: boolean
  TOS_HWA_Left_R_DyConfirm_ObserVale: boolean

TOS_HWA_LeftLane_Pre_ObserVale_bus = Simulink.Bus()
  TOS_HWA_Pre_FusionType_ObserVale: boolean
  TOS_HWA_Pre_BoundaryFilt_ObserVale: boolean
  TOS_HWA_Pre_ObjType_ObserVale: boolean
  TOS_HWA_RoadEdge_ObserVale: boolean

TOS_HWA_RightLane_Confirm_ObserVale_bus = Simulink.Bus()
  TOS_HWA_Right_F_FusType_ObserVale: boolean
  TOS_HWA_Right_F_InLaneFlag_ObserVale: boolean
  TOS_HWA_Right_F_MovDir_ObserVale: boolean
  TOS_HWA_Right_R_MovState_ObserVale: boolean
  TOS_HWA_Right_R_FusionType_ObserVale: boolean
  TOS_HWA_Right_R_InLaneFlag_ObserVale: boolean
  TOS_HWA_Right_R_MovingDir_ObserVale: boolean
  TOS_HWA_Right_R_DyConfirm_ObserVale: boolean

TOS_HWA_RightLane_Pre_ObserVale_bus = Simulink.Bus()
  TOS_HWA_Pre_FusionType_ObserVale: boolean
  TOS_HWA_Pre_BoundaryFilt_ObserVale: boolean
  TOS_HWA_Pre_ObjType_ObserVale: boolean
  TOS_HWA_RoadEdge_ObserVale: boolean

TOS_HWA_SameLane_Pre_ObserVale_bus = Simulink.Bus()
  TOS_HWA_Pre_FusionType_ObserVale: boolean
  TOS_HWA_Pre_FRSplitTarget_ObserVale: boolean
  TOS_HWA_Pre_BoundaryFilt_ObserVale: boolean
  TOS_HWA_Pre_ObjType_ObserVale: boolean
  TOS_HWA_Pre_DyConfirm_ObserVale: boolean
  TOS_HWA_Pre_SameLane_Overlap_ObserVale: boolean
  TOS_HWA_Pre_SameLane_Flag_ObserVale: boolean

TOS_HWA_Same_F1_Confirm_ObserVale_bus = Simulink.Bus()
  TOS_HWA_Same_F1_FusionType_ObserVale: boolean
  TOS_HWA_Same_F1_TrgMovDir_ObserVale: boolean
  TOS_HWA_Same_F1_DxConfirm_ObserVale: boolean
  TOS_HWA_Same_F1_ObjType_ObserVale: boolean
  TOS_HWA_Same_F1_ObstacleProb_ObserVale: boolean
  TOS_HWA_Same_F1_DyConfirm_ObserVale: boolean
  TOS_HWA_Same_F1_MovDir_1_ObserVale: boolean
  TOS_HWA_Same_F1_MovDir_2_ObserVale: boolean
  TOS_HWA_Same_F1_MovDir_3_ObserVale: boolean
  TOS_HWA_Same_F1_MovDir_4_ObserVale: boolean
  TOS_HWA_Same_F1_MovDir_5_ObserVale: boolean
  TOS_HWA_Same_F1_MovDir_6_ObserVale: boolean
  TOS_HWA_Same_F1_DyConfirm_1_ObserVale: boolean
  TOS_HWA_Same_F1_DyConfirm_2_ObserVale: boolean
  TOS_HWA_Same_F1_DyConfirm_3_ObserVale: boolean
  TOS_HWA_Same_F1_DyConfirm_4_ObserVale: boolean
  TOS_HWA_Same_F1_DyConfirm_5_ObserVale: boolean
  TOS_HWA_Same_F1_DyConfirm_ALL_6_ObserVale: boolean

TOS_HWA_Same_R_Confirm_ObserVale_bus = Simulink.Bus()
  TOS_HWA_Same_R_MovState_ObserVale: boolean
  TOS_HWA_Same_R_FusionType_ObserVale: boolean
  TOS_HWA_Same_R_InSameLane_ObserVale: boolean
  TOS_HWA_Same_R_MovingDir_ObserVale: boolean
  TOS_HWA_Same_R_DyConfirm_ObserVale: boolean

TOS_A2L_HWA_LeftLane_Confirm_ObserVale_bus = Simulink.Bus()
  TOS_HWA_Left_F_FusType_ObserVale: boolean
  TOS_HWA_Left_F_InLaneFlag_ObserVale: boolean
  TOS_HWA_Left_F_MovDir_ObserVale: boolean
  TOS_HWA_Left_R_MovState_ObserVale: boolean
  TOS_HWA_Left_R_FusionType_ObserVale: boolean
  TOS_HWA_Left_R_InLaneFlag_ObserVale: boolean
  TOS_HWA_Left_R_MovingDir_ObserVale: boolean
  TOS_HWA_Left_R_DyConfirm_ObserVale: boolean

TOS_A2L_HWA_RightLane_Confirm_ObserVale_bus = Simulink.Bus()
  TOS_HWA_Right_F_FusType_ObserVale: boolean
  TOS_HWA_Right_F_InLaneFlag_ObserVale: boolean
  TOS_HWA_Right_F_MovDir_ObserVale: boolean
  TOS_HWA_Right_R_MovState_ObserVale: boolean
  TOS_HWA_Right_R_FusionType_ObserVale: boolean
  TOS_HWA_Right_R_InLaneFlag_ObserVale: boolean
  TOS_HWA_Right_R_MovingDir_ObserVale: boolean
  TOS_HWA_Right_R_DyConfirm_ObserVale: boolean

TOS_HWA_Same_F2_Confirm_ObserVale_bus = Simulink.Bus()
  TOS_HWA_Same_F2_FusionType_ObserVale: boolean
  TOS_HWA_Same_F2_TrgMovDir_ObserVale: boolean
  TOS_HWA_Same_F2_DxConfirm_ObserVale: boolean
  TOS_HWA_Same_F2_ObjType_ObserVale: boolean
  TOS_HWA_Same_F2_ObstacleProb_ObserVale: boolean
  TOS_HWA_Same_F2_DyConfirm_ObserVale: boolean
  TOS_HWA_Same_F2_MovDir_1_ObserVale: boolean
  TOS_HWA_Same_F2_MovDir_2_ObserVale: boolean
  TOS_HWA_Same_F2_MovDir_3_ObserVale: boolean
  TOS_HWA_Same_F2_MovDir_4_ObserVale: boolean
  TOS_HWA_Same_F2_MovDir_5_ObserVale: boolean
  TOS_HWA_Same_F2_MovDir_6_ObserVale: boolean
  TOS_HWA_Same_F2_DyConfirm_1_ObserVale: boolean
  TOS_HWA_Same_F2_DyConfirm_2_ObserVale: boolean
  TOS_HWA_Same_F2_DyConfirm_3_ObserVale: boolean
  TOS_HWA_Same_F2_DyConfirm_4_ObserVale: boolean
  TOS_HWA_Same_F2_DyConfirm_5_ObserVale: boolean
  TOS_HWA_Same_F2_DyConfirm_ALL_6_ObserVale: boolean