% Simulink data dictionary PvtIfTOS_9_AEB.sldd

C_TOS_AEBJA_PedObjDxThre_Val = Simulink.Parameter(25, DataType="single")
C_TOS_AEBJA_PedObjDyThre_Val = Simulink.Parameter(10, DataType="single")
C_TOS_AEBJA_PedTargetSize_Val = Simulink.Parameter(16, DataType="uint8")
C_TOS_AEBJA_TargetSize_Val = Simulink.Parameter(32, DataType="uint8")
C_TOS_AEBJA_VehObjDxThre_Val = Simulink.Parameter(50, DataType="single")
C_TOS_AEBJA_VehObjDyThre_Val = Simulink.Parameter(10, DataType="single")
C_TOS_AEBJA_VehTargetSize_Val = Simulink.Parameter(16, DataType="uint8")
C_TOS_AEBLat_ObjDxThre_Val = Simulink.Parameter(40, DataType="single")
C_TOS_AEBLat_PedDyThre_Val = Simulink.Parameter(8, DataType="single")
C_TOS_AEBLat_TargetSize_Val = Simulink.Parameter(10, DataType="uint8")
C_TOS_AEBLong_TargetInEgoFront_Flag = Simulink.Parameter(1, DataType="boolean")  % 目标是否位于本车道内标志位
C_TOS_AEB_EgoDxRefPoint_m = Simulink.Parameter(0, DataType="single")  % 车体系下dx参考点原点
C_TOS_AEB_EgoRAxletoFbumplength_m = Simulink.Parameter(0, DataType="single")
C_TOS_AEB_NumberOfEffectiveTargets = Simulink.Parameter(80, DataType="uint8")
C_TOS_AEB_OFMObjIDInvilad_Val = Simulink.Parameter(0, DataType="uint8")
C_TOS_AEB_OFM_ObjValid_Flag = Simulink.Parameter(1, DataType="uint8")
C_TOS_AEB_ObjFusType_FC_FR_Confirm_b = Simulink.Parameter(1, DataType="boolean")
C_TOS_AEB_ObjFusType_FR_Confirm_b = Simulink.Parameter(1, DataType="boolean")
C_TOS_AEB_ObjNotREElementType = Simulink.Parameter(0, DataType="uint8")
C_TOS_AEB_SpeedUnitConversionTO_km_h = Simulink.Parameter(3.6, DataType="single")  % 车速单位转换；m/s转换为km/h
C_TOS_AEB_StepTime_Val = Simulink.Parameter(0.05, DataType="single")
C_TOS_AEB_TargetFront_Flag = Simulink.Parameter(1, DataType="boolean")

TOS_A2L_AEBLong_PreCondition_ObserVale_bus = Simulink.Bus()
  TOS_AEBLong_Pre_FusionType: boolean
  TOS_AEBLong_Pre_FRSplitTarget: boolean
  TOS_AEBLong_Pre_BoundaryFilt: boolean
  TOS_AEBLong_Pre_RoadEdge: boolean
  TOS_AEBLong_Pre_DyConfirme: boolean
  TOS_AEBLong_Pre_Dy_1_ObserVale: boolean
  TOS_AEBLong_Pre_Dy_2_ObserVale: boolean
  TOS_AEBLong_Pre_Dy_3_LMValid_ObserVale: boolean
  TOS_AEBLong_Overlap_SameLane_ObserVale: boolean
  TOS_AEBLong_SameLane_ObserVale: boolean

TOS_AEBJunc_Ped_Pre_observal_bus = Simulink.Bus()
  AEBJunc_PedTargetFusionType_observal: boolean
  AEBJunc_PedTargetObjectType_observal: boolean
  AEBJunc_PedTargetDXDY_observal: boolean
  AEBJunc_PedTargetMovDir_observal: boolean

TOS_AEBJunc_Veh_Pre_observal_bus = Simulink.Bus()
  TOS_AEBJunc_Veh_FusType_observal: boolean
  TOS_AEBJunc_Veh_ObjType_observal: boolean
  TOS_AEBJunc_Veh_DXDY_observal: boolean
  TOS_AEBJunc_Veh_MovDir_observal: boolean
  TOS_AEBJunc_Veh_MovState_observal: boolean

TOS_AEBLat_Pre_observal_bus = Simulink.Bus()
  TOS_AEBLat_FusType_observal: boolean
  TOS_AEBLat_ObjType_observal: boolean
  TOS_AEBLat_DXDY_observal: boolean
  AEBLong_TargetMovDir_observal: boolean

TOS_AEBLong_Confirm_ObserVale_bus = Simulink.Bus()
  TOS_AEBLong_Dx_ObserVale: boolean
  TOS_AEBLong_ObstacleProb_ObserVale: boolean
  TOS_AEBLong_ExistProb_ObserVale: boolean
  TOS_AEBLong_FusType_ObserVale: boolean
  TOS_AEBLong_InEgoFront_ObserVale: boolean
  TOS_AEBLong_MovingDir_ObserVale: boolean
  TOS_AEBLong_Boundary_ObserVale: boolean
  TOS_AEBLong_Dy_ObserVale: boolean
  TOS_AEBLong_SteerWheelAng_ObserVale: boolean
  TOS_AEBLong_Overlap_ObserVale: boolean

TOS_AEBLong_Pre_ObserVale_bus = Simulink.Bus()
  TOS_AEBLong_Pre_FusionType: boolean
  TOS_AEBLong_Pre_FRSplitTarget: boolean
  TOS_AEBLong_Pre_BoundaryFilt: boolean
  TOS_AEBLong_Pre_RoadEdge: boolean
  TOS_AEBLong_Pre_DyConfirme: boolean
  TOS_AEBLong_Pre_Dy_1_ObserVale: boolean
  TOS_AEBLong_Pre_Dy_2_ObserVale: boolean
  TOS_AEBLong_Pre_Dy_3_LMValid_ObserVale: boolean
  TOS_AEBLong_Overlap_SameLane_ObserVale: boolean
  TOS_AEBLong_SameLane_ObserVale: boolean

TOS_A2L_AEBJunc_Ped_Pre_observal_bus = Simulink.Bus()
  AEBJunc_PedTargetFusionType_observal: boolean
  AEBJunc_PedTargetObjectType_observal: boolean
  AEBJunc_PedTargetDXDY_observal: boolean
  AEBJunc_PedTargetMovDir_observal: boolean

TOS_A2L_AEBJunc_Veh_Pre_observal_bus = Simulink.Bus()
  TOS_AEBJunc_Veh_FusType_observal: boolean
  TOS_AEBJunc_Veh_ObjType_observal: boolean
  TOS_AEBJunc_Veh_DXDY_observal: boolean
  TOS_AEBJunc_Veh_MovDir_observal: boolean
  TOS_AEBJunc_Veh_MovState_observal: boolean

TOS_A2L_AEBLat_Pre_observal_bus = Simulink.Bus()
  TOS_AEBLat_FusType_observal: boolean
  TOS_AEBLat_ObjType_observal: boolean
  TOS_AEBLat_DXDY_observal: boolean
  AEBLong_TargetMovDir_observal: boolean

TOS_A2L_AEBLong_TargeConfirm_ObserVale_bus = Simulink.Bus()
  TOS_AEBLong_Dx_ObserVale: boolean
  TOS_AEBLong_ObstacleProb_ObserVale: boolean
  TOS_AEBLong_ExistProb_ObserVale: boolean
  TOS_AEBLong_FusType_ObserVale: boolean
  TOS_AEBLong_InEgoFront_ObserVale: boolean
  TOS_AEBLong_MovingDir_ObserVale: boolean
  TOS_AEBLong_Boundary_ObserVale: boolean
  TOS_AEBLong_Dy_ObserVale: boolean
  TOS_AEBLong_SteerWheelAng_ObserVale: boolean
  TOS_AEBLong_Overlap_ObserVale: boolean