% Simulink data dictionary PvtIfVSM.sldd

HWAError_NoError = Simulink.Parameter(0)
HWAError_ErrorBlindness = Simulink.Parameter(4)
HWAError_ErrorFast = Simulink.Parameter(2)
HWAError_Error = Simulink.Parameter(1)
HWAError_Inhibit = Simulink.Parameter(3)

ACCExitConds = Simulink.Bus()
  VSM_ACCFastExitCons_Standstill3min: boolean
  VSM_ACCFastExitCons_StandstillNoBrakeForce: boolean
  VSM_ACCFastExitCons_RollingBack: boolean
  VSM_ACCFastExitCons_EngineOff: boolean
  VSM_ACCFastExitCons_BrakeDiskOverHeat: boolean
  VSM_ACCFastExitCons_Cancel: boolean
  VSM_ACCFastExitCons_EspOff: boolean
  VSM_ACCFastExitCons_NoForwardGear: boolean
  VSM_ACCFastExitCons_DriveBrakeExit: boolean
  VSM_ACCFastExitCons_EPBClosed: boolean
  VSM_ACCFastExitCons_DriverDoorOpen: boolean
  VSM_ACCSlowExitCons_EspActive400ms: boolean
  VSM_ACCSlowExitCons_MSRactive800ms: boolean
  VSM_ACCSlowExitCons_HDCactive40ms: boolean
  VSM_ACCSlowExitCons_ABSactive400ms: boolean
  VSM_ACCSlowExitCons_TCS1active3000ms: boolean
  VSM_ACCSlowExitCons_TCS2active3000ms: boolean
  VSM_ACCFastExitCons_DriverSBR: boolean

ACC_AD_Bus = Simulink.Bus()
  AccelPedlPosnDiagc: single
  ESP_MasterCylBrkPress: single
  BrkPedalSts: uint8
  EPBSts: uint8
  EPB_SwtPosn: uint8
  VehStandstill: uint8
  RLWheelSpd: single
  RRWheelSpd: single
  RLWheelDriveDirection: uint8
  RRWheelDriveDirection: uint8
  TGS_LEVER: uint8
  EngState: uint8
  Start_StopSts: uint8
  ESPFuncOffSts: boolean
  BrkDskOvrheatd: boolean
  DrvDoorSts: boolean
  DrvSBR: boolean
  CC_ACC_CANCEL_OFFSwt: boolean
  VDCActv: boolean
  MSRActv: boolean
  HDCCtrl: uint8
  ABSActv: boolean
  PTCActv: boolean
  BTCActv: boolean
  AVHSts: uint8
  VehSpd: single
  AccPedalOverride: boolean
  DrivingModDis: uint8
  EngLimpHomeSts: boolean
  APS_WorkSts: uint8
  ECMACCInterface: boolean
  CDDAvailable: boolean
  SysPowerMod: uint8
  CDDActv: boolean

ACC_DrvrOpr_Bus = Simulink.Bus()
  ACCon: boolean
  TJAOn: boolean
  User_ACCSet: boolean
  User_Res: boolean
  User_TJASet: boolean

AD_TSR_CAN = Simulink.Bus()
  TSRSwtReq: boolean
  TSRWarnSwtReq: boolean
  TSR_SnvtySet: int8
  SteerWheelAng: single
  SteerWheelAngSign: boolean
  VehSpd: single
  IP_VehSpdUnit: boolean
  RTurnLmpSwtSts: boolean
  LTurnLmpSwtSts: boolean
  VehYawRate: single
  FFogLmpSts_F_Pbox: boolean
  RFogLmpSts_R_Pbox: boolean
  WindshldWiprActvSts: boolean
  ACAmbTemp: single

BusLKA_lr = Simulink.Bus()
  left: boolean
  right: boolean

CenterLane = Simulink.Bus()
  LCKLane_A0: single
  LCKLane_A1: single
  LCKLane_A2: single
  LCKLane_A3: single
  LCKLane_Valid: boolean

EHR_Bus = Simulink.Bus()
  DrivingOnHighWay: uint8
  FormOfWay: uint8
  TunnelDistance: uint16
  RampDistance: uint16
  MapDataValid: uint8

ESS_AD_CAN_BUS = Simulink.Bus()
  VehSpd: single
  VDCActv: boolean
  PTCActv: boolean
  BTCActv: boolean
  ABSActv: boolean
  EPS_DrvInpTrqVal_HighReslolution: single
  SteerWheelSpd: single
  AccelPedlPosnDiagc: single
  VehLatAccel: single
  EPS_LKATorqOvrlDlvd: single
  SteerWheelSpdSign: boolean
  FrntWiprSwtSts: uint8
  HighBeamSts: boolean
  LowBeamSts: boolean
  ESPFuncOffSts: boolean
  DrvDoorSts: boolean
  PassengerDoorSts: boolean
  DrvSBR: boolean
  VehLgtAccel: single
  MSRActv: boolean
  ESS_PedSwtReq: boolean
  ESS_VehSwtReq: boolean
  EPS_LKATrqOvlDlvdSts: uint8
  canESP_MasterCylindBrakePress: single

ESS_VehicleSts_BUS = Simulink.Bus()
  AEB_PedTrig: boolean
  AEB_VehTrig: boolean
  Inter_FCW_Warn: uint8

HAP_CAN = Simulink.Bus()
  USS_FrontSys_Status: uint8
  USS_FLCNear_Obj_Confidence: single
  USS_FLCNear_Obj_Pos_X: single
  USS_FLCNear_Obj_Pos_Y: single
  USS_FLMNear_Obj_Confidence: single
  USS_FLMNear_Obj_Pos_X: single
  USS_FLMNear_Obj_Pos_Y: single
  USS_FRMNear_Obj_Confidence: single
  USS_FRMNear_Obj_Pos_X: single
  USS_FRMNear_Obj_Pos_Y: single
  USS_FRCNear_Obj_Confidence: single
  USS_FRCNear_Obj_Pos_X: single
  USS_FRCNear_Obj_Pos_Y: single

HWAExitConds = Simulink.Bus()
  AEB_Trigger: boolean
  AEB_Off: boolean
  VSM_HandsOffOverride: boolean
  VSM_HWASlowExitCons_HighSpdIn3s: boolean
  VSM_HWASlowExitCons_DMSInvalid: boolean
  VSM_HWASlowExitCons_MapDataInvalid: boolean
  VSM_HWASlowExitCons_DVRError: boolean
  VSM_HWASlowExitCons_SingleLineLost: boolean
  VSM_ACCSlowExitCons_EspActive400ms: boolean
  VSM_ACCSlowExitCons_MSRactive800ms: boolean
  VSM_ACCSlowExitCons_HDCactive40ms: boolean
  VSM_ACCSlowExitCons_ABSactive400ms: boolean
  VSM_ACCSlowExitCons_TCS1active3000ms: boolean
  VSM_ACCSlowExitCons_TCS2active3000ms: boolean
  VSM_ACCFastExitCons_DriverSBR: boolean
  VSM_HWASlowExitCons_NotHighWayArterialRoad5s: boolean
  VSM_HWASlowExitCons_LCKIdleWithoutTurnLight: boolean
  HWAError_Inhibit: boolean
  HWAError_Error: boolean
  HWAError_ErrorBlindness: boolean
  ACCNotActive: boolean
  HWAErrorFastExit: boolean
  ParkGearOrEPBActive: boolean
  StandstillTimeout: boolean
  OverrideTimeout: boolean
  SpeedTooHighWithOverride: boolean
  VSM_HWAActivationCons_VehicleSpdNormal3s: boolean
  VSM_HWAActivationCons_TJAActive: boolean
  VSM_HWAActivationCons_LCKActive: boolean
  VSM_HWAActivationCons_HandsOn5s: boolean
  VSM_HWAActivationCons_DriverStsGood10s: boolean
  VSM_HWAActivationCons_AEBSwitchOn: boolean
  VSM_HWAActivationCons_HWALineValid: boolean
  VSM_HWAActivationCons_NoSingleLineLost: boolean
  VSM_HWAActivationCons_NoDoubleLineLost: boolean
  VSM_HWAActivationCons_HighWayArterialRoad: boolean
  VSM_HWAActivationCons_NoTunnel300m: boolean
  VSM_HWAActivationCons_NoForkRoad300m: boolean
  VSM_HWAActivationCons_MapDataValid: boolean
  VSM_HWAActivationCons_DVRNoError: boolean
  VSM_HWAActivationCons_NoHWANoError: boolean
  VSM_HWAActivationCons_NoHWASafeStopHappened_b: boolean
  NoHWAFastExitConditions_b: boolean
  DoubleLineNotLostOrP0TargetExist: boolean
  DrivingOnHighWay: boolean
  FormOfWay: boolean
  MapDataValid: boolean
  HWANoError: boolean
  LTurnLightSwOff: boolean
  RTurnLightSwOff: boolean
  HazardLmpSwtStsOff: boolean
  DriverStsGood: boolean
  AEBSwitchOn: boolean

HWA_AD_Bus = Simulink.Bus()
  DVRWorkSts: uint8
  VDCActv: boolean
  MSRActv: boolean
  HDCCtrl: uint8
  ABSActv: boolean
  PTCActv: boolean
  BTCActv: boolean
  LTurnLmpSwtSts: boolean
  RTurnLmpSwtSts: boolean
  HazardLmpSwtSts: boolean
  EPBSts: uint8
  EPB_SwtPosn: uint8
  VehStandstill: uint8
  TGS_LEVER: uint8
  ESPFuncOffSts: boolean
  DrvDoorSts: boolean
  DrvSBR: boolean
  VehSpd: single
  ESP_MasterCylBrkPress: single
  BrkPedalSts: uint8

LCKIE_AD = Simulink.Bus()
  IntelligentEvaSwtReq: boolean
  canABSVehicleSpd: single
  canBCMWiperSwitchSts: uint8
  canBCMHighBeamSts: boolean
  canBCMLowBeamSts: boolean
  canBCMRearFogLmpSts: boolean
  canBCMFrontFogLmpSts: boolean
  canEPS_DriverInputTrqValue: single
  HWASts: uint8

LCKIE_Diagno = Simulink.Bus()
  IFVFail: boolean
  VehConfig: boolean

LCKIE_Lane = Simulink.Bus()
  Left_A0: single
  Left_A1: single
  Left_A2: single
  Left_A3: single
  Left_Valid: boolean
  Right_A0: single
  Right_A1: single
  Right_A2: single
  Right_A3: single
  Right_Valid: boolean
  LeftRE_A0: single
  LeftRE_A1: single
  LeftRE_A2: single
  LeftRE_A3: single
  LeftRE_Valid: boolean
  RightRE_A0: single
  RightRE_A1: single
  RightRE_A2: single
  RightRE_A3: single
  RightRE_Valid: boolean
  LaneCurve: single

LaneARe_SP = Simulink.Bus()
  Left_Valid: boolean
  Left_A3: single
  Left_A2: single
  Left_A1: single
  Left_A0: single
  Left_Range: single
  Left_Type: uint8
  Right_Valid: boolean
  Right_A3: single
  Right_A2: single
  Right_A1: single
  Right_A0: single
  Right_Range: single
  Right_Type: uint8
  LeftRE_Valid: boolean
  LeftRE_A3: single
  LeftRE_A2: single
  LeftRE_A1: single
  LeftRE_A0: single
  LeftRE_Range: single
  RightRE_Valid: boolean
  RightRE_A3: single
  RightRE_A2: single
  RightRE_A1: single
  RightRE_A0: single
  RightRE_Range: single
  LeftValid_A0: single
  LeftValid_A1: single
  LeftValid_A2: single
  LeftValid_A3: single
  LeftValid_Range: single
  LeftValid_Valid: boolean
  LeftValid_Type: uint8
  RightValid_A0: single
  RightValid_A1: single
  RightValid_A2: single
  RightValid_A3: single
  RightValid_Range: single
  RightValid_Valid: boolean
  RightValid_Type: uint8
  DeltaY: single
  T_A0: single
  T_A1: single
  T_A2: single
  T_A3: single
  T_Range: single
  T_Valid: boolean
  C_Lanewidth: single
  LeftChange: boolean
  RightChange: boolean
  Host_LRE: boolean
  Host_RRE: boolean
  LaneCurve: single
  HeadingAngle_In: boolean
  HeadingAngle_Out: boolean
  Left_LaneRe30: single
  Right_LaneRe30: single
  Scene_LaneValid: single
  LDWLKAELK_LWidth: single
  laneCenterA0: single
  laneCenterA1: single
  laneCenterA2: single
  laneCenterA3: single
  laneCenterValid: boolean
  Left_LaneValid: boolean
  Right_LaneValid: boolean
  Left_ReValid: boolean
  Right_ReValid: boolean
  Left_LaneOp_A0: single
  Right_LaneOp_A0: single
  Left_ReOp_A0: single
  Right_ReOp_A0: single
  Signal_Lane1: single
  Signal_Lane2: single
  Signal_Lane3: single
  Left_Lane_A1: single
  Right_Lane_A1: single
  Left_Re_A1: single
  Right_Re_A1: single

LaneARe_SP_LCK = Simulink.Bus()
  Left_Valid: boolean
  Left_A3: single
  Left_A2: single
  Left_A1: single
  Left_A0: single
  Left_Range: single
  Left_Type: uint8
  Right_Valid: boolean
  Right_A3: single
  Right_A2: single
  Right_A1: single
  Right_A0: single
  Right_Range: single
  Right_Type: uint8
  LeftRE_Valid: boolean
  LeftRE_A3: single
  LeftRE_A2: single
  LeftRE_A1: single
  LeftRE_A0: single
  LeftRE_Range: single
  RightRE_Valid: boolean
  RightRE_A3: single
  RightRE_A2: single
  RightRE_A1: single
  RightRE_A0: single
  RightRE_Range: single
  LeftValid_A0: single
  LeftValid_A1: single
  LeftValid_A2: single
  LeftValid_A3: single
  LeftValid_Range: single
  LeftValid_Valid: boolean
  LeftValid_Type: uint8
  RightValid_A0: single
  RightValid_A1: single
  RightValid_A2: single
  RightValid_A3: single
  RightValid_Range: single
  RightValid_Valid: boolean
  RightValid_Type: uint8
  DeltaY: single
  T_A0: single
  T_A1: single
  T_A2: single
  T_A3: single
  T_Range: single
  T_Valid: boolean
  C_Lanewidth: single
  LeftChange: boolean
  RightChange: boolean
  Host_LRE: boolean
  Host_RRE: boolean
  LaneCurve: single
  HeadingAngle_In: boolean
  HeadingAngle_Out: boolean
  Left_LaneRe30: single
  Right_LaneRe30: single
  Scene_LaneValid: single
  LDWLKAELK_LWidth: single
  laneCenterA0: single
  laneCenterA1: single
  laneCenterA2: single
  laneCenterA3: single
  laneCenterValid: boolean
  Left_LaneValid: boolean
  Right_LaneValid: boolean
  Left_ReValid: boolean
  Right_ReValid: boolean
  Left_LaneOp_A0: single
  Right_LaneOp_A0: single
  Left_ReOp_A0: single
  Right_ReOp_A0: single
  Signal_Lane1: single
  Signal_Lane2: single
  Signal_Lane3: single
  Left_Lane_A1: single
  Right_Lane_A1: single
  Left_Re_A1: single
  Right_Re_A1: single

LaneARe_SP_LDW = Simulink.Bus()
  Left_Valid: boolean
  Left_A3: single
  Left_A2: single
  Left_A1: single
  Left_A0: single
  Left_Range: single
  Left_Type: uint8
  Right_Valid: boolean
  Right_A3: single
  Right_A2: single
  Right_A1: single
  Right_A0: single
  Right_Range: single
  Right_Type: uint8
  LeftRE_Valid: boolean
  LeftRE_A3: single
  LeftRE_A2: single
  LeftRE_A1: single
  LeftRE_A0: single
  LeftRE_Range: single
  RightRE_Valid: boolean
  RightRE_A3: single
  RightRE_A2: single
  RightRE_A1: single
  RightRE_A0: single
  RightRE_Range: single
  LeftValid_A0: single
  LeftValid_A1: single
  LeftValid_A2: single
  LeftValid_A3: single
  LeftValid_Range: single
  LeftValid_Valid: boolean
  LeftValid_Type: uint8
  RightValid_A0: single
  RightValid_A1: single
  RightValid_A2: single
  RightValid_A3: single
  RightValid_Range: single
  RightValid_Valid: boolean
  RightValid_Type: uint8
  DeltaY: single
  T_A0: single
  T_A1: single
  T_A2: single
  T_A3: single
  T_Range: single
  T_Valid: boolean
  C_Lanewidth: single
  LeftChange: boolean
  RightChange: boolean
  Host_LRE: boolean
  Host_RRE: boolean
  LaneCurve: single
  HeadingAngle_In: boolean
  HeadingAngle_Out: boolean
  Left_LaneRe30: single
  Right_LaneRe30: single
  Scene_LaneValid: single
  LDWLKAELK_LWidth: single
  laneCenterA0: single
  laneCenterA1: single
  laneCenterA2: single
  laneCenterA3: single
  laneCenterValid: boolean
  Left_LaneValid: boolean
  Right_LaneValid: boolean
  Left_ReValid: boolean
  Right_ReValid: boolean
  Left_LaneOp_A0: single
  Right_LaneOp_A0: single
  Left_ReOp_A0: single
  Right_ReOp_A0: single
  Signal_Lane1: single
  Signal_Lane2: single
  Signal_Lane3: single
  Left_Lane_A1: single
  Right_Lane_A1: single
  Left_Re_A1: single
  Right_Re_A1: single

LaneARe_SP_LKA = Simulink.Bus()
  Left_Valid: boolean
  Left_A3: single
  Left_A2: single
  Left_A1: single
  Left_A0: single
  Left_Range: single
  Left_Type: uint8
  Right_Valid: boolean
  Right_A3: single
  Right_A2: single
  Right_A1: single
  Right_A0: single
  Right_Range: single
  Right_Type: uint8
  LeftRE_Valid: boolean
  LeftRE_A3: single
  LeftRE_A2: single
  LeftRE_A1: single
  LeftRE_A0: single
  LeftRE_Range: single
  RightRE_Valid: boolean
  RightRE_A3: single
  RightRE_A2: single
  RightRE_A1: single
  RightRE_A0: single
  RightRE_Range: single
  LeftValid_A0: single
  LeftValid_A1: single
  LeftValid_A2: single
  LeftValid_A3: single
  LeftValid_Range: single
  LeftValid_Valid: boolean
  LeftValid_Type: uint8
  RightValid_A0: single
  RightValid_A1: single
  RightValid_A2: single
  RightValid_A3: single
  RightValid_Range: single
  RightValid_Valid: boolean
  RightValid_Type: uint8
  DeltaY: single
  T_A0: single
  T_A1: single
  T_A2: single
  T_A3: single
  T_Range: single
  T_Valid: boolean
  C_Lanewidth: single
  LeftChange: boolean
  RightChange: boolean
  Host_LRE: boolean
  Host_RRE: boolean
  LaneCurve: single
  HeadingAngle_In: boolean
  HeadingAngle_Out: boolean
  Left_LaneRe30: single
  Right_LaneRe30: single
  Scene_LaneValid: single
  LDWLKAELK_LWidth: single
  laneCenterA0: single
  laneCenterA1: single
  laneCenterA2: single
  laneCenterA3: single
  laneCenterValid: boolean
  Left_LaneValid: boolean
  Right_LaneValid: boolean
  Left_ReValid: boolean
  Right_ReValid: boolean
  Left_LaneOp_A0: single
  Right_LaneOp_A0: single
  Left_ReOp_A0: single
  Right_ReOp_A0: single
  Signal_Lane1: single
  Signal_Lane2: single
  Signal_Lane3: single
  Left_Lane_A1: single
  Right_Lane_A1: single
  Left_Re_A1: single
  Right_Re_A1: single

TLS_DesLane = Simulink.Bus()
  TarLineValid: boolean
  TarLineC3: single
  TarLineC2: single
  TarLineC1: single
  TarLineC0: single
  TarLineRange: single
  TarDangerLevel: uint8

TLS_ELKLane = Simulink.Bus()
  ELK_LaneValid: boolean
  ELK_LaneA3: single
  ELK_LaneA2: single
  ELK_LaneA1: single
  ELK_LaneA0: single
  ELK_LaneRange: single

TLS_LKALane = Simulink.Bus()
  LKA_LaneValid: boolean
  LKA_LaneA3: single
  LKA_LaneA2: single
  LKA_LaneA1: single
  LKA_LaneA0: single
  LKA_LaneRange: single

VSM_LANE_BUS = Simulink.Bus()
  Valid: boolean
  C3: single
  C2: single
  C1: single
  C0: single
  Range: single

VSM_TSR_TSR_Measurements = Simulink.Bus()
  VSM_TSR_SLIF_Suppress: boolean
  VSM_TSR_SLW_Suppress: boolean
  VSM_TSR_SPL_Constancy_Req: uint8
  VSM_TSR_SPL_EndDist_Req: single
  VSM_TSR_SPL_End_Req: boolean
  SuppName_Value_Remain: uint8
  VSM_TSR_SPL_noSupp_Dist_Req: single
  VSM_TSR_SPL_noSupp_EnableReq: boolean
  VSM_TSR_SPL_noSupp_Value_Req: uint8
  whSupp_Dist_Remain: single
  SPL_whSupp_Dist_Req: single
  SPL_whSupp_EnableReq: boolean
  whSupp_Value_Remain: uint8
  SPL_whSupp_Value_Req: uint8
  VSM_TSR_SnvtySet: int8
  VSM_TSR_TS_Suppress: boolean

TSR_BUS = Simulink.Bus()
  TSRSts: uint8  % TSR模式
  TSRResp: boolean  % TSR开关状态
  TSRWarnResp: boolean  % TSR限速警告开关状态
  TSR_Snvty: int8  % TSR超速警告补偿（现行项目为偏移量）
  TSRSpdLimUnit: uint8  % HMI显示限速单位
  TSRSpdLimSts: uint8  % TSR限速状态
  TSRSpdLim: uint8  % TSR限速值显示
  TSRSpdLimCfdc: uint8  % 置信度
  TSRSpdLimWarn: boolean  % TSR超速警告状态
  TSRConSpdLim: uint8  % TSR条件限速值显示
  TSRConSpdLimWarn: boolean  % TSR条件限速超速警告状态
  TSRTrfcSignVal: uint8  % TSR交通标志类型
  TSRTrfcSignValCfdc: uint8  % 置信度
  SLW_Enable: boolean
  SLW_SpeedLimitValueWhSnvty: uint8
  SPL_noSupp_Dist_Remain: single
  SPL_whSupp_Dist_Remain: single
  TS_SignName_Dist_Remain: single
  SPL_noSupp_Value_Remain: uint8
  SPL_whSupp_Value_Remain: uint8
  TS_SignName_Value_Remain: uint8
  SPL_SuppName_Value_Remain: uint8
  SPLnoSuppDistKeep: single
  SPLwhSuppDistKeep: single
  TSDistKeep: single

ISL_InterSysInfoDisp = enum(DefaultValue="No_display", StorageType="uint8", AddClassNameToEnumNames=true)
  No_display = 0
  Speed_Limit_Confirm_Request = 1
  Speed_Limit_Take_Over_Request = 2

ISLActive = enum(DefaultValue="Inactive", StorageType="uint8", AddClassNameToEnumNames=true)
  Inactive = 0
  Active = 1
  ISL_Take_Over_Warning = 2

ACC_STATE = enum(DefaultValue="ACC_Off", AddClassNameToEnumNames=true)
  ACC_Off = 0
  ACC_Reject = 1
  ACC_Standby = 2
  ACC_ActiveControl = 3
  ACC_BrakeOnly = 4
  ACC_Override = 5
  ACC_StandWait = 6
  ACC_Failure = 7
  ACC_StandActive = 9

ELKSTATE = enum(DefaultValue="ELK_OFF", StorageType="uint8", AddClassNameToEnumNames=true)
  ELK_OFF = 0
  ELK_IDLE = 1
  ELK_READY = 2
  ELK_ACTIVE_LEFT = 3
  ELK_ACTIVE_RIGHT = 4
  ELK_ONCOMING_LEFT = 5
  ELK_ONCOMING_RIGHT = 6
  ELK_OVERTAKING_LEFT = 7
  ELK_OVERTAKING_RIGHT = 8
  ELK_ERROR = 9
  ELK_DEFAULT = 10

HWA_STATE = enum(DefaultValue="HWA_Off", StorageType="uint8", AddClassNameToEnumNames=true)
  HWA_Off = 0
  HWA_Idle = 1
  HWA_Ready = 2
  HWA_CCAct = 3
  HWA_Pause = 4
  HWA_LeftTurn = 5
  HWA_RightTurn = 6
  HWA_Error = 7
  HWA_SafeStop = 9
  HWA_SlowRetreat = 10
  HWA_LeftTurnPrepare = 11
  HWA_RightTurnPrepare = 12

LCK_STATE = enum(DefaultValue="LCK_Off", StorageType="uint8", AddClassNameToEnumNames=true)
  LCK_Off = 0
  LCK_Idle = 1
  LCK_Ready = 2
  LCK_Active = 3
  LCK_Error = 7

STATE = enum(DefaultValue="OFF", StorageType="uint8", AddClassNameToEnumNames=true)
  OFF = 0
  IDLE = 1
  READY = 2
  ACTIVE = 3
  ACTIVE_LEFT = 4
  ACTIVE_RIGHT = 5
  ERROR = 6
  DEFAULT = 7

TJA_STATE = enum(DefaultValue="TJA_Off", StorageType="uint8", AddClassNameToEnumNames=true)
  TJA_Off = 0
  TJA_Idle = 1
  TJA_Ready = 2
  TJA_Active = 3
  TJA_Error = 7
  TJA_SafeStop = 9
  TJA_Wait = 6
  TJA_SlowRetreat = 10