% Simulink data dictionary PvtParsAEB.sldd

P_AEB_LongCA_MasterCylinderPresSlopThres = AUTOSAR4.Parameter(10, SwCalibrationAccess="ReadWrite", StorageClass="ExportedGlobal", DataType="single", Min=0, Max=40)
AEB_vxvRefMs = AUTOSAR4.Signal(SwCalibrationAccess="ReadOnly", StorageClass="ExportedGlobal", DataType="single")
AEB_vxvRefMs_Can = AUTOSAR4.Signal(SwCalibrationAccess="ReadOnly", StorageClass="ExportedGlobal")
AEB_vxvRefMsFilt = AUTOSAR4.Signal(SwCalibrationAccess="ReadOnly", StorageClass="ExportedGlobal", DataType="single")
AEB_FIM_aDesiredGradientInital = AUTOSAR4.Signal(SwCalibrationAccess="ReadOnly", StorageClass="ExportedGlobal")
AEB_FIM_VERSION = AUTOSAR4.Signal(SwCalibrationAccess="ReadOnly", StorageClass="ExportedGlobal")
AEB_VSC_VERSION = AUTOSAR4.Signal(SwCalibrationAccess="ReadOnly", StorageClass="ExportedGlobal")
AEB_INPUT_VERSION = AUTOSAR4.Signal(SwCalibrationAccess="ReadOnly", StorageClass="ExportedGlobal")
AEB_LON_OBJ_VERSION = AUTOSAR4.Signal(SwCalibrationAccess="ReadOnly", StorageClass="ExportedGlobal")
AEB_JA_OBJ_VERSION = AUTOSAR4.Signal(SwCalibrationAccess="ReadOnly", StorageClass="ExportedGlobal")
AEB_FSM_VERSION = AUTOSAR4.Signal(SwCalibrationAccess="ReadOnly", StorageClass="ExportedGlobal")
AEB_FUNC_FUS_VERSION = AUTOSAR4.Signal(SwCalibrationAccess="ReadOnly", StorageClass="ExportedGlobal")
AEB_OUTPUT_VERSION = AUTOSAR4.Signal(SwCalibrationAccess="ReadOnly", StorageClass="ExportedGlobal")
AEB_IPHUT_INFO = AUTOSAR4.Signal(SwCalibrationAccess="ReadOnly", StorageClass="ExportedGlobal")
AEB_JaPedAEB_TTC_Thres = AUTOSAR4.Signal(SwCalibrationAccess="ReadOnly", StorageClass="ExportedGlobal")
AEB_JaPedAEBfullObjActiveCond = AUTOSAR4.Signal(SwCalibrationAccess="ReadOnly", StorageClass="ExportedGlobal", DataType="boolean")
AEB_JAPedAEBfullObjRelAborCond = AUTOSAR4.Signal(SwCalibrationAccess="ReadOnly", StorageClass="ExportedGlobal", DataType="boolean")
AEB_JAPedAEBfullSitActiveCond = AUTOSAR4.Signal(SwCalibrationAccess="ReadOnly", StorageClass="ExportedGlobal", DataType="boolean")
AEB_JaPedAEBfullVehActiveCond = AUTOSAR4.Signal(SwCalibrationAccess="ReadOnly", StorageClass="ExportedGlobal", DataType="boolean")
AEB_JaPedAEBfullVehRelAborCond = AUTOSAR4.Signal(SwCalibrationAccess="ReadOnly", StorageClass="ExportedGlobal", DataType="boolean")
AEB_JaPedObjCalcInfo = AUTOSAR4.Signal(SwCalibrationAccess="ReadOnly", StorageClass="ExportedGlobal")
AEB_JaPedObjPreSelectCond = AUTOSAR4.Signal(SwCalibrationAccess="ReadOnly", StorageClass="ExportedGlobal", DataType="boolean")
AEB_JaPedPrefill_TTC_Thres = AUTOSAR4.Signal(SwCalibrationAccess="ReadOnly", StorageClass="ExportedGlobal")
AEB_JaPedPrefillObjActiveCond = AUTOSAR4.Signal(SwCalibrationAccess="ReadOnly", StorageClass="ExportedGlobal", DataType="boolean")
AEB_JaPedPrefillObjRelAborCond = AUTOSAR4.Signal(SwCalibrationAccess="ReadOnly", StorageClass="ExportedGlobal", DataType="boolean")
AEB_JaPedPrefillSitRelAborCond = AUTOSAR4.Signal(SwCalibrationAccess="ReadOnly", StorageClass="ExportedGlobal", DataType="boolean")
AEB_JaPedPrefillVehActiveCond = AUTOSAR4.Signal(SwCalibrationAccess="ReadOnly", StorageClass="ExportedGlobal", DataType="boolean")
AEB_JaPedPrefillVehRelAborCond = AUTOSAR4.Signal(SwCalibrationAccess="ReadOnly", StorageClass="ExportedGlobal", DataType="boolean")
AEB_JaPedTgtCalcInfo = AUTOSAR4.Signal(SwCalibrationAccess="ReadOnly", StorageClass="ExportedGlobal")
AEB_JaPrefillSitActiveCond = AUTOSAR4.Signal(SwCalibrationAccess="ReadOnly", StorageClass="ExportedGlobal", DataType="boolean")
AEB_JaVehAEB_TTC_Thres = AUTOSAR4.Signal(SwCalibrationAccess="ReadOnly", StorageClass="ExportedGlobal")
AEB_JaVehAEBfullObjActiveCond = AUTOSAR4.Signal(SwCalibrationAccess="ReadOnly", StorageClass="ExportedGlobal", DataType="boolean")
AEB_JaVehAEBfullObjRelAborCond = AUTOSAR4.Signal(SwCalibrationAccess="ReadOnly", StorageClass="ExportedGlobal", DataType="boolean")
AEB_JaVehAEBfullSitActiveCond = AUTOSAR4.Signal(SwCalibrationAccess="ReadOnly", StorageClass="ExportedGlobal", DataType="boolean")
AEB_JaVehAEBfullVehActiveCond = AUTOSAR4.Signal(SwCalibrationAccess="ReadOnly", StorageClass="ExportedGlobal", DataType="boolean")
AEB_JaVehAEBfullVehRelAborCond = AUTOSAR4.Signal(SwCalibrationAccess="ReadOnly", StorageClass="ExportedGlobal", DataType="boolean")
AEB_JaVehObjCalcInfo = AUTOSAR4.Signal(SwCalibrationAccess="ReadOnly", StorageClass="ExportedGlobal")
AEB_JaVehObjPreSelectCond = AUTOSAR4.Signal(SwCalibrationAccess="ReadOnly", StorageClass="ExportedGlobal", DataType="boolean")
AEB_JaVehPrefill_TTC_Thres = AUTOSAR4.Signal(SwCalibrationAccess="ReadOnly", StorageClass="ExportedGlobal")
AEB_JaVehPrefillActiveSitCond = AUTOSAR4.Signal(SwCalibrationAccess="ReadOnly", StorageClass="ExportedGlobal", DataType="boolean")
AEB_JaVehPrefillObjActiveCond = AUTOSAR4.Signal(SwCalibrationAccess="ReadOnly", StorageClass="ExportedGlobal", DataType="boolean")
AEB_JaVehPrefillObjRelAborCond = AUTOSAR4.Signal(SwCalibrationAccess="ReadOnly", StorageClass="ExportedGlobal", DataType="boolean")
AEB_JaVehPrefillSitRelAborCond = AUTOSAR4.Signal(SwCalibrationAccess="ReadOnly", StorageClass="ExportedGlobal", DataType="boolean")
AEB_JaVehPrefillVehActiveCond = AUTOSAR4.Signal(SwCalibrationAccess="ReadOnly", StorageClass="ExportedGlobal", DataType="boolean")
AEB_JaVehPrefillVehRelAborCond = AUTOSAR4.Signal(SwCalibrationAccess="ReadOnly", StorageClass="ExportedGlobal", DataType="boolean")
AEB_JaVehTgtCalcInfo = AUTOSAR4.Signal(SwCalibrationAccess="ReadOnly", StorageClass="ExportedGlobal")
AEB_kapTraj = AUTOSAR4.Signal(SwCalibrationAccess="ReadOnly", StorageClass="ExportedGlobal")
AEB_LatCycAEB_TTC_Thres = AUTOSAR4.Signal(SwCalibrationAccess="ReadOnly", StorageClass="ExportedGlobal")
AEB_LatCycAEBpart_TTC_Thres = AUTOSAR4.Signal(SwCalibrationAccess="ReadOnly", StorageClass="ExportedGlobal")
AEB_latCycCalcInfo = AUTOSAR4.Signal(SwCalibrationAccess="ReadOnly", StorageClass="ExportedGlobal")
AEB_latCycObjPreSelectCond = AUTOSAR4.Signal(SwCalibrationAccess="ReadOnly", StorageClass="ExportedGlobal", DataType="boolean")
AEB_LatCycPrefill_TTC_Thres = AUTOSAR4.Signal(SwCalibrationAccess="ReadOnly", StorageClass="ExportedGlobal")
AEB_latCycTgtCalcInfo = AUTOSAR4.Signal(SwCalibrationAccess="ReadOnly", StorageClass="ExportedGlobal")
AEB_LatPedABA_TTC_Thres = AUTOSAR4.Signal(SwCalibrationAccess="ReadOnly", StorageClass="ExportedGlobal")
AEB_LatPedAEB_TTC_Thres = AUTOSAR4.Signal(SwCalibrationAccess="ReadOnly", StorageClass="ExportedGlobal")
AEB_latPedCalcInfo = AUTOSAR4.Signal(SwCalibrationAccess="ReadOnly", StorageClass="ExportedGlobal")
AEB_latPedObjPreSelectCond = AUTOSAR4.Signal(SwCalibrationAccess="ReadOnly", StorageClass="ExportedGlobal", DataType="boolean")
AEB_LatPedPrefill_TTC_Thres = AUTOSAR4.Signal(SwCalibrationAccess="ReadOnly", StorageClass="ExportedGlobal")
AEB_LatPedPreWarning_TTC = AUTOSAR4.Signal(SwCalibrationAccess="ReadOnly", StorageClass="ExportedGlobal")
AEB_latPedTgtCalcInfo = AUTOSAR4.Signal(SwCalibrationAccess="ReadOnly", StorageClass="ExportedGlobal")
AEB_LongCA_LatAvoidAccelThesBrk = AUTOSAR4.Signal(SwCalibrationAccess="ReadOnly", StorageClass="ExportedGlobal")
AEB_LongCA_LatAvoidAccelThesWarn = AUTOSAR4.Signal(SwCalibrationAccess="ReadOnly", StorageClass="ExportedGlobal")
AEB_LongCA_LowLvlBrkAccelAvoidThes = AUTOSAR4.Signal(SwCalibrationAccess="ReadOnly", StorageClass="ExportedGlobal")
AEB_LongCA_LowLvlBrkAccelAvoidThesBrk = AUTOSAR4.Signal(SwCalibrationAccess="ReadOnly", StorageClass="ExportedGlobal")
AEB_LongCA_LowLvlBrkAccelAvoidThesWarn = AUTOSAR4.Signal(SwCalibrationAccess="ReadOnly", StorageClass="ExportedGlobal")
AEB_LongCA_SeverityHighDlyTime = AUTOSAR4.Signal(SwCalibrationAccess="ReadOnly", StorageClass="ExportedGlobal")
AEB_longObjCalcInfo = AUTOSAR4.Signal(SwCalibrationAccess="ReadOnly", StorageClass="ExportedGlobal")
AEB_LonPedAEB_TTC_Thres = AUTOSAR4.Signal(SwCalibrationAccess="ReadOnly", StorageClass="ExportedGlobal")
AEB_LonVehABA_TTC_Thres = AUTOSAR4.Signal(SwCalibrationAccess="ReadOnly", StorageClass="ExportedGlobal")
AEB_LonVehAcuteWarning_TTC_Thres = AUTOSAR4.Signal(SwCalibrationAccess="ReadOnly", StorageClass="ExportedGlobal")
AEB_LonVehAEBfull_TTC_Thres = AUTOSAR4.Signal(SwCalibrationAccess="ReadOnly", StorageClass="ExportedGlobal")
AEB_LonVehAEBpart_TTC_Thres = AUTOSAR4.Signal(SwCalibrationAccess="ReadOnly", StorageClass="ExportedGlobal")
AEB_LonVehEBA_TTC_Thres = AUTOSAR4.Signal(SwCalibrationAccess="ReadOnly", StorageClass="ExportedGlobal")
AEB_LonVehPrefill_TTC_Thres = AUTOSAR4.Signal(SwCalibrationAccess="ReadOnly", StorageClass="ExportedGlobal")
AEB_LonVehPreWarning_TTC_Thres = AUTOSAR4.Signal(SwCalibrationAccess="ReadOnly", StorageClass="ExportedGlobal")
AEB_LonVruABA_TTC_Thres = AUTOSAR4.Signal(SwCalibrationAccess="ReadOnly", StorageClass="ExportedGlobal")
AEB_LonVruAcuteWarning_TTC_Thres = AUTOSAR4.Signal(SwCalibrationAccess="ReadOnly", StorageClass="ExportedGlobal")
AEB_LonVruAEB_TTC_Thres = AUTOSAR4.Signal(SwCalibrationAccess="ReadOnly", StorageClass="ExportedGlobal")
AEB_LonVruAEBPart_TTC_Thres = AUTOSAR4.Signal(SwCalibrationAccess="ReadOnly", StorageClass="ExportedGlobal")
AEB_LonVruEBA_TTC_Thres = AUTOSAR4.Signal(SwCalibrationAccess="ReadOnly", StorageClass="ExportedGlobal")
AEB_LonVruPrefill_TTC_Thres = AUTOSAR4.Signal(SwCalibrationAccess="ReadOnly", StorageClass="ExportedGlobal")
AEB_LonVruPreWarning_TTC = AUTOSAR4.Signal(SwCalibrationAccess="ReadOnly", StorageClass="ExportedGlobal")
AEB_pedABAObjRelAborCond = AUTOSAR4.Signal(SwCalibrationAccess="ReadOnly", StorageClass="ExportedGlobal", DataType="boolean")
AEB_pedABAObjRelSuppCond = AUTOSAR4.Signal(SwCalibrationAccess="ReadOnly", StorageClass="ExportedGlobal", DataType="boolean")
AEB_pedABASitRelAborCond = AUTOSAR4.Signal(SwCalibrationAccess="ReadOnly", StorageClass="ExportedGlobal", DataType="boolean")
AEB_pedABASituationRelSuppCond = AUTOSAR4.Signal(SwCalibrationAccess="ReadOnly", StorageClass="ExportedGlobal", DataType="boolean")
AEB_pedABAVehRelAborCond = AUTOSAR4.Signal(SwCalibrationAccess="ReadOnly", StorageClass="ExportedGlobal", DataType="boolean")
AEB_pedABAVehRelSuppCond = AUTOSAR4.Signal(SwCalibrationAccess="ReadOnly", StorageClass="ExportedGlobal", DataType="boolean")
AEB_pedAEBfullObjRelAborCond = AUTOSAR4.Signal(SwCalibrationAccess="ReadOnly", StorageClass="ExportedGlobal", DataType="boolean")
AEB_pedAEBfullObjRelSuppCond = AUTOSAR4.Signal(SwCalibrationAccess="ReadOnly", StorageClass="ExportedGlobal", DataType="boolean")
AEB_pedAEBfullSitRelAborCond = AUTOSAR4.Signal(SwCalibrationAccess="ReadOnly", StorageClass="ExportedGlobal", DataType="boolean")
AEB_pedAEBfullSitRelSuppCond = AUTOSAR4.Signal(SwCalibrationAccess="ReadOnly", StorageClass="ExportedGlobal", DataType="boolean")
AEB_pedAEBfullVehRelAborCond = AUTOSAR4.Signal(SwCalibrationAccess="ReadOnly", StorageClass="ExportedGlobal", DataType="boolean")
AEB_pedAEBfullVehRelSuppCond = AUTOSAR4.Signal(SwCalibrationAccess="ReadOnly", StorageClass="ExportedGlobal", DataType="boolean")
AEB_PedLatDistSuppCond4FullBrake = AUTOSAR4.Signal(SwCalibrationAccess="ReadOnly", StorageClass="ExportedGlobal")
AEB_PedLatVySuppCond4ABA = AUTOSAR4.Signal(SwCalibrationAccess="ReadOnly", StorageClass="ExportedGlobal")
AEB_PedLatVySuppCond4FullBrake = AUTOSAR4.Signal(SwCalibrationAccess="ReadOnly", StorageClass="ExportedGlobal")
AEB_PedLatVySuppCond4Prefill = AUTOSAR4.Signal(SwCalibrationAccess="ReadOnly", StorageClass="ExportedGlobal")
AEB_PedLatVySuppCond4Prewarning = AUTOSAR4.Signal(SwCalibrationAccess="ReadOnly", StorageClass="ExportedGlobal")
AEB_PedLongDistMinSuppCond4FullBrake = AUTOSAR4.Signal(SwCalibrationAccess="ReadOnly", StorageClass="ExportedGlobal")
AEB_PedLongDistMinSuppCond4PreWarning = AUTOSAR4.Signal(SwCalibrationAccess="ReadOnly", StorageClass="ExportedGlobal")
AEB_PedLongDistSuppCond4ABA = AUTOSAR4.Signal(SwCalibrationAccess="ReadOnly", StorageClass="ExportedGlobal")
AEB_PedLongDistSuppCond4FullBrake = AUTOSAR4.Signal(SwCalibrationAccess="ReadOnly", StorageClass="ExportedGlobal")
AEB_PedLongDistSuppCond4Prefill = AUTOSAR4.Signal(SwCalibrationAccess="ReadOnly", StorageClass="ExportedGlobal")
AEB_PedLongDistSuppCond4PreWarning = AUTOSAR4.Signal(SwCalibrationAccess="ReadOnly", StorageClass="ExportedGlobal")
AEB_pedPrefillObjRelAborCond = AUTOSAR4.Signal(SwCalibrationAccess="ReadOnly", StorageClass="ExportedGlobal", DataType="boolean")
AEB_pedPrefillObjRelSuppCond = AUTOSAR4.Signal(SwCalibrationAccess="ReadOnly", StorageClass="ExportedGlobal", DataType="boolean")
AEB_pedPrefillSitRelAborCond = AUTOSAR4.Signal(SwCalibrationAccess="ReadOnly", StorageClass="ExportedGlobal", DataType="boolean")
AEB_pedPrefillSitRelSuppCond = AUTOSAR4.Signal(SwCalibrationAccess="ReadOnly", StorageClass="ExportedGlobal", DataType="boolean")
AEB_pedPrefillVehRelAborCond = AUTOSAR4.Signal(SwCalibrationAccess="ReadOnly", StorageClass="ExportedGlobal", DataType="boolean")
AEB_pedPrefillVehRelSuppCond = AUTOSAR4.Signal(SwCalibrationAccess="ReadOnly", StorageClass="ExportedGlobal", DataType="boolean")
AEB_pedPreWarningObjRelAborCond = AUTOSAR4.Signal(SwCalibrationAccess="ReadOnly", StorageClass="ExportedGlobal", DataType="boolean")
AEB_pedPreWarningObjRelSuppCond = AUTOSAR4.Signal(SwCalibrationAccess="ReadOnly", StorageClass="ExportedGlobal", DataType="boolean")
AEB_pedPreWarningSitRelAborCond = AUTOSAR4.Signal(SwCalibrationAccess="ReadOnly", StorageClass="ExportedGlobal", DataType="boolean")
AEB_pedPreWarningSitRelSuppCond = AUTOSAR4.Signal(SwCalibrationAccess="ReadOnly", StorageClass="ExportedGlobal", DataType="boolean")
AEB_pedPreWarningVehRelAborCond = AUTOSAR4.Signal(SwCalibrationAccess="ReadOnly", StorageClass="ExportedGlobal", DataType="boolean")
AEB_pedPreWarningVehRelSuppCond = AUTOSAR4.Signal(SwCalibrationAccess="ReadOnly", StorageClass="ExportedGlobal", DataType="boolean")
AEB_psiDtOpt = AUTOSAR4.Signal(SwCalibrationAccess="ReadOnly", StorageClass="ExportedGlobal")
AEB_ReturnVal = AUTOSAR4.Signal(SwCalibrationAccess="ReadOnly", StorageClass="ExportedGlobal")
AEB_timeStamp = AUTOSAR4.Signal(SwCalibrationAccess="ReadOnly", StorageClass="ExportedGlobal")
AEB_TOS_AEB_JAOBJ = AUTOSAR4.Signal(SwCalibrationAccess="ReadOnly", StorageClass="ExportedGlobal")
AEB_TOS_AEB_LATOBJ = AUTOSAR4.Signal(SwCalibrationAccess="ReadOnly", StorageClass="ExportedGlobal")
AEB_TOS_AEB_LONOBJ = AUTOSAR4.Signal(SwCalibrationAccess="ReadOnly", StorageClass="ExportedGlobal")
AEB_TOS_TimeStamp_OC = AUTOSAR4.Signal(SwCalibrationAccess="ReadOnly", StorageClass="ExportedGlobal")
AEB_TrailerSts = AUTOSAR4.Signal(SwCalibrationAccess="ReadOnly", StorageClass="ExportedGlobal")
AEB_userData = AUTOSAR4.Signal(SwCalibrationAccess="ReadOnly", StorageClass="ExportedGlobal")
AEB_VCAN_ABM = AUTOSAR4.Signal(SwCalibrationAccess="ReadOnly", StorageClass="ExportedGlobal")
AEB_VCAN_BCM = AUTOSAR4.Signal(SwCalibrationAccess="ReadOnly", StorageClass="ExportedGlobal")
AEB_VCAN_CR = AUTOSAR4.Signal(SwCalibrationAccess="ReadOnly", StorageClass="ExportedGlobal")
AEB_VCAN_CSA = AUTOSAR4.Signal(SwCalibrationAccess="ReadOnly", StorageClass="ExportedGlobal")
AEB_VCAN_DCT = AUTOSAR4.Signal(SwCalibrationAccess="ReadOnly", StorageClass="ExportedGlobal")
AEB_VCAN_ECM = AUTOSAR4.Signal(SwCalibrationAccess="ReadOnly", StorageClass="ExportedGlobal")
AEB_VCAN_ESP = AUTOSAR4.Signal(SwCalibrationAccess="ReadOnly", StorageClass="ExportedGlobal")
AEB_VCAN_HCU = AUTOSAR4.Signal(SwCalibrationAccess="ReadOnly", StorageClass="ExportedGlobal")
AEB_VCAN_HUT = AUTOSAR4.Signal(SwCalibrationAccess="ReadOnly", StorageClass="ExportedGlobal")
AEB_VCAN_IB = AUTOSAR4.Signal(SwCalibrationAccess="ReadOnly", StorageClass="ExportedGlobal")
AEB_VCAN_TRAILER = AUTOSAR4.Signal(SwCalibrationAccess="ReadOnly", StorageClass="ExportedGlobal")
AEB_vehABAObjRelAborCond = AUTOSAR4.Signal(SwCalibrationAccess="ReadOnly", StorageClass="ExportedGlobal", DataType="boolean")
AEB_vehABAObjRelActiveCond = AUTOSAR4.Signal(SwCalibrationAccess="ReadOnly", StorageClass="ExportedGlobal", DataType="boolean")
AEB_vehABASitRelAborCond = AUTOSAR4.Signal(SwCalibrationAccess="ReadOnly", StorageClass="ExportedGlobal", DataType="boolean")
AEB_vehABASitRelActiveCond = AUTOSAR4.Signal(SwCalibrationAccess="ReadOnly", StorageClass="ExportedGlobal", DataType="boolean")
AEB_vehABAVehRelAborCond = AUTOSAR4.Signal(SwCalibrationAccess="ReadOnly", StorageClass="ExportedGlobal", DataType="boolean")
AEB_vehABAVehRelActiveCond = AUTOSAR4.Signal(SwCalibrationAccess="ReadOnly", StorageClass="ExportedGlobal", DataType="boolean")
AEB_vehAcuteWarningObjRelAborCond = AUTOSAR4.Signal(SwCalibrationAccess="ReadOnly", StorageClass="ExportedGlobal", DataType="boolean")
AEB_vehAcuteWarningObjRelActiveCond = AUTOSAR4.Signal(SwCalibrationAccess="ReadOnly", StorageClass="ExportedGlobal", DataType="boolean")
AEB_vehAcuteWarningSituationRelAborCond = AUTOSAR4.Signal(SwCalibrationAccess="ReadOnly", StorageClass="ExportedGlobal", DataType="boolean")
AEB_vehAcuteWarningSituationRelActiveCond = AUTOSAR4.Signal(SwCalibrationAccess="ReadOnly", StorageClass="ExportedGlobal", DataType="boolean")
AEB_vehAcuteWarningVehRelAborCond = AUTOSAR4.Signal(SwCalibrationAccess="ReadOnly", StorageClass="ExportedGlobal", DataType="boolean")
AEB_vehAcuteWarningVehRelActiveCond = AUTOSAR4.Signal(SwCalibrationAccess="ReadOnly", StorageClass="ExportedGlobal", DataType="boolean")
AEB_vehAEBfullObjRelAborCond = AUTOSAR4.Signal(SwCalibrationAccess="ReadOnly", StorageClass="ExportedGlobal", DataType="boolean")
AEB_vehAEBfullObjRelActiveCond = AUTOSAR4.Signal(SwCalibrationAccess="ReadOnly", StorageClass="ExportedGlobal", DataType="boolean")
AEB_vehAEBfullSitRelAborCond = AUTOSAR4.Signal(SwCalibrationAccess="ReadOnly", StorageClass="ExportedGlobal", DataType="boolean")
AEB_vehAEBfullSitRelActiveCond = AUTOSAR4.Signal(SwCalibrationAccess="ReadOnly", StorageClass="ExportedGlobal", DataType="boolean")
AEB_vehAEBfullVehRelAborCond = AUTOSAR4.Signal(SwCalibrationAccess="ReadOnly", StorageClass="ExportedGlobal", DataType="boolean")
AEB_vehAEBfullVehRelActiveCond = AUTOSAR4.Signal(SwCalibrationAccess="ReadOnly", StorageClass="ExportedGlobal", DataType="boolean")
AEB_vehAEBpartObjRelAborCond = AUTOSAR4.Signal(SwCalibrationAccess="ReadOnly", StorageClass="ExportedGlobal", DataType="boolean")
AEB_vehAEBpartObjRelActiveCond = AUTOSAR4.Signal(SwCalibrationAccess="ReadOnly", StorageClass="ExportedGlobal", DataType="boolean")
AEB_vehAEBpartSitRelActiveCond = AUTOSAR4.Signal(SwCalibrationAccess="ReadOnly", StorageClass="ExportedGlobal", DataType="boolean")
AEB_vehAEBpartSituationRelAborCond = AUTOSAR4.Signal(SwCalibrationAccess="ReadOnly", StorageClass="ExportedGlobal", DataType="boolean")
AEB_vehAEBpartVehRelAborCond = AUTOSAR4.Signal(SwCalibrationAccess="ReadOnly", StorageClass="ExportedGlobal", DataType="boolean")
AEB_vehAEBpartVehRelActiveCond = AUTOSAR4.Signal(SwCalibrationAccess="ReadOnly", StorageClass="ExportedGlobal", DataType="boolean")
AEB_vehEBAObjRelAborCond = AUTOSAR4.Signal(SwCalibrationAccess="ReadOnly", StorageClass="ExportedGlobal", DataType="boolean")
AEB_vehEBAObjRelActiveCond = AUTOSAR4.Signal(SwCalibrationAccess="ReadOnly", StorageClass="ExportedGlobal", DataType="boolean")
AEB_vehEBASitRelActiveCond = AUTOSAR4.Signal(SwCalibrationAccess="ReadOnly", StorageClass="ExportedGlobal", DataType="boolean")
AEB_vehEBASituationRelAborCond = AUTOSAR4.Signal(SwCalibrationAccess="ReadOnly", StorageClass="ExportedGlobal", DataType="boolean")
AEB_vehEBAVehRelAborCond = AUTOSAR4.Signal(SwCalibrationAccess="ReadOnly", StorageClass="ExportedGlobal", DataType="boolean")
AEB_vehEBAVehRelActiveCond = AUTOSAR4.Signal(SwCalibrationAccess="ReadOnly", StorageClass="ExportedGlobal")
AEB_vehLatentWarningObjRelAborCond = AUTOSAR4.Signal(SwCalibrationAccess="ReadOnly", StorageClass="ExportedGlobal", DataType="boolean")
AEB_vehLatentWarningObjRelActiveCond = AUTOSAR4.Signal(SwCalibrationAccess="ReadOnly", StorageClass="ExportedGlobal", DataType="boolean")
AEB_vehLatentWarningSitRelAborCond = AUTOSAR4.Signal(SwCalibrationAccess="ReadOnly", StorageClass="ExportedGlobal", DataType="boolean")
AEB_vehLatentWarningSitRelActiveCond = AUTOSAR4.Signal(SwCalibrationAccess="ReadOnly", StorageClass="ExportedGlobal", DataType="boolean")
AEB_vehLatentWarningVehRelAborCond = AUTOSAR4.Signal(SwCalibrationAccess="ReadOnly", StorageClass="ExportedGlobal", DataType="boolean")
AEB_vehLatentWarningVehRelActiveCond = AUTOSAR4.Signal(SwCalibrationAccess="ReadOnly", StorageClass="ExportedGlobal", DataType="boolean")
AEB_VehPowerTrainConfig = AUTOSAR4.Signal(SwCalibrationAccess="ReadOnly", StorageClass="ExportedGlobal", DataType="uint8")
AEB_vehPrefillObjRelAborCond = AUTOSAR4.Signal(SwCalibrationAccess="ReadOnly", StorageClass="ExportedGlobal", DataType="boolean")
AEB_vehPrefillObjRelActiveCond = AUTOSAR4.Signal(SwCalibrationAccess="ReadOnly", StorageClass="ExportedGlobal", DataType="boolean")
AEB_vehPrefillSitRelAborCond = AUTOSAR4.Signal(SwCalibrationAccess="ReadOnly", StorageClass="ExportedGlobal", DataType="boolean")
AEB_vehPrefillSituationRelActiveCond = AUTOSAR4.Signal(SwCalibrationAccess="ReadOnly", StorageClass="ExportedGlobal", DataType="boolean")
AEB_vehPrefillVehRelAborCond = AUTOSAR4.Signal(SwCalibrationAccess="ReadOnly", StorageClass="ExportedGlobal", DataType="boolean")
AEB_vehPrefillVehRelActiveCond = AUTOSAR4.Signal(SwCalibrationAccess="ReadOnly", StorageClass="ExportedGlobal", DataType="boolean")
AEB_vehPreWarningObjActiveCond = AUTOSAR4.Signal(SwCalibrationAccess="ReadOnly", StorageClass="ExportedGlobal", DataType="boolean")
AEB_vehPreWarningObjRelAborCond = AUTOSAR4.Signal(SwCalibrationAccess="ReadOnly", StorageClass="ExportedGlobal", DataType="boolean")
AEB_vehPreWarningSitRelAborCond = AUTOSAR4.Signal(SwCalibrationAccess="ReadOnly", StorageClass="ExportedGlobal", DataType="boolean")
AEB_vehPreWarningSitRelActiveCond = AUTOSAR4.Signal(SwCalibrationAccess="ReadOnly", StorageClass="ExportedGlobal", DataType="boolean")
AEB_vehPreWarningVehRelAborCond = AUTOSAR4.Signal(SwCalibrationAccess="ReadOnly", StorageClass="ExportedGlobal", DataType="boolean")
AEB_vehPreWarningVehRelActiveCond = AUTOSAR4.Signal(SwCalibrationAccess="ReadOnly", StorageClass="ExportedGlobal", DataType="boolean")
AEB_vehStateCalcInfo = AUTOSAR4.Signal(SwCalibrationAccess="ReadOnly", StorageClass="ExportedGlobal")
AEB_VSM_HMI = AUTOSAR4.Signal(SwCalibrationAccess="ReadOnly", StorageClass="ExportedGlobal")
AEB_VSM_LON_CTRL = AUTOSAR4.Signal(SwCalibrationAccess="ReadOnly", StorageClass="ExportedGlobal")
AEB_AEBFuncOut = AUTOSAR4.Signal(SwCalibrationAccess="ReadOnly", StorageClass="ExportedGlobal")
AEB_AEBModRawSts = AUTOSAR4.Signal(SwCalibrationAccess="ReadOnly", StorageClass="ExportedGlobal")
AEB_AEBModStsArb = AUTOSAR4.Signal(SwCalibrationAccess="ReadOnly", StorageClass="ExportedGlobal")
AEB_AWB_ConfigSet = AUTOSAR4.Signal(SwCalibrationAccess="ReadOnly", StorageClass="ExportedGlobal")
AEB_axvRefMs2 = AUTOSAR4.Signal(SwCalibrationAccess="ReadOnly", StorageClass="ExportedGlobal")
AEB_ayvRefMs2 = AUTOSAR4.Signal(SwCalibrationAccess="ReadOnly", StorageClass="ExportedGlobal")
AEB_CAL_AEB_CONFIG = AUTOSAR4.Signal(SwCalibrationAccess="ReadOnly", StorageClass="ExportedGlobal")
AEB_cycAEBfullObjRelAborCond = AUTOSAR4.Signal(SwCalibrationAccess="ReadOnly", StorageClass="ExportedGlobal", DataType="boolean")
AEB_cycAEBfullObjRelSuppCond = AUTOSAR4.Signal(SwCalibrationAccess="ReadOnly", StorageClass="ExportedGlobal", DataType="boolean")
AEB_cycAEBfullSitRelAborCond = AUTOSAR4.Signal(SwCalibrationAccess="ReadOnly", StorageClass="ExportedGlobal", DataType="boolean")
AEB_cycAEBfullSitRelSuppCond = AUTOSAR4.Signal(SwCalibrationAccess="ReadOnly", StorageClass="ExportedGlobal", DataType="boolean")

AEB_cycAEBfullVehRelAborCond = AUTOSAR4.Signal(SwCalibrationAccess="ReadOnly", StorageClass="ExportedGlobal", DataType="boolean")
AEB_cycAEBfullVehRelSuppCond = AUTOSAR4.Signal(SwCalibrationAccess="ReadOnly", StorageClass="ExportedGlobal", DataType="boolean")
AEB_cycAEBpartObjRelAborCond = AUTOSAR4.Signal(SwCalibrationAccess="ReadOnly", StorageClass="ExportedGlobal", DataType="boolean")
AEB_cycAEBpartObjRelSuppCond = AUTOSAR4.Signal(SwCalibrationAccess="ReadOnly", StorageClass="ExportedGlobal", DataType="boolean")
AEB_cycAEBpartSitRelAborCond = AUTOSAR4.Signal(SwCalibrationAccess="ReadOnly", StorageClass="ExportedGlobal", DataType="boolean")
AEB_cycAEBpartSitRelSuppCond = AUTOSAR4.Signal(SwCalibrationAccess="ReadOnly", StorageClass="ExportedGlobal", DataType="boolean")
AEB_cycAEBpartVehRelAborCond = AUTOSAR4.Signal(SwCalibrationAccess="ReadOnly", StorageClass="ExportedGlobal", DataType="boolean")
AEB_cycAEBpartVehRelSuppCond = AUTOSAR4.Signal(SwCalibrationAccess="ReadOnly", StorageClass="ExportedGlobal", DataType="boolean")
AEB_CycLatDistSuppCond4FullBrake = AUTOSAR4.Signal(SwCalibrationAccess="ReadOnly", StorageClass="ExportedGlobal")
AEB_CycLatDistSuppCond4PartBrake = AUTOSAR4.Signal(SwCalibrationAccess="ReadOnly", StorageClass="ExportedGlobal")
AEB_CycLatVySuppCond4FullBrake = AUTOSAR4.Signal(SwCalibrationAccess="ReadOnly", StorageClass="ExportedGlobal")
AEB_CycLatVySuppCond4PartBrake = AUTOSAR4.Signal(SwCalibrationAccess="ReadOnly", StorageClass="ExportedGlobal")
AEB_CycLatVySuppCond4Prefill = AUTOSAR4.Signal(SwCalibrationAccess="ReadOnly", StorageClass="ExportedGlobal")
AEB_CycLongDistMinSuppCond4FullBrake = AUTOSAR4.Signal(SwCalibrationAccess="ReadOnly", StorageClass="ExportedGlobal")
AEB_CycLongDistMinSuppCond4PartBrake = AUTOSAR4.Signal(SwCalibrationAccess="ReadOnly", StorageClass="ExportedGlobal")
AEB_CycLongDistSuppCond4FullBrake = AUTOSAR4.Signal(SwCalibrationAccess="ReadOnly", StorageClass="ExportedGlobal")
AEB_CycLongDistSuppCond4PartBrake = AUTOSAR4.Signal(SwCalibrationAccess="ReadOnly", StorageClass="ExportedGlobal")
AEB_CycLongDistSuppCond4Prefill = AUTOSAR4.Signal(SwCalibrationAccess="ReadOnly", StorageClass="ExportedGlobal")
AEB_cycPrefillObjRelAborCond = AUTOSAR4.Signal(SwCalibrationAccess="ReadOnly", StorageClass="ExportedGlobal", DataType="boolean")
AEB_cycPrefillObjRelSuppCond = AUTOSAR4.Signal(SwCalibrationAccess="ReadOnly", StorageClass="ExportedGlobal", DataType="boolean")
AEB_cycPrefillSitRelAborCond = AUTOSAR4.Signal(SwCalibrationAccess="ReadOnly", StorageClass="ExportedGlobal", DataType="boolean")
AEB_cycPrefillSitRelSuppCond = AUTOSAR4.Signal(SwCalibrationAccess="ReadOnly", StorageClass="ExportedGlobal", DataType="boolean")
AEB_cycPrefillVehRelAborCond = AUTOSAR4.Signal(SwCalibrationAccess="ReadOnly", StorageClass="ExportedGlobal", DataType="boolean")
AEB_cycPrefillVehRelSuppCond = AUTOSAR4.Signal(SwCalibrationAccess="ReadOnly", StorageClass="ExportedGlobal", DataType="boolean")
AEB_DFIM_AEB_STS = AUTOSAR4.Signal(SwCalibrationAccess="ReadOnly", StorageClass="ExportedGlobal")
AEB_EQ4_FCF_VD = AUTOSAR4.Signal(SwCalibrationAccess="ReadOnly", StorageClass="ExportedGlobal")
AEB_EQ4_FCF_VRU = AUTOSAR4.Signal(SwCalibrationAccess="ReadOnly", StorageClass="ExportedGlobal")
AEB_Fctb_Distance = AUTOSAR4.Signal(SwCalibrationAccess="ReadOnly", StorageClass="ExportedGlobal")
AEB_Fctb_Distance1 = AUTOSAR4.Signal(SwCalibrationAccess="ReadOnly", StorageClass="ExportedGlobal")
AEB_Fctb_Distance2 = AUTOSAR4.Signal(SwCalibrationAccess="ReadOnly", StorageClass="ExportedGlobal")
AEB_Fctb_State = AUTOSAR4.Signal(SwCalibrationAccess="ReadOnly", StorageClass="ExportedGlobal")
AEB_FctbIsNeedBrake = AUTOSAR4.Signal(SwCalibrationAccess="ReadOnly", StorageClass="ExportedGlobal")
AEB_Func_vehEBA_MCBrkPressDt = AUTOSAR4.Signal(SwCalibrationAccess="ReadOnly", StorageClass="ExportedGlobal")
AEB_Func_VehPreWarning_TTC_Thres = AUTOSAR4.Signal(SwCalibrationAccess="ReadOnly", StorageClass="ExportedGlobal")
AEB_FuncBlockTime = AUTOSAR4.Signal(SwCalibrationAccess="ReadOnly", StorageClass="ExportedGlobal")
AEB_FuncCondCalcInfo = AUTOSAR4.Signal(SwCalibrationAccess="ReadOnly", StorageClass="ExportedGlobal")
AEB_FuncImpSuppAbor = AUTOSAR4.Signal(SwCalibrationAccess="ReadOnly", StorageClass="ExportedGlobal")
AEB_FuncManeuAborCond = AUTOSAR4.Signal(SwCalibrationAccess="ReadOnly", StorageClass="ExportedGlobal")
AEB_IB_BrkPedalAppld = AUTOSAR4.Signal(SwCalibrationAccess="ReadOnly", StorageClass="ExportedGlobal")
AEB_JaCycObjCalcInfo = AUTOSAR4.Signal(SwCalibrationAccess="ReadOnly", StorageClass="ExportedGlobal")
AEB_JaCycObjPreSelectCond = AUTOSAR4.Signal(SwCalibrationAccess="ReadOnly", StorageClass="ExportedGlobal")
AEB_JaCycPrefillSitActiveCond = AUTOSAR4.Signal(SwCalibrationAccess="ReadOnly", StorageClass="ExportedGlobal")
AEB_JaCycPrefillVehActiveCond = AUTOSAR4.Signal(SwCalibrationAccess="ReadOnly", StorageClass="ExportedGlobal")
AEB_JaCycPrefillObjActiveCond = AUTOSAR4.Signal(SwCalibrationAccess="ReadOnly", StorageClass="ExportedGlobal")
AEB_JaCycPrefillObjRelAborCond = AUTOSAR4.Signal(SwCalibrationAccess="ReadOnly", StorageClass="ExportedGlobal")
AEB_JaCycPrefillVehRelAborCond = AUTOSAR4.Signal(SwCalibrationAccess="ReadOnly", StorageClass="ExportedGlobal")
AEB_JaCycPrefillSitRelAborCond = AUTOSAR4.Signal(SwCalibrationAccess="ReadOnly", StorageClass="ExportedGlobal")
AEB_JaCycAEBfullObjActiveCond = AUTOSAR4.Signal(SwCalibrationAccess="ReadOnly", StorageClass="ExportedGlobal")
AEB_JaCycAEBfullVehActiveCond = AUTOSAR4.Signal(SwCalibrationAccess="ReadOnly", StorageClass="ExportedGlobal")
AEB_JACycAEBfullSitActiveCond = AUTOSAR4.Signal(SwCalibrationAccess="ReadOnly", StorageClass="ExportedGlobal")
AEB_JACycAEBfullObjRelAborCond = AUTOSAR4.Signal(SwCalibrationAccess="ReadOnly", StorageClass="ExportedGlobal")
AEB_JaCycAEBfullVehRelAborCond = AUTOSAR4.Signal(SwCalibrationAccess="ReadOnly", StorageClass="ExportedGlobal")
AEB_VSC_vehUnstableSts = AUTOSAR4.Signal(SwCalibrationAccess="ReadOnly", StorageClass="ExportedGlobal")
AEB_VSC_vehAssociatedSysStsSuppFlg = AUTOSAR4.Signal(SwCalibrationAccess="ReadOnly", StorageClass="ExportedGlobal")
AEB_vehCanInfo = AUTOSAR4.Signal(SwCalibrationAccess="ReadOnly", StorageClass="ExportedGlobal")
AEB_JaCycAEB_TTC_Thres = AUTOSAR4.Signal(SwCalibrationAccess="ReadOnly", StorageClass="ExportedGlobal")
AEB_JaCycPrefill_TTC_Thres = AUTOSAR4.Signal(SwCalibrationAccess="ReadOnly", StorageClass="ExportedGlobal")
AEB_EbaIB_BrkPedalAppldOpt = AUTOSAR4.Signal(SwCalibrationAccess="ReadOnly", StorageClass="ExportedGlobal")
AEB_AebFullBrkTriggerInfo = AUTOSAR4.Signal(SwCalibrationAccess="ReadOnly", StorageClass="ExportedGlobal")
AEB_FIM_AchievedIncPhase = AUTOSAR4.Signal(SwCalibrationAccess="ReadOnly", StorageClass="ExportedGlobal")
AEB_FIM_BrakeInfo4Control = AUTOSAR4.Signal(SwCalibrationAccess="ReadOnly", StorageClass="ExportedGlobal")
AEB_FIM_GradientFuncDec = AUTOSAR4.Signal(SwCalibrationAccess="ReadOnly", StorageClass="ExportedGlobal")
AEB_FIM_GradientFuncInc = AUTOSAR4.Signal(SwCalibrationAccess="ReadOnly", StorageClass="ExportedGlobal")
AEB_FIM_ObjectPredicted = AUTOSAR4.Signal(SwCalibrationAccess="ReadOnly", StorageClass="ExportedGlobal")
AEB_FIM_aDesired = AUTOSAR4.Signal(SwCalibrationAccess="ReadOnly", StorageClass="ExportedGlobal")
AEB_FIM_currentIncPhase = AUTOSAR4.Signal(SwCalibrationAccess="ReadOnly", StorageClass="ExportedGlobal")
AEB_FIM_longBrakingFlg = AUTOSAR4.Signal(SwCalibrationAccess="ReadOnly", StorageClass="ExportedGlobal")
AEB_FIM_underDxSecure = AUTOSAR4.Signal(SwCalibrationAccess="ReadOnly", StorageClass="ExportedGlobal")
AEB_FIM_time4IncControlling = AUTOSAR4.Signal(SwCalibrationAccess="ReadOnly", StorageClass="ExportedGlobal")
AEB_FIM_DeltaDesiredaMaxGradientInitial = AUTOSAR4.Signal(SwCalibrationAccess="ReadOnly", StorageClass="ExportedGlobal")
AEB_FIM_aDesiredGradientInitial = AUTOSAR4.Signal(SwCalibrationAccess="ReadOnly", StorageClass="ExportedGlobal")
AEB_FIM_GradientOffsetInitial = AUTOSAR4.Signal(SwCalibrationAccess="ReadOnly", StorageClass="ExportedGlobal")
AEB_FIM_GradientDecHoldTime = AUTOSAR4.Signal(SwCalibrationAccess="ReadOnly", StorageClass="ExportedGlobal")
AEB_GradientFuncDecReset = AUTOSAR4.Signal(SwCalibrationAccess="ReadOnly", StorageClass="ExportedGlobal")
AEB_JaCycTgtCalcInfo = AUTOSAR4.Signal(SwCalibrationAccess="ReadOnly", StorageClass="ExportedGlobal")
AEB_LAT_OBJ_VERSION = AUTOSAR4.Signal(SwCalibrationAccess="ReadOnly", StorageClass="ExportedGlobal")
AEB_FIM_aDesiredJerkInitial = AUTOSAR4.Signal(SwCalibrationAccess="ReadOnly", StorageClass="ExportedGlobal")
AEB_FIM_currentIncStage = AUTOSAR4.Signal(SwCalibrationAccess="ReadOnly", StorageClass="ExportedGlobal")
AEB_FIM_JerkDecHoldTime = AUTOSAR4.Signal(SwCalibrationAccess="ReadOnly", StorageClass="ExportedGlobal")
AEB_FIM_ReachedIncStage = AUTOSAR4.Signal(SwCalibrationAccess="ReadOnly", StorageClass="ExportedGlobal")
AEB_JerkFuncDecReset = AUTOSAR4.Signal(SwCalibrationAccess="ReadOnly", StorageClass="ExportedGlobal")
P_AEB_FIM_BrkControllerConfig = AUTOSAR4.Parameter(0, SwCalibrationAccess="ReadWrite", StorageClass="ExportedGlobal", DataType="boolean")
P_AEB_Func_VehPreWarningTTC_OffsetOfACC = AUTOSAR4.Parameter(0, SwCalibrationAccess="ReadWrite", StorageClass="ExportedGlobal")
P_AEB_LongCA_HighLvlBrkAccelAvoidThes4Brake = AUTOSAR4.Parameter(-6.5, SwCalibrationAccess="ReadWrite", StorageClass="ExportedGlobal", DataType="single", Min=-12, Max=0)
P_AEB_FIM_SubjVelThres4underDxSecure = mpt.Parameter(0.5, StorageClass="ExportedGlobal")
P_AEB_FIM_VxThres4underDxSecure = mpt.Parameter(1, StorageClass="ExportedGlobal")
AEB_FIM_ObjectPredictTime4Control = mpt.Signal(StorageClass="ExportedGlobal")
AEB_LongCA_HighLvlBrkAccelAvoidThes4Brk = mpt.Signal(StorageClass="ExportedGlobal")
P_AEB_LongCA_HighLvlBrkAccelAvoidThes4BrkX = mpt.Parameter([4.17; 8.3; 12.5; 16.7; 20.83; 25; 29; 33.3], StorageClass="ExportedGlobal", DataType="single", Min=0, Max=100)
P_AEB_LongCA_HighLvlBrkAccelAvoidThes4BrkY = mpt.Parameter(repmat(-6.5, 8, 1), StorageClass="ExportedGlobal", DataType="single", Min=-10, Max=0)
AEB_LongCA_HighLvlBrkAccelAvoidThes4Warn = mpt.Signal(StorageClass="ExportedGlobal")
P_AEB_LongCA_HighLvlBrkAccelAvoidThes4WarnX = mpt.Parameter([2.7; 4.17; 5.56; 6.944; 8.3; 12.5; 16.6; 22.2], StorageClass="ExportedGlobal", DataType="single", Min=0, Max=100)
P_AEB_LongCA_HighLvlBrkAccelAvoidThes4WarnY = mpt.Parameter(repmat(-6.5, 8, 1), StorageClass="ExportedGlobal", DataType="single", Min=-10, Max=0)
P_AEB_LongCA_HighLvlBrkAccelAvoidThes4Warn = mpt.Parameter(-6.5, StorageClass="ExportedGlobal", DataType="single", Min=-12, Max=0)
P_AEB_FIM_ObjectPredictTimeMax = mpt.Parameter(0.3, StorageClass="ExportedGlobal", DataType="single")
P_AEB_InterSwtSts4CycAEBpart = AUTOSAR4.Parameter(1, SwCalibrationAccess="ReadWrite", StorageClass="ExportedGlobal", DataType="boolean")
P_AEB_InterSwtSts4JACycPrefill = AUTOSAR4.Parameter(1, SwCalibrationAccess="ReadWrite", StorageClass="ExportedGlobal", DataType="boolean")
P_AEB_InterSwtSts4JACycAEBfull = AUTOSAR4.Parameter(1, SwCalibrationAccess="ReadWrite", StorageClass="ExportedGlobal", DataType="boolean")
P_AEB_LongCA_OverlapEgoWidthMO = AUTOSAR4.Parameter(1, SwCalibrationAccess="ReadWrite", StorageClass="ExportedGlobal", DataType="single", Min=0, Max=2)
P_AEB_LongCA_OverlapEgoWidthSO = AUTOSAR4.Parameter(0.5, SwCalibrationAccess="ReadWrite", StorageClass="ExportedGlobal", DataType="single", Min=0, Max=2)
P_AEB_LongCA_ReactionTime4BrkDrvrAtntv = AUTOSAR4.Parameter(1, SwCalibrationAccess="ReadWrite", StorageClass="ExportedGlobal", DataType="single", Min=0, Max=3)
P_AEB_LongCA_ReactionTime4BrkDrvrInatntv = AUTOSAR4.Parameter(1.4, SwCalibrationAccess="ReadWrite", StorageClass="ExportedGlobal", DataType="single", Min=0, Max=3)
P_AEB_LongCA_ReactionTime4WarnDrvrAtntvHmiEarly = AUTOSAR4.Parameter(2.4, SwCalibrationAccess="ReadWrite", StorageClass="ExportedGlobal", DataType="single", Min=0, Max=3)
P_AEB_LongCA_ReactionTime4WarnDrvrAtntvHmiLate = AUTOSAR4.Parameter(1.5, SwCalibrationAccess="ReadWrite", StorageClass="ExportedGlobal", DataType="single", Min=0, Max=3)
P_AEB_LongCA_ReactionTime4WarnDrvrAtntvHmiMid = AUTOSAR4.Parameter(2.5, SwCalibrationAccess="ReadWrite", StorageClass="ExportedGlobal", DataType="single", Min=0, Max=3)
P_AEB_LongCA_ReactionTime4WarnDrvrInatntvHmiEarly = AUTOSAR4.Parameter(2.16, SwCalibrationAccess="ReadWrite", StorageClass="ExportedGlobal", DataType="single", Min=0, Max=3)
P_AEB_LongCA_ReactionTime4WarnDrvrInatntvHmiLate = AUTOSAR4.Parameter(2, SwCalibrationAccess="ReadWrite", StorageClass="ExportedGlobal", DataType="single", Min=0, Max=3)
P_AEB_LongCA_ReactionTime4WarnDrvrInatntvHmiMid = AUTOSAR4.Parameter(1.5, SwCalibrationAccess="ReadWrite", StorageClass="ExportedGlobal", DataType="single", Min=0, Max=3)
P_AEB_LongCA_ReleaseGasPedalSlopThes = AUTOSAR4.Parameter(90, SwCalibrationAccess="ReadWrite", StorageClass="ExportedGlobal", DataType="single", Min=0, Max=100)
P_AEB_LongCA_SeverityHighAccelMaxDecMOYHmiEarly = AUTOSAR4.Parameter(repmat(-10, 16, 1), SwCalibrationAccess="ReadWrite", StorageClass="ExportedGlobal", DataType="single", Min=-15, Max=0)
P_AEB_LongCA_SeverityHighAccelMaxDecMOYHmiMid = AUTOSAR4.Parameter(repmat(-10, 16, 1), SwCalibrationAccess="ReadWrite", StorageClass="ExportedGlobal", DataType="single", Min=-15, Max=0)
P_AEB_LongCA_SeverityHighBrkDlyTimeHighHmiEarly = AUTOSAR4.Parameter(0.26, SwCalibrationAccess="ReadWrite", StorageClass="ExportedGlobal", DataType="single", Min=0, Max=1)
P_AEB_LongCA_SeverityHighBrkDlyTimeHighHmiLate = AUTOSAR4.Parameter(0.26, SwCalibrationAccess="ReadWrite", StorageClass="ExportedGlobal", DataType="single", Min=0, Max=1)
P_AEB_LongCA_SeverityHighBrkDlyTimeHighHmiMid = AUTOSAR4.Parameter(0.26, SwCalibrationAccess="ReadWrite", StorageClass="ExportedGlobal", DataType="single", Min=0, Max=1)
P_AEB_LongCA_SeverityHighBrkDlyTimeLowHmiEarly = AUTOSAR4.Parameter(0.11, SwCalibrationAccess="ReadWrite", StorageClass="ExportedGlobal", DataType="single", Min=0, Max=1)
P_AEB_LongCA_SeverityHighBrkDlyTimeLowHmiLate = AUTOSAR4.Parameter(0.11, SwCalibrationAccess="ReadWrite", StorageClass="ExportedGlobal", DataType="single", Min=0, Max=1)
P_AEB_LongCA_SeverityHighBrkDlyTimeLowHmiMid = AUTOSAR4.Parameter(0.11, SwCalibrationAccess="ReadWrite", StorageClass="ExportedGlobal", DataType="single", Min=0, Max=1)
P_AEB_LongCA_SeverityHighDistSecureX = AUTOSAR4.Parameter([-20; -15; -10; -5; 0], SwCalibrationAccess="ReadWrite", StorageClass="ExportedGlobal", DataType="single", Min=-70, Max=0)
P_AEB_LongCA_SeverityHighVelMaxReduceMOHmiEarly = AUTOSAR4.Parameter(14, SwCalibrationAccess="ReadWrite", StorageClass="ExportedGlobal", DataType="single", Min=0, Max=25)
P_AEB_LongCA_SeverityHighVelMaxReduceSOHmiEarly = AUTOSAR4.Parameter(14, SwCalibrationAccess="ReadWrite", StorageClass="ExportedGlobal", DataType="single", Min=0, Max=25)
P_AEB_LongCA_StepGasPedalSlopThes = AUTOSAR4.Parameter(50, SwCalibrationAccess="ReadWrite", StorageClass="ExportedGlobal", DataType="single", Min=0, Max=100)
P_AEB_LongCA_StrWheelSpdThes = AUTOSAR4.Parameter(70, SwCalibrationAccess="ReadWrite", StorageClass="ExportedGlobal", DataType="single", Min=0, Max=200)
P_AEB_LongCA_TimeMaxCollisionPredict = AUTOSAR4.Parameter(2, SwCalibrationAccess="ReadWrite", StorageClass="ExportedGlobal", DataType="single", Min=0, Max=5)
P_AEB_LongCA_TimeStepCollisionPredict = AUTOSAR4.Parameter(0.1, SwCalibrationAccess="ReadWrite", StorageClass="ExportedGlobal", DataType="single", Min=0, Max=2)
P_AEB_LongCA_tACCProlongTimeThes = AUTOSAR4.Parameter(5, SwCalibrationAccess="ReadWrite", StorageClass="ExportedGlobal", DataType="single", Min=0, Max=10)
P_AEB_vehStateCalc_VehWheelThres = AUTOSAR4.Parameter(0.7, SwCalibrationAccess="ReadWrite", StorageClass="ExportedGlobal", DataType="single", Min=0, Max=2)
P_AEB_LongCA_SeverityHighSubjAccelThes4BrkDlyTimeHmiEarly = AUTOSAR4.Parameter(-1.5, SwCalibrationAccess="ReadWrite", StorageClass="ExportedGlobal", DataType="single", Min=-8, Max=0)
P_AEB_LongCA_SeverityHighSubjAccelThes4BrkDlyTimeHmiLate = AUTOSAR4.Parameter(-1.5, SwCalibrationAccess="ReadWrite", StorageClass="ExportedGlobal", DataType="single", Min=-8, Max=0)
P_AEB_LongCA_SeverityHighSubjAccelThes4BrkDlyTimeHmiMid = AUTOSAR4.Parameter(-1.5, SwCalibrationAccess="ReadWrite", StorageClass="ExportedGlobal", DataType="single", Min=-8, Max=0)
P_AEB_LongCA_SeverityHighVelMaxReduceMOHmiMid = AUTOSAR4.Parameter(14, SwCalibrationAccess="ReadWrite", StorageClass="ExportedGlobal", DataType="single", Min=0, Max=25)
P_AEB_LongCA_SeverityHighVelMaxReduceMOHmiLate = AUTOSAR4.Parameter(14, SwCalibrationAccess="ReadWrite", StorageClass="ExportedGlobal", DataType="single", Min=0, Max=25)
P_AEB_LongCA_SeverityHighVelMaxReduceSOHmiMid = AUTOSAR4.Parameter(14, SwCalibrationAccess="ReadWrite", StorageClass="ExportedGlobal", DataType="single", Min=0, Max=25)
P_AEB_LongCA_SeverityHighVelMaxReduceSOHmiLate = AUTOSAR4.Parameter(14, SwCalibrationAccess="ReadWrite", StorageClass="ExportedGlobal", DataType="single", Min=0, Max=25)
P_AEB_FIM_CtrlDistSecure = AUTOSAR4.Parameter(1, SwCalibrationAccess="ReadWrite", StorageClass="ExportedGlobal", DataType="single", Min=0, Max=5)
P_AEB_FIM_CtrlMinDec = AUTOSAR4.Parameter(-3, SwCalibrationAccess="ReadWrite", StorageClass="ExportedGlobal", DataType="single", Min=-15, Max=0)
P_AEB_FIM_CtrlDecGradient = AUTOSAR4.Parameter(-30, SwCalibrationAccess="ReadWrite", StorageClass="ExportedGlobal", DataType="single")
P_AEB_FIM_CtrlVxAbsObjThres = AUTOSAR4.Parameter(-0.3, SwCalibrationAccess="ReadWrite", StorageClass="ExportedGlobal", DataType="single", Min=-5, Max=5)
P_AEB_FIM_CtrlDxThres = AUTOSAR4.Parameter(0, SwCalibrationAccess="ReadWrite", StorageClass="ExportedGlobal", DataType="single", Min=-1, Max=10)
P_AEB_FIM_CtrlSubjVelThres = AUTOSAR4.Parameter(-0.5, SwCalibrationAccess="ReadWrite", StorageClass="ExportedGlobal", DataType="single", Min=-5, Max=5)
P_AEB_Func_vehLatentWarningTimeGapDurationThresDefault = AUTOSAR4.Parameter(7, SwCalibrationAccess="ReadWrite", StorageClass="ExportedGlobal", DataType="single", Min=0, Max=10)
P_AEB_Func_vehLatentWarningTimeGapThresDefault = AUTOSAR4.Parameter(0.55, SwCalibrationAccess="ReadWrite", StorageClass="ExportedGlobal", DataType="single", Min=0, Max=3)
P_AEB_LongCA_SeverityHighDistSecureY = AUTOSAR4.Parameter([1; 1; 0.6; 0.6; 0.55], SwCalibrationAccess="ReadWrite", StorageClass="ExportedGlobal", DataType="single", Min=0, Max=5)
P_AEB_FIM_BrkFuncMaxTimeQuitThres = AUTOSAR4.Parameter(1, SwCalibrationAccess="ReadWrite", StorageClass="ExportedGlobal", DataType="single", Min=0, Max=10)
P_AEB_FIM_DecelGradientQuitThres = AUTOSAR4.Parameter(100, SwCalibrationAccess="ReadWrite", StorageClass="ExportedGlobal", DataType="single", Min=0, Max=100)
P_AEB_Func_JaVehAEBPrefillTtcTimeOffset = AUTOSAR4.Parameter(0.3, SwCalibrationAccess="ReadWrite", StorageClass="ExportedGlobal", DataType="single")
P_AEB_Lon_LatW_Set = AUTOSAR4.Parameter(1, SwCalibrationAccess="ReadWrite", StorageClass="ExportedGlobal", DataType="uint8", Min=1, Max=3)
P_AEB_InterSwt4PreWarning = AUTOSAR4.Parameter(1, SwCalibrationAccess="ReadWrite", StorageClass="ExportedGlobal", DataType="boolean")
P_AEB_InterSwt4AcuteWarning = AUTOSAR4.Parameter(1, SwCalibrationAccess="ReadWrite", StorageClass="ExportedGlobal", DataType="boolean")
P_AEB_InterSwt4LatentWarning = AUTOSAR4.Parameter(1, SwCalibrationAccess="ReadWrite", StorageClass="ExportedGlobal", DataType="boolean")
P_AEB_InterSwtSts4Prefill = AUTOSAR4.Parameter(1, SwCalibrationAccess="ReadWrite", StorageClass="ExportedGlobal", DataType="boolean")
P_AEB_InterSwtSts4ABA = AUTOSAR4.Parameter(1, SwCalibrationAccess="ReadWrite", StorageClass="ExportedGlobal", DataType="boolean")
P_AEB_InterSwtSts4AEBpart = AUTOSAR4.Parameter(1, SwCalibrationAccess="ReadWrite", StorageClass="ExportedGlobal", DataType="boolean")
P_AEB_InterSwtSts4AEBfull = AUTOSAR4.Parameter(1, SwCalibrationAccess="ReadWrite", StorageClass="ExportedGlobal", DataType="boolean")
P_AEB_InterSwtSts4EBA = AUTOSAR4.Parameter(1, SwCalibrationAccess="ReadWrite", StorageClass="ExportedGlobal", DataType="boolean")
P_AEB_InterSwtSts4PedPrefill = AUTOSAR4.Parameter(1, SwCalibrationAccess="ReadWrite", StorageClass="ExportedGlobal", DataType="boolean")
P_AEB_InterSwtSts4PedABA = AUTOSAR4.Parameter(1, SwCalibrationAccess="ReadWrite", StorageClass="ExportedGlobal", DataType="boolean")
P_AEB_InterSwtSts4PedPreWaring = AUTOSAR4.Parameter(1, SwCalibrationAccess="ReadWrite", StorageClass="ExportedGlobal", DataType="boolean")
P_AEB_InterSwtSts4PedAEBfull = AUTOSAR4.Parameter(1, SwCalibrationAccess="ReadWrite", StorageClass="ExportedGlobal", DataType="boolean")
P_AEB_InterSwtSts4CycPrefill = AUTOSAR4.Parameter(1, SwCalibrationAccess="ReadWrite", StorageClass="ExportedGlobal", DataType="boolean")
P_AEB_InterSwtSts4CycAEBfull = AUTOSAR4.Parameter(1, SwCalibrationAccess="ReadWrite", StorageClass="ExportedGlobal", DataType="boolean")
P_AEB_InterSwtSts4JAPedPrefill = AUTOSAR4.Parameter(1, SwCalibrationAccess="ReadWrite", StorageClass="ExportedGlobal", DataType="boolean")
P_AEB_InterSwtSts4JAPedAEBfull = AUTOSAR4.Parameter(1, SwCalibrationAccess="ReadWrite", StorageClass="ExportedGlobal", DataType="boolean")
P_AEB_InterSwtSts4JAVehAEBfull = AUTOSAR4.Parameter(1, SwCalibrationAccess="ReadWrite", StorageClass="ExportedGlobal", DataType="boolean")
P_AEB_InterSwtSts4JAVehPrefill = AUTOSAR4.Parameter(1, SwCalibrationAccess="ReadWrite", StorageClass="ExportedGlobal", DataType="boolean")
P_AEB_LatCycCA_BrkJerkMaxPartBrake = AUTOSAR4.Parameter(-45, SwCalibrationAccess="ReadWrite", StorageClass="ExportedGlobal", DataType="single", Min=-64, Max=0)
P_AEB_JaVehCA_PreSelectDyThres = AUTOSAR4.Parameter(7, SwCalibrationAccess="ReadWrite", StorageClass="ExportedGlobal", Min=0, Max=10)
P_AEB_Func_JaVehPrefillSubjLatAccelThres = AUTOSAR4.Parameter(3, SwCalibrationAccess="ReadWrite", StorageClass="ExportedGlobal", Min=0, Max=5)
P_AEB_Func_vehAEBfullDxVarActivationThres = AUTOSAR4.Parameter(1, SwCalibrationAccess="ReadWrite", StorageClass="ExportedGlobal", DataType="single", Min=0, Max=30)
P_AEB_Func_vehAEBpartDxVarActivationThres = AUTOSAR4.Parameter(1, SwCalibrationAccess="ReadWrite", StorageClass="ExportedGlobal", DataType="single", Min=0, Max=30)
P_AEB_Func_vehAcuteWarningDxVarActivationThres = AUTOSAR4.Parameter(1, SwCalibrationAccess="ReadWrite", StorageClass="ExportedGlobal", DataType="single", Min=0, Max=30)
P_AEB_Func_vehEBADxVarActivationThres = AUTOSAR4.Parameter(1, SwCalibrationAccess="ReadWrite", StorageClass="ExportedGlobal", DataType="single", Min=0, Max=30)
P_AEB_Func_vehPreWarningDxVarActivationThres = AUTOSAR4.Parameter(1, SwCalibrationAccess="ReadWrite", StorageClass="ExportedGlobal", DataType="single", Min=0, Max=30)
P_AEB_LongCA_SeverityHighDlyTimeConfig = AUTOSAR4.Parameter(1, SwCalibrationAccess="ReadWrite", StorageClass="ExportedGlobal")
P_AEB_Func_vehAEBfullNoFusionOverlapActivationThresThresY = AUTOSAR4.Parameter([0.5; 0.5; 0.5; 0.5; 0.48], SwCalibrationAccess="ReadWrite", StorageClass="ExportedGlobal", DataType="single", Min=0, Max=1)
P_AEB_LongCA_LatAvoidAccelThesWarnHmiEarlySOX = AUTOSAR4.Parameter([5; 9; 22], SwCalibrationAccess="ReadWrite", StorageClass="ExportedGlobal", DataType="single", Min=0, Max=100)
P_AEB_LongCA_LatAvoidAccelThesWarnHmiLateSOX = AUTOSAR4.Parameter([5; 9; 18], SwCalibrationAccess="ReadWrite", StorageClass="ExportedGlobal", DataType="single", Min=0, Max=100)
P_AEB_LongCA_LatAvoidAccelThesWarnHmiMidSOX = AUTOSAR4.Parameter([5; 9; 18], SwCalibrationAccess="ReadWrite", StorageClass="ExportedGlobal", DataType="single", Min=0, Max=100)
P_AEB_LongCA_LatAvoidAccelThesWarnHmiEarlyMOX = AUTOSAR4.Parameter([5; 9; 22], SwCalibrationAccess="ReadWrite", StorageClass="ExportedGlobal", DataType="single", Min=0, Max=100)
P_AEB_LongCA_LatAvoidAccelThesWarnHmiLateMOX = AUTOSAR4.Parameter([5; 9; 18], SwCalibrationAccess="ReadWrite", StorageClass="ExportedGlobal", DataType="single", Min=0, Max=100)
P_AEB_LongCA_LatAvoidAccelThesWarnHmiMidMOX = AUTOSAR4.Parameter([5; 9; 18], SwCalibrationAccess="ReadWrite", StorageClass="ExportedGlobal", DataType="single", Min=0, Max=100)
P_AEB_Func_vehPreWarningTTCActivationThres = AUTOSAR4.Parameter(4.2, SwCalibrationAccess="ReadWrite", StorageClass="ExportedGlobal", DataType="single", Min=0, Max=10)
P_AEB_FuncFusLatPed_SubjVelOver40kphThres = AUTOSAR4.Parameter(11, SwCalibrationAccess="ReadWrite", StorageClass="ExportedGlobal", DataType="single")
P_AEB_FuncFusLatCyc_SubjVelOver40kphThres = AUTOSAR4.Parameter(11, SwCalibrationAccess="ReadWrite", StorageClass="ExportedGlobal", DataType="single")
P_AEB_Lat_CycAEB_SuppFusType_Set = AUTOSAR4.Parameter(1, SwCalibrationAccess="ReadWrite", StorageClass="ExportedGlobal", DataType="boolean")
P_AEB_Func_pedPrewarningVyhres4Radar = AUTOSAR4.Parameter(1, SwCalibrationAccess="ReadWrite", StorageClass="ExportedGlobal", DataType="single", Min=-3, Max=3)
P_AEB_Func_pedPrewarningVyThres4Fusion = AUTOSAR4.Parameter(1, SwCalibrationAccess="ReadWrite", StorageClass="ExportedGlobal", DataType="single", Min=-3, Max=3)
P_AEB_vehStateCalc_SubjVelThres4HCU_EngCond = AUTOSAR4.Parameter(3.33, SwCalibrationAccess="ReadWrite", StorageClass="ExportedGlobal", DataType="single")
P_AEB_Lat_PedFCW_Set = AUTOSAR4.Parameter(2, SwCalibrationAccess="ReadWrite", StorageClass="ExportedGlobal", DataType="uint8", Min=1, Max=3)
P_AEB_LatPedCA_DxSecureY = AUTOSAR4.Parameter([0; 0.5; 1; 1], SwCalibrationAccess="ReadWrite", StorageClass="ExportedGlobal", DataType="single", Min=0, Max=5)
P_AEB_LatCycCA_DxSecureY = AUTOSAR4.Parameter([0; 0.5; 1; 1], SwCalibrationAccess="ReadWrite", StorageClass="ExportedGlobal", DataType="single", Min=0, Max=5)
P_AEB_Func_vehAcuteWarningOverlapActivationThresY = AUTOSAR4.Parameter([0.4; 0.4; 0.3; 0.3; 0.28], SwCalibrationAccess="ReadWrite", StorageClass="ExportedGlobal", DataType="single", Min=0, Max=1)
P_AEB_Func_vehPreWarningOverlapActivationThresY = AUTOSAR4.Parameter([0.4; 0.4; 0.3; 0.3; 0.28], SwCalibrationAccess="ReadWrite", StorageClass="ExportedGlobal", DataType="single", Min=0, Max=1)
P_AEB_Func_vehAEBpartFusionOverlapActivationThresY = AUTOSAR4.Parameter(repmat(0.4, 5, 1), SwCalibrationAccess="ReadWrite", StorageClass="ExportedGlobal", DataType="single", Min=0, Max=1)
P_AEB_Func_vehAEBpartNoFusionOverlapActivationThresY = AUTOSAR4.Parameter(repmat(0.4, 5, 1), SwCalibrationAccess="ReadWrite", StorageClass="ExportedGlobal", DataType="single", Min=0, Max=1)
P_AEB_Func_vehAEBfullFusionOverlapActivationThresY = AUTOSAR4.Parameter(repmat(0.4, 5, 1), SwCalibrationAccess="ReadWrite", StorageClass="ExportedGlobal", DataType="single", Min=0, Max=1)
P_AEB_Func_vehEBAFusionOverlapActivationThresY = AUTOSAR4.Parameter(repmat(0.4, 5, 1), SwCalibrationAccess="ReadWrite", StorageClass="ExportedGlobal", DataType="single", Min=0, Max=1)
P_AEB_Func_vehEBANoFusionOverlapActivationThresY = AUTOSAR4.Parameter(repmat(0.4, 5, 1), SwCalibrationAccess="ReadWrite", StorageClass="ExportedGlobal", DataType="single", Min=0, Max=1)
P_AEB_Func_vehAEBpartOverlapAborThresY = AUTOSAR4.Parameter(repmat(0.3, 5, 1), SwCalibrationAccess="ReadWrite", StorageClass="ExportedGlobal", DataType="single", Min=0, Max=1)
P_AEB_Func_vehAEBfullOverlapAborThresY = AUTOSAR4.Parameter(repmat(0.3, 5, 1), SwCalibrationAccess="ReadWrite", StorageClass="ExportedGlobal", DataType="single", Min=0, Max=1)
P_AEB_Func_vehAEBfullObjMovingEscapeAborThres = AUTOSAR4.Parameter(0.65, SwCalibrationAccess="ReadWrite", StorageClass="ExportedGlobal", DataType="single", Min=0, Max=1)

P_AEB_LatPedCA_PreSelectVxThres = AUTOSAR4.Parameter(5, SwCalibrationAccess="ReadWrite", StorageClass="ExportedGlobal", DataType="single", Min=0, Max=5)
P_JaVehCA_PrecollisionVehLengthThres = AUTOSAR4.Parameter(4, SwCalibrationAccess="ReadWrite", StorageClass="ExportedGlobal", DataType="single", Min=0, Max=5)
P_JaVehCA_PrecollisionVehWidthThres = AUTOSAR4.Parameter(1.8, SwCalibrationAccess="ReadWrite", StorageClass="ExportedGlobal", DataType="single", Min=0, Max=3)
P_AEB_LatCycCA_BrkJerkMaxFullBrakeY = AUTOSAR4.Parameter(repmat(-20, 16, 1), SwCalibrationAccess="ReadWrite", StorageClass="ExportedGlobal", DataType="single", Min=-64, Max=0)
P_AEB_LatCycCA_BrkSysDelayTimeFullBrake = AUTOSAR4.Parameter(0.25, SwCalibrationAccess="ReadWrite", StorageClass="ExportedGlobal", DataType="single", Min=0, Max=1)
P_AEB_Func_vehAEBfullEscapeActivationThres = AUTOSAR4.Parameter(0.65, SwCalibrationAccess="ReadWrite", StorageClass="ExportedGlobal", DataType="single", Min=0, Max=1)
P_AEB_LatCycCA_CollisionRiskProbLengthThres = AUTOSAR4.Parameter(1.8, SwCalibrationAccess="ReadWrite", StorageClass="ExportedGlobal", DataType="single", Min=0, Max=3)
P_AEB_LatCycCA_CollisionRiskProbWidthThres = AUTOSAR4.Parameter(0.5, SwCalibrationAccess="ReadWrite", StorageClass="ExportedGlobal", DataType="single", Min=0, Max=3)
P_AEB_Lat_CycAEBP_Set = AUTOSAR4.Parameter(2, SwCalibrationAccess="ReadWrite", StorageClass="ExportedGlobal", DataType="uint8", Min=1, Max=3)
P_AEB_Lat_PedABP_Set = AUTOSAR4.Parameter(2, SwCalibrationAccess="ReadWrite", StorageClass="ExportedGlobal", DataType="uint8", Min=1, Max=3)
P_AEB_FIM_AEBVelDecMaxThres = AUTOSAR4.Parameter(17, SwCalibrationAccess="ReadWrite", StorageClass="ExportedGlobal", DataType="single", Min=0, Max=23.6)
P_AEB_Func_vehAEBfullFusionSubjVelMaxThresSO = AUTOSAR4.Parameter(17, SwCalibrationAccess="ReadWrite", StorageClass="ExportedGlobal", DataType="single", Min=0, Max=40)
P_AEB_Func_vehAEBfullDxActivationThresSO = AUTOSAR4.Parameter(28, SwCalibrationAccess="ReadWrite", StorageClass="ExportedGlobal", DataType="single", Min=0, Max=210)
P_AEB_Func_vehAEBfullDxActivationThresMO = AUTOSAR4.Parameter(35, SwCalibrationAccess="ReadWrite", StorageClass="ExportedGlobal", DataType="single", Min=0, Max=210)
P_AEB_Func_pedAEBfullDyLatBoundHmiEarlyMidY = AUTOSAR4.Parameter([1.9; 2.4; 2.75; 2.9; 2.9], SwCalibrationAccess="ReadWrite", StorageClass="ExportedGlobal", DataType="single", Min=0, Max=5)
P_AEB_Func_pedPrefillVxAbsObjSuppThres = AUTOSAR4.Parameter(1, SwCalibrationAccess="ReadWrite", StorageClass="ExportedGlobal")
P_AEB_Func_pedPreWarningVxAbsObjSuppThres = AUTOSAR4.Parameter(1, SwCalibrationAccess="ReadWrite", StorageClass="ExportedGlobal")
P_AEB_Func_pedABAVxAbsObjSuppThres = AUTOSAR4.Parameter(1, SwCalibrationAccess="ReadWrite", StorageClass="ExportedGlobal")
P_AEB_Func_pedAEBfullVxAbsObjSuppThres = AUTOSAR4.Parameter(1, SwCalibrationAccess="ReadWrite", StorageClass="ExportedGlobal")
P_AEB_Func_vehAEBfullDxActivationThresSOHighSpd = AUTOSAR4.Parameter(28, SwCalibrationAccess="ReadWrite", StorageClass="ExportedGlobal", Min=0, Max=210)
P_AEB_Func_vehAEBfullDxActivationThresSOLowSpd = AUTOSAR4.Parameter(23, SwCalibrationAccess="ReadWrite", StorageClass="ExportedGlobal")
P_AEB_JaPedCA_PreCollisionStepTime = AUTOSAR4.Parameter(0.1, SwCalibrationAccess="ReadWrite", StorageClass="ExportedGlobal", DataType="single", Min=0, Max=2)
P_AEB_JaVehCA_PreCollisionStepTime = AUTOSAR4.Parameter(0.05, SwCalibrationAccess="ReadWrite", StorageClass="ExportedGlobal", DataType="single", Min=0, Max=2)
P_AEB_Func_JaVehAEBfullSubjVelStrWheelAngleMinThresY = AUTOSAR4.Parameter([80; 80; 45; 45], SwCalibrationAccess="ReadWrite", StorageClass="ExportedGlobal", DataType="single", Min=0, Max=360)
P_AEB_Func_JaVehAEBfullObjVelSupThresMin = AUTOSAR4.Parameter(7, SwCalibrationAccess="ReadWrite", StorageClass="ExportedGlobal", DataType="single", Min=0, Max=20)
P_AEB_Func_JaVehAEBfullObjVelSupThresMax = AUTOSAR4.Parameter(20, SwCalibrationAccess="ReadWrite", StorageClass="ExportedGlobal", DataType="single", Min=0, Max=40)
P_AEB_Func_JaVehAEBfullMasterCylindBrkPressSupThres = AUTOSAR4.Parameter(5, SwCalibrationAccess="ReadWrite", StorageClass="ExportedGlobal", DataType="single", Min=0, Max=600)
P_AEB_Func_JaVehAEBfullGasPedalSupThres = AUTOSAR4.Parameter(50, SwCalibrationAccess="ReadWrite", StorageClass="ExportedGlobal", DataType="single", Min=0, Max=100)
P_AEB_Func_JaVehAEBfullSubjVelMin = AUTOSAR4.Parameter(2, SwCalibrationAccess="ReadWrite", StorageClass="ExportedGlobal", DataType="single", Min=0, Max=69)
P_AEB_Func_JaVehPrefillObjVelSupThresMin = AUTOSAR4.Parameter(7, SwCalibrationAccess="ReadWrite", StorageClass="ExportedGlobal", DataType="single", Min=0, Max=20)
P_AEB_Func_JaVehPrefillObjVelSupThresMax = AUTOSAR4.Parameter(20, SwCalibrationAccess="ReadWrite", StorageClass="ExportedGlobal", DataType="single", Min=0, Max=40)
P_AEB_Func_JaVehPrefillSubjVelStrWheelAngleMinThresY = AUTOSAR4.Parameter([80; 80; 45; 45], SwCalibrationAccess="ReadWrite", StorageClass="ExportedGlobal", DataType="single", Min=0, Max=360)
P_AEB_Func_JaVehPrefillSubjVelMin = AUTOSAR4.Parameter(2, SwCalibrationAccess="ReadWrite", StorageClass="ExportedGlobal", DataType="single", Min=0, Max=69)
P_AEB_Func_JaVehPrefillGasPedalSupThres = AUTOSAR4.Parameter(50, SwCalibrationAccess="ReadWrite", StorageClass="ExportedGlobal", DataType="single", Min=0, Max=100)
P_AEB_Func_JaPedPrefillGasPedalSupThres = AUTOSAR4.Parameter(50, SwCalibrationAccess="ReadWrite", StorageClass="ExportedGlobal", DataType="single", Min=0, Max=100)
P_AEB_Func_JaPedPrefillSubjVelStrWheelAngleMinThresY = AUTOSAR4.Parameter([150; 150; 150; 150], SwCalibrationAccess="ReadWrite", StorageClass="ExportedGlobal", DataType="single", Min=0, Max=360)
P_AEB_Func_JaPedPrefillBrkCondAborDelayTime = AUTOSAR4.Parameter(1.5, SwCalibrationAccess="ReadWrite", StorageClass="ExportedGlobal", DataType="single", Min=0, Max=5)
P_AEB_Func_JaPedPrefillObjDySupThres = AUTOSAR4.Parameter(1.5, SwCalibrationAccess="ReadWrite", StorageClass="ExportedGlobal", DataType="single")
P_AEB_Func_JaVehAEBfullObjDySupThresMin = AUTOSAR4.Parameter(1, SwCalibrationAccess="ReadWrite", StorageClass="ExportedGlobal", DataType="single")
P_AEB_Func_JaVehAEBfullBrkCondAborDelayTime = AUTOSAR4.Parameter(1.5, SwCalibrationAccess="ReadWrite", StorageClass="ExportedGlobal", DataType="single")
P_AEB_Func_JaVehPrefillObjDySupThresMin = AUTOSAR4.Parameter(1, SwCalibrationAccess="ReadWrite", StorageClass="ExportedGlobal")
P_AEB_Func_JaPedAEBfullObjDySupThres = AUTOSAR4.Parameter(1.5, SwCalibrationAccess="ReadWrite", StorageClass="ExportedGlobal", DataType="single", Max=10)
P_AEB_Func_JaPedAEBfullGasPedalSupThres = AUTOSAR4.Parameter(50, SwCalibrationAccess="ReadWrite", StorageClass="ExportedGlobal", DataType="single", Min=0, Max=100)
P_AEB_Func_JaPedAEBfullMasterCylindBrkPressSupThres = AUTOSAR4.Parameter(5, SwCalibrationAccess="ReadWrite", StorageClass="ExportedGlobal", DataType="single", Min=0, Max=300)
P_AEB_Func_JaPedAEBfullBrkCondAborDelayTime = AUTOSAR4.Parameter(1.5, SwCalibrationAccess="ReadWrite", StorageClass="ExportedGlobal", DataType="single", Min=0, Max=5)
P_AEB_LongCA_SeverityHighAccelGredientMOYHmiEarly = AUTOSAR4.Parameter(repmat(-15, 16, 1), SwCalibrationAccess="ReadWrite", StorageClass="ExportedGlobal", DataType="single", Min=-40, Max=0)
P_AEB_LongCA_SeverityHighAccelGredientMOYHmiLate = AUTOSAR4.Parameter(repmat(-15, 16, 1), SwCalibrationAccess="ReadWrite", StorageClass="ExportedGlobal", DataType="single", Min=-40, Max=0)
P_AEB_LongCA_SeverityHighAccelMaxDecSOYHmiEarly = AUTOSAR4.Parameter(repmat(-10, 16, 1), SwCalibrationAccess="ReadWrite", StorageClass="ExportedGlobal", DataType="single", Min=-15, Max=0)
P_AEB_LongCA_SeverityHighAccelMaxDecSOYHmiLate = AUTOSAR4.Parameter(repmat(-10, 16, 1), SwCalibrationAccess="ReadWrite", StorageClass="ExportedGlobal", DataType="single", Min=-15, Max=0)
P_AEB_LongCA_SeverityHighAccelMaxDecSOYHmiMid = AUTOSAR4.Parameter(repmat(-10, 16, 1), SwCalibrationAccess="ReadWrite", StorageClass="ExportedGlobal", DataType="single", Min=-15, Max=0)
P_AEB_FIM_VehAEBfullDecelMinThresMOY = AUTOSAR4.Parameter([-8; -8; -7; -3.5], SwCalibrationAccess="ReadWrite", StorageClass="ExportedGlobal", DataType="single", Min=-8, Max=0)
P_AEB_Lat_CycABP_Set = AUTOSAR4.Parameter(3, SwCalibrationAccess="ReadWrite", StorageClass="ExportedGlobal", DataType="uint8", Min=1, Max=3)
P_AEB_Func_JaPedPrefillObjVelSupThresMax = AUTOSAR4.Parameter(4, SwCalibrationAccess="ReadWrite", StorageClass="ExportedGlobal", DataType="single", Min=0, Max=40)
P_AEB_Func_JaPedPrefillSubjVelMin = AUTOSAR4.Parameter(1.8, SwCalibrationAccess="ReadWrite", StorageClass="ExportedGlobal", DataType="single", Min=0, Max=30)
P_AEB_Func_JaPedAEBfullObjVelSupThresMax = AUTOSAR4.Parameter(4, SwCalibrationAccess="ReadWrite", StorageClass="ExportedGlobal", DataType="single", Min=0, Max=40)
P_AEB_Func_JaPedAEBfullSubjVelMin = AUTOSAR4.Parameter(1.8, SwCalibrationAccess="ReadWrite", StorageClass="ExportedGlobal", DataType="single", Min=0, Max=30)
P_AEB_Lon_ABA_Set = AUTOSAR4.Parameter(2, SwCalibrationAccess="ReadWrite", StorageClass="ExportedGlobal", DataType="uint8", Min=1, Max=3)
P_AEB_Lon_ABP_Set = AUTOSAR4.Parameter(2, SwCalibrationAccess="ReadWrite", StorageClass="ExportedGlobal", DataType="uint8", Min=1, Max=3)
P_AEB_Lon_AEB_Set = AUTOSAR4.Parameter(2, SwCalibrationAccess="ReadWrite", StorageClass="ExportedGlobal", DataType="uint8", Min=1, Max=3)
P_AEB_Lon_AEBP_Set = AUTOSAR4.Parameter(2, SwCalibrationAccess="ReadWrite", StorageClass="ExportedGlobal", DataType="uint8", Min=1, Max=3)
P_AEB_Lon_AWB_Set = AUTOSAR4.Parameter(2, SwCalibrationAccess="ReadWrite", StorageClass="ExportedGlobal", DataType="uint8", Min=1, Max=3)
P_AEB_Lon_EBA_Set = AUTOSAR4.Parameter(2, SwCalibrationAccess="ReadWrite", StorageClass="ExportedGlobal", DataType="uint8", Min=1, Max=3)
P_AEB_Lon_FCW_Set = AUTOSAR4.Parameter(2, SwCalibrationAccess="ReadWrite", StorageClass="ExportedGlobal", DataType="uint8", Min=1, Max=3)
P_AEB_Ja_PedABP_Set = AUTOSAR4.Parameter(2, SwCalibrationAccess="ReadWrite", StorageClass="ExportedGlobal", DataType="uint8", Min=1, Max=3)
P_AEB_Ja_PedAEB_Set = AUTOSAR4.Parameter(2, SwCalibrationAccess="ReadWrite", StorageClass="ExportedGlobal", DataType="uint8", Min=1, Max=3)
P_AEB_Ja_VehABP_Set = AUTOSAR4.Parameter(3, SwCalibrationAccess="ReadWrite", StorageClass="ExportedGlobal", DataType="uint8", Min=1, Max=3)
P_AEB_AEBJaSwtReqConfig = AUTOSAR4.Parameter(1, SwCalibrationAccess="ReadWrite", StorageClass="ExportedGlobal", DataType="boolean")
P_AEB_AEBPedSwtReqConfig = AUTOSAR4.Parameter(1, SwCalibrationAccess="ReadWrite", StorageClass="ExportedGlobal", DataType="boolean")
P_AEB_VehSwtReqConfig = AUTOSAR4.Parameter(1, SwCalibrationAccess="ReadWrite", StorageClass="ExportedGlobal", DataType="boolean")

P_AEB_AWB_ConfigSet = AUTOSAR4.Parameter(1, SwCalibrationAccess="ReadWrite", StorageClass="ExportedGlobal", DataType="uint8", Min=0, Max=3)  % 当P_AEB_AWB_ConfigSet设为0时，AEB触发时车辆响应表现为FCW+AWB
  % 当P_AEB_AWB_ConfigSet设为1时，车辆响应表现为：各功能保持独立，响应对应功能

P_AEB_LatPedCA_BrkDlyTime = AUTOSAR4.Parameter(0.3, SwCalibrationAccess="ReadWrite", StorageClass="ExportedGlobal", DataType="single", Min=0, Max=1)
P_AEB_LatPedCA_AccelGredientMaxY = AUTOSAR4.Parameter(repmat(-40, 16, 1), SwCalibrationAccess="ReadWrite", StorageClass="ExportedGlobal", DataType="single")
P_AEB_LatPedCA_DecelMaxY = AUTOSAR4.Parameter(repmat(-7.5, 16, 1), SwCalibrationAccess="ReadWrite", StorageClass="ExportedGlobal", DataType="single", Min=-15, Max=0)
P_AEB_Func_vehPreWarningSubjVelMinActivationThres = AUTOSAR4.Parameter(7.78, SwCalibrationAccess="ReadWrite", StorageClass="ExportedGlobal", DataType="single", Min=0, Max=30)
P_AEB_Ja_VehAEB_Set = AUTOSAR4.Parameter(3, SwCalibrationAccess="ReadWrite", StorageClass="ExportedGlobal", DataType="uint8", Min=1, Max=3)
P_AEB_Func_pedPrewarningMasterCylindBrkPressSupThres = AUTOSAR4.Parameter(5, SwCalibrationAccess="ReadWrite", StorageClass="ExportedGlobal", DataType="single", Min=0, Max=300)
P_AEB_Func_pedABAVyThres4Fusion = AUTOSAR4.Parameter(1, SwCalibrationAccess="ReadWrite", StorageClass="ExportedGlobal", DataType="single", Min=-3, Max=3)
P_AEB_Func_pedABAVyThres4Radar = AUTOSAR4.Parameter(1, SwCalibrationAccess="ReadWrite", StorageClass="ExportedGlobal", DataType="single", Min=-3, Max=3)
P_AEB_Func_vehAEBpartSubjVelMinActivationThres = AUTOSAR4.Parameter(7.78, SwCalibrationAccess="ReadWrite", StorageClass="ExportedGlobal", DataType="single", Min=0, Max=30)
P_AEB_LatPedObjAbs_DyThres4deltaVy = AUTOSAR4.Parameter(1, SwCalibrationAccess="ReadWrite", StorageClass="ExportedGlobal")
P_AEB_FIM_VxAborThres = AUTOSAR4.Parameter(2, SwCalibrationAccess="ReadWrite", StorageClass="ExportedGlobal")
P_AEB_LongCA_SeverityHighAccelGredientSOYHmiEarly = AUTOSAR4.Parameter([-15; -15; -15; -15; -15; -15; -15; -12; -12; -12; -12; -12; -12; -12; -12; -12], SwCalibrationAccess="ReadWrite", StorageClass="ExportedGlobal", DataType="single", Min=-40, Max=0)
P_AEB_LongCA_SeverityHighAccelGredientSOYHmiLate = AUTOSAR4.Parameter([-15; -15; -15; -15; -15; -15; -15; -12; -12; -12; -12; -12; -12; -12; -12; -12], SwCalibrationAccess="ReadWrite", StorageClass="ExportedGlobal", DataType="single", Min=-40, Max=0)
P_AEB_LongCA_SeverityHighAccelGredientSOYHmiMid = AUTOSAR4.Parameter([-15; -15; -15; -15; -15; -15; -15; -12; -12; -12; -12; -12; -12; -12; -12; -12], SwCalibrationAccess="ReadWrite", StorageClass="ExportedGlobal", DataType="single", Min=-40, Max=0)
P_AEB_Func_JaPedAEBfullSubjVelStrWheelAngleMinThresY = AUTOSAR4.Parameter([130; 130; 130; 130], SwCalibrationAccess="ReadWrite", StorageClass="ExportedGlobal", DataType="single", Min=0, Max=360)
P_AEB_Lat_PedAEB_Set = AUTOSAR4.Parameter(2, SwCalibrationAccess="ReadWrite", StorageClass="ExportedGlobal", DataType="uint8", Min=1, Max=3)
P_AEB_Lat_PedABA_Set = AUTOSAR4.Parameter(2, SwCalibrationAccess="ReadWrite", StorageClass="ExportedGlobal", DataType="uint8", Min=1, Max=3)
P_AEB_LatCycObjAbs_DyThres4deltaVy = AUTOSAR4.Parameter(1, SwCalibrationAccess="ReadWrite", StorageClass="ExportedGlobal")
P_AEB_Lat_CycAEB_Set = AUTOSAR4.Parameter(3, SwCalibrationAccess="ReadWrite", StorageClass="ExportedGlobal", DataType="uint8", Min=1, Max=3)
P_AEB_Func_vehAEBpartVruFuncConfig = AUTOSAR4.Parameter(1, SwCalibrationAccess="ReadWrite", StorageClass="ExportedGlobal")
P_AEB_Lat_PedAEB_SuppFusType_Set = AUTOSAR4.Parameter(1, SwCalibrationAccess="ReadWrite", StorageClass="ExportedGlobal", DataType="boolean")
P_AEB_Func_vehEBA_MCBrkPressDtActivationThres = AUTOSAR4.Parameter(500, SwCalibrationAccess="ReadWrite", StorageClass="ExportedGlobal")
P_AEB_Func_vehEBA_MCBrkPressDtConfig = AUTOSAR4.Parameter(1, SwCalibrationAccess="ReadWrite", StorageClass="ExportedGlobal")
P_AEB_LatCycCA_PreSelectVxThres = AUTOSAR4.Parameter(5, SwCalibrationAccess="ReadWrite", StorageClass="ExportedGlobal", DataType="single", Min=0, Max=5)
P_AEB_LongCA_LatAvoidAccelThesWarnHmiMidMOY = AUTOSAR4.Parameter([-1.1; -1.5; -0.6], SwCalibrationAccess="ReadWrite", StorageClass="ExportedGlobal", DataType="single", Min=-10, Max=0)
P_AEB_LatCycCA_PreCollisionConfig = AUTOSAR4.Parameter(1, SwCalibrationAccess="ReadWrite", StorageClass="ExportedGlobal")
P_AEB_FIM_FctbDistThes = AUTOSAR4.Parameter(0.4, SwCalibrationAccess="ReadWrite", StorageClass="ExportedGlobal", DataType="single")
P_AEB_LongObjAbs_deltaFC_FRVxThresX = AUTOSAR4.Parameter([5.56; 8.33; 15.2; 22.2; 25], SwCalibrationAccess="ReadWrite", StorageClass="ExportedGlobal", DataType="single")
P_AEB_LongObjAbs_deltaFC_FRVxThresY = AUTOSAR4.Parameter([1.2; 1.5; 2; 2.5; 3], SwCalibrationAccess="ReadWrite", StorageClass="ExportedGlobal", DataType="single")
P_AEB_LongObjAbs_deltaFR_FusVxThresX = AUTOSAR4.Parameter([5.56; 8.33; 15.2; 22.2; 25], SwCalibrationAccess="ReadWrite", StorageClass="ExportedGlobal", DataType="single")
P_AEB_LongObjAbs_deltaFR_FusVxThresY = AUTOSAR4.Parameter(repmat(0.2, 5, 1), SwCalibrationAccess="ReadWrite", StorageClass="ExportedGlobal", DataType="single")
P_AEB_LongObjAbs_deltaFC_FusVxThresX = AUTOSAR4.Parameter([5.56; 8.33; 15.2; 22.2; 25], SwCalibrationAccess="ReadWrite", StorageClass="ExportedGlobal", DataType="single")
P_AEB_LongObjAbs_deltaFC_FusVxThresY = AUTOSAR4.Parameter([0.5; 0.5; 1.5; 2.5; 3], SwCalibrationAccess="ReadWrite", StorageClass="ExportedGlobal", DataType="single")
P_AEB_LatPedCA_AccelGredientMaxX = AUTOSAR4.Parameter([1.38; 2.78; 4.17; 5.56; 6.94; 8.3; 9.72; 11.1; 12.5; 13.8; 15.3; 16.67; 18.05; 19.4; 20.8; 22.2], SwCalibrationAccess="ReadWrite", StorageClass="ExportedGlobal", DataType="single", Min=0, Max=69.44)
P_AEB_LongCA_SeverityHighAccelGredientMOXHmiEarly = AUTOSAR4.Parameter([1.38; 2.78; 4.17; 5.56; 6.94; 8.3; 9.72; 11.1; 12.5; 13.8; 15.3; 16.67; 18.05; 19.4; 20.8; 22.2], SwCalibrationAccess="ReadWrite", StorageClass="ExportedGlobal", DataType="single", Min=0, Max=100)
P_AEB_LongCA_SeverityHighAccelGredientMOXHmiLate = AUTOSAR4.Parameter([1.38; 2.78; 4.17; 5.56; 6.94; 8.3; 9.72; 11.1; 12.5; 13.8; 15.3; 16.67; 18.05; 19.4; 20.8; 22.2], SwCalibrationAccess="ReadWrite", StorageClass="ExportedGlobal", DataType="single", Min=0, Max=100)
P_AEB_LongCA_SeverityHighAccelGredientMOXHmiMid = AUTOSAR4.Parameter([1.38; 2.78; 4.17; 5.56; 6.94; 8.3; 9.72; 11.1; 12.5; 13.8; 15.3; 16.67; 18.05; 19.4; 20.8; 22.2], SwCalibrationAccess="ReadWrite", StorageClass="ExportedGlobal", DataType="single", Min=0, Max=100)
P_AEB_LongCA_SeverityHighAccelGredientSOXHmiEarly = AUTOSAR4.Parameter([1.38; 2.78; 4.17; 5.56; 6.94; 8.3; 9.72; 11.1; 12.5; 13.8; 15.3; 16.67; 18.05; 19.4; 20.8; 22.2], SwCalibrationAccess="ReadWrite", StorageClass="ExportedGlobal", DataType="single", Min=0, Max=100)
P_AEB_LongCA_SeverityHighAccelGredientSOXHmiLate = AUTOSAR4.Parameter([1.38; 2.78; 4.17; 5.56; 6.94; 8.3; 9.72; 11.1; 12.5; 13.8; 15.3; 16.67; 18.05; 19.4; 20.8; 22.2], SwCalibrationAccess="ReadWrite", StorageClass="ExportedGlobal", DataType="single", Min=0, Max=100)
P_AEB_LongCA_SeverityHighAccelGredientSOXHmiMid = AUTOSAR4.Parameter([1.38; 2.78; 4.17; 5.56; 6.94; 8.3; 9.72; 11.1; 12.5; 13.8; 15.3; 16.67; 18.05; 19.4; 20.8; 22.2], SwCalibrationAccess="ReadWrite", StorageClass="ExportedGlobal", DataType="single", Min=0, Max=100)
P_AEB_LongCA_SeverityHighAccelMaxDecMOXHmiEarly = AUTOSAR4.Parameter([1.38; 2.78; 4.17; 5.56; 6.94; 8.3; 9.72; 11.1; 12.5; 13.8; 15.3; 16.67; 18.05; 19.4; 20.8; 22.2], SwCalibrationAccess="ReadWrite", StorageClass="ExportedGlobal", DataType="single", Min=0, Max=100)
P_AEB_LongCA_SeverityHighAccelMaxDecMOXHmiLate = AUTOSAR4.Parameter([1.38; 2.78; 4.17; 5.56; 6.94; 8.3; 9.72; 11.1; 12.5; 13.8; 15.3; 16.67; 18.05; 19.4; 20.8; 22.2], SwCalibrationAccess="ReadWrite", StorageClass="ExportedGlobal", DataType="single", Min=0, Max=100)
P_AEB_LongCA_SeverityHighAccelMaxDecMOXHmiMid = AUTOSAR4.Parameter([1.38; 2.78; 4.17; 5.56; 6.94; 8.3; 9.72; 11.1; 12.5; 13.8; 15.3; 16.67; 18.05; 19.4; 20.8; 22.2], SwCalibrationAccess="ReadWrite", StorageClass="ExportedGlobal", DataType="single", Min=0, Max=100)
P_AEB_LongCA_SeverityHighAccelMaxDecSOXHmiEarly = AUTOSAR4.Parameter([1.38; 2.78; 4.17; 5.56; 6.94; 8.3; 9.72; 11.1; 12.5; 13.8; 15.3; 16.67; 18.05; 19.4; 20.8; 22.2], SwCalibrationAccess="ReadWrite", StorageClass="ExportedGlobal", DataType="single", Min=0, Max=100)
P_AEB_LongCA_SeverityHighAccelMaxDecSOXHmiLate = AUTOSAR4.Parameter([1.38; 2.78; 4.17; 5.56; 6.94; 8.3; 9.72; 11.1; 12.5; 13.8; 15.3; 16.67; 18.05; 19.4; 20.8; 22.2], SwCalibrationAccess="ReadWrite", StorageClass="ExportedGlobal", DataType="single", Min=0, Max=100)
P_AEB_LongCA_SeverityHighAccelMaxDecSOXHmiMid = AUTOSAR4.Parameter([1.38; 2.78; 4.17; 5.56; 6.94; 8.3; 9.72; 11.1; 12.5; 13.8; 15.3; 16.67; 18.05; 19.4; 20.8; 22.2], SwCalibrationAccess="ReadWrite", StorageClass="ExportedGlobal", DataType="single", Min=0, Max=100)
P_AEB_LatPedCA_DecelMaxX = AUTOSAR4.Parameter([1.38; 2.78; 4.17; 5.56; 6.94; 8.3; 9.72; 11.1; 12.5; 13.8; 15.3; 16.67; 18.05; 19.4; 20.8; 22.2], SwCalibrationAccess="ReadWrite", StorageClass="ExportedGlobal", DataType="single", Min=0, Max=69.44)
P_AEB_LatCycCA_DecelMaxFullBrakeX = AUTOSAR4.Parameter([1.38; 2.78; 4.17; 5.56; 6.94; 8.3; 9.72; 11.1; 12.5; 13.8; 15.3; 16.67; 18.05; 19.4; 20.8; 22.2], SwCalibrationAccess="ReadWrite", StorageClass="ExportedGlobal", DataType="single", Min=0, Max=69.44)
P_AEB_LatCycCA_BrkJerkMaxFullBrakeX = AUTOSAR4.Parameter([1.38; 2.78; 4.17; 5.56; 6.94; 8.3; 9.72; 11.1; 12.5; 13.8; 15.3; 16.67; 18.05; 19.4; 20.8; 22.2], SwCalibrationAccess="ReadWrite", StorageClass="ExportedGlobal", DataType="single", Min=0, Max=69.44)
P_AEB_LatCycCA_BrkJerkMaxPartBrakeX = AUTOSAR4.Parameter([1.38; 2.78; 4.17; 5.56; 6.94; 8.3; 9.72; 11.1; 12.5; 13.8; 15.3; 16.67; 18.05; 19.4; 20.8; 22.2], SwCalibrationAccess="ReadWrite", StorageClass="ExportedGlobal", DataType="single", Min=0, Max=69.44)
P_AEB_LatPedObjAbs_SensorDeltVyThresX = AUTOSAR4.Parameter([2.78; 5.56; 8.3; 11.1; 13.8; 16.67], SwCalibrationAccess="ReadWrite", StorageClass="ExportedGlobal", DataType="single")
P_AEB_LatCycObjAbs_SensorDeltVyThresX = AUTOSAR4.Parameter([2.78; 5.56; 8.3; 11.1; 13.8; 16.67], SwCalibrationAccess="ReadWrite", StorageClass="ExportedGlobal", DataType="single")
P_AEB_LatCycObjAbs_SensorDeltVyThresY = AUTOSAR4.Parameter(repmat(2, 6, 1), SwCalibrationAccess="ReadWrite", StorageClass="ExportedGlobal", DataType="single")
P_AEB_LongCA_SeverityHighAccelMaxDecMOYHmiLate = AUTOSAR4.Parameter(repmat(-10, 16, 1), SwCalibrationAccess="ReadWrite", StorageClass="ExportedGlobal", DataType="single", Min=-15, Max=0)
P_AEB_LatCycCA_DecelMaxPartBrakeX = AUTOSAR4.Parameter([1.38; 2.78; 4.17; 5.56; 6.94; 8.3; 9.72; 11.1; 12.5; 13.8; 15.3; 16.67; 18.05; 19.4; 20.8; 22.2], SwCalibrationAccess="ReadWrite", StorageClass="ExportedGlobal", DataType="single", Min=0, Max=69.44)
P_AEB_LatCycCA_DecelMaxPartBrakeY = AUTOSAR4.Parameter(repmat(-5.75, 16, 1), SwCalibrationAccess="ReadWrite", StorageClass="ExportedGlobal", DataType="single", Min=-15, Max=0)
P_AEB_JaPedAEB_TTC_ThresX = AUTOSAR4.Parameter([2.78; 5.56; 8.33; 16.67], SwCalibrationAccess="ReadWrite", StorageClass="ExportedGlobal", DataType="single")
P_AEB_JaPedAEB_TTC_ThresY = AUTOSAR4.Parameter([0.7; 0.8; 1; 1], SwCalibrationAccess="ReadWrite", StorageClass="ExportedGlobal", DataType="single")
P_AEB_JaPedPrefill_TTC_ThresX = AUTOSAR4.Parameter([2.78; 5.56; 8.33; 16.67], SwCalibrationAccess="ReadWrite", StorageClass="ExportedGlobal", DataType="single")
P_AEB_JaPedPrefill_TTC_ThresY = AUTOSAR4.Parameter([0.9; 1; 1.2; 1.2], SwCalibrationAccess="ReadWrite", StorageClass="ExportedGlobal", DataType="single")
P_AEB_JaVehAEB_TTC_ThresX = AUTOSAR4.Parameter([3.1; 6.2; 9.3; 12.4; 15.5; 18.6; 21.7; 24.8], SwCalibrationAccess="ReadWrite", StorageClass="ExportedGlobal", DataType="single")
P_AEB_JaVehAEB_TTC_ThresY = AUTOSAR4.Parameter(repmat(1.3, 8, 1), SwCalibrationAccess="ReadWrite", StorageClass="ExportedGlobal", DataType="single")
P_AEB_JaVehPrefill_TTC_ThresX = AUTOSAR4.Parameter([3.1; 6.2; 9.3; 12.4; 15.5; 18.6; 21.7; 24.8], SwCalibrationAccess="ReadWrite", StorageClass="ExportedGlobal", DataType="single")
P_AEB_JaVehPrefill_TTC_ThresY = AUTOSAR4.Parameter(repmat(1.5, 8, 1), SwCalibrationAccess="ReadWrite", StorageClass="ExportedGlobal", DataType="single")
P_AEB_LatCycAEBpart_TTC_ThresX = AUTOSAR4.Parameter([4.17; 8.33; 12.5; 16.67], SwCalibrationAccess="ReadWrite", StorageClass="ExportedGlobal", DataType="single")
P_AEB_LatCycAEBpart_TTC_ThresY = AUTOSAR4.Parameter([0.95; 1.21; 1.28; 1.28], SwCalibrationAccess="ReadWrite", StorageClass="ExportedGlobal", DataType="single")
P_AEB_LatCycPrefill_TTC_ThresX = AUTOSAR4.Parameter([2.78; 5.56; 8.33; 16.67], SwCalibrationAccess="ReadWrite", StorageClass="ExportedGlobal", DataType="single")
P_AEB_LatCycPrefill_TTC_ThresY = AUTOSAR4.Parameter([0.9; 1; 1.2; 1.2], SwCalibrationAccess="ReadWrite", StorageClass="ExportedGlobal", DataType="single")
P_AEB_LatPedABA_TTC_ThresX = AUTOSAR4.Parameter([2.78; 5.56; 8.33; 16.67], SwCalibrationAccess="ReadWrite", StorageClass="ExportedGlobal", DataType="single")
P_AEB_LatPedABA_TTC_ThresY = AUTOSAR4.Parameter([1.4; 1.5; 1.7; 1.7], SwCalibrationAccess="ReadWrite", StorageClass="ExportedGlobal", DataType="single")
P_AEB_LatPedPreWarning_TTC_ThresX = AUTOSAR4.Parameter([8.33; 11.11; 13.89; 16.67], SwCalibrationAccess="ReadWrite", StorageClass="ExportedGlobal", DataType="single")
P_AEB_LatPedPreWarning_TTC_ThresY = AUTOSAR4.Parameter([1.9; 2; 2.1; 2.1], SwCalibrationAccess="ReadWrite", StorageClass="ExportedGlobal", DataType="single")
P_AEB_LatPedPrefill_TTC_ThresX = AUTOSAR4.Parameter([4.17; 8.33; 12.5; 16.67], SwCalibrationAccess="ReadWrite", StorageClass="ExportedGlobal", DataType="single")
P_AEB_LatPedPrefill_TTC_ThresY = AUTOSAR4.Parameter([1.1; 1.3; 1.45; 1.45], SwCalibrationAccess="ReadWrite", StorageClass="ExportedGlobal", DataType="single")
P_AEB_LonVehABA_TTC_ThresX = AUTOSAR4.Parameter([0; 1.38; 8.33; 11.11; 15.55], SwCalibrationAccess="ReadWrite", StorageClass="ExportedGlobal", DataType="single")
P_AEB_LonVehABA_TTC_ThresY = AUTOSAR4.Parameter([1.5; 1.5; 1.7; 1.7; 1.7], SwCalibrationAccess="ReadWrite", StorageClass="ExportedGlobal", DataType="single")
P_AEB_LonVehAEBfull_TTC_ThresX = AUTOSAR4.Parameter([4.17; 6.94; 9.72; 13.89; 15.28], SwCalibrationAccess="ReadWrite", StorageClass="ExportedGlobal", DataType="single")
P_AEB_LonVehAEBpart_TTC_ThresX = AUTOSAR4.Parameter([8.33; 9.72; 13.89; 15.28], SwCalibrationAccess="ReadWrite", StorageClass="ExportedGlobal", DataType="single")
P_AEB_LonVehAEBpart_TTC_ThresY = AUTOSAR4.Parameter([1.35; 1.46; 1.55; 1.65], SwCalibrationAccess="ReadWrite", StorageClass="ExportedGlobal", DataType="single")
P_AEB_LonVehAcuteWarning_TTC_ThresX = AUTOSAR4.Parameter([8.33; 11.11; 13.89; 19.44; 25], SwCalibrationAccess="ReadWrite", StorageClass="ExportedGlobal", DataType="single")
P_AEB_LonVehEBA_TTC_ThresX = AUTOSAR4.Parameter([0; 1.38; 8.33; 11.11; 15.55], SwCalibrationAccess="ReadWrite", StorageClass="ExportedGlobal", DataType="single")
P_AEB_LonVehEBA_TTC_ThresY = AUTOSAR4.Parameter([1.5; 1.5; 1.7; 1.7; 1.7], SwCalibrationAccess="ReadWrite", StorageClass="ExportedGlobal", DataType="single")
P_AEB_LonVehPreWarning_TTC_ThresX = AUTOSAR4.Parameter([8.33; 11.11; 13.89; 19.44; 25], SwCalibrationAccess="ReadWrite", StorageClass="ExportedGlobal", DataType="single")
P_AEB_LonVehPrefill_TTC_ThresX = AUTOSAR4.Parameter([4.17; 6.94; 9.72; 13.89; 15.28], SwCalibrationAccess="ReadWrite", StorageClass="ExportedGlobal", DataType="single")
P_AEB_LonVehPrefill_TTC_ThresY = AUTOSAR4.Parameter([1.48; 1.65; 1.76; 1.85; 1.95], SwCalibrationAccess="ReadWrite", StorageClass="ExportedGlobal", DataType="single")
P_AEB_LongCA_SeverityHighDlyTimeMOXHmiMid = AUTOSAR4.Parameter([2.78; 5.56; 8.3; 11.1; 13.8; 16.67; 19.4; 22.2], SwCalibrationAccess="ReadWrite", StorageClass="ExportedGlobal", DataType="single", Min=0, Max=25)
P_AEB_LongCA_SeverityHighDlyTimeMOXHmiLate = AUTOSAR4.Parameter([2.78; 5.56; 8.3; 11.1; 13.8; 16.67; 19.4; 22.2], SwCalibrationAccess="ReadWrite", StorageClass="ExportedGlobal", DataType="single", Min=0, Max=25)
P_AEB_LongCA_SeverityHighDlyTimeMOXHmiEarly = AUTOSAR4.Parameter([2.78; 5.56; 8.3; 11.1; 13.8; 16.67; 19.4; 22.2], SwCalibrationAccess="ReadWrite", StorageClass="ExportedGlobal", DataType="single", Min=0, Max=25)
P_AEB_LongCA_SeverityHighDlyTimeSOXHmiMid = AUTOSAR4.Parameter([2.78; 5.56; 8.3; 11.1; 13.8; 16.67; 19.4; 22.2], SwCalibrationAccess="ReadWrite", StorageClass="ExportedGlobal", DataType="single", Min=0, Max=25)
P_AEB_LongCA_SeverityHighDlyTimeSOXHmiLate = AUTOSAR4.Parameter([2.78; 5.56; 8.3; 11.1; 13.8; 16.67; 19.4; 22.2], SwCalibrationAccess="ReadWrite", StorageClass="ExportedGlobal", DataType="single", Min=0, Max=25)
P_AEB_LongCA_SeverityHighDlyTimeSOXHmiEarly = AUTOSAR4.Parameter([2.78; 5.56; 8.3; 11.1; 13.8; 16.67; 19.4; 22.2], SwCalibrationAccess="ReadWrite", StorageClass="ExportedGlobal", DataType="single", Min=0, Max=25)
P_AEB_JaPedCA_BrkJerkMaxFullBrakeX = AUTOSAR4.Parameter([1.38; 2.78; 4.17; 5.56; 6.94; 8.3; 9.72; 11.1; 12.5; 13.8; 15.3; 16.67; 18.05; 19.4; 20.8; 22.2], SwCalibrationAccess="ReadWrite", StorageClass="ExportedGlobal", DataType="single")
P_AEB_JaPedCA_BrkJerkMaxFullBrakeY = AUTOSAR4.Parameter(repmat(-20, 16, 1), SwCalibrationAccess="ReadWrite", StorageClass="ExportedGlobal", DataType="single", Min=-64, Max=0)
P_AEB_JaPedCA_DecelMaxFullBrakeX = AUTOSAR4.Parameter([1.38; 2.78; 4.17; 5.56; 6.94; 8.3; 9.72; 11.1; 12.5; 13.8; 15.3; 16.67; 18.05; 19.4; 20.8; 22.2], SwCalibrationAccess="ReadWrite", StorageClass="ExportedGlobal", DataType="single")
P_AEB_JaVehCA_DecelMaxFullBrakeX = AUTOSAR4.Parameter([1.38; 2.78; 4.17; 5.56; 6.94; 8.3; 9.72; 11.1; 12.5; 13.8; 15.3; 16.67; 18.05; 19.4; 20.8; 22.2], SwCalibrationAccess="ReadWrite", StorageClass="ExportedGlobal", DataType="single")
P_AEB_JaVehCA_BrkJerkMaxFullBrakeX = AUTOSAR4.Parameter([1.38; 2.78; 4.17; 5.56; 6.94; 8.3; 9.72; 11.1; 12.5; 13.8; 15.3; 16.67; 18.05; 19.4; 20.8; 22.2], SwCalibrationAccess="ReadWrite", StorageClass="ExportedGlobal", DataType="single")
P_AEB_LatPedAEB_TTC_ThresX = AUTOSAR4.Parameter([4.17; 8.33; 12.5; 13.8], SwCalibrationAccess="ReadWrite", StorageClass="ExportedGlobal", DataType="single")
P_AEB_LatCycAEB_TTC_ThresX = AUTOSAR4.Parameter([4.17; 8.33; 12.5; 13.8], SwCalibrationAccess="ReadWrite", StorageClass="ExportedGlobal", DataType="single")
P_AEB_JaVehCA_BrkJerkMaxFullBrakeY = AUTOSAR4.Parameter(repmat(-20, 16, 1), SwCalibrationAccess="ReadWrite", StorageClass="ExportedGlobal", DataType="single")
P_AEB_JaVehCA_DecelMaxFullBrakeY = AUTOSAR4.Parameter(repmat(-5.75, 16, 1), SwCalibrationAccess="ReadWrite", StorageClass="ExportedGlobal", DataType="single")
P_AEB_LonVruAEBPart_TTC_ThresX = AUTOSAR4.Parameter([4.17; 8.33; 12.5; 13.8], SwCalibrationAccess="ReadWrite", StorageClass="ExportedGlobal", DataType="single")
P_AEB_LonVruABA_TTC_ThresX = AUTOSAR4.Parameter([2.78; 5.56; 8.33; 16.67], SwCalibrationAccess="ReadWrite", StorageClass="ExportedGlobal", DataType="single")
P_AEB_LonVruABA_TTC_ThresY = AUTOSAR4.Parameter([1.4; 1.5; 1.7; 1.7], SwCalibrationAccess="ReadWrite", StorageClass="ExportedGlobal", DataType="single")
P_AEB_LonVruPrefill_TTC_ThresX = AUTOSAR4.Parameter([4.17; 8.33; 12.5; 16.67], SwCalibrationAccess="ReadWrite", StorageClass="ExportedGlobal", DataType="single")
P_AEB_LonVruPrefill_TTC_ThresY = AUTOSAR4.Parameter([1.1; 1.3; 1.45; 1.45], SwCalibrationAccess="ReadWrite", StorageClass="ExportedGlobal", DataType="single")
P_AEB_LonVruAcuteWarning_TTC_ThresX = AUTOSAR4.Parameter([8.33; 11.11; 13.89; 19.44; 25], SwCalibrationAccess="ReadWrite", StorageClass="ExportedGlobal", DataType="single")
P_AEB_LonVruEBA_TTC_ThresY = AUTOSAR4.Parameter([0.9; 1.1; 1.3; 1.4], SwCalibrationAccess="ReadWrite", StorageClass="ExportedGlobal", DataType="single")
P_AEB_LonVruEBA_TTC_ThresX = AUTOSAR4.Parameter([4.17; 8.33; 12.5; 13.8], SwCalibrationAccess="ReadWrite", StorageClass="ExportedGlobal", DataType="single")
P_AEB_Func_vehPreWarning_TTC_ThresX = AUTOSAR4.Parameter([8.33; 11.11; 13.89; 19.44; 25], SwCalibrationAccess="ReadWrite", StorageClass="ExportedGlobal", DataType="single")
P_AEB_LonVruAEBPart_TTC_ThresY = AUTOSAR4.Parameter([0.95; 1.21; 1.28; 1.28], SwCalibrationAccess="ReadWrite", StorageClass="ExportedGlobal", DataType="single")
P_AEB_LongObjAbs_SensorDeltDxThresX = AUTOSAR4.Parameter([8.33; 11.11; 13.8; 16.67; 19.4; 22.2], SwCalibrationAccess="ReadWrite", StorageClass="ExportedGlobal", DataType="single")
P_AEB_LongObjAbs_SensorDeltDxThresY = AUTOSAR4.Parameter([2; 3.5; 4; 4.5; 4.5; 5], SwCalibrationAccess="ReadWrite", StorageClass="ExportedGlobal", DataType="single")
P_AEB_LongObjAbs_SensorDeltDyThresX = AUTOSAR4.Parameter([8.33; 11.11; 13.8; 16.67; 19.4; 22.2], SwCalibrationAccess="ReadWrite", StorageClass="ExportedGlobal", DataType="single")
P_AEB_JaPedAbs_SensorDeltDxThresX = AUTOSAR4.Parameter([2.78; 4.17; 5.6], SwCalibrationAccess="ReadWrite", StorageClass="ExportedGlobal", DataType="single")
P_AEB_JaPedAbs_SensorDeltDxThresY = AUTOSAR4.Parameter([2; 2; 2], SwCalibrationAccess="ReadWrite", StorageClass="ExportedGlobal", DataType="single")
P_AEB_JaVehAbs_SensorDeltDxThresX = AUTOSAR4.Parameter([8.33; 11.11; 13.8; 16.67; 19.4; 22.2], SwCalibrationAccess="ReadWrite", StorageClass="ExportedGlobal", DataType="single")
P_AEB_JaVehAbs_SensorDeltDyThresX = AUTOSAR4.Parameter([8.33; 11.11; 13.8; 16.67; 19.4; 22.2], SwCalibrationAccess="ReadWrite", StorageClass="ExportedGlobal", DataType="single")
P_AEB_JaVehAbs_SensorDeltDyThresY = AUTOSAR4.Parameter([2.5; 2.5; 3.5; 3.5; 4; 4.5], SwCalibrationAccess="ReadWrite", StorageClass="ExportedGlobal", DataType="single")
P_AEB_LongCA_SeverityHighAccelGredientMOYHmiMid = AUTOSAR4.Parameter(repmat(-15, 16, 1), SwCalibrationAccess="ReadWrite", StorageClass="ExportedGlobal", DataType="single", Min=-40, Max=0)
P_AEB_LongCA_SeverityHighDlyTimeMOYHmiLate = AUTOSAR4.Parameter(repmat(0.3, 8, 1), SwCalibrationAccess="ReadWrite", StorageClass="ExportedGlobal", DataType="single", Min=0, Max=5)
P_AEB_LongCA_SeverityHighDlyTimeMOYHmiEarly = AUTOSAR4.Parameter(repmat(0.3, 8, 1), SwCalibrationAccess="ReadWrite", StorageClass="ExportedGlobal", DataType="single", Min=0, Max=5)
P_AEB_LongCA_SeverityHighDlyTimeMOYHmiMid = AUTOSAR4.Parameter(repmat(0.3, 8, 1), SwCalibrationAccess="ReadWrite", StorageClass="ExportedGlobal", DataType="single", Min=0, Max=5)
P_AEB_LongCA_SeverityHighDlyTimeSOYHmiEarly = AUTOSAR4.Parameter(repmat(0.3, 8, 1), SwCalibrationAccess="ReadWrite", StorageClass="ExportedGlobal", DataType="single", Min=0, Max=5)
P_AEB_LongCA_SeverityHighDlyTimeSOYHmiLate = AUTOSAR4.Parameter(repmat(0.3, 8, 1), SwCalibrationAccess="ReadWrite", StorageClass="ExportedGlobal", DataType="single", Min=0, Max=5)
P_AEB_LongCA_SeverityHighDlyTimeSOYHmiMid = AUTOSAR4.Parameter(repmat(0.3, 8, 1), SwCalibrationAccess="ReadWrite", StorageClass="ExportedGlobal", DataType="single", Min=0, Max=5)
P_AEB_LonVehAEBfull_TTC_ThresY = AUTOSAR4.Parameter([1.08; 1.25; 1.35; 1.5; 1.7], SwCalibrationAccess="ReadWrite", StorageClass="ExportedGlobal", DataType="single")
P_AEB_LonVehPreWarning_TTC_ThresY = AUTOSAR4.Parameter([2; 2; 2.1; 2.3; 2.7], SwCalibrationAccess="ReadWrite", StorageClass="ExportedGlobal", DataType="single")
P_AEB_JaVehAbs_SensorDeltDxThresY = AUTOSAR4.Parameter(repmat(10, 6, 1), SwCalibrationAccess="ReadWrite", StorageClass="ExportedGlobal", DataType="single")
P_AEB_LatCycObjAbs_SensorDeltDxThresX = AUTOSAR4.Parameter([2.78; 5.56; 8.3; 11.1; 13.8; 16.67], SwCalibrationAccess="ReadWrite", StorageClass="ExportedGlobal", DataType="single")
P_AEB_LatCycObjAbs_SensorDeltDxThresY = AUTOSAR4.Parameter([2; 2; 3.5; 3.5; 4; 4.5], SwCalibrationAccess="ReadWrite", StorageClass="ExportedGlobal", DataType="single")
P_AEB_LatPedObjAbs_SensorDeltDxThresY = AUTOSAR4.Parameter(repmat(2.5, 6, 1), SwCalibrationAccess="ReadWrite", StorageClass="ExportedGlobal", DataType="single")
P_AEB_LatPedObjAbs_SensorDeltDyThresX = AUTOSAR4.Parameter([2.78; 5.56; 8.3; 11.1; 13.8; 16.67], SwCalibrationAccess="ReadWrite", StorageClass="ExportedGlobal", DataType="single")
P_AEB_LatPedObjAbs_SensorDeltDyThresY = AUTOSAR4.Parameter(repmat(3, 6, 1), SwCalibrationAccess="ReadWrite", StorageClass="ExportedGlobal", DataType="single")
P_AEB_LatPedObjAbs_SensorDeltDxThresX = AUTOSAR4.Parameter([2.78; 5.56; 8.3; 11.1; 13.8; 16.67], SwCalibrationAccess="ReadWrite", StorageClass="ExportedGlobal", DataType="single")
P_AEB_LatCycObjAbs_SensorDeltDyThresX = AUTOSAR4.Parameter([2.78; 5.56; 8.3; 11.1; 13.8; 16.67], SwCalibrationAccess="ReadWrite", StorageClass="ExportedGlobal", DataType="single")
P_AEB_LatCycObjAbs_SensorDeltDyThresY = AUTOSAR4.Parameter([2; 2; 3.5; 3.5; 4; 4.5], SwCalibrationAccess="ReadWrite", StorageClass="ExportedGlobal", DataType="single")
P_AEB_LatPedObjAbs_SensorDeltVyThresY = AUTOSAR4.Parameter([0.95; 0.95; 0.95; 0.95; 2; 2], SwCalibrationAccess="ReadWrite", StorageClass="ExportedGlobal", DataType="single")
P_AEB_LatPedAEB_TTC_ThresY = AUTOSAR4.Parameter([0.9; 1.1; 1.16; 1.3], SwCalibrationAccess="ReadWrite", StorageClass="ExportedGlobal", DataType="single")
P_AEB_LatCycAEB_TTC_ThresY = AUTOSAR4.Parameter([0.9; 1.1; 1.16; 1.3], SwCalibrationAccess="ReadWrite", StorageClass="ExportedGlobal", DataType="single")
P_AEB_LongObjAbs_SensorDeltDyThresY = AUTOSAR4.Parameter([1.5; 1.5; 1.5; 1.5; 2; 2], SwCalibrationAccess="ReadWrite", StorageClass="ExportedGlobal", DataType="single")
P_AEB_LongCA_SeverityHighDlyTimeLowSOYHmiLate = AUTOSAR4.Parameter(repmat(0.3, 8, 1), SwCalibrationAccess="ReadWrite", StorageClass="ExportedGlobal", DataType="single", Min=0, Max=5)
P_AEB_LongCA_SeverityHighDlyTimeLowSOXHmiLate = AUTOSAR4.Parameter([2.78; 5.56; 8.3; 11.1; 13.8; 16.67; 19.4; 22.2], SwCalibrationAccess="ReadWrite", StorageClass="ExportedGlobal", DataType="single", Min=0, Max=25)
P_AEB_LongCA_SeverityHighDlyTimeLowSOYHmiMid = AUTOSAR4.Parameter(repmat(0.3, 8, 1), SwCalibrationAccess="ReadWrite", StorageClass="ExportedGlobal", DataType="single", Min=0, Max=5)
P_AEB_LongCA_SeverityHighDlyTimeLowSOXHmiMid = AUTOSAR4.Parameter([2.78; 5.56; 8.3; 11.1; 13.8; 16.67; 19.4; 22.2], SwCalibrationAccess="ReadWrite", StorageClass="ExportedGlobal", DataType="single", Min=0, Max=25)
P_AEB_LongCA_SeverityHighDlyTimeLowSOYHmiEarly = AUTOSAR4.Parameter(repmat(0.3, 8, 1), SwCalibrationAccess="ReadWrite", StorageClass="ExportedGlobal", DataType="single", Min=0, Max=5)
P_AEB_LongCA_SeverityHighDlyTimeLowSOXHmiEarly = AUTOSAR4.Parameter([2.78; 5.56; 8.3; 11.1; 13.8; 16.67; 19.4; 22.2], SwCalibrationAccess="ReadWrite", StorageClass="ExportedGlobal", DataType="single", Min=0, Max=25)
P_AEB_LongCA_SeverityHighDlyTimeLowMOYHmiLate = AUTOSAR4.Parameter(repmat(0.3, 8, 1), SwCalibrationAccess="ReadWrite", StorageClass="ExportedGlobal", DataType="single", Min=0, Max=5)
P_AEB_LongCA_SeverityHighDlyTimeLowMOXHmiLate = AUTOSAR4.Parameter([2.78; 5.56; 8.3; 11.1; 13.8; 16.67; 19.4; 22.2], SwCalibrationAccess="ReadWrite", StorageClass="ExportedGlobal", DataType="single", Min=0, Max=25)
P_AEB_LongCA_SeverityHighDlyTimeLowMOYHmiMid = AUTOSAR4.Parameter(repmat(0.3, 8, 1), SwCalibrationAccess="ReadWrite", StorageClass="ExportedGlobal", DataType="single", Min=0, Max=5)
P_AEB_LongCA_SeverityHighDlyTimeLowMOXHmiMid = AUTOSAR4.Parameter([2.78; 5.56; 8.3; 11.1; 13.8; 16.67; 19.4; 22.2], SwCalibrationAccess="ReadWrite", StorageClass="ExportedGlobal", DataType="single", Min=0, Max=25)
P_AEB_LongCA_SeverityHighDlyTimeLowMOYHmiEarly = AUTOSAR4.Parameter(repmat(0.3, 8, 1), SwCalibrationAccess="ReadWrite", StorageClass="ExportedGlobal", DataType="single", Min=0, Max=5)
P_AEB_LongCA_SeverityHighDlyTimeLowMOXHmiEarly = AUTOSAR4.Parameter([2.78; 5.56; 8.3; 11.1; 13.8; 16.67; 19.4; 22.2], SwCalibrationAccess="ReadWrite", StorageClass="ExportedGlobal", DataType="single", Min=0, Max=25)
P_AEB_LatPedObjAbs_SensorFR_VyThres = AUTOSAR4.Parameter(0.35, SwCalibrationAccess="ReadWrite", StorageClass="ExportedGlobal", DataType="single")
P_AEB_LatCycObjAbs_SensorFR_VyThres = AUTOSAR4.Parameter(0.35, SwCalibrationAccess="ReadWrite", StorageClass="ExportedGlobal", DataType="single")
P_AEB_Func_JaVehPrefillBrkDistSecure = AUTOSAR4.Parameter(0.5, SwCalibrationAccess="ReadWrite", StorageClass="ExportedGlobal", DataType="single", Min=0, Max=3)
P_AEB_FIM_AxAbsObjAborThres = AUTOSAR4.Parameter(-0.5, SwCalibrationAccess="ReadWrite", StorageClass="ExportedGlobal", DataType="single")
P_AEB_FIM_VxMOAborThres = AUTOSAR4.Parameter(0.5, SwCalibrationAccess="ReadWrite", StorageClass="ExportedGlobal", DataType="single")
P_AEB_FUS_VyThres = AUTOSAR4.Parameter(0.5, SwCalibrationAccess="ReadWrite", StorageClass="ExportedGlobal", DataType="single")
P_AEB_Func_cycPrefillVxAbsObjSuppThres = AUTOSAR4.Parameter(1.5, SwCalibrationAccess="ReadWrite", StorageClass="ExportedGlobal", DataType="single")
P_AEB_Func_cycAEBpartVxAbsObjSuppThres = AUTOSAR4.Parameter(1.5, SwCalibrationAccess="ReadWrite", StorageClass="ExportedGlobal", DataType="single")
P_AEB_Func_cycAEBfullVxAbsObjSuppThres = AUTOSAR4.Parameter(1.5, SwCalibrationAccess="ReadWrite", StorageClass="ExportedGlobal", DataType="single")
P_AEB_Func_JaVehPrefillBrkCondAborDelayTime = AUTOSAR4.Parameter(1.5, SwCalibrationAccess="ReadWrite", StorageClass="ExportedGlobal", DataType="single")
P_AEB_Func_vehAEBfullDxActivationSubjVelThresSO = AUTOSAR4.Parameter(13.8, SwCalibrationAccess="ReadWrite", StorageClass="ExportedGlobal", DataType="single")
P_AEB_Func_JaVehAEBfullObjDySupThresMax = AUTOSAR4.Parameter(3.75, SwCalibrationAccess="ReadWrite", StorageClass="ExportedGlobal", DataType="single")
P_AEB_Func_JaVehPrefillObjDySupThresMax = AUTOSAR4.Parameter(3.75, SwCalibrationAccess="ReadWrite", StorageClass="ExportedGlobal", DataType="single")
P_AEB_JaCycCA_BrkJerkMaxFullBrake = AUTOSAR4.Parameter(-30, SwCalibrationAccess="ReadWrite", StorageClass="ExportedGlobal", DataType="single", Min=-64, Max=64)
P_AEB_JaCycCA_DecelMaxFullBrake = AUTOSAR4.Parameter(-9, SwCalibrationAccess="ReadWrite", StorageClass="ExportedGlobal", DataType="single", Min=-15, Max=0)
P_AEB_JaCycCA_PreCollisionPredTimeMax = AUTOSAR4.Parameter(2, SwCalibrationAccess="ReadWrite", StorageClass="ExportedGlobal", DataType="single", Min=0, Max=5)
P_AEB_JaCycCA_PreSelectDxThres = AUTOSAR4.Parameter(20, SwCalibrationAccess="ReadWrite", StorageClass="ExportedGlobal", DataType="single", Min=0, Max=40)
P_AEB_JaCycCA_PreSelectDxVarThres = AUTOSAR4.Parameter(1, SwCalibrationAccess="ReadWrite", StorageClass="ExportedGlobal", DataType="single", Min=0, Max=5)
P_AEB_JaCycCA_PreSelectDyThres = AUTOSAR4.Parameter(7, SwCalibrationAccess="ReadWrite", StorageClass="ExportedGlobal", DataType="single", Min=0, Max=10)
P_AEB_JaCycCA_PreSelectObjYawAngleThres = AUTOSAR4.Parameter(45, SwCalibrationAccess="ReadWrite", StorageClass="ExportedGlobal", DataType="single", Min=0, Max=360)
P_AEB_JaCycCA_PreSelectObjectExistProbThres = AUTOSAR4.Parameter(0.8, SwCalibrationAccess="ReadWrite", StorageClass="ExportedGlobal", DataType="single", Min=0, Max=1)
P_AEB_JaCycCA_SelectStrWheelAngleAbsThres = AUTOSAR4.Parameter(20, SwCalibrationAccess="ReadWrite", StorageClass="ExportedGlobal", DataType="single", Min=0, Max=720)
P_AEB_JaCycCA_SelectSubjVelThres = AUTOSAR4.Parameter(8.3, SwCalibrationAccess="ReadWrite", StorageClass="ExportedGlobal", DataType="single", Min=0, Max=50)
P_AEB_JaCycCA_VelReduceMaxFullBrake = AUTOSAR4.Parameter(-8.3, SwCalibrationAccess="ReadWrite", StorageClass="ExportedGlobal", DataType="single", Min=-22.22, Max=0)
P_AEB_JaCycCA_PreCollisionStepTime = AUTOSAR4.Parameter(0.1, SwCalibrationAccess="ReadWrite", StorageClass="ExportedGlobal", DataType="single", Min=0, Max=2)
P_AEB_JaCycCA_BrkJerkMaxFullBrakeX = AUTOSAR4.Parameter([1.38; 2.78; 4.17; 5.56; 6.94; 8.3; 9.72; 11.1; 12.5; 13.8; 15.3; 16.67; 18.05; 19.4; 20.8; 22.2], SwCalibrationAccess="ReadWrite", StorageClass="ExportedGlobal", DataType="single")
P_AEB_JaCycCA_BrkJerkMaxFullBrakeY = AUTOSAR4.Parameter(repmat(-20, 16, 1), SwCalibrationAccess="ReadWrite", StorageClass="ExportedGlobal", DataType="single", Min=-64, Max=0)
P_AEB_JaCycCA_DecelMaxFullBrakeX = AUTOSAR4.Parameter([1.38; 2.78; 4.17; 5.56; 6.94; 8.3; 9.72; 11.1; 12.5; 13.8; 15.3; 16.67; 18.05; 19.4; 20.8; 22.2], SwCalibrationAccess="ReadWrite", StorageClass="ExportedGlobal", DataType="single")
P_AEB_JaCycCA_DecelMaxX = AUTOSAR4.Parameter(0, SwCalibrationAccess="ReadWrite", StorageClass="ExportedGlobal")
P_AEB_JaCycCA_DecelMaxY = AUTOSAR4.Parameter(0, SwCalibrationAccess="ReadWrite", StorageClass="ExportedGlobal")
P_AEB_JaCycAbs_SensorDeltDxThresX = AUTOSAR4.Parameter([2.78; 4.17; 5.6], SwCalibrationAccess="ReadWrite", StorageClass="ExportedGlobal", DataType="single")
P_AEB_Func_JaCycAEBfullAccrCondAborDelayTime = AUTOSAR4.Parameter(1.5, SwCalibrationAccess="ReadWrite", StorageClass="ExportedGlobal", DataType="single", Min=0, Max=5)
P_AEB_Func_JaCycAEBfullBrkDistSecure = AUTOSAR4.Parameter(0.3, SwCalibrationAccess="ReadWrite", StorageClass="ExportedGlobal", DataType="single", Min=0, Max=2)
P_AEB_Func_JaCycAEBfullGasPedalAborThres = AUTOSAR4.Parameter(85, SwCalibrationAccess="ReadWrite", StorageClass="ExportedGlobal", DataType="single", Min=0, Max=100)
P_AEB_Func_JaCycAEBfullObjObstacleProbSupThres = AUTOSAR4.Parameter(0.85, SwCalibrationAccess="ReadWrite", StorageClass="ExportedGlobal", DataType="single", Min=0, Max=1)
P_AEB_Func_JaCycAEBfullStrWheelAngleSpdAborThres = AUTOSAR4.Parameter(300, SwCalibrationAccess="ReadWrite", StorageClass="ExportedGlobal", DataType="single", Min=0, Max=1000)
P_AEB_Func_JaCycAEBfullSubjLatAccelAbsSupThres = AUTOSAR4.Parameter(3, SwCalibrationAccess="ReadWrite", StorageClass="ExportedGlobal", DataType="single", Min=0, Max=10)
P_AEB_Func_JaCycAEBfullSubjVelMax = AUTOSAR4.Parameter(6.1, SwCalibrationAccess="ReadWrite", StorageClass="ExportedGlobal", DataType="single", Min=0, Max=69)
P_AEB_Func_JaCycAEBfullSubjVelStrWheelAngleMaxThresX = AUTOSAR4.Parameter([0; 2.78; 7; 16.67], SwCalibrationAccess="ReadWrite", StorageClass="ExportedGlobal", DataType="single", Min=0, Max=16.67)
P_AEB_Func_JaCycAEBfullSubjVelStrWheelAngleMaxThresY = AUTOSAR4.Parameter([450; 450; 360; 180], SwCalibrationAccess="ReadWrite", StorageClass="ExportedGlobal", DataType="single", Min=0, Max=720)
P_AEB_Func_JaCycAEBfullSubjVelStrWheelAngleMinThresX = AUTOSAR4.Parameter([0; 2.78; 7; 16.67], SwCalibrationAccess="ReadWrite", StorageClass="ExportedGlobal", DataType="single", Min=0, Max=16.67)
P_AEB_Func_JaCycAEBfullTtcTimeOffset = AUTOSAR4.Parameter(0.1, SwCalibrationAccess="ReadWrite", StorageClass="ExportedGlobal", DataType="single", Min=0, Max=3)
P_AEB_Func_JaCycPrefillAccrCondAborDelayTime = AUTOSAR4.Parameter(1.5, SwCalibrationAccess="ReadWrite", StorageClass="ExportedGlobal", DataType="single", Min=0, Max=5)
P_AEB_Func_JaCycPrefillBrkDistSecure = AUTOSAR4.Parameter(0.5, SwCalibrationAccess="ReadWrite", StorageClass="ExportedGlobal", DataType="single", Min=0, Max=3)
P_AEB_Func_JaCycPrefillGasPedalAborThres = AUTOSAR4.Parameter(85, SwCalibrationAccess="ReadWrite", StorageClass="ExportedGlobal", DataType="single", Min=0, Max=100)
P_AEB_Func_JaCycPrefillMasterCylindBrkPressSupThres = AUTOSAR4.Parameter(3, SwCalibrationAccess="ReadWrite", StorageClass="ExportedGlobal", DataType="single", Min=0, Max=10)
P_AEB_Func_JaCycPrefillObjObstacleProbSupThres = AUTOSAR4.Parameter(0.7, SwCalibrationAccess="ReadWrite", StorageClass="ExportedGlobal", DataType="single", Min=0, Max=1)
P_AEB_Func_JaCycPrefillObjVelSupThresMin = AUTOSAR4.Parameter(0.6, SwCalibrationAccess="ReadWrite", StorageClass="ExportedGlobal", DataType="single", Min=0, Max=20)

P_AEB_Func_JaCycPrefillStrWheelAngleSpdAborThres = AUTOSAR4.Parameter(300, SwCalibrationAccess="ReadWrite", StorageClass="ExportedGlobal", DataType="single", Min=0, Max=1000)
P_AEB_Func_JaCycPrefillSubjLatAccelAbsSupThres = AUTOSAR4.Parameter(3, SwCalibrationAccess="ReadWrite", StorageClass="ExportedGlobal", DataType="single", Min=0, Max=10)
P_AEB_Func_JaCycPrefillSubjVelMax = AUTOSAR4.Parameter(6.1, SwCalibrationAccess="ReadWrite", StorageClass="ExportedGlobal", DataType="single", Min=0, Max=69)
P_AEB_Func_JaCycPrefillSubjVelStrWheelAngleMaxThresX = AUTOSAR4.Parameter([0; 2.78; 7; 16.67], SwCalibrationAccess="ReadWrite", StorageClass="ExportedGlobal", DataType="single", Min=0, Max=16.67)
P_AEB_Func_JaCycPrefillSubjVelStrWheelAngleMaxThresY = AUTOSAR4.Parameter([450; 450; 360; 180], SwCalibrationAccess="ReadWrite", StorageClass="ExportedGlobal", DataType="single", Min=0, Max=720)
P_AEB_Func_JaCycPrefillSubjVelStrWheelAngleMinThresX = AUTOSAR4.Parameter([0; 2.78; 7; 16.67], SwCalibrationAccess="ReadWrite", StorageClass="ExportedGlobal", DataType="single", Min=0, Max=16.67)
P_AEB_Func_JaCycPrefillTtcTimeOffset = AUTOSAR4.Parameter(0.3, SwCalibrationAccess="ReadWrite", StorageClass="ExportedGlobal", DataType="single", Min=0, Max=2)
P_AEB_Func_JaCycPrefillGasPedalSupThres = AUTOSAR4.Parameter(50, SwCalibrationAccess="ReadWrite", StorageClass="ExportedGlobal", DataType="single", Min=0, Max=100)
P_AEB_Func_JaCycPrefillSubjVelStrWheelAngleMinThresY = AUTOSAR4.Parameter([150; 150; 150; 150], SwCalibrationAccess="ReadWrite", StorageClass="ExportedGlobal", DataType="single", Min=0, Max=360)
P_AEB_Func_JaCycPrefillBrkCondAborDelayTime = AUTOSAR4.Parameter(1.5, SwCalibrationAccess="ReadWrite", StorageClass="ExportedGlobal", DataType="single", Min=0, Max=5)
P_AEB_Func_JaCycPrefillObjDySupThres = AUTOSAR4.Parameter(1.5, SwCalibrationAccess="ReadWrite", StorageClass="ExportedGlobal", DataType="single")
P_AEB_Func_JaCycAEBfullObjDySupThres = AUTOSAR4.Parameter(1.5, SwCalibrationAccess="ReadWrite", StorageClass="ExportedGlobal", DataType="single", Max=10)
P_AEB_Func_JaCycAEBfullGasPedalSupThres = AUTOSAR4.Parameter(50, SwCalibrationAccess="ReadWrite", StorageClass="ExportedGlobal", DataType="single", Min=0, Max=100)
P_AEB_Func_JaCycAEBfullMasterCylindBrkPressSupThres = AUTOSAR4.Parameter(5, SwCalibrationAccess="ReadWrite", StorageClass="ExportedGlobal", DataType="single", Min=0, Max=300)
P_AEB_Func_JaCycAEBfullBrkCondAborDelayTime = AUTOSAR4.Parameter(1.5, SwCalibrationAccess="ReadWrite", StorageClass="ExportedGlobal", DataType="single", Min=0, Max=5)
P_AEB_Func_JaCycPrefillSubjVelMin = AUTOSAR4.Parameter(1.8, SwCalibrationAccess="ReadWrite", StorageClass="ExportedGlobal", DataType="single", Min=0, Max=30)
P_AEB_Func_JaCycAEBfullSubjVelMin = AUTOSAR4.Parameter(1.8, SwCalibrationAccess="ReadWrite", StorageClass="ExportedGlobal", DataType="single", Min=0, Max=30)
P_AEB_Func_JaCycAEBfullSubjVelStrWheelAngleMinThresY = AUTOSAR4.Parameter([130; 130; 130; 130], SwCalibrationAccess="ReadWrite", StorageClass="ExportedGlobal", DataType="single", Min=0, Max=360)
P_AEB_Ja_CycAEB_Set = AUTOSAR4.Parameter(2, SwCalibrationAccess="ReadWrite", StorageClass="ExportedGlobal", DataType="uint8", Min=1, Max=3)
P_AEB_Ja_CycABP_Set = AUTOSAR4.Parameter(2, SwCalibrationAccess="ReadWrite", StorageClass="ExportedGlobal", DataType="uint8", Min=1, Max=3)
P_AEB_FuncStatus_JaCycAEBfullStandstillWorkTime = AUTOSAR4.Parameter(3, SwCalibrationAccess="ReadWrite", StorageClass="ExportedGlobal", DataType="single", Min=0, Max=60)
P_AEB_FuncStatus_JaCycPrefillStandstillWorkTime = AUTOSAR4.Parameter(3, SwCalibrationAccess="ReadWrite", StorageClass="ExportedGlobal", DataType="single", Min=0, Max=60)
P_AEB_FuncStatus_JaCycAEBfullWorkTime = AUTOSAR4.Parameter(5, SwCalibrationAccess="ReadWrite", StorageClass="ExportedGlobal", DataType="single", Min=0, Max=10)
P_AEB_FuncStatus_JaCycPrefillWorkTime = AUTOSAR4.Parameter(5, SwCalibrationAccess="ReadWrite", StorageClass="ExportedGlobal", DataType="single", Min=0, Max=10)
P_AEB_Func_cycAEBfullDyLatBoundHmiEarlyMid = AUTOSAR4.Parameter(7, SwCalibrationAccess="ReadWrite", StorageClass="ExportedGlobal", DataType="single", Min=0, Max=10)
P_AEB_Func_JaCycAEBfullObjVelSupThresMin = AUTOSAR4.Parameter(1.38, SwCalibrationAccess="ReadWrite", StorageClass="ExportedGlobal", DataType="single", Min=0, Max=20)
P_AEB_JaCycAEB_TTC_ThresY = AUTOSAR4.Parameter([0.7; 0.8; 1; 1], SwCalibrationAccess="ReadWrite", StorageClass="ExportedGlobal", DataType="single")
P_AEB_JaCycAEB_TTC_ThresX = AUTOSAR4.Parameter([2.78; 5.56; 8.33; 16.67], SwCalibrationAccess="ReadWrite", StorageClass="ExportedGlobal", DataType="single")
P_AEB_JaCycPrefill_TTC_ThresX = AUTOSAR4.Parameter([2.78; 5.56; 8.33; 16.67], SwCalibrationAccess="ReadWrite", StorageClass="ExportedGlobal", DataType="single")
P_AEB_JaCycPrefill_TTC_ThresY = AUTOSAR4.Parameter([0.9; 1; 1.2; 1.2], SwCalibrationAccess="ReadWrite", StorageClass="ExportedGlobal", DataType="single")
P_AEB_Func_JaCycAEBfullObjVelSupThresMax = AUTOSAR4.Parameter(8.3, SwCalibrationAccess="ReadWrite", StorageClass="ExportedGlobal", DataType="single", Min=0, Max=40)
P_AEB_JaCycAbs_SensorDeltDxThresY = AUTOSAR4.Parameter([10; 10; 10], SwCalibrationAccess="ReadWrite", StorageClass="ExportedGlobal", DataType="single")
P_AEB_JaCycCA_BrkSysDelayTimeFullBrake = AUTOSAR4.Parameter(0.2, SwCalibrationAccess="ReadWrite", StorageClass="ExportedGlobal", DataType="single", Min=0, Max=1)
P_AEB_JaCycCA_DecelMaxFullBrakeY = AUTOSAR4.Parameter(repmat(-6, 16, 1), SwCalibrationAccess="ReadWrite", StorageClass="ExportedGlobal", DataType="single")
P_AEB_Func_vehEBAiboosterTime = AUTOSAR4.Parameter(0.06, SwCalibrationAccess="ReadWrite", StorageClass="ExportedGlobal", DataType="single", Min=0, Max=10)
P_AEB_FIM_aDesiredGradientInitalX = AUTOSAR4.Parameter([-8; -7; -6; -4; -2], SwCalibrationAccess="ReadWrite", StorageClass="ExportedGlobal", Min=-16, Max=0)
P_AEB_FIM_aDesiredGradientInitalY = AUTOSAR4.Parameter([-50; -25; -14; -9; -6], SwCalibrationAccess="ReadWrite", StorageClass="ExportedGlobal", Min=-50, Max=0)
P_AEB_LongCA_LowLvlBrkAccelAvoidThesWarnHmiMidY = AUTOSAR4.Parameter([-1.3; -1.3; -1], SwCalibrationAccess="ReadWrite", StorageClass="ExportedGlobal", DataType="single", Min=-10, Max=0)
P_AEB_LongCA_LowLvlBrkAccelAvoidThesWarnHmiLateY = AUTOSAR4.Parameter([-1.3; -1.3; -1], SwCalibrationAccess="ReadWrite", StorageClass="ExportedGlobal", DataType="single", Min=-10, Max=0)
P_AEB_LongCA_LowLvlBrkAccelAvoidThesWarnHmiEarlyY = AUTOSAR4.Parameter([-1.2; -1.2; -0.9], SwCalibrationAccess="ReadWrite", StorageClass="ExportedGlobal", DataType="single", Min=-10, Max=0)
P_AEB_LongCA_HighLvlBrkAccelAvoidThes = AUTOSAR4.Parameter(-7, SwCalibrationAccess="ReadWrite", StorageClass="ExportedGlobal", DataType="single", Min=-12, Max=0)
P_AEB_LongCA_LatAvoidAccelThesWarnHmiEarlySOY = AUTOSAR4.Parameter([-1.1; -1.1; -0.6], SwCalibrationAccess="ReadWrite", StorageClass="ExportedGlobal", DataType="single", Min=-10, Max=0)
P_AEB_LongCA_LatAvoidAccelThesWarnHmiLateSOY = AUTOSAR4.Parameter([-1.1; -1.1; -0.6], SwCalibrationAccess="ReadWrite", StorageClass="ExportedGlobal", DataType="single", Min=-10, Max=0)
P_AEB_LongCA_LatAvoidAccelThesWarnHmiMidSOY = AUTOSAR4.Parameter([-1.1; -1.1; -0.6], SwCalibrationAccess="ReadWrite", StorageClass="ExportedGlobal", DataType="single", Min=-10, Max=0)
P_AEB_LongCA_LatAvoidAccelThesWarnHmiEarlyMOY = AUTOSAR4.Parameter([-1.1; -1.1; -0.6], SwCalibrationAccess="ReadWrite", StorageClass="ExportedGlobal", DataType="single", Min=-10, Max=0)
P_AEB_LongCA_LatAvoidAccelThesWarnHmiLateMOY = AUTOSAR4.Parameter([-1.1; -1.1; -0.8], SwCalibrationAccess="ReadWrite", StorageClass="ExportedGlobal", DataType="single", Min=-10, Max=0)
P_AEB_Func_vehPreWarning_TTC_ThresY = AUTOSAR4.Parameter([2.6; 2.6; 2.6; 2.6; 2.7], SwCalibrationAccess="ReadWrite", StorageClass="ExportedGlobal", DataType="single")
P_AEB_LonFCW_FusTTCLow_Thres = AUTOSAR4.Parameter(1.5, SwCalibrationAccess="ReadWrite", StorageClass="ExportedGlobal", DataType="single")
P_AEB_LonFCW_SuppFusType_Set = AUTOSAR4.Parameter(1, SwCalibrationAccess="ReadWrite", StorageClass="ExportedGlobal", DataType="boolean")
P_AEB_PedAebFullSwt4VAF = AUTOSAR4.Parameter(0, SwCalibrationAccess="ReadWrite", StorageClass="ExportedGlobal", DataType="boolean")
P_AEB_VehAebFullSwt4VAF = AUTOSAR4.Parameter(0, SwCalibrationAccess="ReadWrite", StorageClass="ExportedGlobal", DataType="boolean")
P_AEB_Func_vehPreWarning_TTC_ThresY4Mid = AUTOSAR4.Parameter([2.6; 2.6; 2.6; 2.6; 2.7], SwCalibrationAccess="ReadWrite", StorageClass="ExportedGlobal", DataType="single")
P_AEB_Func_vehPreWarning_TTC_ThresY4Late = AUTOSAR4.Parameter([2.6; 2.6; 2.6; 2.6; 2.7], SwCalibrationAccess="ReadWrite", StorageClass="ExportedGlobal", DataType="single")
P_AEB_Func_vehPreWarning_TTC_ThresY4Eary = AUTOSAR4.Parameter([2.6; 2.6; 2.6; 2.6; 2.7], SwCalibrationAccess="ReadWrite", StorageClass="ExportedGlobal", DataType="single")
P_AEB_Func_vehPreWarning_TTC_ThresX4Mid = AUTOSAR4.Parameter([8.33; 11.11; 13.89; 19.44; 25], SwCalibrationAccess="ReadWrite", StorageClass="ExportedGlobal", DataType="single")
P_AEB_Func_vehPreWarning_TTC_ThresX4Late = AUTOSAR4.Parameter([8.33; 11.11; 13.89; 19.44; 25], SwCalibrationAccess="ReadWrite", StorageClass="ExportedGlobal", DataType="single")
P_AEB_Func_vehPreWarning_TTC_ThresX4Eary = AUTOSAR4.Parameter([8.33; 11.11; 13.89; 19.44; 25], SwCalibrationAccess="ReadWrite", StorageClass="ExportedGlobal", DataType="single")
P_AEB_vehStateCalc_SubjVelThres4P0_EngCond = AUTOSAR4.Parameter(3.33, SwCalibrationAccess="ReadWrite", StorageClass="ExportedGlobal", DataType="single")
P_AEB_FIM_dxSecureY = AUTOSAR4.Parameter([0.5 0.5 0.75 0.75; 0.5 0.5 0.75 0.75; 0.75 0.75 0.75 0.75; 0.75 0.75 0.75 0.75], SwCalibrationAccess="ReadWrite", StorageClass="ExportedGlobal", Min=0, Max=5)
P_AEB_FIM_dxSecureX1_vEgo = AUTOSAR4.Parameter([0; 1.95; 2.7; 69.44], SwCalibrationAccess="ReadWrite", StorageClass="ExportedGlobal", Min=0, Max=69.44)
P_AEB_FIM_GradientOffsetInitialY = AUTOSAR4.Parameter([-2.5 -1.5 -1; -5 -3 -2; -15 -10 -5], SwCalibrationAccess="ReadWrite", StorageClass="ExportedGlobal", Min=-20, Max=0)
P_AEB_FIM_DecGradientFactorX_DeltaaDesiredaTgt = AUTOSAR4.Parameter([-10; -8; -5; -3; -2.5; -1.5; -1; -0.5], SwCalibrationAccess="ReadWrite", StorageClass="ExportedGlobal", Min=-10, Max=0)
P_AEB_FIM_VxThres4LongBraking = AUTOSAR4.Parameter(-9.722, SwCalibrationAccess="ReadWrite", StorageClass="ExportedGlobal", Min=-25, Max=0)
P_AEB_FIM_accelMin4lowvRel = AUTOSAR4.Parameter(-6, SwCalibrationAccess="ReadWrite", StorageClass="ExportedGlobal", Min=-8, Max=0)
P_AEB_FIM_vxThres_accelMin4lowvRel = AUTOSAR4.Parameter(-2.2, SwCalibrationAccess="ReadWrite", StorageClass="ExportedGlobal", Min=-2.8, Max=0)
P_AEB_FIM_DecGradientStep4DecControl = AUTOSAR4.Parameter(-0.125, SwCalibrationAccess="ReadWrite", StorageClass="ExportedGlobal", Min=-2, Max=0)
P_AEB_FIM_GradientHoldTimeY = AUTOSAR4.Parameter([0.5; 0.3; 0.1; 0.1], SwCalibrationAccess="ReadWrite", StorageClass="ExportedGlobal", Min=0, Max=1)
P_AEB_LonVruAEB_TTC_ThresY = AUTOSAR4.Parameter([0.9; 1.1; 1.3; 1.4], SwCalibrationAccess="ReadWrite", StorageClass="ExportedGlobal")
P_AEB_FIM_Gradient4ControllingIncXTime = AUTOSAR4.Parameter([0; 0.2; 0.4; 0.6; 0.8; 1; 1.2; 1.4; 1.6; 1.8; 2; 2.2; 2.4; 2.6; 2.8; 3], SwCalibrationAccess="ReadWrite", StorageClass="ExportedGlobal", Min=0, Max=5)
P_AEB_FIM_Gradient4ControllingIncY = AUTOSAR4.Parameter([0; 1; 2; 2; 2.5; 2.5; 3; 3; 3.5; 3.5; 4; 4; 4; 4; 4; 4], SwCalibrationAccess="ReadWrite", StorageClass="ExportedGlobal", Min=0, Max=20)
P_AEB_LonVruPreWarning_TTC_ThresY = AUTOSAR4.Parameter([2.3; 2.3; 2.3; 2.3], SwCalibrationAccess="ReadWrite", StorageClass="ExportedGlobal")
P_AEB_LonVruAEB_TTC_ThresX = AUTOSAR4.Parameter([4.17; 8.33; 12.5; 13.8], SwCalibrationAccess="ReadWrite", StorageClass="ExportedGlobal")
P_AEB_FIM_DecGradientFactorY = AUTOSAR4.Parameter([100; 50; 20; 10; 6; 2; 1; 0], SwCalibrationAccess="ReadWrite", StorageClass="ExportedGlobal", Min=0, Max=100)
P_AEB_FIM_DeltaDesiredaMaxGradientInitialY = AUTOSAR4.Parameter([-2; -4; -15; -30; -50], SwCalibrationAccess="ReadWrite", StorageClass="ExportedGlobal", Min=-50, Max=0)
P_AEB_FIM_GradientOffsetInitialX2_aDesired = AUTOSAR4.Parameter([-5.5 -4.5 -3.5], SwCalibrationAccess="ReadWrite", StorageClass="ExportedGlobal", Min=-16, Max=0)
P_AEB_FIM_DeltaDesiredaMaxGradientInitialX = AUTOSAR4.Parameter([-6; -4; -2; -1; 0], SwCalibrationAccess="ReadWrite", StorageClass="ExportedGlobal", Min=-16, Max=0)
P_AEB_FIM_GradientOffsetInitialX1_vx = AUTOSAR4.Parameter([-7 -5 -1.5], SwCalibrationAccess="ReadWrite", StorageClass="ExportedGlobal", Min=-8, Max=0)
P_AEB_JaPedCA_DecelMaxFullBrakeY = AUTOSAR4.Parameter([-7.5; -7.5; -7; -7; -7; -6.5; -6.5; -6.5; -6.5; -6.5; -6.5; -6.5; -6.5; -6.5; -6.5; -6.5], SwCalibrationAccess="ReadWrite", StorageClass="ExportedGlobal", DataType="single")
P_AEB_FIM_aDesiredGradientInitialX = AUTOSAR4.Parameter([-8; -7; -6; -4; -2], SwCalibrationAccess="ReadWrite", StorageClass="ExportedGlobal", Min=-16, Max=0)
P_AEB_FIM_GradientTimeHoldX_vRel = AUTOSAR4.Parameter([-13.3; -8.3; -4.6; 0], SwCalibrationAccess="ReadWrite", StorageClass="ExportedGlobal", Min=-16.66, Max=0)
P_AEB_LonVehAcuteWarning_TTC_ThresY = AUTOSAR4.Parameter(repmat(2.3, 5, 1), SwCalibrationAccess="ReadWrite", StorageClass="ExportedGlobal", DataType="single")
P_AEB_LonVruAcuteWarning_TTC_ThresY = AUTOSAR4.Parameter(repmat(2.3, 5, 1), SwCalibrationAccess="ReadWrite", StorageClass="ExportedGlobal", DataType="single")
P_AEB_FIM_aDeltaThres4BrakePhase3 = AUTOSAR4.Parameter(-0.9, SwCalibrationAccess="ReadWrite", StorageClass="ExportedGlobal", DataType="single", Min=-5, Max=0)
P_AEB_FIM_axAbsObjThres4LongBrakingOff = AUTOSAR4.Parameter(-0.85, SwCalibrationAccess="ReadWrite", StorageClass="ExportedGlobal", Min=-16, Max=0)
P_AEB_FIM_aDeltaThres4BrakePhase2 = AUTOSAR4.Parameter(-0.6, SwCalibrationAccess="ReadWrite", StorageClass="ExportedGlobal", DataType="single", Min=-5, Max=0)
P_AEB_FIM_aDeltaThres4BrakePhase1 = AUTOSAR4.Parameter(-0.3, SwCalibrationAccess="ReadWrite", StorageClass="ExportedGlobal", DataType="single", Min=-5, Max=0)
P_AEB_FIM_dxSecureX2_vRel = AUTOSAR4.Parameter([0; 1.95; 2.7; 69.44], SwCalibrationAccess="ReadWrite", StorageClass="ExportedGlobal", Min=0, Max=69.44)
P_AEB_FIM_aDesiredGradientInitialY = AUTOSAR4.Parameter([-50; -25; -14; -9; -6], SwCalibrationAccess="ReadWrite", StorageClass="ExportedGlobal", Min=-50, Max=0)
P_AEB_FIM_aDeltaThres4BrakePhase6 = AUTOSAR4.Parameter(-2.3, SwCalibrationAccess="ReadWrite", StorageClass="ExportedGlobal", DataType="single", Min=-5, Max=0)
P_AEB_FIM_aDeltaThres4BrakePhase7 = AUTOSAR4.Parameter(-2.3, SwCalibrationAccess="ReadWrite", StorageClass="ExportedGlobal", DataType="single", Min=-5, Max=0)
P_AEB_FIM_aDeltaaDesiredaMaxThres4FastDec = AUTOSAR4.Parameter(-1.75, SwCalibrationAccess="ReadWrite", StorageClass="ExportedGlobal", DataType="single", Min=-3, Max=0)
P_AEB_FIM_aDeltaThres4BrakePhase5 = AUTOSAR4.Parameter(-1.5, SwCalibrationAccess="ReadWrite", StorageClass="ExportedGlobal", DataType="single", Min=-5, Max=0)
P_AEB_FIM_accelMax = AUTOSAR4.Parameter(-1.5, SwCalibrationAccess="ReadWrite", StorageClass="ExportedGlobal", Min=-8, Max=0)
P_AEB_FIM_axAbsObjThres4LongBrakingOn = AUTOSAR4.Parameter(-1.5, SwCalibrationAccess="ReadWrite", StorageClass="ExportedGlobal", Min=-16, Max=0)
P_AEB_FIM_aDeltaThres4BrakePhase4 = AUTOSAR4.Parameter(-1.2, SwCalibrationAccess="ReadWrite", StorageClass="ExportedGlobal", DataType="single", Min=-5, Max=0)
P_AEB_LonVruPreWarning_TTC_ThresX = AUTOSAR4.Parameter([8.33; 11.11; 13.89; 16.67], SwCalibrationAccess="ReadWrite", StorageClass="ExportedGlobal")
P_AEB_ObjectPredictConfig4Control = AUTOSAR4.Parameter(0, SwCalibrationAccess="ReadWrite", StorageClass="ExportedGlobal", DataType="boolean")
P_AEB_JaPedCA_BrkSysDelayTimeFullBrake = AUTOSAR4.Parameter(0.15, SwCalibrationAccess="ReadWrite", StorageClass="ExportedGlobal", DataType="single", Min=0, Max=1)
P_AEB_FIM_DeltaaDesiredaTgtThres4GradientReset = AUTOSAR4.Parameter(0.2, SwCalibrationAccess="ReadWrite", StorageClass="ExportedGlobal")
P_AEB_FIM_FiltCeof4axAbsObj = AUTOSAR4.Parameter(0.2, SwCalibrationAccess="ReadWrite", StorageClass="ExportedGlobal", DataType="single")
P_AEB_FIM_FiltCeof4vxAbsObj = AUTOSAR4.Parameter(0.2, SwCalibrationAccess="ReadWrite", StorageClass="ExportedGlobal", DataType="single")
P_AEB_FIM_dxOffset4underDxSecure = AUTOSAR4.Parameter(0.25, SwCalibrationAccess="ReadWrite", StorageClass="ExportedGlobal", Min=0, Max=3)
P_AEB_JaCycCA_PreCollisionCycWidthThres = AUTOSAR4.Parameter(0.5, SwCalibrationAccess="ReadWrite", StorageClass="ExportedGlobal")
P_AEB_FIM_accelMin4lowvRel_Config = AUTOSAR4.Parameter(1, SwCalibrationAccess="ReadWrite", StorageClass="ExportedGlobal", Min=0, Max=1)
P_AEB_JaCycCA_PreCollisionCycLengthThres = AUTOSAR4.Parameter(1.8, SwCalibrationAccess="ReadWrite", StorageClass="ExportedGlobal")
P_AEB_FIM_distMinThres4LowControlling = AUTOSAR4.Parameter(2, SwCalibrationAccess="ReadWrite", StorageClass="ExportedGlobal", Min=0, Max=10)
P_AEB_LonFCW_FusTTCHigh_Thres = AUTOSAR4.Parameter(2.6, SwCalibrationAccess="ReadWrite", StorageClass="ExportedGlobal", DataType="single")
P_AEB_FIM_TimerNumber4GradientInc = AUTOSAR4.Parameter(4, SwCalibrationAccess="ReadWrite", StorageClass="ExportedGlobal", DataType="uint8")
P_AEB_FIM_FastDecFactorGain = AUTOSAR4.Parameter(5, SwCalibrationAccess="ReadWrite", StorageClass="ExportedGlobal", Min=0, Max=10)
P_AEB_FIM_TimeIncReduceValue4LongBraking = AUTOSAR4.Parameter(6, SwCalibrationAccess="ReadWrite", StorageClass="ExportedGlobal", DataType="single", Min=0, Max=10)
P_AEB_FIM_aDesiredJerkInitialX = AUTOSAR4.Parameter([-8; -7; -6; -4; -2], SwCalibrationAccess="ReadWrite", StorageClass="ExportedGlobal", Min=-16, Max=0)
P_AEB_FIM_aDesiredJerkInitialY = AUTOSAR4.Parameter([-50; -25; -14; -9; -6], SwCalibrationAccess="ReadWrite", StorageClass="ExportedGlobal", Min=-50, Max=0)
P_AEB_FIM_aErroraDesiredaMaxThres4FastDec = AUTOSAR4.Parameter(-1.75, SwCalibrationAccess="ReadWrite", StorageClass="ExportedGlobal", DataType="single", Min=-3, Max=0)
P_AEB_FIM_aErroraDesiredaTgtThres4JerkReset = AUTOSAR4.Parameter(0.2, SwCalibrationAccess="ReadWrite", StorageClass="ExportedGlobal")
P_AEB_FIM_aErrorThres4BrakeStage1 = AUTOSAR4.Parameter(-0.3, SwCalibrationAccess="ReadWrite", StorageClass="ExportedGlobal", DataType="single", Min=-5, Max=0)
P_AEB_FIM_aErrorThres4BrakeStage2 = AUTOSAR4.Parameter(-0.6, SwCalibrationAccess="ReadWrite", StorageClass="ExportedGlobal", DataType="single", Min=-5, Max=0)
P_AEB_FIM_aErrorThres4BrakeStage3 = AUTOSAR4.Parameter(-0.9, SwCalibrationAccess="ReadWrite", StorageClass="ExportedGlobal", DataType="single", Min=-5, Max=0)
P_AEB_FIM_aErrorThres4BrakeStage4 = AUTOSAR4.Parameter(-1.2, SwCalibrationAccess="ReadWrite", StorageClass="ExportedGlobal", DataType="single", Min=-5, Max=0)
P_AEB_FIM_aErrorThres4BrakeStage5 = AUTOSAR4.Parameter(-1.5, SwCalibrationAccess="ReadWrite", StorageClass="ExportedGlobal", DataType="single", Min=-5, Max=0)
P_AEB_FIM_aErrorThres4BrakeStage6 = AUTOSAR4.Parameter(-2.3, SwCalibrationAccess="ReadWrite", StorageClass="ExportedGlobal", DataType="single", Min=-5, Max=0)
P_AEB_FIM_aErrorThres4BrakeStage7 = AUTOSAR4.Parameter(-2.3, SwCalibrationAccess="ReadWrite", StorageClass="ExportedGlobal", DataType="single", Min=-5, Max=0)
P_AEB_FIM_DecJerkFactorX_ErroraDesiredaTgt = AUTOSAR4.Parameter([-10; -8; -5; -3; -2.5; -1.5; -1; -0.5], SwCalibrationAccess="ReadWrite", StorageClass="ExportedGlobal", Min=-10, Max=0)
P_AEB_FIM_DecJerkFactorY = AUTOSAR4.Parameter([100; 50; 20; 10; 6; 2; 1; 0], SwCalibrationAccess="ReadWrite", StorageClass="ExportedGlobal", Min=0, Max=100)
P_AEB_FIM_DecJerkStep4DecControl = AUTOSAR4.Parameter(-0.125, SwCalibrationAccess="ReadWrite", StorageClass="ExportedGlobal", Min=-2, Max=0)
P_AEB_FIM_Jerk4ControllingIncXTime = AUTOSAR4.Parameter([0; 0.2; 0.4; 0.6; 0.8; 1; 1.2; 1.4; 1.6; 1.8; 2; 2.2; 2.4; 2.6; 2.8; 3], SwCalibrationAccess="ReadWrite", StorageClass="ExportedGlobal", Min=0, Max=5)
P_AEB_FIM_Jerk4ControllingIncY = AUTOSAR4.Parameter([0; 1; 2; 2; 2.5; 2.5; 3; 3; 3.5; 3.5; 4; 4; 4; 4; 4; 4], SwCalibrationAccess="ReadWrite", StorageClass="ExportedGlobal", Min=0, Max=20)
P_AEB_FIM_JerkHoldTimeY = AUTOSAR4.Parameter([0.5; 0.3; 0.1; 0.1], SwCalibrationAccess="ReadWrite", StorageClass="ExportedGlobal", Min=0, Max=1)
P_AEB_FIM_JerkTimeHoldX_vRelStart = AUTOSAR4.Parameter([-13.3; -8.3; -4.6; 0], SwCalibrationAccess="ReadWrite", StorageClass="ExportedGlobal", Min=-16.66, Max=0)
P_AEB_FIM_TimerNumber4JerkInc = AUTOSAR4.Parameter(4, SwCalibrationAccess="ReadWrite", StorageClass="ExportedGlobal", DataType="uint8")
P_AEB_VehAwbSwt4VAF = AUTOSAR4.Parameter(0, SwCalibrationAccess="ReadWrite", StorageClass="ExportedGlobal")
P_AEB_LatCycCA_DecelMaxFullBrakeY = AUTOSAR4.Parameter(repmat(-5, 16, 1), SwCalibrationAccess="ReadWrite", StorageClass="ExportedGlobal", DataType="single", Min=-15, Max=0)
P_AEB_LatCycCA_BrkJerkMaxPartBrakeY = AUTOSAR4.Parameter(repmat(-45, 16, 1), SwCalibrationAccess="ReadWrite", StorageClass="ExportedGlobal", DataType="single", Min=-64, Max=0)
P_AEB_FIM_AcutewarningLvl1VehSpdMinThres = AUTOSAR4.Parameter(8.3, SwCalibrationAccess="ReadWrite", StorageClass="ExportedGlobal", DataType="single", Min=0, Max=50)
P_AEB_FIM_AcutewarningLvl2VehSpdMinThres = AUTOSAR4.Parameter(11.1, SwCalibrationAccess="ReadWrite", StorageClass="ExportedGlobal", DataType="single", Min=0, Max=50)
P_AEB_FIM_AcutewarningLvl3VehSpdMinThres = AUTOSAR4.Parameter(25, SwCalibrationAccess="ReadWrite", StorageClass="ExportedGlobal", DataType="single", Min=0, Max=50)
P_AEB_FIM_AcutewarningLvl4VehSpdMaxThres = AUTOSAR4.Parameter(41.67, SwCalibrationAccess="ReadWrite", StorageClass="ExportedGlobal", DataType="single", Min=0, Max=50)
P_AEB_FIM_AcutewarningLvl4VehSpdMinThres = AUTOSAR4.Parameter(33.33, SwCalibrationAccess="ReadWrite", StorageClass="ExportedGlobal", DataType="single", Min=0, Max=50)
P_AEB_FIM_BrkBlockTimeThres = AUTOSAR4.Parameter(20, SwCalibrationAccess="ReadWrite", StorageClass="ExportedGlobal", DataType="single", Min=0, Max=30)
P_AEB_FIM_BrkReadyBlockTimeThres = AUTOSAR4.Parameter(5, SwCalibrationAccess="ReadWrite", StorageClass="ExportedGlobal", DataType="single", Min=0, Max=30)
P_AEB_FIM_CycAEBPartDecelGradientThres = AUTOSAR4.Parameter(-45, SwCalibrationAccess="ReadWrite", StorageClass="ExportedGlobal", DataType="single", Min=-50, Max=0)
P_AEB_FIM_CycAEBfullDecelGradientThres = AUTOSAR4.Parameter(-45, SwCalibrationAccess="ReadWrite", StorageClass="ExportedGlobal", DataType="single", Min=-50, Max=0)
P_AEB_FIM_CycAEBfullDecelMinThres = AUTOSAR4.Parameter(-9, SwCalibrationAccess="ReadWrite", StorageClass="ExportedGlobal", DataType="single", Min=-15, Max=0)
P_AEB_FIM_DangerCalAccelAvoidThres = AUTOSAR4.Parameter(-0.02, SwCalibrationAccess="ReadWrite", StorageClass="ExportedGlobal", DataType="single", Min=-1, Max=0)
P_AEB_FIM_DangerCalObjAccelThres = AUTOSAR4.Parameter(0, SwCalibrationAccess="ReadWrite", StorageClass="ExportedGlobal", DataType="single", Min=0, Max=4)
P_AEB_FIM_EBAVelDecMaxThres = AUTOSAR4.Parameter(23.6, SwCalibrationAccess="ReadWrite", StorageClass="ExportedGlobal", DataType="single", Min=0, Max=23.6)
P_AEB_FIM_FCTBDecelGradientThres = AUTOSAR4.Parameter(-15, SwCalibrationAccess="ReadWrite", StorageClass="ExportedGlobal", DataType="single", Min=-50, Max=0)
P_AEB_FIM_FCTBDecelMinThres = AUTOSAR4.Parameter(-5, SwCalibrationAccess="ReadWrite", StorageClass="ExportedGlobal", DataType="single", Min=-12, Max=0)
P_AEB_FIM_JAAEBfullDecelGradientThres = AUTOSAR4.Parameter(-25, SwCalibrationAccess="ReadWrite", StorageClass="ExportedGlobal", DataType="single", Min=-50, Max=0)
P_AEB_FIM_JAAEBfullDecelMinThres = AUTOSAR4.Parameter(-8, SwCalibrationAccess="ReadWrite", StorageClass="ExportedGlobal", DataType="single", Min=-15, Max=0)
P_AEB_FIM_JA_PTW_AEBDecelGradientThres = AUTOSAR4.Parameter(-25, SwCalibrationAccess="ReadWrite", StorageClass="ExportedGlobal", DataType="single", Min=-50, Max=0)
P_AEB_FIM_JA_PTW_AEBDecelMinThres = AUTOSAR4.Parameter(-8, SwCalibrationAccess="ReadWrite", StorageClass="ExportedGlobal", DataType="single", Min=-15, Max=0)
P_AEB_FIM_JA_cycAEBDecelGradientThres = AUTOSAR4.Parameter(-45, SwCalibrationAccess="ReadWrite", StorageClass="ExportedGlobal", DataType="single", Min=-50, Max=0)
P_AEB_FIM_JA_cycAEBDecelMinThres = AUTOSAR4.Parameter(-9, SwCalibrationAccess="ReadWrite", StorageClass="ExportedGlobal", DataType="single", Min=-15, Max=0)
P_AEB_FIM_JA_pedAEBDecelGradientThres = AUTOSAR4.Parameter(-45, SwCalibrationAccess="ReadWrite", StorageClass="ExportedGlobal", DataType="single", Min=-50, Max=0)
P_AEB_FIM_JA_pedAEBDecelMinThres = AUTOSAR4.Parameter(-9, SwCalibrationAccess="ReadWrite", StorageClass="ExportedGlobal", DataType="single", Min=-15, Max=0)
P_AEB_FIM_PedAEBfullDecelGradientThres = AUTOSAR4.Parameter(-45, SwCalibrationAccess="ReadWrite", StorageClass="ExportedGlobal", DataType="single", Min=-50, Max=0)
P_AEB_FIM_PedAEBfullDecelMinThres = AUTOSAR4.Parameter(-9, SwCalibrationAccess="ReadWrite", StorageClass="ExportedGlobal", DataType="single", Min=-15, Max=0)
P_AEB_FIM_VehAEBPartDecelGradientThres = AUTOSAR4.Parameter(-15, SwCalibrationAccess="ReadWrite", StorageClass="ExportedGlobal", DataType="single", Min=-50, Max=0)
P_AEB_FIM_VehAEBPartDecelMinThres = AUTOSAR4.Parameter(-5, SwCalibrationAccess="ReadWrite", StorageClass="ExportedGlobal", DataType="single", Min=-8, Max=0)
P_AEB_FIM_VehAEBfullDecelGradientThresMO = AUTOSAR4.Parameter(-20, SwCalibrationAccess="ReadWrite", StorageClass="ExportedGlobal", DataType="single", Min=-50, Max=0)
P_AEB_FIM_VehAEBfullDecelGradientThresSO = AUTOSAR4.Parameter(-25, SwCalibrationAccess="ReadWrite", StorageClass="ExportedGlobal", DataType="single", Min=-50, Max=0)
P_AEB_FIM_VehAEBfullDecelMinThresMOX = AUTOSAR4.Parameter([0; 16.67; 23.6; 34], SwCalibrationAccess="ReadWrite", StorageClass="ExportedGlobal", DataType="single", Min=0, Max=41.67)
P_AEB_FIM_VehAEBfullDecelMinThresSO = AUTOSAR4.Parameter(-8, SwCalibrationAccess="ReadWrite", StorageClass="ExportedGlobal", DataType="single", Min=-8, Max=0)
P_AEB_FIM_VehAEBpartDecelMinThresX = AUTOSAR4.Parameter([0; 16.67; 23.6; 34; 42], SwCalibrationAccess="ReadWrite", StorageClass="ExportedGlobal", DataType="single", Min=0, Max=50)
P_AEB_FIM_VehAEBpartDecelMinThresY = AUTOSAR4.Parameter([-5; -5; -4; -3.5; -3], SwCalibrationAccess="ReadWrite", StorageClass="ExportedGlobal", DataType="single", Min=-8, Max=0)
P_AEB_FIM_VehEBADecelGradientThres = AUTOSAR4.Parameter(-30, SwCalibrationAccess="ReadWrite", StorageClass="ExportedGlobal", DataType="single", Min=-50, Max=0)
P_AEB_FIM_VehEBADecelMinThres = AUTOSAR4.Parameter(-12, SwCalibrationAccess="ReadWrite", StorageClass="ExportedGlobal", DataType="single", Min=-16, Max=0)
P_AEB_FIM_WarningBlockTimeThres = AUTOSAR4.Parameter(5, SwCalibrationAccess="ReadWrite", StorageClass="ExportedGlobal", DataType="single", Min=0, Max=30)
P_AEB_FuncStatus_CycAEBfullStandstillWorkTime = AUTOSAR4.Parameter(3, SwCalibrationAccess="ReadWrite", StorageClass="ExportedGlobal", DataType="single", Min=0, Max=60)
P_AEB_FuncStatus_CycAEBpartStandstillWorkTime = AUTOSAR4.Parameter(3, SwCalibrationAccess="ReadWrite", StorageClass="ExportedGlobal", DataType="single", Min=0, Max=60)
P_AEB_FuncStatus_CycPrefillStandstillWorkTime = AUTOSAR4.Parameter(3, SwCalibrationAccess="ReadWrite", StorageClass="ExportedGlobal", DataType="single", Min=0, Max=60)
P_AEB_FuncStatus_JaPedAEBfullStandstillWorkTime = AUTOSAR4.Parameter(3, SwCalibrationAccess="ReadWrite", StorageClass="ExportedGlobal", DataType="single", Min=0, Max=60)
P_AEB_FuncStatus_JaPedAEBfullWorkTime = AUTOSAR4.Parameter(5, SwCalibrationAccess="ReadWrite", StorageClass="ExportedGlobal", DataType="single", Min=0, Max=10)
P_AEB_FuncStatus_JaPedPrefillStandstillWorkTime = AUTOSAR4.Parameter(3, SwCalibrationAccess="ReadWrite", StorageClass="ExportedGlobal", DataType="single", Min=0, Max=60)
P_AEB_FuncStatus_JaPedPrefillWorkTime = AUTOSAR4.Parameter(5, SwCalibrationAccess="ReadWrite", StorageClass="ExportedGlobal", DataType="single", Min=0, Max=10)
P_AEB_FuncStatus_JaVehAEBfullStandstillWorkTime = AUTOSAR4.Parameter(3, SwCalibrationAccess="ReadWrite", StorageClass="ExportedGlobal", DataType="single", Min=0, Max=60)
P_AEB_FuncStatus_JaVehAEBfullWorkTime = AUTOSAR4.Parameter(5, SwCalibrationAccess="ReadWrite", StorageClass="ExportedGlobal", DataType="single", Min=0, Max=10)
P_AEB_FuncStatus_JaVehPrefillStandstillWorkTime = AUTOSAR4.Parameter(3, SwCalibrationAccess="ReadWrite", StorageClass="ExportedGlobal", DataType="single", Min=0, Max=60)
P_AEB_FuncStatus_JaVehPrefillWorkTime = AUTOSAR4.Parameter(5, SwCalibrationAccess="ReadWrite", StorageClass="ExportedGlobal", DataType="single", Min=0, Max=10)
P_AEB_FuncStatus_PedABAStandstillWorkTime = AUTOSAR4.Parameter(3, SwCalibrationAccess="ReadWrite", StorageClass="ExportedGlobal", DataType="single", Min=0, Max=60)
P_AEB_FuncStatus_PedAEBfullStandstillWorkTime = AUTOSAR4.Parameter(3, SwCalibrationAccess="ReadWrite", StorageClass="ExportedGlobal", DataType="single", Min=0, Max=60)
P_AEB_FuncStatus_PedPreWarningStandstillWorkTime = AUTOSAR4.Parameter(1, SwCalibrationAccess="ReadWrite", StorageClass="ExportedGlobal", DataType="single", Min=0, Max=60)
P_AEB_FuncStatus_PedPrefillStandstillWorkTime = AUTOSAR4.Parameter(3, SwCalibrationAccess="ReadWrite", StorageClass="ExportedGlobal", DataType="single", Min=0, Max=60)
P_AEB_FuncStatus_VehABAStandstillWorkTime = AUTOSAR4.Parameter(3, SwCalibrationAccess="ReadWrite", StorageClass="ExportedGlobal", DataType="single", Min=0, Max=60)
P_AEB_FuncStatus_VehABAWorkTime = AUTOSAR4.Parameter(3, SwCalibrationAccess="ReadWrite", StorageClass="ExportedGlobal", DataType="single", Min=0, Max=60)
P_AEB_FuncStatus_VehAEBPartStandstillWorkTime = AUTOSAR4.Parameter(3, SwCalibrationAccess="ReadWrite", StorageClass="ExportedGlobal", DataType="single", Min=0, Max=60)
P_AEB_FuncStatus_VehAEBPartWorkTime = AUTOSAR4.Parameter(5, SwCalibrationAccess="ReadWrite", StorageClass="ExportedGlobal", DataType="single", Min=0, Max=10)
P_AEB_FuncStatus_VehAEBfullStandstillWorkTime = AUTOSAR4.Parameter(3, SwCalibrationAccess="ReadWrite", StorageClass="ExportedGlobal", DataType="single", Min=0, Max=60)
P_AEB_FuncStatus_VehAEBfullWorkTime = AUTOSAR4.Parameter(5, SwCalibrationAccess="ReadWrite", StorageClass="ExportedGlobal", DataType="single", Min=0, Max=10)
P_AEB_FuncStatus_VehAcuteWarningStandstillWorkTime = AUTOSAR4.Parameter(3, SwCalibrationAccess="ReadWrite", StorageClass="ExportedGlobal", DataType="single", Min=0, Max=60)
P_AEB_FuncStatus_VehAcuteWarningWorkTime = AUTOSAR4.Parameter(1, SwCalibrationAccess="ReadWrite", StorageClass="ExportedGlobal", DataType="single", Min=0, Max=10)
P_AEB_FuncStatus_VehEBAStandstillWorkTime = AUTOSAR4.Parameter(3, SwCalibrationAccess="ReadWrite", StorageClass="ExportedGlobal", DataType="single", Min=0, Max=60)
P_AEB_FuncStatus_VehEBAWorkTime = AUTOSAR4.Parameter(60, SwCalibrationAccess="ReadWrite", StorageClass="ExportedGlobal", DataType="single", Min=0, Max=60)
P_AEB_FuncStatus_VehLatentWarningStandstillWorkTime = AUTOSAR4.Parameter(3, SwCalibrationAccess="ReadWrite", StorageClass="ExportedGlobal", DataType="single", Min=0, Max=60)
P_AEB_FuncStatus_VehLatentWarningTime = AUTOSAR4.Parameter(2, SwCalibrationAccess="ReadWrite", StorageClass="ExportedGlobal", DataType="single", Min=0, Max=60)
P_AEB_FuncStatus_VehPreWarningStandstillWorkTime = AUTOSAR4.Parameter(3, SwCalibrationAccess="ReadWrite", StorageClass="ExportedGlobal", DataType="single", Min=0, Max=60)
P_AEB_FuncStatus_VehPreWarningWorkTime = AUTOSAR4.Parameter(2, SwCalibrationAccess="ReadWrite", StorageClass="ExportedGlobal", DataType="single", Min=0, Max=10)
P_AEB_FuncStatus_VehPrefillStandstillWorkTime = AUTOSAR4.Parameter(3, SwCalibrationAccess="ReadWrite", StorageClass="ExportedGlobal", DataType="single", Min=0, Max=60)
P_AEB_FuncStatus_VehPrefillWorkTime = AUTOSAR4.Parameter(5, SwCalibrationAccess="ReadWrite", StorageClass="ExportedGlobal", DataType="single", Min=0, Max=10)
P_AEB_Func_JaPedAEBfullAccrCondAborDelayTime = AUTOSAR4.Parameter(1.5, SwCalibrationAccess="ReadWrite", StorageClass="ExportedGlobal", DataType="single", Min=0, Max=5)

P_AEB_Func_JaPedAEBfullBrkDistSecure = AUTOSAR4.Parameter(0.3, SwCalibrationAccess="ReadWrite", StorageClass="ExportedGlobal", DataType="single", Min=0, Max=2)
P_AEB_Func_JaPedAEBfullGasPedalAborThres = AUTOSAR4.Parameter(85, SwCalibrationAccess="ReadWrite", StorageClass="ExportedGlobal", DataType="single", Min=0, Max=100)
P_AEB_Func_JaPedAEBfullObjObstacleProbSupThres = AUTOSAR4.Parameter(0.85, SwCalibrationAccess="ReadWrite", StorageClass="ExportedGlobal", DataType="single", Min=0, Max=1)
P_AEB_Func_JaPedAEBfullObjVelSupThresMin = AUTOSAR4.Parameter(0.6, SwCalibrationAccess="ReadWrite", StorageClass="ExportedGlobal", DataType="single", Min=0, Max=20)
P_AEB_Func_JaPedAEBfullStrWheelAngleSpdAborThres = AUTOSAR4.Parameter(300, SwCalibrationAccess="ReadWrite", StorageClass="ExportedGlobal", DataType="single", Min=0, Max=1000)
P_AEB_Func_JaPedAEBfullSubjLatAccelAbsSupThres = AUTOSAR4.Parameter(3, SwCalibrationAccess="ReadWrite", StorageClass="ExportedGlobal", DataType="single", Min=0, Max=10)
P_AEB_Func_JaPedAEBfullSubjVelMax = AUTOSAR4.Parameter(6.1, SwCalibrationAccess="ReadWrite", StorageClass="ExportedGlobal", DataType="single", Min=0, Max=69)
P_AEB_Func_JaPedAEBfullSubjVelStrWheelAngleMaxThresX = AUTOSAR4.Parameter([0; 2.78; 7; 16.67], SwCalibrationAccess="ReadWrite", StorageClass="ExportedGlobal", DataType="single", Min=0, Max=16.67)
P_AEB_Func_JaPedAEBfullSubjVelStrWheelAngleMaxThresY = AUTOSAR4.Parameter([450; 450; 360; 180], SwCalibrationAccess="ReadWrite", StorageClass="ExportedGlobal", DataType="single", Min=0, Max=720)
P_AEB_Func_JaPedAEBfullSubjVelStrWheelAngleMinThresX = AUTOSAR4.Parameter([0; 2.78; 7; 16.67], SwCalibrationAccess="ReadWrite", StorageClass="ExportedGlobal", DataType="single", Min=0, Max=16.67)
P_AEB_Func_JaPedAEBfullTtcTimeOffset = AUTOSAR4.Parameter(0.1, SwCalibrationAccess="ReadWrite", StorageClass="ExportedGlobal", DataType="single", Min=0, Max=3)
P_AEB_Func_JaPedPrefillAccrCondAborDelayTime = AUTOSAR4.Parameter(1.5, SwCalibrationAccess="ReadWrite", StorageClass="ExportedGlobal", DataType="single", Min=0, Max=5)
P_AEB_Func_JaPedPrefillBrkDistSecure = AUTOSAR4.Parameter(0.5, SwCalibrationAccess="ReadWrite", StorageClass="ExportedGlobal", DataType="single", Min=0, Max=3)
P_AEB_Func_JaPedPrefillGasPedalAborThres = AUTOSAR4.Parameter(85, SwCalibrationAccess="ReadWrite", StorageClass="ExportedGlobal", DataType="single", Min=0, Max=100)
P_AEB_Func_JaPedPrefillMasterCylindBrkPressSupThres = AUTOSAR4.Parameter(3, SwCalibrationAccess="ReadWrite", StorageClass="ExportedGlobal", DataType="single", Min=0, Max=10)
P_AEB_Func_JaPedPrefillObjObstacleProbSupThres = AUTOSAR4.Parameter(0.7, SwCalibrationAccess="ReadWrite", StorageClass="ExportedGlobal", DataType="single", Min=0, Max=1)
P_AEB_Func_JaPedPrefillObjVelSupThresMin = AUTOSAR4.Parameter(0.6, SwCalibrationAccess="ReadWrite", StorageClass="ExportedGlobal", DataType="single", Min=0, Max=20)
P_AEB_Func_JaPedPrefillStrWheelAngleSpdAborThres = AUTOSAR4.Parameter(300, SwCalibrationAccess="ReadWrite", StorageClass="ExportedGlobal", DataType="single", Min=0, Max=1000)
P_AEB_Func_JaPedPrefillSubjLatAccelAbsSupThres = AUTOSAR4.Parameter(3, SwCalibrationAccess="ReadWrite", StorageClass="ExportedGlobal", DataType="single", Min=0, Max=10)
P_AEB_Func_JaPedPrefillSubjVelMax = AUTOSAR4.Parameter(6.1, SwCalibrationAccess="ReadWrite", StorageClass="ExportedGlobal", DataType="single", Min=0, Max=69)
P_AEB_Func_JaPedPrefillSubjVelStrWheelAngleMaxThresX = AUTOSAR4.Parameter([0; 2.78; 7; 16.67], SwCalibrationAccess="ReadWrite", StorageClass="ExportedGlobal", DataType="single", Min=0, Max=16.67)
P_AEB_Func_JaPedPrefillSubjVelStrWheelAngleMaxThresY = AUTOSAR4.Parameter([450; 450; 360; 180], SwCalibrationAccess="ReadWrite", StorageClass="ExportedGlobal", DataType="single", Min=0, Max=720)
P_AEB_Func_JaPedPrefillSubjVelStrWheelAngleMinThresX = AUTOSAR4.Parameter([0; 2.78; 7; 16.67], SwCalibrationAccess="ReadWrite", StorageClass="ExportedGlobal", DataType="single", Min=0, Max=16.67)
P_AEB_Func_JaPedPrefillTtcTimeOffset = AUTOSAR4.Parameter(0.3, SwCalibrationAccess="ReadWrite", StorageClass="ExportedGlobal", DataType="single", Min=0, Max=2)
P_AEB_Func_JaVehAEBfullAccrCondAborDelayTime = AUTOSAR4.Parameter(1.5, SwCalibrationAccess="ReadWrite", StorageClass="ExportedGlobal", DataType="single", Min=0, Max=5)
P_AEB_Func_JaVehAEBfullBrkDistSecure = AUTOSAR4.Parameter(0.3, SwCalibrationAccess="ReadWrite", StorageClass="ExportedGlobal", DataType="single", Min=0, Max=3)
P_AEB_Func_JaVehAEBfullGasPedalAborThres = AUTOSAR4.Parameter(85, SwCalibrationAccess="ReadWrite", StorageClass="ExportedGlobal", DataType="single", Min=0, Max=100)
P_AEB_Func_JaVehAEBfullObjObstacleProbSupThres = AUTOSAR4.Parameter(0.85, SwCalibrationAccess="ReadWrite", StorageClass="ExportedGlobal", DataType="single", Min=0, Max=1)
P_AEB_Func_JaVehAEBfullObjWidth = AUTOSAR4.Parameter(1.8, SwCalibrationAccess="ReadWrite", StorageClass="ExportedGlobal", DataType="single", Min=0, Max=3)
P_AEB_Func_JaVehAEBfullStrWheelAngleSpdAborThres = AUTOSAR4.Parameter(300, SwCalibrationAccess="ReadWrite", StorageClass="ExportedGlobal", DataType="single", Min=0, Max=600)
P_AEB_Func_JaVehAEBfullSubjLatAccelAbsSupThres = AUTOSAR4.Parameter(3, SwCalibrationAccess="ReadWrite", StorageClass="ExportedGlobal", DataType="single", Min=0, Max=10)
P_AEB_Func_JaVehAEBfullSubjVelMax = AUTOSAR4.Parameter(6.1, SwCalibrationAccess="ReadWrite", StorageClass="ExportedGlobal", DataType="single", Min=0, Max=69)
P_AEB_Func_JaVehAEBfullSubjVelStrWheelAngleMaxThresX = AUTOSAR4.Parameter([0; 2.78; 7; 16.67], SwCalibrationAccess="ReadWrite", StorageClass="ExportedGlobal", DataType="single", Min=0, Max=16.67)
P_AEB_Func_JaVehAEBfullSubjVelStrWheelAngleMaxThresY = AUTOSAR4.Parameter([450; 450; 360; 180], SwCalibrationAccess="ReadWrite", StorageClass="ExportedGlobal", DataType="single", Min=0, Max=720)
P_AEB_Func_JaVehAEBfullSubjVelStrWheelAngleMinThresX = AUTOSAR4.Parameter([0; 2.78; 7; 16.67], SwCalibrationAccess="ReadWrite", StorageClass="ExportedGlobal", DataType="single", Min=0, Max=16.67)
P_AEB_Func_JaVehAEBfullTtcTimeOffset = AUTOSAR4.Parameter(0.1, SwCalibrationAccess="ReadWrite", StorageClass="ExportedGlobal", DataType="single", Min=0, Max=1)
P_AEB_Func_JaVehPrefillAccrCondAborDelayTime = AUTOSAR4.Parameter(1.5, SwCalibrationAccess="ReadWrite", StorageClass="ExportedGlobal", DataType="single", Min=0, Max=5)
P_AEB_Func_JaVehPrefillGasPedalAborThres = AUTOSAR4.Parameter(85, SwCalibrationAccess="ReadWrite", StorageClass="ExportedGlobal", DataType="single", Min=0, Max=100)
P_AEB_Func_JaVehPrefillMasterCylindBrkPressSupThres = AUTOSAR4.Parameter(3, SwCalibrationAccess="ReadWrite", StorageClass="ExportedGlobal", DataType="single", Min=0, Max=10)
P_AEB_Func_JaVehPrefillObjObstacleProbSupThres = AUTOSAR4.Parameter(0.7, SwCalibrationAccess="ReadWrite", StorageClass="ExportedGlobal", DataType="single", Min=0, Max=1)
P_AEB_Func_JaVehPrefillObjWidth = AUTOSAR4.Parameter(1.8, SwCalibrationAccess="ReadWrite", StorageClass="ExportedGlobal", DataType="single", Min=0, Max=3)
P_AEB_Func_JaVehPrefillStrWheelAngleSpdAborThres = AUTOSAR4.Parameter(300, SwCalibrationAccess="ReadWrite", StorageClass="ExportedGlobal", DataType="single", Min=0, Max=600)
P_AEB_Func_JaVehPrefillSubjVelMax = AUTOSAR4.Parameter(6.1, SwCalibrationAccess="ReadWrite", StorageClass="ExportedGlobal", DataType="single", Min=0, Max=69)
P_AEB_Func_JaVehPrefillSubjVelStrWheelAngleMaxThresX = AUTOSAR4.Parameter([0; 2.78; 7; 16.67], SwCalibrationAccess="ReadWrite", StorageClass="ExportedGlobal", DataType="single", Min=0, Max=16.67)
P_AEB_Func_JaVehPrefillSubjVelStrWheelAngleMaxThresY = AUTOSAR4.Parameter([450; 450; 360; 180], SwCalibrationAccess="ReadWrite", StorageClass="ExportedGlobal", DataType="single", Min=0, Max=720)
P_AEB_Func_JaVehPrefillSubjVelStrWheelAngleMinThresX = AUTOSAR4.Parameter([0; 2.78; 7; 16.67], SwCalibrationAccess="ReadWrite", StorageClass="ExportedGlobal", DataType="single", Min=0, Max=16.67)
P_AEB_Func_cycAEBfulColliisonRiskProbAborThresObjID = AUTOSAR4.Parameter(0.4, SwCalibrationAccess="ReadWrite", StorageClass="ExportedGlobal", DataType="single", Min=0, Max=0.99)
P_AEB_Func_cycAEBfullAZAngleThresObjLatMovContiInvalid = AUTOSAR4.Parameter(0.436, SwCalibrationAccess="ReadWrite", StorageClass="ExportedGlobal", DataType="single", Min=0, Max=1)
P_AEB_Func_cycAEBfullAccrCondAborDelayTime = AUTOSAR4.Parameter(1.5, SwCalibrationAccess="ReadWrite", StorageClass="ExportedGlobal", DataType="single", Min=0, Max=5)
P_AEB_Func_cycAEBfullActivationTimeAborThres = AUTOSAR4.Parameter(1.6, SwCalibrationAccess="ReadWrite", StorageClass="ExportedGlobal", DataType="single", Min=0, Max=5)
P_AEB_Func_cycAEBfullColliisonRiskProbAborThres = AUTOSAR4.Parameter(0.25, SwCalibrationAccess="ReadWrite", StorageClass="ExportedGlobal", DataType="single", Min=0, Max=0.99)
P_AEB_Func_cycAEBfullColliisonRiskProbSupThres4Fusion = AUTOSAR4.Parameter(0.6, SwCalibrationAccess="ReadWrite", StorageClass="ExportedGlobal", DataType="single", Min=0, Max=0.99)
P_AEB_Func_cycAEBfullColliisonRiskProbSupThres4Radar = AUTOSAR4.Parameter(0.6, SwCalibrationAccess="ReadWrite", StorageClass="ExportedGlobal", DataType="single", Min=0, Max=0.99)
P_AEB_Func_cycAEBfullDyAbsThresObjLatMovContiInvalid = AUTOSAR4.Parameter(1.8, SwCalibrationAccess="ReadWrite", StorageClass="ExportedGlobal", DataType="single", Min=0, Max=7)
P_AEB_Func_cycAEBfullDyLatBoundHmiLateY = AUTOSAR4.Parameter([2.4429; 3.729; 5.2294; 7.1584; 9.516], SwCalibrationAccess="ReadWrite", StorageClass="ExportedGlobal", DataType="single", Min=0, Max=10)
P_AEB_Func_cycAEBfullGasPedalSupThres = AUTOSAR4.Parameter(85, SwCalibrationAccess="ReadWrite", StorageClass="ExportedGlobal", DataType="single", Min=0, Max=100)
P_AEB_Func_cycAEBfullLongDistTimeOffset = AUTOSAR4.Parameter(0.15, SwCalibrationAccess="ReadWrite", StorageClass="ExportedGlobal", DataType="single", Min=0, Max=5)
P_AEB_Func_cycAEBfullMasterCylindBrkPressSupThres = AUTOSAR4.Parameter(200, SwCalibrationAccess="ReadWrite", StorageClass="ExportedGlobal", DataType="single", Min=0, Max=300)
P_AEB_Func_cycAEBfullObjVyAbsLatBoundHmiLateX = AUTOSAR4.Parameter([2.5; 4.1667; 5.5556; 6.9444; 8.3333], SwCalibrationAccess="ReadWrite", StorageClass="ExportedGlobal", DataType="single", Min=0, Max=10)
P_AEB_Func_cycAEBfullStrCondAborDelayTime = AUTOSAR4.Parameter(1.5, SwCalibrationAccess="ReadWrite", StorageClass="ExportedGlobal", DataType="single", Min=0, Max=5)
P_AEB_Func_cycAEBfullStrWheelAngleAborThres = AUTOSAR4.Parameter(1.57, SwCalibrationAccess="ReadWrite", StorageClass="ExportedGlobal", DataType="single", Min=0, Max=15)
P_AEB_Func_cycAEBfullStrWheelAngleSpdAborThres = AUTOSAR4.Parameter(1.75, SwCalibrationAccess="ReadWrite", StorageClass="ExportedGlobal", DataType="single", Min=0, Max=6.28)
P_AEB_Func_cycAEBfullStrWheelAngleSpdSupThres = AUTOSAR4.Parameter(1.75, SwCalibrationAccess="ReadWrite", StorageClass="ExportedGlobal", DataType="single", Min=0, Max=6.28)
P_AEB_Func_cycAEBfullStrWheelAngleSupThres = AUTOSAR4.Parameter(1.57, SwCalibrationAccess="ReadWrite", StorageClass="ExportedGlobal", DataType="single", Min=0, Max=15)
P_AEB_Func_cycAEBfullSubjCurvTrajSupThres = AUTOSAR4.Parameter(0.008, SwCalibrationAccess="ReadWrite", StorageClass="ExportedGlobal", DataType="single", Min=0, Max=0.1)
P_AEB_Func_cycAEBfullSubjLatAccelSupThres = AUTOSAR4.Parameter(0.2, SwCalibrationAccess="ReadWrite", StorageClass="ExportedGlobal", DataType="single", Min=-5, Max=5)
P_AEB_Func_cycAEBfullSubjVelMax = AUTOSAR4.Parameter(17.78, SwCalibrationAccess="ReadWrite", StorageClass="ExportedGlobal", DataType="single", Min=10, Max=25)
P_AEB_Func_cycAEBfullSubjVelMin = AUTOSAR4.Parameter(1.1, SwCalibrationAccess="ReadWrite", StorageClass="ExportedGlobal", DataType="single", Min=0, Max=69.44)
P_AEB_Func_cycAEBfullSubjVelThresObjLatMovContiInvalid = AUTOSAR4.Parameter(0.14, SwCalibrationAccess="ReadWrite", StorageClass="ExportedGlobal", DataType="single", Min=0, Max=2)
P_AEB_Func_cycAEBfullVelReduceAborThres = AUTOSAR4.Parameter(8.89, SwCalibrationAccess="ReadWrite", StorageClass="ExportedGlobal", DataType="single", Min=0, Max=22)
P_AEB_Func_cycAEBfullVyAbsMaxThres4Fusion = AUTOSAR4.Parameter(8.33, SwCalibrationAccess="ReadWrite", StorageClass="ExportedGlobal", DataType="single", Min=0, Max=10)
P_AEB_Func_cycAEBfullVyAbsMaxThres4Radar = AUTOSAR4.Parameter(8.33, SwCalibrationAccess="ReadWrite", StorageClass="ExportedGlobal", DataType="single", Min=0, Max=10)
P_AEB_Func_cycAEBfullVyAbsMinThres4Fusion = AUTOSAR4.Parameter(2.5, SwCalibrationAccess="ReadWrite", StorageClass="ExportedGlobal", DataType="single", Min=0, Max=10)
P_AEB_Func_cycAEBfullVyAbsMinThres4Radar = AUTOSAR4.Parameter(2.5, SwCalibrationAccess="ReadWrite", StorageClass="ExportedGlobal", DataType="single", Min=0, Max=10)
P_AEB_Func_cycAEBparObjVyAbsLatBoundHmiEarlyMidX = AUTOSAR4.Parameter([2.5; 4.1667; 5.5556; 6.9444; 8.3333], SwCalibrationAccess="ReadWrite", StorageClass="ExportedGlobal", DataType="single", Min=0, Max=10)
P_AEB_Func_cycAEBpartAZAngleThresObjLatMovContiInvalid = AUTOSAR4.Parameter(0.436, SwCalibrationAccess="ReadWrite", StorageClass="ExportedGlobal", DataType="single", Min=0, Max=1)
P_AEB_Func_cycAEBpartAccrCondAborDelayTime = AUTOSAR4.Parameter(1.5, SwCalibrationAccess="ReadWrite", StorageClass="ExportedGlobal", DataType="single", Min=0, Max=5)
P_AEB_Func_cycAEBpartColliisonRiskProbAborThresObjID = AUTOSAR4.Parameter(0.4, SwCalibrationAccess="ReadWrite", StorageClass="ExportedGlobal", DataType="single", Min=0, Max=0.99)
P_AEB_Func_cycAEBpartColliisonRiskProbSupThres4Fusion = AUTOSAR4.Parameter(0.6, SwCalibrationAccess="ReadWrite", StorageClass="ExportedGlobal", DataType="single", Min=0, Max=0.99)
P_AEB_Func_cycAEBpartColliisonRiskProbSupThres4Radar = AUTOSAR4.Parameter(0.6, SwCalibrationAccess="ReadWrite", StorageClass="ExportedGlobal", DataType="single", Min=0, Max=0.99)
P_AEB_Func_cycAEBpartCollisonRiskProbAborThres = AUTOSAR4.Parameter(0.25, SwCalibrationAccess="ReadWrite", StorageClass="ExportedGlobal", DataType="single", Min=0, Max=0.99)
P_AEB_Func_cycAEBpartDyAbsThresObjLatMovContiInvalid = AUTOSAR4.Parameter(1.8, SwCalibrationAccess="ReadWrite", StorageClass="ExportedGlobal", DataType="single", Min=0, Max=7)
P_AEB_Func_cycAEBpartDyLatBoundHmiEarlyMidY = AUTOSAR4.Parameter([2.5; 4.1667; 5.5556; 6.9444; 8.3333], SwCalibrationAccess="ReadWrite", StorageClass="ExportedGlobal", DataType="single", Min=0, Max=10)
P_AEB_Func_cycAEBpartDyLatBoundHmiLateY = AUTOSAR4.Parameter([2.4429; 3.729; 5.2294; 7.1584; 9.516], SwCalibrationAccess="ReadWrite", StorageClass="ExportedGlobal", DataType="single", Min=0, Max=10)
P_AEB_Func_cycAEBpartGasPedalSupThres = AUTOSAR4.Parameter(85, SwCalibrationAccess="ReadWrite", StorageClass="ExportedGlobal", DataType="single", Min=0, Max=100)
P_AEB_Func_cycAEBpartLongDistTimeOffset = AUTOSAR4.Parameter(0.15, SwCalibrationAccess="ReadWrite", StorageClass="ExportedGlobal", DataType="single", Min=0, Max=5)
P_AEB_Func_cycAEBpartMasterCylindBrkPressSupThres = AUTOSAR4.Parameter(200, SwCalibrationAccess="ReadWrite", StorageClass="ExportedGlobal", DataType="single", Min=0, Max=300)
P_AEB_Func_cycAEBpartObjVyAbsLatBoundHmiLateX = AUTOSAR4.Parameter([2.5; 4.1667; 5.5556; 6.9444; 8.3333], SwCalibrationAccess="ReadWrite", StorageClass="ExportedGlobal", DataType="single", Min=0, Max=10)
P_AEB_Func_cycAEBpartStrCondAborDelayTime = AUTOSAR4.Parameter(1.5, SwCalibrationAccess="ReadWrite", StorageClass="ExportedGlobal", DataType="single", Min=0, Max=5)
P_AEB_Func_cycAEBpartStrWheelAngleAborThres = AUTOSAR4.Parameter(1.57, SwCalibrationAccess="ReadWrite", StorageClass="ExportedGlobal", DataType="single", Min=0, Max=15)
P_AEB_Func_cycAEBpartStrWheelAngleAborThresStandstill = AUTOSAR4.Parameter(1.57, SwCalibrationAccess="ReadWrite", StorageClass="ExportedGlobal", DataType="single", Min=0, Max=15)
P_AEB_Func_cycAEBpartStrWheelAngleSpdAborThres = AUTOSAR4.Parameter(1.75, SwCalibrationAccess="ReadWrite", StorageClass="ExportedGlobal", DataType="single", Min=0, Max=6.28)
P_AEB_Func_cycAEBpartStrWheelAngleSpdAborThresStandstill = AUTOSAR4.Parameter(1.75, SwCalibrationAccess="ReadWrite", StorageClass="ExportedGlobal", DataType="single", Min=0, Max=6.28)
P_AEB_Func_cycAEBpartStrWheelAngleSpdSupThres = AUTOSAR4.Parameter(1.75, SwCalibrationAccess="ReadWrite", StorageClass="ExportedGlobal", DataType="single", Min=0, Max=6.28)
P_AEB_Func_cycAEBpartStrWheelAngleSupThres = AUTOSAR4.Parameter(1.57, SwCalibrationAccess="ReadWrite", StorageClass="ExportedGlobal", DataType="single", Min=0, Max=15)
P_AEB_Func_cycAEBpartSubjCurvTrajSupThres = AUTOSAR4.Parameter(0.008, SwCalibrationAccess="ReadWrite", StorageClass="ExportedGlobal", DataType="single", Min=0, Max=0.1)
P_AEB_Func_cycAEBpartSubjLatAccelSupThres = AUTOSAR4.Parameter(0.2, SwCalibrationAccess="ReadWrite", StorageClass="ExportedGlobal", DataType="single", Min=-5, Max=5)
P_AEB_Func_cycAEBpartSubjVelMax = AUTOSAR4.Parameter(17.78, SwCalibrationAccess="ReadWrite", StorageClass="ExportedGlobal", DataType="single", Min=10, Max=25)
P_AEB_Func_cycAEBpartSubjVelMin = AUTOSAR4.Parameter(1.1, SwCalibrationAccess="ReadWrite", StorageClass="ExportedGlobal", DataType="single", Min=0, Max=69.44)
P_AEB_Func_cycAEBpartSubjVelThresObjLatMovContiInvalid = AUTOSAR4.Parameter(0.14, SwCalibrationAccess="ReadWrite", StorageClass="ExportedGlobal", DataType="single", Min=0, Max=2)
P_AEB_Func_cycAEBpartVelReduceAborThres = AUTOSAR4.Parameter(8.89, SwCalibrationAccess="ReadWrite", StorageClass="ExportedGlobal", DataType="single", Min=0, Max=22)
P_AEB_Func_cycAEBpartVyAbsMaxThres4Fusion = AUTOSAR4.Parameter(8.33, SwCalibrationAccess="ReadWrite", StorageClass="ExportedGlobal", DataType="single", Min=0, Max=10)
P_AEB_Func_cycAEBpartVyAbsMaxThres4Radar = AUTOSAR4.Parameter(8.33, SwCalibrationAccess="ReadWrite", StorageClass="ExportedGlobal", DataType="single", Min=0, Max=10)
P_AEB_Func_cycAEBpartVyAbsMinThres4Fusion = AUTOSAR4.Parameter(2.5, SwCalibrationAccess="ReadWrite", StorageClass="ExportedGlobal", DataType="single", Min=0, Max=10)
P_AEB_Func_cycAEBpartVyAbsMinThres4Radar = AUTOSAR4.Parameter(2.5, SwCalibrationAccess="ReadWrite", StorageClass="ExportedGlobal", DataType="single", Min=0, Max=10)
P_AEB_Func_cycPrefillAccrCondAborDelayTime = AUTOSAR4.Parameter(1.5, SwCalibrationAccess="ReadWrite", StorageClass="ExportedGlobal", DataType="single", Min=0, Max=5)
P_AEB_Func_cycPrefillActivationTimeAborThres = AUTOSAR4.Parameter(1.95, SwCalibrationAccess="ReadWrite", StorageClass="ExportedGlobal", DataType="single", Min=0, Max=5)
P_AEB_Func_cycPrefillColliisonRiskProbSupThres4Fusion = AUTOSAR4.Parameter(0.5, SwCalibrationAccess="ReadWrite", StorageClass="ExportedGlobal", DataType="single", Min=0, Max=0.99)
P_AEB_Func_cycPrefillColliisonRiskProbSupThres4Radar = AUTOSAR4.Parameter(0.5, SwCalibrationAccess="ReadWrite", StorageClass="ExportedGlobal", DataType="single", Min=0, Max=0.99)
P_AEB_Func_cycPrefillGasPedalSupThres = AUTOSAR4.Parameter(85, SwCalibrationAccess="ReadWrite", StorageClass="ExportedGlobal", DataType="single", Min=0, Max=100)
P_AEB_Func_cycPrefillLongDistTimeOffset = AUTOSAR4.Parameter(0.6, SwCalibrationAccess="ReadWrite", StorageClass="ExportedGlobal", DataType="single", Min=0, Max=5)
P_AEB_Func_cycPrefillMasterCylindBrkPressSupThres = AUTOSAR4.Parameter(200, SwCalibrationAccess="ReadWrite", StorageClass="ExportedGlobal", DataType="single", Min=0, Max=300)
P_AEB_Func_cycPrefillStrCondAborDelayTime = AUTOSAR4.Parameter(1.5, SwCalibrationAccess="ReadWrite", StorageClass="ExportedGlobal", DataType="single", Min=0, Max=5)
P_AEB_Func_cycPrefillStrWheelAngleAborThres = AUTOSAR4.Parameter(1.57, SwCalibrationAccess="ReadWrite", StorageClass="ExportedGlobal", DataType="single", Min=0, Max=15)
P_AEB_Func_cycPrefillStrWheelAngleSpdAborThres = AUTOSAR4.Parameter(1.75, SwCalibrationAccess="ReadWrite", StorageClass="ExportedGlobal", DataType="single", Min=0, Max=6.28)
P_AEB_Func_cycPrefillStrWheelAngleSpdSupThres = AUTOSAR4.Parameter(1.75, SwCalibrationAccess="ReadWrite", StorageClass="ExportedGlobal", DataType="single", Min=0, Max=6.28)
P_AEB_Func_cycPrefillStrWheelAngleSupThres = AUTOSAR4.Parameter(1.57, SwCalibrationAccess="ReadWrite", StorageClass="ExportedGlobal", DataType="single", Min=0, Max=15)
P_AEB_Func_cycPrefillSubjCurvTrajSupThres = AUTOSAR4.Parameter(0.008, SwCalibrationAccess="ReadWrite", StorageClass="ExportedGlobal", DataType="single", Min=0, Max=0.1)
P_AEB_Func_cycPrefillSubjLatAccelSupThres = AUTOSAR4.Parameter(0.2, SwCalibrationAccess="ReadWrite", StorageClass="ExportedGlobal", DataType="single", Min=-5, Max=5)
P_AEB_Func_cycPrefillSubjVelMax = AUTOSAR4.Parameter(17.78, SwCalibrationAccess="ReadWrite", StorageClass="ExportedGlobal", DataType="single", Min=10, Max=25)
P_AEB_Func_cycPrefillSubjVelMin = AUTOSAR4.Parameter(1.1, SwCalibrationAccess="ReadWrite", StorageClass="ExportedGlobal", DataType="single", Min=0, Max=69.44)
P_AEB_Func_cycPrefillVyAbsMaxThres4Fusion = AUTOSAR4.Parameter(8.33, SwCalibrationAccess="ReadWrite", StorageClass="ExportedGlobal", DataType="single", Min=0, Max=10)
P_AEB_Func_cycPrefillVyAbsMaxThres4Radar = AUTOSAR4.Parameter(8.33, SwCalibrationAccess="ReadWrite", StorageClass="ExportedGlobal", DataType="single", Min=0, Max=10)
P_AEB_Func_cycPrefillVyAbsMinThres4Fusion = AUTOSAR4.Parameter(2.5, SwCalibrationAccess="ReadWrite", StorageClass="ExportedGlobal", DataType="single", Min=0, Max=10)
P_AEB_Func_cycPrefillVyAbsMinThres4Radar = AUTOSAR4.Parameter(2.5, SwCalibrationAccess="ReadWrite", StorageClass="ExportedGlobal", DataType="single", Min=0, Max=10)
P_AEB_Func_pedABAAccrCondAborDelayTime = AUTOSAR4.Parameter(1.5, SwCalibrationAccess="ReadWrite", StorageClass="ExportedGlobal", DataType="single", Min=0, Max=5)
P_AEB_Func_pedABAColliisonRiskProbSupThres4Fusion = AUTOSAR4.Parameter(0.5, SwCalibrationAccess="ReadWrite", StorageClass="ExportedGlobal", DataType="single", Min=0, Max=0.99)
P_AEB_Func_pedABAColliisonRiskProbSupThres4Radar = AUTOSAR4.Parameter(0.5, SwCalibrationAccess="ReadWrite", StorageClass="ExportedGlobal", DataType="single", Min=0, Max=0.99)
P_AEB_Func_pedABAGasPedalSupThres = AUTOSAR4.Parameter(85, SwCalibrationAccess="ReadWrite", StorageClass="ExportedGlobal", DataType="single", Min=0, Max=100)
P_AEB_Func_pedABALongDistTimeOffsetHmiEarlyMid = AUTOSAR4.Parameter(1.9, SwCalibrationAccess="ReadWrite", StorageClass="ExportedGlobal", DataType="single", Min=0, Max=5)
P_AEB_Func_pedABALongDistTimeOffsetHmiLate = AUTOSAR4.Parameter(1.5, SwCalibrationAccess="ReadWrite", StorageClass="ExportedGlobal", DataType="single", Min=0, Max=5)
P_AEB_Func_pedABAMaxActivationTimeAborThres = AUTOSAR4.Parameter(0.3, SwCalibrationAccess="ReadWrite", StorageClass="ExportedGlobal", DataType="single", Min=0, Max=8)
P_AEB_Func_pedABAStrCondAborDelayTime = AUTOSAR4.Parameter(1.5, SwCalibrationAccess="ReadWrite", StorageClass="ExportedGlobal", DataType="single", Min=0, Max=5)
P_AEB_Func_pedABAStrWheelAngleAborThres = AUTOSAR4.Parameter(1.57, SwCalibrationAccess="ReadWrite", StorageClass="ExportedGlobal", DataType="single", Min=0, Max=15)
P_AEB_Func_pedABAStrWheelAngleSpdAborThres = AUTOSAR4.Parameter(1.75, SwCalibrationAccess="ReadWrite", StorageClass="ExportedGlobal", DataType="single", Min=0, Max=6.28)
P_AEB_Func_pedABAStrWheelAngleSpdSupThres = AUTOSAR4.Parameter(1.75, SwCalibrationAccess="ReadWrite", StorageClass="ExportedGlobal", DataType="single", Min=0, Max=6.28)
P_AEB_Func_pedABAStrWheelAngleSupThres = AUTOSAR4.Parameter(1.57, SwCalibrationAccess="ReadWrite", StorageClass="ExportedGlobal", DataType="single", Min=0, Max=15)
P_AEB_Func_pedABASubjCurvTrajSupThres = AUTOSAR4.Parameter(0.009, SwCalibrationAccess="ReadWrite", StorageClass="ExportedGlobal", DataType="single", Min=0, Max=0.1)
P_AEB_Func_pedABASubjLatAccelSupThres = AUTOSAR4.Parameter(0.3, SwCalibrationAccess="ReadWrite", StorageClass="ExportedGlobal", DataType="single", Min=-5, Max=5)
P_AEB_Func_pedABASubjVelMax = AUTOSAR4.Parameter(17.78, SwCalibrationAccess="ReadWrite", StorageClass="ExportedGlobal", DataType="single", Min=10, Max=25)
P_AEB_Func_pedABASubjVelMin = AUTOSAR4.Parameter(8.33, SwCalibrationAccess="ReadWrite", StorageClass="ExportedGlobal", DataType="single", Min=0, Max=69.44)
P_AEB_Func_pedAEBfulColliisonRiskProbAborThresObjID = AUTOSAR4.Parameter(0.4, SwCalibrationAccess="ReadWrite", StorageClass="ExportedGlobal", DataType="single", Min=0, Max=0.99)
P_AEB_Func_pedAEBfullAbsDyAborThres = AUTOSAR4.Parameter(1.2, SwCalibrationAccess="ReadWrite", StorageClass="ExportedGlobal", DataType="single", Min=0, Max=5)
P_AEB_Func_pedAEBfullAbsVyAborThres = AUTOSAR4.Parameter(0.5, SwCalibrationAccess="ReadWrite", StorageClass="ExportedGlobal", DataType="single", Min=0, Max=3)
P_AEB_Func_pedAEBfullActivationTimeAborThres = AUTOSAR4.Parameter(1.6, SwCalibrationAccess="ReadWrite", StorageClass="ExportedGlobal", DataType="single", Min=0, Max=5)
P_AEB_Func_pedAEBfullActivationTimeAborThresStandstill = AUTOSAR4.Parameter(3.5, SwCalibrationAccess="ReadWrite", StorageClass="ExportedGlobal", DataType="single", Min=1, Max=8)
P_AEB_Func_pedAEBfullColliisonRiskProbAborThres = AUTOSAR4.Parameter(0.25, SwCalibrationAccess="ReadWrite", StorageClass="ExportedGlobal", DataType="single", Min=0, Max=0.99)
P_AEB_Func_pedAEBfullColliisonRiskProbSupThres4Fusion = AUTOSAR4.Parameter(0.4, SwCalibrationAccess="ReadWrite", StorageClass="ExportedGlobal", DataType="single", Min=0, Max=0.99)
P_AEB_Func_pedAEBfullColliisonRiskProbSupThres4Radar = AUTOSAR4.Parameter(0.4, SwCalibrationAccess="ReadWrite", StorageClass="ExportedGlobal", DataType="single", Min=0, Max=0.99)
P_AEB_Func_pedAEBfullDyInnerAreaThres = AUTOSAR4.Parameter(0.45, SwCalibrationAccess="ReadWrite", StorageClass="ExportedGlobal", DataType="single", Min=0, Max=3)
P_AEB_Func_pedAEBfullDyLatBoundHmiLateY = AUTOSAR4.Parameter([1.5; 2; 3.15; 3.2; 3.7], SwCalibrationAccess="ReadWrite", StorageClass="ExportedGlobal", DataType="single", Min=0, Max=5)
P_AEB_Func_pedAEBfullDyMiddleAreaThres = AUTOSAR4.Parameter(2.05, SwCalibrationAccess="ReadWrite", StorageClass="ExportedGlobal", DataType="single", Min=0, Max=3)
P_AEB_Func_pedAEBfullGasPedalSupThres = AUTOSAR4.Parameter(85, SwCalibrationAccess="ReadWrite", StorageClass="ExportedGlobal", DataType="single", Min=0, Max=100)
P_AEB_Func_pedAEBfullLongDistTimeOffset = AUTOSAR4.Parameter(0.17, SwCalibrationAccess="ReadWrite", StorageClass="ExportedGlobal", DataType="single", Min=0, Max=5)
P_AEB_Func_pedAEBfullMasterCylindBrkPressSupThres = AUTOSAR4.Parameter(200, SwCalibrationAccess="ReadWrite", StorageClass="ExportedGlobal", DataType="single", Min=0, Max=300)
P_AEB_Func_pedAEBfullObjVyAbsLatBoundHmiLateX = AUTOSAR4.Parameter([2.8; 5.6; 11.4; 11.5; 14], SwCalibrationAccess="ReadWrite", StorageClass="ExportedGlobal", DataType="single", Min=0, Max=30)
P_AEB_Func_pedAEBfullStrCondAborDelayTime = AUTOSAR4.Parameter(1.5, SwCalibrationAccess="ReadWrite", StorageClass="ExportedGlobal", DataType="single", Min=0, Max=5)
P_AEB_Func_pedAEBfullStrWheelAngleAborThres = AUTOSAR4.Parameter(1.57, SwCalibrationAccess="ReadWrite", StorageClass="ExportedGlobal", DataType="single", Min=0, Max=15)
P_AEB_Func_pedAEBfullStrWheelAngleAborThresStandstill = AUTOSAR4.Parameter(1.57, SwCalibrationAccess="ReadWrite", StorageClass="ExportedGlobal", DataType="single", Min=0, Max=15)
P_AEB_Func_pedAEBfullStrWheelAngleSpdAborThres = AUTOSAR4.Parameter(1.75, SwCalibrationAccess="ReadWrite", StorageClass="ExportedGlobal", DataType="single", Min=0, Max=6.28)
P_AEB_Func_pedAEBfullStrWheelAngleSpdAborThresStandstill = AUTOSAR4.Parameter(1.75, SwCalibrationAccess="ReadWrite", StorageClass="ExportedGlobal", DataType="single", Min=0, Max=6.28)
P_AEB_Func_pedAEBfullStrWheelAngleSpdSupThres = AUTOSAR4.Parameter(1.75, SwCalibrationAccess="ReadWrite", StorageClass="ExportedGlobal", DataType="single", Min=0, Max=6.28)
P_AEB_Func_pedAEBfullStrWheelAngleSupThres = AUTOSAR4.Parameter(1.57, SwCalibrationAccess="ReadWrite", StorageClass="ExportedGlobal", DataType="single", Min=0, Max=15)
P_AEB_Func_pedAEBfullSubjCurvTrajSupThres = AUTOSAR4.Parameter(0.009, SwCalibrationAccess="ReadWrite", StorageClass="ExportedGlobal", DataType="single", Min=0, Max=0.1)
P_AEB_Func_pedAEBfullSubjLatAccelSupThres = AUTOSAR4.Parameter(0.3, SwCalibrationAccess="ReadWrite", StorageClass="ExportedGlobal", DataType="single", Min=-5, Max=5)
P_AEB_Func_pedAEBfullSubjVelAborThresStandstill = AUTOSAR4.Parameter(1.5, SwCalibrationAccess="ReadWrite", StorageClass="ExportedGlobal", DataType="single", Min=0, Max=2)
P_AEB_Func_pedAEBfullSubjVelLatBoundHmiEarlyMidX = AUTOSAR4.Parameter([2.8; 5.6; 11.4; 11.5; 14], SwCalibrationAccess="ReadWrite", StorageClass="ExportedGlobal", DataType="single", Min=0, Max=30)
P_AEB_Func_pedAEBfullSubjVelMax = AUTOSAR4.Parameter(17.78, SwCalibrationAccess="ReadWrite", StorageClass="ExportedGlobal", DataType="single", Min=10, Max=25)
P_AEB_Func_pedAEBfullSubjVelMin = AUTOSAR4.Parameter(1.1, SwCalibrationAccess="ReadWrite", StorageClass="ExportedGlobal", DataType="single", Min=0, Max=69.44)
P_AEB_Func_pedAEBfullVehVelReduceAborThres = AUTOSAR4.Parameter(8.89, SwCalibrationAccess="ReadWrite", StorageClass="ExportedGlobal", DataType="single", Min=0, Max=22)
P_AEB_Func_pedAEBfullVyInnerAreaThres4Fusion = AUTOSAR4.Parameter(0.5, SwCalibrationAccess="ReadWrite", StorageClass="ExportedGlobal", DataType="single", Min=-3, Max=3)
P_AEB_Func_pedAEBfullVyInnerAreaThres4Radar = AUTOSAR4.Parameter(0.3, SwCalibrationAccess="ReadWrite", StorageClass="ExportedGlobal", DataType="single", Min=-3, Max=3)
P_AEB_Func_pedAEBfullVyMaxThres = AUTOSAR4.Parameter(2.78, SwCalibrationAccess="ReadWrite", StorageClass="ExportedGlobal", DataType="single", Min=0, Max=10)
P_AEB_Func_pedAEBfullVyMiddleAreaThres4Fusion = AUTOSAR4.Parameter(0.95, SwCalibrationAccess="ReadWrite", StorageClass="ExportedGlobal", DataType="single", Min=-3, Max=3)
P_AEB_Func_pedAEBfullVyMiddleAreaThres4Radar = AUTOSAR4.Parameter(0.45, SwCalibrationAccess="ReadWrite", StorageClass="ExportedGlobal", DataType="single", Min=-3, Max=3)
P_AEB_Func_pedAEBfullVyOuterAreaThres4Fusion = AUTOSAR4.Parameter(1.8, SwCalibrationAccess="ReadWrite", StorageClass="ExportedGlobal", DataType="single", Min=-3, Max=3)
P_AEB_Func_pedAEBfullVyOuterAreaThres4Radar = AUTOSAR4.Parameter(0.6, SwCalibrationAccess="ReadWrite", StorageClass="ExportedGlobal", DataType="single", Min=-3, Max=3)
P_AEB_Func_pedPrefillAccrCondAborDelayTime = AUTOSAR4.Parameter(1.5, SwCalibrationAccess="ReadWrite", StorageClass="ExportedGlobal", DataType="single", Min=0, Max=5)
P_AEB_Func_pedPrefillColliisonRiskProbSupThres4Fusion = AUTOSAR4.Parameter(0.4, SwCalibrationAccess="ReadWrite", StorageClass="ExportedGlobal", DataType="single", Min=0, Max=0.99)
P_AEB_Func_pedPrefillColliisonRiskProbSupThres4Radar = AUTOSAR4.Parameter(0.4, SwCalibrationAccess="ReadWrite", StorageClass="ExportedGlobal", DataType="single", Min=0, Max=0.99)
P_AEB_Func_pedPrefillDyInnerAreaThres = AUTOSAR4.Parameter(0.45, SwCalibrationAccess="ReadWrite", StorageClass="ExportedGlobal", DataType="single", Min=0, Max=3)
P_AEB_Func_pedPrefillDyMiddleAreaThres = AUTOSAR4.Parameter(2.05, SwCalibrationAccess="ReadWrite", StorageClass="ExportedGlobal", DataType="single", Min=0, Max=3)
P_AEB_Func_pedPrefillGasPedalSupThres = AUTOSAR4.Parameter(85, SwCalibrationAccess="ReadWrite", StorageClass="ExportedGlobal", DataType="single", Min=0, Max=100)
P_AEB_Func_pedPrefillLongDistTimeOffset = AUTOSAR4.Parameter(0.6, SwCalibrationAccess="ReadWrite", StorageClass="ExportedGlobal", DataType="single", Min=0, Max=5)
P_AEB_Func_pedPrefillMasterCylindBrkPressSupThres = AUTOSAR4.Parameter(200, SwCalibrationAccess="ReadWrite", StorageClass="ExportedGlobal", DataType="single", Min=0, Max=300)
P_AEB_Func_pedPrefillMaxActivationTimeAborThres = AUTOSAR4.Parameter(1.95, SwCalibrationAccess="ReadWrite", StorageClass="ExportedGlobal", DataType="single", Min=1, Max=8)
P_AEB_Func_pedPrefillMinActivationTimeAborThres = AUTOSAR4.Parameter(0.6, SwCalibrationAccess="ReadWrite", StorageClass="ExportedGlobal", DataType="single", Min=0, Max=5)
P_AEB_Func_pedPrefillStrCondAborDelayTime = AUTOSAR4.Parameter(1.5, SwCalibrationAccess="ReadWrite", StorageClass="ExportedGlobal", DataType="single", Min=0, Max=5)
P_AEB_Func_pedPrefillStrWheelAngleAborThres = AUTOSAR4.Parameter(1.57, SwCalibrationAccess="ReadWrite", StorageClass="ExportedGlobal", DataType="single", Min=0, Max=15)
P_AEB_Func_pedPrefillStrWheelAngleSpdAborThres = AUTOSAR4.Parameter(1.75, SwCalibrationAccess="ReadWrite", StorageClass="ExportedGlobal", DataType="single", Min=0, Max=6.28)
P_AEB_Func_pedPrefillStrWheelAngleSpdSupThres = AUTOSAR4.Parameter(1.75, SwCalibrationAccess="ReadWrite", StorageClass="ExportedGlobal", DataType="single", Min=0, Max=6.28)
P_AEB_Func_pedPrefillStrWheelAngleSupThres = AUTOSAR4.Parameter(1.57, SwCalibrationAccess="ReadWrite", StorageClass="ExportedGlobal", DataType="single", Min=0, Max=15)
P_AEB_Func_pedPrefillSubjCurvTrajSupThres = AUTOSAR4.Parameter(0.009, SwCalibrationAccess="ReadWrite", StorageClass="ExportedGlobal", DataType="single", Min=0, Max=0.1)
P_AEB_Func_pedPrefillSubjLatAccelSupThres = AUTOSAR4.Parameter(0.3, SwCalibrationAccess="ReadWrite", StorageClass="ExportedGlobal", DataType="single", Min=-5, Max=5)
P_AEB_Func_pedPrefillSubjVelMax = AUTOSAR4.Parameter(17.78, SwCalibrationAccess="ReadWrite", StorageClass="ExportedGlobal", DataType="single", Min=10, Max=25)
P_AEB_Func_pedPrefillSubjVelMin = AUTOSAR4.Parameter(1.1, SwCalibrationAccess="ReadWrite", StorageClass="ExportedGlobal", DataType="single", Min=0, Max=69.44)
P_AEB_Func_pedPrefillVyInnerAreaThres4Fusion = AUTOSAR4.Parameter(0.3, SwCalibrationAccess="ReadWrite", StorageClass="ExportedGlobal", DataType="single", Min=-3, Max=3)
P_AEB_Func_pedPrefillVyInnerAreaThres4Radar = AUTOSAR4.Parameter(0.3, SwCalibrationAccess="ReadWrite", StorageClass="ExportedGlobal", DataType="single", Min=-3, Max=3)
P_AEB_Func_pedPrefillVyMaxThres = AUTOSAR4.Parameter(2.78, SwCalibrationAccess="ReadWrite", StorageClass="ExportedGlobal", DataType="single", Min=0, Max=10)
P_AEB_Func_pedPrefillVyMiddleAreaThres4Fusion = AUTOSAR4.Parameter(0.3, SwCalibrationAccess="ReadWrite", StorageClass="ExportedGlobal", DataType="single", Min=-3, Max=3)

P_AEB_Func_pedPrefillVyMiddleAreaThres4Radar = AUTOSAR4.Parameter(0.3, SwCalibrationAccess="ReadWrite", StorageClass="ExportedGlobal", DataType="single", Min=-3, Max=3)
P_AEB_Func_pedPrefillVyOuterAreaThres4Fusion = AUTOSAR4.Parameter(0.6, SwCalibrationAccess="ReadWrite", StorageClass="ExportedGlobal", DataType="single", Min=-3, Max=3)
P_AEB_Func_pedPrefillVyOuterAreaThres4Radar = AUTOSAR4.Parameter(0.6, SwCalibrationAccess="ReadWrite", StorageClass="ExportedGlobal", DataType="single", Min=-3, Max=3)
P_AEB_Func_pedPrewarningAccrCondAborDelayTime = AUTOSAR4.Parameter(1.5, SwCalibrationAccess="ReadWrite", StorageClass="ExportedGlobal", DataType="single", Min=0, Max=5)
P_AEB_Func_pedPrewarningColliisonRiskProbSupThres4Fusion = AUTOSAR4.Parameter(0.5, SwCalibrationAccess="ReadWrite", StorageClass="ExportedGlobal", DataType="single", Min=0, Max=0.99)
P_AEB_Func_pedPrewarningColliisonRiskProbSupThres4Radar = AUTOSAR4.Parameter(0.5, SwCalibrationAccess="ReadWrite", StorageClass="ExportedGlobal", DataType="single", Min=0, Max=0.99)
P_AEB_Func_pedPrewarningGasPedalSupThres = AUTOSAR4.Parameter(85, SwCalibrationAccess="ReadWrite", StorageClass="ExportedGlobal", DataType="single", Min=0, Max=100)
P_AEB_Func_pedPrewarningLongDistTimeOffsetHmiEarlyMid = AUTOSAR4.Parameter(1.9, SwCalibrationAccess="ReadWrite", StorageClass="ExportedGlobal", DataType="single", Min=0, Max=5)
P_AEB_Func_pedPrewarningLongDistTimeOffsetHmiLate = AUTOSAR4.Parameter(1.5, SwCalibrationAccess="ReadWrite", StorageClass="ExportedGlobal", DataType="single", Min=0, Max=3)
P_AEB_Func_pedPrewarningMaxActivationTimeAborThres = AUTOSAR4.Parameter(2, SwCalibrationAccess="ReadWrite", StorageClass="ExportedGlobal", DataType="single", Min=1, Max=8)
P_AEB_Func_pedPrewarningMinActivationTimeAborThres = AUTOSAR4.Parameter(0.6, SwCalibrationAccess="ReadWrite", StorageClass="ExportedGlobal", DataType="single", Min=0, Max=5)
P_AEB_Func_pedPrewarningMinActivationTimeAborThresObjID = AUTOSAR4.Parameter(0.6, SwCalibrationAccess="ReadWrite", StorageClass="ExportedGlobal", DataType="single", Min=0, Max=5)
P_AEB_Func_pedPrewarningMinActivationTimeAborThresSeverity = AUTOSAR4.Parameter(0.6, SwCalibrationAccess="ReadWrite", StorageClass="ExportedGlobal", DataType="single", Min=0, Max=5)
P_AEB_Func_pedPrewarningMinActivationTimeAborThresVSC = AUTOSAR4.Parameter(0.6, SwCalibrationAccess="ReadWrite", StorageClass="ExportedGlobal", DataType="single", Min=0, Max=5)
P_AEB_Func_pedPrewarningStrCondAborDelayTime = AUTOSAR4.Parameter(1.5, SwCalibrationAccess="ReadWrite", StorageClass="ExportedGlobal", DataType="single", Min=0, Max=5)
P_AEB_Func_pedPrewarningStrWheelAngleSpdSupThres = AUTOSAR4.Parameter(1.75, SwCalibrationAccess="ReadWrite", StorageClass="ExportedGlobal", DataType="single", Min=0, Max=6.28)
P_AEB_Func_pedPrewarningStrWheelAngleSupThres = AUTOSAR4.Parameter(1.57, SwCalibrationAccess="ReadWrite", StorageClass="ExportedGlobal", DataType="single", Min=0, Max=15)
P_AEB_Func_pedPrewarningSubjCurvTrajSupThres = AUTOSAR4.Parameter(0.009, SwCalibrationAccess="ReadWrite", StorageClass="ExportedGlobal", DataType="single", Min=0, Max=0.1)
P_AEB_Func_pedPrewarningSubjLatAccelSupThres = AUTOSAR4.Parameter(0.3, SwCalibrationAccess="ReadWrite", StorageClass="ExportedGlobal", DataType="single", Min=-5, Max=5)
P_AEB_Func_pedPrewarningSubjVelMax = AUTOSAR4.Parameter(17.78, SwCalibrationAccess="ReadWrite", StorageClass="ExportedGlobal", DataType="single", Min=10, Max=25)
P_AEB_Func_pedPrewarningSubjVelMin = AUTOSAR4.Parameter(1.1, SwCalibrationAccess="ReadWrite", StorageClass="ExportedGlobal", DataType="single", Min=0, Max=69.44)
P_AEB_Func_vehABAAccrCondAborDelayTime = AUTOSAR4.Parameter(1.5, SwCalibrationAccess="ReadWrite", StorageClass="ExportedGlobal", DataType="single", Min=0, Max=5)
P_AEB_Func_vehABAEscapeActivationThres = AUTOSAR4.Parameter(0.65, SwCalibrationAccess="ReadWrite", StorageClass="ExportedGlobal", DataType="single", Min=0, Max=1)
P_AEB_Func_vehABAGasPedalAborThres = AUTOSAR4.Parameter(85, SwCalibrationAccess="ReadWrite", StorageClass="ExportedGlobal", DataType="single", Min=0, Max=100)
P_AEB_Func_vehABAGasPedalActivationThres = AUTOSAR4.Parameter(85, SwCalibrationAccess="ReadWrite", StorageClass="ExportedGlobal", DataType="single", Min=0, Max=100)
P_AEB_Func_vehABAObjObstacleProbActivationThres = AUTOSAR4.Parameter(0.7, SwCalibrationAccess="ReadWrite", StorageClass="ExportedGlobal", DataType="single", Min=0, Max=1)
P_AEB_Func_vehABAOverlapActivationThresX = AUTOSAR4.Parameter([0; 5; 20; 35; 100], SwCalibrationAccess="ReadWrite", StorageClass="ExportedGlobal", DataType="single", Min=0, Max=210)
P_AEB_Func_vehABAOverlapActivationThresY = AUTOSAR4.Parameter([0.4; 0.4; 0.3; 0.3; 0.28], SwCalibrationAccess="ReadWrite", StorageClass="ExportedGlobal", DataType="single", Min=0, Max=1)
P_AEB_Func_vehABAStrCondAborDelayTime = AUTOSAR4.Parameter(1.5, SwCalibrationAccess="ReadWrite", StorageClass="ExportedGlobal", DataType="single", Min=0, Max=5)
P_AEB_Func_vehABAStrWheelAngleAborThres = AUTOSAR4.Parameter(1.6, SwCalibrationAccess="ReadWrite", StorageClass="ExportedGlobal", DataType="single", Min=0, Max=15)
P_AEB_Func_vehABAStrWheelAngleActivationThres = AUTOSAR4.Parameter(1.6, SwCalibrationAccess="ReadWrite", StorageClass="ExportedGlobal", DataType="single", Min=0, Max=10)
P_AEB_Func_vehABAStrWheelAngleSpdAborThres = AUTOSAR4.Parameter(1.75, SwCalibrationAccess="ReadWrite", StorageClass="ExportedGlobal", DataType="single", Min=0, Max=10)
P_AEB_Func_vehABAStrWheelAngleSpdActivationThres = AUTOSAR4.Parameter(1.75, SwCalibrationAccess="ReadWrite", StorageClass="ExportedGlobal", DataType="single", Min=0, Max=15)
P_AEB_Func_vehABASubjCurvTrajActivationThresForPedCyc = AUTOSAR4.Parameter(0.009, SwCalibrationAccess="ReadWrite", StorageClass="ExportedGlobal", DataType="single", Min=0, Max=0.1)
P_AEB_Func_vehABASubjLatAccelActivationThresForPedCyc = AUTOSAR4.Parameter(0.3, SwCalibrationAccess="ReadWrite", StorageClass="ExportedGlobal", DataType="single", Min=0, Max=5)
P_AEB_Func_vehABASubjVelActivationThresForPedCyc = AUTOSAR4.Parameter(25, SwCalibrationAccess="ReadWrite", StorageClass="ExportedGlobal", DataType="single", Min=0, Max=30)
P_AEB_Func_vehABASubjVelMaxMO = AUTOSAR4.Parameter(42, SwCalibrationAccess="ReadWrite", StorageClass="ExportedGlobal", DataType="single", Min=0, Max=69)
P_AEB_Func_vehABASubjVelMaxSO = AUTOSAR4.Parameter(25, SwCalibrationAccess="ReadWrite", StorageClass="ExportedGlobal", DataType="single", Min=0, Max=40)
P_AEB_Func_vehABASubjVelMin = AUTOSAR4.Parameter(8.3, SwCalibrationAccess="ReadWrite", StorageClass="ExportedGlobal", DataType="single", Min=0, Max=30)
P_AEB_Func_vehAEBfullAccrCondAborDelayTime = AUTOSAR4.Parameter(1.5, SwCalibrationAccess="ReadWrite", StorageClass="ExportedGlobal", DataType="single", Min=0, Max=5)
P_AEB_Func_vehAEBfullBrkAccelActivationThresX = AUTOSAR4.Parameter([0; 5; 10; 15; 20; 40; 50; 70], SwCalibrationAccess="ReadWrite", StorageClass="ExportedGlobal", DataType="single", Min=0, Max=70)
P_AEB_Func_vehAEBfullBrkAccelActivationThresY = AUTOSAR4.Parameter([-3; -3; -3; -3.5; -3.5; -3.5; -4.5; -4.5], SwCalibrationAccess="ReadWrite", StorageClass="ExportedGlobal", DataType="single", Min=-8, Max=0)
P_AEB_Func_vehAEBfullDxVarAborThres = AUTOSAR4.Parameter(1.5, SwCalibrationAccess="ReadWrite", StorageClass="ExportedGlobal", DataType="single", Min=0, Max=3)
P_AEB_Func_vehAEBfullFusionOverlapActivationThresX = AUTOSAR4.Parameter([0; 5; 20; 35; 100], SwCalibrationAccess="ReadWrite", StorageClass="ExportedGlobal", DataType="single", Min=0, Max=210)
P_AEB_Func_vehAEBfullGasPedalAborThres = AUTOSAR4.Parameter(85, SwCalibrationAccess="ReadWrite", StorageClass="ExportedGlobal", DataType="single", Min=0, Max=100)
P_AEB_Func_vehAEBfullGasPedalActivationThres = AUTOSAR4.Parameter(85, SwCalibrationAccess="ReadWrite", StorageClass="ExportedGlobal", DataType="single", Min=0, Max=100)
P_AEB_Func_vehAEBfullMasterCylindBrkPressActivationThres = AUTOSAR4.Parameter(3, SwCalibrationAccess="ReadWrite", StorageClass="ExportedGlobal", DataType="single", Min=0, Max=10)
P_AEB_Func_vehAEBfullNoFusionOverlapActivationThresX = AUTOSAR4.Parameter([0; 5; 20; 35; 100], SwCalibrationAccess="ReadWrite", StorageClass="ExportedGlobal", DataType="single", Min=0, Max=210)
P_AEB_Func_vehAEBfullNoFusionSubjVelMaxThresSO = AUTOSAR4.Parameter(13.89, SwCalibrationAccess="ReadWrite", StorageClass="ExportedGlobal", DataType="single", Min=0, Max=40)
P_AEB_Func_vehAEBfullObjHeightThres = AUTOSAR4.Parameter(3, SwCalibrationAccess="ReadWrite", StorageClass="ExportedGlobal", DataType="single", Min=0, Max=5)
P_AEB_Func_vehAEBfullObjObstacleProbAborThres = AUTOSAR4.Parameter(0.68, SwCalibrationAccess="ReadWrite", StorageClass="ExportedGlobal", DataType="single", Min=0, Max=1)
P_AEB_Func_vehAEBfullObjObstacleProbActivationThres = AUTOSAR4.Parameter(0.75, SwCalibrationAccess="ReadWrite", StorageClass="ExportedGlobal", DataType="single", Min=0, Max=1)
P_AEB_Func_vehAEBfullObjStandEscapeAborThres = AUTOSAR4.Parameter(0.85, SwCalibrationAccess="ReadWrite", StorageClass="ExportedGlobal", DataType="single", Min=0, Max=1)
P_AEB_Func_vehAEBfullObjSubjLatAccelActivationThresForPedCyc = AUTOSAR4.Parameter(0.3, SwCalibrationAccess="ReadWrite", StorageClass="ExportedGlobal", DataType="single", Min=0, Max=5)
P_AEB_Func_vehAEBfullOverlapAborThresX = AUTOSAR4.Parameter([0; 5; 20; 35; 100], SwCalibrationAccess="ReadWrite", StorageClass="ExportedGlobal", DataType="single", Min=0, Max=210)
P_AEB_Func_vehAEBfullStrCondAborDelayTime = AUTOSAR4.Parameter(1.5, SwCalibrationAccess="ReadWrite", StorageClass="ExportedGlobal", DataType="single", Min=0, Max=5)
P_AEB_Func_vehAEBfullStrWheelAngleAborThres = AUTOSAR4.Parameter(1.6, SwCalibrationAccess="ReadWrite", StorageClass="ExportedGlobal", DataType="single", Min=0, Max=15)
P_AEB_Func_vehAEBfullStrWheelAngleActivationThres = AUTOSAR4.Parameter(1.6, SwCalibrationAccess="ReadWrite", StorageClass="ExportedGlobal", DataType="single", Min=0, Max=10)
P_AEB_Func_vehAEBfullStrWheelAngleSpdAborThres = AUTOSAR4.Parameter(1.75, SwCalibrationAccess="ReadWrite", StorageClass="ExportedGlobal", DataType="single", Min=0, Max=10)
P_AEB_Func_vehAEBfullStrWheelAngleSpdActivationThres = AUTOSAR4.Parameter(1.75, SwCalibrationAccess="ReadWrite", StorageClass="ExportedGlobal", DataType="single", Min=0, Max=15)
P_AEB_Func_vehAEBfullSubjCurvTrajActivationThres = AUTOSAR4.Parameter(0.02, SwCalibrationAccess="ReadWrite", StorageClass="ExportedGlobal", DataType="single", Min=0, Max=1)
P_AEB_Func_vehAEBfullSubjCurvTrajActivationThresForPedCyc = AUTOSAR4.Parameter(0.009, SwCalibrationAccess="ReadWrite", StorageClass="ExportedGlobal", DataType="single", Min=0, Max=0.1)
P_AEB_Func_vehAEBfullSubjVelActivationThresForPedCyc = AUTOSAR4.Parameter(18, SwCalibrationAccess="ReadWrite", StorageClass="ExportedGlobal", DataType="single", Min=0, Max=30)
P_AEB_Func_vehAEBfullSubjVelMinThres = AUTOSAR4.Parameter(1.1, SwCalibrationAccess="ReadWrite", StorageClass="ExportedGlobal", DataType="single", Min=0, Max=30)
P_AEB_Func_vehAEBfullSubjWorkVelMaxThresMO = AUTOSAR4.Parameter(25, SwCalibrationAccess="ReadWrite", StorageClass="ExportedGlobal", DataType="single", Min=0, Max=69)
P_AEB_Func_vehAEBpartAccrCondAborDelayTime = AUTOSAR4.Parameter(1.5, SwCalibrationAccess="ReadWrite", StorageClass="ExportedGlobal", DataType="single", Min=0, Max=5)
P_AEB_Func_vehAEBpartDxActivationThres = AUTOSAR4.Parameter(70, SwCalibrationAccess="ReadWrite", StorageClass="ExportedGlobal", DataType="single", Min=0, Max=210)
P_AEB_Func_vehAEBpartEscapeAborThres = AUTOSAR4.Parameter(0.85, SwCalibrationAccess="ReadWrite", StorageClass="ExportedGlobal", DataType="single", Min=0, Max=1)
P_AEB_Func_vehAEBpartEscapeActivationThres = AUTOSAR4.Parameter(0.65, SwCalibrationAccess="ReadWrite", StorageClass="ExportedGlobal", DataType="single", Min=0, Max=1)
P_AEB_Func_vehAEBpartFusionOverlapActivationThresX = AUTOSAR4.Parameter([0; 5; 20; 35; 100], SwCalibrationAccess="ReadWrite", StorageClass="ExportedGlobal", DataType="single", Min=0, Max=210)
P_AEB_Func_vehAEBpartGasPedalAborThres = AUTOSAR4.Parameter(85, SwCalibrationAccess="ReadWrite", StorageClass="ExportedGlobal", DataType="single", Min=0, Max=100)
P_AEB_Func_vehAEBpartGasPedalActivationThres = AUTOSAR4.Parameter(85, SwCalibrationAccess="ReadWrite", StorageClass="ExportedGlobal", DataType="single", Min=0, Max=100)
P_AEB_Func_vehAEBpartMasterCylindBrkPressActivationThres = AUTOSAR4.Parameter(3, SwCalibrationAccess="ReadWrite", StorageClass="ExportedGlobal", DataType="single", Min=0, Max=10)
P_AEB_Func_vehAEBpartNoFusionOverlapActivationThresX = AUTOSAR4.Parameter([0; 5; 20; 35; 100], SwCalibrationAccess="ReadWrite", StorageClass="ExportedGlobal", DataType="single", Min=0, Max=210)
P_AEB_Func_vehAEBpartObjObstacleProbAborThres = AUTOSAR4.Parameter(0.65, SwCalibrationAccess="ReadWrite", StorageClass="ExportedGlobal", DataType="single", Min=0, Max=1)
P_AEB_Func_vehAEBpartObjObstacleProbActivationThres = AUTOSAR4.Parameter(0.7, SwCalibrationAccess="ReadWrite", StorageClass="ExportedGlobal", DataType="single", Min=0, Max=1)
P_AEB_Func_vehAEBpartOverlapAborThresX = AUTOSAR4.Parameter([0; 5; 20; 35; 100], SwCalibrationAccess="ReadWrite", StorageClass="ExportedGlobal", DataType="single", Min=0, Max=210)
P_AEB_Func_vehAEBpartStrCondAborDelayTime = AUTOSAR4.Parameter(1.5, SwCalibrationAccess="ReadWrite", StorageClass="ExportedGlobal", DataType="single", Min=0, Max=5)
P_AEB_Func_vehAEBpartStrWheelAngleAborThres = AUTOSAR4.Parameter(1.75, SwCalibrationAccess="ReadWrite", StorageClass="ExportedGlobal", DataType="single", Min=0, Max=15)
P_AEB_Func_vehAEBpartStrWheelAngleActivationThres = AUTOSAR4.Parameter(1.6, SwCalibrationAccess="ReadWrite", StorageClass="ExportedGlobal", DataType="single", Min=0, Max=10)
P_AEB_Func_vehAEBpartStrWheelAngleSpdAborThres = AUTOSAR4.Parameter(1.6, SwCalibrationAccess="ReadWrite", StorageClass="ExportedGlobal", DataType="single", Min=0, Max=10)
P_AEB_Func_vehAEBpartStrWheelAngleSpdActivationThres = AUTOSAR4.Parameter(1.75, SwCalibrationAccess="ReadWrite", StorageClass="ExportedGlobal", DataType="single", Min=0, Max=15)
P_AEB_Func_vehAEBpartSubjCurvTrajActivationThres = AUTOSAR4.Parameter(0.02, SwCalibrationAccess="ReadWrite", StorageClass="ExportedGlobal", DataType="single", Min=0, Max=1)
P_AEB_Func_vehAEBpartSubjCurvTrajActivationThresForPedCyc = AUTOSAR4.Parameter(0.009, SwCalibrationAccess="ReadWrite", StorageClass="ExportedGlobal", DataType="single", Min=0, Max=0.1)
P_AEB_Func_vehAEBpartSubjLatAccelActivationThresForPedCyc = AUTOSAR4.Parameter(0.3, SwCalibrationAccess="ReadWrite", StorageClass="ExportedGlobal", DataType="single", Min=0, Max=5)
P_AEB_Func_vehAEBpartSubjVelActivationThresForPedCyc = AUTOSAR4.Parameter(25, SwCalibrationAccess="ReadWrite", StorageClass="ExportedGlobal", DataType="single", Min=0, Max=30)
P_AEB_Func_vehAEBpartSubjVelMaxActivationThres = AUTOSAR4.Parameter(42, SwCalibrationAccess="ReadWrite", StorageClass="ExportedGlobal", DataType="single", Min=0, Max=69)
P_AEB_Func_vehAcuteWarningAccrCondAborDelayTime = AUTOSAR4.Parameter(1.5, SwCalibrationAccess="ReadWrite", StorageClass="ExportedGlobal", DataType="single", Min=0, Max=5)
P_AEB_Func_vehAcuteWarningDxActivationThres = AUTOSAR4.Parameter(65, SwCalibrationAccess="ReadWrite", StorageClass="ExportedGlobal", DataType="single", Min=0, Max=210)
P_AEB_Func_vehAcuteWarningEscapeAborThres = AUTOSAR4.Parameter(0.85, SwCalibrationAccess="ReadWrite", StorageClass="ExportedGlobal", DataType="single", Min=0, Max=1)
P_AEB_Func_vehAcuteWarningEscapeActivationThres = AUTOSAR4.Parameter(0.65, SwCalibrationAccess="ReadWrite", StorageClass="ExportedGlobal", DataType="single", Min=0, Max=1)
P_AEB_Func_vehAcuteWarningGasPedalAborThres = AUTOSAR4.Parameter(85, SwCalibrationAccess="ReadWrite", StorageClass="ExportedGlobal", DataType="single", Min=0, Max=100)
P_AEB_Func_vehAcuteWarningGasPedalActivationThres = AUTOSAR4.Parameter(85, SwCalibrationAccess="ReadWrite", StorageClass="ExportedGlobal", DataType="single", Min=0, Max=100)
P_AEB_Func_vehAcuteWarningMasterCylindBrkPressActivationThres = AUTOSAR4.Parameter(3, SwCalibrationAccess="ReadWrite", StorageClass="ExportedGlobal", DataType="single", Min=0, Max=10)
P_AEB_Func_vehAcuteWarningObjHeightActivationThres = AUTOSAR4.Parameter(3, SwCalibrationAccess="ReadWrite", StorageClass="ExportedGlobal", DataType="single", Min=0, Max=5)
P_AEB_Func_vehAcuteWarningObjObstacleProbActivationThres = AUTOSAR4.Parameter(0.7, SwCalibrationAccess="ReadWrite", StorageClass="ExportedGlobal", DataType="single", Min=0, Max=1)
P_AEB_Func_vehAcuteWarningOverlapAborThresX = AUTOSAR4.Parameter([0; 5; 20; 35; 100], SwCalibrationAccess="ReadWrite", StorageClass="ExportedGlobal", DataType="single", Min=0, Max=210)
P_AEB_Func_vehAcuteWarningOverlapAborThresY = AUTOSAR4.Parameter([0.3; 0.3; 0.28; 0.25; 0.25], SwCalibrationAccess="ReadWrite", StorageClass="ExportedGlobal", DataType="single", Min=0, Max=1)
P_AEB_Func_vehAcuteWarningOverlapActivationThresX = AUTOSAR4.Parameter([0; 5; 20; 35; 100], SwCalibrationAccess="ReadWrite", StorageClass="ExportedGlobal", DataType="single", Min=0, Max=210)
P_AEB_Func_vehAcuteWarningStrCondAborDelayTime = AUTOSAR4.Parameter(1.5, SwCalibrationAccess="ReadWrite", StorageClass="ExportedGlobal", DataType="single", Min=0, Max=5)
P_AEB_Func_vehAcuteWarningStrWheelAngleAborThres = AUTOSAR4.Parameter(1.6, SwCalibrationAccess="ReadWrite", StorageClass="ExportedGlobal", DataType="single", Min=0, Max=15)
P_AEB_Func_vehAcuteWarningStrWheelAngleActivationThres = AUTOSAR4.Parameter(1.6, SwCalibrationAccess="ReadWrite", StorageClass="ExportedGlobal", DataType="single", Min=0, Max=10)
P_AEB_Func_vehAcuteWarningStrWheelAngleSpdAborThres = AUTOSAR4.Parameter(1.75, SwCalibrationAccess="ReadWrite", StorageClass="ExportedGlobal", DataType="single", Min=0, Max=10)
P_AEB_Func_vehAcuteWarningStrWheelAngleSpdActivationThres = AUTOSAR4.Parameter(1.75, SwCalibrationAccess="ReadWrite", StorageClass="ExportedGlobal", DataType="single", Min=0, Max=15)
P_AEB_Func_vehAcuteWarningSubjCurvTrajActivationThres = AUTOSAR4.Parameter(0.02, SwCalibrationAccess="ReadWrite", StorageClass="ExportedGlobal", DataType="single", Min=0, Max=1)
P_AEB_Func_vehAcuteWarningSubjCurvTrajActivationThresForPedCyc = AUTOSAR4.Parameter(0.009, SwCalibrationAccess="ReadWrite", StorageClass="ExportedGlobal", DataType="single", Min=0, Max=0.1)
P_AEB_Func_vehAcuteWarningSubjLatAccelActivationThresForPedCyc = AUTOSAR4.Parameter(0.3, SwCalibrationAccess="ReadWrite", StorageClass="ExportedGlobal", DataType="single", Min=0, Max=5)
P_AEB_Func_vehAcuteWarningSubjLongAccelActivationThres = AUTOSAR4.Parameter(-2.5, SwCalibrationAccess="ReadWrite", StorageClass="ExportedGlobal", DataType="single", Min=-5, Max=0)
P_AEB_Func_vehAcuteWarningSubjVelActivationThresForPedCyc = AUTOSAR4.Parameter(25, SwCalibrationAccess="ReadWrite", StorageClass="ExportedGlobal", DataType="single", Min=0, Max=30)
P_AEB_Func_vehAcuteWarningSubjVelMaxActivationThresMO = AUTOSAR4.Parameter(42, SwCalibrationAccess="ReadWrite", StorageClass="ExportedGlobal", DataType="single", Min=0, Max=69)
P_AEB_Func_vehAcuteWarningSubjVelMaxActivationThresSO = AUTOSAR4.Parameter(25, SwCalibrationAccess="ReadWrite", StorageClass="ExportedGlobal", DataType="single", Min=0, Max=40)
P_AEB_Func_vehEBAAccrCondAborDelayTime = AUTOSAR4.Parameter(1.5, SwCalibrationAccess="ReadWrite", StorageClass="ExportedGlobal", DataType="single", Min=0, Max=5)
P_AEB_Func_vehEBADgrLvlAccelAvoidThresWithWarning = AUTOSAR4.Parameter(-9, SwCalibrationAccess="ReadWrite", StorageClass="ExportedGlobal", DataType="single", Min=-12, Max=0)
P_AEB_Func_vehEBADgrLvlAccelAvoidThresWithoutWarning = AUTOSAR4.Parameter(-9, SwCalibrationAccess="ReadWrite", StorageClass="ExportedGlobal", DataType="single", Min=-12, Max=0)
P_AEB_Func_vehEBADxActivationThres = AUTOSAR4.Parameter(60, SwCalibrationAccess="ReadWrite", StorageClass="ExportedGlobal", DataType="single", Min=0, Max=210)
P_AEB_Func_vehEBAFusionOverlapActivationThresX = AUTOSAR4.Parameter([0; 5; 20; 35; 100], SwCalibrationAccess="ReadWrite", StorageClass="ExportedGlobal", DataType="single", Min=0, Max=210)
P_AEB_Func_vehEBAGasPedalAborThres = AUTOSAR4.Parameter(10, SwCalibrationAccess="ReadWrite", StorageClass="ExportedGlobal", DataType="single", Min=0, Max=100)
P_AEB_Func_vehEBAGasPedalActivationThres = AUTOSAR4.Parameter(85, SwCalibrationAccess="ReadWrite", StorageClass="ExportedGlobal", DataType="single", Min=0, Max=100)
P_AEB_Func_vehEBAMasterCylindBrkPressActivationThres = AUTOSAR4.Parameter(30, SwCalibrationAccess="ReadWrite", StorageClass="ExportedGlobal", DataType="single", Min=0, Max=200)
P_AEB_Func_vehEBANoFusionOverlapActivationThresX = AUTOSAR4.Parameter([0; 5; 20; 35; 100], SwCalibrationAccess="ReadWrite", StorageClass="ExportedGlobal", DataType="single", Min=0, Max=210)
P_AEB_Func_vehEBAObjMovingBrkAccelThresX = AUTOSAR4.Parameter([0; 5; 10; 15; 20; 40; 50; 70], SwCalibrationAccess="ReadWrite", StorageClass="ExportedGlobal", DataType="single", Min=0, Max=70)
P_AEB_Func_vehEBAObjMovingBrkAccelThresY = AUTOSAR4.Parameter([-3; -3; -3; -3.5; -3.5; -3.5; -4.5; -4.5], SwCalibrationAccess="ReadWrite", StorageClass="ExportedGlobal", DataType="single", Min=-8, Max=0)
P_AEB_Func_vehEBAObjObstacleProbActivationThres = AUTOSAR4.Parameter(0.7, SwCalibrationAccess="ReadWrite", StorageClass="ExportedGlobal", DataType="single", Min=0, Max=1)
P_AEB_Func_vehEBAObjStandAccelAvoidThres = AUTOSAR4.Parameter(-5, SwCalibrationAccess="ReadWrite", StorageClass="ExportedGlobal", DataType="single", Min=-10, Max=0)
P_AEB_Func_vehEBAObjStandBrkAccelThresHigh = AUTOSAR4.Parameter(-3.3, SwCalibrationAccess="ReadWrite", StorageClass="ExportedGlobal", DataType="single", Min=-10, Max=0)
P_AEB_Func_vehEBAObjStandBrkAccelThresLow = AUTOSAR4.Parameter(-4.8, SwCalibrationAccess="ReadWrite", StorageClass="ExportedGlobal", DataType="single", Min=-10, Max=0)
P_AEB_Func_vehEBAObjSubjLatAccelActivationThresForPedCyc = AUTOSAR4.Parameter(0.3, SwCalibrationAccess="ReadWrite", StorageClass="ExportedGlobal", DataType="single", Min=0, Max=5)
P_AEB_Func_vehEBAStrCondAborDelayTime = AUTOSAR4.Parameter(1.5, SwCalibrationAccess="ReadWrite", StorageClass="ExportedGlobal", DataType="single", Min=0, Max=5)
P_AEB_Func_vehEBAStrWheelAngleAborThres = AUTOSAR4.Parameter(1.6, SwCalibrationAccess="ReadWrite", StorageClass="ExportedGlobal", DataType="single", Min=0, Max=15)
P_AEB_Func_vehEBAStrWheelAngleActivationThres = AUTOSAR4.Parameter(1.6, SwCalibrationAccess="ReadWrite", StorageClass="ExportedGlobal", DataType="single", Min=0, Max=10)
P_AEB_Func_vehEBAStrWheelAngleSpdAborThres = AUTOSAR4.Parameter(1.75, SwCalibrationAccess="ReadWrite", StorageClass="ExportedGlobal", DataType="single", Min=0, Max=10)
P_AEB_Func_vehEBAStrWheelAngleSpdActivationThres = AUTOSAR4.Parameter(1.75, SwCalibrationAccess="ReadWrite", StorageClass="ExportedGlobal", DataType="single", Min=0, Max=15)
P_AEB_Func_vehEBASubjCurvTrajActivationThresForPedCyc = AUTOSAR4.Parameter(0.009, SwCalibrationAccess="ReadWrite", StorageClass="ExportedGlobal", DataType="single", Min=0, Max=0.1)
P_AEB_Func_vehEBASubjLongAccelActivationThres = AUTOSAR4.Parameter(-3, SwCalibrationAccess="ReadWrite", StorageClass="ExportedGlobal", DataType="single", Min=-5, Max=0)
P_AEB_Func_vehEBASubjVelActivationThresForPedCyc = AUTOSAR4.Parameter(25, SwCalibrationAccess="ReadWrite", StorageClass="ExportedGlobal", DataType="single", Min=0, Max=30)
P_AEB_Func_vehEBASubjVelMaxMO = AUTOSAR4.Parameter(25, SwCalibrationAccess="ReadWrite", StorageClass="ExportedGlobal", DataType="single", Min=0, Max=69)
P_AEB_Func_vehEBASubjVelMaxSO = AUTOSAR4.Parameter(25, SwCalibrationAccess="ReadWrite", StorageClass="ExportedGlobal", DataType="single", Min=0, Max=40)
P_AEB_Func_vehEBASubjVelMin = AUTOSAR4.Parameter(1.1, SwCalibrationAccess="ReadWrite", StorageClass="ExportedGlobal", DataType="single", Min=0, Max=30)
P_AEB_Func_vehEBSMasterCylindBrkPressAborThres = AUTOSAR4.Parameter(5, SwCalibrationAccess="ReadWrite", StorageClass="ExportedGlobal", DataType="single", Min=0, Max=15)
P_AEB_Func_vehLatentWarningObjObstacleProbActivationThres = AUTOSAR4.Parameter(0.6, SwCalibrationAccess="ReadWrite", StorageClass="ExportedGlobal", DataType="single", Min=0, Max=1)
P_AEB_Func_vehLatentWarningSubjVelAborThres = AUTOSAR4.Parameter(16.7, SwCalibrationAccess="ReadWrite", StorageClass="ExportedGlobal", DataType="single", Min=0, Max=30)
P_AEB_Func_vehLatentWarningSubjVelMax = AUTOSAR4.Parameter(42, SwCalibrationAccess="ReadWrite", StorageClass="ExportedGlobal", DataType="single", Min=0, Max=69)
P_AEB_Func_vehLatentWarningSubjVelMin = AUTOSAR4.Parameter(18, SwCalibrationAccess="ReadWrite", StorageClass="ExportedGlobal", DataType="single", Min=0, Max=30)
P_AEB_Func_vehLatentWarningTimeGapCounterThres = AUTOSAR4.Parameter(1, SwCalibrationAccess="ReadWrite", StorageClass="ExportedGlobal", DataType="single", Min=0, Max=3)
P_AEB_Func_vehLatentWarningTimeGapDurationAborThres = AUTOSAR4.Parameter(0.5, SwCalibrationAccess="ReadWrite", StorageClass="ExportedGlobal", DataType="single", Min=0, Max=10)
P_AEB_Func_vehLatentWarningTimeGapDurationThresEarly = AUTOSAR4.Parameter(7, SwCalibrationAccess="ReadWrite", StorageClass="ExportedGlobal", DataType="single", Min=0, Max=10)
P_AEB_Func_vehLatentWarningTimeGapDurationThresLate = AUTOSAR4.Parameter(7, SwCalibrationAccess="ReadWrite", StorageClass="ExportedGlobal", DataType="single", Min=0, Max=10)
P_AEB_Func_vehLatentWarningTimeGapDurationThresMiddle = AUTOSAR4.Parameter(7, SwCalibrationAccess="ReadWrite", StorageClass="ExportedGlobal", DataType="single", Min=0, Max=10)
P_AEB_Func_vehLatentWarningTimeGapThresHmiEarly = AUTOSAR4.Parameter(0.9, SwCalibrationAccess="ReadWrite", StorageClass="ExportedGlobal", DataType="single", Min=0, Max=3)
P_AEB_Func_vehLatentWarningTimeGapThresHmiLate = AUTOSAR4.Parameter(0.55, SwCalibrationAccess="ReadWrite", StorageClass="ExportedGlobal", DataType="single", Min=0, Max=3)
P_AEB_Func_vehLatentWarningTimeGapThresHmiMiddle = AUTOSAR4.Parameter(0.7, SwCalibrationAccess="ReadWrite", StorageClass="ExportedGlobal", DataType="single", Min=0, Max=3)
P_AEB_Func_vehPreWarningAccrCondAborDelayTime = AUTOSAR4.Parameter(1.5, SwCalibrationAccess="ReadWrite", StorageClass="ExportedGlobal", DataType="single", Min=0, Max=5)
P_AEB_Func_vehPreWarningDxActivationThres = AUTOSAR4.Parameter(70, SwCalibrationAccess="ReadWrite", StorageClass="ExportedGlobal", DataType="single", Min=0, Max=210)
P_AEB_Func_vehPreWarningEscapeActivationThres = AUTOSAR4.Parameter(0.65, SwCalibrationAccess="ReadWrite", StorageClass="ExportedGlobal", DataType="single", Min=0, Max=1)
P_AEB_Func_vehPreWarningGasPedalAborThres = AUTOSAR4.Parameter(85, SwCalibrationAccess="ReadWrite", StorageClass="ExportedGlobal", DataType="single", Min=0, Max=100)
P_AEB_Func_vehPreWarningGasPedalActivationThres = AUTOSAR4.Parameter(85, SwCalibrationAccess="ReadWrite", StorageClass="ExportedGlobal", DataType="single", Min=0, Max=100)
P_AEB_Func_vehPreWarningMasterCylindBrkPressThres = AUTOSAR4.Parameter(3, SwCalibrationAccess="ReadWrite", StorageClass="ExportedGlobal", DataType="single", Min=0, Max=10)
P_AEB_Func_vehPreWarningObjHeightActivationThres = AUTOSAR4.Parameter(3, SwCalibrationAccess="ReadWrite", StorageClass="ExportedGlobal", DataType="single", Min=0, Max=5)
P_AEB_Func_vehPreWarningObjObstacleProbActivationThres = AUTOSAR4.Parameter(0.7, SwCalibrationAccess="ReadWrite", StorageClass="ExportedGlobal", DataType="single", Min=0, Max=1)
P_AEB_Func_vehPreWarningOverlapActivationThresX = AUTOSAR4.Parameter([0; 5; 20; 35; 100], SwCalibrationAccess="ReadWrite", StorageClass="ExportedGlobal", DataType="single", Min=0, Max=210)
P_AEB_Func_vehPreWarningStrCondAborDelayTime = AUTOSAR4.Parameter(1.5, SwCalibrationAccess="ReadWrite", StorageClass="ExportedGlobal", DataType="single", Min=0, Max=5)
P_AEB_Func_vehPreWarningStrWheelAngleAborThres = AUTOSAR4.Parameter(1.6, SwCalibrationAccess="ReadWrite", StorageClass="ExportedGlobal", DataType="single", Min=0, Max=15)
P_AEB_Func_vehPreWarningStrWheelAngleActivationThres = AUTOSAR4.Parameter(1.6, SwCalibrationAccess="ReadWrite", StorageClass="ExportedGlobal", DataType="single", Min=0, Max=10)
P_AEB_Func_vehPreWarningStrWheelAngleSpdAborThres = AUTOSAR4.Parameter(1.75, SwCalibrationAccess="ReadWrite", StorageClass="ExportedGlobal", DataType="single", Min=0, Max=10)
P_AEB_Func_vehPreWarningStrWheelAngleSpdActivationThres = AUTOSAR4.Parameter(1.75, SwCalibrationAccess="ReadWrite", StorageClass="ExportedGlobal", DataType="single", Min=0, Max=15)
P_AEB_Func_vehPreWarningSubjCurvTrajActivationThres = AUTOSAR4.Parameter(0.02, SwCalibrationAccess="ReadWrite", StorageClass="ExportedGlobal", DataType="single", Min=0, Max=1)
P_AEB_Func_vehPreWarningSubjCurvTrajActivationThresForPedCyc = AUTOSAR4.Parameter(0.009, SwCalibrationAccess="ReadWrite", StorageClass="ExportedGlobal", DataType="single", Min=0, Max=0.1)
P_AEB_Func_vehPreWarningSubjLatAccelActivationThresForPedCyc = AUTOSAR4.Parameter(0.3, SwCalibrationAccess="ReadWrite", StorageClass="ExportedGlobal", DataType="single", Min=0, Max=5)
P_AEB_Func_vehPreWarningSubjVelActivationThresForPedCyc = AUTOSAR4.Parameter(25, SwCalibrationAccess="ReadWrite", StorageClass="ExportedGlobal", DataType="single", Min=0, Max=30)
P_AEB_Func_vehPreWarningSubjVelMaxActivationThresMO = AUTOSAR4.Parameter(42, SwCalibrationAccess="ReadWrite", StorageClass="ExportedGlobal", DataType="single", Min=0, Max=69)
P_AEB_Func_vehPreWarningSubjVelMaxActivationThresSO = AUTOSAR4.Parameter(25, SwCalibrationAccess="ReadWrite", StorageClass="ExportedGlobal", DataType="single", Min=0, Max=40)
P_AEB_Func_vehPrefillAccrCondAborDelayTime = AUTOSAR4.Parameter(1.5, SwCalibrationAccess="ReadWrite", StorageClass="ExportedGlobal", DataType="single", Min=0, Max=5)
P_AEB_Func_vehPrefillEscapeActivationThres = AUTOSAR4.Parameter(0.65, SwCalibrationAccess="ReadWrite", StorageClass="ExportedGlobal", DataType="single", Min=0, Max=1)
P_AEB_Func_vehPrefillGasPedalAborThres = AUTOSAR4.Parameter(85, SwCalibrationAccess="ReadWrite", StorageClass="ExportedGlobal", DataType="single", Min=0, Max=100)
P_AEB_Func_vehPrefillGasPedalActivationThres = AUTOSAR4.Parameter(85, SwCalibrationAccess="ReadWrite", StorageClass="ExportedGlobal", DataType="single", Min=0, Max=100)
P_AEB_Func_vehPrefillMasterCylindBrkPressAborThres = AUTOSAR4.Parameter(3, SwCalibrationAccess="ReadWrite", StorageClass="ExportedGlobal", DataType="single", Min=0, Max=10)
P_AEB_Func_vehPrefillMasterCylindBrkPressActivationThres = AUTOSAR4.Parameter(3, SwCalibrationAccess="ReadWrite", StorageClass="ExportedGlobal", DataType="single", Min=0, Max=10)
P_AEB_Func_vehPrefillObjObstacleProbActivationThres = AUTOSAR4.Parameter(0.7, SwCalibrationAccess="ReadWrite", StorageClass="ExportedGlobal", DataType="single", Min=0, Max=1)
P_AEB_Func_vehPrefillOverlapActivationThresX = AUTOSAR4.Parameter([0; 5; 20; 35; 100], SwCalibrationAccess="ReadWrite", StorageClass="ExportedGlobal", DataType="single", Min=0, Max=210)
P_AEB_Func_vehPrefillOverlapActivationThresY = AUTOSAR4.Parameter([0.4; 0.4; 0.3; 0.3; 0.28], SwCalibrationAccess="ReadWrite", StorageClass="ExportedGlobal", DataType="single", Min=0, Max=1)
P_AEB_Func_vehPrefillStrCondAborDelayTime = AUTOSAR4.Parameter(1.5, SwCalibrationAccess="ReadWrite", StorageClass="ExportedGlobal", DataType="single", Min=0, Max=5)
P_AEB_Func_vehPrefillStrWheelAngleAborThres = AUTOSAR4.Parameter(1.6, SwCalibrationAccess="ReadWrite", StorageClass="ExportedGlobal", DataType="single", Min=0, Max=15)
P_AEB_Func_vehPrefillStrWheelAngleActivationThres = AUTOSAR4.Parameter(1.75, SwCalibrationAccess="ReadWrite", StorageClass="ExportedGlobal", DataType="single", Min=0, Max=10)
P_AEB_Func_vehPrefillStrWheelAngleSpdAborThres = AUTOSAR4.Parameter(1.75, SwCalibrationAccess="ReadWrite", StorageClass="ExportedGlobal", DataType="single", Min=0, Max=10)
P_AEB_Func_vehPrefillStrWheelAngleSpdActivationThres = AUTOSAR4.Parameter(1.6, SwCalibrationAccess="ReadWrite", StorageClass="ExportedGlobal", DataType="single", Min=0, Max=15)
P_AEB_Func_vehPrefillSubjCurvTrajActivationThresForPedCyc = AUTOSAR4.Parameter(0.009, SwCalibrationAccess="ReadWrite", StorageClass="ExportedGlobal", DataType="single", Min=0, Max=0.1)
P_AEB_Func_vehPrefillSubjLatAccelActivationThresForPedCyc = AUTOSAR4.Parameter(0.3, SwCalibrationAccess="ReadWrite", StorageClass="ExportedGlobal", DataType="single", Min=0, Max=5)
P_AEB_Func_vehPrefillSubjVelActivationThresForPedCyc = AUTOSAR4.Parameter(18, SwCalibrationAccess="ReadWrite", StorageClass="ExportedGlobal", DataType="single", Min=0, Max=30)
P_AEB_Func_vehPrefillSubjVelMaxActivationThresMO = AUTOSAR4.Parameter(42, SwCalibrationAccess="ReadWrite", StorageClass="ExportedGlobal", DataType="single", Min=0, Max=69)
P_AEB_Func_vehPrefillSubjVelMaxActivationThresSO = AUTOSAR4.Parameter(25, SwCalibrationAccess="ReadWrite", StorageClass="ExportedGlobal", DataType="single", Min=0, Max=40)
P_AEB_Func_vehPrefillSubjVelMinActivationThres = AUTOSAR4.Parameter(8.3, SwCalibrationAccess="ReadWrite", StorageClass="ExportedGlobal", DataType="single", Min=0, Max=30)
P_AEB_JaPedCA_BrkJerkMaxFullBrake = AUTOSAR4.Parameter(-30, SwCalibrationAccess="ReadWrite", StorageClass="ExportedGlobal", DataType="single", Min=-64, Max=64)
P_AEB_JaPedCA_DecelMaxFullBrake = AUTOSAR4.Parameter(-9, SwCalibrationAccess="ReadWrite", StorageClass="ExportedGlobal", DataType="single", Min=-15, Max=0)
P_AEB_JaPedCA_PreCollisionPredTimeMax = AUTOSAR4.Parameter(2, SwCalibrationAccess="ReadWrite", StorageClass="ExportedGlobal", DataType="single", Min=0, Max=5)
P_AEB_JaPedCA_PreSelectDxThres = AUTOSAR4.Parameter(20, SwCalibrationAccess="ReadWrite", StorageClass="ExportedGlobal", DataType="single", Min=0, Max=40)
P_AEB_JaPedCA_PreSelectDxVarThres = AUTOSAR4.Parameter(1, SwCalibrationAccess="ReadWrite", StorageClass="ExportedGlobal", DataType="single", Min=0, Max=5)
P_AEB_JaPedCA_PreSelectDyThres = AUTOSAR4.Parameter(7, SwCalibrationAccess="ReadWrite", StorageClass="ExportedGlobal", DataType="single", Min=0, Max=10)
P_AEB_JaPedCA_PreSelectObjYawAngleThres = AUTOSAR4.Parameter(45, SwCalibrationAccess="ReadWrite", StorageClass="ExportedGlobal", DataType="single", Min=0, Max=360)
P_AEB_JaPedCA_PreSelectObjectExistProbThres = AUTOSAR4.Parameter(0.8, SwCalibrationAccess="ReadWrite", StorageClass="ExportedGlobal", DataType="single", Min=0, Max=1)
P_AEB_JaPedCA_SelectStrWheelAngleAbsThres = AUTOSAR4.Parameter(20, SwCalibrationAccess="ReadWrite", StorageClass="ExportedGlobal", DataType="single", Min=0, Max=720)

P_AEB_JaPedCA_SelectSubjVelThres = AUTOSAR4.Parameter(8.3, SwCalibrationAccess="ReadWrite", StorageClass="ExportedGlobal", DataType="single", Min=0, Max=50)
P_AEB_JaPedCA_VelReduceMaxFullBrake = AUTOSAR4.Parameter(-8.3, SwCalibrationAccess="ReadWrite", StorageClass="ExportedGlobal", DataType="single", Min=-22.22, Max=0)
P_AEB_JaVehCA_BrkJerkMaxFullBrake = AUTOSAR4.Parameter(-30, SwCalibrationAccess="ReadWrite", StorageClass="ExportedGlobal", DataType="single", Min=-64, Max=64)
P_AEB_JaVehCA_BrkSysDelayTimeFullBrake = AUTOSAR4.Parameter(0.15, SwCalibrationAccess="ReadWrite", StorageClass="ExportedGlobal", DataType="single", Min=0, Max=1)
P_AEB_JaVehCA_DecelMaxFullBrake = AUTOSAR4.Parameter(-9, SwCalibrationAccess="ReadWrite", StorageClass="ExportedGlobal", DataType="single", Min=-15, Max=0)
P_AEB_JaVehCA_PreCollisionPredTimeMax = AUTOSAR4.Parameter(2, SwCalibrationAccess="ReadWrite", StorageClass="ExportedGlobal", DataType="single", Min=0, Max=5)
P_AEB_JaVehCA_PreSelecVxAbsObjAbsThres = AUTOSAR4.Parameter(18.05, SwCalibrationAccess="ReadWrite", StorageClass="ExportedGlobal", DataType="single", Min=0, Max=30)
P_AEB_JaVehCA_PreSelectDxThres = AUTOSAR4.Parameter(40, SwCalibrationAccess="ReadWrite", StorageClass="ExportedGlobal", DataType="single", Min=0, Max=100)
P_AEB_JaVehCA_PreSelectDxVarThres = AUTOSAR4.Parameter(1.5, SwCalibrationAccess="ReadWrite", StorageClass="ExportedGlobal", DataType="single", Min=0, Max=5)
P_AEB_JaVehCA_PreSelectObjectExistProbThres = AUTOSAR4.Parameter(0.7, SwCalibrationAccess="ReadWrite", StorageClass="ExportedGlobal", DataType="single", Min=0, Max=1)
P_AEB_JaVehCA_SelectStrWheelAngleAbsThres = AUTOSAR4.Parameter(20, SwCalibrationAccess="ReadWrite", StorageClass="ExportedGlobal", DataType="single", Min=0, Max=180)
P_AEB_JaVehCA_SelectSubjVelThres = AUTOSAR4.Parameter(8.3, SwCalibrationAccess="ReadWrite", StorageClass="ExportedGlobal", DataType="single", Min=0, Max=20)
P_AEB_JaVehCA_VelReduceMaxFullBrake = AUTOSAR4.Parameter(-8.3, SwCalibrationAccess="ReadWrite", StorageClass="ExportedGlobal", DataType="single", Min=-22.22, Max=0)
P_AEB_LatCycCA_BrkJerkMaxFullBrake = AUTOSAR4.Parameter(-45, SwCalibrationAccess="ReadWrite", StorageClass="ExportedGlobal", DataType="single", Min=-64, Max=64)
P_AEB_LatCycCA_BrkSysDelayTimePartBrake = AUTOSAR4.Parameter(0.15, SwCalibrationAccess="ReadWrite", StorageClass="ExportedGlobal", DataType="single", Min=0, Max=1)
P_AEB_LatCycCA_CollisionRiskObjAccelMax = AUTOSAR4.Parameter(1, SwCalibrationAccess="ReadWrite", StorageClass="ExportedGlobal", DataType="single", Min=0, Max=3)
P_AEB_LatCycCA_CollisionRiskObjDecelMax = AUTOSAR4.Parameter(-7, SwCalibrationAccess="ReadWrite", StorageClass="ExportedGlobal", DataType="single", Min=-9, Max=0)
P_AEB_LatCycCA_CollisionRiskProbPredTimeMax = AUTOSAR4.Parameter(2, SwCalibrationAccess="ReadWrite", StorageClass="ExportedGlobal", DataType="single", Min=0, Max=5)
P_AEB_LatCycCA_CollisionRiskProbStepTime = AUTOSAR4.Parameter(0.1, SwCalibrationAccess="ReadWrite", StorageClass="ExportedGlobal", DataType="single", Min=0, Max=2)
P_AEB_LatCycCA_DecelMaxFullBrake = AUTOSAR4.Parameter(-5.75, SwCalibrationAccess="ReadWrite", StorageClass="ExportedGlobal", DataType="single", Min=-15, Max=0)
P_AEB_LatCycCA_DecelMaxPartBrake = AUTOSAR4.Parameter(-5.75, SwCalibrationAccess="ReadWrite", StorageClass="ExportedGlobal", DataType="single", Min=-15, Max=0)
P_AEB_LatCycCA_DxSecureSubjVelThres = AUTOSAR4.Parameter(11.94, SwCalibrationAccess="ReadWrite", StorageClass="ExportedGlobal", DataType="single", Min=0, Max=69.44)
P_AEB_LatCycCA_Lvl1SeverityThresCurrentLvl0 = AUTOSAR4.Parameter(0.486, SwCalibrationAccess="ReadWrite", StorageClass="ExportedGlobal", DataType="single", Min=0, Max=0.99)
P_AEB_LatCycCA_Lvl1SeverityThresCurrentLvl1 = AUTOSAR4.Parameter(0.334, SwCalibrationAccess="ReadWrite", StorageClass="ExportedGlobal", DataType="single", Min=0, Max=0.99)
P_AEB_LatCycCA_Lvl1SeverityThresCurrentLvl2 = AUTOSAR4.Parameter(0.334, SwCalibrationAccess="ReadWrite", StorageClass="ExportedGlobal", DataType="single", Min=0, Max=0.99)
P_AEB_LatCycCA_Lvl1SeverityThresCurrentLvl3 = AUTOSAR4.Parameter(0.334, SwCalibrationAccess="ReadWrite", StorageClass="ExportedGlobal", DataType="single", Min=0, Max=0.99)
P_AEB_LatCycCA_Lvl2SeverityThresCurrentLvl0 = AUTOSAR4.Parameter(0.586, SwCalibrationAccess="ReadWrite", StorageClass="ExportedGlobal", DataType="single", Min=0, Max=0.99)
P_AEB_LatCycCA_Lvl2SeverityThresCurrentLvl1 = AUTOSAR4.Parameter(0.586, SwCalibrationAccess="ReadWrite", StorageClass="ExportedGlobal", DataType="single", Min=0, Max=0.99)
P_AEB_LatCycCA_Lvl2SeverityThresCurrentLvl2 = AUTOSAR4.Parameter(0.434, SwCalibrationAccess="ReadWrite", StorageClass="ExportedGlobal", DataType="single", Min=0, Max=0.99)
P_AEB_LatCycCA_Lvl2SeverityThresCurrentLvl3 = AUTOSAR4.Parameter(0.434, SwCalibrationAccess="ReadWrite", StorageClass="ExportedGlobal", DataType="single", Min=0, Max=0.99)
P_AEB_LatCycCA_Lvl3SeverityThresCurrentLvl0 = AUTOSAR4.Parameter(0.686, SwCalibrationAccess="ReadWrite", StorageClass="ExportedGlobal", DataType="single", Min=0, Max=0.99)
P_AEB_LatCycCA_Lvl3SeverityThresCurrentLvl1 = AUTOSAR4.Parameter(0.686, SwCalibrationAccess="ReadWrite", StorageClass="ExportedGlobal", DataType="single", Min=0, Max=0.99)
P_AEB_LatCycCA_Lvl3SeverityThresCurrentLvl2 = AUTOSAR4.Parameter(0.686, SwCalibrationAccess="ReadWrite", StorageClass="ExportedGlobal", DataType="single", Min=0, Max=0.99)
P_AEB_LatCycCA_Lvl3SeverityThresCurrentLvl3 = AUTOSAR4.Parameter(0.534, SwCalibrationAccess="ReadWrite", StorageClass="ExportedGlobal", DataType="single", Min=0, Max=0.99)
P_AEB_LatCycCA_PreCollisionCycLengthThres = AUTOSAR4.Parameter(1.8, SwCalibrationAccess="ReadWrite", StorageClass="ExportedGlobal", DataType="single", Min=0, Max=3)
P_AEB_LatCycCA_PreCollisionCycWidthThres = AUTOSAR4.Parameter(0.5, SwCalibrationAccess="ReadWrite", StorageClass="ExportedGlobal", DataType="single", Min=0, Max=3)
P_AEB_LatCycCA_PreCollisionPredTimeMax = AUTOSAR4.Parameter(2, SwCalibrationAccess="ReadWrite", StorageClass="ExportedGlobal", DataType="single", Min=0, Max=5)
P_AEB_LatCycCA_PreCollisionStepTime = AUTOSAR4.Parameter(0.1, SwCalibrationAccess="ReadWrite", StorageClass="ExportedGlobal", DataType="single", Min=0, Max=2)
P_AEB_LatCycCA_PreSelectDxThres = AUTOSAR4.Parameter(30, SwCalibrationAccess="ReadWrite", StorageClass="ExportedGlobal", DataType="single", Min=0, Max=50)
P_AEB_LatCycCA_PreSelectDyThres = AUTOSAR4.Parameter(7, SwCalibrationAccess="ReadWrite", StorageClass="ExportedGlobal", DataType="single", Min=0, Max=15)
P_AEB_LatCycCA_PreSelectDyVarThres = AUTOSAR4.Parameter(1.3, SwCalibrationAccess="ReadWrite", StorageClass="ExportedGlobal", DataType="single", Min=0, Max=5)
P_AEB_LatCycCA_PreSelectObjectExistProbThres = AUTOSAR4.Parameter(0.8, SwCalibrationAccess="ReadWrite", StorageClass="ExportedGlobal", DataType="single", Min=0, Max=1)
P_AEB_LatCycCA_PreSelectObjectIsObstacleProbThres = AUTOSAR4.Parameter(0.7, SwCalibrationAccess="ReadWrite", StorageClass="ExportedGlobal", DataType="single", Min=0, Max=1)
P_AEB_LatCycCA_SelectObjCollisionRiskProbThres = AUTOSAR4.Parameter(0.6, SwCalibrationAccess="ReadWrite", StorageClass="ExportedGlobal", DataType="single", Min=0, Max=0.99)
P_AEB_LatCycCA_SelectTgtCollisionRiskProbThres = AUTOSAR4.Parameter(0.25, SwCalibrationAccess="ReadWrite", StorageClass="ExportedGlobal", DataType="single", Min=0, Max=0.99)
P_AEB_LatCycCA_SubjVelDxSecureUnder40KphX = AUTOSAR4.Parameter([0; 2.8; 11.1; 20], SwCalibrationAccess="ReadWrite", StorageClass="ExportedGlobal", DataType="single", Min=0, Max=20)
P_AEB_LatCycCA_VelReduceMaxFullBrake = AUTOSAR4.Parameter(-8.3, SwCalibrationAccess="ReadWrite", StorageClass="ExportedGlobal", DataType="single", Min=-22.22, Max=0)
P_AEB_LatCycCA_VelReduceMaxOver40KphFullBrake = AUTOSAR4.Parameter(-6.94, SwCalibrationAccess="ReadWrite", StorageClass="ExportedGlobal", DataType="single", Min=-22.22, Max=0)
P_AEB_LatCycCA_VelReduceMaxOver40KphPartBrake = AUTOSAR4.Parameter(-6.94, SwCalibrationAccess="ReadWrite", StorageClass="ExportedGlobal", DataType="single", Min=-22.22, Max=0)
P_AEB_LatCycCA_VelReduceMaxPartBrake = AUTOSAR4.Parameter(-8.3, SwCalibrationAccess="ReadWrite", StorageClass="ExportedGlobal", DataType="single", Min=-22.22, Max=0)
P_AEB_LatCycCA_VelReduceMaxVelThresFullBrake = AUTOSAR4.Parameter(11.94, SwCalibrationAccess="ReadWrite", StorageClass="ExportedGlobal", DataType="single", Min=0, Max=69.44)
P_AEB_LatCycCA_VelReduceMaxVelThresPartBrake = AUTOSAR4.Parameter(11.94, SwCalibrationAccess="ReadWrite", StorageClass="ExportedGlobal", DataType="single", Min=0, Max=69.44)
P_AEB_LatPedCA_AccelGredientMax = AUTOSAR4.Parameter(-30, SwCalibrationAccess="ReadWrite", StorageClass="ExportedGlobal", DataType="single", Min=-64, Max=64)
P_AEB_LatPedCA_CollisionRiskProbJoggingStsMaxAccelX = AUTOSAR4.Parameter([0; 0.66; 3], SwCalibrationAccess="ReadWrite", StorageClass="ExportedGlobal", DataType="single", Min=0, Max=4)
P_AEB_LatPedCA_CollisionRiskProbJoggingStsMaxAccelY = AUTOSAR4.Parameter([0; 1.6; 0.95], SwCalibrationAccess="ReadWrite", StorageClass="ExportedGlobal", DataType="single", Min=0, Max=2)
P_AEB_LatPedCA_CollisionRiskProbJoggingStsMaxDecelX = AUTOSAR4.Parameter([0; 0.97; 3], SwCalibrationAccess="ReadWrite", StorageClass="ExportedGlobal", DataType="single", Min=0, Max=4)
P_AEB_LatPedCA_CollisionRiskProbJoggingStsMaxDecelY = AUTOSAR4.Parameter([0; -0.765; -0.64], SwCalibrationAccess="ReadWrite", StorageClass="ExportedGlobal", DataType="single", Min=-2, Max=0)
P_AEB_LatPedCA_CollisionRiskProbJoggingStsVelThres = AUTOSAR4.Parameter(4.5, SwCalibrationAccess="ReadWrite", StorageClass="ExportedGlobal", DataType="single", Min=0, Max=10)
P_AEB_LatPedCA_CollisionRiskProbLengthThres = AUTOSAR4.Parameter(0.5, SwCalibrationAccess="ReadWrite", StorageClass="ExportedGlobal", DataType="single", Min=0, Max=3)
P_AEB_LatPedCA_CollisionRiskProbPedStopStsVelThres = AUTOSAR4.Parameter(0.8, SwCalibrationAccess="ReadWrite", StorageClass="ExportedGlobal", DataType="single", Min=0, Max=10)
P_AEB_LatPedCA_CollisionRiskProbPredTimeMax = AUTOSAR4.Parameter(2, SwCalibrationAccess="ReadWrite", StorageClass="ExportedGlobal", DataType="single", Min=0, Max=5)
P_AEB_LatPedCA_CollisionRiskProbRunningStsMaxAccelX = AUTOSAR4.Parameter([0; 0.95; 3], SwCalibrationAccess="ReadWrite", StorageClass="ExportedGlobal", DataType="single", Min=0, Max=4)
P_AEB_LatPedCA_CollisionRiskProbRunningStsMaxAccelY = AUTOSAR4.Parameter([0; 0; 0], SwCalibrationAccess="ReadWrite", StorageClass="ExportedGlobal", DataType="single", Min=0, Max=2)
P_AEB_LatPedCA_CollisionRiskProbRunningStsMaxDecelX = AUTOSAR4.Parameter([0; 0.95; 3], SwCalibrationAccess="ReadWrite", StorageClass="ExportedGlobal", DataType="single", Min=0, Max=4)
P_AEB_LatPedCA_CollisionRiskProbRunningStsMaxDecelY = AUTOSAR4.Parameter([0; -3; -2.8], SwCalibrationAccess="ReadWrite", StorageClass="ExportedGlobal", DataType="single", Min=-5, Max=0)
P_AEB_LatPedCA_CollisionRiskProbStepTime = AUTOSAR4.Parameter(0.1, SwCalibrationAccess="ReadWrite", StorageClass="ExportedGlobal", DataType="single", Min=0, Max=2)
P_AEB_LatPedCA_CollisionRiskProbStopStsMaxAccelX = AUTOSAR4.Parameter([0; 0.66; 3], SwCalibrationAccess="ReadWrite", StorageClass="ExportedGlobal", DataType="single", Min=0, Max=4)
P_AEB_LatPedCA_CollisionRiskProbStopStsMaxAccelY = AUTOSAR4.Parameter([0; 1; 0.5], SwCalibrationAccess="ReadWrite", StorageClass="ExportedGlobal", DataType="single", Min=0, Max=2)
P_AEB_LatPedCA_CollisionRiskProbStopStsMaxDecelX = AUTOSAR4.Parameter([0; 0.66; 3], SwCalibrationAccess="ReadWrite", StorageClass="ExportedGlobal", DataType="single", Min=0, Max=4)
P_AEB_LatPedCA_CollisionRiskProbStopStsMaxDecelY = AUTOSAR4.Parameter([0; 0; 0], SwCalibrationAccess="ReadWrite", StorageClass="ExportedGlobal", DataType="single", Min=0, Max=2)
P_AEB_LatPedCA_CollisionRiskProbWalkingStsMaxAccelX = AUTOSAR4.Parameter([0; 0.9; 3], SwCalibrationAccess="ReadWrite", StorageClass="ExportedGlobal", DataType="single", Min=0, Max=4)
P_AEB_LatPedCA_CollisionRiskProbWalkingStsMaxAccelY = AUTOSAR4.Parameter([0; 0.753; 0.1], SwCalibrationAccess="ReadWrite", StorageClass="ExportedGlobal", DataType="single", Min=0, Max=2)
P_AEB_LatPedCA_CollisionRiskProbWalkingStsMaxDecelX = AUTOSAR4.Parameter([0; 0.66; 3], SwCalibrationAccess="ReadWrite", StorageClass="ExportedGlobal", DataType="single", Min=0, Max=4)
P_AEB_LatPedCA_CollisionRiskProbWalkingStsMaxDecelY = AUTOSAR4.Parameter([0; -0.48; -0.26], SwCalibrationAccess="ReadWrite", StorageClass="ExportedGlobal", DataType="single", Min=-2, Max=0)
P_AEB_LatPedCA_CollisionRiskProbWalkingStsVelThres = AUTOSAR4.Parameter(2.4, SwCalibrationAccess="ReadWrite", StorageClass="ExportedGlobal", DataType="single", Min=0, Max=10)
P_AEB_LatPedCA_CollisionRiskProbWidthThres = AUTOSAR4.Parameter(0.5, SwCalibrationAccess="ReadWrite", StorageClass="ExportedGlobal", DataType="single", Min=0, Max=3)
P_AEB_LatPedCA_DecelMax = AUTOSAR4.Parameter(-9.5, SwCalibrationAccess="ReadWrite", StorageClass="ExportedGlobal", DataType="single", Min=-15, Max=0)
P_AEB_LatPedCA_DecelMaxOver22Kph = AUTOSAR4.Parameter(-7.5, SwCalibrationAccess="ReadWrite", StorageClass="ExportedGlobal", DataType="single", Min=-15, Max=0)
P_AEB_LatPedCA_DxSecureSubjVelThres = AUTOSAR4.Parameter(11.94, SwCalibrationAccess="ReadWrite", StorageClass="ExportedGlobal", DataType="single", Min=0, Max=69.44)
P_AEB_LatPedCA_Lvl1SeverityThresCurrentLevel0 = AUTOSAR4.Parameter(0.3, SwCalibrationAccess="ReadWrite", StorageClass="ExportedGlobal", DataType="single", Min=0, Max=0.99)
P_AEB_LatPedCA_Lvl1SeverityThresCurrentLvl1 = AUTOSAR4.Parameter(0.14, SwCalibrationAccess="ReadWrite", StorageClass="ExportedGlobal", DataType="single", Min=0, Max=0.99)
P_AEB_LatPedCA_Lvl1SeverityThresCurrentLvl2 = AUTOSAR4.Parameter(0.14, SwCalibrationAccess="ReadWrite", StorageClass="ExportedGlobal", DataType="single", Min=0, Max=0.99)
P_AEB_LatPedCA_Lvl1SeverityThresCurrentLvl3 = AUTOSAR4.Parameter(0.14, SwCalibrationAccess="ReadWrite", StorageClass="ExportedGlobal", DataType="single", Min=0, Max=0.99)
P_AEB_LatPedCA_Lvl2SeverityThresCurrentLvl0 = AUTOSAR4.Parameter(0.5, SwCalibrationAccess="ReadWrite", StorageClass="ExportedGlobal", DataType="single", Min=0, Max=0.99)
P_AEB_LatPedCA_Lvl2SeverityThresCurrentLvl1 = AUTOSAR4.Parameter(0.5, SwCalibrationAccess="ReadWrite", StorageClass="ExportedGlobal", DataType="single", Min=0, Max=0.99)
P_AEB_LatPedCA_Lvl2SeverityThresCurrentLvl2 = AUTOSAR4.Parameter(0.34, SwCalibrationAccess="ReadWrite", StorageClass="ExportedGlobal", DataType="single", Min=0, Max=0.99)
P_AEB_LatPedCA_Lvl2SeverityThresCurrentLvl3 = AUTOSAR4.Parameter(0.34, SwCalibrationAccess="ReadWrite", StorageClass="ExportedGlobal", DataType="single", Min=0, Max=0.99)
P_AEB_LatPedCA_Lvl3SeverityThresCurrentLvl0 = AUTOSAR4.Parameter(0.7, SwCalibrationAccess="ReadWrite", StorageClass="ExportedGlobal", DataType="single", Min=0, Max=0.99)
P_AEB_LatPedCA_Lvl3SeverityThresCurrentLvl1 = AUTOSAR4.Parameter(0.7, SwCalibrationAccess="ReadWrite", StorageClass="ExportedGlobal", DataType="single", Min=0, Max=0.99)
P_AEB_LatPedCA_Lvl3SeverityThresCurrentLvl2 = AUTOSAR4.Parameter(0.7, SwCalibrationAccess="ReadWrite", StorageClass="ExportedGlobal", DataType="single", Min=0, Max=0.99)
P_AEB_LatPedCA_Lvl3SeverityThresCurrentLvl3 = AUTOSAR4.Parameter(0.54, SwCalibrationAccess="ReadWrite", StorageClass="ExportedGlobal", DataType="single", Min=0, Max=0.99)
P_AEB_LatPedCA_PreCollisionPedLengthThres = AUTOSAR4.Parameter(0.5, SwCalibrationAccess="ReadWrite", StorageClass="ExportedGlobal", DataType="single", Min=0, Max=3)
P_AEB_LatPedCA_PreCollisionPedWidthThres = AUTOSAR4.Parameter(0.5, SwCalibrationAccess="ReadWrite", StorageClass="ExportedGlobal", DataType="single", Min=0, Max=3)
P_AEB_LatPedCA_PreCollisionPredTimeMax = AUTOSAR4.Parameter(2, SwCalibrationAccess="ReadWrite", StorageClass="ExportedGlobal", DataType="single", Min=0, Max=5)
P_AEB_LatPedCA_PreCollisionStepTime = AUTOSAR4.Parameter(0.1, SwCalibrationAccess="ReadWrite", StorageClass="ExportedGlobal", DataType="single", Min=0, Max=2)
P_AEB_LatPedCA_PreSelectDxThres = AUTOSAR4.Parameter(40, SwCalibrationAccess="ReadWrite", StorageClass="ExportedGlobal", DataType="single", Min=0, Max=50)
P_AEB_LatPedCA_PreSelectDyThres = AUTOSAR4.Parameter(4, SwCalibrationAccess="ReadWrite", StorageClass="ExportedGlobal", DataType="single", Min=0, Max=15)
P_AEB_LatPedCA_PreSelectDyVarThres = AUTOSAR4.Parameter(1, SwCalibrationAccess="ReadWrite", StorageClass="ExportedGlobal", DataType="single", Min=0, Max=5)
P_AEB_LatPedCA_PreSelectObjectExistProbThres = AUTOSAR4.Parameter(0.8, SwCalibrationAccess="ReadWrite", StorageClass="ExportedGlobal", DataType="single", Min=0, Max=1)
P_AEB_LatPedCA_PreSelectObjectIsObstacleProbThres = AUTOSAR4.Parameter(0.7, SwCalibrationAccess="ReadWrite", StorageClass="ExportedGlobal", DataType="single", Min=0, Max=1)
P_AEB_LatPedCA_SelectObjCollisionRiskProbThres = AUTOSAR4.Parameter(0.7, SwCalibrationAccess="ReadWrite", StorageClass="ExportedGlobal", DataType="single", Min=0, Max=0.99)
P_AEB_LatPedCA_SelectTgtCollisionRiskProbThres = AUTOSAR4.Parameter(0.25, SwCalibrationAccess="ReadWrite", StorageClass="ExportedGlobal", DataType="single", Min=0, Max=0.99)
P_AEB_LatPedCA_SeverityLowTimeOffset = AUTOSAR4.Parameter(0.6, SwCalibrationAccess="ReadWrite", StorageClass="ExportedGlobal", DataType="single", Min=0, Max=5)
P_AEB_LatPedCA_SeverityMediumMaxTime = AUTOSAR4.Parameter(1.9, SwCalibrationAccess="ReadWrite", StorageClass="ExportedGlobal", DataType="single", Min=0, Max=3)
P_AEB_LatPedCA_SeverityMediumMaxTimeHmiLate = AUTOSAR4.Parameter(1.5, SwCalibrationAccess="ReadWrite", StorageClass="ExportedGlobal", DataType="single", Min=0, Max=3)
P_AEB_LatPedCA_SubjVelDxSecureUnder40KphX = AUTOSAR4.Parameter([0; 2.8; 11.1; 20], SwCalibrationAccess="ReadWrite", StorageClass="ExportedGlobal", DataType="single", Min=0, Max=20)
P_AEB_LatPedCA_VelAccelMaxVelThres = AUTOSAR4.Parameter(6.11, SwCalibrationAccess="ReadWrite", StorageClass="ExportedGlobal", DataType="single", Min=0, Max=69.44)
P_AEB_LatPedCA_VelReduceMax = AUTOSAR4.Parameter(-11.11, SwCalibrationAccess="ReadWrite", StorageClass="ExportedGlobal", DataType="single", Min=-22.22, Max=0)
P_AEB_LatPedCA_VelReduceMaxOver40Kph = AUTOSAR4.Parameter(-7.78, SwCalibrationAccess="ReadWrite", StorageClass="ExportedGlobal", DataType="single", Min=-22.22, Max=0)
P_AEB_LatPedCA_VelReduceMaxVelThres = AUTOSAR4.Parameter(11.94, SwCalibrationAccess="ReadWrite", StorageClass="ExportedGlobal", DataType="single", Min=0, Max=69.44)
P_AEB_LatPedCA_tSeverityHighTimeOffset = AUTOSAR4.Parameter(0.2, SwCalibrationAccess="ReadWrite", StorageClass="ExportedGlobal", DataType="single", Min=0, Max=5)
P_AEB_LongCA_AccelObjFiltThesTTC = AUTOSAR4.Parameter(0.1, SwCalibrationAccess="ReadWrite", StorageClass="ExportedGlobal", DataType="single", Min=0, Max=1)
P_AEB_LongCA_CollisionPredictObjLength = AUTOSAR4.Parameter(1.8, SwCalibrationAccess="ReadWrite", StorageClass="ExportedGlobal", DataType="single", Min=0, Max=3)
P_AEB_LongCA_CollisionPredictObjWidth = AUTOSAR4.Parameter(0.5, SwCalibrationAccess="ReadWrite", StorageClass="ExportedGlobal", DataType="single", Min=0, Max=3)
P_AEB_LongCA_EscapeEgoWidthSO = AUTOSAR4.Parameter(0.5, SwCalibrationAccess="ReadWrite", StorageClass="ExportedGlobal", DataType="single", Min=0, Max=2)
P_AEB_LongCA_LatAvoidAccelThesBrkX = AUTOSAR4.Parameter([5; 7; 28], SwCalibrationAccess="ReadWrite", StorageClass="ExportedGlobal", DataType="single", Min=0, Max=100)
P_AEB_LongCA_LatAvoidAccelThesBrkY = AUTOSAR4.Parameter([-3; -3; -1], SwCalibrationAccess="ReadWrite", StorageClass="ExportedGlobal", DataType="single", Min=-10, Max=0)
P_AEB_LongCA_LatAvoidLatDistMinSO = AUTOSAR4.Parameter(3, SwCalibrationAccess="ReadWrite", StorageClass="ExportedGlobal", DataType="single", Min=0, Max=5)
P_AEB_LongCA_LatAvoidStrRminSO = AUTOSAR4.Parameter(5, SwCalibrationAccess="ReadWrite", StorageClass="ExportedGlobal", DataType="single", Min=0, Max=10)
P_AEB_LongCA_LowLvlBrkAccelAvoidThesBrkX = AUTOSAR4.Parameter([5; 10; 30], SwCalibrationAccess="ReadWrite", StorageClass="ExportedGlobal", DataType="single", Min=0, Max=100)
P_AEB_LongCA_LowLvlBrkAccelAvoidThesBrkY = AUTOSAR4.Parameter([-1.3; -1.3; -1], SwCalibrationAccess="ReadWrite", StorageClass="ExportedGlobal", DataType="single", Min=-10, Max=0)
P_AEB_LongCA_LowLvlBrkAccelAvoidThesWarnHmiEarlyX = AUTOSAR4.Parameter([5; 10; 30], SwCalibrationAccess="ReadWrite", StorageClass="ExportedGlobal", DataType="single", Min=0, Max=100)
P_AEB_LongCA_LowLvlBrkAccelAvoidThesWarnHmiLateX = AUTOSAR4.Parameter([5; 10; 30], SwCalibrationAccess="ReadWrite", StorageClass="ExportedGlobal", DataType="single", Min=0, Max=100)
P_AEB_LongCA_LowLvlBrkAccelAvoidThesWarnHmiMidX = AUTOSAR4.Parameter([5; 10; 30], SwCalibrationAccess="ReadWrite", StorageClass="ExportedGlobal", DataType="single", Min=0, Max=100)
P_AEB_LongCA_LowLvlBrkDistSecureX = AUTOSAR4.Parameter([-12; 0], SwCalibrationAccess="ReadWrite", StorageClass="ExportedGlobal", DataType="single", Min=-55, Max=0)
P_AEB_LongCA_LowLvlBrkDistSecureY = AUTOSAR4.Parameter([3; 2], SwCalibrationAccess="ReadWrite", StorageClass="ExportedGlobal", DataType="single", Min=0, Max=5)
P_AEB_vxvref_Config = AUTOSAR4.Parameter(0, SwCalibrationAccess="ReadWrite", StorageClass="ExportedGlobal", DataType="uint8")
P_AEB_Func_vehAcuteWarningSubjVelMinActivationThres = AUTOSAR4.Parameter(8.3, SwCalibrationAccess="ReadWrite", StorageClass="ExportedGlobal", DataType="single", Min=0, Max=30)
probEscape = AUTOSAR4.Signal(SwCalibrationAccess="ReadOnly", StorageClass="ExportedGlobal")
overlapRatio = AUTOSAR4.Signal(SwCalibrationAccess="ReadOnly", StorageClass="ExportedGlobal")
AEB_FUNC_VERSION = AUTOSAR4.Signal(SwCalibrationAccess="ReadOnly", StorageClass="ExportedGlobal")
P_AEB_Func_JaCycPrefillObjVelSupThresMax = AUTOSAR4.Parameter(8.3, SwCalibrationAccess="ReadWrite", StorageClass="ExportedGlobal", DataType="single", Min=0, Max=40)
P_AEB_Func_JaCycPrefillTurnSwtStsConfig = AUTOSAR4.Parameter(0, SwCalibrationAccess="ReadWrite", StorageClass="ExportedGlobal")
P_AEB_Func_JaCycAEBfullTurnSwtStsConfig = AUTOSAR4.Parameter(0, SwCalibrationAccess="ReadWrite", StorageClass="ExportedGlobal")
P_AEB_Func_JaVehAEBfullTurnSwtStsConfig = AUTOSAR4.Parameter(0, SwCalibrationAccess="ReadWrite", StorageClass="ExportedGlobal")
P_AEB_Func_JaVehPrefillTurnSwtStsConfig = AUTOSAR4.Parameter(0, SwCalibrationAccess="ReadWrite", StorageClass="ExportedGlobal")
P_AEB_Func_JaPedAEBfullTurnSwtStsConfig = AUTOSAR4.Parameter(0, SwCalibrationAccess="ReadWrite", StorageClass="ExportedGlobal")
P_AEB_Func_JaPedPrefillTurnSwtStsConfig = AUTOSAR4.Parameter(0, SwCalibrationAccess="ReadWrite", StorageClass="ExportedGlobal")