% Simulink data dictionary PvtParsAHBC.sldd

P_AHBC_TURN_LAMP_ENABLE = AUTOSAR4.Parameter(1, SwCalibrationAccess="ReadWrite", DataType="boolean")
P_AHBC_FOG_ENABLE = AUTOSAR4.Parameter(1, SwCalibrationAccess="ReadWrite", DataType="boolean")
P_AHBC_ESP_ENABLE = AUTOSAR4.Parameter(1, SwCalibrationAccess="ReadWrite", DataType="boolean")
P_AHBC_WIPER_ENABLE = AUTOSAR4.Parameter(1, SwCalibrationAccess="ReadWrite", DataType="boolean")
P_AHBC_MAX_TAILLIGHT_DISTANCE_COUPLE2 = AUTOSAR4.Parameter(1000, SwCalibrationAccess="ReadWrite")
P_AHBC_MAX_ONCOMING_DISTANCE_COUPLE2 = AUTOSAR4.Parameter(1000, SwCalibrationAccess="ReadWrite")
P_AHBC_MAX_TAILLIGHT_DISTANCE_ONE2 = AUTOSAR4.Parameter(1000, SwCalibrationAccess="ReadWrite")
P_AHBC_MAX_ONCOMING_DISTANCE_ONE2 = AUTOSAR4.Parameter(1000, SwCalibrationAccess="ReadWrite")
P_AHBC_FOG_TIME = AUTOSAR4.Parameter(3, SwCalibrationAccess="ReadWrite", DataType="uint8")
P_AHBC_WIPER_TIME = AUTOSAR4.Parameter(3, SwCalibrationAccess="ReadWrite", DataType="uint8")
P_AHBC_HIGHBEAM_ACTIVE_GRACE = AUTOSAR4.Parameter(500, SwCalibrationAccess="ReadWrite", DataType="uint16")
P_AHBC_SPEED_SWITCH_HIGH_BEAM_ON2 = AUTOSAR4.Parameter(45, SwCalibrationAccess="ReadWrite", DataType="single")
P_AHBC_SPEED_SWITCH_HIGH_BEAM_OFF2 = AUTOSAR4.Parameter(5, SwCalibrationAccess="ReadWrite", DataType="single")
P_AHBC_LAT_ACC_EXIT = AUTOSAR4.Parameter(3, SwCalibrationAccess="ReadWrite", DataType="single")
P_AHBC_LAT_ACC_ENTER = AUTOSAR4.Parameter(5, SwCalibrationAccess="ReadWrite", DataType="single")
P_AHBC_YAW_RATE_ENTER = AUTOSAR4.Parameter(0.5, SwCalibrationAccess="ReadWrite", DataType="single")
P_AHBC_YAW_RATE_EXIT = AUTOSAR4.Parameter(0.3, SwCalibrationAccess="ReadWrite", DataType="single")
P_AHBC_DRIVE_DIRECTION_ENABLE = AUTOSAR4.Parameter(1, SwCalibrationAccess="ReadWrite", DataType="boolean")
P_AHBC_TrafficStyle = AUTOSAR4.Parameter(1, SwCalibrationAccess="ReadWrite", DataType="uint8")
P_AHBC_communicationTest = AUTOSAR4.Parameter(1, SwCalibrationAccess="ReadWrite")
AHBC_LowPriorityTransformSuppression = AUTOSAR4.Signal(SwCalibrationAccess="ReadOnly", DataType="boolean")
AHBC_HighPriorityTransformSuppression = AUTOSAR4.Signal(SwCalibrationAccess="ReadOnly", DataType="boolean")
AHBC_LaserSuppression = AUTOSAR4.Signal(SwCalibrationAccess="ReadOnly", DataType="boolean")
AHBC_HighBeamSuppression = AUTOSAR4.Signal(SwCalibrationAccess="ReadOnly", DataType="boolean")
AHBC_LSV_Distance1 = AUTOSAR4.Signal(SwCalibrationAccess="ReadOnly", DataType="uint16")
AHBC_LSV_Right_Angle1 = AUTOSAR4.Signal(SwCalibrationAccess="ReadOnly", DataType="single")
AHBC_LSV_Left_Angle1 = AUTOSAR4.Signal(SwCalibrationAccess="ReadOnly", DataType="single")
AHBC_LSV_Distance2 = AUTOSAR4.Signal(SwCalibrationAccess="ReadOnly", DataType="uint16")
AHBC_LSV_Right_Angle2 = AUTOSAR4.Signal(SwCalibrationAccess="ReadOnly", DataType="single")
AHBC_LSV_Left_Angle2 = AUTOSAR4.Signal(SwCalibrationAccess="ReadOnly", DataType="single")
AHBC_LSV_Distance3 = AUTOSAR4.Signal(SwCalibrationAccess="ReadOnly", DataType="uint16")
AHBC_LSV_Right_Angle3 = AUTOSAR4.Signal(SwCalibrationAccess="ReadOnly", DataType="single")
AHBC_LSV_Left_Angle3 = AUTOSAR4.Signal(SwCalibrationAccess="ReadOnly", DataType="single")
AHBC_LSV_Distance4 = AUTOSAR4.Signal(SwCalibrationAccess="ReadOnly", DataType="uint16")
AHBC_LSV_Right_Angle4 = AUTOSAR4.Signal(SwCalibrationAccess="ReadOnly", DataType="single")
AHBC_LSV_Left_Angle4 = AUTOSAR4.Signal(SwCalibrationAccess="ReadOnly", DataType="single")
AHBC_LSV_Distance5 = AUTOSAR4.Signal(SwCalibrationAccess="ReadOnly", DataType="uint16")
AHBC_LSV_Right_Angle5 = AUTOSAR4.Signal(SwCalibrationAccess="ReadOnly", DataType="single")
AHBC_LSV_Left_Angle5 = AUTOSAR4.Signal(SwCalibrationAccess="ReadOnly", DataType="single")
AHBC_LSV_Distance6 = AUTOSAR4.Signal(SwCalibrationAccess="ReadOnly", DataType="uint16")
AHBC_LSV_Right_Angle6 = AUTOSAR4.Signal(SwCalibrationAccess="ReadOnly", DataType="single")
AHBC_LSV_Left_Angle6 = AUTOSAR4.Signal(SwCalibrationAccess="ReadOnly", DataType="single")
AHBC_SubModel_VERSION = AUTOSAR4.Signal(SwCalibrationAccess="ReadOnly")
AHBC_SubModel_Number = AUTOSAR4.Signal(SwCalibrationAccess="ReadOnly")
AHBC_communicationTest_AHBC_HMA = AUTOSAR4.Signal(SwCalibrationAccess="ReadOnly")
AHBC_communicationTest_AHBC_ADB = AUTOSAR4.Signal(SwCalibrationAccess="ReadOnly")
P_AHBC_ABS_ENABLE = AUTOSAR4.Parameter(1, SwCalibrationAccess="ReadWrite", DataType="boolean")