% Simulink data dictionary PvtParsCR_IF.sldd

CR_IF_CR_L_ObjID_1 = AUTOSAR4.Signal(SwCalibrationAccess="ReadOnly")
CR_IF_CR_L_ObjExistProb_1 = AUTOSAR4.Signal(SwCalibrationAccess="ReadOnly")
CR_IF_CR_L_ObjDistY_1 = AUTOSAR4.Signal(SwCalibrationAccess="ReadOnly")
CR_IF_CR_L_ObjDistX_1 = AUTOSAR4.Signal(SwCalibrationAccess="ReadOnly")
CR_IF_BlockCounter1_I = AUTOSAR4.Signal(SwCalibrationAccess="ReadOnly")
CR_IF_BlockCounter2_I = AUTOSAR4.Signal(SwCalibrationAccess="ReadOnly")
CR_IF_BlockCounter3_I = AUTOSAR4.Signal(SwCalibrationAccess="ReadOnly")
CR_IF_BlockCounter4_I = AUTOSAR4.Signal(SwCalibrationAccess="ReadOnly")
CR_IF_BlockCounter5_I = AUTOSAR4.Signal(SwCalibrationAccess="ReadOnly")
CR_IF_BlockCounter6_I = AUTOSAR4.Signal(SwCalibrationAccess="ReadOnly")
CR_IF_CR_BSW_CR_L_AD1 = AUTOSAR4.Signal(SwCalibrationAccess="ReadOnly")
CR_IF_CR_BSW_CR_L_AD2 = AUTOSAR4.Signal(SwCalibrationAccess="ReadOnly")
CR_IF_CR_BSW_CR_L_AD3 = AUTOSAR4.Signal(SwCalibrationAccess="ReadOnly")
CR_IF_CR_BSW_CR_R_AD1 = AUTOSAR4.Signal(SwCalibrationAccess="ReadOnly")
CR_IF_CR_BSW_CR_R_AD2 = AUTOSAR4.Signal(SwCalibrationAccess="ReadOnly")
CR_IF_CR_BSW_CR_R_AD3 = AUTOSAR4.Signal(SwCalibrationAccess="ReadOnly")
CR_IF_CR_DIAG_CR_L_AD1 = AUTOSAR4.Signal(SwCalibrationAccess="ReadOnly")
CR_IF_CR_DIAG_CR_L_AD2 = AUTOSAR4.Signal(SwCalibrationAccess="ReadOnly")
CR_IF_CR_DIAG_CR_L_AD3 = AUTOSAR4.Signal(SwCalibrationAccess="ReadOnly")
CR_IF_CR_DIAG_CR_R_AD1 = AUTOSAR4.Signal(SwCalibrationAccess="ReadOnly")
CR_IF_CR_DIAG_CR_R_AD2 = AUTOSAR4.Signal(SwCalibrationAccess="ReadOnly")
CR_IF_CR_DIAG_CR_R_AD3 = AUTOSAR4.Signal(SwCalibrationAccess="ReadOnly")
CR_IF_CR_L_ObjDistX_1_I = AUTOSAR4.Signal(SwCalibrationAccess="ReadOnly")
CR_IF_CR_L_ObjDistY_1_I = AUTOSAR4.Signal(SwCalibrationAccess="ReadOnly")
CR_IF_CR_L_ObjExistProb_1_I = AUTOSAR4.Signal(SwCalibrationAccess="ReadOnly")
CR_IF_CR_L_ObjID_1_I = AUTOSAR4.Signal(SwCalibrationAccess="ReadOnly")
CR_IF_CR_L_ObjObstacleProb_1_I = AUTOSAR4.Signal(SwCalibrationAccess="ReadOnly")
CR_IF_CR_L_ObjRelAccelX_1_I = AUTOSAR4.Signal(SwCalibrationAccess="ReadOnly")
CR_IF_CR_L_ObjRelAccelY_1_I = AUTOSAR4.Signal(SwCalibrationAccess="ReadOnly")
CR_IF_CR_L_ObjRelVelX_1_I = AUTOSAR4.Signal(SwCalibrationAccess="ReadOnly")
CR_IF_CR_L_ObjRelVelY_1_I = AUTOSAR4.Signal(SwCalibrationAccess="ReadOnly")
CR_IF_CR_L_VFC_ObjLength_1_I = AUTOSAR4.Signal(SwCalibrationAccess="ReadOnly")
CR_IF_CR_L_VFC_ObjWidth_1_I = AUTOSAR4.Signal(SwCalibrationAccess="ReadOnly")
CR_IF_CR_L_hdr_AutoSarTimeStamp_I = AUTOSAR4.Signal(SwCalibrationAccess="ReadOnly")
CR_IF_CR_L_hdr_ErrorStatus_I = AUTOSAR4.Signal(SwCalibrationAccess="ReadOnly")
CR_IF_CR_L_hdr_TimeStamp_I = AUTOSAR4.Signal(SwCalibrationAccess="ReadOnly")
CR_IF_CR_L_hdr_TimerStempStatus_I = AUTOSAR4.Signal(SwCalibrationAccess="ReadOnly")
CR_IF_CR_R_ObjDistX_1_I = AUTOSAR4.Signal(SwCalibrationAccess="ReadOnly")
CR_IF_CR_R_ObjDistY_1_I = AUTOSAR4.Signal(SwCalibrationAccess="ReadOnly")
CR_IF_CR_R_ObjExistProb_1_I = AUTOSAR4.Signal(SwCalibrationAccess="ReadOnly")
CR_IF_CR_R_ObjID_1_I = AUTOSAR4.Signal(SwCalibrationAccess="ReadOnly")
CR_IF_CR_R_ObjObstacleProb_1_I = AUTOSAR4.Signal(SwCalibrationAccess="ReadOnly")
CR_IF_CR_R_ObjRelAccelX_1_I = AUTOSAR4.Signal(SwCalibrationAccess="ReadOnly")
CR_IF_CR_R_ObjRelAccelY_1_I = AUTOSAR4.Signal(SwCalibrationAccess="ReadOnly")
CR_IF_CR_R_ObjRelVelX_1_I = AUTOSAR4.Signal(SwCalibrationAccess="ReadOnly")
CR_IF_CR_R_ObjRelVelY_1_I = AUTOSAR4.Signal(SwCalibrationAccess="ReadOnly")
CR_IF_CR_R_VFC_ObjLength_1_I = AUTOSAR4.Signal(SwCalibrationAccess="ReadOnly")
CR_IF_CR_R_VFC_ObjWidth_1_I = AUTOSAR4.Signal(SwCalibrationAccess="ReadOnly")
CR_IF_CR_R_hdr_AutoSarTimeStamp_I = AUTOSAR4.Signal(SwCalibrationAccess="ReadOnly")
CR_IF_CR_R_hdr_ErrorStatus_I = AUTOSAR4.Signal(SwCalibrationAccess="ReadOnly")
CR_IF_CR_R_hdr_TimeStamp_I = AUTOSAR4.Signal(SwCalibrationAccess="ReadOnly")
CR_IF_CR_R_hdr_TimerStempStatus_I = AUTOSAR4.Signal(SwCalibrationAccess="ReadOnly")
CR_CR_BSW_CR_L_AD1_IsUpdated = AUTOSAR4.Signal(SwCalibrationAccess="ReadOnly")
CR_CR_BSW_CR_L_AD2_IsUpdated = AUTOSAR4.Signal(SwCalibrationAccess="ReadOnly")
CR_CR_BSW_CR_L_AD3_IsUpdated = AUTOSAR4.Signal(SwCalibrationAccess="ReadOnly")
CR_CR_BSW_CR_R_AD1_IsUpdated = AUTOSAR4.Signal(SwCalibrationAccess="ReadOnly")
CR_CR_BSW_CR_R_AD2_IsUpdated = AUTOSAR4.Signal(SwCalibrationAccess="ReadOnly")
CR_CR_BSW_CR_R_AD3_IsUpdated = AUTOSAR4.Signal(SwCalibrationAccess="ReadOnly")
CR_CR_DIAG_IsUpdated = AUTOSAR4.Signal(SwCalibrationAccess="ReadOnly")
CR_IF_CR_R_hdr_TimeStamp = AUTOSAR4.Signal(SwCalibrationAccess="ReadOnly")
CR_IF_CR_R_hdr_TimerStempStatus = AUTOSAR4.Signal(SwCalibrationAccess="ReadOnly")
CR_IF_CR_R_hdr_ErrorStatus = AUTOSAR4.Signal(SwCalibrationAccess="ReadOnly")
CR_IF_CR_R_hdr_AutoSarTimeStamp = AUTOSAR4.Signal(SwCalibrationAccess="ReadOnly")
CR_IF_CR_L_hdr_TimeStamp = AUTOSAR4.Signal(SwCalibrationAccess="ReadOnly")
CR_IF_CR_L_hdr_TimerStempStatus = AUTOSAR4.Signal(SwCalibrationAccess="ReadOnly")
CR_IF_CR_L_hdr_ErrorStatus = AUTOSAR4.Signal(SwCalibrationAccess="ReadOnly")
CR_IF_CR_L_hdr_AutoSarTimeStamp = AUTOSAR4.Signal(SwCalibrationAccess="ReadOnly")
CR_IF_BlockCounter6 = AUTOSAR4.Signal(SwCalibrationAccess="ReadOnly")
CR_IF_BlockCounter5 = AUTOSAR4.Signal(SwCalibrationAccess="ReadOnly")
CR_IF_BlockCounter4 = AUTOSAR4.Signal(SwCalibrationAccess="ReadOnly")
CR_IF_BlockCounter3 = AUTOSAR4.Signal(SwCalibrationAccess="ReadOnly")
CR_IF_BlockCounter2 = AUTOSAR4.Signal(SwCalibrationAccess="ReadOnly")
CR_IF_BlockCounter1 = AUTOSAR4.Signal(SwCalibrationAccess="ReadOnly")
CR_IF_CR_R_VFC_ObjWidth_1 = AUTOSAR4.Signal(SwCalibrationAccess="ReadOnly")
CR_IF_CR_R_VFC_ObjLength_1 = AUTOSAR4.Signal(SwCalibrationAccess="ReadOnly")
CR_IF_CR_R_ObjRelVelY_1 = AUTOSAR4.Signal(SwCalibrationAccess="ReadOnly")
CR_IF_CR_R_ObjRelVelX_1 = AUTOSAR4.Signal(SwCalibrationAccess="ReadOnly")
CR_IF_CR_R_ObjRelAccelY_1 = AUTOSAR4.Signal(SwCalibrationAccess="ReadOnly")
CR_IF_CR_R_ObjRelAccelX_1 = AUTOSAR4.Signal(SwCalibrationAccess="ReadOnly")
CR_IF_CR_R_ObjObstacleProb_1 = AUTOSAR4.Signal(SwCalibrationAccess="ReadOnly")
CR_IF_CR_R_ObjID_1 = AUTOSAR4.Signal(SwCalibrationAccess="ReadOnly")
CR_IF_CR_R_ObjExistProb_1 = AUTOSAR4.Signal(SwCalibrationAccess="ReadOnly")
CR_IF_CR_R_ObjDistY_1 = AUTOSAR4.Signal(SwCalibrationAccess="ReadOnly")
CR_IF_CR_R_ObjDistX_1 = AUTOSAR4.Signal(SwCalibrationAccess="ReadOnly")
CR_IF_CR_L_VFC_ObjWidth_1 = AUTOSAR4.Signal(SwCalibrationAccess="ReadOnly")
CR_IF_CR_L_VFC_ObjLength_1 = AUTOSAR4.Signal(SwCalibrationAccess="ReadOnly")
CR_IF_CR_L_ObjRelVelY_1 = AUTOSAR4.Signal(SwCalibrationAccess="ReadOnly")
CR_IF_CR_L_ObjRelVelX_1 = AUTOSAR4.Signal(SwCalibrationAccess="ReadOnly")
CR_IF_CR_L_ObjRelAccelY_1 = AUTOSAR4.Signal(SwCalibrationAccess="ReadOnly")
CR_IF_CR_L_ObjRelAccelX_1 = AUTOSAR4.Signal(SwCalibrationAccess="ReadOnly")
CR_IF_CR_L_ObjObstacleProb_1 = AUTOSAR4.Signal(SwCalibrationAccess="ReadOnly")
CR_IF_DTC_missingCR_R_ERR = AUTOSAR4.Signal(SwCalibrationAccess="ReadOnly")
CR_IF_DTC_missingCR_L_ERR = AUTOSAR4.Signal(SwCalibrationAccess="ReadOnly")