% Simulink data dictionary PvtParsDMON.sldd

DMON_DTC_U120181_ECM_TRQ_INVALID_ERROR = AUTOSAR4.Signal(SwCalibrationAccess="ReadOnly", Unit="uint8")
DMON_DTC_U120281_ECM_BRK_PEDAL_INVALID_ERROR = AUTOSAR4.Signal(SwCalibrationAccess="ReadOnly", Unit="uint8")
DMON_DTC_U120481_ECM_START_STOP_STS_INVALID_ERROR = AUTOSAR4.Signal(SwCalibrationAccess="ReadOnly", Unit="uint8")
DMON_DTC_U120581_ECM_ACCEL_PEDAL_INVALID_ERROR = AUTOSAR4.Signal(SwCalibrationAccess="ReadOnly", Unit="uint8")
DMON_DTC_U140381_ECM_ENGINE_STATE_STALLING = AUTOSAR4.Signal(SwCalibrationAccess="ReadOnly", Unit="uint8")
DMON_DTC_U140181_ECMACCInterface_ERR = AUTOSAR4.Signal(SwCalibrationAccess="ReadOnly", Unit="uint8")
DMON_DTC_U120781_TCU_RAT_ACT_INVALID_ERROR = AUTOSAR4.Signal(SwCalibrationAccess="ReadOnly", Unit="uint8")
DMON_DTC_U120881_TCU_GEAR_INVALID_ERRO = AUTOSAR4.Signal(SwCalibrationAccess="ReadOnly", Unit="uint8")
DMON_DTC_U120981_TCU_DRV_FAIL_INVALID_ERROR = AUTOSAR4.Signal(SwCalibrationAccess="ReadOnly", Unit="uint8")
DMON_DTC_U122481_BCM_WIPR_REQ_INVALID_ERROR = AUTOSAR4.Signal(SwCalibrationAccess="ReadOnly", Unit="uint8")
DMON_DTC_U122581_AC_AMB_TEMP_INVALID_ERROR = AUTOSAR4.Signal(SwCalibrationAccess="ReadOnly", Unit="uint8")
DMON_DTC_U140481_EPS_TRQ_SNSR_STS_ABNORMAL = AUTOSAR4.Signal(SwCalibrationAccess="ReadOnly", Unit="uint8")
DMON_DTC_U122681_EPS_FAIL_STS_INVALID_ERROR = AUTOSAR4.Signal(SwCalibrationAccess="ReadOnly", Unit="uint8")
DMON_DTC_U122781_EPS_STEER_MOD_INVALID_ERROR = AUTOSAR4.Signal(SwCalibrationAccess="ReadOnly", Unit="uint8")
DMON_DTC_U122981_EPS_Inhibit = AUTOSAR4.Signal(SwCalibrationAccess="ReadOnly", Unit="uint8")
DMON_DTC_U122881_EPS_LKA_TORQ_FAIL = AUTOSAR4.Signal(SwCalibrationAccess="ReadOnly", Unit="uint8")
DMON_DTC_U123081_CSA_FRNT_WIPR_SWT_INVALID_ERROR = AUTOSAR4.Signal(SwCalibrationAccess="ReadOnly", Unit="uint8")
DMON_DTC_U123281_CSA_SAS_STS_ERROR = AUTOSAR4.Signal(SwCalibrationAccess="ReadOnly", Unit="uint8")
DMON_DTC_U123381_CSA_ACC_SWT_ERROR = AUTOSAR4.Signal(SwCalibrationAccess="ReadOnly", Unit="uint8")
DMON_DTC_U30BA81_ABM_YAWRATE_INVALID_ERROR = AUTOSAR4.Signal(SwCalibrationAccess="ReadOnly", Unit="uint8")
DMON_DTC_U31A281_ABM_VEH_ACCEL_INVALID_ERROR = AUTOSAR4.Signal(SwCalibrationAccess="ReadOnly", Unit="uint8")
DMON_DTC_U123681_HUT_IFC_SNVTY_INVALID_ERROR = AUTOSAR4.Signal(SwCalibrationAccess="ReadOnly", Unit="uint8")
DMON_DTC_U123781_HUT_LSS_WARN_FORM_SWT_INVALID_ERROR = AUTOSAR4.Signal(SwCalibrationAccess="ReadOnly", Unit="uint8")
DMON_DTC_U123881_HUT_FCW_SNVTY_INVALID_ERROR = AUTOSAR4.Signal(SwCalibrationAccess="ReadOnly", Unit="uint8")
DMON_DTC_U123981_HUT_TSR_SNVTY_INVALID_ERROR = AUTOSAR4.Signal(SwCalibrationAccess="ReadOnly", Unit="uint8")
DMON_DTC_U124181_HUT_SPD_LIM_INVALID_ERROR = AUTOSAR4.Signal(SwCalibrationAccess="ReadOnly", Unit="uint8")
DMON_DTC_U124381_HUT_IP_ERROR = AUTOSAR4.Signal(SwCalibrationAccess="ReadOnly", Unit="uint8")
DMON_DTC_U15E081_CR_ERR = AUTOSAR4.Signal(SwCalibrationAccess="ReadOnly", Unit="uint8")
DMON_DTC_U140681_CR_R_ObjInfo_Out_of_Range = AUTOSAR4.Signal(SwCalibrationAccess="ReadOnly", Unit="uint8")
DMON_DTC_U024181_HC1_FAILURE_ERROR = AUTOSAR4.Signal(SwCalibrationAccess="ReadOnly", Unit="uint8")
DMON_DTC_U124481_RSDS_TAR_INVALID_ERROR = AUTOSAR4.Signal(SwCalibrationAccess="ReadOnly", Unit="uint8")
DMON_DTC_U125281_ESP_WHEEL_SPD_DIRECTION_INVALID_ERROR = AUTOSAR4.Signal(SwCalibrationAccess="ReadOnly", Unit="uint8")
DMON_DTC_U121081_ESP_WHEEL_SPD_INVALID_ERROR = AUTOSAR4.Signal(SwCalibrationAccess="ReadOnly", Unit="uint8")
DMON_DTC_U121281_ESP_VEH_SPD_INVALID_ERROR = AUTOSAR4.Signal(SwCalibrationAccess="ReadOnly", Unit="uint8")
DMON_DTC_U121681_ESP_VEH_STANDSTILL_INVALID_ERROR = AUTOSAR4.Signal(SwCalibrationAccess="ReadOnly", Unit="uint8")
DMON_DTC_U121481_ESP_EPB_INVALID_ERROR = AUTOSAR4.Signal(SwCalibrationAccess="ReadOnly", Unit="uint8")
DMON_DTC_U121581_ESP_MASTER_CYL_PRESS_INVALID_ERROR = AUTOSAR4.Signal(SwCalibrationAccess="ReadOnly", Unit="uint8")
DMON_DTC_U121781_ESP_HDC_CTRL_INVALID_ERROR = AUTOSAR4.Signal(SwCalibrationAccess="ReadOnly", Unit="uint8")
DMON_DTC_U121881_ESP_DRIVING_MOD_DIS_INVALID_ERROR = AUTOSAR4.Signal(SwCalibrationAccess="ReadOnly", Unit="uint8")
DMON_DTC_C150250_CR_L_ERROR = AUTOSAR4.Signal(SwCalibrationAccess="ReadOnly", Unit="uint8")
DMON_DTC_C150350_CR_R_ERROR = AUTOSAR4.Signal(SwCalibrationAccess="ReadOnly", Unit="uint8")
DMON_DTC_C150450_RSDS_L_ERROR = AUTOSAR4.Signal(SwCalibrationAccess="ReadOnly", Unit="uint8")
DMON_DTC_C150550_RSDS_L_ERROR = AUTOSAR4.Signal(SwCalibrationAccess="ReadOnly", Unit="uint8")
DMON_DTC_U121981_ESP_ABS_FAIL_STS_ERROR = AUTOSAR4.Signal(SwCalibrationAccess="ReadOnly", Unit="uint8")
DMON_DTC_U122281_ESP_ESP_FAIL_STS_ERROR = AUTOSAR4.Signal(SwCalibrationAccess="ReadOnly", Unit="uint8")
DMON_DTC_U122381_ESP_Available_ERR = AUTOSAR4.Signal(SwCalibrationAccess="ReadOnly", Unit="uint8")
DMON_DTC_U140081_ESP_CDD_AVAILABLE_ERROR = AUTOSAR4.Signal(SwCalibrationAccess="ReadOnly", Unit="uint8")
DMON_DTC_U123581_APS_WORK_ST_INVALID_ERROR = AUTOSAR4.Signal(SwCalibrationAccess="ReadOnly", Unit="uint8")
DMON_DTC_U110017_Over_voltage_ERROR = AUTOSAR4.Signal(SwCalibrationAccess="ReadOnly", Unit="uint8")
DMON_DTC_U110116_Under_voltage_ERROR = AUTOSAR4.Signal(SwCalibrationAccess="ReadOnly", Unit="uint8")
DMON_DTC_U02B381_DMS_TIMEOUT_ERROR1 = AUTOSAR4.Signal(SwCalibrationAccess="ReadOnly", Unit="uint8")
DMON_DTC_U123181_CSA_STEER_WHEEL_INVALID_ERROR = AUTOSAR4.Signal(SwCalibrationAccess="ReadOnly", Unit="uint8")
P_DMONDrvEngTrqReqVld = AUTOSAR4.Parameter(0, SwCalibrationAccess="ReadWrite", DataType="uint8")
P_DMONDrvEngTrqReqVld_Enable = AUTOSAR4.Parameter(0, SwCalibrationAccess="ReadWrite", DataType="boolean")
P_DMONEngSpdVldty = AUTOSAR4.Parameter(0, SwCalibrationAccess="ReadWrite", DataType="uint8")
P_DMONEngSpdVldty_Enable = AUTOSAR4.Parameter(0, SwCalibrationAccess="ReadWrite", DataType="boolean")
P_DMONTrqLossVldty = AUTOSAR4.Parameter(0, SwCalibrationAccess="ReadWrite", DataType="uint8")
P_DMONTrqLossVldty_Enable = AUTOSAR4.Parameter(0, SwCalibrationAccess="ReadWrite", DataType="boolean")
P_DMONVolt = AUTOSAR4.Parameter(0, SwCalibrationAccess="ReadWrite", DataType="uint8")
P_DMON_Volt_Enable = AUTOSAR4.Parameter(0, SwCalibrationAccess="ReadWrite", DataType="boolean")
DMON_LSMCnt = AUTOSAR4.Signal(SwCalibrationAccess="ReadOnly", DataType="boolean")
DMON_OFMCnt = AUTOSAR4.Signal(SwCalibrationAccess="ReadOnly", DataType="boolean")
DMON_RFMCnt = AUTOSAR4.Signal(SwCalibrationAccess="ReadOnly", DataType="boolean")
DMON_TOSCnt = AUTOSAR4.Signal(SwCalibrationAccess="ReadOnly", DataType="boolean")
DIAG_EHR_PosiTimOutFailure = Simulink.Parameter(0, DataType="uint8")
DIAG_EHR_PosiCycCntFailure = Simulink.Parameter(0, DataType="uint8")
DIAG_EHR_MetaTimOutFailure = Simulink.Parameter(0, DataType="uint8")
DIAG_EHR_MetaCycCntFailure = Simulink.Parameter(0, DataType="uint8")
DIAG_DEM_GetSet = Simulink.Parameter(0, DataType="uint8")
Camera_BlockageSts = Simulink.Parameter(0, DataType="uint8")
IFC_CalibrationSts = Simulink.Parameter(0, DataType="uint8")
DMON_DTC_U31A081_EngSpdVldty_ERR = AUTOSAR4.Signal(SwCalibrationAccess="ReadOnly", Unit="uint8")
DTC_missingRSDS_ERR = AUTOSAR4.Signal(SwCalibrationAccess="ReadOnly", Unit="uint8")
DTC_MissingECM_ERR = AUTOSAR4.Signal(SwCalibrationAccess="ReadOnly", Unit="uint8")
DTC_PHEVMissingECM_ERR = AUTOSAR4.Signal(SwCalibrationAccess="ReadOnly", Unit="uint8")
DTC_HCCANmissingHCU_ERR = AUTOSAR4.Signal(SwCalibrationAccess="ReadOnly", Unit="uint8")
DTC_HCUChecksum_ERR = AUTOSAR4.Signal(SwCalibrationAccess="ReadOnly", Unit="uint8")
DTC_HCURollingcounter_ERR = AUTOSAR4.Signal(SwCalibrationAccess="ReadOnly", Unit="uint8")
DTC_MissingTCU_PTCAN_ERR = AUTOSAR4.Signal(SwCalibrationAccess="ReadOnly", Unit="uint8")
DTC_MissingESP_ABS_ERR = AUTOSAR4.Signal(SwCalibrationAccess="ReadOnly", Unit="uint8")
DTC_MissingESP_FD3_ERR = AUTOSAR4.Signal(SwCalibrationAccess="ReadOnly", Unit="uint8")
DTC_MissingEPS_ERR = AUTOSAR4.Signal(SwCalibrationAccess="ReadOnly", Unit="uint8")
DTC_MissingDBCM_BCM1_ERR = AUTOSAR4.Signal(SwCalibrationAccess="ReadOnly", Unit="uint8")
DTC_MissingDBCM_BCM3_ERR = AUTOSAR4.Signal(SwCalibrationAccess="ReadOnly", Unit="uint8")
DTC_MissingDBCM_BCM8_ERR = AUTOSAR4.Signal(SwCalibrationAccess="ReadOnly", Unit="uint8")
DTC_MissingAC_ERR = AUTOSAR4.Signal(SwCalibrationAccess="ReadOnly", Unit="uint8")
DTC_MissingFrontPowerBox_ERR = AUTOSAR4.Signal(SwCalibrationAccess="ReadOnly", Unit="uint8")
DTC_MissingCSA1_ERR = AUTOSAR4.Signal(SwCalibrationAccess="ReadOnly", Unit="uint8")
DTC_MissingCSA2_ERR = AUTOSAR4.Signal(SwCalibrationAccess="ReadOnly", Unit="uint8")
DTC_MissingRearPowerBox_ERR = AUTOSAR4.Signal(SwCalibrationAccess="ReadOnly", Unit="uint8")
DTC_Missing_ABM1_ERR = AUTOSAR4.Signal(SwCalibrationAccess="ReadOnly", Unit="uint8")
DTC_Missing_ABM2_ERR = AUTOSAR4.Signal(SwCalibrationAccess="ReadOnly", Unit="uint8")
DTC_missingAVM_ERR = AUTOSAR4.Signal(SwCalibrationAccess="ReadOnly", Unit="uint8")
DTC_missingHU_IP3_ERR = AUTOSAR4.Signal(SwCalibrationAccess="ReadOnly", Unit="uint8")
DTC_missing_HUT_FD2_ERR = AUTOSAR4.Signal(SwCalibrationAccess="ReadOnly", Unit="uint8")
DTC_missing_HUT19_ERR = AUTOSAR4.Signal(SwCalibrationAccess="ReadOnly", Unit="uint8")
DTC_TBOX_FD4_TIMEOUT_ERR = AUTOSAR4.Signal(SwCalibrationAccess="ReadOnly", Unit="uint8")
DTC_LostCommuWithFrntLight_ERR = AUTOSAR4.Signal(SwCalibrationAccess="ReadOnly", Unit="uint8")
DTC_CheckSum_HC2_ERR = AUTOSAR4.Signal(SwCalibrationAccess="ReadOnly", Unit="uint8")
DTC_HC2_RollingCounter_ERR = AUTOSAR4.Signal(SwCalibrationAccess="ReadOnly", Unit="uint8")
DTC_DMS_TimeOut_ERR = AUTOSAR4.Signal(SwCalibrationAccess="ReadOnly", Unit="uint8")
DTC_CheckSum_DMS_FD2_ERR = AUTOSAR4.Signal(SwCalibrationAccess="ReadOnly", Unit="uint8")
DTC_CheckSum_ECM_FD_ERR = AUTOSAR4.Signal(SwCalibrationAccess="ReadOnly", Unit="uint8")
DTC_CheckSum_DCT_FD4_ERR = AUTOSAR4.Signal(SwCalibrationAccess="ReadOnly", Unit="uint8")
DTC_ESP_ABS_CheckSum_ERR = AUTOSAR4.Signal(SwCalibrationAccess="ReadOnly", Unit="uint8")
DTC_ESP_EPB_CheckSum_ERR = AUTOSAR4.Signal(SwCalibrationAccess="ReadOnly", Unit="uint8")
DTC_CheckSum_DCT_FD3_ERR = AUTOSAR4.Signal(SwCalibrationAccess="ReadOnly", Unit="uint8")
DTC_ESP_CheckSum_ESP1_ERR = AUTOSAR4.Signal(SwCalibrationAccess="ReadOnly", Unit="uint8")
DTC_ESP_CheckSum_ESP2_ERR = AUTOSAR4.Signal(SwCalibrationAccess="ReadOnly", Unit="uint8")
DTC_EPS_CHECKSUM_ERR = AUTOSAR4.Signal(SwCalibrationAccess="ReadOnly", Unit="uint8")
DTC_CSA_CheckSum_ERR = AUTOSAR4.Signal(SwCalibrationAccess="ReadOnly", Unit="uint8")
DTC_ABM_CheckSum_ABM1_ERR = AUTOSAR4.Signal(SwCalibrationAccess="ReadOnly", Unit="uint8")
DTC_RSDS_R_CheckSum_ERR = AUTOSAR4.Signal(SwCalibrationAccess="ReadOnly", Unit="uint8")
DTC_RollingCounter_DMS_FD2_ERR = AUTOSAR4.Signal(SwCalibrationAccess="ReadOnly", Unit="uint8")
DTC_RollingCounter_ECM_FD_ERR = AUTOSAR4.Signal(SwCalibrationAccess="ReadOnly", Unit="uint8")
DTC_DCT_RollingCounter_ERR = AUTOSAR4.Signal(SwCalibrationAccess="ReadOnly", Unit="uint8")
DTC_ESP_ABS_RollingCounter_ERR = AUTOSAR4.Signal(SwCalibrationAccess="ReadOnly", Unit="uint8")
DTC_ESP_EPB_RollingCounter_ERR = AUTOSAR4.Signal(SwCalibrationAccess="ReadOnly", Unit="uint8")
DTC_ESP_RollingCounter_ESP1_ERR = AUTOSAR4.Signal(SwCalibrationAccess="ReadOnly", Unit="uint8")
DTC_ESP_RollingCounter_ESP2_ERR = AUTOSAR4.Signal(SwCalibrationAccess="ReadOnly", Unit="uint8")
DTC_EPS_RollingCounter_ERR = AUTOSAR4.Signal(SwCalibrationAccess="ReadOnly", Unit="uint8")
DTC_CSA_RollingCounter_ERR = AUTOSAR4.Signal(SwCalibrationAccess="ReadOnly", Unit="uint8")
DTC_ABM_RollingCounter_ABM1_ERR = AUTOSAR4.Signal(SwCalibrationAccess="ReadOnly", Unit="uint8")
DTC_ABM_RollingCounter_ABM2_ERR = AUTOSAR4.Signal(SwCalibrationAccess="ReadOnly", Unit="uint8")
DTC_HUT_ADAS_CycCnt_ERR = AUTOSAR4.Signal(SwCalibrationAccess="ReadOnly", Unit="uint8")
DTC_missingMRR_ERR = AUTOSAR4.Signal(SwCalibrationAccess="ReadOnly", Unit="uint8")
DTC_missingCR_L_ERR = AUTOSAR4.Signal(SwCalibrationAccess="ReadOnly", Unit="uint8")
DTC_missingCR_R_ERR = AUTOSAR4.Signal(SwCalibrationAccess="ReadOnly", Unit="uint8")
DTC_missingRSDS_L_ERR = AUTOSAR4.Signal(SwCalibrationAccess="ReadOnly", Unit="uint8")
DTC_missingRSDS_R_ERR = AUTOSAR4.Signal(SwCalibrationAccess="ReadOnly", Unit="uint8")
DTC_MRR_CheckSum_ERR = AUTOSAR4.Signal(SwCalibrationAccess="ReadOnly", Unit="uint8")
DTC_CR_FL_CheckSum_ERR = AUTOSAR4.Signal(SwCalibrationAccess="ReadOnly", Unit="uint8")
DTC_CR_FR_CheckSum_ERR = AUTOSAR4.Signal(SwCalibrationAccess="ReadOnly", Unit="uint8")
DTC_CR_RL_CheckSum_ERR = AUTOSAR4.Signal(SwCalibrationAccess="ReadOnly", Unit="uint8")
DTC_CR_RR_CheckSum_ERR = AUTOSAR4.Signal(SwCalibrationAccess="ReadOnly", Unit="uint8")
DTC_MRR_RollingCounter_ERR = AUTOSAR4.Signal(SwCalibrationAccess="ReadOnly", Unit="uint8")
DTC_CR_L_RollingCounter_ERR = AUTOSAR4.Signal(SwCalibrationAccess="ReadOnly", Unit="uint8")
DTC_CR_R_RollingCounter_ERR = AUTOSAR4.Signal(SwCalibrationAccess="ReadOnly", Unit="uint8")
DTC_RSDS_L_RollingCounter_ERR = AUTOSAR4.Signal(SwCalibrationAccess="ReadOnly", Unit="uint8")
DTC_RSDS_R_RollingCounter_ERR = AUTOSAR4.Signal(SwCalibrationAccess="ReadOnly", Unit="uint8")
DTC_ABM_CheckSum_ABM2_ERR = AUTOSAR4.Signal(SwCalibrationAccess="ReadOnly", Unit="uint8")
DTC_RSDS_FD2_RollingCounter_ERR = AUTOSAR4.Signal(SwCalibrationAccess="ReadOnly", Unit="uint8")
DMON_DTC_C150150_MRR_ERROR = AUTOSAR4.Signal(SwCalibrationAccess="ReadOnly")
DMON_InPutVoltage = AUTOSAR4.Signal(SwCalibrationAccess="ReadOnly")
DMON_DTC_ABM_CheckSum_ABM1_ERR = AUTOSAR4.Signal(SwCalibrationAccess="ReadOnly")
DMON_DTC_ABM_CheckSum_ABM2_ERR = AUTOSAR4.Signal(SwCalibrationAccess="ReadOnly")
DMON_DTC_ABM_RollingCounter_ABM1_ERR = AUTOSAR4.Signal(SwCalibrationAccess="ReadOnly")
DMON_DTC_ABM_RollingCounter_ABM2_ERR = AUTOSAR4.Signal(SwCalibrationAccess="ReadOnly")
DMON_DTC_CheckSum_DCT_FD3_ERR = AUTOSAR4.Signal(SwCalibrationAccess="ReadOnly")
DMON_DTC_CheckSum_DCT_FD4_ERR = AUTOSAR4.Signal(SwCalibrationAccess="ReadOnly")
DMON_DTC_CheckSum_ECM_FD_ERR = AUTOSAR4.Signal(SwCalibrationAccess="ReadOnly")
DMON_DTC_CheckSum_HC2_ERR = AUTOSAR4.Signal(SwCalibrationAccess="ReadOnly")
DMON_DTC_CR_FL_CheckSum_ERR = AUTOSAR4.Signal(SwCalibrationAccess="ReadOnly")
DMON_DTC_CR_FR_CheckSum_ERR = AUTOSAR4.Signal(SwCalibrationAccess="ReadOnly")
DMON_DTC_CR_L_RollingCounter_ERR = AUTOSAR4.Signal(SwCalibrationAccess="ReadOnly")
DMON_DTC_CR_R_RollingCounter_ERR = AUTOSAR4.Signal(SwCalibrationAccess="ReadOnly")
DMON_DTC_CSA_CheckSum_ERR = AUTOSAR4.Signal(SwCalibrationAccess="ReadOnly")
DMON_DTC_CSA_RollingCounter_ERR = AUTOSAR4.Signal(SwCalibrationAccess="ReadOnly")
DMON_DTC_DCT_RollingCounter_ERR = AUTOSAR4.Signal(SwCalibrationAccess="ReadOnly")
DMON_DTC_DMS_TimeOut_ERR = AUTOSAR4.Signal(SwCalibrationAccess="ReadOnly")
DMON_DTC_EPS_CHECKSUM_ERR = AUTOSAR4.Signal(SwCalibrationAccess="ReadOnly")
DMON_DTC_EPS_RollingCounter_ERR = AUTOSAR4.Signal(SwCalibrationAccess="ReadOnly")
DMON_DTC_ESP_ABS_CheckSum_ERR = AUTOSAR4.Signal(SwCalibrationAccess="ReadOnly")
DMON_DTC_ESP_ABS_RollingCounter_ERR = AUTOSAR4.Signal(SwCalibrationAccess="ReadOnly")
DMON_DTC_ESP_CheckSum_ESP1_ERR = AUTOSAR4.Signal(SwCalibrationAccess="ReadOnly")
DMON_DTC_ESP_CheckSum_ESP2_ERR = AUTOSAR4.Signal(SwCalibrationAccess="ReadOnly")
DMON_DTC_ESP_EPB_CheckSum_ERR = AUTOSAR4.Signal(SwCalibrationAccess="ReadOnly")
DMON_DTC_ESP_EPB_RollingCounter_ERR = AUTOSAR4.Signal(SwCalibrationAccess="ReadOnly")
DMON_DTC_ESP_RollingCounter_ESP1_ERR = AUTOSAR4.Signal(SwCalibrationAccess="ReadOnly")
DMON_DTC_ESP_RollingCounter_ESP2_ERR = AUTOSAR4.Signal(SwCalibrationAccess="ReadOnly")
DMON_DTC_HC2_RollingCounter_ERR = AUTOSAR4.Signal(SwCalibrationAccess="ReadOnly")
DMON_DTC_HCCANmissingHCU_ERR = AUTOSAR4.Signal(SwCalibrationAccess="ReadOnly")
DMON_DTC_HCUChecksum_ERR = AUTOSAR4.Signal(SwCalibrationAccess="ReadOnly")
DMON_DTC_HCURollingcounter_ERR = AUTOSAR4.Signal(SwCalibrationAccess="ReadOnly")
DMON_DTC_HUT_ADAS_CycCnt_ERR = AUTOSAR4.Signal(SwCalibrationAccess="ReadOnly")
DMON_DTC_LostCommuWithFrntLight_ERR = AUTOSAR4.Signal(SwCalibrationAccess="ReadOnly")
DMON_DTC_Missing_ABM1_ERR = AUTOSAR4.Signal(SwCalibrationAccess="ReadOnly")
DMON_DTC_Missing_ABM2_ERR = AUTOSAR4.Signal(SwCalibrationAccess="ReadOnly")
DMON_DTC_missing_HUT_FD2_ERR = AUTOSAR4.Signal(SwCalibrationAccess="ReadOnly")
DMON_DTC_missing_HUT19_ERR = AUTOSAR4.Signal(SwCalibrationAccess="ReadOnly")
DMON_DTC_MissingAC_ERR = AUTOSAR4.Signal(SwCalibrationAccess="ReadOnly")
DMON_DTC_missingAVM_ERR = AUTOSAR4.Signal(SwCalibrationAccess="ReadOnly")
DMON_DTC_missingCR_L_ERR = AUTOSAR4.Signal(SwCalibrationAccess="ReadOnly")
DMON_DTC_missingCR_R_ERR = AUTOSAR4.Signal(SwCalibrationAccess="ReadOnly")
DMON_DTC_MissingCSA1_ERR = AUTOSAR4.Signal(SwCalibrationAccess="ReadOnly")
DMON_DTC_MissingCSA2_ERR = AUTOSAR4.Signal(SwCalibrationAccess="ReadOnly")
DMON_DTC_MissingDBCM_BCM1_ERR = AUTOSAR4.Signal(SwCalibrationAccess="ReadOnly")
DMON_DTC_MissingDBCM_BCM3_ERR = AUTOSAR4.Signal(SwCalibrationAccess="ReadOnly")
DMON_DTC_MissingDBCM_BCM8_ERR = AUTOSAR4.Signal(SwCalibrationAccess="ReadOnly")
DMON_DTC_MissingECM_ERR = AUTOSAR4.Signal(SwCalibrationAccess="ReadOnly")
DMON_DTC_MissingEPS_ERR = AUTOSAR4.Signal(SwCalibrationAccess="ReadOnly")
DMON_DTC_MissingESP_ABS_ERR = AUTOSAR4.Signal(SwCalibrationAccess="ReadOnly")
DMON_DTC_MissingESP_FD3_ERR = AUTOSAR4.Signal(SwCalibrationAccess="ReadOnly")
DMON_DTC_MissingFrontPowerBox_ERR = AUTOSAR4.Signal(SwCalibrationAccess="ReadOnly")
DMON_DTC_missingHU_IP3_ERR = AUTOSAR4.Signal(SwCalibrationAccess="ReadOnly")
DMON_DTC_missingMRR_ERR = AUTOSAR4.Signal(SwCalibrationAccess="ReadOnly")
DMON_DTC_MissingRearPowerBox_ERR = AUTOSAR4.Signal(SwCalibrationAccess="ReadOnly")
DMON_DTC_missingRSDS_ERR = AUTOSAR4.Signal(SwCalibrationAccess="ReadOnly")
DMON_DTC_missingRSDS_L_ERR = AUTOSAR4.Signal(SwCalibrationAccess="ReadOnly")
DMON_DTC_missingRSDS_R_ERR = AUTOSAR4.Signal(SwCalibrationAccess="ReadOnly")

DMON_DTC_MissingTCU_PTCAN_ERR = AUTOSAR4.Signal(SwCalibrationAccess="ReadOnly")
DMON_DTC_MRR_CheckSum_ERR = AUTOSAR4.Signal(SwCalibrationAccess="ReadOnly")
DMON_DTC_MRR_RollingCounter_ERR = AUTOSAR4.Signal(SwCalibrationAccess="ReadOnly")
DMON_DTC_PHEVMissingECM_ERR = AUTOSAR4.Signal(SwCalibrationAccess="ReadOnly")
DMON_DTC_RollingCounter_DMS_FD2_ERR = AUTOSAR4.Signal(SwCalibrationAccess="ReadOnly")
DMON_DTC_RollingCounter_ECM_FD_ERR = AUTOSAR4.Signal(SwCalibrationAccess="ReadOnly")
DMON_DTC_RSDS_FD2_RollingCounter_ERR = AUTOSAR4.Signal(SwCalibrationAccess="ReadOnly")
DMON_DTC_RSDS_L_RollingCounter_ERR = AUTOSAR4.Signal(SwCalibrationAccess="ReadOnly")
DMON_DTC_RSDS_R_CheckSum_ERR = AUTOSAR4.Signal(SwCalibrationAccess="ReadOnly")
DMON_DTC_RSDS_R_RollingCounter_ERR = AUTOSAR4.Signal(SwCalibrationAccess="ReadOnly")
DMON_DTC_TBOX_FD4_TIMEOUT_ERR = AUTOSAR4.Signal(SwCalibrationAccess="ReadOnly")
DMON_DTC_CR_RL_CheckSum_ERR = AUTOSAR4.Signal(SwCalibrationAccess="ReadOnly")
DMON_DTC_CR_RR_CheckSum_ERR = AUTOSAR4.Signal(SwCalibrationAccess="ReadOnly")
P_DMON_EnableCond = AUTOSAR4.Parameter(1, SwCalibrationAccess="ReadWrite", DataType="uint8")
P_DMON_IsUpdatedTestPassCount = AUTOSAR4.Parameter(1999, SwCalibrationAccess="ReadWrite", DataType="uint16")
P_DMON_IsUpdatedTestFailCount = AUTOSAR4.Parameter(1999, SwCalibrationAccess="ReadWrite", DataType="uint16")
DFIM_DFIM_VSM_STS = AUTOSAR4.Signal(SwCalibrationAccess="ReadOnly")
DFIM_DFIM_AHBC_STS = AUTOSAR4.Signal(SwCalibrationAccess="ReadOnly")
DFIM_DFIM_AEB_STS = AUTOSAR4.Signal(SwCalibrationAccess="ReadOnly")
DMON_DMON_SENS_ERR = AUTOSAR4.Signal(SwCalibrationAccess="ReadOnly")
DMON_DMON_EHR_ERR = AUTOSAR4.Signal(SwCalibrationAccess="ReadOnly")
DMON_DTC_DCU_OverVoltage_ERR = AUTOSAR4.Signal(SwCalibrationAccess="ReadOnly")
DMON_DTC_DCU_UnderVoltage_ERR = AUTOSAR4.Signal(SwCalibrationAccess="ReadOnly")
DMON_DTC_HC_BeamFailSts_ERR = AUTOSAR4.Signal(SwCalibrationAccess="ReadOnly")
DMON_DTC_DMS_DriverSts_ERR = AUTOSAR4.Signal(SwCalibrationAccess="ReadOnly")
DMON_DTC_RSDS_TargetSignal_ERR = AUTOSAR4.Signal(SwCalibrationAccess="ReadOnly")
DMON_DTC_ECM_TorqueSignal_ERR = AUTOSAR4.Signal(SwCalibrationAccess="ReadOnly")
DMON_DTC_ECM_EngSpdVldty_ERR = AUTOSAR4.Signal(SwCalibrationAccess="ReadOnly")
DMON_DTC_ECM_BrkPedalSig_ERR = AUTOSAR4.Signal(SwCalibrationAccess="ReadOnly")
DMON_DTC_ECM_StartStopSts_ERR = AUTOSAR4.Signal(SwCalibrationAccess="ReadOnly")
DMON_DTC_ECM_AccelPedalPosnVldty_ERR = AUTOSAR4.Signal(SwCalibrationAccess="ReadOnly")
DMON_DTC_ECM_EngStateStalling_ERR = AUTOSAR4.Signal(SwCalibrationAccess="ReadOnly")
DMON_DTC_ECM_ACCInterface_ERR = AUTOSAR4.Signal(SwCalibrationAccess="ReadOnly")
DMON_DTC_TCU_RatActSts_ERR = AUTOSAR4.Signal(SwCalibrationAccess="ReadOnly")
DMON_DTC_TCU_GearSig_ERR = AUTOSAR4.Signal(SwCalibrationAccess="ReadOnly")
DMON_DTC_TCU_DrvFaiMsg_ERR = AUTOSAR4.Signal(SwCalibrationAccess="ReadOnly")
DMON_DTC_ESP_WheelDriveDirection_ERR = AUTOSAR4.Signal(SwCalibrationAccess="ReadOnly")
DMON_DTC_ESP_WheelSpdVld_ERR = AUTOSAR4.Signal(SwCalibrationAccess="ReadOnly")
DMON_DTC_ESP_VehSpdVld_ERR = AUTOSAR4.Signal(SwCalibrationAccess="ReadOnly")
DMON_DTC_ESP_VehStandstill_ERR = AUTOSAR4.Signal(SwCalibrationAccess="ReadOnly")
DMON_DTC_ESP_EPBSignal_ERR = AUTOSAR4.Signal(SwCalibrationAccess="ReadOnly")
DMON_DTC_ESP_MasterCylBrkPressVld_ERR = AUTOSAR4.Signal(SwCalibrationAccess="ReadOnly")
DMON_DTC_ESP_HDCCtrl_ERR = AUTOSAR4.Signal(SwCalibrationAccess="ReadOnly")
DMON_DTC_ESP_DrivingModDis_ERR = AUTOSAR4.Signal(SwCalibrationAccess="ReadOnly")
DMON_DTC_ESP_ABSFailSts_ERR = AUTOSAR4.Signal(SwCalibrationAccess="ReadOnly")
DMON_DTC_ESP_ESPFailSts_ERR = AUTOSAR4.Signal(SwCalibrationAccess="ReadOnly")
DMON_DTC_ESP_ESP_Available_ERR = AUTOSAR4.Signal(SwCalibrationAccess="ReadOnly")
DMON_DTC_ESP_CDDAvailable_ERR = AUTOSAR4.Signal(SwCalibrationAccess="ReadOnly")
DMON_DTC_BCM_WiprReq_F_PBOX_ERR = AUTOSAR4.Signal(SwCalibrationAccess="ReadOnly")
DMON_DTC_AC_ACAmbTemp_ERR = AUTOSAR4.Signal(SwCalibrationAccess="ReadOnly")
DMON_DTC_EPS_TrqSnsrSts_ERR = AUTOSAR4.Signal(SwCalibrationAccess="ReadOnly")
DMON_DTC_EPS_FailSts_ERR = AUTOSAR4.Signal(SwCalibrationAccess="ReadOnly")
DMON_DTC_EPS_LKA_Torq_ERR = AUTOSAR4.Signal(SwCalibrationAccess="ReadOnly")
DMON_DTC_CSA_FrntWiprSwtSts_ERR = AUTOSAR4.Signal(SwCalibrationAccess="ReadOnly")
DMON_DTC_CSA_SteerWheel_ERR = AUTOSAR4.Signal(SwCalibrationAccess="ReadOnly")
DMON_DTC_CSA_SAS_Sts_ERR = AUTOSAR4.Signal(SwCalibrationAccess="ReadOnly")
DMON_DTC_CSA_ACCSwtErr_ERR = AUTOSAR4.Signal(SwCalibrationAccess="ReadOnly")
DMON_DTC_ABM_VehYawRate_ERR = AUTOSAR4.Signal(SwCalibrationAccess="ReadOnly")
DMON_DTC_ABM_VehLgtAccel_ERR = AUTOSAR4.Signal(SwCalibrationAccess="ReadOnly")
DMON_DTC_APS_WorkSts_ERR = AUTOSAR4.Signal(SwCalibrationAccess="ReadOnly")
DMON_DTC_HUT_IFC_SnvtySet_ERR = AUTOSAR4.Signal(SwCalibrationAccess="ReadOnly")
DMON_DTC_HUT_LSSWarnFormSwtReq_ERR = AUTOSAR4.Signal(SwCalibrationAccess="ReadOnly")
DMON_DTC_HUT_FCW_SnvtySet_ERR = AUTOSAR4.Signal(SwCalibrationAccess="ReadOnly")
DMON_DTC_HUT_TSR_SnvtySet_ERR = AUTOSAR4.Signal(SwCalibrationAccess="ReadOnly")
DMON_DTC_HUT_NavSpdLimValue_ERR = AUTOSAR4.Signal(SwCalibrationAccess="ReadOnly")
DMON_DTC_HUT_IP_ERR = AUTOSAR4.Signal(SwCalibrationAccess="ReadOnly")
DMON_DTC_CR_ERR = AUTOSAR4.Signal(SwCalibrationAccess="ReadOnly")
DMON_DTC_CR_R_ObjInfoOutofRange_ERR = AUTOSAR4.Signal(SwCalibrationAccess="ReadOnly")
DMON_DTC_MRR_hdr_ERRStatus_ERR = AUTOSAR4.Signal(SwCalibrationAccess="ReadOnly")
DMON_DTC_CR_L_hdr_ERRStatus_ERR = AUTOSAR4.Signal(SwCalibrationAccess="ReadOnly")
DMON_DTC_CR_R_hdr_ERRStatus_ERR = AUTOSAR4.Signal(SwCalibrationAccess="ReadOnly")
DMON_DTC_RSDS_L_hdr_ERRStatus_ERR = AUTOSAR4.Signal(SwCalibrationAccess="ReadOnly")
DMON_DTC_RSDS_R_hdr_ERRStatus_ERR = AUTOSAR4.Signal(SwCalibrationAccess="ReadOnly")
DMON_DTC_HCUCheckSum_ERR = AUTOSAR4.Signal(SwCalibrationAccess="ReadOnly")
DMON_DTC_HCURollingCounter_ERR = AUTOSAR4.Signal(SwCalibrationAccess="ReadOnly")
DMON_DTC_missingHU_IP2_ERR = AUTOSAR4.Signal(SwCalibrationAccess="ReadOnly")
DMON_DTC_missing_HUT_FD1_ERR = AUTOSAR4.Signal(SwCalibrationAccess="ReadOnly")
DMON_DTC_TBOX_FD3_TimeOut_ERR = AUTOSAR4.Signal(SwCalibrationAccess="ReadOnly")
DMON_DTC_CheckSum_HC1_ERR = AUTOSAR4.Signal(SwCalibrationAccess="ReadOnly")
DMON_DTC_HC1_RollingCounter_ERR = AUTOSAR4.Signal(SwCalibrationAccess="ReadOnly")
DMON_DTC_EPS_CheckSum_ERR = AUTOSAR4.Signal(SwCalibrationAccess="ReadOnly")
DMON_DTC_RollingCounter_DMS_FD1_ERR = AUTOSAR4.Signal(SwCalibrationAccess="ReadOnly")
DMON_DTC_RSDS_FD1_RollingCounter_ERR = AUTOSAR4.Signal(SwCalibrationAccess="ReadOnly")
DMON_DTC_EPS_LKATrqOvlDlvdSts_ERR = AUTOSAR4.Signal(SwCalibrationAccess="ReadOnly")
DMON_DTC_EPS_SteerMod_ERR = AUTOSAR4.Signal(SwCalibrationAccess="ReadOnly")
DMON_DTC_CheckSum_DMS_FD1_ERR = AUTOSAR4.Signal(SwCalibrationAccess="ReadOnly")
DMON_SysPowerMod_ON = AUTOSAR4.Signal(SwCalibrationAccess="ReadOnly")
DMON_SysPowerMod_WakeUp = AUTOSAR4.Signal(SwCalibrationAccess="ReadOnly")
DMON_IgnOn_3s = AUTOSAR4.Signal(SwCalibrationAccess="ReadOnly")
DMON_IgnOn = AUTOSAR4.Signal(SwCalibrationAccess="ReadOnly")
DMON_NetReltDiag_Actv = AUTOSAR4.Signal(SwCalibrationAccess="ReadOnly")
DMON_BusOffSt_Not = AUTOSAR4.Signal(SwCalibrationAccess="ReadOnly")
DMON_KL30BRelaySts_0x1 = AUTOSAR4.Signal(SwCalibrationAccess="ReadOnly")
DMON_EngRun_3s = AUTOSAR4.Signal(SwCalibrationAccess="ReadOnly")
DMON_DID_F1B1_Byte10_Bit_7_6_is01 = AUTOSAR4.Signal(SwCalibrationAccess="ReadOnly")
DMON_DID_F1B1_Byte1_Bit_2_0_Not000 = AUTOSAR4.Signal(SwCalibrationAccess="ReadOnly")
DMON_ESP_DiagActv_Inactv = AUTOSAR4.Signal(SwCalibrationAccess="ReadOnly")
DMON_BSW_VBAT_MON = AUTOSAR4.Signal(SwCalibrationAccess="ReadOnly")
DMON_KL30BRelaySts = AUTOSAR4.Signal(SwCalibrationAccess="ReadOnly")
DMON_EngState = AUTOSAR4.Signal(SwCalibrationAccess="ReadOnly")
DMON_ESP_DiagActv = AUTOSAR4.Signal(SwCalibrationAccess="ReadOnly")
DMON_IDC_L2 = AUTOSAR4.Signal(SwCalibrationAccess="ReadOnly")
DMON_AutoParkingSystem = AUTOSAR4.Signal(SwCalibrationAccess="ReadOnly")
DMON_BSW_SYS_ACC_MON = AUTOSAR4.Signal(SwCalibrationAccess="ReadOnly")
DMON_DTC_HCU_PowertrainSts_ERR = AUTOSAR4.Signal(SwCalibrationAccess="ReadOnly")
DMON_CAN_FD1BusOff_UDS_STAT = AUTOSAR4.Signal(SwCalibrationAccess="ReadOnly")
DMON_CAN_FD2BusOff_UDS_STAT = AUTOSAR4.Signal(SwCalibrationAccess="ReadOnly")
DMON_CAN_FD3BusOff_UDS_STAT = AUTOSAR4.Signal(SwCalibrationAccess="ReadOnly")
DMON_CAN_FD4BusOff_UDS_STAT = AUTOSAR4.Signal(SwCalibrationAccess="ReadOnly")
DMON_CAN_FD5BusOff_UDS_STAT = AUTOSAR4.Signal(SwCalibrationAccess="ReadOnly")
DMON_CAN_FD6BusOff_UDS_STAT = AUTOSAR4.Signal(SwCalibrationAccess="ReadOnly")
DMON_MRR_HDR = AUTOSAR4.Signal(SwCalibrationAccess="ReadOnly")
DMON_CR_L_HDR = AUTOSAR4.Signal(SwCalibrationAccess="ReadOnly")
DMON_CR_R_HDR = AUTOSAR4.Signal(SwCalibrationAccess="ReadOnly")
DMON_RSDS_R_HDR = AUTOSAR4.Signal(SwCalibrationAccess="ReadOnly")
DMON_RSDS_L_HDR = AUTOSAR4.Signal(SwCalibrationAccess="ReadOnly")
DMON_Counter = AUTOSAR4.Signal(SwCalibrationAccess="ReadOnly")
DMON_ADASCan_NotBusOff = AUTOSAR4.Signal(SwCalibrationAccess="ReadOnly")
DMON_CRCan_NotBusOff = AUTOSAR4.Signal(SwCalibrationAccess="ReadOnly")
DMON_RSDSCan_NotBusOff = AUTOSAR4.Signal(SwCalibrationAccess="ReadOnly")
DMON_MRRCan_NotBusOff = AUTOSAR4.Signal(SwCalibrationAccess="ReadOnly")
DMON_AVPCan_NotBusOff = AUTOSAR4.Signal(SwCalibrationAccess="ReadOnly")
DMON_DRCan_NotBusOff = AUTOSAR4.Signal(SwCalibrationAccess="ReadOnly")
P_LCS_Trq_Switch_DMON = AUTOSAR4.Parameter(0, SwCalibrationAccess="ReadWrite", DataType="uint8")
DMON_IgnOn_60s = AUTOSAR4.Signal(SwCalibrationAccess="ReadOnly")