% Simulink data dictionary PvtParsDMS.sldd

P_DMS_tDSGoodUnbeliv2LowDistrctn = Simulink.Parameter(1, DataType="single", Unit="s")
P_DMS_tDSGoodUnbeliv2LowDrowsns = Simulink.Parameter(3, DataType="single", Unit="s")
P_DMS_tDSGoodUnbeliv2MidDrowsns = Simulink.Parameter(3, DataType="single", Unit="s")
P_DMS_tDSLow2MidDistractn = Simulink.Parameter(2, DataType="single", Unit="s")
P_DMS_tDSLow2MidDrowsns = Simulink.Parameter(3, DataType="single", Unit="s")
P_DMS_tDSOther2Hi1Drowsns = Simulink.Parameter(0.5, DataType="single", Unit="s")
P_DMS_tDSOther2Hi1Distractn = Simulink.Parameter(2, DataType="single")
P_DMS_tDSOther2Hi2Distractn = Simulink.Parameter(5, DataType="single", Unit="s")
P_DMS_tDSOther2Hi2Drowsns = Simulink.Parameter(3, DataType="single", Unit="s")
DMS_DistractnSts = Simulink.Signal()
DMS_DrowsnsSts = Simulink.Signal()
DMS_DriverSts = Simulink.Signal()
DMS_SubModel_VERSION = Simulink.Signal()
DMS_SubModel_Number = Simulink.Signal()
DMS_DSOther2Good = Simulink.Signal()
DMS_DSOther2Unbeliv = Simulink.Signal()
DMS_DSUnbeliv2DDAEnable = Simulink.Signal()
DMS_DSGoodUnbeliv2LowDistractn = Simulink.Signal()
DMS_DSMidHi1Hi22LowDistractn = Simulink.Signal()
DMS_DSGoodUnbeliv2MidDistractn = Simulink.Signal()
DMS_DSLow2MidDistractn = Simulink.Signal()
DMS_DSHi1Hi22MidDistractn = Simulink.Signal()
DMS_DSOther2Hi1Distractn = Simulink.Signal()
DMS_DSOther2Hi2Distractn = Simulink.Signal()
DMS_DSMidHi1Hi22NoDistractn = Simulink.Signal()
DMS_DSGoodUnbeliv2LowDrowsns = Simulink.Signal()
DMS_DSMidHi1Hi22LowDrowsns = Simulink.Signal()
DMS_DSGoodUnbeliv2MidDrowsns = Simulink.Signal()
DMS_DSLow2MidDrowsns = Simulink.Signal()
DMS_DSHi1Hi22MidDrowsns = Simulink.Signal()
DMS_DSOther2Hi1Drowsns = Simulink.Signal()
DMS_DSOther2Hi2Drowsns = Simulink.Signal()
DMS_DSMidHi1Hi22NoDrowsns = Simulink.Signal()
P_DMS_tDSGoodUnbeliv2MidDistractn = Simulink.Parameter(2, DataType="single")