% Simulink data dictionary PvtParsECUMGR.sldd

ECUMGR_P3V3_RTC_MON = AUTOSAR4.Signal(SwCalibrationAccess="ReadOnly", StorageClass="Global", MemorySection="VAR")
ECUMGR_P1V0_EQ_MON = AUTOSAR4.Signal(SwCalibrationAccess="ReadOnly", StorageClass="Global", MemorySection="VAR")
ECUMGR_McuDomainRdy = AUTOSAR4.Signal(SwCalibrationAccess="ReadOnly", StorageClass="Global", MemorySection="VAR")
ECUMGR_McuActReq = AUTOSAR4.Signal(SwCalibrationAccess="ReadOnly", StorageClass="Global", MemorySection="VAR")
ECUMGR_MCU_TESTMODE = AUTOSAR4.Signal(SwCalibrationAccess="ReadOnly", StorageClass="Global", MemorySection="VAR")
ECUMGR_MCU_HWCFG_5 = AUTOSAR4.Signal(SwCalibrationAccess="ReadOnly", StorageClass="Global", MemorySection="VAR")
ECUMGR_MCU_HWCFG_4 = AUTOSAR4.Signal(SwCalibrationAccess="ReadOnly", StorageClass="Global", MemorySection="VAR")
ECUMGR_MCU_HWCFG_3 = AUTOSAR4.Signal(SwCalibrationAccess="ReadOnly", StorageClass="Global", MemorySection="VAR")
ECUMGR_MCU_HOST_ID_1 = AUTOSAR4.Signal(SwCalibrationAccess="ReadOnly", StorageClass="Global", MemorySection="VAR")
ECUMGR_MCU_HOST_ID_0 = AUTOSAR4.Signal(SwCalibrationAccess="ReadOnly", StorageClass="Global", MemorySection="VAR")
ECUMGR_LED_CONN_0_ADC = AUTOSAR4.Signal(SwCalibrationAccess="ReadOnly", StorageClass="Global", MemorySection="VAR")
ECUMGR_Eq4DomainRdy = AUTOSAR4.Signal(SwCalibrationAccess="ReadOnly", StorageClass="Global", MemorySection="VAR")
ECUMGR_Eq4ActReq = AUTOSAR4.Signal(SwCalibrationAccess="ReadOnly", StorageClass="Global", MemorySection="VAR")
ECUMGR_EcuSubState = AUTOSAR4.Signal(SwCalibrationAccess="ReadOnly", StorageClass="Global", MemorySection="VAR")
ECUMGR_EcuMod = AUTOSAR4.Signal(SwCalibrationAccess="ReadOnly", StorageClass="Global", MemorySection="VAR")
ECUMGR_CAN_INH_MON = AUTOSAR4.Signal(SwCalibrationAccess="ReadOnly", StorageClass="Global", MemorySection="VAR")
ECUMGR_Counter = AUTOSAR4.Signal(SwCalibrationAccess="ReadOnly", StorageClass="Global", MemorySection="VAR")
ECUMGR_H3_BOARD_PRESENT_N = AUTOSAR4.Signal(SwCalibrationAccess="ReadOnly", StorageClass="Global", MemorySection="VAR")
P_ECUMGR_HighPoint = AUTOSAR4.Parameter(3500, SwCalibrationAccess="ReadWrite", StorageClass="Global", MemorySection="CAL", DataType="uint16")
P_ECUMGR_LowPoint = AUTOSAR4.Parameter(2500, SwCalibrationAccess="ReadWrite", StorageClass="Global", MemorySection="CAL", DataType="uint16")
ECUMGR_HWAActive = AUTOSAR4.Signal(SwCalibrationAccess="ReadOnly", StorageClass="Global", MemorySection="VAR")
ECUMGR_ACC_DrvOffReq = AUTOSAR4.Signal(SwCalibrationAccess="ReadOnly", StorageClass="Global", MemorySection="VAR")
P_ECUMGR_ShutTime = AUTOSAR4.Parameter(0.5, SwCalibrationAccess="ReadWrite", StorageClass="Global", MemorySection="CAL", DataType="single")
P_ECUMGR_DelayTime = AUTOSAR4.Parameter(2, SwCalibrationAccess="ReadWrite", StorageClass="Global", MemorySection="CAL", DataType="single")
EDR_AEB_BRK_INFO = AUTOSAR4.Signal(SwCalibrationAccess="ReadOnly", StorageClass="Global", MemorySection="VAR")
EDR_AEB_EDR_JAPED_INFO = AUTOSAR4.Signal(SwCalibrationAccess="ReadOnly", StorageClass="Global", MemorySection="VAR")
EDR_AEB_EDR_JAVEH_INFO = AUTOSAR4.Signal(SwCalibrationAccess="ReadOnly", StorageClass="Global", MemorySection="VAR")
EDR_AEB_EDR_LATCYC_INFO = AUTOSAR4.Signal(SwCalibrationAccess="ReadOnly", StorageClass="Global", MemorySection="VAR")
EDR_AEB_EDR_LATPED_INFO = AUTOSAR4.Signal(SwCalibrationAccess="ReadOnly", StorageClass="Global", MemorySection="VAR")
EDR_AEB_EDR_LONOBJ_INFO = AUTOSAR4.Signal(SwCalibrationAccess="ReadOnly", StorageClass="Global", MemorySection="VAR")
EDR_EDR_AEB_BRK_INFO_REC = AUTOSAR4.Signal(SwCalibrationAccess="ReadOnly", StorageClass="Global", MemorySection="VAR")
EDR_EDR_AEB_JAPED_INFO_REC = AUTOSAR4.Signal(SwCalibrationAccess="ReadOnly", StorageClass="Global", MemorySection="VAR")
EDR_EDR_AEB_JAVEH_INFO_REC = AUTOSAR4.Signal(SwCalibrationAccess="ReadOnly", StorageClass="Global", MemorySection="VAR")
EDR_EDR_AEB_LATCYC_INFO_REC = AUTOSAR4.Signal(SwCalibrationAccess="ReadOnly", StorageClass="Global", MemorySection="VAR")
EDR_EDR_AEB_LATPED_INFO_REC = AUTOSAR4.Signal(SwCalibrationAccess="ReadOnly", StorageClass="Global", MemorySection="VAR")
EDR_EDR_AEB_LONOBJ_INFO_REC = AUTOSAR4.Signal(SwCalibrationAccess="ReadOnly", StorageClass="Global", MemorySection="VAR")
EDR_EDR_AEB_STATUS_REC = AUTOSAR4.Signal(SwCalibrationAccess="ReadOnly", StorageClass="Global", MemorySection="VAR")
ECUMGR_vxvRefMs = AUTOSAR4.Signal(SwCalibrationAccess="ReadOnly")
ECUMGR_VBAT_MON = AUTOSAR4.Signal(SwCalibrationAccess="ReadOnly")
ECUMGR_SYS_ACC_MON = AUTOSAR4.Signal(SwCalibrationAccess="ReadOnly")
ECUMGR_SocDomainRdy = AUTOSAR4.Signal(SwCalibrationAccess="ReadOnly")
ECUMGR_SocActReq = AUTOSAR4.Signal(SwCalibrationAccess="ReadOnly")
ECUMGR_REF_MON_G8 = AUTOSAR4.Signal(SwCalibrationAccess="ReadOnly")
ECUMGR_REF_MON_G3 = AUTOSAR4.Signal(SwCalibrationAccess="ReadOnly")
ECUMGR_REF_MON_G2 = AUTOSAR4.Signal(SwCalibrationAccess="ReadOnly")
ECUMGR_REF_MON_G1 = AUTOSAR4.Signal(SwCalibrationAccess="ReadOnly")
ECUMGR_REF_MON_G0 = AUTOSAR4.Signal(SwCalibrationAccess="ReadOnly")
ECUMGR_PF8200_AMUX_MON = AUTOSAR4.Signal(SwCalibrationAccess="ReadOnly")
ECUMGR_P8V0_CAM_MON = AUTOSAR4.Signal(SwCalibrationAccess="ReadOnly")
ECUMGR_P5V0_MON = AUTOSAR4.Signal(SwCalibrationAccess="ReadOnly")
ECUMGR_P3V3A_MCU_MON = AUTOSAR4.Signal(SwCalibrationAccess="ReadOnly")