% Simulink data dictionary PvtParsHMI.sldd

P_HMI_ObjectTypeFilter = AUTOSAR4.Parameter(1, SwCalibrationAccess="ReadWrite", StorageClass="Global", MemorySection="CAL", DataType="single")
P_HMI_LDW_LKAWarnTime = AUTOSAR4.Parameter(10, SwCalibrationAccess="ReadWrite", StorageClass="Global", MemorySection="CAL", DataType="single")
P_HMI_WarnFormLDWReq = AUTOSAR4.Parameter(0, SwCalibrationAccess="ReadWrite", StorageClass="Global", MemorySection="CAL", DataType="uint8")
HMI_Counter = AUTOSAR4.Signal(SwCalibrationAccess="ReadOnly", StorageClass="Global", MemorySection="VAR")
HMI_SubModel_VERSION = AUTOSAR4.Signal(SwCalibrationAccess="ReadOnly", StorageClass="Global", MemorySection="VAR")
HMI_SubModel_Number = AUTOSAR4.Signal(SwCalibrationAccess="ReadOnly", StorageClass="Global", MemorySection="VAR")
HMI_VSM_LON_CTRL = AUTOSAR4.Signal(SwCalibrationAccess="ReadOnly", StorageClass="Global", MemorySection="VAR")
HMI_VSM_HMI = AUTOSAR4.Signal(SwCalibrationAccess="ReadOnly", StorageClass="Global", MemorySection="VAR")
HMI_VCAN_HUT = AUTOSAR4.Signal(SwCalibrationAccess="ReadOnly", StorageClass="Global", MemorySection="VAR")
HMI_DMON_SENS_ERR = AUTOSAR4.Signal(SwCalibrationAccess="ReadOnly", StorageClass="Global", MemorySection="VAR")
HMI_LONC_CTRL_OUT = AUTOSAR4.Signal(SwCalibrationAccess="ReadOnly", StorageClass="Global", MemorySection="VAR")
HMI_TOS_ACCP0 = AUTOSAR4.Signal(SwCalibrationAccess="ReadOnly", StorageClass="Global", MemorySection="VAR")
HMI_TOS_ACCP1 = AUTOSAR4.Signal(SwCalibrationAccess="ReadOnly", StorageClass="Global", MemorySection="VAR")
HMI_TOS_ACCP2 = AUTOSAR4.Signal(SwCalibrationAccess="ReadOnly", StorageClass="Global", MemorySection="VAR")
HMI_TOS_ACCP3 = AUTOSAR4.Signal(SwCalibrationAccess="ReadOnly", StorageClass="Global", MemorySection="VAR")
HMI_TOS_ACCP4 = AUTOSAR4.Signal(SwCalibrationAccess="ReadOnly", StorageClass="Global", MemorySection="VAR")
HMI_TOS_ACCP5 = AUTOSAR4.Signal(SwCalibrationAccess="ReadOnly", StorageClass="Global", MemorySection="VAR")
HMI_RFM_LINE_L1 = AUTOSAR4.Signal(SwCalibrationAccess="ReadOnly", StorageClass="Global", MemorySection="VAR")
HMI_RFM_LINE_R1 = AUTOSAR4.Signal(SwCalibrationAccess="ReadOnly", StorageClass="Global", MemorySection="VAR")
HMI_RFM_LINE_L2 = AUTOSAR4.Signal(SwCalibrationAccess="ReadOnly", StorageClass="Global", MemorySection="VAR")
HMI_RFM_LINE_R2 = AUTOSAR4.Signal(SwCalibrationAccess="ReadOnly", StorageClass="Global", MemorySection="VAR")
HMI_RFM_LINE_LB = AUTOSAR4.Signal(SwCalibrationAccess="ReadOnly", StorageClass="Global", MemorySection="VAR")
HMI_RFM_LINE_RB = AUTOSAR4.Signal(SwCalibrationAccess="ReadOnly", StorageClass="Global", MemorySection="VAR")
HMI_RFM_ROAD = AUTOSAR4.Signal(SwCalibrationAccess="ReadOnly", StorageClass="Global", MemorySection="VAR")
HMI_RFM_INTERSEC_ALERT = AUTOSAR4.Signal(SwCalibrationAccess="ReadOnly", StorageClass="Global", MemorySection="VAR")
HMI_EHRV2_ROAD_INFO = AUTOSAR4.Signal(SwCalibrationAccess="ReadOnly", StorageClass="Global", MemorySection="VAR")
HMI_AEB_BRK_INFO = AUTOSAR4.Signal(SwCalibrationAccess="ReadOnly", StorageClass="Global", MemorySection="VAR")
HMI_AEB_IPHUT_INFO = AUTOSAR4.Signal(SwCalibrationAccess="ReadOnly", StorageClass="Global", MemorySection="VAR")
HMI_RFM_TSR = AUTOSAR4.Signal(SwCalibrationAccess="ReadOnly", StorageClass="Global", MemorySection="VAR")
HMI_DriverSts = AUTOSAR4.Signal(SwCalibrationAccess="ReadOnly", StorageClass="Global", MemorySection="VAR")
HMI_EHRV2_HDR = AUTOSAR4.Signal(SwCalibrationAccess="ReadOnly", StorageClass="Global", MemorySection="VAR")
HMI_EHRV2_HutHandshake = AUTOSAR4.Signal(SwCalibrationAccess="ReadOnly", StorageClass="Global", MemorySection="VAR")
HMI_PLAN_HMI_BUS = AUTOSAR4.Signal(SwCalibrationAccess="ReadOnly", StorageClass="Global", MemorySection="VAR")
HMI_communicationTest_ACC_FD2 = AUTOSAR4.Signal(SwCalibrationAccess="ReadOnly", StorageClass="Global", MemorySection="VAR")
HMI_communicationTest_ACC_FD1 = AUTOSAR4.Signal(SwCalibrationAccess="ReadOnly", StorageClass="Global", MemorySection="VAR")
HMI_communicationTest_ACC_FD4 = AUTOSAR4.Signal(SwCalibrationAccess="ReadOnly", StorageClass="Global", MemorySection="VAR")
HMI_communicationTest_IFC_FD2 = AUTOSAR4.Signal(SwCalibrationAccess="ReadOnly", StorageClass="Global", MemorySection="VAR")
HMI_communicationTest_IFC_FD5 = AUTOSAR4.Signal(SwCalibrationAccess="ReadOnly", StorageClass="Global", MemorySection="VAR")
HMI_communicationTest_IFC_FD6 = AUTOSAR4.Signal(SwCalibrationAccess="ReadOnly", StorageClass="Global", MemorySection="VAR")
HMI_communicationTest_IFCVibrationWarning = AUTOSAR4.Signal(SwCalibrationAccess="ReadOnly", StorageClass="Global", MemorySection="VAR")
HMI_communicationTest_AESErrSts = AUTOSAR4.Signal(SwCalibrationAccess="ReadOnly", StorageClass="Global", MemorySection="VAR")
HMI_communicationTest_ESSErrSts = AUTOSAR4.Signal(SwCalibrationAccess="ReadOnly", StorageClass="Global", MemorySection="VAR")
HMI_communicationTest_IFC_FD3 = AUTOSAR4.Signal(SwCalibrationAccess="ReadOnly", StorageClass="Global", MemorySection="VAR")
HMI_communicationTest_ACC_FD3 = AUTOSAR4.Signal(SwCalibrationAccess="ReadOnly", StorageClass="Global", MemorySection="VAR")
HMI_communicationTest_Counter = AUTOSAR4.Signal(SwCalibrationAccess="ReadOnly", StorageClass="Global", MemorySection="VAR")
P_HMI_communicationTest = AUTOSAR4.Parameter(1, SwCalibrationAccess="ReadWrite", StorageClass="Global", MemorySection="CAL", DataType="uint8")