% Simulink data dictionary PvtParsLATC.sldd

P_LCS_DeltaEps_SpdBp = AUTOSAR4.Parameter(single([0 5 10 15 20 25 30 35 40 60 80 90 100 110 120 140]), SwCalibrationAccess="ReadWrite", StorageClass="Global", MemorySection="CAL")
P_LCS_preDis_spd = AUTOSAR4.Parameter(single([0 5 10 15 20 25 30 35 40 60 80 90 100 110 120 140]), SwCalibrationAccess="ReadWrite", StorageClass="Global", MemorySection="CAL")
P_LCS_LCcancel_detaA0 = AUTOSAR4.Parameter(1.5, SwCalibrationAccess="ReadWrite", StorageClass="Global", MemorySection="CAL", DataType="single")
P_LCS_SteerAngleOffset_ALG_Switch = AUTOSAR4.Parameter(1, SwCalibrationAccess="ReadWrite", StorageClass="Global", MemorySection="CAL", DataType="uint8")
P_LCS_SteerAngle_Deviation = AUTOSAR4.Parameter(2.2, SwCalibrationAccess="ReadWrite", StorageClass="Global", MemorySection="CAL", DataType="single")
P_LCS_AngleFilterTime = AUTOSAR4.Parameter(0.1, SwCalibrationAccess="ReadWrite", StorageClass="Global", MemorySection="CAL", DataType="single")
P_LCS_PreTime_ESS = AUTOSAR4.Parameter(2, SwCalibrationAccess="ReadWrite", StorageClass="Global", MemorySection="CAL", DataType="single")
P_LCS_PID_Kp_TarAng_ESS = AUTOSAR4.Parameter(12, SwCalibrationAccess="ReadWrite", StorageClass="Global", MemorySection="CAL", DataType="single")
P_LCS_PID_Ki_TarAng_ESS = AUTOSAR4.Parameter(0, SwCalibrationAccess="ReadWrite", StorageClass="Global", MemorySection="CAL", DataType="single")
P_LCS_SW = AUTOSAR4.Parameter(1, SwCalibrationAccess="ReadWrite", StorageClass="Global", MemorySection="CAL", DataType="boolean")
P_LCS_PreTime_ESS2 = AUTOSAR4.Parameter(1.7, SwCalibrationAccess="ReadWrite", StorageClass="Global", MemorySection="CAL", DataType="single")
P_LCS_PID_Kp_TarAng_ESS2 = AUTOSAR4.Parameter(0.5, SwCalibrationAccess="ReadWrite", StorageClass="Global", MemorySection="CAL", DataType="single")
P_LCS_PID_Kp_TarTorq_ESS = AUTOSAR4.Parameter(2, SwCalibrationAccess="ReadWrite", StorageClass="Global", MemorySection="CAL", DataType="single")
P_LCS_TarTorq_Limit_ESS = AUTOSAR4.Parameter(0.25, SwCalibrationAccess="ReadWrite", StorageClass="Global", MemorySection="CAL", DataType="single")
P_LCS_PID_SteerAngSpdLim = AUTOSAR4.Parameter(20, SwCalibrationAccess="ReadWrite", StorageClass="Global", MemorySection="CAL", DataType="single")
P_LCS_MaxTorqSlope = AUTOSAR4.Parameter(0.18, SwCalibrationAccess="ReadWrite", StorageClass="Global", MemorySection="CAL", DataType="single")
P_LCS_TorqReqMax = AUTOSAR4.Parameter(2.99, SwCalibrationAccess="ReadWrite", StorageClass="Global", MemorySection="CAL", DataType="single")
P_LCS_TorqReqMin = AUTOSAR4.Parameter(-2.99, SwCalibrationAccess="ReadWrite", StorageClass="Global", MemorySection="CAL", DataType="single")
P_LCS_ESS_MaxTorqSlope = AUTOSAR4.Parameter(1.5, SwCalibrationAccess="ReadWrite", StorageClass="Global", MemorySection="CAL", DataType="single")
P_LCS_FF_LCRevs_SpdVal = AUTOSAR4.Parameter([0 0.8 0.8 0.8 0.8 0.8 0.8 0.8 0.8 0.8 0.8 0.8 0.8 0.8], SwCalibrationAccess="ReadWrite", StorageClass="Global", MemorySection="CAL", DataType="single")
P_LCS_AngleErrorReversTorq = AUTOSAR4.Parameter(0.06, SwCalibrationAccess="ReadWrite", StorageClass="Global", MemorySection="CAL", DataType="single")
P_LCS_AngleErrorReversTorq_VehSpdFac = AUTOSAR4.Parameter([1 1 0.5 0 0], SwCalibrationAccess="ReadWrite", StorageClass="Global", MemorySection="CAL", DataType="single")
P_LCS_PID_Param_KiFreaseWhenLC_Enable = AUTOSAR4.Parameter(0, SwCalibrationAccess="ReadWrite", StorageClass="Global", MemorySection="CAL", DataType="boolean")
P_LCS_PID_Param_Kp = AUTOSAR4.Parameter(0.15, SwCalibrationAccess="ReadWrite", StorageClass="Global", MemorySection="CAL", DataType="single")
P_LCS_PID_Param_Kd = AUTOSAR4.Parameter(0, SwCalibrationAccess="ReadWrite", StorageClass="Global", MemorySection="CAL", DataType="single")
P_LCS_PID_Param_KdFilterTime = AUTOSAR4.Parameter(0.5, SwCalibrationAccess="ReadWrite", StorageClass="Global", MemorySection="CAL", DataType="single")
P_LCS_PID_Param_Ki = AUTOSAR4.Parameter(0.001, SwCalibrationAccess="ReadWrite", StorageClass="Global", MemorySection="CAL", DataType="single")
P_LCS_OverRideDetect_enable = AUTOSAR4.Parameter(true, SwCalibrationAccess="ReadWrite", StorageClass="Global", MemorySection="CAL", DataType="boolean")
P_LCS_PID_DisableKi_CurveVal = AUTOSAR4.Parameter(0.003, SwCalibrationAccess="ReadWrite", StorageClass="Global", MemorySection="CAL", DataType="single")
P_LCS_AngleErrorReversTorq_LC_VehSpdVal = AUTOSAR4.Parameter([0 0 0 0 0 0 0 0.1 0.05 0.06 0.15 0.2 0.15 0.15 0.4 0.4], SwCalibrationAccess="ReadWrite", StorageClass="Global", MemorySection="CAL", DataType="single")
P_LCS_AngleErrorReversTorq_LC_TarAngleFac = AUTOSAR4.Parameter(single([0 0.5 0.8 1 1 1 1 1]), SwCalibrationAccess="ReadWrite", StorageClass="Global", MemorySection="CAL")
P_LCS_PID_DrvTorqFacVal = AUTOSAR4.Parameter([1 1 1 1], SwCalibrationAccess="ReadWrite", StorageClass="Global", MemorySection="CAL", DataType="single")
P_LCS_PID_DrvTorqFacBp = AUTOSAR4.Parameter([0.7 1 1.5 2], SwCalibrationAccess="ReadWrite", StorageClass="Global", MemorySection="CAL", DataType="single")
P_LCS_TarAngleFilterEnable = AUTOSAR4.Parameter(true, SwCalibrationAccess="ReadWrite", StorageClass="Global", MemorySection="CAL", DataType="boolean")  % TarAngle滤波使能
P_LCS_TestAngleSwitch = AUTOSAR4.Parameter(0, SwCalibrationAccess="ReadWrite", StorageClass="Global", MemorySection="CAL", DataType="single")
P_LCS_TestTarAngle = AUTOSAR4.Parameter(0, SwCalibrationAccess="ReadWrite", StorageClass="Global", MemorySection="CAL", DataType="single")
P_LCS_TarAngleFilterFC_spdVal = AUTOSAR4.Parameter([0.6 0.6 0.6 1 2 3 3 3], SwCalibrationAccess="ReadWrite", StorageClass="Global", MemorySection="CAL", DataType="single")
P_LCS_CurAngleFiltEnable = AUTOSAR4.Parameter(true, SwCalibrationAccess="ReadWrite", StorageClass="Global", MemorySection="CAL", DataType="boolean")
P_LCS_CurAngleFilterFC = AUTOSAR4.Parameter(2, SwCalibrationAccess="ReadWrite", StorageClass="Global", MemorySection="CAL", DataType="single")
P_LCS_IN_Offset_Test_SW = AUTOSAR4.Parameter(0, SwCalibrationAccess="ReadWrite", StorageClass="Global", MemorySection="CAL", DataType="uint8")
P_LCS_DangerLevel_ManualSW = AUTOSAR4.Parameter(0, SwCalibrationAccess="ReadWrite", StorageClass="Global", MemorySection="CAL", DataType="uint8")
P_LCS_DangerLevel_ManualValue = AUTOSAR4.Parameter(1, SwCalibrationAccess="ReadWrite", StorageClass="Global", MemorySection="CAL", DataType="uint8")
P_LCS_IN_Offset_Test_Value = AUTOSAR4.Parameter(0, SwCalibrationAccess="ReadWrite", StorageClass="Global", MemorySection="CAL", DataType="single")
P_LCS_A2S_FliterTime = AUTOSAR4.Parameter(0.02, SwCalibrationAccess="ReadWrite", StorageClass="Global", MemorySection="CAL", DataType="single")
P_LCS_A2Switch = AUTOSAR4.Parameter(1, SwCalibrationAccess="ReadWrite", StorageClass="Global", MemorySection="CAL", DataType="uint8")
P_LCS_A2_Pretime = AUTOSAR4.Parameter(0.075, SwCalibrationAccess="ReadWrite", StorageClass="Global", MemorySection="CAL", DataType="single")
P_LCS_A2_Curve_BP = AUTOSAR4.Parameter(single([0 0.0002 0.0003 0.0007 0.0013 0.0025 0.0033 0.005 0.01 0.02]), SwCalibrationAccess="ReadWrite", StorageClass="Global", MemorySection="CAL")
P_LCS_ESS_SteerAngleFilterTime = AUTOSAR4.Parameter(0.2, SwCalibrationAccess="ReadWrite", StorageClass="Global", MemorySection="CAL", DataType="single")
P_LCS_ESS_TarAngleFilterTime = AUTOSAR4.Parameter(0.2, SwCalibrationAccess="ReadWrite", StorageClass="Global", MemorySection="CAL", DataType="single")
P_LCS_ESS_LogicTest_Enable = AUTOSAR4.Parameter(1, SwCalibrationAccess="ReadWrite", StorageClass="Global", MemorySection="CAL", DataType="boolean")
P_LCS_CurOffsetA2_FliterTime = AUTOSAR4.Parameter(0.2, SwCalibrationAccess="ReadWrite", StorageClass="Global", MemorySection="CAL", DataType="single")
P_LCS_LatAcc2CurveSW = AUTOSAR4.Parameter(0, SwCalibrationAccess="ReadWrite", StorageClass="Global", MemorySection="CAL", DataType="uint8")
P_LCS_preDis_LCK_A2Curve_Fac2 = AUTOSAR4.Parameter(single([1 1 1 0.85 0.75 0.6 0.5 0.3 0.3 0.25]), SwCalibrationAccess="ReadWrite", StorageClass="Global", MemorySection="CAL")
P_LCS_PID_A2_BP = AUTOSAR4.Parameter(single([0 0.0002 0.0003 0.0007 0.0013 0.0025 0.0033 0.005 0.01 0.02]), SwCalibrationAccess="ReadWrite", StorageClass="Global", MemorySection="CAL")
P_LCS_CurOffsetA2_Enable = AUTOSAR4.Parameter(0, SwCalibrationAccess="ReadWrite", StorageClass="Global", MemorySection="CAL", DataType="boolean")
P_LCS_tarAngleSpdFilterFC = AUTOSAR4.Parameter(2, SwCalibrationAccess="ReadWrite", StorageClass="Global", MemorySection="CAL", DataType="single")
P_LCS_A0Slope_LCcancel_DisableFilterTime = AUTOSAR4.Parameter(0.5, SwCalibrationAccess="ReadWrite", StorageClass="Global", MemorySection="CAL", DataType="single")
P_LCS_preDis_TmaxFac = AUTOSAR4.Parameter([0.4 0.4 0.4 0.4 0.4 0.4 0.4 0.4 0.4 0.6 0.6 0.7 0.75 0.9 0.9 0.9], SwCalibrationAccess="ReadWrite", StorageClass="Global", MemorySection="CAL", DataType="single")
P_LCS_LCK_preDis_Nomal_Add = AUTOSAR4.Parameter(repmat(0, 1, 8), SwCalibrationAccess="ReadWrite", StorageClass="Global", MemorySection="CAL", DataType="single")
P_LCS_LCK_preDis_TmaxFac = AUTOSAR4.Parameter([0.4 0.4 0.4 0.4 0.4 0.4 0.4 0.4 0.4 0.4 0.6 0.7 0.75 0.9 0.9 0.9], SwCalibrationAccess="ReadWrite", StorageClass="Global", MemorySection="CAL", DataType="single")
P_LCS_LCK_AngleSlopeNormal_Spd = AUTOSAR4.Parameter(repmat(0.4, 1, 16), SwCalibrationAccess="ReadWrite", StorageClass="Global", MemorySection="CAL", DataType="single")
P_LCS_LCK2ESS_AngleSlopeLimtCnt_Spd = AUTOSAR4.Parameter([50 50 50 50 50 50 0 0 0 0 0 0 0 60 50 50], SwCalibrationAccess="ReadWrite", StorageClass="Global", MemorySection="CAL", DataType="single")
P_LCS_LCK2LC_AngleSlopeLimtCnt_Spd = AUTOSAR4.Parameter([50 50 20 20 20 20 20 20 30 80 80 70 70 60 50 50], SwCalibrationAccess="ReadWrite", StorageClass="Global", MemorySection="CAL", DataType="single")
P_LCS_LCK2ESS_AngleSlope_LimVal = AUTOSAR4.Parameter([0.2 1 1 1 1 0.15], SwCalibrationAccess="ReadWrite", StorageClass="Global", MemorySection="CAL", DataType="single")
P_LCS_LCK2LC_AngleSlope_LimVal = AUTOSAR4.Parameter([0.2 0.2 0.2 0.15 0.15 0.15], SwCalibrationAccess="ReadWrite", StorageClass="Global", MemorySection="CAL", DataType="single")
P_LCS_LCType = AUTOSAR4.Parameter(1, SwCalibrationAccess="ReadWrite", StorageClass="Global", MemorySection="CAL", DataType="single")
P_LCS_ESS_AngleSlopeNormal_Spd = AUTOSAR4.Parameter([0.4 0.4 0.4 0.4 0.4 0.4 1.2 1.2 1.2 1.2 1.2 1 1 0.25 0.25 0.25], SwCalibrationAccess="ReadWrite", StorageClass="Global", MemorySection="CAL", DataType="single")
P_LCS_ESS_preDis_TmaxFac = AUTOSAR4.Parameter([0.4 0.4 0.4 0.4 0.4 0.4 -0.1 -0.1 -0.1 0.1 0.1 0 0 0.9 0.9 0.9], SwCalibrationAccess="ReadWrite", StorageClass="Global", MemorySection="CAL", DataType="single")
P_LCS_LC_AngleSlopeNormal_Spd = AUTOSAR4.Parameter([0.4 0.4 1 1 0.8 0.5 0.5 0.5 0.5 0.35 0.3 0.3 0.2 0.25 0.25 0.25], SwCalibrationAccess="ReadWrite", StorageClass="Global", MemorySection="CAL", DataType="single")
P_LCS_LC_preDis_TmaxFac = AUTOSAR4.Parameter([0.4 0.4 0.1 0.1 0.3 0.4 0.4 0.4 0.3 0.4 0.6 0.7 0.75 0.9 0.9 0.9], SwCalibrationAccess="ReadWrite", StorageClass="Global", MemorySection="CAL", DataType="single")
P_LCS_LC_preDis_Nomal_Add = AUTOSAR4.Parameter([-1 -1 -1 -1 -1 -1 0 0], SwCalibrationAccess="ReadWrite", StorageClass="Global", MemorySection="CAL", DataType="single")
P_LCS_LC_preDis_Nomal = AUTOSAR4.Parameter([6 6 6 6 8 10 10 13 17 22 28 31 35 38 42 49], SwCalibrationAccess="ReadWrite", StorageClass="Global", MemorySection="CAL", DataType="single")
P_LCS_LC_preDis_Nomal_EM = AUTOSAR4.Parameter([6 6 6 6 8 10 10 13 12 18 26 31 32 38 42 49], SwCalibrationAccess="ReadWrite", StorageClass="Global", MemorySection="CAL", DataType="single")
P_LCS_LC_AngleSlopeNormal_EM_Spd = AUTOSAR4.Parameter([0.4 0.4 1 1 0.8 0.5 0.5 0.5 0.8 0.4 0.4 0.45 0.45 0.25 0.25 0.25], SwCalibrationAccess="ReadWrite", StorageClass="Global", MemorySection="CAL", DataType="single")
P_LCS_LC_preDis_TmaxFac_EM = AUTOSAR4.Parameter([0.4 0.4 0.1 0.1 0.3 0.4 0.4 0.4 0.3 0.4 0.4 0.4 0.4 0.9 0.9 0.9], SwCalibrationAccess="ReadWrite", StorageClass="Global", MemorySection="CAL", DataType="single")
P_LCS_LC_preDis_Nomal_EM_Add = AUTOSAR4.Parameter(repmat(0, 1, 8), SwCalibrationAccess="ReadWrite", StorageClass="Global", MemorySection="CAL", DataType="single")
P_LCS_AngleSlope_Spd_BP = AUTOSAR4.Parameter([0 10 20 30 40 60 80 90 100 110 120 140], SwCalibrationAccess="ReadWrite", StorageClass="Global", MemorySection="CAL", DataType="single")
P_LCS_AngleSlopeNormal_LCK_8 = AUTOSAR4.Parameter(repmat(0.4, 1, 12), SwCalibrationAccess="ReadWrite", StorageClass="Global", MemorySection="CAL", DataType="single")
P_LCS_AngleSlopeNormal_LCKIE_9 = AUTOSAR4.Parameter(repmat(0.4, 1, 12), SwCalibrationAccess="ReadWrite", StorageClass="Global", MemorySection="CAL", DataType="single")
P_LCS_AngleSlopeNormal_LC_10 = AUTOSAR4.Parameter(repmat(0.4, 1, 12), SwCalibrationAccess="ReadWrite", StorageClass="Global", MemorySection="CAL", DataType="single")
P_LCS_AngleSlopeNormal_LKA_11 = AUTOSAR4.Parameter(repmat(0.4, 1, 12), SwCalibrationAccess="ReadWrite", StorageClass="Global", MemorySection="CAL", DataType="single")
P_LCS_AngleSlopeNormal_ELK_12 = AUTOSAR4.Parameter(repmat(0.4, 1, 12), SwCalibrationAccess="ReadWrite", StorageClass="Global", MemorySection="CAL", DataType="single")
P_LCS_AngleSlopeNormal_ESS_13 = AUTOSAR4.Parameter(repmat(0.4, 1, 12), SwCalibrationAccess="ReadWrite", StorageClass="Global", MemorySection="CAL", DataType="single")
P_LCS_LevelType = AUTOSAR4.Parameter(1, SwCalibrationAccess="ReadWrite", StorageClass="Global", MemorySection="CAL", DataType="single")
P_LCS_End_Offset_Switch = AUTOSAR4.Parameter(1, SwCalibrationAccess="ReadWrite", StorageClass="Global", MemorySection="CAL", DataType="single")
P_LCS_AngleSlope_limitCnt_BP = AUTOSAR4.Parameter([0 10 20 30 40 50 60 70 80 90 100 110 210 230], SwCalibrationAccess="ReadWrite", StorageClass="Global", MemorySection="CAL", DataType="single")
P_LCS_LCK_preDis_Nomal = AUTOSAR4.Parameter([8 9 10 11 12 13 14 15 17 22 28 33 35 38 42 49], SwCalibrationAccess="ReadWrite", StorageClass="Global", MemorySection="CAL", DataType="single")
P_LCS_A0_Dis_BP = AUTOSAR4.Parameter([0 0.2 0.4 0.6 0.8 1 1.2 1.4 1.6 1.8 2 2.2 2.4 2.6 2.8 3 3.2 3.4 3.6], SwCalibrationAccess="ReadWrite", StorageClass="Global", MemorySection="CAL", DataType="single")
P_LCS_AngleSlope_SpdBp = AUTOSAR4.Parameter([0 10 20 30 40 60 80 90 100 110 120 140], SwCalibrationAccess="ReadWrite", StorageClass="Global", MemorySection="CAL", DataType="single")

P_LCS_AngleSlope_IE2LCK_14 = AUTOSAR4.Parameter([0.2 0.2 0.2 0.2 0.2 0.2 0.1 0.1 0.1 0.1 0.1 0.1
 0.2 0.2 0.2 0.2 0.2 0.2 0.2 0.2 0.2 0.2 0.2 0.2
 0.3 0.3 0.3 0.3 0.3 0.3 0.3 0.3 0.3 0.3 0.3 0.3
 0.4 0.4 0.4 0.4 0.4 0.4 0.4 0.4 0.4 0.4 0.4 0.4
 0.4 0.4 0.4 0.4 0.4 0.4 0.4 0.4 0.4 0.4 0.4 0.4
 0.4 0.4 0.4 0.4 0.4 0.4 0.4 0.4 0.4 0.4 0.4 0.4
 0.4 0.4 0.4 0.4 0.4 0.4 0.4 0.4 0.4 0.4 0.4 0.4
 0.4 0.4 0.4 0.4 0.4 0.4 0.4 0.4 0.4 0.4 0.4 0.4
 0.4 0.4 0.4 0.4 0.4 0.4 0.4 0.4 0.4 0.4 0.4 0.4
 0.4 0.4 0.4 0.4 0.4 0.4 0.4 0.4 0.4 0.4 0.4 0.4
 0.4 0.4 0.4 0.4 0.4 0.4 0.4 0.4 0.4 0.4 0.4 0.4
 0.4 0.4 0.4 0.4 0.4 0.4 0.4 0.4 0.4 0.4 0.4 0.4
 0.4 0.4 0.4 0.4 0.4 0.4 0.4 0.4 0.4 0.4 0.4 0.4
 0.4 0.4 0.4 0.4 0.4 0.4 0.4 0.4 0.4 0.4 0.4 0.4
 0.4 0.4 0.4 0.4 0.4 0.4 0.4 0.4 0.4 0.4 0.4 0.4
 0.4 0.4 0.4 0.4 0.4 0.4 0.4 0.4 0.4 0.4 0.4 0.4
 0.4 0.4 0.4 0.4 0.4 0.4 0.4 0.4 0.4 0.4 0.4 0.4
 0.4 0.4 0.4 0.4 0.4 0.4 0.4 0.4 0.4 0.4 0.4 0.4
 0.4 0.4 0.4 0.4 0.4 0.4 0.4 0.4 0.4 0.4 0.4 0.4], SwCalibrationAccess="ReadWrite", StorageClass="Global", MemorySection="CAL", DataType="single")

P_LCS_AngleSlope_LKA2LCK_15 = AUTOSAR4.Parameter([0.2 0.2 0.2 0.2 0.2 0.2 0.1 0.1 0.1 0.1 0.1 0.1
 0.2 0.2 0.2 0.2 0.2 0.2 0.2 0.2 0.2 0.2 0.2 0.2
 0.3 0.3 0.3 0.3 0.3 0.3 0.3 0.3 0.3 0.3 0.3 0.3
 0.4 0.4 0.4 0.4 0.4 0.4 0.4 0.4 0.4 0.4 0.4 0.4
 0.4 0.4 0.4 0.4 0.4 0.4 0.4 0.4 0.4 0.4 0.4 0.4
 0.4 0.4 0.4 0.4 0.4 0.4 0.4 0.4 0.4 0.4 0.4 0.4
 0.4 0.4 0.4 0.4 0.4 0.4 0.4 0.4 0.4 0.4 0.4 0.4
 0.4 0.4 0.4 0.4 0.4 0.4 0.4 0.4 0.4 0.4 0.4 0.4
 0.4 0.4 0.4 0.4 0.4 0.4 0.4 0.4 0.4 0.4 0.4 0.4
 0.4 0.4 0.4 0.4 0.4 0.4 0.4 0.4 0.4 0.4 0.4 0.4
 0.4 0.4 0.4 0.4 0.4 0.4 0.4 0.4 0.4 0.4 0.4 0.4
 0.4 0.4 0.4 0.4 0.4 0.4 0.4 0.4 0.4 0.4 0.4 0.4
 0.4 0.4 0.4 0.4 0.4 0.4 0.4 0.4 0.4 0.4 0.4 0.4
 0.4 0.4 0.4 0.4 0.4 0.4 0.4 0.4 0.4 0.4 0.4 0.4
 0.4 0.4 0.4 0.4 0.4 0.4 0.4 0.4 0.4 0.4 0.4 0.4
 0.4 0.4 0.4 0.4 0.4 0.4 0.4 0.4 0.4 0.4 0.4 0.4
 0.4 0.4 0.4 0.4 0.4 0.4 0.4 0.4 0.4 0.4 0.4 0.4
 0.4 0.4 0.4 0.4 0.4 0.4 0.4 0.4 0.4 0.4 0.4 0.4
 0.4 0.4 0.4 0.4 0.4 0.4 0.4 0.4 0.4 0.4 0.4 0.4], SwCalibrationAccess="ReadWrite", StorageClass="Global", MemorySection="CAL", DataType="single")

P_LCS_AngleSlope_LKA_17 = AUTOSAR4.Parameter([0.2 0.2 0.2 0.2 0.2 0.2 0.1 0.1 0.1 0.1 0.1 0.1
 0.2 0.2 0.2 0.2 0.2 0.2 0.2 0.2 0.2 0.2 0.2 0.2
 0.3 0.3 0.3 0.3 0.3 0.3 0.3 0.3 0.3 0.3 0.3 0.3
 0.4 0.4 0.4 0.4 0.4 0.4 0.4 0.4 0.4 0.4 0.4 0.4
 0.4 0.4 0.4 0.4 0.4 0.4 0.4 0.4 0.4 0.4 0.4 0.4
 0.4 0.4 0.4 0.4 0.4 0.4 0.4 0.4 0.4 0.4 0.4 0.4
 0.4 0.4 0.4 0.4 0.4 0.4 0.4 0.4 0.4 0.4 0.4 0.4
 0.4 0.4 0.4 0.4 0.4 0.4 0.4 0.4 0.4 0.4 0.4 0.4
 0.4 0.4 0.4 0.4 0.4 0.4 0.4 0.4 0.4 0.4 0.4 0.4
 0.4 0.4 0.4 0.4 0.4 0.4 0.4 0.4 0.4 0.4 0.4 0.4
 0.4 0.4 0.4 0.4 0.4 0.4 0.4 0.4 0.4 0.4 0.4 0.4
 0.4 0.4 0.4 0.4 0.4 0.4 0.4 0.4 0.4 0.4 0.4 0.4
 0.4 0.4 0.4 0.4 0.4 0.4 0.4 0.4 0.4 0.4 0.4 0.4
 0.4 0.4 0.4 0.4 0.4 0.4 0.4 0.4 0.4 0.4 0.4 0.4
 0.4 0.4 0.4 0.4 0.4 0.4 0.4 0.4 0.4 0.4 0.4 0.4
 0.4 0.4 0.4 0.4 0.4 0.4 0.4 0.4 0.4 0.4 0.4 0.4
 0.4 0.4 0.4 0.4 0.4 0.4 0.4 0.4 0.4 0.4 0.4 0.4
 0.4 0.4 0.4 0.4 0.4 0.4 0.4 0.4 0.4 0.4 0.4 0.4
 0.4 0.4 0.4 0.4 0.4 0.4 0.4 0.4 0.4 0.4 0.4 0.4], SwCalibrationAccess="ReadWrite", StorageClass="Global", MemorySection="CAL", DataType="single")

P_LCS_AngleSlope_HoldTime = AUTOSAR4.Parameter([0.6 0.6 0.6 0.6 0.6 0.6 0.6 0.6 0.6 0.6 0.6 1
 0.6 0.6 0.6 0.6 0.6 0.6 0.6 0.6 0.6 0.6 0.6 1
 0.6 0.6 0.6 0.6 0.6 0.6 0.6 0.6 0.6 0.6 0.6 1
 0.6 0.6 0.6 0.6 0.6 0.6 0.6 0.6 0.6 0.6 0.6 1
 0.6 0.6 0.6 0.6 0.6 0.6 0.6 0.6 0.6 0.6 0.6 1
 0.6 0.6 0.6 0.6 0.6 0.6 0.6 0.6 0.6 0.6 0.6 1
 0.6 0.6 0.6 0.6 0.6 0.6 0.6 0.6 0.6 0.6 0.6 1], SwCalibrationAccess="ReadWrite", StorageClass="Global", MemorySection="CAL", DataType="single")

P_LCS_AngleSlope_IE_2 = AUTOSAR4.Parameter([0.2 0.2 0.2 0.2 0.2 0.2 0.1 0.1 0.1 0.1 0.1 0.1
 0.2 0.2 0.2 0.2 0.2 0.2 0.2 0.2 0.2 0.2 0.2 0.2
 0.3 0.3 0.3 0.3 0.3 0.3 0.3 0.3 0.3 0.3 0.3 0.3
 0.4 0.4 0.4 0.4 0.4 0.4 0.4 0.4 0.4 0.4 0.4 0.4
 0.4 0.4 0.4 0.4 0.4 0.4 0.4 0.4 0.4 0.4 0.4 0.4
 0.4 0.4 0.4 0.4 0.4 0.4 0.4 0.4 0.4 0.4 0.4 0.4
 0.4 0.4 0.4 0.4 0.4 0.4 0.4 0.4 0.4 0.4 0.4 0.4
 0.4 0.4 0.4 0.4 0.4 0.4 0.4 0.4 0.4 0.4 0.4 0.4
 0.4 0.4 0.4 0.4 0.4 0.4 0.4 0.4 0.4 0.4 0.4 0.4
 0.4 0.4 0.4 0.4 0.4 0.4 0.4 0.4 0.4 0.4 0.4 0.4
 0.4 0.4 0.4 0.4 0.4 0.4 0.4 0.4 0.4 0.4 0.4 0.4
 0.4 0.4 0.4 0.4 0.4 0.4 0.4 0.4 0.4 0.4 0.4 0.4
 0.4 0.4 0.4 0.4 0.4 0.4 0.4 0.4 0.4 0.4 0.4 0.4
 0.4 0.4 0.4 0.4 0.4 0.4 0.4 0.4 0.4 0.4 0.4 0.4
 0.4 0.4 0.4 0.4 0.4 0.4 0.4 0.4 0.4 0.4 0.4 0.4
 0.4 0.4 0.4 0.4 0.4 0.4 0.4 0.4 0.4 0.4 0.4 0.4
 0.4 0.4 0.4 0.4 0.4 0.4 0.4 0.4 0.4 0.4 0.4 0.4
 0.4 0.4 0.4 0.4 0.4 0.4 0.4 0.4 0.4 0.4 0.4 0.4
 0.4 0.4 0.4 0.4 0.4 0.4 0.4 0.4 0.4 0.4 0.4 0.4], SwCalibrationAccess="ReadWrite", StorageClass="Global", MemorySection="CAL", DataType="single")

P_LCS_OffsetCaclc_SpdLow = AUTOSAR4.Parameter(20, SwCalibrationAccess="ReadWrite", StorageClass="Global", MemorySection="CAL", DataType="single")
P_LCS_OffsetCaclc_SpdUp = AUTOSAR4.Parameter(130, SwCalibrationAccess="ReadWrite", StorageClass="Global", MemorySection="CAL", DataType="single")
P_LCS_Offset_A2_FliterTime = AUTOSAR4.Parameter(2, SwCalibrationAccess="ReadWrite", StorageClass="Global", MemorySection="CAL", DataType="single")
P_LCS_preDis_Nomal = AUTOSAR4.Parameter([8 9 10 11 12 13 14 15 17 22 28 31 35 38 42 49], SwCalibrationAccess="ReadWrite", StorageClass="Global", MemorySection="CAL", DataType="single")
P_LCS_Offset_FliterTime = AUTOSAR4.Parameter(2, SwCalibrationAccess="ReadWrite", StorageClass="Global", MemorySection="CAL", DataType="single")
P_LCS_Offset_Switch = AUTOSAR4.Parameter(1, SwCalibrationAccess="ReadWrite", StorageClass="Global", MemorySection="CAL", DataType="boolean")
P_LCS_StateActive_HoldTime_BP = AUTOSAR4.Parameter([0 0.2 0.4 0.6 0.8 1 1.2 1.4 1.6 1.8 2 4 6 8 10], SwCalibrationAccess="ReadWrite", StorageClass="Global", MemorySection="CAL", DataType="single")
P_LCS_AngleSlope_LCKIE = AUTOSAR4.Parameter(repmat(0.4, 19, 12), SwCalibrationAccess="ReadWrite", StorageClass="Global", MemorySection="CAL", DataType="single")
P_LCS_AngleSlope_LCK = AUTOSAR4.Parameter(repmat(0.4, 19, 12), SwCalibrationAccess="ReadWrite", StorageClass="Global", MemorySection="CAL", DataType="single")

P_LCS_AngleSlope_LC_Nomal = AUTOSAR4.Parameter([0.4 0.4 0.4 0.4 0.4 0.4 0.4 0.4 0.4 0.4 0.4 0.4
 0.4 0.4 0.4 0.4 0.4 0.4 0.4 0.4 0.4 0.4 0.4 0.4
 0.4 0.4 0.4 0.4 0.4 0.4 0.4 0.4 0.4 0.4 0.4 0.4
 0.35 0.35 0.35 0.35 0.35 0.35 0.35 0.35 0.35 0.35 0.35 0.35
 0.35 0.35 0.35 0.35 0.35 0.35 0.35 0.35 0.35 0.35 0.35 0.35
 0.35 0.35 0.35 0.35 0.35 0.35 0.35 0.35 0.35 0.35 0.35 0.35
 0.35 0.35 0.35 0.35 0.35 0.35 0.35 0.35 0.35 0.35 0.35 0.35
 0.35 0.35 0.35 0.35 0.35 0.35 0.35 0.35 0.35 0.35 0.35 0.35
 0.35 0.35 0.35 0.35 0.35 0.35 0.35 0.35 0.35 0.35 0.35 0.35
 0.3 0.3 0.3 0.3 0.3 0.3 0.3 0.3 0.3 0.3 0.3 0.3
 0.3 0.3 0.3 0.3 0.3 0.3 0.3 0.3 0.3 0.3 0.3 0.3
 0.3 0.3 0.3 0.3 0.3 0.3 0.3 0.3 0.3 0.3 0.3 0.3
 0.3 0.3 0.3 0.3 0.3 0.3 0.3 0.3 0.3 0.3 0.3 0.3
 0.3 0.3 0.3 0.3 0.3 0.3 0.3 0.3 0.3 0.3 0.3 0.3
 0.3 0.3 0.3 0.3 0.3 0.3 0.3 0.3 0.3 0.3 0.3 0.3
 0.3 0.3 0.3 0.3 0.3 0.3 0.3 0.3 0.3 0.3 0.3 0.3
 0.3 0.3 0.3 0.3 0.3 0.3 0.3 0.3 0.3 0.3 0.3 0.3
 0.3 0.3 0.3 0.3 0.3 0.3 0.3 0.3 0.3 0.3 0.3 0.3
 0.3 0.3 0.3 0.3 0.3 0.3 0.3 0.3 0.3 0.3 0.3 0.3], SwCalibrationAccess="ReadWrite", StorageClass="Global", MemorySection="CAL", DataType="single")

P_LCS_AngleSlope_LKA = AUTOSAR4.Parameter([0.2 0.2 0.2 0.2 0.2 0.2 0.1 0.1 0.1 0.1 0.1 0.1
 0.2 0.2 0.2 0.2 0.2 0.2 0.2 0.2 0.2 0.2 0.2 0.2
 0.3 0.3 0.3 0.3 0.3 0.3 0.3 0.3 0.3 0.3 0.3 0.3
 0.4 0.4 0.4 0.4 0.4 0.4 0.4 0.4 0.4 0.4 0.4 0.4
 0.4 0.4 0.4 0.4 0.4 0.4 0.4 0.4 0.4 0.4 0.4 0.4
 0.4 0.4 0.4 0.4 0.4 0.4 0.4 0.4 0.4 0.4 0.4 0.4
 0.4 0.4 0.4 0.4 0.4 0.4 0.4 0.4 0.4 0.4 0.4 0.4
 0.4 0.4 0.4 0.4 0.4 0.4 0.4 0.4 0.4 0.4 0.4 0.4
 0.4 0.4 0.4 0.4 0.4 0.4 0.4 0.4 0.4 0.4 0.4 0.4
 0.4 0.4 0.4 0.4 0.4 0.4 0.4 0.4 0.4 0.4 0.4 0.4
 0.4 0.4 0.4 0.4 0.4 0.4 0.4 0.4 0.4 0.4 0.4 0.4
 0.4 0.4 0.4 0.4 0.4 0.4 0.4 0.4 0.4 0.4 0.4 0.4
 0.4 0.4 0.4 0.4 0.4 0.4 0.4 0.4 0.4 0.4 0.4 0.4
 0.4 0.4 0.4 0.4 0.4 0.4 0.4 0.4 0.4 0.4 0.4 0.4
 0.4 0.4 0.4 0.4 0.4 0.4 0.4 0.4 0.4 0.4 0.4 0.4
 0.4 0.4 0.4 0.4 0.4 0.4 0.4 0.4 0.4 0.4 0.4 0.4
 0.4 0.4 0.4 0.4 0.4 0.4 0.4 0.4 0.4 0.4 0.4 0.4
 0.4 0.4 0.4 0.4 0.4 0.4 0.4 0.4 0.4 0.4 0.4 0.4
 0.4 0.4 0.4 0.4 0.4 0.4 0.4 0.4 0.4 0.4 0.4 0.4], SwCalibrationAccess="ReadWrite", StorageClass="Global", MemorySection="CAL", DataType="single")

P_LCS_AngleSlope_LC_Eco = AUTOSAR4.Parameter([0.4 0.4 0.4 0.4 0.4 0.4 0.4 0.4 0.4 0.4 0.4 0.4
 0.4 0.4 0.4 0.4 0.4 0.4 0.4 0.4 0.4 0.4 0.4 0.4
 0.4 0.4 0.4 0.4 0.4 0.4 0.4 0.4 0.4 0.4 0.4 0.4
 0.35 0.35 0.35 0.35 0.35 0.35 0.35 0.35 0.35 0.35 0.35 0.35
 0.35 0.35 0.35 0.35 0.35 0.35 0.35 0.35 0.35 0.35 0.35 0.35
 0.35 0.35 0.35 0.35 0.35 0.35 0.35 0.35 0.35 0.35 0.35 0.35
 0.35 0.35 0.35 0.35 0.35 0.35 0.35 0.35 0.35 0.35 0.35 0.35
 0.35 0.35 0.35 0.35 0.35 0.35 0.35 0.35 0.35 0.35 0.35 0.35
 0.35 0.35 0.35 0.35 0.35 0.35 0.35 0.35 0.35 0.35 0.35 0.35
 0.3 0.3 0.3 0.3 0.3 0.3 0.3 0.3 0.3 0.3 0.3 0.3
 0.3 0.3 0.3 0.3 0.3 0.3 0.3 0.3 0.3 0.3 0.3 0.3
 0.3 0.3 0.3 0.3 0.3 0.3 0.3 0.3 0.3 0.3 0.3 0.3
 0.3 0.3 0.3 0.3 0.3 0.3 0.3 0.3 0.3 0.3 0.3 0.3
 0.3 0.3 0.3 0.3 0.3 0.3 0.3 0.3 0.3 0.3 0.3 0.3
 0.3 0.3 0.3 0.3 0.3 0.3 0.3 0.3 0.3 0.3 0.3 0.3
 0.3 0.3 0.3 0.3 0.3 0.3 0.3 0.3 0.3 0.3 0.3 0.3
 0.3 0.3 0.3 0.3 0.3 0.3 0.3 0.3 0.3 0.3 0.3 0.3
 0.3 0.3 0.3 0.3 0.3 0.3 0.3 0.3 0.3 0.3 0.3 0.3
 0.3 0.3 0.3 0.3 0.3 0.3 0.3 0.3 0.3 0.3 0.3 0.3], SwCalibrationAccess="ReadWrite", StorageClass="Global", MemorySection="CAL", DataType="single")

P_LCS_FF_LCRevs_SpdBP = AUTOSAR4.Parameter([0 10 20 30 40 50 60 70 80 90 100 110 120 130], SwCalibrationAccess="ReadWrite", StorageClass="Global", MemorySection="CAL", DataType="single")
P_LCS_FF_LCRevs_TimeFacVal = AUTOSAR4.Parameter([0.35 0.2 0.1 0.05], SwCalibrationAccess="ReadWrite", StorageClass="Global", MemorySection="CAL", DataType="single")
P_LCS_FF_LCRevs_TimeBP = AUTOSAR4.Parameter([0 0.5 1 1.5], SwCalibrationAccess="ReadWrite", StorageClass="Global", MemorySection="CAL", DataType="single")
P_LCS_FF_Param_CurveFac = AUTOSAR4.Parameter([1 1 1.0691 1.1055 1.4424 1.6703 1.8], SwCalibrationAccess="ReadWrite", StorageClass="Global", MemorySection="CAL", DataType="single")
P_LCS_FF_Param_CurveBp = AUTOSAR4.Parameter([0 0.003 0.008 0.01 0.05 0.08 0.1], SwCalibrationAccess="ReadWrite", StorageClass="Global", MemorySection="CAL", DataType="single")
P_LCS_FFWSwitch = AUTOSAR4.Parameter(0, SwCalibrationAccess="ReadWrite", StorageClass="Global", MemorySection="CAL", DataType="single")
P_LCS_FF_TarAngleTorq_Factor = AUTOSAR4.Parameter([-2.35 -2.2937 -2.1785 -2.1305 -2.0729 -1.9866 -1.9098 -1.737 -1.5739 -1.4395 -1.3148 -1.1804 -1.0461 -0.97889 -0.85 -0.78 -0.71017 -0.6334 -0.4 0 0.4 0.50864 0.62 0.7 0.8 0.91 0.97889 1.1 1.2476 1.4299 1.5451 1.7 1.8 1.9194 2 2.0441 2.0921 2.25 2.3], SwCalibrationAccess="ReadWrite", StorageClass="Global", MemorySection="CAL", DataType="single")
P_LCS_FF_TarAngleTorq_Bp = AUTOSAR4.Parameter([-100 -80 -60 -55 -50 -45 -40 -35 -30 -25 -20 -15 -12 -10 -8 -6 -5 -4 -2 0 2 4 5 6 8 10 12 15 20 25 30 35 40 45 50 55 60 80 100], SwCalibrationAccess="ReadWrite", StorageClass="Global", MemorySection="CAL", DataType="single")
P_LCS_FF_Speed_Factor = AUTOSAR4.Parameter([0.69545 0.6 0.56212 0.56212 0.56515 0.57121 0.57424 0.58333 0.6 0.95 1 1 1 1 1 1], SwCalibrationAccess="ReadWrite", StorageClass="Global", MemorySection="CAL", DataType="single")
P_LCS_FF_Speed_Bp = AUTOSAR4.Parameter([0 5 10 15 20 25 30 35 40 60 70 80 90 100 120 140], SwCalibrationAccess="ReadWrite", StorageClass="Global", MemorySection="CAL", DataType="single")

P_LCS_FFW_Torq_V71 = AUTOSAR4.Parameter([-2.9 -2.3 -2.6 -2.9 -2.62 -2.9 -2.55 -2.29
 -2.9 -1.96 -2.6 -2.9 -2.62 -2.9 -2.55 -2.29
 -2.9 -1.65 -2.15 -2.9 -2.62 -2.9 -2.55 -2.29
 -2.5 -1.5 -2.1 -2.9 -2.62 -2.9 -2.55 -2.29
 -2.45 -1.45 -2.07 -2.8 -2.62 -2.9 -2.55 -2.29
 -2.35 -1.34 -2 -2.6 -2.62 -2.9 -2.55 -2.29
 -2.31 -1.22 -1.85 -2.45 -2.62 -2.9 -2.55 -2.29
 -2.18 -1.15 -1.75 -2.37 -2.62 -2.9 -2.55 -2.29
 -2.05 -1.04 -1.65 -2 -2.62 -2.9 -2.55 -2.29
 -1.86 -0.92 -1.3 -1.96 -2.61 -2.9 -2.55 -2.29
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 ], SwCalibrationAccess="ReadWrite", StorageClass="Global", MemorySection="CAL", DataType="single")

P_LCS_AngleErrorReversTorq_VehSpdBp = AUTOSAR4.Parameter([60 80 90 100 150], SwCalibrationAccess="ReadWrite", StorageClass="Global", MemorySection="CAL", DataType="single")
P_LCS_TorqueGainFilterTime = AUTOSAR4.Parameter(0.1, SwCalibrationAccess="ReadWrite", StorageClass="Global", MemorySection="CAL", DataType="single")
P_LCS_PID_Param_GainSwitch = AUTOSAR4.Parameter(0, SwCalibrationAccess="ReadWrite", StorageClass="Global", MemorySection="CAL", DataType="single")
P_LCS_PID_Param_Speed_Factor_P = AUTOSAR4.Parameter([1 0.8 0.8 0.8 0.8 0.8 0.8 0.8 0.8 0.8 0.8 0.8 0.7 0.6 0.6 0.5], SwCalibrationAccess="ReadWrite", StorageClass="Global", MemorySection="CAL", DataType="single")  % 更新高速P
P_LCS_PID_Param_Speed_Adapt = AUTOSAR4.Parameter([0 5 10 15 20 25 30 35 40 60 70 80 90 100 120 140], SwCalibrationAccess="ReadWrite", StorageClass="Global", MemorySection="CAL", DataType="single")
P_LCS_PID_Param_Speed_Factor_D = AUTOSAR4.Parameter([0.01 0.05 0.1 0.2 0.3 0.4 0.5 0.6 0.8 1 1 1 1 1 1 1], SwCalibrationAccess="ReadWrite", StorageClass="Global", MemorySection="CAL", DataType="single")
P_LCS_PID_Param_Speed_Factor_I = AUTOSAR4.Parameter([0.01 0.05 0.1 0.2 0.3 0.4 0.5 0.6 0.8 0.8 0.8 0.8 0.8 0.8 0.8 0.8], SwCalibrationAccess="ReadWrite", StorageClass="Global", MemorySection="CAL", DataType="single")
P_LCS_PID_Param_SteerWheelSpd_Factor_P = AUTOSAR4.Parameter([1 1 1 0.98 0.8 0.6 0.4 0.3], SwCalibrationAccess="ReadWrite", StorageClass="Global", MemorySection="CAL", DataType="single")
P_LCS_PID_Param_SteerWheelSpd_Adapt = AUTOSAR4.Parameter([0 5 8 10 20 30 40 50], SwCalibrationAccess="ReadWrite", StorageClass="Global", MemorySection="CAL", DataType="single")
P_LCS_PID_Param_SteerWheelSpd_Factor_D = AUTOSAR4.Parameter([1 1.5 1.8 2 2.5 2.8 3 4], SwCalibrationAccess="ReadWrite", StorageClass="Global", MemorySection="CAL", DataType="single")
P_LCS_PID_Param_SteerWheelAngle_Factor_P = AUTOSAR4.Parameter([1 1 1 0.9 0.8 0.7 0.6 0.58], SwCalibrationAccess="ReadWrite", StorageClass="Global", MemorySection="CAL", DataType="single")
P_LCS_PID_Param_SteerWheelAngle_Adapt = AUTOSAR4.Parameter([0 3 6 10 15 20 30 45], SwCalibrationAccess="ReadWrite", StorageClass="Global", MemorySection="CAL", DataType="single")
P_LCS_PID_Param_SteerWheelAngle_Factor_D = AUTOSAR4.Parameter([1 1 1 0.6 0.3 0.3 0.2 0.2], SwCalibrationAccess="ReadWrite", StorageClass="Global", MemorySection="CAL", DataType="single")
P_LCS_PID_AngErrFacVal = AUTOSAR4.Parameter([1 1 0.8 0.6 0.3], SwCalibrationAccess="ReadWrite", StorageClass="Global", MemorySection="CAL", DataType="single")
P_LCS_PID_AngErrFacBp = AUTOSAR4.Parameter([0 2 4 6 12], SwCalibrationAccess="ReadWrite", StorageClass="Global", MemorySection="CAL", DataType="single")
P_LCS_PID_Param_CurveFac = AUTOSAR4.Parameter([0 0 0.069091 0.10545 0.44242 0.6703 0.8], SwCalibrationAccess="ReadWrite", StorageClass="Global", MemorySection="CAL", DataType="single")
P_LCS_PID_Param_CurveBp = AUTOSAR4.Parameter([0 0.003 0.008 0.01 0.05 0.08 0.1], SwCalibrationAccess="ReadWrite", StorageClass="Global", MemorySection="CAL", DataType="single")
P_LCS_OverRideTime_TH_s = AUTOSAR4.Parameter(0.5, SwCalibrationAccess="ReadWrite", StorageClass="Global", MemorySection="CAL", DataType="single")
P_LCS_NoOverRideTime_TH_s = AUTOSAR4.Parameter(1, SwCalibrationAccess="ReadWrite", StorageClass="Global", MemorySection="CAL", DataType="single")
P_LCS_DetOverRide_DrvTrq_TH = AUTOSAR4.Parameter(1, SwCalibrationAccess="ReadWrite", StorageClass="Global", MemorySection="CAL", DataType="single")
P_LCS_DetNoOverRide_DrvTrq_TH = AUTOSAR4.Parameter(0.7, SwCalibrationAccess="ReadWrite", StorageClass="Global", MemorySection="CAL", DataType="single")

P_LCS_AngleSlope_LC_Sport = AUTOSAR4.Parameter([0.4 0.4 0.4 0.4 0.4 0.4 0.4 0.4 0.4 0.4 0.4 0.4
 0.4 0.4 0.4 0.4 0.4 0.4 0.4 0.4 0.4 0.4 0.4 0.4
 0.4 0.4 0.4 0.4 0.4 0.4 0.4 0.4 0.4 0.4 0.4 0.4
 0.35 0.35 0.35 0.35 0.35 0.35 0.35 0.35 0.35 0.35 0.35 0.35
 0.35 0.35 0.35 0.35 0.35 0.35 0.35 0.35 0.35 0.35 0.35 0.35
 0.35 0.35 0.35 0.35 0.35 0.35 0.35 0.35 0.35 0.35 0.35 0.35
 0.35 0.35 0.35 0.35 0.35 0.35 0.35 0.35 0.35 0.35 0.35 0.35
 0.35 0.35 0.35 0.35 0.35 0.35 0.35 0.35 0.35 0.35 0.35 0.35
 0.35 0.35 0.35 0.35 0.35 0.35 0.35 0.35 0.35 0.35 0.35 0.35
 0.3 0.3 0.3 0.3 0.3 0.3 0.3 0.3 0.3 0.3 0.3 0.3
 0.3 0.3 0.3 0.3 0.3 0.3 0.3 0.3 0.3 0.3 0.3 0.3
 0.3 0.3 0.3 0.3 0.3 0.3 0.3 0.3 0.3 0.3 0.3 0.3
 0.3 0.3 0.3 0.3 0.3 0.3 0.3 0.3 0.3 0.3 0.3 0.3
 0.3 0.3 0.3 0.3 0.3 0.3 0.3 0.3 0.3 0.3 0.3 0.3
 0.3 0.3 0.3 0.3 0.3 0.3 0.3 0.3 0.3 0.3 0.3 0.3
 0.3 0.3 0.3 0.3 0.3 0.3 0.3 0.3 0.3 0.3 0.3 0.3
 0.3 0.3 0.3 0.3 0.3 0.3 0.3 0.3 0.3 0.3 0.3 0.3
 0.3 0.3 0.3 0.3 0.3 0.3 0.3 0.3 0.3 0.3 0.3 0.3
 0.3 0.3 0.3 0.3 0.3 0.3 0.3 0.3 0.3 0.3 0.3 0.3], SwCalibrationAccess="ReadWrite", StorageClass="Global", MemorySection="CAL", DataType="single")

P_LCS_DeltaEps_TimeVal = AUTOSAR4.Parameter([0.8 0.8 0.8 0.8 0.8 0.8 0.8 0.8 0.8 0.8 0.5 0.5 0.5 0.5 0.5 0.5], SwCalibrationAccess="ReadWrite", StorageClass="Global", MemorySection="CAL", DataType="single")
P_LCS_FF_EnableSpd = AUTOSAR4.Parameter(5, SwCalibrationAccess="ReadWrite", StorageClass="Global", MemorySection="CAL", DataType="single")
P_LCS_FFW_Torq_SpdBp = AUTOSAR4.Parameter([0 10 30 50 70 90 110 120], SwCalibrationAccess="ReadWrite", StorageClass="Global", MemorySection="CAL", DataType="single")
P_LCS_AngleErrorReversTorq_LC_VehSpdBp = AUTOSAR4.Parameter([0 5 10 15 20 25 30 35 40 60 70 80 90 100 120 140], SwCalibrationAccess="ReadWrite", StorageClass="Global", MemorySection="CAL", DataType="single")
P_LCS_CurentOffset_LimitValue = AUTOSAR4.Parameter(0.001, SwCalibrationAccess="ReadWrite", StorageClass="Global", MemorySection="CAL", DataType="single")
P_LCS_CurOffset_SterAngleSpd_LimitValue = AUTOSAR4.Parameter(6, SwCalibrationAccess="ReadWrite", StorageClass="Global", MemorySection="CAL", DataType="single")
P_LCS_ESSAngleSW2 = AUTOSAR4.Parameter(0, SwCalibrationAccess="ReadWrite", StorageClass="Global", MemorySection="CAL", DataType="single")
P_LCS_ESS_Test_SW = AUTOSAR4.Parameter(0, SwCalibrationAccess="ReadWrite", StorageClass="Global", MemorySection="CAL", DataType="single")
P_LCS_ESSOverrideTime1 = AUTOSAR4.Parameter(0.06, SwCalibrationAccess="ReadWrite", StorageClass="Global", MemorySection="CAL", DataType="single")
P_LCS_ESSOverrideTime3 = AUTOSAR4.Parameter(0.06, SwCalibrationAccess="ReadWrite", StorageClass="Global", MemorySection="CAL", DataType="single")

P_LCS_preDis_ESS_Fac = AUTOSAR4.Parameter([0 0 0 0 0 0 0 0 -0.1 -0.1 -0.1 0 0 0 0 0
 0 0 0 0 0 0 0 0 -0.1 -0.1 -0.1 0 0 0 0 0
 0 0 0 0 0 0 0 0 -0.1 -0.1 -0.1 0 0 0 0 0
 0 0 0 0 0 0 0 0 -0.1 -0.1 -0.1 0 0 0 0 0
 -0.1 -0.1 -0.1 -0.1 -0.1 0.1 0.1 0.1 -0.3 -0.3 -0.3 0 0 0 0 0
 -0.1 -0.1 -0.1 -0.1 -0.1 0.1 0.1 0.1 -0.3 -0.3 -0.3 0 0 0 0 0
 -0.1 -0.1 -0.1 -0.1 -0.1 0.1 0.2 0.2 -0.3 -0.3 -0.3 0 0 0 0 0
 -0.1 -0.1 -0.1 -0.1 -0.1 0.1 0.3 0.3 -0.3 -0.3 -0.3 0 0 0 0 0
 -0.1 -0.1 -0.1 -0.1 -0.1 0.1 0.3 0.3 -0.3 -0.3 -0.3 0 0 0 0 0
 -0.1 -0.1 -0.1 -0.1 -0.1 0.1 0.3 0.3 -0.3 -0.3 -0.3 0 0 0 0 0
 0.1 0.1 0.1 0.1 0.2 0.35 0.4 0.4 -0.3 -0.3 -0.3 0 0 0 0 0
 0.1 0.1 0.1 0.1 0.2 0.35 0.4 0.4 -0.3 -0.3 -0.3 0 0 0 0 0
 0.1 0.1 0.1 0.1 0.2 0.35 0.4 0.4 -0.3 -0.3 -0.3 0 0 0 0 0
 0.2 0.2 0.2 0.2 0.35 0.35 0.4 0.4 -0.3 -0.3 -0.3 0 0 0 0 0
 0.2 0.2 0.2 0.2 0.35 0.35 0.4 0.4 -0.45 -0.45 -0.45 0 0 0 0 0
 0.2 0.2 0.2 0.2 0.35 0.35 0.4 0.4 -0.45 -0.45 -0.45 0 0 0 0 0
 0.2 0.2 0.2 0.2 0.35 0.35 0.4 0.4 -0.45 -0.45 -0.45 0 0 0 0 0
 0.2 0.2 0.2 0.2 0.35 0.35 0.4 0.4 -0.45 -0.45 -0.45 0 0 0 0 0
 0.2 0.2 0.2 0.2 0.35 0.35 0.4 0.4 -0.45 -0.45 -0.45 0 0 0 0 0], SwCalibrationAccess="ReadWrite", StorageClass="Global", MemorySection="CAL", DataType="single")

P_LCS_ESS_SteerAngleErr = AUTOSAR4.Parameter(repmat(30, 1, 16), SwCalibrationAccess="ReadWrite", StorageClass="Global", MemorySection="CAL", DataType="single")
P_LCS_ESS_NotActiveFlgDelayTime = AUTOSAR4.Parameter(0, SwCalibrationAccess="ReadWrite", StorageClass="Global", MemorySection="CAL", DataType="single")
P_LCS_ESS_NotActiveFlgDelayTimeSW = AUTOSAR4.Parameter(0, SwCalibrationAccess="ReadWrite", StorageClass="Global", MemorySection="CAL", DataType="single")
P_LCS_ESS_AngleSlope_Limit = AUTOSAR4.Parameter(2.9, SwCalibrationAccess="ReadWrite", StorageClass="Global", MemorySection="CAL", DataType="single")
P_LCS_ESSOverrideValue2 = AUTOSAR4.Parameter(20, SwCalibrationAccess="ReadWrite", StorageClass="Global", MemorySection="CAL", DataType="single")
P_LCS_ESSOverrideValue1 = AUTOSAR4.Parameter(20, SwCalibrationAccess="ReadWrite", StorageClass="Global", MemorySection="CAL", DataType="single")
P_LCS_ESSOverrideTime2 = AUTOSAR4.Parameter(0.06, SwCalibrationAccess="ReadWrite", StorageClass="Global", MemorySection="CAL", DataType="single")
P_LCS_ESSAngSlope_SW = AUTOSAR4.Parameter(0, SwCalibrationAccess="ReadWrite", StorageClass="Global", MemorySection="CAL", DataType="single")

P_LCS_AngleSlope_ESS = AUTOSAR4.Parameter([0.4 0.4 0.4 0.4 2 2 2 2 2 2 2 2
 0.4 0.4 0.4 0.4 2 2 2 2 2 2 2 2
 0.4 0.4 0.4 0.4 2 2 2 2 2 2 2 2
 0.35 0.35 0.35 0.35 2 2 2 2 2 2 2 2
 0.35 0.35 0.35 0.35 2 2 2 2 2 2 2 2
 0.35 0.35 0.35 0.35 2 2 2 2 2 2 2 2
 0.35 0.35 0.35 0.35 2 2 2 2 2 2 2 2
 0.35 0.35 0.35 0.35 2 2 2 2 2 2 2 2
 0.35 0.35 0.35 0.35 2 2 2 2 2 2 2 2
 0.3 0.3 0.3 0.3 2 2 2 2 2 2 2 2
 0.3 0.3 0.3 0.3 2 2 2 2 2 2 2 2
 0.3 0.3 0.3 0.3 2 2 2 2 2 2 2 2
 0.3 0.3 0.3 0.3 2 2 2 2 2 2 2 2
 0.3 0.3 0.3 0.3 2 2 2 2 2 2 2 2
 0.3 0.3 0.3 0.3 2 2 2 2 2 2 2 2
 0.3 0.3 0.3 0.3 2 2 2 2 2 2 2 2
 0.3 0.3 0.3 0.3 2 2 2 2 2 2 2 2
 0.3 0.3 0.3 0.3 2 2 2 2 2 2 2 2
 0.3 0.3 0.3 0.3 2 2 2 2 2 2 2 2], SwCalibrationAccess="ReadWrite", StorageClass="Global", MemorySection="CAL", DataType="single")

P_LCS_AngleSlope_ESS_Add = AUTOSAR4.Parameter([1 1 1 1 1 1 1 1 1 1 1 1
 1 1 1 1 1 1 1 1 1 1 1 1
 1 1 1 1 1 1 1 1 1 1 1 1
 1 1 1 1 1 1 1 1 1 1 1 1
 2 2 2 2 7.5 7.5 7.5 7.5 7.5 7.5 7.5 7.5
 2 2 2 2 7.5 7.5 7.5 7.5 7.5 7.5 7.5 7.5
 2 2 2 2 7.5 7.5 7.5 7.5 7.5 7.5 7.5 7.5
 7 7 7 7 7.5 7.5 7.5 7.5 7.5 7.5 7.5 7.5
 7 7 7 7 7.5 7.5 7.5 7.5 7.5 7.5 7.5 7.5
 7 7 7 7 7.5 7.5 7.5 7.5 7.5 7.5 7.5 7.5
 7 7 7 7 7.5 7.5 7.5 7.5 7.5 7.5 7.5 7.5
 7 7 7 7 7.5 7.5 7.5 7.5 7.5 7.5 7.5 7.5
 7 7 7 7 7.5 7.5 7.5 7.5 7.5 7.5 7.5 7.5
 7 7 7 7 7.5 7.5 7.5 7.5 7.5 7.5 7.5 7.5
 7 7 7 7 7.5 7.5 7.5 7.5 7.5 7.5 7.5 7.5
 7 7 7 7 8 8 8 8 8 8 8 8
 7 7 7 7 8 8 8 8 8 8 8 8
 7 7 7 7 8 8 8 8 8 8 8 8
 7 7 7 7 8 8 8 8 8 8 8 8], SwCalibrationAccess="ReadWrite", StorageClass="Global", MemorySection="CAL", DataType="single")

P_LCS_preDis_LCK_Fac = AUTOSAR4.Parameter(repmat(0, 19, 16), SwCalibrationAccess="ReadWrite", StorageClass="Global", MemorySection="CAL", DataType="single")
P_LCS_LCcancel_A0_LimitValue = AUTOSAR4.Parameter(0.8, SwCalibrationAccess="ReadWrite", StorageClass="Global", MemorySection="CAL", DataType="single")
P_LCS_LCcancel_A1_LimitValue = AUTOSAR4.Parameter(0.5, SwCalibrationAccess="ReadWrite", StorageClass="Global", MemorySection="CAL", DataType="single")
P_LCS_LCcancel_Delaytime = AUTOSAR4.Parameter(200, SwCalibrationAccess="ReadWrite", StorageClass="Global", MemorySection="CAL", DataType="single")
P_LCS_DesAngle_DelaySample = AUTOSAR4.Parameter(0, SwCalibrationAccess="ReadWrite", StorageClass="Global", MemorySection="CAL", DataType="single")
P_LCS_FFW_Torq_AngleBp = AUTOSAR4.Parameter([-100 -80 -60 -55 -50 -45 -40 -35 -30 -25 -20 -15 -12 -10 -8 -6 -5 -4 -2 0 2 4 5 6 8 10 12 15 20 25 30 35 40 45 50 55 60 80 100], SwCalibrationAccess="ReadWrite", StorageClass="Global", MemorySection="CAL", DataType="single")
P_LCS_AngleErrorReversTorq_LC_TarAngleBp = AUTOSAR4.Parameter([0 2 4 6 8 10 15 20], SwCalibrationAccess="ReadWrite", StorageClass="Global", MemorySection="CAL", DataType="single")
P_LCS_TarAngleAddOffset_enable = AUTOSAR4.Parameter(0, SwCalibrationAccess="ReadWrite", StorageClass="Global", MemorySection="CAL", DataType="single")
P_LCS_TarAngleFilterFC_spdBp = AUTOSAR4.Parameter([0 30 50 60 80 100 120 150], SwCalibrationAccess="ReadWrite", StorageClass="Global", MemorySection="CAL", DataType="single")
P_LCS_A2_LatAcc_BP = AUTOSAR4.Parameter([0 0.5 2 3 4], SwCalibrationAccess="ReadWrite", StorageClass="Global", MemorySection="CAL", DataType="single")

P_LCS_preDis_LC_Eco_Fac = AUTOSAR4.Parameter([0 0 0 0 0 0 0 0 0 0 0 0 0 0 0 0
 0 0 0 0 0 0 0 0 0 0 0 0 0 0 0 0
 0 0 0 0 0 0 0 0 0 0 0 0 0 0 0 0
 0 0 0 0 0 0 0 0 0 0 0 0 0 0 0 0
 0.25 0.25 0.25 0.25 0.25 0.25 0.25 0.25 0.35 0.35 0.35 0.35 0.35 0.35 0.35 0.35
 0.3 0.3 0.3 0.3 0.3 0.35 0.5 0.55 0.55 0.55 0.55 0.55 0.55 0.55 0.55 0.55
 0.3 0.3 0.3 0.3 0.3 0.4 0.55 0.6 0.65 0.7 0.75 0.75 0.75 0.75 0.75 0.75
 0.3 0.3 0.3 0.3 0.3 0.45 0.6 0.65 0.7 0.75 0.8 0.8 0.8 0.8 0.8 0.8
 0.35 0.35 0.35 0.35 0.35 0.5 0.65 0.7 0.75 0.8 0.85 0.85 0.85 0.85 0.85 0.85
 0.35 0.35 0.35 0.35 0.35 0.55 0.7 0.75 0.8 0.85 0.95 0.95 0.95 0.95 0.95 0.95
 0.45 0.45 0.45 0.45 0.55 0.65 0.7 0.75 0.8 0.85 1 1 1 1 1 1
 0.45 0.45 0.45 0.45 0.55 0.65 0.7 0.75 0.8 0.85 1.05 1.1 1.15 1.15 1.15 1.15
 0.45 0.45 0.45 0.45 0.55 0.65 0.7 0.75 0.8 0.85 1.1 1.15 1.2 1.25 1.3 1.3
 0.55 0.55 0.55 0.55 0.6 0.65 0.7 0.75 0.8 0.85 1.1 1.2 1.25 1.3 1.3 1.3
 0.55 0.55 0.55 0.55 0.6 0.65 0.7 0.75 0.8 0.85 1.1 1.2 1.25 1.3 1.3 1.3
 0.55 0.55 0.55 0.55 0.6 0.65 0.7 0.75 0.8 0.85 1.1 1.2 1.25 1.3 1.3 1.3
 0.55 0.55 0.55 0.55 0.6 0.65 0.7 0.75 0.8 0.85 1.1 1.2 1.25 1.3 1.3 1.3
 0.55 0.55 0.55 0.55 0.6 0.65 0.7 0.75 0.8 0.85 1.1 1.2 1.25 1.3 1.3 1.3
 0.55 0.55 0.55 0.55 0.6 0.65 0.7 0.75 0.8 0.85 1.1 1.2 1.25 1.3 1.3 1.3], SwCalibrationAccess="ReadWrite", StorageClass="Global", MemorySection="CAL", DataType="single")

P_LCS_preDis_LC_Nomal_Fac = AUTOSAR4.Parameter([0 0 0 0 0 0 0 0 0 0 0 0 0 0 0 0
 0 0 0 0 0 0 0 0 0 0 0 0 0 0 0 0
 0 0 0 0 0 0 0 0 0 0 0 0 0 0 0 0
 0 0 0 0 0 0 0 0 0 0 0 0 0 0 0 0
 -0.1 -0.1 -0.1 -0.1 -0.1 0.1 0.1 0.1 0.1 0.2 0.2 0.2 0.2 0.2 0.2 0.25
 -0.1 -0.1 -0.1 -0.1 -0.1 0.1 0.2 0.2 0.2 0.3 0.4 0.4 0.4 0.4 0.4 0.45
 -0.1 -0.1 -0.1 -0.1 -0.1 0.1 0.2 0.2 0.2 0.3 0.4 0.4 0.4 0.4 0.4 0.45
 -0.1 -0.1 -0.1 -0.1 -0.1 0.1 0.3 0.3 0.3 0.4 0.45 0.45 0.45 0.45 0.45 0.5
 -0.1 -0.1 -0.1 -0.1 -0.1 0.1 0.3 0.3 0.3 0.4 0.5 0.5 0.5 0.5 0.5 0.55
 -0.1 -0.1 -0.1 -0.1 -0.1 0.1 0.3 0.3 0.3 0.4 0.6 0.6 0.6 0.6 0.6 0.65
 0.1 0.1 0.1 0.1 0.2 0.35 0.4 0.4 0.4 0.45 0.65 0.65 0.65 0.65 0.65 0.7
 0.1 0.1 0.1 0.1 0.2 0.35 0.4 0.4 0.4 0.45 0.7 0.75 0.8 0.8 0.8 0.85
 0.1 0.1 0.1 0.1 0.2 0.35 0.4 0.4 0.4 0.45 0.75 0.75 0.85 0.9 0.95 1
 0.2 0.2 0.2 0.2 0.35 0.35 0.4 0.4 0.4 0.45 0.75 0.8 0.85 0.95 0.95 1
 0.2 0.2 0.2 0.2 0.35 0.35 0.4 0.4 0.4 0.45 0.75 0.85 0.9 0.95 0.95 1
 0.2 0.2 0.2 0.2 0.35 0.35 0.4 0.4 0.4 0.45 0.75 0.85 0.9 0.95 0.95 1
 0.2 0.2 0.2 0.2 0.35 0.35 0.4 0.4 0.4 0.45 0.75 0.85 0.9 0.95 0.95 1
 0.2 0.2 0.2 0.2 0.35 0.35 0.4 0.4 0.4 0.45 0.75 0.85 0.9 0.95 0.95 1
 0.2 0.2 0.2 0.2 0.35 0.35 0.4 0.4 0.4 0.45 0.75 0.85 0.9 0.95 0.95 1], SwCalibrationAccess="ReadWrite", StorageClass="Global", MemorySection="CAL", DataType="single")

P_LCS_preDis_LC_Sport_Fac = AUTOSAR4.Parameter([0 0 0 0 0 0 0 0 0 0 0 0 0 0 0 0
 0 0 0 0 0 0 0 0 0 0 0 0 0 0 0 0
 0 0 0 0 0 0 0 0 0 0 0 0 0 0 0 0
 0 0 0 0 0 0 0 0 0 0 0 0 0 0 0 0
 -0.1 -0.1 -0.1 -0.1 -0.1 0.1 0.1 0.1 0.1 0 0 0 0 0 0 0
 -0.1 -0.1 -0.1 -0.1 -0.1 0.1 0.1 0.1 0.1 0 0 0 0 0 0 0
 -0.1 -0.1 -0.1 -0.1 -0.1 0.1 0.2 0.2 0.2 0 0 0 0 0 0 0
 -0.1 -0.1 -0.1 -0.1 -0.1 0.1 0.3 0.3 0.3 0 0 0 0 0 0 0
 -0.1 -0.1 -0.1 -0.1 -0.1 0.1 0.3 0.3 0.3 0 0.05 0.05 0.05 0.05 0.05 0.05
 -0.1 -0.1 -0.1 -0.1 -0.1 0.1 0.3 0.3 0.3 0 0.1 0.1 0.1 0.1 0.1 0.1
 0.1 0.1 0.1 0.1 0.2 0.35 0.4 0.4 0.4 0.05 0.15 0.15 0.2 0.23 0.25 0.25
 0.1 0.1 0.1 0.1 0.2 0.35 0.4 0.4 0.4 0.05 0.15 0.15 0.2 0.25 0.25 0.25
 0.1 0.1 0.1 0.1 0.2 0.35 0.4 0.4 0.4 0.05 0.15 0.15 0.2 0.25 0.25 0.25
 0.2 0.2 0.2 0.2 0.35 0.35 0.4 0.4 0.4 0.05 0.15 0.15 0.2 0.25 0.25 0.25
 0.2 0.2 0.2 0.2 0.35 0.35 0.4 0.4 0.4 0.1 0.15 0.2 0.2 0.25 0.3 0.35
 0.2 0.2 0.2 0.2 0.35 0.35 0.4 0.4 0.4 0.1 0.2 0.25 0.3 0.35 0.4 0.45
 0.2 0.2 0.2 0.2 0.35 0.35 0.4 0.4 0.4 0.3 0.3 0.35 0.5 0.55 0.6 0.65
 0.2 0.2 0.2 0.2 0.35 0.35 0.4 0.4 0.4 0.5 0.6 0.65 0.8 0.85 0.9 0.95
 0.2 0.2 0.2 0.2 0.35 0.35 0.4 0.4 0.4 0.5 0.6 0.65 0.8 0.85 0.9 0.95], SwCalibrationAccess="ReadWrite", StorageClass="Global", MemorySection="CAL", DataType="single")

P_LCS_preDis_ELK_Fac = AUTOSAR4.Parameter([0 0 0 0 0 0 0 0 0 0 0 0 0 0 0 0
 0 0 0 0 0 0 0 0 0 -0.5 -0.4 -0.25 -0.2 -0.15 -0.1 -0.1
 0 0 0 0 0 0 0 0 0 -0.55 -0.45 -0.3 -0.25 -0.2 -0.15 -0.15
 0 0 0 0 0 0 0 0 0 -0.6 -0.5 -0.35 -0.3 -0.25 -0.2 -0.2
 -0.1 -0.1 -0.1 -0.1 -0.1 0.1 0.1 0.1 0.1 -0.6 -0.5 -0.35 -0.3 -0.25 -0.2 -0.2
 -0.1 -0.1 -0.1 -0.1 -0.1 0.1 0.1 0.1 0.1 -0.6 -0.5 -0.35 -0.3 -0.25 -0.2 -0.2
 -0.1 -0.1 -0.1 -0.1 -0.1 0.1 0.2 0.2 0.2 -0.6 -0.5 -0.35 -0.3 -0.25 -0.2 -0.2
 -0.1 -0.1 -0.1 -0.1 -0.1 0.1 0.3 0.3 0.3 -0.6 -0.5 -0.35 -0.3 -0.25 -0.2 -0.2
 -0.1 -0.1 -0.1 -0.1 -0.1 0.1 0.3 0.3 0.3 -0.6 -0.5 -0.35 -0.3 -0.25 -0.2 -0.2
 -0.1 -0.1 -0.1 -0.1 -0.1 0.1 0.3 0.3 0.3 -0.6 -0.5 -0.35 -0.3 -0.25 -0.2 -0.2
 0.1 0.1 0.1 0.1 0.2 0.35 0.4 0.4 0.4 -0.6 -0.5 -0.35 -0.3 -0.25 -0.2 -0.2
 0.1 0.1 0.1 0.1 0.2 0.35 0.4 0.4 0.4 -0.6 -0.5 -0.35 -0.3 -0.25 -0.2 -0.2
 0.1 0.1 0.1 0.1 0.2 0.35 0.4 0.4 0.4 -0.6 -0.5 -0.35 -0.3 -0.25 -0.2 -0.2
 0.2 0.2 0.2 0.2 0.35 0.35 0.4 0.4 0.4 -0.6 -0.5 -0.35 -0.3 -0.25 -0.2 -0.2
 0.2 0.2 0.2 0.2 0.35 0.35 0.4 0.4 0.4 -0.6 -0.5 -0.35 -0.3 -0.25 -0.2 -0.2
 0.2 0.2 0.2 0.2 0.35 0.35 0.4 0.4 0.4 -0.6 -0.5 -0.35 -0.3 -0.25 -0.2 -0.2
 0.2 0.2 0.2 0.2 0.35 0.35 0.4 0.4 0.4 -0.6 -0.5 -0.35 -0.3 -0.25 -0.2 -0.2
 0.2 0.2 0.2 0.2 0.35 0.35 0.4 0.4 0.4 -0.6 -0.5 -0.35 -0.3 -0.25 -0.2 -0.2
 0.2 0.2 0.2 0.2 0.35 0.35 0.4 0.4 0.4 -0.6 -0.5 -0.35 -0.3 -0.25 -0.2 -0.2], SwCalibrationAccess="ReadWrite", StorageClass="Global", MemorySection="CAL", DataType="single")

P_LCS_AngleSlope_ELK = AUTOSAR4.Parameter([0.4 0.4 0.4 0.4 0.6 0.9 0.7 0.6 0.5 0.5 0.5 0.5
 0.4 0.4 0.4 0.4 0.6 0.9 0.7 0.6 0.5 0.5 0.5 0.5
 0.4 0.4 0.4 0.4 0.6 0.9 0.7 0.6 0.5 0.5 0.5 0.5
 0.4 0.4 0.4 0.4 0.6 0.9 0.7 0.6 0.5 0.5 0.5 0.5
 0.4 0.4 0.4 0.4 0.6 0.9 0.7 0.6 0.5 0.5 0.5 0.5
 0.4 0.4 0.4 0.4 0.6 0.9 0.7 0.6 0.5 0.5 0.5 0.5
 0.4 0.4 0.4 0.4 0.6 0.9 0.7 0.6 0.5 0.5 0.5 0.5
 0.4 0.4 0.4 0.4 0.6 0.9 0.7 0.6 0.5 0.5 0.5 0.5
 0.4 0.4 0.4 0.4 0.6 0.9 0.7 0.6 0.5 0.5 0.5 0.5
 0.4 0.4 0.4 0.4 0.6 0.9 0.7 0.6 0.5 0.5 0.5 0.5
 0.4 0.4 0.4 0.4 0.6 0.9 0.7 0.6 0.5 0.5 0.5 0.5
 0.4 0.4 0.4 0.4 0.6 0.9 0.7 0.6 0.5 0.5 0.5 0.5
 0.4 0.4 0.4 0.4 0.6 0.9 0.7 0.6 0.5 0.5 0.5 0.5
 0.4 0.4 0.4 0.4 0.6 0.9 0.7 0.6 0.5 0.5 0.5 0.5
 0.4 0.4 0.4 0.4 0.6 0.9 0.7 0.6 0.5 0.5 0.5 0.5
 0.4 0.4 0.4 0.4 0.6 0.9 0.7 0.6 0.5 0.5 0.5 0.5
 0.4 0.4 0.4 0.4 0.6 0.9 0.7 0.6 0.5 0.5 0.5 0.5
 0.4 0.4 0.4 0.4 0.6 0.9 0.7 0.6 0.5 0.5 0.5 0.5
 0.4 0.4 0.4 0.4 0.6 0.9 0.7 0.6 0.5 0.5 0.5 0.5], SwCalibrationAccess="ReadWrite", StorageClass="Global", MemorySection="CAL", DataType="single")

P_LCS_ESS_preDis_Nomal = AUTOSAR4.Parameter([8 9 10 10 11 11 11 11 11 12 15 18 22 24 27 33], SwCalibrationAccess="ReadWrite", StorageClass="Global", MemorySection="CAL", DataType="single")
P_LCS_PID_AngErrFacBp_P = AUTOSAR4.Parameter([0 2 4 6 12], SwCalibrationAccess="ReadWrite", StorageClass="Global", MemorySection="CAL", DataType="single")
P_LCS_PID_AngErrFacVal_P = AUTOSAR4.Parameter(repmat(1, 1, 5), SwCalibrationAccess="ReadWrite", StorageClass="Global", MemorySection="CAL", DataType="single")
P_LCS_preDis_LCK_A2Curve_Fac = AUTOSAR4.Parameter([1 0.9 0.7 0.5 0.3], SwCalibrationAccess="ReadWrite", StorageClass="Global", MemorySection="CAL", DataType="single")

P_LCS_preDis_LC_Fac = AUTOSAR4.Parameter([0 0 0 0 0 0 0 0 0 0 0 0 0 0 0 0
 0 0 0 0 0 0 0 0 0 0 0 0 0 0 0 0
 0 0 0 0 0 0 0 0 0 0 0 0 0 0 0 0
 0 0 0 0 0 0 0 0 0 0 0 0 0 0 0 0
 -0.1 -0.1 -0.1 -0.1 -0.1 0.1 0.1 0.1 0.1 0 0 0 0 0 0 0
 -0.1 -0.1 -0.1 -0.1 -0.1 0.1 0.1 0.1 0.1 0 0 0 0 0 0 0
 -0.1 -0.1 -0.1 -0.1 -0.1 0.1 0.2 0.2 0.2 0 0 0 0 0 0 0
 -0.1 -0.1 -0.1 -0.1 -0.1 0.1 0.3 0.3 0.3 0 0 0 0 0 0 0
 -0.1 -0.1 -0.1 -0.1 -0.1 0.1 0.3 0.3 0.3 0 0.05 0.05 0.05 0.05 0.05 0.05
 -0.1 -0.1 -0.1 -0.1 -0.1 0.1 0.3 0.3 0.3 0 0.1 0.1 0.1 0.1 0.1 0.1
 0.1 0.1 0.1 0.1 0.2 0.35 0.4 0.4 0.4 0.05 0.15 0.15 0.2 0.23 0.25 0.25
 0.1 0.1 0.1 0.1 0.2 0.35 0.4 0.4 0.4 0.05 0.15 0.15 0.2 0.25 0.25 0.25
 0.1 0.1 0.1 0.1 0.2 0.35 0.4 0.4 0.4 0.05 0.15 0.15 0.2 0.25 0.25 0.25
 0.2 0.2 0.2 0.2 0.35 0.35 0.4 0.4 0.4 0.05 0.15 0.15 0.2 0.25 0.25 0.25
 0.2 0.2 0.2 0.2 0.35 0.35 0.4 0.4 0.4 0.1 0.15 0.2 0.2 0.25 0.3 0.35
 0.2 0.2 0.2 0.2 0.35 0.35 0.4 0.4 0.4 0.1 0.2 0.25 0.3 0.35 0.4 0.45
 0.2 0.2 0.2 0.2 0.35 0.35 0.4 0.4 0.4 0.3 0.3 0.35 0.5 0.55 0.6 0.65
 0.2 0.2 0.2 0.2 0.35 0.35 0.4 0.4 0.4 0.5 0.6 0.65 0.8 0.85 0.9 0.95
 0.2 0.2 0.2 0.2 0.35 0.35 0.4 0.4 0.4 0.5 0.6 0.65 0.8 0.85 0.9 0.95], SwCalibrationAccess="ReadWrite", StorageClass="Global", MemorySection="CAL", DataType="single")

P_LCS_AngleSlope_LC_Cancel = AUTOSAR4.Parameter([0.4 0.4 0.4 0.4 0.4 0.4 0.4 0.4 0.4 0.4 0.4 0.4
 0.4 0.4 0.4 0.4 0.4 0.4 0.4 0.4 0.4 0.4 0.4 0.4
 0.4 0.4 0.4 0.4 0.4 0.4 0.4 0.4 0.4 0.4 0.4 0.4
 0.35 0.35 0.35 0.35 0.35 0.35 0.35 0.35 0.35 0.35 0.35 0.35
 0.35 0.35 0.35 0.35 0.35 0.35 0.35 0.35 0.35 0.35 0.35 0.35
 0.35 0.35 0.35 0.35 0.35 0.35 0.35 0.35 0.35 0.35 0.35 0.35
 0.35 0.35 0.35 0.35 0.35 0.35 0.35 0.35 0.35 0.35 0.35 0.35
 0.35 0.35 0.35 0.35 0.35 0.35 0.35 0.35 0.35 0.35 0.35 0.35
 0.35 0.35 0.35 0.35 0.35 0.35 0.35 0.35 0.35 0.35 0.35 0.35
 0.3 0.3 0.3 0.3 0.3 0.3 0.3 0.3 0.3 0.3 0.3 0.3
 0.3 0.3 0.3 0.3 0.3 0.3 0.3 0.3 0.3 0.3 0.3 0.3
 0.3 0.3 0.3 0.3 0.3 0.3 0.3 0.3 0.3 0.3 0.3 0.3
 0.3 0.3 0.3 0.3 0.3 0.3 0.3 0.3 0.3 0.3 0.3 0.3
 0.3 0.3 0.3 0.3 0.3 0.3 0.3 0.3 0.3 0.3 0.3 0.3
 0.3 0.3 0.3 0.3 0.3 0.3 0.3 0.3 0.3 0.3 0.3 0.3
 0.3 0.3 0.3 0.3 0.3 0.3 0.3 0.3 0.3 0.3 0.3 0.3
 0.3 0.3 0.3 0.3 0.3 0.3 0.3 0.3 0.3 0.3 0.3 0.3
 0.3 0.3 0.3 0.3 0.3 0.3 0.3 0.3 0.3 0.3 0.3 0.3
 0.3 0.3 0.3 0.3 0.3 0.3 0.3 0.3 0.3 0.3 0.3 0.3], SwCalibrationAccess="ReadWrite", StorageClass="Global", MemorySection="CAL", DataType="single")

P_LCS_PID_A0_BP = AUTOSAR4.Parameter([0 0.1 0.2 0.4 0.6 0.8 1 1.2 1.4 1.6 1.8 2 2.4 2.8 3.2 3.5], SwCalibrationAccess="ReadWrite", StorageClass="Global", MemorySection="CAL", DataType="single")
P_LCS_PID_A0_P = AUTOSAR4.Parameter(repmat(1, 1, 16), SwCalibrationAccess="ReadWrite", StorageClass="Global", MemorySection="CAL", DataType="single")
P_LCS_FF_A0_Torq = AUTOSAR4.Parameter(repmat(0, 1, 16), SwCalibrationAccess="ReadWrite", StorageClass="Global", MemorySection="CAL", DataType="single")
P_LCS_FF_A0_Speed_Factor = AUTOSAR4.Parameter(repmat(1, 1, 16), SwCalibrationAccess="ReadWrite", StorageClass="Global", MemorySection="CAL", DataType="single")
P_LCS_PID_A0_FF_SW = AUTOSAR4.Parameter(0, SwCalibrationAccess="ReadWrite", StorageClass="Global", MemorySection="CAL", DataType="single")
P_LCS_PID_A0_P_Spd_ActiveValue = AUTOSAR4.Parameter(60, SwCalibrationAccess="ReadWrite", StorageClass="Global", MemorySection="CAL", DataType="single")
P_LCS_PID_A2_P_A2_LimitValue = AUTOSAR4.Parameter(0.005, SwCalibrationAccess="ReadWrite", StorageClass="Global", MemorySection="CAL", DataType="single")
P_LCS_PID_A2_P = AUTOSAR4.Parameter(repmat(1, 1, 10), SwCalibrationAccess="ReadWrite", StorageClass="Global", MemorySection="CAL", DataType="single")
P_LCS_CurOffset_VehicleSpd_LimitValue = AUTOSAR4.Parameter(7, SwCalibrationAccess="ReadWrite", StorageClass="Global", MemorySection="CAL", DataType="single")
P_LCS_Line_Plan_ayDtLimit = AUTOSAR4.Parameter(repmat(5, 1, 16), SwCalibrationAccess="ReadWrite", StorageClass="Global", MemorySection="CAL", DataType="single")
P_LCS_Line_Plan_ayLimit = AUTOSAR4.Parameter(repmat(3, 1, 16), SwCalibrationAccess="ReadWrite", StorageClass="Global", MemorySection="CAL", DataType="single")
P_LCS_Line_Plan_preDis = AUTOSAR4.Parameter([8 9 10 11 12 13 14 15 17 22 28 33 35 38 42 49], SwCalibrationAccess="ReadWrite", StorageClass="Global", MemorySection="CAL", DataType="single")
P_LCS_Line_Plan_AngleSlope = AUTOSAR4.Parameter(repmat(0.4, 1, 16), SwCalibrationAccess="ReadWrite", StorageClass="Global", MemorySection="CAL", DataType="single")
P_LCS_Line_PlanSW = AUTOSAR4.Parameter(0, SwCalibrationAccess="ReadWrite", StorageClass="Global", MemorySection="CAL", DataType="single")
P_LCS_EPSFaultCheckValue = AUTOSAR4.Parameter(30, SwCalibrationAccess="ReadWrite", StorageClass="Global", MemorySection="CAL", DataType="single")
P_LCS_EPSNotActiveSpdValue = AUTOSAR4.Parameter(5, SwCalibrationAccess="ReadWrite", StorageClass="Global", MemorySection="CAL", DataType="single")
P_LCS_CurrentOffset_FliterTime = AUTOSAR4.Parameter(0.1, SwCalibrationAccess="ReadWrite", StorageClass="Global", MemorySection="CAL", DataType="single")

P_LCS_StateComplete_AngleSlope = AUTOSAR4.Parameter([0.3 0.3 0.3 0.3 0.3 0.3 0.3 0.3 0.3 0.3 0.3 0.3 0.3 0.3 0.3
 0.3 0.3 0.3 0.3 0.3 0.3 0.3 0.3 0.3 0.3 0.3 0.3 0.3 0.3 0.3
 0.3 0.3 0.3 0.3 0.3 0.3 0.3 0.3 0.3 0.3 0.3 0.3 0.3 0.3 0.3
 0.6 0.6 0.6 0.6 0.6 0.6 0.6 0.6 0.6 0.6 0.6 0.4 0.3 0.3 0.3], SwCalibrationAccess="ReadWrite", StorageClass="Global", MemorySection="CAL", DataType="single")

P_LCS_LC_Complete_PreDisFac = AUTOSAR4.Parameter([1 1 1 1 1 1 1 1 1 1 1 1 1 1 1
 1 1 1 1 1 1 1 1 1 1 1 1 1 1 1
 1 1 1 1 1 1 1 1 1 1 1 1 1 1 1
 0.7 0.7 0.7 0.7 0.7 0.7 0.8 0.8 0.9 0.9 1 1 1 1 1], SwCalibrationAccess="ReadWrite", StorageClass="Global", MemorySection="CAL", DataType="single")

P_LCS_AngleSlope_AES = AUTOSAR4.Parameter([1.5 1.5 1.5 1.5 1.5 1.5 1.5 1.1 1.1 1.15 1.15 0.85
 1.5 1.5 1.5 1.5 1.5 1.5 1.4 1 1 1.05 1.05 0.75
 1.5 1.5 1.5 1.5 1.5 1.5 1.4 1 1 1.05 1.05 0.75
 1.5 1.5 1.5 1.5 1.5 1.5 1.3 0.9 0.9 0.95 0.95 0.65
 1.5 1.5 1.5 1.5 1.55 1.45 1.3 0.9 0.9 0.95 0.95 0.65
 1.5 1.5 1.5 1.5 1.55 1.45 1.2 0.8 0.8 0.85 0.85 0.55
 1.5 1.5 1.5 1.5 1.55 1.45 1.2 0.8 0.8 0.85 0.85 0.55
 1.5 1.5 1.5 1.5 1.55 1.45 1.2 0.8 0.8 0.85 0.85 0.55
 1.5 1.5 1.5 1.5 1.55 1.45 1.2 0.8 0.8 0.85 0.85 0.55
 1.5 1.5 1.5 1.5 1.55 1.4 1.2 0.8 0.8 0.85 0.85 0.55
 1.5 1.5 1.5 1.5 1.55 1.4 1.2 0.8 0.8 0.85 0.85 0.55
 1.5 1.5 1.5 1.5 1.55 1.4 1.2 0.8 0.8 0.85 0.85 0.55
 1.5 1.5 1.5 1.5 1.55 1.4 1.1 0.7 0.7 0.75 0.75 0.45
 1.5 1.5 1.5 1.5 1.55 1.4 1.1 0.7 0.7 0.75 0.75 0.45
 1.5 1.5 1.5 1.5 1.55 1.4 1.1 0.7 0.7 0.75 0.75 0.45
 1.5 1.5 1.5 1.5 1.5 1.4 1.1 0.7 0.7 0.75 0.75 0.45
 1.5 1.5 1.5 1.5 1.5 1.4 1.1 0.7 0.7 0.75 0.75 0.45
 1.5 1.5 1.5 1.5 1.5 1.4 1.1 0.7 0.7 0.75 0.75 0.45
 1.5 1.5 1.5 1.5 1.5 1.4 1.1 0.7 0.7 0.75 0.75 0.45], SwCalibrationAccess="ReadWrite", StorageClass="Global", MemorySection="CAL", DataType="single")

P_LCS_CurSteerAngleOffsetLimit_Up = AUTOSAR4.Parameter(10, SwCalibrationAccess="ReadWrite", StorageClass="Global", MemorySection="CAL", DataType="single")
P_LCS_CurSteerAngleOffsetLimit_Low = AUTOSAR4.Parameter(-10, SwCalibrationAccess="ReadWrite", StorageClass="Global", MemorySection="CAL", DataType="single")
P_LCS_A2_CurrentOffsetFliterTime = AUTOSAR4.Parameter(repmat(2, 1, 10), SwCalibrationAccess="ReadWrite", StorageClass="Global", MemorySection="CAL", DataType="single")
P_LCS_communicationTest = AUTOSAR4.Parameter(1, SwCalibrationAccess="ReadWrite", StorageClass="Global", MemorySection="CAL", DataType="boolean")
P_LCS_StateCompleteFlg_BP = AUTOSAR4.Parameter([7 8 9 10], SwCalibrationAccess="ReadWrite", StorageClass="Global", MemorySection="CAL", DataType="uint8")
P_LCS_StateHold_time = AUTOSAR4.Parameter(250, SwCalibrationAccess="ReadWrite", StorageClass="Global", MemorySection="CAL", DataType="uint16")
P_LCS_CurOffset_SterAngleSpd_Enable = AUTOSAR4.Parameter(0, SwCalibrationAccess="ReadWrite", StorageClass="Global", MemorySection="CAL", DataType="boolean")
P_LCS_ESSAngleSW = AUTOSAR4.Parameter(1, SwCalibrationAccess="ReadWrite", StorageClass="Global", MemorySection="CAL", DataType="boolean")
P_LCS_AngErrReversSign_SourceSW = AUTOSAR4.Parameter(1, SwCalibrationAccess="ReadWrite", StorageClass="Global", MemorySection="CAL", DataType="boolean")
P_LCS_PID_A0_PID_SW = AUTOSAR4.Parameter(0, SwCalibrationAccess="ReadWrite", StorageClass="Global", MemorySection="CAL", DataType="boolean")
P_LCS_PID_A2_PID_SW = AUTOSAR4.Parameter(0, SwCalibrationAccess="ReadWrite", StorageClass="Global", MemorySection="CAL", DataType="boolean")
P_LCS_AES_preDis_Nomal = AUTOSAR4.Parameter([8 9 10 10 11 11 11 11 11 12 15 18 22 24 27 33], SwCalibrationAccess="ReadWrite", StorageClass="Global", MemorySection="CAL")

P_LCS_preDis_AES_Fac = AUTOSAR4.Parameter([0 0 0 0 0 0 0 0 -0.3 -0.3 -0.3 0 0 0.05 0 0.25
 0 0 0 0 0 0 0 0 -0.35 -0.35 -0.2 0.1 0.1 0.15 0.1 0.35
 0 0 0 0 0 0 0 0 -0.35 -0.35 -0.2 0.1 0.1 0.15 0.1 0.35
 0 0 0 0 0 0 0 0 -0.35 -0.35 -0.2 0.1 0.1 0.15 0.1 0.35
 -0.1 -0.1 -0.1 -0.1 -0.1 0.1 0.1 0.1 -0.25 -0.35 -0.2 0.1 0.1 0.15 0.1 0.35
 -0.1 -0.1 -0.1 -0.1 -0.1 0.1 0.1 0.1 -0.25 -0.35 -0.2 0.1 0.1 0.15 0.1 0.35
 -0.1 -0.1 -0.1 -0.1 -0.1 0.1 0.2 0.2 -0.15 -0.35 -0.2 0.1 0.1 0.15 0.1 0.35
 -0.1 -0.1 -0.1 -0.1 -0.1 0.1 0.3 0.3 -0.05 -0.35 -0.2 0.1 0.1 0.15 0.1 0.35
 -0.1 -0.1 -0.1 -0.1 -0.1 0.1 0.3 0.3 -0.05 -0.35 -0.15 0.15 0.15 0.2 0.15 0.4
 -0.1 -0.1 -0.1 -0.1 -0.1 0.1 0.3 0.3 -0.05 -0.35 -0.1 0.2 0.2 0.25 0.2 0.45
 0.1 0.1 0.1 0.1 0.2 0.35 0.4 0.4 0.05 -0.3 -0.05 0.25 0.2 0.25 0.2 0.45
 0.1 0.1 0.1 0.1 0.2 0.35 0.4 0.4 0.05 -0.3 -0.05 0.3 0.25 0.3 0.25 0.5
 0.1 0.1 0.1 0.1 0.2 0.35 0.4 0.4 0 -0.35 -0.1 0.3 0.25 0.3 0.25 0.5
 0.2 0.2 0.2 0.2 0.35 0.35 0.4 0.4 0 -0.35 -0.1 0.3 0.25 0.3 0.25 0.5
 0.2 0.2 0.2 0.2 0.35 0.35 0.4 0.4 0 -0.3 -0.1 0.3 0.25 0.3 0.25 0.5
 0.2 0.2 0.2 0.2 0.35 0.35 0.4 0.4 0 -0.3 -0.05 0.3 0.25 0.3 0.25 0.5
 0.2 0.2 0.2 0.2 0.35 0.35 0.4 0.4 0 -0.1 0.05 0.4 0.35 0.4 0.35 0.6
 0.2 0.2 0.2 0.2 0.35 0.35 0.4 0.4 0 0.1 0.35 0.5 0.45 0.5 0.45 0.7
 0.2 0.2 0.2 0.2 0.35 0.35 0.4 0.4 0 0.1 0.35 0.5 0.45 0.5 0.45 0.7], SwCalibrationAccess="ReadWrite", StorageClass="Global", MemorySection="CAL", DataType="single")

P_LCS_preDis_LCKIE_Fac = AUTOSAR4.Parameter(repmat(0, 19, 16), SwCalibrationAccess="ReadWrite", StorageClass="Global", MemorySection="CAL")
P_LCS_AES_Flg_Sw = AUTOSAR4.Parameter(1, SwCalibrationAccess="ReadWrite", StorageClass="Global", MemorySection="CAL", DataType="single")
P_LCS_AngleSlope_LCK_Curve_Fac = AUTOSAR4.Parameter([1 1 1 1 1.2 1.4 1.4 1.5 1.5 1.6], SwCalibrationAccess="ReadWrite", StorageClass="Global", MemorySection="CAL", DataType="single")
P_LCS_StateActiveFlg_BP = AUTOSAR4.Parameter([1 2 3 4 5 6 11 12], SwCalibrationAccess="ReadWrite", StorageClass="Global", MemorySection="CAL", DataType="uint8")

P_LCS_StateActiv_AngleSlope = AUTOSAR4.Parameter([0.01 0.01 0.1 0.2 0.4 0.8 1 1.2 1.4 1.6 1.8 2 2 2 2
 0.15 0.15 0.2 0.4 0.6 0.8 1 1.2 1.4 1.6 1.8 2 2 2 2
 0.1 0.15 0.2 0.25 0.28 0.8 1 1.2 1.4 1.6 1.8 2 2 2 2
 0.5 0.7 1 1 1 1 1 1.2 1.4 1.6 1.8 2 2 2 2
 1.6 1.6 1.6 1.6 1.6 1.6 1.6 1.6 1.6 1.6 1.6 1.6 2 2 2
 1.6 1.6 1.6 1.6 1.6 1.6 1.6 1.6 1.6 1.6 1.6 1.6 2 2 2
 0.1 0.1 0.1 0.1 0.1 0.1 0.15 0.15 0.2 1.6 1.6 1.6 2 2 2
 0.1 0.1 0.1 0.1 0.1 0.1 0.1 0.1 0.15 0.2 1.6 1.6 2 2 2], SwCalibrationAccess="ReadWrite", StorageClass="Global", MemorySection="CAL", DataType="single")

P_LCS_LATC_LCKMaxLatAcc_ms2 = AUTOSAR4.Parameter(repmat(5, 1, 15), SwCalibrationAccess="ReadWrite", StorageClass="Global", MemorySection="CAL")
P_LCS_LATC_VehicleSpd_TabX_Kph = AUTOSAR4.Parameter([0 10 20 30 40 50 60 70 80 90 100 110 120 130 140], SwCalibrationAccess="ReadWrite", StorageClass="Global", MemorySection="CAL")
P_LCS_LATC_SteerAngleLimit_Sw = AUTOSAR4.Parameter(1, SwCalibrationAccess="ReadWrite", StorageClass="Global", MemorySection="CAL")
P_LCS_LCK_MaxSteerAngle_deg = AUTOSAR4.Parameter(repmat(100, 1, 15), SwCalibrationAccess="ReadWrite", StorageClass="Global", MemorySection="CAL")
P_LCS_SteerAngleLimit_spd = AUTOSAR4.Parameter([0 10 20 30 40 50 60 70 80 90 100 110 120 130 140], SwCalibrationAccess="ReadWrite", StorageClass="Global", MemorySection="CAL")
P_LCS_LATC_LCKSteerAngle_Sw = AUTOSAR4.Parameter(0, SwCalibrationAccess="ReadWrite", StorageClass="Global", MemorySection="CAL")
LCS_MaxHeadingAngle = AUTOSAR4.Signal(SwCalibrationAccess="ReadOnly", StorageClass="Global", MemorySection="VAR")
LCS_preDis = AUTOSAR4.Signal(SwCalibrationAccess="ReadOnly", StorageClass="Global", MemorySection="VAR")
LCS_Q = AUTOSAR4.Signal(SwCalibrationAccess="ReadOnly", StorageClass="Global", MemorySection="VAR")
LCS_TarSteerAngle_deg = AUTOSAR4.Signal(SwCalibrationAccess="ReadOnly", StorageClass="Global", MemorySection="VAR")
LCS_TarSteerAngleSlope = AUTOSAR4.Signal(SwCalibrationAccess="ReadOnly", StorageClass="Global", MemorySection="VAR")
LCS_Counter = AUTOSAR4.Signal(SwCalibrationAccess="ReadOnly", StorageClass="Global", MemorySection="VAR", DataType="uint8")
LCS_IN_vxvRefMs = AUTOSAR4.Signal(SwCalibrationAccess="ReadOnly", StorageClass="Global", MemorySection="VAR")
LCS_IN_axvRefMs2 = AUTOSAR4.Signal(SwCalibrationAccess="ReadOnly", StorageClass="Global", MemorySection="VAR")
LCS_IN_ayvRefMs2 = AUTOSAR4.Signal(SwCalibrationAccess="ReadOnly", StorageClass="Global", MemorySection="VAR")
LCS_IN_kapTraj = AUTOSAR4.Signal(SwCalibrationAccess="ReadOnly", StorageClass="Global", MemorySection="VAR")
LCS_IN_alpSideSlipAngle = AUTOSAR4.Signal(SwCalibrationAccess="ReadOnly", StorageClass="Global", MemorySection="VAR")
LCS_IN_psiDtOpt = AUTOSAR4.Signal(SwCalibrationAccess="ReadOnly", StorageClass="Global", MemorySection="VAR")
LCS_IN_SteerAngOffset_deg = AUTOSAR4.Signal(SwCalibrationAccess="ReadOnly", StorageClass="Global", MemorySection="VAR")
LCS_IN_EPS_DrvInpTrqVal = AUTOSAR4.Signal(SwCalibrationAccess="ReadOnly", StorageClass="Global", MemorySection="VAR")
LCS_IN_EPS_LKATorqOvrlDlvd = AUTOSAR4.Signal(SwCalibrationAccess="ReadOnly", StorageClass="Global", MemorySection="VAR")
LCS_IN_EPS_LKATorqOvrlDlvdVld = AUTOSAR4.Signal(SwCalibrationAccess="ReadOnly", StorageClass="Global", MemorySection="VAR")
LCS_IN_SteerWheelSpd = AUTOSAR4.Signal(SwCalibrationAccess="ReadOnly", StorageClass="Global", MemorySection="VAR")
LCS_IN_SteerWheelAng = AUTOSAR4.Signal(SwCalibrationAccess="ReadOnly", StorageClass="Global", MemorySection="VAR")
LCS_IN_SteerWheelSpdSign = AUTOSAR4.Signal(SwCalibrationAccess="ReadOnly", StorageClass="Global", MemorySection="VAR")
LCS_IN_SteerWheelAngleSign = AUTOSAR4.Signal(SwCalibrationAccess="ReadOnly", StorageClass="Global", MemorySection="VAR")
LCS_MPC_TarAngle1 = AUTOSAR4.Signal(SwCalibrationAccess="ReadOnly", StorageClass="Global", MemorySection="VAR")
LCS_CurSteerAngleAddOffset_deg = AUTOSAR4.Signal(SwCalibrationAccess="ReadOnly", StorageClass="Global", MemorySection="VAR")
LCS_SteerAngleSpd_degs = AUTOSAR4.Signal(SwCalibrationAccess="ReadOnly", StorageClass="Global", MemorySection="VAR")
LCS_DisplaySpd_kph = AUTOSAR4.Signal(SwCalibrationAccess="ReadOnly", StorageClass="Global", MemorySection="VAR")
LCS_TarSteerAngleEnd = AUTOSAR4.Signal(SwCalibrationAccess="ReadOnly", StorageClass="Global", MemorySection="VAR")
LCS_TarSteerAngle = AUTOSAR4.Signal(SwCalibrationAccess="ReadOnly", StorageClass="Global", MemorySection="VAR")
LCS_IN_desLaneA0 = AUTOSAR4.Signal(SwCalibrationAccess="ReadOnly", StorageClass="Global", MemorySection="VAR")
LCS_IN_desLaneA2 = AUTOSAR4.Signal(SwCalibrationAccess="ReadOnly", StorageClass="Global", MemorySection="VAR")
LCS_IN_desLaneA3 = AUTOSAR4.Signal(SwCalibrationAccess="ReadOnly", StorageClass="Global", MemorySection="VAR")
LCS_IN_desLaneA1 = AUTOSAR4.Signal(SwCalibrationAccess="ReadOnly", StorageClass="Global", MemorySection="VAR")
LCS_Predis_facNormal = AUTOSAR4.Signal(SwCalibrationAccess="ReadOnly", StorageClass="Global", MemorySection="VAR")
LCS_Predis_BaseDis = AUTOSAR4.Signal(SwCalibrationAccess="ReadOnly", StorageClass="Global", MemorySection="VAR")
LCS_AngleSlope_LCcancel = AUTOSAR4.Signal(SwCalibrationAccess="ReadOnly", StorageClass="Global", MemorySection="VAR")
LCS_Predis_facEmerg = AUTOSAR4.Signal(SwCalibrationAccess="ReadOnly", StorageClass="Global", MemorySection="VAR")
LCS_Predis_facMediu = AUTOSAR4.Signal(SwCalibrationAccess="ReadOnly", StorageClass="Global", MemorySection="VAR")
LCS_IN_SteerAngleSpd_degs = AUTOSAR4.Signal(SwCalibrationAccess="ReadOnly", StorageClass="Global", MemorySection="VAR")
LCS_AngCmdReqVal = AUTOSAR4.Signal(SwCalibrationAccess="ReadOnly", StorageClass="Global", MemorySection="VAR")
LCS_EPSFault = AUTOSAR4.Signal(SwCalibrationAccess="ReadOnly", StorageClass="Global", MemorySection="VAR")
LCS_RealHoldTime = AUTOSAR4.Signal(SwCalibrationAccess="ReadOnly", StorageClass="Global", MemorySection="VAR")
LCS_LooKTBHoldTime = AUTOSAR4.Signal(SwCalibrationAccess="ReadOnly", StorageClass="Global", MemorySection="VAR")
LCS_StateActive_AngleSlope = AUTOSAR4.Signal(SwCalibrationAccess="ReadOnly", StorageClass="Global", MemorySection="VAR")
LCS_TarSteerAngle_Filter = AUTOSAR4.Signal(SwCalibrationAccess="ReadOnly", StorageClass="Global", MemorySection="VAR", DataType="single")
LCS_IN_CurrentLaneWidth = AUTOSAR4.Signal(SwCalibrationAccess="ReadOnly", StorageClass="Global", MemorySection="VAR")
LCS_TarSteerAngleCalc_Num = AUTOSAR4.Signal(SwCalibrationAccess="ReadOnly", StorageClass="Global", MemorySection="VAR")
LCS_AngleSlope_Flg = AUTOSAR4.Signal(SwCalibrationAccess="ReadOnly", StorageClass="Global", MemorySection="VAR")
LCS_AngleSlope_Cnt = AUTOSAR4.Signal(SwCalibrationAccess="ReadOnly", StorageClass="Global", MemorySection="VAR")
LCS_OffSetUpdate_Flg = AUTOSAR4.Signal(SwCalibrationAccess="ReadOnly", StorageClass="Global", MemorySection="VAR")
LCS_CurrentSteerAngleOffset_deg = AUTOSAR4.Signal(SwCalibrationAccess="ReadOnly", StorageClass="Global", MemorySection="VAR")
LCS_IN_desLaneValid = AUTOSAR4.Signal(SwCalibrationAccess="ReadOnly", StorageClass="Global", MemorySection="VAR")
LCS_LCType = AUTOSAR4.Signal(SwCalibrationAccess="ReadOnly", StorageClass="Global", MemorySection="VAR")
LCS_IN_TarDangerLevel = AUTOSAR4.Signal(SwCalibrationAccess="ReadOnly", StorageClass="Global", MemorySection="VAR")
LCS_State_AngleSlope = AUTOSAR4.Signal(SwCalibrationAccess="ReadOnly", StorageClass="Global", MemorySection="VAR")
LCS_AngleSlope_HoldTime = AUTOSAR4.Signal(SwCalibrationAccess="ReadOnly", StorageClass="Global", MemorySection="VAR", DataType="LCS_AngleSlope_HoldTime")
LCS_TarDangerLevelProc = AUTOSAR4.Signal(SwCalibrationAccess="ReadOnly", StorageClass="Global", MemorySection="VAR")
LCS_IsOverRide = AUTOSAR4.Signal(SwCalibrationAccess="ReadOnly", StorageClass="Global", MemorySection="VAR")
LCS_Torq_OUT = AUTOSAR4.Signal(SwCalibrationAccess="ReadOnly", StorageClass="Global", MemorySection="VAR")
LCS_DangerLevelisNotESS = AUTOSAR4.Signal(SwCalibrationAccess="ReadOnly", StorageClass="Global", MemorySection="VAR")
LCS_ESS_TarTorq = AUTOSAR4.Signal(SwCalibrationAccess="ReadOnly", StorageClass="Global", MemorySection="VAR")
LCS_ESS_TarAngle = AUTOSAR4.Signal(SwCalibrationAccess="ReadOnly", StorageClass="Global", MemorySection="VAR")
LCS_ControlAngleError = AUTOSAR4.Signal(SwCalibrationAccess="ReadOnly", StorageClass="Global", MemorySection="VAR")
LCS_TorqFFPID_OUT = AUTOSAR4.Signal(SwCalibrationAccess="ReadOnly", StorageClass="Global", MemorySection="VAR")
LCS_Torq_PID = AUTOSAR4.Signal(SwCalibrationAccess="ReadOnly", StorageClass="Global", MemorySection="VAR")
LCS_Torq_FFAdd = AUTOSAR4.Signal(SwCalibrationAccess="ReadOnly", StorageClass="Global", MemorySection="VAR")
LCS_AngleErrorReversTorq = AUTOSAR4.Signal(SwCalibrationAccess="ReadOnly", StorageClass="Global", MemorySection="VAR")
LCS_Torq_FF = AUTOSAR4.Signal(SwCalibrationAccess="ReadOnly", StorageClass="Global", MemorySection="VAR")
LCS_Torq_P = AUTOSAR4.Signal(SwCalibrationAccess="ReadOnly", StorageClass="Global", MemorySection="VAR")
LCS_Torq_D = AUTOSAR4.Signal(SwCalibrationAccess="ReadOnly", StorageClass="Global", MemorySection="VAR")
LCS_Torq_I = AUTOSAR4.Signal(SwCalibrationAccess="ReadOnly", StorageClass="Global", MemorySection="VAR")
LCS_HoldTime = AUTOSAR4.Signal(SwCalibrationAccess="ReadOnly", StorageClass="Global", MemorySection="VAR")
LCS_EqA0 = AUTOSAR4.Signal(SwCalibrationAccess="ReadOnly", StorageClass="Global", MemorySection="VAR")
LCS_SteerAngleFilter_deg = AUTOSAR4.Signal(SwCalibrationAccess="ReadOnly", StorageClass="Global", MemorySection="VAR")
LCS_SteerAngleSpdFilter_degs = AUTOSAR4.Signal(SwCalibrationAccess="ReadOnly", StorageClass="Global", MemorySection="VAR")
LCS_SubModel_VERSION = AUTOSAR4.Signal(SwCalibrationAccess="ReadOnly", StorageClass="Global", MemorySection="VAR")
LCS_SubModel_Number = AUTOSAR4.Signal(SwCalibrationAccess="ReadOnly", StorageClass="Global", MemorySection="VAR")
LCS_IN_CurSteerAngle_deg = AUTOSAR4.Signal(SwCalibrationAccess="ReadOnly", StorageClass="Global", MemorySection="VAR")
LCS_LC_NomalPredisFac = AUTOSAR4.Signal(SwCalibrationAccess="ReadOnly", StorageClass="Global", MemorySection="VAR")
LCS_LC_NomalPredis = AUTOSAR4.Signal(SwCalibrationAccess="ReadOnly", StorageClass="Global", MemorySection="VAR")
LCS_LC_EcoPredis = AUTOSAR4.Signal(SwCalibrationAccess="ReadOnly", StorageClass="Global", MemorySection="VAR")
LCS_LC_EcoPredisFac = AUTOSAR4.Signal(SwCalibrationAccess="ReadOnly", StorageClass="Global", MemorySection="VAR")
LCS_LC_SportPredis = AUTOSAR4.Signal(SwCalibrationAccess="ReadOnly", StorageClass="Global", MemorySection="VAR")
LCS_LC_SportPredisFac = AUTOSAR4.Signal(SwCalibrationAccess="ReadOnly", StorageClass="Global", MemorySection="VAR")
LCS_LCKPredis = AUTOSAR4.Signal(SwCalibrationAccess="ReadOnly", StorageClass="Global", MemorySection="VAR")
LCS_LCKPredisFac = AUTOSAR4.Signal(SwCalibrationAccess="ReadOnly", StorageClass="Global", MemorySection="VAR")
LCS_finalPredis = AUTOSAR4.Signal(SwCalibrationAccess="ReadOnly", StorageClass="Global", MemorySection="VAR")
LCS_IN_SteerAngleOffset_deg = AUTOSAR4.Signal(SwCalibrationAccess="ReadOnly", StorageClass="Global", MemorySection="VAR")
LCS_LC_ELKPredisFac = AUTOSAR4.Signal(SwCalibrationAccess="ReadOnly", StorageClass="Global", MemorySection="VAR")
LCS_LC_ESSAESPredisFac = AUTOSAR4.Signal(SwCalibrationAccess="ReadOnly", StorageClass="Global", MemorySection="VAR")
LCS_LC_ELKPredis = AUTOSAR4.Signal(SwCalibrationAccess="ReadOnly", StorageClass="Global", MemorySection="VAR")
LCS_LC_ESSPredis = AUTOSAR4.Signal(SwCalibrationAccess="ReadOnly", StorageClass="Global", MemorySection="VAR")
LCS_OUT_ReqEPSTrgAngle = AUTOSAR4.Signal(SwCalibrationAccess="ReadOnly", StorageClass="Global", MemorySection="VAR")
LCS_OUT_EpsTrqReqValue = AUTOSAR4.Signal(SwCalibrationAccess="ReadOnly", StorageClass="Global", MemorySection="VAR")
LCS_OUT_EpsTrqReqValueVld = AUTOSAR4.Signal(SwCalibrationAccess="ReadOnly", StorageClass="Global", MemorySection="VAR")
LCS_OUT_AngCmdReqValVld = AUTOSAR4.Signal(SwCalibrationAccess="ReadOnly", StorageClass="Global", MemorySection="VAR")
LCS_CurSteerAngle_deg = AUTOSAR4.Signal(SwCalibrationAccess="ReadOnly", StorageClass="Global", MemorySection="VAR")
LCS_A2_LatAcc = AUTOSAR4.Signal(SwCalibrationAccess="ReadOnly", StorageClass="Global", MemorySection="VAR")
LCS_Predis_Curve1 = AUTOSAR4.Signal(SwCalibrationAccess="ReadOnly", StorageClass="Global", MemorySection="VAR")
LCS_Predis_Curve2 = AUTOSAR4.Signal(SwCalibrationAccess="ReadOnly", StorageClass="Global", MemorySection="VAR")
LCS_Predis_Curve3 = AUTOSAR4.Signal(SwCalibrationAccess="ReadOnly", StorageClass="Global", MemorySection="VAR")
LCS_Predis_Curve4 = AUTOSAR4.Signal(SwCalibrationAccess="ReadOnly", StorageClass="Global", MemorySection="VAR")
LCS_Predis_Curve = AUTOSAR4.Signal(SwCalibrationAccess="ReadOnly", StorageClass="Global", MemorySection="VAR")
LCS_LCK_CurveFac = AUTOSAR4.Signal(SwCalibrationAccess="ReadOnly", StorageClass="Global", MemorySection="VAR")
LCS_A2_LatAccFac = AUTOSAR4.Signal(SwCalibrationAccess="ReadOnly", StorageClass="Global", MemorySection="VAR")
LCS_ESS_TarAngleSpd = AUTOSAR4.Signal(SwCalibrationAccess="ReadOnly", StorageClass="Global", MemorySection="VAR")
LCS_ESS_TarAngleSpdFilter = AUTOSAR4.Signal(SwCalibrationAccess="ReadOnly", StorageClass="Global", MemorySection="VAR")
LCS_ESS_SteerWheelAngleSpd = AUTOSAR4.Signal(SwCalibrationAccess="ReadOnly", StorageClass="Global", MemorySection="VAR")
LCS_ESS_SteerWheelAngleSpdFilter = AUTOSAR4.Signal(SwCalibrationAccess="ReadOnly", StorageClass="Global", MemorySection="VAR")
LCS_ESS_NotActiveFlg = AUTOSAR4.Signal(SwCalibrationAccess="ReadOnly", StorageClass="Global", MemorySection="VAR")
LCS_ReqEPSTrgAngle = AUTOSAR4.Signal(SwCalibrationAccess="ReadOnly", StorageClass="Global", MemorySection="VAR")
LCS_CurOffsetA2_Enable = AUTOSAR4.Signal(SwCalibrationAccess="ReadOnly", StorageClass="Global", MemorySection="VAR")
LCS_ESS_TarAngle2 = AUTOSAR4.Signal(SwCalibrationAccess="ReadOnly", StorageClass="Global", MemorySection="VAR")
LCS_DeltaAngle = AUTOSAR4.Signal(SwCalibrationAccess="ReadOnly", StorageClass="Global", MemorySection="VAR")
LCS_LC_AESPredisFac = AUTOSAR4.Signal(SwCalibrationAccess="ReadOnly", StorageClass="Global", MemorySection="VAR")
LCS_LC_AESPredis = AUTOSAR4.Signal(SwCalibrationAccess="ReadOnly", StorageClass="Global", MemorySection="VAR")
LCS_LC_Cancel_Flg = AUTOSAR4.Signal(SwCalibrationAccess="ReadOnly", StorageClass="Global", MemorySection="VAR")
LCS_LC_LCPredisFac = AUTOSAR4.Signal(SwCalibrationAccess="ReadOnly", StorageClass="Global", MemorySection="VAR")
LCS_LC_LCPredis = AUTOSAR4.Signal(SwCalibrationAccess="ReadOnly", StorageClass="Global", MemorySection="VAR")
LCS_Predis_CurveFac = AUTOSAR4.Signal(SwCalibrationAccess="ReadOnly", StorageClass="Global", MemorySection="VAR")
LCS_ESS_NotActiveDelayFlg = AUTOSAR4.Signal(SwCalibrationAccess="ReadOnly", StorageClass="Global", MemorySection="VAR")
LCS_ESS_NotActiveFlg1 = AUTOSAR4.Signal(SwCalibrationAccess="ReadOnly", StorageClass="Global", MemorySection="VAR")
LCS_ESS_NotActiveFlg2 = AUTOSAR4.Signal(SwCalibrationAccess="ReadOnly", StorageClass="Global", MemorySection="VAR")
LCS_ESS_NotActiveFlg3 = AUTOSAR4.Signal(SwCalibrationAccess="ReadOnly", StorageClass="Global", MemorySection="VAR")
LCS_ESS_NotActiveFlgOriginal = AUTOSAR4.Signal(SwCalibrationAccess="ReadOnly", StorageClass="Global", MemorySection="VAR")
LCS_Trq_Switch = AUTOSAR4.Signal(SwCalibrationAccess="ReadOnly", StorageClass="Global", MemorySection="VAR")
LCS_IN_TarDangerlLevel = AUTOSAR4.Signal(SwCalibrationAccess="ReadOnly", StorageClass="Global", MemorySection="VAR")
LCS_IN_EPS_LKAAngDlvdSts = AUTOSAR4.Signal(SwCalibrationAccess="ReadOnly", StorageClass="Global", MemorySection="VAR")
LCS_IN_EPS_LKATrqOvlDlvdSts = AUTOSAR4.Signal(SwCalibrationAccess="ReadOnly", StorageClass="Global", MemorySection="VAR")
LCS_IN_EPS_FailSts = AUTOSAR4.Signal(SwCalibrationAccess="ReadOnly", StorageClass="Global", MemorySection="VAR")
LCS_PID_TarDangerLevel = AUTOSAR4.Signal(SwCalibrationAccess="ReadOnly", StorageClass="Global", MemorySection="VAR")
LCS_PID_A0_SW = AUTOSAR4.Signal(SwCalibrationAccess="ReadOnly", StorageClass="Global", MemorySection="VAR")
LCS_PID_A2_SW = AUTOSAR4.Signal(SwCalibrationAccess="ReadOnly", StorageClass="Global", MemorySection="VAR")
LCS_PID_A2_Curve = AUTOSAR4.Signal(SwCalibrationAccess="ReadOnly", StorageClass="Global", MemorySection="VAR")
LCS_Line_Plan_Valid = AUTOSAR4.Signal(SwCalibrationAccess="ReadOnly", StorageClass="Global", MemorySection="VAR")
LCS_Line_Plan_C3 = AUTOSAR4.Signal(SwCalibrationAccess="ReadOnly", StorageClass="Global", MemorySection="VAR")
LCS_Line_Plan_C2 = AUTOSAR4.Signal(SwCalibrationAccess="ReadOnly", StorageClass="Global", MemorySection="VAR")
LCS_Line_Plan_C1 = AUTOSAR4.Signal(SwCalibrationAccess="ReadOnly", StorageClass="Global", MemorySection="VAR")
LCS_Line_Plan_C0 = AUTOSAR4.Signal(SwCalibrationAccess="ReadOnly", StorageClass="Global", MemorySection="VAR")
LCS_Line_Plan_LoopNum = AUTOSAR4.Signal(SwCalibrationAccess="ReadOnly", StorageClass="Global", MemorySection="VAR")
LCS_Line_Plan_planT = AUTOSAR4.Signal(SwCalibrationAccess="ReadOnly", StorageClass="Global", MemorySection="VAR")
LCS_PreTraj_X = AUTOSAR4.Signal(SwCalibrationAccess="ReadOnly", StorageClass="Global", MemorySection="VAR")
LCS_PreTraj_Y = AUTOSAR4.Signal(SwCalibrationAccess="ReadOnly", StorageClass="Global", MemorySection="VAR")
LCS_LC_Complete_PreDisFac = AUTOSAR4.Signal(SwCalibrationAccess="ReadOnly", StorageClass="Global", MemorySection="VAR")
LCS_CurrentSteerAngleOffset = AUTOSAR4.Signal(SwCalibrationAccess="ReadOnly", StorageClass="Global", MemorySection="VAR")
LCS_communicationTest_IFCTrqOvlCmdReqValue = AUTOSAR4.Signal(SwCalibrationAccess="ReadOnly", StorageClass="Global", MemorySection="VAR")
LCS_communicationTest_IFCFuncTrqCmdReqFlag = AUTOSAR4.Signal(SwCalibrationAccess="ReadOnly", StorageClass="Global", MemorySection="VAR")
LCS_communicationTest_IFCAngCmdReqValue = AUTOSAR4.Signal(SwCalibrationAccess="ReadOnly", StorageClass="Global", MemorySection="VAR")
LCS_communicationTest_IFCFuncAngCmdReqFlag = AUTOSAR4.Signal(SwCalibrationAccess="ReadOnly", StorageClass="Global", MemorySection="VAR")
LCS_LCKIEPredis = AUTOSAR4.Signal(SwCalibrationAccess="ReadOnly", StorageClass="Global", MemorySection="VAR")
LCS_LCKIEPredisFac = AUTOSAR4.Signal(SwCalibrationAccess="ReadOnly", StorageClass="Global", MemorySection="VAR")
LCS_SteerAngleCmd = AUTOSAR4.Signal(SwCalibrationAccess="ReadOnly", StorageClass="Global", MemorySection="VAR")
LCS_SreerAngleLimit = AUTOSAR4.Signal(SwCalibrationAccess="ReadOnly", StorageClass="Global", MemorySection="VAR")
LCS_OUTSteerAngleLimit = AUTOSAR4.Signal(SwCalibrationAccess="ReadOnly", StorageClass="Global", MemorySection="VAR")
LCS_TargetSteerAngle = AUTOSAR4.Signal(SwCalibrationAccess="ReadOnly", StorageClass="Global", MemorySection="VAR")
P_LCS_AngleSlopeNormal = AUTOSAR4.Parameter(0.4, SwCalibrationAccess="ReadWrite", StorageClass="Global", MemorySection="CAL", DataType="single")
P_LCS_Trq_Switch = AUTOSAR4.Parameter(0, SwCalibrationAccess="ReadWrite", StorageClass="Global", MemorySection="CAL", DataType="uint8")