% Simulink data dictionary PvtParsLM_1_InPort.sldd

P_LM_VSLMinLINEL1 = AUTOSAR4.Parameter(-0.8, SwCalibrationAccess="ReadWrite", StorageClass="Global", MemorySection="CAL", DataType="single", Min=-1, Max=0)  % VSL道路模型车道线L1最小C0值
P_LM_VSLMaxLINEL1 = AUTOSAR4.Parameter(3.75, SwCalibrationAccess="ReadWrite", StorageClass="Global", MemorySection="CAL", DataType="single", Min=3, Max=4)  % VSL道路模型车道线L1最大C0值
P_LM_VSLMinLINER1 = AUTOSAR4.Parameter(-3.75, SwCalibrationAccess="ReadWrite", StorageClass="Global", MemorySection="CAL", DataType="single", Min=-4, Max=-3)  % VSL道路模型车道线R1最小C0值
P_LM_VSLMaxLINER1 = AUTOSAR4.Parameter(0.8, SwCalibrationAccess="ReadWrite", StorageClass="Global", MemorySection="CAL", DataType="single", Min=0, Max=1)  % VSL道路模型车道线R1最大C0值
P_LM_VSLMinLINEL2 = AUTOSAR4.Parameter(2.8, SwCalibrationAccess="ReadWrite", StorageClass="Global", MemorySection="CAL", DataType="single", Min=2.5, Max=3.5)  % VSL道路模型车道线L2最小C0值
P_LM_VSLMaxLINEL2 = AUTOSAR4.Parameter(7.5, SwCalibrationAccess="ReadWrite", StorageClass="Global", MemorySection="CAL", DataType="single", Min=3.5, Max=8)  % VSL道路模型车道线L2最大C0值
P_LM_VSLMinLINER2 = AUTOSAR4.Parameter(-7.5, SwCalibrationAccess="ReadWrite", StorageClass="Global", MemorySection="CAL", DataType="single", Min=-8, Max=-3.5)  % VSL道路模型车道线R2最小C0值
P_LM_VSLMaxLINER2 = AUTOSAR4.Parameter(-2.8, SwCalibrationAccess="ReadWrite", StorageClass="Global", MemorySection="CAL", DataType="single", Min=-3.5, Max=-2.5)  % VSL道路模型车道线R2最大C0值