% Simulink data dictionary PvtParsLM_2_PP.sldd

P_LM_FntPath1Timegap = AUTOSAR4.Parameter(3, SwCalibrationAccess="ReadWrite", StorageClass="Global", MemorySection="CAL", DataType="single")
P_LM_FntPath2Timegap = AUTOSAR4.Parameter(2, SwCalibrationAccess="ReadWrite", StorageClass="Global", MemorySection="CAL", DataType="single")
P_LM_FntPath3Timegap = AUTOSAR4.Parameter(1.5, SwCalibrationAccess="ReadWrite", StorageClass="Global", MemorySection="CAL", DataType="single")
P_LM_FntPath1Disgap = AUTOSAR4.Parameter(35, SwCalibrationAccess="ReadWrite", StorageClass="Global", MemorySection="CAL", DataType="single")
P_LM_FntPath2Disgap = AUTOSAR4.Parameter(35, SwCalibrationAccess="ReadWrite", StorageClass="Global", MemorySection="CAL", DataType="single")
P_LM_FntPath3Disgap = AUTOSAR4.Parameter(30, SwCalibrationAccess="ReadWrite", StorageClass="Global", MemorySection="CAL", DataType="single")
P_LM_FntPath1MinDis = AUTOSAR4.Parameter(70, SwCalibrationAccess="ReadWrite", StorageClass="Global", MemorySection="CAL", DataType="single")
P_LM_FntPath2MinDis = AUTOSAR4.Parameter(120, SwCalibrationAccess="ReadWrite", StorageClass="Global", MemorySection="CAL", DataType="single")
P_LM_FntPath3MinDis = AUTOSAR4.Parameter(150, SwCalibrationAccess="ReadWrite", StorageClass="Global", MemorySection="CAL", DataType="single")
LM_FntPath1Dis = AUTOSAR4.Signal(SwCalibrationAccess="ReadOnly", StorageClass="Global", MemorySection="VAR", DataType="single")  % 前方车道线第一段长度
LM_FntPath2Dis = AUTOSAR4.Signal(SwCalibrationAccess="ReadOnly", StorageClass="Global", MemorySection="VAR", DataType="single")  % 前方车道线第二段长度
LM_FntPath3Dis = AUTOSAR4.Signal(SwCalibrationAccess="ReadOnly", StorageClass="Global", MemorySection="VAR", DataType="single")  % 前方车道线第三段长度
LM_RearPath1Dis = AUTOSAR4.Signal(SwCalibrationAccess="ReadOnly", StorageClass="Global", MemorySection="VAR", DataType="single")  % 后方车道线第一段长度
LM_RearPath2Dis = AUTOSAR4.Signal(SwCalibrationAccess="ReadOnly", StorageClass="Global", MemorySection="VAR", DataType="single")  % 后方车道线第二段长度
LM_RearPath3Dis = AUTOSAR4.Signal(SwCalibrationAccess="ReadOnly", StorageClass="Global", MemorySection="VAR", DataType="single")  % 后方车道线第三段长度
LM_ComEVOffsetX = AUTOSAR4.Signal(SwCalibrationAccess="ReadOnly", StorageClass="Global", MemorySection="VAR", DataType="single")  % 自车坐标系下x方向补偿
LM_ComEVOffsetY = AUTOSAR4.Signal(SwCalibrationAccess="ReadOnly", StorageClass="Global", MemorySection="VAR", DataType="single")  % 自车坐标系下y方向补偿
LM_ComEVOffsetAng = AUTOSAR4.Signal(SwCalibrationAccess="ReadOnly", StorageClass="Global", MemorySection="VAR", DataType="single")  % 自车坐标系下角度补偿