% Simulink data dictionary PvtParsLM_3_DIR.sldd

P_LM_DIRLiValidDisStaThre = AUTOSAR4.Parameter(10, SwCalibrationAccess="ReadWrite", StorageClass="Global", MemorySection="CAL", DataType="single", Min=0, Max=50)  % 驾驶员模型车道线有效起点距离阈值
P_LM_DIRLiValidDisFntThre = AUTOSAR4.Parameter(15, SwCalibrationAccess="ReadWrite", StorageClass="Global", MemorySection="CAL", DataType="single", Min=0, Max=50)  % 驾驶员模型车道线有效有效长度阈值
P_LM_DIRLiValidQuaThre = AUTOSAR4.Parameter(0.25, SwCalibrationAccess="ReadWrite", StorageClass="Global", MemorySection="CAL", DataType="single", Min=0, Max=1)  % 驾驶员模型车道线有效车道线质量阈值
P_LM_DIRLaneWidth = AUTOSAR4.Parameter(3.5, SwCalibrationAccess="ReadWrite", StorageClass="Global", MemorySection="CAL", DataType="single", Min=0, Max=5)  % 驾驶员模型模块车道宽度
P_LM_DIREVOnLiC0Thre = AUTOSAR4.Parameter(0.75, SwCalibrationAccess="ReadWrite", StorageClass="Global", MemorySection="CAL", DataType="single", Min=0, Max=5)  % 驾驶员模型中自车压线判断C0阈值
P_LM_DIRLC2LeC1Thre = AUTOSAR4.Parameter(-0.035, SwCalibrationAccess="ReadWrite", StorageClass="Global", MemorySection="CAL", DataType="single", Min=-1, Max=0)  % 驾驶员模型左换道识别C1阈值
P_LM_DIRLC2RigC1Thre = AUTOSAR4.Parameter(0.015, SwCalibrationAccess="ReadWrite", StorageClass="Global", MemorySection="CAL", DataType="single", Min=0, Max=1)  % 驾驶员模型右换道识别C1阈值
P_LM_DIRLCStrWheelAngThreFromVxv_Y = AUTOSAR4.Parameter([10 9 6 3], SwCalibrationAccess="ReadWrite", StorageClass="Global", MemorySection="CAL", DataType="single")  % 驾驶员模型换道不同车速方向盘转角阈值查表X值
P_LM_DIRLCStrWheelAngThreFromVxv_X = AUTOSAR4.Parameter([5 15 25 35], SwCalibrationAccess="ReadWrite", StorageClass="Global", MemorySection="CAL", DataType="single")  % 驾驶员模型换道不同车速方向盘转角阈值查表Y值
P_LM_DIRLCEVOnLiStrWheelAngThre = AUTOSAR4.Parameter(3.5, SwCalibrationAccess="ReadWrite", StorageClass="Global", MemorySection="CAL", DataType="single")  % 驾驶员模型换道识别自车压线方向盘转角阈值
LM_DIRLeftTurnLampOnTime = AUTOSAR4.Signal(SwCalibrationAccess="ReadOnly", StorageClass="Global", MemorySection="VAR", DataType="single")  % DIR左转向灯开启时间
LM_DIRRightTurnLampOnTime = AUTOSAR4.Signal(SwCalibrationAccess="ReadOnly", StorageClass="Global", MemorySection="VAR", DataType="single")  % DIR右转向灯开启时间
LM_DIRTurnLeftProbBytTurnLamp = AUTOSAR4.Signal(SwCalibrationAccess="ReadOnly", StorageClass="Global", MemorySection="VAR", DataType="single")  % DIR基于转向灯开启时间的左转可能性
LM_DIRTurnLeftProbByTurnLampSts = AUTOSAR4.Signal(SwCalibrationAccess="ReadOnly", StorageClass="Global", MemorySection="VAR", DataType="single")  % DIR基于转向灯状态的左转可能性
LM_DIRTurnLeftProbByVehSpd = AUTOSAR4.Signal(SwCalibrationAccess="ReadOnly", StorageClass="Global", MemorySection="VAR", DataType="single")  % DIR基于车速的左转可能性
LM_DIRTurnLeftProbByPsiDtopt = AUTOSAR4.Signal(SwCalibrationAccess="ReadOnly", StorageClass="Global", MemorySection="VAR", DataType="single")  % DIR基于横摆角速度的左转可能性
LM_DIRTurnLeftProbByKapTraj = AUTOSAR4.Signal(SwCalibrationAccess="ReadOnly", StorageClass="Global", MemorySection="VAR", DataType="single")  % DIR基于道路曲率的左转可能性
LM_DIRTurnLeftProbBySteerWheelAng = AUTOSAR4.Signal(SwCalibrationAccess="ReadOnly", StorageClass="Global", MemorySection="VAR", DataType="single")  % DIR基于方向盘转角的左转可能性
LM_DIRTurnLeftProb = AUTOSAR4.Signal(SwCalibrationAccess="ReadOnly", StorageClass="Global", MemorySection="VAR", DataType="single")  % DIR左转可能性
LM_DIRTurnLeftValid = AUTOSAR4.Signal(SwCalibrationAccess="ReadOnly", StorageClass="Global", MemorySection="VAR", DataType="boolean")  % DIR左转标志
LM_DIRTurnRightProbBytTurnLamp = AUTOSAR4.Signal(SwCalibrationAccess="ReadOnly", StorageClass="Global", MemorySection="VAR", DataType="single")  % DIR基于转向灯开启时间的右转可能性
LM_DIRTurnRightProbByTurnLampSts = AUTOSAR4.Signal(SwCalibrationAccess="ReadOnly", StorageClass="Global", MemorySection="VAR", DataType="single")  % DIR基于转向灯状态的右转可能性
LM_DIRTurnRightProbByVehSpd = AUTOSAR4.Signal(SwCalibrationAccess="ReadOnly", StorageClass="Global", MemorySection="VAR", DataType="single")  % DIR基于车速的右转可能性
LM_DIRTurnRightProbByPsiDtopt = AUTOSAR4.Signal(SwCalibrationAccess="ReadOnly", StorageClass="Global", MemorySection="VAR", DataType="single")  % DIR基于横摆角速度的右转可能性
LM_DIRTurnRightProbByKapTraj = AUTOSAR4.Signal(SwCalibrationAccess="ReadOnly", StorageClass="Global", MemorySection="VAR", DataType="single")  % DIR基于道路曲率的右转可能性
LM_DIRTurnRightProbBySteerWheelAng = AUTOSAR4.Signal(SwCalibrationAccess="ReadOnly", StorageClass="Global", MemorySection="VAR", DataType="single")  % DIR基于方向盘转角的右转可能性
LM_DIRTurnRightProb = AUTOSAR4.Signal(SwCalibrationAccess="ReadOnly", StorageClass="Global", MemorySection="VAR", DataType="single")  % DIR右转可能性
LM_DIRTurnRightValid = AUTOSAR4.Signal(SwCalibrationAccess="ReadOnly", StorageClass="Global", MemorySection="VAR", DataType="boolean")  % DIR右转标志
LM_DIREgoVehOnLineValid = AUTOSAR4.Signal(SwCalibrationAccess="ReadOnly", StorageClass="Global", MemorySection="VAR", DataType="boolean")  % DIR车辆压线标志
LM_DIRL1Valid = AUTOSAR4.Signal(SwCalibrationAccess="ReadOnly", StorageClass="Global", MemorySection="VAR", DataType="boolean")  % DIR车道线L1有效
LM_DIRR1Valid = AUTOSAR4.Signal(SwCalibrationAccess="ReadOnly", StorageClass="Global", MemorySection="VAR", DataType="boolean")  % DIR车道线R1有效
LM_DIRL1C0 = AUTOSAR4.Signal(SwCalibrationAccess="ReadOnly", StorageClass="Global", MemorySection="VAR", DataType="single")  % DIR车道线L1C0值
LM_DIRR1C0 = AUTOSAR4.Signal(SwCalibrationAccess="ReadOnly", StorageClass="Global", MemorySection="VAR", DataType="single")  % DIR车道线R1C0值
LM_DIRLiParC1 = AUTOSAR4.Signal(SwCalibrationAccess="ReadOnly", StorageClass="Global", MemorySection="VAR", DataType="single")  % DIR车道线C1值
LM_DIRLC2LeProbBySWA_TLmpOn = AUTOSAR4.Signal(SwCalibrationAccess="ReadOnly", StorageClass="Global", MemorySection="VAR", DataType="single")  % DIR转向灯开启情况基于方向盘角度的左换道可能性
LM_DIRLC2LeProbBytTLmp_TLmpOn = AUTOSAR4.Signal(SwCalibrationAccess="ReadOnly", StorageClass="Global", MemorySection="VAR", DataType="single")  % DIR转向灯开启情况基于转向灯开启时间的左换道可能性
LM_DIRLC2LeProbBySteer_TLmpOn = AUTOSAR4.Signal(SwCalibrationAccess="ReadOnly", StorageClass="Global", MemorySection="VAR", DataType="single")  % DIR转向灯开启情况基于转向的左换道可能性
LM_DIRLaneC0Dif_TLmpOn = AUTOSAR4.Signal(SwCalibrationAccess="ReadOnly", StorageClass="Global", MemorySection="VAR", DataType="single")  % DIR转向灯开启情况C0偏差
LM_DIRLC2LeProbByLB_TLmpOn = AUTOSAR4.Signal(SwCalibrationAccess="ReadOnly", StorageClass="Global", MemorySection="VAR", DataType="single")  % DIR转向灯开启情况基于车道线边界的左换道可能性
LM_DIRLC2LeProbByTLmpSts_TLmpOn = AUTOSAR4.Signal(SwCalibrationAccess="ReadOnly", StorageClass="Global", MemorySection="VAR", DataType="single")  % DIR转向灯开启情况基于转向灯状态的左换道可能性
LM_DIRtLC2LeValid_TLmpOn = AUTOSAR4.Signal(SwCalibrationAccess="ReadOnly", StorageClass="Global", MemorySection="VAR", DataType="boolean")  % DIR转向灯开启情况左换道标志
LM_DIRLC2LeBySteerValid_TLmpOff = AUTOSAR4.Signal(SwCalibrationAccess="ReadOnly", StorageClass="Global", MemorySection="VAR", DataType="boolean")  % DIR转向灯关闭情况基于转向的左换道标志
LM_DIRLC2LeByLBValid_TLmpOff = AUTOSAR4.Signal(SwCalibrationAccess="ReadOnly", StorageClass="Global", MemorySection="VAR", DataType="boolean")  % DIR转向灯关闭情况基于车道线边界的左换道标志
LM_DIRtLC2LeValid_TLmpOff = AUTOSAR4.Signal(SwCalibrationAccess="ReadOnly", StorageClass="Global", MemorySection="VAR", DataType="boolean")  % DIR转向灯关闭情况左换道标志
LM_DIRLC2LeByLiC1Valid = AUTOSAR4.Signal(SwCalibrationAccess="ReadOnly", StorageClass="Global", MemorySection="VAR", DataType="boolean")  % DIR左换道C1有效标志
LM_DIRtLC2LeValid = AUTOSAR4.Signal(SwCalibrationAccess="ReadOnly", StorageClass="Global", MemorySection="VAR", DataType="boolean")  % DIR左换道有效标志（校验前）
LM_DIRLC2LeValid = AUTOSAR4.Signal(SwCalibrationAccess="ReadOnly", StorageClass="Global", MemorySection="VAR", DataType="boolean")  % DIR左换道有效标志（校验后）
LM_DIRLC2RigProbBySWA_TLmpOn = AUTOSAR4.Signal(SwCalibrationAccess="ReadOnly", StorageClass="Global", MemorySection="VAR", DataType="single")  % DIR转向灯开启情况基于方向盘角度的右换道可能性
LM_DIRLC2RigProbBytTLmp_TLmpOn = AUTOSAR4.Signal(SwCalibrationAccess="ReadOnly", StorageClass="Global", MemorySection="VAR", DataType="single")  % DIR转向灯开启情况基于转向灯开启时间的右换道可能性
LM_DIRLC2RigProbBySteer_TLmpOn = AUTOSAR4.Signal(SwCalibrationAccess="ReadOnly", StorageClass="Global", MemorySection="VAR", DataType="single")  % DIR转向灯开启情况基于转向的右换道可能性
LM_DIRLC2RigProbByLB_TLmpOn = AUTOSAR4.Signal(SwCalibrationAccess="ReadOnly", StorageClass="Global", MemorySection="VAR", DataType="single")  % DIR转向灯开启情况基于车道线边界的右换道可能性
LM_DIRtLC2RigValid_TLmpOn = AUTOSAR4.Signal(SwCalibrationAccess="ReadOnly", StorageClass="Global", MemorySection="VAR", DataType="boolean")  % DIR转向灯开启情况右换道标志
LM_DIRLC2RigProbByTLmpSts_TLmpOn = AUTOSAR4.Signal(SwCalibrationAccess="ReadOnly", StorageClass="Global", MemorySection="VAR", DataType="single")  % DIR转向灯开启情况基于转向灯状态的右换道可能性
LM_DIRLC2RigBySteerValid_TLmpOff = AUTOSAR4.Signal(SwCalibrationAccess="ReadOnly", StorageClass="Global", MemorySection="VAR", DataType="boolean")  % DIR转向灯关闭情况基于转向的右换道标志
LM_DIRLC2RigByLBValid_TLmpOff = AUTOSAR4.Signal(SwCalibrationAccess="ReadOnly", StorageClass="Global", MemorySection="VAR", DataType="boolean")  % DIR转向灯关闭情况基于车道线边界的右换道标志
LM_DIRtLC2RigValid_TLmpOff = AUTOSAR4.Signal(SwCalibrationAccess="ReadOnly", StorageClass="Global", MemorySection="VAR", DataType="boolean")  % DIR转向灯关闭情况右换道标志
LM_DIRLC2RigByLiC1Valid = AUTOSAR4.Signal(SwCalibrationAccess="ReadOnly", StorageClass="Global", MemorySection="VAR", DataType="boolean")  % DIR右换道C1有效标志
LM_DIRtLC2RigValid = AUTOSAR4.Signal(SwCalibrationAccess="ReadOnly", StorageClass="Global", MemorySection="VAR", DataType="boolean")  % DIR右换道有效标志（校验前）
LM_DIRLC2RigValid = AUTOSAR4.Signal(SwCalibrationAccess="ReadOnly", StorageClass="Global", MemorySection="VAR", DataType="boolean")  % DIR右换道有效标志（校验后）
LM_DIR_SW_VERSION = AUTOSAR4.Signal(SwCalibrationAccess="ReadOnly", StorageClass="Global", MemorySection="VAR", DataType="uint32")  % DIR软件版本