% Simulink data dictionary PvtParsLM_4_VSL.sldd

P_LM_VSLLineQualitydiffThre = AUTOSAR4.Parameter(0.3, SwCalibrationAccess="ReadWrite", StorageClass="Global", MemorySection="CAL", DataType="single", Min=0, Max=1)  % VSL道路模型车道线平均质量与最小质量差值阈值
P_LM_VSLLineMinQualityThre = AUTOSAR4.Parameter(0.15, SwCalibrationAccess="ReadWrite", StorageClass="Global", MemorySection="CAL", DataType="single", Min=0, Max=1)  % VSL道路模型车道线最小质量阈值
P_LM_VSLBLSDiffThre = AUTOSAR4.Parameter(1, SwCalibrationAccess="ReadWrite", StorageClass="Global", MemorySection="CAL", DataType="single", Min=0, Max=2)  % VSL道路模型与基准线dy偏差阈值
P_LM_VSLBLSDisRatio = AUTOSAR4.Parameter(0.6, SwCalibrationAccess="ReadWrite", StorageClass="Global", MemorySection="CAL", DataType="single", Min=0, Max=1)  % VSL道路模型与基准线dx偏差占比
P_LM_VSLLineBaseQualityRatio = AUTOSAR4.Parameter([0.5 0.8 1 1], SwCalibrationAccess="ReadWrite", StorageClass="Global", MemorySection="CAL", DataType="single", Min=0, Max=1)  % VSL道路模型车道线质量系数
P_LM_VSLAvailLineNum = AUTOSAR4.Parameter([1 2 3 4], SwCalibrationAccess="ReadWrite", StorageClass="Global", MemorySection="CAL", DataType="single", Min=1, Max=4)  % VSL道路模型有效车道线数量
P_LM_VSLFusBLParFiltP_C1 = AUTOSAR4.Parameter(0.5, SwCalibrationAccess="ReadWrite", StorageClass="Global", MemorySection="CAL", DataType="single", Min=0, Max=1)  % VSL道路模型车道线参数C1修正系数
P_LM_VSLFusBLParFiltP_C3 = AUTOSAR4.Parameter(0.25, SwCalibrationAccess="ReadWrite", StorageClass="Global", MemorySection="CAL", DataType="single", Min=0, Max=1)  % VSL道路模型车道线参数C3修正系数
P_LM_VSLFusBLParFiltP_Quality = AUTOSAR4.Parameter(0.25, SwCalibrationAccess="ReadWrite", StorageClass="Global", MemorySection="CAL", DataType="single", Min=0, Max=1)  % VSL道路模型车道线质量修正系数
P_LM_VSLPath1DisDiffThre = AUTOSAR4.Parameter(5, SwCalibrationAccess="ReadWrite", StorageClass="Global", MemorySection="CAL", DataType="single", Min=0, Max=10)  % VSL道路模型前方第一段车道线dx偏差阈值
P_LM_VSLPath2DisDiffThre = AUTOSAR4.Parameter(15, SwCalibrationAccess="ReadWrite", StorageClass="Global", MemorySection="CAL", DataType="single", Min=0, Max=20)  % VSL道路模型前方第二段车道线dx偏差阈值
P_LM_VSLHistTrajBaseDis = AUTOSAR4.Parameter(1.5, SwCalibrationAccess="ReadWrite", StorageClass="Global", MemorySection="CAL", DataType="single", Min=0, Max=3)  % VSL道路模型历史点记录间距
P_LM_VSLHistTrajPNum = AUTOSAR4.Parameter(60, SwCalibrationAccess="ReadWrite", StorageClass="Global", MemorySection="CAL", DataType="uint8", Min=60, Max=90)  % VSL道路模型记录历史点总数
P_LM_VSLLCFntPathC1 = AUTOSAR4.Parameter(0.02, SwCalibrationAccess="ReadWrite", StorageClass="Global", MemorySection="CAL", DataType="single", Min=0.01, Max=0.05)  % VSL道路模型自车变道判断前方车道线C1阈值
P_LM_VSLCLC0diff = AUTOSAR4.Parameter(2, SwCalibrationAccess="ReadWrite", StorageClass="Global", MemorySection="CAL", DataType="single", Min=1.5, Max=3)  % VSL道路模型自车左变道C0差值
P_LM_VSLCLMaxC0 = AUTOSAR4.Parameter(2, SwCalibrationAccess="ReadWrite", StorageClass="Global", MemorySection="CAL", DataType="single", Min=1.5, Max=3)  % VSL道路模型自车左变道C0最大值
P_LM_VSLCLMinC0 = AUTOSAR4.Parameter(1.5, SwCalibrationAccess="ReadWrite", StorageClass="Global", MemorySection="CAL", DataType="single", Min=1, Max=2)  % VSL道路模型自车左变道C0最小值
P_LM_VSLCRC0diff = AUTOSAR4.Parameter(-2, SwCalibrationAccess="ReadWrite", StorageClass="Global", MemorySection="CAL", DataType="single", Min=-3, Max=-1.5)  % VSL道路模型自车右变道C0差值
P_LM_VSLCRMaxC0 = AUTOSAR4.Parameter(-1.5, SwCalibrationAccess="ReadWrite", StorageClass="Global", MemorySection="CAL", DataType="single", Min=-2, Max=-1)  % VSL道路模型自车右变道C0最大值
P_LM_VSLCRMinC0 = AUTOSAR4.Parameter(-2, SwCalibrationAccess="ReadWrite", StorageClass="Global", MemorySection="CAL", DataType="single", Min=-3, Max=-1.5)  % VSL道路模型自车右变道C0最小值
P_LM_VSLRearLaneQualityRatio = AUTOSAR4.Parameter(0.3, SwCalibrationAccess="ReadWrite", StorageClass="Global", MemorySection="CAL", DataType="single", Min=0.2, Max=1)  % VSL道路模型后方车道线质量系数
P_LM_VSLRearLanePolyfitQualityRatio = AUTOSAR4.Parameter(5, SwCalibrationAccess="ReadWrite", StorageClass="Global", MemorySection="CAL", DataType="single", Min=3, Max=10)  % VSL道路模型后方一段拟合车道线质量系数
P_LM_VSLRearPathC2Thre = AUTOSAR4.Parameter(0.05, SwCalibrationAccess="ReadWrite", StorageClass="Global", MemorySection="CAL", DataType="single", Min=0, Max=0.1)  % VSL后方车道线拟合C2判断阈值
P_LM_VSLRearPathC1Thre = AUTOSAR4.Parameter(0.3, SwCalibrationAccess="ReadWrite", StorageClass="Global", MemorySection="CAL", DataType="single", Min=0, Max=1)  % VSL后方车道线拟合C1判断阈值
P_LM_VSLCurveC2Thre = AUTOSAR4.Parameter(0.005, SwCalibrationAccess="ReadWrite", StorageClass="Global", MemorySection="CAL", DataType="single", Min=0, Max=0.5)  % VSL弯道判断曲率阈值
P_LM_VSLMinHistPntDis = AUTOSAR4.Parameter(18, SwCalibrationAccess="ReadWrite", StorageClass="Global", MemorySection="CAL", DataType="single", Min=0, Max=80)  % VSL后方轨迹点最小距离
P_LM_VSLRear1TimesPolyDisThre = AUTOSAR4.Parameter(45, SwCalibrationAccess="ReadWrite", StorageClass="Global", MemorySection="CAL", DataType="single", Min=0, Max=80)  % VSL后方轨迹一段拟合距离阈值
P_LM_VSLCurveJudgC2Thre = AUTOSAR4.Parameter(0.005, SwCalibrationAccess="ReadWrite", StorageClass="Global", MemorySection="CAL", DataType="single", Min=0, Max=1)  % VSL后方轨迹弯道判断C2阈值
P_LM_VSLFusBLParFiltP_C2 = AUTOSAR4.Parameter(0.5, SwCalibrationAccess="ReadWrite", StorageClass="Global", MemorySection="CAL", DataType="single", Min=0, Max=1)  % VSL道路模型车道线参数C2修正系数
P_LM_EQ4_Line_Swt = AUTOSAR4.Parameter(1, SwCalibrationAccess="ReadWrite", StorageClass="Global", MemorySection="CAL", DataType="uint8")

P_LM_VSL_SWSts = AUTOSAR4.Parameter(1, SwCalibrationAccess="ReadWrite", StorageClass="Global", MemorySection="CAL", DataType="uint8")  % 1 VSLOpen
  % 0 VSLOff

LM_VSLL2bIsLineExist = AUTOSAR4.Signal(SwCalibrationAccess="ReadOnly", StorageClass="Global", MemorySection="VAR", DataType="uint8")  % VSL道路模型L2车道线是否存在
LM_VSLL1bIsLineExist = AUTOSAR4.Signal(SwCalibrationAccess="ReadOnly", StorageClass="Global", MemorySection="VAR", DataType="uint8")  % VSL道路模型L1车道线是否存在
LM_VSLR1bIsLineExist = AUTOSAR4.Signal(SwCalibrationAccess="ReadOnly", StorageClass="Global", MemorySection="VAR", DataType="uint8")  % VSL道路模型R1车道线是否存在
LM_VSLR2bIsLineExist = AUTOSAR4.Signal(SwCalibrationAccess="ReadOnly", StorageClass="Global", MemorySection="VAR", DataType="uint8")  % VSL道路模型R2车道线是否存在
LM_VSLL2dQuality = AUTOSAR4.Signal(SwCalibrationAccess="ReadOnly", StorageClass="Global", MemorySection="VAR", DataType="single")  % VSL道路模型L2车道线质量
LM_VSLL1dQuality = AUTOSAR4.Signal(SwCalibrationAccess="ReadOnly", StorageClass="Global", MemorySection="VAR", DataType="single")  % VSL道路模型L1车道线质量
LM_VSLR1dQuality = AUTOSAR4.Signal(SwCalibrationAccess="ReadOnly", StorageClass="Global", MemorySection="VAR", DataType="single")  % VSL道路模型R1车道线质量
LM_VSLR2dQuality = AUTOSAR4.Signal(SwCalibrationAccess="ReadOnly", StorageClass="Global", MemorySection="VAR", DataType="single")  % VSL道路模型R2车道线质量
LM_VSLL2dDisFront = AUTOSAR4.Signal(SwCalibrationAccess="ReadOnly", StorageClass="Global", MemorySection="VAR", DataType="single")  % VSL道路模型L2车道线前方有效长度
LM_VSLL1dDisFront = AUTOSAR4.Signal(SwCalibrationAccess="ReadOnly", StorageClass="Global", MemorySection="VAR", DataType="single")  % VSL道路模型L1车道线前方有效长度
LM_VSLR1dDisFront = AUTOSAR4.Signal(SwCalibrationAccess="ReadOnly", StorageClass="Global", MemorySection="VAR", DataType="single")  % VSL道路模型R1车道线前方有效长度
LM_VSLR2dDisFront = AUTOSAR4.Signal(SwCalibrationAccess="ReadOnly", StorageClass="Global", MemorySection="VAR", DataType="single")  % VSL道路模型R2车道线前方有效长度
LM_VSLL2dDisStart = AUTOSAR4.Signal(SwCalibrationAccess="ReadOnly", StorageClass="Global", MemorySection="VAR", DataType="single")  % VSL道路模型L2前方车道线起始长度
LM_VSLL1dDisStart = AUTOSAR4.Signal(SwCalibrationAccess="ReadOnly", StorageClass="Global", MemorySection="VAR", DataType="single")  % VSL道路模型L1前方车道线起始长度
LM_VSLR1dDisStart = AUTOSAR4.Signal(SwCalibrationAccess="ReadOnly", StorageClass="Global", MemorySection="VAR", DataType="single")  % VSL道路模型R1前方车道线起始长度
LM_VSLR2dDisStart = AUTOSAR4.Signal(SwCalibrationAccess="ReadOnly", StorageClass="Global", MemorySection="VAR", DataType="single")  % VSL道路模型R2前方车道线起始长度
LM_VSLL2C0 = AUTOSAR4.Signal(SwCalibrationAccess="ReadOnly", StorageClass="Global", MemorySection="VAR", DataType="single")  % VSL道路模型L2车道线输入C0值
LM_VSLL1C0 = AUTOSAR4.Signal(SwCalibrationAccess="ReadOnly", StorageClass="Global", MemorySection="VAR", DataType="single")  % VSL道路模型L1车道线输入C0值
LM_VSLR1C0 = AUTOSAR4.Signal(SwCalibrationAccess="ReadOnly", StorageClass="Global", MemorySection="VAR", DataType="single")  % VSL道路模型R1车道线输入C0值
LM_VSLR2C0 = AUTOSAR4.Signal(SwCalibrationAccess="ReadOnly", StorageClass="Global", MemorySection="VAR", DataType="single")  % VSL道路模型R2车道线输入C0值
LM_VSLL2C1 = AUTOSAR4.Signal(SwCalibrationAccess="ReadOnly", StorageClass="Global", MemorySection="VAR", DataType="single")  % VSL道路模型L2车道线输入C1值
LM_VSLL1C1 = AUTOSAR4.Signal(SwCalibrationAccess="ReadOnly", StorageClass="Global", MemorySection="VAR", DataType="single")  % VSL道路模型L1车道线输入C1值
LM_VSLR1C1 = AUTOSAR4.Signal(SwCalibrationAccess="ReadOnly", StorageClass="Global", MemorySection="VAR", DataType="single")  % VSL道路模型R1车道线输入C1值
LM_VSLR2C1 = AUTOSAR4.Signal(SwCalibrationAccess="ReadOnly", StorageClass="Global", MemorySection="VAR", DataType="single")  % VSL道路模型R2车道线输入C1值
LM_VSLL2C2 = AUTOSAR4.Signal(SwCalibrationAccess="ReadOnly", StorageClass="Global", MemorySection="VAR", DataType="single")  % VSL道路模型L2车道线输入C2值
LM_VSLL1C2 = AUTOSAR4.Signal(SwCalibrationAccess="ReadOnly", StorageClass="Global", MemorySection="VAR", DataType="single")  % VSL道路模型L1车道线输入C2值
LM_VSLR1C2 = AUTOSAR4.Signal(SwCalibrationAccess="ReadOnly", StorageClass="Global", MemorySection="VAR", DataType="single")  % VSL道路模型R1车道线输入C2值
LM_VSLR2C2 = AUTOSAR4.Signal(SwCalibrationAccess="ReadOnly", StorageClass="Global", MemorySection="VAR", DataType="single")  % VSL道路模型R2车道线输入C2值
LM_VSLL2C3 = AUTOSAR4.Signal(SwCalibrationAccess="ReadOnly", StorageClass="Global", MemorySection="VAR", DataType="single")  % VSL道路模型L2车道线输入C3值
LM_VSLL1C3 = AUTOSAR4.Signal(SwCalibrationAccess="ReadOnly", StorageClass="Global", MemorySection="VAR", DataType="single")  % VSL道路模型L1车道线输入C3值
LM_VSLR1C3 = AUTOSAR4.Signal(SwCalibrationAccess="ReadOnly", StorageClass="Global", MemorySection="VAR", DataType="single")  % VSL道路模型R1车道线输入C3值
LM_VSLR2C3 = AUTOSAR4.Signal(SwCalibrationAccess="ReadOnly", StorageClass="Global", MemorySection="VAR", DataType="single")  % VSL道路模型R2车道线输入C3值
LM_ComLineLostNum = AUTOSAR4.Signal(SwCalibrationAccess="ReadOnly", StorageClass="Global", MemorySection="VAR", DataType="uint8")  % VSL道路模型车道线丢失数量
LM_VSLLLC0 = AUTOSAR4.Signal(SwCalibrationAccess="ReadOnly", StorageClass="Global", MemorySection="VAR", DataType="single")  % VSL道路模型左左车道线C0
LM_VSLLRC0 = AUTOSAR4.Signal(SwCalibrationAccess="ReadOnly", StorageClass="Global", MemorySection="VAR", DataType="single")  % VSL道路模型左右车道线C0
LM_VSLRLC0 = AUTOSAR4.Signal(SwCalibrationAccess="ReadOnly", StorageClass="Global", MemorySection="VAR", DataType="single")  % VSL道路模型右左车道线C0
LM_VSLRRC0 = AUTOSAR4.Signal(SwCalibrationAccess="ReadOnly", StorageClass="Global", MemorySection="VAR", DataType="single")  % VSL道路模型右右车道线C0
LM_VSLBaseC1 = AUTOSAR4.Signal(SwCalibrationAccess="ReadOnly", StorageClass="Global", MemorySection="VAR", DataType="single")  % VSL道路模型车道线系数C1
LM_VSLBaseC2 = AUTOSAR4.Signal(SwCalibrationAccess="ReadOnly", StorageClass="Global", MemorySection="VAR", DataType="single")  % VSL道路模型车道线系数C2
LM_VSLBaseC3 = AUTOSAR4.Signal(SwCalibrationAccess="ReadOnly", StorageClass="Global", MemorySection="VAR", DataType="single")  % VSL道路模型车道线系数C3
LM_VSLBaseQuality = AUTOSAR4.Signal(SwCalibrationAccess="ReadOnly", StorageClass="Global", MemorySection="VAR", DataType="single")  % VSL道路模型车道线质量
LM_VSLBaseC1Filt = AUTOSAR4.Signal(SwCalibrationAccess="ReadOnly", StorageClass="Global", MemorySection="VAR", DataType="single")  % VSL道路模型滤波后车道线系数C1
LM_VSLBaseC2Filt = AUTOSAR4.Signal(SwCalibrationAccess="ReadOnly", StorageClass="Global", MemorySection="VAR", DataType="single")  % VSL道路模型滤波后车道线系数C2
LM_VSLBaseC3Filt = AUTOSAR4.Signal(SwCalibrationAccess="ReadOnly", StorageClass="Global", MemorySection="VAR", DataType="single")  % VSL道路模型滤波后车道线系数C3
LM_VSLBaseQualityFilt = AUTOSAR4.Signal(SwCalibrationAccess="ReadOnly", StorageClass="Global", MemorySection="VAR", DataType="single")  % VSL道路模型滤波后车道线质量
LM_VSLFntPath1Quality = AUTOSAR4.Signal(SwCalibrationAccess="ReadOnly", StorageClass="Global", MemorySection="VAR", DataType="single")  % VSL道路模型前方第一段车道线质量
LM_VSLFntPath2Quality = AUTOSAR4.Signal(SwCalibrationAccess="ReadOnly", StorageClass="Global", MemorySection="VAR", DataType="single")  % VSL道路模型前方第二段车道线质量
LM_VSLFntPath3Quality = AUTOSAR4.Signal(SwCalibrationAccess="ReadOnly", StorageClass="Global", MemorySection="VAR", DataType="single")  % VSL道路模型前方第三段车道线质量
LM_VSL_RearLRC0 = AUTOSAR4.Signal(SwCalibrationAccess="ReadOnly", StorageClass="Global", MemorySection="VAR", DataType="single")  % VSL道路模型后方左车道线C0
LM_VSL_RearRLC0 = AUTOSAR4.Signal(SwCalibrationAccess="ReadOnly", StorageClass="Global", MemorySection="VAR", DataType="single")  % VSL道路模型后方右车道线C0
LM_VSLHistLineInfoRcdFlg = AUTOSAR4.Signal(SwCalibrationAccess="ReadOnly", StorageClass="Global", MemorySection="VAR", DataType="boolean")  % VSL道路模型后方buffer记点标志位
LM_VSLHistPFristPos = AUTOSAR4.Signal(SwCalibrationAccess="ReadOnly", StorageClass="Global", MemorySection="VAR", DataType="uint8")  % VSL道路模型后方buffer记录起始点
LM_VSLHistPEndPos = AUTOSAR4.Signal(SwCalibrationAccess="ReadOnly", StorageClass="Global", MemorySection="VAR", DataType="uint8")  % VSL道路模型后方buffer记录终止点
LM_VSLHistPNum = AUTOSAR4.Signal(SwCalibrationAccess="ReadOnly", StorageClass="Global", MemorySection="VAR", DataType="uint8")  % VSL道路模型后方buffer记点数量
LM_VSLLaChgC0JumpFlg = AUTOSAR4.Signal(SwCalibrationAccess="ReadOnly", StorageClass="Global", MemorySection="VAR", DataType="int8")  % VSL道路模型判断变道标志位
LM_VSLLRC0HistInfoX = AUTOSAR4.Signal(SwCalibrationAccess="ReadOnly", StorageClass="Global", MemorySection="VAR", DataType="single")  % VSL道路模型后方LR_C0 _X  buffer
LM_VSLLRC0HistInfoY = AUTOSAR4.Signal(SwCalibrationAccess="ReadOnly", StorageClass="Global", MemorySection="VAR", DataType="single")  % VSL道路模型后方LR_C0 _Y  buffer
LM_VSLRLC0HistInfoX = AUTOSAR4.Signal(SwCalibrationAccess="ReadOnly", StorageClass="Global", MemorySection="VAR", DataType="single")  % VSL道路模型后方RL_C0 _X  buffer
LM_VSLRLC0HistInfoY = AUTOSAR4.Signal(SwCalibrationAccess="ReadOnly", StorageClass="Global", MemorySection="VAR", DataType="single")  % VSL道路模型后方RL_C0 _Y  buffer
LM_VSLRearPath1P = AUTOSAR4.Signal(SwCalibrationAccess="ReadOnly", StorageClass="Global", MemorySection="VAR", DataType="single")  % VSL道路模型后方第一段（整段）车道线参数
LM_VSLRearPath1Qulity = AUTOSAR4.Signal(SwCalibrationAccess="ReadOnly", StorageClass="Global", MemorySection="VAR", DataType="single")  % VSL道路模型后方第一段（整段）车道线质量
LM_VSLRearPath2P = AUTOSAR4.Signal(SwCalibrationAccess="ReadOnly", StorageClass="Global", MemorySection="VAR", DataType="single")  % VSL道路模型后方第二段车道线参数
LM_VSLRearPath2Qulity = AUTOSAR4.Signal(SwCalibrationAccess="ReadOnly", StorageClass="Global", MemorySection="VAR", DataType="single")  % VSL道路模型后方第二段车道线质量
LM_VSLRearPath3P = AUTOSAR4.Signal(SwCalibrationAccess="ReadOnly", StorageClass="Global", MemorySection="VAR", DataType="single")  % VSL道路模型后方第三段车道线参数
LM_VSLRearPath3Qulity = AUTOSAR4.Signal(SwCalibrationAccess="ReadOnly", StorageClass="Global", MemorySection="VAR", DataType="single")  % VSL道路模型后方第三段车道线质量
LM_VSLLRC0Flg = AUTOSAR4.Signal(SwCalibrationAccess="ReadOnly", StorageClass="Global", MemorySection="VAR", DataType="boolean")  % VSL道路模型左变道标志位
LM_VSLC1Flg = AUTOSAR4.Signal(SwCalibrationAccess="ReadOnly", StorageClass="Global", MemorySection="VAR", DataType="boolean")  % VSL道路模型C1变道标志位
LM_VSLRigC0Flg = AUTOSAR4.Signal(SwCalibrationAccess="ReadOnly", StorageClass="Global", MemorySection="VAR", DataType="boolean")  % VSL道路模型右变道标志位
LM_VSLLRC0Diff = AUTOSAR4.Signal(SwCalibrationAccess="ReadOnly", StorageClass="Global", MemorySection="VAR", DataType="single")  % VSL道路模型左变道C0差值
LM_VSLLRC0K = AUTOSAR4.Signal(SwCalibrationAccess="ReadOnly", StorageClass="Global", MemorySection="VAR", DataType="single")  % VSL道路模型左变道上一时刻C0值
LM_VSLRLC0Diff = AUTOSAR4.Signal(SwCalibrationAccess="ReadOnly", StorageClass="Global", MemorySection="VAR", DataType="single")  % VSL道路模型右变道C0差值
LM_VSLRLC0K = AUTOSAR4.Signal(SwCalibrationAccess="ReadOnly", StorageClass="Global", MemorySection="VAR", DataType="single")  % VSL道路模型右变道上一时刻C0值
LM_VSLHistRecordC2Val = AUTOSAR4.Signal(SwCalibrationAccess="ReadOnly", StorageClass="Global", MemorySection="VAR", DataType="single")  % VSL记录道路曲率值
LM_VSLHistMaxC2 = AUTOSAR4.Signal(SwCalibrationAccess="ReadOnly", StorageClass="Global", MemorySection="VAR", DataType="single")  % VSL记录历史最大道路曲率
LM_VSLRearPath1Pre = AUTOSAR4.Signal(SwCalibrationAccess="ReadOnly", StorageClass="Global", MemorySection="VAR", DataType="single")  % VSL后方第一段拟合参数（未修正）
LM_VSL_SW_VERSION = AUTOSAR4.Signal(SwCalibrationAccess="ReadOnly", StorageClass="Global", MemorySection="VAR", DataType="uint32")  % VSL软件版本