% Simulink data dictionary PvtParsLM_5_EML.sldd

P_LM_EMLHistTrajBaseDis = AUTOSAR4.Parameter(1.5, SwCalibrationAccess="ReadWrite", StorageClass="Global", MemorySection="CAL", DataType="single")
P_LM_EMLHistTrajPNum = AUTOSAR4.Parameter(80, SwCalibrationAccess="ReadWrite", StorageClass="Global", MemorySection="CAL", DataType="uint8")
P_LM_EMLFntPathBaseQualityX = AUTOSAR4.Parameter([0 5 10 15 20 35 50 80 120 170 280], SwCalibrationAccess="ReadWrite", StorageClass="Global", MemorySection="CAL", DataType="single")  % EML道路模型基础质量转角速率插值
P_LM_EMLFntPathBaseQualityY = AUTOSAR4.Parameter([0.96 0.92 0.8 0.7 0.6 0.5 0.3 0.3 0.28 0.25 0.2], SwCalibrationAccess="ReadWrite", StorageClass="Global", MemorySection="CAL", DataType="single")  % EML道路模型基础质量转角速率输出质量
P_LM_EMLFntPathQualityFacBySteerAngX = AUTOSAR4.Parameter([5 15 30 50 80 100], SwCalibrationAccess="ReadWrite", StorageClass="Global", MemorySection="CAL", DataType="single")  % EML道路模型基础质量方向盘转角插值
P_LM_EMLFntPathQualityFacBySteerAngY = AUTOSAR4.Parameter([0.96 0.8 0.7 0.6 0.5 0.3], SwCalibrationAccess="ReadWrite", StorageClass="Global", MemorySection="CAL", DataType="single")  % EML道路模型基础质量方向盘转角输出质量
P_LM_EMLFntPath1QualityFacByVxvX = AUTOSAR4.Parameter([3 6 10 15 20 35], SwCalibrationAccess="ReadWrite", StorageClass="Global", MemorySection="CAL", DataType="single")  % EML道路模型前方第一段质量车速插值
P_LM_EMLFntPath1QualityFacByVxvY = AUTOSAR4.Parameter([0.35 0.55 0.75 0.9 0.95 0.99], SwCalibrationAccess="ReadWrite", StorageClass="Global", MemorySection="CAL", DataType="single")  % EML道路模型前方第一段质量车速输出
P_LM_EMLFntPath2QualityFacByVxvX = AUTOSAR4.Parameter([0 5 10 15 20 30 40], SwCalibrationAccess="ReadWrite", StorageClass="Global", MemorySection="CAL", DataType="single")  % EML道路模型前方第二段质量车速插值
P_LM_EMLFntPath2QualityFacByVxvY = AUTOSAR4.Parameter([0 0 0.25 0.45 0.55 0.65 0.9], SwCalibrationAccess="ReadWrite", StorageClass="Global", MemorySection="CAL", DataType="single")  % EML道路模型前方第二段质量车速输出
P_LM_EMLFntPath3QualityFacByVxvX = AUTOSAR4.Parameter([0 15 20 30 45 50], SwCalibrationAccess="ReadWrite", StorageClass="Global", MemorySection="CAL", DataType="single")  % EML道路模型前方第三段质量车速插值
P_LM_EMLFntPath3QualityFacByVxvY = AUTOSAR4.Parameter([0 0 0.35 0.5 0.75 0.9], SwCalibrationAccess="ReadWrite", StorageClass="Global", MemorySection="CAL", DataType="single")  % EML道路模型前方第三段质量车速输出
P_LM_EMLHistKapRcdBufSize = AUTOSAR4.Parameter(25, SwCalibrationAccess="ReadWrite", StorageClass="Global", MemorySection="CAL", DataType="uint8")  % EML道路模型存储前3s道路曲率buffer尺寸
P_LM_EMLTurnActKapThre = AUTOSAR4.Parameter(0.03, SwCalibrationAccess="ReadWrite", StorageClass="Global", MemorySection="CAL", DataType="single")  % EML道路模型左右转行为判断道路曲率阈值
P_LM_EMLMinKapThre = AUTOSAR4.Parameter(0.002, SwCalibrationAccess="ReadWrite", StorageClass="Global", MemorySection="CAL", DataType="single")  % EML道路模型最小道路曲率修正阈值
P_LM_EMLKapCorrMaxThre = AUTOSAR4.Parameter(0.002, SwCalibrationAccess="ReadWrite", StorageClass="Global", MemorySection="CAL", DataType="single")  % EML道路模型采用曲率修正值最大阈值，即未超过该值输出修正值，否则输出0.5倍的道路曲率
P_LM_EMLQuaFiltPar = AUTOSAR4.Parameter(0.35, SwCalibrationAccess="ReadWrite", StorageClass="Global", MemorySection="CAL", DataType="single", Min=0, Max=1)  % EML道路模型质量滤波参数
P_LM_EMLValidQuaThre = AUTOSAR4.Parameter(0.1, SwCalibrationAccess="ReadWrite", StorageClass="Global", MemorySection="CAL", DataType="single", Min=0, Max=1)  % EML道路模型有效质量阈值
P_LM_EMLHistKapCalPara = AUTOSAR4.Parameter(0, SwCalibrationAccess="ReadWrite", StorageClass="Global", MemorySection="CAL", DataType="uint8")  % EML道路模型Kap计算开关设置参数，等于0输出25周期内最小值
LM_EMLFntPath_C2 = AUTOSAR4.Signal(SwCalibrationAccess="ReadOnly", StorageClass="Global", MemorySection="VAR", DataType="single")  % EML前方轨迹参数C2
LM_EMLMinKap = AUTOSAR4.Signal(SwCalibrationAccess="ReadOnly", StorageClass="Global", MemorySection="VAR", DataType="single")  % EML前3s内最小道路曲率
LM_EMLKapCorr = AUTOSAR4.Signal(SwCalibrationAccess="ReadOnly", StorageClass="Global", MemorySection="VAR", DataType="single")  % EML道路曲率修正值
LM_EMLKap = AUTOSAR4.Signal(SwCalibrationAccess="ReadOnly", StorageClass="Global", MemorySection="VAR", DataType="single")  % EML道路曲率
LM_EMLFntPath1Quality = AUTOSAR4.Signal(SwCalibrationAccess="ReadOnly", StorageClass="Global", MemorySection="VAR", DataType="single")  % EML道路模型前方第一段轨迹质量
LM_EMLFntPath2Quality = AUTOSAR4.Signal(SwCalibrationAccess="ReadOnly", StorageClass="Global", MemorySection="VAR", DataType="single")  % EML道路模型前方第二段轨迹质量
LM_EMLFntPath3Quality = AUTOSAR4.Signal(SwCalibrationAccess="ReadOnly", StorageClass="Global", MemorySection="VAR", DataType="single")  % EML道路模型前方第三段轨迹质量
LM_EMLLLC0 = AUTOSAR4.Signal(SwCalibrationAccess="ReadOnly", StorageClass="Global", MemorySection="VAR", DataType="single")  % EML道路模型左左车道线C0
LM_EMLLRC0 = AUTOSAR4.Signal(SwCalibrationAccess="ReadOnly", StorageClass="Global", MemorySection="VAR", DataType="single")  % EML道路模型左右车道线C0
LM_EMLRLC0 = AUTOSAR4.Signal(SwCalibrationAccess="ReadOnly", StorageClass="Global", MemorySection="VAR", DataType="single")  % EML道路模型右左车道线C0
LM_EMLRRC0 = AUTOSAR4.Signal(SwCalibrationAccess="ReadOnly", StorageClass="Global", MemorySection="VAR", DataType="single")  % EML道路模型右右车道线C0
LM_EMLRearPath1P = AUTOSAR4.Signal(SwCalibrationAccess="ReadOnly", StorageClass="Global", MemorySection="VAR", DataType="single")  % EML道路模型后方第1段轨迹参数
LM_EMLRearPath1Qulity = AUTOSAR4.Signal(SwCalibrationAccess="ReadOnly", StorageClass="Global", MemorySection="VAR", DataType="single")  % EML道路模型后方第1段轨迹质量
LM_EMLRearPath2P = AUTOSAR4.Signal(SwCalibrationAccess="ReadOnly", StorageClass="Global", MemorySection="VAR", DataType="single")  % EML道路模型后方第2段轨迹参数
LM_EMLRearPath2Qulity = AUTOSAR4.Signal(SwCalibrationAccess="ReadOnly", StorageClass="Global", MemorySection="VAR", DataType="single")  % EML道路模型后方第2段轨迹质量
LM_EMLRearPath3P = AUTOSAR4.Signal(SwCalibrationAccess="ReadOnly", StorageClass="Global", MemorySection="VAR", DataType="single")  % EML道路模型后方第3段轨迹参数
LM_EMLRearPath3Qulity = AUTOSAR4.Signal(SwCalibrationAccess="ReadOnly", StorageClass="Global", MemorySection="VAR", DataType="single")  % EML道路模型后方第3段轨迹质量
LM_EMLRearPathtpx1 = AUTOSAR4.Signal(SwCalibrationAccess="ReadOnly", StorageClass="Global", MemorySection="VAR", DataType="single")  % EML道路模型后方第一段轨迹x_buffer
LM_EMLRearPathtpy1 = AUTOSAR4.Signal(SwCalibrationAccess="ReadOnly", StorageClass="Global", MemorySection="VAR", DataType="single")  % EML道路模型后方第一段轨迹y_buffer
LM_EML_SW_VERSION = AUTOSAR4.Signal(SwCalibrationAccess="ReadOnly", StorageClass="Global", MemorySection="VAR", DataType="uint32")  % EML软件版本