% Simulink data dictionary PvtParsLM_7_OTL.sldd

P_LM_OTLTrajPntBaseDis = AUTOSAR4.Parameter(2, SwCalibrationAccess="ReadWrite", StorageClass="Global", MemorySection="CAL", DataType="single", Min=0, Max=10)  % OTL道路模型采样点间隔距离
P_LM_OTLObjNum = AUTOSAR4.Parameter(80, SwCalibrationAccess="ReadWrite", StorageClass="Global", MemorySection="CAL", DataType="uint8")  % OTL道路模型输入目标总数
P_LM_OTLObjSelectVxThre = AUTOSAR4.Parameter(6, SwCalibrationAccess="ReadWrite", StorageClass="Global", MemorySection="CAL", DataType="single")  % OTL道路模型目标初选最小车速阈值
P_LM_OTLObjSelectVyAssessDx = AUTOSAR4.Parameter([10 40 70 100 130], SwCalibrationAccess="ReadWrite", StorageClass="Global", MemorySection="CAL", DataType="single")
P_LM_OTLObjSelectVyThre = AUTOSAR4.Parameter([2 3 4 5 6], SwCalibrationAccess="ReadWrite", StorageClass="Global", MemorySection="CAL", DataType="single")  % OTL道路模型目标初选最大vy阈值
P_LM_OTLObjSelectAgeThre = AUTOSAR4.Parameter(5, SwCalibrationAccess="ReadWrite", StorageClass="Global", MemorySection="CAL", DataType="uint16")  % OTL道路模型目标初选最小存在周期阈值
P_LM_OTLObjSelectDxAssessVx = AUTOSAR4.Parameter([0 2.7 5.775 8.85 11.925 15 40], SwCalibrationAccess="ReadWrite", StorageClass="Global", MemorySection="CAL", DataType="single")
P_LM_OTLObjSelectDxThre = AUTOSAR4.Parameter([120 120 135 150 165 180 180], SwCalibrationAccess="ReadWrite", StorageClass="Global", MemorySection="CAL", DataType="single", Min=45, Max=180)  % OTL道路模型目标初选最小dx阈值

P_LM_OTL_SWSts = AUTOSAR4.Parameter(1, SwCalibrationAccess="ReadWrite", StorageClass="Global", MemorySection="CAL", DataType="uint8")  % 1 OTLOpen
  % 0 OTLOff

LM_OTL_SW_VERSION = AUTOSAR4.Signal(SwCalibrationAccess="ReadOnly", StorageClass="Global", MemorySection="VAR", DataType="uint32")  % OTL软件版本