% Simulink data dictionary PvtParsLM_8_Fusion.sldd

P_LM_FusEVDifC2Thre = AUTOSAR4.Parameter(0.005, SwCalibrationAccess="ReadWrite", StorageClass="Global", MemorySection="CAL", DataType="single", Min=0, Max=1)
P_LM_FusVSLSW = AUTOSAR4.Parameter(1, SwCalibrationAccess="ReadWrite", StorageClass="Global", MemorySection="CAL", DataType="uint8", Min=0, Max=1)  % 融合部分VSL道路模型开关
P_LM_FusOTLSW = AUTOSAR4.Parameter(1, SwCalibrationAccess="ReadWrite", StorageClass="Global", MemorySection="CAL", DataType="uint8", Min=0, Max=1)  % 融合部分OTL道路模型开关
P_LM_FusVSLQuaThre = AUTOSAR4.Parameter(0.1, SwCalibrationAccess="ReadWrite", StorageClass="Global", MemorySection="CAL", DataType="single", Min=0, Max=1)  % 融合部分VSL有效最小质量阈值
P_LM_FusVSLValidVxvThre = AUTOSAR4.Parameter(2, SwCalibrationAccess="ReadWrite", StorageClass="Global", MemorySection="CAL", DataType="single", Min=0, Max=200)  % 融合部分VSL有效车速最小阈值，即小于该值时，VSL无效
P_LM_FusVSLValidSteerWheerAngThre = AUTOSAR4.Parameter(100, SwCalibrationAccess="ReadWrite", StorageClass="Global", MemorySection="CAL", DataType="single", Min=0, Max=360)  % 融合部分VSL有效方向盘转角阈值，即大于该值时,VSL无效
P_LM_FusParC0Index = AUTOSAR4.Parameter(4, SwCalibrationAccess="ReadWrite", StorageClass="Global", MemorySection="CAL", DataType="uint8", Min=1, Max=4)  % 融合部分C0参数索引
P_LM_FusParC1Index = AUTOSAR4.Parameter(3, SwCalibrationAccess="ReadWrite", StorageClass="Global", MemorySection="CAL", DataType="uint8", Min=1, Max=4)  % 融合部分C1参数索引
P_LM_FusParC3Index = AUTOSAR4.Parameter(1, SwCalibrationAccess="ReadWrite", StorageClass="Global", MemorySection="CAL", DataType="uint8", Min=1, Max=4)  % 融合部分C3参数索引
P_LM_FusBLParFiltP = AUTOSAR4.Parameter(0.25, SwCalibrationAccess="ReadWrite", StorageClass="Global", MemorySection="CAL", DataType="single", Min=0, Max=1)  % 融合部分基础车道线滤波系数
P_LM_FusVSLC1Thre = AUTOSAR4.Parameter(0.25, SwCalibrationAccess="ReadWrite", StorageClass="Global", MemorySection="CAL", DataType="single", Min=0, Max=0.3)  % 融合部分VSL有效最大C1阈值
P_LM_FusPath2DisappearDelayCyc = AUTOSAR4.Parameter(10, SwCalibrationAccess="ReadWrite", StorageClass="Global", MemorySection="CAL", DataType="uint8", Min=0, Max=200)  % 融合部分各段轨迹从有到无延迟周期阈值
P_LM_FusPath2appearDelayCyc = AUTOSAR4.Parameter(5, SwCalibrationAccess="ReadWrite", StorageClass="Global", MemorySection="CAL", DataType="uint8", Min=0, Max=200)  % 融合部分各段轨迹从无到有延迟周期阈值
LM_FusBLInfoBefFilt = AUTOSAR4.Signal(SwCalibrationAccess="ReadOnly", StorageClass="Global", MemorySection="VAR")
LM_FusBLInfoFilt = AUTOSAR4.Signal(SwCalibrationAccess="ReadOnly", StorageClass="Global", MemorySection="VAR")
LM_FusVSLValid = AUTOSAR4.Signal(SwCalibrationAccess="ReadOnly", StorageClass="Global", MemorySection="VAR", DataType="boolean")  % 融合部分VSL道路模型有效标志
LM_FusOTLValid = AUTOSAR4.Signal(SwCalibrationAccess="ReadOnly", StorageClass="Global", MemorySection="VAR", DataType="boolean")  % 融合部分OTL道路模型有效标志
LM_FusCase = AUTOSAR4.Signal(SwCalibrationAccess="ReadOnly", StorageClass="Global", MemorySection="VAR", DataType="uint8")  % 道路模型融合类别（0-EML;1-EML&VSL;2-EML&VSL&OTL;3EML&OTL）
LM_FusEVdiffValid = AUTOSAR4.Signal(SwCalibrationAccess="ReadOnly", StorageClass="Global", MemorySection="VAR", DataType="boolean")  % 融合部分EML和VSL道路模型偏差太大标志
LM_C0InfoFilt = AUTOSAR4.Signal(SwCalibrationAccess="ReadOnly", StorageClass="Global", MemorySection="VAR")  % 融合部分滤波后C0信息
LM_C0InfoBefFilt = AUTOSAR4.Signal(SwCalibrationAccess="ReadOnly", StorageClass="Global", MemorySection="VAR")  % 融合部分滤波前C0信息
LM_FusRatioInfo = AUTOSAR4.Signal(SwCalibrationAccess="ReadOnly", StorageClass="Global", MemorySection="VAR")  % 融合部分各模块占比信息