% Simulink data dictionary PvtParsLM_9_OutPort.sldd

P_LM_FusFntDisOffset2P0 = AUTOSAR4.Parameter(10, SwCalibrationAccess="ReadWrite", StorageClass="Global", MemorySection="CAL", DataType="single", Min=0, Max=25)  % 融合部分前方车道线与目标P0 dx补偿值
P_LM_FusFntDisDif2P0 = AUTOSAR4.Parameter(5, SwCalibrationAccess="ReadWrite", StorageClass="Global", MemorySection="CAL", DataType="single", Min=0, Max=10)  % 融合部分插值车道线与目标P0 dx长度阈值
P_LM_FusFntPathOutMinDisY = AUTOSAR4.Parameter([35 40 55 85 100 110 135 145 150 160], SwCalibrationAccess="ReadWrite", StorageClass="Global", MemorySection="CAL", DataType="single")  % 融合部分前方车道线输出最小插值距离
P_LM_FusFntPathOutMinDisX = AUTOSAR4.Parameter([0 4.16 8.2 12.5 20.8 25 29.2 33.3 41.6 55.5], SwCalibrationAccess="ReadWrite", StorageClass="Global", MemorySection="CAL", DataType="single")  % 融合部分前方车道线输出最小插值距离参照速度
LM_FusFntPathMaxDis = AUTOSAR4.Signal(SwCalibrationAccess="ReadOnly", StorageClass="Global", MemorySection="VAR", DataType="single")  % 融合输出前方车道线最大距离
LM_FusFntPathMaxNum = AUTOSAR4.Signal(SwCalibrationAccess="ReadOnly", StorageClass="Global", MemorySection="VAR", DataType="uint8")  % 融合输出前方车道线输出段数
LM_FusFntPathOutMinDis = AUTOSAR4.Signal(SwCalibrationAccess="ReadOnly", StorageClass="Global", MemorySection="VAR", DataType="single")  % 融合输出车道线插值计算最小距离
LM_LINE_LL = AUTOSAR4.Signal(SwCalibrationAccess="ReadOnly", StorageClass="Global", MemorySection="VAR")  % 道路模型输出左左车道线
LM_LINE_LR = AUTOSAR4.Signal(SwCalibrationAccess="ReadOnly", StorageClass="Global", MemorySection="VAR")  % 道路模型输出左右车道线
LM_LINE_RL = AUTOSAR4.Signal(SwCalibrationAccess="ReadOnly", StorageClass="Global", MemorySection="VAR")  % 道路模型输出右左车道线
LM_LINE_RR = AUTOSAR4.Signal(SwCalibrationAccess="ReadOnly", StorageClass="Global", MemorySection="VAR")  % 道路模型输出右右车道线
LM_SpecialRoadType = AUTOSAR4.Signal(SwCalibrationAccess="ReadOnly", StorageClass="Global", MemorySection="VAR", DataType="uint8")  % 道路模型输出特殊道路类型
LM_RoadNumChgType = AUTOSAR4.Signal(SwCalibrationAccess="ReadOnly", StorageClass="Global", MemorySection="VAR", DataType="uint8")  % 道路模型输出车道数量变化情况
LM_DrivInWLType = AUTOSAR4.Signal(SwCalibrationAccess="ReadOnly", StorageClass="Global", MemorySection="VAR", DataType="uint8")  % 道路模型输出自车行驶在哪个车道