% Simulink data dictionary PvtParsLM_Internal_PublicPars.sldd

P_LM_Cyc = AUTOSAR4.Parameter(0.05, SwCalibrationAccess="ReadWrite", StorageClass="Global", MemorySection="CAL", DataType="single")
P_LM_FusParC2Index = AUTOSAR4.Parameter(2, SwCalibrationAccess="ReadWrite", StorageClass="Global", MemorySection="CAL", DataType="uint8", Min=1, Max=4)  % 融合部分C2参数索引
P_LM_LaneWidth = AUTOSAR4.Parameter(3.5, SwCalibrationAccess="ReadWrite", StorageClass="Global", MemorySection="CAL", DataType="single")