% Simulink data dictionary PvtParsLONC.sldd

P_LongCtrl_VxvRefThrd = AUTOSAR4.Parameter(0.1, SwCalibrationAccess="ReadWrite", StorageClass="Global", MemorySection="CAL", DataType="single")  % m/s
P_LongCtrl_VLCjerkSlidHoldYAxis = AUTOSAR4.Parameter(repmat(-1, 1, 7), SwCalibrationAccess="ReadWrite", StorageClass="Global", MemorySection="CAL", DataType="single")  % m/s^3
P_LongCtrl_VLCjerkSlidHoldXAxis = AUTOSAR4.Parameter([0 0.5 1 1.5 2 2.5 3], SwCalibrationAccess="ReadWrite", StorageClass="Global", MemorySection="CAL", DataType="single")  % m/s^2
P_LongCtrl_VLCdriveOffAxUpLimXAxix = AUTOSAR4.Parameter([0 0.5 1 1.5 3], SwCalibrationAccess="ReadWrite", StorageClass="Global", MemorySection="CAL", DataType="single")
P_LongCtrl_VLCaxCtrlDevTresAddDC2EC = AUTOSAR4.Parameter([0.15 0.15 0.12 0.1 0.1], SwCalibrationAccess="ReadWrite", StorageClass="Global", MemorySection="CAL", DataType="single")
P_LongCtrl_VLCAxCtrlDevThresAddEC2DC_Y = AUTOSAR4.Parameter([0.1 0.1 0.15 0.2 0.2], SwCalibrationAccess="ReadWrite", StorageClass="Global", MemorySection="CAL", DataType="single")
P_LongCtrl_VLCaxCtrlDevFastQuitDCMode = AUTOSAR4.Parameter(0.7, SwCalibrationAccess="ReadWrite", StorageClass="Global", MemorySection="CAL", DataType="single")
P_LongCtrl_VLCaXCKiCtrlDevChar_Y = AUTOSAR4.Parameter([1 1 0.9 0.85 0.7 0.6 0.7 0.85 0.9 1 1], SwCalibrationAccess="ReadWrite", StorageClass="Global", MemorySection="CAL", DataType="single")
P_LongCtrl_VLCaccelMinSlidHoldYAxis = AUTOSAR4.Parameter([-1 -1 -1.5 -2 -2.5 -3 -3.5], SwCalibrationAccess="ReadWrite", StorageClass="Global", MemorySection="CAL", DataType="single")  % m/s^2
P_LongCtrl_VLCaccelMinSlidHoldXAxis = AUTOSAR4.Parameter([0 0.5 1 1.5 2 2.5 3], SwCalibrationAccess="ReadWrite", StorageClass="Global", MemorySection="CAL", DataType="single")  % m/s^2
P_LongCtrl_TotWheelTrqRatio = AUTOSAR4.Parameter(1, SwCalibrationAccess="ReadWrite", StorageClass="Global", MemorySection="CAL", DataType="single")
P_LongCtrl_SlopeValueXAxis = AUTOSAR4.Parameter([0.4894 0.9751 1.4537 1.9219 2.3768 2.816 3.2374 3.6396], SwCalibrationAccess="ReadWrite", StorageClass="Global", MemorySection="CAL", DataType="single", Unit="m/s^2")
P_LongCtrl_SlideFlagEnable = AUTOSAR4.Parameter(1, SwCalibrationAccess="ReadWrite", StorageClass="Global", MemorySection="CAL", DataType="boolean")
P_LongCtrl_MinTrqRatioCoff = AUTOSAR4.Parameter(0, SwCalibrationAccess="ReadWrite", StorageClass="Global", MemorySection="CAL", DataType="single", Min=0, Max=1)
P_LongCtrl_KsGainYAxis = AUTOSAR4.Parameter([0.45 0.55 0.85 0.85 0.85 0.85 0.95 0.95], SwCalibrationAccess="ReadWrite", StorageClass="Global", MemorySection="CAL", DataType="single")
P_LongCtrl_communicationTest = AUTOSAR4.Parameter(1, SwCalibrationAccess="ReadWrite", StorageClass="Global", MemorySection="CAL", DataType="boolean")
P_LongCtrl_AxvRoadSlopeThrd = AUTOSAR4.Parameter(0.1, SwCalibrationAccess="ReadWrite", StorageClass="Global", MemorySection="CAL", DataType="single")  % m/s^2
P_LongCtrl_VLC_WindArea = AUTOSAR4.Parameter(2.4, SwCalibrationAccess="ReadWrite", StorageClass="Global", MemorySection="CAL", DataType="single", Unit="m^2")
P_LongCtrl_VLC_fRollCoef = AUTOSAR4.Parameter(0.395, SwCalibrationAccess="ReadWrite", StorageClass="Global", MemorySection="CAL", DataType="single")
P_LongCtrl_HCUTrqReq_min = AUTOSAR4.Parameter(-16384, SwCalibrationAccess="ReadWrite", StorageClass="Global", MemorySection="CAL", DataType="single")
P_LongCtrl_HCUTrqReq_max = AUTOSAR4.Parameter(16383.5, SwCalibrationAccess="ReadWrite", StorageClass="Global", MemorySection="CAL", DataType="single")
P_LongCtrl_HCUTrqReq_factor = AUTOSAR4.Parameter(0.5, SwCalibrationAccess="ReadWrite", StorageClass="Global", MemorySection="CAL", DataType="single")
P_LongCtrl_EngTrqReq_min = AUTOSAR4.Parameter(-100, SwCalibrationAccess="ReadWrite", StorageClass="Global", MemorySection="CAL", DataType="single")
P_LongCtrl_EngTrqReq_max = AUTOSAR4.Parameter(99.999713, SwCalibrationAccess="ReadWrite", StorageClass="Global", MemorySection="CAL", DataType="single")
P_LongCtrl_EngTrqReq_factor = AUTOSAR4.Parameter(0.0030518, SwCalibrationAccess="ReadWrite", StorageClass="Global", MemorySection="CAL", DataType="single")
P_LongCtrl_Decel_ReqValue_min = AUTOSAR4.Parameter(-7, SwCalibrationAccess="ReadWrite", StorageClass="Global", MemorySection="CAL", DataType="single")
P_LongCtrl_Decel_ReqValue_max = AUTOSAR4.Parameter(5.75, SwCalibrationAccess="ReadWrite", StorageClass="Global", MemorySection="CAL", DataType="single")
P_LongCtrl_Decel_ReqValue_factor = AUTOSAR4.Parameter(0.05, SwCalibrationAccess="ReadWrite", StorageClass="Global", MemorySection="CAL", DataType="single")
LongCtrl_WheelTrqReqLP = AUTOSAR4.Signal(SwCalibrationAccess="ReadOnly", StorageClass="Global", MemorySection="VAR")
LongCtrl_VLCState = AUTOSAR4.Signal(SwCalibrationAccess="ReadOnly", StorageClass="Global", MemorySection="VAR")
LongCtrl_VlcInternalAcc = AUTOSAR4.Signal(SwCalibrationAccess="ReadOnly", StorageClass="Global", MemorySection="VAR")
LongCtrl_VLC_IN_vxvRefMs = AUTOSAR4.Signal(SwCalibrationAccess="ReadOnly", StorageClass="Global", MemorySection="VAR")
LongCtrl_VLC_IN_VehStandstill = AUTOSAR4.Signal(SwCalibrationAccess="ReadOnly", StorageClass="Global", MemorySection="VAR")
LongCtrl_VLC_IN_TotWheelTrq = AUTOSAR4.Signal(SwCalibrationAccess="ReadOnly", StorageClass="Global", MemorySection="VAR")
LongCtrl_VLC_IN_RRWheelDriveDirection = AUTOSAR4.Signal(SwCalibrationAccess="ReadOnly", StorageClass="Global", MemorySection="VAR")
LongCtrl_VLC_IN_RLWheelDriveDirection = AUTOSAR4.Signal(SwCalibrationAccess="ReadOnly", StorageClass="Global", MemorySection="VAR")
LongCtrl_VLC_IN_NoBrkForce = AUTOSAR4.Signal(SwCalibrationAccess="ReadOnly", StorageClass="Global", MemorySection="VAR")
LongCtrl_VLC_IN_MinPsblWheelTrq = AUTOSAR4.Signal(SwCalibrationAccess="ReadOnly", StorageClass="Global", MemorySection="VAR")
LongCtrl_VLC_IN_HCU_PTDrvMod = AUTOSAR4.Signal(SwCalibrationAccess="ReadOnly", StorageClass="Global", MemorySection="VAR")
LongCtrl_VLC_IN_FRWheelDriveDirection = AUTOSAR4.Signal(SwCalibrationAccess="ReadOnly", StorageClass="Global", MemorySection="VAR")
LongCtrl_VLC_IN_FLWheelDriveDirection = AUTOSAR4.Signal(SwCalibrationAccess="ReadOnly", StorageClass="Global", MemorySection="VAR")
LongCtrl_VLC_IN_DriveOffConditonFulfilled = AUTOSAR4.Signal(SwCalibrationAccess="ReadOnly", StorageClass="Global", MemorySection="VAR")
LongCtrl_VLC_IN_DecelToStopReq = AUTOSAR4.Signal(SwCalibrationAccess="ReadOnly", StorageClass="Global", MemorySection="VAR")
LongCtrl_VLC_IN_DecelerateJerk = AUTOSAR4.Signal(SwCalibrationAccess="ReadOnly", StorageClass="Global", MemorySection="VAR")
LongCtrl_VLC_IN_DCT_ShiftInProgress = AUTOSAR4.Signal(SwCalibrationAccess="ReadOnly", StorageClass="Global", MemorySection="VAR")
LongCtrl_VLC_IN_ComfortBandUpperValue = AUTOSAR4.Signal(SwCalibrationAccess="ReadOnly", StorageClass="Global", MemorySection="VAR")
LongCtrl_VLC_IN_ComfortBandLowerValue = AUTOSAR4.Signal(SwCalibrationAccess="ReadOnly", StorageClass="Global", MemorySection="VAR")
LongCtrl_VLC_IN_BrakePrefer = AUTOSAR4.Signal(SwCalibrationAccess="ReadOnly", StorageClass="Global", MemorySection="VAR")
LongCtrl_VLC_IN_axvRoadSlopeMs2 = AUTOSAR4.Signal(SwCalibrationAccess="ReadOnly", StorageClass="Global", MemorySection="VAR")
LongCtrl_VLC_IN_axvCvAim = AUTOSAR4.Signal(SwCalibrationAccess="ReadOnly", StorageClass="Global", MemorySection="VAR")
LongCtrl_VLC_IN_axRefMs2 = AUTOSAR4.Signal(SwCalibrationAccess="ReadOnly", StorageClass="Global", MemorySection="VAR")
LongCtrl_VLC_IN_axRefDt = AUTOSAR4.Signal(SwCalibrationAccess="ReadOnly", StorageClass="Global", MemorySection="VAR")
LongCtrl_VLC_IN_alpSideSlipAngle = AUTOSAR4.Signal(SwCalibrationAccess="ReadOnly", StorageClass="Global", MemorySection="VAR")
LongCtrl_VLC_IN_ACU_ShiftInProgress = AUTOSAR4.Signal(SwCalibrationAccess="ReadOnly", StorageClass="Global", MemorySection="VAR")
LongCtrl_VLC_IN_ACCSts = AUTOSAR4.Signal(SwCalibrationAccess="ReadOnly", StorageClass="Global", MemorySection="VAR")
LongCtrl_VLC_IN_AccelerateJerk = AUTOSAR4.Signal(SwCalibrationAccess="ReadOnly", StorageClass="Global", MemorySection="VAR")
LongCtrl_VLC_IN_ACC_DrvOffReq = AUTOSAR4.Signal(SwCalibrationAccess="ReadOnly", StorageClass="Global", MemorySection="VAR")
LongCtrl_UpdateUpperValue = AUTOSAR4.Signal(SwCalibrationAccess="ReadOnly", StorageClass="Global", MemorySection="VAR")
LongCtrl_UpdateLowerValue = AUTOSAR4.Signal(SwCalibrationAccess="ReadOnly", StorageClass="Global", MemorySection="VAR")
LongCtrl_UpdateEnable = AUTOSAR4.Signal(SwCalibrationAccess="ReadOnly", StorageClass="Global", MemorySection="VAR")
LongCtrl_Tr_Ratio = AUTOSAR4.Signal(SwCalibrationAccess="ReadOnly", StorageClass="Global", MemorySection="VAR")
LongCtrl_TorqDelta = AUTOSAR4.Signal(SwCalibrationAccess="ReadOnly", StorageClass="Global", MemorySection="VAR")
LongCtrl_tECDC = AUTOSAR4.Signal(SwCalibrationAccess="ReadOnly", StorageClass="Global", MemorySection="VAR")
LongCtrl_tEC = AUTOSAR4.Signal(SwCalibrationAccess="ReadOnly", StorageClass="Global", MemorySection="VAR")
LongCtrl_Sw2EC5 = AUTOSAR4.Signal(SwCalibrationAccess="ReadOnly", StorageClass="Global", MemorySection="VAR")
LongCtrl_Sw2EC4 = AUTOSAR4.Signal(SwCalibrationAccess="ReadOnly", StorageClass="Global", MemorySection="VAR")
LongCtrl_Sw2EC3 = AUTOSAR4.Signal(SwCalibrationAccess="ReadOnly", StorageClass="Global", MemorySection="VAR")
LongCtrl_Sw2EC2 = AUTOSAR4.Signal(SwCalibrationAccess="ReadOnly", StorageClass="Global", MemorySection="VAR")
LongCtrl_Sw2EC1 = AUTOSAR4.Signal(SwCalibrationAccess="ReadOnly", StorageClass="Global", MemorySection="VAR")
LongCtrl_Sw2EC = AUTOSAR4.Signal(SwCalibrationAccess="ReadOnly", StorageClass="Global", MemorySection="VAR")
LongCtrl_Sw2DC1 = AUTOSAR4.Signal(SwCalibrationAccess="ReadOnly", StorageClass="Global", MemorySection="VAR")
LongCtrl_Sw2DC = AUTOSAR4.Signal(SwCalibrationAccess="ReadOnly", StorageClass="Global", MemorySection="VAR")
LongCtrl_SubModel_VERSION = AUTOSAR4.Signal(SwCalibrationAccess="ReadOnly", StorageClass="Global", MemorySection="VAR")
LongCtrl_SubModel_Number = AUTOSAR4.Signal(SwCalibrationAccess="ReadOnly", StorageClass="Global", MemorySection="VAR")
LongCtrl_SlideFlag = AUTOSAR4.Signal(SwCalibrationAccess="ReadOnly", StorageClass="Global", MemorySection="VAR")
LongCtrl_PI_WheelTrqInc = AUTOSAR4.Signal(SwCalibrationAccess="ReadOnly", StorageClass="Global", MemorySection="VAR")
LongCtrl_PI_WheelTrq = AUTOSAR4.Signal(SwCalibrationAccess="ReadOnly", StorageClass="Global", MemorySection="VAR")
LongCtrl_OverrideToDC = AUTOSAR4.Signal(SwCalibrationAccess="ReadOnly", StorageClass="Global", MemorySection="VAR")
LongCtrl_jerkSlidHold = AUTOSAR4.Signal(SwCalibrationAccess="ReadOnly", StorageClass="Global", MemorySection="VAR")
LongCtrl_jerkHold = AUTOSAR4.Signal(SwCalibrationAccess="ReadOnly", StorageClass="Global", MemorySection="VAR")
LongCtrl_HCUTrqReq = AUTOSAR4.Signal(SwCalibrationAccess="ReadOnly", StorageClass="Global", MemorySection="VAR")
LongCtrl_Fz = AUTOSAR4.Signal(SwCalibrationAccess="ReadOnly", StorageClass="Global", MemorySection="VAR")
LongCtrl_ForwardFlagVxv = AUTOSAR4.Signal(SwCalibrationAccess="ReadOnly", StorageClass="Global", MemorySection="VAR")
LongCtrl_ForwardFlagTrq = AUTOSAR4.Signal(SwCalibrationAccess="ReadOnly", StorageClass="Global", MemorySection="VAR")
LongCtrl_ForwardFlag = AUTOSAR4.Signal(SwCalibrationAccess="ReadOnly", StorageClass="Global", MemorySection="VAR")
LongCtrl_FF_WheelTrqMax = AUTOSAR4.Signal(SwCalibrationAccess="ReadOnly", StorageClass="Global", MemorySection="VAR")
LongCtrl_FF_WheelTrqInc = AUTOSAR4.Signal(SwCalibrationAccess="ReadOnly", StorageClass="Global", MemorySection="VAR")
LongCtrl_FF_WheelTrq = AUTOSAR4.Signal(SwCalibrationAccess="ReadOnly", StorageClass="Global", MemorySection="VAR")
LongCtrl_ECEnable = AUTOSAR4.Signal(SwCalibrationAccess="ReadOnly", StorageClass="Global", MemorySection="VAR")
LongCtrl_Decel_ReqValue = AUTOSAR4.Signal(SwCalibrationAccess="ReadOnly", StorageClass="Global", MemorySection="VAR")
LongCtrl_DCEnable = AUTOSAR4.Signal(SwCalibrationAccess="ReadOnly", StorageClass="Global", MemorySection="VAR")
LongCtrl_Counter = AUTOSAR4.Signal(SwCalibrationAccess="ReadOnly", StorageClass="Global", MemorySection="VAR")
LongCtrl_communicationTest_ACC_FD1_HCU = AUTOSAR4.Signal(SwCalibrationAccess="ReadOnly", StorageClass="Global", MemorySection="VAR")
LongCtrl_communicationTest_ACC_FD1_ECMESP = AUTOSAR4.Signal(SwCalibrationAccess="ReadOnly", StorageClass="Global", MemorySection="VAR")
LongCtrl_axvTracMin = AUTOSAR4.Signal(SwCalibrationAccess="ReadOnly", StorageClass="Global", MemorySection="VAR")
LongCtrl_axvTracActMean = AUTOSAR4.Signal(SwCalibrationAccess="ReadOnly", StorageClass="Global", MemorySection="VAR")
LongCtrl_axvModelResidual = AUTOSAR4.Signal(SwCalibrationAccess="ReadOnly", StorageClass="Global", MemorySection="VAR")
LongCtrl_axvModelRef = AUTOSAR4.Signal(SwCalibrationAccess="ReadOnly", StorageClass="Global", MemorySection="VAR")
LongCtrl_axvModelDiff = AUTOSAR4.Signal(SwCalibrationAccess="ReadOnly", StorageClass="Global", MemorySection="VAR")
LongCtrl_axvDiff = AUTOSAR4.Signal(SwCalibrationAccess="ReadOnly", StorageClass="Global", MemorySection="VAR")
LongCtrl_axvClosedLoopControl = AUTOSAR4.Signal(SwCalibrationAccess="ReadOnly", StorageClass="Global", MemorySection="VAR")
LongCtrl_accelSlidHold = AUTOSAR4.Signal(SwCalibrationAccess="ReadOnly", StorageClass="Global", MemorySection="VAR")
LongCtrl_accelHoldMin = AUTOSAR4.Signal(SwCalibrationAccess="ReadOnly", StorageClass="Global", MemorySection="VAR")
P_LongCtrl_VLCaxCtrlDevDeadZoneChar_Y = AUTOSAR4.Parameter([0.015 0.075 0.1 0.15 0.2], SwCalibrationAccess="ReadWrite", StorageClass="Global", MemorySection="CAL", DataType="single")
P_LongCtrl_VLCkp = AUTOSAR4.Parameter(1.5, SwCalibrationAccess="ReadWrite", StorageClass="Global", MemorySection="CAL", DataType="single")
P_LongCtrl_VLCaXCDeadZoneProp_Y = AUTOSAR4.Parameter([1 0 0 0 0 0 1], SwCalibrationAccess="ReadWrite", StorageClass="Global", MemorySection="CAL", DataType="single")
P_LongCtrl_VLCki = AUTOSAR4.Parameter(0.8, SwCalibrationAccess="ReadWrite", StorageClass="Global", MemorySection="CAL", DataType="single")
P_LongCtrl_VLCks = AUTOSAR4.Parameter(0.8, SwCalibrationAccess="ReadWrite", StorageClass="Global", MemorySection="CAL", DataType="single")
P_LongCtrl_VLCdriveOffAxUpLimYAxix = AUTOSAR4.Parameter([1.6 1.6 1.6 1.8 2], SwCalibrationAccess="ReadWrite", StorageClass="Global", MemorySection="CAL", DataType="single")
LongCtrl_VLC_IN_IP_VehSpdDisp = AUTOSAR4.Signal(SwCalibrationAccess="ReadOnly", StorageClass="Global", MemorySection="VAR")
P_VLCdFxLimNegX = AUTOSAR4.Parameter([0 10 20 30 40 50 60 70], SwCalibrationAccess="ReadWrite", StorageClass="Global", MemorySection="CAL", DataType="single")
P_VLCdFxLimNegY = AUTOSAR4.Parameter(repmat(900, 1, 8), SwCalibrationAccess="ReadWrite", StorageClass="Global", MemorySection="CAL", DataType="single")
P_VLCdFxLimPosX = AUTOSAR4.Parameter([0 10 20 30 40 50 60 70], SwCalibrationAccess="ReadWrite", StorageClass="Global", MemorySection="CAL", DataType="single")
P_VLCdFxLimPosY = AUTOSAR4.Parameter(repmat(900, 1, 8), SwCalibrationAccess="ReadWrite", StorageClass="Global", MemorySection="CAL", DataType="single")