% Simulink data dictionary PvtParsNVM.sldd

CAL_VehConfigHWA = Simulink.Parameter(1, DataType="uint8")
CAL_VehConfigTJA = Simulink.Parameter(1, DataType="uint8")
CAL_VehConfigLCK = Simulink.Parameter(1, DataType="uint8")
CAL_VehConfigELK = Simulink.Parameter(1, DataType="uint8")
CAL_VehConfigACC = Simulink.Parameter(1, DataType="uint8")
CAL_VehConfigESS = Simulink.Parameter(1, DataType="uint8")
CAL_VehConfigCC = Simulink.Parameter(1, DataType="uint8")
CAL_VehicleConfigFCW = Simulink.Parameter(1, DataType="uint8")
CAL_VehicleConfigAEB = Simulink.Parameter(1, DataType="uint8")
CAL_VehicleConfigAEBPed = Simulink.Parameter(1, DataType="uint8")
CAL_VehicleConfigAEBCyc = Simulink.Parameter(1, DataType="uint8")
CAL_VehConfigAEBJA = Simulink.Parameter(1, DataType="uint8")
CAL_NvMReadWrite = Simulink.Parameter(1, DataType="uint8")
CAL_VehConfigHMA_laser = Simulink.Parameter(1, DataType="uint8")
CAL_VehConfigHMA = Simulink.Parameter(1, DataType="uint8")
CAL_VehConfigADB = Simulink.Parameter(1, DataType="uint8")
CAL_VehConfigLKA = Simulink.Parameter(1, DataType="uint8")
CAL_VehConfigLDW = Simulink.Parameter(1, DataType="uint8")
CAL_VehConfigLCKIE = Simulink.Parameter(1, DataType="uint8")
CAL_VehConfigiACC = Simulink.Parameter(1, DataType="uint8")
CAL_VehConfigTSR = Simulink.Parameter(1, DataType="uint8")
CAL_VehConfigAES = Simulink.Parameter(1, DataType="uint8")
CAL_PPort_NV_NetworkCfg_F1B1 = AUTOSAR4.Signal(SwCalibrationAccess="ReadOnly", StorageClass="Global", MemorySection="VAR", DataType="uint8", Dimensions=31)
CAL_CAL_NetWorkCfg = AUTOSAR4.Signal(SwCalibrationAccess="ReadOnly", StorageClass="Global", MemorySection="VAR")
CAL_VehConfigIbooster = Simulink.Parameter(1, DataType="uint8")
CAL_VehConfigNOH = Simulink.Parameter(1, DataType="uint8")
CAL_VehConfigHWP = Simulink.Parameter(1, DataType="uint8")
CAL_CAL_VSM_CONFIG = AUTOSAR4.Signal(SwCalibrationAccess="ReadOnly", StorageClass="Global", MemorySection="VAR")
CAL_CAL_AEB_CONFIG = AUTOSAR4.Signal(SwCalibrationAccess="ReadOnly", StorageClass="Global", MemorySection="VAR")
CAL_CAL_AHBC_CONFIG = AUTOSAR4.Signal(SwCalibrationAccess="ReadOnly", StorageClass="Global", MemorySection="VAR")
P_CAL_SWT = AUTOSAR4.Parameter(1, SwCalibrationAccess="ReadWrite", StorageClass="Global", MemorySection="CAL", DataType="uint8")