% Simulink data dictionary PvtParsPLAN.sldd

P_PLAN_ALC_vMinPreLC_OverTk = AUTOSAR4.Parameter(56, SwCalibrationAccess="ReadWrite", StorageClass="Global", MemorySection="CAL", DataType="single")
P_PLAN_ALC_LCDeltaTmeGap = AUTOSAR4.Parameter(4, SwCalibrationAccess="ReadWrite", StorageClass="Global", MemorySection="CAL", DataType="single")  % 超车换道不减速，提前时间
P_PLAN_ALC_LciOverTkDeltaSpdLv3 = AUTOSAR4.Parameter(10, SwCalibrationAccess="ReadWrite", StorageClass="Global", MemorySection="CAL", DataType="single")  % 超车换道，前车与本车SetSpd最小差值
P_PLAN_ALC_LciOverTkSpdSupTimeLv1 = AUTOSAR4.Parameter(10, SwCalibrationAccess="ReadWrite", StorageClass="Global", MemorySection="CAL", DataType="single")
P_PLAN_ALC_LciOverTkSpdSupTimeLv3 = AUTOSAR4.Parameter(3, SwCalibrationAccess="ReadWrite", StorageClass="Global", MemorySection="CAL", DataType="single")
P_PLAN_ALC_LciOverTkSpdSupTimeLv2 = AUTOSAR4.Parameter(5, SwCalibrationAccess="ReadWrite", StorageClass="Global", MemorySection="CAL", DataType="single")
P_PLAN_ALC_LciOverTkDeltaSpdLv1 = AUTOSAR4.Parameter(20, SwCalibrationAccess="ReadWrite", StorageClass="Global", MemorySection="CAL", DataType="single")  % 超车换道，前车与本车SetSpd最小差值
P_PLAN_ALC_LciOverTkDeltaSpdLv2 = AUTOSAR4.Parameter(15, SwCalibrationAccess="ReadWrite", StorageClass="Global", MemorySection="CAL", DataType="single")  % 超车换道，前车与本车SetSpd最小差值
P_PLAN_ALC_LcOverTkDPCthreshold = AUTOSAR4.Parameter(0.3, SwCalibrationAccess="ReadWrite", StorageClass="Global", MemorySection="CAL", DataType="single")
P_PLAN_ALC_LciDrvExistDefaultDisp = AUTOSAR4.Parameter(0, SwCalibrationAccess="ReadWrite", StorageClass="Global", MemorySection="CAL", DataType="uint8")
P_PLAN_ALC_LcFinishDyDiffRwFactorForHMI = AUTOSAR4.Parameter(0.57, SwCalibrationAccess="ReadWrite", StorageClass="Global", MemorySection="CAL", DataType="single")
P_PLAN_ALC_tTimeLC = AUTOSAR4.Parameter(4, SwCalibrationAccess="ReadWrite", StorageClass="Global", MemorySection="CAL", DataType="single")
P_PLAN_ALC_DPCConfirmTime = AUTOSAR4.Parameter(2, SwCalibrationAccess="ReadWrite", StorageClass="Global", MemorySection="CAL", DataType="single")
P_PLAN_ALC_LcDrvHMILineValidFtime = AUTOSAR4.Parameter(2, SwCalibrationAccess="ReadWrite", StorageClass="Global", MemorySection="CAL", DataType="single")
P_PLAN_ALC_DPCConfirmTimeHMI = AUTOSAR4.Parameter(0.5, SwCalibrationAccess="ReadWrite", StorageClass="Global", MemorySection="CAL", DataType="single")
P_PLAN_ALC_LcCancelLaneChangeReqDspTimeCnt = AUTOSAR4.Parameter(200, SwCalibrationAccess="ReadWrite", StorageClass="Global", MemorySection="CAL", DataType="uint16")
P_PLAN_ALC_LcOverTkCancelDy_factor = AUTOSAR4.Parameter(0.95, SwCalibrationAccess="ReadWrite", StorageClass="Global", MemorySection="CAL", DataType="single")
P_PLAN_ALC_LcDelayCntSetOverTk = AUTOSAR4.Parameter(75, SwCalibrationAccess="ReadWrite", StorageClass="Global", MemorySection="CAL", DataType="uint8")
P_PLAN_ALC_vMinPreLC_Noh = AUTOSAR4.Parameter(15, SwCalibrationAccess="ReadWrite", StorageClass="Global", MemorySection="CAL", DataType="single")
P_PLAN_ALC_DPCConfimrTimeTableLcMrc = AUTOSAR4.Parameter([0 0 2 6 15], SwCalibrationAccess="ReadWrite", StorageClass="Global", MemorySection="CAL", DataType="single")
P_PLAN_ALC_LcFinishDyDiffRwFactorForAP = AUTOSAR4.Parameter(0.4, SwCalibrationAccess="ReadWrite", StorageClass="Global", MemorySection="CAL", DataType="single")
P_PLAN_ALC_NOHTurnSts = AUTOSAR4.Parameter(0, SwCalibrationAccess="ReadWrite", StorageClass="Global", MemorySection="CAL", DataType="uint8")
P_PLAN_ALC_LcOverTkManualTrigger = AUTOSAR4.Parameter(0, SwCalibrationAccess="ReadWrite", StorageClass="Global", MemorySection="CAL", DataType="uint8")
P_PLAN_ALC_LcDrv_DyDiffThreshold = AUTOSAR4.Parameter(1.2, SwCalibrationAccess="ReadWrite", StorageClass="Global", MemorySection="CAL", DataType="single")
P_PLAN_ALC_DPCConfirmTimeOverTk = AUTOSAR4.Parameter(4, SwCalibrationAccess="ReadWrite", StorageClass="Global", MemorySection="CAL", DataType="single")
P_PLAN_ALC_NOHLcSwt = AUTOSAR4.Parameter(1, SwCalibrationAccess="ReadWrite", StorageClass="Global", MemorySection="CAL", DataType="uint8")
P_PLAN_ALC_vMinPreLC_Drv = AUTOSAR4.Parameter(40, SwCalibrationAccess="ReadWrite", StorageClass="Global", MemorySection="CAL", DataType="uint8")  % 换道请求时的最低速度阈值
P_PLAN_ALC_DPCConfimrTimeTable = AUTOSAR4.Parameter([0 0 2 3 4], SwCalibrationAccess="ReadWrite", StorageClass="Global", MemorySection="CAL", DataType="single")
P_PLAN_ALC_LcDelayCntSetNoh = AUTOSAR4.Parameter(0, SwCalibrationAccess="ReadWrite", StorageClass="Global", MemorySection="CAL", DataType="uint8")
P_PLAN_ALC_NotTouchLineCancelRWFactor = AUTOSAR4.Parameter([0.91 0.91 0.91], SwCalibrationAccess="ReadWrite", StorageClass="Global", MemorySection="CAL", DataType="single")
P_PLAN_ALC_PreNotTouchLineCancelRWFactor = AUTOSAR4.Parameter([0.92 0.92 0.92], SwCalibrationAccess="ReadWrite", StorageClass="Global", MemorySection="CAL", DataType="single")
P_PLAN_ALC_TurnLmpType = AUTOSAR4.Parameter(0, SwCalibrationAccess="ReadWrite", StorageClass="Global", MemorySection="CAL", DataType="uint8")
P_PLAN_ALC_DPCExtraMultiFrameConfirmCntNoh = AUTOSAR4.Parameter(0, SwCalibrationAccess="ReadWrite", StorageClass="Global", MemorySection="CAL", DataType="uint8")
P_PLAN_ALC_FWheelPreTime = AUTOSAR4.Parameter(0.6, SwCalibrationAccess="ReadWrite", StorageClass="Global", MemorySection="CAL", DataType="single")
P_PLAN_ALC_LcCancelRoadWidthOffsetForDPC = AUTOSAR4.Parameter(0, SwCalibrationAccess="ReadWrite", StorageClass="Global", MemorySection="CAL", DataType="single")
P_PLAN_ALC_LcCancelRoadWidthOffset = AUTOSAR4.Parameter(0, SwCalibrationAccess="ReadWrite", StorageClass="Global", MemorySection="CAL", DataType="single")
P_PLAN_LcCancelTestEnable = AUTOSAR4.Parameter(0, SwCalibrationAccess="ReadWrite", StorageClass="Global", MemorySection="CAL", DataType="boolean")
P_PLAN_ALC_DPCthresholdLcDrvLv1 = AUTOSAR4.Parameter(0, SwCalibrationAccess="ReadWrite", StorageClass="Global", MemorySection="CAL", DataType="single")
P_PLAN_ALC_DPCthresholdLcDrvLv2 = AUTOSAR4.Parameter(0.1, SwCalibrationAccess="ReadWrite", StorageClass="Global", MemorySection="CAL", DataType="single")
P_PLAN_ALC_DPCthresholdLcDrvLv3 = AUTOSAR4.Parameter(0.15, SwCalibrationAccess="ReadWrite", StorageClass="Global", MemorySection="CAL", DataType="single")
P_PLAN_ALC_DynamicDPCthreshold = AUTOSAR4.Parameter(0.15, SwCalibrationAccess="ReadWrite", StorageClass="Global", MemorySection="CAL", DataType="single")
P_PLAN_ALC_LcCancelDPCThreshold = AUTOSAR4.Parameter(0.8, SwCalibrationAccess="ReadWrite", StorageClass="Global", MemorySection="CAL", DataType="single")
P_PLAN_ALC_DPCExtraMultiFrameConfirmCntOverTk = AUTOSAR4.Parameter(100, SwCalibrationAccess="ReadWrite", StorageClass="Global", MemorySection="CAL", DataType="uint8")
P_PLAN_ALC_DPCExtraMultiFrameConfirmCntDrv = AUTOSAR4.Parameter(50, SwCalibrationAccess="ReadWrite", StorageClass="Global", MemorySection="CAL", DataType="uint8")
P_PLAN_ALC_LcOverTkTrafficSignSwitch = AUTOSAR4.Parameter(1, SwCalibrationAccess="ReadWrite", StorageClass="Global", MemorySection="CAL", DataType="boolean")
P_PLAN_ALC_LcOverTkTrafficSignDis = AUTOSAR4.Parameter(200, SwCalibrationAccess="ReadWrite", StorageClass="Global", MemorySection="CAL", DataType="uint16")
P_PLAN_ALC_LcHMISwt = AUTOSAR4.Parameter(0, SwCalibrationAccess="ReadWrite", StorageClass="Global", MemorySection="CAL", DataType="boolean")
P_PLAN_ALC_TurnLampOnNotCloseTime = AUTOSAR4.Parameter(400, SwCalibrationAccess="ReadWrite", StorageClass="Global", MemorySection="CAL", DataType="uint16")
P_PLAN_ALC_LcCurvatureInhibitionValueBrkPoints = AUTOSAR4.Parameter([10 20 30 40 50 60 70 80 90 100 110 120 130 140], SwCalibrationAccess="ReadWrite", StorageClass="Global", MemorySection="CAL", DataType="single")
P_PLAN_ALC_LcCurvatureInhibitionValueTable = AUTOSAR4.Parameter([0.1817 0.0393 0.0167 0.0092 0.0058 0.004 0.0029 0.0022 0.0017 0.0014 0.0012 0.001 0.0008 0.0007], SwCalibrationAccess="ReadWrite", StorageClass="Global", MemorySection="CAL", DataType="single")
P_PLAN_ALC_LcFinishDyDiffBrkPoint = AUTOSAR4.Parameter([10 80 100 120], SwCalibrationAccess="ReadWrite", StorageClass="Global", MemorySection="CAL", DataType="single")
P_PLAN_ALC_LcMinVehSpd_OFF = AUTOSAR4.Parameter(39.5, SwCalibrationAccess="ReadWrite", StorageClass="Global", MemorySection="CAL", DataType="single")
P_PLAN_ALC_LcMinVehSpd_ON = AUTOSAR4.Parameter(40, SwCalibrationAccess="ReadWrite", StorageClass="Global", MemorySection="CAL", DataType="single")
P_PLAN_ALC_PreCurvatureFactor = AUTOSAR4.Parameter(1, SwCalibrationAccess="ReadWrite", StorageClass="Global", MemorySection="CAL", DataType="single")
P_PLAN_ALC_PreCurvaturePreTime = AUTOSAR4.Parameter(3, SwCalibrationAccess="ReadWrite", StorageClass="Global", MemorySection="CAL", DataType="single")
P_PLAN_ALC_LcOverTkManualTriggerTimeCnt = AUTOSAR4.Parameter(50, SwCalibrationAccess="ReadWrite", StorageClass="Global", MemorySection="CAL", DataType="uint16")
P_PLAN_ALC_LcFinishDyDiffTableValue = AUTOSAR4.Parameter([0.2 0.2 0.2 0.2], SwCalibrationAccess="ReadWrite", StorageClass="Global", MemorySection="CAL", DataType="single")
P_PLAN_ALC_LcOverTkRearVehTTClimit = AUTOSAR4.Parameter(10, SwCalibrationAccess="ReadWrite", StorageClass="Global", MemorySection="CAL", DataType="single")
P_PLAN_ALC_LcCurvatureInhibitionValueFactor = AUTOSAR4.Parameter(0.5, SwCalibrationAccess="ReadWrite", StorageClass="Global", MemorySection="CAL", DataType="single")
P_PLAN_ALC_vMaxPreLC_Drv = AUTOSAR4.Parameter(125, SwCalibrationAccess="ReadWrite", StorageClass="Global", MemorySection="CAL", DataType="uint8")
P_PLAN_ALC_LampOverTime = AUTOSAR4.Parameter(515, SwCalibrationAccess="ReadWrite", StorageClass="Global", MemorySection="CAL", DataType="uint16")  % 515
P_PLAN_ALC_vMaxPreLC_OverTk = AUTOSAR4.Parameter(120, SwCalibrationAccess="ReadWrite", StorageClass="Global", MemorySection="CAL", DataType="uint8")
P_PLAN_ALC_LcDelayCntSetDrv = AUTOSAR4.Parameter(0, SwCalibrationAccess="ReadWrite", StorageClass="Global", MemorySection="CAL", DataType="uint8")
P_PLAN_ALC_TurnLmpDelayCnt = AUTOSAR4.Parameter(1, SwCalibrationAccess="ReadWrite", StorageClass="Global", MemorySection="CAL", DataType="uint8")
P_PLAN_ALC_OverTkCutOutPreTime = AUTOSAR4.Parameter(1, SwCalibrationAccess="ReadWrite", StorageClass="Global", MemorySection="CAL", DataType="single")
P_PLAN_ALC_LampShortTime = AUTOSAR4.Parameter(15, SwCalibrationAccess="ReadWrite", StorageClass="Global", MemorySection="CAL", DataType="uint8")
P_PLAN_ALC_LcEnterLane_factor = AUTOSAR4.Parameter(0.55, SwCalibrationAccess="ReadWrite", StorageClass="Global", MemorySection="CAL", DataType="single")
P_PLAN_ALC_OveTkrSupDist = AUTOSAR4.Parameter(1000, SwCalibrationAccess="ReadWrite", StorageClass="Global", MemorySection="CAL", DataType="single")
P_PLAN_ALC_LcTouchLane_factor = AUTOSAR4.Parameter(0.91, SwCalibrationAccess="ReadWrite", StorageClass="Global", MemorySection="CAL", DataType="single")
P_PLAN_ALC_OverTkCutOutDyRWFactor = AUTOSAR4.Parameter(0.25, SwCalibrationAccess="ReadWrite", StorageClass="Global", MemorySection="CAL", DataType="single")
P_PLAN_DPC_HWALineRearA3Factor = AUTOSAR4.Parameter(0.1, SwCalibrationAccess="ReadWrite", StorageClass="Global", MemorySection="CAL", DataType="single")
P_PLAN_DPC_HWALineRearA2Factor = AUTOSAR4.Parameter(0.25, SwCalibrationAccess="ReadWrite", StorageClass="Global", MemorySection="CAL", DataType="single")
P_PLAN_DPC_MaxObjNum = AUTOSAR4.Parameter(11, SwCalibrationAccess="ReadWrite", StorageClass="Global", MemorySection="CAL", DataType="uint8", Min=1, Max=32)
P_PLAN_DPC_SafeDistBrkPoints = AUTOSAR4.Parameter([0 20 30 40 60 80 100 120], SwCalibrationAccess="ReadWrite", StorageClass="Global", MemorySection="CAL", DataType="single")
P_PLAN_DPC_PreEgoAccFactor = AUTOSAR4.Parameter(0.5, SwCalibrationAccess="ReadWrite", StorageClass="Global", MemorySection="CAL", DataType="single")
P_PLAN_DPC_BrkPointTTCFactor4 = AUTOSAR4.Parameter(15, SwCalibrationAccess="ReadWrite", StorageClass="Global", MemorySection="CAL", DataType="single")
P_PLAN_DPC_BrkPointTTCFactor3 = AUTOSAR4.Parameter(10, SwCalibrationAccess="ReadWrite", StorageClass="Global", MemorySection="CAL", DataType="single")
P_PLAN_DPC_SafeDistValue = AUTOSAR4.Parameter([5 7 9 10 10 13 16 18], SwCalibrationAccess="ReadWrite", StorageClass="Global", MemorySection="CAL", DataType="single")
P_PLAN_DPC_BrkPointDxFactorF1 = AUTOSAR4.Parameter(0.4, SwCalibrationAccess="ReadWrite", StorageClass="Global", MemorySection="CAL", DataType="single", Min=0, Max=50)
P_PLAN_DPC_BrkPointDxFactorF2 = AUTOSAR4.Parameter(0.8, SwCalibrationAccess="ReadWrite", StorageClass="Global", MemorySection="CAL", DataType="single", Min=0, Max=50)
P_PLAN_DPC_BrkPointDxFactorF3 = AUTOSAR4.Parameter(1.2, SwCalibrationAccess="ReadWrite", StorageClass="Global", MemorySection="CAL", DataType="single", Min=0, Max=50)
P_PLAN_DPC_BrkPointDxFactorF4 = AUTOSAR4.Parameter(1.6, SwCalibrationAccess="ReadWrite", StorageClass="Global", MemorySection="CAL", DataType="single", Min=0, Max=50)
P_PLAN_DPC_BrkPointDxFactorR1 = AUTOSAR4.Parameter(-0.5, SwCalibrationAccess="ReadWrite", StorageClass="Global", MemorySection="CAL", DataType="single", Min=-50, Max=0)
P_PLAN_DPC_BrkPointDxFactorR2 = AUTOSAR4.Parameter(-1, SwCalibrationAccess="ReadWrite", StorageClass="Global", MemorySection="CAL", DataType="single", Min=-50, Max=0)
P_PLAN_DPC_BrkPointDxFactorR3 = AUTOSAR4.Parameter(-1.6, SwCalibrationAccess="ReadWrite", StorageClass="Global", MemorySection="CAL", DataType="single", Min=-50, Max=0)
P_PLAN_DPC_BrkPointDxFactorR4 = AUTOSAR4.Parameter(-2.2, SwCalibrationAccess="ReadWrite", StorageClass="Global", MemorySection="CAL", DataType="single", Min=-50, Max=0)
P_PLAN_DPC_BrkPointTTCFactor1 = AUTOSAR4.Parameter(3, SwCalibrationAccess="ReadWrite", StorageClass="Global", MemorySection="CAL", DataType="single")
P_PLAN_DPC_BrkPointTTCFactor2 = AUTOSAR4.Parameter(6, SwCalibrationAccess="ReadWrite", StorageClass="Global", MemorySection="CAL", DataType="single")
P_PLAN_DPC_ObjVxLPalpha = AUTOSAR4.Parameter(0.1, SwCalibrationAccess="ReadWrite", StorageClass="Global", MemorySection="CAL", DataType="single")
P_PLAN_DPC_ObjDyLPalpha = AUTOSAR4.Parameter(0.1, SwCalibrationAccess="ReadWrite", StorageClass="Global", MemorySection="CAL", DataType="single")
P_PLAN_DPC_SafeTG = AUTOSAR4.Parameter(1, SwCalibrationAccess="ReadWrite", StorageClass="Global", MemorySection="CAL", DataType="single")
P_PLAN_DPCswt = AUTOSAR4.Parameter(0, SwCalibrationAccess="ReadWrite", StorageClass="Global", MemorySection="CAL", DataType="boolean")
P_PLAN_DPC_CriticalTG = AUTOSAR4.Parameter(1, SwCalibrationAccess="ReadWrite", StorageClass="Global", MemorySection="CAL", DataType="single")
P_PLAN_DPC_ObjDxLPalpha = AUTOSAR4.Parameter(1, SwCalibrationAccess="ReadWrite", StorageClass="Global", MemorySection="CAL", DataType="single")
P_PLAN_DPC_SafeAccR = AUTOSAR4.Parameter(0.15, SwCalibrationAccess="ReadWrite", StorageClass="Global", MemorySection="CAL", DataType="single")
P_PLAN_DPC_ObjAxLPalpha = AUTOSAR4.Parameter(0.05, SwCalibrationAccess="ReadWrite", StorageClass="Global", MemorySection="CAL", DataType="single")
P_PLAN_DPC_CriticalAccF = AUTOSAR4.Parameter(4, SwCalibrationAccess="ReadWrite", StorageClass="Global", MemorySection="CAL", DataType="single")
P_PLAN_DPC_CriticalAccR = AUTOSAR4.Parameter(2, SwCalibrationAccess="ReadWrite", StorageClass="Global", MemorySection="CAL", DataType="single")
P_PLAN_DPC_SafeAccF = AUTOSAR4.Parameter(0.3, SwCalibrationAccess="ReadWrite", StorageClass="Global", MemorySection="CAL", DataType="single")
P_PLAN_DPC_xiangduisudu_kmh = AUTOSAR4.Parameter([-49.5 -33 -18 -16.5 -7 -6 -2.5 -2 -1.5 -0.5 0 0.5 1.5 4 4.5 5 5.5 7 9.5 10 12.5 18.5 30 50], SwCalibrationAccess="ReadWrite", StorageClass="Global", MemorySection="CAL", DataType="single")
P_PLAN_DPC_danqianleida_minDx = AUTOSAR4.Parameter(10, SwCalibrationAccess="ReadWrite", StorageClass="Global", MemorySection="CAL", DataType="single")
P_PLAN_DPC_danqianleida_maxDx = AUTOSAR4.Parameter(60, SwCalibrationAccess="ReadWrite", StorageClass="Global", MemorySection="CAL", DataType="single")
P_PLAN_DPC_danqianleida_kaiguan = AUTOSAR4.Parameter(1, SwCalibrationAccess="ReadWrite", StorageClass="Global", MemorySection="CAL", DataType="boolean")
P_PLAN_DPC_HearObj_DX_11 = AUTOSAR4.Parameter([-2 -2 -2 -2 -2 -2 -2 -2 -2 -2 -2 -2 -2 -3.2 -3.6 -4.2 -4.8 -6.4 -9.2 -9.8 -12.6 -19.2 -30 -30], SwCalibrationAccess="ReadWrite", StorageClass="Global", MemorySection="CAL", DataType="single")
P_PLAN_DPC_HearObj_DX_08 = AUTOSAR4.Parameter([-5 -5 -5 -5 -5 -5 -5 -5 -5 -5 -5 -5 -5 -5.2 -5.6 -6.2 -6.8 -8.4 -11.8 -12.4 -16 -24.2 -38 -60], SwCalibrationAccess="ReadWrite", StorageClass="Global", MemorySection="CAL", DataType="single")
P_PLAN_DPC_HearObj_DX_03 = AUTOSAR4.Parameter([-7 -7 -7 -7 -7 -7 -8.1 -9 -9.4 -10.2 -10.8 -11.2 -12.4 -15.2 -15.6 -16.2 -16.8 -19.4 -24.2 -25.6 -30.4 -48.5 -86.4 -140], SwCalibrationAccess="ReadWrite", StorageClass="Global", MemorySection="CAL", DataType="single")
P_PLAN_DPC_HearObj_DX_00 = AUTOSAR4.Parameter([-13 -13 -13 -13 -13 -14 -15.6 -16.2 -16.8 -17.8 -18.4 -19 -20 -22.8 -23.4 -24 -24.6 -28.2 -38.2 -40.2 -47.3 -68 -100 -160], SwCalibrationAccess="ReadWrite", StorageClass="Global", MemorySection="CAL", DataType="single")
P_PLAN_DPC_FrontObj_DX_1 = AUTOSAR4.Parameter([68 46 26.2 24.4 14 12.8 9 8.4 7.8 6.6 6.2 5.6 5.6 5.6 5.6 5.6 5.6 5.6 5.6 5.6 5.6 5.6 5.6 5.6], SwCalibrationAccess="ReadWrite", StorageClass="Global", MemorySection="CAL", DataType="single")
P_PLAN_DPC_FrontObj_DX_08 = AUTOSAR4.Parameter([82 58 31.2 29.2 16 14.8 11 10.4 9.8 8.6 8.2 7.6 7.6 7.6 7.6 7.6 7.6 7.6 7.6 7.6 7.6 7.6 7.6 7.6], SwCalibrationAccess="ReadWrite", StorageClass="Global", MemorySection="CAL", DataType="single")
P_PLAN_DPC_FrontObj_DX_03 = AUTOSAR4.Parameter([160 112 64 60 30.4 28.6 23 21.8 20.5 18.2 16.9 15.6 14.6 13 12.8 12.4 12.2 11.8 11.2 11 10.6 9.2 9.2 9.2], SwCalibrationAccess="ReadWrite", StorageClass="Global", MemorySection="CAL", DataType="single")
P_PLAN_DPC_FrontObj_DX_00 = AUTOSAR4.Parameter([215 150 89 82 36.4 32.4 25.8 23.2 22.6 21.6 21 20.4 19.2 16.6 16 15.4 15.2 14.4 13.2 13.2 12.4 11.2 11.2 11.2], SwCalibrationAccess="ReadWrite", StorageClass="Global", MemorySection="CAL", DataType="single")
P_LongCtrl_ALCAccLimitByDangerXAxis = AUTOSAR4.Parameter([0 0.3 0.5 0.6 0.8], SwCalibrationAccess="ReadWrite", StorageClass="Global", MemorySection="CAL", DataType="single", Min=0, Max=1)
P_LongCtrl_ALCAccLimitByDangerYAxis = AUTOSAR4.Parameter([-2.5 -0.2 0 0 0], SwCalibrationAccess="ReadWrite", StorageClass="Global", MemorySection="CAL", DataType="single", Min=-10, Max=10)
P_LongCtrl_ALIsLaneChangeEnable = AUTOSAR4.Parameter(0, SwCalibrationAccess="ReadWrite", StorageClass="Global", MemorySection="CAL", DataType="boolean")
P_LongCtrl_ALaLowerChar = AUTOSAR4.Parameter([-5 -5 -3.5 -3.5], SwCalibrationAccess="ReadWrite", StorageClass="Global", MemorySection="CAL", DataType="single", Unit="m/s^2")
P_LongCtrl_ALaUpperCharAWD = AUTOSAR4.Parameter([1.489 1.399 1.309 1.264 1.218 1.083 0.993 0.903 0.767 0.679 0.632 0.55 0.45 0.35 0.3], SwCalibrationAccess="ReadWrite", StorageClass="Global", MemorySection="CAL", DataType="single", Min=0, Max=3, Unit="m/s^2")
P_LongCtrl_ALaUpperCharEV = AUTOSAR4.Parameter([1.35 1.25 1.1 1.05 1 0.95 0.85 0.7 0.6 0.55 0.5 0.45 0.35 0.3 0.3], SwCalibrationAccess="ReadWrite", StorageClass="Global", MemorySection="CAL", DataType="single", Min=0, Max=3, Unit="m/s^2")
P_LongCtrl_ALaUpperCharEco = AUTOSAR4.Parameter([1.35 1.25 1.1 1.05 1 0.95 0.85 0.7 0.6 0.55 0.5 0.45 0.35 0.3 0.3], SwCalibrationAccess="ReadWrite", StorageClass="Global", MemorySection="CAL", DataType="single", Min=0, Max=3, Unit="m/s^2")
P_LongCtrl_ALaUpperCharLaneChange = AUTOSAR4.Parameter([1.625 1.534 1.444 1.399 1.309 1.218 1.083 0.993 0.903 0.808 0.76 0.65 0.55 0.45 0.35], SwCalibrationAccess="ReadWrite", StorageClass="Global", MemorySection="CAL", DataType="single", Min=0, Max=3, Unit="m/s^2")
P_LongCtrl_ALaUpperCharNormal = AUTOSAR4.Parameter([1.489 1.399 1.309 1.264 1.218 1.083 0.993 0.903 0.767 0.679 0.632 0.55 0.45 0.35 0.3], SwCalibrationAccess="ReadWrite", StorageClass="Global", MemorySection="CAL", DataType="single", Min=0, Max=3, Unit="m/s^2")
P_LongCtrl_ALaUpperCharSave = AUTOSAR4.Parameter([1.35 1.25 1.1 1.05 1 0.95 0.85 0.7 0.6 0.55 0.5 0.45 0.35 0.3 0.3], SwCalibrationAccess="ReadWrite", StorageClass="Global", MemorySection="CAL", DataType="single", Min=0, Max=3, Unit="m/s^2")
P_LongCtrl_ALaUpperCharSport = AUTOSAR4.Parameter([1.625 1.534 1.444 1.399 1.309 1.218 1.083 0.993 0.903 0.808 0.76 0.65 0.55 0.45 0.35], SwCalibrationAccess="ReadWrite", StorageClass="Global", MemorySection="CAL", DataType="single", Min=0, Max=3, Unit="m/s^2")
P_LongCtrl_ALaUpperCharSportPlus = AUTOSAR4.Parameter([1.625 1.534 1.444 1.399 1.309 1.218 1.083 0.993 0.903 0.808 0.76 0.65 0.55 0.45 0.35], SwCalibrationAccess="ReadWrite", StorageClass="Global", MemorySection="CAL", DataType="single", Min=0, Max=3, Unit="m/s^2")
P_LongCtrl_ALvAcceleLowerChar = AUTOSAR4.Parameter([0 5 20 30], SwCalibrationAccess="ReadWrite", StorageClass="Global", MemorySection="CAL", DataType="single", Min=0, Max=70, Unit="m/s")
P_LongCtrl_ALvAcceleUpperCharAWD = AUTOSAR4.Parameter([1 1.5 2 2.5 4 8 12 15 18 22 25 28 30 40 60], SwCalibrationAccess="ReadWrite", StorageClass="Global", MemorySection="CAL", DataType="single", Min=0, Max=70, Unit="m/s")
P_LongCtrl_ALvAcceleUpperCharEV = AUTOSAR4.Parameter([1 1.5 2 2.5 4 8 12 15 18 22 25 28 30 40 60], SwCalibrationAccess="ReadWrite", StorageClass="Global", MemorySection="CAL", DataType="single", Min=0, Max=70, Unit="m/s")
P_LongCtrl_ALvAcceleUpperCharEco = AUTOSAR4.Parameter([1 1.5 2 2.5 4 8 12 15 18 22 25 28 30 40 60], SwCalibrationAccess="ReadWrite", StorageClass="Global", MemorySection="CAL", DataType="single", Min=0, Max=70, Unit="m/s")
P_LongCtrl_ALvAcceleUpperCharLaneChange = AUTOSAR4.Parameter([1 1.5 2 2.5 4 8 12 15 18 22 25 28 30 40 60], SwCalibrationAccess="ReadWrite", StorageClass="Global", MemorySection="CAL", DataType="single", Min=0, Max=100, Unit="m/s")
P_LongCtrl_ALvAcceleUpperCharNormal = AUTOSAR4.Parameter([1 1.5 2 2.5 4 8 12 15 18 22 25 28 30 40 60], SwCalibrationAccess="ReadWrite", StorageClass="Global", MemorySection="CAL", DataType="single", Min=0, Max=70, Unit="m/s")
P_LongCtrl_ALvAcceleUpperCharSave = AUTOSAR4.Parameter([1 1.5 2 2.5 4 8 12 15 18 22 25 28 30 40 60], SwCalibrationAccess="ReadWrite", StorageClass="Global", MemorySection="CAL", DataType="single", Min=0, Max=70, Unit="m/s")
P_LongCtrl_ALvAcceleUpperCharSport = AUTOSAR4.Parameter([1 1.5 2 2.5 4 8 12 15 18 22 25 28 30 40 60], SwCalibrationAccess="ReadWrite", StorageClass="Global", MemorySection="CAL", DataType="single", Min=0, Max=70, Unit="m/s")
P_LongCtrl_ALvAcceleUpperCharSportPlus = AUTOSAR4.Parameter([1 1.5 2 2.5 4 8 12 15 18 22 25 28 30 40 60], SwCalibrationAccess="ReadWrite", StorageClass="Global", MemorySection="CAL", DataType="single", Min=0, Max=70, Unit="m/s")
P_LongCtrl_AddVelAccelChange = AUTOSAR4.Parameter(0.3, SwCalibrationAccess="ReadWrite", StorageClass="Global", MemorySection="CAL", DataType="single")  % m/s^2
P_LongCtrl_AddVelAccelThrd = AUTOSAR4.Parameter(-0.2, SwCalibrationAccess="ReadWrite", StorageClass="Global", MemorySection="CAL", DataType="single", Min=-10, Max=10)  % m/s^2
P_LongCtrl_AddVelDistDesThrd = AUTOSAR4.Parameter(0.6, SwCalibrationAccess="ReadWrite", StorageClass="Global", MemorySection="CAL", DataType="single")  % m
P_LongCtrl_AddVelEnable = AUTOSAR4.Parameter(0, SwCalibrationAccess="ReadWrite", StorageClass="Global", MemorySection="CAL", DataType="boolean", Min=0, Max=1)
P_LongCtrl_AddVelRefMsThrd = AUTOSAR4.Parameter(1, SwCalibrationAccess="ReadWrite", StorageClass="Global", MemorySection="CAL", DataType="single")  % m/s
P_LongCtrl_AdvanceBrkingEnable = AUTOSAR4.Parameter(1, SwCalibrationAccess="ReadWrite", StorageClass="Global", MemorySection="CAL", DataType="boolean")
P_LongCtrl_CCLCIncSetSpdAdd = AUTOSAR4.Parameter(5, SwCalibrationAccess="ReadWrite", StorageClass="Global", MemorySection="CAL", DataType="single", Min=0, Max=30, Unit="km/h")
P_LongCtrl_CCLCIncSetSpdAddCntStartValue = AUTOSAR4.Parameter(250, SwCalibrationAccess="ReadWrite", StorageClass="Global", MemorySection="CAL", DataType="single", Min=0, Max=1000)
P_LongCtrl_CCLCIncSetSpdEnable = AUTOSAR4.Parameter(0, SwCalibrationAccess="ReadWrite", StorageClass="Global", MemorySection="CAL", DataType="boolean", Min=0, Max=1)
P_LongCtrl_CCResumeDelayDeltaVel = AUTOSAR4.Parameter(-2, SwCalibrationAccess="ReadWrite", StorageClass="Global", MemorySection="CAL", DataType="single")
P_LongCtrl_CCaDtLowerMax = AUTOSAR4.Parameter(-0.4, SwCalibrationAccess="ReadWrite", StorageClass="Global", MemorySection="CAL", DataType="single", Min=-5, Max=0, Unit="m/s^3")
P_LongCtrl_CCaDtLowerMin = AUTOSAR4.Parameter(-2, SwCalibrationAccess="ReadWrite", StorageClass="Global", MemorySection="CAL", DataType="single", Min=-5, Max=0, Unit="m/s^3")
P_LongCtrl_CCaDtUpperMax = AUTOSAR4.Parameter(1, SwCalibrationAccess="ReadWrite", StorageClass="Global", MemorySection="CAL", DataType="single", Min=0, Max=5, Unit="m/s^3")
P_LongCtrl_CCaDtUpperMin = AUTOSAR4.Parameter(0.5, SwCalibrationAccess="ReadWrite", StorageClass="Global", MemorySection="CAL", DataType="single", Min=0, Max=5, Unit="m/s^3")
P_LongCtrl_CCaMinNegAcceleLowerBand = AUTOSAR4.Parameter(-0.2, SwCalibrationAccess="ReadWrite", StorageClass="Global", MemorySection="CAL", DataType="single", Min=-2, Max=0, Unit="m/s^2")
P_LongCtrl_CCaMinNegAcceleUpperBand = AUTOSAR4.Parameter(0.2, SwCalibrationAccess="ReadWrite", StorageClass="Global", MemorySection="CAL", DataType="single", Min=0, Max=2, Unit="m/s^2")
P_LongCtrl_CCaMinPosAcceleLowerBand = AUTOSAR4.Parameter(-0.05, SwCalibrationAccess="ReadWrite", StorageClass="Global", MemorySection="CAL", DataType="single", Min=-2, Max=0, Unit="m/s^2")
P_LongCtrl_CCaMinPosAcceleUpperBand = AUTOSAR4.Parameter(0.2, SwCalibrationAccess="ReadWrite", StorageClass="Global", MemorySection="CAL", DataType="single", Min=0, Max=2, Unit="m/s^2")
P_LongCtrl_CCaccelLowerIsLaneChange = AUTOSAR4.Parameter(0.3, SwCalibrationAccess="ReadWrite", StorageClass="Global", MemorySection="CAL", DataType="single", Min=0, Max=2, Unit="m/s^2")
P_LongCtrl_CCaccelMaxLCActive = AUTOSAR4.Parameter(0.3, SwCalibrationAccess="ReadWrite", StorageClass="Global", MemorySection="CAL", DataType="single", Min=0, Max=2, Unit="m/s^2")
P_LongCtrl_CCaccelMinECOAL = AUTOSAR4.Parameter(0.3, SwCalibrationAccess="ReadWrite", StorageClass="Global", MemorySection="CAL", DataType="single", Min=0, Max=2, Unit="m/s^2")
P_LongCtrl_CCaccelMinFastDecel = AUTOSAR4.Parameter(-1.2, SwCalibrationAccess="ReadWrite", StorageClass="Global", MemorySection="CAL", DataType="single", Min=-5, Max=-1, Unit="m/s^2")
P_LongCtrl_CCaccelMinNoFastDecel = AUTOSAR4.Parameter(-0.2, SwCalibrationAccess="ReadWrite", StorageClass="Global", MemorySection="CAL", DataType="single", Min=-2, Max=0, Unit="m/s^2")
P_LongCtrl_CCaccelMinNormAL = AUTOSAR4.Parameter(0.3, SwCalibrationAccess="ReadWrite", StorageClass="Global", MemorySection="CAL", DataType="single", Min=0, Max=2, Unit="m/s^2")
P_LongCtrl_CCaccelMinSportAL = AUTOSAR4.Parameter(0.65, SwCalibrationAccess="ReadWrite", StorageClass="Global", MemorySection="CAL", DataType="single", Min=0, Max=2, Unit="m/s^2")
P_LongCtrl_CCaccelUpperCC = AUTOSAR4.Parameter(2.5, SwCalibrationAccess="ReadWrite", StorageClass="Global", MemorySection="CAL", DataType="single", Min=1, Max=3, Unit="m/s^2")
P_LongCtrl_CCaccelUpperCCSafeStop = AUTOSAR4.Parameter(-0.4, SwCalibrationAccess="ReadWrite", StorageClass="Global", MemorySection="CAL", DataType="single", Min=-2, Max=0, Unit="m/s^2")
P_LongCtrl_CCbECO = AUTOSAR4.Parameter(0.87382, SwCalibrationAccess="ReadWrite", StorageClass="Global", MemorySection="CAL", DataType="single", Min=-10, Max=10)
P_LongCtrl_CCbNorm = AUTOSAR4.Parameter(1.16939, SwCalibrationAccess="ReadWrite", StorageClass="Global", MemorySection="CAL", DataType="single", Min=-10, Max=10)
P_LongCtrl_CCbSport = AUTOSAR4.Parameter(1.31713, SwCalibrationAccess="ReadWrite", StorageClass="Global", MemorySection="CAL", DataType="single", Min=-10, Max=10)
P_LongCtrl_CCcoefESPSpd2IPSpd1 = AUTOSAR4.Parameter(1.03, SwCalibrationAccess="ReadWrite", StorageClass="Global", MemorySection="CAL", DataType="single", Min=0, Max=2)
P_LongCtrl_CCcoefESPSpd2IPSpd2 = AUTOSAR4.Parameter(1.3, SwCalibrationAccess="ReadWrite", StorageClass="Global", MemorySection="CAL", DataType="single", Min=0, Max=3)
P_LongCtrl_CCfacNegAcceleLowerBand = AUTOSAR4.Parameter(1.1, SwCalibrationAccess="ReadWrite", StorageClass="Global", MemorySection="CAL", DataType="single", Min=0, Max=2)
P_LongCtrl_CCfacNegAcceleUpperBand = AUTOSAR4.Parameter(0.9, SwCalibrationAccess="ReadWrite", StorageClass="Global", MemorySection="CAL", DataType="single", Min=0, Max=2)
P_LongCtrl_CCfacPosAcceleLowerBand = AUTOSAR4.Parameter(0.9, SwCalibrationAccess="ReadWrite", StorageClass="Global", MemorySection="CAL", DataType="single", Min=0, Max=2)
P_LongCtrl_CCfacPosAcceleUpperBand = AUTOSAR4.Parameter(1.1, SwCalibrationAccess="ReadWrite", StorageClass="Global", MemorySection="CAL", DataType="single", Min=0, Max=2)
P_LongCtrl_CCkECO = AUTOSAR4.Parameter(-0.01521, SwCalibrationAccess="ReadWrite", StorageClass="Global", MemorySection="CAL", DataType="single", Min=-10, Max=10)
P_LongCtrl_CCkNorm = AUTOSAR4.Parameter(-0.02055, SwCalibrationAccess="ReadWrite", StorageClass="Global", MemorySection="CAL", DataType="single", Min=-10, Max=10)
P_LongCtrl_CCkSport = AUTOSAR4.Parameter(-0.01466, SwCalibrationAccess="ReadWrite", StorageClass="Global", MemorySection="CAL", DataType="single", Min=-10, Max=10)
P_LongCtrl_CCtAcceleTimeNeg = AUTOSAR4.Parameter(5.5, SwCalibrationAccess="ReadWrite", StorageClass="Global", MemorySection="CAL", DataType="single", Min=1, Max=10, Unit="s")
P_LongCtrl_CCtAcceleTimePos = AUTOSAR4.Parameter(5, SwCalibrationAccess="ReadWrite", StorageClass="Global", MemorySection="CAL", DataType="single", Min=1, Max=10, Unit="s")
P_LongCtrl_CCtJerkLow = AUTOSAR4.Parameter(1.2, SwCalibrationAccess="ReadWrite", StorageClass="Global", MemorySection="CAL", DataType="single", Min=0, Max=10, Unit="s")
P_LongCtrl_CCtJerkUpper = AUTOSAR4.Parameter(2, SwCalibrationAccess="ReadWrite", StorageClass="Global", MemorySection="CAL", DataType="single", Min=0, Max=10, Unit="s")
P_LongCtrl_CCtStepVelPlan = AUTOSAR4.Parameter(0.5, SwCalibrationAccess="ReadWrite", StorageClass="Global", MemorySection="CAL", DataType="single", Min=0, Max=10, Unit="s")
P_LongCtrl_CCtTotVelPlan = AUTOSAR4.Parameter(4, SwCalibrationAccess="ReadWrite", StorageClass="Global", MemorySection="CAL", DataType="single", Min=0, Max=10, Unit="s")
P_LongCtrl_DangerLevelEnterThrd = AUTOSAR4.Parameter(0, SwCalibrationAccess="ReadWrite", StorageClass="Global", MemorySection="CAL", DataType="single", Min=0, Max=1)
P_LongCtrl_DangerLevelExitThrd = AUTOSAR4.Parameter(0.3, SwCalibrationAccess="ReadWrite", StorageClass="Global", MemorySection="CAL", DataType="single", Min=0, Max=1)
P_LongCtrl_FollowAccelAddSlopeAssistXAxis = AUTOSAR4.Parameter([0.8 1.5], SwCalibrationAccess="ReadWrite", StorageClass="Global", MemorySection="CAL", DataType="single", Min=0, Max=4, Unit="m/s^2")
P_LongCtrl_FollowAccelAddSlopeAssistYAxis = AUTOSAR4.Parameter([0.2 0.3], SwCalibrationAccess="ReadWrite", StorageClass="Global", MemorySection="CAL", DataType="single", Min=0, Max=1, Unit="m/s^2")
P_LongCtrl_FollowAccelCharNegVlcAcc2CoefEnlargeAccelJerkXAxis = AUTOSAR4.Parameter([-0.5 0], SwCalibrationAccess="ReadWrite", StorageClass="Global", MemorySection="CAL", DataType="single", Min=-5, Max=3, Unit="m/s^2")
P_LongCtrl_FollowAccelDesThresStartUpAssistEnable = AUTOSAR4.Parameter(0.2, SwCalibrationAccess="ReadWrite", StorageClass="Global", MemorySection="CAL", DataType="single", Min=0, Max=1, Unit="m/s^2")
P_LongCtrl_FollowAccelJerkNegFollowAccel = AUTOSAR4.Parameter(0.95, SwCalibrationAccess="ReadWrite", StorageClass="Global", MemorySection="CAL", DataType="single", Min=0, Max=3, Unit="m/s^3")
P_LongCtrl_FollowAccelSlopeAssistStep = AUTOSAR4.Parameter(0.02, SwCalibrationAccess="ReadWrite", StorageClass="Global", MemorySection="CAL", DataType="single", Min=0, Max=1, Unit="m/s^2")
P_LongCtrl_FollowCoefCharCoefEnlargeAccelJerkYAxis = AUTOSAR4.Parameter([4 1], SwCalibrationAccess="ReadWrite", StorageClass="Global", MemorySection="CAL", DataType="single", Min=0, Max=5)
P_LongCtrl_FollowCoefCharDistCoefEnlargeAccelStartUpAssistYAxis = AUTOSAR4.Parameter([1 1.3], SwCalibrationAccess="ReadWrite", StorageClass="Global", MemorySection="CAL", DataType="single", Min=1, Max=3)
P_LongCtrl_FollowCoefCharVelCoefEnlargeAccelStartUpAssistYAxis = AUTOSAR4.Parameter([1 1.3], SwCalibrationAccess="ReadWrite", StorageClass="Global", MemorySection="CAL", DataType="single", Min=1, Max=3)
P_LongCtrl_FollowCoefStartUpAssistFadeOut = AUTOSAR4.Parameter(0.9, SwCalibrationAccess="ReadWrite", StorageClass="Global", MemorySection="CAL", DataType="single", Min=0, Max=0.99)
P_LongCtrl_FollowDecelJerkDiffTTC2GapCorrEnableTTCThres = AUTOSAR4.Parameter(2, SwCalibrationAccess="ReadWrite", StorageClass="Global", MemorySection="CAL", DataType="single", Min=2, Max=15, Unit="s")
P_LongCtrl_FollowDecelJerkDiffTTC2GapCorrEnableVelSubjThres = AUTOSAR4.Parameter(5, SwCalibrationAccess="ReadWrite", StorageClass="Global", MemorySection="CAL", DataType="single", Min=1, Max=200, Unit="m/s")
P_LongCtrl_FollowDecelJerkDiffTTC2GapCorrXAxis = AUTOSAR4.Parameter(single([2 5]), SwCalibrationAccess="ReadWrite", StorageClass="Global", MemorySection="CAL", Min=0, Max=25, Unit="s")
P_LongCtrl_FollowDecelJerkDiffTTC2GapCorrYAxis = AUTOSAR4.Parameter(single([1 0.25]), SwCalibrationAccess="ReadWrite", StorageClass="Global", MemorySection="CAL", Min=0.01, Max=1)
P_LongCtrl_FollowDecelJerkForceSlopeXAxis = AUTOSAR4.Parameter([0.3 3], SwCalibrationAccess="ReadWrite", StorageClass="Global", MemorySection="CAL", DataType="single", Min=0, Max=4, Unit="m/s^2")
P_LongCtrl_FollowDecelJerkForceSlopeYAxis = AUTOSAR4.Parameter([-4 -30], SwCalibrationAccess="ReadWrite", StorageClass="Global", MemorySection="CAL", DataType="single", Min=-50, Max=0, Unit="m/s^3")
P_LongCtrl_FollowDistDesAddForceStop = AUTOSAR4.Parameter(0.5, SwCalibrationAccess="ReadWrite", StorageClass="Global", MemorySection="CAL", DataType="single", Min=-2, Max=3, Unit="m")
P_LongCtrl_FollowDistDesCompensionVelRelThresMax = AUTOSAR4.Parameter(single(5), SwCalibrationAccess="ReadWrite", StorageClass="Global", MemorySection="CAL", Min=0, Max=20, Unit="km/h")
P_LongCtrl_FollowDistDesCompensionVelRelThresMin = AUTOSAR4.Parameter(0, SwCalibrationAccess="ReadWrite", StorageClass="Global", MemorySection="CAL", DataType="single", Min=-5, Max=2, Unit="km/h")
P_LongCtrl_FollowDistDiff2VelSubjThresEnableStop = AUTOSAR4.Parameter([-1 1], SwCalibrationAccess="ReadWrite", StorageClass="Global", MemorySection="CAL", DataType="single", Min=-5, Max=5, Unit="m")
P_LongCtrl_FollowDistDiffCharCoefEnlargeAccelStartUpAssistXAxis = AUTOSAR4.Parameter([0 5], SwCalibrationAccess="ReadWrite", StorageClass="Global", MemorySection="CAL", DataType="single", Min=0, Max=5, Unit="m")

P_LongCtrl_FollowDrvOffDistCorrDistFullFillOverride = AUTOSAR4.Parameter(1, SwCalibrationAccess="ReadWrite", StorageClass="Global", MemorySection="CAL", DataType="single", Min=0, Max=10, Unit="m")
P_LongCtrl_FollowDrvOffDistCorrVelFullFillOverride = AUTOSAR4.Parameter(0.5, SwCalibrationAccess="ReadWrite", StorageClass="Global", MemorySection="CAL", DataType="single", Min=0, Max=5, Unit="m")
P_LongCtrl_FollowDrvOffDistExitNoOverride = AUTOSAR4.Parameter(0.5, SwCalibrationAccess="ReadWrite", StorageClass="Global", MemorySection="CAL", DataType="single", Min=0, Max=5, Unit="m")
P_LongCtrl_FollowDrvOffDistExitOverride = AUTOSAR4.Parameter(1.5, SwCalibrationAccess="ReadWrite", StorageClass="Global", MemorySection="CAL", DataType="single", Min=0, Max=5, Unit="m")
P_LongCtrl_FollowDrvOffDistOffsetdDesiredAutoDrvOff = AUTOSAR4.Parameter(1.8, SwCalibrationAccess="ReadWrite", StorageClass="Global", MemorySection="CAL", DataType="single", Min=0, Max=4, Unit="m")
P_LongCtrl_FollowDrvOffStandstillVelThres = AUTOSAR4.Parameter(1, SwCalibrationAccess="ReadWrite", StorageClass="Global", MemorySection="CAL", DataType="single", Min=0, Max=5, Unit="m/s")
P_LongCtrl_FollowDrvOffVelCorrVelFullFillOverride = AUTOSAR4.Parameter(0.2, SwCalibrationAccess="ReadWrite", StorageClass="Global", MemorySection="CAL", DataType="single", Min=0, Max=1, Unit="m/s")
P_LongCtrl_FollowDrvOffVelExitDistCorrNoOverride = AUTOSAR4.Parameter(0.5, SwCalibrationAccess="ReadWrite", StorageClass="Global", MemorySection="CAL", DataType="single", Min=0, Max=5, Unit="m")
P_LongCtrl_FollowDrvOffVelExitDistCorrOverride = AUTOSAR4.Parameter(0.8, SwCalibrationAccess="ReadWrite", StorageClass="Global", MemorySection="CAL", DataType="single", Min=0, Max=5, Unit="m")
P_LongCtrl_FollowDrvOffVelExitVelCorrNoOverride = AUTOSAR4.Parameter(0.2, SwCalibrationAccess="ReadWrite", StorageClass="Global", MemorySection="CAL", DataType="single", Min=0, Max=2, Unit="m/s")
P_LongCtrl_FollowDrvOffVelExitVelCorrOverride = AUTOSAR4.Parameter(0.3, SwCalibrationAccess="ReadWrite", StorageClass="Global", MemorySection="CAL", DataType="single", Min=0, Max=2, Unit="m/s")
P_LongCtrl_FollowDrvOffVelRelMinAutoDrvOff = AUTOSAR4.Parameter(0.4, SwCalibrationAccess="ReadWrite", StorageClass="Global", MemorySection="CAL", DataType="single", Min=0, Max=2, Unit="m/s")
P_LongCtrl_FollowDrvOffdistRelMinAutoDrvOff = AUTOSAR4.Parameter(3, SwCalibrationAccess="ReadWrite", StorageClass="Global", MemorySection="CAL", DataType="single", Min=2, Max=6, Unit="m")
P_LongCtrl_FollowDrvOffvSetMinDriveOffConditions = AUTOSAR4.Parameter(1, SwCalibrationAccess="ReadWrite", StorageClass="Global", MemorySection="CAL", DataType="single", Min=0, Max=10, Unit="m/s")
P_LongCtrl_FollowQuickAccelTargAbsEnableThres = AUTOSAR4.Parameter(-0.6, SwCalibrationAccess="ReadWrite", StorageClass="Global", MemorySection="CAL", DataType="single", Min=-3, Max=0, Unit="m/s^2")
P_LongCtrl_FollowQuickDecelAccelDesMax = AUTOSAR4.Parameter(-0.6, SwCalibrationAccess="ReadWrite", StorageClass="Global", MemorySection="CAL", DataType="single", Min=-3, Max=0, Unit="m/s^2")
P_LongCtrl_FollowQuickDecelDiffDistRel2DesThres = AUTOSAR4.Parameter(0.5, SwCalibrationAccess="ReadWrite", StorageClass="Global", MemorySection="CAL", DataType="single", Min=-20, Max=5, Unit="m")
P_LongCtrl_FollowQuickDecelVelSubjThres = AUTOSAR4.Parameter(100, SwCalibrationAccess="ReadWrite", StorageClass="Global", MemorySection="CAL", DataType="single", Min=0, Max=100, Unit="m/s")
P_LongCtrl_FollowQuickDecelVelTargRelThres = AUTOSAR4.Parameter(-1, SwCalibrationAccess="ReadWrite", StorageClass="Global", MemorySection="CAL", DataType="single", Min=-10, Max=0, Unit="m/s")
P_LongCtrl_FollowRateJConditionStep = AUTOSAR4.Parameter(0.15, SwCalibrationAccess="ReadWrite", StorageClass="Global", MemorySection="CAL", DataType="single", Min=0, Max=1)
P_LongCtrl_FollowRateJDirStep = AUTOSAR4.Parameter(0.3, SwCalibrationAccess="ReadWrite", StorageClass="Global", MemorySection="CAL", DataType="single", Min=0, Max=1)
P_LongCtrl_FollowStartUpAssist = AUTOSAR4.Parameter(1, SwCalibrationAccess="ReadWrite", StorageClass="Global", MemorySection="CAL", DataType="boolean", Min=0, Max=1)
P_LongCtrl_FollowTFiltP0XAxis = AUTOSAR4.Parameter(single([-1 0]), SwCalibrationAccess="ReadWrite", StorageClass="Global", MemorySection="CAL", Min=-2, Max=1, Unit="m/s^2")
P_LongCtrl_FollowTFiltP0YAxis = AUTOSAR4.Parameter(single([0.15 0.5]), SwCalibrationAccess="ReadWrite", StorageClass="Global", MemorySection="CAL", Min=0.01, Max=2, Unit="s")
P_LongCtrl_FollowVelCharCoefEnlargeAccelStartUpAssistXAxis = AUTOSAR4.Parameter([0 3], SwCalibrationAccess="ReadWrite", StorageClass="Global", MemorySection="CAL", DataType="single", Min=0, Max=10, Unit="m/s")
P_LongCtrl_FollowVelSubjForceStopEnable = AUTOSAR4.Parameter(1, SwCalibrationAccess="ReadWrite", StorageClass="Global", MemorySection="CAL", DataType="boolean", Min=0, Max=1)
P_LongCtrl_FollowVelSubjNegToleranceAddX1Axis = AUTOSAR4.Parameter([0 9], SwCalibrationAccess="ReadWrite", StorageClass="Global", MemorySection="CAL", DataType="single", Min=0, Max=20, Unit="m")
P_LongCtrl_FollowVelSubjNegToleranceAddX2Axis = AUTOSAR4.Parameter([-4 -1.5], SwCalibrationAccess="ReadWrite", StorageClass="Global", MemorySection="CAL", DataType="single", Min=-10, Max=0, Unit="m/s")
P_LongCtrl_FollowVelSubjNegToleranceAddYAxis = AUTOSAR4.Parameter([-5 -5; 0 0], SwCalibrationAccess="ReadWrite", StorageClass="Global", MemorySection="CAL", DataType="single", Min=-10, Max=0, Unit="m/s")
P_LongCtrl_FollowVelSubjThresForceStopXAxis = AUTOSAR4.Parameter([0.3 2], SwCalibrationAccess="ReadWrite", StorageClass="Global", MemorySection="CAL", DataType="single", Min=0, Max=4, Unit="m/s^2")
P_LongCtrl_FollowVelSubjThresForceStopYAxis = AUTOSAR4.Parameter([0.1 0.5], SwCalibrationAccess="ReadWrite", StorageClass="Global", MemorySection="CAL", DataType="single", Min=0, Max=3, Unit="m/s")
P_LongCtrl_FollowVelSubjThresStartUpAssistEnable = AUTOSAR4.Parameter(8, SwCalibrationAccess="ReadWrite", StorageClass="Global", MemorySection="CAL", DataType="single", Min=0, Max=10, Unit="m/s")
P_LongCtrl_FollowVelTargAbsThresStartUpAssistEnable = AUTOSAR4.Parameter(0.5, SwCalibrationAccess="ReadWrite", StorageClass="Global", MemorySection="CAL", DataType="single", Min=0, Max=3, Unit="m/s")
P_LongCtrl_FollowVelTargetAbsSmoothNum = AUTOSAR4.Parameter(0.2, SwCalibrationAccess="ReadWrite", StorageClass="Global", MemorySection="CAL", DataType="single", Min=0, Max=60, Unit="m/s")
P_LongCtrl_FollowWdCoefXAxis = AUTOSAR4.Parameter([0.1 2 3], SwCalibrationAccess="ReadWrite", StorageClass="Global", MemorySection="CAL", DataType="single", Min=0, Max=20)
P_LongCtrl_FollowWdCoefYAxis = AUTOSAR4.Parameter([0.5 0.1 0.1], SwCalibrationAccess="ReadWrite", StorageClass="Global", MemorySection="CAL", DataType="single", Min=0, Max=5)
P_LongCtrl_FollowWvCoefXAxis = AUTOSAR4.Parameter([-5 -2 0 2], SwCalibrationAccess="ReadWrite", StorageClass="Global", MemorySection="CAL", DataType="single", Min=-20, Max=20)
P_LongCtrl_FollowWvCoefYAxis = AUTOSAR4.Parameter([1.2 0.2 0.1 0.1], SwCalibrationAccess="ReadWrite", StorageClass="Global", MemorySection="CAL", DataType="single", Min=0, Max=20)
P_LongCtrl_FollowaccelFollowDesThresEnableStopXAxis = AUTOSAR4.Parameter([3 4], SwCalibrationAccess="ReadWrite", StorageClass="Global", MemorySection="CAL", DataType="single", Min=0, Max=5.5, Unit="m")
P_LongCtrl_FollowaccelFollowDesThresEnableStopYAxis = AUTOSAR4.Parameter([0.35 0.18], SwCalibrationAccess="ReadWrite", StorageClass="Global", MemorySection="CAL", DataType="single", Min=0, Max=1, Unit="m/s^2")
P_LongCtrl_FollowaccelForceStopMinCharXAxis = AUTOSAR4.Parameter([1 3], SwCalibrationAccess="ReadWrite", StorageClass="Global", MemorySection="CAL", DataType="single", Min=0, Max=5, Unit="m/s^2")
P_LongCtrl_FollowaccelForceStopMinCharYAxis = AUTOSAR4.Parameter([-2 -4], SwCalibrationAccess="ReadWrite", StorageClass="Global", MemorySection="CAL", DataType="single", Min=-6, Max=-2, Unit="m/s^2")
P_LongCtrl_FollowaccelMinAccelSupressionEnter = AUTOSAR4.Parameter(-1.2, SwCalibrationAccess="ReadWrite", StorageClass="Global", MemorySection="CAL", DataType="single")
P_LongCtrl_FollowaccelMinAccelSupressionExit = AUTOSAR4.Parameter(-1.5, SwCalibrationAccess="ReadWrite", StorageClass="Global", MemorySection="CAL", DataType="single", Min=-3.5, Max=0, Unit="m/s^2")
P_LongCtrl_FollowaccelStopMax = AUTOSAR4.Parameter(-0.3, SwCalibrationAccess="ReadWrite", StorageClass="Global", MemorySection="CAL", DataType="single", Min=-1, Max=0, Unit="m/s^2")
P_LongCtrl_FollowaccelSupressionAccelThres = AUTOSAR4.Parameter(0.1, SwCalibrationAccess="ReadWrite", StorageClass="Global", MemorySection="CAL", DataType="single", Min=-0.5, Max=0.5, Unit="m/s^2")
P_LongCtrl_FollowaccelTargAbsEnableNegJerk = AUTOSAR4.Parameter(-4, SwCalibrationAccess="ReadWrite", StorageClass="Global", MemorySection="CAL", DataType="single", Min=-10, Max=0, Unit="m/s^3")
P_LongCtrl_FollowaccelTargAbsEnableNegMax = AUTOSAR4.Parameter(-0.5, SwCalibrationAccess="ReadWrite", StorageClass="Global", MemorySection="CAL", DataType="single", Min=-1, Max=3, Unit="m/s^2")
P_LongCtrl_FollowaccelTargAbsEnablePosJerk = AUTOSAR4.Parameter(3, SwCalibrationAccess="ReadWrite", StorageClass="Global", MemorySection="CAL", DataType="single", Min=0, Max=10, Unit="m/s^3")
P_LongCtrl_FollowaccelTargAbsEnableRangeMax = AUTOSAR4.Parameter(-0.4, SwCalibrationAccess="ReadWrite", StorageClass="Global", MemorySection="CAL", DataType="single", Min=-2, Max=2, Unit="m/s^2")
P_LongCtrl_FollowaccelTargAbsExitNegMin = AUTOSAR4.Parameter(-0.2, SwCalibrationAccess="ReadWrite", StorageClass="Global", MemorySection="CAL", DataType="single", Min=-3, Max=0, Unit="m/s^2")
P_LongCtrl_FollowaccelTargThresEnableStop = AUTOSAR4.Parameter(0.5, SwCalibrationAccess="ReadWrite", StorageClass="Global", MemorySection="CAL", DataType="single", Min=0, Max=2, Unit="m/s^2")
P_LongCtrl_FollowaccelTargThresForceStop = AUTOSAR4.Parameter(0.1, SwCalibrationAccess="ReadWrite", StorageClass="Global", MemorySection="CAL", DataType="single", Min=0, Max=1, Unit="m/s^2")
P_LongCtrl_FollowaccelThresActiveTOR = AUTOSAR4.Parameter(-5.5, SwCalibrationAccess="ReadWrite", StorageClass="Global", MemorySection="CAL", DataType="single", Min=-10, Max=0, Unit="m/s^2")
P_LongCtrl_FollowcoefAccelStandstillOverride = AUTOSAR4.Parameter(2.5, SwCalibrationAccess="ReadWrite", StorageClass="Global", MemorySection="CAL", DataType="single", Min=1, Max=5)
P_LongCtrl_FollowcoefDistEnlargeDecToStop = AUTOSAR4.Parameter(5, SwCalibrationAccess="ReadWrite", StorageClass="Global", MemorySection="CAL", DataType="single", Min=1, Max=20)
P_LongCtrl_FollowcoefDistRelThresActiveTOR = AUTOSAR4.Parameter(0.3, SwCalibrationAccess="ReadWrite", StorageClass="Global", MemorySection="CAL", DataType="single", Min=0, Max=2)
P_LongCtrl_FollowcoefVelEnlargeDecToStop = AUTOSAR4.Parameter(5, SwCalibrationAccess="ReadWrite", StorageClass="Global", MemorySection="CAL", DataType="single", Min=1, Max=20)
P_LongCtrl_FollowdecelJerkCharXAxis = AUTOSAR4.Parameter([0.1 0.5 1 2 5 10], SwCalibrationAccess="ReadWrite", StorageClass="Global", MemorySection="CAL", DataType="single", Min=0, Max=20, Unit="s")
P_LongCtrl_FollowdecelJerkCharYAxis = AUTOSAR4.Parameter([-5 -4.5 -4 -3 -1.8 -1], SwCalibrationAccess="ReadWrite", StorageClass="Global", MemorySection="CAL", DataType="single", Min=-10, Max=0, Unit="m/s^3")
P_LongCtrl_FollowdistDesCompensionXAxis = AUTOSAR4.Parameter([5 30], SwCalibrationAccess="ReadWrite", StorageClass="Global", MemorySection="CAL", DataType="single", Min=0, Max=70, Unit="m/s")
P_LongCtrl_FollowdistDesCompensionYAxis = AUTOSAR4.Parameter([3 15], SwCalibrationAccess="ReadWrite", StorageClass="Global", MemorySection="CAL", DataType="single", Min=0, Max=50, Unit="m")
P_LongCtrl_FollowdistDesStopMin = AUTOSAR4.Parameter(3.5, SwCalibrationAccess="ReadWrite", StorageClass="Global", MemorySection="CAL", DataType="single", Min=1.5, Max=5.5, Unit="m")
P_LongCtrl_FollowdistDesX2Axis = AUTOSAR4.Parameter([0 2.6 17 25 35 60], SwCalibrationAccess="ReadWrite", StorageClass="Global", MemorySection="CAL", DataType="single", Min=0, Max=70, Unit="m/s")

P_LongCtrl_FollowdistDesYAxis = AUTOSAR4.Parameter([3.2 8.5 23 37 49 70
 3.3 9 26 42 56 75
 3.4 9.5 28 47 63 80
 3.5 10 34 54 71 85], SwCalibrationAccess="ReadWrite", StorageClass="Global", MemorySection="CAL", DataType="single", Min=2.5, Max=150)

P_LongCtrl_FollowdistRelDevCalcDistConst = AUTOSAR4.Parameter(0.5, SwCalibrationAccess="ReadWrite", StorageClass="Global", MemorySection="CAL", DataType="single", Min=0, Max=10, Unit="m")
P_LongCtrl_FollowdistRelMaxJudgeStationaryTarget = AUTOSAR4.Parameter(4, SwCalibrationAccess="ReadWrite", StorageClass="Global", MemorySection="CAL", DataType="single", Min=0, Max=10, Unit="m")
P_LongCtrl_FollowdistRelThresEnablePlauCheck = AUTOSAR4.Parameter(4, SwCalibrationAccess="ReadWrite", StorageClass="Global", MemorySection="CAL", DataType="single", Min=0, Max=20, Unit="m")
P_LongCtrl_FollowdistTargRelEnableAccelTargAbsThres = AUTOSAR4.Parameter(20, SwCalibrationAccess="ReadWrite", StorageClass="Global", MemorySection="CAL", DataType="single", Min=0, Max=50, Unit="m")
P_LongCtrl_FollowdistThresEnableStop = AUTOSAR4.Parameter(5, SwCalibrationAccess="ReadWrite", StorageClass="Global", MemorySection="CAL", DataType="single", Min=1, Max=10, Unit="m")
P_LongCtrl_FollowjerkForceStopCharXAxis = AUTOSAR4.Parameter([0.3 1 2], SwCalibrationAccess="ReadWrite", StorageClass="Global", MemorySection="CAL", DataType="single", Min=0, Max=4, Unit="m/s^2")
P_LongCtrl_FollowtStartUpAssistEnableMax = AUTOSAR4.Parameter(15, SwCalibrationAccess="ReadWrite", StorageClass="Global", MemorySection="CAL", DataType="single", Min=0, Max=60)
P_LongCtrl_FollowttcCorrDecelJerkXAxis = AUTOSAR4.Parameter([1 10 20 100], SwCalibrationAccess="ReadWrite", StorageClass="Global", MemorySection="CAL", DataType="single", Min=0, Max=200, Unit="s")
P_LongCtrl_FollowttcCorrDecelJerkYAxis = AUTOSAR4.Parameter([1 0.8 0.5 0.1], SwCalibrationAccess="ReadWrite", StorageClass="Global", MemorySection="CAL", DataType="single", Min=0, Max=1)
P_LongCtrl_FollowvelRelThresEnablePlauCheck = AUTOSAR4.Parameter(-1, SwCalibrationAccess="ReadWrite", StorageClass="Global", MemorySection="CAL", DataType="single", Min=-5, Max=1, Unit="m/s")
P_LongCtrl_FollowvelSubjMaxEnablePlauCheck = AUTOSAR4.Parameter(2.5, SwCalibrationAccess="ReadWrite", StorageClass="Global", MemorySection="CAL", DataType="single", Min=0, Max=20, Unit="m/s")
P_LongCtrl_FollowvelSubjThresEnablePlauCheck = AUTOSAR4.Parameter(0.5, SwCalibrationAccess="ReadWrite", StorageClass="Global", MemorySection="CAL", DataType="single", Min=0, Max=5, Unit="m/s")
P_LongCtrl_FollowvelSubjThresEnableStop = AUTOSAR4.Parameter(0.6, SwCalibrationAccess="ReadWrite", StorageClass="Global", MemorySection="CAL", DataType="single", Min=0.2, Max=2, Unit="m/s")
P_LongCtrl_FollowvelSubjThresEnableStopAddXAxis = AUTOSAR4.Parameter([0 1], SwCalibrationAccess="ReadWrite", StorageClass="Global", MemorySection="CAL", DataType="single", Min=0, Max=3.5, Unit="m")
P_LongCtrl_FollowvelSubjThresEnableStopAddYAxis = AUTOSAR4.Parameter([0 0.6], SwCalibrationAccess="ReadWrite", StorageClass="Global", MemorySection="CAL", DataType="single", Min=0, Max=3, Unit="m/s")
P_LongCtrl_FollowvelTarAbsThresForceStop = AUTOSAR4.Parameter(0.2, SwCalibrationAccess="ReadWrite", StorageClass="Global", MemorySection="CAL", DataType="single", Min=0.1, Max=1, Unit="m/s")
P_LongCtrl_FollowvelTargAbsMaxJudgeStationaryTarget = AUTOSAR4.Parameter(0.2, SwCalibrationAccess="ReadWrite", StorageClass="Global", MemorySection="CAL", DataType="single", Min=0, Max=1, Unit="m/s")
P_LongCtrl_FollowvelTargRelThresActiveTOR = AUTOSAR4.Parameter(-1, SwCalibrationAccess="ReadWrite", StorageClass="Global", MemorySection="CAL", DataType="single", Min=-5, Max=0, Unit="m/s")
P_LongCtrl_ICCurvatureLimitSpdXAxis = AUTOSAR4.Parameter(single([0 0.0002 0.00025 0.000333 0.0005 0.001 0.0014286 0.002 0.002857 0.005 0.01 0.02 0.05 0.1 0.2]), SwCalibrationAccess="ReadWrite", StorageClass="Global", MemorySection="CAL", Min=0, Max=1)
P_LongCtrl_ICCurvatureLimitSpdYAxis = AUTOSAR4.Parameter(single([150 150 150 130 120 110 100 80 60 50 40 30 20 10 5]), SwCalibrationAccess="ReadWrite", StorageClass="Global", MemorySection="CAL", Min=0, Max=150, Unit="km/h")
P_LongCtrl_ICCurvatureMapLimitSpdXAxis = AUTOSAR4.Parameter([0 0.0005 0.001 0.002 0.005 0.01 0.02 0.05 0.1 0.2], SwCalibrationAccess="ReadWrite", StorageClass="Global", MemorySection="CAL", DataType="single", Min=0, Max=1, Unit="1/m")
P_LongCtrl_ICCurvatureMapLimitSpdYAxis = AUTOSAR4.Parameter([150 150 100 70 50 40 30 20 10 5], SwCalibrationAccess="ReadWrite", StorageClass="Global", MemorySection="CAL", DataType="single", Min=0, Max=210, Unit="km/h")
P_LongCtrl_ICCurveDecelEnable = AUTOSAR4.Parameter(1, SwCalibrationAccess="ReadWrite", StorageClass="Global", MemorySection="CAL", DataType="boolean", Min=0, Max=1)
P_LongCtrl_ICKapLimitAccelXAxis = AUTOSAR4.Parameter([0 0.0005 0.001 0.002 0.005 0.01 0.02 0.05 0.1 0.2], SwCalibrationAccess="ReadWrite", StorageClass="Global", MemorySection="CAL", DataType="single", Min=0, Max=1)
P_LongCtrl_ICKapLimitAccelYAxis = AUTOSAR4.Parameter([16 16 16 8 1.5 0.8 0.5 0.4 0.3 0.2], SwCalibrationAccess="ReadWrite", StorageClass="Global", MemorySection="CAL", DataType="single", Min=0, Max=16)
P_LongCtrl_ICKapUpperJerkMin = AUTOSAR4.Parameter(1, SwCalibrationAccess="ReadWrite", StorageClass="Global", MemorySection="CAL", DataType="single")
P_LongCtrl_ICUpperJerkNegVLCInternalAcc = AUTOSAR4.Parameter(4, SwCalibrationAccess="ReadWrite", StorageClass="Global", MemorySection="CAL", DataType="single", Min=0, Max=10, Unit="m/s^3")
P_LongCtrl_IC_EHRV2Enable = AUTOSAR4.Parameter(0, SwCalibrationAccess="ReadWrite", StorageClass="Global", MemorySection="CAL", DataType="boolean", Min=0, Max=1)
P_LongCtrl_IC_EHRV2Pretime = AUTOSAR4.Parameter(3, SwCalibrationAccess="ReadWrite", StorageClass="Global", MemorySection="CAL", DataType="single", Min=0, Max=10, Unit="s")
P_LongCtrl_IC_PreDisLimitByCurXAxis = AUTOSAR4.Parameter([0 0.0005 0.001 0.002 0.005 0.01 0.02 0.05 0.1 0.2], SwCalibrationAccess="ReadWrite", StorageClass="Global", MemorySection="CAL", DataType="single", Min=0, Max=1)
P_LongCtrl_IC_PreDisLimitByCurYAxis = AUTOSAR4.Parameter([90 90 60 30 10 8 5 2 0 0], SwCalibrationAccess="ReadWrite", StorageClass="Global", MemorySection="CAL", DataType="single", Min=0, Max=150, Unit="m")
P_LongCtrl_ICaccelThresEnableLine = AUTOSAR4.Parameter(-1, SwCalibrationAccess="ReadWrite", StorageClass="Global", MemorySection="CAL", DataType="single", Min=-2, Max=1, Unit="m/s^2")
P_LongCtrl_ICcoefCurvatureCharX1 = AUTOSAR4.Parameter([0 0.0025 0.0035 0.0045], SwCalibrationAccess="ReadWrite", StorageClass="Global", MemorySection="CAL", DataType="single", Min=0, Max=1, Unit="1/m")
P_LongCtrl_ICcoefCurvatureCharX2 = AUTOSAR4.Parameter([0.00015 0.0025 0.0035 0.0045], SwCalibrationAccess="ReadWrite", StorageClass="Global", MemorySection="CAL", DataType="single", Min=0, Max=1, Unit="1/m")
P_LongCtrl_ICcoefCurvatureCharY = AUTOSAR4.Parameter([0.9 0.9 0.9 0.9; 0.1 0.6 0.6 0.3; 0.15 0.6 0.8 0.6; 0.2 0.6 0.8 1], SwCalibrationAccess="ReadWrite", StorageClass="Global", MemorySection="CAL", DataType="single", Min=0, Max=1)
P_LongCtrl_ICdeltaAccelLowerBand = AUTOSAR4.Parameter(0.2, SwCalibrationAccess="ReadWrite", StorageClass="Global", MemorySection="CAL", DataType="single", Min=0, Max=0.5, Unit="m/s^2")
P_LongCtrl_ICdeltaAccelUpperBand = AUTOSAR4.Parameter(0.2, SwCalibrationAccess="ReadWrite", StorageClass="Global", MemorySection="CAL", DataType="single", Min=0, Max=0.5, Unit="m/s^2")
P_LongCtrl_IClowerJerkPosVLCInternalAccMax = AUTOSAR4.Parameter(-0.1, SwCalibrationAccess="ReadWrite", StorageClass="Global", MemorySection="CAL", DataType="single", Min=-5, Max=0, Unit="m/s^3")
P_LongCtrl_IClowerJerkPosVLCInternalAccMin = AUTOSAR4.Parameter(-2, SwCalibrationAccess="ReadWrite", StorageClass="Global", MemorySection="CAL", DataType="single", Min=-5, Max=0, Unit="m/s^3")
P_LongCtrl_ICtAcceleTimeNegCurvatureMap = AUTOSAR4.Parameter(10, SwCalibrationAccess="ReadWrite", StorageClass="Global", MemorySection="CAL", DataType="single", Min=1, Max=20, Unit="s")
P_LongCtrl_ICtAcceleTimePosCurvatureMap = AUTOSAR4.Parameter(5, SwCalibrationAccess="ReadWrite", StorageClass="Global", MemorySection="CAL", DataType="single", Min=1, Max=20, Unit="s")
P_LongCtrl_ICupperJerkICCharXAxis = AUTOSAR4.Parameter([-2 -1 0 1], SwCalibrationAccess="ReadWrite", StorageClass="Global", MemorySection="CAL", DataType="single", Min=-2, Max=2, Unit="m/s^2")
P_LongCtrl_ICupperJerkICCharYAxis = AUTOSAR4.Parameter([2 1 0.15 0.5], SwCalibrationAccess="ReadWrite", StorageClass="Global", MemorySection="CAL", DataType="single", Min=0, Max=3, Unit="m/s^3")
P_LongCtrl_KapLPTimeValue = AUTOSAR4.Parameter(2, SwCalibrationAccess="ReadWrite", StorageClass="Global", MemorySection="CAL", DataType="single", Min=0, Max=10)
P_LongCtrl_KeepLaneSurDis = AUTOSAR4.Parameter(5, SwCalibrationAccess="ReadWrite", StorageClass="Global", MemorySection="CAL", DataType="single", Min=0, Max=100, Unit="m")
P_LongCtrl_KeepLaneTime = AUTOSAR4.Parameter(0.3, SwCalibrationAccess="ReadWrite", StorageClass="Global", MemorySection="CAL", DataType="single", Min=0, Max=5, Unit="s")
P_LongCtrl_LaneAvailDis = AUTOSAR4.Parameter(10, SwCalibrationAccess="ReadWrite", StorageClass="Global", MemorySection="CAL", DataType="single", Min=0, Max=100)
P_LongCtrl_LaneAvailStd = AUTOSAR4.Parameter(0.3, SwCalibrationAccess="ReadWrite", StorageClass="Global", MemorySection="CAL", DataType="single", Min=0, Max=1)
P_LongCtrl_LaneAvailStdAverage = AUTOSAR4.Parameter(0.15, SwCalibrationAccess="ReadWrite", StorageClass="Global", MemorySection="CAL", DataType="single", Min=0, Max=1)
P_LongCtrl_LaneAvailStdMax = AUTOSAR4.Parameter(0.4, SwCalibrationAccess="ReadWrite", StorageClass="Global", MemorySection="CAL", DataType="single", Min=0, Max=1)
P_LongCtrl_LaneAvailTime = AUTOSAR4.Parameter(1, SwCalibrationAccess="ReadWrite", StorageClass="Global", MemorySection="CAL", DataType="single", Min=0, Max=10)
P_LongCtrl_LeftLatDisExitThrd = AUTOSAR4.Parameter(0.35, SwCalibrationAccess="ReadWrite", StorageClass="Global", MemorySection="CAL", DataType="single", Min=0, Max=5, Unit="m")
P_LongCtrl_LowerJerkCC = AUTOSAR4.Parameter(-4, SwCalibrationAccess="ReadWrite", StorageClass="Global", MemorySection="CAL", DataType="single", Min=-10, Max=0)  % m/s^3
P_LongCtrl_ORDAccelThrdSpdXAxis = AUTOSAR4.Parameter(single([0 20 40 60 80 100 120]), SwCalibrationAccess="ReadWrite", StorageClass="Global", MemorySection="CAL", Min=0, Max=200, Unit="km/h")
P_LongCtrl_ORDAccelThrdSpdYAxis = AUTOSAR4.Parameter(single(repmat(-0.5, 1, 7)), SwCalibrationAccess="ReadWrite", StorageClass="Global", MemorySection="CAL", Min=-10, Max=10, Unit="m/s^2")
P_LongCtrl_ORDaccelDevLowerBand = AUTOSAR4.Parameter(0.2, SwCalibrationAccess="ReadWrite", StorageClass="Global", MemorySection="CAL", DataType="single", Min=0, Max=1, Unit="m/s^2")
P_LongCtrl_ORDaccelDevUpperBand = AUTOSAR4.Parameter(0.2, SwCalibrationAccess="ReadWrite", StorageClass="Global", MemorySection="CAL", DataType="single", Min=0, Max=1, Unit="m/s^2")
P_LongCtrl_ORDdecelEnable = AUTOSAR4.Parameter(1, SwCalibrationAccess="ReadWrite", StorageClass="Global", MemorySection="CAL", DataType="boolean", Min=0, Max=1)
P_LongCtrl_ORDlowerJerk = AUTOSAR4.Parameter(-2, SwCalibrationAccess="ReadWrite", StorageClass="Global", MemorySection="CAL", DataType="single", Min=-5, Max=0, Unit="m/s^3")
P_LongCtrl_ORDtAcceleTimeNeg = AUTOSAR4.Parameter(20, SwCalibrationAccess="ReadWrite", StorageClass="Global", MemorySection="CAL", DataType="single", Min=5, Max=30, Unit="s")
P_LongCtrl_ORDtAcceleTimePos = AUTOSAR4.Parameter(5, SwCalibrationAccess="ReadWrite", StorageClass="Global", MemorySection="CAL", DataType="single", Min=1, Max=40, Unit="s")
P_LongCtrl_ORDupperJerk = AUTOSAR4.Parameter(2, SwCalibrationAccess="ReadWrite", StorageClass="Global", MemorySection="CAL", DataType="single", Min=0, Max=5, Unit="m/s^3")
P_LongCtrl_ORDvelDeltaEnableThres = AUTOSAR4.Parameter(1, SwCalibrationAccess="ReadWrite", StorageClass="Global", MemorySection="CAL", DataType="single", Min=0, Max=3, Unit="m/s")
P_LongCtrl_PowerTrainConfig = AUTOSAR4.Parameter(1, SwCalibrationAccess="ReadWrite", StorageClass="Global", MemorySection="CAL", DataType="boolean", Min=0, Max=1)
P_LongCtrl_RightLatDisExitThrd = AUTOSAR4.Parameter(0.35, SwCalibrationAccess="ReadWrite", StorageClass="Global", MemorySection="CAL", DataType="single", Min=0, Max=5, Unit="m")
P_LongCtrl_SJVlcInternalAccThresEnableBrkPrefer = AUTOSAR4.Parameter(0.3, SwCalibrationAccess="ReadWrite", StorageClass="Global", MemorySection="CAL", DataType="single", Min=-1, Max=2, Unit="m/s^2")
P_LongCtrl_SJaccelFollowThresEnableBrkPrefer = AUTOSAR4.Parameter(0, SwCalibrationAccess="ReadWrite", StorageClass="Global", MemorySection="CAL", DataType="single", Min=-3, Max=1, Unit="m/s^2")
P_LongCtrl_SJaccelSubjPlanOptThresEnableBrkPrefer = AUTOSAR4.Parameter(-1.3, SwCalibrationAccess="ReadWrite", StorageClass="Global", MemorySection="CAL", DataType="single", Min=-5, Max=0, Unit="m/s^2")
P_LongCtrl_SJaccelSubjThresEnableBrkPrefer = AUTOSAR4.Parameter(-0.5, SwCalibrationAccess="ReadWrite", StorageClass="Global", MemorySection="CAL", DataType="single", Min=-2, Max=1, Unit="m/s^2")
P_LongCtrl_SJaxvRoadSlopeThresEnableBrkPrefer = AUTOSAR4.Parameter(0.3, SwCalibrationAccess="ReadWrite", StorageClass="Global", MemorySection="CAL", DataType="single", Min=-3, Max=4, Unit="m/s^2")
P_LongCtrl_SJdStop = AUTOSAR4.Parameter(4, SwCalibrationAccess="ReadWrite", StorageClass="Global", MemorySection="CAL", DataType="single", Min=4, Max=4)
P_LongCtrl_SJttcThresEnableBrkPrefer = AUTOSAR4.Parameter(10, SwCalibrationAccess="ReadWrite", StorageClass="Global", MemorySection="CAL", DataType="single", Min=0, Max=20, Unit="s")
P_LongCtrl_SJvelSubjThresEnableBrkPrefer = AUTOSAR4.Parameter(3.6, SwCalibrationAccess="ReadWrite", StorageClass="Global", MemorySection="CAL", DataType="single", Min=0, Max=30, Unit="m/s")
P_LongCtrl_SafeDistOffsetSpdXAxis = AUTOSAR4.Parameter(single([10 30 60 90 120]), SwCalibrationAccess="ReadWrite", StorageClass="Global", MemorySection="CAL", Min=0, Max=150, Unit="km/h")
P_LongCtrl_SafeDistOffsetSpdYAxis = AUTOSAR4.Parameter(single(repmat(0.5, 1, 5)), SwCalibrationAccess="ReadWrite", StorageClass="Global", MemorySection="CAL", Min=-10, Max=10, Unit="m")
P_LongCtrl_TargetIDSwitchEnable = AUTOSAR4.Parameter(1, SwCalibrationAccess="ReadWrite", StorageClass="Global", MemorySection="CAL", DataType="boolean", Min=0, Max=1)
P_LongCtrl_TorAccelTTCThrd = AUTOSAR4.Parameter(2, SwCalibrationAccess="ReadWrite", StorageClass="Global", MemorySection="CAL", DataType="single", Min=0, Max=20)  % s
P_LongCtrl_TorTTCThrd = AUTOSAR4.Parameter(3, SwCalibrationAccess="ReadWrite", StorageClass="Global", MemorySection="CAL", DataType="single")  % s
P_LongCtrl_UpperJerkCC = AUTOSAR4.Parameter(4, SwCalibrationAccess="ReadWrite", StorageClass="Global", MemorySection="CAL", DataType="single", Min=0, Max=10)  % m/s^3
P_LongCtrl_VirTargetSwitchEnable = AUTOSAR4.Parameter(0, SwCalibrationAccess="ReadWrite", StorageClass="Global", MemorySection="CAL", DataType="boolean", Min=0, Max=1)
P_LongCtrl_WaitTime = AUTOSAR4.Parameter(0.3, SwCalibrationAccess="ReadWrite", StorageClass="Global", MemorySection="CAL", DataType="single", Min=0, Max=10, Unit="s")
P_LongCtrl_accelTargAbsThrd = AUTOSAR4.Parameter(-2.5, SwCalibrationAccess="ReadWrite", StorageClass="Global", MemorySection="CAL", DataType="single", Min=-6, Max=6, Unit="m/s^2")
P_LongCtrl_distRelDesDistEnable = AUTOSAR4.Parameter(0, SwCalibrationAccess="ReadWrite", StorageClass="Global", MemorySection="CAL", DataType="boolean")
P_LongCtrl_distThreDecToStop = AUTOSAR4.Parameter(20, SwCalibrationAccess="ReadWrite", StorageClass="Global", MemorySection="CAL", DataType="single", Min=0, Max=50, Unit="m")
P_LongCtrl_distThreDecToStopXAxis = AUTOSAR4.Parameter([0 0.2 0.5], SwCalibrationAccess="ReadWrite", StorageClass="Global", MemorySection="CAL", DataType="single", Min=0, Max=5, Unit="m/s^2")
P_LongCtrl_distThreDecToStopYAxis = AUTOSAR4.Parameter([20 1 0.1], SwCalibrationAccess="ReadWrite", StorageClass="Global", MemorySection="CAL", DataType="single", Min=0, Max=30, Unit="m")
P_LongCtrl_numVlcInternalAccDelay = AUTOSAR4.Parameter(19, SwCalibrationAccess="ReadWrite", StorageClass="Global", MemorySection="CAL", DataType="double", Min=5, Max=40)
P_LongCtrl_tCycle = AUTOSAR4.Parameter(0.02, SwCalibrationAccess="ReadWrite", StorageClass="Global", MemorySection="CAL", DataType="single", Min=0.02, Max=0.02, Unit="s")
P_LongCtrl_velSubjThreDecToStop = AUTOSAR4.Parameter(3, SwCalibrationAccess="ReadWrite", StorageClass="Global", MemorySection="CAL", DataType="single", Min=0, Max=10, Unit="m/s")
P_LongCtrl_velTargetThreDecleToStop = AUTOSAR4.Parameter(1, SwCalibrationAccess="ReadWrite", StorageClass="Global", MemorySection="CAL", DataType="single", Min=0, Max=10, Unit="m/s")
PLAN_ALL_SubModel_VERSION = AUTOSAR4.Signal(SwCalibrationAccess="ReadOnly", StorageClass="Global", MemorySection="VAR")
PLAN_ALL_SubModel_Number = AUTOSAR4.Signal(SwCalibrationAccess="ReadOnly", StorageClass="Global", MemorySection="VAR")
PLAN_UpdateCnt = AUTOSAR4.Signal(SwCalibrationAccess="ReadOnly", StorageClass="Global", MemorySection="VAR")
PLAN_SW_VERSION = AUTOSAR4.Signal(SwCalibrationAccess="ReadOnly", StorageClass="Global", MemorySection="VAR")
PLAN_ALC_sts = AUTOSAR4.Signal(SwCalibrationAccess="ReadOnly", StorageClass="Global", MemorySection="VAR")
PLAN_ALC_tStartDecel = AUTOSAR4.Signal(SwCalibrationAccess="ReadOnly", StorageClass="Global", MemorySection="VAR")
PLAN_ALC_UpdateCnt = AUTOSAR4.Signal(SwCalibrationAccess="ReadOnly", StorageClass="Global", MemorySection="VAR")
PLAN_ALC_LcFinish = AUTOSAR4.Signal(SwCalibrationAccess="ReadOnly", StorageClass="Global", MemorySection="VAR")
PLAN_ALC_LcCancelRi_DrvCmpl = AUTOSAR4.Signal(SwCalibrationAccess="ReadOnly", StorageClass="Global", MemorySection="VAR")
PLAN_ALC_LcCancelRi_Drv = AUTOSAR4.Signal(SwCalibrationAccess="ReadOnly", StorageClass="Global", MemorySection="VAR")
PLAN_ALC_LcCancelRi_DPC = AUTOSAR4.Signal(SwCalibrationAccess="ReadOnly", StorageClass="Global", MemorySection="VAR")
PLAN_ALC_LcCancelRi_LineValid = AUTOSAR4.Signal(SwCalibrationAccess="ReadOnly", StorageClass="Global", MemorySection="VAR")
PLAN_ALC_LcCancelLe_DrvCmpl = AUTOSAR4.Signal(SwCalibrationAccess="ReadOnly", StorageClass="Global", MemorySection="VAR")
PLAN_ALC_LcCancelLe_Drv = AUTOSAR4.Signal(SwCalibrationAccess="ReadOnly", StorageClass="Global", MemorySection="VAR")
PLAN_ALC_LcCancelLe_DPC = AUTOSAR4.Signal(SwCalibrationAccess="ReadOnly", StorageClass="Global", MemorySection="VAR")
PLAN_ALC_LcCancelLe_LineValid = AUTOSAR4.Signal(SwCalibrationAccess="ReadOnly", StorageClass="Global", MemorySection="VAR")
PLAN_ALC_LcCancelLe = AUTOSAR4.Signal(SwCalibrationAccess="ReadOnly", StorageClass="Global", MemorySection="VAR")
PLAN_ALC_LcCancelRi = AUTOSAR4.Signal(SwCalibrationAccess="ReadOnly", StorageClass="Global", MemorySection="VAR")
PLAN_ALC_SW_VERSION = AUTOSAR4.Signal(SwCalibrationAccess="ReadOnly", StorageClass="Global", MemorySection="VAR")
PLAN_ALC_RoadWidth = AUTOSAR4.Signal(SwCalibrationAccess="ReadOnly", StorageClass="Global", MemorySection="VAR")
PLAN_ALC_LcReason = AUTOSAR4.Signal(SwCalibrationAccess="ReadOnly", StorageClass="Global", MemorySection="VAR", DataType="uint8")
PLAN_ALC_OveTkrSupDist = AUTOSAR4.Signal(SwCalibrationAccess="ReadOnly", StorageClass="Global", MemorySection="VAR")
PLAN_ALC_PreP0Dy = AUTOSAR4.Signal(SwCalibrationAccess="ReadOnly", StorageClass="Global", MemorySection="VAR")
PLAN_ALC_LcOverTkLe = AUTOSAR4.Signal(SwCalibrationAccess="ReadOnly", StorageClass="Global", MemorySection="VAR")
PLAN_ALC_LcOverTkRi = AUTOSAR4.Signal(SwCalibrationAccess="ReadOnly", StorageClass="Global", MemorySection="VAR")
PLAN_ALC_LcDrvLe = AUTOSAR4.Signal(SwCalibrationAccess="ReadOnly", StorageClass="Global", MemorySection="VAR")
PLAN_ALC_LcDrvRi = AUTOSAR4.Signal(SwCalibrationAccess="ReadOnly", StorageClass="Global", MemorySection="VAR")
PLAN_ALC_LaneChangeReq = AUTOSAR4.Signal(SwCalibrationAccess="ReadOnly", StorageClass="Global", MemorySection="VAR")
PLAN_ALC_LcDrvLe_DPC = AUTOSAR4.Signal(SwCalibrationAccess="ReadOnly", StorageClass="Global", MemorySection="VAR")
PLAN_ALC_LcDrvLe_dyDiff = AUTOSAR4.Signal(SwCalibrationAccess="ReadOnly", StorageClass="Global", MemorySection="VAR")
PLAN_ALC_LcDrvLe_IPVehSpd = AUTOSAR4.Signal(SwCalibrationAccess="ReadOnly", StorageClass="Global", MemorySection="VAR")
PLAN_ALC_LcDrvLe_LciDrv = AUTOSAR4.Signal(SwCalibrationAccess="ReadOnly", StorageClass="Global", MemorySection="VAR")
PLAN_ALC_LcDrvLe_LineValid = AUTOSAR4.Signal(SwCalibrationAccess="ReadOnly", StorageClass="Global", MemorySection="VAR")
PLAN_ALC_LcDrvLe_NoLcCancelFlag = AUTOSAR4.Signal(SwCalibrationAccess="ReadOnly", StorageClass="Global", MemorySection="VAR")
PLAN_ALC_LcDrvLe_NoLcFinishFlag = AUTOSAR4.Signal(SwCalibrationAccess="ReadOnly", StorageClass="Global", MemorySection="VAR")
PLAN_ALC_LcDrvRi_DPC = AUTOSAR4.Signal(SwCalibrationAccess="ReadOnly", StorageClass="Global", MemorySection="VAR")
PLAN_ALC_LcDrvRi_dyDiff = AUTOSAR4.Signal(SwCalibrationAccess="ReadOnly", StorageClass="Global", MemorySection="VAR")
PLAN_ALC_LcDrvRi_IPVehSpd = AUTOSAR4.Signal(SwCalibrationAccess="ReadOnly", StorageClass="Global", MemorySection="VAR")
PLAN_ALC_LcDrvRi_LineValid = AUTOSAR4.Signal(SwCalibrationAccess="ReadOnly", StorageClass="Global", MemorySection="VAR")
PLAN_ALC_LcDrvRi_NoLcCancelFlag = AUTOSAR4.Signal(SwCalibrationAccess="ReadOnly", StorageClass="Global", MemorySection="VAR")
PLAN_ALC_LcDrvRi_NoLcFinishFlag = AUTOSAR4.Signal(SwCalibrationAccess="ReadOnly", StorageClass="Global", MemorySection="VAR")
PLAN_ALC_LcOverTkLe_DPC = AUTOSAR4.Signal(SwCalibrationAccess="ReadOnly", StorageClass="Global", MemorySection="VAR")
PLAN_ALC_LcOverTkLe_dyDiff = AUTOSAR4.Signal(SwCalibrationAccess="ReadOnly", StorageClass="Global", MemorySection="VAR")
PLAN_ALC_LcOverTkLe_IPVehSpd = AUTOSAR4.Signal(SwCalibrationAccess="ReadOnly", StorageClass="Global", MemorySection="VAR")
PLAN_ALC_LcOverTkLe_LineValid = AUTOSAR4.Signal(SwCalibrationAccess="ReadOnly", StorageClass="Global", MemorySection="VAR")
PLAN_ALC_LcOverTkLe_NoLcFinishFlag = AUTOSAR4.Signal(SwCalibrationAccess="ReadOnly", StorageClass="Global", MemorySection="VAR")
PLAN_ALC_LcOverTkLe_NoOnComing = AUTOSAR4.Signal(SwCalibrationAccess="ReadOnly", StorageClass="Global", MemorySection="VAR")
PLAN_ALC_LcOverTkLe_NoPilotReq = AUTOSAR4.Signal(SwCalibrationAccess="ReadOnly", StorageClass="Global", MemorySection="VAR")
PLAN_ALC_LcOverTkLe_NotInDrvCancelArea = AUTOSAR4.Signal(SwCalibrationAccess="ReadOnly", StorageClass="Global", MemorySection="VAR")
PLAN_ALC_LcOverTkLe_NoTurnLampReq = AUTOSAR4.Signal(SwCalibrationAccess="ReadOnly", StorageClass="Global", MemorySection="VAR")
PLAN_ALC_LcOverTkLe_OverTkTrigger = AUTOSAR4.Signal(SwCalibrationAccess="ReadOnly", StorageClass="Global", MemorySection="VAR")
PLAN_ALC_LcOverTkRi_DPC = AUTOSAR4.Signal(SwCalibrationAccess="ReadOnly", StorageClass="Global", MemorySection="VAR")
PLAN_ALC_LcOverTkRi_dyDiff = AUTOSAR4.Signal(SwCalibrationAccess="ReadOnly", StorageClass="Global", MemorySection="VAR")
PLAN_ALC_LcOverTkRi_IPVehSpd = AUTOSAR4.Signal(SwCalibrationAccess="ReadOnly", StorageClass="Global", MemorySection="VAR")
PLAN_ALC_LcOverTkRi_LineValid = AUTOSAR4.Signal(SwCalibrationAccess="ReadOnly", StorageClass="Global", MemorySection="VAR")
PLAN_ALC_LcOverTkRi_NoLcFinishFlag = AUTOSAR4.Signal(SwCalibrationAccess="ReadOnly", StorageClass="Global", MemorySection="VAR")
PLAN_ALC_LcOverTkRi_NoOnComing = AUTOSAR4.Signal(SwCalibrationAccess="ReadOnly", StorageClass="Global", MemorySection="VAR")
PLAN_ALC_LcOverTkRi_NoPilotReq = AUTOSAR4.Signal(SwCalibrationAccess="ReadOnly", StorageClass="Global", MemorySection="VAR")
PLAN_ALC_LcOverTkRi_NotInDrvCancelArea = AUTOSAR4.Signal(SwCalibrationAccess="ReadOnly", StorageClass="Global", MemorySection="VAR")
PLAN_ALC_LcOverTkRi_NoTurnLampReq = AUTOSAR4.Signal(SwCalibrationAccess="ReadOnly", StorageClass="Global", MemorySection="VAR")
PLAN_ALC_LcOverTkRi_OverTkTrigger = AUTOSAR4.Signal(SwCalibrationAccess="ReadOnly", StorageClass="Global", MemorySection="VAR")
PLAN_ALC_LcDrvRi_NoOnComing = AUTOSAR4.Signal(SwCalibrationAccess="ReadOnly", StorageClass="Global", MemorySection="VAR")
PLAN_ALC_LcDrvLe_NoOnComing = AUTOSAR4.Signal(SwCalibrationAccess="ReadOnly", StorageClass="Global", MemorySection="VAR")
PLAN_ALC_LampReq = AUTOSAR4.Signal(SwCalibrationAccess="ReadOnly", StorageClass="Global", MemorySection="VAR")
PLAN_ALC_LcOverTkLe_ALCSwtOn = AUTOSAR4.Signal(SwCalibrationAccess="ReadOnly", StorageClass="Global", MemorySection="VAR")
PLAN_ALC_LcOverTkRi_ALCSwtOn = AUTOSAR4.Signal(SwCalibrationAccess="ReadOnly", StorageClass="Global", MemorySection="VAR")
PLAN_ALC_LcCancelLe_CancelOverTk = AUTOSAR4.Signal(SwCalibrationAccess="ReadOnly", StorageClass="Global", MemorySection="VAR")
PLAN_ALC_LcCancelLe_Oncoming = AUTOSAR4.Signal(SwCalibrationAccess="ReadOnly", StorageClass="Global", MemorySection="VAR")
PLAN_ALC_LcCancelRi_CancelOverTk = AUTOSAR4.Signal(SwCalibrationAccess="ReadOnly", StorageClass="Global", MemorySection="VAR")
PLAN_ALC_LcCancelRi_Oncoming = AUTOSAR4.Signal(SwCalibrationAccess="ReadOnly", StorageClass="Global", MemorySection="VAR")
PLAN_ALC_LcOverTkLe_LaneAvailable = AUTOSAR4.Signal(SwCalibrationAccess="ReadOnly", StorageClass="Global", MemorySection="VAR")
PLAN_ALC_LcOverTkRi_LaneAvailable = AUTOSAR4.Signal(SwCalibrationAccess="ReadOnly", StorageClass="Global", MemorySection="VAR")
PLAN_ALC_LcDrvRi_LciDrv = AUTOSAR4.Signal(SwCalibrationAccess="ReadOnly", StorageClass="Global", MemorySection="VAR")
PLAN_ALC_LaneChange = AUTOSAR4.Signal(SwCalibrationAccess="ReadOnly", StorageClass="Global", MemorySection="VAR")
PLAN_ALC_LcOverTkLe_P0NotCutOut = AUTOSAR4.Signal(SwCalibrationAccess="ReadOnly", StorageClass="Global", MemorySection="VAR")
PLAN_ALC_LcOverTkRi_P0NotCutOut = AUTOSAR4.Signal(SwCalibrationAccess="ReadOnly", StorageClass="Global", MemorySection="VAR")
PLAN_ALC_LcOverTkRi_NoLcCancel = AUTOSAR4.Signal(SwCalibrationAccess="ReadOnly", StorageClass="Global", MemorySection="VAR")
PLAN_ALC_LcOverTkLe_NoLcCancel = AUTOSAR4.Signal(SwCalibrationAccess="ReadOnly", StorageClass="Global", MemorySection="VAR")
PLAN_ALC_LcNohLe_DPC = AUTOSAR4.Signal(SwCalibrationAccess="ReadOnly", StorageClass="Global", MemorySection="VAR")
PLAN_ALC_LcNohLe_IPVehSpd = AUTOSAR4.Signal(SwCalibrationAccess="ReadOnly", StorageClass="Global", MemorySection="VAR")
PLAN_ALC_LcNohLe_LciNoh = AUTOSAR4.Signal(SwCalibrationAccess="ReadOnly", StorageClass="Global", MemorySection="VAR")
PLAN_ALC_LcNohLe_LineValid = AUTOSAR4.Signal(SwCalibrationAccess="ReadOnly", StorageClass="Global", MemorySection="VAR")
PLAN_ALC_LcNohLe_NoLcFinishLeCnt = AUTOSAR4.Signal(SwCalibrationAccess="ReadOnly", StorageClass="Global", MemorySection="VAR")
PLAN_ALC_LcNohLe_NoTurnLamp = AUTOSAR4.Signal(SwCalibrationAccess="ReadOnly", StorageClass="Global", MemorySection="VAR")
PLAN_ALC_LcNohLe_dyDiff = AUTOSAR4.Signal(SwCalibrationAccess="ReadOnly", StorageClass="Global", MemorySection="VAR")
PLAN_ALC_LcNohRi_DPC = AUTOSAR4.Signal(SwCalibrationAccess="ReadOnly", StorageClass="Global", MemorySection="VAR")
PLAN_ALC_LcNohRi_IPVehSpd = AUTOSAR4.Signal(SwCalibrationAccess="ReadOnly", StorageClass="Global", MemorySection="VAR")
PLAN_ALC_LcNohRi_LciNoh = AUTOSAR4.Signal(SwCalibrationAccess="ReadOnly", StorageClass="Global", MemorySection="VAR")
PLAN_ALC_LcNohRi_LineValid = AUTOSAR4.Signal(SwCalibrationAccess="ReadOnly", StorageClass="Global", MemorySection="VAR")
PLAN_ALC_LcNohRi_NoLcFinishRiCnt = AUTOSAR4.Signal(SwCalibrationAccess="ReadOnly", StorageClass="Global", MemorySection="VAR")
PLAN_ALC_LcNohRi_NoTurnLamp = AUTOSAR4.Signal(SwCalibrationAccess="ReadOnly", StorageClass="Global", MemorySection="VAR")
PLAN_ALC_LcNohRi_dyDiff = AUTOSAR4.Signal(SwCalibrationAccess="ReadOnly", StorageClass="Global", MemorySection="VAR")
PLAN_ALC_LcOverTkLe_LineCurvatureValid = AUTOSAR4.Signal(SwCalibrationAccess="ReadOnly", StorageClass="Global", MemorySection="VAR")
PLAN_ALC_LcOverTkRi_LineCurvatureValid = AUTOSAR4.Signal(SwCalibrationAccess="ReadOnly", StorageClass="Global", MemorySection="VAR")
PLAN_ALC_PreCurvature = AUTOSAR4.Signal(SwCalibrationAccess="ReadOnly", StorageClass="Global", MemorySection="VAR")
PLAN_ALC_LcOverTkLe_PilotLaneAvailable = AUTOSAR4.Signal(SwCalibrationAccess="ReadOnly", StorageClass="Global", MemorySection="VAR")
PLAN_ALC_LcOverTkRi_PilotLaneAvailable = AUTOSAR4.Signal(SwCalibrationAccess="ReadOnly", StorageClass="Global", MemorySection="VAR")
PLAN_ALC_LcOverTkRi_DPCLongConfirm = AUTOSAR4.Signal(SwCalibrationAccess="ReadOnly", StorageClass="Global", MemorySection="VAR")
PLAN_ALC_LcOverTkLe_DPCLongConfirm = AUTOSAR4.Signal(SwCalibrationAccess="ReadOnly", StorageClass="Global", MemorySection="VAR")
PLAN_ALC_LcDrvRi_DPCHoldCnt = AUTOSAR4.Signal(SwCalibrationAccess="ReadOnly", StorageClass="Global", MemorySection="VAR")
PLAN_ALC_LcDrvLe_DPCHoldCnt = AUTOSAR4.Signal(SwCalibrationAccess="ReadOnly", StorageClass="Global", MemorySection="VAR")
PLAN_ALC_LcMrcRi_dyDiff = AUTOSAR4.Signal(SwCalibrationAccess="ReadOnly", StorageClass="Global", MemorySection="VAR")
PLAN_ALC_LcMrcRi_NoTurnLamp = AUTOSAR4.Signal(SwCalibrationAccess="ReadOnly", StorageClass="Global", MemorySection="VAR")
PLAN_ALC_LcMrcRi_LineValid = AUTOSAR4.Signal(SwCalibrationAccess="ReadOnly", StorageClass="Global", MemorySection="VAR")
PLAN_ALC_LcMrcRi_LciMrc = AUTOSAR4.Signal(SwCalibrationAccess="ReadOnly", StorageClass="Global", MemorySection="VAR")
PLAN_ALC_LcMrcRi_IPVehSpd = AUTOSAR4.Signal(SwCalibrationAccess="ReadOnly", StorageClass="Global", MemorySection="VAR")
PLAN_ALC_LcMrcRi_DPC = AUTOSAR4.Signal(SwCalibrationAccess="ReadOnly", StorageClass="Global", MemorySection="VAR")
PLAN_ALC_LSMPilotTurnSts = AUTOSAR4.Signal(SwCalibrationAccess="ReadOnly", StorageClass="Global", MemorySection="VAR")
PLAN_ALC_SubModel_Number = AUTOSAR4.Signal(SwCalibrationAccess="ReadOnly", StorageClass="Global", MemorySection="VAR", DataType="uint32")
PLAN_ALC_SubModel_VERSION = AUTOSAR4.Signal(SwCalibrationAccess="ReadOnly", StorageClass="Global", MemorySection="VAR", DataType="uint32")

PLAN_ALC_LaneChangeIncSetSpdReq = AUTOSAR4.Signal(SwCalibrationAccess="ReadOnly", StorageClass="Global", MemorySection="VAR")
PLAN_PreWheelFLy = AUTOSAR4.Signal(SwCalibrationAccess="ReadOnly", StorageClass="Global", MemorySection="VAR")
PLAN_PreWheelFRx = AUTOSAR4.Signal(SwCalibrationAccess="ReadOnly", StorageClass="Global", MemorySection="VAR")
PLAN_PreWheelFRy = AUTOSAR4.Signal(SwCalibrationAccess="ReadOnly", StorageClass="Global", MemorySection="VAR")
PLAN_PreWheelFLx = AUTOSAR4.Signal(SwCalibrationAccess="ReadOnly", StorageClass="Global", MemorySection="VAR")
PLAN_ALC_CruiseSpdGainLe = AUTOSAR4.Signal(SwCalibrationAccess="ReadOnly", StorageClass="Global", MemorySection="VAR")
PLAN_ALC_CruiseSpdGainRi = AUTOSAR4.Signal(SwCalibrationAccess="ReadOnly", StorageClass="Global", MemorySection="VAR")
PLAN_ALC_LcCancelReason = AUTOSAR4.Signal(SwCalibrationAccess="ReadOnly", StorageClass="Global", MemorySection="VAR")
PLAN_ALC_LcOverTkTrafficSign_b = AUTOSAR4.Signal(SwCalibrationAccess="ReadOnly", StorageClass="Global", MemorySection="VAR")
PLAN_DPC_HWA_DangerPlaus_L = AUTOSAR4.Signal(SwCalibrationAccess="ReadOnly", StorageClass="Global", MemorySection="VAR")
PLAN_DPC_HWA_DangerPlaus_R = AUTOSAR4.Signal(SwCalibrationAccess="ReadOnly", StorageClass="Global", MemorySection="VAR")
PLAN_DPC_HWA_NearestObjValid_L = AUTOSAR4.Signal(SwCalibrationAccess="ReadOnly", StorageClass="Global", MemorySection="VAR")
PLAN_DPC_HWA_NearestObjValid_R = AUTOSAR4.Signal(SwCalibrationAccess="ReadOnly", StorageClass="Global", MemorySection="VAR")
PLAN_DPC_HWA_NearestObjSpeed_L = AUTOSAR4.Signal(SwCalibrationAccess="ReadOnly", StorageClass="Global", MemorySection="VAR")
PLAN_DPC_HWA_NearestObjSpeed_R = AUTOSAR4.Signal(SwCalibrationAccess="ReadOnly", StorageClass="Global", MemorySection="VAR")
PLAN_DPC_ESS_DangerPlaus_L = AUTOSAR4.Signal(SwCalibrationAccess="ReadOnly", StorageClass="Global", MemorySection="VAR")
PLAN_DPC_ESS_DangerPlaus_R = AUTOSAR4.Signal(SwCalibrationAccess="ReadOnly", StorageClass="Global", MemorySection="VAR")
PLAN_DPC_ESS_L_Oncoming_flag = AUTOSAR4.Signal(SwCalibrationAccess="ReadOnly", StorageClass="Global", MemorySection="VAR")
PLAN_DPC_ESS_R_Oncoming_flag = AUTOSAR4.Signal(SwCalibrationAccess="ReadOnly", StorageClass="Global", MemorySection="VAR")
PLAN_DPC_ESS_NearestObjValid_L = AUTOSAR4.Signal(SwCalibrationAccess="ReadOnly", StorageClass="Global", MemorySection="VAR")
PLAN_DPC_ESS_NearestObjValid_R = AUTOSAR4.Signal(SwCalibrationAccess="ReadOnly", StorageClass="Global", MemorySection="VAR")
PLAN_DPC_ESS_NearestObjSpeed_L = AUTOSAR4.Signal(SwCalibrationAccess="ReadOnly", StorageClass="Global", MemorySection="VAR")
PLAN_DPC_ESS_NearestObjSpeed_R = AUTOSAR4.Signal(SwCalibrationAccess="ReadOnly", StorageClass="Global", MemorySection="VAR")
PLAN_DPC_ESS_X_Factor_FL = AUTOSAR4.Signal(SwCalibrationAccess="ReadOnly", StorageClass="Global", MemorySection="VAR")
PLAN_DPC_ESS_X_Factor_FR = AUTOSAR4.Signal(SwCalibrationAccess="ReadOnly", StorageClass="Global", MemorySection="VAR")
PLAN_DPC_ESS_X_Factor_RL = AUTOSAR4.Signal(SwCalibrationAccess="ReadOnly", StorageClass="Global", MemorySection="VAR")
PLAN_DPC_ESS_X_Factor_RR = AUTOSAR4.Signal(SwCalibrationAccess="ReadOnly", StorageClass="Global", MemorySection="VAR")
PLAN_DPC_ESS_Y_Factor_L = AUTOSAR4.Signal(SwCalibrationAccess="ReadOnly", StorageClass="Global", MemorySection="VAR")
PLAN_DPC_ESS_Y_Factor_R = AUTOSAR4.Signal(SwCalibrationAccess="ReadOnly", StorageClass="Global", MemorySection="VAR")
PLAN_DPC_ESS_DangerPlaus_FL = AUTOSAR4.Signal(SwCalibrationAccess="ReadOnly", StorageClass="Global", MemorySection="VAR")
PLAN_DPC_ESS_DangerPlaus_FR = AUTOSAR4.Signal(SwCalibrationAccess="ReadOnly", StorageClass="Global", MemorySection="VAR")
PLAN_DPC_ESS_DangerPlaus_RL = AUTOSAR4.Signal(SwCalibrationAccess="ReadOnly", StorageClass="Global", MemorySection="VAR")
PLAN_DPC_ESS_DangerPlaus_RR = AUTOSAR4.Signal(SwCalibrationAccess="ReadOnly", StorageClass="Global", MemorySection="VAR")
PLAN_DPC_HWA_X_Factor_RR = AUTOSAR4.Signal(SwCalibrationAccess="ReadOnly", StorageClass="Global", MemorySection="VAR")
PLAN_DPC_HWA_TTC_Factor_L = AUTOSAR4.Signal(SwCalibrationAccess="ReadOnly", StorageClass="Global", MemorySection="VAR")
PLAN_DPC_HWA_TTC_Factor_R = AUTOSAR4.Signal(SwCalibrationAccess="ReadOnly", StorageClass="Global", MemorySection="VAR")
PLAN_DPC_HWA_DPCMatrix_Le = AUTOSAR4.Signal(SwCalibrationAccess="ReadOnly", StorageClass="Global", MemorySection="VAR")
PLAN_DPC_HWA_DPCMatrix_Ri = AUTOSAR4.Signal(SwCalibrationAccess="ReadOnly", StorageClass="Global", MemorySection="VAR")
PLAN_DPC_HWA_X_Factor_Le = AUTOSAR4.Signal(SwCalibrationAccess="ReadOnly", StorageClass="Global", MemorySection="VAR")
PLAN_DPC_HWA_X_Factor_Ri = AUTOSAR4.Signal(SwCalibrationAccess="ReadOnly", StorageClass="Global", MemorySection="VAR")
PLAN_DPC_HWA_Y_Factor_Le = AUTOSAR4.Signal(SwCalibrationAccess="ReadOnly", StorageClass="Global", MemorySection="VAR")
PLAN_DPC_HWA_Y_Factor_Ri = AUTOSAR4.Signal(SwCalibrationAccess="ReadOnly", StorageClass="Global", MemorySection="VAR")
PLAN_DPC_HWA_TTC_Factor_Le = AUTOSAR4.Signal(SwCalibrationAccess="ReadOnly", StorageClass="Global", MemorySection="VAR")
PLAN_DPC_HWA_TTC_Factor_Ri = AUTOSAR4.Signal(SwCalibrationAccess="ReadOnly", StorageClass="Global", MemorySection="VAR")
PLAN_DPC_HWA_dPreDxRel_Le = AUTOSAR4.Signal(SwCalibrationAccess="ReadOnly", StorageClass="Global", MemorySection="VAR")
PLAN_DPC_HWA_dPreDxRel_Ri = AUTOSAR4.Signal(SwCalibrationAccess="ReadOnly", StorageClass="Global", MemorySection="VAR")
PLAN_DPC_HWA_dPreDyRel_Le = AUTOSAR4.Signal(SwCalibrationAccess="ReadOnly", StorageClass="Global", MemorySection="VAR")
PLAN_DPC_HWA_dPreDyRel_Ri = AUTOSAR4.Signal(SwCalibrationAccess="ReadOnly", StorageClass="Global", MemorySection="VAR")
PLAN_DPC_HWA_tTTC_Le = AUTOSAR4.Signal(SwCalibrationAccess="ReadOnly", StorageClass="Global", MemorySection="VAR")
PLAN_DPC_HWA_tTTC_Ri = AUTOSAR4.Signal(SwCalibrationAccess="ReadOnly", StorageClass="Global", MemorySection="VAR")
PLAN_DPC_ObjID = AUTOSAR4.Signal(SwCalibrationAccess="ReadOnly", StorageClass="Global", MemorySection="VAR")
PLAN_DPC_ObjTimeAlive = AUTOSAR4.Signal(SwCalibrationAccess="ReadOnly", StorageClass="Global", MemorySection="VAR")
PLAN_DPC_ObjDx = AUTOSAR4.Signal(SwCalibrationAccess="ReadOnly", StorageClass="Global", MemorySection="VAR")
PLAN_DPC_ObjDy = AUTOSAR4.Signal(SwCalibrationAccess="ReadOnly", StorageClass="Global", MemorySection="VAR")
PLAN_DPC_ObjVx = AUTOSAR4.Signal(SwCalibrationAccess="ReadOnly", StorageClass="Global", MemorySection="VAR")
PLAN_DPC_HWA_OncomingFlag_Le = AUTOSAR4.Signal(SwCalibrationAccess="ReadOnly", StorageClass="Global", MemorySection="VAR")
PLAN_DPC_HWA_OncomingFlag_Ri = AUTOSAR4.Signal(SwCalibrationAccess="ReadOnly", StorageClass="Global", MemorySection="VAR")
PLAN_DPC_HWA_NearestObjDx_L = AUTOSAR4.Signal(SwCalibrationAccess="ReadOnly", StorageClass="Global", MemorySection="VAR")
PLAN_DPC_HWA_NearestObjDx_R = AUTOSAR4.Signal(SwCalibrationAccess="ReadOnly", StorageClass="Global", MemorySection="VAR")
PLAN_DPC_HWA_DangerPlaus_C = AUTOSAR4.Signal(SwCalibrationAccess="ReadOnly", StorageClass="Global", MemorySection="VAR")
PLAN_DPC_ObjAx = AUTOSAR4.Signal(SwCalibrationAccess="ReadOnly", StorageClass="Global", MemorySection="VAR")
PLAN_DPC_HWA_DPCold_C = AUTOSAR4.Signal(SwCalibrationAccess="ReadOnly", StorageClass="Global", MemorySection="VAR")
PLAN_DPC_HWA_DPCold_R = AUTOSAR4.Signal(SwCalibrationAccess="ReadOnly", StorageClass="Global", MemorySection="VAR")
PLAN_DPC_HWA_DPCold_L = AUTOSAR4.Signal(SwCalibrationAccess="ReadOnly", StorageClass="Global", MemorySection="VAR")
PLAN_DPC_SubModel_VERSION = AUTOSAR4.Signal(SwCalibrationAccess="ReadOnly", StorageClass="Global", MemorySection="VAR", DataType="uint32")
PLAN_DPC_SubModel_Number = AUTOSAR4.Signal(SwCalibrationAccess="ReadOnly", StorageClass="Global", MemorySection="VAR", DataType="uint32")
PLAN_DPC_HWA_DPCrealtimeLe = AUTOSAR4.Signal(SwCalibrationAccess="ReadOnly", StorageClass="Global", MemorySection="VAR")
PLAN_DPC_HWA_DPCrealtimeRi = AUTOSAR4.Signal(SwCalibrationAccess="ReadOnly", StorageClass="Global", MemorySection="VAR")
PLAN_DPC_LockedDPCLe = AUTOSAR4.Signal(SwCalibrationAccess="ReadOnly", StorageClass="Global", MemorySection="VAR")
PLAN_DPC_LockedDPCRi = AUTOSAR4.Signal(SwCalibrationAccess="ReadOnly", StorageClass="Global", MemorySection="VAR")
PLAN_LostBufRemoveMark = AUTOSAR4.Signal(SwCalibrationAccess="ReadOnly", StorageClass="Global", MemorySection="VAR")
PLAN_ObjLostBufDPCLe = AUTOSAR4.Signal(SwCalibrationAccess="ReadOnly", StorageClass="Global", MemorySection="VAR")
PLAN_ObjLostBufDPCRi = AUTOSAR4.Signal(SwCalibrationAccess="ReadOnly", StorageClass="Global", MemorySection="VAR")
PLAN_ObjLostBufDx = AUTOSAR4.Signal(SwCalibrationAccess="ReadOnly", StorageClass="Global", MemorySection="VAR")
PLAN_ObjLostBufDy = AUTOSAR4.Signal(SwCalibrationAccess="ReadOnly", StorageClass="Global", MemorySection="VAR")
PLAN_ObjLostBufID = AUTOSAR4.Signal(SwCalibrationAccess="ReadOnly", StorageClass="Global", MemorySection="VAR")
PLAN_ObjLostBufLostAge = AUTOSAR4.Signal(SwCalibrationAccess="ReadOnly", StorageClass="Global", MemorySection="VAR")
PLAN_ObjLostBufVx = AUTOSAR4.Signal(SwCalibrationAccess="ReadOnly", StorageClass="Global", MemorySection="VAR")
PLAN_DPC_HWA_PreDyRel_Le = AUTOSAR4.Signal(SwCalibrationAccess="ReadOnly", StorageClass="Global", MemorySection="VAR")
PLAN_DPC_HWA_PreDyRel_Dy_Le = AUTOSAR4.Signal(SwCalibrationAccess="ReadOnly", StorageClass="Global", MemorySection="VAR")
PLAN_DPC_HWA_PreDyRel_Ri = AUTOSAR4.Signal(SwCalibrationAccess="ReadOnly", StorageClass="Global", MemorySection="VAR")
PLAN_DPC_HWA_PreDyRel_Dy_Ri = AUTOSAR4.Signal(SwCalibrationAccess="ReadOnly", StorageClass="Global", MemorySection="VAR")
PLAN_DPC_HWA_RearObjValid = AUTOSAR4.Signal(SwCalibrationAccess="ReadOnly", StorageClass="Global", MemorySection="VAR", DataType="boolean")
PLAN_DPC_HWA_RearObjDx = AUTOSAR4.Signal(SwCalibrationAccess="ReadOnly", StorageClass="Global", MemorySection="VAR", DataType="single")
PLAN_DPC_HWA_RearObjSpeed = AUTOSAR4.Signal(SwCalibrationAccess="ReadOnly", StorageClass="Global", MemorySection="VAR", DataType="single")
PLAN_DPC_Locked_Max_Locktime = AUTOSAR4.Signal(SwCalibrationAccess="ReadOnly", StorageClass="Global", MemorySection="VAR", DataType="uint16")
PLAN_DPC_Locked_ID_again = AUTOSAR4.Signal(SwCalibrationAccess="ReadOnly", StorageClass="Global", MemorySection="VAR", DataType="uint16")
PLAN_DPC_Locked_pre_Obj = AUTOSAR4.Signal(SwCalibrationAccess="ReadOnly", StorageClass="Global", MemorySection="VAR", DataType="uint16")
LongCtrl_AP_ICCurLimitSpd_IN = AUTOSAR4.Signal(SwCalibrationAccess="ReadOnly", StorageClass="Global", MemorySection="VAR")
LongCtrl_AP_ICCurLimitSpd_OUT = AUTOSAR4.Signal(SwCalibrationAccess="ReadOnly", StorageClass="Global", MemorySection="VAR")
LongCtrl_AP_IN_ACCSts = AUTOSAR4.Signal(SwCalibrationAccess="ReadOnly", StorageClass="Global", MemorySection="VAR")
LongCtrl_AP_IN_ACC_SpdSetValue = AUTOSAR4.Signal(SwCalibrationAccess="ReadOnly", StorageClass="Global", MemorySection="VAR")
LongCtrl_AP_IN_ACC_TimeGapSet = AUTOSAR4.Signal(SwCalibrationAccess="ReadOnly", StorageClass="Global", MemorySection="VAR")
LongCtrl_AP_IN_ALC_intention = AUTOSAR4.Signal(SwCalibrationAccess="ReadOnly", StorageClass="Global", MemorySection="VAR")
LongCtrl_AP_IN_DrivingMod = AUTOSAR4.Signal(SwCalibrationAccess="ReadOnly", StorageClass="Global", MemorySection="VAR")
LongCtrl_AP_IN_HCU_DrvMod = AUTOSAR4.Signal(SwCalibrationAccess="ReadOnly", StorageClass="Global", MemorySection="VAR")
LongCtrl_AP_IN_HWAAccControlSts = AUTOSAR4.Signal(SwCalibrationAccess="ReadOnly", StorageClass="Global", MemorySection="VAR")
LongCtrl_AP_IN_HWALineC0 = AUTOSAR4.Signal(SwCalibrationAccess="ReadOnly", StorageClass="Global", MemorySection="VAR")
LongCtrl_AP_IN_HWALineC1 = AUTOSAR4.Signal(SwCalibrationAccess="ReadOnly", StorageClass="Global", MemorySection="VAR")
LongCtrl_AP_IN_HWALineC2 = AUTOSAR4.Signal(SwCalibrationAccess="ReadOnly", StorageClass="Global", MemorySection="VAR")
LongCtrl_AP_IN_HWALineC3 = AUTOSAR4.Signal(SwCalibrationAccess="ReadOnly", StorageClass="Global", MemorySection="VAR")
LongCtrl_AP_IN_HWALineVaild = AUTOSAR4.Signal(SwCalibrationAccess="ReadOnly", StorageClass="Global", MemorySection="VAR")
LongCtrl_AP_IN_HWARange = AUTOSAR4.Signal(SwCalibrationAccess="ReadOnly", StorageClass="Global", MemorySection="VAR")
LongCtrl_AP_IN_HWASts = AUTOSAR4.Signal(SwCalibrationAccess="ReadOnly", StorageClass="Global", MemorySection="VAR")
LongCtrl_AP_IN_IDP0 = AUTOSAR4.Signal(SwCalibrationAccess="ReadOnly", StorageClass="Global", MemorySection="VAR")
LongCtrl_AP_IN_IDP2 = AUTOSAR4.Signal(SwCalibrationAccess="ReadOnly", StorageClass="Global", MemorySection="VAR")
LongCtrl_AP_IN_IDP3 = AUTOSAR4.Signal(SwCalibrationAccess="ReadOnly", StorageClass="Global", MemorySection="VAR")
LongCtrl_AP_IN_L1blsLineExist = AUTOSAR4.Signal(SwCalibrationAccess="ReadOnly", StorageClass="Global", MemorySection="VAR")
LongCtrl_AP_IN_L1dC0V = AUTOSAR4.Signal(SwCalibrationAccess="ReadOnly", StorageClass="Global", MemorySection="VAR")
LongCtrl_AP_IN_L1dC1V = AUTOSAR4.Signal(SwCalibrationAccess="ReadOnly", StorageClass="Global", MemorySection="VAR")
LongCtrl_AP_IN_L1dC2V = AUTOSAR4.Signal(SwCalibrationAccess="ReadOnly", StorageClass="Global", MemorySection="VAR")
LongCtrl_AP_IN_L1dC3V = AUTOSAR4.Signal(SwCalibrationAccess="ReadOnly", StorageClass="Global", MemorySection="VAR")
LongCtrl_AP_IN_L1dDisFront = AUTOSAR4.Signal(SwCalibrationAccess="ReadOnly", StorageClass="Global", MemorySection="VAR")
LongCtrl_AP_IN_LC_Merge_reason = AUTOSAR4.Signal(SwCalibrationAccess="ReadOnly", StorageClass="Global", MemorySection="VAR")
LongCtrl_AP_IN_LSM_PilotRoadSts = AUTOSAR4.Signal(SwCalibrationAccess="ReadOnly", StorageClass="Global", MemorySection="VAR")
LongCtrl_AP_IN_NOH_LatestChgLaneDis = AUTOSAR4.Signal(SwCalibrationAccess="ReadOnly", StorageClass="Global", MemorySection="VAR")
LongCtrl_AP_IN_ObjDYP0 = AUTOSAR4.Signal(SwCalibrationAccess="ReadOnly", StorageClass="Global", MemorySection="VAR")
LongCtrl_AP_IN_ObjDYP2 = AUTOSAR4.Signal(SwCalibrationAccess="ReadOnly", StorageClass="Global", MemorySection="VAR")
LongCtrl_AP_IN_ObjDYP3 = AUTOSAR4.Signal(SwCalibrationAccess="ReadOnly", StorageClass="Global", MemorySection="VAR")
LongCtrl_AP_IN_ObjMovingStateP0 = AUTOSAR4.Signal(SwCalibrationAccess="ReadOnly", StorageClass="Global", MemorySection="VAR")
LongCtrl_AP_IN_ObjTypeP0 = AUTOSAR4.Signal(SwCalibrationAccess="ReadOnly", StorageClass="Global", MemorySection="VAR")
LongCtrl_AP_IN_Object_AX = AUTOSAR4.Signal(SwCalibrationAccess="ReadOnly", StorageClass="Global", MemorySection="VAR")
LongCtrl_AP_IN_Object_Age = AUTOSAR4.Signal(SwCalibrationAccess="ReadOnly", StorageClass="Global", MemorySection="VAR")
LongCtrl_AP_IN_Object_DX = AUTOSAR4.Signal(SwCalibrationAccess="ReadOnly", StorageClass="Global", MemorySection="VAR")
LongCtrl_AP_IN_Object_DY = AUTOSAR4.Signal(SwCalibrationAccess="ReadOnly", StorageClass="Global", MemorySection="VAR")
LongCtrl_AP_IN_Object_ExistProb = AUTOSAR4.Signal(SwCalibrationAccess="ReadOnly", StorageClass="Global", MemorySection="VAR")
LongCtrl_AP_IN_Object_Fus_Type = AUTOSAR4.Signal(SwCalibrationAccess="ReadOnly", StorageClass="Global", MemorySection="VAR")
LongCtrl_AP_IN_Object_HeadingAngle = AUTOSAR4.Signal(SwCalibrationAccess="ReadOnly", StorageClass="Global", MemorySection="VAR")
LongCtrl_AP_IN_Object_Hight = AUTOSAR4.Signal(SwCalibrationAccess="ReadOnly", StorageClass="Global", MemorySection="VAR")
LongCtrl_AP_IN_Object_ID = AUTOSAR4.Signal(SwCalibrationAccess="ReadOnly", StorageClass="Global", MemorySection="VAR")
LongCtrl_AP_IN_Object_Length = AUTOSAR4.Signal(SwCalibrationAccess="ReadOnly", StorageClass="Global", MemorySection="VAR")
LongCtrl_AP_IN_Object_ObstacleProb = AUTOSAR4.Signal(SwCalibrationAccess="ReadOnly", StorageClass="Global", MemorySection="VAR")
LongCtrl_AP_IN_Object_Type = AUTOSAR4.Signal(SwCalibrationAccess="ReadOnly", StorageClass="Global", MemorySection="VAR")
LongCtrl_AP_IN_Object_VX = AUTOSAR4.Signal(SwCalibrationAccess="ReadOnly", StorageClass="Global", MemorySection="VAR")
LongCtrl_AP_IN_Object_VY = AUTOSAR4.Signal(SwCalibrationAccess="ReadOnly", StorageClass="Global", MemorySection="VAR")
LongCtrl_AP_IN_Object_Width = AUTOSAR4.Signal(SwCalibrationAccess="ReadOnly", StorageClass="Global", MemorySection="VAR")
LongCtrl_AP_IN_R1blsLineExist = AUTOSAR4.Signal(SwCalibrationAccess="ReadOnly", StorageClass="Global", MemorySection="VAR")
LongCtrl_AP_IN_R1dC0V = AUTOSAR4.Signal(SwCalibrationAccess="ReadOnly", StorageClass="Global", MemorySection="VAR")
LongCtrl_AP_IN_R1dC1V = AUTOSAR4.Signal(SwCalibrationAccess="ReadOnly", StorageClass="Global", MemorySection="VAR")
LongCtrl_AP_IN_R1dC2V = AUTOSAR4.Signal(SwCalibrationAccess="ReadOnly", StorageClass="Global", MemorySection="VAR")
LongCtrl_AP_IN_R1dC3V = AUTOSAR4.Signal(SwCalibrationAccess="ReadOnly", StorageClass="Global", MemorySection="VAR")
LongCtrl_AP_IN_R1dDisFront = AUTOSAR4.Signal(SwCalibrationAccess="ReadOnly", StorageClass="Global", MemorySection="VAR")
LongCtrl_AP_IN_RFM_UpdateCnt = AUTOSAR4.Signal(SwCalibrationAccess="ReadOnly", StorageClass="Global", MemorySection="VAR")
LongCtrl_AP_IN_RoadWidth = AUTOSAR4.Signal(SwCalibrationAccess="ReadOnly", StorageClass="Global", MemorySection="VAR")
LongCtrl_AP_IN_TOS_UpdateCnt = AUTOSAR4.Signal(SwCalibrationAccess="ReadOnly", StorageClass="Global", MemorySection="VAR")
LongCtrl_AP_IN_VSM_ShortBrakeReq = AUTOSAR4.Signal(SwCalibrationAccess="ReadOnly", StorageClass="Global", MemorySection="VAR")
LongCtrl_AP_IN_VehSpd = AUTOSAR4.Signal(SwCalibrationAccess="ReadOnly", StorageClass="Global", MemorySection="VAR")
LongCtrl_AP_IN_VlcInternalAccK1 = AUTOSAR4.Signal(SwCalibrationAccess="ReadOnly", StorageClass="Global", MemorySection="VAR")
LongCtrl_AP_IN_axAbsGroundP0 = AUTOSAR4.Signal(SwCalibrationAccess="ReadOnly", StorageClass="Global", MemorySection="VAR")
LongCtrl_AP_IN_axAbsGroundP2 = AUTOSAR4.Signal(SwCalibrationAccess="ReadOnly", StorageClass="Global", MemorySection="VAR")
LongCtrl_AP_IN_axAbsGroundP3 = AUTOSAR4.Signal(SwCalibrationAccess="ReadOnly", StorageClass="Global", MemorySection="VAR")
LongCtrl_AP_IN_axvRefMs2 = AUTOSAR4.Signal(SwCalibrationAccess="ReadOnly", StorageClass="Global", MemorySection="VAR")
LongCtrl_AP_IN_axvRoadSlopeMs2 = AUTOSAR4.Signal(SwCalibrationAccess="ReadOnly", StorageClass="Global", MemorySection="VAR")
LongCtrl_AP_IN_dangerLevel = AUTOSAR4.Signal(SwCalibrationAccess="ReadOnly", StorageClass="Global", MemorySection="VAR")
LongCtrl_AP_IN_distRamp2Cur = AUTOSAR4.Signal(SwCalibrationAccess="ReadOnly", StorageClass="Global", MemorySection="VAR")
LongCtrl_AP_IN_i_road_curvature = AUTOSAR4.Signal(SwCalibrationAccess="ReadOnly", StorageClass="Global", MemorySection="VAR")
LongCtrl_AP_IN_i_road_curvature_distance_matrix = AUTOSAR4.Signal(SwCalibrationAccess="ReadOnly", StorageClass="Global", MemorySection="VAR")
LongCtrl_AP_IN_i_road_curvature_far = AUTOSAR4.Signal(SwCalibrationAccess="ReadOnly", StorageClass="Global", MemorySection="VAR")
LongCtrl_AP_IN_i_road_curvature_far_distance = AUTOSAR4.Signal(SwCalibrationAccess="ReadOnly", StorageClass="Global", MemorySection="VAR")
LongCtrl_AP_IN_i_road_curvature_matrix_size = AUTOSAR4.Signal(SwCalibrationAccess="ReadOnly", StorageClass="Global", MemorySection="VAR")
LongCtrl_AP_IN_i_road_curvature_value_matrix = AUTOSAR4.Signal(SwCalibrationAccess="ReadOnly", StorageClass="Global", MemorySection="VAR")
LongCtrl_AP_IN_kapTraj = AUTOSAR4.Signal(SwCalibrationAccess="ReadOnly", StorageClass="Global", MemorySection="VAR")
LongCtrl_AP_IN_laneChangeEnable = AUTOSAR4.Signal(SwCalibrationAccess="ReadOnly", StorageClass="Global", MemorySection="VAR")
LongCtrl_AP_IN_laneChangeIncSetSpdReq = AUTOSAR4.Signal(SwCalibrationAccess="ReadOnly", StorageClass="Global", MemorySection="VAR")
LongCtrl_AP_IN_rangeP0 = AUTOSAR4.Signal(SwCalibrationAccess="ReadOnly", StorageClass="Global", MemorySection="VAR")
LongCtrl_AP_IN_rangeP2 = AUTOSAR4.Signal(SwCalibrationAccess="ReadOnly", StorageClass="Global", MemorySection="VAR")
LongCtrl_AP_IN_rangeP3 = AUTOSAR4.Signal(SwCalibrationAccess="ReadOnly", StorageClass="Global", MemorySection="VAR")
LongCtrl_AP_IN_targetExistP0 = AUTOSAR4.Signal(SwCalibrationAccess="ReadOnly", StorageClass="Global", MemorySection="VAR")
LongCtrl_AP_IN_targetExistP2 = AUTOSAR4.Signal(SwCalibrationAccess="ReadOnly", StorageClass="Global", MemorySection="VAR")
LongCtrl_AP_IN_targetExistP3 = AUTOSAR4.Signal(SwCalibrationAccess="ReadOnly", StorageClass="Global", MemorySection="VAR")
LongCtrl_AP_IN_vSetBelowMin = AUTOSAR4.Signal(SwCalibrationAccess="ReadOnly", StorageClass="Global", MemorySection="VAR")
LongCtrl_AP_IN_velOffRampLimit = AUTOSAR4.Signal(SwCalibrationAccess="ReadOnly", StorageClass="Global", MemorySection="VAR")
LongCtrl_AP_IN_vxRelP0 = AUTOSAR4.Signal(SwCalibrationAccess="ReadOnly", StorageClass="Global", MemorySection="VAR")
LongCtrl_AP_IN_vxRelP2 = AUTOSAR4.Signal(SwCalibrationAccess="ReadOnly", StorageClass="Global", MemorySection="VAR")
LongCtrl_AP_IN_vxRelP3 = AUTOSAR4.Signal(SwCalibrationAccess="ReadOnly", StorageClass="Global", MemorySection="VAR")
LongCtrl_AP_IN_vxvRefMs = AUTOSAR4.Signal(SwCalibrationAccess="ReadOnly", StorageClass="Global", MemorySection="VAR")
LongCtrl_AccelALIsLaneChange = AUTOSAR4.Signal(SwCalibrationAccess="ReadOnly", StorageClass="Global", MemorySection="VAR")
LongCtrl_AccelSupreReq = AUTOSAR4.Signal(SwCalibrationAccess="ReadOnly", StorageClass="Global", MemorySection="VAR")
LongCtrl_AccelThrdValidFlag = AUTOSAR4.Signal(SwCalibrationAccess="ReadOnly", StorageClass="Global", MemorySection="VAR")
LongCtrl_AdvanceBrkingFlag = AUTOSAR4.Signal(SwCalibrationAccess="ReadOnly", StorageClass="Global", MemorySection="VAR")
LongCtrl_ArbFlag = AUTOSAR4.Signal(SwCalibrationAccess="ReadOnly", StorageClass="Global", MemorySection="VAR")
LongCtrl_BrakePrefer = AUTOSAR4.Signal(SwCalibrationAccess="ReadOnly", StorageClass="Global", MemorySection="VAR")
LongCtrl_CurDesVelSubj = AUTOSAR4.Signal(SwCalibrationAccess="ReadOnly", StorageClass="Global", MemorySection="VAR")
LongCtrl_CurDistRelDes = AUTOSAR4.Signal(SwCalibrationAccess="ReadOnly", StorageClass="Global", MemorySection="VAR")
LongCtrl_CurvatureOfMap = AUTOSAR4.Signal(SwCalibrationAccess="ReadOnly", StorageClass="Global", MemorySection="VAR")
LongCtrl_CurvatureOfRoad = AUTOSAR4.Signal(SwCalibrationAccess="ReadOnly", StorageClass="Global", MemorySection="VAR")
LongCtrl_DecleToStop = AUTOSAR4.Signal(SwCalibrationAccess="ReadOnly", StorageClass="Global", MemorySection="VAR")
LongCtrl_DisableTargetVir = AUTOSAR4.Signal(SwCalibrationAccess="ReadOnly", StorageClass="Global", MemorySection="VAR")
LongCtrl_DriveOffConditonFulfilled = AUTOSAR4.Signal(SwCalibrationAccess="ReadOnly", StorageClass="Global", MemorySection="VAR")
LongCtrl_DriveOffConditonFulfilled_init = AUTOSAR4.Signal(SwCalibrationAccess="ReadOnly", StorageClass="Global", MemorySection="VAR")
LongCtrl_EnableTargetVir = AUTOSAR4.Signal(SwCalibrationAccess="ReadOnly", StorageClass="Global", MemorySection="VAR")
LongCtrl_FollowAcceleStandstillOverride = AUTOSAR4.Signal(SwCalibrationAccess="ReadOnly", StorageClass="Global", MemorySection="VAR")
LongCtrl_Follow_Counter = AUTOSAR4.Signal(SwCalibrationAccess="ReadOnly", StorageClass="Global", MemorySection="VAR")
LongCtrl_ForceStop = AUTOSAR4.Signal(SwCalibrationAccess="ReadOnly", StorageClass="Global", MemorySection="VAR")
LongCtrl_HWALineC0 = AUTOSAR4.Signal(SwCalibrationAccess="ReadOnly", StorageClass="Global", MemorySection="VAR")
LongCtrl_HWALineC1 = AUTOSAR4.Signal(SwCalibrationAccess="ReadOnly", StorageClass="Global", MemorySection="VAR")
LongCtrl_HWALineC2 = AUTOSAR4.Signal(SwCalibrationAccess="ReadOnly", StorageClass="Global", MemorySection="VAR")
LongCtrl_HWALineC3 = AUTOSAR4.Signal(SwCalibrationAccess="ReadOnly", StorageClass="Global", MemorySection="VAR")
LongCtrl_HWALineValid = AUTOSAR4.Signal(SwCalibrationAccess="ReadOnly", StorageClass="Global", MemorySection="VAR")
LongCtrl_HWARange = AUTOSAR4.Signal(SwCalibrationAccess="ReadOnly", StorageClass="Global", MemorySection="VAR")

LongCtrl_IC_state = AUTOSAR4.Signal(SwCalibrationAccess="ReadOnly", StorageClass="Global", MemorySection="VAR")
LongCtrl_J = AUTOSAR4.Signal(SwCalibrationAccess="ReadOnly", StorageClass="Global", MemorySection="VAR")
LongCtrl_JadtA = AUTOSAR4.Signal(SwCalibrationAccess="ReadOnly", StorageClass="Global", MemorySection="VAR")
LongCtrl_JadtADist = AUTOSAR4.Signal(SwCalibrationAccess="ReadOnly", StorageClass="Global", MemorySection="VAR")
LongCtrl_KapVehVelReq = AUTOSAR4.Signal(SwCalibrationAccess="ReadOnly", StorageClass="Global", MemorySection="VAR")
LongCtrl_L1_Avail_dis = AUTOSAR4.Signal(SwCalibrationAccess="ReadOnly", StorageClass="Global", MemorySection="VAR")
LongCtrl_L1_Avail_time = AUTOSAR4.Signal(SwCalibrationAccess="ReadOnly", StorageClass="Global", MemorySection="VAR")
LongCtrl_L1_KeepLineSts = AUTOSAR4.Signal(SwCalibrationAccess="ReadOnly", StorageClass="Global", MemorySection="VAR")
LongCtrl_L1_Line_std = AUTOSAR4.Signal(SwCalibrationAccess="ReadOnly", StorageClass="Global", MemorySection="VAR")
LongCtrl_LCEnableAssess = AUTOSAR4.Signal(SwCalibrationAccess="ReadOnly", StorageClass="Global", MemorySection="VAR")
LongCtrl_LSMORDValidFlag = AUTOSAR4.Signal(SwCalibrationAccess="ReadOnly", StorageClass="Global", MemorySection="VAR")
LongCtrl_LeftExit1 = AUTOSAR4.Signal(SwCalibrationAccess="ReadOnly", StorageClass="Global", MemorySection="VAR")
LongCtrl_LeftExit2 = AUTOSAR4.Signal(SwCalibrationAccess="ReadOnly", StorageClass="Global", MemorySection="VAR")
LongCtrl_LeftExit3 = AUTOSAR4.Signal(SwCalibrationAccess="ReadOnly", StorageClass="Global", MemorySection="VAR")
LongCtrl_LeftExit4 = AUTOSAR4.Signal(SwCalibrationAccess="ReadOnly", StorageClass="Global", MemorySection="VAR")
LongCtrl_LeftHWASts = AUTOSAR4.Signal(SwCalibrationAccess="ReadOnly", StorageClass="Global", MemorySection="VAR")
LongCtrl_LeftLatRelDistance = AUTOSAR4.Signal(SwCalibrationAccess="ReadOnly", StorageClass="Global", MemorySection="VAR")
LongCtrl_ORDState = AUTOSAR4.Signal(SwCalibrationAccess="ReadOnly", StorageClass="Global", MemorySection="VAR")
LongCtrl_P0DyHWALine = AUTOSAR4.Signal(SwCalibrationAccess="ReadOnly", StorageClass="Global", MemorySection="VAR")
LongCtrl_P2DyHWALine = AUTOSAR4.Signal(SwCalibrationAccess="ReadOnly", StorageClass="Global", MemorySection="VAR")
LongCtrl_P3DyHWALine = AUTOSAR4.Signal(SwCalibrationAccess="ReadOnly", StorageClass="Global", MemorySection="VAR")
LongCtrl_R1_Avail_dis = AUTOSAR4.Signal(SwCalibrationAccess="ReadOnly", StorageClass="Global", MemorySection="VAR")
LongCtrl_R1_Avail_time = AUTOSAR4.Signal(SwCalibrationAccess="ReadOnly", StorageClass="Global", MemorySection="VAR")
LongCtrl_R1_KeepLineSts = AUTOSAR4.Signal(SwCalibrationAccess="ReadOnly", StorageClass="Global", MemorySection="VAR")
LongCtrl_R1_Line_std = AUTOSAR4.Signal(SwCalibrationAccess="ReadOnly", StorageClass="Global", MemorySection="VAR")
LongCtrl_RightExit1 = AUTOSAR4.Signal(SwCalibrationAccess="ReadOnly", StorageClass="Global", MemorySection="VAR")
LongCtrl_RightExit2 = AUTOSAR4.Signal(SwCalibrationAccess="ReadOnly", StorageClass="Global", MemorySection="VAR")
LongCtrl_RightExit3 = AUTOSAR4.Signal(SwCalibrationAccess="ReadOnly", StorageClass="Global", MemorySection="VAR")
LongCtrl_RightExit4 = AUTOSAR4.Signal(SwCalibrationAccess="ReadOnly", StorageClass="Global", MemorySection="VAR")
LongCtrl_RightHWASts = AUTOSAR4.Signal(SwCalibrationAccess="ReadOnly", StorageClass="Global", MemorySection="VAR")
LongCtrl_RightLatRelDistance = AUTOSAR4.Signal(SwCalibrationAccess="ReadOnly", StorageClass="Global", MemorySection="VAR")
LongCtrl_TargetIDSwitch = AUTOSAR4.Signal(SwCalibrationAccess="ReadOnly", StorageClass="Global", MemorySection="VAR")
LongCtrl_TgtObjBarDisp = AUTOSAR4.Signal(SwCalibrationAccess="ReadOnly", StorageClass="Global", MemorySection="VAR")
LongCtrl_TorCtrlReq = AUTOSAR4.Signal(SwCalibrationAccess="ReadOnly", StorageClass="Global", MemorySection="VAR")
LongCtrl_TorTTC = AUTOSAR4.Signal(SwCalibrationAccess="ReadOnly", StorageClass="Global", MemorySection="VAR")
LongCtrl_VlcInternalAccK20 = AUTOSAR4.Signal(SwCalibrationAccess="ReadOnly", StorageClass="Global", MemorySection="VAR")
LongCtrl_accelAL = AUTOSAR4.Signal(SwCalibrationAccess="ReadOnly", StorageClass="Global", MemorySection="VAR")
LongCtrl_accelArb = AUTOSAR4.Signal(SwCalibrationAccess="ReadOnly", StorageClass="Global", MemorySection="VAR")
LongCtrl_accelCC = AUTOSAR4.Signal(SwCalibrationAccess="ReadOnly", StorageClass="Global", MemorySection="VAR")
LongCtrl_accelCCCtrlAfterJerk = AUTOSAR4.Signal(SwCalibrationAccess="ReadOnly", StorageClass="Global", MemorySection="VAR")
LongCtrl_accelCCRaw = AUTOSAR4.Signal(SwCalibrationAccess="ReadOnly", StorageClass="Global", MemorySection="VAR")
LongCtrl_accelCurvature = AUTOSAR4.Signal(SwCalibrationAccess="ReadOnly", StorageClass="Global", MemorySection="VAR")
LongCtrl_accelDesCurvatureMap = AUTOSAR4.Signal(SwCalibrationAccess="ReadOnly", StorageClass="Global", MemorySection="VAR")
LongCtrl_accelFollow = AUTOSAR4.Signal(SwCalibrationAccess="ReadOnly", StorageClass="Global", MemorySection="VAR")
LongCtrl_accelFollowAfterDecelToStop = AUTOSAR4.Signal(SwCalibrationAccess="ReadOnly", StorageClass="Global", MemorySection="VAR")
LongCtrl_accelFollowAfterJerk = AUTOSAR4.Signal(SwCalibrationAccess="ReadOnly", StorageClass="Global", MemorySection="VAR")
LongCtrl_accelFollowAfterLaneChangeSupress = AUTOSAR4.Signal(SwCalibrationAccess="ReadOnly", StorageClass="Global", MemorySection="VAR")
LongCtrl_accelFollowDesThresEnableStop = AUTOSAR4.Signal(SwCalibrationAccess="ReadOnly", StorageClass="Global", MemorySection="VAR")
LongCtrl_accelFollowFilt = AUTOSAR4.Signal(SwCalibrationAccess="ReadOnly", StorageClass="Global", MemorySection="VAR")
LongCtrl_accelFollowSlopeAssist = AUTOSAR4.Signal(SwCalibrationAccess="ReadOnly", StorageClass="Global", MemorySection="VAR")
LongCtrl_accelForceMin = AUTOSAR4.Signal(SwCalibrationAccess="ReadOnly", StorageClass="Global", MemorySection="VAR")
LongCtrl_accelIC = AUTOSAR4.Signal(SwCalibrationAccess="ReadOnly", StorageClass="Global", MemorySection="VAR")
LongCtrl_accelICCurvatureMapMatrix = AUTOSAR4.Signal(SwCalibrationAccess="ReadOnly", StorageClass="Global", MemorySection="VAR")
LongCtrl_accelKap = AUTOSAR4.Signal(SwCalibrationAccess="ReadOnly", StorageClass="Global", MemorySection="VAR")
LongCtrl_accelKapRun = AUTOSAR4.Signal(SwCalibrationAccess="ReadOnly", StorageClass="Global", MemorySection="VAR")
LongCtrl_accelKapStartup = AUTOSAR4.Signal(SwCalibrationAccess="ReadOnly", StorageClass="Global", MemorySection="VAR")
LongCtrl_accelKapStartupRaw = AUTOSAR4.Signal(SwCalibrationAccess="ReadOnly", StorageClass="Global", MemorySection="VAR")
LongCtrl_accelORD = AUTOSAR4.Signal(SwCalibrationAccess="ReadOnly", StorageClass="Global", MemorySection="VAR")
LongCtrl_accelSubjDesCorr = AUTOSAR4.Signal(SwCalibrationAccess="ReadOnly", StorageClass="Global", MemorySection="VAR")
LongCtrl_accelSubjDesRaw = AUTOSAR4.Signal(SwCalibrationAccess="ReadOnly", StorageClass="Global", MemorySection="VAR")
LongCtrl_accelSubjDesRawMatrix = AUTOSAR4.Signal(SwCalibrationAccess="ReadOnly", StorageClass="Global", MemorySection="VAR")
LongCtrl_accelSubjPlan = AUTOSAR4.Signal(SwCalibrationAccess="ReadOnly", StorageClass="Global", MemorySection="VAR")
LongCtrl_accelSubjPlanK1 = AUTOSAR4.Signal(SwCalibrationAccess="ReadOnly", StorageClass="Global", MemorySection="VAR")
LongCtrl_accelSubjPlanK1Matrix = AUTOSAR4.Signal(SwCalibrationAccess="ReadOnly", StorageClass="Global", MemorySection="VAR")
LongCtrl_accelSubjPlanOpt = AUTOSAR4.Signal(SwCalibrationAccess="ReadOnly", StorageClass="Global", MemorySection="VAR")
LongCtrl_accelSupressionEnable = AUTOSAR4.Signal(SwCalibrationAccess="ReadOnly", StorageClass="Global", MemorySection="VAR")
LongCtrl_accelTargAbsEnable = AUTOSAR4.Signal(SwCalibrationAccess="ReadOnly", StorageClass="Global", MemorySection="VAR")
LongCtrl_accelTargAbsFilt = AUTOSAR4.Signal(SwCalibrationAccess="ReadOnly", StorageClass="Global", MemorySection="VAR")
LongCtrl_asum = AUTOSAR4.Signal(SwCalibrationAccess="ReadOnly", StorageClass="Global", MemorySection="VAR")
LongCtrl_axvFollow = AUTOSAR4.Signal(SwCalibrationAccess="ReadOnly", StorageClass="Global", MemorySection="VAR")
LongCtrl_coefCurvatureNoC3 = AUTOSAR4.Signal(SwCalibrationAccess="ReadOnly", StorageClass="Global", MemorySection="VAR")
LongCtrl_coefCurvatureWithC3 = AUTOSAR4.Signal(SwCalibrationAccess="ReadOnly", StorageClass="Global", MemorySection="VAR")
LongCtrl_coefJEnlarge = AUTOSAR4.Signal(SwCalibrationAccess="ReadOnly", StorageClass="Global", MemorySection="VAR")
LongCtrl_coefStandstillOverride = AUTOSAR4.Signal(SwCalibrationAccess="ReadOnly", StorageClass="Global", MemorySection="VAR")
LongCtrl_coefVelDist2AccelStartUp = AUTOSAR4.Signal(SwCalibrationAccess="ReadOnly", StorageClass="Global", MemorySection="VAR")
LongCtrl_curvatureForCurveDecel = AUTOSAR4.Signal(SwCalibrationAccess="ReadOnly", StorageClass="Global", MemorySection="VAR")
LongCtrl_curvatureForCurveDecelRaw = AUTOSAR4.Signal(SwCalibrationAccess="ReadOnly", StorageClass="Global", MemorySection="VAR")
LongCtrl_curvatureNoC3 = AUTOSAR4.Signal(SwCalibrationAccess="ReadOnly", StorageClass="Global", MemorySection="VAR")
LongCtrl_curvatureWithC3 = AUTOSAR4.Signal(SwCalibrationAccess="ReadOnly", StorageClass="Global", MemorySection="VAR")
LongCtrl_dangerLevel = AUTOSAR4.Signal(SwCalibrationAccess="ReadOnly", StorageClass="Global", MemorySection="VAR")
LongCtrl_distAccelSupressionEnter = AUTOSAR4.Signal(SwCalibrationAccess="ReadOnly", StorageClass="Global", MemorySection="VAR")
LongCtrl_distAccelSupressionExit = AUTOSAR4.Signal(SwCalibrationAccess="ReadOnly", StorageClass="Global", MemorySection="VAR")
LongCtrl_distDesCur = AUTOSAR4.Signal(SwCalibrationAccess="ReadOnly", StorageClass="Global", MemorySection="VAR")
LongCtrl_distDesCurvatureMap = AUTOSAR4.Signal(SwCalibrationAccess="ReadOnly", StorageClass="Global", MemorySection="VAR")
LongCtrl_distDesPlan = AUTOSAR4.Signal(SwCalibrationAccess="ReadOnly", StorageClass="Global", MemorySection="VAR", Unit="m")
LongCtrl_distDesPlanCorr = AUTOSAR4.Signal(SwCalibrationAccess="ReadOnly", StorageClass="Global", MemorySection="VAR")
LongCtrl_distRelDesDistRelPlanNumMin = AUTOSAR4.Signal(SwCalibrationAccess="ReadOnly", StorageClass="Global", MemorySection="VAR")
LongCtrl_distRelPlanMin = AUTOSAR4.Signal(SwCalibrationAccess="ReadOnly", StorageClass="Global", MemorySection="VAR")
LongCtrl_distRelPlanMinIndex = AUTOSAR4.Signal(SwCalibrationAccess="ReadOnly", StorageClass="Global", MemorySection="VAR")
LongCtrl_distRelPlanNumMin = AUTOSAR4.Signal(SwCalibrationAccess="ReadOnly", StorageClass="Global", MemorySection="VAR")
LongCtrl_distRelPlanOpt = AUTOSAR4.Signal(SwCalibrationAccess="ReadOnly", StorageClass="Global", MemorySection="VAR")
LongCtrl_distRelPlanTerminate = AUTOSAR4.Signal(SwCalibrationAccess="ReadOnly", StorageClass="Global", MemorySection="VAR", Unit="m")
LongCtrl_fastDecel = AUTOSAR4.Signal(SwCalibrationAccess="ReadOnly", StorageClass="Global", MemorySection="VAR")
LongCtrl_followAccel_Plau = AUTOSAR4.Signal(SwCalibrationAccess="ReadOnly", StorageClass="Global", MemorySection="VAR", Unit="m/s^2")
LongCtrl_jerkForceStop = AUTOSAR4.Signal(SwCalibrationAccess="ReadOnly", StorageClass="Global", MemorySection="VAR")
LongCtrl_kapFilt = AUTOSAR4.Signal(SwCalibrationAccess="ReadOnly", StorageClass="Global", MemorySection="VAR")
LongCtrl_laneChangeEnable = AUTOSAR4.Signal(SwCalibrationAccess="ReadOnly", StorageClass="Global", MemorySection="VAR")
LongCtrl_lowerBandAL = AUTOSAR4.Signal(SwCalibrationAccess="ReadOnly", StorageClass="Global", MemorySection="VAR")
LongCtrl_lowerBandArb = AUTOSAR4.Signal(SwCalibrationAccess="ReadOnly", StorageClass="Global", MemorySection="VAR")
LongCtrl_lowerBandCC = AUTOSAR4.Signal(SwCalibrationAccess="ReadOnly", StorageClass="Global", MemorySection="VAR")
LongCtrl_lowerBandFollow = AUTOSAR4.Signal(SwCalibrationAccess="ReadOnly", StorageClass="Global", MemorySection="VAR")
LongCtrl_lowerBandIC = AUTOSAR4.Signal(SwCalibrationAccess="ReadOnly", StorageClass="Global", MemorySection="VAR")
LongCtrl_lowerJerkAL = AUTOSAR4.Signal(SwCalibrationAccess="ReadOnly", StorageClass="Global", MemorySection="VAR")
LongCtrl_lowerJerkArb = AUTOSAR4.Signal(SwCalibrationAccess="ReadOnly", StorageClass="Global", MemorySection="VAR")
LongCtrl_lowerJerkCC = AUTOSAR4.Signal(SwCalibrationAccess="ReadOnly", StorageClass="Global", MemorySection="VAR")
LongCtrl_lowerJerkFollow = AUTOSAR4.Signal(SwCalibrationAccess="ReadOnly", StorageClass="Global", MemorySection="VAR")
LongCtrl_lowerJerkIC = AUTOSAR4.Signal(SwCalibrationAccess="ReadOnly", StorageClass="Global", MemorySection="VAR")
LongCtrl_num = AUTOSAR4.Signal(SwCalibrationAccess="ReadOnly", StorageClass="Global", MemorySection="VAR")
LongCtrl_numK1 = AUTOSAR4.Signal(SwCalibrationAccess="ReadOnly", StorageClass="Global", MemorySection="VAR")
LongCtrl_numK1Matrix = AUTOSAR4.Signal(SwCalibrationAccess="ReadOnly", StorageClass="Global", MemorySection="VAR")
LongCtrl_numMatrix = AUTOSAR4.Signal(SwCalibrationAccess="ReadOnly", StorageClass="Global", MemorySection="VAR")
LongCtrl_numRaw = AUTOSAR4.Signal(SwCalibrationAccess="ReadOnly", StorageClass="Global", MemorySection="VAR")
LongCtrl_numRawMatrix = AUTOSAR4.Signal(SwCalibrationAccess="ReadOnly", StorageClass="Global", MemorySection="VAR")
LongCtrl_quickDecel = AUTOSAR4.Signal(SwCalibrationAccess="ReadOnly", StorageClass="Global", MemorySection="VAR")
LongCtrl_slopeStartupAssist = AUTOSAR4.Signal(SwCalibrationAccess="ReadOnly", StorageClass="Global", MemorySection="VAR")
LongCtrl_spdSetValueDurLCAccel = AUTOSAR4.Signal(SwCalibrationAccess="ReadOnly", StorageClass="Global", MemorySection="VAR")
LongCtrl_standstillOverrideCondition = AUTOSAR4.Signal(SwCalibrationAccess="ReadOnly", StorageClass="Global", MemorySection="VAR")
LongCtrl_tOverride2ActiveK1 = AUTOSAR4.Signal(SwCalibrationAccess="ReadOnly", StorageClass="Global", MemorySection="VAR")
LongCtrl_tOverride2ActiveK1Matrix = AUTOSAR4.Signal(SwCalibrationAccess="ReadOnly", StorageClass="Global", MemorySection="VAR")
LongCtrl_tStartDecel = AUTOSAR4.Signal(SwCalibrationAccess="ReadOnly", StorageClass="Global", MemorySection="VAR")
LongCtrl_tor = AUTOSAR4.Signal(SwCalibrationAccess="ReadOnly", StorageClass="Global", MemorySection="VAR")
LongCtrl_upperBandAL = AUTOSAR4.Signal(SwCalibrationAccess="ReadOnly", StorageClass="Global", MemorySection="VAR")
LongCtrl_upperBandArb = AUTOSAR4.Signal(SwCalibrationAccess="ReadOnly", StorageClass="Global", MemorySection="VAR")
LongCtrl_upperBandCC = AUTOSAR4.Signal(SwCalibrationAccess="ReadOnly", StorageClass="Global", MemorySection="VAR")
LongCtrl_upperBandFollow = AUTOSAR4.Signal(SwCalibrationAccess="ReadOnly", StorageClass="Global", MemorySection="VAR")
LongCtrl_upperBandIC = AUTOSAR4.Signal(SwCalibrationAccess="ReadOnly", StorageClass="Global", MemorySection="VAR")
LongCtrl_upperJerkAL = AUTOSAR4.Signal(SwCalibrationAccess="ReadOnly", StorageClass="Global", MemorySection="VAR")
LongCtrl_upperJerkArb = AUTOSAR4.Signal(SwCalibrationAccess="ReadOnly", StorageClass="Global", MemorySection="VAR")
LongCtrl_upperJerkCC = AUTOSAR4.Signal(SwCalibrationAccess="ReadOnly", StorageClass="Global", MemorySection="VAR")
LongCtrl_upperJerkFollow = AUTOSAR4.Signal(SwCalibrationAccess="ReadOnly", StorageClass="Global", MemorySection="VAR")
LongCtrl_upperJerkIC = AUTOSAR4.Signal(SwCalibrationAccess="ReadOnly", StorageClass="Global", MemorySection="VAR")
LongCtrl_velPlanRelOpt = AUTOSAR4.Signal(SwCalibrationAccess="ReadOnly", StorageClass="Global", MemorySection="VAR")
LongCtrl_velSubjPlanArb = AUTOSAR4.Signal(SwCalibrationAccess="ReadOnly", StorageClass="Global", MemorySection="VAR")
LongCtrl_velSubjPlanCC = AUTOSAR4.Signal(SwCalibrationAccess="ReadOnly", StorageClass="Global", MemorySection="VAR", DataType="single")
LongCtrl_velSubjPlanFollow = AUTOSAR4.Signal(SwCalibrationAccess="ReadOnly", StorageClass="Global", MemorySection="VAR", DataType="single")
LongCtrl_velSubjPlanOpt = AUTOSAR4.Signal(SwCalibrationAccess="ReadOnly", StorageClass="Global", MemorySection="VAR")
LongCtrl_velSubjThresEnableStopAdd = AUTOSAR4.Signal(SwCalibrationAccess="ReadOnly", StorageClass="Global", MemorySection="VAR")
LongCtrl_velSubjThresForceStop = AUTOSAR4.Signal(SwCalibrationAccess="ReadOnly", StorageClass="Global", MemorySection="VAR")
LongCtrl_velSubjThresForceStopStationaryTarget = AUTOSAR4.Signal(SwCalibrationAccess="ReadOnly", StorageClass="Global", MemorySection="VAR")
LongCtrl_velTargAbsPlanTerminate = AUTOSAR4.Signal(SwCalibrationAccess="ReadOnly", StorageClass="Global", MemorySection="VAR")
PLAN_AP_SubModel_Number = AUTOSAR4.Signal(SwCalibrationAccess="ReadOnly", StorageClass="Global", MemorySection="VAR")
PLAN_AP_SubModel_VERSION = AUTOSAR4.Signal(SwCalibrationAccess="ReadOnly", StorageClass="Global", MemorySection="VAR")
P_PLAN_ALC_tMinCC = AUTOSAR4.Parameter(150, SwCalibrationAccess="ReadWrite", StorageClass="Global", MemorySection="CAL", DataType="uint8")  % 请求换道最少要求巡航保持时间，实际执行时间为标定量*模型调用周期
P_LongCtrl_ICKapLimitSpdXAxis = AUTOSAR4.Parameter(single([0 0.0005 0.001 0.001428 0.002 0.003333 0.005 0.01 0.02 0.05 0.1 0.2]), SwCalibrationAccess="ReadWrite", StorageClass="Global", MemorySection="CAL", Min=0, Max=1)
P_LongCtrl_ICKapLimitSpdYAxis = AUTOSAR4.Parameter(single([150 150 150 150 150 112 70 49 39 30.12 21.3 15.06]), SwCalibrationAccess="ReadWrite", StorageClass="Global", MemorySection="CAL", Min=0, Max=150)
P_LongCtrl_ICtDecel = AUTOSAR4.Parameter(3, SwCalibrationAccess="ReadWrite", StorageClass="Global", MemorySection="CAL", DataType="single", Min=2, Max=10, Unit="s")
P_vVehGeoCalcnOfCrvt_CSC = AUTOSAR4.Parameter(1, SwCalibrationAccess="ReadWrite", StorageClass="Global", MemorySection="CAL", DataType="single")  % 请求换道最少要求巡航保持时间，实际执行时间为标定量*模型调用周期
P_vVehDynAckCalcnOfCrvt_CSC = AUTOSAR4.Parameter(2, SwCalibrationAccess="ReadWrite", StorageClass="Global", MemorySection="CAL", DataType="single")  % 请求换道最少要求巡航保持时间，实际执行时间为标定量*模型调用周期
P_FacUseVGi_CSC_X = AUTOSAR4.Parameter([0 0.03125 0.0507 0.078], SwCalibrationAccess="ReadWrite", StorageClass="Global", MemorySection="CAL", DataType="single")  % 请求换道最少要求巡航保持时间，实际执行时间为标定量*模型调用周期
P_FacUseVGi_CSC_Y = AUTOSAR4.Parameter([1 1 0.7 0.5], SwCalibrationAccess="ReadWrite", StorageClass="Global", MemorySection="CAL", DataType="single")  % 请求换道最少要求巡航保持时间，实际执行时间为标定量*模型调用周期
P_TauforPredCrvt_CSC_X = AUTOSAR4.Parameter([0 10 20 30 40], SwCalibrationAccess="ReadWrite", StorageClass="Global", MemorySection="CAL", DataType="single")  % 请求换道最少要求巡航保持时间，实际执行时间为标定量*模型调用周期
P_TauforPredCrvt_CSC_Y = AUTOSAR4.Parameter([0.35 0.35 0.28 0.1 0], SwCalibrationAccess="ReadWrite", StorageClass="Global", MemorySection="CAL", DataType="single")  % 请求换道最少要求巡航保持时间，实际执行时间为标定量*模型调用周期
P_CharTauPSCAxCtrl_X = AUTOSAR4.Parameter([2.7 15], SwCalibrationAccess="ReadWrite", StorageClass="Global", MemorySection="CAL", DataType="single")  % 请求换道最少要求巡航保持时间，实际执行时间为标定量*模型调用周期
P_vChar = AUTOSAR4.Parameter(22, SwCalibrationAccess="ReadWrite", StorageClass="Global", MemorySection="CAL", DataType="single")  % 请求换道最少要求巡航保持时间，实际执行时间为标定量*模型调用周期
P_CharTauPSCAxCtrl_Y = AUTOSAR4.Parameter([4 6], SwCalibrationAccess="ReadWrite", StorageClass="Global", MemorySection="CAL", DataType="single")  % 请求换道最少要求巡航保持时间，实际执行时间为标定量*模型调用周期
P_LongCtrl_CCtAcceleTimePosCorrXAxis = AUTOSAR4.Parameter(single([0 1 1.5 2]), SwCalibrationAccess="ReadWrite", StorageClass="Global", MemorySection="CAL", Min=0, Max=5, Unit="m/s")
P_pSCayMax_NORMAL_X = AUTOSAR4.Parameter(single([0 5 15 25 35]), SwCalibrationAccess="ReadWrite", StorageClass="Global", MemorySection="CAL")  % 请求换道最少要求巡航保持时间，实际执行时间为标定量*模型调用周期
P_LongCtrl_CCtAcceleTimePosCorrYAxis = AUTOSAR4.Parameter(single([1 0.76 0.6 0.4]), SwCalibrationAccess="ReadWrite", StorageClass="Global", MemorySection="CAL", Min=0, Max=1)
P_pSCayMax_NORMAL_Y = AUTOSAR4.Parameter(single([6 5 3 0.75 0.5]), SwCalibrationAccess="ReadWrite", StorageClass="Global", MemorySection="CAL")  % 请求换道最少要求巡航保持时间，实际执行时间为标定量*模型调用周期
P_LongCtrl_DistDesRelChgX = AUTOSAR4.Parameter(single([0 1 1.5 2 2.5 4 8 12 15 18 22 25 28 30 40 60]), SwCalibrationAccess="ReadWrite", StorageClass="Global", MemorySection="CAL")  % m/s
P_LongCtrl_DistDesRelChgY = AUTOSAR4.Parameter(single([0 2.33 2.88 4.66 5.638 8.36 13.416 15.55 18.08 22 25 29 35 35 35 35]), SwCalibrationAccess="ReadWrite", StorageClass="Global", MemorySection="CAL")  % m
P_LongCtrl_CCtAcceleTimeNegCorrYAxis = AUTOSAR4.Parameter(single([2.8 2.5 2.2 1.8 1.44 1.07 0.7 0.5 0.5]), SwCalibrationAccess="ReadWrite", StorageClass="Global", MemorySection="CAL", Min=0, Max=5)
P_LongCtrl_FollowcoefAccelFadeOutPlauCheck = AUTOSAR4.Parameter(0.4, SwCalibrationAccess="ReadWrite", StorageClass="Global", MemorySection="CAL", DataType="single", Min=0, Max=1)
P_LongCtrl_FollowjerkForceStopCharYAxis = AUTOSAR4.Parameter([-0.02 -0.02 -0.025], SwCalibrationAccess="ReadWrite", StorageClass="Global", MemorySection="CAL", DataType="single", Min=-5, Max=0, Unit="m/s^3")
P_LongCtrl_CCtAcceleTimeNegCorrXAxis = AUTOSAR4.Parameter(single([-11.11 -9.72 -8.33 -6.94 -5.55 -4.17 -2.78 -1.39 0]), SwCalibrationAccess="ReadWrite", StorageClass="Global", MemorySection="CAL", Min=-30, Max=0, Unit="m/s")
P_LongCtrl_CCaccelCCNeg2PosJerk = AUTOSAR4.Parameter(2, SwCalibrationAccess="ReadWrite", StorageClass="Global", MemorySection="CAL", DataType="single", Min=0, Max=100, Unit="m/s^3")
P_LongCtrl_CCaccelCCPosJerk = AUTOSAR4.Parameter(1, SwCalibrationAccess="ReadWrite", StorageClass="Global", MemorySection="CAL", DataType="single", Min=0, Max=100, Unit="m/s^3")
P_LongCtrl_CCdecelCCJerk = AUTOSAR4.Parameter(-2, SwCalibrationAccess="ReadWrite", StorageClass="Global", MemorySection="CAL", DataType="single", Min=-100, Max=0, Unit="m/s^3")
P_LongCtrl_CCdecelCCJerkNegVLCInternalAcc = AUTOSAR4.Parameter(-1, SwCalibrationAccess="ReadWrite", StorageClass="Global", MemorySection="CAL", DataType="single", Min=-100, Max=0, Unit="m/s^3")
P_LongCtrl_FollowgapThresActiveTOR = AUTOSAR4.Parameter(2, SwCalibrationAccess="ReadWrite", StorageClass="Global", MemorySection="CAL", DataType="single", Min=0, Max=10, Unit="s")
P_LongCtrl_FollowVelCharAccelJerkXAxis = AUTOSAR4.Parameter(single([0 1 2 3 5 7 9 10 30]), SwCalibrationAccess="ReadWrite", StorageClass="Global", MemorySection="CAL", Min=0, Max=60, Unit="m/s")
P_LongCtrl_FollowJerkCharAccelJerkYAxis = AUTOSAR4.Parameter(single([4 3.67 3.46 3.26 2.63 2.2 1.5 1 1]), SwCalibrationAccess="ReadWrite", StorageClass="Global", MemorySection="CAL", Min=0, Max=5, Unit="m/s^3")
P_LongCtrl_IClowerJerkICCharXAxis = AUTOSAR4.Parameter(single([-3 -2.5 -2 -1.5 -1 -0.5 0]), SwCalibrationAccess="ReadWrite", StorageClass="Global", MemorySection="CAL", Min=-5, Max=2, Unit="m/s^2")
P_LongCtrl_IClowerJerkICCharYAxis = AUTOSAR4.Parameter(single([-3 -2.6697 -2.2189 -1.7681 -1.2863 -0.5557 -0.081606]), SwCalibrationAccess="ReadWrite", StorageClass="Global", MemorySection="CAL", Min=-5, Max=0, Unit="m/s^3")
LongCtrl_AP_IN_IP_VehSpdDisp = AUTOSAR4.Signal(SwCalibrationAccess="ReadOnly", StorageClass="Global", MemorySection="VAR")
LongCtrl_AP_IN_SteerWheelAng = AUTOSAR4.Signal(SwCalibrationAccess="ReadOnly", StorageClass="Global", MemorySection="VAR")