% Simulink data dictionary PvtParsTOS_10_dop.sldd

P_TOS_dop_DeleRearTrgPoint_Dis_Value = AUTOSAR4.Parameter(-20, SwCalibrationAccess="ReadWrite", StorageClass="Global", MemorySection="CAL", DataType="single")
P_TOS_dop_EgoFrontDxThre_110_Val = AUTOSAR4.Parameter(130, SwCalibrationAccess="ReadWrite", StorageClass="Global", MemorySection="CAL", DataType="single")
P_TOS_dop_EgoFrontDxThre_120_Val = AUTOSAR4.Parameter(140, SwCalibrationAccess="ReadWrite", StorageClass="Global", MemorySection="CAL", DataType="single")
P_TOS_dop_EgoFrontDxThre_70_Val = AUTOSAR4.Parameter(70, SwCalibrationAccess="ReadWrite", StorageClass="Global", MemorySection="CAL", DataType="single")
P_TOS_dop_EgoFrontDxThre_90_Val = AUTOSAR4.Parameter(110, SwCalibrationAccess="ReadWrite", StorageClass="Global", MemorySection="CAL", DataType="single")
P_TOS_dop_EgoFrontDxThre_95_Val = AUTOSAR4.Parameter(95, SwCalibrationAccess="ReadWrite", StorageClass="Global", MemorySection="CAL", DataType="single")
P_TOS_dop_FenceTgtDyMinThre_Val = AUTOSAR4.Parameter(1.45, SwCalibrationAccess="ReadWrite", StorageClass="Global", MemorySection="CAL", DataType="single")
P_TOS_dop_FenceTgtObstProbThre_Val = AUTOSAR4.Parameter(0.85, SwCalibrationAccess="ReadWrite", StorageClass="Global", MemorySection="CAL", DataType="single")
P_TOS_dop_FusType_Front_Diff_dx = AUTOSAR4.Parameter(-0.5, SwCalibrationAccess="ReadWrite", StorageClass="Global", MemorySection="CAL", DataType="single")
P_TOS_dop_FusType_P0_ObjAge_K1 = AUTOSAR4.Parameter(120, SwCalibrationAccess="ReadWrite", StorageClass="Global", MemorySection="CAL", DataType="uint16")
P_TOS_dop_FusType_P0_dx_K1 = AUTOSAR4.Parameter(15, SwCalibrationAccess="ReadWrite", StorageClass="Global", MemorySection="CAL", DataType="single")
P_TOS_dop_FusType_Rear_Diff_dx = AUTOSAR4.Parameter(0.5, SwCalibrationAccess="ReadWrite", StorageClass="Global", MemorySection="CAL", DataType="single")
P_TOS_dop_FusType_vxvRefMs = AUTOSAR4.Parameter(4.16, SwCalibrationAccess="ReadWrite", StorageClass="Global", MemorySection="CAL", DataType="single")
P_TOS_dop_LongVyThre_Val = AUTOSAR4.Parameter(2, SwCalibrationAccess="ReadWrite", StorageClass="Global", MemorySection="CAL", DataType="single")
P_TOS_dop_ObjInSameDirYawAngMaxThre_Val = AUTOSAR4.Parameter(45, SwCalibrationAccess="ReadWrite", StorageClass="Global", MemorySection="CAL", DataType="single")
P_TOS_dop_ObjLatCroYawAngMaxThre_Val = AUTOSAR4.Parameter(135, SwCalibrationAccess="ReadWrite", StorageClass="Global", MemorySection="CAL", DataType="single")
P_TOS_dop_ObjectMovingOrientation_E_SameDir_Threshold = AUTOSAR4.Parameter(-2, SwCalibrationAccess="ReadWrite", StorageClass="Global", MemorySection="CAL", DataType="single")
P_TOS_dop_P0P1_Car_Confirm_dx = AUTOSAR4.Parameter([0 20 40 60 80 100], SwCalibrationAccess="ReadWrite", StorageClass="Global", MemorySection="CAL", DataType="single")
P_TOS_dop_P0P1_Car_Confirm_dy = AUTOSAR4.Parameter([2.3 2.3 2.3 2.2 2.2 2.2], SwCalibrationAccess="ReadWrite", StorageClass="Global", MemorySection="CAL", DataType="single")
P_TOS_dop_P0P1_Car_Pre_dx = AUTOSAR4.Parameter([0 20 40 60 80 100], SwCalibrationAccess="ReadWrite", StorageClass="Global", MemorySection="CAL", DataType="single")
P_TOS_dop_P0P1_Car_Pre_dy = AUTOSAR4.Parameter([2.3 2.3 2.3 2.2 2.2 2.2], SwCalibrationAccess="ReadWrite", StorageClass="Global", MemorySection="CAL", DataType="single")
P_TOS_dop_P0P1_Curvature_val = AUTOSAR4.Parameter(0.0004, SwCalibrationAccess="ReadWrite", StorageClass="Global", MemorySection="CAL", DataType="single")
P_TOS_dop_P0P1_FRSplitTarget_dx_LowLimit = AUTOSAR4.Parameter(-5.5, SwCalibrationAccess="ReadWrite", StorageClass="Global", MemorySection="CAL", DataType="single")
P_TOS_dop_P0P1_FRSplitTarget_dx_UperLimit = AUTOSAR4.Parameter(1, SwCalibrationAccess="ReadWrite", StorageClass="Global", MemorySection="CAL", DataType="single")
P_TOS_dop_P0P1_TargetInFrontEgoVehicle_OverlapThre_Val = AUTOSAR4.Parameter(0.05, SwCalibrationAccess="ReadWrite", StorageClass="Global", MemorySection="CAL", DataType="single")
P_TOS_dop_P0P1_TargetPre_OverlapThre_Val = AUTOSAR4.Parameter(0.05, SwCalibrationAccess="ReadWrite", StorageClass="Global", MemorySection="CAL", DataType="single")
P_TOS_dop_P0P1_TargetPre_Truck_OverlapThre_Val = AUTOSAR4.Parameter(0, SwCalibrationAccess="ReadWrite", StorageClass="Global", MemorySection="CAL", DataType="single")
P_TOS_dop_P0P1_Truck_Confirm_dx = AUTOSAR4.Parameter([0 20 40 60 80 100], SwCalibrationAccess="ReadWrite", StorageClass="Global", MemorySection="CAL", DataType="single")
P_TOS_dop_P0P1_Truck_Confirm_dy = AUTOSAR4.Parameter([2.3 2.3 2.3 2.2 2.2 2.2], SwCalibrationAccess="ReadWrite", StorageClass="Global", MemorySection="CAL", DataType="single")
P_TOS_dop_P0P1_Truck_Pre_dx = AUTOSAR4.Parameter([0 20 40 60 80 100], SwCalibrationAccess="ReadWrite", StorageClass="Global", MemorySection="CAL", DataType="single")
P_TOS_dop_P0P1_Truck_Pre_dy = AUTOSAR4.Parameter([2.3 2.3 2.3 2.2 2.2 2.2], SwCalibrationAccess="ReadWrite", StorageClass="Global", MemorySection="CAL", DataType="single")
P_TOS_dop_P0P1_dx_Value = AUTOSAR4.Parameter(80, SwCalibrationAccess="ReadWrite", StorageClass="Global", MemorySection="CAL", DataType="single")
P_TOS_dop_P0P1_dyCutIn_SteerWheelAng_val = AUTOSAR4.Parameter(10, SwCalibrationAccess="ReadWrite", StorageClass="Global", MemorySection="CAL", DataType="single")
P_TOS_dop_P0P1_dyCutIn_dx_UperLimit = AUTOSAR4.Parameter(40, SwCalibrationAccess="ReadWrite", StorageClass="Global", MemorySection="CAL", DataType="single")
P_TOS_dop_P0P1_dyCutIn_dy_UperLimit = AUTOSAR4.Parameter(0.7, SwCalibrationAccess="ReadWrite", StorageClass="Global", MemorySection="CAL", DataType="single")
P_TOS_dop_P0P1_dyCutIn_vxvRefMs_val = AUTOSAR4.Parameter(23.6, SwCalibrationAccess="ReadWrite", StorageClass="Global", MemorySection="CAL", DataType="single")
P_TOS_dop_P0P1_vy_Value = AUTOSAR4.Parameter(0.58, SwCalibrationAccess="ReadWrite", StorageClass="Global", MemorySection="CAL", DataType="single")
P_TOS_dop_P0_Counter_val = AUTOSAR4.Parameter(30, SwCalibrationAccess="ReadWrite", StorageClass="Global", MemorySection="CAL", DataType="uint32")
P_TOS_dop_P0_DisDxThreshold_m = AUTOSAR4.Parameter(7, SwCalibrationAccess="ReadWrite", StorageClass="Global", MemorySection="CAL", DataType="single")
P_TOS_dop_P0_FRSplit_ObstacleProbThre_Valu = AUTOSAR4.Parameter(0.3, SwCalibrationAccess="ReadWrite", StorageClass="Global", MemorySection="CAL", DataType="single")
P_TOS_dop_P0_ObstacleProbThre_Valu = AUTOSAR4.Parameter(0.4, SwCalibrationAccess="ReadWrite", StorageClass="Global", MemorySection="CAL", DataType="single")
P_TOS_dop_P0_SteerWheelAngMax_Val = AUTOSAR4.Parameter(115, SwCalibrationAccess="ReadWrite", StorageClass="Global", MemorySection="CAL", DataType="single")
P_TOS_dop_P0_SteerWheelSpdMax_Val = AUTOSAR4.Parameter(110, SwCalibrationAccess="ReadWrite", StorageClass="Global", MemorySection="CAL")
P_TOS_dop_P0_TargetOverlapThre_Val = AUTOSAR4.Parameter(0.15, SwCalibrationAccess="ReadWrite", StorageClass="Global", MemorySection="CAL", DataType="single")
P_TOS_dop_P1_ObstacleProbThre_Valu = AUTOSAR4.Parameter(0.4, SwCalibrationAccess="ReadWrite", StorageClass="Global", MemorySection="CAL", DataType="single")
P_TOS_dop_ParkingDyCfmDxThre_Val = AUTOSAR4.Parameter(35, SwCalibrationAccess="ReadWrite", StorageClass="Global", MemorySection="CAL", DataType="single")
P_TOS_dop_ParkingDyCfmDyThre_Val = AUTOSAR4.Parameter(1.45, SwCalibrationAccess="ReadWrite", StorageClass="Global", MemorySection="CAL", DataType="single")
P_TOS_dop_ParkingDyCfmEgoSpdThre_Val = AUTOSAR4.Parameter(1.5, SwCalibrationAccess="ReadWrite", StorageClass="Global", MemorySection="CAL", DataType="single")
P_TOS_dop_ParkingDyCfmOvlpThre_Val = AUTOSAR4.Parameter(0.45, SwCalibrationAccess="ReadWrite", StorageClass="Global", MemorySection="CAL", DataType="single")
P_TOS_dop_ParkingDyCfmSWAngThre_Val = AUTOSAR4.Parameter(6, SwCalibrationAccess="ReadWrite", StorageClass="Global", MemorySection="CAL", DataType="single")
P_TOS_dop_RefPoint_dx_m = AUTOSAR4.Parameter(0, SwCalibrationAccess="ReadWrite", StorageClass="Global", MemorySection="CAL", DataType="single")
P_TOS_dop_SameDirVxvOffset_Val = AUTOSAR4.Parameter(1, SwCalibrationAccess="ReadWrite", StorageClass="Global", MemorySection="CAL", DataType="single")
P_TOS_dop_SameDirVyOffset_Val = AUTOSAR4.Parameter(2, SwCalibrationAccess="ReadWrite", StorageClass="Global", MemorySection="CAL", DataType="single")
P_TOS_dop_SysCycTime_Val = AUTOSAR4.Parameter(0.05, SwCalibrationAccess="ReadWrite", StorageClass="Global", MemorySection="CAL", DataType="single")
P_TOS_dop_TargetDxConfirm_EgoVelocity_70_Threshold = AUTOSAR4.Parameter(19.5, SwCalibrationAccess="ReadWrite", StorageClass="Global", MemorySection="CAL", DataType="single")
P_TOS_dop_TrgStateJudge_Spd_Value = AUTOSAR4.Parameter(0.6, SwCalibrationAccess="ReadWrite", StorageClass="Global", MemorySection="CAL", DataType="single")
P_TOS_dop_VySameDirAbsThre_Val = AUTOSAR4.Parameter(2.5, SwCalibrationAccess="ReadWrite", StorageClass="Global", MemorySection="CAL", DataType="single")
P_TOS_dop_P0P1_TargetPre_dy_Car_OverlapThre_Val = AUTOSAR4.Parameter(0.5, SwCalibrationAccess="ReadWrite", StorageClass="Global", MemorySection="CAL", DataType="single")
P_TOS_dop_P0P1_TargetPre_dy_Truck_OverlapThre_Val = AUTOSAR4.Parameter(0.5, SwCalibrationAccess="ReadWrite", StorageClass="Global", MemorySection="CAL", DataType="single")
P_TOS_dop_VxvRefMs_Val = AUTOSAR4.Parameter(0.466, SwCalibrationAccess="ReadWrite", StorageClass="Global", MemorySection="CAL", DataType="single")
P_dop_OTL_Range_Val = AUTOSAR4.Parameter(10, SwCalibrationAccess="ReadWrite", StorageClass="Global", MemorySection="CAL", DataType="single")
P_TOS_dop_P0_abs_vx = AUTOSAR4.Parameter(2.3, SwCalibrationAccess="ReadWrite", StorageClass="Global", MemorySection="CAL", DataType="single")
P_TOS_dop_Objdy_error = AUTOSAR4.Parameter(0.8, SwCalibrationAccess="ReadWrite", StorageClass="Global", MemorySection="CAL", DataType="single")
P_TOS_dop_P0_counter = AUTOSAR4.Parameter(20, SwCalibrationAccess="ReadWrite", StorageClass="Global", MemorySection="CAL", DataType="uint32")

P_TOS_Dop_Trj_Switch = AUTOSAR4.Parameter(2, SwCalibrationAccess="ReadWrite", StorageClass="Global", MemorySection="CAL", DataType="single")  % 2开启：跟停轨迹不输出优化
  % 1关闭：跟停轨迹不输出优化

P_TOS_dop_P0ID_Confirm = AUTOSAR4.Parameter(3, SwCalibrationAccess="ReadWrite", StorageClass="Global", MemorySection="CAL", DataType="uint8")  % 0: 原始值
  % 1：P0目标跳变，不在使用P0目标；（1s内目标跳回原值，直接输出，大于1s输出当前目标）
  % 2：P0目标跳变，使用P0目标；（1s内目标跳回原值，直接输出，大于1s输出当前目标）
  % 3：P0目标跳变，（1s内目标跳回原值，直接输出，若目标频繁跳变仍用P0；大于ID不变1S输出当前值）

TOS_DOPTraj_d_End = AUTOSAR4.Signal(SwCalibrationAccess="ReadOnly", StorageClass="Global", MemorySection="VAR", DataType="single")
TOS_DOPTraj_d_Start = AUTOSAR4.Signal(SwCalibrationAccess="ReadOnly", StorageClass="Global", MemorySection="VAR", DataType="single")
TOS_DOP_TrgCounter = AUTOSAR4.Signal(SwCalibrationAccess="ReadOnly", StorageClass="Global", MemorySection="VAR", DataType="uint32")
TOS_DOP_TrgValidConfirm = AUTOSAR4.Signal(SwCalibrationAccess="ReadOnly", StorageClass="Global", MemorySection="VAR", DataType="uint8")
TOS_dop_P0P1_Pre = AUTOSAR4.Signal(SwCalibrationAccess="ReadOnly", StorageClass="Global", MemorySection="VAR")
TOS_dop_P0_P1_Index = AUTOSAR4.Signal(SwCalibrationAccess="ReadOnly", StorageClass="Global", MemorySection="VAR", DataType="uint8")
TOS_10_dop_SW_VERSION = AUTOSAR4.Signal(SwCalibrationAccess="ReadOnly", StorageClass="Global", MemorySection="VAR", DataType="uint32")