% Simulink data dictionary PvtParsTOS_2_PP.sldd

P_TOS_PP_Objvyc_DeclineLimit = AUTOSAR4.Parameter(0.2, SwCalibrationAccess="ReadWrite", StorageClass="Global", MemorySection="CAL", DataType="single")
P_TOS_PP_Objvyc_UpperLimit = AUTOSAR4.Parameter(0.35, SwCalibrationAccess="ReadWrite", StorageClass="Global", MemorySection="CAL", DataType="single")
P_TOS_PP_TruckSplitDetaDxLowLmt_Val = AUTOSAR4.Parameter(-20, SwCalibrationAccess="ReadWrite", StorageClass="Global", MemorySection="CAL", DataType="single")
P_TOS_PP_TruckSplitDetaDxUpLmt_Val = AUTOSAR4.Parameter(10, SwCalibrationAccess="ReadWrite", StorageClass="Global", MemorySection="CAL", DataType="single")
P_TOS_PP_ObjFusType_Counter1 = AUTOSAR4.Parameter(1, SwCalibrationAccess="ReadWrite", StorageClass="Global", MemorySection="CAL", DataType="uint16")
P_TOS_PP_ObjFusType_Counter2 = AUTOSAR4.Parameter(3, SwCalibrationAccess="ReadWrite", StorageClass="Global", MemorySection="CAL", DataType="uint16")
P_TOS_PP_ObjFusType_Counter_K1 = AUTOSAR4.Parameter(40, SwCalibrationAccess="ReadWrite", StorageClass="Global", MemorySection="CAL", DataType="uint16")
P_TOS_PP_TAP_ObstacleProbThre_Valu = AUTOSAR4.Parameter(0.4, SwCalibrationAccess="ReadWrite", StorageClass="Global", MemorySection="CAL", DataType="single")
P_TOS_PP_TAP_ExistProbThre_Valu = AUTOSAR4.Parameter(0.5, SwCalibrationAccess="ReadWrite", StorageClass="Global", MemorySection="CAL", DataType="single")
P_TOS_PP_RE_NebrNearTargetDyThre_Val = AUTOSAR4.Parameter(0.5, SwCalibrationAccess="ReadWrite", StorageClass="Global", MemorySection="CAL", DataType="single")
P_TOS_PP_RE_ApartNearTargetDyThre_Val = AUTOSAR4.Parameter(0.5, SwCalibrationAccess="ReadWrite", StorageClass="Global", MemorySection="CAL", DataType="single")
P_TOS_PP_RE_NebrNearTargetDxThre_Val = AUTOSAR4.Parameter(5, SwCalibrationAccess="ReadWrite", StorageClass="Global", MemorySection="CAL", DataType="single")
P_TOS_PP_RE_ApartNearTargetDxThre_Val = AUTOSAR4.Parameter(8, SwCalibrationAccess="ReadWrite", StorageClass="Global", MemorySection="CAL", DataType="single")
P_TOS_PP_RE_TargetDxMaxVal_m = AUTOSAR4.Parameter(200, SwCalibrationAccess="ReadWrite", StorageClass="Global", MemorySection="CAL", DataType="single")
P_TOS_PP_RE_TargetDxMinVal_m = AUTOSAR4.Parameter(0, SwCalibrationAccess="ReadWrite", StorageClass="Global", MemorySection="CAL", DataType="single")
P_TOS_PP_RE_TargetDyMaxVal_m = AUTOSAR4.Parameter(20, SwCalibrationAccess="ReadWrite", StorageClass="Global", MemorySection="CAL", DataType="single")
P_TOS_PP_RE_TargetDyMinVal_m = AUTOSAR4.Parameter(0.5, SwCalibrationAccess="ReadWrite", StorageClass="Global", MemorySection="CAL", DataType="single")
P_TOS_PP_RE_TargetDxStdMaxVal = AUTOSAR4.Parameter(12.5, SwCalibrationAccess="ReadWrite", StorageClass="Global", MemorySection="CAL", DataType="single")
P_TOS_PP_RE_TargetDyStdMaxVal = AUTOSAR4.Parameter(12.5, SwCalibrationAccess="ReadWrite", StorageClass="Global", MemorySection="CAL", DataType="single")
P_TOS_PP_RE_ExistProbThre_val = AUTOSAR4.Parameter(0.4, SwCalibrationAccess="ReadWrite", StorageClass="Global", MemorySection="CAL", DataType="single")
P_TOS_PP_RE_stateProlongationTime = AUTOSAR4.Parameter(0.2, SwCalibrationAccess="ReadWrite", StorageClass="Global", MemorySection="CAL", DataType="single")
P_TOS_PP_RE_Ts = AUTOSAR4.Parameter(0.05, SwCalibrationAccess="ReadWrite", StorageClass="Global", MemorySection="CAL", DataType="single")
P_TOS_PP_TAP_ObstacleProb_LowValu = AUTOSAR4.Parameter(0.3, SwCalibrationAccess="ReadWrite", StorageClass="Global", MemorySection="CAL", DataType="single")
P_TOS_RE_StrightDirThetaMin_val = AUTOSAR4.Parameter(-1.8, SwCalibrationAccess="ReadWrite", StorageClass="Global", MemorySection="CAL", DataType="single")
P_TOS_RE_StrightDirThetaMax_val = AUTOSAR4.Parameter(1.8, SwCalibrationAccess="ReadWrite", StorageClass="Global", MemorySection="CAL", DataType="single")
P_TOS_RE_SameDirTargetChainDyThre_Val = AUTOSAR4.Parameter(3, SwCalibrationAccess="ReadWrite", StorageClass="Global", MemorySection="CAL", DataType="single")
P_TOS_RE_SameDirTargetChainDxThre_Val = AUTOSAR4.Parameter(40, SwCalibrationAccess="ReadWrite", StorageClass="Global", MemorySection="CAL", DataType="single")
P_TOS_RE_RoadEdgeGroupEgoVxvThre_Val = AUTOSAR4.Parameter(16, SwCalibrationAccess="ReadWrite", StorageClass="Global", MemorySection="CAL", DataType="single")
P_TOS_RE_RoadEdgeGroupDy_LowSpeedThre_Val = AUTOSAR4.Parameter(6, SwCalibrationAccess="ReadWrite", StorageClass="Global", MemorySection="CAL", DataType="single")
P_TOS_RE_RoadEdgeGroupDy_HighSpeedThre_Val = AUTOSAR4.Parameter(10, SwCalibrationAccess="ReadWrite", StorageClass="Global", MemorySection="CAL", DataType="single")
P_TOS_RE_RoadEdgeGroupDxThre_Val = AUTOSAR4.Parameter(35, SwCalibrationAccess="ReadWrite", StorageClass="Global", MemorySection="CAL", DataType="single")
P_TOS_RE_REE3TargetThetaMin_Val = AUTOSAR4.Parameter(-22, SwCalibrationAccess="ReadWrite", StorageClass="Global", MemorySection="CAL", DataType="single")
P_TOS_RE_REE3TargetThetaMax_Val = AUTOSAR4.Parameter(22, SwCalibrationAccess="ReadWrite", StorageClass="Global", MemorySection="CAL", DataType="single")
P_TOS_RE_LowSpeedREE4TargetThetaMinOut_Val = AUTOSAR4.Parameter(-12, SwCalibrationAccess="ReadWrite", StorageClass="Global", MemorySection="CAL", DataType="single")
P_TOS_RE_LowSpeedREE4TargetThetaMin_Val = AUTOSAR4.Parameter(-11, SwCalibrationAccess="ReadWrite", StorageClass="Global", MemorySection="CAL", DataType="single")
P_TOS_RE_LowSpeedREE4TargetThetaMaxOut_Val = AUTOSAR4.Parameter(12, SwCalibrationAccess="ReadWrite", StorageClass="Global", MemorySection="CAL", DataType="single")
P_TOS_RE_LowSpeedREE4TargetThetaMax_Val = AUTOSAR4.Parameter(11, SwCalibrationAccess="ReadWrite", StorageClass="Global", MemorySection="CAL", DataType="single")
P_TOS_RE_HighSpeedREE4TargetThetaMinOut_Val = AUTOSAR4.Parameter(-10, SwCalibrationAccess="ReadWrite", StorageClass="Global", MemorySection="CAL", DataType="single")
P_TOS_RE_HighSpeedREE4TargetThetaMin_Val = AUTOSAR4.Parameter(-8, SwCalibrationAccess="ReadWrite", StorageClass="Global", MemorySection="CAL", DataType="single")
P_TOS_RE_HighSpeedREE4TargetThetaMaxOut_Val = AUTOSAR4.Parameter(10, SwCalibrationAccess="ReadWrite", StorageClass="Global", MemorySection="CAL", DataType="single")
P_TOS_RE_HighSpeedREE4TargetThetaMax_Val = AUTOSAR4.Parameter(8, SwCalibrationAccess="ReadWrite", StorageClass="Global", MemorySection="CAL", DataType="single")
P_TOS_RE_DiffDirTargetChainDyThre_Val = AUTOSAR4.Parameter(1, SwCalibrationAccess="ReadWrite", StorageClass="Global", MemorySection="CAL", DataType="single")
P_TOS_RE_DiffDirTargetChainDxThre_Val = AUTOSAR4.Parameter(40, SwCalibrationAccess="ReadWrite", StorageClass="Global", MemorySection="CAL", DataType="single")
P_TOS_PP_TunnelObjectCfmFRVxabsThre_val = AUTOSAR4.Parameter(0.2, SwCalibrationAccess="ReadWrite", StorageClass="Global", MemorySection="CAL", DataType="single")
P_TOS_PP_TunnelObjectCfmFRObstMinThre_val = AUTOSAR4.Parameter(0.1, SwCalibrationAccess="ReadWrite", StorageClass="Global", MemorySection="CAL", DataType="single")
P_TOS_PP_FCObjectConfirmDyThre_val = AUTOSAR4.Parameter(1, SwCalibrationAccess="ReadWrite", StorageClass="Global", MemorySection="CAL", DataType="single")
P_TOS_PP_FCObjectConfirmVyThre_val = AUTOSAR4.Parameter(1.5, SwCalibrationAccess="ReadWrite", StorageClass="Global", MemorySection="CAL", DataType="single")
P_TOS_PP_FCObjectConfirmFDxThre_val = AUTOSAR4.Parameter(-10, SwCalibrationAccess="ReadWrite", StorageClass="Global", MemorySection="CAL", DataType="single")
P_TOS_PP_FCObjectConfirmRDxThre_val = AUTOSAR4.Parameter(3, SwCalibrationAccess="ReadWrite", StorageClass="Global", MemorySection="CAL", DataType="single")
P_TOS_PP_TunnelObjectCfmFRObstMaxThre_val = AUTOSAR4.Parameter(0.28, SwCalibrationAccess="ReadWrite", StorageClass="Global", MemorySection="CAL", DataType="single")

P_TOS_PP_FC_ObjectValidFlag_Switch = AUTOSAR4.Parameter(0, SwCalibrationAccess="ReadWrite", StorageClass="Global", MemorySection="CAL", DataType="boolean")  % FC虚假目标；
  % P_TOS_PP_FC_ObjectValidFlag_Switch =1 开启;FC虚假目标过滤
  % P_TOS_PP_FC_ObjectValidFlag_Switch =0 关闭;FC虚假目标过滤

P_TOS_PP_Tunnel_ObjectConfirm_Switch = AUTOSAR4.Parameter(0, SwCalibrationAccess="ReadWrite", StorageClass="Global", MemorySection="CAL", DataType="boolean")  % 隧道虚假融合目标；
  % P_TOS_PP_Tunnel_ObjectConfirm =1 开启;隧道虚假目标过滤
  % P_TOS_PP_Tunnel_ObjectConfirm =0 关闭;隧道虚假目标过滤

P_PP_TruckSplit_vxvRefMs_min_Val = AUTOSAR4.Parameter(12.5, SwCalibrationAccess="ReadWrite", StorageClass="Global", MemorySection="CAL")
P_TOS_PP_TruckSplitDetaDyThre_max_Val = AUTOSAR4.Parameter(4.2, SwCalibrationAccess="ReadWrite", StorageClass="Global", MemorySection="CAL", DataType="single")
P_TOS_PP_TruckSplitDetaDyThre_min_Val = AUTOSAR4.Parameter(-4.2, SwCalibrationAccess="ReadWrite", StorageClass="Global", MemorySection="CAL", DataType="single")
P_TOS_PP_TruckSplitDetaDyThre_Val = AUTOSAR4.Parameter(4.2, SwCalibrationAccess="ReadWrite", StorageClass="Global", MemorySection="CAL", DataType="single")
P_TOS_PP_TruckSplit_DisThreshold_Table_Val = AUTOSAR4.Parameter([3 3 9 9], SwCalibrationAccess="ReadWrite", StorageClass="Global", MemorySection="CAL")
P_TOS_PP_TruckSplit_dx_Table_Val = AUTOSAR4.Parameter([30 45 120 130], SwCalibrationAccess="ReadWrite", StorageClass="Global", MemorySection="CAL")
P_TOS_PP_TruckSplit_SteerWheelAng_Val = AUTOSAR4.Parameter(10, SwCalibrationAccess="ReadWrite", StorageClass="Global", MemorySection="CAL", DataType="single")
P_TOS_PP_TruckSplit_dx_Val = AUTOSAR4.Parameter(50, SwCalibrationAccess="ReadWrite", StorageClass="Global", MemorySection="CAL", DataType="single")
P_TOS_PP_TruckSplit_dy_Val = AUTOSAR4.Parameter(1.7, SwCalibrationAccess="ReadWrite", StorageClass="Global", MemorySection="CAL", DataType="single")
P_TOS_PP_TruckSplit_vxvRefMs_Val = AUTOSAR4.Parameter(12.5, SwCalibrationAccess="ReadWrite", StorageClass="Global", MemorySection="CAL", DataType="single")
TOS_PP_OFM_ObjValid_Flag = AUTOSAR4.Signal(SwCalibrationAccess="ReadOnly", StorageClass="Global", MemorySection="VAR", DataType="boolean")  % 目标预处理，目标是否有效标志位
TOS_PP_LeftLaneWidth = AUTOSAR4.Signal(SwCalibrationAccess="ReadOnly", StorageClass="Global", MemorySection="VAR", DataType="single")
TOS_PP_SameLaneWidth = AUTOSAR4.Signal(SwCalibrationAccess="ReadOnly", StorageClass="Global", MemorySection="VAR", DataType="single")
TOS_PP_RightLaneWidth = AUTOSAR4.Signal(SwCalibrationAccess="ReadOnly", StorageClass="Global", MemorySection="VAR", DataType="single")
TOS_PP_LM_LeftLane_Vaild = AUTOSAR4.Signal(SwCalibrationAccess="ReadOnly", StorageClass="Global", MemorySection="VAR", DataType="boolean")
TOS_PP_LM_RightLane_Vaild = AUTOSAR4.Signal(SwCalibrationAccess="ReadOnly", StorageClass="Global", MemorySection="VAR", DataType="boolean")
TOS_PP_LM_Length_Vaild = AUTOSAR4.Signal(SwCalibrationAccess="ReadOnly", StorageClass="Global", MemorySection="VAR", DataType="boolean")
TOS_PP_ObjectToCenterLine_Vyc = AUTOSAR4.Signal(SwCalibrationAccess="ReadOnly", StorageClass="Global", MemorySection="VAR", DataType="single")
TOS_PP_ObjectToCenterLine_dy = AUTOSAR4.Signal(SwCalibrationAccess="ReadOnly", StorageClass="Global", MemorySection="VAR", DataType="single")
TOS_PP_EgoVehCenterLine_dy = AUTOSAR4.Signal(SwCalibrationAccess="ReadOnly", StorageClass="Global", MemorySection="VAR", DataType="single")
TOS_PP_RoadEdge = AUTOSAR4.Signal(SwCalibrationAccess="ReadOnly", StorageClass="Global", MemorySection="VAR", DataType="uint8")
TOS_2_PP_SW_VERSION = AUTOSAR4.Signal(SwCalibrationAccess="ReadOnly", StorageClass="Global", MemorySection="VAR", DataType="uint32")