% Simulink data dictionary PvtParsTOS_3_PIL.sldd

P_TOS_PIL_BasicLaneWidth_Bicycle_MinVal = AUTOSAR4.Parameter(2.2, SwCalibrationAccess="ReadWrite", StorageClass="Global", MemorySection="CAL", DataType="single")  % 自行车目标基础道路宽度 // 2.2
P_TOS_PIL_BasicLaneWidth_CAR_MinVal = AUTOSAR4.Parameter(2.5, SwCalibrationAccess="ReadWrite", StorageClass="Global", MemorySection="CAL", DataType="single")  % 车辆目标基础道路宽度 // 2.5m
P_TOS_PIL_BasicLaneWidth_OthertType_MinVal = AUTOSAR4.Parameter(2, SwCalibrationAccess="ReadWrite", StorageClass="Global", MemorySection="CAL", DataType="single")  % 其他类型目标基础道路宽度 // 2.4 m
P_TOS_PIL_BasicLaneWidth_Pedestrian_MinVal = AUTOSAR4.Parameter(2, SwCalibrationAccess="ReadWrite", StorageClass="Global", MemorySection="CAL", DataType="single")  % 行人目标基础道路宽度 // 2
P_TOS_PIL_BasicLaneWidth_StillObj_MinVal = AUTOSAR4.Parameter(1.9, SwCalibrationAccess="ReadWrite", StorageClass="Global", MemorySection="CAL", DataType="single")  % 静态物体目标基础道路宽度 // 1.9 m
P_TOS_PIL_CutInMaxPredictDis_Val = AUTOSAR4.Parameter(110, SwCalibrationAccess="ReadWrite", StorageClass="Global", MemorySection="CAL", DataType="single")  % 目标与本车之间最大 dx距离 ；判断cut in 区间
P_TOS_PIL_CutInMaxPredictTime_Val = AUTOSAR4.Parameter(1.35, SwCalibrationAccess="ReadWrite", StorageClass="Global", MemorySection="CAL", DataType="single")  % cut in 预测时间 最长 1.6 s
P_TOS_PIL_CutInMaxPredict_dy_Val = AUTOSAR4.Parameter(1.2, SwCalibrationAccess="ReadWrite", StorageClass="Global", MemorySection="CAL", DataType="single")  % cut in 横向 dy 最大预测距离 0.7 m
P_TOS_PIL_CutInMinPredictDis_Val = AUTOSAR4.Parameter(3.93, SwCalibrationAccess="ReadWrite", StorageClass="Global", MemorySection="CAL", DataType="single")  % 目标与本车之间最小 dx距离 ；判断cut in 区间
P_TOS_PIL_CutInMinPredictTime_Val = AUTOSAR4.Parameter(1.35, SwCalibrationAccess="ReadWrite", StorageClass="Global", MemorySection="CAL", DataType="single")  % 目标非 cut in 时；预测时间 0
P_TOS_PIL_CutInMinPredict_dy_Val = AUTOSAR4.Parameter(0, SwCalibrationAccess="ReadWrite", StorageClass="Global", MemorySection="CAL", DataType="single")  % cut in 横向 dy 最小预测距离 0
P_TOS_PIL_CutInPluseDecreaseRate_Val = AUTOSAR4.Parameter(0.2, SwCalibrationAccess="ReadWrite", StorageClass="Global", MemorySection="CAL", DataType="single")  % cunin 本车都目标概率下降 速率约束
P_TOS_PIL_CutInPluseUpperRate_Val = AUTOSAR4.Parameter(0.7, SwCalibrationAccess="ReadWrite", StorageClass="Global", MemorySection="CAL", DataType="single")  % 判断 cut in 可能性时，概率值上升累加速率约束
P_TOS_PIL_CutIn_ObjectToCenterLine_Leftdy_Con = AUTOSAR4.Parameter(0.1, SwCalibrationAccess="ReadWrite", StorageClass="Global", MemorySection="CAL", DataType="single")  % 滤波后 ObjectToCenterLine_dy_Filt 与 ObjectToCenterLine_dy差值 > 0.2
P_TOS_PIL_CutIn_ObjectToCenterLine_Rightdy_Con = AUTOSAR4.Parameter(-0.1, SwCalibrationAccess="ReadWrite", StorageClass="Global", MemorySection="CAL", DataType="single")  % 滤波后 ObjectToCenterLine_dy_Filt 与 ObjectToCenterLine_dy差值 < -0.2
P_TOS_PIL_CutOutMaxPredictDis_Val = AUTOSAR4.Parameter(110, SwCalibrationAccess="ReadWrite", StorageClass="Global", MemorySection="CAL", DataType="single")  % 判断目标 cut out 最远距离 110 m
P_TOS_PIL_CutOutMaxPredictTime_Val = AUTOSAR4.Parameter(1, SwCalibrationAccess="ReadWrite", StorageClass="Global", MemorySection="CAL", DataType="single")  % 目标 cut out预测最长时间 1s
P_TOS_PIL_CutOutMaxPredict_LatDis_Val = AUTOSAR4.Parameter(2.8, SwCalibrationAccess="ReadWrite", StorageClass="Global", MemorySection="CAL", DataType="single")  % cut  out 目标最大横向预测距离2.8m
P_TOS_PIL_CutOutMaxPredict_dy_Val = AUTOSAR4.Parameter(2.8, SwCalibrationAccess="ReadWrite", StorageClass="Global", MemorySection="CAL", DataType="single")  % cut out 横向 dy 最大预测距离 2.8 m(1.5~2.8范围内预测cut out)
P_TOS_PIL_CutOutMinPredictDis_Val = AUTOSAR4.Parameter(3.93, SwCalibrationAccess="ReadWrite", StorageClass="Global", MemorySection="CAL", DataType="single")  % 目标与本车之间最小 dx距离 ；判断cut out 区间
P_TOS_PIL_CutOutMinPredictTime_Val = AUTOSAR4.Parameter(0, SwCalibrationAccess="ReadWrite", StorageClass="Global", MemorySection="CAL", DataType="single")  % 目标 cut out预测最短时间 0s
P_TOS_PIL_CutOutMinPredict_dy_Val = AUTOSAR4.Parameter(1.5, SwCalibrationAccess="ReadWrite", StorageClass="Global", MemorySection="CAL", DataType="single")  % cut out 横向 dy 最小预测距离 1.5 m
P_TOS_PIL_CutOutPluseDecreaseRate_Val = AUTOSAR4.Parameter(0.1, SwCalibrationAccess="ReadWrite", StorageClass="Global", MemorySection="CAL", DataType="single")  % 判断 cut out可能性时，概率值累加下降速率约束
P_TOS_PIL_CutOutPluseUpperRate_Val = AUTOSAR4.Parameter(0.1, SwCalibrationAccess="ReadWrite", StorageClass="Global", MemorySection="CAL", DataType="single")  % 判断 cut out可能性时，概率值累加上升速率约束
P_TOS_PIL_CutOut_ObjectToCenterLine_Leftdy_Con = AUTOSAR4.Parameter(0.1, SwCalibrationAccess="ReadWrite", StorageClass="Global", MemorySection="CAL", DataType="single")  % 滤波后 ObjectToCenterLine_dy_Filt 与 ObjectToCenterLine_dy差值 > 0.2
P_TOS_PIL_CutOut_ObjectToCenterLine_Rightdy_Con = AUTOSAR4.Parameter(-0.1, SwCalibrationAccess="ReadWrite", StorageClass="Global", MemorySection="CAL", DataType="single")  % 滤波后 ObjectToCenterLine_dy_Filt 与 ObjectToCenterLine_dy差值 < -0.2
P_TOS_PIL_CutinObjectToCenterLine_dy_Val = AUTOSAR4.Parameter(0.1, SwCalibrationAccess="ReadWrite", StorageClass="Global", MemorySection="CAL", DataType="single")  % cut in 本车道目标与车道中心线之间距离
P_TOS_PIL_CutinObjvyThre_CarTruck_Val = AUTOSAR4.Parameter(0.06, SwCalibrationAccess="ReadWrite", StorageClass="Global", MemorySection="CAL", DataType="single")  % 车辆横向切入最小速度阈值 0.1 m/s
P_TOS_PIL_CutinObjvyThre_Val = AUTOSAR4.Parameter(0.06, SwCalibrationAccess="ReadWrite", StorageClass="Global", MemorySection="CAL", DataType="single")  % 目标沿道路经向，横向切入速度阈值
P_TOS_PIL_CutoutBoundaryToCenterLine_Val = AUTOSAR4.Parameter(0.1, SwCalibrationAccess="ReadWrite", StorageClass="Global", MemorySection="CAL", DataType="single")  % 目标cut out时，目标边界与车道中心线之间 横向距离阈值（0.1 m）
P_TOS_PIL_CutoutObjvyThre = AUTOSAR4.Parameter(0.3, SwCalibrationAccess="ReadWrite", StorageClass="Global", MemorySection="CAL", DataType="single")  % cut out 目标横向速度均值
P_TOS_PIL_CutoutObjvyThre_NegativeVal = AUTOSAR4.Parameter(0, SwCalibrationAccess="ReadWrite", StorageClass="Global", MemorySection="CAL", DataType="single")
P_TOS_PIL_CutoutObjvyThre_Val = AUTOSAR4.Parameter(0, SwCalibrationAccess="ReadWrite", StorageClass="Global", MemorySection="CAL", DataType="single")
P_TOS_PIL_ObjCutInObject_DY_Val = AUTOSAR4.Parameter(2.4, SwCalibrationAccess="ReadWrite", StorageClass="Global", MemorySection="CAL", DataType="single")  % 判断目标切入横向 dy 最远距离（调节cutin 范围）
P_TOS_PIL_ObjCutIn_Age_Count = AUTOSAR4.Parameter([5 5 10 10], SwCalibrationAccess="ReadWrite", StorageClass="Global", MemorySection="CAL", DataType="single")
P_TOS_PIL_ObjCutIn_Age_ObjVx_val = AUTOSAR4.Parameter([-10 -5 2 5], SwCalibrationAccess="ReadWrite", StorageClass="Global", MemorySection="CAL", DataType="single")
P_TOS_PIL_ObjCutIn_LM_fCamAge = AUTOSAR4.Parameter(10, SwCalibrationAccess="ReadWrite", StorageClass="Global", MemorySection="CAL", DataType="uint32")
P_TOS_PIL_ObjCutIn_ResetTime_cyc = AUTOSAR4.Parameter(100, SwCalibrationAccess="ReadWrite", StorageClass="Global", MemorySection="CAL", DataType="uint8")
P_TOS_PIL_ObjCutIn_checkTime_cyc = AUTOSAR4.Parameter(40, SwCalibrationAccess="ReadWrite", StorageClass="Global", MemorySection="CAL", DataType="uint8")
P_TOS_PIL_ObjCutIn_dy_MaxValue = AUTOSAR4.Parameter(2.9, SwCalibrationAccess="ReadWrite", StorageClass="Global", MemorySection="CAL", DataType="single")
P_TOS_PIL_ObjCutIn_dy_MinValue = AUTOSAR4.Parameter(1, SwCalibrationAccess="ReadWrite", StorageClass="Global", MemorySection="CAL", DataType="single")
P_TOS_PIL_ObjCutOutProb_Val = AUTOSAR4.Parameter(0.7, SwCalibrationAccess="ReadWrite", StorageClass="Global", MemorySection="CAL", DataType="single")  % 目标切出 可能性概率值 0.7
P_TOS_PIL_ObjWidthThreshold_Overlap_Val = AUTOSAR4.Parameter(0.4, SwCalibrationAccess="ReadWrite", StorageClass="Global", MemorySection="CAL", DataType="single")
P_TOS_PIL_Object2LeftCenterLine_dy_DeclineLimit = AUTOSAR4.Parameter(0.2, SwCalibrationAccess="ReadWrite", StorageClass="Global", MemorySection="CAL", DataType="single")
P_TOS_PIL_Object2LeftCenterLine_dy_UpperLimit = AUTOSAR4.Parameter(0.35, SwCalibrationAccess="ReadWrite", StorageClass="Global", MemorySection="CAL", DataType="single")
P_TOS_PIL_Object2RightCenterLine_dy_DeclineLimit = AUTOSAR4.Parameter(0.2, SwCalibrationAccess="ReadWrite", StorageClass="Global", MemorySection="CAL", DataType="single")
P_TOS_PIL_Object2RightCenterLine_dy_UpperLimit = AUTOSAR4.Parameter(0.35, SwCalibrationAccess="ReadWrite", StorageClass="Global", MemorySection="CAL", DataType="single")
P_TOS_PIL_Object2SameCenterLine_dy_DeclineLimit = AUTOSAR4.Parameter(0.2, SwCalibrationAccess="ReadWrite", StorageClass="Global", MemorySection="CAL", DataType="single")
P_TOS_PIL_Object2SameCenterLine_dy_UpperLimit = AUTOSAR4.Parameter(0.35, SwCalibrationAccess="ReadWrite", StorageClass="Global", MemorySection="CAL", DataType="single")
P_TOS_PIL_OverlapEgoWidthMO = AUTOSAR4.Parameter(1, SwCalibrationAccess="ReadWrite", StorageClass="Global", MemorySection="CAL", DataType="single")
P_TOS_PIL_OverlapEgoWidthSO = AUTOSAR4.Parameter(0.5, SwCalibrationAccess="ReadWrite", StorageClass="Global", MemorySection="CAL", DataType="single")
P_TOS_PIL_ObjCutIn_near_Age_Count = AUTOSAR4.Parameter([2 2 4 4], SwCalibrationAccess="ReadWrite", StorageClass="Global", MemorySection="CAL", DataType="single")
TOS_PIL_EgoVehiclePro_Bus = AUTOSAR4.Signal(SwCalibrationAccess="ReadOnly", StorageClass="Global", MemorySection="VAR")
TOS_PIL_LeftLaneProb_Filt = AUTOSAR4.Signal(SwCalibrationAccess="ReadOnly", StorageClass="Global", MemorySection="VAR", DataType="single")
TOS_PIL_ObjectCutInPro_Filt = AUTOSAR4.Signal(SwCalibrationAccess="ReadOnly", StorageClass="Global", MemorySection="VAR", DataType="single")
TOS_PIL_ObjectCutIn_Flag = AUTOSAR4.Signal(SwCalibrationAccess="ReadOnly", StorageClass="Global", MemorySection="VAR", DataType="boolean")
TOS_PIL_ObjectCutOutPro_Filt = AUTOSAR4.Signal(SwCalibrationAccess="ReadOnly", StorageClass="Global", MemorySection="VAR", DataType="single")
TOS_PIL_ObjectCutOut_Flag = AUTOSAR4.Signal(SwCalibrationAccess="ReadOnly", StorageClass="Global", MemorySection="VAR", DataType="boolean")
TOS_PIL_OverlapRatio = AUTOSAR4.Signal(SwCalibrationAccess="ReadOnly", StorageClass="Global", MemorySection="VAR", DataType="single")
TOS_PIL_RightLaneProb_Filt = AUTOSAR4.Signal(SwCalibrationAccess="ReadOnly", StorageClass="Global", MemorySection="VAR", DataType="single")
TOS_PIL_SameLanePro_Filt = AUTOSAR4.Signal(SwCalibrationAccess="ReadOnly", StorageClass="Global", MemorySection="VAR", DataType="single")
TOS_3_PIL_SW_VERSION = AUTOSAR4.Signal(SwCalibrationAccess="ReadOnly", StorageClass="Global", MemorySection="VAR", DataType="uint32")

P_TOS_PIL_ObjCutIn_Near_Switch = AUTOSAR4.Parameter(1, SwCalibrationAccess="ReadWrite", StorageClass="Global", MemorySection="CAL", DataType="single")  % 高速近距离切入参数调节开关
  % 1：原始参数开关
  % 2：高速近距离切入优化参数开关

P_TOS_PIL_RightCutIn_Vy_Val = AUTOSAR4.Parameter(-0.3, SwCalibrationAccess="ReadWrite", StorageClass="Global", MemorySection="CAL", DataType="single")
P_TOS_PIL_LeftCutIn_Vy_Val = AUTOSAR4.Parameter(0.3, SwCalibrationAccess="ReadWrite", StorageClass="Global", MemorySection="CAL", DataType="single")
P_TOS_PIL_LeftCutIn_Vy_ResetVal = AUTOSAR4.Parameter(0.2, SwCalibrationAccess="ReadWrite", StorageClass="Global", MemorySection="CAL", DataType="single")
P_TOS_PIL_RightCutIn_Vy_ResetVal = AUTOSAR4.Parameter(-0.2, SwCalibrationAccess="ReadWrite", StorageClass="Global", MemorySection="CAL", DataType="single")