% Simulink data dictionary PvtParsTOS_4_TLJ.sldd

P_TOS_TLJ_EgoInLeftlaneProb_Val = AUTOSAR4.Parameter(0.3, SwCalibrationAccess="ReadWrite", StorageClass="Global", MemorySection="CAL", DataType="single")  % 自车在左车道概率 0.3
P_TOS_TLJ_EgoInMiddlelaneProb_Val = AUTOSAR4.Parameter(0.3, SwCalibrationAccess="ReadWrite", StorageClass="Global", MemorySection="CAL", DataType="single")  % 自车在本车道概率 0.3
P_TOS_TLJ_EgoInRightlaneProb_Val = AUTOSAR4.Parameter(0.3, SwCalibrationAccess="ReadWrite", StorageClass="Global", MemorySection="CAL", DataType="single")  % 自车在右车道概率 0.3
P_TOS_TLJ_ObjInLeftlaneProb_Val = AUTOSAR4.Parameter(0.2, SwCalibrationAccess="ReadWrite", StorageClass="Global", MemorySection="CAL", DataType="single")  % 目标在左车道概率 0.3
P_TOS_TLJ_ObjInRightlaneProb_Val = AUTOSAR4.Parameter(0.2, SwCalibrationAccess="ReadWrite", StorageClass="Global", MemorySection="CAL", DataType="single")  % 目标在右车道概率 0.3
P_TOS_TLJ_ObjinRightLane_Prob_Val = AUTOSAR4.Parameter(0.35, SwCalibrationAccess="ReadWrite", StorageClass="Global", MemorySection="CAL", DataType="single")
P_TOS_TLJ_ObjinLeftLane_Prob_Val = AUTOSAR4.Parameter(0.35, SwCalibrationAccess="ReadWrite", StorageClass="Global", MemorySection="CAL", DataType="single")
P_TOS_TLJ_ObjinEgoLaneProb_Val = AUTOSAR4.Parameter(0.2, SwCalibrationAccess="ReadWrite", StorageClass="Global", MemorySection="CAL", DataType="single")  % 目标在自车道概率 0.3
P_TOS_TLJ_ObjinEgoLane_Prob_Val = AUTOSAR4.Parameter(0.4, SwCalibrationAccess="ReadWrite", StorageClass="Global", MemorySection="CAL", DataType="single")  % 目标在自车道概率 0.3
TOS_TLJ_LeftLane_Prob = AUTOSAR4.Signal(SwCalibrationAccess="ReadOnly", StorageClass="Global", MemorySection="VAR", DataType="single")
TOS_TLJ_LeftLane_flag = AUTOSAR4.Signal(SwCalibrationAccess="ReadOnly", StorageClass="Global", MemorySection="VAR", DataType="boolean")
TOS_TLJ_ObjInLane_Flag = AUTOSAR4.Signal(SwCalibrationAccess="ReadOnly", StorageClass="Global", MemorySection="VAR", DataType="uint8")
TOS_TLJ_RightLane_Prob = AUTOSAR4.Signal(SwCalibrationAccess="ReadOnly", StorageClass="Global", MemorySection="VAR", DataType="single")
TOS_TLJ_RightLane_flag = AUTOSAR4.Signal(SwCalibrationAccess="ReadOnly", StorageClass="Global", MemorySection="VAR", DataType="boolean")
TOS_TLJ_SameLane_Prob = AUTOSAR4.Signal(SwCalibrationAccess="ReadOnly", StorageClass="Global", MemorySection="VAR", DataType="single")
TOS_TLJ_SameLane_flag = AUTOSAR4.Signal(SwCalibrationAccess="ReadOnly", StorageClass="Global", MemorySection="VAR", DataType="boolean")
TOS_4_TLJ_SW_VERSION = AUTOSAR4.Signal(SwCalibrationAccess="ReadOnly", StorageClass="Global", MemorySection="VAR", DataType="uint32")