% Simulink data dictionary PvtParsTOS_7_ACC.sldd

P_TOS_ACC_Curve_LM_fCamAge = AUTOSAR4.Parameter(5, SwCalibrationAccess="ReadWrite", StorageClass="Global", MemorySection="CAL", DataType="uint32")
P_TOS_ACC_Curve_vxvRefMsMax_val = AUTOSAR4.Parameter(120, SwCalibrationAccess="ReadWrite", StorageClass="Global", MemorySection="CAL", DataType="single")
P_TOS_ACC_Curve_vxvRefMsMin_val = AUTOSAR4.Parameter(1.5, SwCalibrationAccess="ReadWrite", StorageClass="Global", MemorySection="CAL", DataType="single")
P_TOS_ACC_CutIn_vxvRefMsMax_val = AUTOSAR4.Parameter(120, SwCalibrationAccess="ReadWrite", StorageClass="Global", MemorySection="CAL", DataType="single")
P_TOS_ACC_CutIn_vxvRefMsMin_val = AUTOSAR4.Parameter(1.5, SwCalibrationAccess="ReadWrite", StorageClass="Global", MemorySection="CAL", DataType="single")
P_TOS_ACC_EgoFrontDxThre_110_Val = AUTOSAR4.Parameter(130, SwCalibrationAccess="ReadWrite", StorageClass="Global", MemorySection="CAL", DataType="single")
P_TOS_ACC_EgoFrontDxThre_120_Val = AUTOSAR4.Parameter(140, SwCalibrationAccess="ReadWrite", StorageClass="Global", MemorySection="CAL", DataType="single")
P_TOS_ACC_EgoFrontDxThre_70_Val = AUTOSAR4.Parameter(70, SwCalibrationAccess="ReadWrite", StorageClass="Global", MemorySection="CAL", DataType="single")
P_TOS_ACC_EgoFrontDxThre_95_Val = AUTOSAR4.Parameter(95, SwCalibrationAccess="ReadWrite", StorageClass="Global", MemorySection="CAL", DataType="single")
P_TOS_ACC_FenceTgtDyMinThre_Val = AUTOSAR4.Parameter(1.45, SwCalibrationAccess="ReadWrite", StorageClass="Global", MemorySection="CAL", DataType="single")
P_TOS_ACC_FenceTgtObstProbThre_Val = AUTOSAR4.Parameter(0.85, SwCalibrationAccess="ReadWrite", StorageClass="Global", MemorySection="CAL", DataType="single")
P_TOS_ACC_FusType_Front_Diff_dx = AUTOSAR4.Parameter(-0.5, SwCalibrationAccess="ReadWrite", StorageClass="Global", MemorySection="CAL", DataType="single")
P_TOS_ACC_FusType_P0_ObjAge_K1 = AUTOSAR4.Parameter(120, SwCalibrationAccess="ReadWrite", StorageClass="Global", MemorySection="CAL", DataType="uint16")
P_TOS_ACC_FusType_P0_dx_K1 = AUTOSAR4.Parameter(15, SwCalibrationAccess="ReadWrite", StorageClass="Global", MemorySection="CAL", DataType="single")
P_TOS_ACC_FusType_Rear_Diff_dx = AUTOSAR4.Parameter(0.5, SwCalibrationAccess="ReadWrite", StorageClass="Global", MemorySection="CAL", DataType="single")
P_TOS_ACC_FusType_vxvRefMs = AUTOSAR4.Parameter(4.16, SwCalibrationAccess="ReadWrite", StorageClass="Global", MemorySection="CAL", DataType="single")
P_TOS_ACC_HightSpeed_TruckSplit_Front_Diff_dx = AUTOSAR4.Parameter(-1.35, SwCalibrationAccess="ReadWrite", StorageClass="Global", MemorySection="CAL", DataType="single")
P_TOS_ACC_HightSpeed_TruckSplit_P0_ObjAge_K1 = AUTOSAR4.Parameter(60, SwCalibrationAccess="ReadWrite", StorageClass="Global", MemorySection="CAL", DataType="uint16")
P_TOS_ACC_HightSpeed_TruckSplit_P0_dx_K1 = AUTOSAR4.Parameter(55, SwCalibrationAccess="ReadWrite", StorageClass="Global", MemorySection="CAL", DataType="single")
P_TOS_ACC_HightSpeed_TruckSplit_Rear_Diff_dx = AUTOSAR4.Parameter(1.35, SwCalibrationAccess="ReadWrite", StorageClass="Global", MemorySection="CAL", DataType="single")
P_TOS_ACC_HightSpeed_TruckSplit_vxvRefMs = AUTOSAR4.Parameter(16.7, SwCalibrationAccess="ReadWrite", StorageClass="Global", MemorySection="CAL", DataType="single")
P_TOS_ACC_LongVyThre_Val = AUTOSAR4.Parameter(2, SwCalibrationAccess="ReadWrite", StorageClass="Global", MemorySection="CAL", DataType="single")
P_TOS_ACC_ObjCutIn_SteerWheelAng_Value = AUTOSAR4.Parameter(5.8, SwCalibrationAccess="ReadWrite", StorageClass="Global", MemorySection="CAL", DataType="single")
P_TOS_ACC_ObjInSameDirYawAngMaxThre_Val = AUTOSAR4.Parameter(45, SwCalibrationAccess="ReadWrite", StorageClass="Global", MemorySection="CAL", DataType="single")
P_TOS_ACC_ObjLatCroYawAngMaxThre_Val = AUTOSAR4.Parameter(135, SwCalibrationAccess="ReadWrite", StorageClass="Global", MemorySection="CAL", DataType="single")
P_TOS_ACC_ObjectMovingOrientation_E_SameDir_Threshold = AUTOSAR4.Parameter(-2, SwCalibrationAccess="ReadWrite", StorageClass="Global", MemorySection="CAL", DataType="single")
P_TOS_ACC_P0P1_CutIn_EgoVehCenterLine_dy_NegativeValue = AUTOSAR4.Parameter(-0.5, SwCalibrationAccess="ReadWrite", StorageClass="Global", MemorySection="CAL", DataType="single")
P_TOS_ACC_P0P1_CutIn_EgoVehCenterLine_dy_Value = AUTOSAR4.Parameter(0.5, SwCalibrationAccess="ReadWrite", StorageClass="Global", MemorySection="CAL", DataType="single")
P_TOS_ACC_P0P1_CutIn_Truck_SameLaneWidth_MaxVal = AUTOSAR4.Parameter(0.1, SwCalibrationAccess="ReadWrite", StorageClass="Global", MemorySection="CAL", DataType="single")
P_TOS_ACC_P0P1_CutIn_Truck_SameLaneWidth_MinVal = AUTOSAR4.Parameter(0.2, SwCalibrationAccess="ReadWrite", StorageClass="Global", MemorySection="CAL", DataType="single")
P_TOS_ACC_P0P1_FRSplitTarget_dx_LowLimit = AUTOSAR4.Parameter(-5.5, SwCalibrationAccess="ReadWrite", StorageClass="Global", MemorySection="CAL", DataType="single")
P_TOS_ACC_P0P1_FRSplitTarget_dx_UperLimit = AUTOSAR4.Parameter(1, SwCalibrationAccess="ReadWrite", StorageClass="Global", MemorySection="CAL", DataType="single")
P_TOS_ACC_P0P1_Pre_Curve_LL_dx = AUTOSAR4.Parameter([0 20 40 60 80 100], SwCalibrationAccess="ReadWrite", StorageClass="Global", MemorySection="CAL", DataType="single")
P_TOS_ACC_P0P1_Pre_Curve_LL_dyc = AUTOSAR4.Parameter(repmat(1.55, 1, 6), SwCalibrationAccess="ReadWrite", StorageClass="Global", MemorySection="CAL", DataType="single")
P_TOS_ACC_P0P1_Pre_Curve_LR_dx = AUTOSAR4.Parameter([0 20 40 60 80 100], SwCalibrationAccess="ReadWrite", StorageClass="Global", MemorySection="CAL", DataType="single")
P_TOS_ACC_P0P1_Pre_Curve_LR_dyc = AUTOSAR4.Parameter(repmat(1.35, 1, 6), SwCalibrationAccess="ReadWrite", StorageClass="Global", MemorySection="CAL", DataType="single")
P_TOS_ACC_P0P1_Pre_Curve_RL_dx = AUTOSAR4.Parameter([0 20 40 60 80 100], SwCalibrationAccess="ReadWrite", StorageClass="Global", MemorySection="CAL", DataType="single")
P_TOS_ACC_P0P1_Pre_Curve_RL_dyc = AUTOSAR4.Parameter(repmat(1.35, 1, 6), SwCalibrationAccess="ReadWrite", StorageClass="Global", MemorySection="CAL", DataType="single")
P_TOS_ACC_P0P1_Pre_Curve_RR_dx = AUTOSAR4.Parameter([0 20 40 60 80 100], SwCalibrationAccess="ReadWrite", StorageClass="Global", MemorySection="CAL", DataType="single")
P_TOS_ACC_P0P1_Pre_Curve_RR_dyc = AUTOSAR4.Parameter(repmat(1.55, 1, 6), SwCalibrationAccess="ReadWrite", StorageClass="Global", MemorySection="CAL", DataType="single")
P_TOS_ACC_P0P1_Pre_Curve_SameLane_dx = AUTOSAR4.Parameter([0 20 40 60 80 100], SwCalibrationAccess="ReadWrite", StorageClass="Global", MemorySection="CAL", DataType="single")
P_TOS_ACC_P0P1_Pre_Curve_SameLane_dyc = AUTOSAR4.Parameter(repmat(1.45, 1, 6), SwCalibrationAccess="ReadWrite", StorageClass="Global", MemorySection="CAL", DataType="single")
P_TOS_ACC_P0P1_Pre_Curve_SteerWheelAng = AUTOSAR4.Parameter([85 85 25 25], SwCalibrationAccess="ReadWrite", StorageClass="Global", MemorySection="CAL", DataType="single")
P_TOS_ACC_P0P1_Pre_Curve_default_dx = AUTOSAR4.Parameter([0 20 40 60 80 100], SwCalibrationAccess="ReadWrite", StorageClass="Global", MemorySection="CAL", DataType="single")
P_TOS_ACC_P0P1_Pre_Curve_default_dyc = AUTOSAR4.Parameter(repmat(1.2, 1, 6), SwCalibrationAccess="ReadWrite", StorageClass="Global", MemorySection="CAL", DataType="single")
P_TOS_ACC_P0P1_Pre_Curve_vxvRefMs = AUTOSAR4.Parameter([0 11.2 26.3 27.7], SwCalibrationAccess="ReadWrite", StorageClass="Global", MemorySection="CAL", DataType="single")
P_TOS_ACC_P0P1_Pre_CutIn_Obj_vx_val = AUTOSAR4.Parameter(2, SwCalibrationAccess="ReadWrite", StorageClass="Global", MemorySection="CAL", DataType="single")
P_TOS_ACC_P0P1_Pre_CutIn_vxvRefMs_val = AUTOSAR4.Parameter([0 13.9 27.7 30], SwCalibrationAccess="ReadWrite", StorageClass="Global", MemorySection="CAL", DataType="single")
P_TOS_ACC_P0P1_Pre_Greater60_EgoCenterLine_Max_dy = AUTOSAR4.Parameter(2.3, SwCalibrationAccess="ReadWrite", StorageClass="Global", MemorySection="CAL", DataType="single")
P_TOS_ACC_P0P1_Pre_Greater60_EgoCenterLine_Min_dy = AUTOSAR4.Parameter(1, SwCalibrationAccess="ReadWrite", StorageClass="Global", MemorySection="CAL", DataType="single")
P_TOS_ACC_P0P1_Pre_Greater60_LL_dx = AUTOSAR4.Parameter([0 20 40 60 80 100], SwCalibrationAccess="ReadWrite", StorageClass="Global", MemorySection="CAL", DataType="single")
P_TOS_ACC_P0P1_Pre_Greater60_LL_dy = AUTOSAR4.Parameter([2.3 2.3 2.2 2.1 2.1 2.1], SwCalibrationAccess="ReadWrite", StorageClass="Global", MemorySection="CAL", DataType="single")
P_TOS_ACC_P0P1_Pre_Greater60_LR_dx = AUTOSAR4.Parameter([0 20 40 60 80 100], SwCalibrationAccess="ReadWrite", StorageClass="Global", MemorySection="CAL", DataType="single")
P_TOS_ACC_P0P1_Pre_Greater60_LR_dy = AUTOSAR4.Parameter([2 2 1.9 1.9 1.8 1.8], SwCalibrationAccess="ReadWrite", StorageClass="Global", MemorySection="CAL", DataType="single")
P_TOS_ACC_P0P1_Pre_Greater60_RL_dx = AUTOSAR4.Parameter([0 20 40 60 80 100], SwCalibrationAccess="ReadWrite", StorageClass="Global", MemorySection="CAL", DataType="single")
P_TOS_ACC_P0P1_Pre_Greater60_RR_dx = AUTOSAR4.Parameter([0 20 40 60 80 100], SwCalibrationAccess="ReadWrite", StorageClass="Global", MemorySection="CAL", DataType="single")
P_TOS_ACC_P0P1_Pre_Greater60_RR_dy = AUTOSAR4.Parameter([2.3 2.3 2.2 2.1 2.1 2.1], SwCalibrationAccess="ReadWrite", StorageClass="Global", MemorySection="CAL", DataType="single")
P_TOS_ACC_P0P1_Pre_Less60_EgoCenterLine_Max_dy = AUTOSAR4.Parameter(2.2, SwCalibrationAccess="ReadWrite", StorageClass="Global", MemorySection="CAL", DataType="single")
P_TOS_ACC_P0P1_Pre_Less60_EgoCenterLine_Min_dy = AUTOSAR4.Parameter(1, SwCalibrationAccess="ReadWrite", StorageClass="Global", MemorySection="CAL", DataType="single")
P_TOS_ACC_P0P1_Pre_Less60_LL_dx = AUTOSAR4.Parameter([0 20 40 60 80 100], SwCalibrationAccess="ReadWrite", StorageClass="Global", MemorySection="CAL", DataType="single")
P_TOS_ACC_P0P1_Pre_Less60_LL_dy = AUTOSAR4.Parameter([2.2 2.2 2.1 2 2 2], SwCalibrationAccess="ReadWrite", StorageClass="Global", MemorySection="CAL", DataType="single")
P_TOS_ACC_P0P1_Pre_Less60_LR_dx = AUTOSAR4.Parameter([0 20 40 60 80 100], SwCalibrationAccess="ReadWrite", StorageClass="Global", MemorySection="CAL", DataType="single")
P_TOS_ACC_P0P1_Pre_Less60_LR_dy = AUTOSAR4.Parameter([1.9 1.9 1.8 1.8 1.7 1.7], SwCalibrationAccess="ReadWrite", StorageClass="Global", MemorySection="CAL", DataType="single")
P_TOS_ACC_P0P1_Pre_Less60_RL_dx = AUTOSAR4.Parameter([0 20 40 60 80 100], SwCalibrationAccess="ReadWrite", StorageClass="Global", MemorySection="CAL", DataType="single")
P_TOS_ACC_P0P1_Pre_Less60_RL_dy = AUTOSAR4.Parameter([1.9 1.9 1.8 1.8 1.7 1.7], SwCalibrationAccess="ReadWrite", StorageClass="Global", MemorySection="CAL", DataType="single")
P_TOS_ACC_P0P1_Pre_Less60_RR_dx = AUTOSAR4.Parameter([0 20 40 60 80 100], SwCalibrationAccess="ReadWrite", StorageClass="Global", MemorySection="CAL", DataType="single")
P_TOS_ACC_P0P1_Pre_Less60_RR_dy = AUTOSAR4.Parameter([2.2 2.2 2.1 2 2 2], SwCalibrationAccess="ReadWrite", StorageClass="Global", MemorySection="CAL", DataType="single")
P_TOS_ACC_P0P1_Pre_Straight_LL_dx = AUTOSAR4.Parameter([0 20 40 60 80 100], SwCalibrationAccess="ReadWrite", StorageClass="Global", MemorySection="CAL", DataType="single")
P_TOS_ACC_P0P1_Pre_Straight_LL_dy = AUTOSAR4.Parameter([2.1 2.1 2 1.9 1.9 1.9], SwCalibrationAccess="ReadWrite", StorageClass="Global", MemorySection="CAL", DataType="single")
P_TOS_ACC_P0P1_Pre_Straight_LL_dyc = AUTOSAR4.Parameter(repmat(1.5, 1, 6), SwCalibrationAccess="ReadWrite", StorageClass="Global", MemorySection="CAL", DataType="single")
P_TOS_ACC_P0P1_Pre_Straight_LR_dy = AUTOSAR4.Parameter([1.9 1.9 1.8 1.8 1.7 1.7], SwCalibrationAccess="ReadWrite", StorageClass="Global", MemorySection="CAL", DataType="single")
P_TOS_ACC_P0P1_Pre_Straight_LR_dyc = AUTOSAR4.Parameter(repmat(1.35, 1, 6), SwCalibrationAccess="ReadWrite", StorageClass="Global", MemorySection="CAL", DataType="single")
P_TOS_ACC_P0P1_Pre_Straight_RL_dx = AUTOSAR4.Parameter([0 20 40 60 80 100], SwCalibrationAccess="ReadWrite", StorageClass="Global", MemorySection="CAL", DataType="single")
P_TOS_ACC_P0P1_Pre_Straight_RL_dy = AUTOSAR4.Parameter([1.9 1.9 1.8 1.8 1.7 1.7], SwCalibrationAccess="ReadWrite", StorageClass="Global", MemorySection="CAL", DataType="single")
P_TOS_ACC_P0P1_Pre_Straight_RL_dyc = AUTOSAR4.Parameter(repmat(1.35, 1, 6), SwCalibrationAccess="ReadWrite", StorageClass="Global", MemorySection="CAL", DataType="single")
P_TOS_ACC_P0P1_Pre_Straight_RR_dx = AUTOSAR4.Parameter([0 20 40 60 80 100], SwCalibrationAccess="ReadWrite", StorageClass="Global", MemorySection="CAL", DataType="single")
P_TOS_ACC_P0P1_Pre_Straight_RR_dy = AUTOSAR4.Parameter([2.1 2.1 2 1.9 1.9 1.9], SwCalibrationAccess="ReadWrite", StorageClass="Global", MemorySection="CAL", DataType="single")
P_TOS_ACC_P0P1_Pre_Straight_RR_dyc = AUTOSAR4.Parameter(repmat(1.5, 1, 6), SwCalibrationAccess="ReadWrite", StorageClass="Global", MemorySection="CAL", DataType="single")
P_TOS_ACC_P0P1_Pre_Straight_SameLane_dx = AUTOSAR4.Parameter([0 20 40 60 80 100], SwCalibrationAccess="ReadWrite", StorageClass="Global", MemorySection="CAL", DataType="single")
P_TOS_ACC_P0P1_Pre_Straight_SameLane_dy_Min = AUTOSAR4.Parameter(0.65, SwCalibrationAccess="ReadWrite", StorageClass="Global", MemorySection="CAL", DataType="single")
P_TOS_ACC_P0P1_Pre_Straight_SameLane_dyc = AUTOSAR4.Parameter(repmat(1.45, 1, 6), SwCalibrationAccess="ReadWrite", StorageClass="Global", MemorySection="CAL", DataType="single")
P_TOS_ACC_P0P1_Pre_Straight_default_dx = AUTOSAR4.Parameter([0 20 40 60 80 100], SwCalibrationAccess="ReadWrite", StorageClass="Global", MemorySection="CAL", DataType="single")
P_TOS_ACC_P0P1_Pre_Straight_default_dy = AUTOSAR4.Parameter(repmat(1.7, 1, 6), SwCalibrationAccess="ReadWrite", StorageClass="Global", MemorySection="CAL", DataType="single")
P_TOS_ACC_P0P1_SmallOvelap_Curvature_val = AUTOSAR4.Parameter(0.0004, SwCalibrationAccess="ReadWrite", StorageClass="Global", MemorySection="CAL", DataType="single")
P_TOS_ACC_P0P1_SmallOvelap_Straight_Curvature_val = AUTOSAR4.Parameter(0.0004, SwCalibrationAccess="ReadWrite", StorageClass="Global", MemorySection="CAL", DataType="single")
P_TOS_ACC_P0P1_SmallOvelap_Straight_Obj_dx_val = AUTOSAR4.Parameter(100, SwCalibrationAccess="ReadWrite", StorageClass="Global", MemorySection="CAL", DataType="single")
P_TOS_ACC_P0P1_SmallOvelap_obj_dx_val = AUTOSAR4.Parameter(80, SwCalibrationAccess="ReadWrite", StorageClass="Global", MemorySection="CAL", DataType="single")
P_TOS_ACC_P0P1_TargetInFrontEgoVehicle_OverlapThre_Val = AUTOSAR4.Parameter(0.05, SwCalibrationAccess="ReadWrite", StorageClass="Global", MemorySection="CAL", DataType="single")
P_TOS_ACC_P0P1_dyCutIn_SteerWheelAng_val = AUTOSAR4.Parameter(10, SwCalibrationAccess="ReadWrite", StorageClass="Global", MemorySection="CAL", DataType="single")
P_TOS_ACC_P0P1_dyCutIn_dx_UperLimit = AUTOSAR4.Parameter(40, SwCalibrationAccess="ReadWrite", StorageClass="Global", MemorySection="CAL", DataType="single")
P_TOS_ACC_P0P1_dyCutIn_dy_UperLimit = AUTOSAR4.Parameter(0.7, SwCalibrationAccess="ReadWrite", StorageClass="Global", MemorySection="CAL", DataType="single")
P_TOS_ACC_P0P1_dyCutIn_vxvRefMs_val = AUTOSAR4.Parameter(23.6, SwCalibrationAccess="ReadWrite", StorageClass="Global", MemorySection="CAL", DataType="single")
P_TOS_ACC_P0_FRSplit_ObstacleProbThre_Valu = AUTOSAR4.Parameter(0.3, SwCalibrationAccess="ReadWrite", StorageClass="Global", MemorySection="CAL", DataType="single")
P_TOS_ACC_P0_ObstacleProbThre_Valu = AUTOSAR4.Parameter(0.4, SwCalibrationAccess="ReadWrite", StorageClass="Global", MemorySection="CAL", DataType="single")
P_TOS_ACC_P0_SteerWheelAngMax_Val = AUTOSAR4.Parameter(115, SwCalibrationAccess="ReadWrite", StorageClass="Global", MemorySection="CAL", DataType="single")
P_TOS_ACC_P0_SteerWheelSpdMax_Val = AUTOSAR4.Parameter(110, SwCalibrationAccess="ReadWrite", StorageClass="Global", MemorySection="CAL")
P_TOS_ACC_P1_ObstacleProbThre_Valu = AUTOSAR4.Parameter(0.4, SwCalibrationAccess="ReadWrite", StorageClass="Global", MemorySection="CAL", DataType="single")
P_TOS_ACC_ParkingDyCfmDxThre_Val = AUTOSAR4.Parameter(35, SwCalibrationAccess="ReadWrite", StorageClass="Global", MemorySection="CAL", DataType="single")
P_TOS_ACC_ParkingDyCfmDyThre_Val = AUTOSAR4.Parameter(1.45, SwCalibrationAccess="ReadWrite", StorageClass="Global", MemorySection="CAL", DataType="single")
P_TOS_ACC_ParkingDyCfmEgoSpdThre_Val = AUTOSAR4.Parameter(1.5, SwCalibrationAccess="ReadWrite", StorageClass="Global", MemorySection="CAL", DataType="single")
P_TOS_ACC_ParkingDyCfmOvlpThre_Val = AUTOSAR4.Parameter(0.45, SwCalibrationAccess="ReadWrite", StorageClass="Global", MemorySection="CAL", DataType="single")
P_TOS_ACC_ParkingDyCfmSWAngThre_Val = AUTOSAR4.Parameter(6, SwCalibrationAccess="ReadWrite", StorageClass="Global", MemorySection="CAL", DataType="single")
P_TOS_ACC_RefPoint_dx_m = AUTOSAR4.Parameter(0, SwCalibrationAccess="ReadWrite", StorageClass="Global", MemorySection="CAL", DataType="single")
P_TOS_ACC_SameDirVxvOffset_Val = AUTOSAR4.Parameter(1, SwCalibrationAccess="ReadWrite", StorageClass="Global", MemorySection="CAL", DataType="single")
P_TOS_ACC_SameDirVyOffset_Val = AUTOSAR4.Parameter(2, SwCalibrationAccess="ReadWrite", StorageClass="Global", MemorySection="CAL", DataType="single")
P_TOS_ACC_Straight_LM_fCamAge = AUTOSAR4.Parameter(5, SwCalibrationAccess="ReadWrite", StorageClass="Global", MemorySection="CAL", DataType="uint32")
P_TOS_ACC_TargetDxConfirm_EgoVelocity_70_Threshold = AUTOSAR4.Parameter(19.5, SwCalibrationAccess="ReadWrite", StorageClass="Global", MemorySection="CAL", DataType="single")
P_TOS_ACC_VySameDirAbsThre_Val = AUTOSAR4.Parameter(2.5, SwCalibrationAccess="ReadWrite", StorageClass="Global", MemorySection="CAL", DataType="single")
P_TOS_ACC_P0P1_Pre_Straight_SameLane_dy_Max = AUTOSAR4.Parameter(2.1, SwCalibrationAccess="ReadWrite", StorageClass="Global", MemorySection="CAL", DataType="single")
P_TOS_ACC_P0P1_Pre_Straight_SameLane_Truck_dy_Min = AUTOSAR4.Parameter(0.65, SwCalibrationAccess="ReadWrite", StorageClass="Global", MemorySection="CAL", DataType="single")
P_TOS_ACC_P0P1_CutIn_EgoVehCenterLine_Truck_dy_Value = AUTOSAR4.Parameter(0.5, SwCalibrationAccess="ReadWrite", StorageClass="Global", MemorySection="CAL", DataType="single")
P_TOS_ACC_P0P1_Pre_Straight_Truck_RL_dx = AUTOSAR4.Parameter([0 20 40 60 80 100], SwCalibrationAccess="ReadWrite", StorageClass="Global", MemorySection="CAL", DataType="single")
P_TOS_ACC_P0P1_Pre_Straight_Truck_RR_dx = AUTOSAR4.Parameter([0 20 40 60 80 100], SwCalibrationAccess="ReadWrite", StorageClass="Global", MemorySection="CAL", DataType="single")
P_TOS_ACC_P0P1_Pre_Straight_Truck_LL_dx = AUTOSAR4.Parameter([0 20 40 60 80 100], SwCalibrationAccess="ReadWrite", StorageClass="Global", MemorySection="CAL", DataType="single")
P_TOS_ACC_P0P1_Pre_Straight_Truck_LR_dx = AUTOSAR4.Parameter([0 20 40 60 80 100], SwCalibrationAccess="ReadWrite", StorageClass="Global", MemorySection="CAL", DataType="single")
P_TOS_ACC_P0P1_Pre_Straight_default_dyc = AUTOSAR4.Parameter(repmat(1.2, 1, 6), SwCalibrationAccess="ReadWrite", StorageClass="Global", MemorySection="CAL", DataType="single")
P_TOS_ACC_P0P1_Pre_Straight_default_Truck_dx = AUTOSAR4.Parameter([0 20 40 60 80 100], SwCalibrationAccess="ReadWrite", StorageClass="Global", MemorySection="CAL", DataType="single")
P_TOS_ACC_P0P1_Pre_Straight_LR_dx = AUTOSAR4.Parameter([0 20 40 60 80 100], SwCalibrationAccess="ReadWrite", StorageClass="Global", MemorySection="CAL", DataType="single")
P_TOS_ACC_P0P1_Pre_Straight_Truck_LL_dy = AUTOSAR4.Parameter([2.5 2.5 2.4 2.4 2.3 2.3], SwCalibrationAccess="ReadWrite", StorageClass="Global", MemorySection="CAL", DataType="single")
P_TOS_ACC_P0P1_Pre_Straight_Truck_RR_dy = AUTOSAR4.Parameter([2.5 2.5 2.4 2.4 2.3 2.3], SwCalibrationAccess="ReadWrite", StorageClass="Global", MemorySection="CAL", DataType="single")
P_TOS_ACC_P0P1_Pre_SmallOverLap_ObjWidth_Max = AUTOSAR4.Parameter(3.2, SwCalibrationAccess="ReadWrite", StorageClass="Global", MemorySection="CAL", DataType="single")
P_TOS_ACC_P0P1_Pre_SmallOverLap_Car_ObjWidth_Max = AUTOSAR4.Parameter(2, SwCalibrationAccess="ReadWrite", StorageClass="Global", MemorySection="CAL", DataType="single")
P_TOS_ACC_P0P1_Pre_SmallOverLap_Car_ObjWidth_Min = AUTOSAR4.Parameter(1.6, SwCalibrationAccess="ReadWrite", StorageClass="Global", MemorySection="CAL", DataType="single")
P_TOS_ACC_Straight_LM_fCamAge_Confirm_dx_Patch = AUTOSAR4.Parameter(15, SwCalibrationAccess="ReadWrite", StorageClass="Global", MemorySection="CAL", DataType="single")
P_TOS_ACC_P0P1_Pre_Straight_SameLane_Truick_dx = AUTOSAR4.Parameter([0 20 40 60 80 100], SwCalibrationAccess="ReadWrite", StorageClass="Global", MemorySection="CAL", DataType="single")
P_TOS_ACC_P0P1_Pre_Straight_LR_Truck_dx = AUTOSAR4.Parameter([0 20 40 60 80 100], SwCalibrationAccess="ReadWrite", StorageClass="Global", MemorySection="CAL", DataType="single")
P_TOS_ACC_P0P1_Pre_Curve_SameLane_Truck_dyc = AUTOSAR4.Parameter(repmat(1.45, 1, 6), SwCalibrationAccess="ReadWrite", StorageClass="Global", MemorySection="CAL", DataType="single")
P_TOS_ACC_P0P1_Pre_Curve_SameLane_Truck_dx = AUTOSAR4.Parameter([0 20 40 60 80 100], SwCalibrationAccess="ReadWrite", StorageClass="Global", MemorySection="CAL", DataType="single")
P_TOS_ACC_P0P1_Pre_Curve_RL_Truck_dyc = AUTOSAR4.Parameter(repmat(1.35, 1, 6), SwCalibrationAccess="ReadWrite", StorageClass="Global", MemorySection="CAL", DataType="single")
P_TOS_ACC_P0P1_Pre_Curve_RL_Truck_dx = AUTOSAR4.Parameter([0 20 40 60 80 100], SwCalibrationAccess="ReadWrite", StorageClass="Global", MemorySection="CAL", DataType="single")
P_TOS_ACC_P0P1_Pre_Curve_RR_Truck_dyc = AUTOSAR4.Parameter(repmat(1.55, 1, 6), SwCalibrationAccess="ReadWrite", StorageClass="Global", MemorySection="CAL", DataType="single")
P_TOS_ACC_P0P1_Pre_Curve_Truck_RR_dx = AUTOSAR4.Parameter([0 20 40 60 80 100], SwCalibrationAccess="ReadWrite", StorageClass="Global", MemorySection="CAL", DataType="single")
P_TOS_ACC_P0P1_Pre_Curve_Truck_LL_dyc = AUTOSAR4.Parameter(repmat(1.55, 1, 6), SwCalibrationAccess="ReadWrite", StorageClass="Global", MemorySection="CAL", DataType="single")
P_TOS_ACC_P0P1_Pre_Curve_Truck_LL_dx = AUTOSAR4.Parameter([0 20 40 60 80 100], SwCalibrationAccess="ReadWrite", StorageClass="Global", MemorySection="CAL", DataType="single")
P_TOS_ACC_P0P1_Pre_Curve_Truck_LR_dyc = AUTOSAR4.Parameter(repmat(1.35, 1, 6), SwCalibrationAccess="ReadWrite", StorageClass="Global", MemorySection="CAL", DataType="single")
P_TOS_ACC_P0P1_Pre_Curve_Truck_LR_dx = AUTOSAR4.Parameter([0 20 40 60 80 100], SwCalibrationAccess="ReadWrite", StorageClass="Global", MemorySection="CAL", DataType="single")
P_TOS_ACC_P0P1_Pre_Curve_Truck_default_dyc = AUTOSAR4.Parameter(repmat(1.2, 1, 6), SwCalibrationAccess="ReadWrite", StorageClass="Global", MemorySection="CAL", DataType="single")
P_TOS_ACC_P0P1_Pre_Curve_Truck_default_dx = AUTOSAR4.Parameter([0 20 40 60 80 100], SwCalibrationAccess="ReadWrite", StorageClass="Global", MemorySection="CAL", DataType="single")
P_TOS_ACC_Curvr_LM_fCamAge_Confirm_dx_Patch = AUTOSAR4.Parameter(15, SwCalibrationAccess="ReadWrite", StorageClass="Global", MemorySection="CAL", DataType="single")
P_TOS_ACC_Curve_LM_Confirm_Counter = AUTOSAR4.Parameter(10, SwCalibrationAccess="ReadWrite", StorageClass="Global", MemorySection="CAL", DataType="uint8")
P_TOS_ACC_Straight_LM_Confirm_Counter = AUTOSAR4.Parameter(15, SwCalibrationAccess="ReadWrite", StorageClass="Global", MemorySection="CAL", DataType="uint8")
P_TOS_ACC_P0_Confirm_DyConfirm_vxvRefMs_Min = AUTOSAR4.Parameter(8.33, SwCalibrationAccess="ReadWrite", StorageClass="Global", MemorySection="CAL", DataType="single")
P_TOS_ACC_P0_Confirm_DyConfirm_vxvRefMs_Max = AUTOSAR4.Parameter(16.66, SwCalibrationAccess="ReadWrite", StorageClass="Global", MemorySection="CAL", DataType="single")
P_TOS_ACC_P0_Confirm_DyConfirm_OverlapRatio = AUTOSAR4.Parameter(0.5, SwCalibrationAccess="ReadWrite", StorageClass="Global", MemorySection="CAL", DataType="single")
P_TOS_ACC_P0_Confirm_DyConfirm_SamllCurve_4 = AUTOSAR4.Parameter(0.00035, SwCalibrationAccess="ReadWrite", StorageClass="Global", MemorySection="CAL", DataType="single")
P_TOS_ACC_P0_Confirm_DyConfirm_SamllCurve_5 = AUTOSAR4.Parameter(0.00032, SwCalibrationAccess="ReadWrite", StorageClass="Global", MemorySection="CAL", DataType="single")
P_TOS_ACC_P0_Confirm_DyConfirm_SamllCurve_6 = AUTOSAR4.Parameter(0.00028, SwCalibrationAccess="ReadWrite", StorageClass="Global", MemorySection="CAL", DataType="single")
P_TOS_ACC_P0_OTL_FusRatio_Val = AUTOSAR4.Parameter(0.33, SwCalibrationAccess="ReadWrite", StorageClass="Global", MemorySection="CAL", DataType="single")
P_TOS_ACC_P0_Mov_OverLap_Val = AUTOSAR4.Parameter(0.15, SwCalibrationAccess="ReadWrite", StorageClass="Global", MemorySection="CAL", DataType="single")
P_TOS_ACC_P0_DisDxThreshold_m = AUTOSAR4.Parameter(8.5, SwCalibrationAccess="ReadWrite", StorageClass="Global", MemorySection="CAL", DataType="single")
P_TOS_ACC_P0_VSL_FusRatio_Val = AUTOSAR4.Parameter(0.1, SwCalibrationAccess="ReadWrite", StorageClass="Global", MemorySection="CAL", DataType="single")
P_TOS_ACC_P0_Curve_DisDxThreshold_m = AUTOSAR4.Parameter(13, SwCalibrationAccess="ReadWrite", StorageClass="Global", MemorySection="CAL", DataType="single")
P_TOS_ACC_P0_TargetOverlapThre_MinVal = AUTOSAR4.Parameter(0.01, SwCalibrationAccess="ReadWrite", StorageClass="Global", MemorySection="CAL", DataType="single")
P_TOS_ACC_P0_TargetOverlapThre_MaxVal = AUTOSAR4.Parameter(0.15, SwCalibrationAccess="ReadWrite", StorageClass="Global", MemorySection="CAL", DataType="single")
P_TOS_ACC_P0_Stationary_OverLap_Val = AUTOSAR4.Parameter(0.5, SwCalibrationAccess="ReadWrite", StorageClass="Global", MemorySection="CAL", DataType="single")
P_TOS_ACC_P1_TargetOverlapThre_Val = AUTOSAR4.Parameter(0.15, SwCalibrationAccess="ReadWrite", StorageClass="Global", MemorySection="CAL", DataType="single")
P_TOS_ACC_P0_TrackingTime = AUTOSAR4.Parameter(40, SwCalibrationAccess="ReadWrite", StorageClass="Global", MemorySection="CAL", DataType="uint32")
P_TOS_ACC_PP_Object_YawAngle_FiltValid = AUTOSAR4.Parameter(0, SwCalibrationAccess="ReadWrite", StorageClass="Global", MemorySection="CAL", DataType="single")
P_TOS_ACC_PP_Truck_Length_max = AUTOSAR4.Parameter(12, SwCalibrationAccess="ReadWrite", StorageClass="Global", MemorySection="CAL", DataType="single")
P_TOS_ACC_PP_Truck_Length_min = AUTOSAR4.Parameter(6, SwCalibrationAccess="ReadWrite", StorageClass="Global", MemorySection="CAL", DataType="single")
P_TOS_ACC_PP_Truck_RightLane_YawAngle_min = AUTOSAR4.Parameter(0, SwCalibrationAccess="ReadWrite", StorageClass="Global", MemorySection="CAL", DataType="single")
P_TOS_ACC_PP_Truck_LeftLane_YawAngle_max = AUTOSAR4.Parameter(0, SwCalibrationAccess="ReadWrite", StorageClass="Global", MemorySection="CAL", DataType="single")
P_TOS_ACC_P0P1_Pre_Straight_SameLane_Truck_dy_Max = AUTOSAR4.Parameter(2.7, SwCalibrationAccess="ReadWrite", StorageClass="Global", MemorySection="CAL", DataType="single")
P_TOS_ACC_P0P1_Pre_Straight_SameLane_Truck_dyc = AUTOSAR4.Parameter(repmat(1.6, 1, 6), SwCalibrationAccess="ReadWrite", StorageClass="Global", MemorySection="CAL", DataType="single")
P_TOS_ACC_P0P1_Pre_Straight_Truck_RR_dyc = AUTOSAR4.Parameter(repmat(1.6, 1, 6), SwCalibrationAccess="ReadWrite", StorageClass="Global", MemorySection="CAL", DataType="single")
P_TOS_ACC_P0P1_Pre_Straight_Truck_LL_dyc = AUTOSAR4.Parameter(repmat(1.6, 1, 6), SwCalibrationAccess="ReadWrite", StorageClass="Global", MemorySection="CAL", DataType="single")
P_TOS_ACC_P0P1_Pre_Straight_Truck_RL_dyc = AUTOSAR4.Parameter(repmat(1.5, 1, 6), SwCalibrationAccess="ReadWrite", StorageClass="Global", MemorySection="CAL", DataType="single")
P_TOS_ACC_P0P1_Pre_Straight_Truck_LR_dyc = AUTOSAR4.Parameter(repmat(1.5, 1, 6), SwCalibrationAccess="ReadWrite", StorageClass="Global", MemorySection="CAL", DataType="single")
P_TOS_ACC_P0P1_Pre_Straight_default_Truck_dyc = AUTOSAR4.Parameter(repmat(1.5, 1, 6), SwCalibrationAccess="ReadWrite", StorageClass="Global", MemorySection="CAL", DataType="single")
P_TOS_ACC_P0P1_SteerWheelAng_Truck_Straight_val = AUTOSAR4.Parameter(8, SwCalibrationAccess="ReadWrite", StorageClass="Global", MemorySection="CAL", DataType="single")
P_TOS_ACC_P0P1_SmallOvelap_Truck_Straight_val = AUTOSAR4.Parameter(0.0004, SwCalibrationAccess="ReadWrite", StorageClass="Global", MemorySection="CAL", DataType="single")
P_TOS_ACC_P0P1_vxvRefMs_Truck_Straight_val = AUTOSAR4.Parameter(16.6, SwCalibrationAccess="ReadWrite", StorageClass="Global", MemorySection="CAL", DataType="single")
P_TOS_ACC_P0P1_ObjDx_Truck_Straight_val = AUTOSAR4.Parameter(30, SwCalibrationAccess="ReadWrite", StorageClass="Global", MemorySection="CAL", DataType="single")
P_TOS_ACC_P0P1_Pre_Straight_SameLane_Truck_dy_offset = AUTOSAR4.Parameter(1.3, SwCalibrationAccess="ReadWrite", StorageClass="Global", MemorySection="CAL", DataType="single")
P_TOS_ACC_P0P1_Pre_Straight_Truck_RL_dy = AUTOSAR4.Parameter([2.4 2.4 2.3 2.3 2.2 2.2], SwCalibrationAccess="ReadWrite", StorageClass="Global", MemorySection="CAL", DataType="single")
P_TOS_ACC_P0P1_Pre_Straight_Truck_LR_dy = AUTOSAR4.Parameter([2.4 2.4 2.3 2.3 2.2 2.2], SwCalibrationAccess="ReadWrite", StorageClass="Global", MemorySection="CAL", DataType="single")
P_TOS_ACC_P0P1_Pre_Straight_default_Truck_dy = AUTOSAR4.Parameter([2.4 2.4 2.3 2.3 2.2 2.2], SwCalibrationAccess="ReadWrite", StorageClass="Global", MemorySection="CAL", DataType="single")
P_TOS_ACC_PP_Truck_LeftLane_YawAngle_min = AUTOSAR4.Parameter(-4.5, SwCalibrationAccess="ReadWrite", StorageClass="Global", MemorySection="CAL", DataType="single")
P_TOS_ACC_PP_Truck_RightLane_YawAngle_max = AUTOSAR4.Parameter(4.5, SwCalibrationAccess="ReadWrite", StorageClass="Global", MemorySection="CAL", DataType="single")
P_TOS_ACC_P5_HMI_DisplayPatch_ObjDx_Val = AUTOSAR4.Parameter(4, SwCalibrationAccess="ReadWrite", StorageClass="Global", MemorySection="CAL", DataType="single")
P_TOS_ACC_P4_HMI_DisplayPatch_ObjDx_Val = AUTOSAR4.Parameter(4, SwCalibrationAccess="ReadWrite", StorageClass="Global", MemorySection="CAL", DataType="single")
P_TOS_ACC_P1_HMI_DisplayPatch_ObjDx_Val = AUTOSAR4.Parameter(4, SwCalibrationAccess="ReadWrite", StorageClass="Global", MemorySection="CAL", DataType="single")
P_TOS_ACC_P0_VSL_FusRatio_CrossRoadsPatch_Val = AUTOSAR4.Parameter(0.1, SwCalibrationAccess="ReadWrite", StorageClass="Global", MemorySection="CAL", DataType="single")
P_TOS_ACC_P0_OTL_FusRatio_CrossRoadsPatch_Val = AUTOSAR4.Parameter(0.33, SwCalibrationAccess="ReadWrite", StorageClass="Global", MemorySection="CAL", DataType="single")
P_TOS_ACC_P0_VIE_EgoVelocity_CrossRoadsPatch_MaxVal = AUTOSAR4.Parameter(16.67, SwCalibrationAccess="ReadWrite", StorageClass="Global", MemorySection="CAL", DataType="single")
P_TOS_ACC_P0_VIE_EgoVelocity_CrossRoadsPatch_MinVal = AUTOSAR4.Parameter(1, SwCalibrationAccess="ReadWrite", StorageClass="Global", MemorySection="CAL", DataType="single")
P_TOS_ACC_P0_TrackingTime_CrossRoadsPatch = AUTOSAR4.Parameter(20, SwCalibrationAccess="ReadWrite", StorageClass="Global", MemorySection="CAL", DataType="uint32")
P_TOS_ACC_P0_CrossRoadsPatch_SteerWheelAngMax_Val = AUTOSAR4.Parameter(150, SwCalibrationAccess="ReadWrite", StorageClass="Global", MemorySection="CAL", DataType="single")
P_TOS_ACC_Motobike_FusType_vxvRefMs = AUTOSAR4.Parameter(16.6, SwCalibrationAccess="ReadWrite", StorageClass="Global", MemorySection="CAL", DataType="single")
P_TOS_ACC_P0P1_MotoBicke_FR_Split_Object_Age = AUTOSAR4.Parameter(60, SwCalibrationAccess="ReadWrite", StorageClass="Global", MemorySection="CAL", DataType="uint16")
P_TOS_ACC_P0P1_VxvRefMs_Val = AUTOSAR4.Parameter(2.5, SwCalibrationAccess="ReadWrite", StorageClass="Global", MemorySection="CAL", DataType="single")
P_TOS_ACC_P0P1_abs_ObjVx_Val = AUTOSAR4.Parameter(1, SwCalibrationAccess="ReadWrite", StorageClass="Global", MemorySection="CAL", DataType="single")
P_TOS_ACC_P0P1_abs_ObjVy_Val = AUTOSAR4.Parameter(1, SwCalibrationAccess="ReadWrite", StorageClass="Global", MemorySection="CAL", DataType="single")
P_TOS_ACC_P0P1_TargetPre_Truck_OverlapThre_Val = AUTOSAR4.Parameter(0.075, SwCalibrationAccess="ReadWrite", StorageClass="Global", MemorySection="CAL", DataType="single")
P_TOS_ACC_P0P1_TargetPre_OverlapThre_Val = AUTOSAR4.Parameter(0.075, SwCalibrationAccess="ReadWrite", StorageClass="Global", MemorySection="CAL", DataType="single")
P_TOS_ACC_P0P1_TargetPre_dy_Truck_OverlapThre_Val = AUTOSAR4.Parameter(0.5, SwCalibrationAccess="ReadWrite", StorageClass="Global", MemorySection="CAL", DataType="single")
P_TOS_ACC_P0P1_ObjCutIn_vxvResMs_Val = AUTOSAR4.Parameter(16.67, SwCalibrationAccess="ReadWrite", StorageClass="Global", MemorySection="CAL", DataType="single")
P_TOS_ACC_P0P1_CutIn_Pre_Greater60_EgoCenterLine_Max_dy = AUTOSAR4.Parameter(2.55, SwCalibrationAccess="ReadWrite", StorageClass="Global", MemorySection="CAL", DataType="single")
P_TOS_ACC_P0P1_CutIn_Pre_Greater60_EgoCenterLine_Min_dy = AUTOSAR4.Parameter(1, SwCalibrationAccess="ReadWrite", StorageClass="Global", MemorySection="CAL", DataType="single")

P_TOS_ACC_P0P1_CutIn_Pre_Greater60_RL_dy = AUTOSAR4.Parameter([2.45 2.45 2.25 2.25 2.15 2.15], SwCalibrationAccess="ReadWrite", StorageClass="Global", MemorySection="CAL", DataType="single")  % 优化参数：[2.45 2.45 2.25 2.25 2.15 2.15]
  % 原始参数：[2 2 1.9 1.9 1.8 1.8]

P_TOS_ACC_P0P1_Pre_Greater60_RL_dy = AUTOSAR4.Parameter([2 2 1.9 1.9 1.8 1.8], SwCalibrationAccess="ReadWrite", StorageClass="Global", MemorySection="CAL", DataType="single")
P_TOS_ACC_P0P1_CutIn_Pre_Greater60_RL_dx = AUTOSAR4.Parameter([0 20 40 60 80 100], SwCalibrationAccess="ReadWrite", StorageClass="Global", MemorySection="CAL", DataType="single")
P_TOS_ACC_P0P1_CutIn_Pre_Greater60_RR_dx = AUTOSAR4.Parameter([0 20 40 60 80 100], SwCalibrationAccess="ReadWrite", StorageClass="Global", MemorySection="CAL", DataType="single")

P_TOS_ACC_P0P1_CutIn_Pre_Greater60_RR_dy = AUTOSAR4.Parameter([2.55 2.55 2.35 2.35 2.25 2.25], SwCalibrationAccess="ReadWrite", StorageClass="Global", MemorySection="CAL", DataType="single")  % 优化后参数：[2.55 2.55 2.35 2.35 2.25 2.25]
  % 原始参数：[2.3 2.3 2.2 2.1 2.1 2.1]

P_TOS_ACC_P0P1_CutIn_Pre_Greater60_LL_dy = AUTOSAR4.Parameter([2.55 2.55 2.35 2.35 2.25 2.25], SwCalibrationAccess="ReadWrite", StorageClass="Global", MemorySection="CAL", DataType="single")  % 优化后参数：[2.55 2.55 2.35 2.35 2.25 2.25]
  % 原始参数：[2.3 2.3 2.2 2.1 2.1 2.1]

P_TOS_ACC_P0P1_CutIn_Pre_Greater60_LL_dx = AUTOSAR4.Parameter([0 20 40 60 80 100], SwCalibrationAccess="ReadWrite", StorageClass="Global", MemorySection="CAL", DataType="single")
P_TOS_ACC_P0P1_CutIn_Pre_Greater60_LR_dx = AUTOSAR4.Parameter([0 20 40 60 80 100], SwCalibrationAccess="ReadWrite", StorageClass="Global", MemorySection="CAL", DataType="single")
P_TOS_ACC_P0P1_CutIn_Pre_Car_ObjWidth_Max = AUTOSAR4.Parameter(2.2, SwCalibrationAccess="ReadWrite", StorageClass="Global", MemorySection="CAL", DataType="single")
P_TOS_ACC_P0P1_CutIn_Pre_Car_ObjWidth_Min = AUTOSAR4.Parameter(1.6, SwCalibrationAccess="ReadWrite", StorageClass="Global", MemorySection="CAL", DataType="single")
P_TOS_ACC_P0P1_CutIn_Pre_Truck_ObjWidth_Max = AUTOSAR4.Parameter(3.2, SwCalibrationAccess="ReadWrite", StorageClass="Global", MemorySection="CAL", DataType="single")
P_TOS_ACC_P0P1_CutIn_Pre_other_ObjWidth_Max = AUTOSAR4.Parameter(2, SwCalibrationAccess="ReadWrite", StorageClass="Global", MemorySection="CAL", DataType="single")
P_TOS_ACC_P0P1_CutIn_Pre_other_ObjWidth_Min = AUTOSAR4.Parameter(1, SwCalibrationAccess="ReadWrite", StorageClass="Global", MemorySection="CAL", DataType="single")

P_TOS_ACC_P0P1_CutIn_Car_SameLaneWidth_MaxVal = AUTOSAR4.Parameter(0.05, SwCalibrationAccess="ReadWrite", StorageClass="Global", MemorySection="CAL", DataType="single")  % 车道宽度修正参数
  % < 0时；加宽车道宽度
  % > 0时；收缩车道宽度

P_TOS_ACC_P0P1_TrackingTime_cys = AUTOSAR4.Parameter(20, SwCalibrationAccess="ReadWrite", StorageClass="Global", MemorySection="CAL", DataType="uint32")
P_TOS_ACC_P0P1_SmallOverlap_vxvResMs_Val = AUTOSAR4.Parameter(16.67, SwCalibrationAccess="ReadWrite", StorageClass="Global", MemorySection="CAL", DataType="single")
P_TOS_P0P1_Pre_Straight_SameLane_LessThan_60_Car_dx = AUTOSAR4.Parameter([0 20 40 60 80 100], SwCalibrationAccess="ReadWrite", StorageClass="Global", MemorySection="CAL", DataType="single")
P_TOS_P0P1_Pre_Straight_LessThan_60_Car_RL_dx = AUTOSAR4.Parameter([0 20 40 60 80 100], SwCalibrationAccess="ReadWrite", StorageClass="Global", MemorySection="CAL", DataType="single")
P_TOS_P0P1_Pre_Straight_LessThan_60_Car_RR_dx = AUTOSAR4.Parameter([0 20 40 60 80 100], SwCalibrationAccess="ReadWrite", StorageClass="Global", MemorySection="CAL", DataType="single")
P_TOS_P0P1_Pre_Straight_LessThan_60_Car_LL_dx = AUTOSAR4.Parameter([0 20 40 60 80 100], SwCalibrationAccess="ReadWrite", StorageClass="Global", MemorySection="CAL", DataType="single")
P_TOS_P0P1_Pre_Straight_LessThan_60_Car_LR_dx = AUTOSAR4.Parameter([0 20 40 60 80 100], SwCalibrationAccess="ReadWrite", StorageClass="Global", MemorySection="CAL", DataType="single")
P_TOS_P0P1_Pre_Straight_LessThan_60_Car_default_dx = AUTOSAR4.Parameter([0 20 40 60 80 100], SwCalibrationAccess="ReadWrite", StorageClass="Global", MemorySection="CAL", DataType="single")
P_TOS_P0P1_Pre_Straight_GreatThan_60_Car_RL_dx = AUTOSAR4.Parameter([0 20 40 60 80 100], SwCalibrationAccess="ReadWrite", StorageClass="Global", MemorySection="CAL", DataType="single")
P_TOS_P0P1_Pre_Straight_GreatThan_60_Car_RR_dx = AUTOSAR4.Parameter([0 20 40 60 80 100], SwCalibrationAccess="ReadWrite", StorageClass="Global", MemorySection="CAL", DataType="single")
P_TOS_P0P1_Pre_Straight_GreatThan_60_Car_LL_dx = AUTOSAR4.Parameter([0 20 40 60 80 100], SwCalibrationAccess="ReadWrite", StorageClass="Global", MemorySection="CAL", DataType="single")
P_TOS_P0P1_Pre_Straight_GreatThan_60_LR_dx = AUTOSAR4.Parameter([0 20 40 60 80 100], SwCalibrationAccess="ReadWrite", StorageClass="Global", MemorySection="CAL", DataType="single")
P_TOS_P0P1_Pre_Straight_SameLane_GreatThan_60_default_dx = AUTOSAR4.Parameter([0 20 40 60 80 100], SwCalibrationAccess="ReadWrite", StorageClass="Global", MemorySection="CAL", DataType="single")
P_TOS_P0P1_Pre_Straight_LessThan_60_RL_dx = AUTOSAR4.Parameter([0 20 40 60 80 100], SwCalibrationAccess="ReadWrite", StorageClass="Global", MemorySection="CAL", DataType="single")
P_TOS_P0P1_Pre_Straight_LessThan_60_RR_dx = AUTOSAR4.Parameter([0 20 40 60 80 100], SwCalibrationAccess="ReadWrite", StorageClass="Global", MemorySection="CAL", DataType="single")
P_TOS_P0P1_Pre_Straight_LessThan_60_LL_dx = AUTOSAR4.Parameter([0 20 40 60 80 100], SwCalibrationAccess="ReadWrite", StorageClass="Global", MemorySection="CAL", DataType="single")
P_TOS_P0P1_Pre_Straight_LessThan_60_LR_dx = AUTOSAR4.Parameter([0 20 40 60 80 100], SwCalibrationAccess="ReadWrite", StorageClass="Global", MemorySection="CAL", DataType="single")
P_TOS_P0P1_Pre_Straight_LessThan_60_default_dx = AUTOSAR4.Parameter([0 20 40 60 80 100], SwCalibrationAccess="ReadWrite", StorageClass="Global", MemorySection="CAL", DataType="single")
P_TOS_P0P1_Pre_Straight_LessThan_60_default_dy = AUTOSAR4.Parameter(repmat(1.7, 1, 6), SwCalibrationAccess="ReadWrite", StorageClass="Global", MemorySection="CAL", DataType="single")
P_TOS_ACC_P0P1_Pre_Straight_SameLane_GreaterThan_60_dy_Min = AUTOSAR4.Parameter(0.65, SwCalibrationAccess="ReadWrite", StorageClass="Global", MemorySection="CAL", DataType="single")
P_TOS_P0P1_Pre_Straight_GreaterThan_60_RL_dx = AUTOSAR4.Parameter([0 20 40 60 80 100], SwCalibrationAccess="ReadWrite", StorageClass="Global", MemorySection="CAL", DataType="single")
P_TOS_P0P1_Pre_Straight_GreaterThan_60_RR_dx = AUTOSAR4.Parameter([0 20 40 60 80 100], SwCalibrationAccess="ReadWrite", StorageClass="Global", MemorySection="CAL", DataType="single")
P_TOS_P0P1_Pre_Straight_GreaterThan_60_LL_dx = AUTOSAR4.Parameter([0 20 40 60 80 100], SwCalibrationAccess="ReadWrite", StorageClass="Global", MemorySection="CAL", DataType="single")
P_TOS_P0P1_Pre_Straight_GreaterThan_60_LR_dx = AUTOSAR4.Parameter([0 20 40 60 80 100], SwCalibrationAccess="ReadWrite", StorageClass="Global", MemorySection="CAL", DataType="single")
P_TOS_P0P1_Pre_Straight_GreaterThan_60_default_dy = AUTOSAR4.Parameter(repmat(1.7, 1, 6), SwCalibrationAccess="ReadWrite", StorageClass="Global", MemorySection="CAL", DataType="single")
P_TOS_P0P1_Pre_Straight_GreaterThan_60_default_dx = AUTOSAR4.Parameter([0 20 40 60 80 100], SwCalibrationAccess="ReadWrite", StorageClass="Global", MemorySection="CAL", DataType="single")

P_TOS_P0P1_Pre_Straight_GreaterThan_60_RL_dy = AUTOSAR4.Parameter([2.1 2.1 2.05 2.05 1.9 1.9], SwCalibrationAccess="ReadWrite", StorageClass="Global", MemorySection="CAL", DataType="single")  % 原始 [1.9 1.9 1.8 1.8 1.7 1.7]
  % 优化后 [2.1     2.1   2.05    2.05       1.9   1.9]

P_TOS_P0P1_Pre_Straight_GreaterThan_60_LR_dy = AUTOSAR4.Parameter([2.1 2.1 2.05 2.05 1.9 1.9], SwCalibrationAccess="ReadWrite", StorageClass="Global", MemorySection="CAL", DataType="single")  % 原始 [1.9 1.9 1.8 1.8 1.7 1.7]
  % 优化后 [2.1     2.1   2.05    2.05       1.9   1.9]

P_TOS_P0P1_Pre_Straight_GreaterThan_60_LL_dy = AUTOSAR4.Parameter([2.3 2.3 2.25 2.1 2.1 2.1], SwCalibrationAccess="ReadWrite", StorageClass="Global", MemorySection="CAL", DataType="single")  % 原始 [2.1 2.1 2 1.9 1.9 1.9]
  % 优化后 [2.3    2.3   2.25    2.1     2.1    2.1   ]

P_TOS_P0P1_Pre_Straight_GreaterThan_60_RR_dy = AUTOSAR4.Parameter([2.3 2.3 2.25 2.1 2.1 2.1], SwCalibrationAccess="ReadWrite", StorageClass="Global", MemorySection="CAL", DataType="single")  % 原始 [2.1 2.1 2 1.9 1.9 1.9]
  % 优化后 [2.3    2.3   2.25    2.1     2.1    2.1   ]

P_TOS_P0P1_Pre_Straight_LessThan_60_RL_dy = AUTOSAR4.Parameter([1.9 1.9 1.8 1.8 1.7 1.7], SwCalibrationAccess="ReadWrite", StorageClass="Global", MemorySection="CAL", DataType="single")  % 原始 [1.9 1.9 1.8 1.8 1.7 1.7]
  % 优化后：[2  2  1.9 1.9 1.8 1.8]

P_TOS_ACC_P0P1_Pre_Straight_SameLane_LessThan_60_Truck_dy_Max = AUTOSAR4.Parameter(2.7, SwCalibrationAccess="ReadWrite", StorageClass="Global", MemorySection="CAL", DataType="single")
P_TOS_ACC_P0P1_Pre_Straight_SameLane_LessThan_60_Truck_dy_Min = AUTOSAR4.Parameter(0.65, SwCalibrationAccess="ReadWrite", StorageClass="Global", MemorySection="CAL", DataType="single")
P_TOS_P0P1_Pre_Straight_SameLane_LessThan_60_Truck_dy_offset = AUTOSAR4.Parameter(1.3, SwCalibrationAccess="ReadWrite", StorageClass="Global", MemorySection="CAL", DataType="single")
P_TOS_ACC_P0P1_Pre_Straight_LessThan_60_Truck_RL_dy = AUTOSAR4.Parameter([2.4 2.4 2.3 2.3 2.2 2.2], SwCalibrationAccess="ReadWrite", StorageClass="Global", MemorySection="CAL", DataType="single")
P_TOS_ACC_P0P1_Pre_Straight_LessThan_60_Truck_RL_dx = AUTOSAR4.Parameter([0 20 40 60 80 100], SwCalibrationAccess="ReadWrite", StorageClass="Global", MemorySection="CAL", DataType="single")
P_TOS_ACC_P0P1_Pre_Straight_LessThan_60_Truck_RR_dy = AUTOSAR4.Parameter([2.5 2.5 2.4 2.4 2.3 2.3], SwCalibrationAccess="ReadWrite", StorageClass="Global", MemorySection="CAL", DataType="single")
P_TOS_ACC_P0P1_Pre_Straight_LessThan_60_Truck_RR_dx = AUTOSAR4.Parameter([0 20 40 60 80 100], SwCalibrationAccess="ReadWrite", StorageClass="Global", MemorySection="CAL", DataType="single")
P_TOS_ACC_P0P1_Pre_Straight_LessThan_60_Truck_LL_dy = AUTOSAR4.Parameter([2.5 2.5 2.4 2.4 2.3 2.3], SwCalibrationAccess="ReadWrite", StorageClass="Global", MemorySection="CAL", DataType="single")
P_TOS_ACC_P0P1_Pre_Straight_LessThan_60_Truck_LL_dx = AUTOSAR4.Parameter([0 20 40 60 80 100], SwCalibrationAccess="ReadWrite", StorageClass="Global", MemorySection="CAL", DataType="single")
P_TOS_ACC_P0P1_Pre_Straight_LessThan_60_Truck_LR_dy = AUTOSAR4.Parameter([2.4 2.4 2.3 2.3 2.2 2.2], SwCalibrationAccess="ReadWrite", StorageClass="Global", MemorySection="CAL", DataType="single")
P_TOS_ACC_P0P1_Pre_Straight_LessThan_60_Truck_LR_dx = AUTOSAR4.Parameter([0 20 40 60 80 100], SwCalibrationAccess="ReadWrite", StorageClass="Global", MemorySection="CAL", DataType="single")
P_TOS_ACC_P0P1_Pre_Straight_default_LessThan_60_Truck_dy = AUTOSAR4.Parameter([2.4 2.4 2.3 2.3 2.2 2.2], SwCalibrationAccess="ReadWrite", StorageClass="Global", MemorySection="CAL", DataType="single")
P_TOS_ACC_P0P1_Pre_Straight_default_LessThan_60_Truck_dx = AUTOSAR4.Parameter([0 20 40 60 80 100], SwCalibrationAccess="ReadWrite", StorageClass="Global", MemorySection="CAL", DataType="single")
P_TOS_P0P1_Pre_Straight_SameLane_GreaterThan_60_Truck_dy_offset = AUTOSAR4.Parameter(1.3, SwCalibrationAccess="ReadWrite", StorageClass="Global", MemorySection="CAL", DataType="single")
P_TOS_P0P1_Pre_Straight_SameLane_GreaterThan_60_Truck_dy_Min = AUTOSAR4.Parameter(0.65, SwCalibrationAccess="ReadWrite", StorageClass="Global", MemorySection="CAL", DataType="single")
P_TOS_ACC_P0P1_Pre_Straight_GreaterThan_60_Truck_RL_dy = AUTOSAR4.Parameter([2.4 2.4 2.3 2.3 2.2 2.2], SwCalibrationAccess="ReadWrite", StorageClass="Global", MemorySection="CAL", DataType="single")
P_TOS_ACC_P0P1_Pre_Straight_GreaterThan_60_Truck_RL_dx = AUTOSAR4.Parameter([0 20 40 60 80 100], SwCalibrationAccess="ReadWrite", StorageClass="Global", MemorySection="CAL", DataType="single")
P_TOS_ACC_P0P1_Pre_Straight_GreaterThan_60_Truck_RR_dy = AUTOSAR4.Parameter([2.5 2.5 2.4 2.4 2.3 2.3], SwCalibrationAccess="ReadWrite", StorageClass="Global", MemorySection="CAL", DataType="single")
P_TOS_ACC_P0P1_Pre_Straight_GreaterThan_60_Truck_RR_dx = AUTOSAR4.Parameter([0 20 40 60 80 100], SwCalibrationAccess="ReadWrite", StorageClass="Global", MemorySection="CAL", DataType="single")
P_TOS_ACC_P0P1_Pre_Straight_GreaterThan_60_Truck_LL_dy = AUTOSAR4.Parameter([2.5 2.5 2.4 2.4 2.3 2.3], SwCalibrationAccess="ReadWrite", StorageClass="Global", MemorySection="CAL", DataType="single")
P_TOS_ACC_P0P1_Pre_Straight_GreaterThan_60_Truck_LL_dx = AUTOSAR4.Parameter([0 20 40 60 80 100], SwCalibrationAccess="ReadWrite", StorageClass="Global", MemorySection="CAL", DataType="single")
P_TOS_ACC_P0P1_Pre_Straight_GreaterThan_60_Truck_LR_dy = AUTOSAR4.Parameter([2.4 2.4 2.3 2.3 2.2 2.2], SwCalibrationAccess="ReadWrite", StorageClass="Global", MemorySection="CAL", DataType="single")
P_TOS_ACC_P0P1_Pre_Straight_GreaterThan_60_Truck_LR_dx = AUTOSAR4.Parameter([0 20 40 60 80 100], SwCalibrationAccess="ReadWrite", StorageClass="Global", MemorySection="CAL", DataType="single")
P_TOS_ACC_P0P1_Pre_Straight_default_GreaterThan_60_Truck_dy = AUTOSAR4.Parameter([2.4 2.4 2.3 2.3 2.2 2.2], SwCalibrationAccess="ReadWrite", StorageClass="Global", MemorySection="CAL", DataType="single")
P_TOS_ACC_P0P1_Pre_Straight_default_GreaterThan_60_Truck_dx = AUTOSAR4.Parameter([0 20 40 60 80 100], SwCalibrationAccess="ReadWrite", StorageClass="Global", MemorySection="CAL", DataType="single")

P_TOS_P0P1_Pre_Straight_LessThan_60_Car_default_dyc = AUTOSAR4.Parameter(repmat(1.2, 1, 6), SwCalibrationAccess="ReadWrite", StorageClass="Global", MemorySection="CAL", DataType="single")  % 原始：[1.2 1.2 1.2 1.2 1.2 1.2]
  % 优化

P_TOS_P0P1_Pre_Straight_GreatThan_60_Car_RL_dyc = AUTOSAR4.Parameter(repmat(1.45, 1, 6), SwCalibrationAccess="ReadWrite", StorageClass="Global", MemorySection="CAL", DataType="single")  % 原始： [1.35  1.35  1.35   1.35   1.35  1.35]
  % 优化后：[1.45 1.45 1.45 1.45 1.45 1.45]

P_TOS_P0P1_Pre_Straight_GreatThan_60_Car_RR_dyc = AUTOSAR4.Parameter(repmat(1.55, 1, 6), SwCalibrationAccess="ReadWrite", StorageClass="Global", MemorySection="CAL", DataType="single")  % 原始：[1.5    1.5    1.5   1.5    1.5  1.5]
  % 优化后：[1.55 1.55 1.55 1.55 1.55 1.55]

P_TOS_P0P1_Pre_Straight_GreatThan_60_Car_LL_dyc = AUTOSAR4.Parameter(repmat(1.55, 1, 6), SwCalibrationAccess="ReadWrite", StorageClass="Global", MemorySection="CAL", DataType="single")  % 原始：[1.5    1.5    1.5   1.5    1.5  1.5]
  % 优化后：[1.55 1.55 1.55 1.55 1.55 1.55]

P_TOS_P0P1_Pre_Straight_GreatThan_60_LR_dyc = AUTOSAR4.Parameter(repmat(1.45, 1, 6), SwCalibrationAccess="ReadWrite", StorageClass="Global", MemorySection="CAL", DataType="single")  % 原始：[1.35  1.35  1.35   1.35   1.35   1.35]
  % 优化：[1.45 1.45 1.45 1.45 1.45 1.45]

P_TOS_P0P1_Pre_Straight_SameLane_GreatThan_60_default_dyc = AUTOSAR4.Parameter(repmat(1.3, 1, 6), SwCalibrationAccess="ReadWrite", StorageClass="Global", MemorySection="CAL", DataType="single")  % 原始： [1.2    1.2    1.2   1.2   1.2  1.2]
  % 优化：[1.3 1.3 1.3 1.3 1.3 1.3]

P_TOS_ACC_P0P1_Pre_Straight_SameLane_LessThan_60_Truck_dyc = AUTOSAR4.Parameter(repmat(1.6, 1, 6), SwCalibrationAccess="ReadWrite", StorageClass="Global", MemorySection="CAL", DataType="single")
P_TOS_ACC_P0P1_Pre_Straight_SameLane_LessThan_60_Truick_dx = AUTOSAR4.Parameter([0 20 40 60 80 100], SwCalibrationAccess="ReadWrite", StorageClass="Global", MemorySection="CAL", DataType="single")
P_TOS_ACC_P0P1_Pre_Straight_LessThan_60_Truck_RL_dyc = AUTOSAR4.Parameter(repmat(1.5, 1, 6), SwCalibrationAccess="ReadWrite", StorageClass="Global", MemorySection="CAL", DataType="single")
P_TOS_ACC_P0P1_Pre_Straight_LessThan_60_Truck_RR_dyc = AUTOSAR4.Parameter(repmat(1.6, 1, 6), SwCalibrationAccess="ReadWrite", StorageClass="Global", MemorySection="CAL", DataType="single")
P_TOS_ACC_P0P1_Pre_Straight_LessThan_60_Truck_LL_dyc = AUTOSAR4.Parameter(repmat(1.6, 1, 6), SwCalibrationAccess="ReadWrite", StorageClass="Global", MemorySection="CAL", DataType="single")
P_TOS_ACC_P0P1_Pre_Straight_LessThan_60_Truck_LR_dyc = AUTOSAR4.Parameter(repmat(1.5, 1, 6), SwCalibrationAccess="ReadWrite", StorageClass="Global", MemorySection="CAL", DataType="single")
P_TOS_ACC_P0P1_Pre_Straight_default_LessThan_60_Truck_dyc = AUTOSAR4.Parameter(repmat(1.5, 1, 6), SwCalibrationAccess="ReadWrite", StorageClass="Global", MemorySection="CAL", DataType="single")
P_TOS_ACC_P0P1_Pre_Straight_SameLane_GreaterThan_60_Truick_dx = AUTOSAR4.Parameter([0 20 40 60 80 100], SwCalibrationAccess="ReadWrite", StorageClass="Global", MemorySection="CAL", DataType="single")
P_TOS_ACC_P0P1_Pre_Straight_SameLane_GreaterThan_60_Truck_dyc = AUTOSAR4.Parameter(repmat(1.6, 1, 6), SwCalibrationAccess="ReadWrite", StorageClass="Global", MemorySection="CAL", DataType="single")
P_TOS_ACC_P0P1_Pre_Straight_GreaterThan_60_Truck_RL_dyc = AUTOSAR4.Parameter(repmat(1.5, 1, 6), SwCalibrationAccess="ReadWrite", StorageClass="Global", MemorySection="CAL", DataType="single")
P_TOS_ACC_P0P1_Pre_Straight_GreaterThan_60_Truck_RR_dyc = AUTOSAR4.Parameter(repmat(1.6, 1, 6), SwCalibrationAccess="ReadWrite", StorageClass="Global", MemorySection="CAL", DataType="single")
P_TOS_ACC_P0P1_Pre_Straight_GreaterThan_60_Truck_LL_dyc = AUTOSAR4.Parameter(repmat(1.6, 1, 6), SwCalibrationAccess="ReadWrite", StorageClass="Global", MemorySection="CAL", DataType="single")
P_TOS_ACC_P0P1_Pre_Straight_GreaterThan_60_Truck_LR_dyc = AUTOSAR4.Parameter(repmat(1.5, 1, 6), SwCalibrationAccess="ReadWrite", StorageClass="Global", MemorySection="CAL", DataType="single")
P_TOS_ACC_P0P1_Pre_Straight_default_GreaterThan_60_Truck_dyc = AUTOSAR4.Parameter(repmat(1.5, 1, 6), SwCalibrationAccess="ReadWrite", StorageClass="Global", MemorySection="CAL", DataType="single")
P_TOS_P0P1_Pre_Straight_SameLane_GreatThan_60_Car_dx = AUTOSAR4.Parameter([0 20 40 60 80 100], SwCalibrationAccess="ReadWrite", StorageClass="Global", MemorySection="CAL", DataType="single")
P_TOS_ACC_P0P1_Pre_SmallOverLap_ObjWidth_Min = AUTOSAR4.Parameter(1.4, SwCalibrationAccess="ReadWrite", StorageClass="Global", MemorySection="CAL", DataType="single")  % value:由2改为1.4 ；三轮车识别为truck误选

P_TOS_P0P1_Pre_Straight_SameLane_LessThan_60_Car_dyc = AUTOSAR4.Parameter(repmat(1.45, 1, 6), SwCalibrationAccess="ReadWrite", StorageClass="Global", MemorySection="CAL", DataType="single")  % 原始：[1.45 1.45 1.45 1.45 1.45 1.45]
  % 优化后：[1.6 1.6 1.6 1.6 1.6 1.6]

P_TOS_P0P1_Pre_Straight_LessThan_60_Car_RL_dyc = AUTOSAR4.Parameter(repmat(1.35, 1, 6), SwCalibrationAccess="ReadWrite", StorageClass="Global", MemorySection="CAL", DataType="single")  % 原始：[1.35 1.35 1.35 1.35 1.35 1.35]
  % 优化后：[1.45 1.45 1.45 1.45 1.45 1.45]

P_TOS_P0P1_Pre_Straight_LessThan_60_Car_RR_dyc = AUTOSAR4.Parameter(repmat(1.5, 1, 6), SwCalibrationAccess="ReadWrite", StorageClass="Global", MemorySection="CAL", DataType="single")  % 原始：[1.5 1.5 1.5 1.5 1.5 1.5]
  % 优化后：[1.55 1.55 1.55 1.55 1.55 1.55]

P_TOS_P0P1_Pre_Straight_LessThan_60_Car_LL_dyc = AUTOSAR4.Parameter(repmat(1.5, 1, 6), SwCalibrationAccess="ReadWrite", StorageClass="Global", MemorySection="CAL", DataType="single")  % 原始：[1.5 1.5 1.5 1.5 1.5 1.5]
  % 优化后：[1.55 1.55 1.55 1.55 1.55 1.55]

P_TOS_P0P1_Pre_Straight_LessThan_60_Car_LR_dyc = AUTOSAR4.Parameter(repmat(1.35, 1, 6), SwCalibrationAccess="ReadWrite", StorageClass="Global", MemorySection="CAL", DataType="single")  % 原始：[1.35 1.35 1.35 1.35 1.35 1.35]
  % 优化：[1.45 1.45 1.45 1.45 1.45 1.45]

P_TOS_P0P1_Pre_Straight_LessThan_60_RR_dy = AUTOSAR4.Parameter([2.1 2.1 2 1.9 1.9 1.9], SwCalibrationAccess="ReadWrite", StorageClass="Global", MemorySection="CAL", DataType="single")  % 优化前：[2.1 2.1 2 1.9 1.9 1.9]
  % 优化后：[2.2    2.2   2.1    2      2    2   ]

P_TOS_P0P1_Pre_Straight_LessThan_60_LL_dy = AUTOSAR4.Parameter([2.1 2.1 2 1.9 1.9 1.9], SwCalibrationAccess="ReadWrite", StorageClass="Global", MemorySection="CAL", DataType="single")  % 优化前：[2.1 2.1 2 1.9 1.9 1.9]
  % 优化后：[2.2    2.2   2.1    2      2    2   ]

P_TOS_P0P1_Pre_Straight_LessThan_60_LR_dy = AUTOSAR4.Parameter([1.9 1.9 1.8 1.8 1.7 1.7], SwCalibrationAccess="ReadWrite", StorageClass="Global", MemorySection="CAL", DataType="single")  % 优化前 [1.9 1.9 1.8 1.8 1.7 1.7]
  % 优化后：[2     2   1.9    1.9       1.8   1.8]

P_TOS_ACC_P0P1_CutIn_Car_SameLaneWidth_MinVal = AUTOSAR4.Parameter(0.1, SwCalibrationAccess="ReadWrite", StorageClass="Global", MemorySection="CAL", DataType="single")  % 车道宽度修正参数
  % < 0时；加宽车道宽度
  % > 0时；收缩车道宽度

P_TOS_ACC_P0P1_CutIn_Pre_Truck_ObjWidth_Min = AUTOSAR4.Parameter(1.4, SwCalibrationAccess="ReadWrite", StorageClass="Global", MemorySection="CAL", DataType="single")  % 三轮车目标误识别truck

P_TOS_P0P1_CutIn_Car_SameLaneWidth_MinVal = AUTOSAR4.Parameter(-0.05, SwCalibrationAccess="ReadWrite", StorageClass="Global", MemorySection="CAL", DataType="single")  % 车道宽度修正参数
  % < 0时；加宽车道宽度
  % > 0时；收缩车道宽度

P_TOS_P0P1_CutIn_Car_SameLaneWidth_MaxVal = AUTOSAR4.Parameter(0.05, SwCalibrationAccess="ReadWrite", StorageClass="Global", MemorySection="CAL", DataType="single")  % 车道宽度修正参数
  % < 0时；加宽车道宽度
  % > 0时；收缩车道宽度

P_TOS_SmallOverlap_Near_Switch = AUTOSAR4.Parameter(2, SwCalibrationAccess="ReadWrite", StorageClass="Global", MemorySection="CAL", DataType="single")  % 1:原始 小重叠输出
  % 2：优化后小重叠输出

P_TOS_P0P1_Pre_Straight_SameLane_LessThan_60_Truck_dy_Max_opt = AUTOSAR4.Parameter(2.5, SwCalibrationAccess="ReadWrite", StorageClass="Global", MemorySection="CAL", DataType="single")
P_TOS_ACC_P0P1_Pre_Curve_SameLane_dyc_HandOff = AUTOSAR4.Parameter(repmat(1.5, 1, 6), SwCalibrationAccess="ReadWrite", StorageClass="Global", MemorySection="CAL", DataType="single")
P_TOS_ACC_P0P1_Pre_Curve_SameLane_dx_HandOff = AUTOSAR4.Parameter([0 20 40 60 80 100], SwCalibrationAccess="ReadWrite", StorageClass="Global", MemorySection="CAL", DataType="single")
P_TOS_ACC_P0P1_Pre_Curve_default_dyc_HandOff = AUTOSAR4.Parameter(repmat(1.2, 1, 6), SwCalibrationAccess="ReadWrite", StorageClass="Global", MemorySection="CAL", DataType="single")
P_TOS_P0P1_Pre_Curve_HandOff_offset = AUTOSAR4.Parameter(0.5, SwCalibrationAccess="ReadWrite", StorageClass="Global", MemorySection="CAL", DataType="single")
P_TOS_ACC_P0P1_Pre_Curve_SameLane_Truck_dyc_HandOff = AUTOSAR4.Parameter(repmat(1.5, 1, 6), SwCalibrationAccess="ReadWrite", StorageClass="Global", MemorySection="CAL", DataType="single")
P_TOS_ACC_P0P1_Pre_Curve_SameLane_Truck_dx_HandOff = AUTOSAR4.Parameter([0 20 40 60 80 100], SwCalibrationAccess="ReadWrite", StorageClass="Global", MemorySection="CAL", DataType="single")
P_TOS_ACC_P0P1_Pre_Curve_Truck_default_dyc_HandOff = AUTOSAR4.Parameter(repmat(1.2, 1, 6), SwCalibrationAccess="ReadWrite", StorageClass="Global", MemorySection="CAL", DataType="single")
P_TOS_P0P1_Pre_Straight_SameLane_LessThan_60_Car_dx_HandOff = AUTOSAR4.Parameter([0 20 40 60 80 100], SwCalibrationAccess="ReadWrite", StorageClass="Global", MemorySection="CAL", DataType="single")
P_TOS_P0P1_Pre_Straight_SameLane_LessThan_60_Car_dyc_HandOff = AUTOSAR4.Parameter(repmat(1.45, 1, 6), SwCalibrationAccess="ReadWrite", StorageClass="Global", MemorySection="CAL", DataType="single")  % 原始：[1.45 1.45 1.45 1.45 1.45 1.45]

P_TOS_P0P1_Pre_Straight_LessThan_60_Car_default_dyc_HandOff = AUTOSAR4.Parameter(repmat(1.2, 1, 6), SwCalibrationAccess="ReadWrite", StorageClass="Global", MemorySection="CAL", DataType="single")  % 原始：[1.2 1.2 1.2 1.2 1.2 1.2]
  % 优化

P_TOS_P0P1_Pre_Straight_SameLane_GreatThan_60_Car_dyc_HandOff = AUTOSAR4.Parameter(repmat(1.6, 1, 6), SwCalibrationAccess="ReadWrite", StorageClass="Global", MemorySection="CAL")  % 原始：[1.45  1.45    1.45    1.45   1.45  1.45]
  % 优化后：[1.6 1.6 1.6 1.6 1.6 1.6]

P_TOS_P0P1_Pre_Straight_SameLane_GreatThan_60_Car_dx_HandOff = AUTOSAR4.Parameter([0 20 40 60 80 100], SwCalibrationAccess="ReadWrite", StorageClass="Global", MemorySection="CAL", DataType="single")

P_TOS_P0P1_Pre_Strght_SameLane_GreatThan_60_default_dyc_HandOff = AUTOSAR4.Parameter(repmat(1.3, 1, 6), SwCalibrationAccess="ReadWrite", StorageClass="Global", MemorySection="CAL", DataType="single")  % 原始： [1.2    1.2    1.2   1.2   1.2  1.2]
  % 优化：[1.3 1.3 1.3 1.3 1.3 1.3]

P_TOS_P0P1_Pre_Strght_SameLane_GreaterThan_60_Truck_dyc_Handoff = AUTOSAR4.Parameter(repmat(1.6, 1, 6), SwCalibrationAccess="ReadWrite", StorageClass="Global", MemorySection="CAL", DataType="single")
P_TOS_P0P1_Pre_Stragt_SameLane_GreaterThan_60_Truick_dx_HandOff = AUTOSAR4.Parameter([0 20 40 60 80 100], SwCalibrationAccess="ReadWrite", StorageClass="Global", MemorySection="CAL", DataType="single")
P_TOS_P0P1_Pre_Stragt_default_GreaterThan_60_Truck_dyc_HandOff = AUTOSAR4.Parameter(repmat(1.5, 1, 6), SwCalibrationAccess="ReadWrite", StorageClass="Global", MemorySection="CAL", DataType="single")
P_TOS_P0P1_Pre_Straight_SameLane_LessThan_60_Truck_dyc_HandOff = AUTOSAR4.Parameter(repmat(1.5, 1, 6), SwCalibrationAccess="ReadWrite", StorageClass="Global", MemorySection="CAL", DataType="single")
P_TOS_P0P1_Pre_Straight_default_LessThan_60_Truck_dyc_HandOff = AUTOSAR4.Parameter(repmat(1.5, 1, 6), SwCalibrationAccess="ReadWrite", StorageClass="Global", MemorySection="CAL", DataType="single")
P_TOS_P0P1_Pre_Straight_SameLane_LessThan_60_dy_Min_HandOff = AUTOSAR4.Parameter(0.65, SwCalibrationAccess="ReadWrite", StorageClass="Global", MemorySection="CAL", DataType="single")
P_TOS_P0P1_Pre_Straight_SameLane_LessThan_60_dy_Max_HandOff = AUTOSAR4.Parameter(2.1, SwCalibrationAccess="ReadWrite", StorageClass="Global", MemorySection="CAL", DataType="single")
P_TOS_P0P1_Pre_Straight_LessThan_60_default_dy_HandOff = AUTOSAR4.Parameter(repmat(1.7, 1, 6), SwCalibrationAccess="ReadWrite", StorageClass="Global", MemorySection="CAL", DataType="single")
P_TOS_P0P1_Pre_Straight_LessThan_60_default_dx_HandOff = AUTOSAR4.Parameter([0 20 40 60 80 100], SwCalibrationAccess="ReadWrite", StorageClass="Global", MemorySection="CAL", DataType="single")
P_TOS_P0P1_Pre_Straight_SameLane_GreaterThan_60_dy_Max_HandOff = AUTOSAR4.Parameter(2.4, SwCalibrationAccess="ReadWrite", StorageClass="Global", MemorySection="CAL", DataType="single")
P_TOS_P0P1_Pre_Straight_SameLane_GreaterThan_60_dy_Min_HandOff = AUTOSAR4.Parameter(0.65, SwCalibrationAccess="ReadWrite", StorageClass="Global", MemorySection="CAL", DataType="single")
P_TOS_P0P1_Pre_Straight_GreaterThan_60_default_dy_HandOff = AUTOSAR4.Parameter(repmat(1.7, 1, 6), SwCalibrationAccess="ReadWrite", StorageClass="Global", MemorySection="CAL", DataType="single")
P_TOS_P0P1_Pre_Straight_GreaterThan_60_default_dx_HandOff = AUTOSAR4.Parameter([0 20 40 60 80 100], SwCalibrationAccess="ReadWrite", StorageClass="Global", MemorySection="CAL", DataType="single")
P_TOS_ACC_P0P1_Pre_Straight_SameLane_LessThan_60_dy_Max = AUTOSAR4.Parameter(2.1, SwCalibrationAccess="ReadWrite", StorageClass="Global", MemorySection="CAL", DataType="single")
P_TOS_ACC_P0P1_Pre_Straight_SameLane_LessThan_60_dy_Min = AUTOSAR4.Parameter(0.65, SwCalibrationAccess="ReadWrite", StorageClass="Global", MemorySection="CAL", DataType="single")
P_TOS_P0P1_Pre_Stragt_SameLane_LessThan_60_Truck_dy_Min_HandOff = AUTOSAR4.Parameter(0.65, SwCalibrationAccess="ReadWrite", StorageClass="Global", MemorySection="CAL", DataType="single")
P_TOS_P0P1_Pre_Stragt_SameLane_LessThan_60_Truck_dy_Max_HandOff = AUTOSAR4.Parameter(2.5, SwCalibrationAccess="ReadWrite", StorageClass="Global", MemorySection="CAL", DataType="single")
P_TOS_P0P1_Pre_Straight_default_LessThan_60_Truck_dy_HandOff = AUTOSAR4.Parameter([2.4 2.4 2.3 2.3 2.2 2.2], SwCalibrationAccess="ReadWrite", StorageClass="Global", MemorySection="CAL", DataType="single")
P_TOS_P0P1_Pre_Straight_default_LessThan_60_Truck_dx_HandOff = AUTOSAR4.Parameter([0 20 40 60 80 100], SwCalibrationAccess="ReadWrite", StorageClass="Global", MemorySection="CAL", DataType="single")
P_TOS_P0P1_Pre_Stragt_SameLane_GtrThan_60_Truck_dy_Min_HandOff = AUTOSAR4.Parameter(0.65, SwCalibrationAccess="ReadWrite", StorageClass="Global", MemorySection="CAL", DataType="single")
P_TOS_P0P1_Pre_Strigt_SameLane_GrtrThan_60_Truck_dy_Max_HandOff = AUTOSAR4.Parameter(2.7, SwCalibrationAccess="ReadWrite", StorageClass="Global", MemorySection="CAL", DataType="single")
P_TOS_P0P1_Pre_Straight_SameLane_GreaterThan_60_Truck_dy_MinCop = AUTOSAR4.Parameter(0.65, SwCalibrationAccess="ReadWrite", StorageClass="Global", MemorySection="CAL", DataType="single")
P_TOS_P0P1_Pre_Straight_SameLane_GreaterThan_60_Truck_dy_Max = AUTOSAR4.Parameter(2.7, SwCalibrationAccess="ReadWrite", StorageClass="Global", MemorySection="CAL", DataType="single")
P_TOS_P0P1_Pre_Stragt_SameLane_GrtrThan_60_Truck_dy_Max_HandOff = AUTOSAR4.Parameter(2.7, SwCalibrationAccess="ReadWrite", StorageClass="Global", MemorySection="CAL", DataType="single")
P_TOS_P0P1_Pre_Straight_default_GreaterThan_60_Truck_dy_HandOff = AUTOSAR4.Parameter([2.4 2.4 2.3 2.3 2.2 2.2], SwCalibrationAccess="ReadWrite", StorageClass="Global", MemorySection="CAL", DataType="single")
P_TOS_P0P1_Pre_Straight_default_GreaterThan_60_Truck_dx_HandOff = AUTOSAR4.Parameter([0 20 40 60 80 100], SwCalibrationAccess="ReadWrite", StorageClass="Global", MemorySection="CAL", DataType="single")
P_TOS_P0P1_Pre_Straight_SameLane_LessThan_60_Truick_dx_HandOff = AUTOSAR4.Parameter([0 20 40 60 80 100], SwCalibrationAccess="ReadWrite", StorageClass="Global", MemorySection="CAL", DataType="single")
P_TOS_P0P1_EgoVehCenterLine_dy_Value_HandOff = AUTOSAR4.Parameter(1.3, SwCalibrationAccess="ReadWrite", StorageClass="Global", MemorySection="CAL", DataType="single")

P_TOS_P0P1_Pre_Straight_SameLane_GreatThan_60_Car_dyc = AUTOSAR4.Parameter([1.8 1.8 1.8 1.7 1.7 1.7], SwCalibrationAccess="ReadWrite", StorageClass="Global", MemorySection="CAL")  % 原始：[1.45  1.45    1.45    1.45   1.45  1.45]
  % 优化后：[1.6 1.6 1.6 1.6 1.6 1.6]
  % 优化后：[1.8 1.8 1.8 1.7 1.7 1.7] -2021-09-01

P_TOS_ACC_P0P1_Pre_CutIn_Obj_absVx_val = AUTOSAR4.Parameter(8, SwCalibrationAccess="ReadWrite", StorageClass="Global", MemorySection="CAL", DataType="single")  % 原始；2.7
  % 优化：8

P_TOS_ACC_P0P1_CutIn_Pre_Greater60_LR_dy = AUTOSAR4.Parameter([2.65 2.65 2.5 2.5 2.45 2.45], SwCalibrationAccess="ReadWrite", StorageClass="Global", MemorySection="CAL", DataType="single")  % 优化：[2.65 2.65 2.5 2.5 2.45 2.45]-2021-09-01
  % 优化参数：[2.45 2.45 2.25 2.25 2.15 2.15]
  % 原始参数：[2 2 1.9 1.9 1.8 1.8]

P_TOS_ACC_P0P1_Pre_CutIn_Obj_dx_val = AUTOSAR4.Parameter([50 50 80 80], SwCalibrationAccess="ReadWrite", StorageClass="Global", MemorySection="CAL", DataType="single")

P_TOS_ACC_P0P1_Pre_Straight_SameLane_GreaterThan_60_dy_Max = AUTOSAR4.Parameter(2.75, SwCalibrationAccess="ReadWrite", StorageClass="Global", MemorySection="CAL", DataType="single")  % 原始： 2.4
  % 优化：2.75

TOS_ACC_P0P1_Index = AUTOSAR4.Signal(SwCalibrationAccess="ReadOnly", StorageClass="Global", MemorySection="VAR")
TOS_ACC_P0P1_Pre = AUTOSAR4.Signal(SwCalibrationAccess="ReadOnly", StorageClass="Global", MemorySection="VAR")
TOS_ACC_P0P1_Pre_FiltFlag = AUTOSAR4.Signal(SwCalibrationAccess="ReadOnly", StorageClass="Global", MemorySection="VAR", DataType="boolean")
TOS_ACC_P0P1_Pre_SameLaneFlag = AUTOSAR4.Signal(SwCalibrationAccess="ReadOnly", StorageClass="Global", MemorySection="VAR", DataType="boolean")
TOS_ACC_P0_Confirm = AUTOSAR4.Signal(SwCalibrationAccess="ReadOnly", StorageClass="Global", MemorySection="VAR")
TOS_ACC_P0_Traget_Index = AUTOSAR4.Signal(SwCalibrationAccess="ReadOnly", StorageClass="Global", MemorySection="VAR", DataType="uint8")
TOS_ACC_P1_Confirm = AUTOSAR4.Signal(SwCalibrationAccess="ReadOnly", StorageClass="Global", MemorySection="VAR")
TOS_ACC_P1_Traget_Index = AUTOSAR4.Signal(SwCalibrationAccess="ReadOnly", StorageClass="Global", MemorySection="VAR", DataType="uint8")
TOS_ACC_P2_P4_Index = AUTOSAR4.Signal(SwCalibrationAccess="ReadOnly", StorageClass="Global", MemorySection="VAR", DataType="uint8")
TOS_ACC_P3_P5_Index = AUTOSAR4.Signal(SwCalibrationAccess="ReadOnly", StorageClass="Global", MemorySection="VAR", DataType="uint8")
TOS_ACC_P2_Traget_Index = AUTOSAR4.Signal(SwCalibrationAccess="ReadOnly", StorageClass="Global", MemorySection="VAR", DataType="uint8")
TOS_ACC_P4_Traget_Index = AUTOSAR4.Signal(SwCalibrationAccess="ReadOnly", StorageClass="Global", MemorySection="VAR", DataType="uint8")
TOS_ACC_P3_Traget_Index = AUTOSAR4.Signal(SwCalibrationAccess="ReadOnly", StorageClass="Global", MemorySection="VAR", DataType="uint8")
TOS_ACC_P5_Traget_Index = AUTOSAR4.Signal(SwCalibrationAccess="ReadOnly", StorageClass="Global", MemorySection="VAR")
TOS_7_ACC_SW_VERSION = AUTOSAR4.Signal(SwCalibrationAccess="ReadOnly", StorageClass="Global", MemorySection="VAR", DataType="uint32")
P_TOS_ACC_P0P1_Curvature_val = AUTOSAR4.Parameter(0.0003, SwCalibrationAccess="ReadWrite", StorageClass="Global", MemorySection="CAL", DataType="single")
P_TOS_ACC_P0P1_TargetPre_dy_Car_OverlapThre_Val = AUTOSAR4.Parameter(0.45, SwCalibrationAccess="ReadWrite", StorageClass="Global", MemorySection="CAL", DataType="single")
P_TOS_ACC_EgoFrontDxThre_90_Val = AUTOSAR4.Parameter(120, SwCalibrationAccess="ReadWrite", StorageClass="Global", MemorySection="CAL", DataType="single")