% Simulink data dictionary PvtParsTOS_8_HWA.sldd

P_TOS_HWA_EgoFrontDxThre_120_Val = AUTOSAR4.Parameter(140, SwCalibrationAccess="ReadWrite", StorageClass="Global", MemorySection="CAL", DataType="single")
P_TOS_HWA_EgoFrontDxThre_70_Val = AUTOSAR4.Parameter(70, SwCalibrationAccess="ReadWrite", StorageClass="Global", MemorySection="CAL", DataType="single")
P_TOS_HWA_EgoFrontDxThre_90_Val = AUTOSAR4.Parameter(110, SwCalibrationAccess="ReadWrite", StorageClass="Global", MemorySection="CAL", DataType="single")
P_TOS_HWA_EgoFrontDxThre_95_Val = AUTOSAR4.Parameter(95, SwCalibrationAccess="ReadWrite", StorageClass="Global", MemorySection="CAL", DataType="single")
P_TOS_HWA_EgoFrontDxThre_Val = AUTOSAR4.Parameter(120, SwCalibrationAccess="ReadWrite", StorageClass="Global", MemorySection="CAL", DataType="single")  % 自车前方最远 120m
P_TOS_HWA_EgoRearDxThre_Val = AUTOSAR4.Parameter(-80, SwCalibrationAccess="ReadWrite", StorageClass="Global", MemorySection="CAL", DataType="single")  % 自车后方最远 80 m
P_TOS_HWA_LongVyThre_Val = AUTOSAR4.Parameter(2, SwCalibrationAccess="ReadWrite", StorageClass="Global", MemorySection="CAL", DataType="single")
P_TOS_HWA_ObjInSameDirYawAngMaxThre_Val = AUTOSAR4.Parameter(45, SwCalibrationAccess="ReadWrite", StorageClass="Global", MemorySection="CAL", DataType="single")
P_TOS_HWA_ObjInSameDirYawAngMinThre_Val = AUTOSAR4.Parameter(0, SwCalibrationAccess="ReadWrite", StorageClass="Global", MemorySection="CAL", DataType="single")
P_TOS_HWA_ObjLatCroYawAngMaxThre_Val = AUTOSAR4.Parameter(135, SwCalibrationAccess="ReadWrite", StorageClass="Global", MemorySection="CAL", DataType="single")
P_TOS_HWA_ObjOncomingYawAngMaxThre_Val = AUTOSAR4.Parameter(180, SwCalibrationAccess="ReadWrite", StorageClass="Global", MemorySection="CAL", DataType="single")
P_TOS_HWA_ObstacleProbThre_Valu = AUTOSAR4.Parameter(0.4, SwCalibrationAccess="ReadWrite", StorageClass="Global", MemorySection="CAL", DataType="single")
P_TOS_HWA_OncomingDirVxvOffset_Val = AUTOSAR4.Parameter(0.2, SwCalibrationAccess="ReadWrite", StorageClass="Global", MemorySection="CAL", DataType="single")
P_TOS_HWA_RefPoint_FixDis_dx1_m = AUTOSAR4.Parameter(-7, SwCalibrationAccess="ReadWrite", StorageClass="Global", MemorySection="CAL", DataType="single")
P_TOS_HWA_RefPoint_FixDis_dx2_m = AUTOSAR4.Parameter(7.5, SwCalibrationAccess="ReadWrite", StorageClass="Global", MemorySection="CAL", DataType="single")
P_TOS_HWA_RefPoint_dx_m = AUTOSAR4.Parameter(0, SwCalibrationAccess="ReadWrite", StorageClass="Global", MemorySection="CAL", DataType="single")
P_TOS_HWA_SameDirVxvOffset_Val = AUTOSAR4.Parameter(1, SwCalibrationAccess="ReadWrite", StorageClass="Global", MemorySection="CAL", DataType="single")
P_TOS_HWA_SameDirVyOffset_Val = AUTOSAR4.Parameter(2, SwCalibrationAccess="ReadWrite", StorageClass="Global", MemorySection="CAL", DataType="single")
P_TOS_HWA_TargetInFrontEgoVehicle_OverlapThre_Val = AUTOSAR4.Parameter(0.05, SwCalibrationAccess="ReadWrite", StorageClass="Global", MemorySection="CAL", DataType="single")
P_TOS_HWA_TargetOverlapThre_Val = AUTOSAR4.Parameter(0.15, SwCalibrationAccess="ReadWrite", StorageClass="Global", MemorySection="CAL", DataType="single")
P_TOS_HWA_TargetPre_OverlapThre_Val = AUTOSAR4.Parameter(0.05, SwCalibrationAccess="ReadWrite", StorageClass="Global", MemorySection="CAL", DataType="single")
P_TOS_HWA_TargetPre_Truck_OverlapThre_Val = AUTOSAR4.Parameter(0, SwCalibrationAccess="ReadWrite", StorageClass="Global", MemorySection="CAL", DataType="single")
P_TOS_HWA_PP_ObjectMovingState_E = AUTOSAR4.Parameter(2, SwCalibrationAccess="ReadWrite", StorageClass="Global", MemorySection="CAL", DataType="uint8")
P_TOS_HWA_HWA_CurrentRear_RefPoint_FixDis_dx1_m = AUTOSAR4.Parameter(-7, SwCalibrationAccess="ReadWrite", StorageClass="Global", MemorySection="CAL", DataType="single")
TOS_HWA_CurrentLane_ObjIndex = AUTOSAR4.Signal(SwCalibrationAccess="ReadOnly", StorageClass="Global", MemorySection="VAR", DataType="uint8")
TOS_HWA_LeftLane_Confirm = AUTOSAR4.Signal(SwCalibrationAccess="ReadOnly", StorageClass="Global", MemorySection="VAR")
TOS_HWA_RightLane_Confirm = AUTOSAR4.Signal(SwCalibrationAccess="ReadOnly", StorageClass="Global", MemorySection="VAR")
TOS_HWA_RightLane_ObjIndex = AUTOSAR4.Signal(SwCalibrationAccess="ReadOnly", StorageClass="Global", MemorySection="VAR", DataType="uint8")
TOS_HWA_Same_F2_Confirm = AUTOSAR4.Signal(SwCalibrationAccess="ReadOnly", StorageClass="Global", MemorySection="VAR")
TOS_8_HWA_SW_VERSION = AUTOSAR4.Signal(SwCalibrationAccess="ReadOnly", StorageClass="Global", MemorySection="VAR", DataType="uint32")