% Simulink data dictionary PvtParsTOS_Internal_PublicPars.sldd

C_TOS_PublicPars_TargNum = Simulink.Parameter(80, DataType="uint8")
C_TOS_PIL_OverLap_CNsubjWidth = Simulink.Parameter(1.8, DataType="single")
Alias = Simulink.AliasType(BaseType="double")

OFM_OBJ_FUSTYPE = enum(DefaultValue="INVALID", AddClassNameToEnumNames=true)
  FC_FR = 3  % FC代表摄像头；FR代表前雷达；
  FC_FR_CL = 7  % CL代表左角雷达；CR代表右角雷达；
  FC_FR_CR = 11  % BL代表左盲点雷达；BR代表右盲点雷达；
  FC_FR_CL_CR = 15
  FC_FR_BL = 19
  FC_FR_CL_BL = 23
  FC_FR_CR_BL = 27
  FC_FR_CL_CR_BL = 31
  FC_FR_BR = 35
  FC_FR_CL_BR = 39
  FC_FR_CR_BR = 43
  FC_FR_CL_CR_BR = 47
  FC_FR_BL_BR = 51
  FC_FR_CL_BL_BR = 55
  FC_FR_CR_BL_BR = 59
  FC_FR_CL_CR_BL_BR = 63
  INVALID = 0
  FC = 1
  FR = 2
  CL = 4
  FC_CL = 5
  FR_CL = 6
  CR = 8
  FC_CR = 9
  FR_CR = 10
  CL_CR = 12
  FC_CL_CR = 13
  FR_CL_CR = 14
  BL = 16
  FC_BL = 17
  FR_BL = 18
  CL_BL = 20
  FC_CL_BL = 21
  FR_CL_BL = 22
  CR_BL = 24
  FC_CR_BL = 25
  FR_CR_BL = 26
  CL_CR_BL = 28
  FC_CL_CR_BL = 29
  FR_CL_CR_BL = 30
  BR = 32
  FC_BR = 33
  FR_BR = 34
  CL_BR = 36
  FC_CL_BR = 37
  FR_CL_BR = 38
  CR_BR = 40
  FC_CR_BR = 41
  FR_CR_BR = 42
  CL_CR_BR = 44
  FC_CL_CR_BR = 45
  FR_CL_CR_BR = 46
  BL_BR = 48
  FC_BL_BR = 49
  FR_BL_BR = 50
  CL_BL_BR = 52
  FC_CL_BL_BR = 53
  FR_CL_BL_BR = 54
  CR_BL_BR = 56
  FC_CR_BL_BR = 57
  FR_CR_BL_BR = 58
  CL_CR_BL_BR = 60
  FC_CL_CR_BL_BR = 61
  FR_CL_CR_BL_BR = 62

LM_DrivInWLFlag_E = enum(DefaultValue="INVALID", AddClassNameToEnumNames=true)
  INVALID = 0
  EgoCarInLeftLane = 1
  EgoCarInMidLane = 2
  EgoCarInRightLane = 3

LM_RoadNumChg_E = enum(DefaultValue="NotChange", AddClassNameToEnumNames=true)
  NotChange = 0
  LeftAdd = 1
  RightAdd = 2
  LeftDes = 3
  RightDes = 4

LM_SpecialRoadType_E = enum(DefaultValue="enum1", AddClassNameToEnumNames=true)
  enum1 = 0

ObjectMovingOrientation_E = enum(DefaultValue="UnknownDir", AddClassNameToEnumNames=true)
  UnknownDir = 0  % 目标运动方向：未知
  SameDir = 1  % 目标运动方向：同向
  OnComingDir = 2  % 目标运动方向：对向
  Crossing = 3  % 目标运动方向：横穿

ObjectMovingState_AEB_E = enum(DefaultValue="UnknownState", AddClassNameToEnumNames=true)
  UnknownState = 0
  Still = 1
  Moving = 2
  Stopped = 3

ObjectMovingState_E = enum(DefaultValue="invalid", AddClassNameToEnumNames=true)
  invalid = 0  % TOS输出，目标运动状态：未知
  UnknownState = 1  % TOS输出，目标运动状态：未知
  Moving = 2  % TOS输出，目标运动状态：运动的
  Still = 3  % TOS输出，目标运动状态：一直静止
  Stopped = 4  % 运动到停