% Simulink data dictionary PvtParsUNPACK_IF.sldd

UNPACK_IF_DATACLCT_VCAN_ABM = AUTOSAR4.Signal(SwCalibrationAccess="ReadOnly", StorageClass="Global", MemorySection="VAR")
UNPACK_IF_EQ4COM_VCAN_ABM = AUTOSAR4.Signal(SwCalibrationAccess="ReadOnly", StorageClass="Global", MemorySection="VAR")
UNPACK_IF_DMON_VCAN_ABM = AUTOSAR4.Signal(SwCalibrationAccess="ReadOnly", StorageClass="Global", MemorySection="VAR")
UNPACK_IF_AHBC_VCAN_ABM = AUTOSAR4.Signal(SwCalibrationAccess="ReadOnly", StorageClass="Global", MemorySection="VAR")
UNPACK_IF_VSM_VCAN_ABM = AUTOSAR4.Signal(SwCalibrationAccess="ReadOnly", StorageClass="Global", MemorySection="VAR")
UNPACK_IF_AEB_VCAN_ABM = AUTOSAR4.Signal(SwCalibrationAccess="ReadOnly", StorageClass="Global", MemorySection="VAR")
UNPACK_IF_VIE_VCAN_ABM = AUTOSAR4.Signal(SwCalibrationAccess="ReadOnly", StorageClass="Global", MemorySection="VAR")
UNPACK_IF_EQ4COM_VCAN_AC = AUTOSAR4.Signal(SwCalibrationAccess="ReadOnly", StorageClass="Global", MemorySection="VAR")
UNPACK_IF_DMON_VCAN_AC = AUTOSAR4.Signal(SwCalibrationAccess="ReadOnly", StorageClass="Global", MemorySection="VAR")
UNPACK_IF_VSM_VCAN_AC = AUTOSAR4.Signal(SwCalibrationAccess="ReadOnly", StorageClass="Global", MemorySection="VAR")
UNPACK_IF_DATACLCT_VCAN_BCM = AUTOSAR4.Signal(SwCalibrationAccess="ReadOnly", StorageClass="Global", MemorySection="VAR")
UNPACK_IF_DMON_VCAN_BCM = AUTOSAR4.Signal(SwCalibrationAccess="ReadOnly", StorageClass="Global", MemorySection="VAR")
UNPACK_IF_AHBC_VCAN_BCM = AUTOSAR4.Signal(SwCalibrationAccess="ReadOnly", StorageClass="Global", MemorySection="VAR")
UNPACK_IF_VSM_VCAN_BCM = AUTOSAR4.Signal(SwCalibrationAccess="ReadOnly", StorageClass="Global", MemorySection="VAR")
UNPACK_IF_AEB_VCAN_BCM = AUTOSAR4.Signal(SwCalibrationAccess="ReadOnly", StorageClass="Global", MemorySection="VAR")
UNPACK_IF_DATACLCT_VCAN_CSA = AUTOSAR4.Signal(SwCalibrationAccess="ReadOnly", StorageClass="Global", MemorySection="VAR")
UNPACK_IF_EQ4COM_VCAN_CSA = AUTOSAR4.Signal(SwCalibrationAccess="ReadOnly", StorageClass="Global", MemorySection="VAR")
UNPACK_IF_DMON_VCAN_CSA = AUTOSAR4.Signal(SwCalibrationAccess="ReadOnly", StorageClass="Global", MemorySection="VAR")
UNPACK_IF_AHBC_VCAN_CSA = AUTOSAR4.Signal(SwCalibrationAccess="ReadOnly", StorageClass="Global", MemorySection="VAR")
UNPACK_IF_VSM_VCAN_CSA = AUTOSAR4.Signal(SwCalibrationAccess="ReadOnly", StorageClass="Global", MemorySection="VAR")
UNPACK_IF_AEB_VCAN_CSA = AUTOSAR4.Signal(SwCalibrationAccess="ReadOnly", StorageClass="Global", MemorySection="VAR")
UNPACK_IF_LATC_VCAN_CSA = AUTOSAR4.Signal(SwCalibrationAccess="ReadOnly", StorageClass="Global", MemorySection="VAR")
UNPACK_IF_TOS_VCAN_CSA = AUTOSAR4.Signal(SwCalibrationAccess="ReadOnly", StorageClass="Global", MemorySection="VAR")
UNPACK_IF_LM_VCAN_CSA = AUTOSAR4.Signal(SwCalibrationAccess="ReadOnly", StorageClass="Global", MemorySection="VAR")
UNPACK_IF_VIE_VCAN_CSA = AUTOSAR4.Signal(SwCalibrationAccess="ReadOnly", StorageClass="Global", MemorySection="VAR")
UNPACK_IF_DMON_VCAN_CR = AUTOSAR4.Signal(SwCalibrationAccess="ReadOnly", StorageClass="Global", MemorySection="VAR")
UNPACK_IF_VSM_VCAN_CR = AUTOSAR4.Signal(SwCalibrationAccess="ReadOnly", StorageClass="Global", MemorySection="VAR")
UNPACK_IF_AEB_VCAN_CR = AUTOSAR4.Signal(SwCalibrationAccess="ReadOnly", StorageClass="Global", MemorySection="VAR")
UNPACK_IF_DATACLCT_VCAN_DCT = AUTOSAR4.Signal(SwCalibrationAccess="ReadOnly", StorageClass="Global", MemorySection="VAR")
UNPACK_IF_EQ4COM_VCAN_DCT = AUTOSAR4.Signal(SwCalibrationAccess="ReadOnly", StorageClass="Global", MemorySection="VAR")
UNPACK_IF_DMON_VCAN_DCT = AUTOSAR4.Signal(SwCalibrationAccess="ReadOnly", StorageClass="Global", MemorySection="VAR")
UNPACK_IF_AHBC_VCAN_DCT = AUTOSAR4.Signal(SwCalibrationAccess="ReadOnly", StorageClass="Global", MemorySection="VAR")
UNPACK_IF_VSM_VCAN_DCT = AUTOSAR4.Signal(SwCalibrationAccess="ReadOnly", StorageClass="Global", MemorySection="VAR")
UNPACK_IF_AEB_VCAN_DCT = AUTOSAR4.Signal(SwCalibrationAccess="ReadOnly", StorageClass="Global", MemorySection="VAR")
UNPACK_IF_LONC_VCAN_DCT = AUTOSAR4.Signal(SwCalibrationAccess="ReadOnly", StorageClass="Global", MemorySection="VAR")
UNPACK_IF_DATACLCT_VCAN_DMS = AUTOSAR4.Signal(SwCalibrationAccess="ReadOnly", StorageClass="Global", MemorySection="VAR")
UNPACK_IF_EQ4COM_VCAN_DMS = AUTOSAR4.Signal(SwCalibrationAccess="ReadOnly", StorageClass="Global", MemorySection="VAR")
UNPACK_IF_DMON_VCAN_DMS = AUTOSAR4.Signal(SwCalibrationAccess="ReadOnly", StorageClass="Global", MemorySection="VAR")
UNPACK_IF_DMS_VCAN_DMS = AUTOSAR4.Signal(SwCalibrationAccess="ReadOnly", StorageClass="Global", MemorySection="VAR")
UNPACK_IF_DATACLCT_VCAN_DVR = AUTOSAR4.Signal(SwCalibrationAccess="ReadOnly", StorageClass="Global", MemorySection="VAR")
UNPACK_IF_EQ4COM_VCAN_ECM = AUTOSAR4.Signal(SwCalibrationAccess="ReadOnly", StorageClass="Global", MemorySection="VAR")
UNPACK_IF_DMON_VCAN_ECM = AUTOSAR4.Signal(SwCalibrationAccess="ReadOnly", StorageClass="Global", MemorySection="VAR")
UNPACK_IF_DATACLCT_VCAN_ECM = AUTOSAR4.Signal(SwCalibrationAccess="ReadOnly", StorageClass="Global", MemorySection="VAR")
UNPACK_IF_VSM_VCAN_ECM = AUTOSAR4.Signal(SwCalibrationAccess="ReadOnly", StorageClass="Global", MemorySection="VAR")
UNPACK_IF_AEB_VCAN_ECM = AUTOSAR4.Signal(SwCalibrationAccess="ReadOnly", StorageClass="Global", MemorySection="VAR")
UNPACK_IF_LONC_VCAN_ECM = AUTOSAR4.Signal(SwCalibrationAccess="ReadOnly", StorageClass="Global", MemorySection="VAR")
UNPACK_IF_DMON_VCAN_EPS = AUTOSAR4.Signal(SwCalibrationAccess="ReadOnly", StorageClass="Global", MemorySection="VAR")
UNPACK_IF_VSM_VCAN_EPS = AUTOSAR4.Signal(SwCalibrationAccess="ReadOnly", StorageClass="Global", MemorySection="VAR")
UNPACK_IF_LATC_VCAN_EPS = AUTOSAR4.Signal(SwCalibrationAccess="ReadOnly", StorageClass="Global", MemorySection="VAR")
UNPACK_IF_EQ4COM_VCAN_ESP = AUTOSAR4.Signal(SwCalibrationAccess="ReadOnly", StorageClass="Global", MemorySection="VAR")
UNPACK_IF_DMON_VCAN_ESP = AUTOSAR4.Signal(SwCalibrationAccess="ReadOnly", StorageClass="Global", MemorySection="VAR")
UNPACK_IF_DATACLCT_VCAN_ESP = AUTOSAR4.Signal(SwCalibrationAccess="ReadOnly", StorageClass="Global", MemorySection="VAR")
UNPACK_IF_AHBC_VCAN_ESP = AUTOSAR4.Signal(SwCalibrationAccess="ReadOnly", StorageClass="Global", MemorySection="VAR")
UNPACK_IF_AEB_VCAN_ESP = AUTOSAR4.Signal(SwCalibrationAccess="ReadOnly", StorageClass="Global", MemorySection="VAR")
UNPACK_IF_VSM_VCAN_ESP = AUTOSAR4.Signal(SwCalibrationAccess="ReadOnly", StorageClass="Global", MemorySection="VAR")
UNPACK_IF_LONC_VCAN_ESP = AUTOSAR4.Signal(SwCalibrationAccess="ReadOnly", StorageClass="Global", MemorySection="VAR")
UNPACK_IF_PLAN_VCAN_ESP = AUTOSAR4.Signal(SwCalibrationAccess="ReadOnly", StorageClass="Global", MemorySection="VAR")
UNPACK_IF_LM_VCAN_ESP = AUTOSAR4.Signal(SwCalibrationAccess="ReadOnly", StorageClass="Global", MemorySection="VAR")
UNPACK_IF_EHRV2_VCAN_ESP = AUTOSAR4.Signal(SwCalibrationAccess="ReadOnly", StorageClass="Global", MemorySection="VAR")
UNPACK_IF_VIE_VCAN_ESP = AUTOSAR4.Signal(SwCalibrationAccess="ReadOnly", StorageClass="Global", MemorySection="VAR")
UNPACK_IF_DATACLCT_VCAN_PBOX = AUTOSAR4.Signal(SwCalibrationAccess="ReadOnly", StorageClass="Global", MemorySection="VAR")
UNPACK_IF_EQ4COM_VCAN_PBOX = AUTOSAR4.Signal(SwCalibrationAccess="ReadOnly", StorageClass="Global", MemorySection="VAR")
UNPACK_IF_AHBC_VCAN_PBOX = AUTOSAR4.Signal(SwCalibrationAccess="ReadOnly", StorageClass="Global", MemorySection="VAR")
UNPACK_IF_VSM_VCAN_PBOX = AUTOSAR4.Signal(SwCalibrationAccess="ReadOnly", StorageClass="Global", MemorySection="VAR")
UNPACK_IF_DATACCT_VCAN_HAP = AUTOSAR4.Signal(SwCalibrationAccess="ReadOnly", StorageClass="Global", MemorySection="VAR")
UNPACK_IF_EQ4COM_VCAN_HAP = AUTOSAR4.Signal(SwCalibrationAccess="ReadOnly", StorageClass="Global", MemorySection="VAR")
UNPACK_IF_DMON_VCAN_HAP = AUTOSAR4.Signal(SwCalibrationAccess="ReadOnly", StorageClass="Global", MemorySection="VAR")
UNPACK_IF_VSM_VCAN_HAP = AUTOSAR4.Signal(SwCalibrationAccess="ReadOnly", StorageClass="Global", MemorySection="VAR")
UNPACK_IF_EQ4COM_VCAN_HC = AUTOSAR4.Signal(SwCalibrationAccess="ReadOnly", StorageClass="Global", MemorySection="VAR")
UNPACK_IF_DMON_VCAN_HC = AUTOSAR4.Signal(SwCalibrationAccess="ReadOnly", StorageClass="Global", MemorySection="VAR")
UNPACK_IF_VSM_VCAN_HC = AUTOSAR4.Signal(SwCalibrationAccess="ReadOnly", StorageClass="Global", MemorySection="VAR")
UNPACK_IF_UNPACK_VCAN_HCM = AUTOSAR4.Signal(SwCalibrationAccess="ReadOnly", StorageClass="Global", MemorySection="VAR")
UNPACK_IF_VSM_VCAN_HCU = AUTOSAR4.Signal(SwCalibrationAccess="ReadOnly", StorageClass="Global", MemorySection="VAR")
UNPACK_IF_AEB_VCAN_HCU = AUTOSAR4.Signal(SwCalibrationAccess="ReadOnly", StorageClass="Global", MemorySection="VAR")
UNPACK_IF_LONC_VCAN_HCU = AUTOSAR4.Signal(SwCalibrationAccess="ReadOnly", StorageClass="Global", MemorySection="VAR")
UNPACK_IF_DATACLCT_VCAN_HUT = AUTOSAR4.Signal(SwCalibrationAccess="ReadOnly", StorageClass="Global", MemorySection="VAR")
UNPACK_IF_DMON_VCAN_HUT = AUTOSAR4.Signal(SwCalibrationAccess="ReadOnly", StorageClass="Global", MemorySection="VAR")
UNPACK_IF_HMI_VCAN_HUT = AUTOSAR4.Signal(SwCalibrationAccess="ReadOnly", StorageClass="Global", MemorySection="VAR")
UNPACK_IF_VSM_VCAN_HUT = AUTOSAR4.Signal(SwCalibrationAccess="ReadOnly", StorageClass="Global", MemorySection="VAR")
UNPACK_IF_AEB_VCAN_HUT = AUTOSAR4.Signal(SwCalibrationAccess="ReadOnly", StorageClass="Global", MemorySection="VAR")
UNPACK_IF_LM_VCAN_HUT = AUTOSAR4.Signal(SwCalibrationAccess="ReadOnly", StorageClass="Global", MemorySection="VAR")
UNPACK_IF_EHRV2_VCAN_HUT = AUTOSAR4.Signal(SwCalibrationAccess="ReadOnly", StorageClass="Global", MemorySection="VAR")
UNPACK_IF_DATACLCT_VCAN_IB = AUTOSAR4.Signal(SwCalibrationAccess="ReadOnly", StorageClass="Global", MemorySection="VAR")
UNPACK_IF_AEB_VCAN_IB = AUTOSAR4.Signal(SwCalibrationAccess="ReadOnly", StorageClass="Global", MemorySection="VAR")
UNPACK_IF_DATACLCT_VCAN_IP = AUTOSAR4.Signal(SwCalibrationAccess="ReadOnly", StorageClass="Global", MemorySection="VAR")
UNPACK_IF_DMON_VCAN_IP = AUTOSAR4.Signal(SwCalibrationAccess="ReadOnly", StorageClass="Global", MemorySection="VAR")
UNPACK_IF_VSM_VCAN_IP = AUTOSAR4.Signal(SwCalibrationAccess="ReadOnly", StorageClass="Global", MemorySection="VAR")
UNPACK_IF_UNPACK_VCAN_LMU = AUTOSAR4.Signal(SwCalibrationAccess="ReadOnly", StorageClass="Global", MemorySection="VAR")
UNPACK_IF_VSM_VCAN_PEPS = AUTOSAR4.Signal(SwCalibrationAccess="ReadOnly", StorageClass="Global", MemorySection="VAR")
UNPACK_IF_DATACLCT_VCAN_RSDS = AUTOSAR4.Signal(SwCalibrationAccess="ReadOnly", StorageClass="Global", MemorySection="VAR")
UNPACK_IF_DMON_VCAN_RSDS = AUTOSAR4.Signal(SwCalibrationAccess="ReadOnly", StorageClass="Global", MemorySection="VAR")
UNPACK_IF_UNPACK_VCAN_TBOX = AUTOSAR4.Signal(SwCalibrationAccess="ReadOnly", StorageClass="Global", MemorySection="VAR")
UNPACK_IF_VSM_VCAN_TRAILER = AUTOSAR4.Signal(SwCalibrationAccess="ReadOnly", StorageClass="Global", MemorySection="VAR")
UNPACK_IF_AEB_VCAN_TRAILER = AUTOSAR4.Signal(SwCalibrationAccess="ReadOnly", StorageClass="Global", MemorySection="VAR")
UNPACK_IF_DEM_CURRENT_GEAR = AUTOSAR4.Signal(SwCalibrationAccess="ReadOnly", StorageClass="Global", MemorySection="VAR")
UNPACK_IF_DEM_VehSpd = AUTOSAR4.Signal(SwCalibrationAccess="ReadOnly", StorageClass="Global", MemorySection="VAR")
UNPACK_IF_DEM_EngSpd = AUTOSAR4.Signal(SwCalibrationAccess="ReadOnly", StorageClass="Global", MemorySection="VAR")
UNPACK_IF_DEM_IP_VehTotDistance = AUTOSAR4.Signal(SwCalibrationAccess="ReadOnly", StorageClass="Global", MemorySection="VAR")
UNPACK_IF_DEM_Time_Year_Right = AUTOSAR4.Signal(SwCalibrationAccess="ReadOnly", StorageClass="Global", MemorySection="VAR")
UNPACK_IF_DEM_Time_Year_Left = AUTOSAR4.Signal(SwCalibrationAccess="ReadOnly", StorageClass="Global", MemorySection="VAR")
UNPACK_IF_DEM_Time_Month = AUTOSAR4.Signal(SwCalibrationAccess="ReadOnly", StorageClass="Global", MemorySection="VAR")
UNPACK_IF_DEM_Time_Day = AUTOSAR4.Signal(SwCalibrationAccess="ReadOnly", StorageClass="Global", MemorySection="VAR")
UNPACK_IF_DEM_Time_Hour = AUTOSAR4.Signal(SwCalibrationAccess="ReadOnly", StorageClass="Global", MemorySection="VAR")
UNPACK_IF_DEM_Time_Minutes = AUTOSAR4.Signal(SwCalibrationAccess="ReadOnly", StorageClass="Global", MemorySection="VAR")
UNPACK_IF_ADCAN_DIAG_RSDS_FD1 = AUTOSAR4.Signal(SwCalibrationAccess="ReadOnly", StorageClass="Global", MemorySection="VAR")
UNPACK_IF_ADCAN_DIAG_RSDS_FD2 = AUTOSAR4.Signal(SwCalibrationAccess="ReadOnly", StorageClass="Global", MemorySection="VAR")
UNPACK_IF_ADCAN_DIAG_ECM_FD1 = AUTOSAR4.Signal(SwCalibrationAccess="ReadOnly", StorageClass="Global", MemorySection="VAR")
UNPACK_IF_ADCAN_DIAG_ECM_FD2 = AUTOSAR4.Signal(SwCalibrationAccess="ReadOnly", StorageClass="Global", MemorySection="VAR")
UNPACK_IF_ADCAN_DIAG_ECM_FD3 = AUTOSAR4.Signal(SwCalibrationAccess="ReadOnly", StorageClass="Global", MemorySection="VAR")
UNPACK_IF_ADCAN_DIAG_ECM1 = AUTOSAR4.Signal(SwCalibrationAccess="ReadOnly", StorageClass="Global", MemorySection="VAR")
UNPACK_IF_ADCAN_DIAG_HCU_FD1 = AUTOSAR4.Signal(SwCalibrationAccess="ReadOnly", StorageClass="Global", MemorySection="VAR")
UNPACK_IF_ADCAN_DIAG_DCT_FD1 = AUTOSAR4.Signal(SwCalibrationAccess="ReadOnly", StorageClass="Global", MemorySection="VAR")
UNPACK_IF_ADCAN_DIAG_DCT_FD4 = AUTOSAR4.Signal(SwCalibrationAccess="ReadOnly", StorageClass="Global", MemorySection="VAR")
UNPACK_IF_ADCAN_DIAG_DCT5 = AUTOSAR4.Signal(SwCalibrationAccess="ReadOnly", StorageClass="Global", MemorySection="VAR")
UNPACK_IF_ADCAN_DIAG_ESP_FD2 = AUTOSAR4.Signal(SwCalibrationAccess="ReadOnly", StorageClass="Global", MemorySection="VAR")
UNPACK_IF_ADCAN_DIAG_ESP_FD3 = AUTOSAR4.Signal(SwCalibrationAccess="ReadOnly", StorageClass="Global", MemorySection="VAR")
UNPACK_IF_ADCAN_DIAG_EPS_FD1 = AUTOSAR4.Signal(SwCalibrationAccess="ReadOnly", StorageClass="Global", MemorySection="VAR")
UNPACK_IF_ADCAN_DIAG_BCM1 = AUTOSAR4.Signal(SwCalibrationAccess="ReadOnly", StorageClass="Global", MemorySection="VAR")
UNPACK_IF_ADCAN_DIAG_BCM3 = AUTOSAR4.Signal(SwCalibrationAccess="ReadOnly", StorageClass="Global", MemorySection="VAR")
UNPACK_IF_ADCAN_DIAG_BCM8 = AUTOSAR4.Signal(SwCalibrationAccess="ReadOnly", StorageClass="Global", MemorySection="VAR")
UNPACK_IF_ADCAN_DIAG_AC2 = AUTOSAR4.Signal(SwCalibrationAccess="ReadOnly", StorageClass="Global", MemorySection="VAR")
UNPACK_IF_ADCAN_DIAG_F_PBox1 = AUTOSAR4.Signal(SwCalibrationAccess="ReadOnly", StorageClass="Global", MemorySection="VAR")
UNPACK_IF_ADCAN_DIAG_R_PBox1 = AUTOSAR4.Signal(SwCalibrationAccess="ReadOnly", StorageClass="Global", MemorySection="VAR")
UNPACK_IF_ADCAN_DIAG_CSA1 = AUTOSAR4.Signal(SwCalibrationAccess="ReadOnly", StorageClass="Global", MemorySection="VAR")
UNPACK_IF_ADCAN_DIAG_CSA2 = AUTOSAR4.Signal(SwCalibrationAccess="ReadOnly", StorageClass="Global", MemorySection="VAR")
UNPACK_IF_ADCAN_DIAG_ABM1 = AUTOSAR4.Signal(SwCalibrationAccess="ReadOnly", StorageClass="Global", MemorySection="VAR")
UNPACK_IF_ADCAN_DIAG_ABM2 = AUTOSAR4.Signal(SwCalibrationAccess="ReadOnly", StorageClass="Global", MemorySection="VAR")
UNPACK_IF_ADCAN_DIAG_HAP_FD1 = AUTOSAR4.Signal(SwCalibrationAccess="ReadOnly", StorageClass="Global", MemorySection="VAR")
UNPACK_IF_ADCAN_DIAG_IP2 = AUTOSAR4.Signal(SwCalibrationAccess="ReadOnly", StorageClass="Global", MemorySection="VAR")
UNPACK_IF_ADCAN_DIAG_HUT_FD1 = AUTOSAR4.Signal(SwCalibrationAccess="ReadOnly", StorageClass="Global", MemorySection="VAR")
UNPACK_IF_ADCAN_DIAG_HUT19 = AUTOSAR4.Signal(SwCalibrationAccess="ReadOnly", StorageClass="Global", MemorySection="VAR")
UNPACK_IF_ADCAN_DIAG_T_Box_FD3 = AUTOSAR4.Signal(SwCalibrationAccess="ReadOnly", StorageClass="Global", MemorySection="VAR")
UNPACK_IF_ADCAN_DIAG_HC1 = AUTOSAR4.Signal(SwCalibrationAccess="ReadOnly", StorageClass="Global", MemorySection="VAR")
UNPACK_IF_ADCAN_DIAG_DMS_FD1 = AUTOSAR4.Signal(SwCalibrationAccess="ReadOnly", StorageClass="Global", MemorySection="VAR")
UNPACK_IF_ADCAN_DIAG_IsUpdate = AUTOSAR4.Signal(SwCalibrationAccess="ReadOnly", StorageClass="Global", MemorySection="VAR")
UNPACK_IF_Counter = AUTOSAR4.Signal(SwCalibrationAccess="ReadOnly", StorageClass="Global", MemorySection="VAR")
UNPACK_IF_ABAavailable_ESP_FD2 = AUTOSAR4.Signal(SwCalibrationAccess="ReadOnly", StorageClass="Global", MemorySection="VAR")
UNPACK_IF_ABPActv_ESP_FD2 = AUTOSAR4.Signal(SwCalibrationAccess="ReadOnly", StorageClass="Global", MemorySection="VAR")
UNPACK_IF_ABPAvailable_ESP_FD2 = AUTOSAR4.Signal(SwCalibrationAccess="ReadOnly", StorageClass="Global", MemorySection="VAR")
UNPACK_IF_ABSActv_ESP_FD2 = AUTOSAR4.Signal(SwCalibrationAccess="ReadOnly", StorageClass="Global", MemorySection="VAR")
UNPACK_IF_ABSFailSts_ESP_FD2 = AUTOSAR4.Signal(SwCalibrationAccess="ReadOnly", StorageClass="Global", MemorySection="VAR")
UNPACK_IF_ACC_TimeGap_DecSetSwt_CSA2 = AUTOSAR4.Signal(SwCalibrationAccess="ReadOnly", StorageClass="Global", MemorySection="VAR")
UNPACK_IF_ACC_TimeGap_IncSetSwt_CSA2 = AUTOSAR4.Signal(SwCalibrationAccess="ReadOnly", StorageClass="Global", MemorySection="VAR")
UNPACK_IF_ACU_ShiftInProgress_HCU_FD1 = AUTOSAR4.Signal(SwCalibrationAccess="ReadOnly", StorageClass="Global", MemorySection="VAR")
UNPACK_IF_ADAS_Meta_CountryCode_HUT19 = AUTOSAR4.Signal(SwCalibrationAccess="ReadOnly", StorageClass="Global", MemorySection="VAR")
UNPACK_IF_ADAS_Meta_CycCnt_HUT19 = AUTOSAR4.Signal(SwCalibrationAccess="ReadOnly", StorageClass="Global", MemorySection="VAR")
UNPACK_IF_ADAS_Meta_DrvSide_HUT19 = AUTOSAR4.Signal(SwCalibrationAccess="ReadOnly", StorageClass="Global", MemorySection="VAR")
UNPACK_IF_ADAS_Meta_HwVer_HUT19 = AUTOSAR4.Signal(SwCalibrationAccess="ReadOnly", StorageClass="Global", MemorySection="VAR")
UNPACK_IF_ADAS_Meta_MapProvider_HUT19 = AUTOSAR4.Signal(SwCalibrationAccess="ReadOnly", StorageClass="Global", MemorySection="VAR")
UNPACK_IF_ADAS_Meta_MapVerQtr_HUT19 = AUTOSAR4.Signal(SwCalibrationAccess="ReadOnly", StorageClass="Global", MemorySection="VAR")
UNPACK_IF_ADAS_Meta_MapVerYear_HUT19 = AUTOSAR4.Signal(SwCalibrationAccess="ReadOnly", StorageClass="Global", MemorySection="VAR")
UNPACK_IF_ADAS_Meta_MsgTyp_HUT19 = AUTOSAR4.Signal(SwCalibrationAccess="ReadOnly", StorageClass="Global", MemorySection="VAR")
UNPACK_IF_ADAS_Meta_ProtVer_Major_HUT19 = AUTOSAR4.Signal(SwCalibrationAccess="ReadOnly", StorageClass="Global", MemorySection="VAR")
UNPACK_IF_ADAS_Meta_ProtVer_MinorSub_HUT19 = AUTOSAR4.Signal(SwCalibrationAccess="ReadOnly", StorageClass="Global", MemorySection="VAR")
UNPACK_IF_ADAS_Meta_ProtVer_Minor_HUT19 = AUTOSAR4.Signal(SwCalibrationAccess="ReadOnly", StorageClass="Global", MemorySection="VAR")
UNPACK_IF_ADAS_Meta_RegionCode_HUT19 = AUTOSAR4.Signal(SwCalibrationAccess="ReadOnly", StorageClass="Global", MemorySection="VAR")
UNPACK_IF_ADAS_Meta_SpdUnits_HUT19 = AUTOSAR4.Signal(SwCalibrationAccess="ReadOnly", StorageClass="Global", MemorySection="VAR")
UNPACK_IF_ADAS_Posn_Age_HUT_FD1 = AUTOSAR4.Signal(SwCalibrationAccess="ReadOnly", StorageClass="Global", MemorySection="VAR")
UNPACK_IF_ADAS_Posn_CurLane_HUT_FD1 = AUTOSAR4.Signal(SwCalibrationAccess="ReadOnly", StorageClass="Global", MemorySection="VAR")
UNPACK_IF_ADAS_Posn_CycCnt_HUT_FD1 = AUTOSAR4.Signal(SwCalibrationAccess="ReadOnly", StorageClass="Global", MemorySection="VAR")
UNPACK_IF_ADAS_Posn_Idx_HUT_FD1 = AUTOSAR4.Signal(SwCalibrationAccess="ReadOnly", StorageClass="Global", MemorySection="VAR")
UNPACK_IF_ADAS_Posn_MsgTye_HUT_FD1 = AUTOSAR4.Signal(SwCalibrationAccess="ReadOnly", StorageClass="Global", MemorySection="VAR")
UNPACK_IF_ADAS_Posn_Offset_HUT_FD1 = AUTOSAR4.Signal(SwCalibrationAccess="ReadOnly", StorageClass="Global", MemorySection="VAR")
UNPACK_IF_ADAS_Posn_Pathldx_HUT_FD1 = AUTOSAR4.Signal(SwCalibrationAccess="ReadOnly", StorageClass="Global", MemorySection="VAR")
UNPACK_IF_ADAS_Posn_PosConfdc_HUT_FD1 = AUTOSAR4.Signal(SwCalibrationAccess="ReadOnly", StorageClass="Global", MemorySection="VAR")
UNPACK_IF_ADAS_Posn_PosProbb_HUT_FD1 = AUTOSAR4.Signal(SwCalibrationAccess="ReadOnly", StorageClass="Global", MemorySection="VAR")
UNPACK_IF_ADAS_Posn_Rehead_HUT_FD1 = AUTOSAR4.Signal(SwCalibrationAccess="ReadOnly", StorageClass="Global", MemorySection="VAR")
UNPACK_IF_ADAS_Posn_Spd_HUT_FD1 = AUTOSAR4.Signal(SwCalibrationAccess="ReadOnly", StorageClass="Global", MemorySection="VAR")
UNPACK_IF_ADAS_ProfLong_CtrlPoint_HUT20 = AUTOSAR4.Signal(SwCalibrationAccess="ReadOnly", StorageClass="Global", MemorySection="VAR")
UNPACK_IF_ADAS_ProfLong_CycCnt_HUT20 = AUTOSAR4.Signal(SwCalibrationAccess="ReadOnly", StorageClass="Global", MemorySection="VAR")
UNPACK_IF_ADAS_ProfLong_MsgTyp_HUT20 = AUTOSAR4.Signal(SwCalibrationAccess="ReadOnly", StorageClass="Global", MemorySection="VAR")
UNPACK_IF_ADAS_ProfLong_Offset_HUT20 = AUTOSAR4.Signal(SwCalibrationAccess="ReadOnly", StorageClass="Global", MemorySection="VAR")
UNPACK_IF_ADAS_ProfLong_PathIdx_HUT20 = AUTOSAR4.Signal(SwCalibrationAccess="ReadOnly", StorageClass="Global", MemorySection="VAR")
UNPACK_IF_ADAS_ProfLong_ProfTyp_HUT20 = AUTOSAR4.Signal(SwCalibrationAccess="ReadOnly", StorageClass="Global", MemorySection="VAR")
UNPACK_IF_ADAS_ProfLong_Retr_HUT20 = AUTOSAR4.Signal(SwCalibrationAccess="ReadOnly", StorageClass="Global", MemorySection="VAR")
UNPACK_IF_ADAS_ProfLong_Update_HUT20 = AUTOSAR4.Signal(SwCalibrationAccess="ReadOnly", StorageClass="Global", MemorySection="VAR")
UNPACK_IF_ADAS_ProfLong_Value_HUT20 = AUTOSAR4.Signal(SwCalibrationAccess="ReadOnly", StorageClass="Global", MemorySection="VAR")
UNPACK_IF_ADAS_ProfShort_AccurClass_HUT21 = AUTOSAR4.Signal(SwCalibrationAccess="ReadOnly", StorageClass="Global", MemorySection="VAR")
UNPACK_IF_ADAS_ProfShort_CtrlPoint_HUT21 = AUTOSAR4.Signal(SwCalibrationAccess="ReadOnly", StorageClass="Global", MemorySection="VAR")
UNPACK_IF_ADAS_ProfShort_CycCnt_HUT21 = AUTOSAR4.Signal(SwCalibrationAccess="ReadOnly", StorageClass="Global", MemorySection="VAR")
UNPACK_IF_ADAS_ProfShort_Dist1_HUT21 = AUTOSAR4.Signal(SwCalibrationAccess="ReadOnly", StorageClass="Global", MemorySection="VAR")
UNPACK_IF_ADAS_ProfShort_MsgTyp_HUT21 = AUTOSAR4.Signal(SwCalibrationAccess="ReadOnly", StorageClass="Global", MemorySection="VAR")
UNPACK_IF_ADAS_ProfShort_Offset_HUT21 = AUTOSAR4.Signal(SwCalibrationAccess="ReadOnly", StorageClass="Global", MemorySection="VAR")
UNPACK_IF_ADAS_ProfShort_PathIdx_HUT21 = AUTOSAR4.Signal(SwCalibrationAccess="ReadOnly", StorageClass="Global", MemorySection="VAR")
UNPACK_IF_ADAS_ProfShort_ProfTyp_HUT21 = AUTOSAR4.Signal(SwCalibrationAccess="ReadOnly", StorageClass="Global", MemorySection="VAR")
UNPACK_IF_ADAS_ProfShort_Retr_HUT21 = AUTOSAR4.Signal(SwCalibrationAccess="ReadOnly", StorageClass="Global", MemorySection="VAR")
UNPACK_IF_ADAS_ProfShort_Update_HUT21 = AUTOSAR4.Signal(SwCalibrationAccess="ReadOnly", StorageClass="Global", MemorySection="VAR")
UNPACK_IF_ADAS_ProfShort_Value0_HUT21 = AUTOSAR4.Signal(SwCalibrationAccess="ReadOnly", StorageClass="Global", MemorySection="VAR")
UNPACK_IF_ADAS_ProfShort_Value1_HUT21 = AUTOSAR4.Signal(SwCalibrationAccess="ReadOnly", StorageClass="Global", MemorySection="VAR")
UNPACK_IF_ADAS_Seg_Brdg_HUT22 = AUTOSAR4.Signal(SwCalibrationAccess="ReadOnly", StorageClass="Global", MemorySection="VAR")
UNPACK_IF_ADAS_Seg_BuildUpArea_HUT22 = AUTOSAR4.Signal(SwCalibrationAccess="ReadOnly", StorageClass="Global", MemorySection="VAR")
UNPACK_IF_ADAS_Seg_CmplxInsct_HUT22 = AUTOSAR4.Signal(SwCalibrationAccess="ReadOnly", StorageClass="Global", MemorySection="VAR")
UNPACK_IF_ADAS_Seg_CycCnt_HUT22 = AUTOSAR4.Signal(SwCalibrationAccess="ReadOnly", StorageClass="Global", MemorySection="VAR")
UNPACK_IF_ADAS_Seg_DivideRoad_HUT22 = AUTOSAR4.Signal(SwCalibrationAccess="ReadOnly", StorageClass="Global", MemorySection="VAR")
UNPACK_IF_ADAS_Seg_EffSpdLmtTyp_HUT22 = AUTOSAR4.Signal(SwCalibrationAccess="ReadOnly", StorageClass="Global", MemorySection="VAR")
UNPACK_IF_ADAS_Seg_EffSpdLmt_HUT22 = AUTOSAR4.Signal(SwCalibrationAccess="ReadOnly", StorageClass="Global", MemorySection="VAR")
UNPACK_IF_ADAS_Seg_FormOfWay_HUT22 = AUTOSAR4.Signal(SwCalibrationAccess="ReadOnly", StorageClass="Global", MemorySection="VAR")
UNPACK_IF_ADAS_Seg_FuncRoadClass_HUT22 = AUTOSAR4.Signal(SwCalibrationAccess="ReadOnly", StorageClass="Global", MemorySection="VAR")
UNPACK_IF_ADAS_Seg_MsgTyp_HUT22 = AUTOSAR4.Signal(SwCalibrationAccess="ReadOnly", StorageClass="Global", MemorySection="VAR")
UNPACK_IF_ADAS_Seg_NumOfLaneDrvDir_HUT22 = AUTOSAR4.Signal(SwCalibrationAccess="ReadOnly", StorageClass="Global", MemorySection="VAR")

UNPACK_IF_ADAS_Seg_NumOfLaneOppDir_HUT22 = AUTOSAR4.Signal(SwCalibrationAccess="ReadOnly", StorageClass="Global", MemorySection="VAR")
UNPACK_IF_ADAS_Seg_Offset_HUT22 = AUTOSAR4.Signal(SwCalibrationAccess="ReadOnly", StorageClass="Global", MemorySection="VAR")
UNPACK_IF_ADAS_Seg_PartOfCalcRoute_HUT22 = AUTOSAR4.Signal(SwCalibrationAccess="ReadOnly", StorageClass="Global", MemorySection="VAR")
UNPACK_IF_ADAS_Seg_PathIdx_HUT22 = AUTOSAR4.Signal(SwCalibrationAccess="ReadOnly", StorageClass="Global", MemorySection="VAR")
UNPACK_IF_ADAS_Seg_RelProbb_HUT22 = AUTOSAR4.Signal(SwCalibrationAccess="ReadOnly", StorageClass="Global", MemorySection="VAR")
UNPACK_IF_ADAS_Seg_Retr_HUT22 = AUTOSAR4.Signal(SwCalibrationAccess="ReadOnly", StorageClass="Global", MemorySection="VAR")
UNPACK_IF_ADAS_Seg_Tunnel_HUT22 = AUTOSAR4.Signal(SwCalibrationAccess="ReadOnly", StorageClass="Global", MemorySection="VAR")
UNPACK_IF_ADAS_Seg_Update_HUT22 = AUTOSAR4.Signal(SwCalibrationAccess="ReadOnly", StorageClass="Global", MemorySection="VAR")
UNPACK_IF_ADAS_Stub_CmplxInsct_HUT23 = AUTOSAR4.Signal(SwCalibrationAccess="ReadOnly", StorageClass="Global", MemorySection="VAR")
UNPACK_IF_ADAS_Stub_CycCnt_HUT23 = AUTOSAR4.Signal(SwCalibrationAccess="ReadOnly", StorageClass="Global", MemorySection="VAR")
UNPACK_IF_ADAS_Stub_FormOfWay_HUT23 = AUTOSAR4.Signal(SwCalibrationAccess="ReadOnly", StorageClass="Global", MemorySection="VAR")
UNPACK_IF_ADAS_Stub_FuncRoadClass_HUT23 = AUTOSAR4.Signal(SwCalibrationAccess="ReadOnly", StorageClass="Global", MemorySection="VAR")
UNPACK_IF_ADAS_Stub_LastStub_HUT23 = AUTOSAR4.Signal(SwCalibrationAccess="ReadOnly", StorageClass="Global", MemorySection="VAR")
UNPACK_IF_ADAS_Stub_MsgTyp_HUT23 = AUTOSAR4.Signal(SwCalibrationAccess="ReadOnly", StorageClass="Global", MemorySection="VAR")
UNPACK_IF_ADAS_Stub_NumOfLaneDrvDir_HUT23 = AUTOSAR4.Signal(SwCalibrationAccess="ReadOnly", StorageClass="Global", MemorySection="VAR")
UNPACK_IF_ADAS_Stub_NumOfLaneOppDir_HUT23 = AUTOSAR4.Signal(SwCalibrationAccess="ReadOnly", StorageClass="Global", MemorySection="VAR")
UNPACK_IF_ADAS_Stub_Offset_HUT23 = AUTOSAR4.Signal(SwCalibrationAccess="ReadOnly", StorageClass="Global", MemorySection="VAR")
UNPACK_IF_ADAS_Stub_PartOfCalcRoute_HUT23 = AUTOSAR4.Signal(SwCalibrationAccess="ReadOnly", StorageClass="Global", MemorySection="VAR")
UNPACK_IF_ADAS_Stub_PathIdx_HUT23 = AUTOSAR4.Signal(SwCalibrationAccess="ReadOnly", StorageClass="Global", MemorySection="VAR")
UNPACK_IF_ADAS_Stub_RelProbb_HUT23 = AUTOSAR4.Signal(SwCalibrationAccess="ReadOnly", StorageClass="Global", MemorySection="VAR")
UNPACK_IF_ADAS_Stub_Retr_HUT23 = AUTOSAR4.Signal(SwCalibrationAccess="ReadOnly", StorageClass="Global", MemorySection="VAR")
UNPACK_IF_ADAS_Stub_RtOfWay_HUT23 = AUTOSAR4.Signal(SwCalibrationAccess="ReadOnly", StorageClass="Global", MemorySection="VAR")
UNPACK_IF_ADAS_Stub_StubPathIdx_HUT23 = AUTOSAR4.Signal(SwCalibrationAccess="ReadOnly", StorageClass="Global", MemorySection="VAR")
UNPACK_IF_ADAS_Stub_TurnAngl_HUT23 = AUTOSAR4.Signal(SwCalibrationAccess="ReadOnly", StorageClass="Global", MemorySection="VAR")
UNPACK_IF_ADAS_Stub_Update_HUT23 = AUTOSAR4.Signal(SwCalibrationAccess="ReadOnly", StorageClass="Global", MemorySection="VAR")
UNPACK_IF_AEBAvailable_ESP_FD2 = AUTOSAR4.Signal(SwCalibrationAccess="ReadOnly", StorageClass="Global", MemorySection="VAR")
UNPACK_IF_AEBBAActv_ESP_FD2 = AUTOSAR4.Signal(SwCalibrationAccess="ReadOnly", StorageClass="Global", MemorySection="VAR")
UNPACK_IF_AEBIBActv_ESP_FD2 = AUTOSAR4.Signal(SwCalibrationAccess="ReadOnly", StorageClass="Global", MemorySection="VAR")
UNPACK_IF_AEB_JASwtReq_HUT_FD1 = AUTOSAR4.Signal(SwCalibrationAccess="ReadOnly", StorageClass="Global", MemorySection="VAR")
UNPACK_IF_AEB_PedSwtReq_HUT_FD1 = AUTOSAR4.Signal(SwCalibrationAccess="ReadOnly", StorageClass="Global", MemorySection="VAR")
UNPACK_IF_AEB_VehSwtReq_HUT_FD1 = AUTOSAR4.Signal(SwCalibrationAccess="ReadOnly", StorageClass="Global", MemorySection="VAR")
UNPACK_IF_AESSwtReq_HUT_FD1 = AUTOSAR4.Signal(SwCalibrationAccess="ReadOnly", StorageClass="Global", MemorySection="VAR")
UNPACK_IF_ALC_SwtReq_HUT_FD1 = AUTOSAR4.Signal(SwCalibrationAccess="ReadOnly", StorageClass="Global", MemorySection="VAR")
UNPACK_IF_AVHSts_ESP_FD2 = AUTOSAR4.Signal(SwCalibrationAccess="ReadOnly", StorageClass="Global", MemorySection="VAR")
UNPACK_IF_AWBActv_ESP_FD2 = AUTOSAR4.Signal(SwCalibrationAccess="ReadOnly", StorageClass="Global", MemorySection="VAR")
UNPACK_IF_AWBAvailable_ESP_FD2 = AUTOSAR4.Signal(SwCalibrationAccess="ReadOnly", StorageClass="Global", MemorySection="VAR")
UNPACK_IF_AccPedalOverride_ECM_FD2 = AUTOSAR4.Signal(SwCalibrationAccess="ReadOnly", StorageClass="Global", MemorySection="VAR")
UNPACK_IF_AccelPedalPosnVldty_ECM_FD2 = AUTOSAR4.Signal(SwCalibrationAccess="ReadOnly", StorageClass="Global", MemorySection="VAR")
UNPACK_IF_AccelPedalPosn_ECM_FD2 = AUTOSAR4.Signal(SwCalibrationAccess="ReadOnly", StorageClass="Global", MemorySection="VAR")
UNPACK_IF_AccelPedlPosnDiagc_ECM_FD2 = AUTOSAR4.Signal(SwCalibrationAccess="ReadOnly", StorageClass="Global", MemorySection="VAR")
UNPACK_IF_ActWheelTrqDmd_HCU_FD1 = AUTOSAR4.Signal(SwCalibrationAccess="ReadOnly", StorageClass="Global", MemorySection="VAR")
UNPACK_IF_AutoLmpSwtSts_CSA1 = AUTOSAR4.Signal(SwCalibrationAccess="ReadOnly", StorageClass="Global", MemorySection="VAR")
UNPACK_IF_BTCActv_ESP_FD2 = AUTOSAR4.Signal(SwCalibrationAccess="ReadOnly", StorageClass="Global", MemorySection="VAR")
UNPACK_IF_BTCActv_RA_ESP_FD2 = AUTOSAR4.Signal(SwCalibrationAccess="ReadOnly", StorageClass="Global", MemorySection="VAR")
UNPACK_IF_BrkDskOvrheatd_ESP_FD2 = AUTOSAR4.Signal(SwCalibrationAccess="ReadOnly", StorageClass="Global", MemorySection="VAR")
UNPACK_IF_BrkPedalSts_ECM_FD1 = AUTOSAR4.Signal(SwCalibrationAccess="ReadOnly", StorageClass="Global", MemorySection="VAR")
UNPACK_IF_CC_ACCSwtErr_CSA2 = AUTOSAR4.Signal(SwCalibrationAccess="ReadOnly", StorageClass="Global", MemorySection="VAR")
UNPACK_IF_CC_ACC_CANCEL_OFFSwt_CSA2 = AUTOSAR4.Signal(SwCalibrationAccess="ReadOnly", StorageClass="Global", MemorySection="VAR")
UNPACK_IF_CC_ACC_CRUISE_OFFSwt_CSA2 = AUTOSAR4.Signal(SwCalibrationAccess="ReadOnly", StorageClass="Global", MemorySection="VAR")
UNPACK_IF_CC_ACC_DecSetSpd_SetSwt_CSA2 = AUTOSAR4.Signal(SwCalibrationAccess="ReadOnly", StorageClass="Global", MemorySection="VAR")
UNPACK_IF_CC_ACC_IncSetSpd_ResuSwt_CSA2 = AUTOSAR4.Signal(SwCalibrationAccess="ReadOnly", StorageClass="Global", MemorySection="VAR")
UNPACK_IF_CDDActv_ESP_FD2 = AUTOSAR4.Signal(SwCalibrationAccess="ReadOnly", StorageClass="Global", MemorySection="VAR")
UNPACK_IF_CDDAvailable_ESP_FD2 = AUTOSAR4.Signal(SwCalibrationAccess="ReadOnly", StorageClass="Global", MemorySection="VAR")
UNPACK_IF_CDPActv_ESP_FD2 = AUTOSAR4.Signal(SwCalibrationAccess="ReadOnly", StorageClass="Global", MemorySection="VAR")
UNPACK_IF_CR_BliSts_CR_FD1 = AUTOSAR4.Signal(SwCalibrationAccess="ReadOnly", StorageClass="Global", MemorySection="VAR")
UNPACK_IF_CR_BrkgReqVal_CR_FD1 = AUTOSAR4.Signal(SwCalibrationAccess="ReadOnly", StorageClass="Global", MemorySection="VAR")
UNPACK_IF_CR_BrkgReq_CR_FD1 = AUTOSAR4.Signal(SwCalibrationAccess="ReadOnly", StorageClass="Global", MemorySection="VAR")
UNPACK_IF_CR_ErrSts_CR_FD1 = AUTOSAR4.Signal(SwCalibrationAccess="ReadOnly", StorageClass="Global", MemorySection="VAR")
UNPACK_IF_CR_FCTA_Resp_CR_FD1 = AUTOSAR4.Signal(SwCalibrationAccess="ReadOnly", StorageClass="Global", MemorySection="VAR")
UNPACK_IF_CR_FCTB_Resp_CR_FD1 = AUTOSAR4.Signal(SwCalibrationAccess="ReadOnly", StorageClass="Global", MemorySection="VAR")
UNPACK_IF_CR_ObjDistXStd_Le_CR_FD1 = AUTOSAR4.Signal(SwCalibrationAccess="ReadOnly", StorageClass="Global", MemorySection="VAR")
UNPACK_IF_CR_ObjDistXStd_Ri_CR_FD1 = AUTOSAR4.Signal(SwCalibrationAccess="ReadOnly", StorageClass="Global", MemorySection="VAR")
UNPACK_IF_CR_ObjDistX_Le_CR_FD1 = AUTOSAR4.Signal(SwCalibrationAccess="ReadOnly", StorageClass="Global", MemorySection="VAR")
UNPACK_IF_CR_ObjDistX_Ri_CR_FD1 = AUTOSAR4.Signal(SwCalibrationAccess="ReadOnly", StorageClass="Global", MemorySection="VAR")
UNPACK_IF_CR_ObjDistYStd_Le_CR_FD1 = AUTOSAR4.Signal(SwCalibrationAccess="ReadOnly", StorageClass="Global", MemorySection="VAR")
UNPACK_IF_CR_ObjDistYStd_Ri_CR_FD1 = AUTOSAR4.Signal(SwCalibrationAccess="ReadOnly", StorageClass="Global", MemorySection="VAR")
UNPACK_IF_CR_ObjDistY_Le_CR_FD1 = AUTOSAR4.Signal(SwCalibrationAccess="ReadOnly", StorageClass="Global", MemorySection="VAR")
UNPACK_IF_CR_ObjDistY_Ri_CR_FD1 = AUTOSAR4.Signal(SwCalibrationAccess="ReadOnly", StorageClass="Global", MemorySection="VAR")
UNPACK_IF_CR_ObjID_Le_CR_FD1 = AUTOSAR4.Signal(SwCalibrationAccess="ReadOnly", StorageClass="Global", MemorySection="VAR")
UNPACK_IF_CR_ObjID_Ri_CR_FD1 = AUTOSAR4.Signal(SwCalibrationAccess="ReadOnly", StorageClass="Global", MemorySection="VAR")
UNPACK_IF_CR_ObjMotionType_Le_CR_FD1 = AUTOSAR4.Signal(SwCalibrationAccess="ReadOnly", StorageClass="Global", MemorySection="VAR")
UNPACK_IF_CR_ObjMotionType_Ri_CR_FD1 = AUTOSAR4.Signal(SwCalibrationAccess="ReadOnly", StorageClass="Global", MemorySection="VAR")
UNPACK_IF_CR_ObjRAccelXStd_Le_CR_FD1 = AUTOSAR4.Signal(SwCalibrationAccess="ReadOnly", StorageClass="Global", MemorySection="VAR")
UNPACK_IF_CR_ObjRAccelXStd_Ri_CR_FD1 = AUTOSAR4.Signal(SwCalibrationAccess="ReadOnly", StorageClass="Global", MemorySection="VAR")
UNPACK_IF_CR_ObjRAccelYStd_Le_CR_FD1 = AUTOSAR4.Signal(SwCalibrationAccess="ReadOnly", StorageClass="Global", MemorySection="VAR")
UNPACK_IF_CR_ObjRAccelYStd_Ri_CR_FD1 = AUTOSAR4.Signal(SwCalibrationAccess="ReadOnly", StorageClass="Global", MemorySection="VAR")
UNPACK_IF_CR_ObjRelAccelX_Le_CR_FD1 = AUTOSAR4.Signal(SwCalibrationAccess="ReadOnly", StorageClass="Global", MemorySection="VAR")
UNPACK_IF_CR_ObjRelAccelX_Ri_CR_FD1 = AUTOSAR4.Signal(SwCalibrationAccess="ReadOnly", StorageClass="Global", MemorySection="VAR")
UNPACK_IF_CR_ObjRelAccelY_Le_CR_FD1 = AUTOSAR4.Signal(SwCalibrationAccess="ReadOnly", StorageClass="Global", MemorySection="VAR")
UNPACK_IF_CR_ObjRelAccelY_Ri_CR_FD1 = AUTOSAR4.Signal(SwCalibrationAccess="ReadOnly", StorageClass="Global", MemorySection="VAR")
UNPACK_IF_CR_ObjRelVelXStd_Le_CR_FD1 = AUTOSAR4.Signal(SwCalibrationAccess="ReadOnly", StorageClass="Global", MemorySection="VAR")
UNPACK_IF_CR_ObjRelVelXStd_Ri_CR_FD1 = AUTOSAR4.Signal(SwCalibrationAccess="ReadOnly", StorageClass="Global", MemorySection="VAR")
UNPACK_IF_CR_ObjRelVelX_Le_CR_FD1 = AUTOSAR4.Signal(SwCalibrationAccess="ReadOnly", StorageClass="Global", MemorySection="VAR")
UNPACK_IF_CR_ObjRelVelX_Ri_CR_FD1 = AUTOSAR4.Signal(SwCalibrationAccess="ReadOnly", StorageClass="Global", MemorySection="VAR")
UNPACK_IF_CR_ObjRelVelYStd_Le_CR_FD1 = AUTOSAR4.Signal(SwCalibrationAccess="ReadOnly", StorageClass="Global", MemorySection="VAR")
UNPACK_IF_CR_ObjRelVelYStd_Ri_CR_FD1 = AUTOSAR4.Signal(SwCalibrationAccess="ReadOnly", StorageClass="Global", MemorySection="VAR")
UNPACK_IF_CR_ObjRelVelY_Le_CR_FD1 = AUTOSAR4.Signal(SwCalibrationAccess="ReadOnly", StorageClass="Global", MemorySection="VAR")
UNPACK_IF_CR_ObjRelVelY_Ri_CR_FD1 = AUTOSAR4.Signal(SwCalibrationAccess="ReadOnly", StorageClass="Global", MemorySection="VAR")
UNPACK_IF_CR_ObjSts_Le_CR_FD1 = AUTOSAR4.Signal(SwCalibrationAccess="ReadOnly", StorageClass="Global", MemorySection="VAR")
UNPACK_IF_CR_ObjSts_Ri_CR_FD1 = AUTOSAR4.Signal(SwCalibrationAccess="ReadOnly", StorageClass="Global", MemorySection="VAR")
UNPACK_IF_CURRENT_GEAR_DCT5 = AUTOSAR4.Signal(SwCalibrationAccess="ReadOnly", StorageClass="Global", MemorySection="VAR")
UNPACK_IF_CurrentGearValid_DCT5 = AUTOSAR4.Signal(SwCalibrationAccess="ReadOnly", StorageClass="Global", MemorySection="VAR")
UNPACK_IF_DrivingModDis_ESP_FD2 = AUTOSAR4.Signal(SwCalibrationAccess="ReadOnly", StorageClass="Global", MemorySection="VAR")
UNPACK_IF_DrvDoorSts_BCM1 = AUTOSAR4.Signal(SwCalibrationAccess="ReadOnly", StorageClass="Global", MemorySection="VAR")
UNPACK_IF_DrvEngTrqReqVld_ECM_FD1 = AUTOSAR4.Signal(SwCalibrationAccess="ReadOnly", StorageClass="Global", MemorySection="VAR")
UNPACK_IF_DrvEngTrqReq_ECM_FD1 = AUTOSAR4.Signal(SwCalibrationAccess="ReadOnly", StorageClass="Global", MemorySection="VAR")
UNPACK_IF_DrvFaiMsg_DCT_FD4 = AUTOSAR4.Signal(SwCalibrationAccess="ReadOnly", StorageClass="Global", MemorySection="VAR")
UNPACK_IF_DrvPressBrkPedalAvl_ESP14 = AUTOSAR4.Signal(SwCalibrationAccess="ReadOnly", StorageClass="Global", MemorySection="VAR")
UNPACK_IF_DrvReqFxBrkDomAvail_ESP14 = AUTOSAR4.Signal(SwCalibrationAccess="ReadOnly", StorageClass="Global", MemorySection="VAR")
UNPACK_IF_DrvReqFxBrkDomAvail_IBooster3 = AUTOSAR4.Signal(SwCalibrationAccess="ReadOnly", StorageClass="Global", MemorySection="VAR")
UNPACK_IF_DrvSBR_ABM1 = AUTOSAR4.Signal(SwCalibrationAccess="ReadOnly", StorageClass="Global", MemorySection="VAR")
UNPACK_IF_DrvTrqReqOvld_HCU_FD3 = AUTOSAR4.Signal(SwCalibrationAccess="ReadOnly", StorageClass="Global", MemorySection="VAR")
UNPACK_IF_EBDFailSts_ESP_FD2 = AUTOSAR4.Signal(SwCalibrationAccess="ReadOnly", StorageClass="Global", MemorySection="VAR")
UNPACK_IF_ECMACCInterface_ECM_FD2 = AUTOSAR4.Signal(SwCalibrationAccess="ReadOnly", StorageClass="Global", MemorySection="VAR")
UNPACK_IF_ECMRespACC_ECM_FD2 = AUTOSAR4.Signal(SwCalibrationAccess="ReadOnly", StorageClass="Global", MemorySection="VAR")
UNPACK_IF_ELKSwtReq_HUT_FD1 = AUTOSAR4.Signal(SwCalibrationAccess="ReadOnly", StorageClass="Global", MemorySection="VAR")
UNPACK_IF_EPBErrSts_ESP_FD3 = AUTOSAR4.Signal(SwCalibrationAccess="ReadOnly", StorageClass="Global", MemorySection="VAR")
UNPACK_IF_EPBSts_ESP_FD3 = AUTOSAR4.Signal(SwCalibrationAccess="ReadOnly", StorageClass="Global", MemorySection="VAR")
UNPACK_IF_EPB_SwtPosnVld_ESP_FD3 = AUTOSAR4.Signal(SwCalibrationAccess="ReadOnly", StorageClass="Global", MemorySection="VAR")
UNPACK_IF_EPB_SwtPosn_ESP_FD3 = AUTOSAR4.Signal(SwCalibrationAccess="ReadOnly", StorageClass="Global", MemorySection="VAR")
UNPACK_IF_ESPBrkLmpCtrl_ESP_FD2 = AUTOSAR4.Signal(SwCalibrationAccess="ReadOnly", StorageClass="Global", MemorySection="VAR")
UNPACK_IF_ESPFailSts_ESP_FD2 = AUTOSAR4.Signal(SwCalibrationAccess="ReadOnly", StorageClass="Global", MemorySection="VAR")
UNPACK_IF_ESPFuncOffSts_ESP_FD2 = AUTOSAR4.Signal(SwCalibrationAccess="ReadOnly", StorageClass="Global", MemorySection="VAR")
UNPACK_IF_ESP_DSTSts_ESP_FD3 = AUTOSAR4.Signal(SwCalibrationAccess="ReadOnly", StorageClass="Global", MemorySection="VAR")
UNPACK_IF_ESP_DiagActv_ESP_FD2 = AUTOSAR4.Signal(SwCalibrationAccess="ReadOnly", StorageClass="Global", MemorySection="VAR")
UNPACK_IF_ESP_MasterCylBrkPressVld_ESP_FD2 = AUTOSAR4.Signal(SwCalibrationAccess="ReadOnly", StorageClass="Global", MemorySection="VAR")
UNPACK_IF_ESP_MasterCylBrkPress_ESP_FD2 = AUTOSAR4.Signal(SwCalibrationAccess="ReadOnly", StorageClass="Global", MemorySection="VAR")
UNPACK_IF_ESS_PedSwtReq_HUT_FD1 = AUTOSAR4.Signal(SwCalibrationAccess="ReadOnly", StorageClass="Global", MemorySection="VAR")
UNPACK_IF_ESS_VehSwtReq_HUT_FD1 = AUTOSAR4.Signal(SwCalibrationAccess="ReadOnly", StorageClass="Global", MemorySection="VAR")
UNPACK_IF_EngFail_ECM_FD2 = AUTOSAR4.Signal(SwCalibrationAccess="ReadOnly", StorageClass="Global", MemorySection="VAR")
UNPACK_IF_EngLimpHomeSts_ECM_FD3 = AUTOSAR4.Signal(SwCalibrationAccess="ReadOnly", StorageClass="Global", MemorySection="VAR")
UNPACK_IF_EngSpdVldty_ECM1 = AUTOSAR4.Signal(SwCalibrationAccess="ReadOnly", StorageClass="Global", MemorySection="VAR")
UNPACK_IF_EngSpdVldty_ECM_FD1 = AUTOSAR4.Signal(SwCalibrationAccess="ReadOnly", StorageClass="Global", MemorySection="VAR")
UNPACK_IF_EngSpd_ECM1 = AUTOSAR4.Signal(SwCalibrationAccess="ReadOnly", StorageClass="Global", MemorySection="VAR")
UNPACK_IF_EngSpd_ECM_FD1 = AUTOSAR4.Signal(SwCalibrationAccess="ReadOnly", StorageClass="Global", MemorySection="VAR")
UNPACK_IF_EngState_ECM_FD2 = AUTOSAR4.Signal(SwCalibrationAccess="ReadOnly", StorageClass="Global", MemorySection="VAR")
UNPACK_IF_EngState_PHEV_ECM_FD2 = AUTOSAR4.Signal(SwCalibrationAccess="ReadOnly", StorageClass="Global", MemorySection="VAR")
UNPACK_IF_EngTrqMaxActSpd_ECM_FD1 = AUTOSAR4.Signal(SwCalibrationAccess="ReadOnly", StorageClass="Global", MemorySection="VAR")
UNPACK_IF_EngTrqMinAct_ECM_FD1 = AUTOSAR4.Signal(SwCalibrationAccess="ReadOnly", StorageClass="Global", MemorySection="VAR")
UNPACK_IF_FCTA_B_FuncSts_CR_FD1 = AUTOSAR4.Signal(SwCalibrationAccess="ReadOnly", StorageClass="Global", MemorySection="VAR")
UNPACK_IF_FCTA_B_TTC_CR_FD1 = AUTOSAR4.Signal(SwCalibrationAccess="ReadOnly", StorageClass="Global", MemorySection="VAR")
UNPACK_IF_FCTA_Warn_CR_FD1 = AUTOSAR4.Signal(SwCalibrationAccess="ReadOnly", StorageClass="Global", MemorySection="VAR")
UNPACK_IF_FCTBTrig_CR_FD1 = AUTOSAR4.Signal(SwCalibrationAccess="ReadOnly", StorageClass="Global", MemorySection="VAR")
UNPACK_IF_FCTB_ABA_Level_CR_FD1 = AUTOSAR4.Signal(SwCalibrationAccess="ReadOnly", StorageClass="Global", MemorySection="VAR")
UNPACK_IF_FCTB_ABA_Req_CR_FD1 = AUTOSAR4.Signal(SwCalibrationAccess="ReadOnly", StorageClass="Global", MemorySection="VAR")
UNPACK_IF_FCTB_ABP_Req_CR_FD1 = AUTOSAR4.Signal(SwCalibrationAccess="ReadOnly", StorageClass="Global", MemorySection="VAR")
UNPACK_IF_FCW_SnvtySet_HUT_FD1 = AUTOSAR4.Signal(SwCalibrationAccess="ReadOnly", StorageClass="Global", MemorySection="VAR")
UNPACK_IF_FLWheelDriveDirection_ESP_FD3 = AUTOSAR4.Signal(SwCalibrationAccess="ReadOnly", StorageClass="Global", MemorySection="VAR")
UNPACK_IF_FLWheelDriveDirection_IBooster_FD2 = AUTOSAR4.Signal(SwCalibrationAccess="ReadOnly", StorageClass="Global", MemorySection="VAR")
UNPACK_IF_FLWheelSpdVld_ESP_FD3 = AUTOSAR4.Signal(SwCalibrationAccess="ReadOnly", StorageClass="Global", MemorySection="VAR")
UNPACK_IF_FLWheelSpdVld_IBooster_FD2 = AUTOSAR4.Signal(SwCalibrationAccess="ReadOnly", StorageClass="Global", MemorySection="VAR")
UNPACK_IF_FLWheelSpd_ESP_FD3 = AUTOSAR4.Signal(SwCalibrationAccess="ReadOnly", StorageClass="Global", MemorySection="VAR")
UNPACK_IF_FLWheelSpd_IBooster_FD2 = AUTOSAR4.Signal(SwCalibrationAccess="ReadOnly", StorageClass="Global", MemorySection="VAR")
UNPACK_IF_FRWheelDriveDirection_ESP_FD3 = AUTOSAR4.Signal(SwCalibrationAccess="ReadOnly", StorageClass="Global", MemorySection="VAR")
UNPACK_IF_FRWheelDriveDirection_IBooster_FD2 = AUTOSAR4.Signal(SwCalibrationAccess="ReadOnly", StorageClass="Global", MemorySection="VAR")
UNPACK_IF_FRWheelSpdVld_ESP_FD3 = AUTOSAR4.Signal(SwCalibrationAccess="ReadOnly", StorageClass="Global", MemorySection="VAR")
UNPACK_IF_FRWheelSpdVld_IBooster_FD2 = AUTOSAR4.Signal(SwCalibrationAccess="ReadOnly", StorageClass="Global", MemorySection="VAR")
UNPACK_IF_FRWheelSpd_ESP_FD3 = AUTOSAR4.Signal(SwCalibrationAccess="ReadOnly", StorageClass="Global", MemorySection="VAR")
UNPACK_IF_FRWheelSpd_IBooster_FD2 = AUTOSAR4.Signal(SwCalibrationAccess="ReadOnly", StorageClass="Global", MemorySection="VAR")
UNPACK_IF_FrntFogLmpSwtSts_CSA1 = AUTOSAR4.Signal(SwCalibrationAccess="ReadOnly", StorageClass="Global", MemorySection="VAR")
UNPACK_IF_FrntWiprSwtSts_CSA1 = AUTOSAR4.Signal(SwCalibrationAccess="ReadOnly", StorageClass="Global", MemorySection="VAR")
UNPACK_IF_FrntWshrSwtSts_CSA1 = AUTOSAR4.Signal(SwCalibrationAccess="ReadOnly", StorageClass="Global", MemorySection="VAR")
UNPACK_IF_HCU_ACCInterface_HCU_FD1 = AUTOSAR4.Signal(SwCalibrationAccess="ReadOnly", StorageClass="Global", MemorySection="VAR")
UNPACK_IF_HCU_AccelPedalPosn_DiagValid_HCU_FD1 = AUTOSAR4.Signal(SwCalibrationAccess="ReadOnly", StorageClass="Global", MemorySection="VAR")
UNPACK_IF_HCU_AccelPedalPosn_Diag_HCU_FD1 = AUTOSAR4.Signal(SwCalibrationAccess="ReadOnly", StorageClass="Global", MemorySection="VAR")
UNPACK_IF_HCU_BrkPedalStsValid_HCU_FD1 = AUTOSAR4.Signal(SwCalibrationAccess="ReadOnly", StorageClass="Global", MemorySection="VAR")
UNPACK_IF_HCU_BrkPedalSts_HCU_FD1 = AUTOSAR4.Signal(SwCalibrationAccess="ReadOnly", StorageClass="Global", MemorySection="VAR")
UNPACK_IF_HCU_DrvMod_HCU_FD3 = AUTOSAR4.Signal(SwCalibrationAccess="ReadOnly", StorageClass="Global", MemorySection="VAR")
UNPACK_IF_HCU_FltLvl_HCU_FD3 = AUTOSAR4.Signal(SwCalibrationAccess="ReadOnly", StorageClass="Global", MemorySection="VAR")
UNPACK_IF_HCU_GearSts_HCU_FD3 = AUTOSAR4.Signal(SwCalibrationAccess="ReadOnly", StorageClass="Global", MemorySection="VAR")
UNPACK_IF_HCU_PTDrvMod_HCU_FD3 = AUTOSAR4.Signal(SwCalibrationAccess="ReadOnly", StorageClass="Global", MemorySection="VAR")
UNPACK_IF_HCU_PowertrainSts_HCU_FD1 = AUTOSAR4.Signal(SwCalibrationAccess="ReadOnly", StorageClass="Global", MemorySection="VAR")
UNPACK_IF_HCU_PowertrainSts_P0_ECM_FD1 = AUTOSAR4.Signal(SwCalibrationAccess="ReadOnly", StorageClass="Global", MemorySection="VAR")
UNPACK_IF_HCU_Start_StopSts_ECM_FD1 = AUTOSAR4.Signal(SwCalibrationAccess="ReadOnly", StorageClass="Global", MemorySection="VAR")
UNPACK_IF_HDCCtrl_ESP_FD2 = AUTOSAR4.Signal(SwCalibrationAccess="ReadOnly", StorageClass="Global", MemorySection="VAR")
UNPACK_IF_HWA_OK_OFFSwt_CSA2 = AUTOSAR4.Signal(SwCalibrationAccess="ReadOnly", StorageClass="Global", MemorySection="VAR")
UNPACK_IF_HWA_SnvtySet_HUT_FD1 = AUTOSAR4.Signal(SwCalibrationAccess="ReadOnly", StorageClass="Global", MemorySection="VAR")
UNPACK_IF_HWA_SwtReq_HUT_FD1 = AUTOSAR4.Signal(SwCalibrationAccess="ReadOnly", StorageClass="Global", MemorySection="VAR")
UNPACK_IF_HazardLmpSwtSts_BCM3 = AUTOSAR4.Signal(SwCalibrationAccess="ReadOnly", StorageClass="Global", MemorySection="VAR")
UNPACK_IF_HiBeamSwtSts_CSA1 = AUTOSAR4.Signal(SwCalibrationAccess="ReadOnly", StorageClass="Global", MemorySection="VAR")
UNPACK_IF_IB_BrkPedalAppldVld_IBooster_FD2 = AUTOSAR4.Signal(SwCalibrationAccess="ReadOnly", StorageClass="Global", MemorySection="VAR")
UNPACK_IF_IB_BrkPedalAppld_IBooster_FD2 = AUTOSAR4.Signal(SwCalibrationAccess="ReadOnly", StorageClass="Global", MemorySection="VAR")
UNPACK_IF_ICA_HandsOffSwtReq_HUT_FD1 = AUTOSAR4.Signal(SwCalibrationAccess="ReadOnly", StorageClass="Global", MemorySection="VAR")
UNPACK_IF_IFC_SnvtySet_HUT_FD1 = AUTOSAR4.Signal(SwCalibrationAccess="ReadOnly", StorageClass="Global", MemorySection="VAR")
UNPACK_IF_ISLSwtReq_HUT_FD1 = AUTOSAR4.Signal(SwCalibrationAccess="ReadOnly", StorageClass="Global", MemorySection="VAR")
UNPACK_IF_IntelligentEvaSwtReq_HUT_FD1 = AUTOSAR4.Signal(SwCalibrationAccess="ReadOnly", StorageClass="Global", MemorySection="VAR")
UNPACK_IF_IsDrvPressBrkPedal_ESP14 = AUTOSAR4.Signal(SwCalibrationAccess="ReadOnly", StorageClass="Global", MemorySection="VAR")
UNPACK_IF_IsDrvReqFxBrakeDom_ESP14 = AUTOSAR4.Signal(SwCalibrationAccess="ReadOnly", StorageClass="Global", MemorySection="VAR")
UNPACK_IF_IsDrvReqFxBrakeDom_IBooster3 = AUTOSAR4.Signal(SwCalibrationAccess="ReadOnly", StorageClass="Global", MemorySection="VAR")
UNPACK_IF_KL30BRelaySts_BCM8 = AUTOSAR4.Signal(SwCalibrationAccess="ReadOnly", StorageClass="Global", MemorySection="VAR")
UNPACK_IF_L12VLCADactive_ESP_FD2 = AUTOSAR4.Signal(SwCalibrationAccess="ReadOnly", StorageClass="Global", MemorySection="VAR")
UNPACK_IF_L12mainVMCavailiable_ESP_FD2 = AUTOSAR4.Signal(SwCalibrationAccess="ReadOnly", StorageClass="Global", MemorySection="VAR")
UNPACK_IF_L3VLCADactive_ESP_FD3 = AUTOSAR4.Signal(SwCalibrationAccess="ReadOnly", StorageClass="Global", MemorySection="VAR")
UNPACK_IF_L3VLCADactive_IBooster_FD2 = AUTOSAR4.Signal(SwCalibrationAccess="ReadOnly", StorageClass="Global", MemorySection="VAR")
UNPACK_IF_L3mainVMCavailiable_ESP_FD3 = AUTOSAR4.Signal(SwCalibrationAccess="ReadOnly", StorageClass="Global", MemorySection="VAR")
UNPACK_IF_L3mainVMCavailiable_IBooster_FD2 = AUTOSAR4.Signal(SwCalibrationAccess="ReadOnly", StorageClass="Global", MemorySection="VAR")
UNPACK_IF_LCKSwtReq_HUT_FD1 = AUTOSAR4.Signal(SwCalibrationAccess="ReadOnly", StorageClass="Global", MemorySection="VAR")
UNPACK_IF_LDWSwtReq_HUT_FD1 = AUTOSAR4.Signal(SwCalibrationAccess="ReadOnly", StorageClass="Global", MemorySection="VAR")
UNPACK_IF_LKASwtReq_HUT_FD1 = AUTOSAR4.Signal(SwCalibrationAccess="ReadOnly", StorageClass="Global", MemorySection="VAR")
UNPACK_IF_LRDoorSts_BCM1 = AUTOSAR4.Signal(SwCalibrationAccess="ReadOnly", StorageClass="Global", MemorySection="VAR")
UNPACK_IF_LSMGearRequest_ESP_FD3 = AUTOSAR4.Signal(SwCalibrationAccess="ReadOnly", StorageClass="Global", MemorySection="VAR")
UNPACK_IF_LSSSwtReq_HUT_FD1 = AUTOSAR4.Signal(SwCalibrationAccess="ReadOnly", StorageClass="Global", MemorySection="VAR")
UNPACK_IF_LSSWarnFormSwtReq_HUT_FD1 = AUTOSAR4.Signal(SwCalibrationAccess="ReadOnly", StorageClass="Global", MemorySection="VAR")
UNPACK_IF_LTurnLmpSwtSts_CSA1 = AUTOSAR4.Signal(SwCalibrationAccess="ReadOnly", StorageClass="Global", MemorySection="VAR")
UNPACK_IF_LowBeamSwtSts_CSA1 = AUTOSAR4.Signal(SwCalibrationAccess="ReadOnly", StorageClass="Global", MemorySection="VAR")
UNPACK_IF_MSRActv_ESP_FD2 = AUTOSAR4.Signal(SwCalibrationAccess="ReadOnly", StorageClass="Global", MemorySection="VAR")
UNPACK_IF_MSRActv_RA_ESP_FD2 = AUTOSAR4.Signal(SwCalibrationAccess="ReadOnly", StorageClass="Global", MemorySection="VAR")
UNPACK_IF_MaxEngTrqNorm_ECM_FD3 = AUTOSAR4.Signal(SwCalibrationAccess="ReadOnly", StorageClass="Global", MemorySection="VAR")
UNPACK_IF_MaxPsblWheelTrq_HCU_FD1 = AUTOSAR4.Signal(SwCalibrationAccess="ReadOnly", StorageClass="Global", MemorySection="VAR")
UNPACK_IF_MinPsblWheelTrq_HCU_FD1 = AUTOSAR4.Signal(SwCalibrationAccess="ReadOnly", StorageClass="Global", MemorySection="VAR")

UNPACK_IF_NOH_Act_Req_HUT_FD3 = AUTOSAR4.Signal(SwCalibrationAccess="ReadOnly", StorageClass="Global", MemorySection="VAR")
UNPACK_IF_NOH_Swt_Req_HUT_FD3 = AUTOSAR4.Signal(SwCalibrationAccess="ReadOnly", StorageClass="Global", MemorySection="VAR")
UNPACK_IF_NavCtryType_HUT_FD1 = AUTOSAR4.Signal(SwCalibrationAccess="ReadOnly", StorageClass="Global", MemorySection="VAR")
UNPACK_IF_NavRoadType_HUT_FD1 = AUTOSAR4.Signal(SwCalibrationAccess="ReadOnly", StorageClass="Global", MemorySection="VAR")
UNPACK_IF_NavSpdLimSignSts_HUT_FD1 = AUTOSAR4.Signal(SwCalibrationAccess="ReadOnly", StorageClass="Global", MemorySection="VAR")
UNPACK_IF_NavSpdLimType_HUT_FD1 = AUTOSAR4.Signal(SwCalibrationAccess="ReadOnly", StorageClass="Global", MemorySection="VAR")
UNPACK_IF_NavSpdLimUnit_HUT_HUT_FD1 = AUTOSAR4.Signal(SwCalibrationAccess="ReadOnly", StorageClass="Global", MemorySection="VAR")
UNPACK_IF_NavSpdLimValue_HUT_FD1 = AUTOSAR4.Signal(SwCalibrationAccess="ReadOnly", StorageClass="Global", MemorySection="VAR")
UNPACK_IF_NavTSRTrafSign_HUT_FD1 = AUTOSAR4.Signal(SwCalibrationAccess="ReadOnly", StorageClass="Global", MemorySection="VAR")
UNPACK_IF_NavVehToTrafEyeDist_HUT_FD1 = AUTOSAR4.Signal(SwCalibrationAccess="ReadOnly", StorageClass="Global", MemorySection="VAR")
UNPACK_IF_NetEngTrq_ECM_FD1 = AUTOSAR4.Signal(SwCalibrationAccess="ReadOnly", StorageClass="Global", MemorySection="VAR")
UNPACK_IF_NoBrkForce_ESP_FD2 = AUTOSAR4.Signal(SwCalibrationAccess="ReadOnly", StorageClass="Global", MemorySection="VAR")
UNPACK_IF_PASWorkCmd_BCM8 = AUTOSAR4.Signal(SwCalibrationAccess="ReadOnly", StorageClass="Global", MemorySection="VAR")
UNPACK_IF_PTCActv_ESP_FD2 = AUTOSAR4.Signal(SwCalibrationAccess="ReadOnly", StorageClass="Global", MemorySection="VAR")
UNPACK_IF_PTCActv_RA_ESP_FD2 = AUTOSAR4.Signal(SwCalibrationAccess="ReadOnly", StorageClass="Global", MemorySection="VAR")
UNPACK_IF_ParkPawlRequest_ESP_FD3 = AUTOSAR4.Signal(SwCalibrationAccess="ReadOnly", StorageClass="Global", MemorySection="VAR")
UNPACK_IF_PassSBR_ABM1 = AUTOSAR4.Signal(SwCalibrationAccess="ReadOnly", StorageClass="Global", MemorySection="VAR")
UNPACK_IF_PassengerDoorSts_BCM1 = AUTOSAR4.Signal(SwCalibrationAccess="ReadOnly", StorageClass="Global", MemorySection="VAR")
UNPACK_IF_RLWheelDriveDirection_ESP_FD3 = AUTOSAR4.Signal(SwCalibrationAccess="ReadOnly", StorageClass="Global", MemorySection="VAR")
UNPACK_IF_RLWheelDriveDirection_IBooster_FD2 = AUTOSAR4.Signal(SwCalibrationAccess="ReadOnly", StorageClass="Global", MemorySection="VAR")
UNPACK_IF_RLWheelSpdVld_ESP_FD3 = AUTOSAR4.Signal(SwCalibrationAccess="ReadOnly", StorageClass="Global", MemorySection="VAR")
UNPACK_IF_RLWheelSpdVld_IBooster_FD2 = AUTOSAR4.Signal(SwCalibrationAccess="ReadOnly", StorageClass="Global", MemorySection="VAR")
UNPACK_IF_RLWheelSpd_ESP_FD3 = AUTOSAR4.Signal(SwCalibrationAccess="ReadOnly", StorageClass="Global", MemorySection="VAR")
UNPACK_IF_RLWheelSpd_IBooster_FD2 = AUTOSAR4.Signal(SwCalibrationAccess="ReadOnly", StorageClass="Global", MemorySection="VAR")
UNPACK_IF_RRDoorSts_BCM1 = AUTOSAR4.Signal(SwCalibrationAccess="ReadOnly", StorageClass="Global", MemorySection="VAR")
UNPACK_IF_RRWheelDriveDirection_ESP_FD3 = AUTOSAR4.Signal(SwCalibrationAccess="ReadOnly", StorageClass="Global", MemorySection="VAR")
UNPACK_IF_RRWheelDriveDirection_IBooster_FD2 = AUTOSAR4.Signal(SwCalibrationAccess="ReadOnly", StorageClass="Global", MemorySection="VAR")
UNPACK_IF_RRWheelSpdVld_ESP_FD3 = AUTOSAR4.Signal(SwCalibrationAccess="ReadOnly", StorageClass="Global", MemorySection="VAR")
UNPACK_IF_RRWheelSpdVld_IBooster_FD2 = AUTOSAR4.Signal(SwCalibrationAccess="ReadOnly", StorageClass="Global", MemorySection="VAR")
UNPACK_IF_RRWheelSpd_ESP_FD3 = AUTOSAR4.Signal(SwCalibrationAccess="ReadOnly", StorageClass="Global", MemorySection="VAR")
UNPACK_IF_RRWheelSpd_IBooster_FD2 = AUTOSAR4.Signal(SwCalibrationAccess="ReadOnly", StorageClass="Global", MemorySection="VAR")
UNPACK_IF_RTurnLmpSwtSts_CSA1 = AUTOSAR4.Signal(SwCalibrationAccess="ReadOnly", StorageClass="Global", MemorySection="VAR")
UNPACK_IF_RatAct_DCT_FD1 = AUTOSAR4.Signal(SwCalibrationAccess="ReadOnly", StorageClass="Global", MemorySection="VAR")
UNPACK_IF_Rollingcounter_CSA2_CSA2 = AUTOSAR4.Signal(SwCalibrationAccess="ReadOnly", StorageClass="Global", MemorySection="VAR")
UNPACK_IF_SAS_Sts_CSA2 = AUTOSAR4.Signal(SwCalibrationAccess="ReadOnly", StorageClass="Global", MemorySection="VAR")
UNPACK_IF_SHIFT_IN_PROGRESS_DCT5 = AUTOSAR4.Signal(SwCalibrationAccess="ReadOnly", StorageClass="Global", MemorySection="VAR")
UNPACK_IF_ShiftInPrgValid_DCT5 = AUTOSAR4.Signal(SwCalibrationAccess="ReadOnly", StorageClass="Global", MemorySection="VAR")
UNPACK_IF_Start_StopSts_ECM_FD1 = AUTOSAR4.Signal(SwCalibrationAccess="ReadOnly", StorageClass="Global", MemorySection="VAR")
UNPACK_IF_SteerWheelAngSign_CSA2 = AUTOSAR4.Signal(SwCalibrationAccess="ReadOnly", StorageClass="Global", MemorySection="VAR")
UNPACK_IF_SteerWheelAng_CSA2 = AUTOSAR4.Signal(SwCalibrationAccess="ReadOnly", StorageClass="Global", MemorySection="VAR")
UNPACK_IF_SteerWheelSpdSign_CSA2 = AUTOSAR4.Signal(SwCalibrationAccess="ReadOnly", StorageClass="Global", MemorySection="VAR")
UNPACK_IF_SteerWheelSpd_CSA2 = AUTOSAR4.Signal(SwCalibrationAccess="ReadOnly", StorageClass="Global", MemorySection="VAR")
UNPACK_IF_TARGET_GEAR_DCT5 = AUTOSAR4.Signal(SwCalibrationAccess="ReadOnly", StorageClass="Global", MemorySection="VAR")
UNPACK_IF_TGS_LEVER_DCT5 = AUTOSAR4.Signal(SwCalibrationAccess="ReadOnly", StorageClass="Global", MemorySection="VAR")
UNPACK_IF_TSRSwtReq_HUT_FD1 = AUTOSAR4.Signal(SwCalibrationAccess="ReadOnly", StorageClass="Global", MemorySection="VAR")
UNPACK_IF_TSRWarnSwtReq_HUT_FD1 = AUTOSAR4.Signal(SwCalibrationAccess="ReadOnly", StorageClass="Global", MemorySection="VAR")
UNPACK_IF_TSR_SnvtySet_HUT_FD1 = AUTOSAR4.Signal(SwCalibrationAccess="ReadOnly", StorageClass="Global", MemorySection="VAR")
UNPACK_IF_TargetGearValid_DCT5 = AUTOSAR4.Signal(SwCalibrationAccess="ReadOnly", StorageClass="Global", MemorySection="VAR")
UNPACK_IF_TimeIndcn_HUT34 = AUTOSAR4.Signal(SwCalibrationAccess="ReadOnly", StorageClass="Global", MemorySection="VAR")
UNPACK_IF_TimeMod_HUT34 = AUTOSAR4.Signal(SwCalibrationAccess="ReadOnly", StorageClass="Global", MemorySection="VAR")
UNPACK_IF_Time_Day_HUT34 = AUTOSAR4.Signal(SwCalibrationAccess="ReadOnly", StorageClass="Global", MemorySection="VAR")
UNPACK_IF_Time_Hour_HUT34 = AUTOSAR4.Signal(SwCalibrationAccess="ReadOnly", StorageClass="Global", MemorySection="VAR")
UNPACK_IF_Time_Minutes_HUT34 = AUTOSAR4.Signal(SwCalibrationAccess="ReadOnly", StorageClass="Global", MemorySection="VAR")
UNPACK_IF_Time_Month_HUT34 = AUTOSAR4.Signal(SwCalibrationAccess="ReadOnly", StorageClass="Global", MemorySection="VAR")
UNPACK_IF_Time_Second_HUT34 = AUTOSAR4.Signal(SwCalibrationAccess="ReadOnly", StorageClass="Global", MemorySection="VAR")
UNPACK_IF_Time_Year_Left_HUT34 = AUTOSAR4.Signal(SwCalibrationAccess="ReadOnly", StorageClass="Global", MemorySection="VAR")
UNPACK_IF_Time_Year_Right_HUT34 = AUTOSAR4.Signal(SwCalibrationAccess="ReadOnly", StorageClass="Global", MemorySection="VAR")
UNPACK_IF_TotWheelTrq_HCU_FD1 = AUTOSAR4.Signal(SwCalibrationAccess="ReadOnly", StorageClass="Global", MemorySection="VAR")
UNPACK_IF_TrailerSts_Trailer1 = AUTOSAR4.Signal(SwCalibrationAccess="ReadOnly", StorageClass="Global", MemorySection="VAR")
UNPACK_IF_TrqLossVldty_ECM_FD1 = AUTOSAR4.Signal(SwCalibrationAccess="ReadOnly", StorageClass="Global", MemorySection="VAR")
UNPACK_IF_TrqLoss_ECM_FD1 = AUTOSAR4.Signal(SwCalibrationAccess="ReadOnly", StorageClass="Global", MemorySection="VAR")
UNPACK_IF_VDCActv_ESP_FD2 = AUTOSAR4.Signal(SwCalibrationAccess="ReadOnly", StorageClass="Global", MemorySection="VAR")
UNPACK_IF_VLC_ESP_FuelCutOffPrevention_ESP_FD3 = AUTOSAR4.Signal(SwCalibrationAccess="ReadOnly", StorageClass="Global", MemorySection="VAR")
UNPACK_IF_VLC_ESP_State_ESP_FD3 = AUTOSAR4.Signal(SwCalibrationAccess="ReadOnly", StorageClass="Global", MemorySection="VAR")
UNPACK_IF_VLC_IntTartAccel_ESP_FD3 = AUTOSAR4.Signal(SwCalibrationAccess="ReadOnly", StorageClass="Global", MemorySection="VAR")
UNPACK_IF_VLC_IntTartAccel_IBooster_FD2 = AUTOSAR4.Signal(SwCalibrationAccess="ReadOnly", StorageClass="Global", MemorySection="VAR")
UNPACK_IF_VehDynYawRateVld_ABM2 = AUTOSAR4.Signal(SwCalibrationAccess="ReadOnly", StorageClass="Global", MemorySection="VAR")
UNPACK_IF_VehLatAccelVld_ABM2 = AUTOSAR4.Signal(SwCalibrationAccess="ReadOnly", StorageClass="Global", MemorySection="VAR")
UNPACK_IF_VehLatAccel_ABM2 = AUTOSAR4.Signal(SwCalibrationAccess="ReadOnly", StorageClass="Global", MemorySection="VAR")
UNPACK_IF_VehLgtAccelVld_ABM2 = AUTOSAR4.Signal(SwCalibrationAccess="ReadOnly", StorageClass="Global", MemorySection="VAR")
UNPACK_IF_VehLgtAccel_ABM2 = AUTOSAR4.Signal(SwCalibrationAccess="ReadOnly", StorageClass="Global", MemorySection="VAR")
UNPACK_IF_VehSpdVld_ESP_FD2 = AUTOSAR4.Signal(SwCalibrationAccess="ReadOnly", StorageClass="Global", MemorySection="VAR")
UNPACK_IF_VehSpdVld_IBooster_FD2 = AUTOSAR4.Signal(SwCalibrationAccess="ReadOnly", StorageClass="Global", MemorySection="VAR")
UNPACK_IF_VehSpd_ESP_FD2 = AUTOSAR4.Signal(SwCalibrationAccess="ReadOnly", StorageClass="Global", MemorySection="VAR")
UNPACK_IF_VehSpd_IBooster_FD2 = AUTOSAR4.Signal(SwCalibrationAccess="ReadOnly", StorageClass="Global", MemorySection="VAR")
UNPACK_IF_VehStandstill_ESP_FD2 = AUTOSAR4.Signal(SwCalibrationAccess="ReadOnly", StorageClass="Global", MemorySection="VAR")
UNPACK_IF_VehStandstill_IBooster_FD2 = AUTOSAR4.Signal(SwCalibrationAccess="ReadOnly", StorageClass="Global", MemorySection="VAR")
UNPACK_IF_VehYawRate_ABM2 = AUTOSAR4.Signal(SwCalibrationAccess="ReadOnly", StorageClass="Global", MemorySection="VAR")
UNPACK_IF_WindshldWiprActvSts_BCM1 = AUTOSAR4.Signal(SwCalibrationAccess="ReadOnly", StorageClass="Global", MemorySection="VAR")
UNPACK_IF_WssFLEdgesSumVld_ESP_FD3 = AUTOSAR4.Signal(SwCalibrationAccess="ReadOnly", StorageClass="Global", MemorySection="VAR")
UNPACK_IF_WssFLEdgesSumVld_IBooster_FD2 = AUTOSAR4.Signal(SwCalibrationAccess="ReadOnly", StorageClass="Global", MemorySection="VAR")
UNPACK_IF_WssFLEdgesSum_ESP_FD3 = AUTOSAR4.Signal(SwCalibrationAccess="ReadOnly", StorageClass="Global", MemorySection="VAR")
UNPACK_IF_WssFLEdgesSum_IBooster_FD2 = AUTOSAR4.Signal(SwCalibrationAccess="ReadOnly", StorageClass="Global", MemorySection="VAR")
UNPACK_IF_WssFREdgesSumVld_ESP_FD3 = AUTOSAR4.Signal(SwCalibrationAccess="ReadOnly", StorageClass="Global", MemorySection="VAR")
UNPACK_IF_WssFREdgesSumVld_IBooster_FD2 = AUTOSAR4.Signal(SwCalibrationAccess="ReadOnly", StorageClass="Global", MemorySection="VAR")
UNPACK_IF_WssFREdgesSum_ESP_FD3 = AUTOSAR4.Signal(SwCalibrationAccess="ReadOnly", StorageClass="Global", MemorySection="VAR")
UNPACK_IF_WssFREdgesSum_IBooster_FD2 = AUTOSAR4.Signal(SwCalibrationAccess="ReadOnly", StorageClass="Global", MemorySection="VAR")
UNPACK_IF_WssRLEdgesSumVld_ESP_FD3 = AUTOSAR4.Signal(SwCalibrationAccess="ReadOnly", StorageClass="Global", MemorySection="VAR")
UNPACK_IF_WssRLEdgesSumVld_IBooster_FD2 = AUTOSAR4.Signal(SwCalibrationAccess="ReadOnly", StorageClass="Global", MemorySection="VAR")
UNPACK_IF_WssRLEdgesSum_ESP_FD3 = AUTOSAR4.Signal(SwCalibrationAccess="ReadOnly", StorageClass="Global", MemorySection="VAR")
UNPACK_IF_WssRLEdgesSum_IBooster_FD2 = AUTOSAR4.Signal(SwCalibrationAccess="ReadOnly", StorageClass="Global", MemorySection="VAR")
UNPACK_IF_WssRREdgesSumVld_ESP_FD3 = AUTOSAR4.Signal(SwCalibrationAccess="ReadOnly", StorageClass="Global", MemorySection="VAR")
UNPACK_IF_WssRREdgesSumVld_IBooster_FD2 = AUTOSAR4.Signal(SwCalibrationAccess="ReadOnly", StorageClass="Global", MemorySection="VAR")
UNPACK_IF_WssRREdgesSum_ESP_FD3 = AUTOSAR4.Signal(SwCalibrationAccess="ReadOnly", StorageClass="Global", MemorySection="VAR")
UNPACK_IF_WssRREdgesSum_IBooster_FD2 = AUTOSAR4.Signal(SwCalibrationAccess="ReadOnly", StorageClass="Global", MemorySection="VAR")
UNPACK_IF_FFogLmpSts_F_Pbox_F_PBox1 = AUTOSAR4.Signal(SwCalibrationAccess="ReadOnly", StorageClass="Global", MemorySection="VAR")
UNPACK_IF_HiBeamSts_F_Pbox_F_PBox1 = AUTOSAR4.Signal(SwCalibrationAccess="ReadOnly", StorageClass="Global", MemorySection="VAR")
UNPACK_IF_HoodSts_F_Pbox_F_PBox1 = AUTOSAR4.Signal(SwCalibrationAccess="ReadOnly", StorageClass="Global", MemorySection="VAR")
UNPACK_IF_LTurnLmpSts_R_Pbox_R_PBox1 = AUTOSAR4.Signal(SwCalibrationAccess="ReadOnly", StorageClass="Global", MemorySection="VAR")
UNPACK_IF_LowBeamSts_F_Pbox_F_PBox1 = AUTOSAR4.Signal(SwCalibrationAccess="ReadOnly", StorageClass="Global", MemorySection="VAR")
UNPACK_IF_RFogLmpSts_R_Pbox_R_PBox1 = AUTOSAR4.Signal(SwCalibrationAccess="ReadOnly", StorageClass="Global", MemorySection="VAR")
UNPACK_IF_RTurnLmpSts_R_Pbox_R_PBox1 = AUTOSAR4.Signal(SwCalibrationAccess="ReadOnly", StorageClass="Global", MemorySection="VAR")
UNPACK_IF_APS_WorkSts_HAP_FD1 = AUTOSAR4.Signal(SwCalibrationAccess="ReadOnly", StorageClass="Global", MemorySection="VAR")
UNPACK_IF_DVRWorkSts_HAP_FD2 = AUTOSAR4.Signal(SwCalibrationAccess="ReadOnly", StorageClass="Global", MemorySection="VAR")
UNPACK_IF_TurnLightsCmd_HAP_FD1 = AUTOSAR4.Signal(SwCalibrationAccess="ReadOnly", StorageClass="Global", MemorySection="VAR")
UNPACK_IF_USS_FLCNear_Obj_Confidence_HAP_FD6 = AUTOSAR4.Signal(SwCalibrationAccess="ReadOnly", StorageClass="Global", MemorySection="VAR")
UNPACK_IF_USS_FLCNear_Obj_Pos_X_HAP_FD6 = AUTOSAR4.Signal(SwCalibrationAccess="ReadOnly", StorageClass="Global", MemorySection="VAR")
UNPACK_IF_USS_FLCNear_Obj_Pos_Y_HAP_FD6 = AUTOSAR4.Signal(SwCalibrationAccess="ReadOnly", StorageClass="Global", MemorySection="VAR")
UNPACK_IF_USS_FLMNear_Obj_Confidence_HAP_FD6 = AUTOSAR4.Signal(SwCalibrationAccess="ReadOnly", StorageClass="Global", MemorySection="VAR")
UNPACK_IF_USS_FLMNear_Obj_Pos_X_HAP_FD6 = AUTOSAR4.Signal(SwCalibrationAccess="ReadOnly", StorageClass="Global", MemorySection="VAR")
UNPACK_IF_USS_FLMNear_Obj_Pos_Y_HAP_FD6 = AUTOSAR4.Signal(SwCalibrationAccess="ReadOnly", StorageClass="Global", MemorySection="VAR")
UNPACK_IF_USS_FRCNear_Obj_Confidence_HAP_FD6 = AUTOSAR4.Signal(SwCalibrationAccess="ReadOnly", StorageClass="Global", MemorySection="VAR")
UNPACK_IF_USS_FRCNear_Obj_Pos_X_HAP_FD6 = AUTOSAR4.Signal(SwCalibrationAccess="ReadOnly", StorageClass="Global", MemorySection="VAR")
UNPACK_IF_USS_FRCNear_Obj_Pos_Y_HAP_FD6 = AUTOSAR4.Signal(SwCalibrationAccess="ReadOnly", StorageClass="Global", MemorySection="VAR")
UNPACK_IF_USS_FRMNear_Obj_Confidence_HAP_FD6 = AUTOSAR4.Signal(SwCalibrationAccess="ReadOnly", StorageClass="Global", MemorySection="VAR")
UNPACK_IF_USS_FRMNear_Obj_Pos_X_HAP_FD6 = AUTOSAR4.Signal(SwCalibrationAccess="ReadOnly", StorageClass="Global", MemorySection="VAR")
UNPACK_IF_USS_FRMNear_Obj_Pos_Y_HAP_FD6 = AUTOSAR4.Signal(SwCalibrationAccess="ReadOnly", StorageClass="Global", MemorySection="VAR")
UNPACK_IF_USS_FrontSys_Status_HAP_FD6 = AUTOSAR4.Signal(SwCalibrationAccess="ReadOnly", StorageClass="Global", MemorySection="VAR")
UNPACK_IF_DMSSts_DMS_FD1 = AUTOSAR4.Signal(SwCalibrationAccess="ReadOnly", StorageClass="Global", MemorySection="VAR")
UNPACK_IF_DVRSts_DVR_FD1 = AUTOSAR4.Signal(SwCalibrationAccess="ReadOnly", StorageClass="Global", MemorySection="VAR")
UNPACK_IF_DistrctnLvlQlty_ACC_DMS_FD1 = AUTOSAR4.Signal(SwCalibrationAccess="ReadOnly", StorageClass="Global", MemorySection="VAR")
UNPACK_IF_DistrctnLvl_ACC_DMS_FD1 = AUTOSAR4.Signal(SwCalibrationAccess="ReadOnly", StorageClass="Global", MemorySection="VAR")
UNPACK_IF_DrowsnsLvl_ACC_DMS_FD1 = AUTOSAR4.Signal(SwCalibrationAccess="ReadOnly", StorageClass="Global", MemorySection="VAR")
UNPACK_IF_HeadDetn_DMS_FD1 = AUTOSAR4.Signal(SwCalibrationAccess="ReadOnly", StorageClass="Global", MemorySection="VAR")
UNPACK_IF_HeadPitchAng_DMS_FD1 = AUTOSAR4.Signal(SwCalibrationAccess="ReadOnly", StorageClass="Global", MemorySection="VAR")
UNPACK_IF_HeadPosnX_DMS_FD1 = AUTOSAR4.Signal(SwCalibrationAccess="ReadOnly", StorageClass="Global", MemorySection="VAR")
UNPACK_IF_HeadPosnY_DMS_FD1 = AUTOSAR4.Signal(SwCalibrationAccess="ReadOnly", StorageClass="Global", MemorySection="VAR")
UNPACK_IF_HeadPosnZ_DMS_FD1 = AUTOSAR4.Signal(SwCalibrationAccess="ReadOnly", StorageClass="Global", MemorySection="VAR")
UNPACK_IF_HeadRollAng_DMS_FD1 = AUTOSAR4.Signal(SwCalibrationAccess="ReadOnly", StorageClass="Global", MemorySection="VAR")
UNPACK_IF_HeadYawAng_DMS_FD1 = AUTOSAR4.Signal(SwCalibrationAccess="ReadOnly", StorageClass="Global", MemorySection="VAR")
UNPACK_IF_IP_ACCErr_IP2 = AUTOSAR4.Signal(SwCalibrationAccess="ReadOnly", StorageClass="Global", MemorySection="VAR")
UNPACK_IF_IP_Err_IP2 = AUTOSAR4.Signal(SwCalibrationAccess="ReadOnly", StorageClass="Global", MemorySection="VAR")
UNPACK_IF_IP_VehSpdDisp_IP1 = AUTOSAR4.Signal(SwCalibrationAccess="ReadOnly", StorageClass="Global", MemorySection="VAR")
UNPACK_IF_IP_VehSpdUnit_IP2 = AUTOSAR4.Signal(SwCalibrationAccess="ReadOnly", StorageClass="Global", MemorySection="VAR")
UNPACK_IF_IP_VehTotDistanceValid_IP2 = AUTOSAR4.Signal(SwCalibrationAccess="ReadOnly", StorageClass="Global", MemorySection="VAR")
UNPACK_IF_IP_VehTotDistance_IP2 = AUTOSAR4.Signal(SwCalibrationAccess="ReadOnly", StorageClass="Global", MemorySection="VAR")
UNPACK_IF_IP_VelSpdDisp_Mile_IP1 = AUTOSAR4.Signal(SwCalibrationAccess="ReadOnly", StorageClass="Global", MemorySection="VAR")
UNPACK_IF_LEyeOpenStsQlty_DMS_FD1 = AUTOSAR4.Signal(SwCalibrationAccess="ReadOnly", StorageClass="Global", MemorySection="VAR")
UNPACK_IF_LEyeOpenSts_DMS_FD1 = AUTOSAR4.Signal(SwCalibrationAccess="ReadOnly", StorageClass="Global", MemorySection="VAR")
UNPACK_IF_LeTarSts_RSDS_FD1 = AUTOSAR4.Signal(SwCalibrationAccess="ReadOnly", StorageClass="Global", MemorySection="VAR")
UNPACK_IF_ObjIDLe_RSDS_FD1 = AUTOSAR4.Signal(SwCalibrationAccess="ReadOnly", StorageClass="Global", MemorySection="VAR")
UNPACK_IF_ObjIDRi_RSDS_FD1 = AUTOSAR4.Signal(SwCalibrationAccess="ReadOnly", StorageClass="Global", MemorySection="VAR")
UNPACK_IF_ObjLatPosnCurvLe_RSDS_FD1 = AUTOSAR4.Signal(SwCalibrationAccess="ReadOnly", StorageClass="Global", MemorySection="VAR")
UNPACK_IF_ObjLatPosnCurvRi_RSDS_FD1 = AUTOSAR4.Signal(SwCalibrationAccess="ReadOnly", StorageClass="Global", MemorySection="VAR")
UNPACK_IF_ObjLatSpdCurvLe_RSDS_FD1 = AUTOSAR4.Signal(SwCalibrationAccess="ReadOnly", StorageClass="Global", MemorySection="VAR")
UNPACK_IF_ObjLatSpdCurvRi_RSDS_FD1 = AUTOSAR4.Signal(SwCalibrationAccess="ReadOnly", StorageClass="Global", MemorySection="VAR")
UNPACK_IF_ObjLenLe_RSDS_FD1 = AUTOSAR4.Signal(SwCalibrationAccess="ReadOnly", StorageClass="Global", MemorySection="VAR")
UNPACK_IF_ObjLgtPosnCurvLe_RSDS_FD1 = AUTOSAR4.Signal(SwCalibrationAccess="ReadOnly", StorageClass="Global", MemorySection="VAR")
UNPACK_IF_ObjLgtPosnCurvRi_RSDS_FD1 = AUTOSAR4.Signal(SwCalibrationAccess="ReadOnly", StorageClass="Global", MemorySection="VAR")
UNPACK_IF_ObjLgtSpdCurvLe_RSDS_FD1 = AUTOSAR4.Signal(SwCalibrationAccess="ReadOnly", StorageClass="Global", MemorySection="VAR")
UNPACK_IF_ObjLgtSpdCurvRi_RSDS_FD1 = AUTOSAR4.Signal(SwCalibrationAccess="ReadOnly", StorageClass="Global", MemorySection="VAR")
UNPACK_IF_ObjRinRi_RSDS_FD1 = AUTOSAR4.Signal(SwCalibrationAccess="ReadOnly", StorageClass="Global", MemorySection="VAR")
UNPACK_IF_ObjStatyLe_RSDS_FD1 = AUTOSAR4.Signal(SwCalibrationAccess="ReadOnly", StorageClass="Global", MemorySection="VAR")
UNPACK_IF_ObjStatyRi_RSDS_FD1 = AUTOSAR4.Signal(SwCalibrationAccess="ReadOnly", StorageClass="Global", MemorySection="VAR")
UNPACK_IF_ObjStsLe_RSDS_FD1 = AUTOSAR4.Signal(SwCalibrationAccess="ReadOnly", StorageClass="Global", MemorySection="VAR")
UNPACK_IF_ObjStsRi_RSDS_FD1 = AUTOSAR4.Signal(SwCalibrationAccess="ReadOnly", StorageClass="Global", MemorySection="VAR")
UNPACK_IF_ObjTTCLe_RSDS_FD1 = AUTOSAR4.Signal(SwCalibrationAccess="ReadOnly", StorageClass="Global", MemorySection="VAR")
UNPACK_IF_ObjTTCRi_RSDS_FD1 = AUTOSAR4.Signal(SwCalibrationAccess="ReadOnly", StorageClass="Global", MemorySection="VAR")
UNPACK_IF_ObjWidthLe_RSDS_FD1 = AUTOSAR4.Signal(SwCalibrationAccess="ReadOnly", StorageClass="Global", MemorySection="VAR")
UNPACK_IF_ObjWidthRi_RSDS_FD1 = AUTOSAR4.Signal(SwCalibrationAccess="ReadOnly", StorageClass="Global", MemorySection="VAR")
UNPACK_IF_RCW_TTC_RSDS_FD2 = AUTOSAR4.Signal(SwCalibrationAccess="ReadOnly", StorageClass="Global", MemorySection="VAR")
UNPACK_IF_REyeOpenStsQlty_DMS_FD1 = AUTOSAR4.Signal(SwCalibrationAccess="ReadOnly", StorageClass="Global", MemorySection="VAR")
UNPACK_IF_REyeOpenSts_DMS_FD1 = AUTOSAR4.Signal(SwCalibrationAccess="ReadOnly", StorageClass="Global", MemorySection="VAR")
UNPACK_IF_RSDS_ObjDistXStd_Le_RSDS_FD1 = AUTOSAR4.Signal(SwCalibrationAccess="ReadOnly", StorageClass="Global", MemorySection="VAR")
UNPACK_IF_RSDS_ObjDistXStd_Ri_RSDS_FD1 = AUTOSAR4.Signal(SwCalibrationAccess="ReadOnly", StorageClass="Global", MemorySection="VAR")
UNPACK_IF_RSDS_ObjDistYStd_Le_RSDS_FD1 = AUTOSAR4.Signal(SwCalibrationAccess="ReadOnly", StorageClass="Global", MemorySection="VAR")
UNPACK_IF_RSDS_ObjDistYStd_Ri_RSDS_FD1 = AUTOSAR4.Signal(SwCalibrationAccess="ReadOnly", StorageClass="Global", MemorySection="VAR")
UNPACK_IF_RSDS_ObjRAccelXStd_Le_RSDS_FD1 = AUTOSAR4.Signal(SwCalibrationAccess="ReadOnly", StorageClass="Global", MemorySection="VAR")
UNPACK_IF_RSDS_ObjRAccelXStd_Ri_RSDS_FD1 = AUTOSAR4.Signal(SwCalibrationAccess="ReadOnly", StorageClass="Global", MemorySection="VAR")
UNPACK_IF_RSDS_ObjRAccelYStd_Le_RSDS_FD1 = AUTOSAR4.Signal(SwCalibrationAccess="ReadOnly", StorageClass="Global", MemorySection="VAR")
UNPACK_IF_RSDS_ObjRAccelYStd_Ri_RSDS_FD1 = AUTOSAR4.Signal(SwCalibrationAccess="ReadOnly", StorageClass="Global", MemorySection="VAR")
UNPACK_IF_RSDS_ObjRelAccelX_Le_RSDS_FD1 = AUTOSAR4.Signal(SwCalibrationAccess="ReadOnly", StorageClass="Global", MemorySection="VAR")
UNPACK_IF_RSDS_ObjRelAccelX_Ri_RSDS_FD1 = AUTOSAR4.Signal(SwCalibrationAccess="ReadOnly", StorageClass="Global", MemorySection="VAR")
UNPACK_IF_RSDS_ObjRelAccelY_Le_RSDS_FD1 = AUTOSAR4.Signal(SwCalibrationAccess="ReadOnly", StorageClass="Global", MemorySection="VAR")
UNPACK_IF_RSDS_ObjRelAccelY_Ri_RSDS_FD1 = AUTOSAR4.Signal(SwCalibrationAccess="ReadOnly", StorageClass="Global", MemorySection="VAR")
UNPACK_IF_RSDS_ObjRelVelXStd_Le_RSDS_FD1 = AUTOSAR4.Signal(SwCalibrationAccess="ReadOnly", StorageClass="Global", MemorySection="VAR")
UNPACK_IF_RSDS_ObjRelVelXStd_Ri_RSDS_FD1 = AUTOSAR4.Signal(SwCalibrationAccess="ReadOnly", StorageClass="Global", MemorySection="VAR")
UNPACK_IF_RSDS_ObjRelVelYStd_Le_RSDS_FD1 = AUTOSAR4.Signal(SwCalibrationAccess="ReadOnly", StorageClass="Global", MemorySection="VAR")
UNPACK_IF_RSDS_ObjRelVelYStd_Ri_RSDS_FD1 = AUTOSAR4.Signal(SwCalibrationAccess="ReadOnly", StorageClass="Global", MemorySection="VAR")
UNPACK_IF_RiTarSts_RSDS_FD1 = AUTOSAR4.Signal(SwCalibrationAccess="ReadOnly", StorageClass="Global", MemorySection="VAR")
UNPACK_IF_RobustGazePitchAng_DMS_FD1 = AUTOSAR4.Signal(SwCalibrationAccess="ReadOnly", StorageClass="Global", MemorySection="VAR")
UNPACK_IF_RobustGazeYawAng_DMS_FD1 = AUTOSAR4.Signal(SwCalibrationAccess="ReadOnly", StorageClass="Global", MemorySection="VAR")
UNPACK_IF_ZoneIndLe_RSDS_FD1 = AUTOSAR4.Signal(SwCalibrationAccess="ReadOnly", StorageClass="Global", MemorySection="VAR")
UNPACK_IF_ZoneIndRi_RSDS_FD1 = AUTOSAR4.Signal(SwCalibrationAccess="ReadOnly", StorageClass="Global", MemorySection="VAR")
UNPACK_IF_ACAmbTemp_AC2 = AUTOSAR4.Signal(SwCalibrationAccess="ReadOnly", StorageClass="Global", MemorySection="VAR")
UNPACK_IF_ADBstatus_HC1 = AUTOSAR4.Signal(SwCalibrationAccess="ReadOnly", StorageClass="Global", MemorySection="VAR")
UNPACK_IF_ALS_FailSts_HC1 = AUTOSAR4.Signal(SwCalibrationAccess="ReadOnly", StorageClass="Global", MemorySection="VAR")
UNPACK_IF_EPS_AngCmdOverRange_EPS_FD1 = AUTOSAR4.Signal(SwCalibrationAccess="ReadOnly", StorageClass="Global", MemorySection="VAR")
UNPACK_IF_EPS_AvailStsforHAD_EPS_FD1 = AUTOSAR4.Signal(SwCalibrationAccess="ReadOnly", StorageClass="Global", MemorySection="VAR")
UNPACK_IF_EPS_DSTCtrlSts_EPS_FD1 = AUTOSAR4.Signal(SwCalibrationAccess="ReadOnly", StorageClass="Global", MemorySection="VAR")
UNPACK_IF_EPS_DrvInpTrqVal_HighResVld_EPS_FD1 = AUTOSAR4.Signal(SwCalibrationAccess="ReadOnly", StorageClass="Global", MemorySection="VAR")
UNPACK_IF_EPS_DrvInpTrqVal_HighReslolution_EPS_FD1 = AUTOSAR4.Signal(SwCalibrationAccess="ReadOnly", StorageClass="Global", MemorySection="VAR")
UNPACK_IF_EPS_FailSts_EPS_FD1 = AUTOSAR4.Signal(SwCalibrationAccess="ReadOnly", StorageClass="Global", MemorySection="VAR")
UNPACK_IF_EPS_HADHndShkRespSt_EPS_FD1 = AUTOSAR4.Signal(SwCalibrationAccess="ReadOnly", StorageClass="Global", MemorySection="VAR")
UNPACK_IF_EPS_HADerror_Reason_EPS_FD1 = AUTOSAR4.Signal(SwCalibrationAccess="ReadOnly", StorageClass="Global", MemorySection="VAR")
UNPACK_IF_EPS_LKATorqOvrlDlvdVld_EPS_FD1 = AUTOSAR4.Signal(SwCalibrationAccess="ReadOnly", StorageClass="Global", MemorySection="VAR")
UNPACK_IF_EPS_LKATorqOvrlDlvd_EPS_FD1 = AUTOSAR4.Signal(SwCalibrationAccess="ReadOnly", StorageClass="Global", MemorySection="VAR")
UNPACK_IF_EPS_LKATrqOvlDlvdSts_EPS_FD1 = AUTOSAR4.Signal(SwCalibrationAccess="ReadOnly", StorageClass="Global", MemorySection="VAR")
UNPACK_IF_EPS_SteerMod_EPS_FD1 = AUTOSAR4.Signal(SwCalibrationAccess="ReadOnly", StorageClass="Global", MemorySection="VAR")
UNPACK_IF_EPS_SteerWheelAngSign_EPS_FD1 = AUTOSAR4.Signal(SwCalibrationAccess="ReadOnly", StorageClass="Global", MemorySection="VAR")

UNPACK_IF_EPS_SteerWheelAngVld_EPS_FD1 = AUTOSAR4.Signal(SwCalibrationAccess="ReadOnly", StorageClass="Global", MemorySection="VAR")
UNPACK_IF_EPS_SteerWheelAng_EPS_FD1 = AUTOSAR4.Signal(SwCalibrationAccess="ReadOnly", StorageClass="Global", MemorySection="VAR")
UNPACK_IF_EPS_SteerWheelSpdSign_EPS_FD1 = AUTOSAR4.Signal(SwCalibrationAccess="ReadOnly", StorageClass="Global", MemorySection="VAR")
UNPACK_IF_EPS_SteerWheelSpd_EPS_FD1 = AUTOSAR4.Signal(SwCalibrationAccess="ReadOnly", StorageClass="Global", MemorySection="VAR")
UNPACK_IF_EPS_TrqSnsrSts_EPS_FD1 = AUTOSAR4.Signal(SwCalibrationAccess="ReadOnly", StorageClass="Global", MemorySection="VAR")
UNPACK_IF_HBStatusSegment0_HC1 = AUTOSAR4.Signal(SwCalibrationAccess="ReadOnly", StorageClass="Global", MemorySection="VAR")
UNPACK_IF_HBStatusSegment1_HC1 = AUTOSAR4.Signal(SwCalibrationAccess="ReadOnly", StorageClass="Global", MemorySection="VAR")
UNPACK_IF_HBStatusSegment2_HC1 = AUTOSAR4.Signal(SwCalibrationAccess="ReadOnly", StorageClass="Global", MemorySection="VAR")
UNPACK_IF_HBStatusSegment3_HC1 = AUTOSAR4.Signal(SwCalibrationAccess="ReadOnly", StorageClass="Global", MemorySection="VAR")
UNPACK_IF_HBStatusSegment4_HC1 = AUTOSAR4.Signal(SwCalibrationAccess="ReadOnly", StorageClass="Global", MemorySection="VAR")
UNPACK_IF_HBStatusSegment5_HC1 = AUTOSAR4.Signal(SwCalibrationAccess="ReadOnly", StorageClass="Global", MemorySection="VAR")
UNPACK_IF_HBStatusSegment6_HC1 = AUTOSAR4.Signal(SwCalibrationAccess="ReadOnly", StorageClass="Global", MemorySection="VAR")
UNPACK_IF_HBStatusSegment7_HC1 = AUTOSAR4.Signal(SwCalibrationAccess="ReadOnly", StorageClass="Global", MemorySection="VAR")
UNPACK_IF_HighBeamSts_HC_HC1 = AUTOSAR4.Signal(SwCalibrationAccess="ReadOnly", StorageClass="Global", MemorySection="VAR")
UNPACK_IF_LLHiBeamReq_HC_HC1 = AUTOSAR4.Signal(SwCalibrationAccess="ReadOnly", StorageClass="Global", MemorySection="VAR")
UNPACK_IF_LeftHighBeamFailSts_HC1 = AUTOSAR4.Signal(SwCalibrationAccess="ReadOnly", StorageClass="Global", MemorySection="VAR")
UNPACK_IF_LeftLowBeamFailSts_HC1 = AUTOSAR4.Signal(SwCalibrationAccess="ReadOnly", StorageClass="Global", MemorySection="VAR")
UNPACK_IF_RLHiBeamReq_HC_HC1 = AUTOSAR4.Signal(SwCalibrationAccess="ReadOnly", StorageClass="Global", MemorySection="VAR")
UNPACK_IF_RightHighBeamFailSts_HC1 = AUTOSAR4.Signal(SwCalibrationAccess="ReadOnly", StorageClass="Global", MemorySection="VAR")
UNPACK_IF_RightLowBeamFailSts_HC1 = AUTOSAR4.Signal(SwCalibrationAccess="ReadOnly", StorageClass="Global", MemorySection="VAR")
UNPACK_IF_LHiBeamSts_HCM_L1 = AUTOSAR4.Signal(SwCalibrationAccess="ReadOnly", StorageClass="Global", MemorySection="VAR")
UNPACK_IF_LLowBeamSts_HCM_L1 = AUTOSAR4.Signal(SwCalibrationAccess="ReadOnly", StorageClass="Global", MemorySection="VAR")
UNPACK_IF_LMUSysSts_LMU1 = AUTOSAR4.Signal(SwCalibrationAccess="ReadOnly", StorageClass="Global", MemorySection="VAR")
UNPACK_IF_RHiBeamSts_HCM_R1 = AUTOSAR4.Signal(SwCalibrationAccess="ReadOnly", StorageClass="Global", MemorySection="VAR")
UNPACK_IF_RLowBeamSts_HCM_R1 = AUTOSAR4.Signal(SwCalibrationAccess="ReadOnly", StorageClass="Global", MemorySection="VAR")
UNPACK_IF_T_Box_SysErrSts_T_Box_FD3 = AUTOSAR4.Signal(SwCalibrationAccess="ReadOnly", StorageClass="Global", MemorySection="VAR")
UNPACK_IF_SysPowerModVld_PEPS2 = AUTOSAR4.Signal(SwCalibrationAccess="ReadOnly", StorageClass="Global", MemorySection="VAR")
UNPACK_IF_SysPowerMod_PEPS2 = AUTOSAR4.Signal(SwCalibrationAccess="ReadOnly", StorageClass="Global", MemorySection="VAR")
UNPACK_IF_ADCAN_BSW_RSDS_FD1 = AUTOSAR4.Signal(SwCalibrationAccess="ReadOnly", StorageClass="Global", MemorySection="VAR")
UNPACK_IF_ADCAN_BSW_RSDS_FD2 = AUTOSAR4.Signal(SwCalibrationAccess="ReadOnly", StorageClass="Global", MemorySection="VAR")
UNPACK_IF_ADCAN_BSW_ECM_FD1 = AUTOSAR4.Signal(SwCalibrationAccess="ReadOnly", StorageClass="Global", MemorySection="VAR")
UNPACK_IF_ADCAN_BSW_ECM_FD2 = AUTOSAR4.Signal(SwCalibrationAccess="ReadOnly", StorageClass="Global", MemorySection="VAR")
UNPACK_IF_ADCAN_BSW_ECM_FD3 = AUTOSAR4.Signal(SwCalibrationAccess="ReadOnly", StorageClass="Global", MemorySection="VAR")
UNPACK_IF_ADCAN_BSW_ECM1 = AUTOSAR4.Signal(SwCalibrationAccess="ReadOnly", StorageClass="Global", MemorySection="VAR")
UNPACK_IF_ADCAN_BSW_HCU_FD1 = AUTOSAR4.Signal(SwCalibrationAccess="ReadOnly", StorageClass="Global", MemorySection="VAR")
UNPACK_IF_ADCAN_BSW_DCT_FD1 = AUTOSAR4.Signal(SwCalibrationAccess="ReadOnly", StorageClass="Global", MemorySection="VAR")
UNPACK_IF_ADCAN_BSW_DCT_FD4 = AUTOSAR4.Signal(SwCalibrationAccess="ReadOnly", StorageClass="Global", MemorySection="VAR")
UNPACK_IF_ADCAN_BSW_DCT5 = AUTOSAR4.Signal(SwCalibrationAccess="ReadOnly", StorageClass="Global", MemorySection="VAR")
UNPACK_IF_ADCAN_BSW_ESP_FD2 = AUTOSAR4.Signal(SwCalibrationAccess="ReadOnly", StorageClass="Global", MemorySection="VAR")
UNPACK_IF_ADCAN_BSW_ESP_FD3 = AUTOSAR4.Signal(SwCalibrationAccess="ReadOnly", StorageClass="Global", MemorySection="VAR")
UNPACK_IF_ADCAN_BSW_EPS_FD1 = AUTOSAR4.Signal(SwCalibrationAccess="ReadOnly", StorageClass="Global", MemorySection="VAR")
UNPACK_IF_ADCAN_BSW_BCM1 = AUTOSAR4.Signal(SwCalibrationAccess="ReadOnly", StorageClass="Global", MemorySection="VAR")
UNPACK_IF_ADCAN_BSW_BCM3 = AUTOSAR4.Signal(SwCalibrationAccess="ReadOnly", StorageClass="Global", MemorySection="VAR")
UNPACK_IF_ADCAN_BSW_BCM8 = AUTOSAR4.Signal(SwCalibrationAccess="ReadOnly", StorageClass="Global", MemorySection="VAR")
UNPACK_IF_ADCAN_BSW_AC2 = AUTOSAR4.Signal(SwCalibrationAccess="ReadOnly", StorageClass="Global", MemorySection="VAR")
UNPACK_IF_ADCAN_BSW_F_PBox1 = AUTOSAR4.Signal(SwCalibrationAccess="ReadOnly", StorageClass="Global", MemorySection="VAR")
UNPACK_IF_ADCAN_BSW_R_PBox = AUTOSAR4.Signal(SwCalibrationAccess="ReadOnly", StorageClass="Global", MemorySection="VAR")
UNPACK_IF_ADCAN_BSW_CSA1 = AUTOSAR4.Signal(SwCalibrationAccess="ReadOnly", StorageClass="Global", MemorySection="VAR")
UNPACK_IF_ADCAN_BSW_CSA2 = AUTOSAR4.Signal(SwCalibrationAccess="ReadOnly", StorageClass="Global", MemorySection="VAR")
UNPACK_IF_ADCAN_BSW_ABM1 = AUTOSAR4.Signal(SwCalibrationAccess="ReadOnly", StorageClass="Global", MemorySection="VAR")
UNPACK_IF_ADCAN_BSW_ABM2 = AUTOSAR4.Signal(SwCalibrationAccess="ReadOnly", StorageClass="Global", MemorySection="VAR")
UNPACK_IF_ADCAN_BSW_HAP_FD1 = AUTOSAR4.Signal(SwCalibrationAccess="ReadOnly", StorageClass="Global", MemorySection="VAR")
UNPACK_IF_ADCAN_BSW_IP2 = AUTOSAR4.Signal(SwCalibrationAccess="ReadOnly", StorageClass="Global", MemorySection="VAR")
UNPACK_IF_ADCAN_BSW_HUT_FD1 = AUTOSAR4.Signal(SwCalibrationAccess="ReadOnly", StorageClass="Global", MemorySection="VAR")
UNPACK_IF_ADCAN_BSW_HUT19 = AUTOSAR4.Signal(SwCalibrationAccess="ReadOnly", StorageClass="Global", MemorySection="VAR")
UNPACK_IF_ADCAN_BSW_T_Box_FD3 = AUTOSAR4.Signal(SwCalibrationAccess="ReadOnly", StorageClass="Global", MemorySection="VAR")
UNPACK_IF_ADCAN_BSW_HC1 = AUTOSAR4.Signal(SwCalibrationAccess="ReadOnly", StorageClass="Global", MemorySection="VAR")
UNPACK_IF_ADCAN_BSW_DMS_FD1 = AUTOSAR4.Signal(SwCalibrationAccess="ReadOnly", StorageClass="Global", MemorySection="VAR")
UNPACK_IF_ADCAN_BSW_RSDS_FD1_IsUpdated = AUTOSAR4.Signal(SwCalibrationAccess="ReadOnly", StorageClass="Global", MemorySection="VAR")
UNPACK_IF_ADCAN_BSW_RSDS_FD2_IsUpdated = AUTOSAR4.Signal(SwCalibrationAccess="ReadOnly", StorageClass="Global", MemorySection="VAR")
UNPACK_IF_ADCAN_BSW_ECM_FD1_IsUpdated = AUTOSAR4.Signal(SwCalibrationAccess="ReadOnly", StorageClass="Global", MemorySection="VAR")
UNPACK_IF_ADCAN_BSW_ECM_FD2_IsUpdated = AUTOSAR4.Signal(SwCalibrationAccess="ReadOnly", StorageClass="Global", MemorySection="VAR")
UNPACK_IF_ADCAN_BSW_ECM_FD3_IsUpdated = AUTOSAR4.Signal(SwCalibrationAccess="ReadOnly", StorageClass="Global", MemorySection="VAR")
UNPACK_IF_ADCAN_BSW_ECM1_IsUpdated = AUTOSAR4.Signal(SwCalibrationAccess="ReadOnly", StorageClass="Global", MemorySection="VAR")
UNPACK_IF_ADCAN_BSW_HCU_FD1_IsUpdated = AUTOSAR4.Signal(SwCalibrationAccess="ReadOnly", StorageClass="Global", MemorySection="VAR")
UNPACK_IF_ADCAN_BSW_DCT_FD1_IsUpdated = AUTOSAR4.Signal(SwCalibrationAccess="ReadOnly", StorageClass="Global", MemorySection="VAR")
UNPACK_IF_ADCAN_BSW_DCT_FD4_IsUpdated = AUTOSAR4.Signal(SwCalibrationAccess="ReadOnly", StorageClass="Global", MemorySection="VAR")
UNPACK_IF_ADCAN_BSW_DCT5_IsUpdated = AUTOSAR4.Signal(SwCalibrationAccess="ReadOnly", StorageClass="Global", MemorySection="VAR")
UNPACK_IF_ADCAN_BSW_ESP_FD2_IsUpdated = AUTOSAR4.Signal(SwCalibrationAccess="ReadOnly", StorageClass="Global", MemorySection="VAR")
UNPACK_IF_ADCAN_BSW_ESP_FD3_IsUpdated = AUTOSAR4.Signal(SwCalibrationAccess="ReadOnly", StorageClass="Global", MemorySection="VAR")
UNPACK_IF_ADCAN_BSW_EPS_FD1_IsUpdated = AUTOSAR4.Signal(SwCalibrationAccess="ReadOnly", StorageClass="Global", MemorySection="VAR")
UNPACK_IF_ADCAN_BSW_BCM1_IsUpdated = AUTOSAR4.Signal(SwCalibrationAccess="ReadOnly", StorageClass="Global", MemorySection="VAR")
UNPACK_IF_ADCAN_BSW_BCM3_IsUpdated = AUTOSAR4.Signal(SwCalibrationAccess="ReadOnly", StorageClass="Global", MemorySection="VAR")
UNPACK_IF_ADCAN_BSW_BCM8_IsUpdated = AUTOSAR4.Signal(SwCalibrationAccess="ReadOnly", StorageClass="Global", MemorySection="VAR")
UNPACK_IF_ADCAN_BSW_AC2_IsUpdated = AUTOSAR4.Signal(SwCalibrationAccess="ReadOnly", StorageClass="Global", MemorySection="VAR")
UNPACK_IF_ADCAN_BSW_F_PBox1_IsUpdated = AUTOSAR4.Signal(SwCalibrationAccess="ReadOnly", StorageClass="Global", MemorySection="VAR")
UNPACK_IF_ADCAN_BSW_R_PBox_IsUpdated = AUTOSAR4.Signal(SwCalibrationAccess="ReadOnly", StorageClass="Global", MemorySection="VAR")
UNPACK_IF_ADCAN_BSW_CSA1_IsUpdated = AUTOSAR4.Signal(SwCalibrationAccess="ReadOnly", StorageClass="Global", MemorySection="VAR")
UNPACK_IF_ADCAN_BSW_CSA2_IsUpdated = AUTOSAR4.Signal(SwCalibrationAccess="ReadOnly", StorageClass="Global", MemorySection="VAR")
UNPACK_IF_ADCAN_BSW_ABM1_IsUpdated = AUTOSAR4.Signal(SwCalibrationAccess="ReadOnly", StorageClass="Global", MemorySection="VAR")
UNPACK_IF_ADCAN_BSW_ABM2_IsUpdated = AUTOSAR4.Signal(SwCalibrationAccess="ReadOnly", StorageClass="Global", MemorySection="VAR")
UNPACK_IF_ADCAN_BSW_HAP_FD1_IsUpdated = AUTOSAR4.Signal(SwCalibrationAccess="ReadOnly", StorageClass="Global", MemorySection="VAR")
UNPACK_IF_ADCAN_BSW_IP2_IsUpdated = AUTOSAR4.Signal(SwCalibrationAccess="ReadOnly", StorageClass="Global", MemorySection="VAR")
UNPACK_IF_ADCAN_BSW_HUT_FD1_IsUpdated = AUTOSAR4.Signal(SwCalibrationAccess="ReadOnly", StorageClass="Global", MemorySection="VAR")
UNPACK_IF_ADCAN_BSW_HUT19_IsUpdated = AUTOSAR4.Signal(SwCalibrationAccess="ReadOnly", StorageClass="Global", MemorySection="VAR")
UNPACK_IF_ADCAN_BSW_T_Box_FD3_IsUpdated = AUTOSAR4.Signal(SwCalibrationAccess="ReadOnly", StorageClass="Global", MemorySection="VAR")
UNPACK_IF_ADCAN_BSW_HC1_IsUpdated = AUTOSAR4.Signal(SwCalibrationAccess="ReadOnly", StorageClass="Global", MemorySection="VAR")
UNPACK_IF_ADCAN_BSW_DMS_FD1_IsUpdated = AUTOSAR4.Signal(SwCalibrationAccess="ReadOnly", StorageClass="Global", MemorySection="VAR")
UNPACK_IF_ADCAN_BSW_RSDS_FD1_IsUpdated_I = AUTOSAR4.Signal(SwCalibrationAccess="ReadOnly", StorageClass="Global", MemorySection="VAR")
UNPACK_IF_ADCAN_BSW_RSDS_FD2_IsUpdated_I = AUTOSAR4.Signal(SwCalibrationAccess="ReadOnly", StorageClass="Global", MemorySection="VAR")
UNPACK_IF_ADCAN_BSW_ECM_FD1_IsUpdated_I = AUTOSAR4.Signal(SwCalibrationAccess="ReadOnly", StorageClass="Global", MemorySection="VAR")
UNPACK_IF_ADCAN_BSW_ECM_FD2_IsUpdated_I = AUTOSAR4.Signal(SwCalibrationAccess="ReadOnly", StorageClass="Global", MemorySection="VAR")
UNPACK_IF_ADCAN_BSW_ECM_FD3_IsUpdated_I = AUTOSAR4.Signal(SwCalibrationAccess="ReadOnly", StorageClass="Global", MemorySection="VAR")
UNPACK_IF_ADCAN_BSW_ECM1_IsUpdated_I = AUTOSAR4.Signal(SwCalibrationAccess="ReadOnly", StorageClass="Global", MemorySection="VAR")
UNPACK_IF_ADCAN_BSW_HCU_FD1_IsUpdated_I = AUTOSAR4.Signal(SwCalibrationAccess="ReadOnly", StorageClass="Global", MemorySection="VAR")
UNPACK_IF_ADCAN_BSW_DCT_FD1_IsUpdated_I = AUTOSAR4.Signal(SwCalibrationAccess="ReadOnly", StorageClass="Global", MemorySection="VAR")
UNPACK_IF_ADCAN_BSW_DCT_FD4_IsUpdated_I = AUTOSAR4.Signal(SwCalibrationAccess="ReadOnly", StorageClass="Global", MemorySection="VAR")
UNPACK_IF_ADCAN_BSW_DCT5_IsUpdated_I = AUTOSAR4.Signal(SwCalibrationAccess="ReadOnly", StorageClass="Global", MemorySection="VAR")
UNPACK_IF_ADCAN_BSW_ESP_FD2_IsUpdated_I = AUTOSAR4.Signal(SwCalibrationAccess="ReadOnly", StorageClass="Global", MemorySection="VAR")
UNPACK_IF_ADCAN_BSW_ESP_FD3_IsUpdated_I = AUTOSAR4.Signal(SwCalibrationAccess="ReadOnly", StorageClass="Global", MemorySection="VAR")
UNPACK_IF_ADCAN_BSW_EPS_FD1_IsUpdated_I = AUTOSAR4.Signal(SwCalibrationAccess="ReadOnly", StorageClass="Global", MemorySection="VAR")
UNPACK_IF_ADCAN_BSW_BCM1_IsUpdated_I = AUTOSAR4.Signal(SwCalibrationAccess="ReadOnly", StorageClass="Global", MemorySection="VAR")
UNPACK_IF_ADCAN_BSW_BCM3_IsUpdated_I = AUTOSAR4.Signal(SwCalibrationAccess="ReadOnly", StorageClass="Global", MemorySection="VAR")
UNPACK_IF_ADCAN_BSW_BCM8_IsUpdated_I = AUTOSAR4.Signal(SwCalibrationAccess="ReadOnly", StorageClass="Global", MemorySection="VAR")
UNPACK_IF_ADCAN_BSW_AC2_IsUpdated_I = AUTOSAR4.Signal(SwCalibrationAccess="ReadOnly", StorageClass="Global", MemorySection="VAR")
UNPACK_IF_ADCAN_BSW_F_PBox1_IsUpdated_I = AUTOSAR4.Signal(SwCalibrationAccess="ReadOnly", StorageClass="Global", MemorySection="VAR")
UNPACK_IF_ADCAN_BSW_R_PBox_IsUpdated_I = AUTOSAR4.Signal(SwCalibrationAccess="ReadOnly", StorageClass="Global", MemorySection="VAR")
UNPACK_IF_ADCAN_BSW_CSA1_IsUpdated_I = AUTOSAR4.Signal(SwCalibrationAccess="ReadOnly", StorageClass="Global", MemorySection="VAR")
UNPACK_IF_ADCAN_BSW_CSA2_IsUpdated_I = AUTOSAR4.Signal(SwCalibrationAccess="ReadOnly", StorageClass="Global", MemorySection="VAR")
UNPACK_IF_ADCAN_BSW_ABM1_IsUpdated_I = AUTOSAR4.Signal(SwCalibrationAccess="ReadOnly", StorageClass="Global", MemorySection="VAR")
UNPACK_IF_ADCAN_BSW_ABM2_IsUpdated_I = AUTOSAR4.Signal(SwCalibrationAccess="ReadOnly", StorageClass="Global", MemorySection="VAR")
UNPACK_IF_ADCAN_BSW_HAP_FD1_IsUpdated_I = AUTOSAR4.Signal(SwCalibrationAccess="ReadOnly", StorageClass="Global", MemorySection="VAR")
UNPACK_IF_ADCAN_BSW_IP2_IsUpdated_I = AUTOSAR4.Signal(SwCalibrationAccess="ReadOnly", StorageClass="Global", MemorySection="VAR")
UNPACK_IF_ADCAN_BSW_HUT_FD1_IsUpdated_I = AUTOSAR4.Signal(SwCalibrationAccess="ReadOnly", StorageClass="Global", MemorySection="VAR")
UNPACK_IF_ADCAN_BSW_HUT19_IsUpdated_I = AUTOSAR4.Signal(SwCalibrationAccess="ReadOnly", StorageClass="Global", MemorySection="VAR")
UNPACK_IF_ADCAN_BSW_T_Box_FD3_IsUpdated_I = AUTOSAR4.Signal(SwCalibrationAccess="ReadOnly", StorageClass="Global", MemorySection="VAR")
UNPACK_IF_ADCAN_BSW_HC1_IsUpdated_I = AUTOSAR4.Signal(SwCalibrationAccess="ReadOnly", StorageClass="Global", MemorySection="VAR")
UNPACK_IF_ADCAN_BSW_DMS_FD1_IsUpdated_I = AUTOSAR4.Signal(SwCalibrationAccess="ReadOnly", StorageClass="Global", MemorySection="VAR")
UNPACK_IF_VCAN_ABM1_RAW = AUTOSAR4.Signal(SwCalibrationAccess="ReadOnly", StorageClass="Global", MemorySection="VAR")
UNPACK_IF_AutoLmpSwtSts_HUT_HUT44 = AUTOSAR4.Signal(SwCalibrationAccess="ReadOnly", StorageClass="Global", MemorySection="VAR")
UNPACK_IF_RearFogLmpSwtSts_HUT_HUT44 = AUTOSAR4.Signal(SwCalibrationAccess="ReadOnly", StorageClass="Global", MemorySection="VAR")
UNPACK_IF_EPS_LKAAngDlvdSts_EPS_FD1 = AUTOSAR4.Signal(SwCalibrationAccess="ReadOnly", StorageClass="Global", MemorySection="VAR")
UNPACK_IF_LowBeamSwtSts_HUT_HUT44 = AUTOSAR4.Signal(SwCalibrationAccess="ReadOnly", StorageClass="Global", MemorySection="VAR")
UNPACK_IF_ADCAN_BSW_HCU_FD3_IsUpdated_I = AUTOSAR4.Signal(SwCalibrationAccess="ReadOnly", StorageClass="Global", MemorySection="VAR")
UNPACK_IF_ACCSts_ACC_FD2 = AUTOSAR4.Signal(SwCalibrationAccess="ReadOnly", StorageClass="Global", MemorySection="VAR")
UNPACK_IF_NavDecSwtReq_HUT32 = AUTOSAR4.Signal(SwCalibrationAccess="ReadOnly", StorageClass="Global", MemorySection="VAR")
UNPACK_IF_RainMode_Swt_Req_HUT32 = AUTOSAR4.Signal(SwCalibrationAccess="ReadOnly", StorageClass="Global", MemorySection="VAR")
UNPACK_IF_LCMode_Swt_Req_HUT32 = AUTOSAR4.Signal(SwCalibrationAccess="ReadOnly", StorageClass="Global", MemorySection="VAR")
UNPACK_IF_ExprsnSts_DMS_FD1 = AUTOSAR4.Signal(SwCalibrationAccess="ReadOnly", StorageClass="Global", MemorySection="VAR")
UNPACK_IF_DrvBehvSts_DMS_FD1 = AUTOSAR4.Signal(SwCalibrationAccess="ReadOnly", StorageClass="Global", MemorySection="VAR")
UNPACK_IF_ABAActv_ESP_FD2 = AUTOSAR4.Signal(SwCalibrationAccess="ReadOnly", StorageClass="Global", MemorySection="VAR")
UNPACK_IF_WiprReq_F_PBox_BCM8 = AUTOSAR4.Signal(SwCalibrationAccess="ReadOnly", StorageClass="Global", MemorySection="VAR")