% Simulink data dictionary PvtParsVSM.sldd

P_VSM_LCKIE_State_Vehspeed_enable = AUTOSAR4.Parameter(1, SwCalibrationAccess="ReadWrite", StorageClass="Global", MemorySection="CAL", DataType="single")
P_VSM_LCKIE_State_wiper_enable = AUTOSAR4.Parameter(1, SwCalibrationAccess="ReadWrite", StorageClass="Global", MemorySection="CAL", DataType="single")
P_VSM_LCKIE_State_detaspd_enable = AUTOSAR4.Parameter(1, SwCalibrationAccess="ReadWrite", StorageClass="Global", MemorySection="CAL", DataType="single")
P_VSM_LCKIE_State_DriverInputTrqValue_enable = AUTOSAR4.Parameter(1, SwCalibrationAccess="ReadWrite", StorageClass="Global", MemorySection="CAL", DataType="single")
P_VSM_LCKIE_State_IFVReady = AUTOSAR4.Parameter(1, SwCalibrationAccess="ReadWrite", StorageClass="Global", MemorySection="CAL", DataType="single")
P_VSM_LCKIE_State_ELKObjClc = AUTOSAR4.Parameter(1, SwCalibrationAccess="ReadWrite", StorageClass="Global", MemorySection="CAL", DataType="single")
P_VSM_LCKIE_State_OppObjClc = AUTOSAR4.Parameter(1, SwCalibrationAccess="ReadWrite", StorageClass="Global", MemorySection="CAL", DataType="single")
P_VSM_LCKIE_State_IEObjClc = AUTOSAR4.Parameter(1, SwCalibrationAccess="ReadWrite", StorageClass="Global", MemorySection="CAL", DataType="single")
P_VSM_LCKIE_LongC_FleetOff = AUTOSAR4.Parameter(80, SwCalibrationAccess="ReadWrite", StorageClass="Global", MemorySection="CAL", DataType="single")
P_VSM_LCKIE_LongC_DirecChangeDis = AUTOSAR4.Parameter(20, SwCalibrationAccess="ReadWrite", StorageClass="Global", MemorySection="CAL", DataType="single")
P_VSM_LCKIE_LongC_maxDis = AUTOSAR4.Parameter(80, SwCalibrationAccess="ReadWrite", StorageClass="Global", MemorySection="CAL", DataType="single")
P_VSM_LCKIE_LongC_minDis = AUTOSAR4.Parameter(50, SwCalibrationAccess="ReadWrite", StorageClass="Global", MemorySection="CAL", DataType="single")
P_VSM_LCKIE_LongC_toff = AUTOSAR4.Parameter(10, SwCalibrationAccess="ReadWrite", StorageClass="Global", MemorySection="CAL", DataType="single")
P_VSM_LCKIE_ORC_LimitDis1 = AUTOSAR4.Parameter(-30, SwCalibrationAccess="ReadWrite", StorageClass="Global", MemorySection="CAL", DataType="single")
P_VSM_LCKIE_POC_LimitDis = AUTOSAR4.Parameter(-15, SwCalibrationAccess="ReadWrite", StorageClass="Global", MemorySection="CAL", DataType="single")
P_VSM_LCKIE_State_Lanecurve_enable = AUTOSAR4.Parameter(1, SwCalibrationAccess="ReadWrite", StorageClass="Global", MemorySection="CAL", DataType="single")
P_VSM_LCKIE_ORC_LimitTTC = AUTOSAR4.Parameter(10, SwCalibrationAccess="ReadWrite", StorageClass="Global", MemorySection="CAL", DataType="single")
P_VSM_LCKIE_OFC_SafDis = AUTOSAR4.Parameter(10, SwCalibrationAccess="ReadWrite", StorageClass="Global", MemorySection="CAL", DataType="single")
P_VSM_LCKIE_OFC_ActDis = AUTOSAR4.Parameter(10, SwCalibrationAccess="ReadWrite", StorageClass="Global", MemorySection="CAL", DataType="single")
P_VSM_LCKIE_OFC_Toff = AUTOSAR4.Parameter(3, SwCalibrationAccess="ReadWrite", StorageClass="Global", MemorySection="CAL", DataType="single")
P_VSM_LCKIE_POC_LimitTTC = AUTOSAR4.Parameter(2, SwCalibrationAccess="ReadWrite", StorageClass="Global", MemorySection="CAL", DataType="single")
P_VSM_LCKIE_tcycle = AUTOSAR4.Parameter(0.02, SwCalibrationAccess="ReadWrite", StorageClass="Global", MemorySection="CAL", DataType="single")
P_VSM_LCKIE_State_Off2on = AUTOSAR4.Parameter(3, SwCalibrationAccess="ReadWrite", StorageClass="Global", MemorySection="CAL", DataType="single")
P_VSM_LCKIE_LongC_MidSpdTTC = AUTOSAR4.Parameter(repmat(5.5, 1, 6), SwCalibrationAccess="ReadWrite", StorageClass="Global", MemorySection="CAL", DataType="single")
P_VSM_LCKIE_LongC_Spd = AUTOSAR4.Parameter([60 80 100 110 120 130], SwCalibrationAccess="ReadWrite", StorageClass="Global", MemorySection="CAL")
P_VSM_LCKIE_State_LCDetaSpd = AUTOSAR4.Parameter([0.5 2.5 5 8 10 15], SwCalibrationAccess="ReadWrite", StorageClass="Global", MemorySection="CAL", DataType="single")
P_VSM_LCKIE_State_LCtoffset = AUTOSAR4.Parameter([6 3.5 2 1.5 1.5 1.5], SwCalibrationAccess="ReadWrite", StorageClass="Global", MemorySection="CAL", DataType="single")
P_VSM_LCKIE_LongC_DetaSpd = AUTOSAR4.Parameter([1 3 16], SwCalibrationAccess="ReadWrite", StorageClass="Global", MemorySection="CAL")
P_VSM_LCKIE_LatC_LanWidth = AUTOSAR4.Parameter([2.6 2.8 3 3.5], SwCalibrationAccess="ReadWrite", StorageClass="Global", MemorySection="CAL", DataType="single")
P_VSM_LCKIE_LatC_DisOffofLanWidth = AUTOSAR4.Parameter([3 3 3 3], SwCalibrationAccess="ReadWrite", StorageClass="Global", MemorySection="CAL", DataType="single")
P_VSM_LCKIE_LatC_DisOffofSpd = AUTOSAR4.Parameter(repmat(3, 1, 6), SwCalibrationAccess="ReadWrite", StorageClass="Global", MemorySection="CAL", DataType="single")
P_VSM_LCKIE_LatC_Spd = AUTOSAR4.Parameter([60 80 100 110 120 130], SwCalibrationAccess="ReadWrite", StorageClass="Global", MemorySection="CAL", DataType="single")
P_VSM_LCKIE_LatC_LimitDisEgoToObjSelt = AUTOSAR4.Parameter(1.5, SwCalibrationAccess="ReadWrite", StorageClass="Global", MemorySection="CAL", DataType="single")
P_VSM_LCKIE_LatC_LimitEgoToOppLane = AUTOSAR4.Parameter(0.3, SwCalibrationAccess="ReadWrite", StorageClass="Global", MemorySection="CAL", DataType="single")
P_VSM_LCKIE_LatC_MoveEnableDis = AUTOSAR4.Parameter(0, SwCalibrationAccess="ReadWrite", StorageClass="Global", MemorySection="CAL", DataType="single")
P_VSM_LCKIE_ORC_LatDis = AUTOSAR4.Parameter(1.8, SwCalibrationAccess="ReadWrite", StorageClass="Global", MemorySection="CAL", DataType="single")
P_VSM_LCKIE_ORC_LowSpd = AUTOSAR4.Parameter(-5, SwCalibrationAccess="ReadWrite", StorageClass="Global", MemorySection="CAL", DataType="single")
P_VSM_LCKIE_OFC_DownTTC = AUTOSAR4.Parameter(5, SwCalibrationAccess="ReadWrite", StorageClass="Global", MemorySection="CAL", DataType="single")
P_VSM_LCKIE_OFC_DownDis = AUTOSAR4.Parameter(10, SwCalibrationAccess="ReadWrite", StorageClass="Global", MemorySection="CAL", DataType="single")
P_VSM_LCKIE_ORC_LimitDis2 = AUTOSAR4.Parameter(-10, SwCalibrationAccess="ReadWrite", StorageClass="Global", MemorySection="CAL", DataType="single")
P_VSM_LCKIE_Laneoffset_BP = AUTOSAR4.Parameter([60 80 100 110 120], SwCalibrationAccess="ReadWrite", StorageClass="Global", MemorySection="CAL", DataType="single")
P_VSM_LCKIE_LATC_LimitDis_BP = AUTOSAR4.Parameter([0 0.1 0.2 0.3 0.4], SwCalibrationAccess="ReadWrite", StorageClass="Global", MemorySection="CAL", DataType="single")
P_VSM_LCKIE_LATC_LimitDis = AUTOSAR4.Parameter([0.2 0.2 0.2 0.1 0.1], SwCalibrationAccess="ReadWrite", StorageClass="Global", MemorySection="CAL", DataType="single")
P_VSM_LCKIE_LongC_d1 = AUTOSAR4.Parameter(repmat(10, 1, 6), SwCalibrationAccess="ReadWrite", StorageClass="Global", MemorySection="CAL", DataType="single")
P_VSM_LCKIE_LongC_d2 = AUTOSAR4.Parameter([30 30 60], SwCalibrationAccess="ReadWrite", StorageClass="Global", MemorySection="CAL")
P_VSM_LCKIE_Laneoffset = AUTOSAR4.Parameter(repmat(0.3, 1, 5), SwCalibrationAccess="ReadWrite", StorageClass="Global", MemorySection="CAL", DataType="single")
P_VSM_LCKIE_State_CurveMin = AUTOSAR4.Parameter(0.005555556, SwCalibrationAccess="ReadWrite", StorageClass="Global", MemorySection="CAL", DataType="single")
P_VSM_LCKIE_STATE_ORCObjenable = AUTOSAR4.Parameter(0, SwCalibrationAccess="ReadWrite", StorageClass="Global", MemorySection="CAL", DataType="single")
P_VSM_LCKIE_ClassInput = AUTOSAR4.Parameter(0, SwCalibrationAccess="ReadWrite", StorageClass="Global", MemorySection="CAL", DataType="uint8")
P_VSM_LCKIE_LatC_ObjTypeDis = AUTOSAR4.Parameter([0 0 1.2 3 1.2 1.1 1.2 1.5 1.5], SwCalibrationAccess="ReadWrite", StorageClass="Global", MemorySection="CAL", DataType="single")
P_VSM_LCKIE_OFC_LatDisOff = AUTOSAR4.Parameter(1.2, SwCalibrationAccess="ReadWrite", StorageClass="Global", MemorySection="CAL", DataType="single")
P_VSM_LCKIE_LatC_ObjType = AUTOSAR4.Parameter([0 1 2 3 4 5 6 7 8], SwCalibrationAccess="ReadWrite", StorageClass="Global", MemorySection="CAL", DataType="uint8")
P_VSM_LCKIE_State_foglamb_enable = AUTOSAR4.Parameter(1, SwCalibrationAccess="ReadWrite", StorageClass="Global", MemorySection="CAL", DataType="single")
P_VSM_LCKIE_State_lamb_enable = AUTOSAR4.Parameter(0, SwCalibrationAccess="ReadWrite", StorageClass="Global", MemorySection="CAL", DataType="single")
P_VSM_LCKIE_State_detaspd = AUTOSAR4.Parameter(5, SwCalibrationAccess="ReadWrite", StorageClass="Global", MemorySection="CAL", DataType="single")
P_VSM_LCKIE_State_LaneValid_enable = AUTOSAR4.Parameter(1, SwCalibrationAccess="ReadWrite", StorageClass="Global", MemorySection="CAL", DataType="single")
P_VSM_LCKIE_POC_LengthAdd = AUTOSAR4.Parameter(-30, SwCalibrationAccess="ReadWrite", StorageClass="Global", MemorySection="CAL", DataType="single")
P_VSM_LCKIE_POC_detaTTC = AUTOSAR4.Parameter([-2 0 2 5 8 10], SwCalibrationAccess="ReadWrite", StorageClass="Global", MemorySection="CAL", DataType="single")
P_VSM_LCKIE_POC_Delaytime = AUTOSAR4.Parameter([2 4 5 8 9 12], SwCalibrationAccess="ReadWrite", StorageClass="Global", MemorySection="CAL", DataType="single")
P_VSM_LCKIE_State_HWAdelaytime = AUTOSAR4.Parameter(3, SwCalibrationAccess="ReadWrite", StorageClass="Global", MemorySection="CAL", DataType="single")
P_VSM_LCKIE_State_HWASts_disable = AUTOSAR4.Parameter(1, SwCalibrationAccess="ReadWrite", StorageClass="Global", MemorySection="CAL", DataType="single")
P_VSM_LCKIE_DirectSpdLimmit = AUTOSAR4.Parameter(0.6, SwCalibrationAccess="ReadWrite", StorageClass="Global", MemorySection="CAL", DataType="single")
P_VSM_LCKIE_State_CurveMax = AUTOSAR4.Parameter(0.002, SwCalibrationAccess="ReadWrite", StorageClass="Global", MemorySection="CAL", DataType="single")
P_VSM_LCKIE_OFC_DySW = AUTOSAR4.Parameter(1, SwCalibrationAccess="ReadWrite", StorageClass="Global", MemorySection="CAL", DataType="uint8")
P_VSM_LCKIE_LongC_ShutDownLongDis = AUTOSAR4.Parameter(-20, SwCalibrationAccess="ReadWrite", StorageClass="Global", MemorySection="CAL", DataType="single")
P_VSM_LCKIE_LongC_ShutDownTTC = AUTOSAR4.Parameter(-3, SwCalibrationAccess="ReadWrite", StorageClass="Global", MemorySection="CAL", DataType="single")
P_VSM_LCKIE_LatC_DisSW = AUTOSAR4.Parameter(1, SwCalibrationAccess="ReadWrite", StorageClass="Global", MemorySection="CAL", DataType="single")
P_VSM_LCKIE_LatC_minLimitDisREToLane = AUTOSAR4.Parameter(0.8, SwCalibrationAccess="ReadWrite", StorageClass="Global", MemorySection="CAL", DataType="single")
P_VSM_LCKIE_LatC_maxLimitDisREToLane = AUTOSAR4.Parameter(2, SwCalibrationAccess="ReadWrite", StorageClass="Global", MemorySection="CAL", DataType="single")
P_VSM_LCKIE_LatC_RESafDis = AUTOSAR4.Parameter(0.5, SwCalibrationAccess="ReadWrite", StorageClass="Global", MemorySection="CAL", DataType="single")
P_VSM_LCKIE_LatC_SafeDisofLanWidth = AUTOSAR4.Parameter([0.35 0.35 0.35 0.35], SwCalibrationAccess="ReadWrite", StorageClass="Global", MemorySection="CAL", DataType="single")
P_VSM_LCKIE_TruckWidthLimmit = AUTOSAR4.Parameter(1.5, SwCalibrationAccess="ReadWrite", StorageClass="Global", MemorySection="CAL", DataType="single")
P_VSM_LCKIE_TruckLongLimmit = AUTOSAR4.Parameter(6, SwCalibrationAccess="ReadWrite", StorageClass="Global", MemorySection="CAL", DataType="single")
P_VSM_LCKIE_IEActTypeSW = AUTOSAR4.Parameter(1, SwCalibrationAccess="ReadWrite", StorageClass="Global", MemorySection="CAL", DataType="boolean")
P_VSM_LCKIE_TruckIDChangeLongLimmit = AUTOSAR4.Parameter(6, SwCalibrationAccess="ReadWrite", StorageClass="Global", MemorySection="CAL", DataType="single")
P_VSM_LCKIE_TruckIDChangeLatLimmit = AUTOSAR4.Parameter(1, SwCalibrationAccess="ReadWrite", StorageClass="Global", MemorySection="CAL", DataType="single")
P_VSM_LCKIE_LongC_ObjLength = AUTOSAR4.Parameter([6 8 10 12 14 16], SwCalibrationAccess="ReadWrite", StorageClass="Global", MemorySection="CAL", DataType="single")
P_VSM_LCKIE_LongC_LongDisClcmin = AUTOSAR4.Parameter([9 10 11 12 13 14], SwCalibrationAccess="ReadWrite", StorageClass="Global", MemorySection="CAL", DataType="single")
P_VSM_ELK_State_Vehspeed_enable = AUTOSAR4.Parameter(1, SwCalibrationAccess="ReadWrite", StorageClass="Global", MemorySection="CAL", DataType="single")
P_VSM_ELK_State_Yawsup_enable = AUTOSAR4.Parameter(1, SwCalibrationAccess="ReadWrite", StorageClass="Global", MemorySection="CAL", DataType="single")
P_VSM_ELK_State_Absesp_enable = AUTOSAR4.Parameter(1, SwCalibrationAccess="ReadWrite", StorageClass="Global", MemorySection="CAL", DataType="single")
P_VSM_ELK_State_Lane_enable = AUTOSAR4.Parameter(1, SwCalibrationAccess="ReadWrite", StorageClass="Global", MemorySection="CAL", DataType="single")
P_VSM_ELK_State_Headingangle_enable = AUTOSAR4.Parameter(1, SwCalibrationAccess="ReadWrite", StorageClass="Global", MemorySection="CAL", DataType="single")
P_VSM_ELK_State_Lanecurve_enable = AUTOSAR4.Parameter(1, SwCalibrationAccess="ReadWrite", StorageClass="Global", MemorySection="CAL", DataType="single")
P_VSM_ELK_State_Failsafe_enable = AUTOSAR4.Parameter(1, SwCalibrationAccess="ReadWrite", StorageClass="Global", MemorySection="CAL", DataType="single")
P_VSM_ELK_State_Handson_enable = AUTOSAR4.Parameter(1, SwCalibrationAccess="ReadWrite", StorageClass="Global", MemorySection="CAL", DataType="single")
P_VSM_ELK_State_SteerWheelAngle_enable = AUTOSAR4.Parameter(1, SwCalibrationAccess="ReadWrite", StorageClass="Global", MemorySection="CAL", DataType="single")
P_VSM_ELK_State_DriverInputTrqValue_enable = AUTOSAR4.Parameter(1, SwCalibrationAccess="ReadWrite", StorageClass="Global", MemorySection="CAL", DataType="single")
P_VSM_ELK_State_SteerWheelSpd_enable = AUTOSAR4.Parameter(1, SwCalibrationAccess="ReadWrite", StorageClass="Global", MemorySection="CAL", DataType="single")
P_VSM_ELK_State_LateralAcce_enable = AUTOSAR4.Parameter(1, SwCalibrationAccess="ReadWrite", StorageClass="Global", MemorySection="CAL", DataType="single")
P_VSM_ELK_State_LongitudeAcc_enable = AUTOSAR4.Parameter(1, SwCalibrationAccess="ReadWrite", StorageClass="Global", MemorySection="CAL", DataType="single")
P_VSM_ELK_State_Breakpressure_enable = AUTOSAR4.Parameter(1, SwCalibrationAccess="ReadWrite", StorageClass="Global", MemorySection="CAL", DataType="single")
P_VSM_ELK_State_Accpedalrate_enable = AUTOSAR4.Parameter(1, SwCalibrationAccess="ReadWrite", StorageClass="Global", MemorySection="CAL", DataType="single")
P_VSM_ELK_State_Eps_enable = AUTOSAR4.Parameter(1, SwCalibrationAccess="ReadWrite", StorageClass="Global", MemorySection="CAL", DataType="single")
P_VSM_ELK_State_GEAR_enable = AUTOSAR4.Parameter(1, SwCalibrationAccess="ReadWrite", StorageClass="Global", MemorySection="CAL", DataType="single")
P_VSM_ELK_State_TurnLight_enable = AUTOSAR4.Parameter(1, SwCalibrationAccess="ReadWrite", StorageClass="Global", MemorySection="CAL", DataType="single")
P_VSM_ELK_State_Overide_enable = AUTOSAR4.Parameter(1, SwCalibrationAccess="ReadWrite", StorageClass="Global", MemorySection="CAL", DataType="single")
P_VSM_ELK_State_Param_Lane = AUTOSAR4.Parameter(0.45, SwCalibrationAccess="ReadWrite", StorageClass="Global", MemorySection="CAL", DataType="single")
P_VSM_ELK_State_Param_Re = AUTOSAR4.Parameter(0.55, SwCalibrationAccess="ReadWrite", StorageClass="Global", MemorySection="CAL", DataType="single")
P_VSM_ELK_State_Param_LaneDeac = AUTOSAR4.Parameter(0.75, SwCalibrationAccess="ReadWrite", StorageClass="Global", MemorySection="CAL", DataType="single")
P_VSM_ELK_State_Param_Oncoming = AUTOSAR4.Parameter(0.55, SwCalibrationAccess="ReadWrite", StorageClass="Global", MemorySection="CAL", DataType="single")
P_VSM_ELK_State_Param_OnDeac = AUTOSAR4.Parameter(0.75, SwCalibrationAccess="ReadWrite", StorageClass="Global", MemorySection="CAL", DataType="single")
P_VSM_ELK_State_Param_Over = AUTOSAR4.Parameter(0.55, SwCalibrationAccess="ReadWrite", StorageClass="Global", MemorySection="CAL", DataType="single")
P_VSM_ELK_State_Param_OverDeac = AUTOSAR4.Parameter(0.75, SwCalibrationAccess="ReadWrite", StorageClass="Global", MemorySection="CAL", DataType="single")
P_VSM_ELK_State_Param_LaneTime = AUTOSAR4.Parameter(repmat(0.7, 1, 16), SwCalibrationAccess="ReadWrite", StorageClass="Global", MemorySection="CAL", DataType="single")
P_VSM_ELK_State_Param_OutOffset = AUTOSAR4.Parameter(0.15, SwCalibrationAccess="ReadWrite", StorageClass="Global", MemorySection="CAL", DataType="single")
P_VSM_ELK_State_Param_AngleOffset = AUTOSAR4.Parameter(0.05, SwCalibrationAccess="ReadWrite", StorageClass="Global", MemorySection="CAL", DataType="single")
P_VSM_ELK_State_Param_OnTime = AUTOSAR4.Parameter(repmat(0.7, 1, 16), SwCalibrationAccess="ReadWrite", StorageClass="Global", MemorySection="CAL", DataType="single")
P_VSM_ELK_State_Param_OvTime = AUTOSAR4.Parameter(repmat(0.7, 1, 16), SwCalibrationAccess="ReadWrite", StorageClass="Global", MemorySection="CAL", DataType="single")
P_VSM_ELK_OverTaking_Lateral = AUTOSAR4.Parameter(2, SwCalibrationAccess="ReadWrite", StorageClass="Global", MemorySection="CAL", DataType="single")
P_VSM_ELK_Lateral_Speed_Table = AUTOSAR4.Parameter([0.1 0.2 0.3 0.4 0.5 0.6 0.7 0.8 0.9 1 1.1 1.2], SwCalibrationAccess="ReadWrite", StorageClass="Global", MemorySection="CAL", DataType="single")
P_VSM_ELK_Lateral_Speed_Table_Calibration = AUTOSAR4.Parameter(repmat(1, 1, 12), SwCalibrationAccess="ReadWrite", StorageClass="Global", MemorySection="CAL", DataType="single")
P_VSM_ELK_Lane_Width_Table = AUTOSAR4.Parameter([2.5 3 3.5 4 4.5 5 5.5], SwCalibrationAccess="ReadWrite", StorageClass="Global", MemorySection="CAL", DataType="single")
P_VSM_ELK_Curvature_R_Table = AUTOSAR4.Parameter([150 500 1000 1500 2000 3000 4000 5000 5500], SwCalibrationAccess="ReadWrite", StorageClass="Global", MemorySection="CAL", DataType="single")
P_VSM_ELK_Curvature_R_Table_Calibration = AUTOSAR4.Parameter(repmat(1, 1, 9), SwCalibrationAccess="ReadWrite", StorageClass="Global", MemorySection="CAL", DataType="single")
P_VSM_ELK_State_Param_Speed = AUTOSAR4.Parameter([0 5 10 15 20 25 30 35 40 60 80 90 100 110 120 140], SwCalibrationAccess="ReadWrite", StorageClass="Global", MemorySection="CAL", DataType="single")
P_VSM_ELK_Lane_Width_Table_Calibration = AUTOSAR4.Parameter(repmat(0, 1, 7), SwCalibrationAccess="ReadWrite", StorageClass="Global", MemorySection="CAL", DataType="single")
P_VSM_ELK_Sensitive_Table_Calibration = AUTOSAR4.Parameter([0 0.1 -0.1], SwCalibrationAccess="ReadWrite", StorageClass="Global", MemorySection="CAL", DataType="single")
P_VSM_ELK_State_ESSSts_enable = AUTOSAR4.Parameter(1, SwCalibrationAccess="ReadWrite", StorageClass="Global", MemorySection="CAL", DataType="single")
P_VSM_ELK_LeftSlopeBaseValue_ratio = AUTOSAR4.Parameter(-0.002, SwCalibrationAccess="ReadWrite", StorageClass="Global", MemorySection="CAL", DataType="single")
P_VSM_ELK_RightSlopeBaseValue_ratio = AUTOSAR4.Parameter(0.002, SwCalibrationAccess="ReadWrite", StorageClass="Global", MemorySection="CAL", DataType="single")
P_VSM_ELK_ObjectMovType_INVALID = AUTOSAR4.Parameter(0, SwCalibrationAccess="ReadWrite", StorageClass="Global", MemorySection="CAL", DataType="uint8")
P_VSM_ELK_ObjectMovType_UNKNOWN = AUTOSAR4.Parameter(1, SwCalibrationAccess="ReadWrite", StorageClass="Global", MemorySection="CAL", DataType="uint8")
P_VSM_ELK_ObjectObj_MovType_MOVING = AUTOSAR4.Parameter(2, SwCalibrationAccess="ReadWrite", StorageClass="Global", MemorySection="CAL", DataType="uint8")
P_VSM_ELK_ROnComingLatDis_m = AUTOSAR4.Parameter(2.8, SwCalibrationAccess="ReadWrite", StorageClass="Global", MemorySection="CAL", DataType="single")
P_VSM_ELK_LeftEgeSlope_ratio = AUTOSAR4.Parameter(-0.002, SwCalibrationAccess="ReadWrite", StorageClass="Global", MemorySection="CAL", DataType="single")
P_VSM_ELK_RightEgeSlope_ratio = AUTOSAR4.Parameter(0.002, SwCalibrationAccess="ReadWrite", StorageClass="Global", MemorySection="CAL", DataType="single")
P_VSM_ELK_FL2LeftEgeDisOffset_m = AUTOSAR4.Parameter(0.5, SwCalibrationAccess="ReadWrite", StorageClass="Global", MemorySection="CAL", DataType="single")  % 车头左侧距离左侧边界线的横向距离Offset
P_VSM_ELK_FR2RightEgeDisOffset_m = AUTOSAR4.Parameter(0.5, SwCalibrationAccess="ReadWrite", StorageClass="Global", MemorySection="CAL", DataType="single")  % 车头右侧距离右侧边界线横向距离Offset
P_VSM_ELK_LeftOnComingInAreaLowDis_m = AUTOSAR4.Parameter(1.1, SwCalibrationAccess="ReadWrite", StorageClass="Global", MemorySection="CAL", DataType="single")
P_VSM_ELK_LeftOnComingInAreaHiDis_m = AUTOSAR4.Parameter(5.6, SwCalibrationAccess="ReadWrite", StorageClass="Global", MemorySection="CAL", DataType="single")
P_VSM_ELK_LeftOnComingOutAreaLowDis_m = AUTOSAR4.Parameter(1, SwCalibrationAccess="ReadWrite", StorageClass="Global", MemorySection="CAL", DataType="single")
P_VSM_ELK_LeftOnComingOutAreaHiDis_m = AUTOSAR4.Parameter(6.3, SwCalibrationAccess="ReadWrite", StorageClass="Global", MemorySection="CAL", DataType="single")
P_VSM_ELK_StandLaneWid = AUTOSAR4.Parameter(3.75, SwCalibrationAccess="ReadWrite", StorageClass="Global", MemorySection="CAL", DataType="single")
P_VSM_ELK_RightOnComingInAreaHiDis_m = AUTOSAR4.Parameter(-1.1, SwCalibrationAccess="ReadWrite", StorageClass="Global", MemorySection="CAL", DataType="single")
P_VSM_ELK_RightOnComingInAreaLowDis_m = AUTOSAR4.Parameter(-5.6, SwCalibrationAccess="ReadWrite", StorageClass="Global", MemorySection="CAL", DataType="single")
P_VSM_ELK_RightOnComingOutAreaHiDis_m = AUTOSAR4.Parameter(-1, SwCalibrationAccess="ReadWrite", StorageClass="Global", MemorySection="CAL", DataType="single")
P_VSM_ELK_RightOnComingOutAreaLowDis_m = AUTOSAR4.Parameter(-6.3, SwCalibrationAccess="ReadWrite", StorageClass="Global", MemorySection="CAL", DataType="single")
P_VSM_ELK_LeftOvtakingInAreaLowDis_m = AUTOSAR4.Parameter(0.9, SwCalibrationAccess="ReadWrite", StorageClass="Global", MemorySection="CAL", DataType="single")
P_VSM_ELK_LeftOvtakingInAreaHiDis_m = AUTOSAR4.Parameter(5.5, SwCalibrationAccess="ReadWrite", StorageClass="Global", MemorySection="CAL", DataType="single")
P_VSM_ELK_LeftOvtakingOutAreaLowDis_m = AUTOSAR4.Parameter(0.85, SwCalibrationAccess="ReadWrite", StorageClass="Global", MemorySection="CAL", DataType="single")
P_VSM_ELK_LeftOvtakingOutAreaHiDis_m = AUTOSAR4.Parameter(6.5, SwCalibrationAccess="ReadWrite", StorageClass="Global", MemorySection="CAL", DataType="single")
P_VSM_ELK_RightOvtakingInAreaHiDis_m = AUTOSAR4.Parameter(-0.9, SwCalibrationAccess="ReadWrite", StorageClass="Global", MemorySection="CAL", DataType="single")
P_VSM_ELK_RightOvtakingInAreaLowDis_m = AUTOSAR4.Parameter(-5.5, SwCalibrationAccess="ReadWrite", StorageClass="Global", MemorySection="CAL", DataType="single")
P_VSM_ELK_RightOvtakingOutAreaLowDis_m = AUTOSAR4.Parameter(-6.5, SwCalibrationAccess="ReadWrite", StorageClass="Global", MemorySection="CAL", DataType="single")
P_VSM_ELK_RightOvtakingOutAreaHiDis_m = AUTOSAR4.Parameter(-0.85, SwCalibrationAccess="ReadWrite", StorageClass="Global", MemorySection="CAL", DataType="single")
P_VSM_ELK_OverObjDxExitLength_m = AUTOSAR4.Parameter(4.5, SwCalibrationAccess="ReadWrite", StorageClass="Global", MemorySection="CAL", DataType="single")
P_VSM_ELK_OverObjectInAreaLow_m = AUTOSAR4.Parameter(-55, SwCalibrationAccess="ReadWrite", StorageClass="Global", MemorySection="CAL", DataType="single")
P_VSM_ELK_OverObjectInAreaHi_m = AUTOSAR4.Parameter(-50, SwCalibrationAccess="ReadWrite", StorageClass="Global", MemorySection="CAL", DataType="single")
P_VSM_ELK_OverObjectLength_m = AUTOSAR4.Parameter(4.5, SwCalibrationAccess="ReadWrite", StorageClass="Global", MemorySection="CAL", DataType="single")
P_VSM_ELK_OnComeObjVy_ms = AUTOSAR4.Parameter(-0.15, SwCalibrationAccess="ReadWrite", StorageClass="Global", MemorySection="CAL", DataType="single")
P_VSM_ELK_OverObjectVy_ms = AUTOSAR4.Parameter(-0.15, SwCalibrationAccess="ReadWrite", StorageClass="Global", MemorySection="CAL", DataType="single")
P_VSM_ELK_OverObjectLength_mCopy = AUTOSAR4.Parameter(4.5, SwCalibrationAccess="ReadWrite", StorageClass="Global", MemorySection="CAL", DataType="single")
P_VSM_ELK_OverObjectVx_ms = AUTOSAR4.Parameter(-0.1, SwCalibrationAccess="ReadWrite", StorageClass="Global", MemorySection="CAL", DataType="single")
P_VSM_ELK_OnComing_TTC = AUTOSAR4.Parameter(2.5, SwCalibrationAccess="ReadWrite", StorageClass="Global", MemorySection="CAL", DataType="single")
P_VSM_ELK_OnComingCenLineKap_ratio = AUTOSAR4.Parameter([0 0.0005 0.001 0.0015 0.002 0.0025 0.003 0.0035], SwCalibrationAccess="ReadWrite", StorageClass="Global", MemorySection="CAL", DataType="single")
P_VSM_ELK_OnComingPreDis_m = AUTOSAR4.Parameter([30 28 26 24 20 18 15 10], SwCalibrationAccess="ReadWrite", StorageClass="Global", MemorySection="CAL", DataType="single")
P_VSM_ELK_OnOverSwitch_b = AUTOSAR4.Parameter(0, SwCalibrationAccess="ReadWrite", StorageClass="Global", MemorySection="CAL", DataType="boolean")
P_VSM_ELK_OverrideLimValueDiff_Nm = AUTOSAR4.Parameter(1.8, SwCalibrationAccess="ReadWrite", StorageClass="Global", MemorySection="CAL", DataType="single")
P_VSM_ELK_OverrideLimValueSame_Nm = AUTOSAR4.Parameter(2.1, SwCalibrationAccess="ReadWrite", StorageClass="Global", MemorySection="CAL", DataType="single")
P_VSM_ELK_EPSTqVerifyTimeDiff_s = AUTOSAR4.Parameter(0.6, SwCalibrationAccess="ReadWrite", StorageClass="Global", MemorySection="CAL", DataType="single")
P_VSM_ELK_EPSTqVerifyTimeSame_s = AUTOSAR4.Parameter(0.6, SwCalibrationAccess="ReadWrite", StorageClass="Global", MemorySection="CAL", DataType="single")
P_VSM_ELK_OverrideSw_b = AUTOSAR4.Parameter(0, SwCalibrationAccess="ReadWrite", StorageClass="Global", MemorySection="CAL", DataType="boolean")
P_VSM_ELK_LeftLatDisOffset_m = AUTOSAR4.Parameter(-0.01, SwCalibrationAccess="ReadWrite", StorageClass="Global", MemorySection="CAL", DataType="single")  % 车辆质心距离车道中心线的Offset值
P_VSM_ELK_LatDisOffsetTime_s = AUTOSAR4.Parameter(0.1, SwCalibrationAccess="ReadWrite", StorageClass="Global", MemorySection="CAL", DataType="single")
P_VSM_ELK_RiLatDisOffset_m = AUTOSAR4.Parameter(0.01, SwCalibrationAccess="ReadWrite", StorageClass="Global", MemorySection="CAL", DataType="single")
P_VSM_ELK_OverTaking_TTC = AUTOSAR4.Parameter(4, SwCalibrationAccess="ReadWrite", StorageClass="Global", MemorySection="CAL", DataType="single")
P_VSM_ELK_LOvertakingLatDis_m = AUTOSAR4.Parameter(2.2, SwCalibrationAccess="ReadWrite", StorageClass="Global", MemorySection="CAL", DataType="single")
P_VSM_ELK_ROvertakingLatDis_m = AUTOSAR4.Parameter(2.2, SwCalibrationAccess="ReadWrite", StorageClass="Global", MemorySection="CAL", DataType="single")
P_VSM_ELK_LeftOnComingPointAMaxDis_m = AUTOSAR4.Parameter(1.8, SwCalibrationAccess="ReadWrite", StorageClass="Global", MemorySection="CAL", DataType="single")
P_VSM_ELK_LeftOnComingPointAMinDis_m = AUTOSAR4.Parameter(1.5, SwCalibrationAccess="ReadWrite", StorageClass="Global", MemorySection="CAL", DataType="single")
P_VSM_ELK_RiOnComingPointBMaxDis_m = AUTOSAR4.Parameter(-1.8, SwCalibrationAccess="ReadWrite", StorageClass="Global", MemorySection="CAL", DataType="single")
P_VSM_ELK_RiOnComingPointBMinDis_m = AUTOSAR4.Parameter(-1.5, SwCalibrationAccess="ReadWrite", StorageClass="Global", MemorySection="CAL", DataType="single")
P_VSM_ELK_LOnComingLatDis_m = AUTOSAR4.Parameter(1.5, SwCalibrationAccess="ReadWrite", StorageClass="Global", MemorySection="CAL", DataType="single")
P_VSM_ELK_OnComing_Lateral = AUTOSAR4.Parameter(1.5, SwCalibrationAccess="ReadWrite", StorageClass="Global", MemorySection="CAL", DataType="single")
P_VSM_ELK_State_LaneChange_enable = AUTOSAR4.Parameter(0, SwCalibrationAccess="ReadWrite", StorageClass="Global", MemorySection="CAL", DataType="single")
P_VSM_ELK_State_Inhibit_enable = AUTOSAR4.Parameter(1, SwCalibrationAccess="ReadWrite", StorageClass="Global", MemorySection="CAL", DataType="boolean")
P_VSM_ELK_State_EPSFaultCheck_enable = AUTOSAR4.Parameter(1, SwCalibrationAccess="ReadWrite", StorageClass="Global", MemorySection="CAL", DataType="boolean")
P_VSM_ELK_EPSFaultCheckValue = AUTOSAR4.Parameter(30, SwCalibrationAccess="ReadWrite", StorageClass="Global", MemorySection="CAL", DataType="single")
P_VSM_ELK_EPSFaultCheckCountNum = AUTOSAR4.Parameter(3000, SwCalibrationAccess="ReadWrite", StorageClass="Global", MemorySection="CAL", DataType="single")
P_VSM_LCK_State_Yawsup_enable = AUTOSAR4.Parameter(1, SwCalibrationAccess="ReadWrite", StorageClass="Global", MemorySection="CAL", DataType="single")
P_VSM_LCK_State_Handson_enable = AUTOSAR4.Parameter(1, SwCalibrationAccess="ReadWrite", StorageClass="Global", MemorySection="CAL", DataType="single")
P_VSM_LCK_State_Absesp_enable = AUTOSAR4.Parameter(1, SwCalibrationAccess="ReadWrite", StorageClass="Global", MemorySection="CAL", DataType="single")
P_VSM_LCK_State_Lane_enable = AUTOSAR4.Parameter(1, SwCalibrationAccess="ReadWrite", StorageClass="Global", MemorySection="CAL", DataType="single")
P_VSM_LCK_State_Vehspeed_enable = AUTOSAR4.Parameter(1, SwCalibrationAccess="ReadWrite", StorageClass="Global", MemorySection="CAL", DataType="single")
P_VSM_LCK_State_TurnLight_enable = AUTOSAR4.Parameter(1, SwCalibrationAccess="ReadWrite", StorageClass="Global", MemorySection="CAL", DataType="single")
P_VSM_LCK_State_SteerWheelSpd_enable = AUTOSAR4.Parameter(1, SwCalibrationAccess="ReadWrite", StorageClass="Global", MemorySection="CAL", DataType="single")
P_VSM_LCK_State_Breakpressure_enable = AUTOSAR4.Parameter(1, SwCalibrationAccess="ReadWrite", StorageClass="Global", MemorySection="CAL", DataType="single")
P_VSM_LCK_State_SteerWheelAngle_enable = AUTOSAR4.Parameter(1, SwCalibrationAccess="ReadWrite", StorageClass="Global", MemorySection="CAL", DataType="single")
P_VSM_LCK_State_DriverInputTrqValue_enable = AUTOSAR4.Parameter(1, SwCalibrationAccess="ReadWrite", StorageClass="Global", MemorySection="CAL", DataType="single")
P_VSM_LCK_State_LateralAcce_enable = AUTOSAR4.Parameter(1, SwCalibrationAccess="ReadWrite", StorageClass="Global", MemorySection="CAL", DataType="single")
P_VSM_LCK_State_LongitudeAcc_enable = AUTOSAR4.Parameter(1, SwCalibrationAccess="ReadWrite", StorageClass="Global", MemorySection="CAL", DataType="single")
P_VSM_LCK_State_GEAR_enable = AUTOSAR4.Parameter(1, SwCalibrationAccess="ReadWrite", StorageClass="Global", MemorySection="CAL", DataType="single")
P_VSM_LCK_State_Overide_enable = AUTOSAR4.Parameter(1, SwCalibrationAccess="ReadWrite", StorageClass="Global", MemorySection="CAL", DataType="single")
P_VSM_LCK_LaneDouble = AUTOSAR4.Parameter(1, SwCalibrationAccess="ReadWrite", StorageClass="Global", MemorySection="CAL", DataType="single")
P_VSM_LCK_State_TargetLaneIn_enable = AUTOSAR4.Parameter(1, SwCalibrationAccess="ReadWrite", StorageClass="Global", MemorySection="CAL", DataType="single")
P_VSM_LCK_State_LSMLine_enable = AUTOSAR4.Parameter(1, SwCalibrationAccess="ReadWrite", StorageClass="Global", MemorySection="CAL", DataType="single")
P_VSM_LCK_State_ReadyInTime_enable = AUTOSAR4.Parameter(1, SwCalibrationAccess="ReadWrite", StorageClass="Global", MemorySection="CAL", DataType="single")
P_VSM_LCK_IdleInTime = AUTOSAR4.Parameter(2, SwCalibrationAccess="ReadWrite", StorageClass="Global", MemorySection="CAL", DataType="single")
P_VSM_LCK_State_IdleInTime_enable = AUTOSAR4.Parameter(0, SwCalibrationAccess="ReadWrite", StorageClass="Global", MemorySection="CAL", DataType="single")

P_VSM_LCK_State_LaneCurve_enable = AUTOSAR4.Parameter(0, SwCalibrationAccess="ReadWrite", StorageClass="Global", MemorySection="CAL", DataType="single")
P_VSM_LCK_State_Accpedalrate_enable = AUTOSAR4.Parameter(0, SwCalibrationAccess="ReadWrite", StorageClass="Global", MemorySection="CAL", DataType="single")
P_VSM_LCK_LeftSteerMinVal_deg = AUTOSAR4.Parameter(0.1, SwCalibrationAccess="ReadWrite", StorageClass="Global", MemorySection="CAL", DataType="single")  % 方向盘左转最小值-根据报文分辨率设定
P_VSM_LCK_RightSteerMinVal_deg = AUTOSAR4.Parameter(-0.1, SwCalibrationAccess="ReadWrite", StorageClass="Global", MemorySection="CAL", DataType="single")  % 方向盘右转角度最小值-根据报文分辨率设定
P_VSM_LCK_A0OffsetSwitch = AUTOSAR4.Parameter(1, SwCalibrationAccess="ReadWrite", StorageClass="Global", MemorySection="CAL", DataType="boolean")  % LCKA0-Offset切换开关
P_VSM_LCK_A0switch = AUTOSAR4.Parameter(0, SwCalibrationAccess="ReadWrite", StorageClass="Global", MemorySection="CAL", DataType="boolean")
P_VSM_LCK_A1offsetSwitch = AUTOSAR4.Parameter(1, SwCalibrationAccess="ReadWrite", StorageClass="Global", MemorySection="CAL", DataType="boolean")
P_VSM_LCK_A1switch = AUTOSAR4.Parameter(0, SwCalibrationAccess="ReadWrite", StorageClass="Global", MemorySection="CAL", DataType="boolean")
P_VSM_LCK_State_Param_LaneCurve_Offset = AUTOSAR4.Parameter([-0.2 -0.15 -0.1 -0.05 0 0.05 0.1 0.15 0.2], SwCalibrationAccess="ReadWrite", StorageClass="Global", MemorySection="CAL", DataType="single")
P_VSM_LCK_State_Param_LaneCurve = AUTOSAR4.Parameter([-0.05 -0.01 -0.005 -0.001 0 0.001 0.005 0.01 0.05], SwCalibrationAccess="ReadWrite", StorageClass="Global", MemorySection="CAL", DataType="single")
P_VSM_LCK_LcOverrideLimValueDiff_Nm = AUTOSAR4.Parameter(1.5, SwCalibrationAccess="ReadWrite", StorageClass="Global", MemorySection="CAL", DataType="single")  % 左右换道-反方向时驾驶员手力矩阈值
P_VSM_LCK_LcEPSTqVerifyTimeDiff_s = AUTOSAR4.Parameter(0.2, SwCalibrationAccess="ReadWrite", StorageClass="Global", MemorySection="CAL", DataType="single")  % 左右换道-反方向时Override确认时间
P_VSM_LCK_LcEPSTqVerifyTimeSame_s = AUTOSAR4.Parameter(0.2, SwCalibrationAccess="ReadWrite", StorageClass="Global", MemorySection="CAL", DataType="single")  % 左右换道-同方向时Override确认时间
P_VSM_LCK_OverrideLimValueDiff_Nm = AUTOSAR4.Parameter(1.5, SwCalibrationAccess="ReadWrite", StorageClass="Global", MemorySection="CAL", DataType="single")  % 非换道-反方向时Override手力矩阈值
P_VSM_LCK_OverrideLimValueSame_Nm = AUTOSAR4.Parameter(1.8, SwCalibrationAccess="ReadWrite", StorageClass="Global", MemorySection="CAL", DataType="single")  % 非换道-同方向时Override手力矩阈值
P_VSM_LCK_EPSTqVerifyTimeDiff_s = AUTOSAR4.Parameter(0.2, SwCalibrationAccess="ReadWrite", StorageClass="Global", MemorySection="CAL", DataType="single")  % 非换道-反方向时Override确认时间
P_VSM_LCK_EPSTqVerifyTimeSame_s = AUTOSAR4.Parameter(0.2, SwCalibrationAccess="ReadWrite", StorageClass="Global", MemorySection="CAL", DataType="single")  % 非换道-驾驶员手力矩Override确认时间
P_VSM_LCK_TqOrDegControlSw_b = AUTOSAR4.Parameter(1, SwCalibrationAccess="ReadWrite", StorageClass="Global", MemorySection="CAL", DataType="boolean")  % EPS扭矩控制or角度控制切换开关
P_VSM_LCK_TargetInSwitch = AUTOSAR4.Parameter(0, SwCalibrationAccess="ReadWrite", StorageClass="Global", MemorySection="CAL", DataType="boolean")
P_VSM_LCK_Lanewidthswitch = AUTOSAR4.Parameter(1, SwCalibrationAccess="ReadWrite", StorageClass="Global", MemorySection="CAL", DataType="boolean")
P_VSM_LCK_A1 = AUTOSAR4.Parameter(15, SwCalibrationAccess="ReadWrite", StorageClass="Global", MemorySection="CAL", DataType="single")
P_VSM_LCK_LcOverrideLimValueSame_Nm = AUTOSAR4.Parameter(1.8, SwCalibrationAccess="ReadWrite", StorageClass="Global", MemorySection="CAL", DataType="single")  % 左右换道-同方向时驾驶员手力矩阈值
P_VSM_LCK_State_ESSSts_enable = AUTOSAR4.Parameter(1, SwCalibrationAccess="ReadWrite", StorageClass="Global", MemorySection="CAL", DataType="boolean")
P_VSM_LCK_LCOverrideValue = AUTOSAR4.Parameter(1.5, SwCalibrationAccess="ReadWrite", StorageClass="Global", MemorySection="CAL", DataType="single")
P_VSM_LCK_AccrPelRateOut = AUTOSAR4.Parameter(0, SwCalibrationAccess="ReadWrite", StorageClass="Global", MemorySection="CAL", DataType="single")
P_VSM_LCK_LCOverrideTime = AUTOSAR4.Parameter(0.6, SwCalibrationAccess="ReadWrite", StorageClass="Global", MemorySection="CAL", DataType="single")
P_VSM_LCK_AccRateIn = AUTOSAR4.Parameter(30, SwCalibrationAccess="ReadWrite", StorageClass="Global", MemorySection="CAL", DataType="single")
P_VSM_LCK_AccRateInTime = AUTOSAR4.Parameter(1.5, SwCalibrationAccess="ReadWrite", StorageClass="Global", MemorySection="CAL", DataType="single")
P_VSM_LCK_AccRateOut = AUTOSAR4.Parameter(80, SwCalibrationAccess="ReadWrite", StorageClass="Global", MemorySection="CAL", DataType="single")
P_VSM_LCK_YawRateIn = AUTOSAR4.Parameter(0.2, SwCalibrationAccess="ReadWrite", StorageClass="Global", MemorySection="CAL", DataType="single")
P_VSM_LCK_YawRateInTime = AUTOSAR4.Parameter(1, SwCalibrationAccess="ReadWrite", StorageClass="Global", MemorySection="CAL", DataType="single")
P_VSM_LCK_YawRateOut = AUTOSAR4.Parameter(0.25, SwCalibrationAccess="ReadWrite", StorageClass="Global", MemorySection="CAL", DataType="single")
P_VSM_LCK_AbsEspInTime = AUTOSAR4.Parameter(3, SwCalibrationAccess="ReadWrite", StorageClass="Global", MemorySection="CAL", DataType="single")
P_VSM_LCK_SteerAngleSpdIn = AUTOSAR4.Parameter(150, SwCalibrationAccess="ReadWrite", StorageClass="Global", MemorySection="CAL", DataType="single")
P_VSM_LCK_SteerAngleSpdInTime = AUTOSAR4.Parameter(3, SwCalibrationAccess="ReadWrite", StorageClass="Global", MemorySection="CAL", DataType="single")
P_VSM_LCK_BrakePressIn = AUTOSAR4.Parameter(3, SwCalibrationAccess="ReadWrite", StorageClass="Global", MemorySection="CAL", DataType="single")
P_VSM_LCK_BrakePressInTime = AUTOSAR4.Parameter(1.5, SwCalibrationAccess="ReadWrite", StorageClass="Global", MemorySection="CAL", DataType="single")
P_VSM_LCK_SteerWheelAngleIn = AUTOSAR4.Parameter(70, SwCalibrationAccess="ReadWrite", StorageClass="Global", MemorySection="CAL", DataType="single")
P_VSM_LCK_SteerWheelAngleInTime = AUTOSAR4.Parameter(3, SwCalibrationAccess="ReadWrite", StorageClass="Global", MemorySection="CAL", DataType="single")
P_VSM_LCK_DrvInputTrqValueInTime = AUTOSAR4.Parameter(3, SwCalibrationAccess="ReadWrite", StorageClass="Global", MemorySection="CAL", DataType="single")
P_VSM_LCK_LateralAcceInTime = AUTOSAR4.Parameter(3, SwCalibrationAccess="ReadWrite", StorageClass="Global", MemorySection="CAL", DataType="single")
P_VSM_LCK_LongitudeAccIn = AUTOSAR4.Parameter(3, SwCalibrationAccess="ReadWrite", StorageClass="Global", MemorySection="CAL", DataType="single")
P_VSM_LCK_LongitudeAccInTime = AUTOSAR4.Parameter(3, SwCalibrationAccess="ReadWrite", StorageClass="Global", MemorySection="CAL", DataType="single")
P_VSM_LCK_absLongitudeAccIn = AUTOSAR4.Parameter(2.5, SwCalibrationAccess="ReadWrite", StorageClass="Global", MemorySection="CAL", DataType="single")
P_VSM_LCK_OverrideInTime = AUTOSAR4.Parameter(3, SwCalibrationAccess="ReadWrite", StorageClass="Global", MemorySection="CAL", DataType="single")
P_VSM_LCK_SteerAngleSpdOut = AUTOSAR4.Parameter(200, SwCalibrationAccess="ReadWrite", StorageClass="Global", MemorySection="CAL", DataType="single")
P_VSM_LCK_BrakePressOut = AUTOSAR4.Parameter(5, SwCalibrationAccess="ReadWrite", StorageClass="Global", MemorySection="CAL", DataType="single")
P_VSM_LCK_SteerWheelAngleOut = AUTOSAR4.Parameter(90, SwCalibrationAccess="ReadWrite", StorageClass="Global", MemorySection="CAL", DataType="single")
P_VSM_LCK_LongitudeAccOut = AUTOSAR4.Parameter(3.5, SwCalibrationAccess="ReadWrite", StorageClass="Global", MemorySection="CAL", DataType="single")
P_VSM_LCK_absLongitudeAccOut = AUTOSAR4.Parameter(3, SwCalibrationAccess="ReadWrite", StorageClass="Global", MemorySection="CAL", DataType="single")
P_VSM_LCK_Warnarea1 = AUTOSAR4.Parameter(-0.55, SwCalibrationAccess="ReadWrite", StorageClass="Global", MemorySection="CAL", DataType="single")
P_VSM_LCK_Warnarea2 = AUTOSAR4.Parameter(-0.35, SwCalibrationAccess="ReadWrite", StorageClass="Global", MemorySection="CAL", DataType="single")
P_VSM_LCK_WarnInTime = AUTOSAR4.Parameter(2, SwCalibrationAccess="ReadWrite", StorageClass="Global", MemorySection="CAL", DataType="single")
P_VSM_LCK_AccrPelOut = AUTOSAR4.Parameter(30, SwCalibrationAccess="ReadWrite", StorageClass="Global", MemorySection="CAL", DataType="single")
P_VSM_LCK_LCDrvInputTrqValueOut = AUTOSAR4.Parameter(3, SwCalibrationAccess="ReadWrite", StorageClass="Global", MemorySection="CAL", DataType="single")
P_VSM_LCK_PreTime = AUTOSAR4.Parameter(0.2, SwCalibrationAccess="ReadWrite", StorageClass="Global", MemorySection="CAL", DataType="single")
P_VSM_LCK_T1 = AUTOSAR4.Parameter(15, SwCalibrationAccess="ReadWrite", StorageClass="Global", MemorySection="CAL", DataType="single")
P_VSM_LCK_T0 = AUTOSAR4.Parameter(0.75, SwCalibrationAccess="ReadWrite", StorageClass="Global", MemorySection="CAL", DataType="single")
P_VSM_LCK_LateralAcceIn = AUTOSAR4.Parameter(3, SwCalibrationAccess="ReadWrite", StorageClass="Global", MemorySection="CAL", DataType="single")
P_VSM_LCK_LateralAcceOut = AUTOSAR4.Parameter(3.5, SwCalibrationAccess="ReadWrite", StorageClass="Global", MemorySection="CAL", DataType="single")
P_VSM_LCK_dypreFactor = AUTOSAR4.Parameter(1, SwCalibrationAccess="ReadWrite", StorageClass="Global", MemorySection="CAL", DataType="single")
P_VSM_LCK_LanechangeSwitch = AUTOSAR4.Parameter(0, SwCalibrationAccess="ReadWrite", StorageClass="Global", MemorySection="CAL", DataType="boolean")
P_VSM_LCK_State_Param_LaneWidth = AUTOSAR4.Parameter([2.5 3 3.5 4 4.5 5 5.5], SwCalibrationAccess="ReadWrite", StorageClass="Global", MemorySection="CAL", DataType="single")
P_VSM_LCK_State_Param_LaneWidth_Offset = AUTOSAR4.Parameter([-0.27 -0.16 0 0.07 0.17 0.28 0.4], SwCalibrationAccess="ReadWrite", StorageClass="Global", MemorySection="CAL", DataType="single")
P_VSM_LCK_OverrideValue = AUTOSAR4.Parameter(1.5, SwCalibrationAccess="ReadWrite", StorageClass="Global", MemorySection="CAL", DataType="single")
P_VSM_LCK_OverrideTime = AUTOSAR4.Parameter(0.45, SwCalibrationAccess="ReadWrite", StorageClass="Global", MemorySection="CAL", DataType="single")
P_VSM_LCK_DrvInputTrqValueOut = AUTOSAR4.Parameter(3.5, SwCalibrationAccess="ReadWrite", StorageClass="Global", MemorySection="CAL", DataType="single")
P_VSM_LCK_DrvInputTrqValueIn = AUTOSAR4.Parameter(2.5, SwCalibrationAccess="ReadWrite", StorageClass="Global", MemorySection="CAL", DataType="single")
P_VSM_LCK_ParamA1 = AUTOSAR4.Parameter([-1.2 -1 -0.6 -0.3 0 0.3 0.6 1 1.2], SwCalibrationAccess="ReadWrite", StorageClass="Global", MemorySection="CAL", DataType="single")
P_VSM_LCK_State_LaneChange_enable = AUTOSAR4.Parameter(0, SwCalibrationAccess="ReadWrite", StorageClass="Global", MemorySection="CAL", DataType="boolean")
P_VSM_LCK_WarnLCOverrideValue = AUTOSAR4.Parameter(1.8, SwCalibrationAccess="ReadWrite", StorageClass="Global", MemorySection="CAL", DataType="single")
P_VSM_LCK_WarnOverrideValue = AUTOSAR4.Parameter(1.8, SwCalibrationAccess="ReadWrite", StorageClass="Global", MemorySection="CAL", DataType="single")
P_VSM_LCK_OverrideHWADelayNum_n = AUTOSAR4.Parameter(250, SwCalibrationAccess="ReadWrite", StorageClass="Global", MemorySection="CAL", DataType="uint16")
P_VSM_LCK_State_Eps_enable = AUTOSAR4.Parameter(0, SwCalibrationAccess="ReadWrite", StorageClass="Global", MemorySection="CAL", DataType="single")
P_VSM_LCK_OverrideVehSpd_kph = AUTOSAR4.Parameter([0 10 20 30 40 50 60 70 80 90 100 110 120 130 140 150], SwCalibrationAccess="ReadWrite", StorageClass="Global", MemorySection="CAL", DataType="single")
P_VSM_LCK_OverrideTrqCoe_ratio = AUTOSAR4.Parameter(repmat(1, 1, 16), SwCalibrationAccess="ReadWrite", StorageClass="Global", MemorySection="CAL", DataType="single")
P_VSM_LCK_OverrideVeryTimeCoe_ratio = AUTOSAR4.Parameter(repmat(1, 1, 16), SwCalibrationAccess="ReadWrite", StorageClass="Global", MemorySection="CAL", DataType="single")
P_VSM_LCK_WarnLcEPSTqVerifyTimeDiff_s = AUTOSAR4.Parameter(0.6, SwCalibrationAccess="ReadWrite", StorageClass="Global", MemorySection="CAL", DataType="single")
P_VSM_LCK_WarnLcOverrideLimValueDiff_Nm = AUTOSAR4.Parameter(2.2, SwCalibrationAccess="ReadWrite", StorageClass="Global", MemorySection="CAL", DataType="single")
P_VSM_LCK_WarnLcOverrideLimValueSame_Nm = AUTOSAR4.Parameter(2.2, SwCalibrationAccess="ReadWrite", StorageClass="Global", MemorySection="CAL", DataType="single")
P_VSM_LCK_WarnLcEPSTqVerifyTimeSame_s = AUTOSAR4.Parameter(0.6, SwCalibrationAccess="ReadWrite", StorageClass="Global", MemorySection="CAL", DataType="single")
P_VSM_LCK_WarnOverrideLimValueDiff_Nm = AUTOSAR4.Parameter(2.2, SwCalibrationAccess="ReadWrite", StorageClass="Global", MemorySection="CAL", DataType="single")
P_VSM_LCK_WarnEPSTqVerifyTimeDiff_s = AUTOSAR4.Parameter(0.6, SwCalibrationAccess="ReadWrite", StorageClass="Global", MemorySection="CAL", DataType="single")
P_VSM_LCK_WarnEPSTqVerifyTimeSame_s = AUTOSAR4.Parameter(0.6, SwCalibrationAccess="ReadWrite", StorageClass="Global", MemorySection="CAL", DataType="single")
P_VSM_LCK_WarnOverrideLimValueSame_Nm = AUTOSAR4.Parameter(2.2, SwCalibrationAccess="ReadWrite", StorageClass="Global", MemorySection="CAL", DataType="single")
P_VSM_LCK_State_Inhibit_enable = AUTOSAR4.Parameter(1, SwCalibrationAccess="ReadWrite", StorageClass="Global", MemorySection="CAL", DataType="boolean")
P_VSM_LCK_State_EPSFaultCheck_enable = AUTOSAR4.Parameter(1, SwCalibrationAccess="ReadWrite", StorageClass="Global", MemorySection="CAL", DataType="boolean")
P_VSM_LCK_EPSFaultCheckValue = AUTOSAR4.Parameter(30, SwCalibrationAccess="ReadWrite", StorageClass="Global", MemorySection="CAL", DataType="single")
P_VSM_LCK_EPSFaultCheckCountNum = AUTOSAR4.Parameter(3000, SwCalibrationAccess="ReadWrite", StorageClass="Global", MemorySection="CAL", DataType="single")
P_VSM_LKA_State_Vehspeed_enable = AUTOSAR4.Parameter(1, SwCalibrationAccess="ReadWrite", StorageClass="Global", MemorySection="CAL", DataType="single")
P_VSM_LKA_State_Yawsup_enable = AUTOSAR4.Parameter(1, SwCalibrationAccess="ReadWrite", StorageClass="Global", MemorySection="CAL", DataType="single")
P_VSM_LKA_State_Absesp_enable = AUTOSAR4.Parameter(1, SwCalibrationAccess="ReadWrite", StorageClass="Global", MemorySection="CAL", DataType="single")
P_VSM_LKA_State_Lane_enable = AUTOSAR4.Parameter(1, SwCalibrationAccess="ReadWrite", StorageClass="Global", MemorySection="CAL", DataType="single")
P_VSM_LKA_State_Headingangle_enable = AUTOSAR4.Parameter(1, SwCalibrationAccess="ReadWrite", StorageClass="Global", MemorySection="CAL", DataType="single")
P_VSM_LKA_State_Lanecurve_enable = AUTOSAR4.Parameter(1, SwCalibrationAccess="ReadWrite", StorageClass="Global", MemorySection="CAL", DataType="single")
P_VSM_LKA_State_Failsafe_enable = AUTOSAR4.Parameter(1, SwCalibrationAccess="ReadWrite", StorageClass="Global", MemorySection="CAL", DataType="single")
P_VSM_LKA_State_Handson_enable = AUTOSAR4.Parameter(1, SwCalibrationAccess="ReadWrite", StorageClass="Global", MemorySection="CAL", DataType="single")
P_VSM_LKA_State_SteerWheelAngle_enable = AUTOSAR4.Parameter(1, SwCalibrationAccess="ReadWrite", StorageClass="Global", MemorySection="CAL", DataType="single")
P_VSM_LKA_State_DriverInputTrqValue_enable = AUTOSAR4.Parameter(1, SwCalibrationAccess="ReadWrite", StorageClass="Global", MemorySection="CAL", DataType="single")
P_VSM_LKA_State_SteerWheelSpd_enable = AUTOSAR4.Parameter(1, SwCalibrationAccess="ReadWrite", StorageClass="Global", MemorySection="CAL", DataType="single")
P_VSM_LKA_State_LateralAcce_enable = AUTOSAR4.Parameter(1, SwCalibrationAccess="ReadWrite", StorageClass="Global", MemorySection="CAL", DataType="single")
P_VSM_LKA_State_Breakpressure_enable = AUTOSAR4.Parameter(1, SwCalibrationAccess="ReadWrite", StorageClass="Global", MemorySection="CAL", DataType="single")
P_VSM_LKA_State_GEAR_enable = AUTOSAR4.Parameter(1, SwCalibrationAccess="ReadWrite", StorageClass="Global", MemorySection="CAL", DataType="single")
P_VSM_LKA_State_Overide_enable = AUTOSAR4.Parameter(1, SwCalibrationAccess="ReadWrite", StorageClass="Global", MemorySection="CAL", DataType="single")
P_VSM_LKA_State_LaneChange_enable = AUTOSAR4.Parameter(1, SwCalibrationAccess="ReadWrite", StorageClass="Global", MemorySection="CAL", DataType="single")
P_VSM_LKA_State_HandsOff_enable = AUTOSAR4.Parameter(1, SwCalibrationAccess="ReadWrite", StorageClass="Global", MemorySection="CAL", DataType="single")
P_VSM_LKA_State_Param_OutTime = AUTOSAR4.Parameter(2, SwCalibrationAccess="ReadWrite", StorageClass="Global", MemorySection="CAL", DataType="single")
P_VSM_LKA_State_LongitudeAcc_enable = AUTOSAR4.Parameter(1, SwCalibrationAccess="ReadWrite", StorageClass="Global", MemorySection="CAL", DataType="single")
P_VSM_LKA_State_Param_InterventionZoneIn = AUTOSAR4.Parameter(0.4, SwCalibrationAccess="ReadWrite", StorageClass="Global", MemorySection="CAL", DataType="single")
P_VSM_LKA_State_Param_OutOffset = AUTOSAR4.Parameter(0.2, SwCalibrationAccess="ReadWrite", StorageClass="Global", MemorySection="CAL", DataType="single")
P_VSM_LKA_State_Param_InterventionZoneOut = AUTOSAR4.Parameter(-0.65, SwCalibrationAccess="ReadWrite", StorageClass="Global", MemorySection="CAL", DataType="single")
P_VSM_LKA_State_Param_REInterventionZoneIn = AUTOSAR4.Parameter(0.55, SwCalibrationAccess="ReadWrite", StorageClass="Global", MemorySection="CAL", DataType="single")
P_VSM_LKA_State_Param_AngleOffset = AUTOSAR4.Parameter(0.15, SwCalibrationAccess="ReadWrite", StorageClass="Global", MemorySection="CAL", DataType="single")
P_VSM_LKA_State_Param_LaneWidth_Offset = AUTOSAR4.Parameter([-0.27 -0.16 -0.05 0.07 0.17 0.28 0.4], SwCalibrationAccess="ReadWrite", StorageClass="Global", MemorySection="CAL", DataType="single")
P_VSM_LKA_State_Param_Sensitive_Offset = AUTOSAR4.Parameter([0 0.2 -0.2], SwCalibrationAccess="ReadWrite", StorageClass="Global", MemorySection="CAL", DataType="single")
P_VSM_LKA_State_TJASts_enable = AUTOSAR4.Parameter(1, SwCalibrationAccess="ReadWrite", StorageClass="Global", MemorySection="CAL", DataType="single")
P_VSM_LKA_State_Accpedalrate_enable = AUTOSAR4.Parameter(1, SwCalibrationAccess="ReadWrite", StorageClass="Global", MemorySection="CAL", DataType="single")
P_VSM_LKA_CurveFactor = AUTOSAR4.Parameter(1, SwCalibrationAccess="ReadWrite", StorageClass="Global", MemorySection="CAL", DataType="single")
P_VSM_LKA_AccPedalRateOutTime = AUTOSAR4.Parameter(0, SwCalibrationAccess="ReadWrite", StorageClass="Global", MemorySection="CAL", DataType="single")
P_VSM_LKA_AccPedalPosnOut = AUTOSAR4.Parameter(30, SwCalibrationAccess="ReadWrite", StorageClass="Global", MemorySection="CAL", DataType="single")
P_VSM_LKA_TurnLightInTime = AUTOSAR4.Parameter(3, SwCalibrationAccess="ReadWrite", StorageClass="Global", MemorySection="CAL", DataType="single")
P_VSM_LKA_LaneCurveOut = AUTOSAR4.Parameter(0.006, SwCalibrationAccess="ReadWrite", StorageClass="Global", MemorySection="CAL", DataType="single")
P_VSM_LKA_Warnarea2 = AUTOSAR4.Parameter(-0.35, SwCalibrationAccess="ReadWrite", StorageClass="Global", MemorySection="CAL", DataType="single")
P_VSM_LKA_Warnarea1 = AUTOSAR4.Parameter(-0.55, SwCalibrationAccess="ReadWrite", StorageClass="Global", MemorySection="CAL", DataType="single")
P_VSM_LKA_WarnInTime = AUTOSAR4.Parameter(2, SwCalibrationAccess="ReadWrite", StorageClass="Global", MemorySection="CAL", DataType="single")
P_VSM_LKA_AbsEspInTime = AUTOSAR4.Parameter(3, SwCalibrationAccess="ReadWrite", StorageClass="Global", MemorySection="CAL", DataType="single")
P_VSM_LKA_YawRateInTime = AUTOSAR4.Parameter(1, SwCalibrationAccess="ReadWrite", StorageClass="Global", MemorySection="CAL", DataType="single")
P_VSM_LKA_YawRateIn = AUTOSAR4.Parameter(0.2, SwCalibrationAccess="ReadWrite", StorageClass="Global", MemorySection="CAL", DataType="single")
P_VSM_LKA_YawRateOut = AUTOSAR4.Parameter(0.25, SwCalibrationAccess="ReadWrite", StorageClass="Global", MemorySection="CAL", DataType="single")
P_VSM_LKA_OverrideTime = AUTOSAR4.Parameter(0.3, SwCalibrationAccess="ReadWrite", StorageClass="Global", MemorySection="CAL", DataType="single")
P_VSM_LKA_OverrideValue = AUTOSAR4.Parameter(1.2, SwCalibrationAccess="ReadWrite", StorageClass="Global", MemorySection="CAL", DataType="single")
P_VSM_LKA_BrakePressOut = AUTOSAR4.Parameter(5, SwCalibrationAccess="ReadWrite", StorageClass="Global", MemorySection="CAL", DataType="single")
P_VSM_LKA_absLongitudeAcceOut = AUTOSAR4.Parameter(3, SwCalibrationAccess="ReadWrite", StorageClass="Global", MemorySection="CAL", DataType="single")
P_VSM_LKA_LongitudeAcceOut = AUTOSAR4.Parameter(3.5, SwCalibrationAccess="ReadWrite", StorageClass="Global", MemorySection="CAL", DataType="single")
P_VSM_LKA_LateralAcceOut = AUTOSAR4.Parameter(3.5, SwCalibrationAccess="ReadWrite", StorageClass="Global", MemorySection="CAL", DataType="single")
P_VSM_LKA_SteerWheelSpdOut = AUTOSAR4.Parameter(200, SwCalibrationAccess="ReadWrite", StorageClass="Global", MemorySection="CAL", DataType="single")
P_VSM_LKA_SteerWheelAngleOut = AUTOSAR4.Parameter(90, SwCalibrationAccess="ReadWrite", StorageClass="Global", MemorySection="CAL", DataType="single")
P_VSM_LKA_WhelDy = AUTOSAR4.Parameter(2, SwCalibrationAccess="ReadWrite", StorageClass="Global", MemorySection="CAL", DataType="single")
P_VSM_LKA_OverrideInTime = AUTOSAR4.Parameter(1.5, SwCalibrationAccess="ReadWrite", StorageClass="Global", MemorySection="CAL", DataType="single")
P_VSM_LKA_BrakePressInTime = AUTOSAR4.Parameter(1.5, SwCalibrationAccess="ReadWrite", StorageClass="Global", MemorySection="CAL", DataType="single")
P_VSM_LKA_BrakePressIn = AUTOSAR4.Parameter(3, SwCalibrationAccess="ReadWrite", StorageClass="Global", MemorySection="CAL", DataType="single")
P_VSM_LKA_absLongitudeAcceInTime = AUTOSAR4.Parameter(3, SwCalibrationAccess="ReadWrite", StorageClass="Global", MemorySection="CAL", DataType="single")
P_VSM_LKA_absLongitudeAcceIn = AUTOSAR4.Parameter(2.5, SwCalibrationAccess="ReadWrite", StorageClass="Global", MemorySection="CAL", DataType="single")
P_VSM_LKA_LongitudeAcceIn = AUTOSAR4.Parameter(3, SwCalibrationAccess="ReadWrite", StorageClass="Global", MemorySection="CAL", DataType="single")
P_VSM_LKA_LateralAcceInTime = AUTOSAR4.Parameter(3, SwCalibrationAccess="ReadWrite", StorageClass="Global", MemorySection="CAL", DataType="single")
P_VSM_LKA_LateralAcceIn = AUTOSAR4.Parameter(3, SwCalibrationAccess="ReadWrite", StorageClass="Global", MemorySection="CAL", DataType="single")
P_VSM_LKA_SteerWheelSpdInTime = AUTOSAR4.Parameter(3, SwCalibrationAccess="ReadWrite", StorageClass="Global", MemorySection="CAL", DataType="single")
P_VSM_LKA_SteerWheelSpdIn = AUTOSAR4.Parameter(150, SwCalibrationAccess="ReadWrite", StorageClass="Global", MemorySection="CAL", DataType="single")
P_VSM_LKA_DriverInputTrqValueInTime = AUTOSAR4.Parameter(3, SwCalibrationAccess="ReadWrite", StorageClass="Global", MemorySection="CAL", DataType="single")
P_VSM_LKA_SteerWheelAngleInTime = AUTOSAR4.Parameter(3, SwCalibrationAccess="ReadWrite", StorageClass="Global", MemorySection="CAL", DataType="single")
P_VSM_LKA_SteerWheelAngleIn = AUTOSAR4.Parameter(70, SwCalibrationAccess="ReadWrite", StorageClass="Global", MemorySection="CAL", DataType="single")
P_VSM_LKA_LaneCurveIn = AUTOSAR4.Parameter(0.005, SwCalibrationAccess="ReadWrite", StorageClass="Global", MemorySection="CAL", DataType="single")
P_VSM_LKA_AccRateInTime = AUTOSAR4.Parameter(1.5, SwCalibrationAccess="ReadWrite", StorageClass="Global", MemorySection="CAL", DataType="single")
P_VSM_LKA_AccRateOut = AUTOSAR4.Parameter(70, SwCalibrationAccess="ReadWrite", StorageClass="Global", MemorySection="CAL", DataType="single")
P_VSM_LKA_AccRateIn = AUTOSAR4.Parameter(30, SwCalibrationAccess="ReadWrite", StorageClass="Global", MemorySection="CAL", DataType="single")
P_VSM_LKA_DriverInputTrqValueOut = AUTOSAR4.Parameter(2.3, SwCalibrationAccess="ReadWrite", StorageClass="Global", MemorySection="CAL", DataType="single")
P_VSM_LKA_DriverInputTrqValueIn = AUTOSAR4.Parameter(2, SwCalibrationAccess="ReadWrite", StorageClass="Global", MemorySection="CAL", DataType="single")
P_VSM_LKA_State_Param_LaneCurve_Offset = AUTOSAR4.Parameter([0 0.1 0.2 0.3], SwCalibrationAccess="ReadWrite", StorageClass="Global", MemorySection="CAL", DataType="single")
P_VSM_LKA_State_Param_LaneCurve = AUTOSAR4.Parameter([0.001 0.00125 0.00167 0.05], SwCalibrationAccess="ReadWrite", StorageClass="Global", MemorySection="CAL", DataType="single")
P_VSM_LKA_LaneChangeOffset = AUTOSAR4.Parameter(0.11, SwCalibrationAccess="ReadWrite", StorageClass="Global", MemorySection="CAL", DataType="single")
P_VSM_LKA_EndSwitch = AUTOSAR4.Parameter(1, SwCalibrationAccess="ReadWrite", StorageClass="Global", MemorySection="CAL", DataType="boolean")
P_VSM_LKA_State_ESSSts_enable = AUTOSAR4.Parameter(1, SwCalibrationAccess="ReadWrite", StorageClass="Global", MemorySection="CAL", DataType="boolean")
P_VSM_LKA_ELKSW_b = AUTOSAR4.Parameter(0, SwCalibrationAccess="ReadWrite", StorageClass="Global", MemorySection="CAL", DataType="boolean")
P_VSM_LKA_ELKSwtReq_b = AUTOSAR4.Parameter(0, SwCalibrationAccess="ReadWrite", StorageClass="Global", MemorySection="CAL", DataType="boolean")
P_VSM_LKA_LKASwt_b = AUTOSAR4.Parameter(0, SwCalibrationAccess="ReadWrite", StorageClass="Global", MemorySection="CAL", DataType="boolean")
P_VSM_LKA_LKAOnOff_b = AUTOSAR4.Parameter(0, SwCalibrationAccess="ReadWrite", StorageClass="Global", MemorySection="CAL", DataType="boolean")
P_VSM_LKA_OverrideLimValueDiff_Nm = AUTOSAR4.Parameter(1.8, SwCalibrationAccess="ReadWrite", StorageClass="Global", MemorySection="CAL", DataType="single")
P_VSM_LKA_OverrideLimValueSame_Nm = AUTOSAR4.Parameter(2.1, SwCalibrationAccess="ReadWrite", StorageClass="Global", MemorySection="CAL", DataType="single")
P_VSM_LKA_EPSTqVerifyTimeDiff_s = AUTOSAR4.Parameter(0.6, SwCalibrationAccess="ReadWrite", StorageClass="Global", MemorySection="CAL", DataType="single")
P_VSM_LKA_EPSTqVerifyTimeSame_s = AUTOSAR4.Parameter(0.6, SwCalibrationAccess="ReadWrite", StorageClass="Global", MemorySection="CAL", DataType="single")
P_VSM_LKA_OverrideSw_b = AUTOSAR4.Parameter(0, SwCalibrationAccess="ReadWrite", StorageClass="Global", MemorySection="CAL", DataType="boolean")
P_VSM_LKA_WarningKeepTime_s = AUTOSAR4.Parameter(0.5, SwCalibrationAccess="ReadWrite", StorageClass="Global", MemorySection="CAL", DataType="single")
P_VSM_LKA_RiCrossFLW2LeftLineThreValue_m = AUTOSAR4.Parameter(0, SwCalibrationAccess="ReadWrite", StorageClass="Global", MemorySection="CAL", DataType="single")
P_VSM_LKA_RiCrossFRW2LeftLineThreValue_m = AUTOSAR4.Parameter(0, SwCalibrationAccess="ReadWrite", StorageClass="Global", MemorySection="CAL", DataType="single")
P_VSM__LKA_RelieveLaneChangeTime_s = AUTOSAR4.Parameter(0.1, SwCalibrationAccess="ReadWrite", StorageClass="Global", MemorySection="CAL", DataType="single")
P_VSM_LKA_State_TurnLight_enable = AUTOSAR4.Parameter(0, SwCalibrationAccess="ReadWrite", StorageClass="Global", MemorySection="CAL", DataType="single")
P_VSM_LDW_RiCrossFLW2LeftLineThreValue_m = AUTOSAR4.Parameter(0, SwCalibrationAccess="ReadWrite", StorageClass="Global", MemorySection="CAL", DataType="single")
P_VSM_LDW_RiCrossFRW2LeftLineThreValue_m = AUTOSAR4.Parameter(0, SwCalibrationAccess="ReadWrite", StorageClass="Global", MemorySection="CAL", DataType="single")
P_VSM_LKA_RelieveLaneChangeTime_s = AUTOSAR4.Parameter(0.1, SwCalibrationAccess="ReadWrite", StorageClass="Global", MemorySection="CAL", DataType="single")
P_VSM_LKA_MaxLaneInhiTime_s = AUTOSAR4.Parameter(3, SwCalibrationAccess="ReadWrite", StorageClass="Global", MemorySection="CAL", DataType="single")
P_VSM_LKA_LeftCrossFRW2LeftLineThreValue_m = AUTOSAR4.Parameter(0, SwCalibrationAccess="ReadWrite", StorageClass="Global", MemorySection="CAL", DataType="single")
P_VSM_LKA_LeftCrossFLW2RiLineThreValue_m = AUTOSAR4.Parameter(0, SwCalibrationAccess="ReadWrite", StorageClass="Global", MemorySection="CAL", DataType="single")
P_VSM_LKA_VehSpdMinValue_kph = AUTOSAR4.Parameter(60, SwCalibrationAccess="ReadWrite", StorageClass="Global", MemorySection="CAL", DataType="single")
P_VSM_LKA_WarnInterMax_m = AUTOSAR4.Parameter(20, SwCalibrationAccess="ReadWrite", StorageClass="Global", MemorySection="CAL", DataType="single")
P_VSM_LKATime_s = AUTOSAR4.Parameter(0.1, SwCalibrationAccess="ReadWrite", StorageClass="Global", MemorySection="CAL", DataType="single")
P_VSM_LKA_ActiveFgSW_b = AUTOSAR4.Parameter(0, SwCalibrationAccess="ReadWrite", StorageClass="Global", MemorySection="CAL", DataType="boolean")
P_VSM_LKA_ActiveFgDefault_b = AUTOSAR4.Parameter(1, SwCalibrationAccess="ReadWrite", StorageClass="Global", MemorySection="CAL", DataType="boolean")
P_VSM_LKA_tCycle_s = AUTOSAR4.Parameter(0.02, SwCalibrationAccess="ReadWrite", StorageClass="Global", MemorySection="CAL", DataType="single")
P_VSM_LKA_WarnDetectFlagSw_b = AUTOSAR4.Parameter(0, SwCalibrationAccess="ReadWrite", StorageClass="Global", MemorySection="CAL", DataType="boolean")
P_VSM_LKA_WarnDetectFlag_b = AUTOSAR4.Parameter(1, SwCalibrationAccess="ReadWrite", StorageClass="Global", MemorySection="CAL", DataType="boolean")
P_VSM_LKA_LaneInWidth_m = AUTOSAR4.Parameter(2.5, SwCalibrationAccess="ReadWrite", StorageClass="Global", MemorySection="CAL", DataType="single")
P_VSM_LKA_LaneOutWidth_m = AUTOSAR4.Parameter(2.4, SwCalibrationAccess="ReadWrite", StorageClass="Global", MemorySection="CAL", DataType="single")
P_VSM_LKA_State_Inhibit_enable = AUTOSAR4.Parameter(1, SwCalibrationAccess="ReadWrite", StorageClass="Global", MemorySection="CAL", DataType="boolean")
P_VSM_LKA_State_EPSFaultCheck_enable = AUTOSAR4.Parameter(1, SwCalibrationAccess="ReadWrite", StorageClass="Global", MemorySection="CAL", DataType="boolean")
P_VSM_LKA_EPSFaultCheckValue = AUTOSAR4.Parameter(30, SwCalibrationAccess="ReadWrite", StorageClass="Global", MemorySection="CAL", DataType="single")
P_VSM_LKA_EPSFaultCheckCountNum = AUTOSAR4.Parameter(3000, SwCalibrationAccess="ReadWrite", StorageClass="Global", MemorySection="CAL", DataType="single")
P_VSM_LDW_State_Yawsup_enable = AUTOSAR4.Parameter(1, SwCalibrationAccess="ReadWrite", StorageClass="Global", MemorySection="CAL", DataType="single")
P_VSM_LDW_State_Absesp_enable = AUTOSAR4.Parameter(1, SwCalibrationAccess="ReadWrite", StorageClass="Global", MemorySection="CAL", DataType="single")
P_VSM_LDW_State_Headingangle_enable = AUTOSAR4.Parameter(1, SwCalibrationAccess="ReadWrite", StorageClass="Global", MemorySection="CAL", DataType="single")
P_VSM_LDW_State_Failsafe_enable = AUTOSAR4.Parameter(1, SwCalibrationAccess="ReadWrite", StorageClass="Global", MemorySection="CAL", DataType="single")

P_VSM_LDW_State_Lanecurve_enable = AUTOSAR4.Parameter(1, SwCalibrationAccess="ReadWrite", StorageClass="Global", MemorySection="CAL", DataType="single")
P_VSM_LDW_State_Lane_enable = AUTOSAR4.Parameter(1, SwCalibrationAccess="ReadWrite", StorageClass="Global", MemorySection="CAL", DataType="single")
P_VSM_LDW_State_Vehspeed_enable = AUTOSAR4.Parameter(1, SwCalibrationAccess="ReadWrite", StorageClass="Global", MemorySection="CAL", DataType="single")
P_VSM_LDW_State_SteerWheelAngle_enable = AUTOSAR4.Parameter(1, SwCalibrationAccess="ReadWrite", StorageClass="Global", MemorySection="CAL", DataType="single")
P_VSM_LDW_State_DriverInputTrqValue_enable = AUTOSAR4.Parameter(1, SwCalibrationAccess="ReadWrite", StorageClass="Global", MemorySection="CAL", DataType="single")
P_VSM_LDW_State_SteerWheelSpd_enable = AUTOSAR4.Parameter(1, SwCalibrationAccess="ReadWrite", StorageClass="Global", MemorySection="CAL", DataType="single")
P_VSM_LDW_State_LateralAcce_enable = AUTOSAR4.Parameter(1, SwCalibrationAccess="ReadWrite", StorageClass="Global", MemorySection="CAL", DataType="single")
P_VSM_LDW_State_LongitudeAcc_enable = AUTOSAR4.Parameter(1, SwCalibrationAccess="ReadWrite", StorageClass="Global", MemorySection="CAL", DataType="single")
P_VSM_LDW_State_Breakpressure_enable = AUTOSAR4.Parameter(1, SwCalibrationAccess="ReadWrite", StorageClass="Global", MemorySection="CAL", DataType="single")
P_VSM_LDW_State_GEAR_enable = AUTOSAR4.Parameter(1, SwCalibrationAccess="ReadWrite", StorageClass="Global", MemorySection="CAL", DataType="single")
P_VSM_LDW_State_LaneChange_enable = AUTOSAR4.Parameter(1, SwCalibrationAccess="ReadWrite", StorageClass="Global", MemorySection="CAL", DataType="single")
P_VSM_LDW_State_Param_WarningZoneOut = AUTOSAR4.Parameter(-0.65, SwCalibrationAccess="ReadWrite", StorageClass="Global", MemorySection="CAL", DataType="single")
P_VSM_LDW_State_Param_LaneWidth_Offset = AUTOSAR4.Parameter([-0.2 -0.1 0 0.1 0.2 0.3 0.4], SwCalibrationAccess="ReadWrite", StorageClass="Global", MemorySection="CAL", DataType="single")
P_VSM_LDW_State_Param_REWarningZoneIn = AUTOSAR4.Parameter(0.35, SwCalibrationAccess="ReadWrite", StorageClass="Global", MemorySection="CAL", DataType="single")
P_VSM_LDW_State_Param_LaneTime = AUTOSAR4.Parameter(repmat(0.7, 1, 16), SwCalibrationAccess="ReadWrite", StorageClass="Global", MemorySection="CAL", DataType="single")
P_VSM_LDW_State_Accpedalrate_enable = AUTOSAR4.Parameter(1, SwCalibrationAccess="ReadWrite", StorageClass="Global", MemorySection="CAL", DataType="single")
P_VSM_LDW_State_Param_WarningZoneIn = AUTOSAR4.Parameter(0.35, SwCalibrationAccess="ReadWrite", StorageClass="Global", MemorySection="CAL", DataType="single")
P_VSM_LDW_State_Param_Sensitive_Offset = AUTOSAR4.Parameter([0 0.05 -0.2], SwCalibrationAccess="ReadWrite", StorageClass="Global", MemorySection="CAL", DataType="single")
P_VSM_LDW_AccRateOutTime = AUTOSAR4.Parameter(0, SwCalibrationAccess="ReadWrite", StorageClass="Global", MemorySection="CAL", DataType="single")
P_VSM_LDW_LaneCurveOut = AUTOSAR4.Parameter(0.006, SwCalibrationAccess="ReadWrite", StorageClass="Global", MemorySection="CAL", DataType="single")
P_VSM_LDW_YawRateOut = AUTOSAR4.Parameter(0.25, SwCalibrationAccess="ReadWrite", StorageClass="Global", MemorySection="CAL", DataType="single")
P_VSM_LDW_BrakePressOut = AUTOSAR4.Parameter(5, SwCalibrationAccess="ReadWrite", StorageClass="Global", MemorySection="CAL", DataType="single")
P_VSM_LDW_absLongitudeAccOut = AUTOSAR4.Parameter(3, SwCalibrationAccess="ReadWrite", StorageClass="Global", MemorySection="CAL", DataType="single")
P_VSM_LDW_LongitudeAccOut = AUTOSAR4.Parameter(3.5, SwCalibrationAccess="ReadWrite", StorageClass="Global", MemorySection="CAL", DataType="single")
P_VSM_LDW_LateralAcceOut = AUTOSAR4.Parameter(3.5, SwCalibrationAccess="ReadWrite", StorageClass="Global", MemorySection="CAL", DataType="single")
P_VSM_LDW_SteerWheelSpdOut = AUTOSAR4.Parameter(200, SwCalibrationAccess="ReadWrite", StorageClass="Global", MemorySection="CAL", DataType="single")
P_VSM_LDW_SteerWheelAngleOut = AUTOSAR4.Parameter(90, SwCalibrationAccess="ReadWrite", StorageClass="Global", MemorySection="CAL", DataType="single")
P_VSM_LDW_WhelDy = AUTOSAR4.Parameter(2, SwCalibrationAccess="ReadWrite", StorageClass="Global", MemorySection="CAL", DataType="single")
P_VSM_LDW_TurnLightInTime = AUTOSAR4.Parameter(3, SwCalibrationAccess="ReadWrite", StorageClass="Global", MemorySection="CAL", DataType="single")
P_VSM_LDW_BrakePressInTime = AUTOSAR4.Parameter(1.5, SwCalibrationAccess="ReadWrite", StorageClass="Global", MemorySection="CAL", DataType="single")
P_VSM_LDW_BrakePressIn = AUTOSAR4.Parameter(3, SwCalibrationAccess="ReadWrite", StorageClass="Global", MemorySection="CAL", DataType="single")
P_VSM_LDW_LongitudeAccInTime = AUTOSAR4.Parameter(3, SwCalibrationAccess="ReadWrite", StorageClass="Global", MemorySection="CAL", DataType="single")
P_VSM_LDW_absLongitudeAccIn = AUTOSAR4.Parameter(2.5, SwCalibrationAccess="ReadWrite", StorageClass="Global", MemorySection="CAL", DataType="single")
P_VSM_LDW_LongitudeAccIn = AUTOSAR4.Parameter(3, SwCalibrationAccess="ReadWrite", StorageClass="Global", MemorySection="CAL", DataType="single")
P_VSM_LDW_LateralAcceInTime = AUTOSAR4.Parameter(3, SwCalibrationAccess="ReadWrite", StorageClass="Global", MemorySection="CAL", DataType="single")
P_VSM_LDW_LateralAcceIn = AUTOSAR4.Parameter(3, SwCalibrationAccess="ReadWrite", StorageClass="Global", MemorySection="CAL", DataType="single")
P_VSM_LDW_SteerWheelSpdInTime = AUTOSAR4.Parameter(3, SwCalibrationAccess="ReadWrite", StorageClass="Global", MemorySection="CAL", DataType="single")
P_VSM_LDW_SteerWheelSpdIn = AUTOSAR4.Parameter(150, SwCalibrationAccess="ReadWrite", StorageClass="Global", MemorySection="CAL", DataType="single")
P_VSM_LDW_SteerWheelAngleInTime = AUTOSAR4.Parameter(3, SwCalibrationAccess="ReadWrite", StorageClass="Global", MemorySection="CAL", DataType="single")
P_VSM_LDW_SteerWheelAngleIn = AUTOSAR4.Parameter(70, SwCalibrationAccess="ReadWrite", StorageClass="Global", MemorySection="CAL", DataType="single")
P_VSM_LDW_LaneCurveIn = AUTOSAR4.Parameter(0.005, SwCalibrationAccess="ReadWrite", StorageClass="Global", MemorySection="CAL", DataType="single")
P_VSM_LDW_AbsEspInTime = AUTOSAR4.Parameter(3, SwCalibrationAccess="ReadWrite", StorageClass="Global", MemorySection="CAL", DataType="single")
P_VSM_LDW_YawRateInTime = AUTOSAR4.Parameter(1, SwCalibrationAccess="ReadWrite", StorageClass="Global", MemorySection="CAL", DataType="single")
P_VSM_LDW_YawRateIn = AUTOSAR4.Parameter(0.2, SwCalibrationAccess="ReadWrite", StorageClass="Global", MemorySection="CAL", DataType="single")
P_VSM_LDW_AccRateInTime = AUTOSAR4.Parameter(1.5, SwCalibrationAccess="ReadWrite", StorageClass="Global", MemorySection="CAL", DataType="single")
P_VSM_LDW_AccRateIn = AUTOSAR4.Parameter(30, SwCalibrationAccess="ReadWrite", StorageClass="Global", MemorySection="CAL", DataType="single")
P_VSM_LDW_AccRateOut = AUTOSAR4.Parameter(80, SwCalibrationAccess="ReadWrite", StorageClass="Global", MemorySection="CAL", DataType="single")
P_VSM_LDW_LaneChangeOffset = AUTOSAR4.Parameter(0.11, SwCalibrationAccess="ReadWrite", StorageClass="Global", MemorySection="CAL", DataType="single")
P_VSM_LDW_AccPedalOut = AUTOSAR4.Parameter(30, SwCalibrationAccess="ReadWrite", StorageClass="Global", MemorySection="CAL", DataType="single")
P_VSM_LDW_State_ESSSts_enable = AUTOSAR4.Parameter(1, SwCalibrationAccess="ReadWrite", StorageClass="Global", MemorySection="CAL", DataType="boolean")
P_VSM_LDW_LDWSwt_b = AUTOSAR4.Parameter(0, SwCalibrationAccess="ReadWrite", StorageClass="Global", MemorySection="CAL", DataType="boolean")
P_VSM_LDW_LDWOnOff_b = AUTOSAR4.Parameter(0, SwCalibrationAccess="ReadWrite", StorageClass="Global", MemorySection="CAL", DataType="boolean")
P_VSM_LDWArea_m = AUTOSAR4.Parameter(0.05, SwCalibrationAccess="ReadWrite", StorageClass="Global", MemorySection="CAL", DataType="single")
P_VSM_LDW_State_TurnLight_enable = AUTOSAR4.Parameter(0, SwCalibrationAccess="ReadWrite", StorageClass="Global", MemorySection="CAL", DataType="single")
P_VSM_LDW_RiCrossFLW2RiLineThreValue_m = AUTOSAR4.Parameter(0, SwCalibrationAccess="ReadWrite", StorageClass="Global", MemorySection="CAL", DataType="single")
P_VSM_LDW_VehSpdMinValue_kph = AUTOSAR4.Parameter(60, SwCalibrationAccess="ReadWrite", StorageClass="Global", MemorySection="CAL", DataType="single")
P_VSM_LDW_WarnInterMax_m = AUTOSAR4.Parameter(20, SwCalibrationAccess="ReadWrite", StorageClass="Global", MemorySection="CAL", DataType="single")
P_VSM_LDWTime_s = AUTOSAR4.Parameter(0.1, SwCalibrationAccess="ReadWrite", StorageClass="Global", MemorySection="CAL", DataType="single")
P_VSM_LDW_LeftCrossFRW2RiLineThreValue_m = AUTOSAR4.Parameter(0, SwCalibrationAccess="ReadWrite", StorageClass="Global", MemorySection="CAL", DataType="single")
P_VSM_LDW_LeftCrossFLW2RiLineThreValue_m = AUTOSAR4.Parameter(0, SwCalibrationAccess="ReadWrite", StorageClass="Global", MemorySection="CAL", DataType="single")
P_VSM_RelieveLaneChangeTime_s = AUTOSAR4.Parameter(0.1, SwCalibrationAccess="ReadWrite", StorageClass="Global", MemorySection="CAL", DataType="single")
P_VSM_LDW_tCycle_s = AUTOSAR4.Parameter(0.02, SwCalibrationAccess="ReadWrite", StorageClass="Global", MemorySection="CAL", DataType="single")
P_VSM_LDW_MaxLaneInhiTime_s = AUTOSAR4.Parameter(3, SwCalibrationAccess="ReadWrite", StorageClass="Global", MemorySection="CAL", DataType="single")
P_VSM_LDW_State_Inhibit_enable = AUTOSAR4.Parameter(1, SwCalibrationAccess="ReadWrite", StorageClass="Global", MemorySection="CAL", DataType="boolean")
P_VSM_ACC_BOMEntry_AxvRefMs2 = AUTOSAR4.Parameter(-0.5, SwCalibrationAccess="ReadWrite", StorageClass="Global", MemorySection="CAL", DataType="single", Min=-2, Max=0)
P_VSM_ACC_BOMEntry_ACCDecReqValue = AUTOSAR4.Parameter(-0.5, SwCalibrationAccess="ReadWrite", StorageClass="Global", MemorySection="CAL", DataType="single", Min=-2, Max=0)
P_VSM_ACC_BOMExit_ACCDecReqValue = AUTOSAR4.Parameter(-0.3, SwCalibrationAccess="ReadWrite", StorageClass="Global", MemorySection="CAL", DataType="single", Min=-2, Max=0)
P_VSM_ACCExit_StandWaitTime = AUTOSAR4.Parameter(180, SwCalibrationAccess="ReadWrite", StorageClass="Global", MemorySection="CAL", DataType="uint16", Min=0, Max=1000, Unit="<S>")
P_VSM_ACC_BrakeOnlyNum = AUTOSAR4.Parameter(500, SwCalibrationAccess="ReadWrite", StorageClass="Global", MemorySection="CAL", DataType="uint16", Min=0, Max=600, Unit="num")
P_VSM_TJA_ActiveWaitNum = AUTOSAR4.Parameter(3000, SwCalibrationAccess="ReadWrite", StorageClass="Global", MemorySection="CAL", DataType="uint16", Min=0, Max=3000, Unit="num")
P_VSM_ACCExit_AccOverride = AUTOSAR4.Parameter(900, SwCalibrationAccess="ReadWrite", StorageClass="Global", MemorySection="CAL", DataType="uint16", Min=0, Max=1000, Unit="s")
P_VSM_ACC_StandActiveNumACCMode = AUTOSAR4.Parameter(1500, SwCalibrationAccess="ReadWrite", StorageClass="Global", MemorySection="CAL", DataType="uint16", Min=0, Max=9000, Unit="num")
P_VSM_ACC_StandActiveNumHWAMode = AUTOSAR4.Parameter(1500, SwCalibrationAccess="ReadWrite", StorageClass="Global", MemorySection="CAL", DataType="uint16", Min=0, Max=9000, Unit="num")
P_VSM_ACC_RadarOffset = AUTOSAR4.Parameter(0.5, SwCalibrationAccess="ReadWrite", StorageClass="Global", MemorySection="CAL", DataType="single")
P_VSM_PassSBRSpdIPLimt = AUTOSAR4.Parameter(31, SwCalibrationAccess="ReadWrite", StorageClass="Global", MemorySection="CAL", DataType="uint8")
P_VSM_ACC_AutoGoSW = AUTOSAR4.Parameter(0, SwCalibrationAccess="ReadWrite", StorageClass="Global", MemorySection="CAL", DataType="boolean")
P_VSM_LSMC_SampleTime = AUTOSAR4.Parameter(0.02, SwCalibrationAccess="ReadWrite", StorageClass="Global", MemorySection="CAL", DataType="single")
P_VSM_LSSWarnFormSwtReq = AUTOSAR4.Parameter(false, SwCalibrationAccess="ReadWrite", StorageClass="Global", MemorySection="CAL", DataType="boolean")
P_VSM_LKASwtReq = AUTOSAR4.Parameter(false, SwCalibrationAccess="ReadWrite", StorageClass="Global", MemorySection="CAL", DataType="boolean")
P_VSM_LCKSwtReq = AUTOSAR4.Parameter(false, SwCalibrationAccess="ReadWrite", StorageClass="Global", MemorySection="CAL", DataType="boolean")
P_VSM_ELKSwtReq = AUTOSAR4.Parameter(false, SwCalibrationAccess="ReadWrite", StorageClass="Global", MemorySection="CAL", DataType="boolean")
P_VSM_ISLSwtReq = AUTOSAR4.Parameter(false, SwCalibrationAccess="ReadWrite", StorageClass="Global", MemorySection="CAL", DataType="boolean")
P_VSM_LSSSwtReq = AUTOSAR4.Parameter(false, SwCalibrationAccess="ReadWrite", StorageClass="Global", MemorySection="CAL", DataType="boolean")
P_VSM_AESSwtReq = AUTOSAR4.Parameter(false, SwCalibrationAccess="ReadWrite", StorageClass="Global", MemorySection="CAL", DataType="boolean")
P_VSM_HWASwtReq = AUTOSAR4.Parameter(false, SwCalibrationAccess="ReadWrite", StorageClass="Global", MemorySection="CAL", DataType="boolean")
P_VSM_ALCSwtReq = AUTOSAR4.Parameter(false, SwCalibrationAccess="ReadWrite", StorageClass="Global", MemorySection="CAL", DataType="boolean")
P_VSM_LDWSwtReq = AUTOSAR4.Parameter(false, SwCalibrationAccess="ReadWrite", StorageClass="Global", MemorySection="CAL", DataType="boolean")
P_VSM_TSRSwtReq = AUTOSAR4.Parameter(false, SwCalibrationAccess="ReadWrite", StorageClass="Global", MemorySection="CAL", DataType="boolean")
P_VSM_TSRWarnSwtReq = AUTOSAR4.Parameter(false, SwCalibrationAccess="ReadWrite", StorageClass="Global", MemorySection="CAL", DataType="boolean")
P_VSM_ICA_HandsOffSwtReq = AUTOSAR4.Parameter(false, SwCalibrationAccess="ReadWrite", StorageClass="Global", MemorySection="CAL", DataType="boolean")
P_VSM_ESSPedSwtReq = AUTOSAR4.Parameter(false, SwCalibrationAccess="ReadWrite", StorageClass="Global", MemorySection="CAL", DataType="boolean")
P_VSM_ESS_VehSwtReq = AUTOSAR4.Parameter(false, SwCalibrationAccess="ReadWrite", StorageClass="Global", MemorySection="CAL", DataType="boolean")
P_VSM_IntelligentEvaSwtReq = AUTOSAR4.Parameter(false, SwCalibrationAccess="ReadWrite", StorageClass="Global", MemorySection="CAL", DataType="boolean")
P_VSM_NOH_Act_Req = AUTOSAR4.Parameter(false, SwCalibrationAccess="ReadWrite", StorageClass="Global", MemorySection="CAL", DataType="boolean")
P_VSM_NOH_Swt_Req = AUTOSAR4.Parameter(false, SwCalibrationAccess="ReadWrite", StorageClass="Global", MemorySection="CAL", DataType="boolean")
P_VSM_DHT_V51V61_BeamSts = AUTOSAR4.Parameter(1, SwCalibrationAccess="ReadWrite", StorageClass="Global", MemorySection="CAL", DataType="boolean")
P_VSM_ESS_SafeDistance_m = AUTOSAR4.Parameter(1.5, SwCalibrationAccess="ReadWrite", StorageClass="Global", MemorySection="CAL", DataType="single")
P_VSM_ESS_SpdPoint_kmh = AUTOSAR4.Parameter([50 60 70 80 90 100], SwCalibrationAccess="ReadWrite", StorageClass="Global", MemorySection="CAL", DataType="single")
P_VSM_ESS_SpdTime_s = AUTOSAR4.Parameter([0.2 0.25 0.35 0.4 0.45 0.5], SwCalibrationAccess="ReadWrite", StorageClass="Global", MemorySection="CAL", DataType="single")
P_VSM_ESS_DangerPlausLeft = AUTOSAR4.Parameter(0.3, SwCalibrationAccess="ReadWrite", StorageClass="Global", MemorySection="CAL", DataType="single")
P_VSM_ESS_DangerPlausRight = AUTOSAR4.Parameter(0.3, SwCalibrationAccess="ReadWrite", StorageClass="Global", MemorySection="CAL", DataType="single")
P_VSM_ESS_Vehspeed_enable = AUTOSAR4.Parameter(1, SwCalibrationAccess="ReadWrite", StorageClass="Global", MemorySection="CAL", DataType="boolean")
P_VSM_ESS_ESPFuncOffSts_enable = AUTOSAR4.Parameter(1, SwCalibrationAccess="ReadWrite", StorageClass="Global", MemorySection="CAL", DataType="boolean")
P_VSM_ESS_DoorSts_enable = AUTOSAR4.Parameter(1, SwCalibrationAccess="ReadWrite", StorageClass="Global", MemorySection="CAL", DataType="boolean")
P_VSM_ESS_DrvSBR_enable = AUTOSAR4.Parameter(1, SwCalibrationAccess="ReadWrite", StorageClass="Global", MemorySection="CAL", DataType="boolean")
P_VSM_ESS_TrailerSts_enable = AUTOSAR4.Parameter(1, SwCalibrationAccess="ReadWrite", StorageClass="Global", MemorySection="CAL", DataType="boolean")
P_VSM_ESS_WiprReq_enable = AUTOSAR4.Parameter(1, SwCalibrationAccess="ReadWrite", StorageClass="Global", MemorySection="CAL", DataType="boolean")
P_VSM_ESS_HiLoBeam_enable = AUTOSAR4.Parameter(1, SwCalibrationAccess="ReadWrite", StorageClass="Global", MemorySection="CAL", DataType="boolean")
P_VSM_ESS_ESPActive_enable = AUTOSAR4.Parameter(1, SwCalibrationAccess="ReadWrite", StorageClass="Global", MemorySection="CAL", DataType="boolean")
P_VSM_ESS_LateralAccel_enable = AUTOSAR4.Parameter(1, SwCalibrationAccess="ReadWrite", StorageClass="Global", MemorySection="CAL", DataType="boolean")
P_VSM_ESS_SteerWheelSpd_enable = AUTOSAR4.Parameter(1, SwCalibrationAccess="ReadWrite", StorageClass="Global", MemorySection="CAL", DataType="boolean")
P_VSM_ESS_AccelPed_enable = AUTOSAR4.Parameter(1, SwCalibrationAccess="ReadWrite", StorageClass="Global", MemorySection="CAL", DataType="boolean")
P_VSM_ESS_VehLgtAccel_enable = AUTOSAR4.Parameter(1, SwCalibrationAccess="ReadWrite", StorageClass="Global", MemorySection="CAL", DataType="boolean")
P_VSM_ESS_FcwSw_enable = AUTOSAR4.Parameter(1, SwCalibrationAccess="ReadWrite", StorageClass="Global", MemorySection="CAL", DataType="boolean")
P_VSM_ESS_FcwDisFlag_enable = AUTOSAR4.Parameter(1, SwCalibrationAccess="ReadWrite", StorageClass="Global", MemorySection="CAL", DataType="boolean")
P_VSM_ESS_AEBFlag_enable = AUTOSAR4.Parameter(1, SwCalibrationAccess="ReadWrite", StorageClass="Global", MemorySection="CAL", DataType="boolean")
P_VSM_ESS_MaxLateral_mss = AUTOSAR4.Parameter([10 9 8 7 6 5], SwCalibrationAccess="ReadWrite", StorageClass="Global", MemorySection="CAL", DataType="single")
P_VSM_ESS_IPSpeed_kmh = AUTOSAR4.Parameter([50 60 70 80 90 100], SwCalibrationAccess="ReadWrite", StorageClass="Global", MemorySection="CAL", DataType="single")
P_VSM_ESS_AccPedlPosn_Param = AUTOSAR4.Parameter(60, SwCalibrationAccess="ReadWrite", StorageClass="Global", MemorySection="CAL", DataType="single")
P_VSM_ESS_StopA0_Param = AUTOSAR4.Parameter(0.2, SwCalibrationAccess="ReadWrite", StorageClass="Global", MemorySection="CAL", DataType="single")
P_VSM_ESS_StopA1Time_Param = AUTOSAR4.Parameter(2, SwCalibrationAccess="ReadWrite", StorageClass="Global", MemorySection="CAL", DataType="single")
P_VSM_ESS_AngleSpdTable_deg = AUTOSAR4.Parameter([65 60 55 45 35 25], SwCalibrationAccess="ReadWrite", StorageClass="Global", MemorySection="CAL", DataType="single")
P_VSM_ESS_ACtiveTime = AUTOSAR4.Parameter(5, SwCalibrationAccess="ReadWrite", StorageClass="Global", MemorySection="CAL", DataType="single")
P_VSM_ESS_MasterCylindBrake = AUTOSAR4.Parameter(5, SwCalibrationAccess="ReadWrite", StorageClass="Global", MemorySection="CAL", DataType="single")
P_VSM_ESS_LgtAccelUpper_Param = AUTOSAR4.Parameter(3, SwCalibrationAccess="ReadWrite", StorageClass="Global", MemorySection="CAL", DataType="single")
P_VSM_ESS_LgtAccelLower_Param = AUTOSAR4.Parameter(-8, SwCalibrationAccess="ReadWrite", StorageClass="Global", MemorySection="CAL", DataType="single")
P_VSM_ESS_StopA1_Param = AUTOSAR4.Parameter(0.02, SwCalibrationAccess="ReadWrite", StorageClass="Global", MemorySection="CAL", DataType="single")
P_VSM_ESS_Ready2ACtiveTime = AUTOSAR4.Parameter(5, SwCalibrationAccess="ReadWrite", StorageClass="Global", MemorySection="CAL", DataType="single")
P_VSM_ESS_DelayTime = AUTOSAR4.Parameter(3, SwCalibrationAccess="ReadWrite", StorageClass="Global", MemorySection="CAL", DataType="single")
P_VSM_ESS_SteerWheelSpd_Param = AUTOSAR4.Parameter(repmat(100, 1, 6), SwCalibrationAccess="ReadWrite", StorageClass="Global", MemorySection="CAL", DataType="single")
P_VSM_ESS_OVERRIDE_SW = AUTOSAR4.Parameter(0, SwCalibrationAccess="ReadWrite", StorageClass="Global", MemorySection="CAL", DataType="boolean")
P_VSM_ESS_DriveIn_BP = AUTOSAR4.Parameter([50 60 70 80 90 100], SwCalibrationAccess="ReadWrite", StorageClass="Global", MemorySection="CAL", DataType="single")
P_VSM_ESS_DriverInputdSameDire_delaytime = AUTOSAR4.Parameter(1, SwCalibrationAccess="ReadWrite", StorageClass="Global", MemorySection="CAL", DataType="single")
P_VSM_ESS_DrvOverTime_Paramsame = AUTOSAR4.Parameter(0.2, SwCalibrationAccess="ReadWrite", StorageClass="Global", MemorySection="CAL", DataType="single")
P_VSM_ESS_DrvOverTime_Param = AUTOSAR4.Parameter(0.2, SwCalibrationAccess="ReadWrite", StorageClass="Global", MemorySection="CAL", DataType="single")
P_VSM_ESS_DriverInputTrq_Param = AUTOSAR4.Parameter(repmat(1.5, 1, 6), SwCalibrationAccess="ReadWrite", StorageClass="Global", MemorySection="CAL", DataType="single")
P_VSM_ESS_DriveIn = AUTOSAR4.Parameter(repmat(2.5, 1, 6), SwCalibrationAccess="ReadWrite", StorageClass="Global", MemorySection="CAL", DataType="single")
P_VSM_ESS_StopA0Time_Param = AUTOSAR4.Parameter(2, SwCalibrationAccess="ReadWrite", StorageClass="Global", MemorySection="CAL", DataType="single")
P_VSM_ESS_SteerWheelSpd_BP = AUTOSAR4.Parameter([60 80 90 100 110 120], SwCalibrationAccess="ReadWrite", StorageClass="Global", MemorySection="CAL", DataType="single")
P_VSM_HMI_HWASYS2 = AUTOSAR4.Parameter(0, SwCalibrationAccess="ReadWrite", StorageClass="Global", MemorySection="CAL", DataType="uint8")
P_VSM_HMI_HWASYS1 = AUTOSAR4.Parameter(0, SwCalibrationAccess="ReadWrite", StorageClass="Global", MemorySection="CAL", DataType="uint8")
P_VSM_HMI_Curve = AUTOSAR4.Parameter(0.003, SwCalibrationAccess="ReadWrite", StorageClass="Global", MemorySection="CAL", DataType="single")
P_VSM_HMI_CurveTime = AUTOSAR4.Parameter(0.1, SwCalibrationAccess="ReadWrite", StorageClass="Global", MemorySection="CAL", DataType="single")
P_VSM_HOD_HandsOn_Tr = AUTOSAR4.Parameter(0.35, SwCalibrationAccess="ReadWrite", StorageClass="Global", MemorySection="CAL", DataType="single")
P_VSM_HOD_HandsOff_Tr = AUTOSAR4.Parameter(0.23, SwCalibrationAccess="ReadWrite", StorageClass="Global", MemorySection="CAL", DataType="single")
P_VSM_HOD_Handson_TrqInsertPoint = AUTOSAR4.Parameter([0.26 0.5 0.9 1.1 1.5], SwCalibrationAccess="ReadWrite", StorageClass="Global", MemorySection="CAL", DataType="single")
P_VSM_HOD_Handson_TimeInsertPoint = AUTOSAR4.Parameter([0.1 0.08 0.05 0.02 0], SwCalibrationAccess="ReadWrite", StorageClass="Global", MemorySection="CAL", DataType="single")
P_VSM_HOD_DrvTrqFlterTIme = AUTOSAR4.Parameter(0.5, SwCalibrationAccess="ReadWrite", StorageClass="Global", MemorySection="CAL", DataType="single")
P_VSM_HOD_HWA_HandsOffLev1TimeCnt = AUTOSAR4.Parameter(3000, SwCalibrationAccess="ReadWrite", StorageClass="Global", MemorySection="CAL", DataType="single")
P_VSM_HOD_HWA_HandsOffLev2TimeCnt = AUTOSAR4.Parameter(3150, SwCalibrationAccess="ReadWrite", StorageClass="Global", MemorySection="CAL", DataType="single")
P_VSM_HOD_HWA_HandsOffLev3TimeCnt = AUTOSAR4.Parameter(3350, SwCalibrationAccess="ReadWrite", StorageClass="Global", MemorySection="CAL", DataType="single")
P_VSM_HOD_HWA_HandsOffLev4TimeCnt = AUTOSAR4.Parameter(3600, SwCalibrationAccess="ReadWrite", StorageClass="Global", MemorySection="CAL", DataType="single")
P_VSM_HOD_LCKTJA_HandsOffLev1TimeCnt = AUTOSAR4.Parameter(3000, SwCalibrationAccess="ReadWrite", StorageClass="Global", MemorySection="CAL", DataType="single")
P_VSM_HOD_LCKTJA_HandsOffLev2TimeCnt = AUTOSAR4.Parameter(3150, SwCalibrationAccess="ReadWrite", StorageClass="Global", MemorySection="CAL", DataType="single")
P_VSM_HOD_LCKTJA_HandsOffLev3TimeCnt = AUTOSAR4.Parameter(3350, SwCalibrationAccess="ReadWrite", StorageClass="Global", MemorySection="CAL", DataType="single")
P_VSM_HOD_LCKTJA_HandsOffLev4TimeCnt = AUTOSAR4.Parameter(3600, SwCalibrationAccess="ReadWrite", StorageClass="Global", MemorySection="CAL", DataType="single")
P_VSM_HWA_EHR_Enable = AUTOSAR4.Parameter(0, SwCalibrationAccess="ReadWrite", StorageClass="Global", MemorySection="CAL", DataType="boolean")  % EHR使能开关
P_VSM_HWA_AutoLC_Spd_low_kph = AUTOSAR4.Parameter(56, SwCalibrationAccess="ReadWrite", StorageClass="Global", MemorySection="CAL", DataType="single")  % HWA auto lanechane vehSpeed
P_VSM_HWAActivation_Spd_Up = AUTOSAR4.Parameter(120, SwCalibrationAccess="ReadWrite", StorageClass="Global", MemorySection="CAL", DataType="single")
P_VSM_ALC_vMinPreLC_Drv = AUTOSAR4.Parameter(40, SwCalibrationAccess="ReadWrite", StorageClass="Global", MemorySection="CAL", DataType="single")
P_VSM_HWA_ALCStsSW = AUTOSAR4.Parameter(true, SwCalibrationAccess="ReadWrite", StorageClass="Global", MemorySection="CAL", DataType="boolean")
P_VSM_HWASlowExit_SingleLineLostDuring = AUTOSAR4.Parameter(3, SwCalibrationAccess="ReadWrite", StorageClass="Global", MemorySection="CAL", DataType="uint8")
P_VSM_HWAActivation_NOAMOd_Spd = AUTOSAR4.Parameter(5, SwCalibrationAccess="ReadWrite", StorageClass="Global", MemorySection="CAL", DataType="single")
P_VSM_HWAActivation_Spd_Low = AUTOSAR4.Parameter(5, SwCalibrationAccess="ReadWrite", StorageClass="Global", MemorySection="CAL", DataType="single")
P_VSM_NOH_PilotSelc_SW = AUTOSAR4.Parameter(0, SwCalibrationAccess="ReadWrite", StorageClass="Global", MemorySection="CAL", DataType="uint8")
P_VSM_TimeGapHMI_SW = AUTOSAR4.Parameter(0, SwCalibrationAccess="ReadWrite", StorageClass="Global", MemorySection="CAL", DataType="boolean")
P_VSM_TJA_PassSBRSpdExistSlow = AUTOSAR4.Parameter(30, SwCalibrationAccess="ReadWrite", StorageClass="Global", MemorySection="CAL", DataType="uint8")
P_VSM_NOH_Swt_Req_SW = AUTOSAR4.Parameter(0, SwCalibrationAccess="ReadWrite", StorageClass="Global", MemorySection="CAL", DataType="boolean")
P_VSM_SOSSpdLimit = AUTOSAR4.Parameter(0, SwCalibrationAccess="ReadWrite", StorageClass="Global", MemorySection="CAL", DataType="single")
P_VSM_SOSContinueTime = AUTOSAR4.Parameter(3000, SwCalibrationAccess="ReadWrite", StorageClass="Global", MemorySection="CAL", DataType="uint16")
P_VSM_HWA_DMS_Enable = AUTOSAR4.Parameter(0, SwCalibrationAccess="ReadWrite", StorageClass="Global", MemorySection="CAL", DataType="boolean")  % 驾驶员状态使能开关
P_VSM_SafeStopNumCount = AUTOSAR4.Parameter(250, SwCalibrationAccess="ReadWrite", StorageClass="Global", MemorySection="CAL", DataType="uint16")
P_VSM_ISL_TimeTakeOver = AUTOSAR4.Parameter(30, SwCalibrationAccess="ReadWrite", StorageClass="Global", MemorySection="CAL", DataType="uint8", Unit="s")
P_VSM_ISL_SLW_Warning_Time = AUTOSAR4.Parameter(10, SwCalibrationAccess="ReadWrite", StorageClass="Global", MemorySection="CAL", DataType="uint8")
P_VSM_ISL_TimeInformDis = AUTOSAR4.Parameter(6, SwCalibrationAccess="ReadWrite", StorageClass="Global", MemorySection="CAL", DataType="uint8", Min=1, Max=255, Unit="s")
P_VSM_ISL_AutoSpPpercentage = AUTOSAR4.Parameter(0.1, SwCalibrationAccess="ReadWrite", StorageClass="Global", MemorySection="CAL", DataType="single")  % 0-1表示0-100%
P_VSM_ISL_SpdUPmaxDiff = AUTOSAR4.Parameter(25, SwCalibrationAccess="ReadWrite", StorageClass="Global", MemorySection="CAL", DataType="uint8")  % 增加Spd最大增量
P_VSM_ISL_SpdUPminDiff = AUTOSAR4.Parameter(10, SwCalibrationAccess="ReadWrite", StorageClass="Global", MemorySection="CAL", DataType="uint8")  % 增加setspd 最小限速增加量
P_VSM_ISL_SpdDOWNmaxDiff = AUTOSAR4.Parameter(50, SwCalibrationAccess="ReadWrite", StorageClass="Global", MemorySection="CAL", DataType="uint8")  % 减小setspd最大减小量
P_VSM_LDW_State_Param_Speed = AUTOSAR4.Parameter([0 5 10 15 20 25 30 35 40 60 70 80 90 100 120 140], SwCalibrationAccess="ReadWrite", StorageClass="Global", MemorySection="CAL", DataType="single")
P_VSM_SCM_LKALaneWidthMinValue_m = AUTOSAR4.Parameter(4, SwCalibrationAccess="ReadWrite", StorageClass="Global", MemorySection="CAL", DataType="single")
P_VSM_SCM_LKALaneWidthMaxValue_m = AUTOSAR4.Parameter(4.5, SwCalibrationAccess="ReadWrite", StorageClass="Global", MemorySection="CAL", DataType="single")
P_VSM_SCM_CenterLineSw_b = AUTOSAR4.Parameter(0, SwCalibrationAccess="ReadWrite", StorageClass="Global", MemorySection="CAL", DataType="boolean")
P_VSM_SCM_Dis2LineThreValue_m = AUTOSAR4.Parameter(2.75, SwCalibrationAccess="ReadWrite", StorageClass="Global", MemorySection="CAL", DataType="single")
P_VSM_SCM_LeftReValidSW_b = AUTOSAR4.Parameter(1, SwCalibrationAccess="ReadWrite", StorageClass="Global", MemorySection="CAL", DataType="boolean")
P_VSM_SCM_LeftReValid_b = AUTOSAR4.Parameter(0, SwCalibrationAccess="ReadWrite", StorageClass="Global", MemorySection="CAL", DataType="boolean")
P_VSM_SCM_RightReValidSW_b = AUTOSAR4.Parameter(1, SwCalibrationAccess="ReadWrite", StorageClass="Global", MemorySection="CAL", DataType="boolean")
P_VSM_SCM_RightReValid_b = AUTOSAR4.Parameter(0, SwCalibrationAccess="ReadWrite", StorageClass="Global", MemorySection="CAL", DataType="boolean")
P_VSM_SCM_SignalSW_b = AUTOSAR4.Parameter(1, SwCalibrationAccess="ReadWrite", StorageClass="Global", MemorySection="CAL", DataType="single")
P_VSM_SCM_LeftChangenewSW_b = AUTOSAR4.Parameter(0, SwCalibrationAccess="ReadWrite", StorageClass="Global", MemorySection="CAL", DataType="boolean")
P_VSM_SCM_LeftChangenewInibit_b = AUTOSAR4.Parameter(0, SwCalibrationAccess="ReadWrite", StorageClass="Global", MemorySection="CAL", DataType="boolean")
P_VSM_SCM_RightChangenewSW_b = AUTOSAR4.Parameter(0, SwCalibrationAccess="ReadWrite", StorageClass="Global", MemorySection="CAL", DataType="boolean")
P_VSM_SCM_RightChangenewInibit_b = AUTOSAR4.Parameter(0, SwCalibrationAccess="ReadWrite", StorageClass="Global", MemorySection="CAL", DataType="boolean")
P_VSM_SCM_State_Param_Offset = AUTOSAR4.Parameter(2, SwCalibrationAccess="ReadWrite", StorageClass="Global", MemorySection="CAL", DataType="single")
P_VSM_SCM_HeadingAngleInValue_deg = AUTOSAR4.Parameter(3.5, SwCalibrationAccess="ReadWrite", StorageClass="Global", MemorySection="CAL", DataType="single")
P_VSM_SCM_HeadingAngleOutValue_deg = AUTOSAR4.Parameter(5, SwCalibrationAccess="ReadWrite", StorageClass="Global", MemorySection="CAL", DataType="single")
P_VSM_SCM_LineLostTime_s = AUTOSAR4.Parameter(0.2, SwCalibrationAccess="ReadWrite", StorageClass="Global", MemorySection="CAL", DataType="single")
P_VSM_SetSpdSlopLimIncStep = AUTOSAR4.Parameter(100, SwCalibrationAccess="ReadWrite", StorageClass="Global", MemorySection="CAL", DataType="single")
P_VSM_SetSpdSlopLimDecStep = AUTOSAR4.Parameter(-0.1, SwCalibrationAccess="ReadWrite", StorageClass="Global", MemorySection="CAL", DataType="single")
P_VSM_SetSpdWiprReqTime = AUTOSAR4.Parameter(750, SwCalibrationAccess="ReadWrite", StorageClass="Global", MemorySection="CAL", DataType="single")

P_VSM_PassSBRSpdIPLimtEn = AUTOSAR4.Parameter(0, SwCalibrationAccess="ReadWrite", StorageClass="Global", MemorySection="CAL", DataType="boolean")
P_VSM_TLS_LCCancelTime = AUTOSAR4.Parameter(250, SwCalibrationAccess="ReadWrite", StorageClass="Global", MemorySection="CAL", DataType="uint16")
P_VSM_TLS_IELineSw_b = AUTOSAR4.Parameter(0, SwCalibrationAccess="ReadWrite", StorageClass="Global", MemorySection="CAL", DataType="boolean")
P_VSM_TLS_LeftLKAActiveOffset_m = AUTOSAR4.Parameter(0.2, SwCalibrationAccess="ReadWrite", StorageClass="Global", MemorySection="CAL", DataType="single")
P_VSM_TLS_RightLKAActiveOffset_m = AUTOSAR4.Parameter(-0.2, SwCalibrationAccess="ReadWrite", StorageClass="Global", MemorySection="CAL", DataType="single")
P_VSM_TLS_LKALineA0Sw_b = AUTOSAR4.Parameter(0, SwCalibrationAccess="ReadWrite", StorageClass="Global", MemorySection="CAL", DataType="boolean")
P_VSM_TSR_Dis_keep_SPLend = AUTOSAR4.Parameter(50, SwCalibrationAccess="ReadWrite", StorageClass="Global", MemorySection="CAL", DataType="uint16")
P_VSM_TSR_Dis_keep_TS_Table = AUTOSAR4.Parameter(repmat(200, 1, 48), SwCalibrationAccess="ReadWrite", StorageClass="Global", MemorySection="CAL", DataType="uint16")
P_VSM_TSR_Ena_TS_Table = AUTOSAR4.Parameter(repmat(1, 1, 48), SwCalibrationAccess="ReadWrite", StorageClass="Global", MemorySection="CAL", DataType="uint8")
P_VSM_TSR_SLIF_Speed_High = AUTOSAR4.Parameter(150, SwCalibrationAccess="ReadWrite", StorageClass="Global", MemorySection="CAL", DataType="uint8")
P_VSM_TSR_SLIF_Speed_Low = AUTOSAR4.Parameter(0, SwCalibrationAccess="ReadWrite", StorageClass="Global", MemorySection="CAL", DataType="uint8")
P_VSM_TSR_SLW_SnvtySwitch = AUTOSAR4.Parameter(0, SwCalibrationAccess="ReadWrite", StorageClass="Global", MemorySection="CAL", DataType="boolean")
P_VSM_TSR_SLW_Speed_High = AUTOSAR4.Parameter(150, SwCalibrationAccess="ReadWrite", StorageClass="Global", MemorySection="CAL", DataType="uint8")
P_VSM_TSR_SLW_Speed_Low = AUTOSAR4.Parameter(30, SwCalibrationAccess="ReadWrite", StorageClass="Global", MemorySection="CAL", DataType="uint8")
P_VSM_TSR_SLW_TrafEyeAvtiveDist = AUTOSAR4.Parameter(100, SwCalibrationAccess="ReadWrite", StorageClass="Global", MemorySection="CAL", DataType="uint16")
P_VSM_TSR_SLW_Warning_Time = AUTOSAR4.Parameter(10, SwCalibrationAccess="ReadWrite", StorageClass="Global", MemorySection="CAL", DataType="uint8")
P_VSM_TSR_SteerWheelAngle = AUTOSAR4.Parameter(360, SwCalibrationAccess="ReadWrite", StorageClass="Global", MemorySection="CAL", DataType="single")
P_VSM_TSR_SWS_speed_withDir = AUTOSAR4.Parameter(9, SwCalibrationAccess="ReadWrite", StorageClass="Global", MemorySection="CAL", DataType="uint8")
P_VSM_TSR_SWS_speed_woDir = AUTOSAR4.Parameter(24, SwCalibrationAccess="ReadWrite", StorageClass="Global", MemorySection="CAL", DataType="uint8")
P_VSM_TSR_Ena_SPLSupp_Table = AUTOSAR4.Parameter(uint8([0 0 0 0 0 0 1 1 1 1 1 1 1 1 0 0 0 0 0 0 0 0 0]), SwCalibrationAccess="ReadWrite", StorageClass="Global", MemorySection="CAL")
P_VSM_TSR_communicationTest = AUTOSAR4.Parameter(1, SwCalibrationAccess="ReadWrite", StorageClass="Global", MemorySection="CAL", DataType="boolean")
P_VSM_TSR_SLW_Speed_Delta_enable = AUTOSAR4.Parameter(1, SwCalibrationAccess="ReadWrite", StorageClass="Global", MemorySection="CAL", DataType="uint8")
P_VSM_TSR_SLW_Speed_Delta_disable = AUTOSAR4.Parameter(0, SwCalibrationAccess="ReadWrite", StorageClass="Global", MemorySection="CAL", DataType="uint8")
P_VSM_CruiseFunUserInputMappingWays = AUTOSAR4.Parameter(0, SwCalibrationAccess="ReadWrite", StorageClass="Global", MemorySection="CAL", DataType="uint8")
P_VSM_SetSpdInitmph = AUTOSAR4.Parameter(20, SwCalibrationAccess="ReadWrite", StorageClass="Global", MemorySection="CAL", DataType="uint8", Unit="mph")
P_VSM_SetSpdInitkph = AUTOSAR4.Parameter(30, SwCalibrationAccess="ReadWrite", StorageClass="Global", MemorySection="CAL", DataType="uint8", Unit="km/hr")
VSM_LCKIE_State_IFVReady = AUTOSAR4.Signal(SwCalibrationAccess="ReadOnly", StorageClass="Global", MemorySection="VAR", DataType="boolean")
VSM_LCKIE_State_IFVFail = AUTOSAR4.Signal(SwCalibrationAccess="ReadOnly", StorageClass="Global", MemorySection="VAR", DataType="boolean")
VSM_LCKIE_State_Vehspeed_Idel2Ready = AUTOSAR4.Signal(SwCalibrationAccess="ReadOnly", StorageClass="Global", MemorySection="VAR", DataType="boolean")
VSM_LCKIE_State_Vehspeed_Ready2Idel = AUTOSAR4.Signal(SwCalibrationAccess="ReadOnly", StorageClass="Global", MemorySection="VAR", DataType="boolean")
VSM_LCKIE_State_Lanecurve_Idel2Ready = AUTOSAR4.Signal(SwCalibrationAccess="ReadOnly", StorageClass="Global", MemorySection="VAR", DataType="boolean")
VSM_LCKIE_State_LaneWidth_Idel2Ready = AUTOSAR4.Signal(SwCalibrationAccess="ReadOnly", StorageClass="Global", MemorySection="VAR", DataType="boolean")
VSM_LCKIE_State_wiper_Idel2Ready = AUTOSAR4.Signal(SwCalibrationAccess="ReadOnly", StorageClass="Global", MemorySection="VAR", DataType="boolean")
VSM_LCKIE_State_lamb_Idel2Ready = AUTOSAR4.Signal(SwCalibrationAccess="ReadOnly", StorageClass="Global", MemorySection="VAR", DataType="boolean")
VSM_LCKIE_State_detaspd_Idel2Ready = AUTOSAR4.Signal(SwCalibrationAccess="ReadOnly", StorageClass="Global", MemorySection="VAR", DataType="boolean")
VSM_LCKIE_State_Idel2Ready = AUTOSAR4.Signal(SwCalibrationAccess="ReadOnly", StorageClass="Global", MemorySection="VAR", DataType="boolean")
VSM_LCKIE_State_Ready2Idel = AUTOSAR4.Signal(SwCalibrationAccess="ReadOnly", StorageClass="Global", MemorySection="VAR", DataType="boolean")
VSM_LCKIE_State_DrvInputTrqValue_Ready2Active = AUTOSAR4.Signal(SwCalibrationAccess="ReadOnly", StorageClass="Global", MemorySection="VAR", DataType="boolean")
VSM_LCKIE_State_DrvInputTrqValue_Active2Ready = AUTOSAR4.Signal(SwCalibrationAccess="ReadOnly", StorageClass="Global", MemorySection="VAR", DataType="boolean")
VSM_LCKIE_State_ELKObj_Ready2Active = AUTOSAR4.Signal(SwCalibrationAccess="ReadOnly", StorageClass="Global", MemorySection="VAR", DataType="boolean")
VSM_LCKIE_State_ELKObj_Active2Ready = AUTOSAR4.Signal(SwCalibrationAccess="ReadOnly", StorageClass="Global", MemorySection="VAR", DataType="boolean")
VSM_LCKIE_State_OppFrontObj_Ready2Active = AUTOSAR4.Signal(SwCalibrationAccess="ReadOnly", StorageClass="Global", MemorySection="VAR", DataType="boolean")
VSM_LCKIE_State_OppFrontObj_Active2Ready = AUTOSAR4.Signal(SwCalibrationAccess="ReadOnly", StorageClass="Global", MemorySection="VAR", DataType="boolean")
VSM_LCKIE_State_IEObj_Ready2Active = AUTOSAR4.Signal(SwCalibrationAccess="ReadOnly", StorageClass="Global", MemorySection="VAR", DataType="boolean")
VSM_LCKIE_State_IEObj_Active2Ready = AUTOSAR4.Signal(SwCalibrationAccess="ReadOnly", StorageClass="Global", MemorySection="VAR", DataType="boolean")
VSM_LCKIE_State_Ready2Active = AUTOSAR4.Signal(SwCalibrationAccess="ReadOnly", StorageClass="Global", MemorySection="VAR", DataType="boolean")
VSM_LCKIE_State_Active2Ready = AUTOSAR4.Signal(SwCalibrationAccess="ReadOnly", StorageClass="Global", MemorySection="VAR", DataType="boolean")
VSM_LCKIE_State_LCToff = AUTOSAR4.Signal(SwCalibrationAccess="ReadOnly", StorageClass="Global", MemorySection="VAR", DataType="single")
VSM_LCKIE_State_LCflg = AUTOSAR4.Signal(SwCalibrationAccess="ReadOnly", StorageClass="Global", MemorySection="VAR", DataType="uint8")
VSM_LCKIE_State_LCCounter = AUTOSAR4.Signal(SwCalibrationAccess="ReadOnly", StorageClass="Global", MemorySection="VAR", DataType="uint8")
VSM_LCKIE_OS_RoadWidth = AUTOSAR4.Signal(SwCalibrationAccess="ReadOnly", StorageClass="Global", MemorySection="VAR", DataType="single")
VSM_LCKIE_LatC_SafeDisToLaneEdge = AUTOSAR4.Signal(SwCalibrationAccess="ReadOnly", StorageClass="Global", MemorySection="VAR", DataType="single")
VSM_LCKIE_LongC_LongDis = AUTOSAR4.Signal(SwCalibrationAccess="ReadOnly", StorageClass="Global", MemorySection="VAR", DataType="single")
VSM_LCKIE_LongC_LongDisfinal = AUTOSAR4.Signal(SwCalibrationAccess="ReadOnly", StorageClass="Global", MemorySection="VAR", DataType="single")
VSM_LCKIE_LongC_ObjLong = AUTOSAR4.Signal(SwCalibrationAccess="ReadOnly", StorageClass="Global", MemorySection="VAR", DataType="single")
VSM_LCKIE_OFC_Long = AUTOSAR4.Signal(SwCalibrationAccess="ReadOnly", StorageClass="Global", MemorySection="VAR", DataType="single")
VSM_LCKIE_OFC_OppObjDetaSpd = AUTOSAR4.Signal(SwCalibrationAccess="ReadOnly", StorageClass="Global", MemorySection="VAR", DataType="single")
VSM_LCKIE_ORC_ObjTTC = AUTOSAR4.Signal(SwCalibrationAccess="ReadOnly", StorageClass="Global", MemorySection="VAR", DataType="single")
VSM_LCKIE_ORC_ObjLong = AUTOSAR4.Signal(SwCalibrationAccess="ReadOnly", StorageClass="Global", MemorySection="VAR", DataType="single")
VSM_LCKIE_ORC_ObjDetaSpd = AUTOSAR4.Signal(SwCalibrationAccess="ReadOnly", StorageClass="Global", MemorySection="VAR", DataType="single")
VSM_LCKIE_ORC_ObjLatPos = AUTOSAR4.Signal(SwCalibrationAccess="ReadOnly", StorageClass="Global", MemorySection="VAR", DataType="single")
VSM_LCKIE_Laneoffset = AUTOSAR4.Signal(SwCalibrationAccess="ReadOnly", StorageClass="Global", MemorySection="VAR", DataType="single")
VSM_LCKIE_OS_OppFObjID = AUTOSAR4.Signal(SwCalibrationAccess="ReadOnly", StorageClass="Global", MemorySection="VAR", DataType="uint8")
VSM_LCKIE_LatC_MovDirct = AUTOSAR4.Signal(SwCalibrationAccess="ReadOnly", StorageClass="Global", MemorySection="VAR", DataType="uint8")
VSM_LCKIE_LongC_IEReady = AUTOSAR4.Signal(SwCalibrationAccess="ReadOnly", StorageClass="Global", MemorySection="VAR", DataType="uint8")
VSM_LCKIE_LongC_LongFlg = AUTOSAR4.Signal(SwCalibrationAccess="ReadOnly", StorageClass="Global", MemorySection="VAR", DataType="uint8")
VSM_LCKIE_OFC_OppObjReady = AUTOSAR4.Signal(SwCalibrationAccess="ReadOnly", StorageClass="Global", MemorySection="VAR", DataType="uint8")
VSM_LCKIE_OFC_Counter = AUTOSAR4.Signal(SwCalibrationAccess="ReadOnly", StorageClass="Global", MemorySection="VAR", DataType="uint8")
VSM_LCKIE_ORC_OppREARObjReady = AUTOSAR4.Signal(SwCalibrationAccess="ReadOnly", StorageClass="Global", MemorySection="VAR", DataType="uint8")
VSM_LCKIE_ORC_Counter = AUTOSAR4.Signal(SwCalibrationAccess="ReadOnly", StorageClass="Global", MemorySection="VAR", DataType="uint8")
VSM_LCKIE_POC_Counter = AUTOSAR4.Signal(SwCalibrationAccess="ReadOnly", StorageClass="Global", MemorySection="VAR", DataType="uint8")
VSM_LCKIE_POC_delay_time = AUTOSAR4.Signal(SwCalibrationAccess="ReadOnly", StorageClass="Global", MemorySection="VAR", DataType="single")
VSM_LCKIE_POC_LongDown = AUTOSAR4.Signal(SwCalibrationAccess="ReadOnly", StorageClass="Global", MemorySection="VAR", DataType="uint8")
VSM_LCKIE_POC_OvertakeFlg = AUTOSAR4.Signal(SwCalibrationAccess="ReadOnly", StorageClass="Global", MemorySection="VAR", DataType="uint8")
VSM_LCKIE_POC_OvertakeSpd = AUTOSAR4.Signal(SwCalibrationAccess="ReadOnly", StorageClass="Global", MemorySection="VAR", DataType="single")
VSM_LCKIE_POC_POSID = AUTOSAR4.Signal(SwCalibrationAccess="ReadOnly", StorageClass="Global", MemorySection="VAR", DataType="uint8")
VSM_LCKIE_LongC_PocFlg = AUTOSAR4.Signal(SwCalibrationAccess="ReadOnly", StorageClass="Global", MemorySection="VAR", DataType="uint8")
VSM_LCKIE_LongC_CouterOff = AUTOSAR4.Signal(SwCalibrationAccess="ReadOnly", StorageClass="Global", MemorySection="VAR", DataType="uint16")
VSM_LCKIE_LongC_Counter = AUTOSAR4.Signal(SwCalibrationAccess="ReadOnly", StorageClass="Global", MemorySection="VAR", DataType="uint8")
VSM_LCKIE_LongC_Couter1 = AUTOSAR4.Signal(SwCalibrationAccess="ReadOnly", StorageClass="Global", MemorySection="VAR", DataType="uint16")
VSM_LCKIE_LongC_Couter2 = AUTOSAR4.Signal(SwCalibrationAccess="ReadOnly", StorageClass="Global", MemorySection="VAR", DataType="uint16")
VSM_LCKIE_OFC_OppObjFail = AUTOSAR4.Signal(SwCalibrationAccess="ReadOnly", StorageClass="Global", MemorySection="VAR", DataType="uint8")
VSM_LCKIE_OFC_Tset = AUTOSAR4.Signal(SwCalibrationAccess="ReadOnly", StorageClass="Global", MemorySection="VAR", DataType="single")
VSM_LCKIE_POC_Couter1 = AUTOSAR4.Signal(SwCalibrationAccess="ReadOnly", StorageClass="Global", MemorySection="VAR", DataType="uint16")
VSM_LCKIE_DelayTime = AUTOSAR4.Signal(SwCalibrationAccess="ReadOnly", StorageClass="Global", MemorySection="VAR", DataType="single")
VSM_LCKIE_LongC_d1 = AUTOSAR4.Signal(SwCalibrationAccess="ReadOnly", StorageClass="Global", MemorySection="VAR", DataType="single")
VSM_LCKIE_LongC_d2 = AUTOSAR4.Signal(SwCalibrationAccess="ReadOnly", StorageClass="Global", MemorySection="VAR")
VSM_LCKIE_OS_OppRObjID = AUTOSAR4.Signal(SwCalibrationAccess="ReadOnly", StorageClass="Global", MemorySection="VAR", DataType="uint8")
VSM_LCKIE_OS_POSRObjID = AUTOSAR4.Signal(SwCalibrationAccess="ReadOnly", StorageClass="Global", MemorySection="VAR", DataType="uint8")
VSM_LCKIE_OS_ObjLane = AUTOSAR4.Signal(SwCalibrationAccess="ReadOnly", StorageClass="Global", MemorySection="VAR", DataType="uint8")
VSM_LCKIE_OS_DisEgo2ObjSelect = AUTOSAR4.Signal(SwCalibrationAccess="ReadOnly", StorageClass="Global", MemorySection="VAR", DataType="single")
VSM_LCKIE_OS_DetaSpdSelect = AUTOSAR4.Signal(SwCalibrationAccess="ReadOnly", StorageClass="Global", MemorySection="VAR", DataType="single")
VSM_LCKIE_OS_DisEgo2OppLane = AUTOSAR4.Signal(SwCalibrationAccess="ReadOnly", StorageClass="Global", MemorySection="VAR", DataType="single")
VSM_LCKIE_OS_DetaSpd = AUTOSAR4.Signal(SwCalibrationAccess="ReadOnly", StorageClass="Global", MemorySection="VAR", DataType="single")
VSM_LCKIE_OS_TTC = AUTOSAR4.Signal(SwCalibrationAccess="ReadOnly", StorageClass="Global", MemorySection="VAR", DataType="single")
VSM_LCKIE_OS_ObjSelectID = AUTOSAR4.Signal(SwCalibrationAccess="ReadOnly", StorageClass="Global", MemorySection="VAR", DataType="uint8")
VSM_LCKIE_OS_ObjIDSelect = AUTOSAR4.Signal(SwCalibrationAccess="ReadOnly", StorageClass="Global", MemorySection="VAR", DataType="uint8")
VSM_LCKIE_OS_Couter1 = AUTOSAR4.Signal(SwCalibrationAccess="ReadOnly", StorageClass="Global", MemorySection="VAR", DataType="uint8")
VSM_LCKIE_OS_Couter = AUTOSAR4.Signal(SwCalibrationAccess="ReadOnly", StorageClass="Global", MemorySection="VAR", DataType="uint8")
VSM_LCKIE_LatC_MovDirct1 = AUTOSAR4.Signal(SwCalibrationAccess="ReadOnly", StorageClass="Global", MemorySection="VAR", DataType="uint8")
VSM_LCKIE_LatC_MoveDis = AUTOSAR4.Signal(SwCalibrationAccess="ReadOnly", StorageClass="Global", MemorySection="VAR", DataType="single")
VSM_LCKIE_LatC_DirectChange = AUTOSAR4.Signal(SwCalibrationAccess="ReadOnly", StorageClass="Global", MemorySection="VAR", DataType="uint8")
VSM_LCKIE_LatC_LatFLg = AUTOSAR4.Signal(SwCalibrationAccess="ReadOnly", StorageClass="Global", MemorySection="VAR", DataType="uint8")
VSM_LCKIE_LatC_Counter5 = AUTOSAR4.Signal(SwCalibrationAccess="ReadOnly", StorageClass="Global", MemorySection="VAR", DataType="uint8")
VSM_LCKIE_LatC_Counter4 = AUTOSAR4.Signal(SwCalibrationAccess="ReadOnly", StorageClass="Global", MemorySection="VAR", DataType="uint8")
VSM_LCKIE_LatC_Counter3 = AUTOSAR4.Signal(SwCalibrationAccess="ReadOnly", StorageClass="Global", MemorySection="VAR", DataType="uint8")
VSM_LCKIE_LatC_Counter2 = AUTOSAR4.Signal(SwCalibrationAccess="ReadOnly", StorageClass="Global", MemorySection="VAR", DataType="uint8")
VSM_LCKIE_LatC_Counter1 = AUTOSAR4.Signal(SwCalibrationAccess="ReadOnly", StorageClass="Global", MemorySection="VAR", DataType="uint8")
VSM_LCKIE_LatC_Counter = AUTOSAR4.Signal(SwCalibrationAccess="ReadOnly", StorageClass="Global", MemorySection="VAR", DataType="uint8")
VSM_LCKIE_LongC_Couter3 = AUTOSAR4.Signal(SwCalibrationAccess="ReadOnly", StorageClass="Global", MemorySection="VAR", DataType="uint16")
VSM_LCKIE_POC_ObjLong = AUTOSAR4.Signal(SwCalibrationAccess="ReadOnly", StorageClass="Global", MemorySection="VAR", DataType="single")
VSM_LCKIE_POC_ObjTTC = AUTOSAR4.Signal(SwCalibrationAccess="ReadOnly", StorageClass="Global", MemorySection="VAR", DataType="single")
VSM_LCKIE_POC_Counter2 = AUTOSAR4.Signal(SwCalibrationAccess="ReadOnly", StorageClass="Global", MemorySection="VAR", DataType="uint8")
VSM_LCKIE_POC_POSObjID = AUTOSAR4.Signal(SwCalibrationAccess="ReadOnly", StorageClass="Global", MemorySection="VAR", DataType="uint8")
VSM_LCKIE_OFC_Counter1 = AUTOSAR4.Signal(SwCalibrationAccess="ReadOnly", StorageClass="Global", MemorySection="VAR", DataType="uint8")
VSM_LCKIE_OFC_ObjTTC = AUTOSAR4.Signal(SwCalibrationAccess="ReadOnly", StorageClass="Global", MemorySection="VAR", DataType="single")
VSM_LCKIE_LaneCurve = AUTOSAR4.Signal(SwCalibrationAccess="ReadOnly", StorageClass="Global", MemorySection="VAR", DataType="single")
VSM_LCKIE_LatC_LatWarning = AUTOSAR4.Signal(SwCalibrationAccess="ReadOnly", StorageClass="Global", MemorySection="VAR", DataType="uint8")
VSM_LCKIE_LatC_ObjLatFailFlg = AUTOSAR4.Signal(SwCalibrationAccess="ReadOnly", StorageClass="Global", MemorySection="VAR", DataType="uint8")
VSM_LCKIE_LatC_DisEgo2ObjOff = AUTOSAR4.Signal(SwCalibrationAccess="ReadOnly", StorageClass="Global", MemorySection="VAR", DataType="single")
VSM_LCKIE_LatC_DisREToLane = AUTOSAR4.Signal(SwCalibrationAccess="ReadOnly", StorageClass="Global", MemorySection="VAR", DataType="single")
VSM_LCKIE_LatC_SafDis = AUTOSAR4.Signal(SwCalibrationAccess="ReadOnly", StorageClass="Global", MemorySection="VAR", DataType="single")
VSM_LCKIE_POC_POCObjLong = AUTOSAR4.Signal(SwCalibrationAccess="ReadOnly", StorageClass="Global", MemorySection="VAR", DataType="single")
VSM_LCKIE_POC_POCObjTTC = AUTOSAR4.Signal(SwCalibrationAccess="ReadOnly", StorageClass="Global", MemorySection="VAR", DataType="single")
VSM_LCKIE_POC_Couter2 = AUTOSAR4.Signal(SwCalibrationAccess="ReadOnly", StorageClass="Global", MemorySection="VAR", DataType="uint8")
VSM_LCKIE_LatC_LatMovDis = AUTOSAR4.Signal(SwCalibrationAccess="ReadOnly", StorageClass="Global", MemorySection="VAR", DataType="single")
VSM_LCKIE_State = AUTOSAR4.Signal(SwCalibrationAccess="ReadOnly", StorageClass="Global", MemorySection="VAR", DataType="uint8")
VSM_LCKIE_State_Lanecurve_Ready2Idel = AUTOSAR4.Signal(SwCalibrationAccess="ReadOnly", StorageClass="Global", MemorySection="VAR", DataType="boolean")
VSM_LCKIE_State_LaneWidth_Ready2Idel = AUTOSAR4.Signal(SwCalibrationAccess="ReadOnly", StorageClass="Global", MemorySection="VAR", DataType="boolean")
VSM_LCKIE_State_wiper_Ready2Idel = AUTOSAR4.Signal(SwCalibrationAccess="ReadOnly", StorageClass="Global", MemorySection="VAR", DataType="boolean")
VSM_LCKIE_State_lamb_Ready2Idel = AUTOSAR4.Signal(SwCalibrationAccess="ReadOnly", StorageClass="Global", MemorySection="VAR", DataType="boolean")
VSM_LCKIE_State_detaspd_Ready2Idel = AUTOSAR4.Signal(SwCalibrationAccess="ReadOnly", StorageClass="Global", MemorySection="VAR", DataType="boolean")
VSM_LCKIE_State_HWASts_Ready2Active = AUTOSAR4.Signal(SwCalibrationAccess="ReadOnly", StorageClass="Global", MemorySection="VAR", DataType="boolean")
VSM_LCKIE_DelayReady = AUTOSAR4.Signal(SwCalibrationAccess="ReadOnly", StorageClass="Global", MemorySection="VAR", DataType="uint8")
VSM_LCKIE_SubModel_VERSION = AUTOSAR4.Signal(SwCalibrationAccess="ReadOnly", StorageClass="Global", MemorySection="VAR", DataType="uint32")
VSM_LCKIE_SubModel_Number = AUTOSAR4.Signal(SwCalibrationAccess="ReadOnly", StorageClass="Global", MemorySection="VAR", DataType="uint16")
VSM_LCKIE_OS_DisEgo2Obj = AUTOSAR4.Signal(SwCalibrationAccess="ReadOnly", StorageClass="Global", MemorySection="VAR", DataType="single")
VSM_LCKIE_LatC_latmovori = AUTOSAR4.Signal(SwCalibrationAccess="ReadOnly", StorageClass="Global", MemorySection="VAR", DataType="single")
VSM_LCKIE_LatC_DetaDis = AUTOSAR4.Signal(SwCalibrationAccess="ReadOnly", StorageClass="Global", MemorySection="VAR", DataType="single")
VSM_LCKIE_LatC_Flg = AUTOSAR4.Signal(SwCalibrationAccess="ReadOnly", StorageClass="Global", MemorySection="VAR", DataType="uint8")
VSM_LCKIE_LatC_tdisOR = AUTOSAR4.Signal(SwCalibrationAccess="ReadOnly", StorageClass="Global", MemorySection="VAR", DataType="single")
VSM_LCKIE_LatC_tdis = AUTOSAR4.Signal(SwCalibrationAccess="ReadOnly", StorageClass="Global", MemorySection="VAR", DataType="single")
VSM_LCKIE_LatC_ts = AUTOSAR4.Signal(SwCalibrationAccess="ReadOnly", StorageClass="Global", MemorySection="VAR", DataType="single")
VSM_LCKIE_State_alllamb_Ready2Idel = AUTOSAR4.Signal(SwCalibrationAccess="ReadOnly", StorageClass="Global", MemorySection="VAR", DataType="boolean")
VSM_LCKIE_State_foglamb_Ready2Idel = AUTOSAR4.Signal(SwCalibrationAccess="ReadOnly", StorageClass="Global", MemorySection="VAR", DataType="boolean")
VSM_LCKIE_State_foglamb_Idel2Ready = AUTOSAR4.Signal(SwCalibrationAccess="ReadOnly", StorageClass="Global", MemorySection="VAR", DataType="boolean")
VSM_LCKIE_State_Lanecurve_Ready2IdelCopy = AUTOSAR4.Signal(SwCalibrationAccess="ReadOnly", StorageClass="Global", MemorySection="VAR", DataType="boolean")
VSM_LCKIE_State_alllamb_Idel2Ready = AUTOSAR4.Signal(SwCalibrationAccess="ReadOnly", StorageClass="Global", MemorySection="VAR", DataType="boolean")
VSM_LCKIE_OS_LFObjID = AUTOSAR4.Signal(SwCalibrationAccess="ReadOnly", StorageClass="Global", MemorySection="VAR", DataType="uint8")
VSM_LCKIE_OS_RFObjID = AUTOSAR4.Signal(SwCalibrationAccess="ReadOnly", StorageClass="Global", MemorySection="VAR", DataType="uint8")
VSM_LCKIE_OS_ObjType = AUTOSAR4.Signal(SwCalibrationAccess="ReadOnly", StorageClass="Global", MemorySection="VAR", DataType="uint8")
VSM_LCKIE_State_LaneValid_Idel2Ready = AUTOSAR4.Signal(SwCalibrationAccess="ReadOnly", StorageClass="Global", MemorySection="VAR", DataType="boolean")
VSM_LCKIE_State_LaneValid_Ready2Idel = AUTOSAR4.Signal(SwCalibrationAccess="ReadOnly", StorageClass="Global", MemorySection="VAR", DataType="boolean")
VSM_LCKIE_POC_OvertakeDis = AUTOSAR4.Signal(SwCalibrationAccess="ReadOnly", StorageClass="Global", MemorySection="VAR", DataType="single")
VSM_LCKIE_POC_OvertakeTTC = AUTOSAR4.Signal(SwCalibrationAccess="ReadOnly", StorageClass="Global", MemorySection="VAR", DataType="single")
VSM_LCKIE_OS_ObjSelectDy = AUTOSAR4.Signal(SwCalibrationAccess="ReadOnly", StorageClass="Global", MemorySection="VAR", DataType="single")
VSM_LCKIE_OS_ObjSelectDx = AUTOSAR4.Signal(SwCalibrationAccess="ReadOnly", StorageClass="Global", MemorySection="VAR", DataType="single")
VSM_LCKIE_OS_ObjSelectLength = AUTOSAR4.Signal(SwCalibrationAccess="ReadOnly", StorageClass="Global", MemorySection="VAR", DataType="single")
VSM_LCKIE_LongDisClcmin = AUTOSAR4.Signal(SwCalibrationAccess="ReadOnly", StorageClass="Global", MemorySection="VAR", DataType="single")
VSM_ELK_Con_VehicleSpeed_Idle2ReadyELK = AUTOSAR4.Signal(SwCalibrationAccess="ReadOnly", StorageClass="Global", MemorySection="VAR", DataType="boolean")
VSM_ELK_Con_YawRate_Idle2Ready = AUTOSAR4.Signal(SwCalibrationAccess="ReadOnly", StorageClass="Global", MemorySection="VAR", DataType="boolean")
VSM_ELK_Con_AbsEsp_Idle2Ready = AUTOSAR4.Signal(SwCalibrationAccess="ReadOnly", StorageClass="Global", MemorySection="VAR", DataType="boolean")
VSM_ELK_Con_Lane_Idle2Ready = AUTOSAR4.Signal(SwCalibrationAccess="ReadOnly", StorageClass="Global", MemorySection="VAR", DataType="boolean")
VSM_ELK_Con_Headingangel_Idle2Ready = AUTOSAR4.Signal(SwCalibrationAccess="ReadOnly", StorageClass="Global", MemorySection="VAR", DataType="boolean")
VSM_ELK_Con_LaneCurve_Idle2Ready = AUTOSAR4.Signal(SwCalibrationAccess="ReadOnly", StorageClass="Global", MemorySection="VAR", DataType="boolean")
VSM_ELK_Con_Failsafe_Idle2Ready = AUTOSAR4.Signal(SwCalibrationAccess="ReadOnly", StorageClass="Global", MemorySection="VAR", DataType="boolean")
VSM_ELK_Con_Handson_Idle2Ready = AUTOSAR4.Signal(SwCalibrationAccess="ReadOnly", StorageClass="Global", MemorySection="VAR", DataType="boolean")
VSM_ELK_Con_SteerWheelAngle_Ready2Active = AUTOSAR4.Signal(SwCalibrationAccess="ReadOnly", StorageClass="Global", MemorySection="VAR", DataType="boolean")
VSM_ELK_Con_DriverInput_Ready2Active = AUTOSAR4.Signal(SwCalibrationAccess="ReadOnly", StorageClass="Global", MemorySection="VAR", DataType="boolean")
VSM_ELK_Con_SteerWheelSpd_Ready2Active = AUTOSAR4.Signal(SwCalibrationAccess="ReadOnly", StorageClass="Global", MemorySection="VAR", DataType="boolean")
VSM_ELK_Con_LateralAcc_Ready2Active = AUTOSAR4.Signal(SwCalibrationAccess="ReadOnly", StorageClass="Global", MemorySection="VAR", DataType="boolean")
VSM_ELK_Con_LongitudeAcc_Ready2Active = AUTOSAR4.Signal(SwCalibrationAccess="ReadOnly", StorageClass="Global", MemorySection="VAR", DataType="boolean")
VSM_ELK_Con_BrakePressure_Ready2Active = AUTOSAR4.Signal(SwCalibrationAccess="ReadOnly", StorageClass="Global", MemorySection="VAR", DataType="boolean")
VSM_ELK_Con_AccPedalRate_Ready2Active = AUTOSAR4.Signal(SwCalibrationAccess="ReadOnly", StorageClass="Global", MemorySection="VAR", DataType="boolean")
VSM_ELK_Con_EpsSta_Ready2Active = AUTOSAR4.Signal(SwCalibrationAccess="ReadOnly", StorageClass="Global", MemorySection="VAR", DataType="boolean")
VSM_ELK_Con_CURRENT_GEAR_Ready2Active = AUTOSAR4.Signal(SwCalibrationAccess="ReadOnly", StorageClass="Global", MemorySection="VAR", DataType="boolean")
VSM_ELK_Con_TurnLight_Ready2Active = AUTOSAR4.Signal(SwCalibrationAccess="ReadOnly", StorageClass="Global", MemorySection="VAR", DataType="boolean")
VSM_ELK_Con_SteerWheelAngle_Active2Ready = AUTOSAR4.Signal(SwCalibrationAccess="ReadOnly", StorageClass="Global", MemorySection="VAR", DataType="boolean")
VSM_ELK_Con_DriverInput_Active2Ready = AUTOSAR4.Signal(SwCalibrationAccess="ReadOnly", StorageClass="Global", MemorySection="VAR", DataType="boolean")
VSM_ELK_Con_SteerWheelSpd_Active2Ready = AUTOSAR4.Signal(SwCalibrationAccess="ReadOnly", StorageClass="Global", MemorySection="VAR", DataType="boolean")
VSM_ELK_Con_LateralAcc_Active2Ready = AUTOSAR4.Signal(SwCalibrationAccess="ReadOnly", StorageClass="Global", MemorySection="VAR", DataType="boolean")
VSM_ELK_Con_LongitudeAcc_Active2Ready = AUTOSAR4.Signal(SwCalibrationAccess="ReadOnly", StorageClass="Global", MemorySection="VAR", DataType="boolean")
VSM_ELK_Con_BrakePressure_Active2Ready = AUTOSAR4.Signal(SwCalibrationAccess="ReadOnly", StorageClass="Global", MemorySection="VAR", DataType="boolean")
VSM_ELK_Con_AccPedalRate_Active2Ready = AUTOSAR4.Signal(SwCalibrationAccess="ReadOnly", StorageClass="Global", MemorySection="VAR", DataType="boolean")
VSM_ELK_Con_EpsSta_Active2Ready = AUTOSAR4.Signal(SwCalibrationAccess="ReadOnly", StorageClass="Global", MemorySection="VAR", DataType="boolean")
VSM_ELK_Con_CURRENT_GEAR_Active2Ready = AUTOSAR4.Signal(SwCalibrationAccess="ReadOnly", StorageClass="Global", MemorySection="VAR", DataType="boolean")
VSM_ELK_Con_TurnLight_Active2Ready = AUTOSAR4.Signal(SwCalibrationAccess="ReadOnly", StorageClass="Global", MemorySection="VAR", DataType="boolean")
VSM_ELK_Con_OverRide_Active2Ready = AUTOSAR4.Signal(SwCalibrationAccess="ReadOnly", StorageClass="Global", MemorySection="VAR", DataType="boolean")
VSM_ELK_Con_VehicleSpeed_Ready2Idle = AUTOSAR4.Signal(SwCalibrationAccess="ReadOnly", StorageClass="Global", MemorySection="VAR", DataType="boolean")
VSM_ELK_Con_YawRate_Ready2Idle = AUTOSAR4.Signal(SwCalibrationAccess="ReadOnly", StorageClass="Global", MemorySection="VAR", DataType="boolean")
VSM_ELK_Con_AbsEsp_Ready2Idle = AUTOSAR4.Signal(SwCalibrationAccess="ReadOnly", StorageClass="Global", MemorySection="VAR", DataType="boolean")
VSM_ELK_Con_Lane_Ready2Idle = AUTOSAR4.Signal(SwCalibrationAccess="ReadOnly", StorageClass="Global", MemorySection="VAR", DataType="boolean")
VSM_ELK_Con_Failsafe_Ready2Idle = AUTOSAR4.Signal(SwCalibrationAccess="ReadOnly", StorageClass="Global", MemorySection="VAR", DataType="boolean")
VSM_ELK_Con_LaneCurve_Ready2Idle = AUTOSAR4.Signal(SwCalibrationAccess="ReadOnly", StorageClass="Global", MemorySection="VAR", DataType="boolean")
VSM_ELK_Con_Headingangle_Ready2Idle = AUTOSAR4.Signal(SwCalibrationAccess="ReadOnly", StorageClass="Global", MemorySection="VAR", DataType="boolean")
VSM_ELK_Con_HandOff_Ready2Idle = AUTOSAR4.Signal(SwCalibrationAccess="ReadOnly", StorageClass="Global", MemorySection="VAR", DataType="boolean")
VSM_ELK_Idle2Ready = AUTOSAR4.Signal(SwCalibrationAccess="ReadOnly", StorageClass="Global", MemorySection="VAR", DataType="boolean")
VSM_ELK_Ready2Active = AUTOSAR4.Signal(SwCalibrationAccess="ReadOnly", StorageClass="Global", MemorySection="VAR", DataType="boolean")
VSM_ELK_Active2Ready = AUTOSAR4.Signal(SwCalibrationAccess="ReadOnly", StorageClass="Global", MemorySection="VAR", DataType="boolean")
VSM_ELK_Other2Idle = AUTOSAR4.Signal(SwCalibrationAccess="ReadOnly", StorageClass="Global", MemorySection="VAR", DataType="boolean")

VSM_ELK_OnComing_LOnComing = AUTOSAR4.Signal(SwCalibrationAccess="ReadOnly", StorageClass="Global", MemorySection="VAR", DataType="boolean")
VSM_ELK_OnComing_Lttc = AUTOSAR4.Signal(SwCalibrationAccess="ReadOnly", StorageClass="Global", MemorySection="VAR", DataType="boolean")
VSM_ELK_OnComing_ROnComing = AUTOSAR4.Signal(SwCalibrationAccess="ReadOnly", StorageClass="Global", MemorySection="VAR", DataType="boolean")
VSM_ELK_OnComing_Rttc = AUTOSAR4.Signal(SwCalibrationAccess="ReadOnly", StorageClass="Global", MemorySection="VAR", DataType="boolean")
VSM_ELK_OverTaking_LLateral = AUTOSAR4.Signal(SwCalibrationAccess="ReadOnly", StorageClass="Global", MemorySection="VAR", DataType="boolean")
VSM_ELK_OverTaking_leftcar = AUTOSAR4.Signal(SwCalibrationAccess="ReadOnly", StorageClass="Global", MemorySection="VAR", DataType="boolean")
VSM_ELK_OverTaking_RLateral = AUTOSAR4.Signal(SwCalibrationAccess="ReadOnly", StorageClass="Global", MemorySection="VAR", DataType="boolean")
VSM_ELK_OverTaking_rightcar = AUTOSAR4.Signal(SwCalibrationAccess="ReadOnly", StorageClass="Global", MemorySection="VAR", DataType="boolean")
VSM_ELK_Con_Override_Ready2Active = AUTOSAR4.Signal(SwCalibrationAccess="ReadOnly", StorageClass="Global", MemorySection="VAR", DataType="boolean")
VSM_ELK_LWidth = AUTOSAR4.Signal(SwCalibrationAccess="ReadOnly", StorageClass="Global", MemorySection="VAR", DataType="single")
VSM_ELK_OnComing_Lv_re = AUTOSAR4.Signal(SwCalibrationAccess="ReadOnly", StorageClass="Global", MemorySection="VAR", DataType="single")
VSM_ELK_OnComing_Llateral = AUTOSAR4.Signal(SwCalibrationAccess="ReadOnly", StorageClass="Global", MemorySection="VAR", DataType="single")
VSM_ELK_OnComing_Rv_re = AUTOSAR4.Signal(SwCalibrationAccess="ReadOnly", StorageClass="Global", MemorySection="VAR", DataType="single")
VSM_ELK_OnComing_Rlateral = AUTOSAR4.Signal(SwCalibrationAccess="ReadOnly", StorageClass="Global", MemorySection="VAR", DataType="single")
VSM_ELKState = AUTOSAR4.Signal(SwCalibrationAccess="ReadOnly", StorageClass="Global", MemorySection="VAR", DataType="uint8")
VSM_ELK_Warning = AUTOSAR4.Signal(SwCalibrationAccess="ReadOnly", StorageClass="Global", MemorySection="VAR", DataType="single")
VSM_ELK_Counter = AUTOSAR4.Signal(SwCalibrationAccess="ReadOnly", StorageClass="Global", MemorySection="VAR", DataType="uint8")
VSM_ELK_Con_ESSSts_Ready2Idle = AUTOSAR4.Signal(SwCalibrationAccess="ReadOnly", StorageClass="Global", MemorySection="VAR", DataType="boolean")
VSM_ELK_Con_ESSSts_Idle2Ready = AUTOSAR4.Signal(SwCalibrationAccess="ReadOnly", StorageClass="Global", MemorySection="VAR", DataType="boolean")
VSM_ELK_Con_LaneChange_Ready2Active = AUTOSAR4.Signal(SwCalibrationAccess="ReadOnly", StorageClass="Global", MemorySection="VAR", DataType="boolean")
VSM_ELK_Con_LaneChange_Active2Ready = AUTOSAR4.Signal(SwCalibrationAccess="ReadOnly", StorageClass="Global", MemorySection="VAR", DataType="boolean")
VSM_ELK_VehConfigELK = AUTOSAR4.Signal(SwCalibrationAccess="ReadOnly", StorageClass="Global", MemorySection="VAR", DataType="uint8")
VSM_ELK_SubModel_VERSION = AUTOSAR4.Signal(SwCalibrationAccess="ReadOnly", StorageClass="Global", MemorySection="VAR")
VSM_ELK_SubModel_Number = AUTOSAR4.Signal(SwCalibrationAccess="ReadOnly", StorageClass="Global", MemorySection="VAR")
VSM_SCM_SubModel_VERSION = AUTOSAR4.Signal(SwCalibrationAccess="ReadOnly", StorageClass="Global", MemorySection="VAR")
VSM_SCM_SubModel_Number = AUTOSAR4.Signal(SwCalibrationAccess="ReadOnly", StorageClass="Global", MemorySection="VAR")
VSM_ELK_RoadEgeInter_st = AUTOSAR4.Signal(SwCalibrationAccess="ReadOnly", StorageClass="Global", MemorySection="VAR")
VSM_ELK_RightOvertakingFlag_b = AUTOSAR4.Signal(SwCalibrationAccess="ReadOnly", StorageClass="Global", MemorySection="VAR")
VSM_ELK_RightOvertakingTTCFlag = AUTOSAR4.Signal(SwCalibrationAccess="ReadOnly", StorageClass="Global", MemorySection="VAR")
VSM_ELK_LeftOvertakingTTCFlag = AUTOSAR4.Signal(SwCalibrationAccess="ReadOnly", StorageClass="Global", MemorySection="VAR")
VSM_ELK_LeftOnComingDyFlag = AUTOSAR4.Signal(SwCalibrationAccess="ReadOnly", StorageClass="Global", MemorySection="VAR")
VSM_ELK_LeftOnComingTTCFlag = AUTOSAR4.Signal(SwCalibrationAccess="ReadOnly", StorageClass="Global", MemorySection="VAR")
VSM_ELK_LeftOnComingLatDisFlag = AUTOSAR4.Signal(SwCalibrationAccess="ReadOnly", StorageClass="Global", MemorySection="VAR")
VSM_ELK_LeftOnComingFlag_b = AUTOSAR4.Signal(SwCalibrationAccess="ReadOnly", StorageClass="Global", MemorySection="VAR")
VSM_ELK_RightOnComingDyFlag = AUTOSAR4.Signal(SwCalibrationAccess="ReadOnly", StorageClass="Global", MemorySection="VAR")
VSM_ELK_RightOnComingTTCFlag = AUTOSAR4.Signal(SwCalibrationAccess="ReadOnly", StorageClass="Global", MemorySection="VAR")
VSM_ELK_RightOnComingLatDisFlag = AUTOSAR4.Signal(SwCalibrationAccess="ReadOnly", StorageClass="Global", MemorySection="VAR")
VSM_ELK_RightOnComingFlag_b = AUTOSAR4.Signal(SwCalibrationAccess="ReadOnly", StorageClass="Global", MemorySection="VAR")
VSM_ELK_LeftOvertakingDyFlag = AUTOSAR4.Signal(SwCalibrationAccess="ReadOnly", StorageClass="Global", MemorySection="VAR")
VSM_ELK_LeftOvertakingFlag_b = AUTOSAR4.Signal(SwCalibrationAccess="ReadOnly", StorageClass="Global", MemorySection="VAR")
VSM_ELK_RightOvertakingDyFlag = AUTOSAR4.Signal(SwCalibrationAccess="ReadOnly", StorageClass="Global", MemorySection="VAR")
VSM_ELK_LaneValid_b = AUTOSAR4.Signal(SwCalibrationAccess="ReadOnly", StorageClass="Global", MemorySection="VAR", DataType="boolean")
VSM_ELK_LaneWidth_Valid = AUTOSAR4.Signal(SwCalibrationAccess="ReadOnly", StorageClass="Global", MemorySection="VAR", DataType="boolean")
VSM_ELK_OnComing_LetfCondition_b = AUTOSAR4.Signal(SwCalibrationAccess="ReadOnly", StorageClass="Global", MemorySection="VAR", DataType="boolean")
VSM_ELK_OnComing_RightCondition_b = AUTOSAR4.Signal(SwCalibrationAccess="ReadOnly", StorageClass="Global", MemorySection="VAR", DataType="boolean")
VSM_ELK_OnComing_LOut_b = AUTOSAR4.Signal(SwCalibrationAccess="ReadOnly", StorageClass="Global", MemorySection="VAR", DataType="boolean")
VSM_ELK_OnComing_ROut_b = AUTOSAR4.Signal(SwCalibrationAccess="ReadOnly", StorageClass="Global", MemorySection="VAR", DataType="boolean")
VSM_ELK_OverTaking_LeftCondition_b = AUTOSAR4.Signal(SwCalibrationAccess="ReadOnly", StorageClass="Global", MemorySection="VAR", DataType="boolean")
VSM_ELK_OverTaking_RightCondition_b = AUTOSAR4.Signal(SwCalibrationAccess="ReadOnly", StorageClass="Global", MemorySection="VAR", DataType="boolean")
VSM_ELK_OverTaking_LOut_b = AUTOSAR4.Signal(SwCalibrationAccess="ReadOnly", StorageClass="Global", MemorySection="VAR", DataType="boolean")
VSM_ELK_OverTaking_ROut_b = AUTOSAR4.Signal(SwCalibrationAccess="ReadOnly", StorageClass="Global", MemorySection="VAR", DataType="boolean")
VSM_ELK_OnComingFlag_b = AUTOSAR4.Signal(SwCalibrationAccess="ReadOnly", StorageClass="Global", MemorySection="VAR")
VSM_ELK_OvertakingFlag_b = AUTOSAR4.Signal(SwCalibrationAccess="ReadOnly", StorageClass="Global", MemorySection="VAR")
VSM_ELK_OverLTarVehMinDx_m = AUTOSAR4.Signal(SwCalibrationAccess="ReadOnly", StorageClass="Global", MemorySection="VAR")
VSM_ELK_OverLeftObjInAreaFlag_b = AUTOSAR4.Signal(SwCalibrationAccess="ReadOnly", StorageClass="Global", MemorySection="VAR")
VSM_ELK_OverRTarVehMinDx_m = AUTOSAR4.Signal(SwCalibrationAccess="ReadOnly", StorageClass="Global", MemorySection="VAR")
VSM_ELK_OverRightObjInAreaFlag_b = AUTOSAR4.Signal(SwCalibrationAccess="ReadOnly", StorageClass="Global", MemorySection="VAR")
VSM_ELK_Lane_valid = AUTOSAR4.Signal(SwCalibrationAccess="ReadOnly", StorageClass="Global", MemorySection="VAR")
VSM_ELK_Lwidth_Valid = AUTOSAR4.Signal(SwCalibrationAccess="ReadOnly", StorageClass="Global", MemorySection="VAR")
VSM_ELK_OnComing_LetfCondition = AUTOSAR4.Signal(SwCalibrationAccess="ReadOnly", StorageClass="Global", MemorySection="VAR")
VSM_ELK_OnComing_RightCondition = AUTOSAR4.Signal(SwCalibrationAccess="ReadOnly", StorageClass="Global", MemorySection="VAR")
VSM_ELK_OnComing_LOut = AUTOSAR4.Signal(SwCalibrationAccess="ReadOnly", StorageClass="Global", MemorySection="VAR")
VSM_ELK_OnComing_ROut = AUTOSAR4.Signal(SwCalibrationAccess="ReadOnly", StorageClass="Global", MemorySection="VAR")
VSM_ELK_OverTaking_LeftCondition = AUTOSAR4.Signal(SwCalibrationAccess="ReadOnly", StorageClass="Global", MemorySection="VAR")
VSM_ELK_OverTaking_RightCondition = AUTOSAR4.Signal(SwCalibrationAccess="ReadOnly", StorageClass="Global", MemorySection="VAR")
VSM_ELK_OverTaking_LOut = AUTOSAR4.Signal(SwCalibrationAccess="ReadOnly", StorageClass="Global", MemorySection="VAR")
VSM_ELK_OverTaking_ROut = AUTOSAR4.Signal(SwCalibrationAccess="ReadOnly", StorageClass="Global", MemorySection="VAR")
VSM_ELK_LeftOvertakingLatFlag = AUTOSAR4.Signal(SwCalibrationAccess="ReadOnly", StorageClass="Global", MemorySection="VAR")
VSM_ELK_RightOvertakingLatFlag = AUTOSAR4.Signal(SwCalibrationAccess="ReadOnly", StorageClass="Global", MemorySection="VAR")
VSM_ELK_LeftOverObjInAreaFlag_b = AUTOSAR4.Signal(SwCalibrationAccess="ReadOnly", StorageClass="Global", MemorySection="VAR")
VSM_ELK_RightOverObjInAreaFlag_b = AUTOSAR4.Signal(SwCalibrationAccess="ReadOnly", StorageClass="Global", MemorySection="VAR")
VSM_ELK_LeftOnComingPreDis_m = AUTOSAR4.Signal(SwCalibrationAccess="ReadOnly", StorageClass="Global", MemorySection="VAR")
VSM_ELK_LeftOnComingInAreaFlag_b = AUTOSAR4.Signal(SwCalibrationAccess="ReadOnly", StorageClass="Global", MemorySection="VAR")
VSM_ELK_RiOnComingPreDis_m = AUTOSAR4.Signal(SwCalibrationAccess="ReadOnly", StorageClass="Global", MemorySection="VAR")
VSM_ELK_RiOnComingInAreaFlag_b = AUTOSAR4.Signal(SwCalibrationAccess="ReadOnly", StorageClass="Global", MemorySection="VAR")
VSM_ELK_EPSTqDiffOverFlag_b = AUTOSAR4.Signal(SwCalibrationAccess="ReadOnly", StorageClass="Global", MemorySection="VAR")
VSM_ELK_EPSTqSameOverFlag_b = AUTOSAR4.Signal(SwCalibrationAccess="ReadOnly", StorageClass="Global", MemorySection="VAR")
VSM_ELK_EPSTqDegOverrideFlag_b = AUTOSAR4.Signal(SwCalibrationAccess="ReadOnly", StorageClass="Global", MemorySection="VAR")
VSM_ELK_LeftOnComingLatDisOffsetFlag_b = AUTOSAR4.Signal(SwCalibrationAccess="ReadOnly", StorageClass="Global", MemorySection="VAR")
VSM_ELK_LeftOvertakingLatDisOffsetFlag_b = AUTOSAR4.Signal(SwCalibrationAccess="ReadOnly", StorageClass="Global", MemorySection="VAR")
VSM_ELK_RiOnComingLatDisOffsetFlag_b = AUTOSAR4.Signal(SwCalibrationAccess="ReadOnly", StorageClass="Global", MemorySection="VAR")
VSM_ELK_RiOvertakingLatDisOffsetFlag_b = AUTOSAR4.Signal(SwCalibrationAccess="ReadOnly", StorageClass="Global", MemorySection="VAR")
VSM_ELK_Con_Inhibit_Ready2Idle = AUTOSAR4.Signal(SwCalibrationAccess="ReadOnly", StorageClass="Global", MemorySection="VAR")
VSM_ELK_Con_EPSFaultCheck_Ready2Idle = AUTOSAR4.Signal(SwCalibrationAccess="ReadOnly", StorageClass="Global", MemorySection="VAR")
VSM_ELK_LeftRoadEgeInter_b = AUTOSAR4.Signal(SwCalibrationAccess="ReadOnly", StorageClass="Global", MemorySection="VAR")
VSM_ELK_LRECenterStableFlag_b = AUTOSAR4.Signal(SwCalibrationAccess="ReadOnly", StorageClass="Global", MemorySection="VAR")
VSM_ELK_RightRoadEgeInter_b = AUTOSAR4.Signal(SwCalibrationAccess="ReadOnly", StorageClass="Global", MemorySection="VAR")
VSM_ELK_RRECenterStableFlag_b = AUTOSAR4.Signal(SwCalibrationAccess="ReadOnly", StorageClass="Global", MemorySection="VAR")
VSM_ELK_RoadEgeInterState_st = AUTOSAR4.Signal(SwCalibrationAccess="ReadOnly", StorageClass="Global", MemorySection="VAR")
VSM_ELK_ObjectAge = AUTOSAR4.Signal(SwCalibrationAccess="ReadOnly", StorageClass="Global", MemorySection="VAR")
VSM_ELK_ObjectAX = AUTOSAR4.Signal(SwCalibrationAccess="ReadOnly", StorageClass="Global", MemorySection="VAR")
VSM_ELK_ObjectAY = AUTOSAR4.Signal(SwCalibrationAccess="ReadOnly", StorageClass="Global", MemorySection="VAR")
VSM_ELK_ObjectDX = AUTOSAR4.Signal(SwCalibrationAccess="ReadOnly", StorageClass="Global", MemorySection="VAR")
VSM_ELK_ObjectDY = AUTOSAR4.Signal(SwCalibrationAccess="ReadOnly", StorageClass="Global", MemorySection="VAR")
VSM_ELK_ObjectExistProb = AUTOSAR4.Signal(SwCalibrationAccess="ReadOnly", StorageClass="Global", MemorySection="VAR")
VSM_ELK_ObjectFusType = AUTOSAR4.Signal(SwCalibrationAccess="ReadOnly", StorageClass="Global", MemorySection="VAR")
VSM_ELK_ObjectHeadingAngle = AUTOSAR4.Signal(SwCalibrationAccess="ReadOnly", StorageClass="Global", MemorySection="VAR")
VSM_ELK_ObjectHight = AUTOSAR4.Signal(SwCalibrationAccess="ReadOnly", StorageClass="Global", MemorySection="VAR")
VSM_ELK_ObjectID = AUTOSAR4.Signal(SwCalibrationAccess="ReadOnly", StorageClass="Global", MemorySection="VAR")
VSM_ELK_ObjectInLane = AUTOSAR4.Signal(SwCalibrationAccess="ReadOnly", StorageClass="Global", MemorySection="VAR")
VSM_ELK_ObjectLength = AUTOSAR4.Signal(SwCalibrationAccess="ReadOnly", StorageClass="Global", MemorySection="VAR")
VSM_ELK_ObjectMovingState = AUTOSAR4.Signal(SwCalibrationAccess="ReadOnly", StorageClass="Global", MemorySection="VAR")
VSM_ELK_ObjectObstacleProb = AUTOSAR4.Signal(SwCalibrationAccess="ReadOnly", StorageClass="Global", MemorySection="VAR")
VSM_ELK_ObjectOrientation = AUTOSAR4.Signal(SwCalibrationAccess="ReadOnly", StorageClass="Global", MemorySection="VAR")
VSM_ELK_ObjectStdAX = AUTOSAR4.Signal(SwCalibrationAccess="ReadOnly", StorageClass="Global", MemorySection="VAR")
VSM_ELK_ObjectStdAY = AUTOSAR4.Signal(SwCalibrationAccess="ReadOnly", StorageClass="Global", MemorySection="VAR")
VSM_ELK_ObjectStdDX = AUTOSAR4.Signal(SwCalibrationAccess="ReadOnly", StorageClass="Global", MemorySection="VAR")
VSM_ELK_ObjectStdDY = AUTOSAR4.Signal(SwCalibrationAccess="ReadOnly", StorageClass="Global", MemorySection="VAR")
VSM_ELK_ObjectStdHeadingAngle = AUTOSAR4.Signal(SwCalibrationAccess="ReadOnly", StorageClass="Global", MemorySection="VAR")
VSM_ELK_ObjectStdLength = AUTOSAR4.Signal(SwCalibrationAccess="ReadOnly", StorageClass="Global", MemorySection="VAR")
VSM_ELK_ObjectStdVX = AUTOSAR4.Signal(SwCalibrationAccess="ReadOnly", StorageClass="Global", MemorySection="VAR")
VSM_ELK_ObjectStdVY = AUTOSAR4.Signal(SwCalibrationAccess="ReadOnly", StorageClass="Global", MemorySection="VAR")
VSM_ELK_ObjectStdWidth = AUTOSAR4.Signal(SwCalibrationAccess="ReadOnly", StorageClass="Global", MemorySection="VAR")
VSM_ELK_ObjectType = AUTOSAR4.Signal(SwCalibrationAccess="ReadOnly", StorageClass="Global", MemorySection="VAR")
VSM_ELK_ObjectTypeProb = AUTOSAR4.Signal(SwCalibrationAccess="ReadOnly", StorageClass="Global", MemorySection="VAR")
VSM_ELK_ObjectVX = AUTOSAR4.Signal(SwCalibrationAccess="ReadOnly", StorageClass="Global", MemorySection="VAR")
VSM_ELK_ObjectVY = AUTOSAR4.Signal(SwCalibrationAccess="ReadOnly", StorageClass="Global", MemorySection="VAR")
VSM_ELK_ObjectWidth = AUTOSAR4.Signal(SwCalibrationAccess="ReadOnly", StorageClass="Global", MemorySection="VAR")
VSM_ELK_ObjectYawAngle = AUTOSAR4.Signal(SwCalibrationAccess="ReadOnly", StorageClass="Global", MemorySection="VAR")
VSM_ELK_CurrentLaneProb = AUTOSAR4.Signal(SwCalibrationAccess="ReadOnly", StorageClass="Global", MemorySection="VAR")
VSM_ELK_LeftLaneProb = AUTOSAR4.Signal(SwCalibrationAccess="ReadOnly", StorageClass="Global", MemorySection="VAR")
VSM_ELK_RightLaneProb = AUTOSAR4.Signal(SwCalibrationAccess="ReadOnly", StorageClass="Global", MemorySection="VAR")
VSM_LCK_Con_ESSSts_Idle2Ready = AUTOSAR4.Signal(SwCalibrationAccess="ReadOnly", StorageClass="Global", MemorySection="VAR")
VSM_LCK_Con_Lane_Idle2Ready = AUTOSAR4.Signal(SwCalibrationAccess="ReadOnly", StorageClass="Global", MemorySection="VAR", DataType="boolean")
VSM_LCK_Con_BrakePress_Active2Ready = AUTOSAR4.Signal(SwCalibrationAccess="ReadOnly", StorageClass="Global", MemorySection="VAR", DataType="boolean")
VSM_LCK_Con_OverRide_Active2Ready = AUTOSAR4.Signal(SwCalibrationAccess="ReadOnly", StorageClass="Global", MemorySection="VAR", DataType="boolean")
VSM_LCK_Con_AccPedalRate_Active2Ready = AUTOSAR4.Signal(SwCalibrationAccess="ReadOnly", StorageClass="Global", MemorySection="VAR", DataType="boolean")
VSM_LCK_Con_SteerWheelAngle_Active2Ready = AUTOSAR4.Signal(SwCalibrationAccess="ReadOnly", StorageClass="Global", MemorySection="VAR", DataType="boolean")
VSM_LCK_Con_DriverInput_Active2Ready = AUTOSAR4.Signal(SwCalibrationAccess="ReadOnly", StorageClass="Global", MemorySection="VAR", DataType="boolean")
VSM_LCK_Con_EpsSta_Active2Ready = AUTOSAR4.Signal(SwCalibrationAccess="ReadOnly", StorageClass="Global", MemorySection="VAR", DataType="boolean")
VSM_LCK_Con_LateralAcc_Active2Ready = AUTOSAR4.Signal(SwCalibrationAccess="ReadOnly", StorageClass="Global", MemorySection="VAR", DataType="boolean")
VSM_LCK_Con_LongitudeAcc_Active2Ready = AUTOSAR4.Signal(SwCalibrationAccess="ReadOnly", StorageClass="Global", MemorySection="VAR", DataType="boolean")
VSM_LCK_Con_CURRENT_GEAR_Active2Ready = AUTOSAR4.Signal(SwCalibrationAccess="ReadOnly", StorageClass="Global", MemorySection="VAR", DataType="boolean")
VSM_LCK_Con_YawRate_Ready2Idle = AUTOSAR4.Signal(SwCalibrationAccess="ReadOnly", StorageClass="Global", MemorySection="VAR", DataType="boolean")
VSM_LCK_Con_AbsEsp_Ready2Idle = AUTOSAR4.Signal(SwCalibrationAccess="ReadOnly", StorageClass="Global", MemorySection="VAR", DataType="boolean")
VSM_LCK_Con_HandsOff_Ready2Idle = AUTOSAR4.Signal(SwCalibrationAccess="ReadOnly", StorageClass="Global", MemorySection="VAR", DataType="boolean")
VSM_LCK_Con_Lane_Ready2Idle = AUTOSAR4.Signal(SwCalibrationAccess="ReadOnly", StorageClass="Global", MemorySection="VAR", DataType="boolean")
VSM_LCK_Con_VehicleSpd_Ready2Idle = AUTOSAR4.Signal(SwCalibrationAccess="ReadOnly", StorageClass="Global", MemorySection="VAR", DataType="boolean")
VSM_LCK_Idle2Ready = AUTOSAR4.Signal(SwCalibrationAccess="ReadOnly", StorageClass="Global", MemorySection="VAR", DataType="boolean")
VSM_LCK_Ready2Active = AUTOSAR4.Signal(SwCalibrationAccess="ReadOnly", StorageClass="Global", MemorySection="VAR", DataType="boolean")
VSM_LCK_Active2Ready = AUTOSAR4.Signal(SwCalibrationAccess="ReadOnly", StorageClass="Global", MemorySection="VAR", DataType="boolean")
VSM_LCK_Ready2Idle = AUTOSAR4.Signal(SwCalibrationAccess="ReadOnly", StorageClass="Global", MemorySection="VAR", DataType="boolean")
VSM_LCK_Active2Idle = AUTOSAR4.Signal(SwCalibrationAccess="ReadOnly", StorageClass="Global", MemorySection="VAR", DataType="boolean")
VSM_LCK_Con_AbsEsp_Idle2Ready = AUTOSAR4.Signal(SwCalibrationAccess="ReadOnly", StorageClass="Global", MemorySection="VAR", DataType="boolean")
VSM_LCK_Con_LaneChange_Active2Ready = AUTOSAR4.Signal(SwCalibrationAccess="ReadOnly", StorageClass="Global", MemorySection="VAR", DataType="boolean")
VSM_LCK_Con_LaneChange_Ready2Active = AUTOSAR4.Signal(SwCalibrationAccess="ReadOnly", StorageClass="Global", MemorySection="VAR", DataType="boolean")
VSM_LCK_Con_ESSSts_Ready2Idle = AUTOSAR4.Signal(SwCalibrationAccess="ReadOnly", StorageClass="Global", MemorySection="VAR", DataType="boolean")
VSM_LCK_Con_LaneCurve_Ready2Idle = AUTOSAR4.Signal(SwCalibrationAccess="ReadOnly", StorageClass="Global", MemorySection="VAR", DataType="boolean")
VSM_LCK_Con_LaneCurve_Idle2Ready = AUTOSAR4.Signal(SwCalibrationAccess="ReadOnly", StorageClass="Global", MemorySection="VAR", DataType="boolean")
VSM_LCK_Warning = AUTOSAR4.Signal(SwCalibrationAccess="ReadOnly", StorageClass="Global", MemorySection="VAR")
VSM_LCK_Con_YawRate_Idle2Ready = AUTOSAR4.Signal(SwCalibrationAccess="ReadOnly", StorageClass="Global", MemorySection="VAR", DataType="boolean")
VSM_LCK_Con_Handson_Idle2Ready = AUTOSAR4.Signal(SwCalibrationAccess="ReadOnly", StorageClass="Global", MemorySection="VAR", DataType="boolean")
VSM_LCK_Con_Headingangle_Idle2Ready = AUTOSAR4.Signal(SwCalibrationAccess="ReadOnly", StorageClass="Global", MemorySection="VAR", DataType="boolean")
VSM_LCK_Con_VehicleSpd_Idle2Ready = AUTOSAR4.Signal(SwCalibrationAccess="ReadOnly", StorageClass="Global", MemorySection="VAR", DataType="boolean")
VSM_LCK_Con_TurnLight_Ready2Active = AUTOSAR4.Signal(SwCalibrationAccess="ReadOnly", StorageClass="Global", MemorySection="VAR", DataType="boolean")
VSM_LCK_Con_SteerAngleSpd_Ready2Active = AUTOSAR4.Signal(SwCalibrationAccess="ReadOnly", StorageClass="Global", MemorySection="VAR", DataType="boolean")
VSM_LCK_Con_BrakePress_Ready2Active = AUTOSAR4.Signal(SwCalibrationAccess="ReadOnly", StorageClass="Global", MemorySection="VAR", DataType="boolean")
VSM_LCK_Con_AccPedalRate_Ready2Active = AUTOSAR4.Signal(SwCalibrationAccess="ReadOnly", StorageClass="Global", MemorySection="VAR", DataType="boolean")
VSM_LCK_Con_SteerWheelAngle_Ready2Active = AUTOSAR4.Signal(SwCalibrationAccess="ReadOnly", StorageClass="Global", MemorySection="VAR", DataType="boolean")
VSM_LCK_Con_DrvInputTrqValue_Ready2Active = AUTOSAR4.Signal(SwCalibrationAccess="ReadOnly", StorageClass="Global", MemorySection="VAR", DataType="boolean")
VSM_LCK_Con_LateralAcc_Ready2Active = AUTOSAR4.Signal(SwCalibrationAccess="ReadOnly", StorageClass="Global", MemorySection="VAR", DataType="boolean")
VSM_LCK_Con_LongitudeAcc_Ready2Active = AUTOSAR4.Signal(SwCalibrationAccess="ReadOnly", StorageClass="Global", MemorySection="VAR", DataType="boolean")
VSM_LCK_Con_CURRENT_GEAR_Ready2Active = AUTOSAR4.Signal(SwCalibrationAccess="ReadOnly", StorageClass="Global", MemorySection="VAR", DataType="boolean")
VSM_LCK_Con_OverRide_Ready2Active = AUTOSAR4.Signal(SwCalibrationAccess="ReadOnly", StorageClass="Global", MemorySection="VAR", DataType="boolean")
VSM_LCK_Con_EpsSts_Ready2Active = AUTOSAR4.Signal(SwCalibrationAccess="ReadOnly", StorageClass="Global", MemorySection="VAR", DataType="boolean")
VSM_LCK_Con_TurnLight_Active2Ready = AUTOSAR4.Signal(SwCalibrationAccess="ReadOnly", StorageClass="Global", MemorySection="VAR", DataType="boolean")
VSM_LCK_Con_SteerAngleSpd_Active2Ready = AUTOSAR4.Signal(SwCalibrationAccess="ReadOnly", StorageClass="Global", MemorySection="VAR", DataType="boolean")
VSM_LCKState = AUTOSAR4.Signal(SwCalibrationAccess="ReadOnly", StorageClass="Global", MemorySection="VAR", DataType="uint8")
VSM_LCK_Con_TJALane_Idle2Ready = AUTOSAR4.Signal(SwCalibrationAccess="ReadOnly", StorageClass="Global", MemorySection="VAR")
VSM_LCK_Con_TJALane_Ready2Idle = AUTOSAR4.Signal(SwCalibrationAccess="ReadOnly", StorageClass="Global", MemorySection="VAR")
VSM_LCK_Counter = AUTOSAR4.Signal(SwCalibrationAccess="ReadOnly", StorageClass="Global", MemorySection="VAR", DataType="uint8")
VSM_LCK_Con_TargetLaneIn_Idle2Ready = AUTOSAR4.Signal(SwCalibrationAccess="ReadOnly", StorageClass="Global", MemorySection="VAR", DataType="boolean")
VSM_LCK_VERSION = AUTOSAR4.Signal(SwCalibrationAccess="ReadOnly", StorageClass="Global", MemorySection="VAR", DataType="uint32")
VSM_LCK_Con_LSMLine_Idle2Ready = AUTOSAR4.Signal(SwCalibrationAccess="ReadOnly", StorageClass="Global", MemorySection="VAR", DataType="boolean")
VSM_LCK_Con_LSMLine_Ready2Idle = AUTOSAR4.Signal(SwCalibrationAccess="ReadOnly", StorageClass="Global", MemorySection="VAR", DataType="boolean")
VSM_LCK_TJAActive2Ready = AUTOSAR4.Signal(SwCalibrationAccess="ReadOnly", StorageClass="Global", MemorySection="VAR", DataType="boolean")
VSM_LCK_TJAReady2Active = AUTOSAR4.Signal(SwCalibrationAccess="ReadOnly", StorageClass="Global", MemorySection="VAR", DataType="boolean")
VSM_LCK_Con_InTime_Idle2Ready = AUTOSAR4.Signal(SwCalibrationAccess="ReadOnly", StorageClass="Global", MemorySection="VAR", DataType="boolean")
VSM_LCK_Con_InTime_Ready2Active = AUTOSAR4.Signal(SwCalibrationAccess="ReadOnly", StorageClass="Global", MemorySection="VAR", DataType="boolean")
VSM_TJALCKState = AUTOSAR4.Signal(SwCalibrationAccess="ReadOnly", StorageClass="Global", MemorySection="VAR")
VSM_LCK_Con_TJAVehicleSpd_Idle2Ready = AUTOSAR4.Signal(SwCalibrationAccess="ReadOnly", StorageClass="Global", MemorySection="VAR", DataType="boolean")
VSM_LCK_TJAIdle2Ready = AUTOSAR4.Signal(SwCalibrationAccess="ReadOnly", StorageClass="Global", MemorySection="VAR", DataType="boolean")
VSM_LCK_Con_TJA_Active2Ready = AUTOSAR4.Signal(SwCalibrationAccess="ReadOnly", StorageClass="Global", MemorySection="VAR")
VSM_LCK_Con_TJA_Ready2Active = AUTOSAR4.Signal(SwCalibrationAccess="ReadOnly", StorageClass="Global", MemorySection="VAR", DataType="boolean")
VSM_LCK_TJAReady2Idle = AUTOSAR4.Signal(SwCalibrationAccess="ReadOnly", StorageClass="Global", MemorySection="VAR", DataType="boolean")
VSM_LCK_Con_TJAVehicleSpd_Ready2Idle = AUTOSAR4.Signal(SwCalibrationAccess="ReadOnly", StorageClass="Global", MemorySection="VAR", DataType="boolean")
VSM_LCK_Con_TJAHandson_Idle2Ready = AUTOSAR4.Signal(SwCalibrationAccess="ReadOnly", StorageClass="Global", MemorySection="VAR", DataType="boolean")
VSM_LCK_TargetLaneIn_A1 = AUTOSAR4.Signal(SwCalibrationAccess="ReadOnly", StorageClass="Global", MemorySection="VAR", DataType="boolean")
VSM_LCK_TargetLaneIn_A0 = AUTOSAR4.Signal(SwCalibrationAccess="ReadOnly", StorageClass="Global", MemorySection="VAR", DataType="boolean")
VSM_LCK_SubModel_VERSION = AUTOSAR4.Signal(SwCalibrationAccess="ReadOnly", StorageClass="Global", MemorySection="VAR")
VSM_LCK_SubModel_Number = AUTOSAR4.Signal(SwCalibrationAccess="ReadOnly", StorageClass="Global", MemorySection="VAR")
VSM_SteerAngOffsetInit = AUTOSAR4.Signal(SwCalibrationAccess="ReadOnly", StorageClass="Global", MemorySection="VAR")
VSM_SteerAngleOffset_deg = AUTOSAR4.Signal(SwCalibrationAccess="ReadOnly", StorageClass="Global", MemorySection="VAR")
VSM_LCK_preDis = AUTOSAR4.Signal(SwCalibrationAccess="ReadOnly", StorageClass="Global", MemorySection="VAR")
VSM_LCK_dypre = AUTOSAR4.Signal(SwCalibrationAccess="ReadOnly", StorageClass="Global", MemorySection="VAR")
VSM_LCK_dypreoffset = AUTOSAR4.Signal(SwCalibrationAccess="ReadOnly", StorageClass="Global", MemorySection="VAR")
VSM_LCK_TargetLaneIn = AUTOSAR4.Signal(SwCalibrationAccess="ReadOnly", StorageClass="Global", MemorySection="VAR")
VSM_LCK_dy0 = AUTOSAR4.Signal(SwCalibrationAccess="ReadOnly", StorageClass="Global", MemorySection="VAR")
VSM_LCK_TargetLaneIn2 = AUTOSAR4.Signal(SwCalibrationAccess="ReadOnly", StorageClass="Global", MemorySection="VAR")
VSM_LCK_Lanewidth = AUTOSAR4.Signal(SwCalibrationAccess="ReadOnly", StorageClass="Global", MemorySection="VAR")

VSM_LCK_SameDegsignFlag_b = AUTOSAR4.Signal(SwCalibrationAccess="ReadOnly", StorageClass="Global", MemorySection="VAR")
VSM_LCK_SameDirChRateFlag_b = AUTOSAR4.Signal(SwCalibrationAccess="ReadOnly", StorageClass="Global", MemorySection="VAR")
VSM_LCK_SteerDirection_st = AUTOSAR4.Signal(SwCalibrationAccess="ReadOnly", StorageClass="Global", MemorySection="VAR")
VSM_LCK_SameDirDegOverride_b = AUTOSAR4.Signal(SwCalibrationAccess="ReadOnly", StorageClass="Global", MemorySection="VAR")
VSM_LCK_DiffDegsignFlag_b = AUTOSAR4.Signal(SwCalibrationAccess="ReadOnly", StorageClass="Global", MemorySection="VAR")
VSM_LCK_DiffDegsignOverride_b = AUTOSAR4.Signal(SwCalibrationAccess="ReadOnly", StorageClass="Global", MemorySection="VAR")
VSM_LCK_SteerDegOverride_b = AUTOSAR4.Signal(SwCalibrationAccess="ReadOnly", StorageClass="Global", MemorySection="VAR")
VSM_LCK_LaneCure = AUTOSAR4.Signal(SwCalibrationAccess="ReadOnly", StorageClass="Global", MemorySection="VAR")
VSM_LCK_LaneWidth_offset = AUTOSAR4.Signal(SwCalibrationAccess="ReadOnly", StorageClass="Global", MemorySection="VAR")
VSM_LCK_d0 = AUTOSAR4.Signal(SwCalibrationAccess="ReadOnly", StorageClass="Global", MemorySection="VAR")
VSM_LCK_LaneCure_Offset = AUTOSAR4.Signal(SwCalibrationAccess="ReadOnly", StorageClass="Global", MemorySection="VAR")
VSM_LCK_LcEPSTqDiffOverFlag_b = AUTOSAR4.Signal(SwCalibrationAccess="ReadOnly", StorageClass="Global", MemorySection="VAR")  % 左右换道-反方向时Override标志
VSM_LCK_LcEPSTqSameOverFlag_b = AUTOSAR4.Signal(SwCalibrationAccess="ReadOnly", StorageClass="Global", MemorySection="VAR")  % 左右换道-同方向时Override标志
VSM_LCK_EPSTqDiffOverFlag_b = AUTOSAR4.Signal(SwCalibrationAccess="ReadOnly", StorageClass="Global", MemorySection="VAR")  % 非换道-反方向时Override标志
VSM_LCK_EPSTqSameOverFlag_b = AUTOSAR4.Signal(SwCalibrationAccess="ReadOnly", StorageClass="Global", MemorySection="VAR")  % 非换道-驾驶员Override标志
VSM_LCK_EPSTqDegOverrideFlag_b = AUTOSAR4.Signal(SwCalibrationAccess="ReadOnly", StorageClass="Global", MemorySection="VAR")  % LCK-Override标志
VSM_LCK_WarnLcEPSTqDiffOverFlag_b = AUTOSAR4.Signal(SwCalibrationAccess="ReadOnly", StorageClass="Global", MemorySection="VAR")
VSM_LCK_WarnLcEPSTqSameOverFlag_b = AUTOSAR4.Signal(SwCalibrationAccess="ReadOnly", StorageClass="Global", MemorySection="VAR")
VSM_LCK_WarnEPSTqDiffOverFlag_b = AUTOSAR4.Signal(SwCalibrationAccess="ReadOnly", StorageClass="Global", MemorySection="VAR")
VSM_LCK_WarnEPSTqSameOverFlag_b = AUTOSAR4.Signal(SwCalibrationAccess="ReadOnly", StorageClass="Global", MemorySection="VAR")
VSM_LCK_Con_Inhibit_Ready2Idle = AUTOSAR4.Signal(SwCalibrationAccess="ReadOnly", StorageClass="Global", MemorySection="VAR")
VSM_LCK_Con_EPSFaultCheck_Ready2Idle = AUTOSAR4.Signal(SwCalibrationAccess="ReadOnly", StorageClass="Global", MemorySection="VAR")
VSM_LKA_Idle2Ready = AUTOSAR4.Signal(SwCalibrationAccess="ReadOnly", StorageClass="Global", MemorySection="VAR", DataType="boolean")
VSM_LKA_Ready2Active = AUTOSAR4.Signal(SwCalibrationAccess="ReadOnly", StorageClass="Global", MemorySection="VAR", DataType="boolean")
VSM_LKA_Active2Ready = AUTOSAR4.Signal(SwCalibrationAccess="ReadOnly", StorageClass="Global", MemorySection="VAR", DataType="boolean")
VSM_LKA_Other2Idle = AUTOSAR4.Signal(SwCalibrationAccess="ReadOnly", StorageClass="Global", MemorySection="VAR", DataType="boolean")
VSM_LKA_Con_VehicleSpeed_Idle2Ready = AUTOSAR4.Signal(SwCalibrationAccess="ReadOnly", StorageClass="Global", MemorySection="VAR", DataType="boolean")
VSM_LKA_Con_YawRate_Idle2Ready = AUTOSAR4.Signal(SwCalibrationAccess="ReadOnly", StorageClass="Global", MemorySection="VAR", DataType="boolean")
VSM_LKA_Con_AbsEsp_Idle2Ready = AUTOSAR4.Signal(SwCalibrationAccess="ReadOnly", StorageClass="Global", MemorySection="VAR", DataType="boolean")
VSM_LKA_Con_Lane_Idle2Ready = AUTOSAR4.Signal(SwCalibrationAccess="ReadOnly", StorageClass="Global", MemorySection="VAR", DataType="boolean")
VSM_LKA_Con_Headingangle_Idle2Ready = AUTOSAR4.Signal(SwCalibrationAccess="ReadOnly", StorageClass="Global", MemorySection="VAR", DataType="boolean")
VSM_LKA_Con_LaneCurve_Idle2Ready = AUTOSAR4.Signal(SwCalibrationAccess="ReadOnly", StorageClass="Global", MemorySection="VAR", DataType="boolean")
VSM_LKA_Con_Failsafe_Idle2Ready = AUTOSAR4.Signal(SwCalibrationAccess="ReadOnly", StorageClass="Global", MemorySection="VAR", DataType="boolean")
VSM_LKA_Con_Handson_Idle2Ready = AUTOSAR4.Signal(SwCalibrationAccess="ReadOnly", StorageClass="Global", MemorySection="VAR", DataType="boolean")
VSM_LKA_Con_TurnLight_Ready2Active = AUTOSAR4.Signal(SwCalibrationAccess="ReadOnly", StorageClass="Global", MemorySection="VAR", DataType="boolean")
VSM_LKA_Con_SteerWheelAngle_Ready2Active = AUTOSAR4.Signal(SwCalibrationAccess="ReadOnly", StorageClass="Global", MemorySection="VAR", DataType="boolean")
VSM_LKA_Con_DriverInput_Ready2Active = AUTOSAR4.Signal(SwCalibrationAccess="ReadOnly", StorageClass="Global", MemorySection="VAR", DataType="boolean")
VSM_LKA_Con_SteerWheelSpd_Ready2Active = AUTOSAR4.Signal(SwCalibrationAccess="ReadOnly", StorageClass="Global", MemorySection="VAR", DataType="boolean")
VSM_LKA_Con_LateralAcc_Ready2Active = AUTOSAR4.Signal(SwCalibrationAccess="ReadOnly", StorageClass="Global", MemorySection="VAR", DataType="boolean")
VSM_LKA_Con_LongitudeAcc_Ready2Active = AUTOSAR4.Signal(SwCalibrationAccess="ReadOnly", StorageClass="Global", MemorySection="VAR", DataType="boolean")
VSM_LKA_Con_BrakePressure_Ready2Active = AUTOSAR4.Signal(SwCalibrationAccess="ReadOnly", StorageClass="Global", MemorySection="VAR", DataType="boolean")
VSM_LKA_Con_AccPedalRate_Ready2Active = AUTOSAR4.Signal(SwCalibrationAccess="ReadOnly", StorageClass="Global", MemorySection="VAR", DataType="boolean")
VSM_LKA_Con_EpsSta_Ready2Active = AUTOSAR4.Signal(SwCalibrationAccess="ReadOnly", StorageClass="Global", MemorySection="VAR", DataType="boolean")
VSM_LKA_Con_CURRENT_GEAR_Ready2Active = AUTOSAR4.Signal(SwCalibrationAccess="ReadOnly", StorageClass="Global", MemorySection="VAR", DataType="boolean")
VSM_LKA_Con_Override_Ready2Active = AUTOSAR4.Signal(SwCalibrationAccess="ReadOnly", StorageClass="Global", MemorySection="VAR", DataType="boolean")
VSM_LKA_Con_LaneChange_Ready2Active = AUTOSAR4.Signal(SwCalibrationAccess="ReadOnly", StorageClass="Global", MemorySection="VAR", DataType="boolean")
VSM_LKA_Con_TurnLight_Active2Ready = AUTOSAR4.Signal(SwCalibrationAccess="ReadOnly", StorageClass="Global", MemorySection="VAR", DataType="boolean")
VSM_LKA_Con_SteerWheelAngle_Active2Ready = AUTOSAR4.Signal(SwCalibrationAccess="ReadOnly", StorageClass="Global", MemorySection="VAR", DataType="boolean")
VSM_LKA_Con_DriverInput_Active2Ready = AUTOSAR4.Signal(SwCalibrationAccess="ReadOnly", StorageClass="Global", MemorySection="VAR", DataType="boolean")
VSM_LKA_Con_SteerWheelSpd_Active2Ready = AUTOSAR4.Signal(SwCalibrationAccess="ReadOnly", StorageClass="Global", MemorySection="VAR", DataType="boolean")
VSM_LKA_Con_LateralAcc_Active2Ready = AUTOSAR4.Signal(SwCalibrationAccess="ReadOnly", StorageClass="Global", MemorySection="VAR", DataType="boolean")
VSM_LKA_Con_LongitudeAcc_Active2Ready = AUTOSAR4.Signal(SwCalibrationAccess="ReadOnly", StorageClass="Global", MemorySection="VAR", DataType="boolean")
VSM_LKA_Con_BrakePressure_Active2Ready = AUTOSAR4.Signal(SwCalibrationAccess="ReadOnly", StorageClass="Global", MemorySection="VAR", DataType="boolean")
VSM_LKA_Con_AccPedalRate_Active2Ready = AUTOSAR4.Signal(SwCalibrationAccess="ReadOnly", StorageClass="Global", MemorySection="VAR", DataType="boolean")
VSM_LKA_Con_EpsSta_Active2Ready = AUTOSAR4.Signal(SwCalibrationAccess="ReadOnly", StorageClass="Global", MemorySection="VAR", DataType="boolean")
VSM_LKA_Con_CURRENT_GEAR_Active2Ready = AUTOSAR4.Signal(SwCalibrationAccess="ReadOnly", StorageClass="Global", MemorySection="VAR", DataType="boolean")
VSM_LKA_Con_OverRide_Active2Ready = AUTOSAR4.Signal(SwCalibrationAccess="ReadOnly", StorageClass="Global", MemorySection="VAR", DataType="boolean")
VSM_LKA_Con_LaneChange_Active2Ready = AUTOSAR4.Signal(SwCalibrationAccess="ReadOnly", StorageClass="Global", MemorySection="VAR", DataType="boolean")
VSM_LKA_Con_Lane_Ready2Idle = AUTOSAR4.Signal(SwCalibrationAccess="ReadOnly", StorageClass="Global", MemorySection="VAR", DataType="boolean")
VSM_LKA_Con_VehicleSpeed_Ready2Idle = AUTOSAR4.Signal(SwCalibrationAccess="ReadOnly", StorageClass="Global", MemorySection="VAR", DataType="boolean")
VSM_LKA_Con_YawRate_Ready2Idle = AUTOSAR4.Signal(SwCalibrationAccess="ReadOnly", StorageClass="Global", MemorySection="VAR", DataType="boolean")
VSM_LKA_Con_AbsEsp_Ready2Idle = AUTOSAR4.Signal(SwCalibrationAccess="ReadOnly", StorageClass="Global", MemorySection="VAR", DataType="boolean")
VSM_LKA_Con_Failsafe_Ready2Idle = AUTOSAR4.Signal(SwCalibrationAccess="ReadOnly", StorageClass="Global", MemorySection="VAR", DataType="boolean")
VSM_LKA_Con_LaneCurve_Ready2Idle = AUTOSAR4.Signal(SwCalibrationAccess="ReadOnly", StorageClass="Global", MemorySection="VAR", DataType="boolean")
VSM_LKA_Con_Headingangle_Ready2Idle = AUTOSAR4.Signal(SwCalibrationAccess="ReadOnly", StorageClass="Global", MemorySection="VAR", DataType="boolean")
VSM_LKA_Con_HandsOff_Ready2Idle = AUTOSAR4.Signal(SwCalibrationAccess="ReadOnly", StorageClass="Global", MemorySection="VAR", DataType="boolean")
VSM_LKA_LeftWarning = AUTOSAR4.Signal(SwCalibrationAccess="ReadOnly", StorageClass="Global", MemorySection="VAR", DataType="boolean")
VSM_LKA_RightWarning = AUTOSAR4.Signal(SwCalibrationAccess="ReadOnly", StorageClass="Global", MemorySection="VAR", DataType="boolean")
VSM_LKA_End = AUTOSAR4.Signal(SwCalibrationAccess="ReadOnly", StorageClass="Global", MemorySection="VAR", DataType="boolean")
VSM_LKA_Con_ESSSts_Idle2Ready = AUTOSAR4.Signal(SwCalibrationAccess="ReadOnly", StorageClass="Global", MemorySection="VAR", DataType="boolean")
VSM_LKA_Con_ESSSts_Ready2Idle = AUTOSAR4.Signal(SwCalibrationAccess="ReadOnly", StorageClass="Global", MemorySection="VAR", DataType="boolean")
VSM_LKA_InterventionEnd = AUTOSAR4.Signal(SwCalibrationAccess="ReadOnly", StorageClass="Global", MemorySection="VAR", DataType="single")
VSM_LKA_State = AUTOSAR4.Signal(SwCalibrationAccess="ReadOnly", StorageClass="Global", MemorySection="VAR", DataType="uint8")
VSM_LKA_Warning = AUTOSAR4.Signal(SwCalibrationAccess="ReadOnly", StorageClass="Global", MemorySection="VAR", DataType="uint8")
VSM_LKAState = AUTOSAR4.Signal(SwCalibrationAccess="ReadOnly", StorageClass="Global", MemorySection="VAR", DataType="uint8")
VSM_LKAWarnflag = AUTOSAR4.Signal(SwCalibrationAccess="ReadOnly", StorageClass="Global", MemorySection="VAR")
VSM_LKA_AccrPedlPosnDiagc = AUTOSAR4.Signal(SwCalibrationAccess="ReadOnly", StorageClass="Global", MemorySection="VAR")
VSM_LKA_Con_TJASts_Active2Ready = AUTOSAR4.Signal(SwCalibrationAccess="ReadOnly", StorageClass="Global", MemorySection="VAR", DataType="boolean")
VSM_LKA_Con_TJASts_Ready2Active = AUTOSAR4.Signal(SwCalibrationAccess="ReadOnly", StorageClass="Global", MemorySection="VAR", DataType="boolean")
VSM_LKA_Counter = AUTOSAR4.Signal(SwCalibrationAccess="ReadOnly", StorageClass="Global", MemorySection="VAR", DataType="uint8")
VSM_LKA_Con_ESSSts_Active2Ready = AUTOSAR4.Signal(SwCalibrationAccess="ReadOnly", StorageClass="Global", MemorySection="VAR", DataType="boolean")
VSM_LKA_VERSION = AUTOSAR4.Signal(SwCalibrationAccess="ReadOnly", StorageClass="Global", MemorySection="VAR", DataType="uint32")
VSM_LKA_LKAactive = AUTOSAR4.Signal(SwCalibrationAccess="ReadOnly", StorageClass="Global", MemorySection="VAR", DataType="single")
VSM_LKA_LKAout = AUTOSAR4.Signal(SwCalibrationAccess="ReadOnly", StorageClass="Global", MemorySection="VAR", DataType="single")
VSM_LKA_Error = AUTOSAR4.Signal(SwCalibrationAccess="ReadOnly", StorageClass="Global", MemorySection="VAR")
VSM_LKA_SubModel_VERSION = AUTOSAR4.Signal(SwCalibrationAccess="ReadOnly", StorageClass="Global", MemorySection="VAR")
VSM_LKA_SubModel_Number = AUTOSAR4.Signal(SwCalibrationAccess="ReadOnly", StorageClass="Global", MemorySection="VAR")
VSM_LKA_leftactive = AUTOSAR4.Signal(SwCalibrationAccess="ReadOnly", StorageClass="Global", MemorySection="VAR")
VSM_LKA_rightactive = AUTOSAR4.Signal(SwCalibrationAccess="ReadOnly", StorageClass="Global", MemorySection="VAR")
VSM_LKA_EPSTqDiffOverFlag_b = AUTOSAR4.Signal(SwCalibrationAccess="ReadOnly", StorageClass="Global", MemorySection="VAR")
VSM_LKA_EPSTqSameOverFlag_b = AUTOSAR4.Signal(SwCalibrationAccess="ReadOnly", StorageClass="Global", MemorySection="VAR")
VSM_LKA_EPSTqDegOverrideFlag_b = AUTOSAR4.Signal(SwCalibrationAccess="ReadOnly", StorageClass="Global", MemorySection="VAR")
VSM_LKA_RiLaneChangeReFlag_b = AUTOSAR4.Signal(SwCalibrationAccess="ReadOnly", StorageClass="Global", MemorySection="VAR")
VSM_LKA_LeftLaneChangeReFlag_b = AUTOSAR4.Signal(SwCalibrationAccess="ReadOnly", StorageClass="Global", MemorySection="VAR")
VSM_LKA_RiInCrossLineFlag_b = AUTOSAR4.Signal(SwCalibrationAccess="ReadOnly", StorageClass="Global", MemorySection="VAR")
VSM_LKA_Ldy = AUTOSAR4.Signal(SwCalibrationAccess="ReadOnly", StorageClass="Global", MemorySection="VAR")
VSM_LKA_Rdy = AUTOSAR4.Signal(SwCalibrationAccess="ReadOnly", StorageClass="Global", MemorySection="VAR")
VSM_LKA_RiOutCrossLineFlag_b = AUTOSAR4.Signal(SwCalibrationAccess="ReadOnly", StorageClass="Global", MemorySection="VAR")
VSM_LKA_LeftInCrossLineFlag_b = AUTOSAR4.Signal(SwCalibrationAccess="ReadOnly", StorageClass="Global", MemorySection="VAR")
VSM_LKA_LeftOutCrossLineFlag_b = AUTOSAR4.Signal(SwCalibrationAccess="ReadOnly", StorageClass="Global", MemorySection="VAR")
VSM_LKA_Con_Inhibit_Ready2Idle = AUTOSAR4.Signal(SwCalibrationAccess="ReadOnly", StorageClass="Global", MemorySection="VAR")
VSM_LKA_Con_EPSFaultCheck_Ready2Idle = AUTOSAR4.Signal(SwCalibrationAccess="ReadOnly", StorageClass="Global", MemorySection="VAR")
VSM_LDW_Idle2Ready = AUTOSAR4.Signal(SwCalibrationAccess="ReadOnly", StorageClass="Global", MemorySection="VAR", DataType="boolean")
VSM_LDW_Con_YawRate_Idle2Ready = AUTOSAR4.Signal(SwCalibrationAccess="ReadOnly", StorageClass="Global", MemorySection="VAR", DataType="boolean")
VSM_LDW_Con_AbsEsp_Idle2Ready = AUTOSAR4.Signal(SwCalibrationAccess="ReadOnly", StorageClass="Global", MemorySection="VAR", DataType="boolean")
VSM_LDW_Con_Headingangle_Idle2Ready = AUTOSAR4.Signal(SwCalibrationAccess="ReadOnly", StorageClass="Global", MemorySection="VAR", DataType="boolean")
VSM_LDW_Con_Failsafe_Idle2Ready = AUTOSAR4.Signal(SwCalibrationAccess="ReadOnly", StorageClass="Global", MemorySection="VAR", DataType="boolean")
VSM_LDW_Con_LaneCurve_Idle2Ready = AUTOSAR4.Signal(SwCalibrationAccess="ReadOnly", StorageClass="Global", MemorySection="VAR", DataType="boolean")
VSM_LDW_Con_Lane_Idle2Ready = AUTOSAR4.Signal(SwCalibrationAccess="ReadOnly", StorageClass="Global", MemorySection="VAR", DataType="boolean")
VSM_LDW_Con_VehicleSpeed_Idle2Ready = AUTOSAR4.Signal(SwCalibrationAccess="ReadOnly", StorageClass="Global", MemorySection="VAR", DataType="boolean")
VSM_LDW_Con_SteerWheelAngle_Ready2Active = AUTOSAR4.Signal(SwCalibrationAccess="ReadOnly", StorageClass="Global", MemorySection="VAR", DataType="boolean")
VSM_LDW_Con_SteerWheelSpd_Ready2Active = AUTOSAR4.Signal(SwCalibrationAccess="ReadOnly", StorageClass="Global", MemorySection="VAR", DataType="boolean")
VSM_LDW_Con_LateralAcc_Ready2Active = AUTOSAR4.Signal(SwCalibrationAccess="ReadOnly", StorageClass="Global", MemorySection="VAR", DataType="boolean")
VSM_LDW_Con_LongitudeAcc_Ready2Active = AUTOSAR4.Signal(SwCalibrationAccess="ReadOnly", StorageClass="Global", MemorySection="VAR", DataType="boolean")
VSM_LDW_Con_AccPedalRate_Ready2Active = AUTOSAR4.Signal(SwCalibrationAccess="ReadOnly", StorageClass="Global", MemorySection="VAR", DataType="boolean")
VSM_LDW_Con_CURRENT_GEAR_Ready2Active = AUTOSAR4.Signal(SwCalibrationAccess="ReadOnly", StorageClass="Global", MemorySection="VAR", DataType="boolean")
VSM_LDW_Con_TurnLight_Ready2Active = AUTOSAR4.Signal(SwCalibrationAccess="ReadOnly", StorageClass="Global", MemorySection="VAR", DataType="boolean")
VSM_LDW_Con_LaneChange_Ready2Active = AUTOSAR4.Signal(SwCalibrationAccess="ReadOnly", StorageClass="Global", MemorySection="VAR", DataType="boolean")
VSM_LDW_Con_SteerWheelAngle_Active2Ready = AUTOSAR4.Signal(SwCalibrationAccess="ReadOnly", StorageClass="Global", MemorySection="VAR", DataType="boolean")
VSM_LDW_Con_SteerWheelSpd_Active2Ready = AUTOSAR4.Signal(SwCalibrationAccess="ReadOnly", StorageClass="Global", MemorySection="VAR", DataType="boolean")
VSM_LDW_Con_LateralAcc_Active2Ready = AUTOSAR4.Signal(SwCalibrationAccess="ReadOnly", StorageClass="Global", MemorySection="VAR", DataType="boolean")
VSM_LDW_Con_LongitudeAcc_Active2Ready = AUTOSAR4.Signal(SwCalibrationAccess="ReadOnly", StorageClass="Global", MemorySection="VAR", DataType="boolean")
VSM_LDW_Con_BrakePressure_Active2Ready = AUTOSAR4.Signal(SwCalibrationAccess="ReadOnly", StorageClass="Global", MemorySection="VAR", DataType="boolean")
VSM_LDW_Con_AccPedalRate_Active2Ready = AUTOSAR4.Signal(SwCalibrationAccess="ReadOnly", StorageClass="Global", MemorySection="VAR", DataType="boolean")
VSM_LDW_Con_CURRENT_GEAR_Active2Ready = AUTOSAR4.Signal(SwCalibrationAccess="ReadOnly", StorageClass="Global", MemorySection="VAR", DataType="boolean")
VSM_LDW_Con_TurnLight_Active2Ready = AUTOSAR4.Signal(SwCalibrationAccess="ReadOnly", StorageClass="Global", MemorySection="VAR", DataType="boolean")
VSM_LDW_Con_LaneChange_Active2Ready = AUTOSAR4.Signal(SwCalibrationAccess="ReadOnly", StorageClass="Global", MemorySection="VAR", DataType="boolean")
VSM_LDW_Other2Idle = AUTOSAR4.Signal(SwCalibrationAccess="ReadOnly", StorageClass="Global", MemorySection="VAR", DataType="boolean")
VSM_LDW_Active2Ready = AUTOSAR4.Signal(SwCalibrationAccess="ReadOnly", StorageClass="Global", MemorySection="VAR", DataType="boolean")
VSM_LDW_Ready2Active = AUTOSAR4.Signal(SwCalibrationAccess="ReadOnly", StorageClass="Global", MemorySection="VAR", DataType="boolean")
VSM_LDW_Con_Lane_Ready2Idle = AUTOSAR4.Signal(SwCalibrationAccess="ReadOnly", StorageClass="Global", MemorySection="VAR", DataType="boolean")
VSM_LDW_Con_VehicleSpeed_Ready2Idle = AUTOSAR4.Signal(SwCalibrationAccess="ReadOnly", StorageClass="Global", MemorySection="VAR", DataType="boolean")
VSM_LDW_Con_YawRate_Ready2Idle = AUTOSAR4.Signal(SwCalibrationAccess="ReadOnly", StorageClass="Global", MemorySection="VAR", DataType="boolean")
VSM_LDW_Con_AbsEsp_Ready2Idle = AUTOSAR4.Signal(SwCalibrationAccess="ReadOnly", StorageClass="Global", MemorySection="VAR", DataType="boolean")
VSM_LDW_Con_Failsafe_Ready2Idle = AUTOSAR4.Signal(SwCalibrationAccess="ReadOnly", StorageClass="Global", MemorySection="VAR", DataType="boolean")
VSM_LDW_Con_LaneCurve_Ready2Idle = AUTOSAR4.Signal(SwCalibrationAccess="ReadOnly", StorageClass="Global", MemorySection="VAR", DataType="boolean")
VSM_LDW_Con_Headingangle_Ready2Idle = AUTOSAR4.Signal(SwCalibrationAccess="ReadOnly", StorageClass="Global", MemorySection="VAR", DataType="boolean")
VSM_LDW_Con_BrakePressure_Ready2Active = AUTOSAR4.Signal(SwCalibrationAccess="ReadOnly", StorageClass="Global", MemorySection="VAR", DataType="boolean")
VSM_LDW_Con_ESSSts_Idle2Ready = AUTOSAR4.Signal(SwCalibrationAccess="ReadOnly", StorageClass="Global", MemorySection="VAR", DataType="boolean")
VSM_LDW_Con_ESSSts_Ready2Idle = AUTOSAR4.Signal(SwCalibrationAccess="ReadOnly", StorageClass="Global", MemorySection="VAR", DataType="boolean")
VSM_LDW_Leftwarnflag = AUTOSAR4.Signal(SwCalibrationAccess="ReadOnly", StorageClass="Global", MemorySection="VAR", DataType="single")
VSM_LDW_wCount = AUTOSAR4.Signal(SwCalibrationAccess="ReadOnly", StorageClass="Global", MemorySection="VAR", DataType="single")
VSM_LDW_Count = AUTOSAR4.Signal(SwCalibrationAccess="ReadOnly", StorageClass="Global", MemorySection="VAR", DataType="single")
VSM_LDW_Rightwarnflag = AUTOSAR4.Signal(SwCalibrationAccess="ReadOnly", StorageClass="Global", MemorySection="VAR", DataType="single")
VSM_LDWSts = AUTOSAR4.Signal(SwCalibrationAccess="ReadOnly", StorageClass="Global", MemorySection="VAR", DataType="uint8")
VSM_LDW_Counter = AUTOSAR4.Signal(SwCalibrationAccess="ReadOnly", StorageClass="Global", MemorySection="VAR", DataType="uint8")
VSM_LDW_VERSION = AUTOSAR4.Signal(SwCalibrationAccess="ReadOnly", StorageClass="Global", MemorySection="VAR", DataType="uint32")
VSM_LDW_Error = AUTOSAR4.Signal(SwCalibrationAccess="ReadOnly", StorageClass="Global", MemorySection="VAR")
VSM_LDW_SubModel_VERSION = AUTOSAR4.Signal(SwCalibrationAccess="ReadOnly", StorageClass="Global", MemorySection="VAR")
VSM_LDW_SubModel_Number = AUTOSAR4.Signal(SwCalibrationAccess="ReadOnly", StorageClass="Global", MemorySection="VAR")
VSM_LDW_RiInCrossLineFlag_b = AUTOSAR4.Signal(SwCalibrationAccess="ReadOnly", StorageClass="Global", MemorySection="VAR")
VSM_LDW_RiOutCrossLineFlag_b = AUTOSAR4.Signal(SwCalibrationAccess="ReadOnly", StorageClass="Global", MemorySection="VAR")
VSM_LDW_LeftInCrossLineFlag_b = AUTOSAR4.Signal(SwCalibrationAccess="ReadOnly", StorageClass="Global", MemorySection="VAR")
VSM_LDW_LeftOutCrossLineFlag_b = AUTOSAR4.Signal(SwCalibrationAccess="ReadOnly", StorageClass="Global", MemorySection="VAR")
VSM_LDW_LeftLaneChangeReFlag_b = AUTOSAR4.Signal(SwCalibrationAccess="ReadOnly", StorageClass="Global", MemorySection="VAR")
VSM_LDW_RiLaneChangeReFlag_b = AUTOSAR4.Signal(SwCalibrationAccess="ReadOnly", StorageClass="Global", MemorySection="VAR")
VSM_LDW_Ldy = AUTOSAR4.Signal(SwCalibrationAccess="ReadOnly", StorageClass="Global", MemorySection="VAR")
VSM_LDW_Rdy = AUTOSAR4.Signal(SwCalibrationAccess="ReadOnly", StorageClass="Global", MemorySection="VAR")
VSM_LDW_Con_Inhibit_Ready2Idle = AUTOSAR4.Signal(SwCalibrationAccess="ReadOnly", StorageClass="Global", MemorySection="VAR")
VSM_ACCSlowExitCons_EspActive400ms = AUTOSAR4.Signal(SwCalibrationAccess="ReadOnly", StorageClass="Global", MemorySection="VAR")
VSM_ACCSlowExitCons_MSRactive800ms = AUTOSAR4.Signal(SwCalibrationAccess="ReadOnly", StorageClass="Global", MemorySection="VAR")
VSM_ACCSlowExitCons_HDCactive40ms = AUTOSAR4.Signal(SwCalibrationAccess="ReadOnly", StorageClass="Global", MemorySection="VAR")
VSM_ACCSlowExitCons_ABSactive400ms = AUTOSAR4.Signal(SwCalibrationAccess="ReadOnly", StorageClass="Global", MemorySection="VAR")
VSM_ACCSlowExitCons_TCS1active3000ms = AUTOSAR4.Signal(SwCalibrationAccess="ReadOnly", StorageClass="Global", MemorySection="VAR")
VSM_ACCSlowExitCons_TCS2active3000ms = AUTOSAR4.Signal(SwCalibrationAccess="ReadOnly", StorageClass="Global", MemorySection="VAR")
VSM_ACCFastExitCons_Standstill3min = AUTOSAR4.Signal(SwCalibrationAccess="ReadOnly", StorageClass="Global", MemorySection="VAR")
VSM_ACCFastExitCons_StandstillNoBrakeForce = AUTOSAR4.Signal(SwCalibrationAccess="ReadOnly", StorageClass="Global", MemorySection="VAR")
VSM_ACCFastExitCons_RollingBack = AUTOSAR4.Signal(SwCalibrationAccess="ReadOnly", StorageClass="Global", MemorySection="VAR")
VSM_ACCFastExitCons_EngineOff = AUTOSAR4.Signal(SwCalibrationAccess="ReadOnly", StorageClass="Global", MemorySection="VAR")
VSM_ACCFastExitCons_BrakeDiskOverHeat = AUTOSAR4.Signal(SwCalibrationAccess="ReadOnly", StorageClass="Global", MemorySection="VAR")
VSM_ACCFastExitCons_Cancel = AUTOSAR4.Signal(SwCalibrationAccess="ReadOnly", StorageClass="Global", MemorySection="VAR")
VSM_ACCFastExitCons_EspOff = AUTOSAR4.Signal(SwCalibrationAccess="ReadOnly", StorageClass="Global", MemorySection="VAR")
VSM_ACCFastExitCons_NoForwardGear = AUTOSAR4.Signal(SwCalibrationAccess="ReadOnly", StorageClass="Global", MemorySection="VAR")
VSM_ACCFastExitCons_DriveBrakeExit = AUTOSAR4.Signal(SwCalibrationAccess="ReadOnly", StorageClass="Global", MemorySection="VAR")
VSM_ACCFastExitCons_EPBClosed = AUTOSAR4.Signal(SwCalibrationAccess="ReadOnly", StorageClass="Global", MemorySection="VAR")
VSM_ACCFastExitCons_DriverDoorOpen = AUTOSAR4.Signal(SwCalibrationAccess="ReadOnly", StorageClass="Global", MemorySection="VAR")
VSM_ACCFastExit = AUTOSAR4.Signal(SwCalibrationAccess="ReadOnly", StorageClass="Global", MemorySection="VAR")
VSM_ACCSlowExit = AUTOSAR4.Signal(SwCalibrationAccess="ReadOnly", StorageClass="Global", MemorySection="VAR")
VSM_ACCActCondF = AUTOSAR4.Signal(SwCalibrationAccess="ReadOnly", StorageClass="Global", MemorySection="VAR")
VSM_AccOverride = AUTOSAR4.Signal(SwCalibrationAccess="ReadOnly", StorageClass="Global", MemorySection="VAR")
VSM_ACCFastExitCons_AEBTrigger = AUTOSAR4.Signal(SwCalibrationAccess="ReadOnly", StorageClass="Global", MemorySection="VAR")
VSM_ACCFastExitCons_VehSpdExit = AUTOSAR4.Signal(SwCalibrationAccess="ReadOnly", StorageClass="Global", MemorySection="VAR")
VSM_ACCFastExitCons_DrivingModExit = AUTOSAR4.Signal(SwCalibrationAccess="ReadOnly", StorageClass="Global", MemorySection="VAR")
VSM_ACCFastExitCons_EngLimpHome = AUTOSAR4.Signal(SwCalibrationAccess="ReadOnly", StorageClass="Global", MemorySection="VAR")
VSM_ACCFastExitCons_APSGuidance = AUTOSAR4.Signal(SwCalibrationAccess="ReadOnly", StorageClass="Global", MemorySection="VAR")
VSM_ACCFastExitCons_ACCError_Inhibit = AUTOSAR4.Signal(SwCalibrationAccess="ReadOnly", StorageClass="Global", MemorySection="VAR")
VSM_Diagnostic_ACCError = AUTOSAR4.Signal(SwCalibrationAccess="ReadOnly", StorageClass="Global", MemorySection="VAR")
VSM_DriveBrake = AUTOSAR4.Signal(SwCalibrationAccess="ReadOnly", StorageClass="Global", MemorySection="VAR")
VSM_ActiveEnable = AUTOSAR4.Signal(SwCalibrationAccess="ReadOnly", StorageClass="Global", MemorySection="VAR")
VSM_VehicleStandStill = AUTOSAR4.Signal(SwCalibrationAccess="ReadOnly", StorageClass="Global", MemorySection="VAR")
VSM_TJASts = AUTOSAR4.Signal(SwCalibrationAccess="ReadOnly", StorageClass="Global", MemorySection="VAR")
VSM_ACC_DrvOffReq = AUTOSAR4.Signal(SwCalibrationAccess="ReadOnly", StorageClass="Global", MemorySection="VAR")
VSM_TJA_ModeDisp = AUTOSAR4.Signal(SwCalibrationAccess="ReadOnly", StorageClass="Global", MemorySection="VAR")
VSM_ACC_ParkShiftReq = AUTOSAR4.Signal(SwCalibrationAccess="ReadOnly", StorageClass="Global", MemorySection="VAR")
VSM_ACC_VehCnfgACC = AUTOSAR4.Signal(SwCalibrationAccess="ReadOnly", StorageClass="Global", MemorySection="VAR")
VSM_ACC_Version = AUTOSAR4.Signal(SwCalibrationAccess="ReadOnly", StorageClass="Global", MemorySection="VAR")
VSM_ACC_BOMExit = AUTOSAR4.Signal(SwCalibrationAccess="ReadOnly", StorageClass="Global", MemorySection="VAR")
VSM_ACC_DecReqValue = AUTOSAR4.Signal(SwCalibrationAccess="ReadOnly", StorageClass="Global", MemorySection="VAR")
VSM_ACCStandActive2Active_DrvrSts = AUTOSAR4.Signal(SwCalibrationAccess="ReadOnly", StorageClass="Global", MemorySection="VAR")
VSM_ACCStandActive2Wait_DrvrSts = AUTOSAR4.Signal(SwCalibrationAccess="ReadOnly", StorageClass="Global", MemorySection="VAR")

VSM_ACCStandActive2Wait_USS = AUTOSAR4.Signal(SwCalibrationAccess="ReadOnly", StorageClass="Global", MemorySection="VAR")
VSM_ACCStandActiveTime = AUTOSAR4.Signal(SwCalibrationAccess="ReadOnly", StorageClass="Global", MemorySection="VAR")
VSM_ACCFastExitCons_ACCOverride = AUTOSAR4.Signal(SwCalibrationAccess="ReadOnly", StorageClass="Global", MemorySection="VAR")
VSM_ACC_DrvOfftoSM = AUTOSAR4.Signal(SwCalibrationAccess="ReadOnly", StorageClass="Global", MemorySection="VAR")
VSM_ACC_USSObjExist = AUTOSAR4.Signal(SwCalibrationAccess="ReadOnly", StorageClass="Global", MemorySection="VAR")
VSM_ACC_DrvrOff_Disp = AUTOSAR4.Signal(SwCalibrationAccess="ReadOnly", StorageClass="Global", MemorySection="VAR")
VSM_ACC_USSObjDxMin = AUTOSAR4.Signal(SwCalibrationAccess="ReadOnly", StorageClass="Global", MemorySection="VAR")
VSM_ACC_P0DxThrehod = AUTOSAR4.Signal(SwCalibrationAccess="ReadOnly", StorageClass="Global", MemorySection="VAR")
VSM_ACC_AccPedalTouch = AUTOSAR4.Signal(SwCalibrationAccess="ReadOnly", StorageClass="Global", MemorySection="VAR")
VSM_ACC_DriverBrake = AUTOSAR4.Signal(SwCalibrationAccess="ReadOnly", StorageClass="Global", MemorySection="VAR")
VSM_ACCSlowExitCons_DriverSBR = AUTOSAR4.Signal(SwCalibrationAccess="ReadOnly", StorageClass="Global", MemorySection="VAR")
VSM_ACC_SubModel_VERSION = AUTOSAR4.Signal(SwCalibrationAccess="ReadOnly", StorageClass="Global", MemorySection="VAR", DataType="uint32")
VSM_ACC_SubModel_Number = AUTOSAR4.Signal(SwCalibrationAccess="ReadOnly", StorageClass="Global", MemorySection="VAR", DataType="uint16")
VSM_Counter = AUTOSAR4.Signal(SwCalibrationAccess="ReadOnly", StorageClass="Global", MemorySection="VAR")
VSM_ACCSts = AUTOSAR4.Signal(SwCalibrationAccess="ReadOnly", StorageClass="Global", MemorySection="VAR")
VSM_ERROR_RIGHT = AUTOSAR4.Signal(SwCalibrationAccess="ReadOnly", StorageClass="Global", MemorySection="VAR", DataType="single")
VSM_ERROR_LEFT = AUTOSAR4.Signal(SwCalibrationAccess="ReadOnly", StorageClass="Global", MemorySection="VAR", DataType="single")
VSM_LeftChange_old = AUTOSAR4.Signal(SwCalibrationAccess="ReadOnly", StorageClass="Global", MemorySection="VAR", DataType="boolean")
VSM_RightChange_old = AUTOSAR4.Signal(SwCalibrationAccess="ReadOnly", StorageClass="Global", MemorySection="VAR", DataType="boolean")
VSM_LeftChange_new = AUTOSAR4.Signal(SwCalibrationAccess="ReadOnly", StorageClass="Global", MemorySection="VAR", DataType="boolean")
VSM_RightChange_new = AUTOSAR4.Signal(SwCalibrationAccess="ReadOnly", StorageClass="Global", MemorySection="VAR", DataType="boolean")
VSM_FLWhelDy = AUTOSAR4.Signal(SwCalibrationAccess="ReadOnly", StorageClass="Global", MemorySection="VAR", DataType="single")
VSM_FRWhelDy = AUTOSAR4.Signal(SwCalibrationAccess="ReadOnly", StorageClass="Global", MemorySection="VAR", DataType="single")
VSM_preFLWhelDy = AUTOSAR4.Signal(SwCalibrationAccess="ReadOnly", StorageClass="Global", MemorySection="VAR", DataType="single")
VSM_preFRWhelDy = AUTOSAR4.Signal(SwCalibrationAccess="ReadOnly", StorageClass="Global", MemorySection="VAR", DataType="single")
VSM_ALL_SubModel_VERSION = AUTOSAR4.Signal(SwCalibrationAccess="ReadOnly", StorageClass="Global", MemorySection="VAR")
VSM_ALL_SubModel_Number = AUTOSAR4.Signal(SwCalibrationAccess="ReadOnly", StorageClass="Global", MemorySection="VAR")
VSM_ESS_SteerWheelSpd_READY2ACTIVE = AUTOSAR4.Signal(SwCalibrationAccess="ReadOnly", StorageClass="Global", MemorySection="VAR", DataType="boolean")
VSM_ESS_AccelPed_READY2ACTIVE = AUTOSAR4.Signal(SwCalibrationAccess="ReadOnly", StorageClass="Global", MemorySection="VAR", DataType="boolean")
VSM_ESS_VehLgtAccel_READY2ACTIVE = AUTOSAR4.Signal(SwCalibrationAccess="ReadOnly", StorageClass="Global", MemorySection="VAR", DataType="boolean")
VSM_ESS_AEBVruFlag_Ready2Active = AUTOSAR4.Signal(SwCalibrationAccess="ReadOnly", StorageClass="Global", MemorySection="VAR", DataType="boolean")
VSM_ESS_AEBVehFlag_Ready2Active = AUTOSAR4.Signal(SwCalibrationAccess="ReadOnly", StorageClass="Global", MemorySection="VAR", DataType="boolean")
VSM_ESS_FcwDisFlag_Ready2Active = AUTOSAR4.Signal(SwCalibrationAccess="ReadOnly", StorageClass="Global", MemorySection="VAR", DataType="boolean")
VSM_ESS_FcwWarn_Ready2Active = AUTOSAR4.Signal(SwCalibrationAccess="ReadOnly", StorageClass="Global", MemorySection="VAR", DataType="boolean")
VSM_ESS_AEBTrigFlag_ACTIVE2IDLE = AUTOSAR4.Signal(SwCalibrationAccess="ReadOnly", StorageClass="Global", MemorySection="VAR", DataType="boolean")
VSM_ESS_DrvSBR_ACTIVE2IDLE = AUTOSAR4.Signal(SwCalibrationAccess="ReadOnly", StorageClass="Global", MemorySection="VAR", DataType="boolean")
VSM_ESS_DoorSts_ACTIVE2IDLE = AUTOSAR4.Signal(SwCalibrationAccess="ReadOnly", StorageClass="Global", MemorySection="VAR", DataType="boolean")
VSM_ESS_ESPFuncOffSts_ACTIVE2IDLE = AUTOSAR4.Signal(SwCalibrationAccess="ReadOnly", StorageClass="Global", MemorySection="VAR", DataType="boolean")
VSM_ESS_LateralAccel_ACTIVE2IDLE = AUTOSAR4.Signal(SwCalibrationAccess="ReadOnly", StorageClass="Global", MemorySection="VAR", DataType="boolean")
VSM_ESS_ESPActive_ACTIVE2IDLE = AUTOSAR4.Signal(SwCalibrationAccess="ReadOnly", StorageClass="Global", MemorySection="VAR", DataType="boolean")
VSM_ESS_PedSwtReq = AUTOSAR4.Signal(SwCalibrationAccess="ReadOnly", StorageClass="Global", MemorySection="VAR", DataType="boolean")
VSM_ESS_VehSwtReq = AUTOSAR4.Signal(SwCalibrationAccess="ReadOnly", StorageClass="Global", MemorySection="VAR", DataType="boolean")
VSM_ESS_Sensor_idle2error = AUTOSAR4.Signal(SwCalibrationAccess="ReadOnly", StorageClass="Global", MemorySection="VAR", DataType="boolean")
VSM_ESS_IDLE2READY = AUTOSAR4.Signal(SwCalibrationAccess="ReadOnly", StorageClass="Global", MemorySection="VAR", DataType="boolean")
VSM_ESS_READY2IDLE = AUTOSAR4.Signal(SwCalibrationAccess="ReadOnly", StorageClass="Global", MemorySection="VAR", DataType="boolean")
VSM_ESS_READY2ACTIVE = AUTOSAR4.Signal(SwCalibrationAccess="ReadOnly", StorageClass="Global", MemorySection="VAR", DataType="boolean")
VSM_ESS_ACTIVE2IDLE = AUTOSAR4.Signal(SwCalibrationAccess="ReadOnly", StorageClass="Global", MemorySection="VAR", DataType="boolean")
VSM_ESS_L_ACTIVE2READY = AUTOSAR4.Signal(SwCalibrationAccess="ReadOnly", StorageClass="Global", MemorySection="VAR", DataType="boolean")
VSM_ESS_R_ACTIVE2READY = AUTOSAR4.Signal(SwCalibrationAccess="ReadOnly", StorageClass="Global", MemorySection="VAR", DataType="boolean")
VSM_ESS_Left_READY2ACTIVE = AUTOSAR4.Signal(SwCalibrationAccess="ReadOnly", StorageClass="Global", MemorySection="VAR", DataType="boolean")
VSM_ESS_Right_READY2ACTIVE = AUTOSAR4.Signal(SwCalibrationAccess="ReadOnly", StorageClass="Global", MemorySection="VAR", DataType="boolean")
VSM_ESSState = AUTOSAR4.Signal(SwCalibrationAccess="ReadOnly", StorageClass="Global", MemorySection="VAR", DataType="uint8")
VSM_ESS_LastPoint = AUTOSAR4.Signal(SwCalibrationAccess="ReadOnly", StorageClass="Global", MemorySection="VAR", DataType="single")
VSM_ESS_DPC_L_Active2Ready = AUTOSAR4.Signal(SwCalibrationAccess="ReadOnly", StorageClass="Global", MemorySection="VAR", DataType="boolean")
VSM_ESS_L_Oncoming_Active2Ready = AUTOSAR4.Signal(SwCalibrationAccess="ReadOnly", StorageClass="Global", MemorySection="VAR", DataType="boolean")
VSM_ESS_L_Active2Ready = AUTOSAR4.Signal(SwCalibrationAccess="ReadOnly", StorageClass="Global", MemorySection="VAR", DataType="boolean")
VSM_ESS_LValid_Active2Ready = AUTOSAR4.Signal(SwCalibrationAccess="ReadOnly", StorageClass="Global", MemorySection="VAR", DataType="boolean")
VSM_ESS_DPC_R_Active2Ready = AUTOSAR4.Signal(SwCalibrationAccess="ReadOnly", StorageClass="Global", MemorySection="VAR", DataType="boolean")
VSM_ESS_R_Oncoming_Active2Ready = AUTOSAR4.Signal(SwCalibrationAccess="ReadOnly", StorageClass="Global", MemorySection="VAR", DataType="boolean")
VSM_ESS_R_Active2Ready = AUTOSAR4.Signal(SwCalibrationAccess="ReadOnly", StorageClass="Global", MemorySection="VAR", DataType="boolean")
VSM_ESS_RValid_Active2Ready = AUTOSAR4.Signal(SwCalibrationAccess="ReadOnly", StorageClass="Global", MemorySection="VAR", DataType="boolean")
VSM_ESS_Obj_Active2Ready = AUTOSAR4.Signal(SwCalibrationAccess="ReadOnly", StorageClass="Global", MemorySection="VAR", DataType="boolean")
VSM_ESS_LineRValid_Ready2Active = AUTOSAR4.Signal(SwCalibrationAccess="ReadOnly", StorageClass="Global", MemorySection="VAR", DataType="boolean")
VSM_ESS_R_SteerWheelSpdSign_Ready2Active = AUTOSAR4.Signal(SwCalibrationAccess="ReadOnly", StorageClass="Global", MemorySection="VAR", DataType="boolean")
VSM_ESS_LineLValid_Ready2Active = AUTOSAR4.Signal(SwCalibrationAccess="ReadOnly", StorageClass="Global", MemorySection="VAR", DataType="boolean")
VSM_ESS_L_SteerWheelSpdSign_Ready2Active = AUTOSAR4.Signal(SwCalibrationAccess="ReadOnly", StorageClass="Global", MemorySection="VAR", DataType="boolean")
VSM_ESS_VehicleSpd_IDLE2READY = AUTOSAR4.Signal(SwCalibrationAccess="ReadOnly", StorageClass="Global", MemorySection="VAR", DataType="boolean")
VSM_ESS_ESPFuncOffSts_IDLE2READY = AUTOSAR4.Signal(SwCalibrationAccess="ReadOnly", StorageClass="Global", MemorySection="VAR", DataType="boolean")
VSM_ESS_DoorSts_IDLE2READY = AUTOSAR4.Signal(SwCalibrationAccess="ReadOnly", StorageClass="Global", MemorySection="VAR", DataType="boolean")
VSM_ESS_DrvSBR_IDLE2READY = AUTOSAR4.Signal(SwCalibrationAccess="ReadOnly", StorageClass="Global", MemorySection="VAR", DataType="boolean")
VSM_ESS_TrailerSts_IDLE2READY = AUTOSAR4.Signal(SwCalibrationAccess="ReadOnly", StorageClass="Global", MemorySection="VAR", DataType="boolean")
VSM_ESS_WiprReq_IDLE2READY = AUTOSAR4.Signal(SwCalibrationAccess="ReadOnly", StorageClass="Global", MemorySection="VAR", DataType="boolean")
VSM_ESS_HiLoBeam_IDLE2READY = AUTOSAR4.Signal(SwCalibrationAccess="ReadOnly", StorageClass="Global", MemorySection="VAR", DataType="boolean")
VSM_ESS_ESPActive_IDLE2READY = AUTOSAR4.Signal(SwCalibrationAccess="ReadOnly", StorageClass="Global", MemorySection="VAR", DataType="boolean")
VSM_ESS_LateralAccel_IDLE2READY = AUTOSAR4.Signal(SwCalibrationAccess="ReadOnly", StorageClass="Global", MemorySection="VAR", DataType="boolean")
VSM_ESS_VehicleSpd_READY2IDLE = AUTOSAR4.Signal(SwCalibrationAccess="ReadOnly", StorageClass="Global", MemorySection="VAR", DataType="boolean")
VSM_ESS_ESPFuncOffSts_READY2IDLE = AUTOSAR4.Signal(SwCalibrationAccess="ReadOnly", StorageClass="Global", MemorySection="VAR", DataType="boolean")
VSM_ESS_DoorSts_READY2IDLE = AUTOSAR4.Signal(SwCalibrationAccess="ReadOnly", StorageClass="Global", MemorySection="VAR", DataType="boolean")
VSM_ESS_DrvSBR_READY2IDLE = AUTOSAR4.Signal(SwCalibrationAccess="ReadOnly", StorageClass="Global", MemorySection="VAR", DataType="boolean")
VSM_ESS_TrailerSts_READY2IDLE = AUTOSAR4.Signal(SwCalibrationAccess="ReadOnly", StorageClass="Global", MemorySection="VAR", DataType="boolean")
VSM_ESS_WiprReq_READY2IDLE = AUTOSAR4.Signal(SwCalibrationAccess="ReadOnly", StorageClass="Global", MemorySection="VAR", DataType="boolean")
VSM_ESS_HiLoBeam_READY2IDLE = AUTOSAR4.Signal(SwCalibrationAccess="ReadOnly", StorageClass="Global", MemorySection="VAR", DataType="boolean")
VSM_ESS_ESPActive_READY2IDLE = AUTOSAR4.Signal(SwCalibrationAccess="ReadOnly", StorageClass="Global", MemorySection="VAR", DataType="boolean")
VSM_ESS_LateralAccel_READY2IDLE = AUTOSAR4.Signal(SwCalibrationAccess="ReadOnly", StorageClass="Global", MemorySection="VAR", DataType="boolean")
VSM_ESS_FcwFlag_READY2ACTIVE = AUTOSAR4.Signal(SwCalibrationAccess="ReadOnly", StorageClass="Global", MemorySection="VAR", DataType="boolean")
VSM_ESS_AEBFlag_READY2ACTIVE = AUTOSAR4.Signal(SwCalibrationAccess="ReadOnly", StorageClass="Global", MemorySection="VAR", DataType="boolean")
VSM_ESS_DrvOver_Active2Ready = AUTOSAR4.Signal(SwCalibrationAccess="ReadOnly", StorageClass="Global", MemorySection="VAR", DataType="boolean")
VSM_ESS_LeftOncoming_Ready2Active = AUTOSAR4.Signal(SwCalibrationAccess="ReadOnly", StorageClass="Global", MemorySection="VAR", DataType="boolean")
VSM_ESS_DangerPlausLeft_Ready2Active = AUTOSAR4.Signal(SwCalibrationAccess="ReadOnly", StorageClass="Global", MemorySection="VAR", DataType="boolean")
VSM_ESS_RightOncoming_Ready2Active = AUTOSAR4.Signal(SwCalibrationAccess="ReadOnly", StorageClass="Global", MemorySection="VAR", DataType="boolean")
VSM_ESS_DangerPlausRight_Ready2Active = AUTOSAR4.Signal(SwCalibrationAccess="ReadOnly", StorageClass="Global", MemorySection="VAR", DataType="boolean")
VSM_ESS_LineA0_Active2Ready = AUTOSAR4.Signal(SwCalibrationAccess="ReadOnly", StorageClass="Global", MemorySection="VAR", DataType="boolean")
VSM_ESS_LineA1_Active2Ready = AUTOSAR4.Signal(SwCalibrationAccess="ReadOnly", StorageClass="Global", MemorySection="VAR", DataType="boolean")
VSM_ESS_VehCnfgESS = AUTOSAR4.Signal(SwCalibrationAccess="ReadOnly", StorageClass="Global", MemorySection="VAR", DataType="uint8")
VSM_ESS_MasterCylindBrakePress_ACTIVE2IDLE = AUTOSAR4.Signal(SwCalibrationAccess="ReadOnly", StorageClass="Global", MemorySection="VAR", DataType="boolean")
VSM_ESS_VehicleSpd_ACTIVE2IDLE = AUTOSAR4.Signal(SwCalibrationAccess="ReadOnly", StorageClass="Global", MemorySection="VAR", DataType="boolean")
VSM_ESS_SubModel_VERSION = AUTOSAR4.Signal(SwCalibrationAccess="ReadOnly", StorageClass="Global", MemorySection="VAR", DataType="uint32")
VSM_ESS_SubModel_Number = AUTOSAR4.Signal(SwCalibrationAccess="ReadOnly", StorageClass="Global", MemorySection="VAR", DataType="uint16")
VSM_ESScnt = AUTOSAR4.Signal(SwCalibrationAccess="ReadOnly", StorageClass="Global", MemorySection="VAR")
VSM_ESSLtime = AUTOSAR4.Signal(SwCalibrationAccess="ReadOnly", StorageClass="Global", MemorySection="VAR")
VSM_ESSRtime = AUTOSAR4.Signal(SwCalibrationAccess="ReadOnly", StorageClass="Global", MemorySection="VAR")
VSM_cnt = AUTOSAR4.Signal(SwCalibrationAccess="ReadOnly", StorageClass="Global", MemorySection="VAR")
VSM_ESS_Statecnt = AUTOSAR4.Signal(SwCalibrationAccess="ReadOnly", StorageClass="Global", MemorySection="VAR", DataType="uint16")
VSM_ESS_StateR = AUTOSAR4.Signal(SwCalibrationAccess="ReadOnly", StorageClass="Global", MemorySection="VAR", DataType="single")
VSM_ESS_StateL = AUTOSAR4.Signal(SwCalibrationAccess="ReadOnly", StorageClass="Global", MemorySection="VAR", DataType="single")
VSM_ESS_DelayReady = AUTOSAR4.Signal(SwCalibrationAccess="ReadOnly", StorageClass="Global", MemorySection="VAR")
VSM_ESS_DrvOver_Active2Ready_DiffDirc = AUTOSAR4.Signal(SwCalibrationAccess="ReadOnly", StorageClass="Global", MemorySection="VAR", DataType="boolean")
VSM_ESS_DrvOver_Active2Ready_SamDirc = AUTOSAR4.Signal(SwCalibrationAccess="ReadOnly", StorageClass="Global", MemorySection="VAR", DataType="boolean")
VSM_ESS_LineActive2Ready = AUTOSAR4.Signal(SwCalibrationAccess="ReadOnly", StorageClass="Global", MemorySection="VAR", DataType="boolean")
VSM_ESS_NormalOutActive2Ready = AUTOSAR4.Signal(SwCalibrationAccess="ReadOnly", StorageClass="Global", MemorySection="VAR", DataType="boolean")
VSM_ESS_AccelPed_ACTIVE2READY = AUTOSAR4.Signal(SwCalibrationAccess="ReadOnly", StorageClass="Global", MemorySection="VAR", DataType="boolean")
VSM_ESS_Dia = AUTOSAR4.Signal(SwCalibrationAccess="ReadOnly", StorageClass="Global", MemorySection="VAR")
VSM_HMI_SubModel_VERSION = AUTOSAR4.Signal(SwCalibrationAccess="ReadOnly", StorageClass="Global", MemorySection="VAR")
VSM_HMI_SubModel_Number = AUTOSAR4.Signal(SwCalibrationAccess="ReadOnly", StorageClass="Global", MemorySection="VAR")
VSM_ACC_ModeDisp = AUTOSAR4.Signal(SwCalibrationAccess="ReadOnly", StorageClass="Global", MemorySection="VAR")
VSM_ACCTextDisp = AUTOSAR4.Signal(SwCalibrationAccess="ReadOnly", StorageClass="Global", MemorySection="VAR")
VSM_ACC_HazActv = AUTOSAR4.Signal(SwCalibrationAccess="ReadOnly", StorageClass="Global", MemorySection="VAR")
VSM_TJATextDisp = AUTOSAR4.Signal(SwCalibrationAccess="ReadOnly", StorageClass="Global", MemorySection="VAR")
VSM_HWA_ModeDisp = AUTOSAR4.Signal(SwCalibrationAccess="ReadOnly", StorageClass="Global", MemorySection="VAR")
VSM_HWATextDisp = AUTOSAR4.Signal(SwCalibrationAccess="ReadOnly", StorageClass="Global", MemorySection="VAR")
VSM_HandsOffWarningLevel = AUTOSAR4.Signal(SwCalibrationAccess="ReadOnly", StorageClass="Global", MemorySection="VAR")
VSM_HandsOffDetd = AUTOSAR4.Signal(SwCalibrationAccess="ReadOnly", StorageClass="Global", MemorySection="VAR")
VSM_HOD_DrvTrqFilted = AUTOSAR4.Signal(SwCalibrationAccess="ReadOnly", StorageClass="Global", MemorySection="VAR")
VSM_HOD_SubModel_VERSION = AUTOSAR4.Signal(SwCalibrationAccess="ReadOnly", StorageClass="Global", MemorySection="VAR", DataType="uint32")
VSM_HOD_SubModel_Number = AUTOSAR4.Signal(SwCalibrationAccess="ReadOnly", StorageClass="Global", MemorySection="VAR", DataType="uint16")
VSM_HWASlowExitCons_HighSpdIn3s = AUTOSAR4.Signal(SwCalibrationAccess="ReadOnly", StorageClass="Global", MemorySection="VAR")
VSM_HWASlowExitCons_DMSInvalid = AUTOSAR4.Signal(SwCalibrationAccess="ReadOnly", StorageClass="Global", MemorySection="VAR")
VSM_HWASlowExitCons_MapDataInvalid = AUTOSAR4.Signal(SwCalibrationAccess="ReadOnly", StorageClass="Global", MemorySection="VAR")
VSM_HWASlowExitCons_SingleLineLost = AUTOSAR4.Signal(SwCalibrationAccess="ReadOnly", StorageClass="Global", MemorySection="VAR")
VSM_HWASlowExitCons_NotHighWayArterialRoad5s = AUTOSAR4.Signal(SwCalibrationAccess="ReadOnly", StorageClass="Global", MemorySection="VAR")
VSM_HWASlowExitCons_LCKIdleWithoutTurnLight = AUTOSAR4.Signal(SwCalibrationAccess="ReadOnly", StorageClass="Global", MemorySection="VAR")
VSM_HWASlowExitConditions_b = AUTOSAR4.Signal(SwCalibrationAccess="ReadOnly", StorageClass="Global", MemorySection="VAR")
VSM_SomeHWASafeStop2ExitConditions_b = AUTOSAR4.Signal(SwCalibrationAccess="ReadOnly", StorageClass="Global", MemorySection="VAR")
VSM_HWAFastExitConditions_b = AUTOSAR4.Signal(SwCalibrationAccess="ReadOnly", StorageClass="Global", MemorySection="VAR")
VSM_HWAActivationConditions_b = AUTOSAR4.Signal(SwCalibrationAccess="ReadOnly", StorageClass="Global", MemorySection="VAR")
VSM_HWAActivationCons_TJAActive = AUTOSAR4.Signal(SwCalibrationAccess="ReadOnly", StorageClass="Global", MemorySection="VAR")
VSM_HWAActivationCons_LCKActive = AUTOSAR4.Signal(SwCalibrationAccess="ReadOnly", StorageClass="Global", MemorySection="VAR")
VSM_HWAActivationCons_HandsOn5s = AUTOSAR4.Signal(SwCalibrationAccess="ReadOnly", StorageClass="Global", MemorySection="VAR")
VSM_HWAActivationCons_DriverStsGood10s = AUTOSAR4.Signal(SwCalibrationAccess="ReadOnly", StorageClass="Global", MemorySection="VAR")
VSM_HWAActivationCons_AEBSwitchOn = AUTOSAR4.Signal(SwCalibrationAccess="ReadOnly", StorageClass="Global", MemorySection="VAR")
VSM_HWAActivationCons_HWALineValid = AUTOSAR4.Signal(SwCalibrationAccess="ReadOnly", StorageClass="Global", MemorySection="VAR")
VSM_HWAActivationCons_NoSingleLineLost = AUTOSAR4.Signal(SwCalibrationAccess="ReadOnly", StorageClass="Global", MemorySection="VAR")
VSM_HWAActivationCons_NoDoubleLineLost = AUTOSAR4.Signal(SwCalibrationAccess="ReadOnly", StorageClass="Global", MemorySection="VAR")
VSM_HWAActivationCons_HighWayArterialRoad = AUTOSAR4.Signal(SwCalibrationAccess="ReadOnly", StorageClass="Global", MemorySection="VAR")
VSM_HWAActivationCons_NoTunnel300m = AUTOSAR4.Signal(SwCalibrationAccess="ReadOnly", StorageClass="Global", MemorySection="VAR")
VSM_HWAActivationCons_NoForkRoad300m = AUTOSAR4.Signal(SwCalibrationAccess="ReadOnly", StorageClass="Global", MemorySection="VAR")
VSM_HWAActivationCons_MapDataValid = AUTOSAR4.Signal(SwCalibrationAccess="ReadOnly", StorageClass="Global", MemorySection="VAR")
VSM_HWAActivationCons_DVRNoError = AUTOSAR4.Signal(SwCalibrationAccess="ReadOnly", StorageClass="Global", MemorySection="VAR")
VSM_HWAActivationCons_NoHWANoError = AUTOSAR4.Signal(SwCalibrationAccess="ReadOnly", StorageClass="Global", MemorySection="VAR")
VSM_HWAActivationCons_NoHWASafeStopHappened_b = AUTOSAR4.Signal(SwCalibrationAccess="ReadOnly", StorageClass="Global", MemorySection="VAR")
VSM_HWAActivationCons_VehicleSpdNormal3s = AUTOSAR4.Signal(SwCalibrationAccess="ReadOnly", StorageClass="Global", MemorySection="VAR")
VSM_HWAWarningLevel = AUTOSAR4.Signal(SwCalibrationAccess="ReadOnly", StorageClass="Global", MemorySection="VAR")
VSM_HWASafeStopEn = AUTOSAR4.Signal(SwCalibrationAccess="ReadOnly", StorageClass="Global", MemorySection="VAR")
VSM_HWAFastExit_b = AUTOSAR4.Signal(SwCalibrationAccess="ReadOnly", StorageClass="Global", MemorySection="VAR")
VSM_HWASlowExit_b = AUTOSAR4.Signal(SwCalibrationAccess="ReadOnly", StorageClass="Global", MemorySection="VAR")
VSM_Diagnostic_HWAError = AUTOSAR4.Signal(SwCalibrationAccess="ReadOnly", StorageClass="Global", MemorySection="VAR")
VSM_HandsOn = AUTOSAR4.Signal(SwCalibrationAccess="ReadOnly", StorageClass="Global", MemorySection="VAR")
VSM_HandsOff = AUTOSAR4.Signal(SwCalibrationAccess="ReadOnly", StorageClass="Global", MemorySection="VAR")
VSM_HandsOffOverride = AUTOSAR4.Signal(SwCalibrationAccess="ReadOnly", StorageClass="Global", MemorySection="VAR")
VSM_HWADriveOffCondF_b = AUTOSAR4.Signal(SwCalibrationAccess="ReadOnly", StorageClass="Global", MemorySection="VAR")
VSM_HWA_LaneChangeReq = AUTOSAR4.Signal(SwCalibrationAccess="ReadOnly", StorageClass="Global", MemorySection="VAR")
VSM_HWA_Warning = AUTOSAR4.Signal(SwCalibrationAccess="ReadOnly", StorageClass="Global", MemorySection="VAR")
VSM_HWAActive = AUTOSAR4.Signal(SwCalibrationAccess="ReadOnly", StorageClass="Global", MemorySection="VAR")
VSM_HWASts = AUTOSAR4.Signal(SwCalibrationAccess="ReadOnly", StorageClass="Global", MemorySection="VAR")
VSM_HWAAccControlSts = AUTOSAR4.Signal(SwCalibrationAccess="ReadOnly", StorageClass="Global", MemorySection="VAR")
VSM_HWANOA_Mode = AUTOSAR4.Signal(SwCalibrationAccess="ReadOnly", StorageClass="Global", MemorySection="VAR")
VSM_HWA_Version = AUTOSAR4.Signal(SwCalibrationAccess="ReadOnly", StorageClass="Global", MemorySection="VAR")
VSM_HWA_StopExit = AUTOSAR4.Signal(SwCalibrationAccess="ReadOnly", StorageClass="Global", MemorySection="VAR")
VSM_HWASlowExitCons_ACCError = AUTOSAR4.Signal(SwCalibrationAccess="ReadOnly", StorageClass="Global", MemorySection="VAR")
VSM_HWAFastExitCons_DVRError = AUTOSAR4.Signal(SwCalibrationAccess="ReadOnly", StorageClass="Global", MemorySection="VAR")
VSM_Diagnostic_TJAError = AUTOSAR4.Signal(SwCalibrationAccess="ReadOnly", StorageClass="Global", MemorySection="VAR")
VSM_HWAActivationCons_NoHWAFastExitConditions_b = AUTOSAR4.Signal(SwCalibrationAccess="ReadOnly", StorageClass="Global", MemorySection="VAR")
VSM_HWAFastExitCons_ACCNotActive = AUTOSAR4.Signal(SwCalibrationAccess="ReadOnly", StorageClass="Global", MemorySection="VAR")
VSM_HWAFastExitCons_HWAErrorFastExit = AUTOSAR4.Signal(SwCalibrationAccess="ReadOnly", StorageClass="Global", MemorySection="VAR")
VSM_HWASlowExitCons_TCS2Active3000ms = AUTOSAR4.Signal(SwCalibrationAccess="ReadOnly", StorageClass="Global", MemorySection="VAR")
VSM_HWAFastExitCons_OverrideTimeout = AUTOSAR4.Signal(SwCalibrationAccess="ReadOnly", StorageClass="Global", MemorySection="VAR")
VSM_HWAFastExitCons_ParkGearOrEPBActive = AUTOSAR4.Signal(SwCalibrationAccess="ReadOnly", StorageClass="Global", MemorySection="VAR")
VSM_HWAFastExitCons_SpeedTooHighWithOverride = AUTOSAR4.Signal(SwCalibrationAccess="ReadOnly", StorageClass="Global", MemorySection="VAR")
VSM_HWASlowExitCons_ABSActive400ms = AUTOSAR4.Signal(SwCalibrationAccess="ReadOnly", StorageClass="Global", MemorySection="VAR")
VSM_HWASlowExitCons_AEBOff = AUTOSAR4.Signal(SwCalibrationAccess="ReadOnly", StorageClass="Global", MemorySection="VAR")
VSM_HWASlowExitCons_AEBTrigger = AUTOSAR4.Signal(SwCalibrationAccess="ReadOnly", StorageClass="Global", MemorySection="VAR")
VSM_HWASlowExitCons_EPBClosed = AUTOSAR4.Signal(SwCalibrationAccess="ReadOnly", StorageClass="Global", MemorySection="VAR")
VSM_HWASlowExitCons_ESPOff = AUTOSAR4.Signal(SwCalibrationAccess="ReadOnly", StorageClass="Global", MemorySection="VAR")
VSM_HWASlowExitCons_EspActive400ms = AUTOSAR4.Signal(SwCalibrationAccess="ReadOnly", StorageClass="Global", MemorySection="VAR")
VSM_HWASlowExitCons_HDCActive40ms = AUTOSAR4.Signal(SwCalibrationAccess="ReadOnly", StorageClass="Global", MemorySection="VAR")
VSM_HWASlowExitCons_DriverBrakeExit = AUTOSAR4.Signal(SwCalibrationAccess="ReadOnly", StorageClass="Global", MemorySection="VAR")
VSM_HWASlowExitCons_NoForwardGear = AUTOSAR4.Signal(SwCalibrationAccess="ReadOnly", StorageClass="Global", MemorySection="VAR")
VSM_HWASlowExitCons_DriverDoorOpen = AUTOSAR4.Signal(SwCalibrationAccess="ReadOnly", StorageClass="Global", MemorySection="VAR")
VSM_HWASlowExitCons_HandsoffOverride = AUTOSAR4.Signal(SwCalibrationAccess="ReadOnly", StorageClass="Global", MemorySection="VAR")
VSM_HWASlowExitCons_MSRActive400ms = AUTOSAR4.Signal(SwCalibrationAccess="ReadOnly", StorageClass="Global", MemorySection="VAR")
VSM_HWASlowExitCons_TCS1Active3000ms = AUTOSAR4.Signal(SwCalibrationAccess="ReadOnly", StorageClass="Global", MemorySection="VAR")
VSM_HWAFastExitCons_StandstillTimeout = AUTOSAR4.Signal(SwCalibrationAccess="ReadOnly", StorageClass="Global", MemorySection="VAR")
VSM_HWASlowExitCons_MSRActive800ms = AUTOSAR4.Signal(SwCalibrationAccess="ReadOnly", StorageClass="Global", MemorySection="VAR")
VSM_HWASlowExitCons_HWAError_Inhibit = AUTOSAR4.Signal(SwCalibrationAccess="ReadOnly", StorageClass="Global", MemorySection="VAR")
VSM_HWASlowExitCons_HWAError_Error = AUTOSAR4.Signal(SwCalibrationAccess="ReadOnly", StorageClass="Global", MemorySection="VAR")
VSM_HWASlowExitCons_HWAError_ErrorBlindness = AUTOSAR4.Signal(SwCalibrationAccess="ReadOnly", StorageClass="Global", MemorySection="VAR")
VSM_HWA_ParkShiftReq = AUTOSAR4.Signal(SwCalibrationAccess="ReadOnly", StorageClass="Global", MemorySection="VAR")
VSM_HWAFastExitCons_DriverSBR = AUTOSAR4.Signal(SwCalibrationAccess="ReadOnly", StorageClass="Global", MemorySection="VAR")
VSM_HWA_TJA_SubModel_VERSION = AUTOSAR4.Signal(SwCalibrationAccess="ReadOnly", StorageClass="Global", MemorySection="VAR", DataType="uint32")
VSM_HWA_TJA_SubModel_Number = AUTOSAR4.Signal(SwCalibrationAccess="ReadOnly", StorageClass="Global", MemorySection="VAR", DataType="uint16")

VSM_ISL_SLWSPLvalue = AUTOSAR4.Signal(SwCalibrationAccess="ReadOnly", StorageClass="Global", MemorySection="VAR")
VSM_ISL_SubModel_VERSION = AUTOSAR4.Signal(SwCalibrationAccess="ReadOnly", StorageClass="Global", MemorySection="VAR", DataType="uint32")
VSM_ISL_SubModel_Number = AUTOSAR4.Signal(SwCalibrationAccess="ReadOnly", StorageClass="Global", MemorySection="VAR", DataType="uint16")
VSM_ISL_Resp = AUTOSAR4.Signal(SwCalibrationAccess="ReadOnly", StorageClass="Global", MemorySection="VAR")
VSM_ISL_WorkCond = AUTOSAR4.Signal(SwCalibrationAccess="ReadOnly", StorageClass="Global", MemorySection="VAR")
VSM_ISL_TsrAutoWorkCond = AUTOSAR4.Signal(SwCalibrationAccess="ReadOnly", StorageClass="Global", MemorySection="VAR")
VSM_ISL_CurSetSpd = AUTOSAR4.Signal(SwCalibrationAccess="ReadOnly", StorageClass="Global", MemorySection="VAR")
VSM_ISL_ReqSpdDown = AUTOSAR4.Signal(SwCalibrationAccess="ReadOnly", StorageClass="Global", MemorySection="VAR")
VSM_ISL_ReqSpdUP = AUTOSAR4.Signal(SwCalibrationAccess="ReadOnly", StorageClass="Global", MemorySection="VAR")
VSM_ISL_TsrSetSpdAdjValue = AUTOSAR4.Signal(SwCalibrationAccess="ReadOnly", StorageClass="Global", MemorySection="VAR")
VSM_ISL_TsrSetSpdReqRefresh = AUTOSAR4.Signal(SwCalibrationAccess="ReadOnly", StorageClass="Global", MemorySection="VAR")
VSM_ISL_TsrAutoSetSpdAdjReq = AUTOSAR4.Signal(SwCalibrationAccess="ReadOnly", StorageClass="Global", MemorySection="VAR")
VSM_ISL_TsrManualSetSpdAdjReq = AUTOSAR4.Signal(SwCalibrationAccess="ReadOnly", StorageClass="Global", MemorySection="VAR")
VSM_ISL_AutoSetSpdReq = AUTOSAR4.Signal(SwCalibrationAccess="ReadOnly", StorageClass="Global", MemorySection="VAR")
VSM_ISL_ManualSetSpdReq = AUTOSAR4.Signal(SwCalibrationAccess="ReadOnly", StorageClass="Global", MemorySection="VAR")
VSM_ISL_SetSpdValue = AUTOSAR4.Signal(SwCalibrationAccess="ReadOnly", StorageClass="Global", MemorySection="VAR")
VSM_ISL_SetSpdReqRefresh = AUTOSAR4.Signal(SwCalibrationAccess="ReadOnly", StorageClass="Global", MemorySection="VAR")
VSM_ISL_ReqConfirmed = AUTOSAR4.Signal(SwCalibrationAccess="ReadOnly", StorageClass="Global", MemorySection="VAR")
VSM_ISL_Deactivation = AUTOSAR4.Signal(SwCalibrationAccess="ReadOnly", StorageClass="Global", MemorySection="VAR")
VSM_ISL_TakeoverReqCancel = AUTOSAR4.Signal(SwCalibrationAccess="ReadOnly", StorageClass="Global", MemorySection="VAR")
VSM_ISL_ReqSetSpdAdjCancel = AUTOSAR4.Signal(SwCalibrationAccess="ReadOnly", StorageClass="Global", MemorySection="VAR")
VSM_ISL_TakeoverReq = AUTOSAR4.Signal(SwCalibrationAccess="ReadOnly", StorageClass="Global", MemorySection="VAR")
VSM_ISL_ISLActive = AUTOSAR4.Signal(SwCalibrationAccess="ReadOnly", StorageClass="Global", MemorySection="VAR")
VSM_ISL_SetSpdAdjReq = AUTOSAR4.Signal(SwCalibrationAccess="ReadOnly", StorageClass="Global", MemorySection="VAR")
VSM_ISL_SetSpdAdjVal = AUTOSAR4.Signal(SwCalibrationAccess="ReadOnly", StorageClass="Global", MemorySection="VAR")
VSM_ISL_SetSwtNoEffect = AUTOSAR4.Signal(SwCalibrationAccess="ReadOnly", StorageClass="Global", MemorySection="VAR")
VSM_ISL_InterSysInfoDisp = AUTOSAR4.Signal(SwCalibrationAccess="ReadOnly", StorageClass="Global", MemorySection="VAR")
VSM_ISL_SM_Sts = AUTOSAR4.Signal(SwCalibrationAccess="ReadOnly", StorageClass="Global", MemorySection="VAR")
VSM_SCM_FRWhel2LeftLineDy = AUTOSAR4.Signal(SwCalibrationAccess="ReadOnly", StorageClass="Global", MemorySection="VAR")
VSM_SCM_FLWhel2RiLineDy = AUTOSAR4.Signal(SwCalibrationAccess="ReadOnly", StorageClass="Global", MemorySection="VAR")
VSM_SCM_CenterLineA0 = AUTOSAR4.Signal(SwCalibrationAccess="ReadOnly", StorageClass="Global", MemorySection="VAR")
VSM_SCM_CenterLineA1 = AUTOSAR4.Signal(SwCalibrationAccess="ReadOnly", StorageClass="Global", MemorySection="VAR")
VSM_SCM_CenterLineA2 = AUTOSAR4.Signal(SwCalibrationAccess="ReadOnly", StorageClass="Global", MemorySection="VAR")
VSM_SCM_CenterLineA3 = AUTOSAR4.Signal(SwCalibrationAccess="ReadOnly", StorageClass="Global", MemorySection="VAR")
VSM_SCM_CenterLineRange = AUTOSAR4.Signal(SwCalibrationAccess="ReadOnly", StorageClass="Global", MemorySection="VAR")
VSM_SCM_CenterLineValid = AUTOSAR4.Signal(SwCalibrationAccess="ReadOnly", StorageClass="Global", MemorySection="VAR")
VSM_SCM_CenterLaneWidth = AUTOSAR4.Signal(SwCalibrationAccess="ReadOnly", StorageClass="Global", MemorySection="VAR")
VSM_SCM_HeadingAngleInFlag_b = AUTOSAR4.Signal(SwCalibrationAccess="ReadOnly", StorageClass="Global", MemorySection="VAR")
VSM_SCM_HeadingAngleOutFlag_b = AUTOSAR4.Signal(SwCalibrationAccess="ReadOnly", StorageClass="Global", MemorySection="VAR")
VSM_ACC_SpdSetValue = AUTOSAR4.Signal(SwCalibrationAccess="ReadOnly", StorageClass="Global", MemorySection="VAR")
VSM_ACC_VsetBelowMin = AUTOSAR4.Signal(SwCalibrationAccess="ReadOnly", StorageClass="Global", MemorySection="VAR")
VSM_ACC_TimeGapSet_RESERVE = AUTOSAR4.Signal(SwCalibrationAccess="ReadOnly", StorageClass="Global", MemorySection="VAR")
VSM_SetSpd_SubModel_Number = AUTOSAR4.Signal(SwCalibrationAccess="ReadOnly", StorageClass="Global", MemorySection="VAR")
VSM_SetSpd_SubModel_VERSION = AUTOSAR4.Signal(SwCalibrationAccess="ReadOnly", StorageClass="Global", MemorySection="VAR")
VSM_ACC_TimeGapInit_IN = AUTOSAR4.Signal(SwCalibrationAccess="ReadOnly", StorageClass="Global", MemorySection="VAR")
VSM_ACC_TimeGapSetHMI = AUTOSAR4.Signal(SwCalibrationAccess="ReadOnly", StorageClass="Global", MemorySection="VAR")
VSM_ACC_SetSpeedNoUnit = AUTOSAR4.Signal(SwCalibrationAccess="ReadOnly", StorageClass="Global", MemorySection="VAR")
VSM_ACC_SetSpeedKmHNoRateLim = AUTOSAR4.Signal(SwCalibrationAccess="ReadOnly", StorageClass="Global", MemorySection="VAR")
VSM_TarLineValid = AUTOSAR4.Signal(SwCalibrationAccess="ReadOnly", StorageClass="Global", MemorySection="VAR", DataType="boolean")
VSM_TarLineC3 = AUTOSAR4.Signal(SwCalibrationAccess="ReadOnly", StorageClass="Global", MemorySection="VAR", DataType="single")
VSM_TarLineC2 = AUTOSAR4.Signal(SwCalibrationAccess="ReadOnly", StorageClass="Global", MemorySection="VAR", DataType="single")
VSM_TarLineC1 = AUTOSAR4.Signal(SwCalibrationAccess="ReadOnly", StorageClass="Global", MemorySection="VAR", DataType="single")
VSM_TarLineC0 = AUTOSAR4.Signal(SwCalibrationAccess="ReadOnly", StorageClass="Global", MemorySection="VAR", DataType="single")
VSM_TarLineRange = AUTOSAR4.Signal(SwCalibrationAccess="ReadOnly", StorageClass="Global", MemorySection="VAR", DataType="single")
VSM_ELKLaneA3 = AUTOSAR4.Signal(SwCalibrationAccess="ReadOnly", StorageClass="Global", MemorySection="VAR", DataType="single")
VSM_ELKLaneA2 = AUTOSAR4.Signal(SwCalibrationAccess="ReadOnly", StorageClass="Global", MemorySection="VAR", DataType="single")
VSM_ELKLaneA1 = AUTOSAR4.Signal(SwCalibrationAccess="ReadOnly", StorageClass="Global", MemorySection="VAR", DataType="single")
VSM_ELKLaneA0 = AUTOSAR4.Signal(SwCalibrationAccess="ReadOnly", StorageClass="Global", MemorySection="VAR", DataType="single")
VSM_ELKLaneRange = AUTOSAR4.Signal(SwCalibrationAccess="ReadOnly", StorageClass="Global", MemorySection="VAR", DataType="single")
VSM_LKALaneA3 = AUTOSAR4.Signal(SwCalibrationAccess="ReadOnly", StorageClass="Global", MemorySection="VAR", DataType="single")
VSM_LKALaneA2 = AUTOSAR4.Signal(SwCalibrationAccess="ReadOnly", StorageClass="Global", MemorySection="VAR", DataType="single")
VSM_LKALaneA1 = AUTOSAR4.Signal(SwCalibrationAccess="ReadOnly", StorageClass="Global", MemorySection="VAR", DataType="single")
VSM_LKALaneA0 = AUTOSAR4.Signal(SwCalibrationAccess="ReadOnly", StorageClass="Global", MemorySection="VAR", DataType="single")
VSM_LKALaneRange = AUTOSAR4.Signal(SwCalibrationAccess="ReadOnly", StorageClass="Global", MemorySection="VAR", DataType="single")
VSM_ELKLaneValid = AUTOSAR4.Signal(SwCalibrationAccess="ReadOnly", StorageClass="Global", MemorySection="VAR", DataType="boolean")
VSM_LKALaneValid = AUTOSAR4.Signal(SwCalibrationAccess="ReadOnly", StorageClass="Global", MemorySection="VAR", DataType="boolean")
VSM_TarDangerLevel = AUTOSAR4.Signal(SwCalibrationAccess="ReadOnly", StorageClass="Global", MemorySection="VAR", DataType="uint8")
VSM_TLS_SubModel_VERSION = AUTOSAR4.Signal(SwCalibrationAccess="ReadOnly", StorageClass="Global", MemorySection="VAR")
VSM_TLS_SubModel_Number = AUTOSAR4.Signal(SwCalibrationAccess="ReadOnly", StorageClass="Global", MemorySection="VAR")
VSM_TSR_TS_Suppress = AUTOSAR4.Signal(SwCalibrationAccess="ReadOnly", StorageClass="Global", MemorySection="VAR", DataType="boolean")
VSM_TSR_SPL_whSupp_Value_Req = AUTOSAR4.Signal(SwCalibrationAccess="ReadOnly", StorageClass="Global", MemorySection="VAR", DataType="uint8")
VSM_TSR_SPL_whSupp_Value = AUTOSAR4.Signal(SwCalibrationAccess="ReadOnly", StorageClass="Global", MemorySection="VAR", DataType="uint8")
VSM_TSR_SPL_whSupp_EnableReq = AUTOSAR4.Signal(SwCalibrationAccess="ReadOnly", StorageClass="Global", MemorySection="VAR", DataType="boolean")
VSM_TSR_SPL_whSupp_Dist_Req = AUTOSAR4.Signal(SwCalibrationAccess="ReadOnly", StorageClass="Global", MemorySection="VAR", DataType="single")
VSM_TSR_SPL_noSupp_Value_Req = AUTOSAR4.Signal(SwCalibrationAccess="ReadOnly", StorageClass="Global", MemorySection="VAR", DataType="uint8")
VSM_TSR_SPL_noSupp_Value = AUTOSAR4.Signal(SwCalibrationAccess="ReadOnly", StorageClass="Global", MemorySection="VAR", DataType="uint8")
VSM_TSR_SPL_noSupp_EnableReq = AUTOSAR4.Signal(SwCalibrationAccess="ReadOnly", StorageClass="Global", MemorySection="VAR", DataType="boolean")
VSM_TSR_SPL_noSupp_Dist_Req = AUTOSAR4.Signal(SwCalibrationAccess="ReadOnly", StorageClass="Global", MemorySection="VAR", DataType="single")
VSM_TSR_SPL_EndDist_Req = AUTOSAR4.Signal(SwCalibrationAccess="ReadOnly", StorageClass="Global", MemorySection="VAR", DataType="single")
VSM_TSR_SPL_End_Req = AUTOSAR4.Signal(SwCalibrationAccess="ReadOnly", StorageClass="Global", MemorySection="VAR", DataType="boolean")
VSM_TSR_SPL_Constancy_Req = AUTOSAR4.Signal(SwCalibrationAccess="ReadOnly", StorageClass="Global", MemorySection="VAR", DataType="uint8")
VSM_TSR_SLW_Suppress = AUTOSAR4.Signal(SwCalibrationAccess="ReadOnly", StorageClass="Global", MemorySection="VAR", DataType="boolean")
VSM_TSR_SLIF_Suppress = AUTOSAR4.Signal(SwCalibrationAccess="ReadOnly", StorageClass="Global", MemorySection="VAR", DataType="boolean")
VSM_TSR_SLIF_LaneChange = AUTOSAR4.Signal(SwCalibrationAccess="ReadOnly", StorageClass="Global", MemorySection="VAR", DataType="boolean")
VSM_TSR_SubModel_VERSION = AUTOSAR4.Signal(SwCalibrationAccess="ReadOnly", StorageClass="Global", MemorySection="VAR", DataType="uint32")
VSM_TSR_SubModel_Number = AUTOSAR4.Signal(SwCalibrationAccess="ReadOnly", StorageClass="Global", MemorySection="VAR", DataType="uint16")
VSM_TSR_communicationTest = AUTOSAR4.Signal(SwCalibrationAccess="ReadOnly", StorageClass="Global", MemorySection="VAR")
VSM_TJA_ACC_SelSts = AUTOSAR4.Signal(SwCalibrationAccess="ReadOnly", StorageClass="Global", MemorySection="VAR")
VSM_ACC_SWCruise = AUTOSAR4.Signal(SwCalibrationAccess="ReadOnly", StorageClass="Global", MemorySection="VAR")
VSM_ACC_SWEngState = AUTOSAR4.Signal(SwCalibrationAccess="ReadOnly", StorageClass="Global", MemorySection="VAR")
VSM_ACC_SWSet = AUTOSAR4.Signal(SwCalibrationAccess="ReadOnly", StorageClass="Global", MemorySection="VAR")
VSM_ACC_SWRes = AUTOSAR4.Signal(SwCalibrationAccess="ReadOnly", StorageClass="Global", MemorySection="VAR")
VSM_UOM_SubModel_VERSION = AUTOSAR4.Signal(SwCalibrationAccess="ReadOnly", StorageClass="Global", MemorySection="VAR", DataType="uint32")
VSM_UOM_SubModel_Number = AUTOSAR4.Signal(SwCalibrationAccess="ReadOnly", StorageClass="Global", MemorySection="VAR", DataType="uint16")
P_VSM_LCKIE_State_LaneWidth_enable = AUTOSAR4.Parameter(1, SwCalibrationAccess="ReadWrite", StorageClass="Global", MemorySection="CAL", DataType="single")
P_VSM_LKA_State_Eps_enable = AUTOSAR4.Parameter(1, SwCalibrationAccess="ReadWrite", StorageClass="Global", MemorySection="CAL", DataType="single")
P_VSM_ELK_Sensitive_Table = AUTOSAR4.Parameter([0 1 2], SwCalibrationAccess="ReadWrite", StorageClass="Global", MemorySection="CAL", DataType="single")
P_VSM_LKA_State_Param_WarnTime_s = AUTOSAR4.Parameter(20, SwCalibrationAccess="ReadWrite", StorageClass="Global", MemorySection="CAL", DataType="single")
M_TOS_LCKIE = AUTOSAR4.Signal(SwCalibrationAccess="ReadOnly", StorageClass="Global", MemorySection="VAR")
P_VSM_ACCSOS_SW = AUTOSAR4.Parameter(0, SwCalibrationAccess="ReadWrite", StorageClass="Global", MemorySection="CAL", DataType="boolean")
P_VSM_LCK_C0 = AUTOSAR4.Parameter(0.75, SwCalibrationAccess="ReadWrite", StorageClass="Global", MemorySection="CAL", DataType="single")
P_VSM_TSR_Dis_keep_SPL_Table = AUTOSAR4.Parameter(uint16([250 250 250 250 400 400 400 400 800 800 1200 1200 1500 1500 1500 1500]), SwCalibrationAccess="ReadWrite", StorageClass="Global", MemorySection="CAL")